# Grasshopper definition 2HoudiniFX.gh (Grasshopper 1.0.8)
# plug-ins: MeshEdit Components

mesh = Mesh(<mesh referenced from the Rhino model>)
mesh_flip = MeshFlip(Mesh=mesh)
deconstruct_mesh = DeconstructMesh(Mesh=mesh_flip)  # -> Vertices, Faces, Colours, Normals
panel = Panel(deconstruct_mesh.Vertices)
panel_2 = Panel(deconstruct_mesh.Faces)
replace_text = ReplaceText(Text=panel_2, Find="Q{", RecursiveReplace=False)
replace_text_2 = ReplaceText(Text=panel, Find="{", RecursiveReplace=False)
replace_text_3 = ReplaceText(Text=replace_text, Find="}", RecursiveReplace=False)
replace_text_4 = ReplaceText(Text=replace_text_3, Find=";", Replace=" ", RecursiveReplace=False)
replace_text_5 = ReplaceText(Text=replace_text_2, Find="}", RecursiveReplace=False)
list_length = ListLength(List=panel_2)
list_length_2 = ListLength(List=panel)
replace_text_6 = ReplaceText(Text=replace_text_4, Find=" ", RecursiveReplace=False)
replace_text_7 = ReplaceText(Text=replace_text_5, Find=",", RecursiveReplace=False)
text_length = TextLength(Text=replace_text_6)
panel_3 = Panel(replace_text_4)
concatenate = Concatenate(Fragment_A="Run ", Fragment_B=list_length, A=" Poly")
panel_4 = Panel("PGEOMETRY V5")
concatenate_2 = Concatenate(FragmentA=replace_text_7, FragmentB=" 1")
concatenate_3 = Concatenate(FragmentA="NPrims ", FragmentB=list_length)
concatenate_4 = Concatenate(Fragment_A="NPoints ", Fragment_B=list_length_2, A=" ")
concatenate_5 = Concatenate(Fragment_A="4", Fragment_B=" < ", A=replace_text_4)
panel_5 = Panel("""beginExtra
endExtra""")
panel_6 = Panel(concatenate_2)
text_join = TextJoin(Text=[concatenate_4, concatenate_3])
entwine = Entwine(
    Branch00="PGEOMETRY V5",
    Branch01=text_join,
    Branch02="NPointGroups 0 NPrimGroups 0",
    Branch03="NPointAttrib 0 NVertexAttrib 0 NPrimAttrib 0 NAttrib 0",
    Branch04=concatenate_2,
    Branch05=concatenate,
    Branch06=concatenate_5,
    Branch07=panel_5,
    FlattenInputs=True)  # -> flatten(Result)
# PGEOMETRY V5
# NPoints 32 NPrims 24
# NPointGroups 0 NPrimGroups 0
# NPointAttrib 0 NVertexAttrib 0 NPrimAttrib 0 NAttrib 0
# 0.5 -0.5 0.5 1
# -0.5 -0.5 0.5 1
# 0.5 0.5 0.5 1
# -0.5 0.5 0.5 1
# -0.5 -0.5 -0.5 1
# 0.5 -0.5 -0.5 1
# -0.5 0.5 -0.5 1
# 0.5 0.5 -0.5 1
# 4.25 -0.25 0.25 1
# 3.75 -0.25 0.25 1
# 4.25 0.25 0.25 1
# 3.75 0.25 0.25 1
# 3.75 -0.25 -0.25 1
# 4.25 -0.25 -0.25 1
# 3.75 0.25 -0.25 1
# 4.25 0.25 -0.25 1
# 8.125 -0.125 0.125 1
# 7.875 -0.125 0.125 1
# 8.125 0.125 0.125 1
# 7.875 0.125 0.125 1
# 7.875 -0.125 -0.125 1
# 8.125 -0.125 -0.125 1
# 7.875 0.125 -0.125 1
# 8.125 0.125 -0.125 1
# 12.0625 -0.0625 0.0625 1
# 11.9375 -0.0625 0.0625 1
# 12.0625 0.0625 0.0625 1
# 11.9375 0.0625 0.0625 1
# 11.9375 -0.0625 -0.0625 1
# 12.0625 -0.0625 -0.0625 1
# 11.9375 0.0625 -0.0625 1
# 12.0625 0.0625 -0.0625 1
# Run 24 Poly
#  4 < 0 1 3 2
#  4 < 4 5 7 6
#  4 < 6 7 2 3
#  4 < 5 4 1 0
#  4 < 5 0 2 7
#  4 < 1 4 6 3
#  4 < 8 9 11 10
#  4 < 12 13 15 14
#  4 < 14 15 10 11
#  4 < 13 12 9 8
#  4 < 13 8 10 15
#  4 < 9 12 14 11
#  4 < 16 17 19 18
#  4 < 20 21 23 22
#  4 < 22 23 18 19
#  4 < 21 20 17 16
#  4 < 21 16 18 23
#  4 < 17 20 22 19
#  4 < 24 25 27 26
#  4 < 28 29 31 30
#  4 < 30 31 26 27
#  4 < 29 28 25 24
#  4 < 29 24 26 31
#  4 < 25 28 30 27
# beginExtra
# endExtra
panel_7 = Panel(entwine)
