# Grasshopper definition test.gh (Grasshopper 1.0.8)
# plug-ins: RhinoCodePluginGH

file_path = FilePath("D:\_MAIN\Architectural Templates\UAP-Plugins\02_GH\2HoudiniFX\test.hip")
read_file = ReadFile(File=file_path, PerLineParse=True)
list_item = ListItem(List=read_file, Index="1041", Wrap=True)
cull_index = CullIndex(List=read_file, Indices="1041", Wrap=True)
replace_text = ReplaceText(Text=list_item, Find="ABCDEFGHIJKLMNOPQRSTUVWXYZ", Replace="$HIP/test.stl", RecursiveReplace=False)
read_file_2 = ReadFile(PerLineParse=True)
insert_items = InsertItems(List=cull_index, Item=replace_text, Indices="1041", Wrap=True)
panel = Panel(read_file)
text_join = TextJoin(Text=insert_items)  # disabled
c_script = CSharpScript(filepath="C:\Users\Clark Cheng\Desktop\test.hip", content=text_join)  # -> out, a; inputs filepath: String, content: String; disabled
# ---------- c_script: C# ----------
// Grasshopper Script Instance
#region Usings
using System;
using System.Linq;
using System.Collections;
using System.Collections.Generic;
using System.Drawing;

using Rhino;
using Rhino.Geometry;

using Grasshopper;
using Grasshopper.Kernel;
using Grasshopper.Kernel.Data;
using Grasshopper.Kernel.Types;
#endregion

public class Script_Instance : GH_ScriptInstance
{
    #region Notes
    /* 
      Members:
        RhinoDoc RhinoDocument
        GH_Document GrasshopperDocument
        IGH_Component Component
        int Iteration

      Methods (Virtual & overridable):
        Print(string text)
        Print(string format, params object[] args)
        Reflect(object obj)
        Reflect(object obj, string method_name)
    */
    #endregion

    private void RunScript(string filepath, string content, ref object a)
    {
        // Write content to the file
    System.IO.File.WriteAllText(filepath, content);
    
    // Set a confirmation message or the filepath as output
    a = "File written successfully to " + filepath;
    }
}
# ---------- end c_script ----------
panel_2 = Panel(c_script.a)
