# Grasshopper definition 3D Packing.gh (Grasshopper 1.0.8)
# plug-ins: Pufferfish, BlockTools

brep = Brep(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)
deconstruct_brep = DeconstructBrep(Brep=brep)  # -> Faces, Edges, Vertices
list_item = ListItem(List=deconstruct_brep.Vertices, Index=0, Wrap=True)  # -> Item, Item1, Item2, Item3, Item4
distance = Distance(PointA=list_item.Item1, PointB=list_item.Item4)
distance_2 = Distance(PointA=list_item.Item, PointB=list_item.Item1)
distance_3 = Distance(PointA=list_item.Item1, PointB=list_item.Item2)
mesh = Mesh([<mesh referenced from the Rhino model> x20])
rebuild_mesh = RebuildMesh(
    Mesh=mesh,
    RebuildNormals=False,
    CullUnused=False,
    UnifyNormals=False,
    FlipNormals=False,
    IdenticalCombine=False,
    WeldVertices="0.01")
bounding_box = BoundingBox(Content=rebuild_mesh, Plane=PlaneXY(0, 0, 0))  # -> Box, Box_2
c_script = CSharpScript(G=rebuild_mesh, BinW=distance, BinD=distance_3, BinH=distance_2)  # -> out, a, b, c; inputs G: list of GeometryBase, BinW: Double, BinD: Double, BinH: Double
# ---------- c_script: C# ----------
// Grasshopper Script Instance
#region Usings
using System;
#r "D:\Architectural Templates\Ptarmigan\02_GH\3D Packing\CromulentBisgetti.ContainerPacking.dll"
using System.Linq;
using System.Collections;
using System.Collections.Generic;
using System.Drawing;

using Rhino;
using Rhino.Geometry;

using Grasshopper;
using Grasshopper.Kernel;
using Grasshopper.Kernel.Data;
using Grasshopper.Kernel.Types;

using CromulentBisgetti.ContainerPacking;
using CromulentBisgetti.ContainerPacking.Entities;
using CromulentBisgetti.ContainerPacking.Algorithms;

#endregion

public class Script_Instance : GH_ScriptInstance
{
    #region Notes
    /* 
      Members:
        RhinoDoc RhinoDocument
        GH_Document GrasshopperDocument
        IGH_Component Component
        int Iteration

      Methods (Virtual & overridable):
        Print(string text)
        Print(string format, params object[] args)
        Reflect(object obj)
        Reflect(object obj, string method_name)
    */
    #endregion

    private void RunScript(
		List<GeometryBase> G,
		double BinW,
		double BinD,
		double BinH,
		ref object a,
		ref object b,
		ref object c)
    {
        // 1) Define container
        var containers = new List<Container> {
            new Container(0, (decimal)BinW, (decimal)BinD, (decimal)BinH)
        };

        // 2) Build items from your Breps' dimensions
        var items = new List<Item>();
        List<Plane> sourcePlane = new List<Plane>();
        List<Brep> sourceBoxes = new List<Brep>();

        

        for (int i = 0; i < G.Count; i++)
        {
            var bb = G[i].GetBoundingBox(true);
            double w = bb.Max.X - bb.Min.X;
            double d = bb.Max.Y - bb.Min.Y;
            double h = bb.Max.Z - bb.Min.Z;

            items.Add(new Item(i, (decimal)w, (decimal)d, (decimal)h, 1));

            // Plane at bbox min corner (for reference)
            Plane plane = new Plane(bb.Min, Vector3d.XAxis, Vector3d.YAxis);
            sourcePlane.Add(plane);

            // Convert BoundingBox → Box → Brep
            Box box = new Box(bb);
            sourceBoxes.Add(box.ToBrep());
        }

        // 3) Run EB-AFIT
        var algos = new List<int> { (int)AlgorithmType.EB_AFIT };
        var results = PackingService.Pack(containers, items, algos);

        // 4) Use only the first algorithm result for the first container
        var firstAlgo = results[0].AlgorithmPackingResults.First();

        // 5) Prepare outputs
        var transforms = new List<Transform>(new Transform[G.Count]);
        for (int i = 0; i < G.Count; i++) transforms[i] = Transform.Identity;

        var placed = new List<Brep>();

        List<Plane> targetPlane = new List<Plane>();

        foreach (var packed in firstAlgo.PackedItems)
        {
            int idx = packed.ID;

            // --- Source: from geometry's bounding box ---
            var bb = G[idx].GetBoundingBox(true);
            // Construct a plane at the bbox min corner, aligned to world axes
            Plane source = new Plane(bb.Min, Vector3d.XAxis, Vector3d.YAxis);

            // --- Target: placement plane for packed box ---
            var targetOrigin = new Point3d(
                (double)packed.CoordX,
                (double)packed.CoordY,
                (double)packed.CoordZ
            );
            Plane target = new Plane(targetOrigin, Vector3d.XAxis, Vector3d.YAxis);

            targetPlane.Add(target);

            // --- Transform from source → target (move + orient) ---
            Transform xform = Transform.PlaneToPlane(source, target);
            transforms[idx] = xform;

            // --- Debug: create box from packed dimensions at target plane ---
            var box = new Box(
                target,
                new Interval(0, (double)packed.PackDimX),
                new Interval(0, (double)packed.PackDimY),
                new Interval(0, (double)packed.PackDimZ)
            );
            placed.Add(box.ToBrep());
        }

        a = transforms; // apply these to your referenced Rhino Breps
        b = placed;     // packed boxes for verification
        c = sourceBoxes;


    }
}
# ---------- end c_script ----------
brep_2 = Brep(flatten(c_script.b))
brep_3 = Brep(flatten(c_script.c))
justarea = JustArea(Geometry=brep_2)
justarea_2 = JustArea(Geometry=brep_3)
round_to_decimal_place = RoundToDecimalPlace(NumberX=justarea, DecimalPlace="0", RoundType="1")  # -> Rounded, Difference
round_to_decimal_place_2 = RoundToDecimalPlace(NumberX=justarea_2, DecimalPlace="0", RoundType="1")  # -> Rounded, Difference
weave = Weave(Pattern=[0, 1], Stream0=brep_3, Stream1=brep_2, NullGaps=False)
sort_list = SortList(Keys=round_to_decimal_place.Rounded, ValuesValuesA=brep_2)  # -> Keys, ValuesValuesA
sort_list_2 = SortList(Keys=round_to_decimal_place_2.Rounded, ValuesA=brep_3)  # -> Keys, ValuesA
panel = Panel("""0
1""")
weave_2 = Weave(Pattern=[0, 1], Stream0=sort_list_2.ValuesA, Stream1=sort_list.ValuesValuesA, NullGaps=False)
dispatch = Dispatch(List=weave_2, DispatchPattern=panel)  # -> ListA, ListB
brep_4 = Brep(dispatch.ListB)
panel_2 = Panel(dispatch.ListA)
deconstruct_brep_2 = DeconstructBrep(Brep=dispatch.ListB)  # -> Faces, Edges, Vertices
deconstruct_brep_3 = DeconstructBrep(Brep=dispatch.ListA)  # -> Faces, Edges, Vertices
justarea_3 = JustArea(Geometry=deconstruct_brep_2.Faces)
justarea_4 = JustArea(Geometry=deconstruct_brep_3.Faces)
create_set = CreateSet(List=justarea_3)  # -> Set, Map
create_set_2 = CreateSet(List=justarea_4)  # -> Set, Map
sort_list_3 = SortList(Keys=create_set.Map, ValuesValuesA=deconstruct_brep_2.Faces)  # -> Keys, ValuesValuesA
sort_list_4 = SortList(Keys=create_set_2.Map, ValuesValuesA=deconstruct_brep_3.Faces)  # -> Keys, ValuesValuesA
partition_list = PartitionList(List=sort_list_3.ValuesValuesA, Size="2")
partition_list_2 = PartitionList(List=sort_list_4.ValuesValuesA, Size="2")
list_item_2 = ListItem(List=partition_list_2, Index=0, Wrap=True)
list_item_3 = ListItem(List=partition_list, Index=0, Wrap=True)
area = Area(Geometry=partition_list_2)  # -> Area, Centroid
area_2 = Area(Geometry=list_item_2)  # -> Area, flatten(Centroid)
area_3 = Area(Geometry=list_item_3)  # -> Area, flatten(Centroid)
polyline = PolyLine(Vertices=area.Centroid, Closed=False)
partition_list_3 = PartitionList(List=area_2.Centroid, Size="3")
partition_list_4 = PartitionList(List=area_3.Centroid, Size="3")
list_item_4 = ListItem(List=partition_list_3, Index=0, Wrap=True)  # -> Item, Item1, Item2
list_item_5 = ListItem(List=partition_list_4, Index=0, Wrap=True)  # -> Item, Item1, Item2
plane_3pt = Plane3Pt(PointA=list_item_4.Item, PointB=list_item_4.Item1, PointC=list_item_4.Item2)
plane_3pt_2 = Plane3Pt(PointA=list_item_5.Item, PointB=list_item_5.Item1, PointC=list_item_5.Item2)
orient = Orient(Geometry=brep_4, Source=flatten(plane_3pt_2), Target=flatten(plane_3pt))  # -> Geometry, Transform
list_item_6 = ListItem(List=dispatch.ListA, Index=0, Wrap=True)  # -> Item, Item1, Item2, Item3
list_item_7 = ListItem(List=orient.Geometry, Index=0, Wrap=True)  # -> Item, Item1, Item2, Item3
transform = Transform(Geometry=rebuild_mesh, Transform=orient.Transform)
