# Grasshopper definition Packing.gh (Grasshopper 1.0.8)
# plug-ins: Heron

boolean_toggle = BooleanToggle(False)
# // ============================================================================
# // Nest3D — OpenNest-style options, Rhino 8 C# Script component
# // SCRIPT-INSTANCE MODE (class form) so Component.Message works.
# //
# // In the script editor use the Script-Instance template (or Convert to
# // Script-Instance from the editor menu), then replace the whole file with this.
# //
# // INPUTS — names, order, and access must match the RunScript signature below:
# //   G    : List Access — meshes and/or breps
# //   B    : Item Access — container Box
# //   S    : Spacing between items                        (default 0)
# //   Run  : search while true, freeze best when false    (default false)
# //   Iter : total iteration budget, 0 = run until stopped (default 0)
# //   Seed : 0 = random each session, else reproducible   (default 0)
# //   Mut  : Mutation 0-100, order-noise strength in %    (default 10)
# //   Pop  : Population, packing attempts per solve       (default 5)
# //   Rot  : All Rotations true/false                     (default true)
# //   Pack : 0=Auto 1=Shelf 2=Guillotine                  (default 0)
# //   Live : show newest attempt instead of best-so-far   (default false)
# //   Reset: wire a BUTTON (not a toggle) - press to wipe best + iteration
# //          count and restart the search with the same inputs
# // OUTPUTS: N, X, C, BIN, REP
# //
# // SELF-LOOPING: no Timer/Trigger component needed. While Run is true the
# // script schedules its own next solution every ~100 ms. Flip Run off (or
# // let the Iter budget run out) and the loop stops on the best layout found.
# // ============================================================================
boolean_toggle_2 = BooleanToggle(False)
number_slider = Slider(0.07, range=0..0.1)
brep = Brep(<brep referenced from the Rhino model>)
button = Button()
mesh = Mesh([<mesh referenced from the Rhino model> x20])
c_script = CSharpScript(G=mesh, B=brep, S=number_slider, Run=boolean_toggle_2, Iter="0", Rot="true", Pack="1", Live=boolean_toggle, Reset=button)  # -> out, N, X, C, BIN, REP; inputs G: list
# ---------- c_script: C# ----------
// ============================================================================
// Nest3D — OpenNest-style options, Rhino 8 C# Script component
// SCRIPT-INSTANCE MODE (class form) so Component.Message works.
//
// In the script editor use the Script-Instance template (or Convert to
// Script-Instance from the editor menu), then replace the whole file with this.
//
// INPUTS — names, order, and access must match the RunScript signature below:
//   G    : List Access — meshes and/or breps
//   B    : Item Access — container Box
//   S    : Spacing between items                        (default 0)
//   Run  : search while true, freeze best when false    (default false)
//   Iter : total iteration budget, 0 = run until stopped (default 0)
//   Seed : 0 = random each session, else reproducible   (default 0)
//   Mut  : Mutation 0-100, order-noise strength in %    (default 10)
//   Pop  : Population, packing attempts per solve       (default 5)
//   Rot  : All Rotations true/false                     (default true)
//   Pack : 0=Auto 1=Shelf 2=Guillotine                  (default 0)
//   Live : show newest attempt instead of best-so-far   (default false)
//   Reset: wire a BUTTON (not a toggle) - press to wipe best + iteration
//          count and restart the search with the same inputs
// OUTPUTS: N, X, C, BIN, REP
//
// SELF-LOOPING: no Timer/Trigger component needed. While Run is true the
// script schedules its own next solution every ~100 ms. Flip Run off (or
// let the Iter budget run out) and the loop stops on the best layout found.
// ============================================================================

#r "G:\Architectural Templates\Ptarmigan\02_GH\3D Packing\Sharp3DBinPacking.dll"

using System;
using System.Collections;
using System.Collections.Generic;
using System.Linq;
using Rhino;
using Rhino.Geometry;
using Grasshopper;
using Grasshopper.Kernel;
using Grasshopper.Kernel.Types;
using Sharp3DBinPacking;
using Sharp3DBinPacking.Internal;
using Sharp3DBinPacking.Algorithms;

public class Script_Instance : GH_ScriptInstance
{
    private void RunScript(
		List<object> G,
		object B,
		object S,
		object Run,
		object Iter,
		object Seed,
		object Mut,
		object Pop,
		object Rot,
		object Pack,
		object Live,
		object Reset,
		ref object N,
		ref object X,
		ref object C,
		ref object BIN,
		ref object REP)
    {
        // ---- unwrap untyped inputs ----------------------------------------
        var geos = new List<GeometryBase>();
        if (G != null)
            foreach (var item in G) geos.Add(Unwrap(item) as GeometryBase);

        Box box = Box.Unset;
        var bRaw = Unwrap(B);
        if (bRaw is Box bx) box = bx;
        else if (bRaw is BoundingBox bb2) box = new Box(bb2);
        else if (bRaw is GeometryBase gb) box = new Box(gb.GetBoundingBox(true));

        double spacing    = Dbl(S, 0);
        bool   run        = Bul(Run, false);
        int    iterBudget = Math.Max(0, Int(Iter, 0));
        int    seed       = Int(Seed, 0);
        int    mutation   = Math.Min(100, Math.Max(0, Int(Mut, 10)));
        int    population = Math.Max(1, Int(Pop, 5));
        bool   allRot     = Bul(Rot, true);
        int    packMode   = Math.Min(2, Math.Max(0, Int(Pack, 0)));
        bool   liveView   = Bul(Live, false);
        bool   resetNow   = Bul(Reset, false);

        // Manual reset: wipe the search and start over with the same inputs
        if (resetNow)
        {
            NestOpt.Hash = null; NestOpt.Best = null; NestOpt.Last = null;
            NestOpt.BestScore = null; NestOpt.LastScore = null;
            NestOpt.Iters = 0; NestOpt.SeedUsed = int.MinValue;
        }

        // ---- setup --------------------------------------------------------
        var report = new System.Text.StringBuilder();
        int n = geos.Count;
        var outGeo = new GeometryBase[n];
        var outXform = new object[n];
        var outBox = new object[n];
        var outBin = new int[n];
        for (int i = 0; i < n; i++) outBin[i] = -1;

        N = outGeo; X = outXform; C = outBox; BIN = outBin; REP = "";
        Component.Message = "idle";

        if (n == 0 || !box.IsValid) { REP = "No geometry or invalid box."; return; }

        double tol = RhinoDocument.ModelAbsoluteTolerance;
        double binW = box.X.Length, binH = box.Y.Length, binD = box.Z.Length;

        // ---- measure items ------------------------------------------------
        var dims = new Vector3d[n];
        var centers = new Point3d[n];
        var packable = new List<int>();
        var impossible = new List<int>();

        for (int i = 0; i < n; i++)
        {
            if (geos[i] == null) { impossible.Add(i); continue; }
            BoundingBox bb = geos[i].GetBoundingBox(true);
            double dx = Math.Max(bb.Diagonal.X, tol) + spacing;
            double dy = Math.Max(bb.Diagonal.Y, tol) + spacing;
            double dz = Math.Max(bb.Diagonal.Z, tol) + spacing;
            dims[i] = new Vector3d(dx, dy, dz);
            centers[i] = bb.Center;

            if (!CanEverFit(dx, dy, dz, binW, binH, binD, allRot))
            {
                impossible.Add(i);
                report.AppendLine($"Item {i}: too big for container in any allowed orientation.");
                continue;
            }
            packable.Add(i);
        }

        if (packable.Count == 0)
        { REP = report.ToString() + "Nothing packable."; Component.Message = "nothing packable"; return; }

        // ---- state: reset best only when the PROBLEM changes --------------
        var hb = new System.Text.StringBuilder();
        hb.Append($"{binW:F9}|{binH:F9}|{binD:F9}|{spacing:F9}|{allRot}|{n}");
        for (int i = 0; i < n; i++) hb.Append($"|{dims[i].X:F9},{dims[i].Y:F9},{dims[i].Z:F9}");
        string hash = hb.ToString();
        if (NestOpt.Hash != hash)
        { NestOpt.Hash = hash; NestOpt.Best = null; NestOpt.Last = null; NestOpt.Iters = 0; NestOpt.SeedUsed = int.MinValue; }

        if (NestOpt.SeedUsed != seed)
        { NestOpt.Rnd = seed == 0 ? new Random() : new Random(seed); NestOpt.SeedUsed = seed; }

        // ---- search -------------------------------------------------------
        bool budgetReached = iterBudget > 0 && NestOpt.Iters >= iterBudget;
        int attempts = run && !budgetReached ? population : (NestOpt.Best == null ? 1 : 0);
        if (iterBudget > 0 && run) attempts = Math.Min(attempts, Math.Max(0, iterBudget - NestOpt.Iters));

        for (int a = 0; a < attempts; a++)
        {
            var cuboids = packable
                .Select(i => new Cuboid((decimal)dims[i].X, (decimal)dims[i].Y, (decimal)dims[i].Z, 0, i));

            double amp = mutation / 100.0;
            IEnumerable<Cuboid> order = NestOpt.Iters == 0 || amp <= 0
                ? cuboids.OrderByDescending(c => c.Width * c.Height * c.Depth)
                : cuboids.OrderByDescending(c =>
                    (double)(c.Width * c.Height * c.Depth) * (1.0 + (NestOpt.Rnd.NextDouble() * 2 - 1) * amp));

            var param = new BinPackParameter(
                (decimal)binW, (decimal)binH, (decimal)binD, 0, allRot, order.ToList())
                { ShuffleCount = seed == 0 ? 2 : 0 };

            var packer = new BinPacker(BinPackerVerifyOption.BestOnly, Factories(packMode));
            var bins = packer.Pack(param).BestResult.ToList();
            var score = ScoreOf(bins, binW, binH, binD);
            NestOpt.Iters++;
            NestOpt.Last = bins;
            NestOpt.LastScore = score;

            if (NestOpt.Best == null || Better(score, NestOpt.BestScore))
            { NestOpt.Best = bins; NestOpt.BestScore = score; }
        }

        bool showLive = run && liveView && !budgetReached && NestOpt.Last != null;
        var bestBins = showLive ? NestOpt.Last : NestOpt.Best;

        // ---- place geometry from chosen layout ----------------------------
        Plane cornerPl = new Plane(box.PointAt(0, 0, 0), box.Plane.XAxis, box.Plane.YAxis);
        Transform toBox = Transform.PlaneToPlane(Plane.WorldXY, cornerPl);

        for (int b = 0; b < bestBins.Count; b++)
        {
            Vector3d overflowV = cornerPl.XAxis * (b * binW * 1.15);

            foreach (var c in bestBins[b])
            {
                int i = (int)c.Tag;
                outBin[i] = b;

                double pw = (double)c.Width, ph = (double)c.Height, pd = (double)c.Depth;

                Transform rot; Vector3d permDims;
                if (!FindRotation(dims[i], new Vector3d(pw, ph, pd), tol, out rot, out permDims))
                { rot = Transform.Identity; permDims = dims[i]; }

                Transform rotAboutCenter =
                    Transform.Translation(centers[i] - Point3d.Origin) * rot * Transform.Translation(Point3d.Origin - centers[i]);
                Point3d rotatedMin = centers[i] - permDims * 0.5;
                Point3d targetLocal = new Point3d((double)c.X, (double)c.Y, (double)c.Z);
                Transform move = Transform.Translation(targetLocal - rotatedMin);

                Transform final = Transform.Translation(overflowV) * toBox * move * rotAboutCenter;

                var dup = geos[i].Duplicate();
                dup.Transform(final);
                outGeo[i] = dup;
                outXform[i] = final;

                Point3d p0 = cornerPl.Origin + overflowV
                    + cornerPl.XAxis * ((double)c.X + spacing * 0.5)
                    + cornerPl.YAxis * ((double)c.Y + spacing * 0.5)
                    + cornerPl.ZAxis * ((double)c.Z + spacing * 0.5);
                Plane pp = new Plane(p0, cornerPl.XAxis, cornerPl.YAxis);
                outBox[i] = new Box(pp, new Interval(0, pw - spacing), new Interval(0, ph - spacing), new Interval(0, pd - spacing));
            }
        }

        // ---- report + banner ----------------------------------------------
        int inBoxCount = 0, over = 0;
        for (int i = 0; i < n; i++) { if (outBin[i] == 0) inBoxCount++; else if (outBin[i] > 0) over++; }
        double fillPct = -NestOpt.BestScore[1] / (binW * binH * binD) * 100;
        string[] packNames = { "Auto", "Shelf", "Guillotine" };
        report.AppendLine($"Placed {inBoxCount} in container, {over} in {Math.Max(0, bestBins.Count - 1)} overflow bin(s), {impossible.Count} impossible.");
        report.AppendLine($"Packing: {packNames[packMode]} | Seed: {(seed == 0 ? "random" : seed.ToString())} | Mutation: {mutation} | Population: {population} | All Rotations: {(allRot ? "On" : "Off")}");
        report.AppendLine($"Iteration {NestOpt.Iters}{(iterBudget > 0 ? "/" + iterBudget : "")} | best fill {fillPct:F1}% | stack height {NestOpt.BestScore[2]:F2}");
        if (showLive)
        {
            double liveFill = -NestOpt.LastScore[1] / (binW * binH * binD) * 100;
            report.AppendLine($"LIVE VIEW: showing newest attempt (fill {liveFill:F1}%, {(int)NestOpt.LastScore[0]} bin(s)) - freeze to snap to best.");
        }
        report.AppendLine(budgetReached ? "Iteration budget reached - frozen."
            : run ? "SEARCHING (self-looping; toggle Run off to stop)"
                  : "Frozen on best found. Run on to search.");

        N = outGeo; X = outXform; C = outBox; BIN = outBin; REP = report.ToString();

        string iterTxt = iterBudget > 0 ? $"{NestOpt.Iters}/{iterBudget}" : NestOpt.Iters.ToString();
        Component.Message =
            budgetReached ? $"Iter {iterTxt} \u2022 done"
            : showLive    ? $"Iter {iterTxt} \u2022 LIVE"
            : run         ? $"Iter {iterTxt} \u2022 {fillPct:F0}%"
                          : $"Iter {iterTxt} \u2022 frozen";

        // ---- self-loop: schedule the next solution while searching --------
        // No Timer component needed. Each solve queues the next one 100 ms
        // out; flipping Run off (or hitting the Iter budget) breaks the chain.
        if (run && !budgetReached)
            GrasshopperDocument.ScheduleSolution(100, d => Component.ExpireSolution(false));
    }

    // ---- helpers ----------------------------------------------------------
    object Unwrap(object o) => o is IGH_Goo goo ? goo.ScriptVariable() : o;
    double Dbl(object o, double dflt) { var v = Unwrap(o); return v == null ? dflt : Convert.ToDouble(v); }
    int    Int(object o, int dflt)    { var v = Unwrap(o); return v == null ? dflt : Convert.ToInt32(v); }
    bool   Bul(object o, bool dflt)   { var v = Unwrap(o); return v == null ? dflt : Convert.ToBoolean(v); }

    bool CanEverFit(double dx, double dy, double dz, double w, double h, double d, bool allowVertical)
    {
        if (allowVertical)
        {
            var s = new[] { dx, dy, dz }; Array.Sort(s);
            var t = new[] { w, h, d }; Array.Sort(t);
            return s[0] <= t[0] && s[1] <= t[1] && s[2] <= t[2];
        }
        return dz <= d && ((dx <= w && dy <= h) || (dy <= w && dx <= h));
    }

    bool FindRotation(Vector3d d0, Vector3d d1, double tl, out Transform rot, out Vector3d permDims)
    {
        int[][] perms = {
            new[]{0,1,2}, new[]{0,2,1}, new[]{1,0,2}, new[]{1,2,0}, new[]{2,0,1}, new[]{2,1,0} };
        double[] src = { d0.X, d0.Y, d0.Z };
        foreach (var p in perms)
        {
            if (Math.Abs(src[p[0]] - d1.X) > tl) continue;
            if (Math.Abs(src[p[1]] - d1.Y) > tl) continue;
            if (Math.Abs(src[p[2]] - d1.Z) > tl) continue;
            for (int signs = 0; signs < 8; signs++)
            {
                var m = new double[3, 3];
                for (int k = 0; k < 3; k++) m[k, p[k]] = ((signs >> k) & 1) == 0 ? 1 : -1;
                double det = m[0,0]*(m[1,1]*m[2,2]-m[1,2]*m[2,1])
                           - m[0,1]*(m[1,0]*m[2,2]-m[1,2]*m[2,0])
                           + m[0,2]*(m[1,0]*m[2,1]-m[1,1]*m[2,0]);
                if (Math.Abs(det - 1.0) > 0.5) continue;
                Transform t = Transform.Identity;
                t.M00=m[0,0]; t.M01=m[0,1]; t.M02=m[0,2];
                t.M10=m[1,0]; t.M11=m[1,1]; t.M12=m[1,2];
                t.M20=m[2,0]; t.M21=m[2,1]; t.M22=m[2,2];
                rot = t; permDims = new Vector3d(src[p[0]], src[p[1]], src[p[2]]);
                return true;
            }
        }
        rot = Transform.Identity; permDims = d0; return false;
    }

    double[] ScoreOf(List<IList<Cuboid>> bins, double binW, double binH, double binD)
    {
        double vol = bins[0].Sum(c => (double)(c.Width * c.Height * c.Depth));
        double height = bins[0].Max(c => (double)c.Z + (double)c.Depth);
        return new[] { (double)bins.Count, -vol, height };
    }

    bool Better(double[] a, double[] b)
    {
        for (int k = 0; k < a.Length; k++)
        { if (a[k] < b[k] - 1e-12) return true; if (a[k] > b[k] + 1e-12) return false; }
        return false;
    }

    BinPackAlgorithmFactory[] Factories(int mode)
    {
        var shelf = new BinPackAlgorithmFactory[] {
            p => new BinPackShelfAlgorithm(p, FreeRectChoiceHeuristic.RectBestAreaFit,
                GuillotineSplitHeuristic.SplitLongerLeftoverAxis, ShelfChoiceHeuristic.ShelfFirstFit),
            p => new BinPackShelfAlgorithm(p, FreeRectChoiceHeuristic.RectBestAreaFit,
                GuillotineSplitHeuristic.SplitLongerLeftoverAxis, ShelfChoiceHeuristic.ShelfNextFit) };
        var guillotine = new BinPackAlgorithmFactory[] {
            p => new BinPackGuillotineAlgorithm(p, FreeCuboidChoiceHeuristic.CuboidMinHeight,
                GuillotineSplitHeuristic.SplitLongerLeftoverAxis),
            p => new BinPackGuillotineAlgorithm(p, FreeCuboidChoiceHeuristic.CuboidMinHeight,
                GuillotineSplitHeuristic.SplitShorterLeftoverAxis) };
        if (mode == 1) return shelf;
        if (mode == 2) return guillotine;
        return shelf.Concat(guillotine).ToArray();
    }
}

// ---- persistent state (survives between solutions) -------------------------
static class NestOpt
{
    public static string Hash;
    public static List<IList<Cuboid>> Best;
    public static List<IList<Cuboid>> Last;
    public static double[] BestScore;
    public static double[] LastScore;
    public static int Iters;
    public static Random Rnd = new Random();
    public static int SeedUsed = int.MinValue;
}
# ---------- end c_script ----------
c_script_2 = CSharpScript(G=mesh, B=brep, S=number_slider, Run=boolean_toggle_2, Iter="0", Rot="true", Pack="1", Live=boolean_toggle, Reset=button)  # -> out, N, X, C, BIN, REP; inputs G: list of GeometryBase, B: Box, S: Double, Run: Boolean, Iter: Int32, Seed: Int32, Mut: Int32, Pop: Int32, Rot: Boolean, Pack: Int32, Live: Boolean, Reset: Boolean
# ---------- c_script_2: C# ----------
// ============================================================================
// Nest3D — typed version. Set the type hints on the component and the
// RunScript signature below matches them directly. No unwrapping code.
//
// COMPONENT SETUP — inputs in this order, with these hints:
//   G     : List Access, type hint GeometryBase
//   B     : Item Access, type hint Box
//   S     : Item Access, type hint double   (spacing)
//   Run   : Item Access, type hint bool
//   Iter  : Item Access, type hint int      (0 = run until stopped)
//   Seed  : Item Access, type hint int      (0 = random)
//   Mut   : Item Access, type hint int      (mutation 0-100)
//   Pop   : Item Access, type hint int      (attempts per tick)
//   Rot   : Item Access, type hint bool     (all rotations)
//   Pack  : Item Access, type hint int      (0=Auto 1=Shelf 2=Guillotine)
//   Live  : Item Access, type hint bool     (show newest attempt)
//   Reset : Item Access, type hint bool     (wire a BUTTON)
// Outputs: N, X, C, BIN, REP
//
// IMPORTANT: with value-type hints (bool/int/double), every input must have
// data wired or the component will not run at all — wire sliders, toggles,
// and a button to all of them. That fits the OpenNest-style panel anyway.
//
// SELF-LOOPING: while Run is true the script schedules its own next solution
// every ~100 ms. No Timer component. Run off / Iter budget reached = frozen.
// ============================================================================

#r "G:\Architectural Templates\Ptarmigan\02_GH\3D Packing\Sharp3DBinPacking.dll"

using System;
using System.Collections;
using System.Collections.Generic;
using System.Linq;
using Rhino;
using Rhino.Geometry;
using Grasshopper;
using Grasshopper.Kernel;
using Grasshopper.Kernel.Types;
using Sharp3DBinPacking;
using Sharp3DBinPacking.Internal;
using Sharp3DBinPacking.Algorithms;

public class Script_Instance : GH_ScriptInstance
{
    private void RunScript(
		List<GeometryBase> G,
		Box B,
		double S,
		bool Run,
		int Iter,
		int Seed,
		int Mut,
		int Pop,
		bool Rot,
		int Pack,
		bool Live,
		bool Reset,
		ref object N,
		ref object X,
		ref object C,
		ref object BIN,
		ref object REP)
    {
        // ---- hover tooltips ----------------------------------------------
        string[] inDesc = {
            "Geometry to nest: meshes and/or breps. Each item is packed by its world axis-aligned bounding box.",
            "Container box to nest into.",
            "Spacing: minimum gap between items and to the container walls, in model units.",
            "Run: true = search continuously (self-looping), false = freeze on the best layout found.",
            "Iterations: total attempt budget. 0 = run until Run is toggled off.",
            "Seed: 0 = random each session, any other value = fully reproducible search.",
            "Mutation (0-100): % noise applied to the packing order each attempt. 0 = pure greedy.",
            "Population: packing attempts per solve tick.",
            "All Rotations: true = any orthogonal orientation, false = rotate about Z only (stay upright).",
            "Packing algorithm: 0 = Auto, 1 = Shelf, 2 = Guillotine. Wire a Value List.",
            "Live: true = display the newest attempt every tick, false = display best-so-far.",
            "Reset: wire a BUTTON (momentary). Press to wipe the search and restart with the same inputs." };
        string[] outDesc = {
            "Nested geometry, index-aligned with G. Null for items that can never fit.",
            "Transform per item (aligned with G). Apply to other geometry to reproduce placements.",
            "Placement box per item: the packed slot minus spacing.",
            "Bin index per item: 0 = in container, 1+ = overflow, -1 = impossible.",
            "Text report: placements, settings, iteration status." };
        for (int i = 0; i < Component.Params.Input.Count && i < inDesc.Length; i++)
            Component.Params.Input[i].Description = inDesc[i];
        for (int i = 0; i < Component.Params.Output.Count && i < outDesc.Length; i++)
            Component.Params.Output[i].Description = outDesc[i];

        // ---- clamp settings ----------------------------------------------
        double spacing    = S;
        int    iterBudget = Math.Max(0, Iter);
        int    mutation   = Math.Min(100, Math.Max(0, Mut));
        int    population = Math.Max(1, Pop);
        int    packMode   = Math.Min(2, Math.Max(0, Pack));

        // ---- manual reset -------------------------------------------------
        if (Reset)
        {
            NestOpt.Hash = null; NestOpt.Best = null; NestOpt.Last = null;
            NestOpt.BestScore = null; NestOpt.LastScore = null;
            NestOpt.Iters = 0; NestOpt.SeedUsed = int.MinValue;
        }

        // ---- setup --------------------------------------------------------
        var report = new System.Text.StringBuilder();
        int n = G == null ? 0 : G.Count;
        var outGeo = new GeometryBase[n];
        var outXform = new object[n];
        var outBox = new object[n];
        var outBin = new int[n];
        for (int i = 0; i < n; i++) outBin[i] = -1;

        N = outGeo; X = outXform; C = outBox; BIN = outBin; REP = "";
        Component.Message = "idle";

        if (n == 0 || !B.IsValid) { REP = "No geometry or invalid box."; return; }

        double tol = RhinoDocument.ModelAbsoluteTolerance;
        double binW = B.X.Length, binH = B.Y.Length, binD = B.Z.Length;

        // ---- measure items ------------------------------------------------
        var dims = new Vector3d[n];
        var centers = new Point3d[n];
        var packable = new List<int>();
        var impossible = new List<int>();

        for (int i = 0; i < n; i++)
        {
            if (G[i] == null) { impossible.Add(i); continue; }
            BoundingBox bb = G[i].GetBoundingBox(true);
            double dx = Math.Max(bb.Diagonal.X, tol) + spacing;
            double dy = Math.Max(bb.Diagonal.Y, tol) + spacing;
            double dz = Math.Max(bb.Diagonal.Z, tol) + spacing;
            dims[i] = new Vector3d(dx, dy, dz);
            centers[i] = bb.Center;

            if (!CanEverFit(dx, dy, dz, binW, binH, binD, Rot))
            {
                impossible.Add(i);
                report.AppendLine($"Item {i}: too big for container in any allowed orientation.");
                continue;
            }
            packable.Add(i);
        }

        if (packable.Count == 0)
        { REP = report.ToString() + "Nothing packable."; Component.Message = "nothing packable"; return; }

        // ---- state: reset best only when the PROBLEM changes --------------
        var hb = new System.Text.StringBuilder();
        hb.Append($"{binW:F9}|{binH:F9}|{binD:F9}|{spacing:F9}|{Rot}|{n}");
        for (int i = 0; i < n; i++) hb.Append($"|{dims[i].X:F9},{dims[i].Y:F9},{dims[i].Z:F9}");
        string hash = hb.ToString();
        if (NestOpt.Hash != hash)
        { NestOpt.Hash = hash; NestOpt.Best = null; NestOpt.Last = null; NestOpt.Iters = 0; NestOpt.SeedUsed = int.MinValue; }

        if (NestOpt.SeedUsed != Seed)
        { NestOpt.Rnd = Seed == 0 ? new Random() : new Random(Seed); NestOpt.SeedUsed = Seed; }

        // ---- search -------------------------------------------------------
        bool budgetReached = iterBudget > 0 && NestOpt.Iters >= iterBudget;
        int attempts = Run && !budgetReached ? population : (NestOpt.Best == null ? 1 : 0);
        if (iterBudget > 0 && Run) attempts = Math.Min(attempts, Math.Max(0, iterBudget - NestOpt.Iters));

        for (int a = 0; a < attempts; a++)
        {
            var cuboids = packable
                .Select(i => new Cuboid((decimal)dims[i].X, (decimal)dims[i].Y, (decimal)dims[i].Z, 0, i));

            double amp = mutation / 100.0;
            IEnumerable<Cuboid> order = NestOpt.Iters == 0 || amp <= 0
                ? cuboids.OrderByDescending(c => c.Width * c.Height * c.Depth)
                : cuboids.OrderByDescending(c =>
                    (double)(c.Width * c.Height * c.Depth) * (1.0 + (NestOpt.Rnd.NextDouble() * 2 - 1) * amp));

            var param = new BinPackParameter(
                (decimal)binW, (decimal)binH, (decimal)binD, 0, Rot, order.ToList())
                { ShuffleCount = Seed == 0 ? 2 : 0 };

            var packer = new BinPacker(BinPackerVerifyOption.BestOnly, Factories(packMode));
            var bins = packer.Pack(param).BestResult.ToList();
            var score = ScoreOf(bins);
            NestOpt.Iters++;
            NestOpt.Last = bins;
            NestOpt.LastScore = score;

            if (NestOpt.Best == null || Better(score, NestOpt.BestScore))
            { NestOpt.Best = bins; NestOpt.BestScore = score; }
        }

        bool showLive = Run && Live && !budgetReached && NestOpt.Last != null;
        var bestBins = showLive ? NestOpt.Last : NestOpt.Best;

        // ---- place geometry from chosen layout ----------------------------
        Plane cornerPl = new Plane(B.PointAt(0, 0, 0), B.Plane.XAxis, B.Plane.YAxis);
        Transform toBox = Transform.PlaneToPlane(Plane.WorldXY, cornerPl);

        for (int b = 0; b < bestBins.Count; b++)
        {
            Vector3d overflowV = cornerPl.XAxis * (b * binW * 1.15);

            foreach (var c in bestBins[b])
            {
                int i = (int)c.Tag;
                outBin[i] = b;

                double pw = (double)c.Width, ph = (double)c.Height, pd = (double)c.Depth;

                Transform rot; Vector3d permDims;
                if (!FindRotation(dims[i], new Vector3d(pw, ph, pd), tol, out rot, out permDims))
                { rot = Transform.Identity; permDims = dims[i]; }

                Transform rotAboutCenter =
                    Transform.Translation(centers[i] - Point3d.Origin) * rot * Transform.Translation(Point3d.Origin - centers[i]);
                Point3d rotatedMin = centers[i] - permDims * 0.5;
                Point3d targetLocal = new Point3d((double)c.X, (double)c.Y, (double)c.Z);
                Transform move = Transform.Translation(targetLocal - rotatedMin);

                Transform final = Transform.Translation(overflowV) * toBox * move * rotAboutCenter;

                var dup = G[i].Duplicate();
                dup.Transform(final);
                outGeo[i] = dup;
                outXform[i] = final;

                Point3d p0 = cornerPl.Origin + overflowV
                    + cornerPl.XAxis * ((double)c.X + spacing * 0.5)
                    + cornerPl.YAxis * ((double)c.Y + spacing * 0.5)
                    + cornerPl.ZAxis * ((double)c.Z + spacing * 0.5);
                Plane pp = new Plane(p0, cornerPl.XAxis, cornerPl.YAxis);
                outBox[i] = new Box(pp, new Interval(0, pw - spacing), new Interval(0, ph - spacing), new Interval(0, pd - spacing));
            }
        }

        // ---- report + banner ----------------------------------------------
        int inBoxCount = 0, over = 0;
        for (int i = 0; i < n; i++) { if (outBin[i] == 0) inBoxCount++; else if (outBin[i] > 0) over++; }
        double fillPct = -NestOpt.BestScore[1] / (binW * binH * binD) * 100;
        string[] packNames = { "Auto", "Shelf", "Guillotine" };
        report.AppendLine($"Placed {inBoxCount} in container, {over} in {Math.Max(0, bestBins.Count - 1)} overflow bin(s), {impossible.Count} impossible.");
        report.AppendLine($"Packing: {packNames[packMode]} | Seed: {(Seed == 0 ? "random" : Seed.ToString())} | Mutation: {mutation} | Population: {population} | All Rotations: {(Rot ? "On" : "Off")}");
        report.AppendLine($"Iteration {NestOpt.Iters}{(iterBudget > 0 ? "/" + iterBudget : "")} | best fill {fillPct:F1}% | stack height {NestOpt.BestScore[2]:F2}");
        if (showLive)
        {
            double liveFill = -NestOpt.LastScore[1] / (binW * binH * binD) * 100;
            report.AppendLine($"LIVE VIEW: showing newest attempt (fill {liveFill:F1}%, {(int)NestOpt.LastScore[0]} bin(s)) - freeze to snap to best.");
        }
        report.AppendLine(budgetReached ? "Iteration budget reached - frozen."
            : Run ? "SEARCHING (self-looping; toggle Run off to stop)"
                  : "Frozen on best found. Run on to search.");

        N = outGeo; X = outXform; C = outBox; BIN = outBin; REP = report.ToString();

        string iterTxt = iterBudget > 0 ? $"{NestOpt.Iters}/{iterBudget}" : NestOpt.Iters.ToString();
        Component.Message =
            budgetReached ? $"Iter {iterTxt} \u2022 done"
            : showLive    ? $"Iter {iterTxt} \u2022 LIVE"
            : Run         ? $"Iter {iterTxt} \u2022 {fillPct:F0}%"
                          : $"Iter {iterTxt} \u2022 frozen";

        // ---- self-loop ----------------------------------------------------
        if (Run && !budgetReached)
            GrasshopperDocument.ScheduleSolution(100, d => Component.ExpireSolution(false));
    }

    // ---- helpers ----------------------------------------------------------
    bool CanEverFit(double dx, double dy, double dz, double w, double h, double d, bool allowVertical)
    {
        if (allowVertical)
        {
            var s = new[] { dx, dy, dz }; Array.Sort(s);
            var t = new[] { w, h, d }; Array.Sort(t);
            return s[0] <= t[0] && s[1] <= t[1] && s[2] <= t[2];
        }
        return dz <= d && ((dx <= w && dy <= h) || (dy <= w && dx <= h));
    }

    bool FindRotation(Vector3d d0, Vector3d d1, double tl, out Transform rot, out Vector3d permDims)
    {
        int[][] perms = {
            new[]{0,1,2}, new[]{0,2,1}, new[]{1,0,2}, new[]{1,2,0}, new[]{2,0,1}, new[]{2,1,0} };
        double[] src = { d0.X, d0.Y, d0.Z };
        foreach (var p in perms)
        {
            if (Math.Abs(src[p[0]] - d1.X) > tl) continue;
            if (Math.Abs(src[p[1]] - d1.Y) > tl) continue;
            if (Math.Abs(src[p[2]] - d1.Z) > tl) continue;
            for (int signs = 0; signs < 8; signs++)
            {
                var m = new double[3, 3];
                for (int k = 0; k < 3; k++) m[k, p[k]] = ((signs >> k) & 1) == 0 ? 1 : -1;
                double det = m[0,0]*(m[1,1]*m[2,2]-m[1,2]*m[2,1])
                           - m[0,1]*(m[1,0]*m[2,2]-m[1,2]*m[2,0])
                           + m[0,2]*(m[1,0]*m[2,1]-m[1,1]*m[2,0]);
                if (Math.Abs(det - 1.0) > 0.5) continue;
                Transform t = Transform.Identity;
                t.M00=m[0,0]; t.M01=m[0,1]; t.M02=m[0,2];
                t.M10=m[1,0]; t.M11=m[1,1]; t.M12=m[1,2];
                t.M20=m[2,0]; t.M21=m[2,1]; t.M22=m[2,2];
                rot = t; permDims = new Vector3d(src[p[0]], src[p[1]], src[p[2]]);
                return true;
            }
        }
        rot = Transform.Identity; permDims = d0; return false;
    }

    double[] ScoreOf(List<IList<Cuboid>> bins)
    {
        double vol = bins[0].Sum(c => (double)(c.Width * c.Height * c.Depth));
        double height = bins[0].Max(c => (double)c.Z + (double)c.Depth);
        return new[] { (double)bins.Count, -vol, height };
    }

    bool Better(double[] a, double[] b)
    {
        for (int k = 0; k < a.Length; k++)
        { if (a[k] < b[k] - 1e-12) return true; if (a[k] > b[k] + 1e-12) return false; }
        return false;
    }

    BinPackAlgorithmFactory[] Factories(int mode)
    {
        var shelf = new BinPackAlgorithmFactory[] {
            p => new BinPackShelfAlgorithm(p, FreeRectChoiceHeuristic.RectBestAreaFit,
                GuillotineSplitHeuristic.SplitLongerLeftoverAxis, ShelfChoiceHeuristic.ShelfFirstFit),
            p => new BinPackShelfAlgorithm(p, FreeRectChoiceHeuristic.RectBestAreaFit,
                GuillotineSplitHeuristic.SplitLongerLeftoverAxis, ShelfChoiceHeuristic.ShelfNextFit) };
        var guillotine = new BinPackAlgorithmFactory[] {
            p => new BinPackGuillotineAlgorithm(p, FreeCuboidChoiceHeuristic.CuboidMinHeight,
                GuillotineSplitHeuristic.SplitLongerLeftoverAxis),
            p => new BinPackGuillotineAlgorithm(p, FreeCuboidChoiceHeuristic.CuboidMinHeight,
                GuillotineSplitHeuristic.SplitShorterLeftoverAxis) };
        if (mode == 1) return shelf;
        if (mode == 2) return guillotine;
        return shelf.Concat(guillotine).ToArray();
    }
}

// ---- persistent state (survives between solutions) -------------------------
static class NestOpt
{
    public static string Hash;
    public static List<IList<Cuboid>> Best;
    public static List<IList<Cuboid>> Last;
    public static double[] BestScore;
    public static double[] LastScore;
    public static int Iters;
    public static Random Rnd = new Random();
    public static int SeedUsed = int.MinValue;
}
# ---------- end c_script_2 ----------
volume = Volume(Geometry=brep)  # -> Volume, Centroid
box = Box(c_script.C)
volume_2 = Volume(Geometry=box)  # -> Volume, Centroid
inverse_transform = InverseTransform(Transform=c_script.X)  # disabled
mesh_2 = Mesh(c_script.N)
transform = Transform(Geometry=c_script.N, Transform=inverse_transform)  # disabled
mass_addition = MassAddition(Input=volume_2.Volume)  # -> Result, PartialResults
set_earthanchorpoint = SetEarthAnchorPoint(SetEAP=Toggle(True))
division = Division(A=mass_addition.Result, B=volume.Volume)
c_script_3 = CSharpScript()  # -> out, a
# ---------- c_script_3: C# ----------
// Grasshopper Script Instance
#region Usings
using System;
using System.Collections.Generic;
using System.IO;
using System.Windows.Forms;
using System.Linq;
using System.Text.RegularExpressions;

using Grasshopper.Kernel;
using Grasshopper.Kernel.Data;
using Grasshopper.Kernel.Types;
using GH_IO;
using GH_IO.Serialization;
using Rhino;
using Rhino.Geometry;

#endregion

public class Script_Instance : GH_ScriptInstance
{
    #region Notes
    /* 
      Members:
        RhinoDoc RhinoDocument
        GH_Document GrasshopperDocument
        IGH_Component Component
        int Iteration

      Methods (Virtual & overridable):
        Print(string text)
        Print(string format, params object[] args)
        Reflect(object obj)
        Reflect(object obj, string method_name)
    */
    #endregion

    private void RunScript(object x, object y, ref object a)
    {
        Component.Message = "test";
    }
}
# ---------- end c_script_3 ----------
panel = Panel(division)
