# Grasshopper definition AxisAlignedBB.gh (Grasshopper 1.0.8)
# plug-ins: Pufferfish

mesh = Mesh(<mesh referenced from the Rhino model>)
deconstruct_mesh = DeconstructMesh(Mesh=mesh)  # -> Vertices, Faces, Colours, Normals
mesh_2 = Mesh(<mesh referenced from the Rhino model>)
deconstruct = Deconstruct(Point=deconstruct_mesh.Vertices)  # -> XComponent, YComponent, ZComponent
deconstruct_mesh_2 = DeconstructMesh(Mesh=mesh_2)  # -> Vertices, Faces, Colours, Normals
sort_list = SortList(Keys=deconstruct.ZComponent)  # -> Keys, ValuesValuesA
sort_list_2 = SortList(Keys=deconstruct.XComponent)  # -> Keys, ValuesA
sort_list_3 = SortList(Keys=deconstruct.YComponent)  # -> Keys, ValuesA
deconstruct_2 = Deconstruct(Point=deconstruct_mesh_2.Vertices)  # -> XComponent, YComponent, ZComponent
reverse_list = ReverseList(List=sort_list_2.Keys)
reverse_list_2 = ReverseList(List=sort_list_3.Keys)
reverse_list_3 = ReverseList(List=sort_list.Keys)
sort_list_4 = SortList(Keys=deconstruct_2.ZComponent, ValuesA=deconstruct_mesh_2.Vertices)  # -> Keys, ValuesA
list_item = ListItem(List=sort_list_2.Keys, Index=0, Wrap=True)
list_item_2 = ListItem(List=sort_list_3.Keys, Index=0, Wrap=True)
list_item_3 = ListItem(List=sort_list.Keys, Index=0, Wrap=True)
list_item_4 = ListItem(List=reverse_list, Index=0, Wrap=True)
list_item_5 = ListItem(List=reverse_list_2, Index=0, Wrap=True)
list_item_6 = ListItem(List=reverse_list_3, Index=0, Wrap=True)
list_item_7 = ListItem(List=sort_list_4.ValuesA, Index=0, Wrap=True)
construct_point = ConstructPoint(XCoordinate=list_item, YCoordinate=list_item_2, ZCoordinate=list_item_3)
construct_point_2 = ConstructPoint(XCoordinate=list_item_4, YCoordinate=list_item_5, ZCoordinate=list_item_6)
construct_point_3 = ConstructPoint(XCoordinate=deconstruct_2.XComponent, YCoordinate=deconstruct_2.YComponent, ZCoordinate=0)
xy_plane = XYPlane(Origin=list_item_7)
rotate = Rotate(Geometry=xy_plane, Angle=degrees(Slider(0, range=0..90)), Plane=xy_plane)  # -> Geometry, Transform
average = Average(Input=deconstruct_mesh.Vertices)
bounding_rectangle = BoundingRectangle(Geometry=mesh_2, Plane=rotate.Geometry, Axis=0, Slide=0, Union=True)  # -> Bounding, DimensionX, DimensionY
subtraction = Subtraction(A=average, B=deconstruct_mesh.Vertices)
transform_matrix = TransformMatrix(subtraction, Digits=3)
point = Point(subtraction)
area = Area(Geometry=bounding_rectangle.Bounding)  # -> Area, Centroid
deconstruct_3 = Deconstruct(Point=point)  # -> XComponent, YComponent, ZComponent
data_recorder = DataRecorder(bounding_rectangle.Bounding, DataLimit=-10, RecordData=True)
data_recorder_2 = DataRecorder(area.Area, DataLimit=-10, RecordData=True)
sort_list_5 = SortList(Keys=data_recorder_2, ValuesA=data_recorder)  # -> Keys, ValuesA
square = Square(Value=deconstruct_3.ZComponent)
square_2 = Square(Value=deconstruct_3.XComponent)
square_3 = Square(Value=deconstruct_3.YComponent)
multiplication = Multiplication(A=deconstruct_3.XComponent, B=deconstruct_3.YComponent)
multiplication_2 = Multiplication(A=deconstruct_3.XComponent, B=deconstruct_3.ZComponent)
multiplication_3 = Multiplication(A=deconstruct_3.YComponent, B=deconstruct_3.ZComponent)
sort_list_6 = SortList(Keys=deconstruct_2.ZComponent)  # -> Keys, ValuesValuesA
list_length = ListLength(List=deconstruct_3.XComponent)
list_item_8 = ListItem(List=sort_list_5.ValuesA, Index=0, Wrap=True)
reverse_list_4 = ReverseList(List=sort_list_6.Keys)
mass_addition = MassAddition(Input=square)  # -> Result, PartialResults
mass_addition_2 = MassAddition(Input=multiplication_2)  # -> Result, PartialResults
mass_addition_3 = MassAddition(Input=square_2)  # -> Result, PartialResults
mass_addition_4 = MassAddition(Input=multiplication)  # -> Result, PartialResults
mass_addition_5 = MassAddition(Input=multiplication_3)  # -> Result, PartialResults
mass_addition_6 = MassAddition(Input=square_3)  # -> Result, PartialResults
list_item_9 = ListItem(List=sort_list_6.Keys, Index=0, Wrap=True)
list_item_10 = ListItem(List=reverse_list_4, Index=0, Wrap=True)
division = Division(A=mass_addition_5.Result, B=list_length)
division_2 = Division(A=mass_addition.Result, B=list_length)
absolute = Absolute(Value=list_item_10)
division_3 = Division(A=mass_addition_3.Result, B=list_length)
division_4 = Division(A=mass_addition_4.Result, B=list_length)
division_5 = Division(A=mass_addition_2.Result, B=list_length)
absolute_2 = Absolute(Value=list_item_9)
division_6 = Division(A=mass_addition_6.Result, B=list_length)
addition = Addition(A=absolute, B=absolute_2)
panel = Panel(division_4)
panel_2 = Panel(division_5)
panel_3 = Panel(division_3)
panel_4 = Panel(division_6)
panel_5 = Panel(division_2)
panel_6 = Panel(division)
unit_z = UnitZ(Factor=addition)
c_script = CSharpScript(varX=division_6, varY=division_2, varZ=division_4, covXY=division_4, covXZ=division_5, covYZ=division)  # -> out, V1, V2, V3, Normal; inputs varX: Double, varY: Double, varZ: Double, covXY: Double, covXZ: Double, covYZ: Double
# ---------- c_script: C# ----------
// Grasshopper Script Instance
#region Usings
using System;
#r "D:\Architectural Templates\Ptarmigan\02_GH\_lib\MathNet.Numerics.dll"
using System.Linq;
using System.Collections;
using System.Collections.Generic;
using System.Drawing;

using Rhino;
using Rhino.Geometry;

using MathNet.Numerics.LinearAlgebra;

using Grasshopper;
using Grasshopper.Kernel;
using Grasshopper.Kernel.Data;
using Grasshopper.Kernel.Types;
#endregion

public class Script_Instance : GH_ScriptInstance
{
    #region Notes
    /* 
      Members:
        RhinoDoc RhinoDocument
        GH_Document GrasshopperDocument
        IGH_Component Component
        int Iteration

      Methods (Virtual & overridable):
        Print(string text)
        Print(string format, params object[] args)
        Reflect(object obj)
        Reflect(object obj, string method_name)
    */
    #endregion

    private void RunScript(
		double varX,
		double varY,
		double varZ,
		double covXY,
		double covXZ,
		double covYZ,
		ref object V1,
		ref object V2,
		ref object V3,
		ref object Normal)
    {
        // 1. Build symmetric 3x3 covariance matrix
        var M = Matrix<double>.Build.DenseOfArray(new double[,] {
        { varX,  covXY, covXZ },
        { covXY, varY,  covYZ },
        { covXZ, covYZ, varZ  }
        });

        // 2. Eigen decomposition (symmetric)
        var evd = M.Evd(Symmetricity.Symmetric);

        var eigenValues = evd.EigenValues;
        var eigenVectors = evd.EigenVectors;

        // 3. Find smallest eigenvalue index (for normal)
        int minIndex = 0;
        double minVal = eigenValues[0].Real;
        for (int i = 1; i < 3; i++)
        {
        if (eigenValues[i].Real < minVal)
        {
            minVal = eigenValues[i].Real;
            minIndex = i;
        }
        }

        // 4. Extract eigenvectors as Vector3d
        Vector3d[] vectors = new Vector3d[3];
        for (int i = 0; i < 3; i++)
        {
        vectors[i] = new Vector3d(
            eigenVectors[0, i],
            eigenVectors[1, i],
            eigenVectors[2, i]
        );
        }

        // 5. Output
        V1 = vectors[0];
        V2 = vectors[1];
        V3 = vectors[2];
        Normal = vectors[minIndex];  // Normal = vector of smallest eigenvalue
    }
}
# ---------- end c_script ----------
# varX (double)
# 
# varY (double)
# 
# varZ (double)
# 
# covXY (double)
# 
# covXZ (double)
# 
# covYZ (double)
panel_7 = Panel("0,0,0")
extrude = Extrude(Base=list_item_8, Direction=unit_z)
vector_display = VectorDisplay(Anchor=panel_7, Vector=c_script.V1)
vector_display_2 = VectorDisplay(Anchor=panel_7, Vector=c_script.Normal)
vector_display_3 = VectorDisplay(Anchor=panel_7, Vector=c_script.V2)
vector_display_4 = VectorDisplay(Anchor=panel_7, Vector=c_script.V3)
panel_8 = Panel(list_item_9)
construct_plane = ConstructPlane(Origin=panel_7, XAxis=c_script.V2, YAxis=c_script.V3)
plane_surface = PlaneSurface(Plane=construct_plane, XSize=Domain(-10, 10), YSize=Domain(-10, 10))
