# Grasshopper definition DeconstructDetail.gh (Grasshopper 1.0.8)
# plug-ins: Analyse Direction

guid = Guid([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])
guid_2 = Guid(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)
curve = Curve(<curve referenced from the Rhino model>)  # disabled
curve_2 = Curve(<curve referenced from the Rhino model>)
explode = Explode(Curve=curve, Recursive=True)  # -> Segments, Vertices; disabled
c_script = CSharpScript(view=guid)  # -> out, a, b, width, height; inputs view: Guid; disabled
# ---------- c_script: C# ----------
// Grasshopper Script Instance
#region Usings
using System;
using System.Linq;
using System.Collections;
using System.Collections.Generic;
using System.Drawing;

using Rhino;
using Rhino.Geometry;
using Rhino.DocObjects;

using Grasshopper;
using Grasshopper.Kernel;
using Grasshopper.Kernel.Data;
using Grasshopper.Kernel.Types;
#endregion

public class Script_Instance : GH_ScriptInstance
{
    #region Notes
    /* 
      Members:
        RhinoDoc RhinoDocument
        GH_Document GrasshopperDocument
        IGH_Component Component
        int Iteration

      Methods (Virtual & overridable):
        Print(string text)
        Print(string format, params object[] args)
        Reflect(object obj)
        Reflect(object obj, string method_name)
    */
    #endregion

    private void RunScript(
		Guid view,
		ref object a,
		ref object b,
		ref object width,
		ref object height)
    {
        //Guid newView = view;

        RhinoObject detailGeo = RhinoDocument.Objects.Find(view);

        DetailViewObject details = detailGeo as DetailViewObject;

        Rhino.Display.RhinoViewport vp = details.Viewport;

        Point3d camTarget = vp.CameraTarget;
        Point3d camLoca = vp.CameraLocation;
        var dims = vp.Size;

        double Dwidth = dims.Width;
        double Dheight = dims.Height;

        

        a = camTarget;
        b = camLoca;

        width = Dwidth;
        height = Dheight;


        


    }
}
# ---------- end c_script ----------
c_script_2 = CSharpScript(view=guid)  # -> out, a, b, width, height, scale, toWorld; inputs view: Guid; disabled
# ---------- c_script_2: C# ----------
// Grasshopper Script Instance
#region Usings
using System;
using System.Linq;
using System.Collections;
using System.Collections.Generic;
using System.Drawing;

using Rhino;
using Rhino.Geometry;
using Rhino.DocObjects;

using Grasshopper;
using Grasshopper.Kernel;
using Grasshopper.Kernel.Data;
using Grasshopper.Kernel.Types;
#endregion

public class Script_Instance : GH_ScriptInstance
{
    #region Notes
    /* 
      Members:
        RhinoDoc RhinoDocument
        GH_Document GrasshopperDocument
        IGH_Component Component
        int Iteration

      Methods (Virtual & overridable):
        Print(string text)
        Print(string format, params object[] args)
        Reflect(object obj)
        Reflect(object obj, string method_name)
    */
    #endregion

    private void RunScript(
		Guid view,
		ref object a,
		ref object b,
		ref object width,
		ref object height,
		ref object scale,
		ref object toWorld)
    {
        //Guid newView = view;

        //Convert Guid to RhinoObject
        RhinoObject detailGeo = RhinoDocument.Objects.Find(view);

        //Convert RhinoObject to DetailViewObject
        
        DetailViewObject details = detailGeo as DetailViewObject;

        Rhino.Display.RhinoViewport vp = details.Viewport;

        Point3d camTarget = vp.CameraTarget;
        Point3d camLoca = vp.CameraLocation;
        var dims = vp.Size;

        double Dwidth = dims.Width;
        double Dheight = dims.Height;

        DetailView detailView = details.DetailGeometry;

        double scaleFactor = detailView.PageToModelRatio;
        scale = scaleFactor;
        

        a = camTarget;
        b = camLoca;


        width = Dwidth;
        height = Dheight;


        


    }
}
# ---------- end c_script_2 ----------
curve_closest_point = CurveClosestPoint(Point=explode.Vertices, Curve=curve_2)  # -> Point, Parameter, Distance; disabled
subtraction = Subtraction(A=curve_closest_point.Point, B=explode.Vertices)  # disabled
vector_display = VectorDisplay(Anchor=curve_closest_point.Point, Vector=subtraction)  # disabled
guid_3 = Guid(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)
guid_4 = Guid(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)
move = Move(Geometry=curve_closest_point.Point, Motion=subtraction)  # -> Geometry, Transform; disabled
polyline = PolyLine(Vertices=move.Geometry, Closed=False)  # disabled
guid_5 = Guid(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)
guid_6 = Guid(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)
gate_not = GateNot(A=Button())
c_script_3 = CSharpScript(view=guid, update=gate_not)  # -> out, a, b, width, height, scale; inputs view: Guid, update: Boolean
# ---------- c_script_3: C# ----------
// Grasshopper Script Instance
#region Usings
using System;
using System.Linq;
using System.Collections;
using System.Collections.Generic;
using System.Drawing;

using Rhino;
using Rhino.Geometry;
using Rhino.DocObjects;

using Grasshopper;
using Grasshopper.Kernel;
using Grasshopper.Kernel.Data;
using Grasshopper.Kernel.Types;
#endregion

public class Script_Instance : GH_ScriptInstance
{
    #region Notes
    /* 
      Members:
        RhinoDoc RhinoDocument
        GH_Document GrasshopperDocument
        IGH_Component Component
        int Iteration

      Methods (Virtual & overridable):
        Print(string text)
        Print(string format, params object[] args)
        Reflect(object obj)
        Reflect(object obj, string method_name)
    */
    #endregion

    private void RunScript(
		Guid view,
		bool update,
		ref object a,
		ref object b,
		ref object width,
		ref object height,
		ref object scale)
    {

        RhinoObject detailGeo = RhinoDocument.Objects.Find(view);


        DetailViewObject details = detailGeo as DetailViewObject;

        Rhino.Display.RhinoViewport vp = details.Viewport;

        if (update==true)
        {
            Point3d camTarget = vp.CameraTarget;
            Point3d camLoca = vp.CameraLocation;
            var dims = vp.Size;

            double Dwidth = dims.Width;
            double Dheight = dims.Height;

            DetailView detailView = details.DetailGeometry;

            double scaleFactor = detailView.PageToModelRatio;

            scale = scaleFactor;

            

            a = camTarget;
            b = camLoca;

            width = Dwidth;
            height = Dheight;

        }

        else
        {
            return;
        }


        


    }
}
# ---------- end c_script_3 ----------
subtraction_2 = Subtraction(A=c_script_3.b, B=c_script_3.a)
line_sdl = LineSDL(Start=c_script_3.a, Direction=subtraction_2, Length="10")
end_points = EndPoints(Curve=line_sdl)  # -> Start, End
merge = Merge(Data1=graft(end_points.End), Data2=graft(end_points.Start))
# only use target and vector direction.
# important to ignore camera location because it is useless in details.
# the location is technically determined by the scale factor
panel = Panel(c_script_3.scale)
panel_2 = Panel(c_script_3.a)
panel_3 = Panel(c_script_3.b)
panel_4 = Panel(c_script_3.width)
curve_closest_point_2 = CurveClosestPoint(Point=merge, Curve=curve_2)  # -> Point, Parameter, Distance
line = Line(StartPoint=c_script_3.a, EndPoint=c_script_3.b)
vector_display_2 = VectorDisplay(Anchor=c_script_3.a, Vector=subtraction_2)
point = Point(panel_3)
polyline_2 = PolyLine(Vertices=merge, Closed=False)
deconstruct = Deconstruct(Point=merge)  # -> XComponent, YComponent, ZComponent
deconstruct_2 = Deconstruct(Point=curve_closest_point_2.Point)  # -> XComponent, YComponent, ZComponent
curve_direction = CurveDirection(Curve=polyline_2)
c_script_4 = CSharpScript(view=guid_3, update=gate_not)  # -> out, a, b, width, height, scale, northUp; inputs view: Guid, update: Boolean
# ---------- c_script_4: C# ----------
// Grasshopper Script Instance
#region Usings
using System;
using System.Linq;
using System.Collections;
using System.Collections.Generic;
using System.Drawing;

using Rhino;
using Rhino.Geometry;
using Rhino.DocObjects;

using Grasshopper;
using Grasshopper.Kernel;
using Grasshopper.Kernel.Data;
using Grasshopper.Kernel.Types;
#endregion

public class Script_Instance : GH_ScriptInstance
{
    #region Notes
    /* 
      Members:
        RhinoDoc RhinoDocument
        GH_Document GrasshopperDocument
        IGH_Component Component
        int Iteration

      Methods (Virtual & overridable):
        Print(string text)
        Print(string format, params object[] args)
        Reflect(object obj)
        Reflect(object obj, string method_name)
    */
    #endregion

    private void RunScript(
		Guid view,
		bool update,
		ref object a,
		ref object b,
		ref object width,
		ref object height,
		ref object scale,
		ref object northUp)
    {

        RhinoObject detailGeo = RhinoDocument.Objects.Find(view);


        DetailViewObject details = detailGeo as DetailViewObject;

        Rhino.Display.RhinoViewport vp = details.Viewport;

        if (update==true)
        {
            Point3d camTarget = vp.CameraTarget;
            Point3d camLoca = vp.CameraLocation;
            var dims = vp.Size;

            double Dwidth = dims.Width;
            double Dheight = dims.Height;

            DetailView detailView = details.DetailGeometry;

            double scaleFactor = detailView.PageToModelRatio;
            scale = scaleFactor;

            Vector3d cameraUp = vp.CameraUp;

            

            a = camTarget;
            b = camLoca;

            width = Dwidth;
            height = Dheight;

            northUp = cameraUp;

        }

        else
        {
            return;
        }


        


    }
}
# ---------- end c_script_4 ----------
c_script_5 = CSharpScript(view=guid_4, update=gate_not)  # -> out, a, b, width, height, scale, northUp; inputs view: Guid, update: Boolean; same code as c_script_4
construct_point = ConstructPoint(XCoordinate=deconstruct_2.XComponent, YCoordinate=deconstruct_2.YComponent, ZCoordinate=deconstruct.ZComponent)
subtraction_3 = Subtraction(A=c_script_4.b, B=c_script_4.a)
panel_5 = Panel(c_script_4.northUp)
subtraction_4 = Subtraction(A=construct_point, B=merge)
unit_vector = UnitVector(Vector=subtraction_3)
vector_display_3 = VectorDisplay(Anchor=c_script_4.a, Vector=subtraction_3)
reverse = Reverse(Vector=c_script_4.northUp)
panel_6 = Panel(unit_vector)
vector_display_4 = VectorDisplay(Anchor=construct_point, Vector=subtraction_4)
guid_7 = Guid([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])
addition = Addition(A=construct_point, B=subtraction_4)
polyline_3 = PolyLine(Vertices=addition, Closed=False)
list_item = ListItem(List=addition, Index="1", Wrap=True)
c_script_6 = CSharpScript(
    view=guid_5,
    cameraLocation=c_script_4.b,
    cameraTarget=c_script_4.a,
    update=gate_not,
    scale=c_script_4.scale,
    northUp=c_script_4.northUp)  # -> out, a, b; inputs view: Guid, cameraLocation: Point3d, cameraTarget: Point3d, update: Boolean, scale: Double, northUp: Vector3d
# ---------- c_script_6: C# ----------
// Grasshopper Script Instance
#region Usings
using System;
using System.Linq;
using System.Collections;
using System.Collections.Generic;
using System.Drawing;

using Rhino;
using Rhino.Geometry;
using Rhino.DocObjects;

using Grasshopper;
using Grasshopper.Kernel;
using Grasshopper.Kernel.Data;
using Grasshopper.Kernel.Types;
#endregion

public class Script_Instance : GH_ScriptInstance
{
    #region Notes
    /* 
      Members:
        RhinoDoc RhinoDocument
        GH_Document GrasshopperDocument
        IGH_Component Component
        int Iteration

      Methods (Virtual & overridable):
        Print(string text)
        Print(string format, params object[] args)
        Reflect(object obj)
        Reflect(object obj, string method_name)
    */
    #endregion

    private void RunScript(
		Guid view,
		Point3d cameraLocation,
		Point3d cameraTarget,
		bool update,
		double scale,
		Vector3d northUp,
		ref object a,
		ref object b)
    {
        RhinoObject detailGeo = RhinoDocument.Objects.Find(view);
        DetailViewObject details = detailGeo as DetailViewObject;

        if (details==null)
        {
            return;
        }

        Rhino.Display.RhinoViewport vp = details.Viewport;


        Vector3d cameraDirection = cameraTarget-cameraLocation;
        
        //vp.SetCameraLocation(cameraLocation,false);
        //vp.SetCameraDirection(cameraDirection,false);
        vp.SetCameraTarget(cameraTarget,false);
        

        vp.SetCameraLocations(cameraTarget,cameraLocation);


        DetailView detailView = details.DetailGeometry;
        Rhino.UnitSystem sysUnits = Rhino.RhinoDoc.ActiveDoc.ModelUnitSystem;
        detailView.SetScale(1,sysUnits,scale,sysUnits);


        vp.CameraUp = northUp;
        


        if (update == true)
        {
            details.CommitChanges();
            details.CommitViewportChanges();
            detailGeo.CommitChanges();
            RhinoDocument.Views.Redraw();
        }
        else

        {
            return;
        }
        

    }
}
# ---------- end c_script_6 ----------
c_script_7 = CSharpScript(
    view=guid_6,
    cameraLocation=c_script_5.b,
    cameraTarget=c_script_5.a,
    update=gate_not,
    scale=c_script_5.scale,
    northUp=c_script_5.northUp)  # -> out, a, b; inputs view: Guid, cameraLocation: Point3d, cameraTarget: Point3d, update: Boolean, scale: Double, northUp: Vector3d; same code as c_script_6
list_item_2 = ListItem(List=addition, Index=0, Wrap=True)
c_script_8 = CSharpScript(view=guid_7, update=gate_not)  # -> out, a, b, width, height, scale; inputs view: Guid, update: Boolean; same code as c_script_3
graft_tree = GraftTree(Tree=c_script_3.scale, IncludeEmptyLists=True, IncludeNullItems=True)
curve_direction_2 = CurveDirection(Curve=polyline_3)
subtraction_5 = Subtraction()
panel_7 = Panel(c_script_8.scale)
c_script_9 = CSharpScript(view=graft(guid_7), cameraLocation=list_item_2, cameraTarget=list_item, update=gate_not, scale=graft_tree)  # -> out, a, b; inputs view: Guid, cameraLocation: Point3d, cameraTarget: Point3d, update: Boolean, scale: Double
# ---------- c_script_9: C# ----------
// Grasshopper Script Instance
#region Usings
using System;
using System.Linq;
using System.Collections;
using System.Collections.Generic;
using System.Drawing;

using Rhino;
using Rhino.Geometry;
using Rhino.DocObjects;

using Grasshopper;
using Grasshopper.Kernel;
using Grasshopper.Kernel.Data;
using Grasshopper.Kernel.Types;
#endregion

public class Script_Instance : GH_ScriptInstance
{
    #region Notes
    /* 
      Members:
        RhinoDoc RhinoDocument
        GH_Document GrasshopperDocument
        IGH_Component Component
        int Iteration

      Methods (Virtual & overridable):
        Print(string text)
        Print(string format, params object[] args)
        Reflect(object obj)
        Reflect(object obj, string method_name)
    */
    #endregion

    private void RunScript(
		Guid view,
		Point3d cameraLocation,
		Point3d cameraTarget,
		bool update,
		double scale,
		ref object a,
		ref object b)
    {
        RhinoObject detailGeo = RhinoDocument.Objects.Find(view);
        DetailViewObject details = detailGeo as DetailViewObject;

        if (details==null)
        {
            return;
        }

        Rhino.Display.RhinoViewport vp = details.Viewport;


        Vector3d cameraDirection = cameraTarget-cameraLocation;
        
        //vp.SetCameraLocation(cameraLocation,false);
        //vp.SetCameraDirection(cameraDirection,false);
        vp.SetCameraTarget(cameraTarget,false);
        

        vp.SetCameraLocations(cameraTarget,cameraLocation);


        DetailView detailView = details.DetailGeometry;
        Rhino.UnitSystem sysUnits = Rhino.RhinoDoc.ActiveDoc.ModelUnitSystem;
        detailView.SetScale(1,sysUnits,scale,sysUnits);
        


        if (update == true)
        {
            details.CommitChanges();
            details.CommitViewportChanges();
            detailGeo.CommitChanges();
            RhinoDocument.Views.Redraw();
        }
        else

        {
            return;
        }
        

    }
}
# ---------- end c_script_9 ----------
panel_8 = Panel(c_script_8.a)
panel_9 = Panel(c_script_8.b)
panel_10 = Panel(list_item)
panel_11 = Panel(list_item_2)
point_2 = Point(panel_9)
point_3 = Point(panel_8)
