# Grasshopper definition DeconstructText.gh (Grasshopper 1.0.8)

panel = Panel("test")
guid = Guid(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)
c_script = CSharpScript()  # -> out, a; inputs Pl: Plane, Text: String
# ---------- c_script: C# ----------
// Grasshopper Script Instance
#region Usings
using System;
using System.Linq;
using System.Collections;
using System.Collections.Generic;
using System.Drawing;

using Rhino;
using Rhino.Geometry;

using Grasshopper;
using Grasshopper.Kernel;
using Grasshopper.Kernel.Data;
using Grasshopper.Kernel.Types;
#endregion

public class Script_Instance : GH_ScriptInstance
{
    #region Notes
    /* 
      Members:
        RhinoDoc RhinoDocument
        GH_Document GrasshopperDocument
        IGH_Component Component
        int Iteration

      Methods (Virtual & overridable):
        Print(string text)
        Print(string format, params object[] args)
        Reflect(object obj)
        Reflect(object obj, string method_name)
    */
    #endregion

    private void RunScript(
		Plane Pl,
		string Text,
		object Justification,
		ref object a)
    {
        Rhino.Geometry.TextEntity txtE = new Rhino.Geometry.TextEntity();

        if (Text is null)
        {
            Component.AddRuntimeMessage(GH_RuntimeMessageLevel.Warning, "Text Failed to Collect Data.");
            return;
        }

        txtE.Plane = Pl;
        txtE.RichText = TextEntity.PlainTextToRtf(Text);
        //txtE.PlainText = y;

        if (Justification == null)
        {
            Component.AddRuntimeMessage(GH_RuntimeMessageLevel.Warning, "Not TextJustification Type.");
            Console.WriteLine("empty or null");
            return;
        }

        Rhino.Geometry.TextJustification just = (TextJustification)Justification;


        txtE.Justification = just;

        a = txtE;

    }
}
# ---------- end c_script ----------
c_script_2 = CSharpScript(TextID=guid)  # -> out, a, b, c, d, e; inputs TextID: Guid
# ---------- c_script_2: C# ----------
// Grasshopper Script Instance
#region Usings
using System;
using System.Linq;
using System.Collections;
using System.Collections.Generic;
using System.Drawing;

using Rhino;
using Rhino.Geometry;

using Grasshopper;
using Grasshopper.Kernel;
using Grasshopper.Kernel.Data;
using Grasshopper.Kernel.Types;
#endregion

public class Script_Instance : GH_ScriptInstance
{
    #region Notes
    /* 
      Members:
        RhinoDoc RhinoDocument
        GH_Document GrasshopperDocument
        IGH_Component Component
        int Iteration

      Methods (Virtual & overridable):
        Print(string text)
        Print(string format, params object[] args)
        Reflect(object obj)
        Reflect(object obj, string method_name)
    */
    #endregion

    private void RunScript(
		Guid TextID,
		ref object a,
		ref object b,
		ref object c,
		ref object d,
		ref object e)
    {
        var obj = RhinoDocument.Objects.FindId(TextID);

        var TextEntity = obj.Geometry as Rhino.Geometry.TextEntity;

        a = TextEntity;
        b = TextEntity.PlainText;
        c = TextEntity.PlainTextWithFields;
        d = TextEntity.Plane;
        e = TextEntity.Justification;

    }
}
# ---------- end c_script_2 ----------
panel_2 = Panel(c_script_2.a)
panel_3 = Panel(c_script_2.b)
number_slider = Slider(40, range=0..100)
text_split = TextSplit(Text=c_script_2.c, Separators="\")
series = Series(Start="41", Step=1, Count=number_slider)
list_length = ListLength(List=text_split)  # -> expr("x-1", Length)
concatenate = Concatenate(Fragment_A="\C", Fragment_B=series, A="\")>%")  # -> graft(Result)
cull_index = CullIndex(List=text_split, Indices=list_length, Wrap=True)
text_join = TextJoin(Text=cull_index, Join="\")
weave = Weave(Pattern=[0, 1], Stream0=text_join, Stream1=concatenate, NullGaps=False)
plane = Plane(c_script_2.d)
deconstruct_plane = DeconstructPlane(Plane=plane)  # -> Origin, XAxis, YAxis, ZAxis
series_2 = Series(Start=0, Step="0.125", Count=number_slider)
text_join_2 = TextJoin(Text=weave)  # -> flatten(Result)
unit_y = UnitY(Factor=series_2)
text = Text(text_join_2)
negative = Negative(Value=unit_y)
addition = Addition(A=deconstruct_plane.Origin, B=negative)
xy_plane = XYPlane(Origin=addition)
c_script_3 = CSharpScript(x=xy_plane, y=text, z=c_script_2.e)  # -> out, a; inputs x: Plane, y: String
# ---------- c_script_3: C# ----------
// Grasshopper Script Instance
#region Usings
using System;
using System.Linq;
using System.Collections;
using System.Collections.Generic;
using System.Drawing;

using Rhino;
using Rhino.Geometry;

using Grasshopper;
using Grasshopper.Kernel;
using Grasshopper.Kernel.Data;
using Grasshopper.Kernel.Types;
#endregion

public class Script_Instance : GH_ScriptInstance
{
    #region Notes
    /* 
      Members:
        RhinoDoc RhinoDocument
        GH_Document GrasshopperDocument
        IGH_Component Component
        int Iteration

      Methods (Virtual & overridable):
        Print(string text)
        Print(string format, params object[] args)
        Reflect(object obj)
        Reflect(object obj, string method_name)
    */
    #endregion

    private void RunScript(Plane x, string y, object z, ref object a)
    {
        Rhino.Geometry.TextEntity txtE = new Rhino.Geometry.TextEntity();

        txtE.Plane = x;
        txtE.RichText = TextEntity.PlainTextToRtf(y);
        //txtE.PlainText = y;


        Rhino.Geometry.TextJustification just = (TextJustification)z;

        txtE.Justification = just;

        a = txtE;

    }
}
# ---------- end c_script_3 ----------
panel_4 = Panel(c_script_3.a)
