# Grasshopper definition Heading & Main Settings.gh (Grasshopper 1.0.8)
# plug-ins: Pufferfish

# | Angle | Direction |
# | ----- | --------- |
# | 0°    | North     |
# | 90°   | East      |
# | 180°  | South     |
# | 270°  | West      |
point = Point(<point referenced from the Rhino model>)
curve = Curve(<curve referenced from the Rhino model>)

# ---- group: Compass
c_script = CSharpScript(size=Slider(54, range=0..100), point=point)  # -> out, a; inputs size: Double, point: Point3d
# ---------- c_script: C# ----------
// Grasshopper Script Instance
#region Usings
using System;
using System.Linq;
using System.Collections;
using System.Collections.Generic;
using System.Drawing;

using Rhino;
using Rhino.Geometry;

using Grasshopper;
using Grasshopper.Kernel;
using Grasshopper.Kernel.Data;
using Grasshopper.Kernel.Types;
#endregion

public class Script_Instance : GH_ScriptInstance
{
    #region Notes
    /* 
      Members:
        RhinoDoc RhinoDocument
        GH_Document GrasshopperDocument
        IGH_Component Component
        int Iteration

      Methods (Virtual & overridable):
        Print(string text)
        Print(string format, params object[] args)
        Reflect(object obj)
        Reflect(object obj, string method_name)
    */
    #endregion

    private void RunScript(double size, Point3d point, ref object a)
    {
        //Directions
        Vector3d North = new Vector3d(0,1,0);
        Vector3d South = new Vector3d(0,-1,0);
        Vector3d East = new Vector3d(1,0,0);
        Vector3d West = new Vector3d(-1,0,0);

        double extension = 1.5;

        Rhino.Geometry.Circle compassBase = new Rhino.Geometry.Circle(point, size);

        Rhino.Geometry.Line north = new Rhino.Geometry.Line(point, North,size *extension);
        Rhino.Geometry.Line south = new Rhino.Geometry.Line(point, South, size*extension);
        Rhino.Geometry.Line east = new Rhino.Geometry.Line(point,East, size*extension);
        Rhino.Geometry.Line west = new Rhino.Geometry.Line(point, West, size*extension);

        //North Label
        Rhino.Geometry.TextEntity N = new Rhino.Geometry.TextEntity();
        N.Plane = new Plane(north.To, Vector3d.XAxis, Vector3d.YAxis);
        N.PlainText = "N";
        N.TextHeight = 2;
        N.Justification = TextJustification.MiddleCenter;

        //South Label
        Rhino.Geometry.TextEntity S = new Rhino.Geometry.TextEntity();
        S.Plane = new Plane(south.To, Vector3d.XAxis, Vector3d.YAxis);
        S.PlainText = "S";
        S.TextHeight = 2;
        S.Justification = TextJustification.MiddleCenter;
        
        //East Label
        Rhino.Geometry.TextEntity E = new Rhino.Geometry.TextEntity();
        E.Plane = new Plane(east.To, Vector3d.XAxis, Vector3d.YAxis);
        E.PlainText = "E";
        E.TextHeight = 2;
        E.Justification = TextJustification.MiddleCenter;

        //West Label
        Rhino.Geometry.TextEntity W = new Rhino.Geometry.TextEntity();
        W.Plane = new Plane(west.To, Vector3d.XAxis, Vector3d.YAxis);
        W.PlainText = "W";
        W.TextHeight = 2;
        W.Justification = TextJustification.MiddleCenter;

        List<Object> compass = new List<Object>();
        compass.Add(compassBase);
        compass.Add(north);
        compass.Add(south);
        compass.Add(east);
        compass.Add(west);

        compass.Add(N);
        compass.Add(S);
        compass.Add(E);
        compass.Add(W);



        a = compass;
    }
}
# ---------- end c_script ----------

# ----
c_script_2 = CSharpScript(
    flyToWaylineMode="XXXX",
    finishAction="XXXX",
    exitOnRCLost="XXXX",
    executeRCLostAction="XXXX",
    globalTransitionalSpeed=Slider(2.5, range=0..10))  # -> out, missionConfig, settings; inputs flyToWaylineMode: String, finishAction: String, exitOnRCLost: String, executeRCLostAction: String, globalTransitionalSpeed: Double
# ---------- c_script_2: C# ----------
// Grasshopper Script Instance
#region Usings
using System;
using System.Linq;
using System.Collections;
using System.Collections.Generic;
using System.Drawing;

using Rhino;
using Rhino.Geometry;

using Grasshopper;
using Grasshopper.Kernel;
using Grasshopper.Kernel.Data;
using Grasshopper.Kernel.Types;
#endregion

public class Script_Instance : GH_ScriptInstance
{
    #region Notes
    /* 
      Members:
        RhinoDoc RhinoDocument
        GH_Document GrasshopperDocument
        IGH_Component Component
        int Iteration

      Methods (Virtual & overridable):
        Print(string text)
        Print(string format, params object[] args)
        Reflect(object obj)
        Reflect(object obj, string method_name)
    */
    #endregion

    private void RunScript(
		string flyToWaylineMode,
		string finishAction,
		string exitOnRCLost,
		string executeRCLostAction,
		double globalTransitionalSpeed,
		ref object missionConfig,
		ref object settings)
    {


        //MISSION CONFIG


        //Header Section
        string header = @"<?xml version=""1.0"" encoding=""UTF-8""?>" +
        Environment.NewLine + 
        @"<kml xmlns=""http://www.opengis.net/kml/2.2"" xmlns:wpml=""http://www.uav.com/wpmz/1.0.2"">" + Environment.NewLine;


        //Document
        string document = @"    <Document>
        <wpml:missionConfig>
            <wpml:flyToWaylineMode>" + flyToWaylineMode + @"</wpml:flyToWaylineMode>
            <wpml:finishAction>" + finishAction + @"</wpml:finishAction>
            <wpml:exitOnRCLost>" + exitOnRCLost + @"</wpml:exitOnRCLost>
            <wpml:executeRCLostAction>" + executeRCLostAction + @"</wpml:executeRCLostAction>
            <wpml:globalTransitionalSpeed>" + globalTransitionalSpeed + @"</wpml:globalTransitionalSpeed>
            <wpml:droneInfo>
                <wpml:droneEnumValue>68</wpml:droneEnumValue>
                <wpml:droneSubEnumValue>0</wpml:droneSubEnumValue>
            </wpml:droneInfo>
        </wpml:missionConfig>";


        //Settings
        string settingmode = 
        flyToWaylineMode + Environment.NewLine +
        finishAction + Environment.NewLine +
        exitOnRCLost + Environment.NewLine +
        executeRCLostAction + Environment.NewLine +
        globalTransitionalSpeed + " m/s";


        missionConfig = header + document;

        settings = settingmode;


    }
}
# ---------- end c_script_2 ----------
graft_tree = GraftTree(Tree=curve, IncludeEmptyLists=True, IncludeNullItems=True)
negative = Negative(Value=Slider(18.5, range=0..100))
point_2 = Point(<point referenced from the Rhino model>)
number_slider = Slider(0.313, range=0..1)  # disabled
c_script_3 = CSharpScript(
    missionConfig=c_script_2.missionConfig,
    executeHeightMode="relativeToStartPoint",
    flightPath=graft_tree,
    height=Slider(40.5, range=0..100),
    gimbalPitchRotateAngle=negative,
    POI=point_2)  # -> out, a, b, c; inputs missionConfig: String, executeHeightMode: String, flightPath: Curve, height: Double, gimbalPitchRotateAngle: Double, POI: Point3d
# ---------- c_script_3: C# ----------
// Grasshopper Script Instance
#region Usings
using System;
using System.Linq;
using System.Collections;
using System.Collections.Generic;
using System.Drawing;

using Rhino;
using Rhino.Geometry;

using Grasshopper;
using Grasshopper.Kernel;
using Grasshopper.Kernel.Data;
using Grasshopper.Kernel.Types;
#endregion

public class Script_Instance : GH_ScriptInstance
{
    #region Notes
    /* 
      Members:
        RhinoDoc RhinoDocument
        GH_Document GrasshopperDocument
        IGH_Component Component
        int Iteration

      Methods (Virtual & overridable):
        Print(string text)
        Print(string format, params object[] args)
        Reflect(object obj)
        Reflect(object obj, string method_name)
    */
    #endregion

    private void RunScript(
		string missionConfig,
		string executeHeightMode,
		Curve flightPath,
		double height,
		double gimbalPitchRotateAngle,
		Point3d POI,
		ref object a,
		ref object b,
		ref object c)
    {
        //Folder Start
        string folderStart = missionConfig + @"
        <Folder>
            <wpml:templateId>0</wpml:templateId>
            <wpml:executeHeightMode>relativeToStartPoint</wpml:executeHeightMode>
            <wpml:waylineId>0</wpml:waylineId>
            <wpml:distance>0</wpml:distance>
            <wpml:duration>0</wpml:duration>
            <wpml:autoFlightSpeed>2.5</wpml:autoFlightSpeed>";

        Point3d[] pts;
        double[] waypoints = flightPath.DivideByCount(10,true, out pts );
        
        List<double> X = new List<double>();
        List<double> Y = new List<double>();

        c = pts;
        
        //Point Coordinates
        foreach (Point3d p in pts)
        {
            double XCoord = p.X;
            double YCoord = p.Y;

            X.Add(XCoord);
            Y.Add(YCoord);

        }

        //Tangent Vector
        List<double> angle = new List<double>();
        List<Plane> DroneOri = new List<Plane>();
        List<Vector3d> tangent = new List<Vector3d>();

        foreach (double i in waypoints)
        {
            Vector3d vector = flightPath.TangentAt(i);
            double flightAngle = Vector3d.VectorAngle(vector,Vector3d.YAxis, Plane.WorldXY);
            double flightAngleDegrees = Rhino.RhinoMath.ToDegrees(flightAngle);
            angle.Add(flightAngleDegrees);
            tangent.Add(vector);

            //Cross Product
            //Drone Orientation
            Vector3d perpV = Vector3d.CrossProduct(vector,Vector3d.ZAxis);
            Plane ori = new Plane(flightPath.PointAt(i), perpV, vector);
            DroneOri.Add(ori);
        }



        b = tangent;
        
        //Point of Interest
        if (POI == null)
        {
            POI=new Point3d (0.000000,0.000000,0.000000);
        }
        else
        {
            double poiX = POI.X;
            double poiY = POI.Y;
            double poiZ = POI.Z;

            Rhino.Geometry.Point3d POIpt = new Point3d (poiX,poiY,poiZ);

        }




        List<string> placeholder = new List<string>();
        for (int i = 0; i < X.Count; i++)
        {
            double x = X[i];
            double y = Y[i];
            double an = angle[i];


            string coordinates = $@"
            <Placemark>
                <Point>
                    <coordinates>
                        {x},{y}
                    </coordinates>
                </Point>
                <wpml:index>0</wpml:index>
                <wpml:executeHeight>{height}</wpml:executeHeight>
                <wpml:waypointSpeed>2.5</wpml:waypointSpeed>
                <wpml:waypointHeadingParam>
                    <wpml:waypointHeadingMode>smoothTransition</wpml:waypointHeadingMode>
                    <wpml:waypointHeadingAngle>{an}</wpml:waypointHeadingAngle>
                    <wpml:waypointPoiPoint>{POI}</wpml:waypointPoiPoint>
                    <wpml:waypointHeadingAngleEnable>1</wpml:waypointHeadingAngleEnable>
                    <wpml:waypointHeadingPathMode>followBadArc</wpml:waypointHeadingPathMode>
                    <wpml:waypointHeadingPoiIndex>0</wpml:waypointHeadingPoiIndex>
                </wpml:waypointHeadingParam>
                <wpml:waypointTurnParam>
                    <wpml:waypointTurnMode>toPointAndStopWithContinuityCurvature</wpml:waypointTurnMode>
                    <wpml:waypointTurnDampingDist>0</wpml:waypointTurnDampingDist>
                </wpml:waypointTurnParam>
                <wpml:useStraightLine>0</wpml:useStraightLine>
                <wpml:actionGroup>
                    <wpml:actionGroupId>1</wpml:actionGroupId>
                    <wpml:actionGroupStartIndex>0</wpml:actionGroupStartIndex>
                    <wpml:actionGroupEndIndex>0</wpml:actionGroupEndIndex>
                    <wpml:actionGroupMode>parallel</wpml:actionGroupMode>
                    <wpml:actionTrigger>
                        <wpml:actionTriggerType>reachPoint</wpml:actionTriggerType>
                    </wpml:actionTrigger>
                    <wpml:action>
                        <wpml:actionId>1</wpml:actionId>
                        <wpml:actionActuatorFunc>gimbalRotate</wpml:actionActuatorFunc>
                        <wpml:actionActuatorFuncParam>
                            <wpml:gimbalHeadingYawBase>aircraft</wpml:gimbalHeadingYawBase>
                            <wpml:gimbalRotateMode>absoluteAngle</wpml:gimbalRotateMode>
                            <wpml:gimbalPitchRotateEnable>1</wpml:gimbalPitchRotateEnable>
                            <wpml:gimbalPitchRotateAngle>{gimbalPitchRotateAngle}</wpml:gimbalPitchRotateAngle>
                            <wpml:gimbalRollRotateEnable>1</wpml:gimbalRollRotateEnable>
                            <wpml:gimbalRollRotateAngle>0</wpml:gimbalRollRotateAngle>
                            <wpml:gimbalYawRotateEnable>0</wpml:gimbalYawRotateEnable>
                            <wpml:gimbalYawRotateAngle>0</wpml:gimbalYawRotateAngle>
                            <wpml:gimbalRotateTimeEnable>0</wpml:gimbalRotateTimeEnable>
                            <wpml:gimbalRotateTime>0</wpml:gimbalRotateTime>
                            <wpml:payloadPositionIndex>0</wpml:payloadPositionIndex>
                        </wpml:actionActuatorFuncParam>
                    </wpml:action>
                    </wpml:actionGroup>
                <wpml:actionGroup>
                    <wpml:actionGroupId>2</wpml:actionGroupId>
                    <wpml:actionGroupStartIndex>0</wpml:actionGroupStartIndex>
                    <wpml:actionGroupEndIndex>1</wpml:actionGroupEndIndex>
                    <wpml:actionGroupMode>parallel</wpml:actionGroupMode>
                    <wpml:actionTrigger>
                        <wpml:actionTriggerType>reachPoint</wpml:actionTriggerType>
                    </wpml:actionTrigger>
                    <wpml:action>
                        <wpml:actionId>2</wpml:actionId>
                        <wpml:actionActuatorFunc>gimbalEvenlyRotate</wpml:actionActuatorFunc>
                        <wpml:actionActuatorFuncParam>
                        <wpml:gimbalPitchRotateAngle>-18.5</wpml:gimbalPitchRotateAngle>
                        <wpml:gimbalRollRotateAngle>0</wpml:gimbalRollRotateAngle>
                        <wpml:payloadPositionIndex>0</wpml:payloadPositionIndex>
                        </wpml:actionActuatorFuncParam>
                    </wpml:action>
                    </wpml:actionGroup>
                <wpml:waypointGimbalHeadingParam>
                    <wpml:waypointGimbalPitchAngle>0</wpml:waypointGimbalPitchAngle>
                    <wpml:waypointGimbalYawAngle>0</wpml:waypointGimbalYawAngle>
                </wpml:waypointGimbalHeadingParam>
            </Placemark>";

            placeholder.Add(coordinates);

        }

        //Folder End
        string folderEnd = @"
        </Folder>
    </Document>
</kml>";



        a = folderStart + string.Join("",placeholder) + folderEnd;

    }
}
# ---------- end c_script_3 ----------
panel = Panel(c_script_2.missionConfig)
panel_2 = Panel(c_script_2.settings)
divide_curve = DivideCurve(Curve=curve, Count=Slider(12, range=0..100), Kinks=False)  # -> Points, Tangents, Parameters
point_3 = Point(c_script_3.c)
evaluate_curve = EvaluateCurve(Curve=reparameterize(curve), Parameter=number_slider)  # -> Point, Tangent, Angle; disabled
shift_list = ShiftList(List=divide_curve.Tangents, Shift=1, Wrap=invert(True))
panel_3 = Panel("20")  # disabled
vector_display = VectorDisplay(Anchor=point, Vector=expr("x*50", c_script_3.b))
subtraction = Subtraction(A=point_2, B=point_3)
number_slider_2 = Slider(0.153, range=0..1)
tween_two_vectors = TweenTwoVectors(VectorA=divide_curve.Tangents, VectorB=shift_list, Factor=0.5)
shatter = Shatter(Curve=curve, Parameters=divide_curve.Parameters)
vector_display_2 = VectorDisplay(Anchor=point_3, Vector=subtraction)
line_sdl = LineSDL(Start=evaluate_curve.Point, Direction=evaluate_curve.Tangent, Length=panel_3)  # disabled
panel_4 = Panel(c_script_3.a)
pipe = Pipe(Curve=line_sdl, Radius=1, Caps=0, FitRail=False)  # disabled
tween_through_vectors = TweenThroughVectors(
    Vectors=divide_curve.Tangents,
    Factor=number_slider_2,
    Normalized=True,
    Equalized=False,
    Weighted=False,
    Loopback=False,
    Degree=3,
    InterpolationType="1")
curve_middle = CurveMiddle(Curve=shatter)
evaluate_curve_2 = EvaluateCurve(Curve=reparameterize(curve), Parameter=number_slider_2)  # -> graft(Point), Tangent, Angle
c_script_4 = CSharpScript(vectors=divide_curve.Tangents, t=number_slider_2)  # -> out, a; inputs vectors: list of Vector3d, t: Double
# ---------- c_script_4: C# ----------
// Grasshopper Script Instance
#region Usings
using System;
using System.Linq;
using System.Collections;
using System.Collections.Generic;
using System.Drawing;

using Rhino;
using Rhino.Geometry;

using Grasshopper;
using Grasshopper.Kernel;
using Grasshopper.Kernel.Data;
using Grasshopper.Kernel.Types;
#endregion

public class Script_Instance : GH_ScriptInstance
{
    #region Notes
    /* 
      Members:
        RhinoDoc RhinoDocument
        GH_Document GrasshopperDocument
        IGH_Component Component
        int Iteration

      Methods (Virtual & overridable):
        Print(string text)
        Print(string format, params object[] args)
        Reflect(object obj)
        Reflect(object obj, string method_name)
    */
    #endregion

    private void RunScript(List<Vector3d> vectors, double t, ref object a)
    {
        int n = vectors.Count - 1;

        double scaled = t * n;
        int i = (int)Math.Floor(scaled);

        if (i >= n)
        {
            a = vectors[n];
            return;
        }

        double localT = scaled - i;

        a = (1 - localT) * vectors[i] + localT * vectors[i + 1];
    }
}
# ---------- end c_script_4 ----------
vector_display_3 = VectorDisplay(Anchor=divide_curve.Points, Vector=divide_curve.Tangents)
vector_display_4 = VectorDisplay(Anchor=evaluate_curve_2.Point, Vector=tween_through_vectors)
vector_display_5 = VectorDisplay(Anchor=evaluate_curve_2.Point, Vector=c_script_4.a)
