# Grasshopper definition Extract Layers.gh (Grasshopper 1.0.8)

c_script = CSharpScript()  # -> out, a, b
# ---------- c_script: C# ----------
// Grasshopper Script Instance
#region Usings
using System;
using System.Linq;
using System.Collections;
using System.Collections.Generic;
using System.Drawing;

using Rhino;
using Rhino.Geometry;
using Rhino.DocObjects;

using Grasshopper;
using Grasshopper.Kernel;
using Grasshopper.Kernel.Data;
using Grasshopper.Kernel.Types;
#endregion

public class Script_Instance : GH_ScriptInstance
{
    #region Notes
    /* 
      Members:
        RhinoDoc RhinoDocument
        GH_Document GrasshopperDocument
        IGH_Component Component
        int Iteration

      Methods (Virtual & overridable):
        Print(string text)
        Print(string format, params object[] args)
        Reflect(object obj)
        Reflect(object obj, string method_name)
    */
    #endregion

    private void RunScript(ref object a, ref object b)
    {
        RhinoDoc doc = RhinoDoc.ActiveDoc;
        List<string> layerNames = new List<string>();
        List<Color> color = new List<Color>();

        foreach (Layer layer in doc.Layers)
        {
            // Ensure the layer is active and not deleted
            if (!layer.IsDeleted)
            {
                layerNames.Add(layer.FullPath);
                color.Add(layer.Color);
            }
        }

        a = layerNames;
        b = color;
    }
}
# ---------- end c_script ----------
panel = Panel(c_script.a)
panel_2 = Panel(c_script.b)
