# Grasshopper definition filemods (1).gh (Grasshopper 1.0.8)
# plug-ins: RhinoCodePluginGH

folder = Panel("C:\Users\clark.cheng\Documents")
subfolders = BooleanToggle(False)
name_patterns = Panel("")
find_files = CSharpScript(Dir=folder, Pat=name_patterns, Sub=subfolders)  # -> out, Files; inputs Dir: String, Pat: list of String, Sub: Boolean
# ---------- find_files: C# ----------
    SearchOption options = SearchOption.TopDirectoryOnly;
    if (Sub)
      options = SearchOption.AllDirectories;

    HashSet<string> files = new HashSet<string>();
    foreach(string pattern in Pat)
      files.UnionWith(System.IO.Directory.GetFiles(Dir, pattern, options));

    Files = files;
# ---------- end find_files ----------
c_script = CSharpScript(Directory=folder, Sub=Toggle(False))  # -> out, Files; inputs Directory: String, Pattern: list of String, Sub: Boolean
# ---------- c_script: C# ----------
// Grasshopper Script Instance
#region Usings
using System.IO;
using System.Linq;
using System.Data;
using System.Drawing;
using System.Reflection;
using System.Windows.Forms;
using System.Xml;
using System.Xml.Linq;
using System.Runtime.InteropServices;
using System.Collections.Generic;


using Rhino.DocObjects;
using Rhino.Collections;
using GH_IO;
using GH_IO.Serialization;


#endregion

public class Script_Instance : GH_ScriptInstance
{
    #region Notes
    /* 
      Members:
        RhinoDoc RhinoDocument
        GH_Document GrasshopperDocument
        IGH_Component Component
        int Iteration

      Methods (Virtual & overridable):
        Print(string text)
        Print(string format, params object[] args)
        Reflect(object obj)
        Reflect(object obj, string method_name)
    */
    #endregion

    private void RunScript(
	string Directory,
	List<string> Pattern,
	bool Sub,
	ref object Files)
    {
        
        //Default variables
        List<string> defaultPattern=new List<string>{"*"};
        
        
        if (Pattern ==null) Pattern=defaultPattern;

        SearchOption options = SearchOption.TopDirectoryOnly;
        if (Sub)
            options = SearchOption.AllDirectories;

        HashSet<string> files = new HashSet<string>();
        foreach (string pattern in Pattern)
            files.UnionWith(System.IO.Directory.GetFiles(Directory, pattern, options));

        // If Files is a List<string>
        Files = files.ToList();  // Convert HashSet to List

        // If Files is a HashSet<string>, this would work directly:
        Files = files;

    }
}
# ---------- end c_script ----------
folder_2 = Panel("C:\Users\clark.cheng\Downloads")
panel = Panel(c_script.Files)
copy = BooleanToggle(True)
move_file = CSharpScript(File=find_files.Files, Folder=folder_2, Copy=copy)  # -> out, A; inputs File: String, Folder: String, Copy: Boolean; disabled
# ---------- move_file: C# ----------
    string newPath = Folder + System.IO.Path.GetFileName(File);
    System.IO.File.Copy(File, newPath, true);

    if (!Copy)
    {
      Microsoft.VisualBasic.FileIO.FileSystem.DeleteFile(
        File,
        Microsoft.VisualBasic.FileIO.UIOption.OnlyErrorDialogs,
        Microsoft.VisualBasic.FileIO.RecycleOption.SendToRecycleBin);
    }
# ---------- end move_file ----------
c_script_2 = CSharpScript(File=c_script.Files, Folder=folder_2, Copy=copy)  # -> a; inputs File: String, Folder: String, Copy: Boolean; disabled
# ---------- c_script_2: C# ----------
// Grasshopper Script Instance
#region Usings
using System;
using System.Linq;
using System.Collections;
using System.Collections.Generic;
using System.Drawing;

using Rhino;
using Rhino.Geometry;

using Grasshopper;
using Grasshopper.Kernel;
using Grasshopper.Kernel.Data;
using Grasshopper.Kernel.Types;
#endregion

public class Script_Instance : GH_ScriptInstance
{
    #region Notes
    /* 
      Members:
        RhinoDoc RhinoDocument
        GH_Document GrasshopperDocument
        IGH_Component Component
        int Iteration

      Methods (Virtual & overridable):
        Print(string text)
        Print(string format, params object[] args)
        Reflect(object obj)
        Reflect(object obj, string method_name)
    */
    #endregion

    private void RunScript(string File, string Folder, bool Copy, ref object a)
    {   

        //Declare backslash separator
        string backslash=@"\";

        //Declare string filepath
        string newPath = Folder + backslash + System.IO.Path.GetFileName(File);
        System.IO.File.Copy(File, newPath, true);

        //Output filepath
        a=newPath;

        if (!Copy)
        {
        Microsoft.VisualBasic.FileIO.FileSystem.DeleteFile(
            File,
            Microsoft.VisualBasic.FileIO.UIOption.OnlyErrorDialogs,
            Microsoft.VisualBasic.FileIO.RecycleOption.SendToRecycleBin);
        }
    }
}
# ---------- end c_script_2 ----------
panel_2 = Panel(c_script_2)
