# Grasshopper definition IsTri_working.gh (Grasshopper 1.0.8)
# plug-ins: RhinoCodePluginGH, Heteroptera, Pufferfish

polygon = Polygon(Plane=PlaneXY(0, 0, 0), Radius=3, Segments=6, FilletRadius=0)  # -> Polygon, Length
polygon_2 = Polygon(Plane=PlaneXY(0, 0, 0), Radius=3, Segments="3", FilletRadius=0)  # -> Polygon, Length
populate_2d = Populate2D(Region={Plane=PlaneXY(0, 0, 0), Size=Domain2(u=0..20, v=0..10)}, Count=Slider(15, range=0..100), Seed=1)
center = Center(Geometry=polygon.Polygon)  # -> Center, Dimension
center_2 = Center(Geometry=polygon_2.Polygon)  # -> Center, Dimension
partition_list = PartitionList(List=populate_2d, Size="3")
explode_tree = ExplodeTree(Data=partition_list)  # -> Branch0, Branch1, Branch2, Branch3, Branch4
move_to_point = MoveToPoint(Geometry=polygon_2.Polygon, PointA=center_2.Center, PointB=explode_tree.Branch1)  # -> Moved, Vector, Transform
move_to_point_2 = MoveToPoint(Geometry=polygon.Polygon, PointA=center.Center, PointB=explode_tree.Branch0)  # -> Moved, Vector, Transform
merge = Merge(Data1=move_to_point_2.Moved, Data2=move_to_point.Moved)  # -> flatten(Result)
c_script = CSharpScript(Polygon=merge)  # -> out, Pattern; inputs Polygon: Polyline
#   port Polygon: Polygon for Testing
#   port Pattern: Boolean Pattern
# ---------- c_script: C# ----------
// Grasshopper Script Instance
#region Usings
using System;
using System.Linq;
using System.Collections;
using System.Collections.Generic;
using System.Drawing;

using Rhino;
using Rhino.Geometry;

using Grasshopper;
using Grasshopper.Kernel;
using Grasshopper.Kernel.Data;
using Grasshopper.Kernel.Types;
#endregion

public class Script_Instance : GH_ScriptInstance
{
    #region Notes
    /* 
      Members:
        RhinoDoc RhinoDocument
        GH_Document GrasshopperDocument
        IGH_Component Component
        int Iteration

      Methods (Virtual & overridable):
        Print(string text)
        Print(string format, params object[] args)
        Reflect(object obj)
        Reflect(object obj, string method_name)
    */
    #endregion

    private void RunScript(Polyline Polygon, ref object Pattern)
    {
        // Write your logic here

        //Sanity checks
        if (Polygon==null)
        {
            this.AddRuntimeMessage(GH_RuntimeMessageLevel.Warning,"Input parameter Polygon failed to collect data");
            return;
        }


        int segcount=Polygon.SegmentCount;
        
        
        List<bool> IsTri= new List<bool>{};

        if (segcount ==3)
        {
            
            IsTri.Add(true);

        }
        else
        {
            
            IsTri.Add(false);
        }
        
        DataTree<bool> IsTri_tree=new DataTree<bool>(IsTri);
        IsTri_tree.Flatten();
        Pattern=IsTri_tree;

        
    }
}
# ---------- end c_script ----------
cull_pattern = CullPattern(List=merge, CullPattern=c_script.Pattern)
