# Grasshopper definition Jarvis March Component Example.gh (Grasshopper 1.0.8)
# plug-ins: RhinoCodePluginGH

point = Point(flatten(Tree({0;0;0;0;0}: [Point(9.259724618, -58.30504397, 0), Point(92.03907819, -70.30667624, 0), Point(116.1386943, -34.97378236, 0), Point(89.98230627, -15.37592787, 0), Point(24.44646307, -8.463179544, 0)], {0;0;0;1;0}: [Point(77.32193395, -16.07093124, 0), Point(89.12565531, -28.07256352, 0), Point(113.2252714, 65.87905505, 0), Point(139.5649061, -9.327669253, 0), Point(93.39393366, 20.57256219, 0)], {0;0;0;2;0}: [Point(129.3607829, -19.12075518, 0), Point(170.4115528, -31.12238746, 0), Point(265.052346, 4.210506432, 0), Point(168.3547809, 77.77898717, 0), Point(202.2806697, 39.97439012, 0)], {0;0;0;3;0}: [Point(207.277742, -63.67372541, 0), Point(248.3285119, -75.67535769, 0), Point(259.7076455, -40.3424638, 0), Point(211.9972712, -26.13020799, 0), Point(206.006587, -20.92341486, 0)], {0;0;0;4;0}: [Point(163.1918653, -129.5591184, 0), Point(204.2426352, -178.9136899, 0), Point(228.3422513, -106.2278568, 0), Point(202.1858633, -72.38929516, 0), Point(44.30942874, -177.8876516, 0)], {0;0;0;5;0}: [Point(33.79368338, -95.70498409, 0), Point(101.6250718, -109.2209247, 0), Point(125.7246879, -73.88803082, 0), Point(99.56829989, -40.04946921, 0), Point(59.30314695, -54.46898188, 0)])))
c_script = CSharpScript(Points=point)  # -> Hull_Points, Polyline; inputs Points: list of Point3d
#   port Points: Points for Jarvis March solution.
#   port Hull_Points: Convex Hull points.
#   port Polyline: Convex Hull in world space.
# ---------- c_script: C# ----------
// Grasshopper Script Instance
#region Usings
using System;
using System.Linq;
using System.Collections;
using System.Collections.Generic;
using System.Drawing;

using Rhino;
using Rhino.Geometry;

using Grasshopper;
using Grasshopper.Kernel;
using Grasshopper.Kernel.Data;
using Grasshopper.Kernel.Types;
#endregion

public class Script_Instance : GH_ScriptInstance
{
    #region Notes
    /* 
      Members:
        RhinoDoc RhinoDocument
        GH_Document GrasshopperDocument
        IGH_Component Component
        int Iteration

      Methods (Virtual & overridable):
        Print(string text)
        Print(string format, params object[] args)
        Reflect(object obj)
        Reflect(object obj, string method_name)
    */
    #endregion

    private void RunScript(
	List<Point3d> Points,
	ref object Hull_Points,
	ref object Polyline)
    {

        //Sanity
        if (Points==null)
        {
            this.AddRuntimeMessage(GH_RuntimeMessageLevel.Error, "Input parameter Points failed to collect data");
            return;
        }

        
        
        


        //Checking if any points to calculate
        int pt_count=Points.Count();

        if (pt_count==0)
        {
            this.AddRuntimeMessage(GH_RuntimeMessageLevel.Warning, "Input parameter Point failed to collect data");
            return;
        }



        
        List<Point3d>Jarvis_pts=new List<Point3d>();
        List<Vector3d> largest_v=new List<Vector3d>();

        

        //Logic for master point only START
        // Assuming Points is a list or array of Point3d objects
        List<Point3d> points = new List<Point3d>(Points);

        

        // Sort points by their X values
        points.Sort((p1, p2) => p1.X.CompareTo(p2.X));

        // Isolate the first point in the sorted list
        Point3d firstPoint = points[0];  // The first point

        // Vector representing the X-axis
        Vector3d xAxis = new Vector3d(1, 0, 0);

        // Variables to keep track of the largest angle and the corresponding point
        double largestAngle = 0;
        Point3d pointWithLargestAngle = firstPoint;

        // Calculate the angles with respect to the X-axis
        foreach (Point3d point in points)
        {
            // Create a vector from firstPoint to the current point
            Vector3d diff = new Vector3d(point.X - firstPoint.X, point.Y - firstPoint.Y, point.Z - firstPoint.Z);

            // Calculate the angle between the vector and the X-axis
            double angle = Vector3d.VectorAngle(diff, xAxis);

            // Check if this is the largest angle
            if (angle > largestAngle)
            {
                largestAngle = angle;
                pointWithLargestAngle = point;  // Store the point with the largest angle
            }
        }

        // Output the point with the largest angle
        Jarvis_pts.Add(firstPoint);
        Jarvis_pts.Add(pointWithLargestAngle);

        double f_x=firstPoint.X;
        double f_y=firstPoint.Y;
        double f_z=firstPoint.Z;

        double end_value=f_x+f_y+f_z;
        
        
        

        Vector3d initial_vector = new Vector3d(pointWithLargestAngle.X - firstPoint.X, pointWithLargestAngle.Y - firstPoint.Y, pointWithLargestAngle.Z - firstPoint.Z);

        largest_v.Add(initial_vector);

        
        //Logic for master point only END

        

        int iterationcount=0;
        int maxiterations=20;


        //Create new vectors to measure

        List<Vector3d> new_v=new List<Vector3d>();
        

        //Declare a list to store angle values
        List<double> measured_angles=new List<double>();

        //List of max angle values
        List<double> max_angles=new List<double>();


        bool going=true;

        
        

        
        //while loop
        while (iterationcount < maxiterations && going)
        {
            iterationcount++;

            //Index of list
            int index_reverse=largest_v.Count-1;


            //isolate what needs to be reversed
            Vector3d to_be_reversed=largest_v[index_reverse];

            //reverse vector
            Vector3d reversed_v=to_be_reversed*-1;


            

            //Index for point list
            int index_pt= Jarvis_pts.Count-1;


            //Isolate point for angle measurement
            Point3d angle_meas=Jarvis_pts[index_pt];

            

            

            foreach (Point3d point in Points)
            {
                Vector3d vector=point-angle_meas;
                double angle=Vector3d.VectorAngle(reversed_v,vector);
                measured_angles.Add(angle);
                new_v.Add(vector);
                
            }

            //
            double maximum=measured_angles.Max();
            max_angles.Add(maximum);
            

            int pt_index=measured_angles.IndexOf(maximum);
            
            Vector3d new_max_angle=new_v[pt_index];
            largest_v.Add(new_max_angle);
            
            Point3d point_w_measured_angles=Points[pt_index];

            //Add point to jarvis list
            Jarvis_pts.Add(point_w_measured_angles);
            
            //Check values
            //length of Jarvis list
            int Jarvis_length=Jarvis_pts.Count();

            
            Point3d newest_point=Jarvis_pts[Jarvis_length-1];
                
            double n_x=newest_point.X;
            double n_y=newest_point.Y;
            double n_z=newest_point.Z;

            double check_value=n_x+n_y+n_z;
            
            if (check_value==end_value)
            {
                going=false;
            }
            
            

            //clear lists
            measured_angles.Clear();
            new_v.Clear();
        }
        

        //Message box of how many points made it into the Wrapping
        int Jarvis_count=Jarvis_pts.Count();
        this.Component.Message=Jarvis_count.ToString() + " Point(s)";

        //Output
        
        Hull_Points=Jarvis_pts;

            //Create polyline
        Polyline polyline= new Polyline(Jarvis_pts);
        Polyline=polyline;
        
    }
}
# ---------- end c_script ----------
convex_hull = ConvexHull(Plane=PlaneXY(0, 0, 0))  # -> Hull, HullZ, Indices
