# Grasshopper definition Jarvis March Concept.gh (Grasshopper 1.0.8)
# plug-ins: RhinoCodePluginGH

point = Point(flatten(Tree({0;0;0;0;0}: [Point(9.259724618, -58.30504397, 0), Point(92.03907819, -70.30667624, 0), Point(116.1386943, -34.97378236, 0), Point(89.98230627, -15.37592787, 0), Point(24.44646307, 42.10183494, 0)], {0;0;0;1;0}: [Point(39.46422528, -16.07093124, 0), Point(89.12565531, -28.07256352, 0), Point(113.2252714, 7.26033037, 0), Point(139.5649061, -9.327669253, 0), Point(93.39393366, 20.57256219, 0)], {0;0;0;2;0}: [Point(129.3607829, -19.12075518, 0), Point(170.4115528, -31.12238746, 0), Point(194.5111689, 4.210506432, 0), Point(168.3547809, 8.136804407, 0), Point(151.813792, 23.62955537, 0)], {0;0;0;3;0}: [Point(207.277742, -63.67372541, 0), Point(248.3285119, -75.67535769, 0), Point(333.5052313, -40.3424638, 0), Point(262.4742161, -2.443434221, 0), Point(206.006587, -20.92341486, 0)], {0;0;0;4;0}: [Point(163.1918653, -129.5591184, 0), Point(204.2426352, -178.9136899, 0), Point(228.3422513, -106.2278568, 0), Point(202.1858633, -72.38929516, 0), Point(161.9207103, -86.80880783, 0)], {0;0;0;5;0}: [Point(57.51784748, -97.21929244, 0), Point(101.6250718, -109.2209247, 0), Point(125.7246879, -73.88803082, 0), Point(99.56829989, -40.04946921, 0), Point(59.30314695, -54.46898188, 0)])))
c_script = CSharpScript(pts=point)  # -> out, a; inputs pts: list of Point3d; disabled
# ---------- c_script: C# ----------
// Grasshopper Script Instance
#region Usings
using System;
using System.Linq;
using System.Collections;
using System.Collections.Generic;
using System.Drawing;

using Rhino;
using Rhino.Geometry;

using Grasshopper;
using Grasshopper.Kernel;
using Grasshopper.Kernel.Data;
using Grasshopper.Kernel.Types;
#endregion

public class Script_Instance : GH_ScriptInstance
{
    #region Notes
    /* 
      Members:
        RhinoDoc RhinoDocument
        GH_Document GrasshopperDocument
        IGH_Component Component
        int Iteration

      Methods (Virtual & overridable):
        Print(string text)
        Print(string format, params object[] args)
        Reflect(object obj)
        Reflect(object obj, string method_name)
    */
    #endregion

    private void RunScript(List<Point3d> pts, ref object a)
    {
        // Write your logic here
        a = pts;
    }
}
# ---------- end c_script ----------
c_script_2 = CSharpScript(pts=point)  # -> out, a; inputs pts: list of Point3d; disabled
# ---------- c_script_2: C# ----------
// Grasshopper Script Instance
#region Usings
using System;
using System.Linq;
using System.Collections;
using System.Collections.Generic;
using System.Drawing;

using Rhino;
using Rhino.Geometry;

using Grasshopper;
using Grasshopper.Kernel;
using Grasshopper.Kernel.Data;
using Grasshopper.Kernel.Types;
#endregion

public class Script_Instance : GH_ScriptInstance
{
    #region Notes
    /* 
      Members:
        RhinoDoc RhinoDocument
        GH_Document GrasshopperDocument
        IGH_Component Component
        int Iteration

      Methods (Virtual & overridable):
        Print(string text)
        Print(string format, params object[] args)
        Reflect(object obj)
        Reflect(object obj, string method_name)
    */
    #endregion

    private void RunScript(List<Point3d> pts, ref object a)
    {
        // Assuming pts is a list or array of Point3d objects
        List<Point3d> points = new List<Point3d>(pts);

        // Sort points by their X values
        points.Sort((p1, p2) => p1.X.CompareTo(p2.X));

        // Isolate the first point in the sorted list (renamed to masterPoint)
        Point3d masterPoint = points[0];  // The first point, renamed as masterPoint

        // Initialize the Jarvis_pts list with the masterPoint
        List<Point3d> Jarvis_pts = new List<Point3d>();
        Jarvis_pts.Add(masterPoint);  // The first point (renamed masterPoint)

        // Start with the masterPoint as the currentPoint
        Point3d currentPoint = masterPoint;
        
        // Vector representing the X-axis for the first iteration
        Vector3d referenceVector = new Vector3d(1, 0, 0);

        // Add an iteration limit to prevent infinite loops (points.Count * 2 as a buffer)
        int maxIterations = points.Count * 2;
        int iterationCount = 0;

        // Loop until we reach the masterPoint again
        while (iterationCount < maxIterations)
        {
            iterationCount++;  // Increment the iteration count

            // Variables to track the point with the largest angle
            double largestAngle = -1;
            Point3d pointWithLargestAngle = currentPoint;
            Vector3d vectorWithLargestAngle = new Vector3d();

            // First pass: find the point with the largest angle relative to the reference vector
            foreach (Point3d point in points)
            {
                // Skip if the point is already in Jarvis_pts
                if (Jarvis_pts.Contains(point)) continue;

                // Create a vector from currentPoint to the point
                Vector3d diff = new Vector3d(point.X - currentPoint.X, point.Y - currentPoint.Y, point.Z - currentPoint.Z);

                // Calculate the angle between the vector and the reference vector
                double angle = Vector3d.VectorAngle(diff, referenceVector);

                // Track the largest angle
                if (angle > largestAngle)
                {
                    largestAngle = angle;
                    pointWithLargestAngle = point;  // Store the point with the largest angle
                    vectorWithLargestAngle = diff;  // Store the vector with the largest angle
                }
            }

            // Add the point with the largest angle to the Jarvis_pts list
            Jarvis_pts.Add(pointWithLargestAngle);

            // Reverse the vector that created the largest angle to set up the next reference vector
            referenceVector = new Vector3d(-vectorWithLargestAngle.X, -vectorWithLargestAngle.Y, -vectorWithLargestAngle.Z);

            // Check if the newly added point is the same as the masterPoint (check XYZ values)
            if (Math.Abs(pointWithLargestAngle.X - masterPoint.X) < 0.0001 &&
                Math.Abs(pointWithLargestAngle.Y - masterPoint.Y) < 0.0001 &&
                Math.Abs(pointWithLargestAngle.Z - masterPoint.Z) < 0.0001)
            {
                // If the XYZ values of the point match the masterPoint, exit the loop
                break;
            }

            // Update the current point to the point just added
            currentPoint = pointWithLargestAngle;
        }

        // Output the list of points
        a = Jarvis_pts;
    }
}
# ---------- end c_script_2 ----------
c_script_3 = CSharpScript(pts=point)  # -> out, a, b; inputs pts: list of Point3d; disabled
# ---------- c_script_3: C# ----------
// Grasshopper Script Instance
#region Usings
using System;
using System.Linq;
using System.Collections;
using System.Collections.Generic;
using System.Drawing;

using Rhino;
using Rhino.Geometry;

using Grasshopper;
using Grasshopper.Kernel;
using Grasshopper.Kernel.Data;
using Grasshopper.Kernel.Types;
#endregion

public class Script_Instance : GH_ScriptInstance
{
    #region Notes
    /* 
      Members:
        RhinoDoc RhinoDocument
        GH_Document GrasshopperDocument
        IGH_Component Component
        int Iteration

      Methods (Virtual & overridable):
        Print(string text)
        Print(string format, params object[] args)
        Reflect(object obj)
        Reflect(object obj, string method_name)
    */
    #endregion

    private void RunScript(List<Point3d> pts, ref object a, ref object b)
    {
        
        List<Point3d>Jarvis_pts=new List<Point3d>();
        List<Vector3d> largest_v=new List<Vector3d>();

        

        //Logic for master point only START
        // Assuming pts is a list or array of Point3d objects
        List<Point3d> points = new List<Point3d>(pts);

        

        // Sort points by their X values
        points.Sort((p1, p2) => p1.X.CompareTo(p2.X));

        // Isolate the first point in the sorted list
        Point3d firstPoint = points[0];  // The first point

        // Vector representing the X-axis
        Vector3d xAxis = new Vector3d(1, 0, 0);

        // Variables to keep track of the largest angle and the corresponding point
        double largestAngle = 0;
        Point3d pointWithLargestAngle = firstPoint;

        // Calculate the angles with respect to the X-axis
        foreach (Point3d point in points)
        {
            // Create a vector from firstPoint to the current point
            Vector3d diff = new Vector3d(point.X - firstPoint.X, point.Y - firstPoint.Y, point.Z - firstPoint.Z);

            // Calculate the angle between the vector and the X-axis
            double angle = Vector3d.VectorAngle(diff, xAxis);

            // Check if this is the largest angle
            if (angle > largestAngle)
            {
                largestAngle = angle;
                pointWithLargestAngle = point;  // Store the point with the largest angle
            }
        }

        // Output the point with the largest angle
        Jarvis_pts.Add(firstPoint);
        Jarvis_pts.Add(pointWithLargestAngle);
        
        

        Vector3d initial_vector = new Vector3d(pointWithLargestAngle.X - firstPoint.X, pointWithLargestAngle.Y - firstPoint.Y, pointWithLargestAngle.Z - firstPoint.Z);

        largest_v.Add(initial_vector);

        
        //Logic for master point only END

        //for for looping eventually

        int iterationcount=0;
        int maxiterations=3;

        
        
            

        //Index of list
        int index_reverse=largest_v.Count-1;


        //isolate what needs to be reversed
        Vector3d to_be_reversed=largest_v[index_reverse];

        //reverse vector
        Vector3d reversed_v=to_be_reversed*-1;


        

        //Index for point list
        int index_pt= Jarvis_pts.Count-1;


        //Isolate point for angle measurement
        Point3d angle_meas=Jarvis_pts[index_pt];

        //Create new vectors to measure

        List<Vector3d> new_v=new List<Vector3d>();
        

        //Declare a list to store angle values
        List<double> max_angle=new List<double>();

        

        foreach (Point3d point in pts)
        {
            Vector3d vector=point-angle_meas;
            double angle=Vector3d.VectorAngle(reversed_v,vector);
            max_angle.Add(angle);
            new_v.Add(vector);
            
        }

        //
        double maximum=max_angle.Max();

        int pt_index=max_angle.IndexOf(maximum);

        Point3d point_w_max_angle=pts[pt_index];

        //Add point to jarvis list
        Jarvis_pts.Add(point_w_max_angle);
        

        //b=point_w_max_angle;
        max_angle.Clear();
        
        
        b=new_v;
        a=angle_meas;


        
    }
}
# ---------- end c_script_3 ----------
deconstruct = Deconstruct(Point=point)  # -> XComponent, YComponent, ZComponent
c_script_4 = CSharpScript(pts=point)  # -> out, a, b; inputs pts: list of Point3d
# ---------- c_script_4: C# ----------
// Grasshopper Script Instance
#region Usings
using System;
using System.Linq;
using System.Collections;
using System.Collections.Generic;
using System.Drawing;

using Rhino;
using Rhino.Geometry;

using Grasshopper;
using Grasshopper.Kernel;
using Grasshopper.Kernel.Data;
using Grasshopper.Kernel.Types;
#endregion

public class Script_Instance : GH_ScriptInstance
{
    #region Notes
    /* 
      Members:
        RhinoDoc RhinoDocument
        GH_Document GrasshopperDocument
        IGH_Component Component
        int Iteration

      Methods (Virtual & overridable):
        Print(string text)
        Print(string format, params object[] args)
        Reflect(object obj)
        Reflect(object obj, string method_name)
    */
    #endregion

    private void RunScript(List<Point3d> pts, ref object a, ref object b)
    {
        
        List<Point3d>Jarvis_pts=new List<Point3d>();
        List<Vector3d> largest_v=new List<Vector3d>();

        

        //Logic for master point only START
        // Assuming pts is a list or array of Point3d objects
        List<Point3d> points = new List<Point3d>(pts);

        

        // Sort points by their X values
        points.Sort((p1, p2) => p1.X.CompareTo(p2.X));

        // Isolate the first point in the sorted list
        Point3d firstPoint = points[0];  // The first point

        // Vector representing the X-axis
        Vector3d xAxis = new Vector3d(1, 0, 0);

        // Variables to keep track of the largest angle and the corresponding point
        double largestAngle = 0;
        Point3d pointWithLargestAngle = firstPoint;

        // Calculate the angles with respect to the X-axis
        foreach (Point3d point in points)
        {
            // Create a vector from firstPoint to the current point
            Vector3d diff = new Vector3d(point.X - firstPoint.X, point.Y - firstPoint.Y, point.Z - firstPoint.Z);

            // Calculate the angle between the vector and the X-axis
            double angle = Vector3d.VectorAngle(diff, xAxis);

            // Check if this is the largest angle
            if (angle > largestAngle)
            {
                largestAngle = angle;
                pointWithLargestAngle = point;  // Store the point with the largest angle
            }
        }

        // Output the point with the largest angle
        Jarvis_pts.Add(firstPoint);
        Jarvis_pts.Add(pointWithLargestAngle);
        
        

        Vector3d initial_vector = new Vector3d(pointWithLargestAngle.X - firstPoint.X, pointWithLargestAngle.Y - firstPoint.Y, pointWithLargestAngle.Z - firstPoint.Z);

        largest_v.Add(initial_vector);

        
        //Logic for master point only END

        //for for looping eventually

        int iterationcount=0;
        int maxiterations=6;


        //Create new vectors to measure

        List<Vector3d> new_v=new List<Vector3d>();
        

        //Declare a list to store angle values
        List<double> measured_angles=new List<double>();

        //List of max angle values
        List<double> max_angles=new List<double>();

        
        //while loop
        while (iterationcount < maxiterations)
        {
            iterationcount++;

            //Index of list
            int index_reverse=largest_v.Count-1;


            //isolate what needs to be reversed
            Vector3d to_be_reversed=largest_v[index_reverse];

            //reverse vector
            Vector3d reversed_v=to_be_reversed*-1;


            

            //Index for point list
            int index_pt= Jarvis_pts.Count-1;


            //Isolate point for angle measurement
            Point3d angle_meas=Jarvis_pts[index_pt];

            

            

            foreach (Point3d point in pts)
            {
                Vector3d vector=point-angle_meas;
                double angle=Vector3d.VectorAngle(reversed_v,vector);
                measured_angles.Add(angle);
                new_v.Add(vector);
                
            }

            //
            double maximum=measured_angles.Max();
            max_angles.Add(maximum);
            

            int pt_index=measured_angles.IndexOf(maximum);
            
            Vector3d new_max_angle=new_v[pt_index];
            largest_v.Add(new_max_angle);
            
            Point3d point_w_measured_angles=pts[pt_index];

            //Add point to jarvis list
            Jarvis_pts.Add(point_w_measured_angles);
            

            //b=point_w_measured_angles;
            measured_angles.Clear();
            new_v.Clear();
        }
        
        b=largest_v;
        a=Jarvis_pts;


        
    }
}
# ---------- end c_script_4 ----------
sort_list = SortList(Keys=deconstruct.XComponent, ValuesValuesA=point)  # -> Keys, ValuesValuesA
point_list = PointList(Points=c_script_4.a, Size="20")
polyline = PolyLine(Vertices=c_script_4.a, Closed=False)
list_item = ListItem(Index=0, Wrap=True)
panel = Panel(c_script_3.b)
vector_display = VectorDisplay(Anchor=c_script_3.a, Vector=c_script_3.b)
list_item_2 = ListItem(List=sort_list.ValuesValuesA, Index=0, Wrap=True)
panel_2 = Panel(c_script_4.b)
subtraction = Subtraction(A=sort_list.ValuesValuesA, B=list_item_2)
unit_x = UnitX(Factor=1)
vector_display_2 = VectorDisplay(Anchor=list_item_2, Vector=subtraction)
angle = Angle(VectorA=subtraction, VectorB=unit_x)  # -> Angle, Reflex
# 1. Get x-value
# 2. Find the smallest x-value
# 3. Isolate point with smallest x-value
# 4. Calculate all vectors (subtract isolated point with all points)
# 5. Vector angle in respect to x-axis
# 6. Sort angles to the largest angle, in sync with the points
# 7. Isolate point that creates the largest angle
# 8. Repeat 4-6 *5 instead of x-axis, measure from the largest angle vector created
sort_list_2 = SortList(Keys=angle.Angle, ValuesValuesA=sort_list.ValuesValuesA)  # -> Keys, reverse(ValuesValuesA)
list_item_3 = ListItem(List=sort_list_2.ValuesValuesA, Index=0, Wrap=True)
subtraction_2 = Subtraction(A=list_item_3, B=list_item_2)
subtraction_3 = Subtraction(A=sort_list_2.ValuesValuesA, B=list_item_3)
reverse = Reverse(Vector=subtraction_2)
vector_display_3 = VectorDisplay(Anchor=list_item_3, Vector=subtraction_3)  # disabled
vector_display_4 = VectorDisplay(Anchor=list_item_3, Vector=reverse)  # disabled
angle_2 = Angle(VectorA=subtraction_3, VectorB=reverse)  # -> Angle, Reflex
sort_list_3 = SortList(Keys=angle_2.Angle, ValuesValuesA=sort_list_2.ValuesValuesA)  # -> Keys, reverse(ValuesValuesA)
list_item_4 = ListItem(List=sort_list_3.ValuesValuesA, Index=0, Wrap=True)
panel_3 = Panel(angle_2.Angle)
subtraction_4 = Subtraction(A=list_item_4, B=list_item_3)
vector_display_5 = VectorDisplay(Anchor=list_item_3, Vector=subtraction_4)
