# Grasshopper definition Jarvis March_working.gh (Grasshopper 1.0.8)
# plug-ins: RhinoCodePluginGH

construct_domain = ConstructDomain(DomainStart=0, DomainEnd=Slider(10, range=0..10))
point = Point(flatten(Tree({0;0;0;0;0}: [Point(9.259724618, -58.30504397, 0), Point(92.03907819, -70.30667624, 0), Point(116.1386943, -34.97378236, 0), Point(89.98230627, -15.37592787, 0), Point(24.44646307, -8.463179544, 0)], {0;0;0;1;0}: [Point(77.32193395, -16.07093124, 0), Point(89.12565531, -28.07256352, 0), Point(113.2252714, 65.87905505, 0), Point(139.5649061, -9.327669253, 0), Point(93.39393366, 20.57256219, 0)], {0;0;0;2;0}: [Point(129.3607829, -19.12075518, 0), Point(170.4115528, -31.12238746, 0), Point(265.052346, 4.210506432, 0), Point(168.3547809, 77.77898717, 0), Point(202.2806697, 39.97439012, 0)], {0;0;0;3;0}: [Point(207.277742, -63.67372541, 0), Point(248.3285119, -75.67535769, 0), Point(259.7076455, -40.3424638, 0), Point(211.9972712, -26.13020799, 0), Point(206.006587, -20.92341486, 0)], {0;0;0;4;0}: [Point(163.1918653, -129.5591184, 0), Point(204.2426352, -178.9136899, 0), Point(228.3422513, -106.2278568, 0), Point(202.1858633, -72.38929516, 0), Point(44.30942874, -177.8876516, 0)], {0;0;0;5;0}: [Point(33.79368338, -95.70498409, 0), Point(101.6250718, -109.2209247, 0), Point(125.7246879, -73.88803082, 0), Point(99.56829989, -40.04946921, 0), Point(59.30314695, -54.46898188, 0)])))
fit_line = FitLine(Points=point)
c_script = CSharpScript(pts=fit_line)  # -> out, A; inputs pts: list of Point3d
# ---------- c_script: C# ----------
// Grasshopper Script Instance
#region Usings
using System;
using System.Linq;
using System.Collections;
using System.Collections.Generic;
using System.Drawing;

using Rhino;
using Rhino.Geometry;

using Grasshopper;
using Grasshopper.Kernel;
using Grasshopper.Kernel.Data;
using Grasshopper.Kernel.Types;
#endregion

public class Script_Instance : GH_ScriptInstance
{
    #region Notes
    /* 
      Members:
        RhinoDoc RhinoDocument
        GH_Document GrasshopperDocument
        IGH_Component Component
        int Iteration

      Methods (Virtual & overridable):
        Print(string text)
        Print(string format, params object[] args)
        Reflect(object obj)
        Reflect(object obj, string method_name)
    */
    #endregion

    private void RunScript(List<Point3d> pts, ref object A)
    {
    // Check if the input is null
    if (pts == null)
    {
        // Add a runtime error message for null input
        this.AddRuntimeMessage(GH_RuntimeMessageLevel.Error, "Input is null: Please provide a valid input.");
        return;
    }

    // Check if the input is not a List<Point3d>
    if (!(pts is List<Point3d>))
    {
        // Add a runtime error message for wrong data type
        this.AddRuntimeMessage(GH_RuntimeMessageLevel.Error, "Wrong Data Type. Please input a List of Point3d.");
        return;
    }

    // Cast to List<Point3d> after confirming the type
    List<Point3d> points = pts as List<Point3d>;

    // Output the list of points
    A = points;
    
    }
}
# ---------- end c_script ----------
list_length = ListLength(List=point)
number_slider = Slider(7, range=0..10)
c_script_2 = CSharpScript(pts=point)  # -> out, a, b; inputs pts: list of Point3d; disabled
# ---------- c_script_2: C# ----------
// Grasshopper Script Instance
#region Usings
using System;
using System.Linq;
using System.Collections;
using System.Collections.Generic;
using System.Drawing;

using Rhino;
using Rhino.Geometry;

using Grasshopper;
using Grasshopper.Kernel;
using Grasshopper.Kernel.Data;
using Grasshopper.Kernel.Types;
#endregion

public class Script_Instance : GH_ScriptInstance
{
    #region Notes
    /* 
      Members:
        RhinoDoc RhinoDocument
        GH_Document GrasshopperDocument
        IGH_Component Component
        int Iteration

      Methods (Virtual & overridable):
        Print(string text)
        Print(string format, params object[] args)
        Reflect(object obj)
        Reflect(object obj, string method_name)
    */
    #endregion

    private void RunScript(List<Point3d> pts, ref object a, ref object b)
    {
        
        List<Point3d>Jarvis_pts=new List<Point3d>();
        List<Vector3d> largest_v=new List<Vector3d>();

        

        //Logic for master point only START
        // Assuming pts is a list or array of Point3d objects
        List<Point3d> points = new List<Point3d>(pts);

        

        // Sort points by their X values
        points.Sort((p1, p2) => p1.X.CompareTo(p2.X));

        // Isolate the first point in the sorted list
        Point3d firstPoint = points[0];  // The first point

        // Vector representing the X-axis
        Vector3d xAxis = new Vector3d(1, 0, 0);

        // Variables to keep track of the largest angle and the corresponding point
        double largestAngle = 0;
        Point3d pointWithLargestAngle = firstPoint;

        // Calculate the angles with respect to the X-axis
        foreach (Point3d point in points)
        {
            // Create a vector from firstPoint to the current point
            Vector3d diff = new Vector3d(point.X - firstPoint.X, point.Y - firstPoint.Y, point.Z - firstPoint.Z);

            // Calculate the angle between the vector and the X-axis
            double angle = Vector3d.VectorAngle(diff, xAxis);

            // Check if this is the largest angle
            if (angle > largestAngle)
            {
                largestAngle = angle;
                pointWithLargestAngle = point;  // Store the point with the largest angle
            }
        }

        // Output the point with the largest angle
        Jarvis_pts.Add(firstPoint);
        Jarvis_pts.Add(pointWithLargestAngle);
        
        

        Vector3d initial_vector = new Vector3d(pointWithLargestAngle.X - firstPoint.X, pointWithLargestAngle.Y - firstPoint.Y, pointWithLargestAngle.Z - firstPoint.Z);

        largest_v.Add(initial_vector);

        
        //Logic for master point only END

        //for for looping eventually

        int iterationcount=0;
        int maxiterations=3;

        
        
            

        //Index of list
        int index_reverse=largest_v.Count-1;


        //isolate what needs to be reversed
        Vector3d to_be_reversed=largest_v[index_reverse];

        //reverse vector
        Vector3d reversed_v=to_be_reversed*-1;


        

        //Index for point list
        int index_pt= Jarvis_pts.Count-1;


        //Isolate point for angle measurement
        Point3d angle_meas=Jarvis_pts[index_pt];

        //Create new vectors to measure

        List<Vector3d> new_v=new List<Vector3d>();
        

        //Declare a list to store angle values
        List<double> max_angle=new List<double>();

        

        foreach (Point3d point in pts)
        {
            Vector3d vector=point-angle_meas;
            double angle=Vector3d.VectorAngle(reversed_v,vector);
            max_angle.Add(angle);
            new_v.Add(vector);
            
        }

        //
        double maximum=max_angle.Max();

        int pt_index=max_angle.IndexOf(maximum);

        Point3d point_w_max_angle=pts[pt_index];

        //Add point to jarvis list
        Jarvis_pts.Add(point_w_max_angle);
        

        //b=point_w_max_angle;
        max_angle.Clear();
        
        
        b=new_v;
        a=angle_meas;


        
    }
}
# ---------- end c_script_2 ----------
c_script_3 = CSharpScript(pts=point)  # -> out, a; inputs pts: list of Point3d; disabled
# ---------- c_script_3: C# ----------
// Grasshopper Script Instance
#region Usings
using System;
using System.Linq;
using System.Collections;
using System.Collections.Generic;
using System.Drawing;

using Rhino;
using Rhino.Geometry;

using Grasshopper;
using Grasshopper.Kernel;
using Grasshopper.Kernel.Data;
using Grasshopper.Kernel.Types;
#endregion

public class Script_Instance : GH_ScriptInstance
{
    #region Notes
    /* 
      Members:
        RhinoDoc RhinoDocument
        GH_Document GrasshopperDocument
        IGH_Component Component
        int Iteration

      Methods (Virtual & overridable):
        Print(string text)
        Print(string format, params object[] args)
        Reflect(object obj)
        Reflect(object obj, string method_name)
    */
    #endregion

    private void RunScript(List<Point3d> pts, ref object a)
    {
        // Assuming pts is a list or array of Point3d objects
        List<Point3d> points = new List<Point3d>(pts);

        // Sort points by their X values
        points.Sort((p1, p2) => p1.X.CompareTo(p2.X));

        // Isolate the first point in the sorted list (renamed to masterPoint)
        Point3d masterPoint = points[0];  // The first point, renamed as masterPoint

        // Initialize the Jarvis_pts list with the masterPoint
        List<Point3d> Jarvis_pts = new List<Point3d>();
        Jarvis_pts.Add(masterPoint);  // The first point (renamed masterPoint)

        // Start with the masterPoint as the currentPoint
        Point3d currentPoint = masterPoint;
        
        // Vector representing the X-axis for the first iteration
        Vector3d referenceVector = new Vector3d(1, 0, 0);

        // Add an iteration limit to prevent infinite loops (points.Count * 2 as a buffer)
        int maxIterations = points.Count * 2;
        int iterationCount = 0;

        // Loop until we reach the masterPoint again
        while (iterationCount < maxIterations)
        {
            iterationCount++;  // Increment the iteration count

            // Variables to track the point with the largest angle
            double largestAngle = -1;
            Point3d pointWithLargestAngle = currentPoint;
            Vector3d vectorWithLargestAngle = new Vector3d();

            // First pass: find the point with the largest angle relative to the reference vector
            foreach (Point3d point in points)
            {
                // Skip if the point is already in Jarvis_pts
                if (Jarvis_pts.Contains(point)) continue;

                // Create a vector from currentPoint to the point
                Vector3d diff = new Vector3d(point.X - currentPoint.X, point.Y - currentPoint.Y, point.Z - currentPoint.Z);

                // Calculate the angle between the vector and the reference vector
                double angle = Vector3d.VectorAngle(diff, referenceVector);

                // Track the largest angle
                if (angle > largestAngle)
                {
                    largestAngle = angle;
                    pointWithLargestAngle = point;  // Store the point with the largest angle
                    vectorWithLargestAngle = diff;  // Store the vector with the largest angle
                }
            }

            // Add the point with the largest angle to the Jarvis_pts list
            Jarvis_pts.Add(pointWithLargestAngle);

            // Reverse the vector that created the largest angle to set up the next reference vector
            referenceVector = new Vector3d(-vectorWithLargestAngle.X, -vectorWithLargestAngle.Y, -vectorWithLargestAngle.Z);

            // Check if the newly added point is the same as the masterPoint (check XYZ values)
            if (Math.Abs(pointWithLargestAngle.X - masterPoint.X) < 0.0001 &&
                Math.Abs(pointWithLargestAngle.Y - masterPoint.Y) < 0.0001 &&
                Math.Abs(pointWithLargestAngle.Z - masterPoint.Z) < 0.0001)
            {
                // If the XYZ values of the point match the masterPoint, exit the loop
                break;
            }

            // Update the current point to the point just added
            currentPoint = pointWithLargestAngle;
        }

        // Output the list of points
        a = Jarvis_pts;
    }
}
# ---------- end c_script_3 ----------
c_script_4 = CSharpScript(pts=point)  # -> out, a; inputs pts: list of Point3d; disabled
# ---------- c_script_4: C# ----------
// Grasshopper Script Instance
#region Usings
using System;
using System.Linq;
using System.Collections;
using System.Collections.Generic;
using System.Drawing;

using Rhino;
using Rhino.Geometry;

using Grasshopper;
using Grasshopper.Kernel;
using Grasshopper.Kernel.Data;
using Grasshopper.Kernel.Types;
#endregion

public class Script_Instance : GH_ScriptInstance
{
    #region Notes
    /* 
      Members:
        RhinoDoc RhinoDocument
        GH_Document GrasshopperDocument
        IGH_Component Component
        int Iteration

      Methods (Virtual & overridable):
        Print(string text)
        Print(string format, params object[] args)
        Reflect(object obj)
        Reflect(object obj, string method_name)
    */
    #endregion

    private void RunScript(List<Point3d> pts, ref object a)
    {
        // Write your logic here
        a = pts;
    }
}
# ---------- end c_script_4 ----------
deconstruct = Deconstruct(Point=point)  # -> XComponent, YComponent, ZComponent; disabled
random = Random(Range=construct_domain, Number=list_length, Seed=2)
c_script_5 = CSharpScript(pts=point, itera=number_slider)  # -> out, a, b; inputs pts: list of Point3d, itera: Int32; disabled
# ---------- c_script_5: C# ----------
// Grasshopper Script Instance
#region Usings
using System;
using System.Linq;
using System.Collections;
using System.Collections.Generic;
using System.Drawing;

using Rhino;
using Rhino.Geometry;

using Grasshopper;
using Grasshopper.Kernel;
using Grasshopper.Kernel.Data;
using Grasshopper.Kernel.Types;
#endregion

public class Script_Instance : GH_ScriptInstance
{
    #region Notes
    /* 
      Members:
        RhinoDoc RhinoDocument
        GH_Document GrasshopperDocument
        IGH_Component Component
        int Iteration

      Methods (Virtual & overridable):
        Print(string text)
        Print(string format, params object[] args)
        Reflect(object obj)
        Reflect(object obj, string method_name)
    */
    #endregion

    private void RunScript(List<Point3d> pts, int itera, ref object a, ref object b)
    {
        
        List<Point3d>Jarvis_pts=new List<Point3d>();
        List<Vector3d> largest_v=new List<Vector3d>();

        

        //Logic for master point only START
        // Assuming pts is a list or array of Point3d objects
        List<Point3d> points = new List<Point3d>(pts);

        

        // Sort points by their X values
        points.Sort((p1, p2) => p1.X.CompareTo(p2.X));

        // Isolate the first point in the sorted list
        Point3d firstPoint = points[0];  // The first point

        // Vector representing the X-axis
        Vector3d xAxis = new Vector3d(1, 0, 0);

        // Variables to keep track of the largest angle and the corresponding point
        double largestAngle = 0;
        Point3d pointWithLargestAngle = firstPoint;

        // Calculate the angles with respect to the X-axis
        foreach (Point3d point in points)
        {
            // Create a vector from firstPoint to the current point
            Vector3d diff = new Vector3d(point.X - firstPoint.X, point.Y - firstPoint.Y, point.Z - firstPoint.Z);

            // Calculate the angle between the vector and the X-axis
            double angle = Vector3d.VectorAngle(diff, xAxis);

            // Check if this is the largest angle
            if (angle > largestAngle)
            {
                largestAngle = angle;
                pointWithLargestAngle = point;  // Store the point with the largest angle
            }
        }

        // Output the point with the largest angle
        Jarvis_pts.Add(firstPoint);
        Jarvis_pts.Add(pointWithLargestAngle);
        
        

        Vector3d initial_vector = new Vector3d(pointWithLargestAngle.X - firstPoint.X, pointWithLargestAngle.Y - firstPoint.Y, pointWithLargestAngle.Z - firstPoint.Z);

        largest_v.Add(initial_vector);

        
        //Logic for master point only END

        //for for looping eventually

        int iterationcount=0;
        int maxiterations=itera;


        //Create new vectors to measure

        List<Vector3d> new_v=new List<Vector3d>();
        

        //Declare a list to store angle values
        List<double> measured_angles=new List<double>();

        //List of max angle values
        List<double> max_angles=new List<double>();

        
        //while loop
        while (iterationcount < maxiterations)
        {
            iterationcount++;

            //Index of list
            int index_reverse=largest_v.Count-1;


            //isolate what needs to be reversed
            Vector3d to_be_reversed=largest_v[index_reverse];

            //reverse vector
            Vector3d reversed_v=to_be_reversed*-1;


            

            //Index for point list
            int index_pt= Jarvis_pts.Count-1;


            //Isolate point for angle measurement
            Point3d angle_meas=Jarvis_pts[index_pt];

            

            

            foreach (Point3d point in pts)
            {
                Vector3d vector=point-angle_meas;
                double angle=Vector3d.VectorAngle(reversed_v,vector);
                measured_angles.Add(angle);
                new_v.Add(vector);
                
            }

            //
            double maximum=measured_angles.Max();
            max_angles.Add(maximum);
            

            int pt_index=measured_angles.IndexOf(maximum);
            
            Vector3d new_max_angle=new_v[pt_index];
            largest_v.Add(new_max_angle);
            
            Point3d point_w_measured_angles=pts[pt_index];

            //Add point to jarvis list
            Jarvis_pts.Add(point_w_measured_angles);
            

            //b=point_w_measured_angles;
            measured_angles.Clear();
            new_v.Clear();
        }
        
        b=largest_v;
        a=Jarvis_pts;


        
    }
}
# ---------- end c_script_5 ----------
c_script_6 = CSharpScript(pts=point, itera=number_slider)  # -> out, a, b, c; inputs pts: list of Point3d, itera: Int32; disabled
# ---------- c_script_6: C# ----------
// Grasshopper Script Instance
#region Usings
using System;
using System.Linq;
using System.Collections;
using System.Collections.Generic;
using System.Drawing;

using Rhino;
using Rhino.Geometry;

using Grasshopper;
using Grasshopper.Kernel;
using Grasshopper.Kernel.Data;
using Grasshopper.Kernel.Types;
#endregion

public class Script_Instance : GH_ScriptInstance
{
    #region Notes
    /* 
      Members:
        RhinoDoc RhinoDocument
        GH_Document GrasshopperDocument
        IGH_Component Component
        int Iteration

      Methods (Virtual & overridable):
        Print(string text)
        Print(string format, params object[] args)
        Reflect(object obj)
        Reflect(object obj, string method_name)
    */
    #endregion

    private void RunScript(
	List<Point3d> pts,
	int itera,
	ref object a,
	ref object b,
	ref object c)
    {
        
        List<Point3d>Jarvis_pts=new List<Point3d>();
        List<Vector3d> largest_v=new List<Vector3d>();

        

        //Logic for master point only START
        // Assuming pts is a list or array of Point3d objects
        List<Point3d> points = new List<Point3d>(pts);

        

        // Sort points by their X values
        points.Sort((p1, p2) => p1.X.CompareTo(p2.X));

        // Isolate the first point in the sorted list
        Point3d firstPoint = points[0];  // The first point

        // Vector representing the X-axis
        Vector3d xAxis = new Vector3d(1, 0, 0);

        // Variables to keep track of the largest angle and the corresponding point
        double largestAngle = 0;
        Point3d pointWithLargestAngle = firstPoint;

        // Calculate the angles with respect to the X-axis
        foreach (Point3d point in points)
        {
            // Create a vector from firstPoint to the current point
            Vector3d diff = new Vector3d(point.X - firstPoint.X, point.Y - firstPoint.Y, point.Z - firstPoint.Z);

            // Calculate the angle between the vector and the X-axis
            double angle = Vector3d.VectorAngle(diff, xAxis);

            // Check if this is the largest angle
            if (angle > largestAngle)
            {
                largestAngle = angle;
                pointWithLargestAngle = point;  // Store the point with the largest angle
            }
        }

        // Output the point with the largest angle
        Jarvis_pts.Add(firstPoint);
        Jarvis_pts.Add(pointWithLargestAngle);

        double f_x=firstPoint.X;
        double f_y=firstPoint.Y;
        double f_z=firstPoint.Z;

        double end_value=f_x+f_y+f_z;
        
        c=end_value;
        

        Vector3d initial_vector = new Vector3d(pointWithLargestAngle.X - firstPoint.X, pointWithLargestAngle.Y - firstPoint.Y, pointWithLargestAngle.Z - firstPoint.Z);

        largest_v.Add(initial_vector);

        
        //Logic for master point only END

        

        int iterationcount=0;
        int maxiterations=itera;


        //Create new vectors to measure

        List<Vector3d> new_v=new List<Vector3d>();
        

        //Declare a list to store angle values
        List<double> measured_angles=new List<double>();

        //List of max angle values
        List<double> max_angles=new List<double>();

        
        //while loop
        while (iterationcount < maxiterations)
        {
            iterationcount++;

            //Index of list
            int index_reverse=largest_v.Count-1;


            //isolate what needs to be reversed
            Vector3d to_be_reversed=largest_v[index_reverse];

            //reverse vector
            Vector3d reversed_v=to_be_reversed*-1;


            

            //Index for point list
            int index_pt= Jarvis_pts.Count-1;


            //Isolate point for angle measurement
            Point3d angle_meas=Jarvis_pts[index_pt];

            

            

            foreach (Point3d point in pts)
            {
                Vector3d vector=point-angle_meas;
                double angle=Vector3d.VectorAngle(reversed_v,vector);
                measured_angles.Add(angle);
                new_v.Add(vector);
                
            }

            //
            double maximum=measured_angles.Max();
            max_angles.Add(maximum);
            

            int pt_index=measured_angles.IndexOf(maximum);
            
            Vector3d new_max_angle=new_v[pt_index];
            largest_v.Add(new_max_angle);
            
            Point3d point_w_measured_angles=pts[pt_index];

            //Add point to jarvis list
            Jarvis_pts.Add(point_w_measured_angles);
            
            //length of Jarvis list
            int Jarvis_length=Jarvis_pts.Count();

            

            Point3d newest_point=Jarvis_pts[Jarvis_length-1];
            
            

            double n_x=newest_point.X;
            double n_y=newest_point.Y;
            double n_z=newest_point.Z;

            double check_value=n_x+n_y+n_z;

            b=check_value;

            //clear lists
            measured_angles.Clear();
            new_v.Clear();
        }
        
        
        a=Jarvis_pts;


        
    }
}
# ---------- end c_script_6 ----------
subd_from_mesh = SubDFromMesh(Creases=1, Corners=1, Interpolate=False)
c_script_7 = CSharpScript(pts=point)  # -> out, a, b, c; inputs pts: list of Point3d; disabled
# ---------- c_script_7: C# ----------
// Grasshopper Script Instance
#region Usings
using System;
using System.Linq;
using System.Collections;
using System.Collections.Generic;
using System.Drawing;

using Rhino;
using Rhino.Geometry;

using Grasshopper;
using Grasshopper.Kernel;
using Grasshopper.Kernel.Data;
using Grasshopper.Kernel.Types;
#endregion

public class Script_Instance : GH_ScriptInstance
{
    #region Notes
    /* 
      Members:
        RhinoDoc RhinoDocument
        GH_Document GrasshopperDocument
        IGH_Component Component
        int Iteration

      Methods (Virtual & overridable):
        Print(string text)
        Print(string format, params object[] args)
        Reflect(object obj)
        Reflect(object obj, string method_name)
    */
    #endregion

    private void RunScript(
	List<Point3d> pts,
	ref object a,
	ref object b,
	ref object c)
    {

        //Sanity
        if (pts==null)
        {
            this.AddRuntimeMessage(GH_RuntimeMessageLevel.Error, "Wrong Data Type");
            return;
        }
        
        int pt_count=pts.Count();

        if (pt_count==0)
        {
            this.AddRuntimeMessage(GH_RuntimeMessageLevel.Warning, "Input parameter Point failed to collect data");
            return;
        }



        
        List<Point3d>Jarvis_pts=new List<Point3d>();
        List<Vector3d> largest_v=new List<Vector3d>();

        

        //Logic for master point only START
        // Assuming pts is a list or array of Point3d objects
        List<Point3d> points = new List<Point3d>(pts);

        

        // Sort points by their X values
        points.Sort((p1, p2) => p1.X.CompareTo(p2.X));

        // Isolate the first point in the sorted list
        Point3d firstPoint = points[0];  // The first point

        // Vector representing the X-axis
        Vector3d xAxis = new Vector3d(1, 0, 0);

        // Variables to keep track of the largest angle and the corresponding point
        double largestAngle = 0;
        Point3d pointWithLargestAngle = firstPoint;

        // Calculate the angles with respect to the X-axis
        foreach (Point3d point in points)
        {
            // Create a vector from firstPoint to the current point
            Vector3d diff = new Vector3d(point.X - firstPoint.X, point.Y - firstPoint.Y, point.Z - firstPoint.Z);

            // Calculate the angle between the vector and the X-axis
            double angle = Vector3d.VectorAngle(diff, xAxis);

            // Check if this is the largest angle
            if (angle > largestAngle)
            {
                largestAngle = angle;
                pointWithLargestAngle = point;  // Store the point with the largest angle
            }
        }

        // Output the point with the largest angle
        Jarvis_pts.Add(firstPoint);
        Jarvis_pts.Add(pointWithLargestAngle);

        double f_x=firstPoint.X;
        double f_y=firstPoint.Y;
        double f_z=firstPoint.Z;

        double end_value=f_x+f_y+f_z;
        
        
        

        Vector3d initial_vector = new Vector3d(pointWithLargestAngle.X - firstPoint.X, pointWithLargestAngle.Y - firstPoint.Y, pointWithLargestAngle.Z - firstPoint.Z);

        largest_v.Add(initial_vector);

        
        //Logic for master point only END

        

        int iterationcount=0;
        int maxiterations=20;


        //Create new vectors to measure

        List<Vector3d> new_v=new List<Vector3d>();
        

        //Declare a list to store angle values
        List<double> measured_angles=new List<double>();

        //List of max angle values
        List<double> max_angles=new List<double>();


        bool going=true;

        
        

        
        //while loop
        while (iterationcount < maxiterations && going)
        {
            iterationcount++;

            //Index of list
            int index_reverse=largest_v.Count-1;


            //isolate what needs to be reversed
            Vector3d to_be_reversed=largest_v[index_reverse];

            //reverse vector
            Vector3d reversed_v=to_be_reversed*-1;


            

            //Index for point list
            int index_pt= Jarvis_pts.Count-1;


            //Isolate point for angle measurement
            Point3d angle_meas=Jarvis_pts[index_pt];

            

            

            foreach (Point3d point in pts)
            {
                Vector3d vector=point-angle_meas;
                double angle=Vector3d.VectorAngle(reversed_v,vector);
                measured_angles.Add(angle);
                new_v.Add(vector);
                
            }

            //
            double maximum=measured_angles.Max();
            max_angles.Add(maximum);
            

            int pt_index=measured_angles.IndexOf(maximum);
            
            Vector3d new_max_angle=new_v[pt_index];
            largest_v.Add(new_max_angle);
            
            Point3d point_w_measured_angles=pts[pt_index];

            //Add point to jarvis list
            Jarvis_pts.Add(point_w_measured_angles);
            
            //Check values
            //length of Jarvis list
            int Jarvis_length=Jarvis_pts.Count();

            
            Point3d newest_point=Jarvis_pts[Jarvis_length-1];
                
            double n_x=newest_point.X;
            double n_y=newest_point.Y;
            double n_z=newest_point.Z;

            double check_value=n_x+n_y+n_z;
            
            if (check_value==end_value)
            {
                going=false;
            }
            
            

            //clear lists
            measured_angles.Clear();
            new_v.Clear();
        }
        

        
        
        c=end_value;
        a=Jarvis_pts;


        
    }
}
# ---------- end c_script_7 ----------
sort_list = SortList(Keys=deconstruct.XComponent, ValuesValuesA=point)  # -> Keys, ValuesValuesA; disabled
unit_z = UnitZ(Factor=random)
panel = Panel(c_script_2.b)
list_item = ListItem(List=sort_list.ValuesValuesA, Index=0, Wrap=True)  # disabled
point_list = PointList(Points=c_script_7.a, Size="20")
move = Move(Geometry=point, Motion=unit_z)  # -> Geometry, Transform
convex_hull = ConvexHull(Plane=PlaneXY(0, 0, 0))  # -> Hull, HullZ, Indices
populate_2d = Populate2D(Region={Plane=PlaneXY(0, 0, 0), Size=Domain2(u=0..20, v=0..10)}, Count=Slider(1000, range=0..1000), Seed=1)
subtraction = Subtraction(A=sort_list.ValuesValuesA, B=list_item)  # disabled
unit_x = UnitX(Factor=1)  # disabled
c_script_8 = CSharpScript(pts=populate_2d)  # -> out, a, c; inputs pts: list of Point3d
# ---------- c_script_8: C# ----------
// Grasshopper Script Instance
#region Usings
using System;
using System.Linq;
using System.Collections;
using System.Collections.Generic;
using System.Drawing;

using Rhino;
using Rhino.Geometry;

using Grasshopper;
using Grasshopper.Kernel;
using Grasshopper.Kernel.Data;
using Grasshopper.Kernel.Types;
#endregion

public class Script_Instance : GH_ScriptInstance
{
    #region Notes
    /* 
      Members:
        RhinoDoc RhinoDocument
        GH_Document GrasshopperDocument
        IGH_Component Component
        int Iteration

      Methods (Virtual & overridable):
        Print(string text)
        Print(string format, params object[] args)
        Reflect(object obj)
        Reflect(object obj, string method_name)
    */
    #endregion

    private void RunScript(List<Point3d> pts, ref object a, ref object c)
    {

        //Sanity
        if (pts==null)
        {
            this.AddRuntimeMessage(GH_RuntimeMessageLevel.Error, "Input parameter Points failed to collect data");
            return;
        }

        
        
        


        //Checking if any points to calculate
        int pt_count=pts.Count();

        if (pt_count==0)
        {
            this.AddRuntimeMessage(GH_RuntimeMessageLevel.Warning, "Input parameter Point failed to collect data");
            return;
        }



        
        List<Point3d>Jarvis_pts=new List<Point3d>();
        List<Vector3d> largest_v=new List<Vector3d>();

        

        //Logic for master point only START
        // Assuming pts is a list or array of Point3d objects
        List<Point3d> points = new List<Point3d>(pts);

        

        // Sort points by their X values
        points.Sort((p1, p2) => p1.X.CompareTo(p2.X));

        // Isolate the first point in the sorted list
        Point3d firstPoint = points[0];  // The first point

        // Vector representing the X-axis
        Vector3d xAxis = new Vector3d(1, 0, 0);

        // Variables to keep track of the largest angle and the corresponding point
        double largestAngle = 0;
        Point3d pointWithLargestAngle = firstPoint;

        // Calculate the angles with respect to the X-axis
        foreach (Point3d point in points)
        {
            // Create a vector from firstPoint to the current point
            Vector3d diff = new Vector3d(point.X - firstPoint.X, point.Y - firstPoint.Y, point.Z - firstPoint.Z);

            // Calculate the angle between the vector and the X-axis
            double angle = Vector3d.VectorAngle(diff, xAxis);

            // Check if this is the largest angle
            if (angle > largestAngle)
            {
                largestAngle = angle;
                pointWithLargestAngle = point;  // Store the point with the largest angle
            }
        }

        // Output the point with the largest angle
        Jarvis_pts.Add(firstPoint);
        Jarvis_pts.Add(pointWithLargestAngle);

        double f_x=firstPoint.X;
        double f_y=firstPoint.Y;
        double f_z=firstPoint.Z;

        double end_value=f_x+f_y+f_z;
        
        
        

        Vector3d initial_vector = new Vector3d(pointWithLargestAngle.X - firstPoint.X, pointWithLargestAngle.Y - firstPoint.Y, pointWithLargestAngle.Z - firstPoint.Z);

        largest_v.Add(initial_vector);

        
        //Logic for master point only END

        

        int iterationcount=0;
        int maxiterations=100;


        //Create new vectors to measure

        List<Vector3d> new_v=new List<Vector3d>();
        

        //Declare a list to store angle values
        List<double> measured_angles=new List<double>();

        //List of max angle values
        List<double> max_angles=new List<double>();


        bool going=true;

        
        

        
        //while loop
        while (iterationcount < maxiterations && going)
        {
            iterationcount++;

            //Index of list
            int index_reverse=largest_v.Count-1;
            


            //isolate what needs to be reversed
            Vector3d to_be_reversed=largest_v[index_reverse];

            //reverse vector
            Vector3d reversed_v=to_be_reversed*-1;


            

            //Index for point list
            int index_pt= Jarvis_pts.Count-1;


            //Isolate point for angle measurement
            Point3d angle_meas=Jarvis_pts[index_pt];

            

            

            foreach (Point3d point in pts)
            {
                Vector3d vector=point-angle_meas;
                double angle=Vector3d.VectorAngle(reversed_v,vector);
                measured_angles.Add(angle);
                new_v.Add(vector);
                
            }

            //adding maximum angle to list
            double maximum=measured_angles.Max();
            max_angles.Add(maximum);
            
            
            //Index of maximum angle in relation to the point list (which pts gave the max angle)
            int pt_index=measured_angles.IndexOf(maximum);
            
            Vector3d new_max_angle=new_v[pt_index];
            largest_v.Add(new_max_angle);
            
            Point3d point_w_measured_angles=pts[pt_index];

            //Add point to jarvis list
            Jarvis_pts.Add(point_w_measured_angles);
            
            //Check values
            //length of Jarvis list
            int Jarvis_length=Jarvis_pts.Count();

            
            Point3d newest_point=Jarvis_pts[Jarvis_length-1];
                
            double n_x=newest_point.X;
            double n_y=newest_point.Y;
            double n_z=newest_point.Z;

            double check_value=n_x+n_y+n_z;
            
            if (check_value==end_value)
            {
                going=false;
            }
            
            

            //clear lists
            measured_angles.Clear();
            new_v.Clear();
        }
        

        //Message box of how many points made it into the Wrapping
        int Jarvis_count=Jarvis_pts.Count();
        this.Component.Message=Jarvis_count.ToString() + " Point(s)";

        //Output
        
        a=Jarvis_pts;

            //Create polyline
        Polyline polyline= new Polyline(Jarvis_pts);
        c=polyline;
        
    }
}
# ---------- end c_script_8 ----------
panel_2 = Panel(c_script_7.c)
panel_3 = Panel(c_script_7.b)
panel_4 = Panel(c_script_7.a)
vector_display = VectorDisplay(Anchor=list_item, Vector=subtraction)  # disabled
angle = Angle(VectorA=subtraction, VectorB=unit_x)  # -> Angle, Reflex; disabled
sort_list_2 = SortList(Keys=angle.Angle, ValuesValuesA=sort_list.ValuesValuesA)  # -> Keys, reverse(ValuesValuesA); disabled
list_item_2 = ListItem(List=sort_list_2.ValuesValuesA, Index=0, Wrap=True)  # disabled
# 1. Get x-value
# 2. Find the smallest x-value
# 3. Isolate point with smallest x-value
# 4. Calculate all vectors (subtract isolated point with all points)
# 5. Vector angle in respect to x-axis
# 6. Sort angles to the largest angle, in sync with the points
# 7. Isolate point that creates the largest angle
# 8. Repeat 4-6 *5 instead of x-axis, measure from the largest angle vector created
polyline = PolyLine(Vertices=c_script_7.a, Closed=False)
subtraction_2 = Subtraction(A=list_item_2, B=list_item)  # disabled
subtraction_3 = Subtraction(A=sort_list_2.ValuesValuesA, B=list_item_2)  # disabled
reverse = Reverse(Vector=subtraction_2)  # disabled
vector_display_2 = VectorDisplay(Anchor=list_item_2, Vector=subtraction_3)  # disabled
vector_display_3 = VectorDisplay(Anchor=list_item_2, Vector=reverse)  # disabled
angle_2 = Angle(VectorA=subtraction_3, VectorB=reverse)  # -> Angle, Reflex; disabled
sort_list_3 = SortList(Keys=angle_2.Angle, ValuesValuesA=sort_list_2.ValuesValuesA)  # -> Keys, reverse(ValuesValuesA); disabled
list_item_3 = ListItem(List=sort_list_3.ValuesValuesA, Index=0, Wrap=True)  # disabled
panel_5 = Panel(angle_2.Angle)  # disabled
subtraction_4 = Subtraction(A=list_item_3, B=list_item_2)  # disabled
vector_display_4 = VectorDisplay(Anchor=list_item_2, Vector=subtraction_4)  # disabled
