# Grasshopper definition JustVolume.gh (Grasshopper 1.0.8)

geometry = Geometry([<surface referenced from the Rhino model> x4])

# ---- group: JustVolume
c_script = CSharpScript(x=geometry)  # -> out, a; inputs x: list of GeometryBase
# ---------- c_script: C# ----------
// Grasshopper Script Instance
#region Usings
using System;
using System.Linq;
using System.Collections;
using System.Collections.Generic;
using System.Drawing;

using Rhino;
using Rhino.Geometry;

using Grasshopper;
using Grasshopper.Kernel;
using Grasshopper.Kernel.Data;
using Grasshopper.Kernel.Types;
#endregion

public class Script_Instance : GH_ScriptInstance
{
    #region Notes
    /* 
      Members:
        RhinoDoc RhinoDocument
        GH_Document GrasshopperDocument
        IGH_Component Component
        int Iteration

      Methods (Virtual & overridable):
        Print(string text)
        Print(string format, params object[] args)
        Reflect(object obj)
        Reflect(object obj, string method_name)
    */
    #endregion

    private void RunScript(List<GeometryBase> x, ref object a)
    {
        List<double> volume = new List<double>();
        foreach (GeometryBase geo in x)
        {
            VolumeMassProperties vmp = VolumeMassProperties.Compute(x);
            volume.Add(vmp.Volume);

        }

        


        a = volume;
    }
}
# ---------- end c_script ----------

# ---- group: JustArea
c_script_2 = CSharpScript(x=geometry)  # -> out, a; inputs x: list of GeometryBase
# ---------- c_script_2: C# ----------
// Grasshopper Script Instance
#region Usings
using System;
using System.Linq;
using System.Collections;
using System.Collections.Generic;
using System.Drawing;

using Rhino;
using Rhino.Geometry;

using Grasshopper;
using Grasshopper.Kernel;
using Grasshopper.Kernel.Data;
using Grasshopper.Kernel.Types;
#endregion

public class Script_Instance : GH_ScriptInstance
{
    #region Notes
    /* 
      Members:
        RhinoDoc RhinoDocument
        GH_Document GrasshopperDocument
        IGH_Component Component
        int Iteration

      Methods (Virtual & overridable):
        Print(string text)
        Print(string format, params object[] args)
        Reflect(object obj)
        Reflect(object obj, string method_name)
    */
    #endregion

    private void RunScript(List<GeometryBase> x, ref object a)
    {
        List<double> area = new List<double>();

        foreach (GeometryBase geo in x)
        {
            AreaMassProperties amp = AreaMassProperties.Compute(x);
            area.Add(amp.Area);

        }
        


        a = area;
    }
}
# ---------- end c_script_2 ----------

# ----
panel = Panel(c_script_2.a)
panel_2 = Panel(c_script.a)
