# Grasshopper definition KML Export.gh (Grasshopper 1.0.8)

# Points
panel = Panel("""	<Placemark>
        <name>Istanbul Airport</name>
        <Point>
          <coordinates>
            28.7301397,41.2768187,0
          </coordinates>
        </Point>
      </Placemark>""")
range = Range(Domain=Domain(0, 1), Steps=10)  # disabled
# Curves/Lines
panel_2 = Panel("""      <Placemark>
        <name>Line 3</name>
        <LineString>
          <tessellate>1</tessellate>
          <coordinates>
            33.3219631,35.3415522,0
            33.5605158,35.491298,0
            33.853838,35.6676729,0
            33.9834894,35.9150654,0
            33.9889826,36.159373,0
            33.88792,36.319969,0
          </coordinates>
        </LineString>
      </Placemark>""")
curve = Curve([<curve referenced from the Rhino model> x2])
evaluate_curve = EvaluateCurve(Curve=reparameterize(graft(curve)), Parameter=range)  # -> Point, Tangent, Angle; disabled
text_split = TextSplit(Text="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", Separators=" ")
list_length = ListLength(List=curve)
number_slider = Slider(19, range=0..100)
c_script = CSharpScript(x=curve, y=number_slider)  # -> out, a, b; inputs x: list of Curve, y: Int32
# ---------- c_script: C# ----------
// Grasshopper Script Instance
#region Usings
using System;
using System.Linq;
using System.Collections;
using System.Collections.Generic;
using System.Drawing;

using Rhino;
using Rhino.Geometry;

using Grasshopper;
using Grasshopper.Kernel;
using Grasshopper.Kernel.Data;
using Grasshopper.Kernel.Types;
#endregion

public class Script_Instance : GH_ScriptInstance
{
    #region Notes
    /* 
      Members:
        RhinoDoc RhinoDocument
        GH_Document GrasshopperDocument
        IGH_Component Component
        int Iteration

      Methods (Virtual & overridable):
        Print(string text)
        Print(string format, params object[] args)
        Reflect(object obj)
        Reflect(object obj, string method_name)
    */
    #endregion

    private void RunScript(List<Curve> x, int y, ref object a, ref object b)
    {
        
        List<double> divnum = new List<double>();
        List<Point3d> divpts = new List<Point3d>();

        List<List<Point3d>> test = new List<List<Point3d>>();


        foreach (Curve crv in x)
        {   
            List<Point3d> templist = new List<Point3d>();

            double length = crv.GetLength();
            double count = y + 1;
            double div = length / y;

            for (int i = 0; i < count; i++)
            {
                double value = div * i;
                Point3d pt = crv.PointAtLength(value);
                templist.Add(pt);
                //tree.Append(new GH_Point(pt), new GH_Path(i));
            }
            test.Add(templist);

        }

        //Polyline pline = new Polyline(divpts);

        a = test;
        //b=pline;
        
    }
}
# ---------- end c_script ----------
c_script_2 = CSharpScript(x=curve, y=number_slider)  # -> out, a; inputs x: list of Curve, y: Int32; disabled
# ---------- c_script_2: C# ----------
// Grasshopper Script Instance
#region Usings
using System;
using System.Linq;
using System.Collections;
using System.Collections.Generic;
using System.Drawing;

using Rhino;
using Rhino.Geometry;

using Grasshopper;
using Grasshopper.Kernel;
using Grasshopper.Kernel.Data;
using Grasshopper.Kernel.Types;
#endregion

public class Script_Instance : GH_ScriptInstance
{
    #region Notes
    /* 
      Members:
        RhinoDoc RhinoDocument
        GH_Document GrasshopperDocument
        IGH_Component Component
        int Iteration

      Methods (Virtual & overridable):
        Print(string text)
        Print(string format, params object[] args)
        Reflect(object obj)
        Reflect(object obj, string method_name)
    */
    #endregion

    private void RunScript(List<Curve> x, int y, ref object a)
    {
        foreach (Curve crv in x)
        {
            Point3d[] pts = crv.DivideEquidistant(y);
            a=pts;
        }
    }
}
# ---------- end c_script_2 ----------
point = Point([<point referenced from the Rhino model> x2])
deconstruct = Deconstruct(Point=point)  # -> XComponent, YComponent, ZComponent
series = Series(Start=0, Step=1, Count=list_length)
point_list = PointList(Points=c_script.a, Size=Slider(0.72, range=0..1))  # disabled
text_split_2 = TextSplit(Text=text_split, Separators=",")
panel_3 = Panel(deconstruct.YComponent)
list_item = ListItem(List=text_split_2, Index=0, Wrap=True)  # -> Item, Item1
c_script_3 = CSharpScript()  # -> out, a
# ---------- c_script_3: C# ----------
// Grasshopper Script Instance
#region Usings
using System;
using System.Linq;
using System.Collections;
using System.Collections.Generic;
using System.Drawing;

using Rhino;
using Rhino.Geometry;

using Grasshopper;
using Grasshopper.Kernel;
using Grasshopper.Kernel.Data;
using Grasshopper.Kernel.Types;
#endregion

public class Script_Instance : GH_ScriptInstance
{
    #region Notes
    /* 
      Members:
        RhinoDoc RhinoDocument
        GH_Document GrasshopperDocument
        IGH_Component Component
        int Iteration

      Methods (Virtual & overridable):
        Print(string text)
        Print(string format, params object[] args)
        Reflect(object obj)
        Reflect(object obj, string method_name)
    */
    #endregion

    private void RunScript(object x, object y, ref object a)
    {
        // Write your logic here
        a = null;
    }
}
# ---------- end c_script_3 ----------
c_script_4 = CSharpScript(x=curve, y=number_slider, name="test", ptname="test", points=point)  # -> out, a, b; inputs x: list of Curve, y: Int32, name: list of String, ptname: list of String, points: list of Point3d
# ---------- c_script_4: C# ----------
// Grasshopper Script Instance
#region Usings
using System;
using System.Linq;
using System.Collections;
using System.Collections.Generic;
using System.Drawing;

using Rhino;
using Rhino.Geometry;

using Grasshopper;
using Grasshopper.Kernel;
using Grasshopper.Kernel.Data;
using Grasshopper.Kernel.Types;
#endregion

public class Script_Instance : GH_ScriptInstance
{
    #region Notes
    /* 
      Members:
        RhinoDoc RhinoDocument
        GH_Document GrasshopperDocument
        IGH_Component Component
        int Iteration

      Methods (Virtual & overridable):
        Print(string text)
        Print(string format, params object[] args)
        Reflect(object obj)
        Reflect(object obj, string method_name)
    */
    #endregion

    private void RunScript(
		List<Curve> x,
		int y,
		List<string> name,
		List<string> ptname,
		List<Point3d> points,
		ref object a,
		ref object b)
    {
        //Print("Called once.");

        // Beginning string
        string beginning = "<?xml version=\"1.0\" encoding=\"UTF-8\"?>" + Environment.NewLine +
        "<kml xmlns=\"http://www.opengis.net/kml/2.2\">" + Environment.NewLine + "   <Document>" + Environment.NewLine;

        // End string
        string end = Environment.NewLine + "   </Document>" + Environment.NewLine + "</kml>";



        // Data tree to hold points (for visualizing in GH)
        GH_Structure<GH_Point> tree = new GH_Structure<GH_Point>();

        // List to store placemark strings
        List<string> placemarkBlocks = new List<string>();
        List<string> placemarkpts = new List<string>();

        List<string> dot = new List<string>();
        foreach (Point3d pt in points)
        {
            double ptX = pt.X;
            double ptY = pt.Y;
            double ptZ = pt.Z;

            string dotstring = "                " + ptX.ToString() + "," + ptY.ToString() + "," + ptZ.ToString();
            

            // Placemark block for the points
            string placemark_pts =
                "   <Placemark>" + Environment.NewLine +
                "       <name>" + string.Join(Environment.NewLine + Environment.NewLine, ptname) + "</name>" + Environment.NewLine +
                "       <Point>" + Environment.NewLine +
                "           <coordinates>" + Environment.NewLine +
                dotstring + Environment.NewLine +
                "           </coordinates>" + Environment.NewLine +
                "       </Point>" + Environment.NewLine +
                "   </Placemark>";
            placemarkpts.Add(placemark_pts);

            
        }
        Console.WriteLine(dot);

        for (int i = 0; i < x.Count; i++)
        {
            Curve crv = x[i];
            double length = crv.GetLength();
            double count = y + 1;
            double div = length / y;

            // Collect coordinates as strings
            List<string> coordinates = new List<string>();

            for (int j = 0; j < count; j++)
            {
                double value = div * j;
                Point3d pt = crv.PointAtLength(value);
                tree.Append(new GH_Point(pt), new GH_Path(i));

                string coords = $"           {pt.X},{pt.Y},{pt.Z}";
                coordinates.Add(coords);
            }


            


            // Placemark block for the paths
            string placemark_paths =
                "   <Placemark>" + Environment.NewLine +
                "       <name>" + string.Join(Environment.NewLine + Environment.NewLine, name) + "</name>" + Environment.NewLine +
                "       <LineString>" + Environment.NewLine +
                "           <tessellate>1</tessellate>" + Environment.NewLine +
                "           <coordinates>" + Environment.NewLine +
                string.Join(Environment.NewLine, coordinates) + Environment.NewLine +
                "           </coordinates>" + Environment.NewLine +
                "       </LineString>" + Environment.NewLine +
                "   </Placemark>";

            placemarkBlocks.Add(placemark_paths);
        }
        
        a = beginning + string.Join(Environment.NewLine + Environment.NewLine, placemarkpts) + end;
        // Output the tree of points and the KML content as a string
        //a = tree;

        b = beginning + string.Join(Environment.NewLine + Environment.NewLine, placemarkpts) +string.Join(Environment.NewLine + Environment.NewLine, placemarkBlocks) + end;
        
    }

    
}
# ---------- end c_script_4 ----------
c_script_5 = CSharpScript(x=curve, y=number_slider, name="test", ptname="test", points=point)  # -> out, a, b; inputs x: list of Curve, y: Int32, name: String, ptname: String, points: list of Point3d; disabled
# ---------- c_script_5: C# ----------
// Grasshopper Script Instance
#region Usings
using System;
using System.Linq;
using System.Collections;
using System.Collections.Generic;
using System.Drawing;

using Rhino;
using Rhino.Geometry;

using Grasshopper;
using Grasshopper.Kernel;
using Grasshopper.Kernel.Data;
using Grasshopper.Kernel.Types;
#endregion

public class Script_Instance : GH_ScriptInstance
{
    #region Notes
    /* 
      Members:
        RhinoDoc RhinoDocument
        GH_Document GrasshopperDocument
        IGH_Component Component
        int Iteration

      Methods (Virtual & overridable):
        Print(string text)
        Print(string format, params object[] args)
        Reflect(object obj)
        Reflect(object obj, string method_name)
    */
    #endregion

    private void RunScript(
		List<Curve> x,
		int y,
		string name,
		string ptname,
		List<Point3d> points,
		ref object a,
		ref object b)
    {
        // Beginning string
        string beginning = "<?xml version=\"1.0\" encoding=\"UTF-8\"?>" + Environment.NewLine +
        "<kml xmlns=\"http://www.opengis.net/kml/2.2\">" + Environment.NewLine + "   <Document>" + Environment.NewLine;

        // End string
        string end = Environment.NewLine + "   </Document>" + Environment.NewLine + "</kml>";



        // Data tree to hold points (for visualizing in GH)
        GH_Structure<GH_Point> tree = new GH_Structure<GH_Point>();

        // List to store placemark strings
        List<string> placemarkBlocks = new List<string>();
        List<string> placemarkpts = new List<string>();

        for (int i = 0; i < x.Count; i++)
        {
            Curve crv = x[i];
            double length = crv.GetLength();
            double count = y + 1;
            double div = length / y;

            // Collect coordinates as strings
            List<string> coordinates = new List<string>();

            for (int j = 0; j < count; j++)
            {
                double value = div * j;
                Point3d pt = crv.PointAtLength(value);
                tree.Append(new GH_Point(pt), new GH_Path(i));

                string coords = $"           {pt.X},{pt.Y},{pt.Z}";
                coordinates.Add(coords);
            }

            List<string> dot = new List<string>();

            foreach (Point3d pt in points)
            {
                double ptX = pt.X;
                double ptY = pt.Y;
                double ptZ = pt.Z;

                string dotstring = "                " + ptX.ToString() + "," + ptY.ToString() + "," + ptZ.ToString();
                dot.Add(dotstring);
            }

            

            // Placemark block for the points
            string placemark_pts =
                "   <Placemark>" + Environment.NewLine +
                "       <name>" + ptname + "</name>" + Environment.NewLine +
                "       <LineString" + Environment.NewLine +
                "           <tessellate>1<tessellate>" + Environment.NewLine +
                "           <coordinates>" + Environment.NewLine +
                string.Join(Environment.NewLine, dot) + Environment.NewLine +
                "           </coordinates>" + Environment.NewLine +
                "       <LineString>" + Environment.NewLine +
                "   <Placemark>";
            placemarkpts.Add(placemark_pts);

            // Placemark block for the paths
            string placemark_paths =
                "   <Placemark>" + Environment.NewLine +
                "       <name>" + name + "</name>" + Environment.NewLine +
                "       <LineString>" + Environment.NewLine +
                "           <tessellate>1</tessellate>" + Environment.NewLine +
                "           <coordinates>" + Environment.NewLine +
                string.Join(Environment.NewLine, coordinates) + Environment.NewLine +
                "           </coordinates>" + Environment.NewLine +
                "       </LineString>" + Environment.NewLine +
                "   </Placemark>";

            placemarkBlocks.Add(placemark_paths);
        }
        
        a = beginning + string.Join(Environment.NewLine + Environment.NewLine, placemarkpts) + end;
        // Output the tree of points and the KML content as a string
        //a = tree;

        b = beginning + string.Join(Environment.NewLine + Environment.NewLine, placemarkpts) + string.Join(Environment.NewLine + Environment.NewLine, placemarkBlocks) + end;
        
    }
    
}
# ---------- end c_script_5 ----------
construct_point = ConstructPoint(XCoordinate=list_item.Item, YCoordinate=list_item.Item1, ZCoordinate=0)
panel_4 = Panel(text_split_2)
# <?xml version="1.0" encoding="UTF-8"?>
# <kml xmlns="http://www.opengis.net/kml/2.2">
panel_5 = Panel(c_script_4.b)
panel_6 = Panel(c_script_4.a)
