# Grasshopper definition CC_Design_Template.gh (Grasshopper 1.0.8)

c_script = CSharpScript()  # -> out, a, b, c
# ---------- c_script: C# ----------
// Grasshopper Script Instance
#region Usings
using System;
using System.Linq;
using System.Collections;
using System.Collections.Generic;
using System.Drawing;

using Rhino;
using Rhino.Geometry;

using Grasshopper;
using Grasshopper.Kernel;
using Grasshopper.Kernel.Data;
using Grasshopper.Kernel.Types;
#endregion

public class Script_Instance : GH_ScriptInstance
{
    #region Notes
    /* 
      Members:
        RhinoDoc RhinoDocument
        GH_Document GrasshopperDocument
        IGH_Component Component
        int Iteration

      Methods (Virtual & overridable):
        Print(string text)
        Print(string format, params object[] args)
        Reflect(object obj)
        Reflect(object obj, string method_name)
    */
    #endregion

    private void RunScript(ref object a, ref object b, ref object c)
    {
        RhinoDoc rhinodoc = RhinoDoc.ActiveDoc;

        var pageviews = rhinodoc.Views.GetPageViews();


        List<Guid> viewportId = new List<Guid>();
        List<string> pageNames = new List<string>();
        
    
        foreach (var page in pageviews)
        {
            Guid id = page.MainViewport.Id;
            string pagenames = page.PageName;

            

            viewportId.Add(id);
            pageNames.Add(pagenames);
        }

        rhinodoc.Views.Redraw();

        a = viewportId;
        b = pageNames;
    }
}
# ---------- end c_script ----------
button = Button()
list_item = ListItem(List=c_script.a, Index="1", Wrap=True)
panel = Panel(c_script.a)
panel_2 = Panel("""0
1
2""")
c_script_2 = CSharpScript(reset=button)  # -> out, a, b, c
# ---------- c_script_2: C# ----------
// Grasshopper Script Instance
#region Usings
using System;
using System.Linq;
using System.Collections;
using System.Collections.Generic;
using System.Drawing;

using Rhino;
using Rhino.Geometry;

using Grasshopper;
using Grasshopper.Kernel;
using Grasshopper.Kernel.Data;
using Grasshopper.Kernel.Types;
#endregion

public class Script_Instance : GH_ScriptInstance
{
    #region Notes
    /* 
      Members:
        RhinoDoc RhinoDocument
        GH_Document GrasshopperDocument
        IGH_Component Component
        int Iteration

      Methods (Virtual & overridable):
        Print(string text)
        Print(string format, params object[] args)
        Reflect(object obj)
        Reflect(object obj, string method_name)
    */
    #endregion

    private void RunScript(object reset, ref object a, ref object b, ref object c)
    {
        RhinoDoc rhinodoc = RhinoDoc.ActiveDoc;

        var pageviews = rhinodoc.Views.GetPageViews();


        List<Guid> viewportId = new List<Guid>();
        List<string> pageNames = new List<string>();
        List<int>pagenum = new List<int>();
        
    
        foreach (var page in pageviews)
        {
            Guid id = page.MainViewport.Id;
            string pagenames = page.PageName;
            int num = page.PageNumber;

            

            viewportId.Add(id);
            pageNames.Add(pagenames);
            pagenum.Add(num);
        }
        if (reset is true)
        {
            rhinodoc.Views.Redraw();
        }
        rhinodoc.Views.Redraw();

        a = viewportId;
        b = pageNames;
        c = pagenum;
    }
}
# ---------- end c_script_2 ----------
c_script_3 = CSharpScript(layoutuserId=list_item, toggle=button)  # -> out, keys, values; inputs layoutuserId: Guid, toggle: Boolean
# ---------- c_script_3: C# ----------
// Grasshopper Script Instance
#region Usings
using System;
using System.Linq;
using System.Collections;
using System.Collections.Generic;
using System.Collections.Specialized;
using System.Drawing;

using Rhino;
using Rhino.Geometry;

using Grasshopper;
using Grasshopper.Kernel;
using Grasshopper.Kernel.Data;
using Grasshopper.Kernel.Types;
#endregion

public class Script_Instance : GH_ScriptInstance
{
    #region Notes
    /* 
      Members:
        RhinoDoc RhinoDocument
        GH_Document GrasshopperDocument
        IGH_Component Component
        int Iteration

      Methods (Virtual & overridable):
        Print(string text)
        Print(string format, params object[] args)
        Reflect(object obj)
        Reflect(object obj, string method_name)
    */
    #endregion

    private void RunScript(
		Guid layoutuserId,
		bool toggle,
		ref object keys,
		ref object values)
    {
        //sanity checks
        if (layoutuserId == Guid.Empty)
        {

            AddRuntimeMessage(GH_RuntimeMessageLevel.Warning,"1. Input parameter layoutuserID failed to collect data");
            return;
            
        }



        RhinoDoc doc = RhinoDoc.ActiveDoc;

        if (toggle is true)
        {
            doc.Views.Redraw();
        }


        List<string>v = new List<string>();
        
        var page = doc.Views.Find(layoutuserId);
        var userstring = page.MainViewport.GetUserStrings();
        var Ukey = userstring.AllKeys;

        foreach (var i in Ukey)
        {
            string guidstr = layoutuserId.ToString();
            v.Add(Rhino.Runtime.TextFields.LayoutUserText(guidstr,i));
        }
        
        

        keys = Ukey;
        values = v;
        
    }
}
# ---------- end c_script_3 ----------
cull_index = CullIndex(List=c_script_2.a, Indices=panel_2, Wrap=True)
button_2 = Button()
list_item_2 = ListItem(List=c_script_2.a, Index="2", Wrap=True)
concatenate = Concatenate(B="*", Fragment_A="table0", A="\", Fragment_B="B", C="*")
concatenate_2 = Concatenate(B="*", Fragment_A="table0", A="\", Fragment_B="D", C="*")
panel_3 = Panel("""1
1
0""")
concatenate_3 = Concatenate(B="*", Fragment_A="table0", A="\", Fragment_B="C", C="*")
c_script_4 = CSharpScript(layoutuserId=cull_index, toggle=button)  # -> out, keys, values; inputs layoutuserId: Guid, toggle: Boolean; same code as c_script_3
concatenate_4 = Concatenate(B="*", Fragment_A="table0", A="\", Fragment_B="A", C="*")
c_script_5 = CSharpScript(reset=button)  # -> out, a, b, c; same code as c_script_2
read_file = ReadFile(File="C:\Users\Clark Cheng\Desktop\BOM TEMPLATE.CSV", PerLineParse=True)

# ---- group: Get LayoutUserText Strings
c_script_6 = CSharpScript(x=list_item_2)  # -> out, a; inputs x: Guid
# ---------- c_script_6: C# ----------
// Grasshopper Script Instance
#region Usings
using System;
using System.Linq;
using System.Collections;
using System.Collections.Generic;
using System.Drawing;

using Rhino;
using Rhino.Geometry;

using Grasshopper;
using Grasshopper.Kernel;
using Grasshopper.Kernel.Data;
using Grasshopper.Kernel.Types;
#endregion

public class Script_Instance : GH_ScriptInstance
{
    #region Notes
    /* 
      Members:
        RhinoDoc RhinoDocument
        GH_Document GrasshopperDocument
        IGH_Component Component
        int Iteration

      Methods (Virtual & overridable):
        Print(string text)
        Print(string format, params object[] args)
        Reflect(object obj)
        Reflect(object obj, string method_name)
    */
    #endregion

    private void RunScript(Guid x, ref object a)
    {
        RhinoDoc doc = RhinoDoc.ActiveDoc;

        var page = doc.Views.Find(x);

        var s = page.MainViewport.GetUserStrings();

        a = s;
    }
}
# ---------- end c_script_6 ----------

# ----
merge = Merge(Data1=concatenate, Data2=concatenate_2)
python_3_script = Python3Script(x=read_file)  # -> out, a; inputs x: list of String
# ---------- python_3_script: Python ----------
import csv
import Grasshopper as gh

tree = gh.DataTree[object]()

for i, line in enumerate(x):
    row = next(csv.reader([line]))
    path = gh.Kernel.Data.GH_Path(i)

    for value in row:
        tree.Add(value, path)

a = tree
# ---------- end python_3_script ----------
merge_2 = Merge(Data1=concatenate_4, Data2=concatenate_3)
panel_4 = Panel("""COVER

OVERVIEW""")
cull_pattern = CullPattern(List=c_script_4.values, CullPattern=panel_3)
match_text = MatchText(Text=c_script_3.keys, Pattern=graft(merge), Case=True)
list_item_3 = ListItem(List=c_script_5.a, Index="2", Wrap=True)
match_text_2 = MatchText(Text=c_script_3.keys, Pattern=graft(merge_2), Case=True)
tree_statistics = TreeStatistics(Tree=python_3_script.a)  # -> Paths, Length, Count
concatenate_5 = Concatenate(B="*", Fragment_A="table3", A="\", Fragment_B="A", C="*")
concatenate_6 = Concatenate(B="*", Fragment_A="table3", A="\", Fragment_B="B", C="*")
concatenate_7 = Concatenate(B="*", Fragment_A="table3", A="\", Fragment_B="C", C="*")
panel_5 = Panel("""A
B
C
D
E
F""")
merge_3 = Merge(Data1=panel_4, Data2=cull_pattern)  # -> flatten(Result)

# ---- group: Get LayoutUserText Strings
c_script_7 = CSharpScript(x=list_item_3)  # -> out, a; inputs x: Guid; same code as c_script_6

# ---- group: ITEM NO
cull_pattern_2 = CullPattern(List=c_script_3.keys, CullPattern=match_text_2)  # -> flatten(List)

# ---- group: DESCRIP
cull_pattern_3 = CullPattern(List=c_script_3.keys, CullPattern=match_text)  # -> flatten(List)

# ----
merge_4 = Merge(Data1=concatenate_5, Data2=concatenate_6, Data3=concatenate_7)
cull_index_2 = CullIndex(List=tree_statistics.Paths, Indices="0", Wrap=True)
panel_6 = Panel("B")
partition_list = PartitionList(List=merge_3, Size="2")
# ITEM DRAWINGS
match_text_3 = MatchText(Text=c_script_6.a, Pattern=graft(merge_4), Case=True)
tree_branch = TreeBranch(Tree=python_3_script.a, Path=cull_index_2, MaintainPaths=True)
concatenate_8 = Concatenate(B="*", Fragment_A="table4", A="\", Fragment_B=panel_5, C="*")
concatenate_9 = Concatenate(FragmentA=partition_list, FragmentB=" ")
c_script_8 = CSharpScript(x=tree_branch)  # -> out, a, b; inputs x: list of String
# ---------- c_script_8: C# ----------
// Grasshopper Script Instance
#region Usings
using System;
using System.Linq;
using System.Collections;
using System.Collections.Generic;
using System.Drawing;

using Rhino;
using Rhino.Geometry;

using Grasshopper;
using Grasshopper.Kernel;
using Grasshopper.Kernel.Data;
using Grasshopper.Kernel.Types;
#endregion

public class Script_Instance : GH_ScriptInstance
{
    #region Notes
    /* 
      Members:
        RhinoDoc RhinoDocument
        GH_Document GrasshopperDocument
        IGH_Component Component
        int Iteration

      Methods (Virtual & overridable):
        Print(string text)
        Print(string format, params object[] args)
        Reflect(object obj)
        Reflect(object obj, string method_name)
    */
    #endregion

    private void RunScript(List<string> x, ref object a, ref object b)
    {
        List<int> booltoggle = new List<int>();

        foreach (string i in x)
        {
            if (string.IsNullOrEmpty(i))
            {
                int y = 1;
                booltoggle.Add(y);
            }

            else
            {
                int z =0;
                booltoggle.Add(z);
            }
        }

        List<int> indices = new List<int>();
        for (int i = 0; i < booltoggle.Count; i++)
        {
            if (booltoggle[i] == 1)
            {
                indices.Add(i);
            }
        }




       

        a = booltoggle;
        b = indices;
    }
}
# ---------- end c_script_8 ----------

# ---- group: ITEM NO
cull_pattern_4 = CullPattern(List=c_script_6.a, CullPattern=match_text_3)

# ----
merge_5 = Merge(Data1=concatenate_8)
sift_pattern = SiftPattern(List=tree_branch, SiftPattern=c_script_8.a)  # -> Output0, Output1
panel_7 = Panel(merge_2)
panel_8 = Panel(concatenate_8)
match_text_4 = MatchText(Text=c_script_7.a, Pattern=graft(concatenate_8), Case=True)
text_join = TextJoin(Text=concatenate_9)  # -> flatten(Result)
c_script_9 = CSharpScript()  # -> out, keys, values
# ---------- c_script_9: C# ----------
// Grasshopper Script Instance
#region Usings
using System;
using System.Linq;
using System.Collections;
using System.Collections.Generic;
using System.Collections.Specialized;
using System.Drawing;

using Rhino;
using Rhino.Geometry;

using Grasshopper;
using Grasshopper.Kernel;
using Grasshopper.Kernel.Data;
using Grasshopper.Kernel.Types;
#endregion

public class Script_Instance : GH_ScriptInstance
{
    #region Notes
    /* 
      Members:
        RhinoDoc RhinoDocument
        GH_Document GrasshopperDocument
        IGH_Component Component
        int Iteration

      Methods (Virtual & overridable):
        Print(string text)
        Print(string format, params object[] args)
        Reflect(object obj)
        Reflect(object obj, string method_name)
    */
    #endregion

    private void RunScript(ref object keys, ref object values)
    {
        var view = RhinoDoc.ActiveDoc.Views.ActiveView;

        if (view == null)
            return;

        NameValueCollection userText =
            view.MainViewport.GetUserStrings();

        var Akeys = new List<string>();
        var Avalues = new List<string>();

        foreach (string key in userText.AllKeys)
        {
            Akeys.Add(key);
            Avalues.Add(userText[key]);
        }

        keys = Akeys;
        values = Avalues;
    }
}
# ---------- end c_script_9 ----------
replace_items = ReplaceItems(List=sift_pattern.Output1, Item="--", Indices=c_script_8.b, Wrap=False)

# ---- group: RESET VALUES
c_script_10 = CSharpScript(x=c_script_9.keys, y="--", toggle=Button())  # -> out, a; inputs x: list of String, y: String, toggle: Boolean
# ---------- c_script_10: C# ----------
// Grasshopper Script Instance
#region Usings
using System;
using System.Linq;
using System.Collections;
using System.Collections.Generic;
using System.Drawing;

using Rhino;
using Rhino.Geometry;

using Grasshopper;
using Grasshopper.Kernel;
using Grasshopper.Kernel.Data;
using Grasshopper.Kernel.Types;
#endregion

public class Script_Instance : GH_ScriptInstance
{
    #region Notes
    /* 
      Members:
        RhinoDoc RhinoDocument
        GH_Document GrasshopperDocument
        IGH_Component Component
        int Iteration

      Methods (Virtual & overridable):
        Print(string text)
        Print(string format, params object[] args)
        Reflect(object obj)
        Reflect(object obj, string method_name)
    */
    #endregion

    private void RunScript(List<string> x, string y, bool toggle, ref object a)
    {
        RhinoDoc doc = RhinoDoc.ActiveDoc;

        Guid layoutid = new Guid("555f892c-cc6f-4a2a-be12-98ab1795e454");
        var page = doc.Views.Find(layoutid);

        if (toggle is true)
        {
            foreach (string keys in x)
            {
                a = page.MainViewport.SetUserString(keys,y);
            }
        }


    }
}
# ---------- end c_script_10 ----------

# ---- group: ITEM NO
cull_pattern_5 = CullPattern(List=c_script_7.a, CullPattern=match_text_4)

# ----
combine_data = CombineData(Input0=sift_pattern.Output0, Input1=replace_items)  # -> Result, Index
list_length = ListLength(List=text_join)
construct_domain = ConstructDomain(DomainStart=0, DomainEnd=1)
flip_matrix = FlipMatrix(Data=combine_data.Result)
c_script_11 = CSharpScript()  # -> out, a
# ---------- c_script_11: C# ----------
// Grasshopper Script Instance
#region Usings
using System;

#endregion

public class Script_Instance : GH_ScriptInstance
{
    #region Notes
    /* 
      Members:
        RhinoDoc RhinoDocument
        GH_Document GrasshopperDocument
        IGH_Component Component
        int Iteration

      Methods (Virtual & overridable):
        Print(string text)
        Print(string format, params object[] args)
        Reflect(object obj)
        Reflect(object obj, string method_name)
    */
    #endregion

    private void RunScript(ref object a)
    {
        string todayText = DateTime.Now.ToString("yyyy-MM-dd");
        a = todayText;
    }
}
# ---------- end c_script_11 ----------
series = Series(Start="1", Step="1", Count=list_length)
panel_9 = Panel(cull_pattern_4)
list_length_2 = ListLength(List=flip_matrix)
duplicate_data = DuplicateData(Data=c_script_11.a, Number=list_length, Order=True)
series_2 = Series(Start=0, Step=1, Count=list_length_2)
list_length_3 = ListLength(List=cull_pattern_4)
subtraction = Subtraction(A=series, B="1")
entwine = Entwine(Branch00=series, Branch01=text_join, Branch02=duplicate_data, FlattenInputs=True)
list_item_4 = ListItem(List=cull_pattern_4, Index=subtraction, Wrap=True)
list_item_5 = ListItem(List=cull_pattern_5, Index=series_2, Wrap=True)
panel_10 = Panel(list_item_4)
c_script_12 = CSharpScript(LayoutKey=graft(list_item_4), values=graft(entwine), layoutGuid=list_item_2)  # -> out, a; inputs LayoutKey: list of String, values: String, layoutGuid: Guid
# ---------- c_script_12: C# ----------
// Grasshopper Script Instance
#region Usings
using System;
using System.Linq;
using System.Collections;
using System.Collections.Generic;
using System.Drawing;

using Rhino;
using Rhino.Geometry;

using Grasshopper;
using Grasshopper.Kernel;
using Grasshopper.Kernel.Data;
using Grasshopper.Kernel.Types;
#endregion

public class Script_Instance : GH_ScriptInstance
{
    #region Notes
    /* 
      Members:
        RhinoDoc RhinoDocument
        GH_Document GrasshopperDocument
        IGH_Component Component
        int Iteration

      Methods (Virtual & overridable):
        Print(string text)
        Print(string format, params object[] args)
        Reflect(object obj)
        Reflect(object obj, string method_name)
    */
    #endregion

    private void RunScript(
		List<string> LayoutKey,
		string values,
		Guid layoutGuid,
		ref object a)
    {
        RhinoDoc doc = RhinoDoc.ActiveDoc;

        var page = doc.Views.Find(layoutGuid);

        foreach (var s in LayoutKey)
        {
            var test = page.MainViewport.SetUserString(s,values);
        }
        
    }
}
# ---------- end c_script_12 ----------
panel_11 = Panel(duplicate_data)
c_script_13 = CSharpScript(LayoutKey=graft(list_item_5), values=graft(flip_matrix), layoutGuid=list_item_3)  # -> out, a; inputs LayoutKey: list of String, values: String, layoutGuid: Guid; same code as c_script_12
