# Grasshopper definition layout user text testing.gh (Grasshopper 1.0.8)

button = Button()
panel = Panel(button)
c_script = CSharpScript(pagenum="9", toggle=button)  # -> out, a, b; inputs pagenum: String, toggle: Boolean
# ---------- c_script: C# ----------
// Grasshopper Script Instance
#region Usings
using System;
using System.Linq;
using System.Collections;
using System.Collections.Generic;
using System.Drawing;

using Rhino;
using Rhino.Geometry;

using Grasshopper;
using Grasshopper.Kernel;
using Grasshopper.Kernel.Data;
using Grasshopper.Kernel.Types;
#endregion

public class Script_Instance : GH_ScriptInstance
{
    #region Notes
    /* 
      Members:
        RhinoDoc RhinoDocument
        GH_Document GrasshopperDocument
        IGH_Component Component
        int Iteration

      Methods (Virtual & overridable):
        Print(string text)
        Print(string format, params object[] args)
        Reflect(object obj)
        Reflect(object obj, string method_name)
    */
    #endregion

    private void RunScript(string pagenum, bool toggle, ref object a, ref object b)
    {
        RhinoDoc doc = RhinoDoc.ActiveDoc;

        Guid layoutid=new Guid("555f892c-cc6f-4a2a-be12-98ab1795e454");
        var page = doc.Views.Find(layoutid);

        if (toggle is true)
        {
            if (page != null)
            {
                a = page.MainViewport.SetUserString(@"$tk\lay\table3\A01",pagenum);
                doc.Views.Redraw();


            }
            else
            {
                a=null;
            }
        }
        else
        {
            return;

        }


    }
}
# ---------- end c_script ----------
panel_2 = Panel("test")
panel_3 = Panel(c_script.b)
c_script_2 = CSharpScript()  # -> out, a
# ---------- c_script_2: C# ----------
// Grasshopper Script Instance
#region Usings
using System;
using System.Linq;
using System.Collections;
using System.Collections.Generic;
using System.Drawing;

using Rhino;
using Rhino.Geometry;

using Grasshopper;
using Grasshopper.Kernel;
using Grasshopper.Kernel.Data;
using Grasshopper.Kernel.Types;
#endregion

public class Script_Instance : GH_ScriptInstance
{
    #region Notes
    /* 
      Members:
        RhinoDoc RhinoDocument
        GH_Document GrasshopperDocument
        IGH_Component Component
        int Iteration

      Methods (Virtual & overridable):
        Print(string text)
        Print(string format, params object[] args)
        Reflect(object obj)
        Reflect(object obj, string method_name)
    */
    #endregion

    private void RunScript(ref object a)
    {
        RhinoDoc doc = RhinoDoc.ActiveDoc;

        Guid layoutid=new Guid("555f892c-cc6f-4a2a-be12-98ab1795e454");
        var page = doc.Views.Find(layoutid);

        if (page != null)
        {
            a = page.MainViewport.GetUserString(@"$tk\lay\table3\A08");


        }
        else
        {
            a=null;
        }
    }
}
# ---------- end c_script_2 ----------
c_script_3 = CSharpScript()  # -> out, keys, values
# ---------- c_script_3: C# ----------
// Grasshopper Script Instance
#region Usings
using System;
using System.Linq;
using System.Collections;
using System.Collections.Generic;
using System.Collections.Specialized;
using System.Drawing;

using Rhino;
using Rhino.Geometry;

using Grasshopper;
using Grasshopper.Kernel;
using Grasshopper.Kernel.Data;
using Grasshopper.Kernel.Types;
#endregion

public class Script_Instance : GH_ScriptInstance
{
    #region Notes
    /* 
      Members:
        RhinoDoc RhinoDocument
        GH_Document GrasshopperDocument
        IGH_Component Component
        int Iteration

      Methods (Virtual & overridable):
        Print(string text)
        Print(string format, params object[] args)
        Reflect(object obj)
        Reflect(object obj, string method_name)
    */
    #endregion

    private void RunScript(ref object keys, ref object values)
    {
        var view = RhinoDoc.ActiveDoc.Views.ActiveView;

        if (view == null)
            return;

        NameValueCollection userText =
            view.MainViewport.GetUserStrings();

        var Akeys = new List<string>();
        var Avalues = new List<string>();

        foreach (string key in userText.AllKeys)
        {
            Akeys.Add(key);
            Avalues.Add(userText[key]);
        }

        keys = Akeys;
        values = Avalues;
    }
}
# ---------- end c_script_3 ----------
concatenate = Concatenate(B="*", Fragment_A="table3", A="\", Fragment_B="B", C="*")
panel_4 = Panel(c_script_2.a)
panel_5 = Panel(c_script_3.values)
c_script_4 = CSharpScript()  # -> out, a
# ---------- c_script_4: C# ----------
// Grasshopper Script Instance
#region Usings
using System;
using System.Linq;
using System.Collections;
using System.Collections.Generic;
using System.Drawing;

using Rhino;
using Rhino.Geometry;

using Grasshopper;
using Grasshopper.Kernel;
using Grasshopper.Kernel.Data;
using Grasshopper.Kernel.Types;
#endregion

public class Script_Instance : GH_ScriptInstance
{
    #region Notes
    /* 
      Members:
        RhinoDoc RhinoDocument
        GH_Document GrasshopperDocument
        IGH_Component Component
        int Iteration

      Methods (Virtual & overridable):
        Print(string text)
        Print(string format, params object[] args)
        Reflect(object obj)
        Reflect(object obj, string method_name)
    */
    #endregion

    private void RunScript(ref object a)
    {
        RhinoDoc doc = RhinoDoc.ActiveDoc;

        int test = doc.Strings.DocumentUserTextCount;
        Console.WriteLine(test);

        List<string> keystr = new List<string>();

        for (int i = 0; i<test;i++)
        {
            var test1 = doc.Strings.GetKey(i);
            keystr.Add(test1);
        }

        a = keystr;
        
    }
}
# ---------- end c_script_4 ----------
c_script_5 = CSharpScript()  # -> out, a, b
# ---------- c_script_5: C# ----------
// Grasshopper Script Instance
#region Usings
using System;
using System.Linq;
using System.Collections;
using System.Collections.Generic;
using System.Drawing;

using Rhino;
using Rhino.Geometry;

using Grasshopper;
using Grasshopper.Kernel;
using Grasshopper.Kernel.Data;
using Grasshopper.Kernel.Types;
#endregion

public class Script_Instance : GH_ScriptInstance
{
    #region Notes
    /* 
      Members:
        RhinoDoc RhinoDocument
        GH_Document GrasshopperDocument
        IGH_Component Component
        int Iteration

      Methods (Virtual & overridable):
        Print(string text)
        Print(string format, params object[] args)
        Reflect(object obj)
        Reflect(object obj, string method_name)
    */
    #endregion

    private void RunScript(ref object a, ref object b)
    {
        RhinoDoc doc = RhinoDoc.ActiveDoc;

        var pageviews = doc.Views.GetPageViews();

        List<string> pagenames = new List<string>();
        List<int> pagenums = new List<int>();

        foreach (var layout in pageviews)
        {
            string name = layout.PageName;
            int pagenum = layout.PageNumber;

            pagenames.Add(name);
            pagenums.Add(pagenum);
        }
        
        a = pagenames;
        b = pagenums;
    }
}
# ---------- end c_script_5 ----------
match_text = MatchText(Text=c_script_3.keys, Pattern=concatenate, Case=True)
panel_7 = Panel(c_script_4.a)
panel_8 = Panel("""0
1
2""")
addition = Addition(A=c_script_5.b, B="1")
cull_pattern = CullPattern(List=c_script_3.keys, CullPattern=match_text)
list_length = ListLength(List=cull_pattern)
list_length_2 = ListLength(List=c_script_5.a)
c_script_6 = CSharpScript()  # -> out, a, b, c
# ---------- c_script_6: C# ----------
// Grasshopper Script Instance
#region Usings
using System;
using System.Linq;
using System.Collections;
using System.Collections.Generic;
using System.Drawing;

using Rhino;
using Rhino.Geometry;

using Grasshopper;
using Grasshopper.Kernel;
using Grasshopper.Kernel.Data;
using Grasshopper.Kernel.Types;
#endregion

public class Script_Instance : GH_ScriptInstance
{
    #region Notes
    /* 
      Members:
        RhinoDoc RhinoDocument
        GH_Document GrasshopperDocument
        IGH_Component Component
        int Iteration

      Methods (Virtual & overridable):
        Print(string text)
        Print(string format, params object[] args)
        Reflect(object obj)
        Reflect(object obj, string method_name)
    */
    #endregion

    private void RunScript(ref object a, ref object b, ref object c)
    {
        RhinoDoc rhinodoc = RhinoDoc.ActiveDoc;

        var pageviews = rhinodoc.Views.GetPageViews();


        List<Guid> viewportId = new List<Guid>();
        List<string> pageNames = new List<string>();
        
    
        foreach (var page in pageviews)
        {
            Guid id = page.MainViewport.Id;
            string pagenames = page.PageName;

            

            viewportId.Add(id);
            pageNames.Add(pagenames);
        }

        rhinodoc.Views.Redraw();

        a = viewportId;
        b = pageNames;
    }
}
# ---------- end c_script_6 ----------
panel_9 = Panel(addition)
panel_10 = Panel(c_script_5.a)
concatenate_2 = Concatenate(FragmentA="\", FragmentB="B")
subtraction = Subtraction(A=list_length, B=list_length_2)
text_split = TextSplit(Text=cull_pattern, Separators=concatenate_2)
duplicate_data = DuplicateData(Data="--", Number=subtraction, Order=True)
cull_index = CullIndex(List=c_script_6.b, Indices=panel_8, Wrap=True)
list_item = ListItem(List=c_script_6.a, Index=Slider(3, range=0..10), Wrap=True)  # -> Item, Item1
cull_index_2 = CullIndex(List=c_script_6.a, Indices=panel_8, Wrap=True)
list_item_2 = ListItem(List=c_script_6.a, Index="2", Wrap=True)

# ---- group: RESET VALUES
c_script_7 = CSharpScript(x=c_script_3.keys, y="--", toggle=Button())  # -> out, a; inputs x: list of String, y: String, toggle: Boolean
# ---------- c_script_7: C# ----------
// Grasshopper Script Instance
#region Usings
using System;
using System.Linq;
using System.Collections;
using System.Collections.Generic;
using System.Drawing;

using Rhino;
using Rhino.Geometry;

using Grasshopper;
using Grasshopper.Kernel;
using Grasshopper.Kernel.Data;
using Grasshopper.Kernel.Types;
#endregion

public class Script_Instance : GH_ScriptInstance
{
    #region Notes
    /* 
      Members:
        RhinoDoc RhinoDocument
        GH_Document GrasshopperDocument
        IGH_Component Component
        int Iteration

      Methods (Virtual & overridable):
        Print(string text)
        Print(string format, params object[] args)
        Reflect(object obj)
        Reflect(object obj, string method_name)
    */
    #endregion

    private void RunScript(List<string> x, string y, bool toggle, ref object a)
    {
        RhinoDoc doc = RhinoDoc.ActiveDoc;

        Guid layoutid = new Guid("555f892c-cc6f-4a2a-be12-98ab1795e454");
        var page = doc.Views.Find(layoutid);

        if (toggle is true)
        {
            foreach (string keys in x)
            {
                a = page.MainViewport.SetUserString(keys,y);
            }
        }


    }
}
# ---------- end c_script_7 ----------

# ----
list_item_3 = ListItem(List=text_split, Index="4", Wrap=True)  # -> flatten(Item)
merge = Merge(Data1=list_item.Item, Data2=list_item.Item1)
sort_list = SortList(Keys=list_item_3, ValuesValuesA=cull_pattern)  # -> Keys, ValuesValuesA
panel_11 = Panel("""1
1
0""")
c_script_8 = CSharpScript(layoutId=cull_index_2)  # -> out, a; inputs layoutId: list of Guid; disabled
# ---------- c_script_8: C# ----------
// Grasshopper Script Instance
#region Usings
using System;
using System.Linq;
using System.Collections;
using System.Collections.Generic;
using System.Drawing;

using Rhino;
using Rhino.Geometry;

using Grasshopper;
using Grasshopper.Kernel;
using Grasshopper.Kernel.Data;
using Grasshopper.Kernel.Types;
#endregion

public class Script_Instance : GH_ScriptInstance
{
    #region Notes
    /* 
      Members:
        RhinoDoc RhinoDocument
        GH_Document GrasshopperDocument
        IGH_Component Component
        int Iteration

      Methods (Virtual & overridable):
        Print(string text)
        Print(string format, params object[] args)
        Reflect(object obj)
        Reflect(object obj, string method_name)
    */
    #endregion

    private void RunScript(List<Guid> layoutId, object usertext, ref object a)
    {
        RhinoDoc rhinodoc = RhinoDoc.ActiveDoc;


        List<string>drawingNames = new List<string>();

        foreach (Guid id in layoutId)
        {
            var page = rhinodoc.Views.Find(id);

            var userstring = page.MainViewport.GetUserStrings();
            var Ukey = userstring.AllKeys;

            string stringGuid = id.ToString();
            //Console.WriteLine(stringGuid);

            foreach (var key in Ukey)
            {
 
                string userDefinedtext = Rhino.Runtime.TextFields.LayoutUserText(stringGuid,key);
                Console.WriteLine(userDefinedtext);
                drawingNames.Add(userDefinedtext);
                
            }
            
            
            

        }

        a = drawingNames;


    }
}
# ---------- end c_script_8 ----------
c_script_9 = CSharpScript(layoutuserId=cull_index_2, toggle=Button())  # -> out, keys, values; inputs layoutuserId: Guid, toggle: Boolean
# ---------- c_script_9: C# ----------
// Grasshopper Script Instance
#region Usings
using System;
using System.Linq;
using System.Collections;
using System.Collections.Generic;
using System.Collections.Specialized;
using System.Drawing;

using Rhino;
using Rhino.Geometry;

using Grasshopper;
using Grasshopper.Kernel;
using Grasshopper.Kernel.Data;
using Grasshopper.Kernel.Types;
#endregion

public class Script_Instance : GH_ScriptInstance
{
    #region Notes
    /* 
      Members:
        RhinoDoc RhinoDocument
        GH_Document GrasshopperDocument
        IGH_Component Component
        int Iteration

      Methods (Virtual & overridable):
        Print(string text)
        Print(string format, params object[] args)
        Reflect(object obj)
        Reflect(object obj, string method_name)
    */
    #endregion

    private void RunScript(
		Guid layoutuserId,
		bool toggle,
		ref object keys,
		ref object values)
    {
        //sanity checks
        if (layoutuserId == Guid.Empty)
        {

            AddRuntimeMessage(GH_RuntimeMessageLevel.Warning,"1. Input parameter layoutuserID failed to collect data");
            return;
            
        }



        RhinoDoc doc = RhinoDoc.ActiveDoc;

        if (toggle is true)
        {
            doc.Views.Redraw();
        }


        List<string>v = new List<string>();
        
        var page = doc.Views.Find(layoutuserId);
        var userstring = page.MainViewport.GetUserStrings();
        var Ukey = userstring.AllKeys;

        foreach (var i in Ukey)
        {
            string guidstr = layoutuserId.ToString();
            v.Add(Rhino.Runtime.TextFields.LayoutUserText(guidstr,i));
        }
        
        

        keys = Ukey;
        values = v;
        
    }
}
# ---------- end c_script_9 ----------
cull_pattern_2 = CullPattern(List=c_script_9.values, CullPattern=panel_11)
panel_12 = Panel(c_script_9.keys)
panel_13 = Panel("""COVER

OVERVIEW""")
panel_14 = Panel(sort_list.ValuesValuesA)
merge_2 = Merge(Data1=panel_13, Data2=cull_pattern_2)  # -> flatten(Result)
panel_15 = Panel(cull_pattern_2)
partition_list = PartitionList(List=merge_2, Size="2")
concatenate_3 = Concatenate(FragmentA=partition_list, FragmentB=" ")
text_join = TextJoin(Text=concatenate_3)  # -> flatten(Result)
entwine = Entwine(Branch00=text_join, Branch01=duplicate_data, FlattenInputs=True)  # -> flatten(Result)
c_script_10 = CSharpScript(x=graft(sort_list.ValuesValuesA), y=graft(entwine), toggle=Button())  # -> out, a; inputs x: list of String, y: String, toggle: Boolean; same code as c_script_7
panel_16 = Panel(c_script_10.a)
panel_17 = Panel(entwine)
panel_18 = Panel(text_join)
