# Grasshopper definition MT_Boolean_Difference_Example.gh (Grasshopper 1.0.8)
# plug-ins: RhinoCodePluginGH

number_slider = Slider(21, range=0..100)
rectangle = Rectangle(Plane=PlaneXY(0, 0, 0), XSize=number_slider, YSize=number_slider, Radius=0)  # -> Rectangle, Length
rectangle_2 = Rectangle(Plane=PlaneXY(0, 0, 0), XSize=number_slider, YSize=number_slider, Radius=0)  # -> Rectangle, Length
populate_2d = Populate2D(Region=rectangle_2.Rectangle, Count=100, Seed=1)
cylinder = Cylinder(Base=populate_2d, Radius=0.5, Length=1)
unit_z = UnitZ(Factor=1)
unit_z_2 = UnitZ(Factor="0.5")
extrude = Extrude(Base=rectangle_2.Rectangle, Direction=unit_z)
move = Move(Geometry=cylinder, Motion=unit_z_2)  # -> Geometry, Transform
cap_holes = CapHoles(Brep=extrude)
cap_holes_2 = CapHoles(Brep=move.Geometry)
flatten_tree = FlattenTree(Tree=cap_holes_2, Path="{0}")
suirify = Suirify(cap_holes_2)
panel = Panel(suirify)
# tree data has to match like so. use Surify component
panel_2 = Panel(cap_holes)
c_script = CSharpScript(S=cap_holes, D=suirify)  # -> out, R, BB; inputs S: tree of Brep, D: tree of Brep
# ---------- c_script: C# ----------
#region using
using System;
using System.Collections;
using System.Collections.Generic;

using Rhino;
using Rhino.Geometry;

using Grasshopper;
using Grasshopper.Kernel;
using Grasshopper.Kernel.Data;
using Grasshopper.Kernel.Types;
#endregion
using System.Threading.Tasks;
using System.Collections.Concurrent;

public class Script_Instance : GH_ScriptInstance
{
    #region Utility functions
    private void Print(string text) { __out.Add(text); }
    private void Print(string format, params object[] args) { __out.Add(string.Format(format, args)); }
    private void Reflect(object obj) { __out.Add(GH_ScriptComponentUtilities.ReflectType_CS(obj)); }
    private void Reflect(object obj, string method_name) { __out.Add(GH_ScriptComponentUtilities.ReflectType_CS(obj, method_name)); }
    #endregion

    #region Members
    private RhinoDoc RhinoDocument;
    private GH_Document GrasshopperDocument;
    private IGH_Component Component;
    private int Iteration;
    #endregion

    private void RunScript(
	DataTree<Brep> S,
	DataTree<Brep> D,
	ref object R,
	ref object BB)
    {
        // Check if input trees are null or empty
        if (S == null || D == null || S.BranchCount == 0 || D.BranchCount == 0)
        {
            Print("Input data is null or empty.");
            return;
        }

        // Check RhinoDocument
        if (RhinoDocument == null)
        {
            Print("Rhino document is not initialized. Using a default tolerance value.");
            RhinoDocument = Rhino.RhinoDoc.ActiveDoc;
            if (RhinoDocument == null)
            {
                Print("No active Rhino document found. Using default tolerance of 0.01.");
            }
        }

        double tolerance = RhinoDocument != null ? RhinoDocument.ModelAbsoluteTolerance : 0.01;

        // Debug: Print the tolerance value
        Print($"Using tolerance: {tolerance}");

        // Debug: Print the size of the input trees
        Print($"S tree has {S.BranchCount} branches.");
        Print($"D tree has {D.BranchCount} branches.");

        // Declare dictionaries that work in parallel to hold the successful boolean results and
        // the unsuccessful boolean cutters
        var mainBrepsMT = new ConcurrentDictionary<GH_Path, Brep>();
        var badBrepsMT = new ConcurrentDictionary<GH_Path, List<Brep>>();

        var totalMaxConcurrancy = System.Environment.ProcessorCount - 1;
        //this.Component.Message = totalMaxConcurrancy + " threads";

        // Parallel processing
        Parallel.ForEach(S.Paths, new ParallelOptions { MaxDegreeOfParallelism = totalMaxConcurrancy }, pth =>
        {
            if (S.Branch(pth) == null || S.Branch(pth).Count == 0)
            {
                Print($"Branch {pth} in S is null or empty.");
                return;
            }

            if (D.Branch(pth) == null || D.Branch(pth).Count == 0)
            {
                Print($"Branch {pth} in D is null or empty.");
                return;
            }

            var badBrep = new List<Brep>();
            var mainBrep = S.Branch(pth)[0]; // Main brep for this branch
            var diffBreps = D.Branch(pth);   // Cutters for this branch

            foreach (Brep b in diffBreps)
            {
                if (b == null) continue; // Skip null breps
                var breps = Brep.CreateBooleanDifference(mainBrep, b, tolerance);
                if (breps == null || breps.Length < 1)
                {
                    badBrep.Add(b);
                }
                else
                {
                    mainBrep = breps[0];
                }
            }

            // Debug: Make sure the branches are populated
            Print($"Processed branch {pth}. Main Brep: {mainBrep}, Bad Breps: {badBrep.Count}");

            mainBrepsMT[pth] = mainBrep;
            badBrepsMT[pth] = badBrep;
        });

        // Convert dictionaries to regular data trees
        var mainBreps = new DataTree<Brep>();
        var badBreps = new DataTree<Brep>();

        foreach (KeyValuePair<GH_Path, Brep> p in mainBrepsMT)
        {
            mainBreps.Add(p.Value, p.Key);
        }

        foreach (KeyValuePair<GH_Path, List<Brep>> b in badBrepsMT)
        {
            badBreps.AddRange(b.Value, b.Key);
        }

        // Debug: Check if the output trees are populated
        Print($"Main Breps tree has {mainBreps.BranchCount} branches.");
        Print($"Bad Breps tree has {badBreps.BranchCount} branches.");

        // Assign the output
        R = mainBreps;
        BB = badBreps;
    }

    private List<string> __err = new List<string>();
    private List<string> __out = new List<string>();
    private RhinoDoc doc = Instances.ActiveRhinoDoc;
    private IGH_ActiveObject owner;
    private int runCount;
}
# ---------- end c_script ----------
panel_3 = Panel(flatten_tree)
