# Grasshopper definition DMesh Test.gh (Grasshopper 1.0.8)
# plug-ins: Pufferfish, Weaverbird

mesh = Mesh(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)
mesh_2 = Mesh(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)
close_mesh = CloseMesh(Mesh=mesh_2, Quadrangulate=False)  # -> Closed, Amount, Openings, ResultBoolean
close_mesh_2 = CloseMesh(Mesh=mesh, Quadrangulate=False)  # -> Closed, Amount, Openings, ResultBoolean
weaverbird_s_loop_subdivision = WeaverbirdsLoopSubdivision(MeshCurves=close_mesh.Closed, Level=1, SmoothNakedEdges=1)
weaverbird_s_loop_subdivision_2 = WeaverbirdsLoopSubdivision(MeshCurves=close_mesh_2.Closed, Level=1, SmoothNakedEdges=1)
mesh_3 = Mesh(<mesh referenced from the Rhino model>)
mesh_4 = Mesh(<mesh referenced from the Rhino model>)
mesh_statistics = MeshStatistics(Mesh=mesh_3)  # -> VertexCount, FaceCount, QuadFaceCount, TriangleFaceCount, ColorCount, PieceCount
c_script = CSharpScript(mesh=weaverbird_s_loop_subdivision_2)  # -> out, a; inputs mesh: Mesh
# ---------- c_script: C# ----------
// Grasshopper Script Instance
#region Usings
using System;
//#r "C:\Users\clark.cheng\OneDrive - UAP Company\Desktop\_COMMONS\UAP-Plugins\02_GH\_lib\geometry4Sharp-main\geometry4Sharp-main\bin\Release\geometry4sharp.dll"
#r "D:\_MAIN\Architectural Templates\UAP-Plugins\02_GH\_lib\geometry4Sharp-main\bin\Release\geometry4sharp.dll"
using System.Linq;
using System.Collections;
using System.Collections.Generic;
using System.Drawing;

using Rhino;
using Rhino.Geometry;

using Grasshopper;
using Grasshopper.Kernel;
using Grasshopper.Kernel.Data;
using Grasshopper.Kernel.Types;

using g4;
#endregion

public class Script_Instance : GH_ScriptInstance
{
    #region Notes
    /* 
      Members:
        RhinoDoc RhinoDocument
        GH_Document GrasshopperDocument
        IGH_Component Component
        int Iteration

      Methods (Virtual & overridable):
        Print(string text)
        Print(string format, params object[] args)
        Reflect(object obj)
        Reflect(object obj, string method_name)
    */
    #endregion

    private void RunScript(Mesh mesh, ref object a)
    {
        // Write your logic here
        DMesh3 dm= new DMesh3(true,true,true,true);

        for (int i =0;i<mesh.Vertices.Count;i++)
        {
            Point3f vert=mesh.Vertices[i];
            
            g4.Vector3d v3 = new g4.Vector3d(vert.X,vert.Y,vert.Z);
            dm.AppendVertex(v3);
        }

        for (int i=0; i<mesh.Faces.Count;i++)
        {
            MeshFace mf =mesh.Faces.GetFace(i);
            dm.AppendTriangle(mf.A,mf.B,mf.C);
        }

        a=dm;
    }
}
# ---------- end c_script ----------
c_script_2 = CSharpScript(mesh=weaverbird_s_loop_subdivision)  # -> out, a; inputs mesh: Mesh
# ---------- c_script_2: C# ----------
// Grasshopper Script Instance
#region Usings
using System;
//#r "C:\Users\clark.cheng\OneDrive - UAP Company\Desktop\_COMMONS\UAP-Plugins\02_GH\_lib\geometry4Sharp-main\geometry4Sharp-main\bin\Release\geometry4sharp.dll"
//#r "D:\_MAIN\Architectural Templates\UAP-Plugins\02_GH\_lib\geometry4Sharp-main\bin\Release\geometry4sharp.dll"
#r "C:\Users\clark.cheng\OneDrive - UAP Company\Desktop\_COMMONS\UAP-Plugins\02_GH\_lib\geometry4Sharp-main\bin\Release\geometry4sharp.dll"
using System.Linq;
using System.Collections;
using System.Collections.Generic;
using System.Drawing;

using Rhino;
using Rhino.Geometry;

using Grasshopper;
using Grasshopper.Kernel;
using Grasshopper.Kernel.Data;
using Grasshopper.Kernel.Types;

using g4;
#endregion

public class Script_Instance : GH_ScriptInstance
{
    #region Notes
    /* 
      Members:
        RhinoDoc RhinoDocument
        GH_Document GrasshopperDocument
        IGH_Component Component
        int Iteration

      Methods (Virtual & overridable):
        Print(string text)
        Print(string format, params object[] args)
        Reflect(object obj)
        Reflect(object obj, string method_name)
    */
    #endregion

    private void RunScript(Mesh mesh, ref object a)
    {
        // Write your logic here
        DMesh3 dm= new DMesh3(true,true,true,true);

        for (int i =0;i<mesh.Vertices.Count;i++)
        {
            Point3f vert=mesh.Vertices[i];
            
            g4.Vector3d v3 = new g4.Vector3d(vert.X,vert.Y,vert.Z);
            dm.AppendVertex(v3);
        }

        for (int i=0; i<mesh.Faces.Count;i++)
        {
            MeshFace mf =mesh.Faces.GetFace(i);
            dm.AppendTriangle(mf.A,mf.B,mf.C);
        }

        a=dm;
    }
}
# ---------- end c_script_2 ----------

# ---- group: Mesh BooleanUnion
c_script_3 = CSharpScript(x=c_script_2.a, y=c_script.a)  # -> out, a
# ---------- c_script_3: C# ----------
// Grasshopper Script Instance
#region Usings
using System;
#r "D:\_MAIN\Architectural Templates\UAP-Plugins\02_GH\_lib\geometry4Sharp-main\bin\Release\geometry4sharp.dll"
using System.Linq;
using System.Collections;
using System.Collections.Generic;
using System.Drawing;

using Rhino;
using Rhino.Geometry;

using Grasshopper;
using Grasshopper.Kernel;
using Grasshopper.Kernel.Data;
using Grasshopper.Kernel.Types;
using g4;
#endregion

public class Script_Instance : GH_ScriptInstance
{
    #region Notes
    /* 
      Members:
        RhinoDoc RhinoDocument
        GH_Document GrasshopperDocument
        IGH_Component Component
        int Iteration

      Methods (Virtual & overridable):
        Print(string text)
        Print(string format, params object[] args)
        Reflect(object obj)
        Reflect(object obj, string method_name)
    */
    #endregion

    private void RunScript(object x, object y, ref object a)
    {
         // Initialize MeshBoolean object
        DMesh3 meshA=x as DMesh3; 
        DMesh3 meshB=y as DMesh3;

        MeshBoolean meshBoolean = new MeshBoolean
        {
            Target = meshA,
            Tool = meshB,
            VertexSnapTol = 0.00001
        };

        // Perform the boolean operation
        if (meshBoolean.Compute())
        {
            // Assign the result to the output parameter
            a=meshBoolean.Result;
        }
        else
        {
            Print("Boolean computation failed.");
        }

        
    }
}
# ---------- end c_script_3 ----------

# ---- group: Mesh BooleanDiffere
c_script_4 = CSharpScript(x=weaverbird_s_loop_subdivision, y=weaverbird_s_loop_subdivision_2)  # -> out, a; inputs x: Mesh, y: Mesh
# ---------- c_script_4: C# ----------
// Grasshopper Script Instance
#region Usings
using System;
#r "D:\Architectural Templates\Ptarmigan\02_GH\_lib\geometry4Sharp-main\bin\Release\geometry4sharp.dll"
using System.Linq;
using System.Collections;
using System.Collections.Generic;
using System.Drawing;

using Rhino;
using Rhino.Geometry;

using Grasshopper;
using Grasshopper.Kernel;
using Grasshopper.Kernel.Data;
using Grasshopper.Kernel.Types;
using g4;
#endregion

public class Script_Instance : GH_ScriptInstance
{
    #region Notes
    /* 
      Members:
        RhinoDoc RhinoDocument
        GH_Document GrasshopperDocument
        IGH_Component Component
        int Iteration

      Methods (Virtual & overridable):
        Print(string text)
        Print(string format, params object[] args)
        Reflect(object obj)
        Reflect(object obj, string method_name)
    */
    #endregion

    private void RunScript(Mesh x, Mesh y, ref object a)
    {   
        
        //Mesh A
        DMesh3 dm= new DMesh3(true,true,true,true);

        for (int i =0;i<x.Vertices.Count;i++)
        {
            Point3f vert=x.Vertices[i];
            
            g4.Vector3d v3 = new g4.Vector3d(vert.X,vert.Y,vert.Z);
            dm.AppendVertex(v3);
        }

        for (int i=0; i<x.Faces.Count;i++)
        {
            MeshFace mf =x.Faces.GetFace(i);
            dm.AppendTriangle(mf.A,mf.B,mf.C);
        }


        //Mesh B
        DMesh3 dmB= new DMesh3(true,true,true,true);

        for (int i =0;i<y.Vertices.Count;i++)
        {
            Point3f vert=y.Vertices[i];
            
            g4.Vector3d v3 = new g4.Vector3d(vert.X,vert.Y,vert.Z);
            dmB.AppendVertex(v3);
        }

        for (int i=0; i<y.Faces.Count;i++)
        {
            MeshFace mf =y.Faces.GetFace(i);
            dmB.AppendTriangle(mf.A,mf.B,mf.C);
        }


         // Initialize MeshBoolean object
        DMesh3 meshA=dm;
        DMesh3 meshB=dmB;

        MeshBoolean meshBoolean = new MeshBoolean
        {
            Target = meshA,
            Tool = meshB,
            VertexSnapTol = 0.0001
        };


        DMesh3 booleanResult = null;
        // Perform the boolean operation
        if (meshBoolean.ComputeTest())
        {
            booleanResult=meshBoolean.Result;

        }
        else
        {
            Print("Boolean computation failed.");
        }

        //Convert back to GH mesh
        

        Mesh converted_DMesh=new Mesh();

        int vertCount=booleanResult.VertexCount;
        Console.WriteLine("vertice "+vertCount);

        for (int i=0;i<booleanResult.VertexCount;i++)
        {
            if (booleanResult.IsVertex(i))
            {
                g4.Vector3d v=booleanResult.GetVertex(i);
                converted_DMesh.Vertices.Add(v.x,v.y,v.z);
                
            }
        }
        int count=booleanResult.TriangleCount;
        //Console.WriteLine(count);

        List <Index3i> polycount=new List<Index3i>();
        for (int i=0;i<booleanResult.TriangleCount;i++)
        {
            Index3i t=booleanResult.GetTriangle(i);
            converted_DMesh.Faces.AddFace(t.a,t.b,t.c);

            polycount.Add(t);
            
            
        }
        //converted_DMesh.RebuildNormals();

        Console.WriteLine("face "+polycount.Count());
        a=converted_DMesh;

        
    }
}
# ---------- end c_script_4 ----------

# ---- group: Mesh BooleanUnion
c_script_5 = CSharpScript(x=weaverbird_s_loop_subdivision, y=weaverbird_s_loop_subdivision_2)  # -> out, a; inputs x: Mesh, y: Mesh
# ---------- c_script_5: C# ----------
// Grasshopper Script Instance
#region Usings
using System;
#r "D:\Architectural Templates\Ptarmigan\02_GH\_lib\geometry4Sharp-main\bin\Release\geometry4sharp.dll"
using System.Linq;
using System.Collections;
using System.Collections.Generic;
using System.Drawing;

using Rhino;
using Rhino.Geometry;

using Grasshopper;
using Grasshopper.Kernel;
using Grasshopper.Kernel.Data;
using Grasshopper.Kernel.Types;
using g4;
#endregion

public class Script_Instance : GH_ScriptInstance
{
    #region Notes
    /* 
      Members:
        RhinoDoc RhinoDocument
        GH_Document GrasshopperDocument
        IGH_Component Component
        int Iteration

      Methods (Virtual & overridable):
        Print(string text)
        Print(string format, params object[] args)
        Reflect(object obj)
        Reflect(object obj, string method_name)
    */
    #endregion

    private void RunScript(Mesh x, Mesh y, ref object a)
    {   
        
        //Mesh A
        DMesh3 dm= new DMesh3(true,true,true,true);

        for (int i =0;i<x.Vertices.Count;i++)
        {
            Point3f vert=x.Vertices[i];
            
            g4.Vector3d v3 = new g4.Vector3d(vert.X,vert.Y,vert.Z);
            dm.AppendVertex(v3);
        }

        for (int i=0; i<x.Faces.Count;i++)
        {
            MeshFace mf =x.Faces.GetFace(i);
            dm.AppendTriangle(mf.A,mf.B,mf.C);
        }


        //Mesh B
        DMesh3 dmB= new DMesh3(true,true,true,true);

        for (int i =0;i<y.Vertices.Count;i++)
        {
            Point3f vert=y.Vertices[i];
            
            g4.Vector3d v3 = new g4.Vector3d(vert.X,vert.Y,vert.Z);
            dmB.AppendVertex(v3);
        }

        for (int i=0; i<y.Faces.Count;i++)
        {
            MeshFace mf =y.Faces.GetFace(i);
            dmB.AppendTriangle(mf.A,mf.B,mf.C);
        }


         // Initialize MeshBoolean object
        DMesh3 meshA=dm;
        DMesh3 meshB=dmB;

        MeshBoolean meshBoolean = new MeshBoolean
        {
            Target = meshA,
            Tool = meshB,
            VertexSnapTol = 0.001
        };


        DMesh3 booleanResult = null;
        // Perform the boolean operation
        if (meshBoolean.Compute())
        {
            // Assign the result to the output parameter
            booleanResult=meshBoolean.Result;
        }
        else
        {
            Print("Boolean computation failed.");
        }

        //Convert back to GH mesh
        

        Mesh converted_DMesh=new Mesh();

        int vertCount=booleanResult.VertexCount;
        //Console.WriteLine(vertCount);

        for (int i=0;i<booleanResult.VertexCount;i++)
        {
            if (booleanResult.IsVertex(i))
            {
                g4.Vector3d v=booleanResult.GetVertex(i);
                converted_DMesh.Vertices.Add(v.x,v.y,v.z);
                //Console.WriteLine(converted_DMesh.Vertices.Add(v.x,v.y,v.z));
                
            }
        }
        int count=booleanResult.TriangleCount;
        //Console.WriteLine(count);

        List <Index3i> polycount=new List<Index3i>();
        for (int i=0;i<booleanResult.TriangleCount;i++)
        {
            Index3i t=booleanResult.GetTriangle(i);
            polycount.Add(t);
            converted_DMesh.Faces.AddFace(t.a,t.b,t.c);
            
        }
        //converted_DMesh.RebuildNormals();

        Console.WriteLine(polycount.Count());
        a=converted_DMesh;

        
    }
}
# ---------- end c_script_5 ----------

# ----
c_script_6 = CSharpScript()  # -> out, a
# ---------- c_script_6: C# ----------
// Grasshopper Script Instance
#region Usings
using System;
#r "nuget: MeshLib"
using System.Linq;
using System.Collections;
using System.Collections.Generic;
using System.Drawing;

using Rhino;
using Rhino.Geometry;

using Grasshopper;
using Grasshopper.Kernel;
using Grasshopper.Kernel.Data;
using Grasshopper.Kernel.Types;
using MR.DotNet;
#endregion

public class Script_Instance : GH_ScriptInstance
{
    #region Notes
    /* 
      Members:
        RhinoDoc RhinoDocument
        GH_Document GrasshopperDocument
        IGH_Component Component
        int Iteration

      Methods (Virtual & overridable):
        Print(string text)
        Print(string format, params object[] args)
        Reflect(object obj)
        Reflect(object obj, string method_name)
    */
    #endregion

    private void RunScript(object x, object y, ref object a)
    {
        // Write your logic here
        a = null;
    }
}
# ---------- end c_script_6 ----------
c_script_7 = CSharpScript(x=c_script_3.a)  # -> out, a
# ---------- c_script_7: C# ----------
// Grasshopper Script Instance
#region Usings
using System;
#r "D:\_MAIN\Architectural Templates\UAP-Plugins\02_GH\_lib\geometry4Sharp-main\bin\Release\geometry4sharp.dll"
using System.Linq;
using System.Collections;
using System.Collections.Generic;
using System.Drawing;

using Rhino;
using Rhino.Geometry;

using Grasshopper;
using Grasshopper.Kernel;
using Grasshopper.Kernel.Data;
using Grasshopper.Kernel.Types;
using g4;
#endregion

public class Script_Instance : GH_ScriptInstance
{
    #region Notes
    /* 
      Members:
        RhinoDoc RhinoDocument
        GH_Document GrasshopperDocument
        IGH_Component Component
        int Iteration

      Methods (Virtual & overridable):
        Print(string text)
        Print(string format, params object[] args)
        Reflect(object obj)
        Reflect(object obj, string method_name)
    */
    #endregion

    private void RunScript(object x, ref object a)
    {
        DMesh3 dm=x as DMesh3;

        Mesh converted_DMesh=new Mesh();

        int vertCount=dm.VertexCount;
        Console.WriteLine(vertCount);

        for (int i=0;i<dm.VertexCount;i++)
        {
            if (dm.IsVertex(i))
            {
                g4.Vector3d v=dm.GetVertex(i);
                converted_DMesh.Vertices.Add(v.x,v.y,v.z);
                
            }
        }
        int count=dm.TriangleCount;
        Console.WriteLine(count);
        for (int i=0;i<dm.TriangleCount;i++)
        {
            Index3i t=dm.GetTriangle(i);
            converted_DMesh.Faces.AddFace(t.a,t.b,t.c);
            Console.WriteLine(t);
            /*if (dm.IsTriangle(i))
            {
                Index3i t=dm.GetTriangle(i);
                converted_DMesh.Faces.AddFace(t.a,t.b,t.c);
                Console.WriteLine(converted_DMesh.Faces.AddFace(t.a,t.b,t.c));
            }
            */
        }
        //converted_DMesh.RebuildNormals();


        a=converted_DMesh;
    }   

}
# ---------- end c_script_7 ----------
weaverbird_s_join_meshes_and_weld = WeaverbirdsJoinMeshesAndWeld(Mesh=c_script_4.a, Weld=True)
weaverbird_s_join_meshes_and_weld_2 = WeaverbirdsJoinMeshesAndWeld(Mesh=c_script_5.a, Weld=True)
deconstruct_mesh = DeconstructMesh(Mesh=c_script_5.a)  # -> Vertices, Faces, Colours, Normals
mesh_5 = Mesh(c_script_7.a)  # disabled
mesh_edges = MeshEdges(Mesh=c_script_5.a)  # -> NakedEdges, InteriorEdges, NonManifoldEdges
panel = Panel(deconstruct_mesh.Vertices)
panel_2 = Panel("0.01")
rebuild_mesh = RebuildMesh(
    Mesh=c_script_4.a,
    RebuildNormals="1",
    CullUnused="1",
    UnifyNormals="1",
    FlipNormals="1",
    IdenticalCombine="1",
    WeldVertices=0)
c_script_8 = CSharpScript()  # -> out, a; same code as c_script_7
panel_3 = Panel(weaverbird_s_join_meshes_and_weld)
