# Grasshopper definition MeshLib.gh (Grasshopper 1.0.8)
# plug-ins: RhinoCodePluginGH, Pufferfish, Weaverbird

mesh = Mesh(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)
mesh_2 = Mesh(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)
close_mesh = CloseMesh(Mesh=mesh_2, Quadrangulate=False)  # -> Closed, Amount, Openings, ResultBoolean
close_mesh_2 = CloseMesh(Mesh=mesh, Quadrangulate=False)  # -> Closed, Amount, Openings, ResultBoolean
weaverbird_s_loop_subdivision = WeaverbirdsLoopSubdivision(MeshCurves=close_mesh.Closed, Level=1, SmoothNakedEdges=1)
weaverbird_s_loop_subdivision_2 = WeaverbirdsLoopSubdivision(MeshCurves=close_mesh_2.Closed, Level=1, SmoothNakedEdges=1)
number_slider = Slider(0.1, range=0..0.1)
c_script = CSharpScript(rhinoMesh=weaverbird_s_loop_subdivision)  # -> out, meshlibMesh; inputs rhinoMesh: Mesh
# ---------- c_script: C# ----------
// Grasshopper Script Instance
#region Usings
using System;
#r "nuget: MeshLib"
using System.Linq;
using System.Collections;
using System.Collections.Generic;
using System.Drawing;

using Rhino;
using Rhino.Geometry;

using Grasshopper;
using Grasshopper.Kernel;
using Grasshopper.Kernel.Data;
using Grasshopper.Kernel.Types;
using MR.DotNet;
#endregion

public class Script_Instance : GH_ScriptInstance
{
    #region Notes
    /* 
      Members:
        RhinoDoc RhinoDocument
        GH_Document GrasshopperDocument
        IGH_Component Component
        int Iteration

      Methods (Virtual & overridable):
        Print(string text)
        Print(string format, params object[] args)
        Reflect(object obj)
        Reflect(object obj, string method_name)
    */
    #endregion

    private void RunScript(Mesh rhinoMesh, ref object meshlibMesh)
    {
        try
        {
            // Convert Rhino.Geometry.Mesh vertices to MR.DotNet.Vector3d
            List<Vector3d> vertices = new List<Vector3d>();
            foreach (var vertex in rhinoMesh.Vertices)
            {
                vertices.Add(new MR.DotNet.Vector3d(vertex.X, vertex.Y, vertex.Z)); // Explicitly MR.DotNet.Vector3d
            }

            // Convert Rhino.Geometry.Mesh faces to MR.DotNet-compatible format
            List<int[]> faces = new List<int[]>();
            foreach (var face in rhinoMesh.Faces)
            {
                if (face.IsTriangle)
                {
                    faces.Add(new int[] { face.A, face.B, face.C });
                }
                else if (face.IsQuad)
                {
                    // Split quad into two triangles
                    faces.Add(new int[] { face.A, face.B, face.C });
                    faces.Add(new int[] { face.A, face.C, face.D });
                }
            }

            // Create MR.DotNet.Mesh using a factory method or initializer
            MR.DotNet.Mesh mrMesh = MR.DotNet.Mesh.Create(vertices, faces); // Hypothetical factory method (replace if needed)

            // Output the MR.DotNet.Mesh object
            meshlibMesh = mrMesh;
        }
        catch (Exception ex)
        {
            throw new Exception($"Failed to convert Rhino mesh to MeshLib mesh: {ex.Message}");
        }
    }
}
# ---------- end c_script ----------
c_script_2 = CSharpScript()  # -> out, meshlibMesh; inputs rhinoMesh: Mesh
# ---------- c_script_2: C# ----------
// Grasshopper Script Instance
#region Usings
using System;
#r "nuget: MeshLib"
using System.Linq;
using System.Collections;
using System.Collections.Generic;
using System.Drawing;

using Rhino;
using Rhino.Geometry;

using Grasshopper;
using Grasshopper.Kernel;
using Grasshopper.Kernel.Data;
using Grasshopper.Kernel.Types;
using MR.DotNet;
#endregion

public class Script_Instance : GH_ScriptInstance
{
    #region Notes
    /* 
      Members:
        RhinoDoc RhinoDocument
        GH_Document GrasshopperDocument
        IGH_Component Component
        int Iteration

      Methods (Virtual & overridable):
        Print(string text)
        Print(string format, params object[] args)
        Reflect(object obj)
        Reflect(object obj, string method_name)
    */
    #endregion

    private void RunScript(Mesh rhinoMesh, ref object meshlibMesh)
    {
        // Create a cube mesh with specified center and size
        MR.DotNet.Vector3f center = new MR.DotNet.Vector3f(0.0f, 0.0f, 0.0f);
        MR.DotNet.Vector3f size = new MR.DotNet.Vector3f(1.0f, 1.0f, 1.0f);
        MR.DotNet.Mesh cubeMesh = MR.DotNet.Mesh.MakeCube(center, size);

        // Retrieve all vertex positions
        var vertices = cubeMesh.Points; // Points is a List<Vector3f>

        Console.WriteLine(vertices);

    }
}
# ---------- end c_script_2 ----------
c_script_3 = CSharpScript()  # -> out, a; inputs x: Vector3d, y: Vector3d
# ---------- c_script_3: C# ----------
// Grasshopper Script Instance
#region Usings
using System;
using System.Linq;
using System.Collections;
using System.Collections.Generic;
using System.Drawing;

using Rhino;
using Rhino.Geometry;

using Grasshopper;
using Grasshopper.Kernel;
using Grasshopper.Kernel.Data;
using Grasshopper.Kernel.Types;
#endregion

public class Script_Instance : GH_ScriptInstance
{
    #region Notes
    /* 
      Members:
        RhinoDoc RhinoDocument
        GH_Document GrasshopperDocument
        IGH_Component Component
        int Iteration

      Methods (Virtual & overridable):
        Print(string text)
        Print(string format, params object[] args)
        Reflect(object obj)
        Reflect(object obj, string method_name)
    */
    #endregion

    private void RunScript(Vector3d x, Vector3d y, ref object a)
    {
        Vector3d v = Vector3d.CrossProduct(x,y);
        a=v;
    }
}
# ---------- end c_script_3 ----------
