# Grasshopper definition test.gh (Grasshopper 1.0.8)
# plug-ins: Pufferfish

mesh = Mesh(<mesh referenced from the Rhino model>)
mesh_2 = Mesh(<mesh referenced from the Rhino model>)
c_script = CSharpScript()  # -> out, a
# ---------- c_script: C# ----------
// Grasshopper Script Instance
#region Usings
using System;
#r "C:\Users\Clark\AppData\Roaming\Grasshopper\Libraries\MeshLib\MRDotNet.dll"
using System.Linq;
using System.Collections;
using System.Collections.Generic;
using System.Drawing;

using Rhino;
using Rhino.Geometry;

using Grasshopper;
using Grasshopper.Kernel;
using Grasshopper.Kernel.Data;
using Grasshopper.Kernel.Types;

using static MR.DotNet;
#endregion

public class Script_Instance : GH_ScriptInstance
{
    #region Notes
    /* 
      Members:
        RhinoDoc RhinoDocument
        GH_Document GrasshopperDocument
        IGH_Component Component
        int Iteration

      Methods (Virtual & overridable):
        Print(string text)
        Print(string format, params object[] args)
        Reflect(object obj)
        Reflect(object obj, string method_name)
    */
    #endregion

    private void RunScript(object x, object y, ref object a)
    {
        try
        {
            // Make a cube
            var size = new MR.DotNet.Vector3f(1, 1, 1);
            var baseCoords = new MR.DotNet.Vector3f(0, 0, 0);
            MR.DotNet.Mesh cube = MR.DotNet.Mesh.MakeCube(size, baseCoords);

            double vol = cube.Volume();
            double area = cube.Area();

            a = $"MeshLib OK — Volume={vol}, Area={area}";
        }
        catch (System.Exception ex)
        {
            a = "Error: " + ex.Message;
        }
    }
}
# ---------- end c_script ----------
c_script_2 = CSharpScript()  # -> out, a
# ---------- c_script_2: C# ----------
// Grasshopper Script Instance
#region Usings
using System;
#r "C:\Users\Clark\AppData\Roaming\Grasshopper\Libraries\MeshLib\MRDotNet.dll"
using System.Linq;
using System.Collections;
using System.Collections.Generic;
using System.Drawing;

using Rhino;
using Rhino.Geometry;

using Grasshopper;
using Grasshopper.Kernel;
using Grasshopper.Kernel.Data;
using Grasshopper.Kernel.Types;

using static MR.DotNet;
#endregion

public class Script_Instance : GH_ScriptInstance
{
    #region Notes
    /* 
      Members:
        RhinoDoc RhinoDocument
        GH_Document GrasshopperDocument
        IGH_Component Component
        int Iteration

      Methods (Virtual & overridable):
        Print(string text)
        Print(string format, params object[] args)
        Reflect(object obj)
        Reflect(object obj, string method_name)
    */
    #endregion

    private void RunScript(object x, object y, ref object a)
    {
        MR.DotNet.Mesh sphere = MR.DotNet.Mesh.MakeSphere(2.0f, 200);
        a = $"Sphere OK — Volume={sphere.Volume()}, Area={sphere.Area()}";
    }
}
# ---------- end c_script_2 ----------
c_script_3 = CSharpScript()  # -> out, a
# ---------- c_script_3: C# ----------
// Grasshopper Script Instance
#region Usings
using System;
#r "C:\Users\Clark\AppData\Roaming\Grasshopper\Libraries\MeshLib\MRDotNet.dll"
using System.Linq;
using System.Collections;
using System.Collections.Generic;
using System.Drawing;

using Rhino;
using Rhino.Geometry;

using Grasshopper;
using Grasshopper.Kernel;
using Grasshopper.Kernel.Data;
using Grasshopper.Kernel.Types;

using static MR.DotNet;

#endregion



public class Script_Instance : GH_ScriptInstance
{
    #region Notes
    /* 
      Members:
        RhinoDoc RhinoDocument
        GH_Document GrasshopperDocument
        IGH_Component Component
        int Iteration

      Methods (Virtual & overridable):
        Print(string text)
        Print(string format, params object[] args)
        Reflect(object obj)
        Reflect(object obj, string method_name)
    */
    #endregion

    private void RunScript(ref object a)
    {
        var cube = MR.DotNet.Mesh.MakeCube(new MR.DotNet.Vector3f(1,1,1), new MR.DotNet.Vector3f(0,0,0));
        var sphere = MR.DotNet.Mesh.MakeSphere(0.75f, 300);

        // Boolean: cube - sphere
        var result = MR.DotNet.Boolean(cube, sphere, BooleanOperation.DifferenceAB);


        MR.DotNet.Mesh resultMesh = result.mesh;

        // --- Convert MR.DotNet.Mesh -> Rhino.Geometry.Mesh ---
        var rhMesh = new Rhino.Geometry.Mesh();

        // vertices
        foreach (var p in resultMesh.Points)
            rhMesh.Vertices.Add(p.X, p.Y, p.Z);

        // faces
        foreach (var tri in resultMesh.Triangulation)
            rhMesh.Faces.AddFace(tri.v0.Id, tri.v1.Id, tri.v2.Id);

        rhMesh.Vertices.CombineIdentical(true, true);
        rhMesh.Vertices.CullUnused();
        rhMesh.Faces.CullDegenerateFaces();
        rhMesh.UnifyNormals();
        rhMesh.Normals.ComputeNormals();
        rhMesh.Compact();

        // Output to GH
        a = rhMesh;
    }
}
# ---------- end c_script_3 ----------
panel = Panel(c_script.a)
c_script_4 = CSharpScript(x=mesh)  # -> out, a
# ---------- c_script_4: C# ----------
// Grasshopper Script Instance
#region Usings
using System;
using System.Linq;
using System.Collections;
using System.Collections.Generic;
using System.Drawing;

#r "C:\Users\Clark\AppData\Roaming\Grasshopper\Libraries\MeshLib\MRDotNet.dll"

using Rhino;
using Rhino.Geometry;

using Grasshopper;
using Grasshopper.Kernel;
using Grasshopper.Kernel.Data;
using Grasshopper.Kernel.Types;

using static MR.DotNet;
#endregion


public class Script_Instance : GH_ScriptInstance
{
    #region Notes
    /* 
      Members:
        RhinoDoc RhinoDocument
        GH_Document GrasshopperDocument
        IGH_Component Component
        int Iteration

      Methods (Virtual & overridable):
        Print(string text)
        Print(string format, params object[] args)
        Reflect(object obj)
        Reflect(object obj, string method_name)
    */
    #endregion

    private void RunScript(object x, ref object a)
    {
        Rhino.Geometry.Mesh rhMesh = x as Rhino.Geometry.Mesh;
        if (x == null)
        {
            a = null;
            return;
        }

        MR.DotNet.Mesh ToMeshLibMesh(Rhino.Geometry.Mesh rhMesh)
        {
            // Duplicate and triangulate quads
            var triMesh = rhMesh.DuplicateMesh();
            triMesh.Faces.ConvertQuadsToTriangles();

            // Build point list
            var points = new List<MR.DotNet.Vector3f>(triMesh.Vertices.Count);
            foreach (var v in triMesh.Vertices)
                points.Add(new MR.DotNet.Vector3f((float)v.X, (float)v.Y, (float)v.Z));

            // Build triangle list
            var tris = new List<MR.DotNet.ThreeVertIds>(triMesh.Faces.Count);
            foreach (var f in triMesh.Faces)
            {
                if (f.IsTriangle)
                {
                    var tri = new MR.DotNet.ThreeVertIds();
                    tri.v0.Id = f.A;
                    tri.v1.Id = f.B;
                    tri.v2.Id = f.C;
                    tris.Add(tri);
                }
            }

            // Construct MeshLib mesh
            return MR.DotNet.Mesh.FromTriangles(points, tris);
        }

    }
}
# ---------- end c_script_4 ----------

# ---- group: BOOLEAN INTERSECT
c_script_5 = CSharpScript(x=mesh, y=mesh_2)  # -> out, a, b
# ---------- c_script_5: C# ----------
// Grasshopper Script Instance
#region Usings
using System;
using System.Linq;
using System.Collections;
using System.Collections.Generic;
using System.Drawing;

#r "C:\Users\Clark\AppData\Roaming\Grasshopper\Libraries\MeshLib\MRDotNet.dll"

using Rhino;
using Rhino.Geometry;

using Grasshopper;
using Grasshopper.Kernel;
using Grasshopper.Kernel.Data;
using Grasshopper.Kernel.Types;

using static MR.DotNet;
#endregion

//converter to use for rhino meshes to mesh lib mesh
public static class RhMeshMRMeshConvertors
{
    /// <summary>
    /// Convert a Rhino mesh into a MeshLib (MR.DotNet) mesh.
    /// </summary>
    public static MR.DotNet.Mesh ToMeshLibMesh(Rhino.Geometry.Mesh rhMesh)
    {
        if (rhMesh == null) return null;

        // Duplicate and triangulate quads
        Rhino.Geometry.Mesh triMesh = rhMesh.DuplicateMesh();
        triMesh.Faces.ConvertQuadsToTriangles();
        // If Rhino 8 is available, you can also add:
        // triMesh.ConvertNonPlanarFacesToTriangles(1e-6);

        // Build point list
        var points = new List<MR.DotNet.Vector3f>(triMesh.Vertices.Count);
        foreach (var v in triMesh.Vertices)
            points.Add(new MR.DotNet.Vector3f((float)v.X, (float)v.Y, (float)v.Z));

        // Build triangle list
        var tris = new List<MR.DotNet.ThreeVertIds>(triMesh.Faces.Count);
        foreach (var f in triMesh.Faces)
        {
            if (f.IsTriangle)
            {
                var tri = new MR.DotNet.ThreeVertIds();
                tri.v0.Id = f.A;
                tri.v1.Id = f.B;
                tri.v2.Id = f.C;
                tris.Add(tri);
            }
        }

        // Construct MeshLib mesh
        return MR.DotNet.Mesh.FromTriangles(points, tris);
    }

    public static Rhino.Geometry.Mesh ToRhinoMesh(MR.DotNet.Mesh mlMesh)
    {
        if (mlMesh == null) return null;

        var rhMesh = new Rhino.Geometry.Mesh();

        // Vertices
        foreach (var p in mlMesh.Points)
            rhMesh.Vertices.Add(p.X, p.Y, p.Z);

        // Faces
        foreach (var tri in mlMesh.Triangulation)
            rhMesh.Faces.AddFace(tri.v0.Id, tri.v1.Id, tri.v2.Id);

        // Cleanup
        rhMesh.Vertices.CombineIdentical(true, true);
        rhMesh.Vertices.CullUnused();
        rhMesh.Faces.CullDegenerateFaces();
        rhMesh.UnifyNormals();
        rhMesh.Normals.ComputeNormals();
        rhMesh.Compact();

        return rhMesh;
    }
}

public class Script_Instance : GH_ScriptInstance
{
    #region Notes
    /* 
      Members:
        RhinoDoc RhinoDocument
        GH_Document GrasshopperDocument
        IGH_Component Component
        int Iteration

      Methods (Virtual & overridable):
        Print(string text)
        Print(string format, params object[] args)
        Reflect(object obj)
        Reflect(object obj, string method_name)
    */
    #endregion

    private void RunScript(object x, object y, ref object a, ref object b)
    {
        Rhino.Geometry.Mesh rhMesh = x as Rhino.Geometry.Mesh;
        Rhino.Geometry.Mesh rhMesh2 = y as Rhino.Geometry.Mesh;

        //convert rhino to mrdot mesh
        var mlMesh = RhMeshMRMeshConvertors.ToMeshLibMesh(rhMesh);
        a = mlMesh;

        //convert rhino to mrdot mesh
        var mlMeshB = RhMeshMRMeshConvertors.ToMeshLibMesh(rhMesh2);

        var result = MR.DotNet.Boolean(mlMesh, mlMeshB, MR.DotNet.BooleanOperation.Intersection);

        b = RhMeshMRMeshConvertors.ToRhinoMesh(result.mesh);
    }
}
# ---------- end c_script_5 ----------

# ---- group: OUTSIDE A
c_script_6 = CSharpScript(x=mesh, y=mesh_2)  # -> out, a, b
# ---------- c_script_6: C# ----------
// Grasshopper Script Instance
#region Usings
using System;
using System.Linq;
using System.Collections;
using System.Collections.Generic;
using System.Drawing;

#r "C:\Users\Clark\AppData\Roaming\Grasshopper\Libraries\MeshLib\MRDotNet.dll"

using Rhino;
using Rhino.Geometry;

using Grasshopper;
using Grasshopper.Kernel;
using Grasshopper.Kernel.Data;
using Grasshopper.Kernel.Types;

using static MR.DotNet;
#endregion

//converter to use for rhino meshes to mesh lib mesh
public static class RhMeshMRMeshConvertors
{
    /// <summary>
    /// Convert a Rhino mesh into a MeshLib (MR.DotNet) mesh.
    /// </summary>
    public static MR.DotNet.Mesh ToMeshLibMesh(Rhino.Geometry.Mesh rhMesh)
    {
        if (rhMesh == null) return null;

        // Duplicate and triangulate quads
        var triMesh = rhMesh.DuplicateMesh();
        triMesh.Faces.ConvertQuadsToTriangles();
        // If Rhino 8 is available, you can also add:
        // triMesh.ConvertNonPlanarFacesToTriangles(1e-6);

        // Build point list
        var points = new List<MR.DotNet.Vector3f>(triMesh.Vertices.Count);
        foreach (var v in triMesh.Vertices)
            points.Add(new MR.DotNet.Vector3f((float)v.X, (float)v.Y, (float)v.Z));

        // Build triangle list
        var tris = new List<MR.DotNet.ThreeVertIds>(triMesh.Faces.Count);
        foreach (var f in triMesh.Faces)
        {
            if (f.IsTriangle)
            {
                var tri = new MR.DotNet.ThreeVertIds();
                tri.v0.Id = f.A;
                tri.v1.Id = f.B;
                tri.v2.Id = f.C;
                tris.Add(tri);
            }
        }

        // Construct MeshLib mesh
        return MR.DotNet.Mesh.FromTriangles(points, tris);
    }

    public static Rhino.Geometry.Mesh ToRhinoMesh(MR.DotNet.Mesh mlMesh)
    {
        if (mlMesh == null) return null;

        var rhMesh = new Rhino.Geometry.Mesh();

        // Vertices
        foreach (var p in mlMesh.Points)
            rhMesh.Vertices.Add(p.X, p.Y, p.Z);

        // Faces
        foreach (var tri in mlMesh.Triangulation)
            rhMesh.Faces.AddFace(tri.v0.Id, tri.v1.Id, tri.v2.Id);

        // Cleanup
        rhMesh.Vertices.CombineIdentical(true, true);
        rhMesh.Vertices.CullUnused();
        rhMesh.Faces.CullDegenerateFaces();
        rhMesh.UnifyNormals();
        rhMesh.Normals.ComputeNormals();
        rhMesh.Compact();

        return rhMesh;
    }
}

public class Script_Instance : GH_ScriptInstance
{
    #region Notes
    /* 
      Members:
        RhinoDoc RhinoDocument
        GH_Document GrasshopperDocument
        IGH_Component Component
        int Iteration

      Methods (Virtual & overridable):
        Print(string text)
        Print(string format, params object[] args)
        Reflect(object obj)
        Reflect(object obj, string method_name)
    */
    #endregion

    private void RunScript(object x, object y, ref object a, ref object b)
    {
        Rhino.Geometry.Mesh rhMesh = x as Rhino.Geometry.Mesh;
        Rhino.Geometry.Mesh rhMesh2 = y as Rhino.Geometry.Mesh;

        //convert rhino to mrdot mesh
        var mlMesh = RhMeshMRMeshConvertors.ToMeshLibMesh(rhMesh);
        a = mlMesh;

        //convert rhino to mrdot mesh
        var mlMeshB = RhMeshMRMeshConvertors.ToMeshLibMesh(rhMesh2);

        var result = MR.DotNet.Boolean(mlMesh, mlMeshB, MR.DotNet.BooleanOperation.OutsideA);

        b = RhMeshMRMeshConvertors.ToRhinoMesh(result.mesh);
    }
}
# ---------- end c_script_6 ----------

# ---- group: OUTSIDE B
c_script_7 = CSharpScript(x=mesh, y=mesh_2)  # -> out, a, b
# ---------- c_script_7: C# ----------
// Grasshopper Script Instance
#region Usings
using System;
using System.Linq;
using System.Collections;
using System.Collections.Generic;
using System.Drawing;

#r "C:\Users\Clark\AppData\Roaming\Grasshopper\Libraries\MeshLib\MRDotNet.dll"

using Rhino;
using Rhino.Geometry;

using Grasshopper;
using Grasshopper.Kernel;
using Grasshopper.Kernel.Data;
using Grasshopper.Kernel.Types;

using static MR.DotNet;
#endregion

//converter to use for rhino meshes to mesh lib mesh
public static class RhMeshMRMeshConvertors
{
    /// <summary>
    /// Convert a Rhino mesh into a MeshLib (MR.DotNet) mesh.
    /// </summary>
    public static MR.DotNet.Mesh ToMeshLibMesh(Rhino.Geometry.Mesh rhMesh)
    {
        if (rhMesh == null) return null;

        // Duplicate and triangulate quads
        var triMesh = rhMesh.DuplicateMesh();
        triMesh.Faces.ConvertQuadsToTriangles();
        // If Rhino 8 is available, you can also add:
        // triMesh.ConvertNonPlanarFacesToTriangles(1e-6);

        // Build point list
        var points = new List<MR.DotNet.Vector3f>(triMesh.Vertices.Count);
        foreach (var v in triMesh.Vertices)
            points.Add(new MR.DotNet.Vector3f((float)v.X, (float)v.Y, (float)v.Z));

        // Build triangle list
        var tris = new List<MR.DotNet.ThreeVertIds>(triMesh.Faces.Count);
        foreach (var f in triMesh.Faces)
        {
            if (f.IsTriangle)
            {
                var tri = new MR.DotNet.ThreeVertIds();
                tri.v0.Id = f.A;
                tri.v1.Id = f.B;
                tri.v2.Id = f.C;
                tris.Add(tri);
            }
        }

        // Construct MeshLib mesh
        return MR.DotNet.Mesh.FromTriangles(points, tris);
    }

    public static Rhino.Geometry.Mesh ToRhinoMesh(MR.DotNet.Mesh mlMesh)
    {
        if (mlMesh == null) return null;

        var rhMesh = new Rhino.Geometry.Mesh();

        // Vertices
        foreach (var p in mlMesh.Points)
            rhMesh.Vertices.Add(p.X, p.Y, p.Z);

        // Faces
        foreach (var tri in mlMesh.Triangulation)
            rhMesh.Faces.AddFace(tri.v0.Id, tri.v1.Id, tri.v2.Id);

        // Cleanup
        rhMesh.Vertices.CombineIdentical(true, true);
        rhMesh.Vertices.CullUnused();
        rhMesh.Faces.CullDegenerateFaces();
        rhMesh.UnifyNormals();
        rhMesh.Normals.ComputeNormals();
        rhMesh.Compact();

        return rhMesh;
    }
}

public class Script_Instance : GH_ScriptInstance
{
    #region Notes
    /* 
      Members:
        RhinoDoc RhinoDocument
        GH_Document GrasshopperDocument
        IGH_Component Component
        int Iteration

      Methods (Virtual & overridable):
        Print(string text)
        Print(string format, params object[] args)
        Reflect(object obj)
        Reflect(object obj, string method_name)
    */
    #endregion

    private void RunScript(object x, object y, ref object a, ref object b)
    {
        Rhino.Geometry.Mesh rhMesh = x as Rhino.Geometry.Mesh;
        Rhino.Geometry.Mesh rhMesh2 = y as Rhino.Geometry.Mesh;

        //convert rhino to mrdot mesh
        var mlMesh = RhMeshMRMeshConvertors.ToMeshLibMesh(rhMesh);
        a = mlMesh;

        //convert rhino to mrdot mesh
        var mlMeshB = RhMeshMRMeshConvertors.ToMeshLibMesh(rhMesh2);

        var result = MR.DotNet.Boolean(mlMesh, mlMeshB, MR.DotNet.BooleanOperation.OutsideB);

        b = RhMeshMRMeshConvertors.ToRhinoMesh(result.mesh);
    }
}
# ---------- end c_script_7 ----------

# ---- group: INSIDE A
c_script_8 = CSharpScript(x=mesh, y=mesh_2)  # -> out, a, b
# ---------- c_script_8: C# ----------
// Grasshopper Script Instance
#region Usings
using System;
using System.Linq;
using System.Collections;
using System.Collections.Generic;
using System.Drawing;

#r "C:\Users\Clark\AppData\Roaming\Grasshopper\Libraries\MeshLib\MRDotNet.dll"

using Rhino;
using Rhino.Geometry;

using Grasshopper;
using Grasshopper.Kernel;
using Grasshopper.Kernel.Data;
using Grasshopper.Kernel.Types;

using static MR.DotNet;
#endregion

//converter to use for rhino meshes to mesh lib mesh
public static class RhMeshMRMeshConvertors
{
    /// <summary>
    /// Convert a Rhino mesh into a MeshLib (MR.DotNet) mesh.
    /// </summary>
    public static MR.DotNet.Mesh ToMeshLibMesh(Rhino.Geometry.Mesh rhMesh)
    {
        if (rhMesh == null) return null;

        // Duplicate and triangulate quads
        var triMesh = rhMesh.DuplicateMesh();
        triMesh.Faces.ConvertQuadsToTriangles();
        // If Rhino 8 is available, you can also add:
        // triMesh.ConvertNonPlanarFacesToTriangles(1e-6);

        // Build point list
        var points = new List<MR.DotNet.Vector3f>(triMesh.Vertices.Count);
        foreach (var v in triMesh.Vertices)
            points.Add(new MR.DotNet.Vector3f((float)v.X, (float)v.Y, (float)v.Z));

        // Build triangle list
        var tris = new List<MR.DotNet.ThreeVertIds>(triMesh.Faces.Count);
        foreach (var f in triMesh.Faces)
        {
            if (f.IsTriangle)
            {
                var tri = new MR.DotNet.ThreeVertIds();
                tri.v0.Id = f.A;
                tri.v1.Id = f.B;
                tri.v2.Id = f.C;
                tris.Add(tri);
            }
        }

        // Construct MeshLib mesh
        return MR.DotNet.Mesh.FromTriangles(points, tris);
    }

    public static Rhino.Geometry.Mesh ToRhinoMesh(MR.DotNet.Mesh mlMesh)
    {
        if (mlMesh == null) return null;

        var rhMesh = new Rhino.Geometry.Mesh();

        // Vertices
        foreach (var p in mlMesh.Points)
            rhMesh.Vertices.Add(p.X, p.Y, p.Z);

        // Faces
        foreach (var tri in mlMesh.Triangulation)
            rhMesh.Faces.AddFace(tri.v0.Id, tri.v1.Id, tri.v2.Id);

        // Cleanup
        rhMesh.Vertices.CombineIdentical(true, true);
        rhMesh.Vertices.CullUnused();
        rhMesh.Faces.CullDegenerateFaces();
        rhMesh.UnifyNormals();
        rhMesh.Normals.ComputeNormals();
        rhMesh.Compact();

        return rhMesh;
    }
}

public class Script_Instance : GH_ScriptInstance
{
    #region Notes
    /* 
      Members:
        RhinoDoc RhinoDocument
        GH_Document GrasshopperDocument
        IGH_Component Component
        int Iteration

      Methods (Virtual & overridable):
        Print(string text)
        Print(string format, params object[] args)
        Reflect(object obj)
        Reflect(object obj, string method_name)
    */
    #endregion

    private void RunScript(object x, object y, ref object a, ref object b)
    {
        Rhino.Geometry.Mesh rhMesh = x as Rhino.Geometry.Mesh;
        Rhino.Geometry.Mesh rhMesh2 = y as Rhino.Geometry.Mesh;

        //convert rhino to mrdot mesh
        var mlMesh = RhMeshMRMeshConvertors.ToMeshLibMesh(rhMesh);
        a = mlMesh;

        //convert rhino to mrdot mesh
        var mlMeshB = RhMeshMRMeshConvertors.ToMeshLibMesh(rhMesh2);

        var result = MR.DotNet.Boolean(mlMesh, mlMeshB, MR.DotNet.BooleanOperation.InsideA);

        b = RhMeshMRMeshConvertors.ToRhinoMesh(result.mesh);
    }
}
# ---------- end c_script_8 ----------

# ---- group: INSIDE B
c_script_9 = CSharpScript(x=mesh, y=mesh_2)  # -> out, a, b
# ---------- c_script_9: C# ----------
// Grasshopper Script Instance
#region Usings
using System;
using System.Linq;
using System.Collections;
using System.Collections.Generic;
using System.Drawing;

#r "C:\Users\Clark\AppData\Roaming\Grasshopper\Libraries\MeshLib\MRDotNet.dll"

using Rhino;
using Rhino.Geometry;

using Grasshopper;
using Grasshopper.Kernel;
using Grasshopper.Kernel.Data;
using Grasshopper.Kernel.Types;

using static MR.DotNet;
#endregion

//converter to use for rhino meshes to mesh lib mesh
public static class RhMeshMRMeshConvertors
{
    /// <summary>
    /// Convert a Rhino mesh into a MeshLib (MR.DotNet) mesh.
    /// </summary>
    public static MR.DotNet.Mesh ToMeshLibMesh(Rhino.Geometry.Mesh rhMesh)
    {
        if (rhMesh == null) return null;

        // Duplicate and triangulate quads
        var triMesh = rhMesh.DuplicateMesh();
        triMesh.Faces.ConvertQuadsToTriangles();
        // If Rhino 8 is available, you can also add:
        // triMesh.ConvertNonPlanarFacesToTriangles(1e-6);

        // Build point list
        var points = new List<MR.DotNet.Vector3f>(triMesh.Vertices.Count);
        foreach (var v in triMesh.Vertices)
            points.Add(new MR.DotNet.Vector3f((float)v.X, (float)v.Y, (float)v.Z));

        // Build triangle list
        var tris = new List<MR.DotNet.ThreeVertIds>(triMesh.Faces.Count);
        foreach (var f in triMesh.Faces)
        {
            if (f.IsTriangle)
            {
                var tri = new MR.DotNet.ThreeVertIds();
                tri.v0.Id = f.A;
                tri.v1.Id = f.B;
                tri.v2.Id = f.C;
                tris.Add(tri);
            }
        }

        // Construct MeshLib mesh
        return MR.DotNet.Mesh.FromTriangles(points, tris);
    }

    public static Rhino.Geometry.Mesh ToRhinoMesh(MR.DotNet.Mesh mlMesh)
    {
        if (mlMesh == null) return null;

        var rhMesh = new Rhino.Geometry.Mesh();

        // Vertices
        foreach (var p in mlMesh.Points)
            rhMesh.Vertices.Add(p.X, p.Y, p.Z);

        // Faces
        foreach (var tri in mlMesh.Triangulation)
            rhMesh.Faces.AddFace(tri.v0.Id, tri.v1.Id, tri.v2.Id);

        // Cleanup
        rhMesh.Vertices.CombineIdentical(true, true);
        rhMesh.Vertices.CullUnused();
        rhMesh.Faces.CullDegenerateFaces();
        rhMesh.UnifyNormals();
        rhMesh.Normals.ComputeNormals();
        rhMesh.Compact();

        return rhMesh;
    }
}

public class Script_Instance : GH_ScriptInstance
{
    #region Notes
    /* 
      Members:
        RhinoDoc RhinoDocument
        GH_Document GrasshopperDocument
        IGH_Component Component
        int Iteration

      Methods (Virtual & overridable):
        Print(string text)
        Print(string format, params object[] args)
        Reflect(object obj)
        Reflect(object obj, string method_name)
    */
    #endregion

    private void RunScript(object x, object y, ref object a, ref object b)
    {
        Rhino.Geometry.Mesh rhMesh = x as Rhino.Geometry.Mesh;
        Rhino.Geometry.Mesh rhMesh2 = y as Rhino.Geometry.Mesh;

        //convert rhino to mrdot mesh
        var mlMesh = RhMeshMRMeshConvertors.ToMeshLibMesh(rhMesh);
        a = mlMesh;

        //convert rhino to mrdot mesh
        var mlMeshB = RhMeshMRMeshConvertors.ToMeshLibMesh(rhMesh2);

        var result = MR.DotNet.Boolean(mlMesh, mlMeshB, MR.DotNet.BooleanOperation.InsideB);

        b = RhMeshMRMeshConvertors.ToRhinoMesh(result.mesh);
    }
}
# ---------- end c_script_9 ----------

# ---- group: RH MESH 2 MRDOT MESH
c_script_10 = CSharpScript(x=mesh)  # -> out, a, b
# ---------- c_script_10: C# ----------
// Grasshopper Script Instance
#region Usings
using System;
using System.Linq;
using System.Collections;
using System.Collections.Generic;
using System.Drawing;

#r "C:\Users\Clark\AppData\Roaming\Grasshopper\Libraries\MeshLib\MRDotNet.dll"

using Rhino;
using Rhino.Geometry;

using Grasshopper;
using Grasshopper.Kernel;
using Grasshopper.Kernel.Data;
using Grasshopper.Kernel.Types;

using static MR.DotNet;
#endregion

public static class RhMeshMRMeshConvertors
{
    /// <summary>
    /// Convert a Rhino mesh into a MeshLib (MR.DotNet) mesh.
    /// </summary>
    public static MR.DotNet.Mesh ToMeshLibMesh(Rhino.Geometry.Mesh rhMesh)
    {
        if (rhMesh == null) return null;

        // Duplicate and triangulate quads
        var triMesh = rhMesh.DuplicateMesh();
        triMesh.Faces.ConvertQuadsToTriangles();
        // If Rhino 8 is available, you can also add:
        // triMesh.ConvertNonPlanarFacesToTriangles(1e-6);

        // Build point list
        var points = new List<MR.DotNet.Vector3f>(triMesh.Vertices.Count);
        foreach (var v in triMesh.Vertices)
            points.Add(new MR.DotNet.Vector3f((float)v.X, (float)v.Y, (float)v.Z));

        // Build triangle list
        var tris = new List<MR.DotNet.ThreeVertIds>(triMesh.Faces.Count);
        foreach (var f in triMesh.Faces)
        {
            if (f.IsTriangle)
            {
                var tri = new MR.DotNet.ThreeVertIds();
                tri.v0.Id = f.A;
                tri.v1.Id = f.B;
                tri.v2.Id = f.C;
                tris.Add(tri);
            }
        }

        // Construct MeshLib mesh
        return MR.DotNet.Mesh.FromTriangles(points, tris);
    }

    public static Rhino.Geometry.Mesh ToRhinoMesh(MR.DotNet.Mesh mlMesh)
    {
        if (mlMesh == null) return null;

        var rhMesh = new Rhino.Geometry.Mesh();

        // Vertices
        foreach (var p in mlMesh.Points)
            rhMesh.Vertices.Add(p.X, p.Y, p.Z);

        // Faces
        foreach (var tri in mlMesh.Triangulation)
            rhMesh.Faces.AddFace(tri.v0.Id, tri.v1.Id, tri.v2.Id);

        // Cleanup
        rhMesh.Vertices.CombineIdentical(true, true);
        rhMesh.Vertices.CullUnused();
        rhMesh.Faces.CullDegenerateFaces();
        rhMesh.UnifyNormals();
        rhMesh.Normals.ComputeNormals();
        rhMesh.Compact();

        return rhMesh;
    }
}

public class Script_Instance : GH_ScriptInstance
{
    #region Notes
    /* 
      Members:
        RhinoDoc RhinoDocument
        GH_Document GrasshopperDocument
        IGH_Component Component
        int Iteration

      Methods (Virtual & overridable):
        Print(string text)
        Print(string format, params object[] args)
        Reflect(object obj)
        Reflect(object obj, string method_name)
    */
    #endregion

    private void RunScript(object x, ref object a, ref object b)
    {
        Rhino.Geometry.Mesh rhMesh = x as Rhino.Geometry.Mesh;

        var mlMesh = RhMeshMRMeshConvertors.ToMeshLibMesh(rhMesh);
        a = mlMesh;

        b = RhMeshMRMeshConvertors.ToRhinoMesh(mlMesh);
    }
}
# ---------- end c_script_10 ----------

# ---- group: BOOLEAN DIFFERENCE
c_script_11 = CSharpScript(x=mesh_2, y=mesh)  # -> out, a, b
# ---------- c_script_11: C# ----------
// Grasshopper Script Instance
#region Usings
using System;
using System.Linq;
using System.Collections;
using System.Collections.Generic;
using System.Drawing;

#r "C:\Users\Clark\AppData\Roaming\Grasshopper\Libraries\MeshLib\MRDotNet.dll"

using Rhino;
using Rhino.Geometry;

using Grasshopper;
using Grasshopper.Kernel;
using Grasshopper.Kernel.Data;
using Grasshopper.Kernel.Types;

using static MR.DotNet;
#endregion

public static class RhMeshMRMeshConvertors
{
    /// <summary>
    /// Convert a Rhino mesh into a MeshLib (MR.DotNet) mesh.
    /// </summary>
    public static MR.DotNet.Mesh ToMeshLibMesh(Rhino.Geometry.Mesh rhMesh)
    {
        if (rhMesh == null) return null;

        // Duplicate and triangulate quads
        var triMesh = rhMesh.DuplicateMesh();
        triMesh.Faces.ConvertQuadsToTriangles();
        // If Rhino 8 is available, you can also add:
        // triMesh.ConvertNonPlanarFacesToTriangles(1e-6);

        // Build point list
        var points = new List<MR.DotNet.Vector3f>(triMesh.Vertices.Count);
        foreach (var v in triMesh.Vertices)
            points.Add(new MR.DotNet.Vector3f((float)v.X, (float)v.Y, (float)v.Z));

        // Build triangle list
        var tris = new List<MR.DotNet.ThreeVertIds>(triMesh.Faces.Count);
        foreach (var f in triMesh.Faces)
        {
            if (f.IsTriangle)
            {
                var tri = new MR.DotNet.ThreeVertIds();
                tri.v0.Id = f.A;
                tri.v1.Id = f.B;
                tri.v2.Id = f.C;
                tris.Add(tri);
            }
        }

        // Construct MeshLib mesh
        return MR.DotNet.Mesh.FromTriangles(points, tris);
    }

    public static Rhino.Geometry.Mesh ToRhinoMesh(MR.DotNet.Mesh mlMesh)
    {
        if (mlMesh == null) return null;

        var rhMesh = new Rhino.Geometry.Mesh();

        // Vertices
        foreach (var p in mlMesh.Points)
            rhMesh.Vertices.Add(p.X, p.Y, p.Z);

        // Faces
        foreach (var tri in mlMesh.Triangulation)
            rhMesh.Faces.AddFace(tri.v0.Id, tri.v1.Id, tri.v2.Id);

        // Cleanup
        rhMesh.Vertices.CombineIdentical(true, true);
        rhMesh.Vertices.CullUnused();
        rhMesh.Faces.CullDegenerateFaces();
        rhMesh.UnifyNormals();
        rhMesh.Normals.ComputeNormals();
        rhMesh.Compact();

        return rhMesh;
    }
}

public class Script_Instance : GH_ScriptInstance
{
    #region Notes
    /* 
      Members:
        RhinoDoc RhinoDocument
        GH_Document GrasshopperDocument
        IGH_Component Component
        int Iteration

      Methods (Virtual & overridable):
        Print(string text)
        Print(string format, params object[] args)
        Reflect(object obj)
        Reflect(object obj, string method_name)
    */
    #endregion

    private void RunScript(object x, object y, ref object a, ref object b)
    {
        Rhino.Geometry.Mesh rhMesh = x as Rhino.Geometry.Mesh;
        Rhino.Geometry.Mesh rhMesh2 = y as Rhino.Geometry.Mesh;

        //convert rhino to mrdot mesh
        var mlMesh = RhMeshMRMeshConvertors.ToMeshLibMesh(rhMesh);
        a = mlMesh;

        //convert rhino to mrdot mesh
        var mlMeshB = RhMeshMRMeshConvertors.ToMeshLibMesh(rhMesh2);

        var result = MR.DotNet.Boolean(mlMesh, mlMeshB, MR.DotNet.BooleanOperation.DifferenceAB);

        b = RhMeshMRMeshConvertors.ToRhinoMesh(result.mesh);
    }
}
# ---------- end c_script_11 ----------

# ----
panel_2 = Panel(c_script_2.a)

# ---- group: BOOLEAN UNION
c_script_12 = CSharpScript(x=mesh, y=mesh_2)  # -> out, a, b
# ---------- c_script_12: C# ----------
// Grasshopper Script Instance
#region Usings
using System;
using System.Linq;
using System.Collections;
using System.Collections.Generic;
using System.Drawing;

#r "C:\Users\Clark\AppData\Roaming\Grasshopper\Libraries\MeshLib\MRDotNet.dll"

using Rhino;
using Rhino.Geometry;

using Grasshopper;
using Grasshopper.Kernel;
using Grasshopper.Kernel.Data;
using Grasshopper.Kernel.Types;

using static MR.DotNet;
#endregion

public static class RhMeshMRMeshConvertors
{
    /// <summary>
    /// Convert a Rhino mesh into a MeshLib (MR.DotNet) mesh.
    /// </summary>
    public static MR.DotNet.Mesh ToMeshLibMesh(Rhino.Geometry.Mesh rhMesh)
    {
        if (rhMesh == null) return null;

        // Duplicate and triangulate quads
        var triMesh = rhMesh.DuplicateMesh();
        triMesh.Faces.ConvertQuadsToTriangles();
        // If Rhino 8 is available, you can also add:
        // triMesh.ConvertNonPlanarFacesToTriangles(1e-6);

        // Build point list
        var points = new List<MR.DotNet.Vector3f>(triMesh.Vertices.Count);
        foreach (var v in triMesh.Vertices)
            points.Add(new MR.DotNet.Vector3f((float)v.X, (float)v.Y, (float)v.Z));

        // Build triangle list
        var tris = new List<MR.DotNet.ThreeVertIds>(triMesh.Faces.Count);
        foreach (var f in triMesh.Faces)
        {
            if (f.IsTriangle)
            {
                var tri = new MR.DotNet.ThreeVertIds();
                tri.v0.Id = f.A;
                tri.v1.Id = f.B;
                tri.v2.Id = f.C;
                tris.Add(tri);
            }
        }

        // Construct MeshLib mesh
        return MR.DotNet.Mesh.FromTriangles(points, tris);
    }

    public static Rhino.Geometry.Mesh ToRhinoMesh(MR.DotNet.Mesh mlMesh)
    {
        if (mlMesh == null) return null;

        var rhMesh = new Rhino.Geometry.Mesh();

        // Vertices
        foreach (var p in mlMesh.Points)
            rhMesh.Vertices.Add(p.X, p.Y, p.Z);

        // Faces
        foreach (var tri in mlMesh.Triangulation)
            rhMesh.Faces.AddFace(tri.v0.Id, tri.v1.Id, tri.v2.Id);

        // Cleanup
        rhMesh.Vertices.CombineIdentical(true, true);
        rhMesh.Vertices.CullUnused();
        rhMesh.Faces.CullDegenerateFaces();
        rhMesh.UnifyNormals();
        rhMesh.Normals.ComputeNormals();
        rhMesh.Compact();

        return rhMesh;
    }
}

public class Script_Instance : GH_ScriptInstance
{
    #region Notes
    /* 
      Members:
        RhinoDoc RhinoDocument
        GH_Document GrasshopperDocument
        IGH_Component Component
        int Iteration

      Methods (Virtual & overridable):
        Print(string text)
        Print(string format, params object[] args)
        Reflect(object obj)
        Reflect(object obj, string method_name)
    */
    #endregion

    private void RunScript(object x, object y, ref object a, ref object b)
    {
        Rhino.Geometry.Mesh rhMesh = x as Rhino.Geometry.Mesh;
        Rhino.Geometry.Mesh rhMesh2 = y as Rhino.Geometry.Mesh;

        //convert rhino to mrdot mesh
        var mlMesh = RhMeshMRMeshConvertors.ToMeshLibMesh(rhMesh);
        a = mlMesh;

        //convert rhino to mrdot mesh
        var mlMeshB = RhMeshMRMeshConvertors.ToMeshLibMesh(rhMesh2);

        var result = MR.DotNet.Boolean(mlMesh, mlMeshB, MR.DotNet.BooleanOperation.Union);

        b = RhMeshMRMeshConvertors.ToRhinoMesh(result.mesh);
    }
}
# ---------- end c_script_12 ----------

# ----
rebuild_mesh = RebuildMesh(
    Mesh=c_script_3.a,
    RebuildNormals=False,
    CullUnused=False,
    UnifyNormals=False,
    FlipNormals=False,
    IdenticalCombine=False,
    WeldVertices="0.01")
mesh_3 = Mesh(c_script_5.b)
mesh_4 = Mesh(c_script_7.b)
mesh_5 = Mesh(c_script_8.b)
mesh_6 = Mesh(c_script_9.b)
mesh_7 = Mesh(c_script_10.b)
mesh_8 = Mesh(<mesh referenced from the Rhino model>)
mesh_9 = Mesh(<mesh referenced from the Rhino model>)
panel_3 = Panel(c_script_3.a)
number_slider = Slider(0.279, range=0..1)
mesh_10 = Mesh(<mesh referenced from the Rhino model>)
mesh_11 = Mesh(<mesh referenced from the Rhino model>)

# ---- group: Mesh Split
c_script_13 = CSharpScript(x=mesh_8, y=mesh_9)  # -> out, a, b
# ---------- c_script_13: C# ----------
// Grasshopper Script Instance
#region Usings
using System;
using System.Linq;
using System.Collections;
using System.Collections.Generic;
using System.Drawing;

#r "C:\Users\Clark\AppData\Roaming\Grasshopper\Libraries\MeshLib\MRDotNet.dll"

using Rhino;
using Rhino.Geometry;

using Grasshopper;
using Grasshopper.Kernel;
using Grasshopper.Kernel.Data;
using Grasshopper.Kernel.Types;

using static MR.DotNet;
#endregion

public static class RhMeshMRMeshConvertors
{
    /// <summary>
    /// Convert a Rhino mesh into a MeshLib (MR.DotNet) mesh.
    /// </summary>
    public static MR.DotNet.Mesh ToMeshLibMesh(Rhino.Geometry.Mesh rhMesh)
    {
        if (rhMesh == null) return null;

        // Duplicate and triangulate quads
        var triMesh = rhMesh.DuplicateMesh();
        triMesh.Faces.ConvertQuadsToTriangles();
        // If Rhino 8 is available, you can also add:
        // triMesh.ConvertNonPlanarFacesToTriangles(1e-6);

        // Build point list
        var points = new List<MR.DotNet.Vector3f>(triMesh.Vertices.Count);
        foreach (var v in triMesh.Vertices)
            points.Add(new MR.DotNet.Vector3f((float)v.X, (float)v.Y, (float)v.Z));

        // Build triangle list
        var tris = new List<MR.DotNet.ThreeVertIds>(triMesh.Faces.Count);
        foreach (var f in triMesh.Faces)
        {
            if (f.IsTriangle)
            {
                var tri = new MR.DotNet.ThreeVertIds();
                tri.v0.Id = f.A;
                tri.v1.Id = f.B;
                tri.v2.Id = f.C;
                tris.Add(tri);
            }
        }

        // Construct MeshLib mesh
        return MR.DotNet.Mesh.FromTriangles(points, tris);
    }

    public static Rhino.Geometry.Mesh ToRhinoMesh(MR.DotNet.Mesh mlMesh)
    {
        if (mlMesh == null) return null;

        var rhMesh = new Rhino.Geometry.Mesh();

        // Vertices
        foreach (var p in mlMesh.Points)
            rhMesh.Vertices.Add(p.X, p.Y, p.Z);

        // Faces
        foreach (var tri in mlMesh.Triangulation)
            rhMesh.Faces.AddFace(tri.v0.Id, tri.v1.Id, tri.v2.Id);

        // Cleanup
        rhMesh.Vertices.CombineIdentical(true, true);
        rhMesh.Vertices.CullUnused();
        rhMesh.Faces.CullDegenerateFaces();
        rhMesh.UnifyNormals();
        rhMesh.Normals.ComputeNormals();
        rhMesh.Compact();

        return rhMesh;
    }
}

public class Script_Instance : GH_ScriptInstance
{
    #region Notes
    /* 
      Members:
        RhinoDoc RhinoDocument
        GH_Document GrasshopperDocument
        IGH_Component Component
        int Iteration

      Methods (Virtual & overridable):
        Print(string text)
        Print(string format, params object[] args)
        Reflect(object obj)
        Reflect(object obj, string method_name)
    */
    #endregion

    private void RunScript(object x, object y, ref object a, ref object b)
    {
        Rhino.Geometry.Mesh rhMesh = x as Rhino.Geometry.Mesh;
        Rhino.Geometry.Mesh rhMesh2 = y as Rhino.Geometry.Mesh;

        //convert rhino to mrdot mesh
        var mlMesh = RhMeshMRMeshConvertors.ToMeshLibMesh(rhMesh);
        //a = mlMesh;

        //convert rhino to mrdot mesh
        var mlMeshB = RhMeshMRMeshConvertors.ToMeshLibMesh(rhMesh2);

        var outsideA = MR.DotNet.Boolean(mlMesh, mlMeshB, MR.DotNet.BooleanOperation.OutsideA);
        var insideA = MR.DotNet.Boolean(mlMesh, mlMeshB, MR.DotNet.BooleanOperation.InsideA);

        a = RhMeshMRMeshConvertors.ToRhinoMesh(insideA.mesh);
        b = RhMeshMRMeshConvertors.ToRhinoMesh(outsideA.mesh);
    }
}
# ---------- end c_script_13 ----------

# ----
mesh_12 = Mesh(<mesh referenced from the Rhino model>)

# ---- group: MESH FILL HOLES
c_script_14 = CSharpScript(x=mesh_10)  # -> out, a, b
# ---------- c_script_14: C# ----------
// Grasshopper Script Instance
#region Usings
using System;
using System.Linq;
using System.Collections;
using System.Collections.Generic;
using System.Drawing;

#r "C:\Users\Clark\AppData\Roaming\Grasshopper\Libraries\MeshLib\MRDotNet.dll"

using Rhino;
using Rhino.Geometry;

using Grasshopper;
using Grasshopper.Kernel;
using Grasshopper.Kernel.Data;
using Grasshopper.Kernel.Types;

using static MR.DotNet;
#endregion

public static class RhMeshMRMeshConvertors
{
    /// <summary>
    /// Convert a Rhino mesh into a MeshLib (MR.DotNet) mesh.
    /// </summary>
    public static MR.DotNet.Mesh ToMeshLibMesh(Rhino.Geometry.Mesh rhMesh)
    {
        if (rhMesh == null) return null;

        // Duplicate and triangulate quads
        var triMesh = rhMesh.DuplicateMesh();
        triMesh.Faces.ConvertQuadsToTriangles();

        // Build point list
        var points = new List<MR.DotNet.Vector3f>(triMesh.Vertices.Count);
        foreach (Point3f v in triMesh.Vertices)
            points.Add(new MR.DotNet.Vector3f((float)v.X, (float)v.Y, (float)v.Z));

        // Build triangle list
        var tris = new List<MR.DotNet.ThreeVertIds>(triMesh.Faces.Count);
        foreach (var f in triMesh.Faces)
        {
            if (f.IsTriangle)
            {
                var tri = new MR.DotNet.ThreeVertIds();
                tri.v0.Id = f.A;
                tri.v1.Id = f.B;
                tri.v2.Id = f.C;
                tris.Add(tri);
            }
        }

        // Construct MeshLib mesh
        return MR.DotNet.Mesh.FromTriangles(points, tris);
    }

    public static Rhino.Geometry.Mesh ToRhinoMesh(MR.DotNet.Mesh mlMesh)
    {
        if (mlMesh == null) return null;

        var rhMesh = new Rhino.Geometry.Mesh();

        // Vertices
        foreach (var p in mlMesh.Points)
            rhMesh.Vertices.Add(p.X, p.Y, p.Z);

        // Faces
        foreach (var tri in mlMesh.Triangulation)
            rhMesh.Faces.AddFace(tri.v0.Id, tri.v1.Id, tri.v2.Id);

        // Cleanup
        rhMesh.Vertices.CombineIdentical(true, true);
        rhMesh.Vertices.CullUnused();
        rhMesh.Faces.CullDegenerateFaces();
        rhMesh.UnifyNormals();
        rhMesh.Normals.ComputeNormals();
        rhMesh.Compact();

        return rhMesh;
    }
}

public class Script_Instance : GH_ScriptInstance
{
    #region Notes
    /* 
      Members:
        RhinoDoc RhinoDocument
        GH_Document GrasshopperDocument
        IGH_Component Component
        int Iteration

      Methods (Virtual & overridable):
        Print(string text)
        Print(string format, params object[] args)
        Reflect(object obj)
        Reflect(object obj, string method_name)
    */
    #endregion

    private void RunScript(object x, ref object a, ref object b)
    {
        Rhino.Geometry.Mesh rhMesh = x as Rhino.Geometry.Mesh;


        //convert rhino to mrdot mesh
        var mlMesh = RhMeshMRMeshConvertors.ToMeshLibMesh(rhMesh);
        //a = mlMesh;

        //get hole edge ids
        List<EdgeId> holeEdges = new List<EdgeId>(mlMesh.HoleRepresentiveEdges);

        //hole params
        var fillparams = new FillHoleParams();

        MR.DotNet.FillHoles(ref mlMesh, holeEdges, fillparams);


        a = RhMeshMRMeshConvertors.ToRhinoMesh(mlMesh);
    }
}
# ---------- end c_script_14 ----------

# ---- group: MESH FILL HOLES NICELY
c_script_15 = CSharpScript(x=mesh_11)  # -> out, a, b
# ---------- c_script_15: C# ----------
// Grasshopper Script Instance
#region Usings
using System;
using System.Linq;
using System.Collections;
using System.Collections.Generic;
using System.Drawing;

#r "C:\Users\Clark\AppData\Roaming\Grasshopper\Libraries\MeshLib\MRDotNet.dll"

using Rhino;
using Rhino.Geometry;

using Grasshopper;
using Grasshopper.Kernel;
using Grasshopper.Kernel.Data;
using Grasshopper.Kernel.Types;

using static MR.DotNet;
#endregion

public static class RhMeshMRMeshConvertors
{
    /// <summary>
    /// Convert a Rhino mesh into a MeshLib (MR.DotNet) mesh.
    /// </summary>
    public static MR.DotNet.Mesh ToMeshLibMesh(Rhino.Geometry.Mesh rhMesh)
    {
        if (rhMesh == null) return null;

        // Duplicate and triangulate quads
        var triMesh = rhMesh.DuplicateMesh();
        triMesh.Faces.ConvertQuadsToTriangles();

        // Build point list
        var points = new List<MR.DotNet.Vector3f>(triMesh.Vertices.Count);
        foreach (Point3f v in triMesh.Vertices)
            points.Add(new MR.DotNet.Vector3f((float)v.X, (float)v.Y, (float)v.Z));

        // Build triangle list
        var tris = new List<MR.DotNet.ThreeVertIds>(triMesh.Faces.Count);
        foreach (var f in triMesh.Faces)
        {
            if (f.IsTriangle)
            {
                var tri = new MR.DotNet.ThreeVertIds();
                tri.v0.Id = f.A;
                tri.v1.Id = f.B;
                tri.v2.Id = f.C;
                tris.Add(tri);
            }
        }

        // Construct MeshLib mesh
        return MR.DotNet.Mesh.FromTriangles(points, tris);
    }

    public static Rhino.Geometry.Mesh ToRhinoMesh(MR.DotNet.Mesh mlMesh)
    {
        if (mlMesh == null) return null;

        var rhMesh = new Rhino.Geometry.Mesh();

        // Vertices
        foreach (var p in mlMesh.Points)
            rhMesh.Vertices.Add(p.X, p.Y, p.Z);

        // Faces
        foreach (var tri in mlMesh.Triangulation)
            rhMesh.Faces.AddFace(tri.v0.Id, tri.v1.Id, tri.v2.Id);

        // Cleanup
        rhMesh.Vertices.CombineIdentical(true, true);
        rhMesh.Vertices.CullUnused();
        rhMesh.Faces.CullDegenerateFaces();
        rhMesh.UnifyNormals();
        rhMesh.Normals.ComputeNormals();
        rhMesh.Compact();

        return rhMesh;
    }
}

public class Script_Instance : GH_ScriptInstance
{
    #region Notes
    /* 
      Members:
        RhinoDoc RhinoDocument
        GH_Document GrasshopperDocument
        IGH_Component Component
        int Iteration

      Methods (Virtual & overridable):
        Print(string text)
        Print(string format, params object[] args)
        Reflect(object obj)
        Reflect(object obj, string method_name)
    */
    #endregion

    private void RunScript(object x, ref object a, ref object b)
    {
        Rhino.Geometry.Mesh rhMesh = x as Rhino.Geometry.Mesh;


        //convert rhino to mrdot mesh
        var mlMesh = RhMeshMRMeshConvertors.ToMeshLibMesh(rhMesh);
        //a = mlMesh;

        //get hole edge ids
        var holeEdges = mlMesh.HoleRepresentiveEdges;

        //hole nicely params
        var fillnicelyparams = new FillHoleNicelyParams();
        fillnicelyparams.NaturalSmooth = true;

        foreach (var h in holeEdges)
        {
            MR.DotNet.FillHoleNicely(ref mlMesh, h, fillnicelyparams);
        }

        b = RhMeshMRMeshConvertors.ToRhinoMesh(mlMesh);


    }
}
# ---------- end c_script_15 ----------

# ----
negative = Negative(Value=number_slider)
mesh_13 = Mesh(c_script_13.b)
mesh_14 = Mesh(c_script_14.b)
mesh_15 = Mesh(c_script_15.b)

# ---- group: VOXEL OFFSET
c_script_16 = CSharpScript(x=mesh_12, y=negative)  # -> out, a; inputs y: Double
# ---------- c_script_16: C# ----------
// Grasshopper Script Instance
#region Usings
using System;
using System.Linq;
using System.Collections;
using System.Collections.Generic;
using System.Drawing;

using Rhino;
using Rhino.Geometry;

using Grasshopper;
using Grasshopper.Kernel;
using Grasshopper.Kernel.Data;
using Grasshopper.Kernel.Types;

#r "C:\Users\Clark\AppData\Roaming\Grasshopper\Libraries\MeshLib\MRDotNet.dll"
using static MR.DotNet;
#endregion

public static class RhMeshMRMeshConvertors
{
    /// <summary>
    /// Convert a Rhino mesh into a MeshLib (MR.DotNet) mesh.
    /// </summary>
    public static MR.DotNet.Mesh ToMeshLibMesh(Rhino.Geometry.Mesh rhMesh)
    {
        if (rhMesh == null) return null;

        // Duplicate and triangulate quads
        var triMesh = rhMesh.DuplicateMesh();
        triMesh.Faces.ConvertQuadsToTriangles();

        // Build point list
        var points = new List<MR.DotNet.Vector3f>(triMesh.Vertices.Count);
        foreach (Point3f v in triMesh.Vertices)
            points.Add(new MR.DotNet.Vector3f((float)v.X, (float)v.Y, (float)v.Z));

        // Build triangle list
        var tris = new List<MR.DotNet.ThreeVertIds>(triMesh.Faces.Count);
        foreach (var f in triMesh.Faces)
        {
            if (f.IsTriangle)
            {
                var tri = new MR.DotNet.ThreeVertIds();
                tri.v0.Id = f.A;
                tri.v1.Id = f.B;
                tri.v2.Id = f.C;
                tris.Add(tri);
            }
        }

        // Construct MeshLib mesh
        return MR.DotNet.Mesh.FromTriangles(points, tris);
    }

    public static Rhino.Geometry.Mesh ToRhinoMesh(MR.DotNet.Mesh mlMesh)
    {
        if (mlMesh == null) return null;

        var rhMesh = new Rhino.Geometry.Mesh();

        // Vertices
        foreach (var p in mlMesh.Points)
            rhMesh.Vertices.Add(p.X, p.Y, p.Z);

        // Faces
        foreach (var tri in mlMesh.Triangulation)
            rhMesh.Faces.AddFace(tri.v0.Id, tri.v1.Id, tri.v2.Id);

        // Cleanup
        rhMesh.Vertices.CombineIdentical(true, true);
        rhMesh.Vertices.CullUnused();
        rhMesh.Faces.CullDegenerateFaces();
        rhMesh.UnifyNormals();
        rhMesh.Normals.ComputeNormals();
        rhMesh.Compact();

        return rhMesh;
    }
}


public class Script_Instance : GH_ScriptInstance
{
    #region Notes
    /* 
      Members:
        RhinoDoc RhinoDocument
        GH_Document GrasshopperDocument
        IGH_Component Component
        int Iteration

      Methods (Virtual & overridable):
        Print(string text)
        Print(string format, params object[] args)
        Reflect(object obj)
        Reflect(object obj, string method_name)
    */
    #endregion

    private void RunScript(object x, double y, ref object a)
    {
        Rhino.Geometry.Mesh rhMesh = x as Rhino.Geometry.Mesh;

        //convert to MRDot Mesh
        var mlMesh = RhMeshMRMeshConvertors.ToMeshLibMesh(rhMesh);

        //Convert to voxels
        MR.DotNet.MeshPart VMesh = new MR.DotNet.MeshPart(mlMesh);


        //define offset params
        var offsetParams = new OffsetParameters();
        offsetParams.voxelSize = 0.08f;
        offsetParams.memoryEfficient = true;
        offsetParams.signDetectionMode = SignDetectionMode.OpenVDB;
    
        float offsetDist = (float)y;
        MR.DotNet.Mesh offsetMesh = Offset.OffsetMesh(VMesh, offsetDist, offsetParams);

        Rhino.Geometry.Mesh rhoffsetMesh = RhMeshMRMeshConvertors.ToRhinoMesh(offsetMesh);

        Rhino.Geometry.Mesh[] sides = rhoffsetMesh.SplitDisjointPieces();

        a = sides;

    }
}
# ---------- end c_script_16 ----------

# ---- group: SHELL
c_script_17 = CSharpScript(x=mesh_12, y=number_slider)  # -> out, a, b; inputs y: Double
# ---------- c_script_17: C# ----------
// Grasshopper Script Instance
#region Usings
using System;
using System.Linq;
using System.Collections;
using System.Collections.Generic;
using System.Drawing;

using Rhino;
using Rhino.Geometry;

using Grasshopper;
using Grasshopper.Kernel;
using Grasshopper.Kernel.Data;
using Grasshopper.Kernel.Types;

#r "C:\Users\Clark\AppData\Roaming\Grasshopper\Libraries\MeshLib\MRDotNet.dll"
using static MR.DotNet;
#endregion

public static class RhMeshMRMeshConvertors
{
    /// <summary>
    /// Convert a Rhino mesh into a MeshLib (MR.DotNet) mesh.
    /// </summary>
    public static MR.DotNet.Mesh ToMeshLibMesh(Rhino.Geometry.Mesh rhMesh)
    {
        if (rhMesh == null) return null;

        // Duplicate and triangulate quads
        var triMesh = rhMesh.DuplicateMesh();
        triMesh.Faces.ConvertQuadsToTriangles();

        // Build point list
        var points = new List<MR.DotNet.Vector3f>(triMesh.Vertices.Count);
        foreach (Point3f v in triMesh.Vertices)
            points.Add(new MR.DotNet.Vector3f((float)v.X, (float)v.Y, (float)v.Z));

        // Build triangle list
        var tris = new List<MR.DotNet.ThreeVertIds>(triMesh.Faces.Count);
        foreach (var f in triMesh.Faces)
        {
            if (f.IsTriangle)
            {
                var tri = new MR.DotNet.ThreeVertIds();
                tri.v0.Id = f.A;
                tri.v1.Id = f.B;
                tri.v2.Id = f.C;
                tris.Add(tri);
            }
        }

        // Construct MeshLib mesh
        return MR.DotNet.Mesh.FromTriangles(points, tris);
    }

    public static Rhino.Geometry.Mesh ToRhinoMesh(MR.DotNet.Mesh mlMesh)
    {
        if (mlMesh == null) return null;

        var rhMesh = new Rhino.Geometry.Mesh();

        // Vertices
        foreach (var p in mlMesh.Points)
            rhMesh.Vertices.Add(p.X, p.Y, p.Z);

        // Faces
        foreach (var tri in mlMesh.Triangulation)
            rhMesh.Faces.AddFace(tri.v0.Id, tri.v1.Id, tri.v2.Id);

        // Cleanup
        rhMesh.Vertices.CombineIdentical(true, true);
        rhMesh.Vertices.CullUnused();
        rhMesh.Faces.CullDegenerateFaces();
        rhMesh.UnifyNormals();
        rhMesh.Normals.ComputeNormals();
        rhMesh.Compact();

        return rhMesh;
    }
}


public class Script_Instance : GH_ScriptInstance
{
    #region Notes
    /* 
      Members:
        RhinoDoc RhinoDocument
        GH_Document GrasshopperDocument
        IGH_Component Component
        int Iteration

      Methods (Virtual & overridable):
        Print(string text)
        Print(string format, params object[] args)
        Reflect(object obj)
        Reflect(object obj, string method_name)
    */
    #endregion

    private void RunScript(object x, double y, ref object a, ref object b)
    {
        Rhino.Geometry.Mesh rhMesh = x as Rhino.Geometry.Mesh;

        //convert to MRDot Mesh
        var mlMesh = RhMeshMRMeshConvertors.ToMeshLibMesh(rhMesh);

        //Convert to voxels
        MR.DotNet.MeshPart VMesh = new MR.DotNet.MeshPart(mlMesh);


        var offsetParams = new OffsetParameters();
        offsetParams.voxelSize = 0.08f;
        offsetParams.memoryEfficient = true;
        offsetParams.signDetectionMode = SignDetectionMode.OpenVDB;

        var generalParams = new GeneralOffsetParameters();

        float offsetDist = (float)y;

        MR.DotNet.Mesh offsetMesh = Offset.ThickenMesh(mlMesh, offsetDist, offsetParams, generalParams);

        //a = RhMeshMRMeshConvertors.ToRhinoMesh(offsetMesh);

        Rhino.Geometry.Mesh RHOffsetMesh = RhMeshMRMeshConvertors.ToRhinoMesh(offsetMesh);

        //Normal Output
        a = RHOffsetMesh;

        //SplitDisjointMesh
        Rhino.Geometry.Mesh[] sides = RHOffsetMesh.SplitDisjointPieces();



        //SplitDisjoint Output
        b = sides;

    }
}
# ---------- end c_script_17 ----------

# ----
series = Series(Start=0, Step=Slider(6, range=0..10), Count=10)
mesh_16 = Mesh(c_script_16.a)
offset_mesh = OffsetMesh(Distance=1, BothSides=0, CreateSolid=True)
mesh_17 = Mesh(c_script_17.a)
mesh_18 = Mesh([<mesh referenced from the Rhino model> x2])
boolean_toggle = BooleanToggle(True)
unit_x = UnitX(Factor=series)
mesh_join = MeshJoin(Meshes=mesh_18)
move = Move(Geometry=mesh_12, Motion=unit_x)  # -> Geometry, Transform

# ---- group: Mesh Clean
c_script_18 = CSharpScript(
    x=mesh_join,
    SelfIntersections=boolean_toggle,
    RemoveUnusedVertices=boolean_toggle,
    FillHoles=boolean_toggle,
    Triangulate=boolean_toggle,
    SplitDisjointMesh=boolean_toggle,
    UnifyNormals=boolean_toggle,
    WeldMesh=boolean_toggle)  # -> out, a, b; inputs SelfIntersections: Boolean, RemoveUnusedVertices: Boolean, FillHoles: Boolean, Triangulate: Boolean, SplitDisjointMesh: Boolean, UnifyNormals: Boolean
# ---------- c_script_18: C# ----------
// Grasshopper Script Instance
#region Usings
using System;
using System.Linq;
using System.Collections;
using System.Collections.Generic;
using System.Drawing;

using Rhino;
using Rhino.Geometry;

using Grasshopper;
using Grasshopper.Kernel;
using Grasshopper.Kernel.Data;
using Grasshopper.Kernel.Types;

using System.Runtime.InteropServices;


#r "C:\Users\Clark\AppData\Roaming\Grasshopper\Libraries\MeshLib\MRDotNet.dll"
using static MR.DotNet;
using MR;

#endregion

public static class RhMeshMRMeshConvertors
{
    /// <summary>
    /// Convert a Rhino mesh into a MeshLib (MR.DotNet) mesh.
    /// </summary>
    public static MR.DotNet.Mesh ToMeshLibMesh(Rhino.Geometry.Mesh rhMesh)
    {
        if (rhMesh == null) return null;

        // Duplicate and triangulate quads
        var triMesh = rhMesh.DuplicateMesh();
        triMesh.Faces.ConvertQuadsToTriangles();

        // Build point list
        var points = new List<MR.DotNet.Vector3f>(triMesh.Vertices.Count);
        foreach (Point3f v in triMesh.Vertices)
            points.Add(new MR.DotNet.Vector3f((float)v.X, (float)v.Y, (float)v.Z));

        // Build triangle list
        var tris = new List<MR.DotNet.ThreeVertIds>(triMesh.Faces.Count);
        foreach (var f in triMesh.Faces)
        {
            if (f.IsTriangle)
            {
                var tri = new MR.DotNet.ThreeVertIds();
                tri.v0.Id = f.A;
                tri.v1.Id = f.B;
                tri.v2.Id = f.C;
                tris.Add(tri);
            }
        }

        // Construct MeshLib mesh
        return MR.DotNet.Mesh.FromTriangles(points, tris);
    }

    public static Rhino.Geometry.Mesh ToRhinoMesh(MR.DotNet.Mesh mlMesh)
    {
        if (mlMesh == null) return null;

        var rhMesh = new Rhino.Geometry.Mesh();

        // Vertices
        foreach (var p in mlMesh.Points)
            rhMesh.Vertices.Add(p.X, p.Y, p.Z);

        // Faces
        foreach (var tri in mlMesh.Triangulation)
            rhMesh.Faces.AddFace(tri.v0.Id, tri.v1.Id, tri.v2.Id);

        // Cleanup
        rhMesh.Vertices.CombineIdentical(true, true);
        rhMesh.Vertices.CullUnused();
        rhMesh.Faces.CullDegenerateFaces();
        rhMesh.UnifyNormals();
        rhMesh.Normals.ComputeNormals();
        rhMesh.Compact();

        return rhMesh;
    }
}

public class Script_Instance : GH_ScriptInstance
{
    #region Notes
    /* 
      Members:
        RhinoDoc RhinoDocument
        GH_Document GrasshopperDocument
        IGH_Component Component
        int Iteration

      Methods (Virtual & overridable):
        Print(string text)
        Print(string format, params object[] args)
        Reflect(object obj)
        Reflect(object obj, string method_name)
    */
    #endregion

    private void RunScript(
		object x,
		bool SelfIntersections,
		bool RemoveUnusedVertices,
		bool FillHoles,
		bool Triangulate,
		bool SplitDisjointMesh,
		bool UnifyNormals,
		object WeldMesh,
		ref object a,
		ref object b)
    {
        Rhino.Geometry.Mesh rhMesh = x as Rhino.Geometry.Mesh;

        MR.DotNet.Mesh mlMesh = RhMeshMRMeshConvertors.ToMeshLibMesh(rhMesh);

        //var settings = new FixMeshDegeneraciesParams();

        var settings = new DotNet.SelfIntersections.Settings();

        if (SelfIntersections == true)
        {
            //Fix self-intersection
            MR.DotNet.SelfIntersections.Fix(ref mlMesh, settings);
        }

        if (RemoveUnusedVertices == true)
        {
            //Cull unused vertices
            mlMesh.PackOptimally();
        }

        if (FillHoles == true)
        {
            //Fill Holes
            List<EdgeId> holeEdges = new List<EdgeId>(mlMesh.HoleRepresentiveEdges);
            var fillparams = new FillHoleParams();
            MR.DotNet.FillHoles(ref mlMesh, holeEdges, fillparams);
        }

        //Convert to rhino mesh
        Rhino.Geometry.Mesh mrfixedmesh = RhMeshMRMeshConvertors.ToRhinoMesh(mlMesh);

        if (Triangulate == true)
        {
            //Triangulate
            mrfixedmesh.Faces.ConvertQuadsToTriangles();
        }


        //Unify normals
        mrfixedmesh.UnifyNormals();

        //Weld mesh
        mrfixedmesh.Weld(0.01);


        //Disjoint Mesh List
        List<Rhino.Geometry.Mesh> disjointprts = new List<Rhino.Geometry.Mesh>();

        if (SplitDisjointMesh == true)
        {
            //SplitDisjoint Mesh
            Rhino.Geometry.Mesh[] parts = mrfixedmesh.SplitDisjointPieces();

            double minarea = 5;
            List<double>areas = new List<double>();
            foreach (Rhino.Geometry.Mesh m in parts)
            {
                double area = Rhino.Geometry.AreaMassProperties.Compute(m).Area;

                

                if (area>minarea)
                {
                    areas.Add(area);
                    disjointprts.Add(m);
                }
            }

            a = disjointprts;
            b = areas;
            
        }
        else
        {
            double area = Rhino.Geometry.AreaMassProperties.Compute(mrfixedmesh).Area;
            b = area;
            a = mrfixedmesh;
        }
        

        
    }
}
# ---------- end c_script_18 ----------

# ----
mesh_19 = Mesh(<mesh referenced from the Rhino model>)
c_script_19 = CSharpScript()  # -> out, a
# ---------- c_script_19: C# ----------
// Grasshopper Script Instance
#region Usings
using System;
using System.Linq;
using System.Collections;
using System.Collections.Generic;
using System.Drawing;

using Rhino;
using Rhino.Geometry;

using Grasshopper;
using Grasshopper.Kernel;
using Grasshopper.Kernel.Data;
using Grasshopper.Kernel.Types;

#r "C:\Users\Clark\AppData\Roaming\Grasshopper\Libraries\MeshLib\MRDotNet.dll"
using static MR.DotNet;
#endregion

public static class RhMeshMRMeshConvertors
{
    /// <summary>
    /// Convert a Rhino mesh into a MeshLib (MR.DotNet) mesh.
    /// </summary>
    public static MR.DotNet.Mesh ToMeshLibMesh(Rhino.Geometry.Mesh rhMesh)
    {
        if (rhMesh == null) return null;

        // Duplicate and triangulate quads
        var triMesh = rhMesh.DuplicateMesh();
        triMesh.Faces.ConvertQuadsToTriangles();

        // Build point list
        var points = new List<MR.DotNet.Vector3f>(triMesh.Vertices.Count);
        foreach (Point3f v in triMesh.Vertices)
            points.Add(new MR.DotNet.Vector3f((float)v.X, (float)v.Y, (float)v.Z));

        // Build triangle list
        var tris = new List<MR.DotNet.ThreeVertIds>(triMesh.Faces.Count);
        foreach (var f in triMesh.Faces)
        {
            if (f.IsTriangle)
            {
                var tri = new MR.DotNet.ThreeVertIds();
                tri.v0.Id = f.A;
                tri.v1.Id = f.B;
                tri.v2.Id = f.C;
                tris.Add(tri);
            }
        }

        // Construct MeshLib mesh
        return MR.DotNet.Mesh.FromTriangles(points, tris);
    }

    public static Rhino.Geometry.Mesh ToRhinoMesh(MR.DotNet.Mesh mlMesh)
    {
        if (mlMesh == null) return null;

        var rhMesh = new Rhino.Geometry.Mesh();

        // Vertices
        foreach (var p in mlMesh.Points)
            rhMesh.Vertices.Add(p.X, p.Y, p.Z);

        // Faces
        foreach (var tri in mlMesh.Triangulation)
            rhMesh.Faces.AddFace(tri.v0.Id, tri.v1.Id, tri.v2.Id);

        // Cleanup
        rhMesh.Vertices.CombineIdentical(true, true);
        rhMesh.Vertices.CullUnused();
        rhMesh.Faces.CullDegenerateFaces();
        rhMesh.UnifyNormals();
        rhMesh.Normals.ComputeNormals();
        rhMesh.Compact();

        return rhMesh;
    }
}

public class Script_Instance : GH_ScriptInstance
{
    #region Notes
    /* 
      Members:
        RhinoDoc RhinoDocument
        GH_Document GrasshopperDocument
        IGH_Component Component
        int Iteration

      Methods (Virtual & overridable):
        Print(string text)
        Print(string format, params object[] args)
        Reflect(object obj)
        Reflect(object obj, string method_name)
    */
    #endregion

    private void RunScript(object x, object y, ref object a)
    {
        // Write your logic here
        a = null;
    }
}
# ---------- end c_script_19 ----------
mesh_closest_point = MeshClosestPoint()  # -> Point, Index, Parameter

# ---- group: Decimate
c_script_20 = CSharpScript(x=mesh_12, polyCount=Slider(914, range=0..10000))  # -> out, a; inputs polyCount: Int32
# ---------- c_script_20: C# ----------
// Grasshopper Script Instance
#region Usings
using System;
using System.Linq;
using System.Collections;
using System.Collections.Generic;
using System.Drawing;

using Rhino;
using Rhino.Geometry;

using Grasshopper;
using Grasshopper.Kernel;
using Grasshopper.Kernel.Data;
using Grasshopper.Kernel.Types;

#r "C:\Users\Clark\AppData\Roaming\Grasshopper\Libraries\MeshLib\MRDotNet.dll"
using static MR.DotNet;
#endregion

public static class RhMeshMRMeshConvertors
{
    /// <summary>
    /// Convert a Rhino mesh into a MeshLib (MR.DotNet) mesh.
    /// </summary>
    public static MR.DotNet.Mesh ToMeshLibMesh(Rhino.Geometry.Mesh rhMesh)
    {
        if (rhMesh == null) return null;

        // Duplicate and triangulate quads
        var triMesh = rhMesh.DuplicateMesh();
        triMesh.Faces.ConvertQuadsToTriangles();

        // Build point list
        var points = new List<MR.DotNet.Vector3f>(triMesh.Vertices.Count);
        foreach (Point3f v in triMesh.Vertices)
            points.Add(new MR.DotNet.Vector3f((float)v.X, (float)v.Y, (float)v.Z));

        // Build triangle list
        var tris = new List<MR.DotNet.ThreeVertIds>(triMesh.Faces.Count);
        foreach (var f in triMesh.Faces)
        {
            if (f.IsTriangle)
            {
                var tri = new MR.DotNet.ThreeVertIds();
                tri.v0.Id = f.A;
                tri.v1.Id = f.B;
                tri.v2.Id = f.C;
                tris.Add(tri);
            }
        }

        // Construct MeshLib mesh
        return MR.DotNet.Mesh.FromTriangles(points, tris);
    }

    public static Rhino.Geometry.Mesh ToRhinoMesh(MR.DotNet.Mesh mlMesh)
    {
        if (mlMesh == null) return null;

        var rhMesh = new Rhino.Geometry.Mesh();

        // Vertices
        foreach (var p in mlMesh.Points)
            rhMesh.Vertices.Add(p.X, p.Y, p.Z);

        // Faces
        foreach (var tri in mlMesh.Triangulation)
            rhMesh.Faces.AddFace(tri.v0.Id, tri.v1.Id, tri.v2.Id);

        // Cleanup
        rhMesh.Vertices.CombineIdentical(true, true);
        rhMesh.Vertices.CullUnused();
        rhMesh.Faces.CullDegenerateFaces();
        rhMesh.UnifyNormals();
        rhMesh.Normals.ComputeNormals();
        rhMesh.Compact();

        return rhMesh;
    }
}

public class Script_Instance : GH_ScriptInstance
{
    #region Notes
    /* 
      Members:
        RhinoDoc RhinoDocument
        GH_Document GrasshopperDocument
        IGH_Component Component
        int Iteration

      Methods (Virtual & overridable):
        Print(string text)
        Print(string format, params object[] args)
        Reflect(object obj)
        Reflect(object obj, string method_name)
    */
    #endregion

    private void RunScript(object x, int polyCount, ref object a)
    {
        Rhino.Geometry.Mesh rhMesh = x as Rhino.Geometry.Mesh;

        MR.DotNet.Mesh mlMesh = RhMeshMRMeshConvertors.ToMeshLibMesh(rhMesh);


        int targetFaces = polyCount;
        int currentFaces = mlMesh.ValidFaces.Count();
        //Console.WriteLine(currentFaces);

        var decimateParams = new DecimateParameters();
        decimateParams.maxDeletedFaces = currentFaces - targetFaces;
        decimateParams.maxError = float.MaxValue; //makes numebr infinity, saying max error can be a super laarge deviation
        decimateParams.optimizeVertexPos = true;

        var decimateMesh = MR.DotNet.Decimate(ref mlMesh, decimateParams);

        

        a = RhMeshMRMeshConvertors.ToRhinoMesh(mlMesh);
    }
}
# ---------- end c_script_20 ----------

# ----
mesh_20 = Mesh(c_script_18.a)

# ---- group: isSolid
c_script_21 = CSharpScript(Mesh=mesh_join)  # -> out, a, b; inputs Mesh: Mesh
# ---------- c_script_21: C# ----------
// Grasshopper Script Instance
#region Usings
using System;
using System.Linq;
using System.Collections;
using System.Collections.Generic;
using System.Drawing;

using Rhino;
using Rhino.Geometry;

using Grasshopper;
using Grasshopper.Kernel;
using Grasshopper.Kernel.Data;
using Grasshopper.Kernel.Types;
#endregion

public class Script_Instance : GH_ScriptInstance
{
    #region Notes
    /* 
      Members:
        RhinoDoc RhinoDocument
        GH_Document GrasshopperDocument
        IGH_Component Component
        int Iteration

      Methods (Virtual & overridable):
        Print(string text)
        Print(string format, params object[] args)
        Reflect(object obj)
        Reflect(object obj, string method_name)
    */
    #endregion

    private void RunScript(Mesh Mesh, ref object a, ref object b)
    {
        bool isSolid = Mesh.IsSolid;

        //get naked edges
        Polyline[] nakedEdges = Mesh.GetNakedEdges();

        a = isSolid;
        b = nakedEdges;
    }
}
# ---------- end c_script_21 ----------

# ----
mesh_edges = MeshEdges(Mesh=c_script_20.a)  # -> NakedEdges, InteriorEdges, NonManifoldEdges
curve = Curve(c_script_21.b)
panel_4 = Panel(c_script_21.b)
