# Grasshopper definition Minkowski_Difference.gh (Grasshopper 1.0.8)
# plug-ins: RhinoCodePluginGH, Kangaroo Components, Kangaroo2 Components

curve = Curve(<curve referenced from the Rhino model>)
curve_2 = Curve(<curve referenced from the Rhino model>)
explode = Explode(Curve=curve, Recursive=True)  # -> Segments, Vertices
explode_2 = Explode(Curve=curve_2, Recursive=True)  # -> Segments, Vertices
removeduplicatepts = RemoveDuplicatePts(Points=explode.Vertices, Tolerance=0.01)  # -> graft(UniquePoints)
removeduplicatepts_2 = RemoveDuplicatePts(Points=explode_2.Vertices, Tolerance=0.01)
subtraction = Subtraction(A=removeduplicatepts, B=removeduplicatepts_2)
xy_plane = XYPlane(Origin=Point(0, 0, 0))
removeduplicatepts_3 = RemoveDuplicatePts(Points=subtraction, Tolerance=0.01)  # -> flatten(UniquePoints)
panel = Panel(removeduplicatepts_3)
deconstruct = Deconstruct(Point=removeduplicatepts_3)  # -> XComponent, YComponent, ZComponent; disabled
convex_hull = ConvexHull(Points=flatten(removeduplicatepts_3), Plane=xy_plane)  # -> Hull, HullZ, Indices
c_script = CSharpScript(pts=removeduplicatepts_3)  # -> out, a; inputs pts: list of Point3d; disabled
# ---------- c_script: C# ----------
// Grasshopper Script Instance
#region Usings
using System;
using System.Linq;
using System.Collections;
using System.Collections.Generic;
using System.Drawing;

using Rhino;
using Rhino.Geometry;

using Grasshopper;
using Grasshopper.Kernel;
using Grasshopper.Kernel.Data;
using Grasshopper.Kernel.Types;
#endregion

public class Script_Instance : GH_ScriptInstance
{
    #region Notes
    /* 
      Members:
        RhinoDoc RhinoDocument
        GH_Document GrasshopperDocument
        IGH_Component Component
        int Iteration

      Methods (Virtual & overridable):
        Print(string text)
        Print(string format, params object[] args)
        Reflect(object obj)
        Reflect(object obj, string method_name)
    */
    #endregion

    private void RunScript(List<Point3d> pts, ref object a)
    {
        List<double> x_val = new List<double>();

        // Assuming 'pts' is a collection of Point3d objects
        foreach (Point3d pt in pts)
        {
            x_val.Add(pt.X);  // Add the X coordinate of each point
        }

        // Sort the X values in ascending order
        x_val.Sort();

        // Output the sorted list
        a = x_val;


    }
}
# ---------- end c_script ----------
explode_3 = Explode(Curve=convex_hull.Hull, Recursive=True)  # -> Segments, Vertices
panel_2 = Panel(c_script.a)  # disabled
sort_list = SortList(Keys=flatten(deconstruct.XComponent), ValuesA=removeduplicatepts_3)  # -> Keys, ValuesA; disabled
point_in_curve = PointInCurve(Point="0,0,0", Curve=convex_hull.Hull)  # -> Relationship, Point; disabled
curve_closest_point = CurveClosestPoint(Point="0,0,0", Curve=explode_3.Segments)  # -> Point, Parameter, Distance
unit_x = UnitX(Factor=1)  # disabled
list_item = ListItem(List=sort_list.ValuesA, Index=0, Wrap=True)  # disabled
xy_plane_2 = XYPlane(Origin=Point(0, 0, 0))  # disabled
panel_3 = Panel(point_in_curve.Relationship)  # disabled
line_sdl = LineSDL(Start=list_item, Direction=unit_x, Length=1)  # disabled
subtraction_2 = Subtraction(A=sort_list.ValuesA, B=list_item)  # disabled
sort_list_2 = SortList(Keys=curve_closest_point.Distance, ValuesValuesA=curve_closest_point.Point, ValuesA=explode_3.Segments)  # -> Keys, ValuesValuesA, ValuesA
cross_product = CrossProduct(VectorA=subtraction_2, VectorB=unit_x, Unitize=False)  # -> Vector, Length; disabled
list_item_2 = ListItem(List=sort_list_2.ValuesValuesA, Index=0, Wrap=True)
list_item_3 = ListItem(List=sort_list_2.ValuesA, Index=0, Wrap=True)
vector_display = VectorDisplay(Anchor=list_item, Vector=subtraction_2)  # disabled
distance = Distance(PointA=list_item_2, PointB="0,0,0")
deconstruct_vector = DeconstructVector(Vector=cross_product.Vector)  # -> XComponent, YComponent, ZComponent; disabled
subtraction_3 = Subtraction(A=list_item_2, B="0,0,0")
end_points = EndPoints(Curve=list_item_3)  # -> Start, End
unit_z = UnitZ(Factor=1)
sort_list_3 = SortList(Keys=deconstruct_vector.ZComponent, ValuesValuesA=sort_list.ValuesA)  # -> reverse(Keys), reverse(ValuesValuesA); disabled
reverse = Reverse(Vector=subtraction_3)
subtraction_4 = Subtraction(A=end_points.End, B=end_points.Start)
addition = Addition(A=distance, B=Slider(0.25, range=0..1))
cross_product_2 = CrossProduct(VectorA=subtraction_3, VectorB=unit_z, Unitize=invert(False))  # -> Vector, Length
vector_display_2 = VectorDisplay(Anchor="0,0,0", Vector=subtraction_3)
cross_product_3 = CrossProduct(VectorA=subtraction_4, VectorB=unit_z, Unitize=invert(False))  # -> Vector, Length
list_item_4 = ListItem(List=sort_list_3.ValuesValuesA, Index=0, Wrap=True)  # disabled
amplitude = Amplitude(Vector=reverse, Amplitude=addition)
vector_display_3 = VectorDisplay(Anchor="0,0,0", Vector=cross_product_3.Vector)
panel_4 = Panel(sort_list_3.Keys)  # disabled
move = Move(Geometry=curve, Motion=reverse)  # -> Geometry, Transform
panel_5 = Panel(cross_product_3.Vector)
panel_6 = Panel(subtraction_3)
