# Grasshopper definition OffsetCrv+.gh (Grasshopper 1.0.8)
# plug-ins: Pufferfish

curve = Curve([<curve referenced from the Rhino model> x3])
curve_2 = Curve(<curve referenced from the Rhino model>)
flip_curve = FlipCurve(Curve=curve_2)  # -> Curve, Flag
list_length = ListLength(List=curve)
random = Random(Range="2", Number=list_length, Seed=Slider(3, range=0..10))
merge = Merge(Data1=curve_2, Data2=flip_curve.Curve)
number_slider = Slider(18, range=0..100)
round = Round(Number=random)  # -> Nearest, Floor, Ceiling
curve_3 = Curve([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])
list_item = ListItem(List=merge, Index=round.Nearest, Wrap=True)
explode = Explode(Curve=curve_3, Recursive=True)  # -> Segments, Vertices
series = Series(Start=0, Step=Slider(5, range=0..10), Count=number_slider)
flip_curve_2 = FlipCurve(Curve=graft(curve), Guide=graft(list_item))  # -> flatten(Curve), Flag
plane_fit = PlaneFit(Points=explode.Vertices)  # -> Plane, Deviation
negative = Negative(Value=series)
negative_2 = Negative(Value=series)
xy_plane = XYPlane(Origin=Point(0, 0, 0))
curve_4 = Curve(<curve referenced from the Rhino model>)
number_slider_2 = Slider(5.54, range=0..10)
curve_5 = Curve([<curve referenced from the Rhino model> x3])
explode_2 = Explode(Curve=curve_4, Recursive=True)  # -> Segments, Vertices
end_points = EndPoints(Curve=curve_4)  # -> Start, End
list_item_2 = ListItem(List=explode_2.Vertices, Index=0, Wrap=True)
point = Point(<point referenced from the Rhino model>)
offset_curve = OffsetCurve(Curve=curve_4, Distance=number_slider, Plane=xy_plane, Corners=Slider(1, range=0..10))  # disabled
plane_fit_2 = PlaneFit(Points=explode_2.Vertices)  # -> Plane, Deviation
subtraction = Subtraction(A=end_points.End, B=end_points.Start)
unit_z = UnitZ(Factor=1)
reverse = Reverse(Vector=subtraction)
flip_plane = FlipPlane(Plane=plane_fit_2.Plane, ReverseX=False, ReverseY=False, SwapAxes=True)
move_to_point = MoveToPoint(Geometry=plane_fit_2.Plane, PointA="0,0,0", PointB=list_item_2)  # -> Moved, Vector, Transform
c_script = CSharpScript(crv=curve_4, plane=flip_plane, dist=negative, tol="0.01")  # -> out, a; inputs crv: Curve, plane: Plane, dist: Double, tol: Double; disabled
# ---------- c_script: C# ----------
// Grasshopper Script Instance
#region Usings
using System;
using System.Linq;
using System.Collections;
using System.Collections.Generic;
using System.Drawing;

using Rhino;
using Rhino.Geometry;

using Grasshopper;
using Grasshopper.Kernel;
using Grasshopper.Kernel.Data;
using Grasshopper.Kernel.Types;
#endregion

public class Script_Instance : GH_ScriptInstance
{
    #region Notes
    /* 
      Members:
        RhinoDoc RhinoDocument
        GH_Document GrasshopperDocument
        IGH_Component Component
        int Iteration

      Methods (Virtual & overridable):
        Print(string text)
        Print(string format, params object[] args)
        Reflect(object obj)
        Reflect(object obj, string method_name)
    */
    #endregion

    private void RunScript(
		Curve crv,
		Plane plane,
		double dist,
		double tol,
		ref object a)
    {
        List<Curve> offsetcrv = new List<Curve>();

        //offsetcrv = crv.Offset(plane,dist,tol,0);
        a = crv.Offset(plane,dist,tol,Rhino.Geometry.CurveOffsetCornerStyle.Sharp);
    }
}
# ---------- end c_script ----------
cross_product = CrossProduct(VectorA=subtraction, VectorB=unit_z, Unitize=False)  # -> Vector, Length
deconstruct_plane = DeconstructPlane(Plane=plane_fit_2.Plane)  # -> Origin, XAxis, YAxis, ZAxis
amplitude = Amplitude(Vector=cross_product.Vector, Amplitude="1000")
c_script_2 = CSharpScript(crv=curve_4, bothsides=graft(series), plane=flip_plane, cornerstyle=Slider(1, range=0..10))  # -> out, a, b; inputs crv: Curve, dist: Double, bothsides: Double, plane: Plane, tol: Double, cornerstyle: Int32, endstyle: Int32; disabled
# ---------- c_script_2: C# ----------
// Grasshopper Script Instance
#region Usings
using System;
using System.Linq;
using System.Collections;
using System.Collections.Generic;
using System.Drawing;

using Rhino;
using Rhino.Geometry;

using Grasshopper;
using Grasshopper.Kernel;
using Grasshopper.Kernel.Data;
using Grasshopper.Kernel.Types;
#endregion

public class Script_Instance : GH_ScriptInstance
{
    #region Notes
    /* 
      Members:
        RhinoDoc RhinoDocument
        GH_Document GrasshopperDocument
        IGH_Component Component
        int Iteration

      Methods (Virtual & overridable):
        Print(string text)
        Print(string format, params object[] args)
        Reflect(object obj)
        Reflect(object obj, string method_name)
    */
    #endregion

    private void RunScript(
		Curve crv,
		double dist,
		double bothsides,
		Plane plane,
		double tol,
		int cornerstyle,
		int endstyle,
		ref object a,
		ref object b)
    {

        double angTol = Rhino.RhinoDoc.ActiveDoc?.ModelAngleToleranceRadians ?? Rhino.RhinoMath.ToRadians(1.0);

        Curve test = crv;

        //sanity check for plane
        if (!plane.IsValid)
        {
            plane = Plane.WorldXY;
        }
        



        //extract plane
        Vector3d normal = plane.Normal;
        Point3d origin = plane.Origin;

        //Console.WriteLine(normal);

        //Side A
        Curve[] offsetcrva = test.Offset(origin,normal,dist,tol,angTol,false,(CurveOffsetCornerStyle)cornerstyle,(CurveOffsetEndStyle)endstyle);

        a = offsetcrva;

        //Side B
        Curve[] offsetcrvb = test.Offset(origin,-normal,Math.Abs(bothsides),tol,angTol,false,(CurveOffsetCornerStyle)cornerstyle,(CurveOffsetEndStyle)endstyle);        b=offsetcrvb;



    }
}
# ---------- end c_script_2 ----------
flip_curve_3 = FlipCurve(Curve=curve_4)  # -> Curve, Flag
vector_display = VectorDisplay(Anchor=end_points.Start, Vector=cross_product.Vector)
addition = Addition(A=end_points.Start, B=amplitude)
c_script_3 = CSharpScript(crv=curve_4, dist=series, tol="0.01", origin=point, normal=deconstruct_plane.ZAxis)  # -> out, a; inputs crv: Curve, dist: Double, tol: Double, origin: Point3d, normal: Vector3d; disabled
# ---------- c_script_3: C# ----------
// Grasshopper Script Instance
#region Usings
using System;
using System.Linq;
using System.Collections;
using System.Collections.Generic;
using System.Drawing;

using Rhino;
using Rhino.Geometry;

using Grasshopper;
using Grasshopper.Kernel;
using Grasshopper.Kernel.Data;
using Grasshopper.Kernel.Types;
#endregion

public class Script_Instance : GH_ScriptInstance
{
    #region Notes
    /* 
      Members:
        RhinoDoc RhinoDocument
        GH_Document GrasshopperDocument
        IGH_Component Component
        int Iteration

      Methods (Virtual & overridable):
        Print(string text)
        Print(string format, params object[] args)
        Reflect(object obj)
        Reflect(object obj, string method_name)
    */
    #endregion

    private void RunScript(
		Curve crv,
		double dist,
		double tol,
		Point3d origin,
		Vector3d normal,
		ref object a)
    {
        List<double> test = new List<double>{5,10,15,20,25,30,60,70,120};
        List<Curve> alld = new List<Curve>();

        foreach(double d in test)
        {
            Curve[] offsetcrv = crv.Offset(
            origin,normal,d,tol,0.1,false,(CurveOffsetCornerStyle)1,(CurveOffsetEndStyle)0
            );
            
            a=offsetcrv;
        
        

        }

        //a=alld;

    }
}
# ---------- end c_script_3 ----------
construct_plane = ConstructPlane(Origin=addition, XAxis=cross_product.Vector, YAxis=subtraction)
panel = Panel(c_script_2.b)
number_slider_3 = Slider(187, range=0..1000)
curve_6 = Curve(<curve referenced from the Rhino model>)
boolean_toggle = BooleanToggle(True)
negative_3 = Negative(Value=series)
divide_curve = DivideCurve(Curve=curve_6, Count=10, Kinks=False)  # -> Points, Tangents, Parameters
c_script_4 = CSharpScript(crv=curve_6, dist=negative_3, tol="0.01", flip=boolean_toggle)  # -> out, a, b; inputs crv: Curve, dist: Double, tol: Double, plane: Plane, flip: Boolean; disabled
# ---------- c_script_4: C# ----------
// Grasshopper Script Instance
#region Usings
using System;
using System.Linq;
using System.Collections;
using System.Collections.Generic;
using System.Drawing;

using Rhino;
using Rhino.Geometry;

using Grasshopper;
using Grasshopper.Kernel;
using Grasshopper.Kernel.Data;
using Grasshopper.Kernel.Types;
#endregion

public class Script_Instance : GH_ScriptInstance
{
    #region Notes
    /* 
      Members:
        RhinoDoc RhinoDocument
        GH_Document GrasshopperDocument
        IGH_Component Component
        int Iteration

      Methods (Virtual & overridable):
        Print(string text)
        Print(string format, params object[] args)
        Reflect(object obj)
        Reflect(object obj, string method_name)
    */
    #endregion

    private void RunScript(
		Curve crv,
		double dist,
		double tol,
		Plane plane,
		bool flip,
		ref object a,
		ref object b)
    {
        b=plane;

        if (!plane.IsValid)
        {
            return;
        }

        //declare x,y,origin values
        Vector3d x;
        Vector3d y;
        Vector3d z;
        Point3d ori;
        Vector3d relz;

        //get end points of the curve
        Point3d startpt = crv.PointAtStart;
        Point3d endpt = crv.PointAtEnd;

        y=endpt-startpt;

        Vector3d relx = Vector3d.CrossProduct(y,Vector3d.ZAxis);
        

        relz = Vector3d.CrossProduct(relx,y);
        
        ori = startpt+(relx*100);
        //b=ori;
        
        if (plane != null)
        {
            Vector3d xaxis = plane.XAxis;
            Vector3d yaxis = plane.YAxis;
            Vector3d zaxis = plane.ZAxis;

            ori = startpt+(yaxis*100);
            relz = zaxis;


        }

        if (flip == true)
        {
            dist = dist*-1;
        }
        

        Curve[] offsetcrv = crv.Offset(
        ori,relz,dist,tol,0.1,false,(CurveOffsetCornerStyle)1,(CurveOffsetEndStyle)0
        );
        
        a=offsetcrv;


    }
}
# ---------- end c_script_4 ----------
c_script_5 = CSharpScript(crv=curve_6, dist=series, tol="0.01", origin=point, normal=deconstruct_plane.ZAxis, plane=construct_plane)  # -> out, a; inputs crv: Curve, dist: Double, tol: Double, origin: Point3d, normal: Vector3d, plane: Plane; disabled
# ---------- c_script_5: C# ----------
// Grasshopper Script Instance
#region Usings
using System;
using System.Linq;
using System.Collections;
using System.Collections.Generic;
using System.Drawing;

using Rhino;
using Rhino.Geometry;

using Grasshopper;
using Grasshopper.Kernel;
using Grasshopper.Kernel.Data;
using Grasshopper.Kernel.Types;
#endregion

public class Script_Instance : GH_ScriptInstance
{
    #region Notes
    /* 
      Members:
        RhinoDoc RhinoDocument
        GH_Document GrasshopperDocument
        IGH_Component Component
        int Iteration

      Methods (Virtual & overridable):
        Print(string text)
        Print(string format, params object[] args)
        Reflect(object obj)
        Reflect(object obj, string method_name)
    */
    #endregion

    private void RunScript(
		Curve crv,
		double dist,
		double tol,
		Point3d origin,
		Vector3d normal,
		Plane plane,
		ref object a)
    {

        if (plane == null)
        {
            plane = Plane.WorldXY;
        }

        else
        {
            Vector3d x = plane.XAxis;
            Vector3d z = plane.ZAxis;
            Point3d or = plane.Origin;
        }

        Curve[] offsetcrv = crv.Offset(
        origin,normal,dist,tol,0.1,false,(CurveOffsetCornerStyle)1,(CurveOffsetEndStyle)0
        );
        
        a=offsetcrv;


    }
}
# ---------- end c_script_5 ----------
list_item_3 = ListItem(List=divide_curve.Points, Index=0, Wrap=True)
plane_fit_3 = PlaneFit(Points=divide_curve.Points)  # -> Plane, Deviation
c_script_6 = CSharpScript(crv=curve_6, dist=negative_3, flip=boolean_toggle)  # -> out, flatten(a), b; inputs crv: Curve, dist: Double, flip: Boolean
# ---------- c_script_6: C# ----------
// Grasshopper Script Instance
#region Usings
using System;
using System.Linq;
using System.Collections;
using System.Collections.Generic;
using System.Drawing;

using Rhino;
using Rhino.Geometry;

using Grasshopper;
using Grasshopper.Kernel;
using Grasshopper.Kernel.Data;
using Grasshopper.Kernel.Types;
#endregion

public class Script_Instance : GH_ScriptInstance
{
    #region Notes
    /* 
      Members:
        RhinoDoc RhinoDocument
        GH_Document GrasshopperDocument
        IGH_Component Component
        int Iteration

      Methods (Virtual & overridable):
        Print(string text)
        Print(string format, params object[] args)
        Reflect(object obj)
        Reflect(object obj, string method_name)
    */
    #endregion

    private void RunScript(
		Curve crv,
		double dist,
		bool flip,
		ref object a,
		ref object b)
    {

        double tol  = RhinoDoc.ActiveDoc.ModelAbsoluteTolerance;
        b=tol;

        //points for plane fit
        Point3d pt1 = crv.PointAtEnd;
        Point3d pt2 = crv.PointAtStart;
        Point3d pt3 = crv.PointAtMid;

        List<Point3d> pts = new List<Point3d>{pt1,pt2,pt3};

        Plane fitPlane;

        PlaneFitResult result = Plane.FitPlaneToPoints(pts, out fitPlane);

        Vector3d xaxis = fitPlane.XAxis;
        Vector3d zaxis = fitPlane.ZAxis;

        Point3d side = pt2 + (xaxis*100);

        /*Vector3d zaxis = plane.ZAxis;
        Vector3d xaxis = plane.XAxis;

        Point3d origin = crv.PointAtStart;

        Point3d side = origin + (xaxis * 100);*/


        if (flip == true)
        {
            dist = dist*-1;
        }
        

        Curve[] offsetcrv = crv.Offset(
        side,zaxis,dist,tol,0.1,false,(CurveOffsetCornerStyle)1,(CurveOffsetEndStyle)0
        );
        
        a=offsetcrv;


    }
}
# ---------- end c_script_6 ----------
yz_plane = YZPlane(Origin=list_item_3)
list_length_2 = ListLength(List=c_script_6.a)  # disabled
number_slider_4 = Slider(7.5, range=0..10)  # disabled
range = Range(Domain=Domain(0, 1), Steps=list_length_2)  # disabled
fillet = Fillet(Curve=c_script_6.a, Radius=number_slider_4)  # disabled
rotate = Rotate(Geometry=fillet, Angle=range, Plane=yz_plane)  # -> Geometry, Transform; disabled
