# Grasshopper definition QuickShadow.gh (Grasshopper 1.0.8)

curve = Curve(<curve referenced from the Rhino model>)
trigger = Trigger(Interval=100, TimerInterval=100, Target=data_recorder)  # disabled
mesh = Mesh(<mesh referenced from the Rhino model>)
end_points = EndPoints(Curve=curve)  # -> Start, End
data_recorder = DataRecorder("1", DataLimit=-10, RecordData=True)
deconstruct_mesh = DeconstructMesh(Mesh=mesh)  # -> Vertices, Faces, Colours, Normals
mass_addition = MassAddition(Input=data_recorder)  # -> Result, PartialResults
xy_plane = XYPlane(Origin=Point(0, 0, 0))
unit_x = UnitX(Factor=mass_addition.Result)
move = Move(Geometry=end_points.Start, Motion=unit_x)  # -> Geometry, Transform
line = Line(StartPoint=move.Geometry, EndPoint=end_points.End)
panel = Panel(mass_addition.Result)
end_points_2 = EndPoints(Curve=curve)  # -> Start, End
subtraction = Subtraction(A=end_points_2.End, B=end_points_2.Start)
plane_normal = PlaneNormal(Origin=end_points_2.Start, ZAxis=subtraction)
c_script = CSharpScript(mesh=mesh, plane=plane_normal)  # -> out, a; inputs mesh: Mesh, plane: Plane
# ---------- c_script: C# ----------
// Grasshopper Script Instance
#region Usings
using System;
using System.Linq;
using System.Collections;
using System.Collections.Generic;
using System.Drawing;

using Rhino;
using Rhino.Geometry;

using Grasshopper;
using Grasshopper.Kernel;
using Grasshopper.Kernel.Data;
using Grasshopper.Kernel.Types;
#endregion

public class Script_Instance : GH_ScriptInstance
{
    #region Notes
    /* 
      Members:
        RhinoDoc RhinoDocument
        GH_Document GrasshopperDocument
        IGH_Component Component
        int Iteration

      Methods (Virtual & overridable):
        Print(string text)
        Print(string format, params object[] args)
        Reflect(object obj)
        Reflect(object obj, string method_name)
    */
    #endregion

    private void RunScript(Mesh mesh, Plane plane, ref object a)
    {
        Polyline[] outline = mesh.GetOutlines(plane);

        a = outline;
    }
}
# ---------- end c_script ----------
project_along = ProjectAlong(Geometry=c_script.a, Plane=PlaneXY(0, 0, 0), Direction=subtraction)  # -> Geometry, Transform
boundary_surfaces = BoundarySurfaces(Edges=project_along.Geometry)
data_recorder_2 = DataRecorder(boundary_surfaces, DataLimit=-10, RecordData=True)
custom_preview = CustomPreview(
    Geometry=flatten(boundary_surfaces),
    Material={diffuse=RGB(105, 105, 105), emission=RGB(66, 48, 66), shine=0.5, specular=RGB(255, 255, 255), transparency=0})
