# Grasshopper definition RandomColors.gh (Grasshopper 1.0.8)
# plug-ins: Pancake

true_only_button = TrueOnlyButton(LastSaveLocalization="neutral,N")
brep = Brep([<brep referenced from the Rhino model> x6])
c_script = CSharpScript(geo=brep, boolean=true_only_button)  # -> out, randColors, a; inputs geo: list of Guid, boolean: Boolean
# ---------- c_script: C# ----------
// Grasshopper Script Instance
#region Usings
using System;
using System.Linq;
using System.Collections;
using System.Collections.Generic;
using System.Drawing;

using Rhino;
using Rhino.Geometry;

using Grasshopper;
using Grasshopper.Kernel;
using Grasshopper.Kernel.Data;
using Grasshopper.Kernel.Types;
#endregion

public class Script_Instance : GH_ScriptInstance
{
    #region Notes
    /* 
      Members:
        RhinoDoc RhinoDocument
        GH_Document GrasshopperDocument
        IGH_Component Component
        int Iteration

      Methods (Virtual & overridable):
        Print(string text)
        Print(string format, params object[] args)
        Reflect(object obj)
        Reflect(object obj, string method_name)
    */
    #endregion

    private void RunScript(
		List<Guid> geo,
		bool boolean,
		ref object randColors,
		ref object a)
    {
        

        int objcount=  geo.Count;
        Console.WriteLine(objcount);



        Random r = new Random();
        
        
        List<string> colorspaces = new List<string>();

        foreach (Guid item in geo)
        {
            var obj = Rhino.RhinoDoc.ActiveDoc.Objects.Find(item);
            var att = obj.Attributes;

            //random values

            int red = r.Next(0,255);
            int green = r.Next(0,255);
            int blue = r.Next(0,255);
            

            string colorspace = string.Concat(red,",",green,",",blue);
            
            att.ObjectColor = System.Drawing.Color.FromArgb(red,blue,green);
            att.ColorSource = Rhino.DocObjects.ObjectColorSource.ColorFromObject;

            Rhino.RhinoDoc.ActiveDoc.Objects.ModifyAttributes(obj, att, boolean);

            Console.WriteLine(colorspace);
            colorspaces.Add(colorspace);
            
        }
        a=colorspaces;
        



        


        Rhino.RhinoDoc.ActiveDoc.Views.Redraw();

   

        //a = null;
    }
}
# ---------- end c_script ----------
c_script_2 = CSharpScript(geo=brep, boolean=true_only_button, channel=Slider(1, range=0..3))  # -> out, randColors; inputs geo: list of Guid, boolean: Boolean, channel: Int32
# ---------- c_script_2: C# ----------
// Grasshopper Script Instance
#region Usings
using System;
using System.Linq;
using System.Collections;
using System.Collections.Generic;
using System.Drawing;

using Rhino;
using Rhino.Geometry;

using Grasshopper;
using Grasshopper.Kernel;
using Grasshopper.Kernel.Data;
using Grasshopper.Kernel.Types;
#endregion

public class Script_Instance : GH_ScriptInstance
{
    #region Notes
    /* 
      Members:
        RhinoDoc RhinoDocument
        GH_Document GrasshopperDocument
        IGH_Component Component
        int Iteration

      Methods (Virtual & overridable):
        Print(string text)
        Print(string format, params object[] args)
        Reflect(object obj)
        Reflect(object obj, string method_name)
    */
    #endregion

    private void RunScript(
		List<Guid> geo,
		bool boolean,
		int channel,
		ref object randColors)
    {
        

        int objcount=  geo.Count;
        Console.WriteLine(objcount);



        Random r = new Random();
        
        
        List<string> colorspaces = new List<string>();

        foreach (Guid item in geo)
        {
            var obj = Rhino.RhinoDoc.ActiveDoc.Objects.Find(item);
            var att = obj.Attributes;



            //red channel
            if (channel==1)
            {
                int red = r.Next(5,255);
                int green = 0;
                int blue = 0;

                string colorspace = string.Concat(red,",",green,",",blue);
            
                att.ObjectColor = System.Drawing.Color.FromArgb(red,blue,green);
                att.ColorSource = Rhino.DocObjects.ObjectColorSource.ColorFromObject;

                Rhino.RhinoDoc.ActiveDoc.Objects.ModifyAttributes(obj, att, boolean);

                Console.WriteLine(colorspace);
                colorspaces.Add(colorspace);
            }

            //blue channel
            else if (channel==2)
            {
                int red = 0;
                int green = r.Next(5,255);
                int blue = 0;

                string colorspace = string.Concat(red,",",green,",",blue);

                att.ObjectColor = System.Drawing.Color.FromArgb(red,blue,green);
                att.ColorSource = Rhino.DocObjects.ObjectColorSource.ColorFromObject;

                Rhino.RhinoDoc.ActiveDoc.Objects.ModifyAttributes(obj,att,boolean);

                colorspaces.Add(colorspace);
            }

            //green channel
            else if (channel==3)
            {
                int red = 0;
                int green = 0;
                int blue = r.Next(5,255);

                string colorspace = string.Concat(red,",",green,",",blue);

                att.ObjectColor = System.Drawing.Color.FromArgb(red, blue, green);
                att.ColorSource = Rhino.DocObjects.ObjectColorSource.ColorFromObject;

                Rhino.RhinoDoc.ActiveDoc.Objects.ModifyAttributes(obj,att,boolean);

                colorspaces.Add(colorspace);
            }

            else
            {
                int red = r.Next(0,255);
                int green = r.Next(0,255);
                int blue = r.Next(0,255);

                string colorspace = string.Concat(red, ",", green, ",", blue);
                att.ObjectColor = System.Drawing.Color.FromArgb(red, blue, green);
                att.ColorSource = Rhino.DocObjects.ObjectColorSource.ColorFromObject;

                Rhino.RhinoDoc.ActiveDoc.Objects.ModifyAttributes(obj,att,boolean);

                colorspaces.Add(colorspace);
            }


            
        }
        randColors=colorspaces;
        
        //changes baked objects into the changed attributes
        Rhino.RhinoDoc.ActiveDoc.Views.Redraw();


    }
}
# ---------- end c_script_2 ----------
panel = Panel(c_script_2.randColors)
