# Grasshopper definition Rename Layers.gh (Grasshopper 1.0.8)

c_script = CSharpScript()  # -> out, a; inputs newName: String
# ---------- c_script: C# ----------
// Grasshopper Script Instance
#region Usings
using System;
using System.Linq;
using System.Collections;
using System.Collections.Generic;
using System.Drawing;

using Rhino;
using Rhino.Geometry;

using Grasshopper;
using Grasshopper.Kernel;
using Grasshopper.Kernel.Data;
using Grasshopper.Kernel.Types;
#endregion

public class Script_Instance : GH_ScriptInstance
{
    #region Notes
    /* 
      Members:
        RhinoDoc RhinoDocument
        GH_Document GrasshopperDocument
        IGH_Component Component
        int Iteration

      Methods (Virtual & overridable):
        Print(string text)
        Print(string format, params object[] args)
        Reflect(object obj)
        Reflect(object obj, string method_name)
    */
    #endregion

    private void RunScript(string newName, ref object a)
    {

        //sanity check
        if (string.IsNullOrEmpty(newName))
        {
            return;
        }

        int layerindex = Rhino.RhinoDoc.ActiveDoc.Layers.FindByFullPath("Layer 01",true);
        
        Rhino.DocObjects.Layer layer = Rhino.RhinoDoc.ActiveDoc.Layers[layerindex];
        layer.Name = "testName";

        Rhino.RhinoDoc.ActiveDoc.Layers.Modify(layer,layerindex,true);

        var alllayers =Rhino.RhinoDoc.ActiveDoc.Layers;
    


        a = null;
    }
}
# ---------- end c_script ----------
