# Grasshopper definition SelectinRhino_working.gh (Grasshopper 1.0.8)
# plug-ins: RhinoCodePluginGH, Pancake

curve = Curve([<curve referenced from the Rhino model> x3])
true_only_button = TrueOnlyButton(LastSaveLocalization="neutral,N")
guid = Guid(curve)
c_script = CSharpScript(Guid=guid, Toggle=true_only_button)  # -> out, a; inputs Guid: Guid, Toggle: Boolean
# ---------- c_script: C# ----------
// Grasshopper Script Instance
#region Usings
using System;
using System.Linq;
using System.Collections;
using System.Collections.Generic;
using System.Drawing;

using Rhino;
using Rhino.Geometry;

using Grasshopper;
using Grasshopper.Kernel;
using Grasshopper.Kernel.Data;
using Grasshopper.Kernel.Types;


using Rhino.DocObjects;
using Rhino.Collections;
using GH_IO;
using GH_IO.Serialization;
#endregion

public class Script_Instance : GH_ScriptInstance
{
    #region Notes
    /* 
      Members:
        RhinoDoc RhinoDocument
        GH_Document GrasshopperDocument
        IGH_Component Component
        int Iteration

      Methods (Virtual & overridable):
        Print(string text)
        Print(string format, params object[] args)
        Reflect(object obj)
        Reflect(object obj, string method_name)
    */
    #endregion

    private void RunScript(Guid Guid, bool Toggle, ref object a)
    {

        //Sanity checks
        if (Guid==null)
        {
            return;
        }

        //Getting active documents
        Rhino.RhinoDoc doc = Rhino.RhinoDoc.ActiveDoc;
        
        List<bool> boolean=new List<bool>(); 

        if (Toggle==true)
        {
            bool test=Rhino.RhinoDoc.ActiveDoc.Objects.Select(Guid);
            boolean.Add(test);
        }

        //Message box
        DataTree<bool>boolean_tree=new DataTree<bool>(boolean);

        List<int>count=new List<int>();
        for (int i=0; i<boolean_tree.BranchCount;i++)
        {
            count.Add(boolean_tree.Branches[i].Count);
        }

        int total_sum=count.Sum();
        Console.WriteLine(total_sum);
        string message=total_sum.ToString();
        this.Component.Message=message+" Rhino Selections.";
        //a=k;
        
        //doc.Objects.Select(x);

        

        
    }
}
# ---------- end c_script ----------
panel = Panel(c_script.a)
