# Grasshopper definition Smart Boolean Difference.gh (Grasshopper 1.0.7)

activate = BooleanToggle(True)

# ---- group: Subtract From
# ***Only works with clean geometry
# no naked edges
# no mandifolded edges
# 1. Reference Geometry
# 2. Activate using the activate toggle. This is used to prevent crashing
# 3. Check of any "bad" geo from either user error or tolerance errors.
brep = Brep([<brep referenced from the Rhino model> x1312])

# ---- group: Subtract With
brep_2 = Brep([<brep referenced from the Rhino model> x1312])

# ----
# If geo fails, change the Absolute tolerance under Options->Units-> Absolute tolerance
# from 0.01(default) to 0.0001 or higher
smart_boolean_difference = SmartBooleanDifference(brep=brep, brep_2=brep_2, boolean=activate)  # -> list, result, list_2
brep_3 = Brep(smart_boolean_difference.list)
# How many bools have failed
panel = Panel(smart_boolean_difference.result)

# ==== cluster SmartBooleanDifference
brep = ClusterInput()
brep_2 = ClusterInput()
boolean = ClusterInput()
brep_3 = Brep(brep)
brep_4 = Brep(brep_2)
boolean_2 = Boolean(boolean)
collision_one_many = CollisionOneMany(Collider=brep_4, Obstacles=brep_3)  # -> Collision, Index
create_set = CreateSet(List=collision_one_many.Index)  # -> Set, Map
member_index = MemberIndex(Set=collision_one_many.Index, Member=create_set.Set)  # -> Index, Count
list_item = ListItem(List=brep_3, Index=create_set.Set, Wrap=True)  # -> graft(Item)
list_item_2 = ListItem(List=brep_4, Index=member_index.Index, Wrap=True)
brep_5 = Brep(list_item)
brep_6 = Brep(list_item_2)
stream_gate = StreamGate(Stream=brep_5, Gate=boolean_2)  # -> Target0, Target1
stream_gate_2 = StreamGate(Stream=brep_6, Gate=boolean_2)  # -> Target0, Target1
c_recursive_boolean = CSharpScript(S=stream_gate.Target1, D=stream_gate_2.Target1)  # -> out, R, BB; inputs S: tree of Brep, D: tree of Brep
# ---------- c_recursive_boolean: C# usings ----------
using System.IO;
using System.Linq;
using System.Data;
using System.Drawing;
using System.Reflection;
using System.Windows.Forms;
using System.Xml;
using System.Xml.Linq;
using System.Runtime.InteropServices;


using System.Threading.Tasks;
using System.Collections.Concurrent;
using Rhino.DocObjects;
using Rhino.Collections;
using GH_IO;
using GH_IO.Serialization;
# ---------- c_recursive_boolean: C# ----------
    /////////////////////////////
    //written by Brian Washburn//
    //washburnarchitecture.com //
    //2018.06.06               //
    /////////////////////////////
    // Code cleanup, RIL 2020-10-17 (removed loooooong namespaces)

    var tolerance = doc.ModelAbsoluteTolerance;

    // Declare dictionaries that work in parallel to hold the successful boolean results and
    // the unsuccessful boolean cutters

    var mainBrepsMT = new ConcurrentDictionary<GH_Path, Brep>();
    var badBrepsMT = new ConcurrentDictionary<GH_Path,List<Brep>>();

    // Need to reserve a processor for GUI, otherwise we get a "Server Busy..." warning.
    // The booleaning still works, you would just have to click through the warning

    var totalMaxConcurrancy = System.Environment.ProcessorCount - 1;

    // Display us how many threads we're using

    this.Component.Message = totalMaxConcurrancy + " threads";


    // Start of the parallel engine

    Parallel.ForEach(S.Paths, new ParallelOptions {MaxDegreeOfParallelism = totalMaxConcurrancy}, pth =>
      {

      var badBrep = new List<Brep>();
      var goodBrep = new List<Brep>();
      var mainBrep = S.Branch(pth)[0];
      var diffBreps = D.Branch(pth);

      // Difference one cutter brep at a time from the main brep in the branch
      // this allows the boolean operation to continue without failing
      // and bad cutter breps can be discarded to a list that can be used for troubleshooting
      // haven't noticed a hit big hit on performance

      foreach (Brep b in diffBreps)
      {
        var breps = new Brep[]{};
        breps = Brep.CreateBooleanDifference(mainBrep, b, tolerance);
        if ((breps == null) || (breps.Length < 1))
        {
          badBrep.Add(b);
        }
        else
        {
          mainBrep = breps[0];
        }
      }
      mainBrepsMT[pth] = mainBrep;
      badBrepsMT[pth] = badBrep;
      });
    // End of the parallel engine

    // Convert dictionaries to regular old data trees

    var mainBreps = new DataTree<Brep>();
    var badBreps = new DataTree<Brep>();

    foreach(KeyValuePair<GH_Path,Brep> p in mainBrepsMT)
    {
      mainBreps.Add(p.Value, p.Key);
    }

    foreach(KeyValuePair<GH_Path, List<Brep>> b in badBrepsMT)
    {
      badBreps.AddRange(b.Value, b.Key);
    }

    // OUTPUT

    R = mainBreps;
    BB = badBreps;
# ---------- end c_recursive_boolean ----------
text = Text(c_recursive_boolean.R)
match_text = MatchText(Text=text, Pattern="Invalid Brep", Case=True)
mass_addition = MassAddition(Input=flatten(match_text))  # -> Result, PartialResults
cull_pattern = CullPattern(List=c_recursive_boolean.R, CullPattern=invert(match_text))
cull_pattern_2 = CullPattern(List=c_recursive_boolean.R, CullPattern=match_text)
list = ClusterOutput(cull_pattern)
result = ClusterOutput(mass_addition.Result)
list_2 = ClusterOutput(cull_pattern_2)
