# Grasshopper definition Triple Product working.gh (Grasshopper 1.0.8)
# plug-ins: RhinoCodePluginGH

curve = Curve(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)
evaluate_curve = EvaluateCurve(Curve=reparameterize(curve), Parameter=Slider(0.47, range=0..1))  # -> Point, Tangent, Angle
unit_z = UnitZ(Factor=1)
cross_product = CrossProduct(VectorA=evaluate_curve.Tangent, VectorB=unit_z, Unitize=False)  # -> Vector, Length
c_script = CSharpScript(Vector_A=evaluate_curve.Tangent)  # -> out, Cross_Product, Triple_Product; inputs Vector_A: Vector3d, Vector_B: Vector3d
# ---------- c_script: C# ----------
// Grasshopper Script Instance
#region Usings
using System;
using System.Linq;
using System.Collections;
using System.Collections.Generic;
using System.Drawing;

using Rhino;
using Rhino.Geometry;

using Grasshopper;
using Grasshopper.Kernel;
using Grasshopper.Kernel.Data;
using Grasshopper.Kernel.Types;
#endregion

public class Script_Instance : GH_ScriptInstance
{
    #region Notes
    /* 
      Members:
        RhinoDoc RhinoDocument
        GH_Document GrasshopperDocument
        IGH_Component Component
        int Iteration

      Methods (Virtual & overridable):
        Print(string text)
        Print(string format, params object[] args)
        Reflect(object obj)
        Reflect(object obj, string method_name)
    */
    #endregion

    private void RunScript(
	Vector3d Vector_A,
	Vector3d Vector_B,
	ref object Cross_Product,
	ref object Triple_Product)
    {
        //Triple product
        
        

        //Sanity checks

        bool vA=Vector_A.IsZero;
        bool vB=Vector_B.IsZero;

        Console.WriteLine(vA.ToString());

        if (vA==true && vB==true)
        {
            this.AddRuntimeMessage(GH_RuntimeMessageLevel.Warning,"Input failed to collect Vector A and Vector B parameter.");
            return;
        }

        if (vA==true)
        {
            this.AddRuntimeMessage(GH_RuntimeMessageLevel.Warning,"Input failed to collect Vector A.");
            return;
        }

        if(vB==true)
        {
            this.AddRuntimeMessage(GH_RuntimeMessageLevel.Warning,"Input failed to collect Vector B.");
            return;
        }

        
        //cross product #1
        Vector3d cross_1=Vector3d.CrossProduct(Vector_A,Vector_B);
        
        //cross product #2
        Vector3d cross_2=Vector3d.CrossProduct(cross_1,Vector_A);

        //outputs
        Cross_Product=cross_1;
        Triple_Product=cross_2;

        
        
    }
}
# ---------- end c_script ----------
c_script_2 = CSharpScript()  # -> out, Cross_Product, Triple_Product; inputs Vector_A: Vector3d, Vector_B: Vector3d
# ---------- c_script_2: C# ----------
// Grasshopper Script Instance
#region Usings
using System;
using System.Linq;
using System.Collections;
using System.Collections.Generic;
using System.Drawing;

using Rhino;
using Rhino.Geometry;

using Grasshopper;
using Grasshopper.Kernel;
using Grasshopper.Kernel.Data;
using Grasshopper.Kernel.Types;
#endregion

public class Script_Instance : GH_ScriptInstance
{
    #region Notes
    /* 
      Members:
        RhinoDoc RhinoDocument
        GH_Document GrasshopperDocument
        IGH_Component Component
        int Iteration

      Methods (Virtual & overridable):
        Print(string text)
        Print(string format, params object[] args)
        Reflect(object obj)
        Reflect(object obj, string method_name)
    */
    #endregion

    private void RunScript(
	Vector3d Vector_A,
	Vector3d Vector_B,
	ref object Cross_Product,
	ref object Triple_Product)
    {
        //Triple product
        
        //Sanity checks
        if (Vector_A==null || Vector_B==null)
        {
            this.AddRuntimeMessage(GH_RuntimeMessageLevel.Warning,"Input failed to collect parameter.");
            return;
        }

        

        Vector3d cross_1=Vector3d.CrossProduct(Vector_A,Vector_B);

        Vector3d cross_2=Vector3d.CrossProduct(cross_1,Vector_A);

        Cross_Product=cross_1;
        Triple_Product=cross_2;

        
        
    }
}
# ---------- end c_script_2 ----------
c_script_3 = CSharpScript(x=evaluate_curve.Tangent, y=unit_z)  # -> out, a, b; inputs x: Vector3d, y: Vector3d
# ---------- c_script_3: C# ----------
// Grasshopper Script Instance
#region Usings
using System;
using System.Linq;
using System.Collections;
using System.Collections.Generic;
using System.Drawing;

using Rhino;
using Rhino.Geometry;

using Grasshopper;
using Grasshopper.Kernel;
using Grasshopper.Kernel.Data;
using Grasshopper.Kernel.Types;
#endregion

public class Script_Instance : GH_ScriptInstance
{
    #region Notes
    /* 
      Members:
        RhinoDoc RhinoDocument
        GH_Document GrasshopperDocument
        IGH_Component Component
        int Iteration

      Methods (Virtual & overridable):
        Print(string text)
        Print(string format, params object[] args)
        Reflect(object obj)
        Reflect(object obj, string method_name)
    */
    #endregion

    private void RunScript(Vector3d x, Vector3d y, ref object a, ref object b)
    {
        //Triple product
        
        //Sanity checks
        if (x==null||y==null)
        {
            return;
        }

        Vector3d cross_1=Vector3d.CrossProduct(x,y);

        Vector3d cross_2=Vector3d.CrossProduct(cross_1,x);

        a=cross_1;
        b=cross_2;

        
        
    }
}
# ---------- end c_script_3 ----------
cross_product_2 = CrossProduct(VectorA=cross_product.Vector, VectorB=evaluate_curve.Tangent, Unitize=False)  # -> Vector, Length
vector_display = VectorDisplay(Anchor=evaluate_curve.Point, Vector=c_script_3.a)
vector_display_2 = VectorDisplay(Anchor=evaluate_curve.Point, Vector=c_script_3.b)
vector_display_3 = VectorDisplay(Anchor=evaluate_curve.Point, Vector=expr("x*5", evaluate_curve.Tangent))
vector_display_4 = VectorDisplay(Anchor=evaluate_curve.Point, Vector=expr("x*5", cross_product.Vector))
vector_display_5 = VectorDisplay(Anchor=evaluate_curve.Point, Vector=expr("x*5", cross_product_2.Vector))
vector_display_6 = VectorDisplay(Anchor=evaluate_curve.Point, Vector=expr("x*5", unit_z))
