# Grasshopper definition 2D Grid Distortion.gh (Grasshopper 1.0.8)
# plug-ins: Human

# ----
# LEGEND
# Parameters
# Basic Groups
# Inputs
# Outputs
# Exports /
# Data Outputs
# /Display
# Display
# Local Testing
# Ready to
# Organize
# In Progress /
# To Implement
data = Data()
data_2 = Data()
data_3 = Data()
data_4 = Data()
data_5 = Data()
data_6 = Data()
data_7 = Data()
data_8 = Data()
data_9 = Data()

# ----
# Feedback /
# Improvements
data_10 = Data()
# Reference
# Geometry
data_11 = Data()
number_slider = Slider(31, range=0..100)
surface = Surface(<surface referenced from the Rhino model>)
number = Number(Slider(28.91, range=0..100))
number_2 = Number(Slider(6.98, range=0..10))
divide_surface = DivideSurface(Surface=surface, UCount=number_slider, VCount=number_slider)  # -> Points, Normals, Parameters
point = Point(graft([<point referenced from the Rhino model> x5]))
point_2 = Point(divide_surface.Points)

# ---- group: Point Distort
point_3 = Point(point)

point_4 = Point(point_3)

# ----
point_5 = Point(point_2)
number_3 = Number(number)

flatten_tree = FlattenTree(Tree=point_5, Path="{0}")
distance = Distance(PointA=flatten_tree, PointB=point_4)
smaller_than = SmallerThan(FirstNumber=distance, SecondNumber=number_3)  # -> SmallerThan, OrEqualTo
sift_pattern = SiftPattern(List=flatten_tree, SiftPattern=smaller_than.SmallerThan)  # -> Output0, Output1

colour_picker = ColourPicker(PickedColour=RGB(43, 224, 67))
circle = Circle(Plane=point_4, Radius=number_3)
custom_preview_lineweights = CustomPreviewLineweights(Geometry=circle, Shader=colour_picker, Thickness=Slider(6.4, range=0..10), Absolute=False)
point_6 = Point(sift_pattern.Output1)
point_7 = Point(flatten_tree)
point_8 = Point(point_6)

flatten_tree_2 = FlattenTree(Tree=point_8, Path="{0}")
replace_nulls = ReplaceNulls(Items=flatten_tree_2, Replacements="0")  # -> Items, Count
equality = Equality(FirstNumber=replace_nulls.Items, SecondNumber="0")  # -> Equality, Inequality
sift_pattern_2 = SiftPattern(List=flatten_tree_2, SiftPattern=equality.Inequality)  # -> Output0, Output1

point_9 = Point(point_3)
point_10 = Point(point_3)
point_11 = Point(point_7)
point_12 = Point(sift_pattern_2.Output1)
point_13 = Point(point_12)

create_set = CreateSet(List=point_13)  # -> Set, Map
member_index = MemberIndex(Set=point_13, Member=create_set.Set)  # -> Index, Count
equality_2 = Equality(FirstNumber=member_index.Count, SecondNumber="1")  # -> graft(Equality), Inequality

integer = Integer(member_index.Index)
boolean = Boolean(equality_2.Equality)
boolean_2 = Boolean(boolean)

cull_pattern = CullPattern(List=member_index.Index, CullPattern=invert(boolean_2))  # disabled
list_length = ListLength(List=cull_pattern)  # disabled
panel = Panel("0")  # disabled
larger_than = LargerThan(FirstNumber=list_length, SecondNumber=panel)  # -> LargerThan, OrEqualTo; disabled
cull_pattern_2 = CullPattern(List=list_length, CullPattern=larger_than.LargerThan)  # disabled

point_14 = Point(point_12)
integer_2 = Integer(integer)
boolean_3 = Boolean(boolean)
point_15 = Point(point_6)

cull_pattern_3 = CullPattern(List=integer_2, CullPattern=invert(boolean_3))  # -> flatten(List)
replace_items = ReplaceItems(List=point_14, Indices=cull_pattern_3, Wrap=False)
unflatten_tree = UnflattenTree(Tree=replace_items, Guide=point_15)

point_16 = Point(flatten_tree)
point_17 = Point(point_2)
point_18 = Point(unflatten_tree)
point_19 = Point(point_18)

vector_2pt = Vector2Pt(PointA=point_9, PointB=point_19, Unitize=False)  # -> Vector, Length
replace_nulls_2 = ReplaceNulls(Items=vector_2pt.Vector, Replacements="{0,0,0}")  # -> Items, Count
flip_matrix = FlipMatrix(Data=replace_nulls_2.Items)
mass_addition = MassAddition(Input=flip_matrix)  # -> Result, PartialResults
flip_matrix_2 = FlipMatrix(Data=mass_addition.Result)

# ---- group: Distortion Vectors
vector = Vector(flip_matrix_2)

vector_2 = Vector(vector)

# ----
flatten_tree_3 = FlattenTree(Tree=point_10, Path="{0}")
closest_point = ClosestPoint(Point=point_11, Cloud=flatten_tree_3)  # -> ClosestPoint, CPIndex, Distance
bounds = Bounds(Numbers=closest_point.Distance)
remap_numbers = RemapNumbers(Value=closest_point.Distance, Source=bounds, Target=Domain(0, 1))  # -> Mapped, Clipped
graph_mapper = GraphMapper(
    simplify(remap_numbers.Mapped),
    x0=0,
    x1=1,
    y0=0,
    y1=1,
    container_name="Gaussian",
    factor=0.2,
    mean=0.08965091407,
    sdev=0.1220508479)
bounds_2 = Bounds(Numbers=graph_mapper)
remap_numbers_2 = RemapNumbers(Value=graph_mapper, Source=bounds_2, Target=Slider(5.75, range=-10..10))  # -> Mapped, Clipped
amplitude = Amplitude(Vector=vector_2, Amplitude=remap_numbers_2.Mapped)

vector_3 = Vector(amplitude)
vector_4 = Vector(vector_3)

move = Move(Geometry=point_16, Motion=vector_4)  # -> Geometry, Transform
unflatten_tree_2 = UnflattenTree(Tree=move.Geometry, Guide=point_17)

point_20 = Point(unflatten_tree_2)
point_21 = Point(point_20)
number_4 = Number(number_2)

flip_matrix_3 = FlipMatrix(Data=point_21)
interpolate = Interpolate(Vertices=flip_matrix_3, Degree=3, Periodic=False, KnotStyle=1)  # -> Curve, Length, Domain
extend_curve = ExtendCurve(Curve=interpolate.Curve, Type=0, Start=number_4, End=number_4)

interpolate_2 = Interpolate(Vertices=point_21, Degree=3, Periodic=False, KnotStyle=1)  # -> Curve, Length, Domain
extend_curve_2 = ExtendCurve(Curve=interpolate_2.Curve, Type=0, Start=number_4, End=number_4)
