# Grasshopper definition Centerlines from Pipe.gh (Grasshopper 1.0.8)
# plug-ins: Pancake, Sasquatch

range = Range(Domain=Domain(0, 1), Steps=Slider(12, range=0..100))
brep = Brep(<brep referenced from the Rhino model>)
true_only_button = TrueOnlyButton(LastSaveLocalization="neutral,N")
deconstruct_brep = DeconstructBrep(Brep=brep)  # -> Faces, Edges, Vertices
construct_point = ConstructPoint(XCoordinate=range, YCoordinate=0, ZCoordinate=0)
area = Area(Geometry=deconstruct_brep.Faces)  # -> Area, Centroid
select_in_document = SelectInDocument(GeometryObject=brep, Select=true_only_button, unselectSelInDoc=False)
sort_list = SortList(Keys=area.Area, ValuesValuesA=deconstruct_brep.Faces)  # -> Keys, reverse(ValuesValuesA)
list_item = ListItem(List=sort_list.ValuesValuesA, Index=0, Wrap=True)
brep_edges = BrepEdges(Brep=deconstruct_brep.Faces)  # -> Naked, Interior, NonManifold
curve = Curve(brep_edges.Naked)
join_curves = JoinCurves(Curves=curve, Preserve=False)
path_mapper = PathMapper(source="{A;B}", target="{B}")
area_2 = Area(Geometry=join_curves)  # -> Area, flatten(Centroid)
length = Length()  # -> flatten(Length)
create_set = CreateSet(List=length)  # -> Set, Map
removeduplicatepts = RemoveDuplicatePts(Points=area_2.Centroid, Tolerance=0.01)
panel = Panel(removeduplicatepts)
polyline = PolyLine(Vertices=removeduplicatepts, Closed=False)
pipe = Pipe(Curve=polyline, Radius=Slider(2.25, range=0..10), Caps=0, FitRail=False)
