# Grasshopper definition Circle Packing.gh (Grasshopper 1.0.8)
# plug-ins: Heteroptera

curve = Curve(<curve referenced from the Rhino model>)
boundary_surfaces = BoundarySurfaces(Edges=curve)
mesh_sphere = MeshSphere(Base=PlaneXY(0, 0, 0), Radius=10, UCount=10, VCount=20)
triremesh = TriRemesh(Geometry=boundary_surfaces, Length=Slider(0.2, range=0..1), Iterations=25)  # -> Triangulation, Dual, Creases
triremesh_2 = TriRemesh(Geometry=mesh_sphere, Length=Slider(1, range=0..1), Iterations=25)  # -> Triangulation, Dual, Creases
deconstruct_mesh = DeconstructMesh(Mesh=triremesh.Triangulation)  # -> Vertices, Faces, Colours, Normals
tangentincircles = TangentIncircles(Mesh=triremesh_2.Triangulation, Boundary=curve, Strength=1)
point_in_curves = PointInCurves(Point=deconstruct_mesh.Vertices, Curves=curve)  # -> Relationship, Index, Point
show = Show(G=triremesh_2.Triangulation)
larger_than = LargerThan(FirstNumber=point_in_curves.Relationship, SecondNumber="2")  # -> LargerThan, OrEqualTo
merge = Merge(Data1=show, Data2=tangentincircles)  # -> flatten(Result)
mesh_colours = MeshColours(
    Mesh=triremesh.Triangulation,
    Colours=[RGB(127, 255, 0), RGB(0, 100, 0), RGB(34, 139, 34), RGB(124, 252, 0), RGB(154, 205, 50), RGB(173, 255, 47), RGB(50, 205, 50), RGB(152, 251, 152)])
cull_pattern = CullPattern(List=deconstruct_mesh.Vertices, CullPattern=larger_than.OrEqualTo)
solver = Solver(GoalObjects=flatten(merge), Reset=Button(), Threshold=1e-15, Tolerance=0.0001, On=Toggle(False))  # -> I, V, O
list_item = ListItem(List=solver.O, Index=0, Wrap=True)
imagecircles = ImageCircles(
    Points=cull_pattern,
    Mesh=mesh_colours,
    Min=Slider(0.03, range=0..1),
    Max=Slider(0.22, range=0..1),
    Curves=curve,
    Strength=1)
tangentcircles = TangentCircles(Mesh=list_item)  # -> Incircles, CirclePacking, Dual
solver_2 = Solver(GoalObjects=imagecircles, Reset=Button(), Threshold=1e-15, Tolerance=0.0001, On=Toggle(True))  # -> I, V, O; disabled
curve_2 = Curve(tangentcircles.CirclePacking)
center = Center(Geometry=curve_2)  # -> Center, Dimension
circle = Circle(Plane=solver_2.V, Radius=solver_2.O)
c_script = CSharpScript(Pt=center.Center, M=list_item)  # -> out, a, b; inputs Pt: Point3d, M: Mesh, minDist: Double
# ---------- c_script: C# ----------
// Grasshopper Script Instance
#region Usings
using System;
using System.Linq;
using System.Collections;
using System.Collections.Generic;
using System.Drawing;

using Rhino;
using Rhino.Geometry;

using Grasshopper;
using Grasshopper.Kernel;
using Grasshopper.Kernel.Data;
using Grasshopper.Kernel.Types;
#endregion

public class Script_Instance : GH_ScriptInstance
{
    #region Notes
    /* 
      Members:
        RhinoDoc RhinoDocument
        GH_Document GrasshopperDocument
        IGH_Component Component
        int Iteration

      Methods (Virtual & overridable):
        Print(string text)
        Print(string format, params object[] args)
        Reflect(object obj)
        Reflect(object obj, string method_name)
    */
    #endregion

    private void RunScript(
		Point3d Pt,
		Mesh M,
		double minDist,
		ref object a,
		ref object b)
    {
        Point3d ProjPt;
        Vector3d N;
        minDist = 1000;

        int face = M.ClosestPoint(Pt, out ProjPt, out N, minDist);

        a = N;
        b = ProjPt;

    }
}
# ---------- end c_script ----------
vector_display = VectorDisplay(Anchor=c_script.b, Vector=c_script.a)
extrude = Extrude(Base=curve_2, Direction=c_script.a)
