# Grasshopper definition Clipper Examples.gh (Grasshopper 1.0.8)
# plug-ins: Clipper2

number_slider = Slider(58, range=0..100)
plane_surface = PlaneSurface(Plane=PlaneXY(0, 0, 0), XSize=number_slider, YSize=number_slider)
divide_surface = DivideSurface(Surface=plane_surface, UCount=10, VCount=10)  # -> flatten(Points), Normals, Parameters
point = Point(<point referenced from the Rhino model>)
closest_point = ClosestPoint(Point=divide_surface.Points, Cloud=point)  # -> ClosestPoint, CPIndex, Distance
construct_domain = ConstructDomain(DomainStart=Slider(4.12, range=0..10), DomainEnd=Slider(1.48, range=0..10))
bounds = Bounds(Numbers=closest_point.Distance)
remap_numbers = RemapNumbers(Value=closest_point.Distance, Source=bounds, Target=construct_domain)  # -> Mapped, Clipped
number_slider_2 = Slider(0.3, range=0..1)
circle = Circle(Plane=divide_surface.Points, Radius=remap_numbers.Mapped)  # -> flatten(Circle)
curve_to_polyline = CurveToPolyline(Curve=circle, ToleranceDistance=0, ToleranceAngle=0, MaxEdge=number_slider_2)  # -> Polyline, Segments
clipper2_union = Clipper2Union(Polylines=curve_to_polyline.Polyline, UnionRule=0, Precision=4)
curve = Curve(<curve referenced from the Rhino model>)
construct_domain_2 = ConstructDomain(DomainStart=0, DomainEnd=Slider(2.53, range=0..10))
curve_to_polyline_2 = CurveToPolyline(Curve=curve, ToleranceDistance=0, ToleranceAngle=0, MaxEdge=number_slider_2)  # -> Polyline, Segments
range = Range(Domain=construct_domain_2, Steps="5")
clipper2_offset = Clipper2Offset(Polylines=curve_to_polyline_2.Polyline, Distance=range, JoinType=0, EndType=3, MiterLimit=2, Precision=4)  # -> Holes, Outer, ClipperPaths
panel = Panel(curve_to_polyline_2.Polyline)
curve_2 = Curve(clipper2_offset.Outer)
