# Grasshopper definition Component Message.gh (Grasshopper 1.0.8)

c_script = CSharpScript()  # -> out, a
# ---------- c_script: C# ----------
// Grasshopper Script Instance
#region Usings
using System;
using System.Collections.Generic;
using System.IO;
using System.Windows.Forms;
using System.Linq;
using System.Text.RegularExpressions;

using Grasshopper.Kernel;
using Grasshopper.Kernel.Data;
using Grasshopper.Kernel.Types;
using GH_IO;
using GH_IO.Serialization;
using Rhino;
using Rhino.Geometry;

#endregion

public class Script_Instance : GH_ScriptInstance
{
    #region Notes
    /* 
      Members:
        RhinoDoc RhinoDocument
        GH_Document GrasshopperDocument
        IGH_Component Component
        int Iteration

      Methods (Virtual & overridable):
        Print(string text)
        Print(string format, params object[] args)
        Reflect(object obj)
        Reflect(object obj, string method_name)
    */
    #endregion

    private void RunScript(object x, object y, ref object a)
    {
        Component.Message = "test";
    }
}
# ---------- end c_script ----------
