# Grasshopper definition Fermat Spiral.gh (Grasshopper 1.0.8)

number_slider = Slider(100, range=0..100)
number_slider_2 = Slider(40, range=0..1000)
number_slider_3 = Slider(276, range=0..1000)
number_slider_4 = Slider(0.34, range=0..1)
series = Series(Start="1", Step=1, Count=number_slider_3)
series_2 = Series(Start="1", Step=1, Count=number_slider_3)
multiplication = Multiplication(A=series_2, B=Slider(2.39996, range=0..10))
expression = Expression(n=series_2, c=number_slider_4, Expression="c*Sqrt(n)*Sin(2.39996*n)")
expression_2 = Expression(n=series_2, c=number_slider_4, Expression="c*Sqrt(n)*Cos(2.39996*n)")
expression_3 = Expression(n=series, c=number_slider_4, Expression="c*Sqrt(n)*-Sin(2.39996*n)")
expression_4 = Expression(n=series, c=number_slider_4, Expression="c*Sqrt(n)*Cos(2.39996*n)")
degrees = Degrees(Radians=multiplication)
panel = Panel(degrees)
construct_point = ConstructPoint(XCoordinate=expression_2, YCoordinate=expression, ZCoordinate=0)
construct_point_2 = ConstructPoint(XCoordinate=expression_4, YCoordinate=expression_3, ZCoordinate=0)
partition_list = PartitionList(List=construct_point, Size=Slider(8, range=0..10))
circle = Circle(Plane=PlaneXY(0, 0, 0), Radius=Slider(3.06, range=0..10))
point_list = PointList(Points=construct_point_2, Size=Slider(0.03, range=0..1))
flip_matrix = FlipMatrix(Data=partition_list)
construct_point_3 = ConstructPoint(XCoordinate=0, YCoordinate=0, ZCoordinate=0)
partition_list_2 = PartitionList(List=construct_point_2, Size=Slider(8, range=0..10))
divide_curve = DivideCurve(Curve=circle, Count=10, Kinks=False)  # -> Points, Tangents, Parameters
circle_2 = Circle(Plane=flip_matrix, Radius=number_slider_4)
interpolate = Interpolate(Vertices=flip_matrix, Degree=3, Periodic=False, KnotStyle=1)  # -> Curve, Length, Domain
flip_matrix_2 = FlipMatrix(Data=partition_list_2)
area = Area(Geometry=circle_2)  # -> Area, Centroid
closest_point = ClosestPoint(Point=area.Centroid, Cloud=divide_curve.Points)  # -> ClosestPoint, CPIndex, Distance
interpolate_2 = Interpolate(Vertices=flip_matrix_2, Degree=3, Periodic=False, KnotStyle=1)  # -> Curve, Length, Domain
bounds = Bounds(Numbers=closest_point.Distance)
remap_numbers = RemapNumbers(Value=closest_point.Distance, Source=bounds, Target=Domain(0, 1))  # -> Mapped, Clipped
construct_domain = ConstructDomain(DomainStart=Slider(0.24, range=0.01..1), DomainEnd=Slider(0.79, range=0..1))
graph_mapper = GraphMapper(
    remap_numbers.Mapped,
    x0=0,
    x1=1,
    y0=0,
    y1=1,
    container_name="Gaussian",
    factor=0.2,
    mean=0.1944703907,
    sdev=0.1847313046)
bounds_2 = Bounds(Numbers=graph_mapper)
remap_numbers_2 = RemapNumbers(Value=graph_mapper, Source=bounds_2, Target=construct_domain)  # -> Mapped, Clipped
scale = Scale(Geometry=circle_2, Center=area.Centroid, Factor=remap_numbers_2.Mapped)  # -> Geometry, Transform
