# Grasshopper definition 16zu9_GH_metaball.ghx (Grasshopper 1.0.4)

slider = Slider(10, range=0..200)
point = Point(<point referenced from the Rhino model>)
curve = Curve(<curve referenced from the Rhino model>)
random = Random(Range=Domain(-10, 10), Number=slider, Seed=3, Integers=False)
random_2 = Random(Range=Domain(-10, 10), Number=slider, Seed=4, Integers=False)
random_3 = Random(Range=Domain(-10, 10), Number=slider, Seed=2, Integers=False)
perp_frames = PerpFrames(Curve=curve, Count=Slider(100, range=0..100), Align=True)  # -> Frames, Parameters
vector_xyz = VectorXYZ(XComponent=flatten(random_3), YComponent=flatten(random), ZComponent=flatten(random_2))  # -> Vector, Length
move = Move(Geometry=point, Translation=flatten(vector_xyz.Vector))
line = Line(StartPoint=point, EndPoint=move)
evaluate_curve = EvaluateCurve(Curve=line, Parameter=Slider(0.4351, range=0..20))  # -> Point, Tangent, Length
metaball_t = MetaBallT(Points=evaluate_curve.Point, Plane=perp_frames.Frames, Threshold=Slider(0.5619, range=0..10))
flatten_tree = FlattenTree(Tree=metaball_t, Path="{0}")
graft_tree = GraftTree(Tree=metaball_t, IncludeEmptyLists=True, IncludeNullItems=True)
clean_tree = CleanTree(Tree=metaball_t, CleanInvalid=True, CleanEmpty=True)
loft = Loft(Options={Adjust=False, Closed=False, LoftEnds=0, LoftSimp=0, LoftType=0, Rebuild=10, Refit=0.01})
panel = Panel(flatten_tree)
list_item = ListItem(List=flatten_tree, Index=0, Wrap=True)
shader = CreateMaterial(Diffuse=RGB(154, 205, 50), Specular=RGB(255, 255, 255), Emission=RGB(0, 0, 0), Transparency=0, Shine=0)
custom_preview = CustomPreview(Geometry=clean_tree, Material=shader)
