# Grasshopper definition Attractor Point using Orient Direction.gh (Grasshopper 0.9.76)

series = Series(Start=0, Step=Slider(6, range=0..10), Count=Slider(17, range=0..100))
series_2 = Series(Start=0, Step=Slider(6, range=0..10), Count=Slider(17, range=0..100))
construct_point = ConstructPoint(XCoordinate=series, YCoordinate=graft(series), ZCoordinate=0)
construct_point_2 = ConstructPoint(XCoordinate=series_2, YCoordinate=graft(series_2), ZCoordinate=0)
polygon = Polygon(Plane=construct_point, Radius=3, Segments=Slider(4, range=0..10), FilletRadius=0)  # -> Polygon, Length
point = Point([<point referenced from the Rhino model> x4])
polygon_2 = Polygon(Plane=construct_point_2, Radius=3, Segments=Slider(4, range=0..10), FilletRadius=0)  # -> Polygon, Length
radians = Radians(Degrees=Slider(45, range=0..100))
radians_2 = Radians(Degrees=Slider(45, range=0..100))
rotate = Rotate(Geometry=polygon.Polygon, Angle=radians, Plane=construct_point)  # -> Geometry, Transform
rotate_2 = Rotate(Geometry=polygon_2.Polygon, Angle=radians_2, Plane=construct_point_2)  # -> Geometry, Transform
negative = Negative(Value=Slider(7, range=0..10))
area = Area(Geometry=rotate_2.Geometry)  # -> Area, Centroid
vector_2pt = Vector2Pt(PointA=construct_point, PointB=point, Unitize=Slider(0, range=0..1))  # -> Vector, Length
unit_x = UnitX(Factor=1)
distance = Distance(PointA=area.Centroid, PointB=point)
area_2 = Area(Geometry=rotate.Geometry)  # -> Area, Centroid
construct_domain = ConstructDomain(DomainStart=negative, DomainEnd=Slider(0, range=0..100))
bounds = Bounds(Numbers=distance)
vector_2pt_2 = Vector2Pt(PointA=area.Centroid, PointB=point, Unitize=False)  # -> Vector, Length
remap_numbers = RemapNumbers(Value=vector_2pt.Length, Source=Domain(0, 1), Target=Domain(0, 1))  # -> Mapped, Clipped
unit_vector = UnitVector(Vector=vector_2pt.Vector)
vector_display = VectorDisplay(Anchor=area_2.Centroid, Vector=vector_2pt.Vector)
remap_numbers_2 = RemapNumbers(Value=distance, Source=bounds, Target=construct_domain)  # -> Mapped, Clipped
amplitude = Amplitude(Vector=vector_2pt_2.Vector, Amplitude=remap_numbers_2.Mapped)
construct_domain_2 = ConstructDomain(DomainStart=Slider(0.962, range=0..1), DomainEnd=Slider(0.943, range=0..1))
move = Move(Geometry=rotate_2.Geometry, Motion=amplitude)  # -> Geometry, Transform
graph_mapper = GraphMapper(remap_numbers.Mapped)
vector_display_2 = VectorDisplay(Anchor=area.Centroid, Vector=vector_2pt_2.Vector)
remap_numbers_3 = RemapNumbers(Value=graph_mapper, Source=Domain(0, 1), Target=construct_domain_2)  # -> Mapped, Clipped
orient_direction = OrientDirection(Geometry=rotate.Geometry, PointA=area_2.Centroid, DirectionA=unit_x, PointB=area_2.Centroid, DirectionB=unit_vector)  # -> Geometry, Transform
panel = Panel(remap_numbers_3.Mapped)
