# Grasshopper definition Backsplash.gh (Grasshopper 0.9.76)
# plug-ins: LunchBox

surface = Surface(<surface referenced from the Rhino model>)
surface_2 = Surface(<surface referenced from the Rhino model>)

surface_3 = Surface(<surface referenced from the Rhino model>)
surface_4 = Surface(<surface referenced from the Rhino model>)
staggered_quad_panels = StaggeredQuadPanels(Surface=surface, UDivisions=Slider(38, range=0..100), VDivisions=Slider(55, range=0..100))  # -> graft(Panels)
staggered_quad_panels_2 = StaggeredQuadPanels(Surface=surface_3, UDivisions=Slider(38, range=0..100), VDivisions=Slider(55, range=0..100))  # -> graft(Panels)
panel = Panel(staggered_quad_panels)
explode = Explode(Curve=staggered_quad_panels, Recursive=True)  # -> Segments, Vertices
panel_2 = Panel(staggered_quad_panels_2)
explode_2 = Explode(Curve=staggered_quad_panels_2, Recursive=True)  # -> Segments, Vertices
area = Area(Geometry=staggered_quad_panels)  # -> Area, Centroid
area_2 = Area(Geometry=staggered_quad_panels_2)  # -> Area, Centroid
number_slider = Slider(0.12, range=0..1)
scale = Scale(Geometry=staggered_quad_panels, Center=area.Centroid, Factor=Slider(0.95, range=0..1))  # -> Geometry, Transform
unit_x = UnitX(Factor=Slider(0.12, range=0..1))
unit_x_2 = UnitX(Factor=Slider(12, range=0..100))
scale_2 = Scale(Geometry=staggered_quad_panels_2, Center=area_2.Centroid, Factor=Slider(0.95, range=0..1))  # -> Geometry, Transform
unit_x_3 = UnitX(Factor=number_slider)
unit_y = UnitY(Factor=Slider(12, range=0..100))
extrude = Extrude(Base=surface_2, Direction=unit_x_2)
extrude_2 = Extrude(Base=scale.Geometry, Direction=unit_x)
unit_y_2 = UnitY(Factor=number_slider)
unit_x_4 = UnitX(Factor=1)
extrude_3 = Extrude(Base=surface_4, Direction=unit_y)
extrude_4 = Extrude(Base=scale_2.Geometry, Direction=unit_y_2)
unit_y_3 = UnitY(Factor=1)
negative = Negative(Value=unit_x_4)
move = Move(Geometry=extrude, Motion=negative)  # -> Geometry, Transform
negative_2 = Negative(Value=unit_y_3)
move_2 = Move(Geometry=extrude_3, Motion=negative_2)  # -> Geometry, Transform
