# Grasshopper definition BlendSrf.gh (Grasshopper 1.0.7)

slider = Slider(0.391, range=0..1)
slider_2 = Slider(0.273, range=0..1)
s1 = Surface(<surface referenced from the Rhino model>)
s2 = Surface(<surface referenced from the Rhino model>)
blendsrf = BlendSrf(
    s1=s1,
    s2=s2,
    t1=slider_2,
    t2=slider_2,
    num=Slider(27, range=0..100),
    boolean=Toggle(True),
    boolean_2=Toggle(False),
    flip=Toggle(True),
    C=2)  # -> crv_2, srf_2
loft = Loft(Options={Adjust=False, Closed=False, LoftEnds=0, LoftSimp=0, LoftType=0, Rebuild=10, Refit=0.01})
s1_2 = Surface()
s1_3 = Surface()
s2_2 = Surface()
s2_3 = Surface()
num = Integer()
num_2 = Integer()
t1 = Number()
t1_2 = Number()
t2 = Number()
t2_2 = Number()
boolean = Boolean()
boolean_2 = Boolean()
flip = Boolean()
flip_2 = Boolean()
s1_4 = Surface()
s2_4 = Surface()
num_3 = Integer()
t1_3 = Number()
t2_3 = Number()
boolean_3 = Boolean()
flip_3 = Boolean()
s1_5 = Surface()
s2_5 = Surface()
num_4 = Integer()
t1_4 = Number()
t2_4 = Number()
boolean_4 = Boolean()
flip_4 = Boolean()
s1_6 = Surface(s1_2)
s1_7 = Surface(s1_3)
s2_6 = Surface(s2_2)
s2_7 = Surface(s2_3)
num_5 = Integer(num)
num_6 = Integer(num_2)
t1_5 = Number(t1)
t1_6 = Number(t1_2)
t2_5 = Number(t2)
t2_6 = Number(t2_2)
boolean_5 = Boolean(boolean)
boolean_6 = Boolean(boolean_2)
flip_5 = Boolean(flip)
flip_6 = Boolean(flip_2)
s1_8 = Surface(s1_4)
s2_8 = Surface(s2_4)
num_7 = Integer(num_3)
t1_7 = Number(t1_3)
t2_7 = Number(t2_3)
boolean_7 = Boolean(boolean_3)
flip_7 = Boolean(flip_3)
s1_9 = Surface(s1_5)
s2_9 = Surface(s2_5)
num_8 = Integer(num_4)
t1_8 = Number(t1_4)
t2_8 = Number(t2_4)
boolean_8 = Boolean(boolean_4)
flip_8 = Boolean(flip_4)
range = Range(Domain=Domain(0, 1), Steps=num_5)
range_2 = Range(Domain=Domain(0, 1), Steps=num_6)
range_3 = Range(Domain=Domain(0, 1), Steps=num_7)
range_4 = Range(Domain=Domain(0, 1), Steps=num_8)
pt = PointXYZ(XComponent=0, YComponent=range, ZComponent=0, System=PlaneXY(0, 0, 0))
pt_2 = PointXYZ(XComponent=0, YComponent=range_2, ZComponent=0, System=PlaneXY(0, 0, 0))
pt_3 = PointXYZ(XComponent=0, YComponent=range_3, ZComponent=0, System=PlaneXY(0, 0, 0))
loft_options = LoftOptions(Closed=False, Adjust=False, Rebuild=0, Refit=0, Type=Slider(5, range=0..10))
pt_4 = PointXYZ(XComponent=0, YComponent=range_4, ZComponent=0, System=PlaneXY(0, 0, 0))
iso = IsoCurve(Surface=reparameterize(s1_6), UVPoint=pt)  # -> UIsocurve, VIsocurve
iso_2 = IsoCurve(Surface=reparameterize(s1_7), UVPoint=pt_2)  # -> UIsocurve, VIsocurve
iso_3 = IsoCurve(Surface=reparameterize(s2_6), UVPoint=pt)  # -> UIsocurve, VIsocurve
iso_4 = IsoCurve(Surface=reparameterize(s2_7), UVPoint=pt_2)  # -> UIsocurve, VIsocurve
iso_5 = IsoCurve(Surface=reparameterize(s1_8), UVPoint=pt_3)  # -> UIsocurve, VIsocurve
iso_6 = IsoCurve(Surface=reparameterize(s2_8), UVPoint=pt_3)  # -> UIsocurve, VIsocurve
iso_7 = IsoCurve(Surface=reparameterize(s1_9), UVPoint=pt_4)  # -> UIsocurve, VIsocurve
iso_8 = IsoCurve(Surface=reparameterize(s2_9), UVPoint=pt_4)  # -> UIsocurve, VIsocurve
loft_2 = Loft(Curves=blendsrf.crv_2, Options=loft_options)
filter = StreamFilter(Gate=boolean_5, Stream0=iso.UIsocurve, Stream1=iso.VIsocurve)
filter_2 = StreamFilter(Gate=boolean_6, Stream0=iso_2.UIsocurve, Stream1=iso_2.VIsocurve)
filter_3 = StreamFilter(Gate=boolean_5, Stream0=iso_3.UIsocurve, Stream1=iso_3.VIsocurve)
filter_4 = StreamFilter(Gate=boolean_6, Stream0=iso_4.UIsocurve, Stream1=iso_4.VIsocurve)
filter_5 = StreamFilter(Gate=boolean_7, Stream0=iso_5.UIsocurve, Stream1=iso_5.VIsocurve)
filter_6 = StreamFilter(Gate=boolean_7, Stream0=iso_6.UIsocurve, Stream1=iso_6.VIsocurve)
filter_7 = StreamFilter(Gate=boolean_8, Stream0=iso_7.UIsocurve, Stream1=iso_7.VIsocurve)
filter_8 = StreamFilter(Gate=boolean_8, Stream0=iso_8.UIsocurve, Stream1=iso_8.VIsocurve)
flip_9 = Flip(Curve=filter)  # -> Curve, Flag
flip_10 = Flip(Curve=filter_2)  # -> Curve, Flag
flip_11 = Flip(Curve=filter_5)  # -> Curve, Flag
flip_12 = Flip(Curve=filter_7)  # -> Curve, Flag
filter_9 = StreamFilter(Gate=flip_5, Stream0=filter, Stream1=flip_9.Curve)
filter_10 = StreamFilter(Gate=flip_6, Stream0=filter_2, Stream1=flip_10.Curve)
filter_11 = StreamFilter(Gate=flip_7, Stream0=filter_5, Stream1=flip_11.Curve)
filter_12 = StreamFilter(Gate=flip_8, Stream0=filter_7, Stream1=flip_12.Curve)
blendc = BlendCurve(CurveA=filter_9, CurveB=filter_3, BulgeA=t1_5, BulgeB=t2_5, Continuity=2)  # -> flatten(Blend)
blendc_2 = BlendCurve(CurveA=filter_10, CurveB=filter_4, BulgeA=t1_6, BulgeB=t2_6, Continuity=2)  # -> flatten(Blend)
blendc_3 = BlendCurve(CurveA=filter_11, CurveB=filter_6, BulgeA=t1_7, BulgeB=t2_7, Continuity=2)  # -> flatten(Blend)
blendc_4 = BlendCurve(CurveA=filter_12, CurveB=filter_8, BulgeA=t1_8, BulgeB=t2_8, Continuity=2)  # -> flatten(Blend)
loft_3 = Loft(Curves=blendc, Options={Adjust=False, Closed=False, LoftEnds=0, LoftSimp=0, LoftType=0, Rebuild=10, Refit=0.01})
loft_4 = Loft(Curves=blendc_2, Options={Adjust=False, Closed=False, LoftEnds=0, LoftSimp=0, LoftType=0, Rebuild=10, Refit=0.01})
loft_5 = Loft(Curves=blendc_3, Options={Adjust=False, Closed=False, LoftEnds=0, LoftSimp=0, LoftType=0, Rebuild=10, Refit=0.01})
loft_6 = Loft(Curves=blendc_4, Options={Adjust=False, Closed=False, LoftEnds=0, LoftSimp=0, LoftType=0, Rebuild=10, Refit=0.01})
crv = Curve(blendc)
crv_2 = Curve(blendc_2)
srf = Surface(loft_3)
srf_2 = Surface(loft_4)
crv_3 = Curve(blendc_3)
srf_3 = Surface(loft_5)
crv_4 = Curve(blendc_4)
srf_4 = Surface(loft_6)
crv_5 = Curve(crv)
crv_6 = Curve(crv_2)
srf_5 = Surface(srf)
srf_6 = Surface(srf_2)
crv_7 = Curve(crv_3)
srf_7 = Surface(srf_3)
crv_8 = Curve(crv_4)
srf_8 = Surface(srf_4)

# ==== cluster BlendSrf: Blend surfaces
s1 = ClusterInput()
s2 = ClusterInput()
t1 = ClusterInput()
t2 = ClusterInput()
num = ClusterInput()
boolean = ClusterInput()  # (False=X, True=Y)
boolean_2 = ClusterInput()  # (False=U, True=V)
flip = ClusterInput()
C = ClusterInput()  # Continuity of blend (0=position, 1=tangency, 2=curvature)
s2_2 = Surface(s2)
t2_2 = Number(t2)
num_2 = Integer(num)
flip_2 = Boolean(flip)
s1_2 = Surface(s1)
t1_2 = Number(t1)
boolean_3 = Boolean(boolean)
boolean_4 = Boolean(boolean_2)
C_2 = Integer(C)
range = Range(Domain=Domain(0, 1), Steps=num_2)
range_2 = Range(Domain=Domain(0, 1), Steps=num_2)
pt = PointXYZ(XComponent=0, YComponent=range_2, ZComponent=0, System=PlaneXY(0, 0, 0))
pt_2 = PointXYZ(XComponent=range, YComponent=0, ZComponent=0, System=PlaneXY(0, 0, 0))
filter = StreamFilter(Gate=boolean_3, Stream0=pt_2, Stream1=pt)
iso = IsoCurve(Surface=reparameterize(s1_2), UVPoint=filter)  # -> UIsocurve, VIsocurve
iso_2 = IsoCurve(Surface=reparameterize(s2_2), UVPoint=filter)  # -> UIsocurve, VIsocurve
filter_2 = StreamFilter(Gate=boolean_4, Stream0=iso.UIsocurve, Stream1=iso.VIsocurve)
filter_3 = StreamFilter(Gate=boolean_4, Stream0=iso_2.UIsocurve, Stream1=iso_2.VIsocurve)
flip_3 = Flip(Curve=filter_2)  # -> Curve, Flag
loft_options = LoftOptions(Closed=False, Adjust=False, Rebuild=0, Refit=0, Type=Slider(5, range=0..10))
filter_4 = StreamFilter(Gate=flip_2, Stream0=filter_2, Stream1=flip_3.Curve)
blendc = BlendCurve(CurveA=filter_4, CurveB=filter_3, BulgeA=t1_2, BulgeB=t2_2, Continuity=C_2)  # -> flatten(Blend)
loft = Loft(Curves=blendc, Options=loft_options)
crv = Curve(blendc)
srf = Surface(loft)
crv_2 = ClusterOutput(crv)
srf_2 = ClusterOutput(srf)
