# Grasshopper definition CirclePackingRadiusSetotheroptions.ghx (Grasshopper 0.9.76)

crv = Curve(<curve referenced from the Rhino model>)
crv_2 = Curve(<curve referenced from the Rhino model>)
crv_3 = Curve(<curve referenced from the Rhino model>)
crv_4 = Curve([<curve referenced from the Rhino model> x5])

end = EndPoints(Curve=crv)  # -> Start, End
ln = Line(PointA=end.Start, PointB=end.End)
cen = Center(Arc=crv)  # -> Center, Radius
cen_2 = Center(Arc=crv_2)  # -> Center, Radius
crv_cp = CurveCP(Point=cen.Center, Curve=ln)  # -> Point, Parameter, Distance
curvepoint = PointOnCurve(ln, parameter=0.5)
sph = Sphere(Base=cen.Center, Radius=cen.Radius)
dist = Distance(PointA=cen.Center, PointB=crv_cp.Point)
sph_2 = Sphere(Base=cen_2.Center, Radius=cen_2.Radius)
Y = UnitY(Factor=1)
dom = Domain(DomainStart=expr("-x", cen.Radius), DomainEnd=cen.Radius)
dom_2 = Domain(DomainStart=expr("-x", cen.Radius), DomainEnd=dist)
pl = PlaneNormal(Origin=curvepoint, ZAxis=Y)
xy = XYPlane(Origin=Point(0, 0, 0))
box = IntervalBox(Base=cen.Center, X=dom, Y=dom_2, Z=dom)
trim = TrimSolid(Shape=sph, Cutters=box)
sdiff = SolidDifference(FirstSet=trim, SecondSet=sph_2)
orient = Orient(Geometry=sdiff, Initial=pl, Final=xy)

cen_3 = Center(Arc=crv_3)  # -> Center, Radius
pcomp = Decompose(Point=cen_3.Center)  # -> XComponent, YComponent, ZComponent
Y_2 = UnitY(Factor=expr("-x", pcomp.YComponent))
move = Move(Geometry=crv_4, Translation=Y_2)
circle = Circle(move)
number_of_circles = Slider(200, range=0..1000)
panel = Panel("""0.5
1.0
1.5
5""")
crv_5 = Curve([<curve referenced from the Rhino model> x2])
outline = Curve(<curve referenced from the Rhino model>)
# Dôme
geo = Geometry(sdiff)
vb = VBScript(
    C=outline,
    N=number_of_circles,
    R=panel,
    distfront=Slider(0, range=0..10),
    interdist=Slider(0, range=0..10),
    rand=Slider(56387, range=0..1000000),
    PreCircles=crv_5,
    MaxTries=Slider(7718, range=0..100000))  # -> out, A; inputs C: Curve, R: list, PreCircles: list
# ---------- vb: VB ----------
    If (C Is Nothing) Then Return
    If (N <= 0) Then Return

    If (Not C.IsClosed()) Then
      Print("Your input curve is not closed.")
      Return
    End If

    Dim bbox As BoundingBox = C.GetBoundingBox(False)
    Dim U As New Interval(bbox.Min.X, bbox.Max.X)
    Dim V As New Interval(bbox.Min.Y, bbox.Max.Y)

    Dim rnd As New Random(rand)

    Dim circles As New List(Of Circle)
    For Each cir As Circle In PreCircles
      circles.Add(cir)
    Next
    Dim attempts As Int32 = 0

    Do While (attempts < 10000)
      attempts += 1

      Dim radius As Double = R(rnd.Next(R.Count))
      Dim point As New Point3d(U.ParameterAt(rnd.NextDouble()), V.ParameterAt(rnd.NextDouble()), 0)

      If (C.Contains(point, Plane.WorldXY) <> Rhino.Geometry.PointContainment.Inside) Then Continue Do
      Dim ct As Double
      C.ClosestPoint(point, ct)
      Dim cp As Point3d = C.PointAt(ct)

      If (point.DistanceTo(cp) < radius + distfront) Then Continue Do

      For Each crc As Circle In circles
        If (point.DistanceTo(crc.Center) <= (crc.Radius + radius + interdist)) Then Continue Do
      Next

      Dim circle As New Circle(point, radius)
      circles.add(circle)
      If (circles.Count >= N) Then Exit Do
      attempts = 0
    Loop

    A = circles
# ---------- end vb ----------
# Dôme aligné/origine
geo_2 = Geometry(orient)
explode = BrepComponents(Brep=orient)  # -> Faces, Edges, Vertices
item = ListItem(List=explode.Edges, Index=0, Wrap=False)
crv_6 = Curve(circle)

number_of_circles_2 = Slider(200, range=0..1000)
outline_2 = Curve(item)
panel_2 = Panel("""25
30
35""")
vb_2 = VBScript(
    C=outline_2,
    N=number_of_circles_2,
    R=panel_2,
    distfront=Slider(10, range=0..10),
    interdist=Slider(0, range=0..10),
    rand=Slider(56387, range=0..1000000),
    PreCircles=crv_6)  # -> out, A; inputs C: Curve, R: list, PreCircles: list; same code as vb

scale = Scale(Geometry=item, Center=Point(0, 0, 0), Factor=1.5)
# Ouvertures
# Points génération voronois
geo_3 = Geometry(vb_2.A)

lng = ListLength(List=vb_2.A)
lng_2 = ListLength(List=crv_6)
series = Series(Start=0, Step=1, Count=lng)
cen_4 = Center(Arc=crv_6)  # -> Center, Radius
larger = LargerThan(FirstNumber=series, SecondNumber=expr("x-1", lng_2))  # -> LargerThan, OrEqualTo
cull = CullPattern(List=vb_2.A, CullPattern=larger.LargerThan)
scale_2 = Scale(Geometry=crv_6, Center=cen_4.Center, Factor=Slider(0.6, range=0..1))
crv_7 = Curve(cull)
divide = DivideCurve(Curve=scale, Number=100, Kinks=False)  # -> Points, Tangents, Parameters
cen_5 = Center(Arc=crv_7)  # -> Center, Radius
cen_6 = Center(Arc=crv_6)  # -> Center, Radius
divlength = DivideLength(Curve=scale_2, Length=20)  # -> Points, Tangents, Parameters
pt = Point(flatten([divide.Points, cen_5.Center, cen_6.Center, divlength.Points]))
voronoi = Voronoi(Points=flatten(pt), Plane=PlaneXY(0, 0, 0), BruteForceOverride=False)

geo_4 = Geometry(pt)
# Voronois
geo_5 = Geometry(voronoi)
con = Containment(Point=graft(pt), Curve=crv_6)  # -> Relationship, Point
equals = Equality(FirstNumber=con.Relationship, SecondNumber=2)  # -> Equality, Inequality
ma = MassAddition(Input=equals.Equality)  # -> Result, PartialResult
flatten = FlattenTree(Data=ma.Result, Path="{0}")
equals_2 = Equality(FirstNumber=flatten, SecondNumber=lng_2)  # -> Equality, Inequality
scale_3 = Scale(Geometry=outline_2, Center=Point(0, 0, 0), Factor=1.05)
dispatch = Dispatch(List=voronoi, DispatchPattern=equals_2.Equality)  # -> ListA, ListB
xy_2 = XYPlane(Origin=Point(0, 0, 0))
runion = RegionUnion(Curves=dispatch.ListB, Plane=xy_2)
rint = RegionIntersection(GroupA=runion, GroupB=scale_3, Plane=xy_2)
rint_2 = RegionIntersection(GroupA=dispatch.ListA, GroupB=outline_2, Plane=xy_2)
Z = UnitZ(Factor=200)
move_2 = Move(Geometry=rint_2, Translation=Z)
Z_2 = UnitZ(Factor=200)
move_3 = Move(Geometry=rint, Translation=Z_2)

crv_8 = Curve(move_2)
crv_9 = Curve(move_3)

# ----
# Voronois filtrés
geo_6 = Geometry([crv_8, crv_9])

cpoly = ControlPolygon(Curve=crv_9)  # -> Polygon, Points
disc = Discontinuity(Curve=crv_8, Level=1)  # -> Points, Parameters
pline = PolyLine(Vertices=disc.Points, Closed=True)
explode_2 = Explode(Curve=flatten(pline), Recursive=True)  # -> Segments, Vertices
redpline = Reduce(Polyline=cpoly.Polygon, Tolerance=Slider(5.5, range=0..20))  # -> Polyline, Reduction
shift = ShiftList(List=explode_2.Vertices, Shift=1, Wrap=False)
curvepoint_2 = PointOnCurve(explode_2.Segments, parameter=0.5)
path_mapper = PathMapper(shift, source="{A;B;C}", target="{A;B}")
explode_3 = Explode(Curve=redpline.Polyline, Recursive=True)  # -> Segments, Vertices
# Voronois filtrés offset+simplifiés
merge = Merge(StreamA=curvepoint_2, StreamB=path_mapper)
curvepoint_3 = PointOnCurve(explode_3.Segments, parameter=0.375)
crv_cp_2 = CurveCP(Point=merge, Curve=graft(crv_8))  # -> Point, Parameter, Distance
sort = SortList(Keys=crv_cp_2.Parameter, ValuesA=merge)  # -> List, ValuesA
area = BrepArea(Brep=crv_8)  # -> Area, Centroid
crv_10 = Curve(Vertices=curvepoint_3, Degree=2, Periodic=True)  # -> Curve, Length, Domain
crv_11 = Curve(Vertices=sort.ValuesA, Degree=3, Periodic=True)  # -> Curve, Length, Domain
area_2 = BrepArea(Brep=crv_9)  # -> Area, Centroid
scale_4 = Scale(Geometry=crv_11.Curve, Center=graft(area.Centroid), Factor=Slider(0.87, range=0..1))
scale_5 = Scale(Geometry=crv_10.Curve, Center=graft(area_2.Centroid), Factor=Slider(0.95, range=0..1))

geo_7 = Geometry([scale_4, scale_5])

Z_3 = UnitZ(Factor=-400)
extr = Extrude(Base=flatten(scale_4), Direction=Z_3)
Z_4 = UnitZ(Factor=-400)
extr_2 = Extrude(Base=flatten(scale_5), Direction=Z_4)
cap = CapHoles(Brep=extr_2)
cap_2 = CapHoles(Brep=extr)
trim_2 = TrimSolid(Shape=orient, Cutters=cap)
trim_3 = TrimSolid(Shape=trim_2, Cutters=cap_2)

# ----
# Dôme trim par extrusions
# Extrusion Voronois
geo_8 = Geometry([cap_2, cap])
geo_9 = Geometry(trim_3)
