# Grasshopper definition ComputationalMethods_Midterm_FINAL REFERENCE (1).gh (Grasshopper 0.9.76)

number_slider = Slider(8, range=0..10)
curve = Curve(<curve referenced from the Rhino model>)
explode = Explode(Curve=curve, Recursive=True)  # -> Segments, Vertices
hexagonal = Hexagonal(Plane=PlaneXY(0, 0, 0), Size=Slider(10, range=0..10), ExtentX=number_slider, ExtentY=number_slider)  # -> Cells, Points
list_item = ListItem(List=explode.Vertices, Index=Slider(4, range=0..10), Wrap=True)
join_curves = JoinCurves(Curves=explode.Segments, Preserve=False)
pi = Pi(Factor=1)
list_item_2 = ListItem(List=explode.Segments, Index=0, Wrap=True)
division = Division(A=pi, B=Slider(2, range=0..10))
divide_curve = DivideCurve(Curve=list_item_2, Count=Slider(2, range=0..10), Kinks=False)  # -> Points, Tangents, Parameters
rotate = Rotate(Geometry=hexagonal.Cells, Angle=division, Plane=PlaneXY(0, 0, 0))  # -> Geometry, Transform
list_item_3 = ListItem(List=divide_curve.Points, Index=Slider(1, range=0..10), Wrap=True)
area = Area(Geometry=rotate.Geometry)  # -> Area, Centroid
list_item_4 = ListItem(List=divide_curve.Points, Index=Slider(1, range=0..1), Wrap=True)
radians = Radians(Degrees=Slider(180, range=0..1000))
series = Series(Start=0, Step=Slider(2, range=0..10), Count=10)
explode_2 = Explode(Curve=rotate.Geometry, Recursive=True)  # -> Segments, Vertices

list_item_5 = ListItem(List=explode_2.Vertices, Index=Slider(3, range=0..10), Wrap=True)
list_item_6 = ListItem(List=explode_2.Vertices, Index=Slider(2, range=0..10), Wrap=True)
list_item_7 = ListItem(List=explode_2.Vertices, Index=Slider(4, range=0..10), Wrap=True)
list_item_8 = ListItem(List=explode_2.Vertices, Index=Slider(1, range=0..1), Wrap=True)
list_item_9 = ListItem(List=explode_2.Vertices, Index=Slider(5, range=0..10), Wrap=True)
list_item_10 = ListItem(List=explode_2.Vertices, Index=Slider(0, range=0..100), Wrap=True)
point = Point(list_item_10)
point_2 = Point(list_item_8)

rotate_2 = Rotate(Geometry=join_curves, Angle=radians, Plane=list_item_4)  # -> Geometry, Transform
curve_2 = Curve(curve)
unit_x = UnitX(Factor=series)
line = Line(StartPoint=list_item_3, EndPoint=list_item)
unit_x_2 = UnitX(Factor=Slider(0.5, range=0..1))
panel = Panel(curve_2)
move = Move(Geometry=[rotate_2.Geometry, curve_2], Motion=unit_x)  # -> Geometry, Transform
move_2 = Move(Geometry=line, Motion=unit_x_2)  # -> Geometry, Transform
point_3 = Point(list_item_8)
move_3 = Move(Geometry=line, Motion=unit_x)  # -> Geometry, Transform
unit_x_3 = UnitX(Factor=Slider(1, range=0..1))
move_4 = Move(Geometry=move_2.Geometry, Motion=unit_x)  # -> Geometry, Transform
graft_tree = GraftTree(Tree=move.Geometry, IncludeEmptyLists=True, IncludeNullItems=True)
unit_y = UnitY(Factor=Slider(2, range=0..10))
panel_2 = Panel(explode_2.Vertices)
number_slider_2 = Slider(6, range=0..10)
move_5 = Move(Geometry=graft_tree, Motion=unit_y)  # -> Geometry, Transform
move_away_from = MoveAwayFrom(Distance=10)  # -> Geometry, Transform
move_6 = Move(Geometry=move_5.Geometry, Motion=unit_x_3)  # -> Geometry, Transform
series_2 = Series(Start=0, Step=Slider(4, range=0..10), Count=number_slider_2)
series_3 = Series(Start=0, Step=Slider(4, range=0..10), Count=number_slider_2)
unit_y_2 = UnitY(Factor=1)
list_item_11 = ListItem(List=explode_2.Segments, Index=Slider(4, range=0..10), Wrap=True)
list_item_12 = ListItem(List=explode_2.Segments, Index=Slider(1, range=0..1), Wrap=True)
number_slider_3 = Slider(2, range=0..10)
unit_y_3 = UnitY(Factor=series_3)
unit_y_4 = UnitY(Factor=series_2)
join_curves_2 = JoinCurves(Curves=[move_3.Geometry, move_4.Geometry], Preserve=False)
divide_curve_2 = DivideCurve(Curve=list_item_11, Count=number_slider_3, Kinks=False)  # -> Points, Tangents, Parameters
divide_curve_3 = DivideCurve(Curve=list_item_12, Count=number_slider_3, Kinks=False)  # -> Points, Tangents, Parameters
move_7 = Move(Geometry=graft_tree, Motion=unit_y_3)  # -> Geometry, Transform
move_8 = Move(Geometry=move_6.Geometry, Motion=unit_y_4)  # -> Geometry, Transform
line_2 = Line(StartPoint=point, EndPoint=list_item_5)
number_slider_4 = Slider(4, range=0..10)
panel_3 = Panel("""0
1
0""")
move_9 = Move(Geometry=join_curves_2, Motion=unit_y)  # -> Geometry, Transform
number_slider_5 = Slider(4, range=0..10)
explode_3 = Explode(Curve=move_7.Geometry, Recursive=True)  # -> Segments, Vertices
panel_4 = Panel(move_7.Geometry)
explode_4 = Explode(Curve=move_8.Geometry, Recursive=True)  # -> Segments, Vertices
move_10 = Move(Geometry=move_9.Geometry, Motion=unit_x_3)  # -> Geometry, Transform
cull_pattern = CullPattern(List=divide_curve_2.Points, CullPattern=panel_3)
cull_pattern_2 = CullPattern(List=divide_curve_3.Points, CullPattern=panel_3)
panel_5 = Panel(explode_4.Vertices)
number_slider_6 = Slider(2, range=0..10)
list_item_13 = ListItem(List=explode_4.Segments, Index=0, Wrap=True)
point_4 = Point(cull_pattern_2)
list_item_14 = ListItem(List=explode_3.Segments, Index=0, Wrap=True)
point_5 = Point(cull_pattern_2)
point_6 = Point(cull_pattern)
point_7 = Point(cull_pattern)
panel_6 = Panel("""0
1
0""")
number_slider_7 = Slider(1, range=0..1)
line_3 = Line(StartPoint=point_6, EndPoint=point_5)
divide_curve_4 = DivideCurve(Curve=list_item_13, Count=number_slider_6, Kinks=False)  # -> Points, Tangents, Parameters
divide_curve_5 = DivideCurve(Curve=list_item_14, Count=number_slider_6, Kinks=False)  # -> Points, Tangents, Parameters
divide_curve_6 = DivideCurve(Curve=line_3, Count=Slider(3, range=0..10), Kinks=False)  # -> Points, Tangents, Parameters
list_item_15 = ListItem(List=explode_3.Vertices, Index=number_slider_5, Wrap=True)
panel_7 = Panel("""0
1""")
cull_pattern_3 = CullPattern(List=divide_curve_4.Points, CullPattern=panel_6)
cull_pattern_4 = CullPattern(List=divide_curve_5.Points, CullPattern=panel_6)
list_item_16 = ListItem(List=explode_4.Vertices, Index=number_slider_5, Wrap=True)
curve_curve = CurveCurve(CurveA=line_3, CurveB=line_2)  # -> Points, ParamsA, ParamsB
curve_curve_2 = CurveCurve(CurveA=line_3, CurveB=line_2)  # -> Points, ParamsA, ParamsB

list_item_17 = ListItem(List=divide_curve_6.Points, Index=Slider(2, range=0..10), Wrap=True)
list_item_18 = ListItem(List=divide_curve_6.Points, Index=Slider(1, range=0..10), Wrap=True)

cull_pattern_5 = CullPattern(List=flatten(list_item_15), CullPattern=panel_7)  # -> graft(List)
panel_8 = Panel(divide_curve_6.Points)
cull_pattern_6 = CullPattern(List=flatten(list_item_16), CullPattern=panel_7)  # -> graft(List)
list_item_19 = ListItem(List=divide_curve_6.Points, Index=0, Wrap=True)
point_8 = Point(list_item_18)
point_9 = Point(<point referenced from the Rhino model>)
panel_9 = Panel(list_item_15)
panel_10 = Panel(list_item_16)
negative = Negative(Value=Slider(0, range=0..100))
distance = Distance(PointA=flatten(list_item_17), PointB=point_9)
panel_12 = Panel(cull_pattern_5)
construct_domain = ConstructDomain(DomainStart=negative, DomainEnd=Slider(6.608, range=0..10))
bounds = Bounds(Numbers=distance)
vector_2pt = Vector2Pt(PointA=curve_curve_2.Points, PointB=divide_curve_6.Points, Unitize=False)  # -> Vector, Length
panel_13 = Panel(cull_pattern_4)
remap_numbers = RemapNumbers(Value=graft(distance), Source=bounds, Target=construct_domain)  # -> Mapped, Clipped
point_10 = Point(cull_pattern_4)
point_11 = Point(cull_pattern_3)
point_12 = Point(cull_pattern_5)
point_13 = Point(cull_pattern_6)
amplitude = Amplitude(Vector=vector_2pt.Vector, Amplitude=remap_numbers.Mapped)
move_11 = Move(Geometry=curve_curve_2.Points, Motion=amplitude)  # -> Geometry, Transform
move_12 = Move(Geometry=graft(move_10.Geometry), Motion=unit_y_4)  # -> Geometry, Transform
move_13 = Move(Geometry=graft(join_curves_2), Motion=unit_y_3)  # -> Geometry, Transform

explode_5 = Explode(Curve=move_13.Geometry, Recursive=True)  # -> Segments, Vertices
explode_6 = Explode(Curve=move_12.Geometry, Recursive=True)  # -> Segments, Vertices

list_item_20 = ListItem(List=explode_5.Vertices, Index=Slider(2, range=0..10), Wrap=True)
list_item_21 = ListItem(List=move_11.Geometry, Index=Slider(0, range=0..100), Wrap=True)
point_14 = Point()
panel_14 = Panel(move_11.Geometry)
point_15 = Point(explode_6.Vertices)
list_item_22 = ListItem(List=point_15, Index=Slider(0, range=0..1), Wrap=True)
list_item_23 = ListItem(List=explode_6.Segments, Index=Slider(1, range=0..1), Wrap=True)
list_item_24 = ListItem(List=explode_5.Segments, Index=0, Wrap=True)
list_item_25 = ListItem(List=explode_5.Segments, Index=Slider(1, range=0..1), Wrap=True)
list_item_26 = ListItem(List=explode_6.Segments, Index=0, Wrap=True)
list_item_27 = ListItem(List=move_11.Geometry, Index=Slider(3, range=0..3), Wrap=True)
line_4 = Line(list_item_26)
text_join = TextJoin()
construct_domain_2 = ConstructDomain(DomainStart=0, DomainEnd=1)
_4point_surface = _4PointSurface(CornerA=list_item_27, CornerB=point, CornerC=point_2, CornerD=point_4)
_4point_surface_2 = _4PointSurface(CornerA=list_item_21, CornerB=point, CornerC=list_item_9, CornerD=point_7)
line_5 = Line(StartPoint=point_7, EndPoint=point_5)
vector_2pt_2 = Vector2Pt(Unitize=False)  # -> Vector, Length
divide_curve_7 = DivideCurve(Curve=line_4, Count=Slider(2, range=0..10), Kinks=False)  # -> Points, Tangents, Parameters
list_item_28 = ListItem(List=explode_5.Vertices, Index=Slider(2, range=0..10), Wrap=True)
list_item_29 = ListItem(List=point_15, Index=Slider(0, range=0..1), Wrap=True)
brep_join = BrepJoin(Breps=[_4point_surface_2, _4point_surface])  # -> Breps, Closed
panel_15 = Panel("""0
1""")
panel_16 = Panel(brep_join.Breps)
cull_pattern_7 = CullPattern(List=divide_curve_7.Points, CullPattern=panel_15)
distance_2 = Distance(PointA=flatten(cull_pattern_7), PointB=point_14)
bounds_2 = Bounds(Numbers=distance_2)
remap_numbers_2 = RemapNumbers(Value=distance_2, Source=bounds_2, Target=construct_domain_2)  # -> Mapped, Clipped
amplitude_2 = Amplitude(Vector=vector_2pt_2.Vector, Amplitude=remap_numbers_2.Mapped)
cull_index = CullIndex(Wrap=True)
xz_plane = XZPlane(Origin=Point(0, 0, 0))
radians_2 = Radians(Degrees=Slider(180, range=0..1000))
rotate_3 = Rotate(Geometry=brep_join.Breps, Angle=radians_2, Plane=curve_curve_2.Points)  # -> Geometry, Transform
move_14 = Move(Geometry=cull_pattern_7, Motion=amplitude_2)  # -> Geometry, Transform
