# Grasshopper definition Curve Array Example.gh (Grasshopper 1.0.7)

curve = Curve(<curve referenced from the Rhino model>)
curve_2 = Curve(<curve referenced from the Rhino model>)
flip_curve = FlipCurve(Curve=curve_2)  # -> Curve, Flag
curve_array = CurveArray(Geometry=curve, Curve=flip_curve.Curve, Count=Slider(8, range=0..100))  # -> Geometry, Transform
