# Grasshopper definition Diamond Tower Jeddeh.gh (Grasshopper 1.0.4)
# plug-ins: LunchBox

number_slider = Slider(100, range=0..100)
number_slider_2 = Slider(8, range=0..100)
number_slider_3 = Slider(57, range=0..100)
number_slider_4 = Slider(2, range=0..10)
series = Series(Start=0, Step=number_slider_4, Count=number_slider_3)
addition = Addition(A=number_slider_2, B=Slider(8, range=0..10))
unit_z = UnitZ(Factor=series)
construct_domain = ConstructDomain(DomainStart=Slider(0, range=0..100), DomainEnd=Slider(167, range=0..360))
unit_z_2 = UnitZ(Factor=Slider(19, range=0..100))
subtraction = Subtraction(A=number_slider_3, B=Slider(1, range=0..1))
multiplication = Multiplication(A=number_slider_4, B=subtraction)
cylinder = Cylinder(Base=PlaneXY(0, 0, 0), Radius=number_slider_2, Length=multiplication)
cap_holes = CapHoles(Brep=cylinder)
quad_panels = QuadPanels(Surface=cylinder, UDivisions=Slider(18, range=0..100), VDivisions=Slider(10, range=0..100))
circle = Circle(Plane=PlaneXY(0, 0, 0), Radius=addition)
range = Range(Domain=construct_domain, Steps=subtraction)
radians = Radians(Degrees=range)
number_slider_5 = Slider(8, range=0..10)
addition_2 = Addition(A=number_slider_2, B=number_slider_5)
polygon = Polygon(Plane=PlaneXY(0, 0, 0), Radius=addition_2, Segments=Slider(4, range=0..10), FilletRadius=0)  # -> Polygon, Length
circle_2 = Circle(Plane=PlaneXY(0, 0, 0), Radius=addition_2)
move = Move(Geometry=polygon.Polygon, Motion=unit_z)  # -> Geometry, Transform
move_2 = Move(Geometry=circle_2, Motion=unit_z_2)  # -> Geometry, Transform
loft = Loft(
    Curves=[move_2.Geometry, circle],
    Options={Adjust=False, Closed=False, LoftEnds=0, LoftSimp=0, LoftType=0, Rebuild=10, Refit=0.01})
cap_holes_2 = CapHoles(Brep=loft)
rotate = Rotate(Geometry=move.Geometry, Angle=radians, Plane=PlaneXY(0, 0, 0))  # -> Geometry, Transform
explode = Explode(Curve=rotate.Geometry, Recursive=True)  # -> Segments, Vertices
list_item = ListItem(List=explode.Vertices, Index=0, Wrap=True)
list_item_2 = ListItem(List=explode.Vertices, Index=Slider(1, range=0..1), Wrap=True)
list_item_3 = ListItem(List=explode.Vertices, Index=Slider(2, range=0..10), Wrap=True)
list_item_4 = ListItem(List=explode.Vertices, Index=Slider(3, range=0..10), Wrap=True)
flatten_tree = FlattenTree(Tree=list_item, Path="{0}")
flatten_tree_2 = FlattenTree(Tree=list_item_2, Path="{0}")
flatten_tree_3 = FlattenTree(Tree=list_item_3, Path="{0}")
flatten_tree_4 = FlattenTree(Tree=list_item_4, Path="{0}")
interpolate = Interpolate(Vertices=flatten_tree, Degree=3, Periodic=False, KnotStyle=1)  # -> Curve, Length, Domain
interpolate_2 = Interpolate(Vertices=flatten_tree_2, Degree=3, Periodic=False, KnotStyle=1)  # -> Curve, Length, Domain
interpolate_3 = Interpolate(Vertices=flatten_tree_3, Degree=3, Periodic=False, KnotStyle=1)  # -> Curve, Length, Domain
interpolate_4 = Interpolate(Vertices=flatten_tree_4, Degree=3, Periodic=False, KnotStyle=1)  # -> Curve, Length, Domain
number_slider_6 = Slider(4, range=0..10)

curve = Curve(interpolate.Curve)
perp_frame = PerpFrame(Curve=curve, Parameter=Slider(0, range=0..10))
rectangle = Rectangle(Plane=perp_frame, XSize=number_slider_6, YSize=number_slider_5, Radius=0)  # -> Rectangle, Length
sweep1 = Sweep1(Rail=curve, Sections=rectangle.Rectangle, Miter=1)

perp_frame_2 = PerpFrame(Curve=interpolate_2.Curve, Parameter=Slider(0, range=0..10))
rectangle_2 = Rectangle(Plane=perp_frame_2, XSize=number_slider_6, YSize=number_slider_5, Radius=0)  # -> Rectangle, Length
sweep1_2 = Sweep1(Rail=interpolate_2.Curve, Sections=rectangle_2.Rectangle, Miter=1)
cap_holes_3 = CapHoles(Brep=sweep1_2)

number_slider_7 = Slider(4, range=0..10)
perp_frame_3 = PerpFrame(Curve=interpolate_4.Curve, Parameter=Slider(0, range=0..10))
rectangle_3 = Rectangle(Plane=perp_frame_3, XSize=number_slider_6, YSize=number_slider_5, Radius=0)  # -> Rectangle, Length
sweep1_3 = Sweep1(Rail=interpolate_4.Curve, Sections=rectangle_3.Rectangle, Miter=1)

number_slider_8 = Slider(4, range=0..10)
perp_frame_4 = PerpFrame(Curve=interpolate_3.Curve, Parameter=Slider(0, range=0..10))
rectangle_4 = Rectangle(Plane=perp_frame_4, XSize=number_slider_6, YSize=number_slider_5, Radius=0)  # -> Rectangle, Length
sweep1_4 = Sweep1(Rail=interpolate_3.Curve, Sections=rectangle_4.Rectangle, Miter=1)

cap_holes_4 = CapHoles(Brep=sweep1)
cap_holes_5 = CapHoles(Brep=sweep1_4)
cap_holes_6 = CapHoles(Brep=sweep1_3)
solid_difference = SolidDifference(BrepsA=[cap_holes_4, cap_holes_3, cap_holes_5, cap_holes_6], BrepsB=cap_holes_2)
