# Grasshopper definition 000_simpleframes.gh (Grasshopper 0.9.64)
# plug-ins: Millipede

mat = MillC_StockSupportType(X=True, Y=True, Z=True, RX=True, RY=True, RZ=True)
mat_2 = Material(MaterialType=2)
pt = Point([<point referenced from the Rhino model> x2])
crv = Curve([<curve referenced from the Rhino model> x236])
csection = MillC_CrossSection(Material=mat_2, InnerRadius=0.09, Thickness=0.01, CrossSectionType=1)
fepointsupports = FEPointSupports(Point=pt, SupportType=mat)
fcurves = FrameCurves(Curves=crv, CrossSection=csection, LinearLoad=Vector(0, 0, 0), SupportType=0)

fe_system = FESystem(
    ModelComponents=[fcurves, fepointsupports],
    IntersectAddedCurves=True,
    MergeTolerance=0.0001,
    MinimumCurveSpan=0.05,
    MaximumCurveSpan=10000,
    CurveTolerance=0.1)
fe_solver = FESolver(
    FEModel=fe_system,
    SelfWeightCoefficient=Slider(1, range=0..1),
    BeamOptimisationIterations=0,
    QuadOptimisationIterations=0,
    OptimizationTarget=0.3,
    OptimizationPenalization=2,
    LoadCase=0,
    AllCases=True)  # -> FEModel, MaxDeflection, Weight

division = Division(A=Slider(1.35, range=0..9), B=fe_solver.MaxDeflection)
frame_visualization = FrameVisualization(
    FEModel=fe_solver.FEModel,
    DetailedOutput=True,
    Deflection=division,
    Inflation=Slider(0.602, range=0..1),
    Subdivision=Slider(0.145, range=0..1),
    Range="-20000000 to 20000000",
    OptScale=Toggle(False),
    ColorMode=8)  # -> Curves, Meshes, CompleteRange, VisibleRange
result_range = Panel(frame_visualization.CompleteRange)
result_visible_range = Panel(frame_visualization.VisibleRange)
preview = CustomPreview(Geometry=frame_visualization.Meshes, Shader=ColourSwatch(SwatchColor=RGB(78, 151, 204)))
