# Grasshopper definition 000_simpleframes_eigenmodes.gh (Grasshopper 0.9.64)
# plug-ins: Millipede

pipeline = GeometryPipeline(
    GroupByLayer=False,
    GroupByType=False,
    IncludeHidden=True,
    IncludeLocked=True,
    LayerFilter="crv",
    NameFilter="*",
    TypeFilter=4)
mat = MillC_StockSupportType(X=True, Y=True, Z=True, RX=True, RY=True, RZ=True)
mat_2 = Material(MaterialType=2)
pt = Point([<point referenced from the Rhino model> x2])
csection = MillC_CrossSection(Material=mat_2, Width=Slider(0.05, range=0..2), Height=Slider(0.05, range=0..10), Thickness=0.01, CrossSectionType=5)
fepointsupports = FEPointSupports(Point=pt, SupportType=mat)
fcurves = FrameCurves(Curves=pipeline, CrossSection=csection, LinearLoad=Vector(0, 0, 0), SupportType=0)

fe_system = FESystem(
    ModelComponents=[fcurves, fepointsupports],
    IntersectAddedCurves=True,
    MergeTolerance=0.0001,
    MinimumCurveSpan=0.05,
    MaximumCurveSpan=10000,
    CurveTolerance=0.1)
fe_solver = FESolver(
    FEModel=fe_system,
    SelfWeightCoefficient=Slider(1, range=0..1),
    BeamOptimisationIterations=0,
    QuadOptimisationIterations=0,
    OptimizationTarget=0.3,
    OptimizationPenalization=2,
    LoadCase=0,
    AllCases=True)  # -> FEModel, MaxDeflection, Weight

division = Division(A=Slider(0, range=0..9), B=fe_solver.MaxDeflection)
frame_visualization = FrameVisualization(
    FEModel=fe_solver.FEModel,
    DetailedOutput=True,
    Deflection=division,
    Inflation=Slider(0, range=0..1),
    Subdivision=Slider(0.145, range=0..1),
    Range="-20000000 to 20000000",
    OptScale=Toggle(False),
    ColorMode=8)  # -> Curves, Meshes, CompleteRange, VisibleRange
result_range = Panel(frame_visualization.CompleteRange)
result_visible_range = Panel(frame_visualization.VisibleRange)
preview = CustomPreview(Geometry=frame_visualization.Meshes, Shader=ColourSwatch(SwatchColor=RGB(78, 151, 204)))

c_script = CSharpScript(
    fe=fe_solver.FEModel,
    y=Slider(100, range=0..500),
    Reference=["C:\Users\pan\AppData\Roaming\Grasshopper\Libraries\Sawapansolversnet.dll", "C:\Users\pan\AppData\Roaming\Grasshopper\Libraries\SawapanStatRhino.dll", "C:\Users\pan\AppData\Roaming\Grasshopper\Libraries\SawapanStatica.dll"])  # -> out, A, B; inputs y: Int32
# ---------- c_script: C# ----------
    RStatSystem sys = fe as RStatSystem;

    BigEigenSystem be = sys.GetGlobalEigenSystem(y);
    
    List<Point3d> p = new List<Point3d>();
    foreach (RStatNode n in sys.Nodes) {
      p.Add(n.p.ToPoint3d());
    }

    A = be;
    B = p;
# ---------- end c_script ----------
c_script_2 = CSharpScript(
    e=c_script.A,
    p=c_script.B,
    du=Slider(-20.3, range=-40..40),
    vi=Slider(59, range=0..100),
    Reference=["C:\Users\pan\AppData\Roaming\Grasshopper\Libraries\Sawapansolversnet.dll", "C:\Users\pan\AppData\Roaming\Grasshopper\Libraries\SawapanStatRhino.dll", "C:\Users\pan\AppData\Roaming\Grasshopper\Libraries\SawapanStatica.dll"])  # -> out, A; inputs p: list of Point3d, du: Double, vi: Int32
# ---------- c_script_2: C# ----------
    BigEigenSystem be = e as BigEigenSystem;

    BigVector v = be.EigenVectorNormalized(vi);
    if (v == null) return;
    
    for(int i = 0; i < p.Count; ++i) {
      Point3d pp = p[i];
      pp.X += v.U[i*6]*du;
      pp.Y += v.U[i*6+1]*du;
      pp.Z += v.U[i*6+2]*du;
      
      p[i] = pp;
    }

    A = p;
# ---------- end c_script_2 ----------
c_script_3 = CSharpScript(
    fe=fe_solver.FEModel,
    p=c_script_2.A,
    r=Slider(0.063, range=0..1),
    Reference=["C:\Users\pan\AppData\Roaming\Grasshopper\Libraries\Sawapansolversnet.dll", "C:\Users\pan\AppData\Roaming\Grasshopper\Libraries\SawapanStatRhino.dll", "C:\Users\pan\AppData\Roaming\Grasshopper\Libraries\SawapanStatica.dll"])  # -> out, A; inputs p: list of Point3d, r: Double
# ---------- c_script_3: C# ----------
    RStatSystem sys = fe as RStatSystem;

    //List<Line> ln = new List<Line>();

    Mesh ms = new Mesh();
    Mesh cm = Mesh.CreateFromCylinder(new Cylinder(new Circle(1.0), 1.0), 1, 5);

    foreach (RStatBeam b in sys.Beams) {

      Mesh cc = cm.DuplicateMesh();

      //ln.Add(new Line(p[b.Node0.id], p[b.Node1.id]));

      Point3d p0 = p[b.Node0.id];
      Point3d p1 = p[b.Node1.id];

      Vector3d vz = p1 - p0;
      double vzl = vz.Length;
      
      vz *= (1.0 / vzl);
      
      Vector3d vy = Vector3d.ZAxis;
      if (Math.Abs(vz.Z) > 0.8) vy = Vector3d.YAxis;
      
      Vector3d vx = Vector3d.CrossProduct(vy, vz);
      vx.Unitize();
      
      vy = Vector3d.CrossProduct(vz, vx);
      vy.Unitize();
      
      vx *= r;
      vy *= r;
      vz *= vzl;

      // Plane p2 = new Plane(b.Csys.O.ToPoint3d(), b.Csys.Ey.ToVector3d(), b.Csys.Ez.ToVector3d());
      //Transform t = Transform.PlaneToPlane(Plane.WorldXY, p2);

      Transform t = new Transform(1.0);
      t.M00 = vx.X;
      t.M10 = vx.Y;
      t.M20 = vx.Z;

      t.M01 = vy.X;
      t.M11 = vy.Y;
      t.M21 = vy.Z;

      t.M02 = vz.X;
      t.M12 = vz.Y;
      t.M22 = vz.Z;

      t.M03 = p0.X;
      t.M13 = p0.Y;
      t.M23 = p0.Z;

      cc.Transform(t);

      ms.Append(cc);
    }

    A = ms;
# ---------- end c_script_3 ----------
preview_2 = CustomPreview(Geometry=c_script_3.A, Shader=ColourSwatch(SwatchColor=RGB(158, 158, 158)))
