# Grasshopper definition 000_simpleframes_upvector.gh (Grasshopper 0.9.64)
# plug-ins: Millipede

mat = Material(MaterialType=2)
csection = MillC_CrossSection(Material=mat, Width=Slider(0.366, range=0..1), Height=Slider(1, range=0..1), Thickness=0.01, CrossSectionType=5)

crv = Curve([<curve referenced from the Rhino model> x3])
crv_2 = Curve(<curve referenced from the Rhino model>)
domcomp = DomainComponents(Domain=crv_2)  # -> Start, End
end = EndPoints(Curve=crv)  # -> Start, End
eval = EvaluateCurve(Curve=crv_2, Parameter=domcomp.Start)  # -> Point, Tangent, Angle
frame_element = FeFrameElement(P0=end.Start, P1=end.End, CrossSection=csection, LinearLoad=Vector(0, 0, 0), UpVector=eval.Tangent)

pt = Point([<point referenced from the Rhino model> x2])
mat_2 = MillC_StockSupportType(X=True, Y=True, Z=True, RX=True, RY=True, RZ=True)
fepointsupports = FEPointSupports(Point=pt, SupportType=mat_2)

fe_system = FESystem(
    ModelComponents=[fepointsupports, frame_element],
    IntersectAddedCurves=True,
    MergeTolerance=0.0001,
    MinimumCurveSpan=0.05,
    MaximumCurveSpan=10000,
    CurveTolerance=0.1)
fe_solver = FESolver(
    FEModel=fe_system,
    SelfWeightCoefficient=1,
    BeamOptimisationIterations=0,
    QuadOptimisationIterations=0,
    OptimizationTarget=0.3,
    OptimizationPenalization=2,
    LoadCase=0,
    AllCases=True)  # -> FEModel, MaxDeflection, Weight

division = Division(A=Slider(0, range=0..9), B=fe_solver.MaxDeflection)
frame_visualization = FrameVisualization(
    FEModel=fe_solver.FEModel,
    DetailedOutput=Toggle(True),
    Deflection=division,
    Inflation=Slider(0, range=0..1),
    Subdivision=Slider(0.145, range=0..1),
    OptScale=False,
    ColorMode=0)  # -> Curves, Meshes, CompleteRange, VisibleRange
preview = CustomPreview(Geometry=frame_visualization.Meshes, Shader=ColourSwatch(SwatchColor=RGB(78, 151, 204)))
