# Grasshopper definition 001_Curvedframes.gh (Grasshopper 0.9.64)
# plug-ins: Millipede

mat = Material(MaterialType=2)
crv = Curve([<curve referenced from the Rhino model> x15])
csection = MillC_CrossSection(Material=mat, InnerRadius=0.09, Thickness=0.01, CrossSectionType=1)
fcurves = FrameCurves(Curves=crv, CrossSection=csection, LinearLoad=Vector(0, 0, 0), SupportType=0)

pt = Point([<point referenced from the Rhino model> x5])
mat_2 = MillC_StockSupportType(X=True, Y=True, Z=True, RX=True, RY=True, RZ=True)
fepointsupports = FEPointSupports(Point=pt, SupportType=mat_2)

fe_system = FESystem(
    ModelComponents=[fcurves, fepointsupports],
    IntersectAddedCurves=True,
    MergeTolerance=0.0001,
    MinimumCurveSpan=0.05,
    MaximumCurveSpan=10000,
    CurveTolerance=0.1)
fe_solver = FESolver(
    FEModel=fe_system,
    SelfWeightCoefficient=Slider(1, range=0..1),
    BeamOptimisationIterations=0,
    QuadOptimisationIterations=0,
    OptimizationTarget=0.3,
    OptimizationPenalization=2,
    LoadCase=0,
    AllCases=True)  # -> FEModel, MaxDeflection, Weight

division = Division(A=Slider(0, range=0..9), B=fe_solver.MaxDeflection)
frame_visualization = FrameVisualization(
    FEModel=fe_solver.FEModel,
    DetailedOutput=Toggle(True),
    Deflection=division,
    Inflation=Slider(1, range=0..1),
    Subdivision=Slider(0.261, range=0..1),
    OptScale=False,
    ColorMode=4)  # -> Curves, Meshes, CompleteRange, VisibleRange
preview = CustomPreview(Geometry=frame_visualization.Meshes, Shader=ColourSwatch(SwatchColor=RGB(78, 151, 204)))
