# Grasshopper definition 00_EigenModesVisualization.gh (Grasshopper 0.9.64)
# plug-ins: Millipede

mesh = Mesh(<mesh referenced from the Rhino model>)
eigensystem = EigenSystem(Mesh=mesh, EigenModes=-1)  # -> Eigensys, Modes, Dimensions, EigenValues

# ----
# EigenValues
eigenvalues = QuickGraph(eigensystem.EigenValues)

list = ValueList({"noColor": 0, "RedBlue": 1, "Grey": 2, "GreyAbs": 3}, selected="RedBlue")

number_slider = Slider(7, range=0..10)
series = Series(Start=0, Step=1, Count=Slider(49, range=0..65))
mesh_visualization = MeshVisualization(EigenSystem=eigensystem.Eigensys, Selector=series, Displacement=Slider(0, range=-3..6), ColorMode=list)  # -> Mesh, Values

number_slider_2 = Slider(21.748, range=0..40)
integer_division = IntegerDivision(A=series, B=number_slider)
mod = Modulus(A=series, B=number_slider)
multiplication = Multiplication(A=mod, B=number_slider_2)
multiplication_2 = Multiplication(A=integer_division, B=number_slider_2)
vec = VectorXYZ(XComponent=multiplication, YComponent=multiplication_2, ZComponent=0)  # -> Vector, Length

move = Move(Geometry=mesh_visualization.Mesh, Motion=vec.Vector)  # -> Geometry, Transform
preview = CustomPreview(Geometry=move.Geometry, Shader=ColourSwatch(SwatchColor=RGB(150, 150, 150)))
