# Grasshopper definition 01_EigenSmoothing.gh (Grasshopper 0.9.64)
# plug-ins: Millipede

mesh = Mesh(<mesh referenced from the Rhino model>)
eigensystem = EigenSystem(Mesh=mesh, EigenModes=-1)  # -> Eigensys, Modes, Dimensions, EigenValues

spectral_filter = SpectralFilter(EigenSystem=eigensystem.Eigensys, M0=Slider(0, range=0..200), M1=Slider(3, range=0..200))
preview = CustomPreview(Geometry=spectral_filter, Shader=ColourSwatch(SwatchColor=RGB(186, 186, 186)))
