# Grasshopper definition 02_EigenDisplacement.gh (Grasshopper 0.9.64)
# plug-ins: Millipede

mesh = Mesh(<mesh referenced from the Rhino model>)
eigensystem = EigenSystem(Mesh=mesh, EigenModes=-1)  # -> Eigensys, Modes, Dimensions, EigenValues

genes = GenePool(
    Decimals=4,
    Maximum=1,
    Minimum=-1,
    Value=[0.2691, 1, -0.9308, -0.0546, 0.1745, 0.0728, 0.0254, 0.2546, 1, -0.0254, 0.52, -1, 0.7818, 0, 1, -0.5273, 1, 1, 1, -0.8])
displace_by_spectrum = DisplaceBySpectrum(EigenSystem=eigensystem.Eigensys, Spectrum=genes, Displacement=Slider(26.94, range=-14..57))  # -> Mesh, Values
preview = CustomPreview(Geometry=displace_by_spectrum.Mesh, Shader=ColourSwatch(SwatchColor=RGB(186, 186, 186)))

extract_eigenvector = ExtractEigenVector(EigenSystem=eigensystem.Eigensys, Selector=Slider(11, range=0..25))  # -> V, Λ
graph = QuickGraph(extract_eigenvector.V)
