# Grasshopper definition 01_ParabolicVaults.gh (Grasshopper 0.9.64)
# plug-ins: Millipede

panel = Panel("Mesh input surface")

support_breps = Brep([<brep referenced from the Rhino model> x2])
srf = Surface(<surface referenced from the Rhino model>)
mesh_uv = MeshSurface(Surface=srf, UCount=Slider(20, range=0..60), VCount=Slider(20, range=0..60), Overhang=False, Equalize=True)

x_height = Slider(-0.448, range=-1..1)
degree_x = Slider(1, range=0.5..3)
y_height = Slider(-0.402, range=-1..1)
hypar = Slider(0.15, range=-1..1)
degree_y = Slider(1, range=0.5..3)
# parametrically deform  surface mesh according to the formula defined inside the C# component.
# 
# the scrollbars determine the degree and strength of the parabolar in the X and Y directions
mcomp = Decompose(Mesh=mesh_uv)  # -> Vertices, Faces, Colours, Normals
inmul = InsideMultiple(Brep=support_breps, Point=mcomp.Vertices, Strict=False)  # -> Inside, Index
c_script = CSharpScript(m=mesh_uv, spp=inmul.Inside, a=x_height, b=y_height, c=hypar, d1=degree_x, d2=degree_y)  # -> out, A, B, C; inputs m: Mesh, spp: list of Boolean, a: Double, b: Double, c: Double, d1: Double, d2: Double
# ---------- c_script: C# ----------
    //create lists for support and load points
    List<Point3d> SupportPoints = new List<Point3d>();
    List<Point3d> LoadPoints = new List<Point3d>();

    //loop through all vertices in the mesh m,
    //we are going to move each vertex along its normal by an amount given 
    //by the equation d=a*(x^2d1)+b*(y^2d2)+c*x*y;
    //this means that along X we'll get parabolas of degree 2xd1 and along Y parabolas of degree 2xd2
    //the last term adds an antisymmetric displacement 
    for(int i = 0; i < m.Vertices.Count; ++i) {
      Point3d p = new Point3d(m.Vertices[i]);   //get point at vertex i
      Vector3d n = new Vector3d(m.Normals[i]);  //get normal at vertex i

      double x = p.X; //get x and y coordinates [just to make expression more readable] 
      double y = p.Y;

      //compute displacement for vertex i
      double deformation = a * Math.Pow(x * x, d1) + b * Math.Pow(y * y, d2) + c * x * y;
      
      //compute new position for vertex i by adding its normal to its iniital position multiplied by the deformation factor
      p = p + n * deformation;
      //set vertex coordinates to new point
      m.Vertices.SetVertex(i, p);

      //if vertex i is a support add its location to the list of supports otherwise add it to the list of loads
      if (spp[i]) {
        SupportPoints.Add(p);
      }
      else {
        LoadPoints.Add(p);
      }
    }

    //update mesh normals. Since we changed the geometry of the mesh the normals now are different
    m.FaceNormals.ComputeFaceNormals();
    m.Normals.ComputeNormals();

    //et outputs
    A = m;
    B = SupportPoints;
    C = LoadPoints;
# ---------- end c_script ----------

toggle = BooleanToggle(False)
pt = Point(c_script.B)
# set up the analysis model
mat = Material(MaterialType=2)
Z = UnitZ(Factor=Slider(-943.088, range=-10000..1))
mat_2 = MillC_StockSupportType(X=True, Y=True, Z=True, RX=toggle, RY=toggle, RZ=toggle)
femesh = FEMesh(Meshes=c_script.A, Material=mat, Thickness=Slider(0.25, range=0..1), AreaLoad=Vector(0, 0, 0), NormalAreaLoad=0)
fepointsupports = FEPointSupports(Point=pt, SupportType=mat_2)
fepointload = FEPointLoad(Point=c_script.C, Load=Z)
selfweight = Slider(0, range=0..1)
fea_system = FEASystem(
    ModelComponents=flatten([femesh, fepointsupports, fepointload]),
    IntersectAddedCurves=True,
    MergeTolerance=0.0001,
    MinimumCurveSpan=0.05,
    MaximumCurveSpan=10000,
    CurveTolerance=0.1)
fe_solver = FESolver(
    FEModel=fea_system,
    SelfWeightCoefficient=selfweight,
    BeamOptimisationIterations=0,
    QuadOptimisationIterations=0,
    OptimizationTarget=0.3,
    OptimizationPenalization=2,
    LoadCase=0,
    AllCases=True)  # -> FEModel, MaxDeflection, Weight

deflection = Panel(fe_solver.MaxDeflection)
# here the galapagos optimization component is linked to the scrollbars [inputs] and will try to minimize the maximum deflection of the structure by modifying the shape through these scrollbars
galapagos = Galapagos(fitness=fe_solver, gene=[x_height, y_height, hypar, degree_x, degree_y])
panel_2 = Panel("Visualization")

deflection_2 = Slider(0, range=0..1)
plane = Slider(1, range=-1..1)
division = Division(A=deflection_2, B=fe_solver.MaxDeflection)
mesh_visualization = MeshVisualization(FEModel=fe_solver.FEModel, Deflection=division, Plane=plane, ShowThickness=Toggle(False), ColorMode=2)  # -> Mesh, CompleteRange, VisibleRange

scale = BooleanToggle(True)
lambda = BooleanToggle(False)
omega = Slider(8.448, range=0..11)
iter = Slider(6481, range=0..21618)
stress_pattern = StressPattern(
    FEModel=fe_solver.FEModel,
    Omega=omega,
    Scalefield=scale,
    Uselambda=lambda,
    Smoothfactor=0,
    SmoothModulo=1,
    Iterations=iter,
    MeshDenisty=2,
    Layer=1,
    Thickness=0,
    Bending=Toggle(False))
curves = Curves(System=stress_pattern)
