# Grasshopper definition 020_bridge_02.gh (Grasshopper 0.9.64)
# plug-ins: Millipede

slider = Slider(-0.062, range=-3..3)
slider_2 = Slider(-1.455, range=-3..3)
slider_3 = Slider(1.959, range=-3..3)
slider_4 = Slider(-1.363, range=-3..3)
panel = Panel("Geometry Generation")
c_script = CSharpScript(p1=slider_2, p2=slider_3, p3=slider, p4=slider_4)  # -> out, A, B; inputs p1: Double, p2: Double, p3: Double, p4: Double
# ---------- c_script: C# ----------
    //Create an empty list in which to store the curve points
    List<Point3d> pp = new List<Point3d>();

    //Number of points to sample along the curve
    int nu = 40;
    //sampling step along curve in normalized coordinates. That is nu steps of dt will give us 1.0
    double dt = 1.0 / (double) (nu - 1.0);

    //Loop that evaluates the curve formula at different parameters t
    //and adds the generated points to the list pp
    for(int i = 0; i < nu; ++i) {
      double t = i * dt;  //parameter t of current steps

      //...................................curve formulas
      //The curve propagates along x from -10 to +10
      double x = -10.0 + t * 20.0;
      //it forms a wave in the y direction of amplitude p1 and frequency p3
      double y = p1 * Math.Cos(2.0 * t * Math.PI * p3);
      //it forms a wave in the z direction of amplitude p2 and frequency p4
      double z = p2 * Math.Cos(2.0 * t * Math.PI * p4);

      //add point with coordinates x,y,z to list pp
      pp.Add(new Point3d(x, y, z));
    }

    //Create a smooth interpolated curve from the points in the list pp
    Curve nc = NurbsCurve.CreateInterpolatedCurve(pp, 3);

    //Create a list of points that we will use later to designate support locations
    List<Point3d> sp = new List<Point3d>();
    //add the endpoints of the newly created curve nc to the list of support locations
    sp.Add(nc.PointAtStart);
    sp.Add(nc.PointAtEnd);

    //Output the curve nc and the support points sp
    A = nc;
    B = sp;
# ---------- end c_script ----------
mesh = Mesh(<mesh referenced from the Rhino model>)

galapagos = Galapagos(fitness=fe_solver, gene=[slider_2, slider_3, slider, slider_4])

# ----
# Generation of struts and mirroring of curves
slider_5 = Slider(28, range=0..45)
divide = DivideCurve(Curve=c_script.A, Count=slider_5, Kinks=False)  # -> Points, Tangents, Parameters
pt = Point([<point referenced from the Rhino model> x43])
cp = ClosestPoint(Point=divide.Points, Cloud=pt)  # -> ClosestPoint, CPIndex, Distance
xz = XZPlane(Origin=Point(0, 0, 0))
ln = Line(StartPoint=divide.Points, EndPoint=cp.ClosestPoint)
mirror = Mirror(Geometry=flatten([c_script.A, ln]), Plane=xz)  # -> Geometry, Transform

mat = Material(MaterialType=2)
csection = MillC_CrossSection(Material=mat, InnerRadius=Slider(0.058, range=0..1), Thickness=0.01, CrossSectionType=1)
fcurves = FrameCurves(Curves=flatten([mirror.Geometry, c_script.A, ln]), CrossSection=csection, LinearLoad=Vector(0, 0, 0), SupportType=0)

mirror_2 = Mirror(Geometry=flatten(c_script.B), Plane=xz)  # -> Geometry, Transform
mat_2 = MillC_StockSupportType(X=True, Y=True, Z=True, RX=True, RY=True, RZ=True)
fepointsupports = FEPointSupports(Point=flatten([mirror_2.Geometry, c_script.B]), SupportType=mat_2)

mat_3 = Material(MaterialType=5)
femesh = FEMesh(Meshes=mesh, Material=mat_3, Thickness=Slider(0.23, range=0..1), AreaLoad=Vector(0, 0, 0), NormalAreaLoad=0)

fea_system = FEASystem(
    ModelComponents=[fcurves, fepointsupports, femesh],
    IntersectAddedCurves=True,
    MergeTolerance=0.0001,
    MinimumCurveSpan=0.05,
    MaximumCurveSpan=10000,
    CurveTolerance=0.1)
fe_solver = FESolver(
    FEModel=fea_system,
    SelfWeightCoefficient=1,
    BeamOptimisationIterations=0,
    QuadOptimisationIterations=0,
    OptimizationTarget=0.3,
    OptimizationPenalization=2,
    LoadCase=0,
    AllCases=True)  # -> FEModel, MaxDeflection, Weight

division = Division(A=Slider(0, range=0..3), B=fe_solver.MaxDeflection)
mesh_visualization = MeshVisualization(FEModel=fe_solver.FEModel, Deflection=division, Plane=1, Range="0 to 50000000", ShowThickness=Toggle(True), ColorMode=4)  # -> Mesh, CompleteRange, VisibleRange
frame_visualization = FrameVisualization(
    FEModel=fe_solver.FEModel,
    DetailedOutput=Toggle(True),
    Deflection=division,
    Inflation=Slider(0, range=0..1),
    Subdivision=0.1,
    Range="0 to 50000000",
    OptScale=False,
    ColorMode=8)  # -> Curves, Meshes, CompleteRange, VisibleRange
