# Grasshopper definition 02_WaveFunctions.gh (Grasshopper 0.9.64)
# plug-ins: Millipede

srf = Surface(<surface referenced from the Rhino model>)
support_breps = Brep([<brep referenced from the Rhino model> x2])

support_breps_2 = Brep([<brep referenced from the Rhino model> x2])
srf_2 = Surface(<surface referenced from the Rhino model>)

support_breps_3 = Brep(<brep referenced from the Rhino model>)
srf_3 = Surface(<surface referenced from the Rhino model>)

# ----
# here the galapagos optimization component is linked to the scrollbars [inputs] and will try to minimize the maximum deflection of the structure by modifying the shape through these scrollbars
# parametrically deform  surface mesh according to the formula defined inside the C# component.
# 
# the scrollbars determine amplitudes, frequencies, phases and rotations of two planar waves
# Mesh input surface:
# Here we create a custom C# surface meshing component because we want to transfer the UV coordinates of each vertex on the initial surface.
# this is so that the deormations we describe will wrap around curved surfaces instead of operating on the XY projection of the vertices
# set up the analysis model
c_script = CSharpScript(s=srf, ru=Slider(39, range=0..60), rv=Slider(40, range=0..60))  # -> out, A; inputs s: Surface, ru: Int32, rv: Int32
# ---------- c_script: C# ----------
    Mesh m = Mesh.CreateFromPlane(Plane.WorldXY, s.Domain(0), s.Domain(1), ru - 1, rv - 1);

    for(int i = 0; i < m.Vertices.Count; ++i) {
      double u = m.Vertices[i].X;
      double v = m.Vertices[i].Y;
      m.TextureCoordinates.SetTextureCoordinate(i, 2.0 * (s.Domain(0).NormalizedParameterAt(u) - 0.5), 2.0 * (s.Domain(1).NormalizedParameterAt(v) - 0.5));
      m.Vertices.SetVertex(i, s.PointAt(u, v));
      m.Normals.SetNormal(i, s.NormalAt(u, v));
    }

    A = m;
# ---------- end c_script ----------
galapagos = Galapagos(fitness=fe_solver, gene=[amp1, freq1, rot1, amp2])
panel = Panel("Visualization")

mcomp = Decompose(Mesh=c_script.A)  # -> Vertices, Faces, Colours, Normals
amp1 = Slider(0.81, range=0..1)
freq1 = Slider(1.118, range=0..5)
rot1 = Slider(-0.031, range=-4..4)
phase1 = Slider(0.571, range=-4..4)
amp2 = Slider(0.528, range=0..0.7)
freq2 = Slider(8, range=0..8)
rot2 = Slider(1.479, range=-4..4)
phase2 = Slider(0.395, range=-4..4)
inmul = InsideMultiple(Brep=support_breps, Point=mcomp.Vertices, Strict=False)  # -> Inside, Index
c_script_2 = CSharpScript(m=c_script.A, spp=inmul.Inside, a1=amp1, f1=freq1, r1=rot1, p1=phase1, a2=amp2, f2=freq2, r2=rot2, p2=phase2)  # -> out, A, B, C; inputs m: Mesh, spp: list of Boolean, a1: Double, f1: Double, r1: Double, p1: Double, a2: Double, f2: Double, r2: Double, p2: Double
# ---------- c_script_2: C# ----------
    //initialize point lists for supports and loads
    List<Point3d> supportPoints = new List<Point3d>();
    List<Point3d> loadPoints = new List<Point3d>();

    //loop through all the vertices and displace each vertex in the surface mesh
    //by an amount given by the composition of the two waves
    for(int i = 0; i < m.Vertices.Count; ++i) {
      //get point and normal at vertex i
      Point3d p = new Point3d(m.Vertices[i]);
      Vector3d n = new Vector3d(m.Normals[i]);

      //get texture coordinates at vertex i. Because the mesh
      //we connected here comes from a previous c# component that stored the
      //UV coordinates of the vertices as texture coordinates in the mesh
      //this means that we can associate the vertices with the original surface
      //our wave function w1(u,v) and w2(u,v) will wrap nicely around the mesh
      //regardless of the curvature of the original surface
      //this is better than using functions f the form w1(x,y) and w2(x,y) that
      //would break down for surfaces that wrap around themselves [when there are
      //more than one surface points corresponding to a given (x,y)
      double s = m.TextureCoordinates[i].X;
      double t = m.TextureCoordinates[i].Y;

      //compute the rotated wave coordinate from s and t
      double wp1 = Math.Cos(r1) * s + Math.Sin(r1) * t;
      //find the displacement of the first wave
      double wave1 = a1 * Math.Cos(wp1 * f1 + p1);

      double wp2 = Math.Cos(r2) * s + Math.Sin(r2) * t;
      double wave2 = a2 * Math.Cos(wp2 * f2 + p2);

      p = p + n * wave1 * wave2; //move point p along normal n by the composite wave displacement [could use wave1+wave2 too]

      m.Vertices.SetVertex(i, p);

      if (spp[i]) {
        supportPoints.Add(p);
      }
      else {
        loadPoints.Add(p);
      }
    }

    m.FaceNormals.ComputeFaceNormals();
    m.Normals.ComputeNormals();

    A = m;
    B = supportPoints;
    C = loadPoints;
# ---------- end c_script_2 ----------

toggle = BooleanToggle(False)
pt = Point(c_script_2.B)
mat = Material(MaterialType=2)
Z = UnitZ(Factor=Slider(-943.088, range=-10000..1))
mat_2 = MillC_StockSupportType(X=True, Y=True, Z=True, RX=toggle, RY=toggle, RZ=toggle)
femesh = FEMesh(Meshes=c_script_2.A, Material=mat, Thickness=Slider(0.25, range=0..1), AreaLoad=Vector(0, 0, 0), NormalAreaLoad=0)
fepointsupports = FEPointSupports(Point=pt, SupportType=mat_2)
fepointload = FEPointLoad(Point=c_script_2.C, Load=Z)
selfweight = Slider(0, range=0..1)
fea_system = FEASystem(
    ModelComponents=flatten([femesh, fepointsupports, fepointload]),
    IntersectAddedCurves=True,
    MergeTolerance=0.0001,
    MinimumCurveSpan=0.05,
    MaximumCurveSpan=10000,
    CurveTolerance=0.1)
fe_solver = FESolver(
    FEModel=fea_system,
    SelfWeightCoefficient=selfweight,
    BeamOptimisationIterations=0,
    QuadOptimisationIterations=0,
    OptimizationTarget=0.3,
    OptimizationPenalization=2,
    LoadCase=0,
    AllCases=True)  # -> FEModel, MaxDeflection, Weight

deflection = Panel(fe_solver.MaxDeflection)

scale = BooleanToggle(True)
lambda = BooleanToggle(False)
iter = Slider(6481, range=0..21618)
omega = Slider(8.448, range=0..11)
stress_pattern = StressPattern(
    FEModel=fe_solver.FEModel,
    Omega=omega,
    Scalefield=scale,
    Uselambda=lambda,
    Smoothfactor=0,
    SmoothModulo=1,
    Iterations=iter,
    MeshDenisty=2,
    Layer=1,
    Thickness=0,
    Bending=Toggle(False))  # disabled
curves = Curves(System=stress_pattern)

deflection_2 = Slider(0, range=0..1)
plane = Slider(1, range=-1..1)
division = Division(A=deflection_2, B=fe_solver.MaxDeflection)
mesh_visualization = MeshVisualization(FEModel=fe_solver.FEModel, Deflection=division, Plane=plane, ShowThickness=False, ColorMode=2)  # -> Mesh, CompleteRange, VisibleRange

# ----
# parametrically deform  surface mesh according to the formula defined inside the C# component.
# 
# the scrollbars determine amplitudes, frequencies, phases and rotations of two planar waves
# set up the analysis model
c_script_3 = CSharpScript(s=srf_2, ru=Slider(20, range=0..60), rv=Slider(20, range=0..60))  # -> out, A; inputs s: Surface, ru: Int32, rv: Int32; same code as c_script

mcomp_2 = Decompose(Mesh=c_script_3.A)  # -> Vertices, Faces, Colours, Normals
phase1_2 = Slider(0.571, range=-4..4)
amp2_2 = Slider(0.5, range=0..0.5)
amp1_2 = Slider(0.81, range=0..1)
freq1_2 = Slider(5, range=0..5)
rot1_2 = Slider(-0.031, range=-4..4)
freq2_2 = Slider(1.506, range=0..5)
rot2_2 = Slider(2.077, range=-4..4)
phase2_2 = Slider(2.059, range=-4..4)
inmul_2 = InsideMultiple(Brep=support_breps_2, Point=mcomp_2.Vertices, Strict=False)  # -> Inside, Index
c_script_4 = CSharpScript(
    m=c_script_3.A,
    spp=inmul_2.Inside,
    a1=amp1_2,
    f1=freq1_2,
    r1=rot1_2,
    p1=phase1_2,
    a2=amp2_2,
    f2=freq2_2,
    r2=rot2_2,
    p2=phase2_2)  # -> out, A, B, C; inputs m: Mesh, spp: list of Boolean, a1: Double, f1: Double, r1: Double, p1: Double, a2: Double, f2: Double, r2: Double, p2: Double; same code as c_script_2

toggle_2 = BooleanToggle(False)
pt_2 = Point(c_script_4.B)
mat_3 = Material(MaterialType=2)
Z_2 = UnitZ(Factor=Slider(-943.088, range=-10000..1))
mat_4 = MillC_StockSupportType(X=True, Y=True, Z=True, RX=toggle_2, RY=toggle_2, RZ=toggle_2)
femesh_2 = FEMesh(Meshes=c_script_4.A, Material=mat_3, Thickness=Slider(0.25, range=0..1), AreaLoad=Vector(0, 0, 0), NormalAreaLoad=0)
fepointsupports_2 = FEPointSupports(Point=pt_2, SupportType=mat_4)
fepointload_2 = FEPointLoad(Point=c_script_4.C, Load=Z_2)
selfweight_2 = Slider(0, range=0..1)
fea_system_2 = FEASystem(
    ModelComponents=flatten([femesh_2, fepointsupports_2, fepointload_2]),
    IntersectAddedCurves=True,
    MergeTolerance=0.0001,
    MinimumCurveSpan=0.05,
    MaximumCurveSpan=10000,
    CurveTolerance=0.1)
fe_solver_2 = FESolver(
    FEModel=fea_system_2,
    SelfWeightCoefficient=selfweight_2,
    BeamOptimisationIterations=0,
    QuadOptimisationIterations=0,
    OptimizationTarget=0.3,
    OptimizationPenalization=2,
    LoadCase=0,
    AllCases=True)  # -> FEModel, MaxDeflection, Weight

deflection_3 = Panel(fe_solver_2.MaxDeflection)

scale_2 = BooleanToggle(True)
lambda_2 = BooleanToggle(False)
omega_2 = Slider(8.448, range=0..11)
iter_2 = Slider(6481, range=0..21618)
stress_pattern_2 = StressPattern(
    FEModel=fe_solver_2.FEModel,
    Omega=omega_2,
    Scalefield=scale_2,
    Uselambda=lambda_2,
    Smoothfactor=0,
    SmoothModulo=1,
    Iterations=iter_2,
    MeshDenisty=2,
    Layer=1,
    Thickness=0,
    Bending=Toggle(False))  # disabled
curves_2 = Curves(System=stress_pattern_2)

deflection_4 = Slider(0, range=0..1)
plane_2 = Slider(1, range=-1..1)
division_2 = Division(A=deflection_4, B=fe_solver_2.MaxDeflection)
mesh_visualization_2 = MeshVisualization(FEModel=fe_solver_2.FEModel, Deflection=division_2, Plane=plane_2, ShowThickness=False, ColorMode=2)  # -> Mesh, CompleteRange, VisibleRange

# ----
# parametrically deform  surface mesh according to the formula defined inside the C# component.
# 
# the scrollbars determine amplitudes, frequencies, phases and rotations of two planar waves
# set up the analysis model
c_script_5 = CSharpScript(s=srf_3, ru=Slider(20, range=0..60), rv=Slider(20, range=0..60))  # -> out, A; inputs s: Surface, ru: Int32, rv: Int32; same code as c_script

mcomp_3 = Decompose(Mesh=c_script_5.A)  # -> Vertices, Faces, Colours, Normals
phase1_3 = Slider(0.571, range=-4..4)
amp2_3 = Slider(0.46, range=0..0.5)
amp1_3 = Slider(0.27, range=0..1)
freq1_3 = Slider(2.745, range=0..5)
rot1_3 = Slider(-0.031, range=-4..4)
freq2_3 = Slider(1.506, range=0..5)
rot2_3 = Slider(2.077, range=-4..4)
phase2_3 = Slider(2.059, range=-4..4)
inmul_3 = InsideMultiple(Brep=support_breps_3, Point=mcomp_3.Vertices, Strict=False)  # -> Inside, Index
c_script_6 = CSharpScript(
    m=c_script_5.A,
    spp=inmul_3.Inside,
    a1=amp1_3,
    f1=freq1_3,
    r1=rot1_3,
    p1=phase1_3,
    a2=amp2_3,
    f2=freq2_3,
    r2=rot2_3,
    p2=phase2_3)  # -> out, A, B, C; inputs m: Mesh, spp: list of Boolean, a1: Double, f1: Double, r1: Double, p1: Double, a2: Double, f2: Double, r2: Double, p2: Double; same code as c_script_2

toggle_3 = BooleanToggle(False)
pt_3 = Point(c_script_6.B)
mat_5 = Material(MaterialType=2)
Z_3 = UnitZ(Factor=Slider(-943.088, range=-10000..1))
mat_6 = MillC_StockSupportType(X=True, Y=True, Z=True, RX=toggle_3, RY=toggle_3, RZ=toggle_3)
femesh_3 = FEMesh(Meshes=c_script_6.A, Material=mat_5, Thickness=Slider(0.25, range=0..1), AreaLoad=Vector(0, 0, 0), NormalAreaLoad=0)
fepointsupports_3 = FEPointSupports(Point=pt_3, SupportType=mat_6)
fepointload_3 = FEPointLoad(Point=c_script_6.C, Load=Z_3)
selfweight_3 = Slider(0, range=0..1)
fea_system_3 = FEASystem(
    ModelComponents=flatten([femesh_3, fepointsupports_3, fepointload_3]),
    IntersectAddedCurves=True,
    MergeTolerance=0.0001,
    MinimumCurveSpan=0.05,
    MaximumCurveSpan=10000,
    CurveTolerance=0.1)
fe_solver_3 = FESolver(
    FEModel=fea_system_3,
    SelfWeightCoefficient=selfweight_3,
    BeamOptimisationIterations=0,
    QuadOptimisationIterations=0,
    OptimizationTarget=0.3,
    OptimizationPenalization=2,
    LoadCase=0,
    AllCases=True)  # -> FEModel, MaxDeflection, Weight

deflection_5 = Panel(fe_solver_3.MaxDeflection)

scale_3 = BooleanToggle(True)
lambda_3 = BooleanToggle(False)
omega_3 = Slider(8.448, range=0..11)
iter_3 = Slider(6481, range=0..21618)
stress_pattern_3 = StressPattern(
    FEModel=fe_solver_3.FEModel,
    Omega=omega_3,
    Scalefield=scale_3,
    Uselambda=lambda_3,
    Smoothfactor=0,
    SmoothModulo=1,
    Iterations=iter_3,
    MeshDenisty=2,
    Layer=1,
    Thickness=0,
    Bending=Toggle(False))  # disabled
curves_3 = Curves(System=stress_pattern_3)

deflection_6 = Slider(0, range=0..1)
plane_3 = Slider(1, range=-1..1)
division_3 = Division(A=deflection_6, B=fe_solver_3.MaxDeflection)
mesh_visualization_3 = MeshVisualization(FEModel=fe_solver_3.FEModel, Deflection=division_3, Plane=plane_3, ShowThickness=False, ColorMode=2)  # -> Mesh, CompleteRange, VisibleRange
