# Grasshopper definition 03_InvertedDisplacement.gh (Grasshopper 0.9.64)
# plug-ins: Millipede

srf = Surface(<surface referenced from the Rhino model>)
# This file demostrates the use of the displacement values from a first analysis step as a shape modifier that changes the initial geometry.
# 
# We start by setting up a regular analysis on the original surface but we add a second step where we read the displacements of the original and modify its geometry by inverting and scaling up thoise deflections.
# 
# Therefore the originally flat surface becomes a much more stable vault whose shape depends on the boundary conditions
support_breps = Brep([<brep referenced from the Rhino model> x2])
mesh_uv = MeshSurface(Surface=srf, UCount=Slider(20, range=0..60), VCount=Slider(20, range=0..60), Overhang=False, Equalize=True)

toggle = BooleanToggle(False)
mat = Material(MaterialType=2)
mat_2 = MillC_StockSupportType(X=True, Y=True, Z=True, RX=toggle, RY=toggle, RZ=toggle)
support_region = MSupportTypeRegion(Boundary=support_breps, SupportType=mat_2, AmmendExistingSupports=True)
femesh = FEMesh(Meshes=mesh_uv, Material=mat, Thickness=Slider(0.061, range=0..1), AreaLoad=Vector(0, 0, 0), NormalAreaLoad=0)

# ----
# this number determines the scaling of the calculated deflections from the first step when applied to the original geometry in order to shift its vertices
# 
# This scrollbar is connected to the millipede component in the begining so that it can trigger a complete recalculation of the first step each time it changes. Otherwise you will get an accumulative effect every time it moves [which may be what you want in some cases]
# this script reads the analysis results and applies the deflections to the original geometry
# 
# !!!if it doesn't work you might need to relink the SawapanStatica Assemblies using the "manage assembly option" of the right click menu
slider = Slider(-1.115, range=-3..3)

fea_system = FEASystem(
    ModelComponents=flatten([femesh, support_region]),
    IntersectAddedCurves=True,
    MergeTolerance=0.0001,
    MinimumCurveSpan=0.05,
    MaximumCurveSpan=10000,
    CurveTolerance=slider)
fe_solver = FESolver(
    FEModel=fea_system,
    SelfWeightCoefficient=Slider(1, range=0..1),
    BeamOptimisationIterations=0,
    QuadOptimisationIterations=0,
    OptimizationTarget=0.3,
    OptimizationPenalization=2,
    LoadCase=0,
    AllCases=True)  # -> FEModel, MaxDeflection, Weight
division = Division(A=Slider(0, range=0..1), B=fe_solver.MaxDeflection)
mesh_visualization = MeshVisualization(FEModel=fe_solver.FEModel, Deflection=division, Plane=Slider(1, range=-1..1), ShowThickness=False, ColorMode=2)  # -> Mesh, CompleteRange, VisibleRange

c_script = CSharpScript(
    FE=fe_solver.FEModel,
    dt=slider,
    Reference=["C:\Users\pan\AppData\Roaming\Grasshopper\Libraries\SawapanStatica.dll", "C:\Users\pan\AppData\Roaming\Grasshopper\Libraries\SawapanStatRhino.dll"])  # -> out, A, B; inputs dt: Double
# ---------- c_script: C# ----------
    //cast the connected FE object to a proper RStatSystem so we can access its properties
    RStatSystem sys = FE as RStatSystem;

    //for each structural node move its location p by the deflection using the multiplier dt
    //here we also divide by the maximum displacement which normalizes deflection
    //this means that if dt=1.0 then the maximum amount that a node will be shifted is
    //going to be 1.0 unit
    foreach(RStatNode n in sys.Nodes) {
      n.p = n.p + n.u * (dt / (  sys.MaximumDisplacement));
    }

    //since we changed the nodes we need to recalculate the mesh quads[ the
    //the Calc methods updats the local coordinate system each quad as well as
    //recalculating its area
    foreach(RStatShellQuad q in sys.Quads) {
      q.Calc();
    }

    //solve the analysis system again to get the new deflections
    sys.SolveSystem();


    A = sys;
    B = sys.MaximumDisplacement;
# ---------- end c_script ----------
division_2 = Division(A=Slider(0, range=0..1), B=c_script.B)
mesh_visualization_2 = MeshVisualization(FEModel=c_script.A, Deflection=division_2, Plane=Slider(1, range=-1..1), ShowThickness=False, ColorMode=2)  # -> Mesh, CompleteRange, VisibleRange

deflection_of_curved = Panel(c_script.B)
deflection_of_original = Panel(fe_solver.MaxDeflection)
