# Grasshopper definition 011_isoSurfaces.gh (Grasshopper 0.9.64)
# plug-ins: Millipede

geo = Geometry(<brep referenced from the Rhino model>)
slider = Slider(40, range=2..50)
slider_2 = Slider(40, range=2..50)
slider_3 = Slider(40, range=2..50)
iso = Slider(0.772, range=-2..2)
bbox = BoundingBox(Content=geo, Plane=PlaneXY(0, 0, 0))  # -> Box, Box_2
c_script = CSharpScript(b=bbox.Box, rx=slider, ry=slider_2, rz=slider_3)  # -> out, A; inputs b: Box, rx: Int32, ry: Int32, rz: Int32
# ---------- c_script: C# ----------
    double dx = 1.0 / (double) (rx - 1.0);
    double dy = 1.0 / (double) (ry - 1.0);
    double dz = 1.0 / (double) (rz - 1.0);

    int k = 0;
    int j = 0;
    int i = 0;

    List<double> d = new List<double>(rx * ry * rz);

    double dd = 0.0;
    double nx;
    double ny;
    double nz;

    double px;
    double py;
    double pz;

    double pi2 = Math.PI * 2.0;

    for(k = 0; k < rz;++k) {
      nz = k * dz;
      for(j = 0; j < ry;++j) {
        ny = j * dy;
        for(i = 0; i < rx;++i) {
          nx = i * dx;
          Point3d p = b.PointAt(nx, ny, nz);
          px = p.X;
          py = p.Y;
          pz = p.Z;


          //dd = 0.1 * Math.Cos(pi2 * nx) * Math.Cos(2.0 * pi2 * (nz - ny)) - 0.1 * Math.Cos(pi2 * (3.0 * ny - 2.0 * nz)) + 0.2 * Math.Sin(2.0 * pi2 * (nz + ny));
          //Sherk surface
          // dd = Math.Exp(pz) * Math.Cos(px) - Math.Cos(py);
          //dd = pz * Math.Cos(px) - Math.Cos(py);
          //dd = pz * pz * Math.Cos(px) - Math.Cos(py);
          //Swartz P
          //dd = Math.Cos(px) + Math.Cos(py) + Math.Cos(pz);

          //Diamond
          dd = Math.Sin(px) * Math.Sin(py) * Math.Sin(pz) +
            Math.Sin(px) * Math.Cos(py) * Math.Cos(pz) +
            Math.Cos(px) * Math.Sin(py) * Math.Cos(pz) +
            Math.Cos(px) * Math.Cos(py) * Math.Sin(pz);

          //Gyroid
          /*dd = Math.Cos(px) * Math.Sin(py) +
          Math.Cos(py) * Math.Sin(pz) +
          Math.Cos(pz) * Math.Sin(px);*/

          //Neovius

          /*dd = 3.0 * (Math.Cos(px) + Math.Cos(py) + Math.Cos(pz)) +
          4.0 * (Math.Cos(px) * Math.Cos(py) * Math.Cos(pz));*/

          //Math.Cos(px) * Math.Cos(py) - Math.Cos(pz) * Math.Cos(py)

          d.Add(dd);
        }
      }
    }

    A = d;
# ---------- end c_script ----------
iso_surface = IsoSurface(
    Box=bbox.Box,
    Values=c_script.A,
    XResolution=slider,
    YResolution=slider_2,
    ZResolution=slider_3,
    IsoValue=iso,
    MergeVertices=Toggle(True))
preview = CustomPreview(Geometry=iso_surface, Shader=ColourSwatch(SwatchColor=RGB(130, 129, 129)))
