# Grasshopper definition 014_object_contours.gh (Grasshopper 0.9.64)
# plug-ins: Millipede

box = DomainBox(Base=PlaneXY(0, 0, 0), X=Slider(1, range=0..1), Y=Slider(1, range=0..1), Z=Slider(1, range=0..1))
geo = Geometry([<brep referenced from the Rhino model>, <curve referenced from the Rhino model> x2])
slider = Slider(50, range=2..50)
slider_2 = Slider(50, range=2..50)
slider_3 = Slider(50, range=2..50)
mat = MillC_IsoWrapper(
    Geometry=geo,
    Power=[Slider(1, range=0..1), Slider(1, range=-1..1)],
    Spread=Slider(39.726, range=0..95),
    Exponent=2,
    Box=box,
    XResolution=slider,
    YResolution=slider_2,
    ZResolution=slider_3)

lng = ListLength(List=mat)
sort = SortList(Keys=mat)  # -> Keys, ValuesA
integer_division = IntegerDivision(A=lng, B=2)
item = ListItem(List=sort.Keys, Index=integer_division, Wrap=False)
bnd = Bounds(Numbers=mat)
c_script = CSharpScript(med=item, mm=bnd, d=Slider(0.6, range=0..1))  # -> out, A; inputs med: Double, d: Double
# ---------- c_script: C# ----------
    if (d < 0.5) A = mm.Min + (med - mm.Min) * d * 2.0;
    else A = med + (mm.Max - med) * (d - 0.5) * 2.0;
# ---------- end c_script ----------
iso_surface = IsoSurface(
    Box=box,
    Values=mat,
    XResolution=slider,
    YResolution=slider_2,
    ZResolution=slider_3,
    IsoValue=c_script.A,
    MergeVertices=Toggle(True))
preview = CustomPreview(Geometry=iso_surface, Shader=ColourSwatch(SwatchColor=RGB(166, 166, 166)))
