# Grasshopper definition 019_contour_dist.gh (Grasshopper 0.9.64)
# plug-ins: Millipede

mesh = Mesh(<mesh referenced from the Rhino model>)
preview = CustomPreview(Geometry=mesh, Shader=ColourSwatch(SwatchColor=RGB(255, 255, 255)))

geo = Geometry(<brep referenced from the Rhino model>)
geo_2 = Geometry(<curve referenced from the Rhino model>)
mcomp = Decompose(Mesh=mesh)  # -> Vertices, Faces, Colours, Normals
pull = PullPoint(Point=mcomp.Vertices, Geometry=geo, ClosestOnly=True)  # -> ClosestPoint, Distance
pull_2 = PullPoint(Point=mcomp.Vertices, Geometry=geo_2, ClosestOnly=True)  # -> ClosestPoint, Distance
division = Division(A=pull.Distance, B=pull_2.Distance)
subtraction = Subtraction(A=pull.Distance, B=pull_2.Distance)
atan = ArcTangent(Value=division)
bnd = Bounds(Numbers=atan)
range = Range(Domain=bnd, Steps=Slider(51, range=1..60))

mesh_contours = MeshContourField(Mesh=mesh, Values=atan, IsoValues=flatten(range))
preview_2 = CustomPreview(Geometry=mesh_contours, Shader=ColourSwatch(SwatchColor=RGB(0, 0, 0)))
