# Grasshopper definition ComplexContours.gh (Grasshopper 0.9.64)
# plug-ins: Millipede

mplane = MeshPlane(
    Boundary={Plane=PlaneXY(-3, -3, 0), Size=Domain2(u=0..6, v=0..6)},
    WidthCount=Slider(44, range=0..90),
    HeightCount=Slider(44, range=0..90))  # -> Mesh, Area

mplane_2 = MeshPlane(
    Boundary={Plane=PlaneXY(-3, -3, 0), Size=Domain2(u=0..6, v=0..6)},
    WidthCount=Slider(44, range=0..90),
    HeightCount=Slider(44, range=0..90))  # -> Mesh, Area

mplane_3 = MeshPlane(
    Boundary={Plane=PlaneXY(-3, -3, 0), Size=Domain2(u=0..6, v=0..6)},
    WidthCount=Slider(44, range=0..90),
    HeightCount=Slider(44, range=0..90))  # -> Mesh, Area

mplane_4 = MeshPlane(
    Boundary={Plane=PlaneXY(-3, -3, 0), Size=Domain2(u=0..6, v=0..6)},
    WidthCount=Slider(44, range=0..90),
    HeightCount=Slider(44, range=0..90))  # -> Mesh, Area

mplane_5 = MeshPlane(
    Boundary={Plane=PlaneXY(-3, -3, 0), Size=Domain2(u=0..6, v=0..6)},
    WidthCount=Slider(44, range=0..90),
    HeightCount=Slider(44, range=0..90))  # -> Mesh, Area

demesh = DeconstructMesh(Mesh=mplane.Mesh)  # -> Vertices, Faces, Colours, Normals
devec = DeconstructVector(Vector=demesh.Vertices)  # -> XComponent, YComponent, ZComponent
complex = CreateComplex(Real=devec.XComponent, Imaginary=devec.YComponent)
sin = Sine(Value=complex)
cmod = ComplexModulus(Complex=sin)
arg = ComplexArgument(Complex=sin)
complex_2 = ComplexComponents(Complex=sin)  # -> Real, Imaginary

demesh_2 = DeconstructMesh(Mesh=mplane_2.Mesh)  # -> Vertices, Faces, Colours, Normals
devec_2 = DeconstructVector(Vector=demesh_2.Vertices)  # -> XComponent, YComponent, ZComponent
complex_3 = CreateComplex(Real=devec_2.XComponent, Imaginary=devec_2.YComponent)
sin_2 = Sine(Value=complex_3)
cmod_2 = ComplexModulus(Complex=sin_2)
arg_2 = ComplexArgument(Complex=sin_2)
complex_4 = ComplexComponents(Complex=sin_2)  # -> Real, Imaginary

demesh_3 = DeconstructMesh(Mesh=mplane_3.Mesh)  # -> Vertices, Faces, Colours, Normals
devec_3 = DeconstructVector(Vector=demesh_3.Vertices)  # -> XComponent, YComponent, ZComponent
complex_5 = CreateComplex(Real=devec_3.XComponent, Imaginary=devec_3.YComponent)
tan = Tangent(Value=complex_5)
cmod_3 = ComplexModulus(Complex=tan)
arg_3 = ComplexArgument(Complex=tan)
complex_6 = ComplexComponents(Complex=tan)  # -> Real, Imaginary

atan = ArcTangent(Value=complex_6.Imaginary)
atan_2 = ArcTangent(Value=complex_6.Real)
bnd = Bounds(Numbers=atan_2)
bnd_2 = Bounds(Numbers=atan)
number_slider = Slider(38, range=0..100)
remap = RemapNumbers(Value=atan_2, Source=bnd, Target=Domain(0, 1))  # -> Mapped, Clipped
remap_2 = RemapNumbers(Value=atan, Source=bnd_2, Target=Domain(0, 1))  # -> Mapped, Clipped
range = Range(Domain=Domain(0, 1), Steps=number_slider)
range_2 = Range(Domain=Domain(0, 1), Steps=number_slider)

c_script = CSharpScript(m=mplane.Mesh, z=cmod, h=Slider(-0.659, range=-5..6), tr=Slider(6.5, range=0..206))  # -> out, A; inputs m: Mesh, z: list of Double, h: Double, tr: Double
# ---------- c_script: C# ----------
    for(int i = 0; i < m.Vertices.Count; ++i) {
      Point3d p = new Point3d(m.Vertices[i]);
      Vector3d n = new Vector3d(m.Normals[i]);

      p.X += tr;
      m.Vertices.SetVertex(i, p + n * z[i] * h);
    }

    m.FaceNormals.ComputeFaceNormals();
    m.Normals.ComputeNormals();

    A = m;
# ---------- end c_script ----------
preview = CustomPreview(Geometry=c_script.A, Shader=ColourSwatch(SwatchColor=RGB(176, 176, 176)))

bnd_3 = Bounds(Numbers=cmod)
bnd_4 = Bounds(Numbers=arg)
number_slider_2 = Slider(39, range=0..100)
remap_3 = RemapNumbers(Value=cmod, Source=bnd_3, Target=Domain(0, 1))  # -> Mapped, Clipped
remap_4 = RemapNumbers(Value=arg, Source=bnd_4, Target=Domain(0, 1))  # -> Mapped, Clipped
range_3 = Range(Domain=Domain(0, 1), Steps=number_slider_2)
range_4 = Range(Domain=Domain(0, 1), Steps=number_slider_2)

c_script_2 = CSharpScript(m=mplane_2.Mesh, z=cmod_2, h=Slider(-0.585, range=-5..6), tr=Slider(0, range=0..206))  # -> out, A; inputs m: Mesh, z: list of Double, h: Double, tr: Double; same code as c_script
preview_2 = CustomPreview(Geometry=c_script_2.A, Shader=ColourSwatch(SwatchColor=RGB(176, 176, 176)))

bnd_5 = Bounds(Numbers=complex_4.Real)
bnd_6 = Bounds(Numbers=complex_4.Imaginary)
number_slider_3 = Slider(39, range=0..100)
remap_5 = RemapNumbers(Value=complex_4.Real, Source=bnd_5, Target=Domain(0, 1))  # -> Mapped, Clipped
remap_6 = RemapNumbers(Value=complex_4.Imaginary, Source=bnd_6, Target=Domain(0, 1))  # -> Mapped, Clipped
range_5 = Range(Domain=Domain(0, 1), Steps=number_slider_3)
range_6 = Range(Domain=Domain(0, 1), Steps=number_slider_3)

c_script_3 = CSharpScript(m=mplane_3.Mesh, z=cmod_3, h=Slider(-0.658, range=-5..6), tr=Slider(13, range=0..206))  # -> out, A; inputs m: Mesh, z: list of Double, h: Double, tr: Double; same code as c_script
preview_3 = CustomPreview(Geometry=c_script_3.A, Shader=ColourSwatch(SwatchColor=RGB(176, 176, 176)))

mesh_contours = MeshContourField(Mesh=c_script_2.A, Values=remap_5.Mapped, IsoValues=range_5)
mesh_contours_2 = MeshContourField(Mesh=c_script_2.A, Values=remap_6.Mapped, IsoValues=range_6)
swatch = ColourSwatch(SwatchColor=RGB(0, 108, 135))
preview_4 = CustomPreview(Geometry=mesh_contours_2, Shader=ColourSwatch(SwatchColor=RGB(0, 0, 0)))
preview_5 = CustomPreview(Geometry=mesh_contours, Shader=swatch)

mesh_contours_3 = MeshContourField(Mesh=c_script.A, Values=remap_3.Mapped, IsoValues=range_3)
mesh_contours_4 = MeshContourField(Mesh=c_script.A, Values=remap_4.Mapped, IsoValues=range_4)
preview_6 = CustomPreview(Geometry=mesh_contours_4, Shader=ColourSwatch(SwatchColor=RGB(0, 0, 0)))
preview_7 = CustomPreview(Geometry=mesh_contours_3, Shader=swatch)

mesh_contours_5 = MeshContourField(Mesh=c_script_3.A, Values=remap.Mapped, IsoValues=range)
mesh_contours_6 = MeshContourField(Mesh=c_script_3.A, Values=remap_2.Mapped, IsoValues=range_2)
preview_8 = CustomPreview(Geometry=mesh_contours_6, Shader=ColourSwatch(SwatchColor=RGB(0, 0, 0)))
preview_9 = CustomPreview(Geometry=mesh_contours_5, Shader=swatch)

demesh_4 = DeconstructMesh(Mesh=mplane_4.Mesh)  # -> Vertices, Faces, Colours, Normals
devec_4 = DeconstructVector(Vector=demesh_4.Vertices)  # -> XComponent, YComponent, ZComponent
complex_7 = CreateComplex(Real=devec_4.XComponent, Imaginary=devec_4.YComponent)

sqr = Square(Value=complex_7)

cmod_4 = ComplexModulus(Complex=sqr)
arg_4 = ComplexArgument(Complex=sqr)
complex_8 = ComplexComponents(Complex=sqr)  # -> Real, Imaginary

c_script_4 = CSharpScript(m=mplane_4.Mesh, z=cmod_4, h=Slider(-0.163, range=-5..6), tr=Slider(19.5, range=0..206))  # -> out, A; inputs m: Mesh, z: list of Double, h: Double, tr: Double; same code as c_script
preview_10 = CustomPreview(Geometry=c_script_4.A, Shader=ColourSwatch(SwatchColor=RGB(176, 176, 176)))

bnd_7 = Bounds(Numbers=complex_8.Real)
bnd_8 = Bounds(Numbers=complex_8.Imaginary)
number_slider_4 = Slider(38, range=0..100)
remap_7 = RemapNumbers(Value=complex_8.Real, Source=bnd_7, Target=Domain(0, 1))  # -> Mapped, Clipped
remap_8 = RemapNumbers(Value=complex_8.Imaginary, Source=bnd_8, Target=Domain(0, 1))  # -> Mapped, Clipped
range_7 = Range(Domain=Domain(0, 1), Steps=number_slider_4)
range_8 = Range(Domain=Domain(0, 1), Steps=number_slider_4)

mesh_contours_7 = MeshContourField(Mesh=c_script_4.A, Values=remap_7.Mapped, IsoValues=range_7)
mesh_contours_8 = MeshContourField(Mesh=c_script_4.A, Values=remap_8.Mapped, IsoValues=range_8)
preview_11 = CustomPreview(Geometry=mesh_contours_8, Shader=ColourSwatch(SwatchColor=RGB(0, 0, 0)))
preview_12 = CustomPreview(Geometry=mesh_contours_7, Shader=swatch)

demesh_5 = DeconstructMesh(Mesh=mplane_5.Mesh)  # -> Vertices, Faces, Colours, Normals
devec_5 = DeconstructVector(Vector=demesh_5.Vertices)  # -> XComponent, YComponent, ZComponent
complex_9 = CreateComplex(Real=devec_5.XComponent, Imaginary=devec_5.YComponent)

csc = CoSecant(Value=complex_9)

cmod_5 = ComplexModulus(Complex=csc)
arg_5 = ComplexArgument(Complex=csc)
complex_10 = ComplexComponents(Complex=csc)  # -> Real, Imaginary

atan_3 = ArcTangent(Value=complex_10.Real)
atan_4 = ArcTangent(Value=complex_10.Imaginary)
bnd_9 = Bounds(Numbers=atan_3)
bnd_10 = Bounds(Numbers=atan_4)
number_slider_5 = Slider(38, range=0..100)
remap_9 = RemapNumbers(Value=atan_3, Source=bnd_9, Target=Domain(0, 1))  # -> Mapped, Clipped
remap_10 = RemapNumbers(Value=atan_4, Source=bnd_10, Target=Domain(0, 1))  # -> Mapped, Clipped
range_9 = Range(Domain=Domain(0, 1), Steps=number_slider_5)
range_10 = Range(Domain=Domain(0, 1), Steps=number_slider_5)

c_script_5 = CSharpScript(m=mplane_5.Mesh, z=cmod_5, h=Slider(0.826, range=-5..6), tr=Slider(26, range=0..206))  # -> out, A; inputs m: Mesh, z: list of Double, h: Double, tr: Double; same code as c_script
preview_13 = CustomPreview(Geometry=c_script_5.A, Shader=ColourSwatch(SwatchColor=RGB(176, 176, 176)))

mesh_contours_9 = MeshContourField(Mesh=c_script_5.A, Values=remap_9.Mapped, IsoValues=range_9)
mesh_contours_10 = MeshContourField(Mesh=c_script_5.A, Values=remap_10.Mapped, IsoValues=range_10)
preview_14 = CustomPreview(Geometry=mesh_contours_10, Shader=ColourSwatch(SwatchColor=RGB(0, 0, 0)))
preview_15 = CustomPreview(Geometry=mesh_contours_9, Shader=swatch)
