# Grasshopper definition Discretization.gh (Grasshopper 0.9.64)
# plug-ins: Millipede

brep = Brep(<brep referenced from the Rhino model>)
discretization = Discretization(
    Breps=brep,
    Tolerance=0.001,
    MeshSize=Slider(0.4, range=0..10),
    Iterations=Slider(500, range=0..1000),
    Beta=Slider(1, range=0..10))  # -> Meshes, Curves
