# Grasshopper definition DiscretizationB.gh (Grasshopper 0.9.64)
# plug-ins: Millipede

brep = Brep([<brep referenced from the Rhino model> x3])
crv = Curve(<curve referenced from the Rhino model>)
pt = Point([<point referenced from the Rhino model> x8])
discretization = Discretization(
    Breps=brep,
    Curves=crv,
    Points=pt,
    Tolerance=0.001,
    MeshSize=Slider(0.4, range=0..4),
    Iterations=Slider(800, range=0..2000),
    Beta=Slider(0.8, range=0..4))  # -> Meshes, Curves
