# Grasshopper definition MinimalSurfaceEdges.gh (Grasshopper 0.9.64)
# plug-ins: Millipede

crv = Curve([<curve referenced from the Rhino model> x9])

minisrfedge = MinimalSurfaceFromEdges(
    InputCurves=crv,
    Iterations=Slider(424, range=0..596),
    MeanStep=Slider(0.221, range=0..1),
    RelaxStep=Slider(0.186, range=0..1),
    Resolution=Slider(11, range=0..20))

preview = CustomPreview(Geometry=minisrfedge, Shader=ColourSwatch(SwatchColor=RGB(255, 255, 255)))

faceb = FaceBoundaries(Mesh=minisrfedge)

crv_2 = Curve([<curve referenced from the Rhino model> x6])

minisrfedge_2 = MinimalSurfaceFromEdges(
    InputCurves=crv_2,
    Iterations=Slider(424, range=0..596),
    MeanStep=Slider(0.221, range=0..1),
    RelaxStep=Slider(0.186, range=0..1),
    Resolution=Slider(11, range=0..20))

preview_2 = CustomPreview(Geometry=minisrfedge_2, Shader=ColourSwatch(SwatchColor=RGB(255, 255, 255)))

crv_3 = Curve([<curve referenced from the Rhino model> x6])

minisrfedge_3 = MinimalSurfaceFromEdges(
    InputCurves=crv_3,
    Iterations=Slider(355, range=0..596),
    MeanStep=Slider(0.471, range=0..1),
    RelaxStep=Slider(0.226, range=0..1),
    Resolution=Slider(13, range=0..20))

preview_3 = CustomPreview(Geometry=minisrfedge_3, Shader=ColourSwatch(SwatchColor=RGB(255, 255, 255)))
