# Grasshopper definition MinimalSurfaceFromMesh.gh (Grasshopper 0.9.64)
# plug-ins: Millipede

mesh = Mesh(<mesh referenced from the Rhino model>)
pt = Point([<point referenced from the Rhino model> x2])
c_script = CSharpScript(
    ms=mesh,
    iter=Slider(500, range=0..2000),
    dt=Slider(0.04, range=0..1),
    dr=Slider(0.066, range=0..1),
    fixboundaries=Toggle(True),
    fixedpoints=pt)  # -> out, A; inputs ms: Mesh, iter: Int32, dt: Double, dr: Double, fixboundaries: Boolean, fixedpoints: list of Point3d
# ---------- c_script: C# ----------
    A = SmoothMesh(ms, iter, dt, dr, fixboundaries, fixedpoints);
# ---------- c_script: C# additional code ----------
  public Mesh SmoothMesh(Mesh _ms, int _iter, double _dt, double _dr, bool _fixboundaries, List<Point3d> _fixedp)
  {

    int i = 0;
    int j = 0;
    int k = 0;

    int vc = _ms.Vertices.Count;

    Point3d[] vx = new Point3d[vc];
    Vector3d[] nx = new Vector3d[vc];
    Vector3d[] ex = new Vector3d[vc];
    double[] area = new double[vc];
    // bool[] boundary = new bool[vc];

    Mesh m = _ms.DuplicateMesh();
    m.Faces.ConvertQuadsToTriangles();



    for (i = 0; i < vc; ++i)
    {
      vx[i] = new Point3d(m.Vertices[i].X, m.Vertices[i].Y, m.Vertices[i].Z);
      nx[i] = new Vector3d(0.0, 0.0, 0.0);
      ex[i] = new Vector3d(0.0, 0.0, 0.0);

      area[i] = 0.0;
      // boundary[i] = false;
    }


    // MeshTopology tp = m.Topology();
    bool[] boundary;

    if (_fixboundaries) boundary = m.GetNakedEdgePointStatus();
    else
    {
      boundary = new bool[vc];
      for (i = 0; i < boundary.Length; ++i)
      {
        boundary[i] = false;
      }
    }

    if (_fixedp != null && _fixedp.Count > 0)
    {
      for (j = 0; j < _fixedp.Count; ++j)
      {
        for (i = 0; i < vc; ++i)
        {
          if (boundary[i]) continue;
          if (_fixedp[j].DistanceTo(vx[i]) < 0.0001)
          {
            boundary[i] = true;
          }
        }
      }
    }

               /* for (i = 0; i < tp.m_tope.Count(); ++i)
                {
                    if (tp.m_tope[i].m_topf_count == 1)
                    {
                        boundary[tp.m_topv[tp.m_tope[i].get_m_topvi(0)].m_vi[0]] = true;
                        boundary[tp.m_topv[tp.m_tope[i].get_m_topvi(1)].m_vi[0]] = true;
                    }
                }*/

    int v0 = 0;
    int v1 = 0;
    int v2 = 0;

    Vector3d e0 = new Vector3d();
    Vector3d e1 = new Vector3d();
    Vector3d e2 = new Vector3d();
    Vector3d ec = new Vector3d();

    // double l0 = 0.0;
    // double l1 = 0.0;
    // double l2 = 0.0;

    double cot0 = 0.0;
    double cot1 = 0.0;
    double cot2 = 0.0;

    double fa = 0.0;
    double ifa = 0.0;


      for (k = 0; k < _iter; ++k)
      {

        for (i = 0; i < m.Faces.Count; ++i)
        {

          v0 = m.Faces.GetFace(i).A;
          v1 = m.Faces.GetFace(i).B;
          v2 = m.Faces.GetFace(i).C;


          e0 = vx[v1] - vx[v0];
          e1 = vx[v2] - vx[v1];
          e2 = vx[v0] - vx[v2];


          ec = Vector3d.CrossProduct(e1, e0);
          fa = ec.Length;
          ifa = 1.0 / fa;

          //  if (fa > 0.00000001)
          //  {

          cot0 = -(e0 * e2) * ifa;
          cot1 = -(e1 * e0) * ifa;
          cot2 = -(e2 * e1) * ifa;

          fa *= 0.5;

          area[v0] += fa;
          area[v1] += fa;
          area[v2] += fa;

          ex[v0] += e0; ex[v0] -= e2;
          ex[v1] += e1; ex[v1] -= e0;
          ex[v2] += e2; ex[v2] -= e1;

          e0 *= cot2;
          e1 *= cot0;
          e2 *= cot1;

          nx[v0] += e0; nx[v0] -= e2;
          nx[v1] += e1; nx[v1] -= e0;
          nx[v2] += e2; nx[v2] -= e1;

        }



        for (i = 0; i < vc; ++i)
        {
          if (boundary[i]) continue;

          vx[i] += nx[i] * _dt;/// (4.0 * area[i]);
          vx[i] += ex[i] * _dr;


          area[i] = 0.0;
          nx[i].X = 0.0; nx[i].Y = 0.0; nx[i].Z = 0.0;
          ex[i].X = 0.0; ex[i].Y = 0.0; ex[i].Z = 0.0;

          //nx[i] = new Vector3d(0.0, 0.0, 0.0);
          //ex[i] = new Vector3d(0.0, 0.0, 0.0);
        }
      }
    
    

    m = _ms.DuplicateMesh();


    for (i = 0; i < vc; ++i)
    {
      m.Vertices.SetVertex(i, vx[i]);
    }

    m.UnifyNormals();

    m.Normals.ComputeNormals();

    return m;


  }
# ---------- end c_script ----------

preview = CustomPreview(Geometry=c_script.A, Shader=ColourSwatch(SwatchColor=RGB(212, 212, 212)))

reparameterization = Reparameterization(
    Mesh=c_script.A,
    Omega=Slider(3.908, range=0..6),
    Scalefield=True,
    Uselambda=Toggle(False),
    Smoothfactor=0,
    SmoothModulo=1,
    Iterations=0,
    MeshDenisty=1)  # disabled
curves = Curves(System=reparameterization)
