# Grasshopper definition 015_SparseSolver.gh (Grasshopper 0.9.64)
# plug-ins: Millipede

crv = Curve([<curve referenced from the Rhino model> x23])
pt = Point([<point referenced from the Rhino model> x8])
c_script = CSharpScript(c=crv, pt=pt)  # -> out, A, B, C, D, E, F; inputs c: list of Line, pt: list of Point3d
# ---------- c_script: C# ----------
    Truss tr = new Truss();
    foreach(Line l in c) {
      tr.AddEdge(l.From, l.To);
    }

    foreach(Point3d pp in pt) {
      tr.FixPoint(pp, true, true, true);
    }

    foreach(Node ni in tr.n) {
      ni.f += Vector3d.YAxis * (-1.5);
    }

    List<Point3d> K = new List<Point3d>();
    List<double> b = new List<double>();
    List<Point3d> BC = new List<Point3d>();
    double [,] k = new double[6, 6];

    int j0 = 0;
    int i0 = 0;
    foreach(Edge ei in tr.e) {
      ei.FillInSMatrix(1.0, 1.0, k);


      for(int j = 0; j < 6; ++j) {
        if (j < 3) j0 = ei.n0.id * 3 + j;
        else j0 = ei.n1.id * 3 + j - 3;

        for(int i = j; i < 6; ++i) {
          if (i < 3) i0 = ei.n0.id * 3 + i;
          else i0 = ei.n1.id * 3 + i - 3;

          K.Add(new Point3d(j0, i0, k[j, i]));
        }
      }
    }

    foreach(Node ni in tr.n) {
      b.Add(ni.f.X);
      b.Add(ni.f.Y);
      b.Add(ni.f.Z);

      if (ni.fixX) BC.Add(new Point3d(ni.id * 3, 0.0, 0.0));
      if (ni.fixY) BC.Add(new Point3d(ni.id * 3 + 1, 0.0, 0.0));
      if (ni.fixZ) BC.Add(new Point3d(ni.id * 3 + 2, 0.0, 0.0));
    }

    A = K;
    B = b;
    C = BC;

    List<Point3d> np = new List<Point3d>();
    foreach(Node ni in tr.n) {
      np.Add(ni.p);
    }

    D = np;

    List<int> sp = new List<int>();
    List<int> ep = new List<int>();
    foreach(Edge ei in tr.e) {
      sp.Add(ei.n0.id);
      ep.Add(ei.n1.id);
    }

    E = sp;
    F = ep;
# ---------- c_script: C# additional code ----------
  class Truss {
    public List<Node> n = new List<Node>();
    public List<Edge> e = new List<Edge>();

    public void Clear() {
      n.Clear();
      e.Clear();
    }

    public Edge AddEdge(Point3d p0, Point3d p1) {
      Edge ei = new Edge(AddPoint(p0, 0.0001), AddPoint(p1, 0.0001));
      e.Add(ei);
      return ei;
    }

    public void AddLoad(Point3d p, Vector3d f) {
      Node nd = AddPoint(p, 0.001);
      nd.f += f;
    }

    public void FixPoint(Point3d p, bool fixx, bool fixy, bool fixz) {
      Node nd = AddPoint(p, 0.001);
      nd.fixX = fixx;
      nd.fixY = fixy;
      nd.fixZ = fixz;
    }

    public Node AddPoint(Point3d p, double tolerance) {
      Node ni = FindNode(p, tolerance);
      if (ni != null) return ni;
      ni = new Node();
      ni.p = p;

      ni.id = n.Count;
      n.Add(ni);

      return ni;
    }

    public Node FindNode(Point3d p, double tolerance) {
      double t2 = tolerance * tolerance;

      foreach(Node ni in n) {
        Vector3d dv = ni.p - p;
        if (dv.SquareLength <= t2) return ni;
      }
      return null;
    }


  }

  class Node {
    public Point3d p = Point3d.Origin;
    public Vector3d f = Vector3d.Zero;
    public int id = 0;
    public bool fixX = false;
    public bool fixY = false;
    public bool fixZ = false;
  }

  class Edge {
    public Edge(Node _n0, Node _n1) {
      n0 = _n0;
      n1 = _n1;
    }

    public  Node n0;
    public  Node n1;

    public void FillInSMatrix(double E, double A, double [,] K) {
      Vector3d dv = n1.p - n0.p;
      double L = dv.Length;
      double EAL = E * A / L;

      double l = dv.X / L;
      double m = dv.Y / L;
      double n = dv.Z / L;

      K[0, 0] = l * l;
      K[1, 1] = m * m;
      K[2, 2] = n * n;

      K[3, 3] = l * l;
      K[4, 4] = m * m;
      K[5, 5] = n * n;

      K[0, 1] = K[1, 0] = m * l;
      K[0, 2] = K[2, 0] = n * l;
      K[0, 3] = K[3, 0] = -l * l;
      K[0, 4] = K[4, 0] = -m * l;
      K[0, 5] = K[5, 0] = -n * l;

      K[1, 2] = K[2, 1] = m * n;
      K[1, 3] = K[3, 1] = -m * l;
      K[1, 4] = K[4, 1] = -m * m;
      K[1, 5] = K[5, 1] = -m * n;

      K[2, 3] = K[3, 2] = -n * l;
      K[2, 4] = K[4, 2] = -m * n;
      K[2, 5] = K[5, 2] = -n * n;

      K[3, 4] = K[4, 3] = m * l;
      K[3, 5] = K[5, 3] = n * l;

      K[4, 5] = K[5, 4] = m * n;
    }

  }
# ---------- end c_script ----------
sparse_solver = SparseSystemSolver(MatrixEntries=c_script.A, BVector=c_script.B, BoundaryConditions=c_script.C)

dispatch = Dispatch(List=sparse_solver, DispatchPattern=[True, False, False])  # -> ListA, ListB
dispatch_2 = Dispatch(List=dispatch.ListB, DispatchPattern=[True, False])  # -> ListA, ListB
vec = VectorXYZ(XComponent=dispatch.ListA, YComponent=dispatch_2.ListA, ZComponent=dispatch_2.ListB)  # -> Vector, Length
bnd = Bounds(Numbers=vec.Length)
domcomp = DomainComponents(Domain=bnd)  # -> Start, End
division = Division(A=Slider(3.413, range=0..21), B=domcomp.End)
multiplication = Multiplication(A=vec.Vector, B=division)
addition = Addition(A=c_script.D, B=multiplication)
item = ListItem(List=addition, Index=c_script.E, Wrap=False)
item_2 = ListItem(List=addition, Index=c_script.F, Wrap=False)
ln = Line(StartPoint=item, EndPoint=item_2)
