# Grasshopper definition 018_eigenfunctions.gh (Grasshopper 0.9.64)
# plug-ins: Millipede

crv = Curve(<curve referenced from the Rhino model>)
planar = PlanarSrf(Edges=crv)
mesh_uv = MeshSurface(Surface=planar, UCount=Slider(35, range=0..60), VCount=Slider(35, range=0..60), Overhang=False, Equalize=True)

c_script = CSharpScript(m=mesh_uv)  # -> out, A, B; inputs m: Mesh
# ---------- c_script: C# ----------
    int rs = m.Vertices.Count;
    int rs2 = rs * rs;
    double[] a = new double[rs2];
    Random rn = new Random();
    for(int i = 0; i < rs2; ++i) {
      a[i] = 0.0;//rn.NextDouble();
    }

    for(int i = 0; i < m.Faces.Count; ++i) {
      int qn = 3;
      if (m.Faces[i].IsQuad) qn = 4;
      for(int j = 0; j < qn; ++j) {
        int v0 = m.Faces[i][j];
        int v1 = m.Faces[i][(j + 1) % qn];

        int i01 = v0 * rs + v1;
        if (a[i01] != 0.0) continue;

        int i10 = v1 * rs + v0;

        int i00 = v0 * rs + v0;
        int i11 = v1 * rs + v1;

        a[i01] = -1.0;
        a[i10] = -1.0;

        a[i00] += 1.0;
        a[i11] += 1.0;
      }
    }

    A = a;
    B = rs;
# ---------- end c_script ----------
eigensystem = SymmetricEigenSystem(RealMatrix=c_script.A, ImagMatrix=c_script.A, Resolution=c_script.B, NumberOfEigenVectors=Slider(0, range=0..238))  # -> EigenValues, EigenVectors

branch = TreeBranch(Tree=eigensystem.EigenVectors, Path=Slider(37, range=0..60), MaintainPaths=False)

complex = ComplexComponents(Complex=branch)  # -> Real, Imaginary
cmod = ComplexModulus(Complex=branch)
bnd = Bounds(Numbers=complex.Imaginary)
bnd_2 = Bounds(Numbers=complex.Real)
bnd_3 = Bounds(Numbers=cmod)
remap = RemapNumbers(Values=complex.Imaginary, Source=bnd, Target=Domain(0, 1))
remap_2 = RemapNumbers(Values=complex.Real, Source=bnd_2, Target=Domain(0, 1))
remap_3 = RemapNumbers(Values=cmod, Source=bnd_3, Target=Domain(0, 1))
xyz = ColourXYZ(Alpha=1, X=remap_3, Y=remap_3, Z=remap_3)
mcol = MeshColours(Mesh=mesh_uv, Colours=xyz)
