# Grasshopper definition 01_codingElements.gh (Grasshopper 0.9.64)
# plug-ins: Millipede

# ----
# example of constructing the FE system in code
pt = Point(<point referenced from the Rhino model>)
c_script = CSharpScript(
    p=pt,
    Reference=["C:\Users\pan\AppData\Roaming\Grasshopper\Libraries\SawapanStatica.dll", "C:\Users\pan\AppData\Roaming\Grasshopper\Libraries\SawapanStatRhino.dll"])  # -> out, A, B, C; inputs p: Point3d
# ---------- c_script: C# ----------
    //create an FE system
    RStatSystem rs = new RStatSystem();

    //add a material to the system
    StatMaterial m = rs.AddMaterial(MATERIALTYPES.STEEL, "steel1");
    //add a cross-section using material m
    StatCrossSection s = rs.AddSection(m, "sec1");
    //set the cros section shape to hollow circular, and set radii
    s.CircHollow(0.03, 0.04, 16);

    //create the 3 points of the system
    Point3d p0 = p;
    Point3d p1 = new Point3d(p.X, p.Y + 0.2, p.Z + 1.0);
    Point3d p2 = new Point3d(p.X + 1.0, p.Y, p.Z + 2.5);
    Point3d p3 = new Point3d(p.X - 1.0, p.Y, p.Z + 2.5);
    Point3d p4 = new Point3d(p.X, p.Y + 1.0, p.Z + 2.5);

    //create a node for each point [if two points coincide then you will get the same node for both of them]
    RStatNode n0 = rs.AddNode(p);
    RStatNode n1 = rs.AddNode(p1);
    RStatNode n2 = rs.AddNode(p2);
    RStatNode n3 = rs.AddNode(p3);
    RStatNode n4 = rs.AddNode(p4);


    //add some frame elements connecting the previously created nodes
    RStatBeam b0 = rs.AddBeam(n0, n1, s);
    RStatBeam b1 = rs.AddBeam(n1, n2, s);
    RStatBeam b2 = rs.AddBeam(n1, n3, s);
    RStatBeam b3 = rs.AddBeam(n1, n4, s);

    n0.SupportType = BOUNDARYCONDITIONS.ALL;
    n2.AddLoad(0.0, 0.0, -1000.0);
    n3.AddLoad(0.0, 0.0, -1000.0);
    n4.AddLoad(0.0, 0.0, -1000.0);

    //set the self weight factor to 0.0. Only applied loads will be taken into account
    rs.DeadLoadFactor = 0.0;


    //solve the system and recover displacements, forces etc....
    rs.SolveSystem();


    //output the whole system [so that we can connect other millipede components
    A = rs;
    //output the Maximum deflection
    B = rs.MaximumDisplacement;
    //output the maximum normal stress along the first frame element
    C = b0.MaxStress;
# ---------- end c_script ----------
division = Division(A=Slider(0, range=0..9), B=c_script.B)
frame_visualization = FrameVisualization(
    FEModel=c_script.A,
    DetailedOutput=True,
    Deflection=division,
    Inflation=Slider(0, range=0..3),
    Subdivision=0.1,
    OptScale=False,
    ColorMode=4)  # -> Curves, Meshes, CompleteRange, VisibleRange
