# Grasshopper definition 03_readingResults.gh (Grasshopper 0.9.64)
# plug-ins: Millipede

# ----
# example of constructing the FE system in code
pipeline = GeometryPipeline(
    GroupByLayer=False,
    GroupByType=False,
    IncludeHidden=True,
    IncludeLocked=True,
    LayerFilter="frames",
    NameFilter="*",
    TypeFilter=4)
pipeline_2 = GeometryPipeline(
    GroupByLayer=False,
    GroupByType=False,
    IncludeHidden=True,
    IncludeLocked=True,
    LayerFilter="supports",
    NameFilter="*",
    TypeFilter=1)
c_script = CSharpScript(
    c=pipeline,
    sp=pipeline_2,
    Reference=["C:\Users\pan\AppData\Roaming\Grasshopper\Libraries\SawapanStatica.dll", "C:\Users\pan\AppData\Roaming\Grasshopper\Libraries\SawapanStatRhino.dll"])  # -> out, A, B, T, TN, C, CN; inputs c: list of Curve, sp: list of Point3d
# ---------- c_script: C# ----------
    //create an FE system
    RStatSystem rs = new RStatSystem();

    //add a material to the system
    StatMaterial m = rs.AddMaterial(MATERIALTYPES.STEEL, "steel1");
    //add a cross-section using material m
    StatCrossSection s = rs.AddSection(m, "sec1");
    //set the cros section shape to hollow circular, and set radii
    s.CircHollow(0.03, 0.04, 16);


    rs.SplitAndAddCurvesAsBeams(c, s, 0.001, 0.1);
    //rs.AddCurvesAsBeams(c, s, 0.001, 0.1);

    rs.AddSupportAtPoints(sp, BOUNDARYCONDITIONS.ALL);



    rs.DeadLoadFactor = 1.0;


    //solve the system and recover displacements, forces etc....
    rs.SolveSystem();



    //output the whole system [so that we can connect other millipede components
    A = rs;
    //output the Maximum deflection
    B = rs.MaximumDisplacement;

    List<Line> Tension = new List<Line>();
    List<Line> Compression = new List<Line>();

    List<double> TensionN = new List<double>();
    List<double> CompressionN = new List<double>();

    foreach (RStatBeam b in rs.Beams) {
      if (b.ForceAtNode0.x < 0.0) {
        Tension.Add(new Line(b.P0.ToPoint3d(), b.P1.ToPoint3d()));
        TensionN.Add(b.ForceAtNode0.x);
      }
      else {
        Compression.Add(new Line(b.P0.ToPoint3d(), b.P1.ToPoint3d()));
        CompressionN.Add(b.ForceAtNode0.x);
      }
    }
    
    T = Tension;
    TN = TensionN;
    C = Compression;
    CN = CompressionN;
# ---------- end c_script ----------
division = Division(A=Slider(0, range=0..9), B=c_script.B)
frame_visualization = FrameVisualization(
    FEModel=c_script.A,
    DetailedOutput=True,
    Deflection=division,
    Inflation=Slider(0.373, range=0..3),
    Subdivision=0.1,
    OptScale=False,
    ColorMode=1)  # -> Curves, Meshes, CompleteRange, VisibleRange; disabled

crv = Curve(c_script.T)
crv_2 = Curve(c_script.C)
pipe = Pipe(Curve=crv_2, Radius=Slider(0.163, range=0..1), Caps=0)
pipe_2 = Pipe(Curve=crv, Radius=Slider(0.038, range=0..1), Caps=0)
preview = CustomPreview(Geometry=pipe_2, Shader=ColourSwatch(SwatchColor=RGB(99, 168, 184)))
preview_2 = CustomPreview(Geometry=pipe, Shader=ColourSwatch(SwatchColor=RGB(222, 211, 206)))
