# Grasshopper definition 04_reanalyze.gh (Grasshopper 0.9.64)
# plug-ins: Millipede

# ----
# example of constructing the FE system in code
pipeline = GeometryPipeline(
    GroupByLayer=False,
    GroupByType=False,
    IncludeHidden=True,
    IncludeLocked=True,
    LayerFilter="frames",
    NameFilter="*",
    TypeFilter=4)
pipeline_2 = GeometryPipeline(
    GroupByLayer=False,
    GroupByType=False,
    IncludeHidden=True,
    IncludeLocked=True,
    LayerFilter="supports",
    NameFilter="*",
    TypeFilter=1)
c_script = CSharpScript(
    c=pipeline,
    sp=pipeline_2,
    Reference=["C:\Users\pan\AppData\Roaming\Grasshopper\Libraries\SawapanStatica.dll", "C:\Users\pan\AppData\Roaming\Grasshopper\Libraries\SawapanStatRhino.dll"])  # -> out, A, B; inputs c: list of Curve, sp: list of Point3d
# ---------- c_script: C# ----------
    //create an FE system
    RStatSystem rs = new RStatSystem();

    //add a material to the system
    StatMaterial m = rs.AddMaterial(MATERIALTYPES.STEEL, "steel1");
    //add a cross-section using material m
    StatCrossSection s = rs.AddSection(m, "sec1");
    //set the cros section shape to hollow circular, and set radii
    s.CircHollow(0.03, 0.04, 9);


    rs.SplitAndAddCurvesAsBeams(c, s, 0.001, 0.1);
    //rs.AddCurvesAsBeams(c, s, 0.001, 0.1);

    rs.AddSupportAtPoints(sp, BOUNDARYCONDITIONS.ALL);



    rs.DeadLoadFactor = 1.0;


    //solve the system and recover displacements, forces etc....
    rs.SolveSystem();





    StatCrossSection s2 = rs.AddSection(m, "sec2");
    s2.CircHollow(0.08, 0.09, 9);


    List<double> stresses = new List<double>();
    foreach(RStatBeam b in rs.Beams) {
      stresses.Add(b.MaxStress);
    }

    stresses.Sort();

    double median = stresses[stresses.Count / 2];
    double maximum = stresses[stresses.Count - 1];

    foreach(RStatBeam b in rs.Beams) {
      double rad = 0.1 * b.MaxStress / maximum;
      StatCrossSection si = rs.AddSection(m, "sec2");
      si.CircHollow(rad, rad + 0.05, 9);

      b.CrossSection = si;
    }


    rs.SolveSystem();



    //output the whole system [so that we can connect other millipede components
    A = rs;
    //output the Maximum deflection
    B = rs.MaximumDisplacement;
# ---------- end c_script ----------
division = Division(A=Slider(0, range=0..9), B=c_script.B)
frame_visualization = FrameVisualization(
    FEModel=c_script.A,
    DetailedOutput=True,
    Deflection=division,
    Inflation=Slider(0.373, range=0..3),
    Subdivision=0.1,
    OptScale=False,
    ColorMode=0)  # -> Curves, Meshes, CompleteRange, VisibleRange

preview = CustomPreview(Geometry=frame_visualization.Meshes, Shader=ColourSwatch(SwatchColor=RGB(204, 204, 204)))
