# Grasshopper definition 05_detailedResults.gh (Grasshopper 0.9.64)
# plug-ins: Millipede

pipeline = GeometryPipeline(
    GroupByLayer=False,
    GroupByType=False,
    IncludeHidden=True,
    IncludeLocked=True,
    LayerFilter="frames",
    NameFilter="*",
    TypeFilter=4)
pipeline_2 = GeometryPipeline(
    GroupByLayer=False,
    GroupByType=False,
    IncludeHidden=True,
    IncludeLocked=True,
    LayerFilter="supports",
    NameFilter="*",
    TypeFilter=1)
mat = Material(MaterialType=2)
mat_2 = SupportType(X=True, Y=True, Z=True, RX=True, RY=True, RZ=True)
csection = CrossSection(Material=mat, InnerRadius=Slider(0.041, range=0..1), Thickness=0.01, CrossSectionType=1)
fcurves = FrameCurves(Curves=pipeline, CrossSection=csection, LinearLoad=Vector(0, 0, 0), SupportType=0)
fepointsupports = FEPointSupports(Point=pipeline_2, SupportType=mat_2)

fea_system = FEASystem(
    ModelComponents=flatten([fcurves, fepointsupports]),
    IntersectAddedCurves=True,
    MergeTolerance=0.0001,
    MinimumCurveSpan=0.05,
    MaximumCurveSpan=10000,
    CurveTolerance=0.1)
fe_solver = FESolver(
    FEModel=fea_system,
    SelfWeightCoefficient=1,
    BeamOptimisationIterations=0,
    QuadOptimisationIterations=0,
    OptimizationTarget=0.3,
    OptimizationPenalization=2,
    LoadCase=0,
    AllCases=True)  # -> FEModel, MaxDeflection, Weight
division = Division(A=Slider(0, range=0..9), B=fe_solver.MaxDeflection)
frame_visualization = FrameVisualization(
    FEModel=fe_solver.FEModel,
    DetailedOutput=True,
    Deflection=division,
    Inflation=Slider(0, range=0..3),
    Subdivision=0.1,
    OptScale=False,
    ColorMode=2)  # -> Curves, Meshes, CompleteRange, VisibleRange

c_script = CSharpScript(
    ri=fe_solver.FEModel,
    Reference=["C:\Users\pan\AppData\Roaming\Grasshopper\Libraries\SawapanStatica.dll", "C:\Users\pan\AppData\Roaming\Grasshopper\Libraries\SawapanStatRhino.dll"])  # -> out, A, B
# ---------- c_script: C# ----------
    RStatSystem rs = ri as RStatSystem;


    double maxmom = rs.Beams.Max(bx => bx.MaxBendingMoment);

    StatBeamResults br = new StatBeamResults();

    int num = 10;
    List<Line> slines = new List<Line>();
    List<Ellipse> el = new List<Ellipse>();

    foreach(RStatBeam b0 in rs.Beams) {
      for(int i = 0; i < num; ++i) {

        br.t = i / (double) (num - 1.0);
        br.yL = 0.0;
        br.zL = 0.0;

        b0.GetInterpolatedAxisResultsAt(rs.GravityDirection, rs.DeadLoadFactor, br);
        C_vector pt = b0.GetPointGlobal(br, 0.0);
        C_vector mo = new C_vector(0.0, -br.MomentL.z, br.MomentL.y);
        double mag = mo.Length;
        C_vector dm;
        b0.TransformVectorLtoW(mo, out dm);

        dm.Normalize();

        C_vector dz = C_vector.CrossProduct(dm, b0.Csys.Ex);

        Plane pl = new Plane(pt.ToPoint3d(), dm.ToVector3d(), dz.ToVector3d());

        double sz = 0.05 + 0.1 * mag / maxmom;

        C_vector pp0 = pt - dm * sz;
        C_vector pp1 = pt + dm * sz;

        if (mag > maxmom * 0.25)
          el.Add(new Ellipse(pl, sz, sz * 0.5));
        else
          el.Add(new Ellipse(pl, 0.03, 0.03));

        slines.Add(new Line(pp0.ToPoint3d(), pp1.ToPoint3d()));
      }
    }

    A = slines;
    B = el;
# ---------- end c_script ----------
