# Grasshopper definition 002_ShellSurface.gh (Grasshopper 0.9.64)
# plug-ins: Millipede

brep = Brep([<brep referenced from the Rhino model> x2])
Z = UnitZ(Factor=Slider(-802.523, range=-1110..1))
load_region = LoadRegion(Boundary=brep, NodeLoad=Z)

mat = Material(MaterialType=2)
brep_2 = Brep(<brep referenced from the Rhino model>)
mesh = MeshBrep(
    Brep=brep_2,
    Settings={GridMaxCount=0, GridMinCount=16, JaggedSeams=False, MaxEdgeLength=2, MinEdgeLength=2, MinTolerance=0, Refine=True, RefineAngle=0, RelativeTolerance=0.65, SimplePlanes=True, Tolerance=0})
femesh = FEMesh(Meshes=mesh, Material=mat, Thickness=Slider(0.245, range=0..1), AreaLoad=Vector(0, 0, 0), NormalAreaLoad=0)

mat_2 = MillC_StockSupportType(X=True, Y=True, Z=True, RX=True, RY=True, RZ=True)
brep_3 = Brep([<brep referenced from the Rhino model> x2])
support_region = MSupportTypeRegion(Boundary=brep_3, SupportType=mat_2, AmmendExistingSupports=True)

fe_system = FESystem(
    ModelComponents=[femesh, support_region, load_region],
    IntersectAddedCurves=True,
    MergeTolerance=0.0001,
    MinimumCurveSpan=0.05,
    MaximumCurveSpan=10000,
    CurveTolerance=0.1)
fe_solver = FESolver(
    FEModel=fe_system,
    SelfWeightCoefficient=Slider(0, range=0..1),
    BeamOptimisationIterations=0,
    QuadOptimisationIterations=0,
    OptimizationTarget=0.3,
    OptimizationPenalization=2,
    LoadCase=0,
    AllCases=True)  # -> FEModel, MaxDeflection, Weight

division = Division(A=Slider(0, range=0..14), B=fe_solver.MaxDeflection)
mesh_visualization = MeshVisualization(FEModel=fe_solver.FEModel, Deflection=division, Plane=Slider(1, range=-1..1), ShowThickness=Toggle(False), ColorMode=4)  # -> Mesh, CompleteRange, VisibleRange
