# Grasshopper definition 003_slab_02.gh (Grasshopper 0.9.64)
# plug-ins: Millipede

brep = Brep(<brep referenced from the Rhino model>)
mat = Material(MaterialType=2)
mesh = MeshBrep(
    Brep=brep,
    Settings={GridMaxCount=0, GridMinCount=16, JaggedSeams=False, MaxEdgeLength=0.5, MinEdgeLength=0.5, MinTolerance=0, Refine=True, RefineAngle=0, RelativeTolerance=0.65, SimplePlanes=False, Tolerance=0})
femesh = FEMesh(Meshes=mesh, Material=mat, Thickness=Slider(0.245, range=0..1), AreaLoad=Vector(0, 0, 0), NormalAreaLoad=0)

brep_2 = Brep([<brep referenced from the Rhino model> x2])
Z = UnitZ(Factor=Slider(-802.523, range=-1110..1))
load_region = LoadRegion(Boundary=brep_2, NodeLoad=Z)

brep_3 = Brep([<brep referenced from the Rhino model> x2])
mat_2 = MillC_StockSupportType(X=True, Y=True, Z=True, RX=True, RY=True, RZ=True)
support_region = MSupportTypeRegion(Boundary=brep_3, SupportType=mat_2, AmmendExistingSupports=True)

fe_system = FESystem(
    ModelComponents=[femesh, support_region, load_region],
    IntersectAddedCurves=True,
    MergeTolerance=0.0001,
    MinimumCurveSpan=0.05,
    MaximumCurveSpan=10000,
    CurveTolerance=0.1)
fe_solver = FESolver(
    FEModel=fe_system,
    SelfWeightCoefficient=Slider(0, range=0..1),
    BeamOptimisationIterations=0,
    QuadOptimisationIterations=0,
    OptimizationTarget=0.3,
    OptimizationPenalization=2,
    LoadCase=0,
    AllCases=True)  # -> FEModel, MaxDeflection, Weight

slider = Slider(1, range=-1..1)
quad_results = QuadResults(FEModel=fe_solver.FEModel, Plane=slider)  # -> PrincipalStressFrame, Area, NormalDisplacement, MaxVonMisesStress, PS1, PS2, StiffnessMultiplier, Bending
c_script = CSharpScript(ps1=quad_results.PS2)  # -> out, A; inputs ps1: Double
# ---------- c_script: C# ----------
    if (ps1 < 0.0) A = Color.Red;
    else A = Color.Cyan;
# ---------- end c_script ----------
pcomp = PlaneComponents(Plane=quad_results.PrincipalStressFrame)  # -> Origin, XAxis, YAxis, ZAxis
c_script_2 = CSharpScript(ps1=quad_results.PS1)  # -> out, A; inputs ps1: Double; same code as c_script
vdisex = VectorDisplayEx(Point=pcomp.Origin, Vector=pcomp.XAxis, Colour=c_script_2.A, Width=1)
vdisex_2 = VectorDisplayEx(Point=pcomp.Origin, Vector=pcomp.YAxis, Colour=c_script.A, Width=1)

popgeo = PopulateGeometry(Geometry=brep, Count=Slider(130, range=0..1000), Seed=1)
stresslines = StressLines(FEModel=fe_solver.FEModel, Points=popgeo, Plane=slider)  # -> Stress1, Stress2
preview = CustomPreview(Geometry=stresslines.Stress2, Shader=ColourSwatch(SwatchColor=RGB(255, 255, 255)))
preview_2 = CustomPreview(Geometry=stresslines.Stress1, Shader=ColourSwatch(SwatchColor=RGB(0, 0, 0)))

division = Division(A=Slider(0, range=0..14), B=fe_solver.MaxDeflection)
mesh_visualization = MeshVisualization(FEModel=fe_solver.FEModel, Deflection=division, Plane=slider, ShowThickness=False, ColorMode=2)  # -> Mesh, CompleteRange, VisibleRange
