# Grasshopper definition 004_leaf.gh (Grasshopper 0.9.64)
# plug-ins: Millipede

brep = Brep(<brep referenced from the Rhino model>)
Z = UnitZ(Factor=Slider(-802.523, range=-1110..1))
load_region = LoadRegion(Boundary=brep, NodeLoad=Z)

brep_2 = Brep(<brep referenced from the Rhino model>)
mat = MillC_StockSupportType(X=True, Y=True, Z=True, RX=True, RY=True, RZ=True)
support_region = MSupportTypeRegion(Boundary=brep_2, SupportType=mat, AmmendExistingSupports=True)

brep_3 = Brep(<brep referenced from the Rhino model>)
mat_2 = Material(MaterialType=2)
mesh = MeshBrep(
    Brep=brep_3,
    Settings={GridMaxCount=0, GridMinCount=16, JaggedSeams=False, MaxEdgeLength=1, MinEdgeLength=1, MinTolerance=0, Refine=True, RefineAngle=0, RelativeTolerance=0.65, SimplePlanes=False, Tolerance=0})
femesh = FEMesh(Meshes=mesh, Material=mat_2, Thickness=Slider(2.184, range=0..4), AreaLoad=Vector(0, 0, 0), NormalAreaLoad=0)

fe_system = FESystem(
    ModelComponents=[femesh, support_region, load_region],
    IntersectAddedCurves=True,
    MergeTolerance=0.0001,
    MinimumCurveSpan=0.05,
    MaximumCurveSpan=10000,
    CurveTolerance=0.1)
fe_solver = FESolver(
    FEModel=fe_system,
    SelfWeightCoefficient=Slider(0, range=0..1),
    BeamOptimisationIterations=0,
    QuadOptimisationIterations=Slider(14, range=0..14),
    OptimizationTarget=0.3,
    OptimizationPenalization=Slider(1.5, range=0..3),
    LoadCase=0,
    AllCases=True)  # -> FEModel, MaxDeflection, Weight

division = Division(A=Slider(0, range=0..14), B=fe_solver.MaxDeflection)
mesh_visualization = MeshVisualization(FEModel=fe_solver.FEModel, Deflection=division, Plane=Slider(1, range=-1..1), ShowThickness=Toggle(False), ColorMode=8)  # -> Mesh, CompleteRange, VisibleRange
preview = CustomPreview(Geometry=mesh_visualization.Mesh, Shader=ColourSwatch(SwatchColor=RGB(161, 161, 161)))
