# Grasshopper definition 005_chair.gh (Grasshopper 0.9.64)
# plug-ins: Millipede

brep = Brep(<brep referenced from the Rhino model>)
mat = Material(MaterialType=2)
mesh_uv = MeshSurface(Surface=brep, UCount=Slider(59, range=0..100), VCount=Slider(22, range=0..100), Overhang=True, Equalize=False)
femesh = FEMesh(Meshes=mesh_uv, Material=mat, Thickness=Slider(0.1, range=0..3), AreaLoad=Vector(0, 0, 0), NormalAreaLoad=0)

brep_2 = Brep(<brep referenced from the Rhino model>)
load_region = LoadRegion(Boundary=brep_2, ArealNormalLoad=Slider(-802.523, range=-1110..1))

brep_3 = Brep(<brep referenced from the Rhino model>)
mat_2 = MillC_StockSupportType(X=True, Y=True, Z=True, RX=True, RY=True, RZ=True)
support_region = MSupportTypeRegion(Boundary=brep_3, SupportType=mat_2, AmmendExistingSupports=True)

faceb = FaceBoundaries(Mesh=mesh_uv)  # disabled

fe_system = FESystem(
    ModelComponents=[femesh, support_region, load_region],
    IntersectAddedCurves=True,
    MergeTolerance=0.0001,
    MinimumCurveSpan=0.05,
    MaximumCurveSpan=10000,
    CurveTolerance=0.1)
fe_solver = FESolver(
    FEModel=fe_system,
    SelfWeightCoefficient=Slider(1, range=0..1),
    BeamOptimisationIterations=0,
    QuadOptimisationIterations=Slider(18, range=0..18),
    OptimizationTarget=Slider(0.15, range=0..1),
    OptimizationPenalization=Slider(2.088, range=0..3),
    LoadCase=0,
    AllCases=True)  # -> FEModel, MaxDeflection, Weight

slider = Slider(1, range=-1..1)
division = Division(A=Slider(0, range=0..14), B=fe_solver.MaxDeflection)
quad_results = QuadResults(FEModel=fe_solver.FEModel, Plane=1)  # -> PrincipalStressFrame, Area, NormalDisplacement, MaxVonMisesStress, PS1, PS2, StiffnessMultiplier, Bending; disabled
mesh_visualization = MeshVisualization(FEModel=fe_solver.FEModel, Deflection=division, Plane=slider, ShowThickness=Toggle(False), ColorMode=8)  # -> Mesh, CompleteRange, VisibleRange
stresslines = StressLines(FEModel=fe_solver.FEModel, Points=quad_results.PrincipalStressFrame, Plane=slider)  # -> Stress1, Stress2
