# Grasshopper definition 0088_Simpleshells.gh (Grasshopper 0.9.64)
# plug-ins: Millipede

support_breps = Brep(<brep referenced from the Rhino model>)
srf = Surface(<surface referenced from the Rhino model>)
c_script = CSharpScript(s=srf, ru=Slider(30, range=0..60), rv=Slider(30, range=0..60))  # -> out, A; inputs s: Surface, ru: Int32, rv: Int32
# ---------- c_script: C# ----------
    Mesh m = Mesh.CreateFromPlane(Plane.WorldXY, s.Domain(0), s.Domain(1), ru - 1, rv - 1);

    for(int i = 0; i < m.Vertices.Count; ++i) {
      double u = m.Vertices[i].X;
      double v = m.Vertices[i].Y;
      m.TextureCoordinates.SetTextureCoordinate(i, 2.0*(s.Domain(0).NormalizedParameterAt(u)-0.5), 2.0*(s.Domain(1).NormalizedParameterAt(v)-0.5));
      m.Vertices.SetVertex(i, s.PointAt(u, v));
      m.Normals.SetNormal(i, s.NormalAt(u, v));
    }

    A = m;
# ---------- end c_script ----------

toggle = BooleanToggle(True)
mat = Material(MaterialType=2)
mat_2 = MillC_StockSupportType(X=True, Y=True, Z=True, RX=toggle, RY=toggle, RZ=toggle)
support_region = MSupportTypeRegion(Boundary=support_breps, SupportType=mat_2, AmmendExistingSupports=True)
femesh = FEMesh(Meshes=c_script.A, Material=mat, Thickness=Slider(0.25, range=0..1), AreaLoad=Vector(0, 0, 0), NormalAreaLoad=0)

fea_system = FEASystem(
    ModelComponents=flatten([support_region, femesh]),
    IntersectAddedCurves=True,
    MergeTolerance=0.0001,
    MinimumCurveSpan=0.05,
    MaximumCurveSpan=10000,
    CurveTolerance=0.1)
fe_solver = FESolver(
    FEModel=fea_system,
    SelfWeightCoefficient=Slider(1, range=0..1),
    BeamOptimisationIterations=0,
    QuadOptimisationIterations=Slider(5, range=0..10),
    OptimizationTarget=Slider(0.4, range=0..1),
    OptimizationPenalization=2,
    LoadCase=0,
    AllCases=True)  # -> FEModel, MaxDeflection, Weight

panel = Panel("0 To 158526.449639")

division = Division(A=Slider(0, range=0..1), B=fe_solver.MaxDeflection)
mesh_visualization = MeshVisualization(FEModel=fe_solver.FEModel, Deflection=division, Plane=1, ShowThickness=Toggle(True), ColorMode=8)  # -> Mesh, CompleteRange, VisibleRange

panel_2 = Panel(mesh_visualization.CompleteRange)
preview = CustomPreview(Geometry=mesh_visualization.Mesh, Shader=ColourSwatch(SwatchColor=RGB(169, 134, 209)))
