# Grasshopper definition 00_Simpleshells.gh (Grasshopper 0.9.64)
# plug-ins: Millipede

support_breps = Brep(<brep referenced from the Rhino model>)
srf = Surface(<surface referenced from the Rhino model>)
c_script = CSharpScript(s=srf, ru=Slider(30, range=0..60), rv=Slider(30, range=0..60))  # -> out, A; inputs s: Surface, ru: Int32, rv: Int32
# ---------- c_script: C# ----------
    Mesh m = Mesh.CreateFromPlane(Plane.WorldXY, s.Domain(0), s.Domain(1), ru - 1, rv - 1);

    for(int i = 0; i < m.Vertices.Count; ++i) {
      double u = m.Vertices[i].X;
      double v = m.Vertices[i].Y;
      m.TextureCoordinates.SetTextureCoordinate(i, 2.0*(s.Domain(0).NormalizedParameterAt(u)-0.5), 2.0*(s.Domain(1).NormalizedParameterAt(v)-0.5));
      m.Vertices.SetVertex(i, s.PointAt(u, v));
      m.Normals.SetNormal(i, s.NormalAt(u, v));
    }

    A = m;
# ---------- end c_script ----------

support_breps_2 = Brep(<brep referenced from the Rhino model>)
srf_2 = Surface(<surface referenced from the Rhino model>)
c_script_2 = CSharpScript(s=srf_2, ru=Slider(30, range=0..60), rv=Slider(30, range=0..60))  # -> out, A; inputs s: Surface, ru: Int32, rv: Int32; same code as c_script

support_breps_3 = Brep(<brep referenced from the Rhino model>)
srf_3 = Surface(<surface referenced from the Rhino model>)
c_script_3 = CSharpScript(s=srf_3, ru=Slider(30, range=0..60), rv=Slider(30, range=0..60))  # -> out, A; inputs s: Surface, ru: Int32, rv: Int32; same code as c_script

support_breps_4 = Brep(<brep referenced from the Rhino model>)
srf_4 = Surface(<surface referenced from the Rhino model>)
c_script_4 = CSharpScript(s=srf_4, ru=Slider(30, range=0..60), rv=Slider(30, range=0..60))  # -> out, A; inputs s: Surface, ru: Int32, rv: Int32; same code as c_script

support_breps_5 = Brep(<brep referenced from the Rhino model>)
srf_5 = Surface(<surface referenced from the Rhino model>)
c_script_5 = CSharpScript(s=srf_5, ru=Slider(30, range=0..60), rv=Slider(30, range=0..60))  # -> out, A; inputs s: Surface, ru: Int32, rv: Int32; same code as c_script

toggle = BooleanToggle(True)
mat = Material(MaterialType=2)
mat_2 = MillC_StockSupportType(X=True, Y=True, Z=True, RX=toggle, RY=toggle, RZ=toggle)
support_region = MSupportTypeRegion(Boundary=support_breps, SupportType=mat_2, AmmendExistingSupports=True)
femesh = FEMesh(Meshes=c_script.A, Material=mat, Thickness=Slider(0.25, range=0..1), AreaLoad=Vector(0, 0, 0), NormalAreaLoad=0)

toggle_2 = BooleanToggle(True)
mat_3 = Material(MaterialType=2)
mat_4 = MillC_StockSupportType(X=True, Y=True, Z=True, RX=toggle_2, RY=toggle_2, RZ=toggle_2)
support_region_2 = MSupportTypeRegion(Boundary=support_breps_2, SupportType=mat_4, AmmendExistingSupports=True)
femesh_2 = FEMesh(Meshes=c_script_2.A, Material=mat_3, Thickness=Slider(0.25, range=0..1), AreaLoad=Vector(0, 0, 0), NormalAreaLoad=0)

toggle_3 = BooleanToggle(True)
mat_5 = Material(MaterialType=2)
mat_6 = MillC_StockSupportType(X=True, Y=True, Z=True, RX=toggle_3, RY=toggle_3, RZ=toggle_3)
support_region_3 = MSupportTypeRegion(Boundary=support_breps_3, SupportType=mat_6, AmmendExistingSupports=True)
femesh_3 = FEMesh(Meshes=c_script_3.A, Material=mat_5, Thickness=Slider(0.25, range=0..1), AreaLoad=Vector(0, 0, 0), NormalAreaLoad=0)

toggle_4 = BooleanToggle(True)
mat_7 = Material(MaterialType=2)
mat_8 = MillC_StockSupportType(X=True, Y=True, Z=True, RX=toggle_4, RY=toggle_4, RZ=toggle_4)
support_region_4 = MSupportTypeRegion(Boundary=support_breps_4, SupportType=mat_8, AmmendExistingSupports=True)
femesh_4 = FEMesh(Meshes=c_script_4.A, Material=mat_7, Thickness=Slider(0.25, range=0..1), AreaLoad=Vector(0, 0, 0), NormalAreaLoad=0)

toggle_5 = BooleanToggle(True)
mat_9 = Material(MaterialType=2)
mat_10 = MillC_StockSupportType(X=True, Y=True, Z=True, RX=toggle_5, RY=toggle_5, RZ=toggle_5)
support_region_5 = MSupportTypeRegion(Boundary=support_breps_5, SupportType=mat_10, AmmendExistingSupports=True)
femesh_5 = FEMesh(Meshes=c_script_5.A, Material=mat_9, Thickness=Slider(0.25, range=0..1), AreaLoad=Vector(0, 0, 0), NormalAreaLoad=0)

fea_system = FEASystem(
    ModelComponents=flatten([support_region, femesh]),
    IntersectAddedCurves=True,
    MergeTolerance=0.0001,
    MinimumCurveSpan=0.05,
    MaximumCurveSpan=10000,
    CurveTolerance=0.1)
fe_solver = FESolver(
    FEModel=fea_system,
    SelfWeightCoefficient=Slider(1, range=0..1),
    BeamOptimisationIterations=0,
    QuadOptimisationIterations=0,
    OptimizationTarget=0.3,
    OptimizationPenalization=2,
    LoadCase=0,
    AllCases=True)  # -> FEModel, MaxDeflection, Weight

fea_system_2 = FEASystem(
    ModelComponents=flatten([support_region_2, femesh_2]),
    IntersectAddedCurves=True,
    MergeTolerance=0.0001,
    MinimumCurveSpan=0.05,
    MaximumCurveSpan=10000,
    CurveTolerance=0.1)
fe_solver_2 = FESolver(
    FEModel=fea_system_2,
    SelfWeightCoefficient=Slider(1, range=0..1),
    BeamOptimisationIterations=0,
    QuadOptimisationIterations=0,
    OptimizationTarget=0.3,
    OptimizationPenalization=2,
    LoadCase=0,
    AllCases=True)  # -> FEModel, MaxDeflection, Weight

fea_system_3 = FEASystem(
    ModelComponents=flatten([support_region_3, femesh_3]),
    IntersectAddedCurves=True,
    MergeTolerance=0.0001,
    MinimumCurveSpan=0.05,
    MaximumCurveSpan=10000,
    CurveTolerance=0.1)
fe_solver_3 = FESolver(
    FEModel=fea_system_3,
    SelfWeightCoefficient=Slider(1, range=0..1),
    BeamOptimisationIterations=0,
    QuadOptimisationIterations=0,
    OptimizationTarget=0.3,
    OptimizationPenalization=2,
    LoadCase=0,
    AllCases=True)  # -> FEModel, MaxDeflection, Weight

fea_system_4 = FEASystem(
    ModelComponents=flatten([support_region_4, femesh_4]),
    IntersectAddedCurves=True,
    MergeTolerance=0.0001,
    MinimumCurveSpan=0.05,
    MaximumCurveSpan=10000,
    CurveTolerance=0.1)
fe_solver_4 = FESolver(
    FEModel=fea_system_4,
    SelfWeightCoefficient=Slider(1, range=0..1),
    BeamOptimisationIterations=0,
    QuadOptimisationIterations=0,
    OptimizationTarget=0.3,
    OptimizationPenalization=2,
    LoadCase=0,
    AllCases=True)  # -> FEModel, MaxDeflection, Weight

fea_system_5 = FEASystem(
    ModelComponents=flatten([support_region_5, femesh_5]),
    IntersectAddedCurves=True,
    MergeTolerance=0.0001,
    MinimumCurveSpan=0.05,
    MaximumCurveSpan=10000,
    CurveTolerance=0.1)
fe_solver_5 = FESolver(
    FEModel=fea_system_5,
    SelfWeightCoefficient=Slider(1, range=0..1),
    BeamOptimisationIterations=0,
    QuadOptimisationIterations=0,
    OptimizationTarget=0.3,
    OptimizationPenalization=2,
    LoadCase=0,
    AllCases=True)  # -> FEModel, MaxDeflection, Weight

division = Division(A=Slider(0, range=0..1), B=fe_solver.MaxDeflection)
mesh_visualization = MeshVisualization(FEModel=fe_solver.FEModel, Deflection=division, Plane=1, ShowThickness=False, ColorMode=2)  # -> Mesh, CompleteRange, VisibleRange

division_2 = Division(A=Slider(0, range=0..1), B=fe_solver_2.MaxDeflection)
mesh_visualization_2 = MeshVisualization(FEModel=fe_solver_2.FEModel, Deflection=division_2, Plane=1, ShowThickness=False, ColorMode=2)  # -> Mesh, CompleteRange, VisibleRange

omega = Slider(8.448, range=0..11)
scale = BooleanToggle(True)
lambda = BooleanToggle(False)
density = Slider(2, range=0..8)
iter = Slider(3729, range=0..21618)
stress_pattern = StressPattern(
    FEModel=fe_solver.FEModel,
    Omega=omega,
    Scalefield=scale,
    Uselambda=lambda,
    Smoothfactor=0,
    SmoothModulo=1,
    Iterations=iter,
    MeshDenisty=density,
    Layer=1,
    Thickness=0,
    Bending=False)
curves = Curves(System=stress_pattern)

omega_2 = Slider(8.448, range=0..11)
scale_2 = BooleanToggle(True)
lambda_2 = BooleanToggle(False)
iter_2 = Slider(3729, range=0..21618)
density_2 = Slider(2, range=0..8)
stress_pattern_2 = StressPattern(
    FEModel=fe_solver_2.FEModel,
    Omega=omega_2,
    Scalefield=scale_2,
    Uselambda=lambda_2,
    Smoothfactor=0,
    SmoothModulo=1,
    Iterations=iter_2,
    MeshDenisty=density_2,
    Layer=1,
    Thickness=0,
    Bending=False)
curves_2 = Curves(System=stress_pattern_2)

division_3 = Division(A=Slider(0, range=0..1), B=fe_solver_3.MaxDeflection)
mesh_visualization_3 = MeshVisualization(FEModel=fe_solver_3.FEModel, Deflection=division_3, Plane=1, ShowThickness=False, ColorMode=2)  # -> Mesh, CompleteRange, VisibleRange

scale_3 = BooleanToggle(True)
lambda_3 = BooleanToggle(False)
omega_3 = Slider(8.448, range=0..11)
iter_3 = Slider(3729, range=0..21618)
density_3 = Slider(2, range=0..8)
stress_pattern_3 = StressPattern(
    FEModel=fe_solver_3.FEModel,
    Omega=omega_3,
    Scalefield=scale_3,
    Uselambda=lambda_3,
    Smoothfactor=0,
    SmoothModulo=1,
    Iterations=iter_3,
    MeshDenisty=density_3,
    Layer=1,
    Thickness=0,
    Bending=False)
curves_3 = Curves(System=stress_pattern_3)

division_4 = Division(A=Slider(0, range=0..1), B=fe_solver_4.MaxDeflection)
mesh_visualization_4 = MeshVisualization(FEModel=fe_solver_4.FEModel, Deflection=division_4, Plane=1, ShowThickness=False, ColorMode=2)  # -> Mesh, CompleteRange, VisibleRange

scale_4 = BooleanToggle(True)
lambda_4 = BooleanToggle(False)
omega_4 = Slider(8.448, range=0..11)
density_4 = Slider(2, range=0..8)
iter_4 = Slider(3729, range=0..21618)
stress_pattern_4 = StressPattern(
    FEModel=fe_solver_4.FEModel,
    Omega=omega_4,
    Scalefield=scale_4,
    Uselambda=lambda_4,
    Smoothfactor=0,
    SmoothModulo=1,
    Iterations=iter_4,
    MeshDenisty=density_4,
    Layer=1,
    Thickness=0,
    Bending=False)
curves_4 = Curves(System=stress_pattern_4)

division_5 = Division(A=Slider(0, range=0..1), B=fe_solver_5.MaxDeflection)
mesh_visualization_5 = MeshVisualization(FEModel=fe_solver_5.FEModel, Deflection=division_5, Plane=1, ShowThickness=False, ColorMode=2)  # -> Mesh, CompleteRange, VisibleRange

scale_5 = BooleanToggle(True)
lambda_5 = BooleanToggle(False)
omega_5 = Slider(8.448, range=0..11)
density_5 = Slider(2, range=0..8)
iter_5 = Slider(3729, range=0..21618)
stress_pattern_5 = StressPattern(
    FEModel=fe_solver_5.FEModel,
    Omega=omega_5,
    Scalefield=scale_5,
    Uselambda=lambda_5,
    Smoothfactor=0,
    SmoothModulo=1,
    Iterations=iter_5,
    MeshDenisty=density_5,
    Layer=1,
    Thickness=0,
    Bending=False)
curves_5 = Curves(System=stress_pattern_5)
