# Grasshopper definition 025_readingresults.gh (Grasshopper 0.9.64)
# plug-ins: Millipede

slider = Slider(22, range=0..34)
panel = Panel("Geometry generation")
srf = Surface(<surface referenced from the Rhino model>)
mesh_uv = MeshSurface(Surface=srf, UCount=slider, VCount=slider, Overhang=True, Equalize=True)
pt = Point([<point referenced from the Rhino model> x4])

mat = Material(MaterialType=2)
femesh = FEMesh(Meshes=mesh_uv, Material=mat, Thickness=Slider(1, range=0..1), AreaLoad=Vector(0, 0, 0), NormalAreaLoad=0)

brep = Brep(<brep referenced from the Rhino model>)
mat_2 = MillC_StockSupportType(X=True, Y=True, Z=True, RX=True, RY=True, RZ=True)
fepointsupports = FEPointSupports(Point=pt, SupportType=mat_2)
support_region = MSupportTypeRegion(Boundary=brep, SupportType=mat_2, AmmendExistingSupports=True)

fea_system = FEASystem(
    ModelComponents=[femesh, fepointsupports, support_region],
    IntersectAddedCurves=True,
    MergeTolerance=0.0001,
    MinimumCurveSpan=0.05,
    MaximumCurveSpan=10000,
    CurveTolerance=0.1)
fe_solver = FESolver(
    FEModel=fea_system,
    SelfWeightCoefficient=1,
    BeamOptimisationIterations=0,
    QuadOptimisationIterations=Slider(10, range=0..20),
    OptimizationTarget=0.3,
    OptimizationPenalization=2,
    LoadCase=0,
    AllCases=True)  # -> FEModel, MaxDeflection, Weight

division = Division(A=Slider(0, range=0..8), B=fe_solver.MaxDeflection)
quad_results = QuadResults(FEModel=fe_solver.FEModel, Plane=1)  # -> PrincipalStressFrame, Area, NormalDisplacement, MaxVonMisesStress, PS1, PS2, StiffnessMultiplier, Bending
mesh_visualization = MeshVisualization(FEModel=fe_solver.FEModel, Deflection=division, Plane=Slider(0, range=0..1), ShowThickness=Toggle(True), ColorMode=0)  # -> Mesh, CompleteRange, VisibleRange
stress_pattern = StressPattern(
    FEModel=fe_solver.FEModel,
    Omega=Slider(1.7, range=0..6),
    Scalefield=True,
    Uselambda=False,
    Smoothfactor=0,
    SmoothModulo=1,
    Iterations=0,
    MeshDenisty=1,
    Layer=1,
    Thickness=0,
    Bending=False)
curves = Curves(System=stress_pattern)
preview = CustomPreview(Geometry=curves, Shader=ColourSwatch(SwatchColor=RGB(0, 0, 0)))
