# Grasshopper definition 05_ThicknessByStress.gh (Grasshopper 0.9.64)
# plug-ins: Millipede

# ----
# Meshing of input surface
srf = Surface(<surface referenced from the Rhino model>)
# This file demonstrates the use of scripting in order to extract the stresses of the mesh elements and use them to modify the thickness of these elements for subsequent steps
support_breps = Brep([<brep referenced from the Rhino model> x2])
mesh_uv = MeshSurface(Surface=srf, UCount=Slider(20, range=0..60), VCount=Slider(20, range=0..60), Overhang=False, Equalize=True)

panel = Panel("structural analysis")
toggle = BooleanToggle(True)
mat = Material(MaterialType=2)
mat_2 = MillC_StockSupportType(X=True, Y=True, Z=True, RX=toggle, RY=toggle, RZ=toggle)
femesh = FEMesh(Meshes=mesh_uv, Material=mat, Thickness=Slider(0.5, range=0..1), AreaLoad=Vector(0, 0, 0), NormalAreaLoad=0)
support_region = MSupportTypeRegion(Boundary=support_breps, SupportType=mat_2, AmmendExistingSupports=True)
fea_system = FEASystem(
    ModelComponents=flatten([femesh, support_region]),
    IntersectAddedCurves=True,
    MergeTolerance=0.0001,
    MinimumCurveSpan=0.05,
    MaximumCurveSpan=10000,
    CurveTolerance=0.1)
fe_solver = FESolver(
    FEModel=fea_system,
    SelfWeightCoefficient=Slider(1, range=0..1),
    BeamOptimisationIterations=0,
    QuadOptimisationIterations=0,
    OptimizationTarget=0.3,
    OptimizationPenalization=2,
    LoadCase=0,
    AllCases=True)  # -> FEModel, MaxDeflection, Weight

# ----
# visualization of analysis results
slider = Slider(0, range=0..1)
division = Division(A=slider, B=fe_solver.MaxDeflection)
mesh_visualization = MeshVisualization(FEModel=fe_solver.FEModel, Deflection=division, Plane=Slider(1, range=-1..1), ShowThickness=False, ColorMode=2)  # -> Mesh, CompleteRange, VisibleRange

# ----
# we take the list of stresses and remap it from its min max values to the range of thicknesses
# 
# we can raise the stresses to a constant power. Powers less than 1.0 will result in smoother distributions of thickness. This is needed because stresses have a tendency to vary sharply
# finally we apply the thicknesses to the actual quads and redo the structural analysis.
# stress extraction and thickness reassignment
# the first component here extracts the reaults for all the quad shell elements of the initial mesh
min_thickness = Slider(0.01, range=0..1)
max_thickness = Slider(0.6, range=0..1)
quad_results = QuadResults(FEModel=fe_solver.FEModel, Plane=1)  # -> PrincipalStressFrame, Area, NormalDisplacement, MaxVonMisesStress, PS1, PS2, StiffnessMultiplier, Bending
pow = Power(A=quad_results.MaxVonMisesStress, B=Slider(0.262, range=0..1))
dom = ConstructDomain(DomainStart=min_thickness, DomainEnd=max_thickness)
bnd = Bounds(Numbers=pow)
remap = RemapNumbers(Value=pow, Source=bnd, Target=dom)  # -> Mapped, Clipped
c_script = CSharpScript(
    FE=fe_solver.FEModel,
    t=remap.Mapped,
    Reference=["C:\Users\pan\AppData\Roaming\Grasshopper\Libraries\SawapanStatica.dll", "C:\Users\pan\AppData\Roaming\Grasshopper\Libraries\SawapanStatRhino.dll"])  # -> out, A, B, C; inputs t: list of Double
# ---------- c_script: C# ----------
    RStatSystem sys = FE as RStatSystem;


    int qi = 0;
    foreach(RStatShellQuad q in sys.Quads) {
      q.Thickness = t[qi];
      q.Calc();
      qi++;
    }


    sys.SolveSystem();


    A = sys;
    B = sys.MaximumDisplacement;
    C = sys.TotalWeight;
# ---------- end c_script ----------

initial_deflection_and_weight = Panel([fe_solver.MaxDeflection, fe_solver.Weight])
deflection_and_weight_after_redistributi = Panel([c_script.B, c_script.C])  # "deflection and weight after redistribution"

# ----
# visualization of thickened mesh
c_script_2 = CSharpScript(
    FE=c_script.A,
    Reference=["C:\Users\pan\AppData\Roaming\Grasshopper\Libraries\SawapanStatica.dll", "C:\Users\pan\AppData\Roaming\Grasshopper\Libraries\SawapanStatRhino.dll"])  # -> out, A
# ---------- c_script_2: C# ----------
    RStatSystem sys = FE as RStatSystem;

    Mesh m = new Mesh();

    foreach(RStatShellQuad q in sys.Quads) {
      Mesh m2 = new Mesh();

      C_vector qn = q.Csys.Ez * q.Thickness;

      m2.Vertices.Add((q.Node[0].p - qn).ToPoint3d());
      m2.Vertices.Add((q.Node[1].p - qn).ToPoint3d());
      m2.Vertices.Add((q.Node[2].p - qn).ToPoint3d());
      m2.Vertices.Add((q.Node[3].p - qn).ToPoint3d());


      m2.Vertices.Add((q.Node[0].p + qn).ToPoint3d());
      m2.Vertices.Add((q.Node[1].p + qn).ToPoint3d());
      m2.Vertices.Add((q.Node[2].p + qn).ToPoint3d());
      m2.Vertices.Add((q.Node[3].p + qn).ToPoint3d());

      m2.Faces.AddFace(0, 1, 2, 3);
      m2.Faces.AddFace(4, 5, 6, 7);

      m2.Faces.AddFace(0, 1, 5, 4);
      m2.Faces.AddFace(1, 2, 6, 5);
      m2.Faces.AddFace(2, 3, 7, 6);
      m2.Faces.AddFace(3, 0, 4, 7);

      m.Append(m2);
    }


    m.FaceNormals.ComputeFaceNormals();
    m.Normals.ComputeNormals();


    A = m;
# ---------- end c_script_2 ----------
preview = CustomPreview(Geometry=c_script_2.A, Shader=ColourSwatch(SwatchColor=RGB(255, 255, 255)))
