# Grasshopper definition 06_ThicknessDistribution.gh (Grasshopper 0.9.64)
# plug-ins: Millipede

# ----
# meshing of original surface
support_breps = Brep([<brep referenced from the Rhino model> x2])
brep = Brep(<brep referenced from the Rhino model>)
c_script = CSharpScript(s=brep, ru=Slider(40, range=0..60), rv=Slider(30, range=0..60))  # -> out, A; inputs s: Surface, ru: Int32, rv: Int32
# ---------- c_script: C# ----------
    Mesh m = Mesh.CreateFromPlane(Plane.WorldXY, s.Domain(0), s.Domain(1), ru - 1, rv - 1);

    for(int i = 0; i < m.Vertices.Count; ++i) {
      double u = m.Vertices[i].X;
      double v = m.Vertices[i].Y;
      m.TextureCoordinates.SetTextureCoordinate(i, 2.0*(s.Domain(0).NormalizedParameterAt(u)-0.5), 2.0*(s.Domain(1).NormalizedParameterAt(v)-0.5));
      m.Vertices.SetVertex(i, s.PointAt(u, v));
      m.Normals.SetNormal(i, s.NormalAt(u, v));
    }

    A = m;
# ---------- end c_script ----------
mcomp = Decompose(Mesh=c_script.A)  # -> Vertices, Faces, Colours, Normals
inmul = InsideMultiple(Brep=support_breps, Point=mcomp.Vertices, Strict=False)  # -> Inside, Index
c_script_2 = CSharpScript(m=c_script.A, spp=inmul.Inside)  # -> out, A, B, C; inputs m: Mesh, spp: list of Boolean
# ---------- c_script_2: C# ----------
    List<Point3d> pt = new List<Point3d>();
    List<Point3d> pt0 = new List<Point3d>();

    for(int i = 0; i < m.Vertices.Count; ++i) {
      Point3d p = new Point3d(m.Vertices[i]);

      if (spp[i]) {
        pt.Add(p);
      }
      else pt0.Add(p);
    }

    m.FaceNormals.ComputeFaceNormals();
    m.Normals.ComputeNormals();

    A = m;
    B = pt;
    C = pt0;
# ---------- end c_script_2 ----------
pt = Point(c_script_2.B)

# ----
# press repeatedly on the "step" button until a shape emerges
panel = Panel("analysis and optimization")
toggle = BooleanToggle(True)
mat = Material(MaterialType=2)
Z = UnitZ(Factor=Slider(-3343.328, range=-10000..1))
mat_2 = MillC_StockSupportType(X=True, Y=True, Z=True, RX=toggle, RY=toggle, RZ=toggle)
femesh = FEMesh(Meshes=c_script_2.A, Material=mat, Thickness=Slider(0.25, range=0..1), AreaLoad=Vector(0, 0, 0), NormalAreaLoad=0)
fepointsupports = FEPointSupports(Point=pt, SupportType=mat_2)
fepointload = FEPointLoad(Point=c_script_2.C, Load=Z)
optimization_steps = Slider(3, range=0..5)
selfweight = Slider(1, range=0..1)
fea_system = FEASystem(
    ModelComponents=flatten([femesh, fepointsupports, fepointload]),
    IntersectAddedCurves=True,
    MergeTolerance=0.0001,
    MinimumCurveSpan=0.05,
    MaximumCurveSpan=10000,
    CurveTolerance=0.1)
fe_solver = FESolver(
    FEModel=fea_system,
    SelfWeightCoefficient=selfweight,
    BeamOptimisationIterations=0,
    QuadOptimisationIterations=optimization_steps,
    OptimizationTarget=0.3,
    OptimizationPenalization=1.5,
    LoadCase=0,
    AllCases=True)  # -> FEModel, MaxDeflection, Weight

panel_2 = Panel("visualization")
division = Division(A=Slider(0, range=0..1), B=fe_solver.MaxDeflection)
mesh_visualization = MeshVisualization(FEModel=fe_solver.FEModel, Deflection=division, Plane=1, ShowThickness=False, ColorMode=8)  # -> Mesh, CompleteRange, VisibleRange

panel_3 = Panel("visualization of thickness")
c_script_3 = CSharpScript(m=mesh_visualization.Mesh, dh=Slider(0.27, range=-1..1))  # -> out, A; inputs m: Mesh, dh: Double
# ---------- c_script_3: C# ----------
    m.FaceNormals.ComputeFaceNormals();
    m.Normals.ComputeNormals();

    for(int i = 0; i < m.Vertices.Count; ++i) {
      Point3d p = new Point3d(m.Vertices[i]);
      Vector3d n = new Vector3d(m.Normals[i]);

      m.Vertices.SetVertex(i, p + n * dh * m.TextureCoordinates[i].X);
    }

    m.VertexColors.Clear();

    m.FaceNormals.ComputeFaceNormals();
    m.Normals.ComputeNormals();


    A = m;
# ---------- end c_script_3 ----------
preview = CustomPreview(Geometry=c_script_3.A, Shader=ColourSwatch(SwatchColor=RGB(255, 255, 255)))
