# Grasshopper definition 06_patternSizeOptimization.gh (Grasshopper 0.9.64)
# plug-ins: Millipede

pt = Point(<point referenced from the Rhino model>)
pt_2 = Point(<point referenced from the Rhino model>)
c_script = CSharpScript(
    rx=Slider(22, range=2..30),
    p1=pt,
    p2=pt_2,
    mod=Slider(5, range=0..16),
    mtype=Slider(0, range=0..3),
    dist=Slider(4.086, range=0..6))  # -> out, A, B; inputs rx: Int32, p1: Point3d, p2: Point3d, mod: Int32, mtype: Int32, dist: Double
# ---------- c_script: C# ----------
    int i;
    int j;

    double dx = (p2.X - p1.X) / (double) (rx - 1.0);
    int ry = (int) (0.5 + (p2.Y - p1.Y) / dx);


    List<Point3d> pt = new List<Point3d>();
    for(j = 0; j < ry; j++) {
      for(i = 0; i < rx; i++) {
        double x = p1.X + i * dx;
        double y = p1.Y + j * dx;
        if (mtype == 0) {
          if(( i * i - j * j ) % mod == 0) {
            pt.Add(new Point3d(x, y, 0.0));
          }
        }
        else if (mtype == 1) {
          if(( i * i + j * j ) % mod == 0) {
            pt.Add(new Point3d(x, y, 0.0));
          }
        }
        else if (mtype == 2) {
          if(( i * j  ) % mod == 0) {
            pt.Add(new Point3d(x, y, 0.0));
          }
        }
        else {
          if(( i * j + j + i ) % mod == 0) {
            pt.Add(new Point3d(x, y, 0.0));
          }
        }
      }
    }

    A = pt;

    List<Line> ln = new List<Line>();


    double d2 = dist * dist;
    for(j = 0; j < pt.Count; ++j) {
      for(i = j + 1; i < pt.Count; ++i) {
        if (dist2(pt[i], pt[j]) < d2 ) {
          ln.Add(new Line(pt[i], pt[j]));
        }
      }

    }

    B = ln;
# ---------- c_script: C# additional code ----------
  double dist2(Point3d p0, Point3d p1) {
    return (p0.X - p1.X) * (p0.X - p1.X) + (p0.Y - p1.Y) * (p0.Y - p1.Y) + (p0.Z - p1.Z) * (p0.Z - p1.Z);
  }
# ---------- end c_script ----------

pt_3 = Point(<point referenced from the Rhino model>)
pt_4 = Point(<point referenced from the Rhino model>)
c_script_2 = CSharpScript(
    rx=Slider(17, range=2..30),
    p1=pt_4,
    p2=pt_3,
    mod=Slider(6, range=0..16),
    mtype=Slider(1, range=0..3),
    dist=Slider(2.664, range=0..6))  # -> out, A, B; inputs rx: Int32, p1: Point3d, p2: Point3d, mod: Int32, mtype: Int32, dist: Double
# ---------- c_script_2: C# ----------
    int i;
    int j;
    int k;

    double dx = (p2.X - p1.X) / (double) (rx - 1.0);
    int ry = (int) (0.5 + (p2.Y - p1.Y) / dx);
    int rz = (int) (0.5 + (p2.Z - p1.Z) / dx);


    List<Point3d> pt = new List<Point3d>();
    for(k = 0; k < rz; ++k) {
      for(j = 0; j < ry; j++) {
        for(i = 0; i < rx; i++) {
          double x = p1.X + i * dx;
          double y = p1.Y + j * dx;
          double z = p1.Z + k * dx;
          if (mtype == 0) {
            if(( i * i - j * j + k * k) % mod == 0) {
              pt.Add(new Point3d(x, y, z));
            }
          }
          else if (mtype == 1) {
            if(( i * i + j * j + k * k ) % mod == 0) {
              pt.Add(new Point3d(x, y, z));
            }
          }
          else if (mtype == 2) {
            if(( i * j * k  ) % mod == 0) {
              pt.Add(new Point3d(x, y, z));
            }
          }
          else {
            if(( i * j + j * k + i * k ) % mod == 0) {
              pt.Add(new Point3d(x, y, z));
            }
          }
        }
      }
    }

    A = pt;

    List<Line> ln = new List<Line>();


    double d2 = dist * dist;
    for(j = 0; j < pt.Count; ++j) {
      for(i = j + 1; i < pt.Count; ++i) {
        if (dist2(pt[i], pt[j]) < d2 ) {
          ln.Add(new Line(pt[i], pt[j]));
        }
      }

    }

    B = ln;
# ---------- c_script_2: C# additional code ----------
  double dist2(Point3d p0, Point3d p1) {
    return (p0.X - p1.X) * (p0.X - p1.X) + (p0.Y - p1.Y) * (p0.Y - p1.Y) + (p0.Z - p1.Z) * (p0.Z - p1.Z);
  }
# ---------- end c_script_2 ----------

# ----
# here we make sure that we distribute the same load equally to all nodes that fall within the Brep
brep = Brep(<brep referenced from the Rhino model>)
brepinc = PointInBrep(Brep=brep, Point=c_script.A, Strict=False)
dispatch = Dispatch(List=c_script.A, DispatchPattern=brepinc)  # -> ListA, ListB
lng = ListLength(List=dispatch.ListA)
division = Division(A=Slider(-770832.604, range=-1000000..1), B=lng)
Y = UnitY(Factor=division)

brep_2 = Brep(<brep referenced from the Rhino model>)
brepinc_2 = PointInBrep(Brep=brep_2, Point=c_script_2.A, Strict=False)
dispatch_2 = Dispatch(List=c_script_2.A, DispatchPattern=brepinc_2)  # -> ListA, ListB
lng_2 = ListLength(List=dispatch_2.ListA)
division_2 = Division(A=Slider(-770832.604, range=-1000000..1), B=lng_2)
Y_2 = UnitY(Factor=division_2)

brep_3 = Brep(<brep referenced from the Rhino model>)
mat = SupportType(X=True, Y=True, Z=True, RX=True, RY=True, RZ=True)
support_region = MSupportTypeRegion(Boundary=brep_3, SupportType=mat, AmmendExistingSupports=True)

brep_4 = Brep(<brep referenced from the Rhino model>)
mat_2 = SupportType(X=True, Y=True, Z=True, RX=True, RY=True, RZ=True)
support_region_2 = MSupportTypeRegion(Boundary=brep_4, SupportType=mat_2, AmmendExistingSupports=True)

mat_3 = Material(MaterialType=2)
csection = CrossSection(Material=mat_3, InnerRadius=Slider(0.1, range=0..1), Thickness=Slider(0.004, range=0..1), CrossSectionType=1)

mat_4 = Material(MaterialType=2)
csection_2 = CrossSection(Material=mat_4, InnerRadius=Slider(0.1, range=0..1), Thickness=Slider(0.004, range=0..1), CrossSectionType=1)

fcurves = FrameCurves(Curves=c_script_2.B, CrossSection=csection_2, LinearLoad=Vector(0, 0, 0), SupportType=0)
fepointload = FEPointLoad(Point=dispatch_2.ListA, Load=Y_2)
fea_system = FEASystem(
    ModelComponents=flatten([fcurves, support_region, fepointload]),
    IntersectAddedCurves=True,
    MergeTolerance=0.0001,
    MinimumCurveSpan=0.05,
    MaximumCurveSpan=10000,
    CurveTolerance=0.1)

fepointload_2 = FEPointLoad(Point=dispatch.ListA, Load=Y)
fcurves_2 = FrameCurves(Curves=c_script.B, CrossSection=csection, LinearLoad=Vector(0, 0, 0), SupportType=0)
fea_system_2 = FEASystem(
    ModelComponents=flatten([fcurves_2, support_region_2, fepointload_2]),
    IntersectAddedCurves=True,
    MergeTolerance=0.0001,
    MinimumCurveSpan=0.05,
    MaximumCurveSpan=10000,
    CurveTolerance=0.1)

fe_solver = FESolver(
    FEModel=fea_system_2,
    SelfWeightCoefficient=Slider(0, range=0..1),
    BeamOptimisationIterations=Slider(5, range=0..6),
    QuadOptimisationIterations=0,
    OptimizationTarget=Slider(0.42, range=0..1),
    OptimizationPenalization=Slider(1, range=0..3),
    LoadCase=0,
    AllCases=True)  # -> FEModel, MaxDeflection, Weight

fe_solver_2 = FESolver(
    FEModel=fea_system,
    SelfWeightCoefficient=Slider(0, range=0..1),
    BeamOptimisationIterations=Slider(5, range=0..6),
    QuadOptimisationIterations=0,
    OptimizationTarget=Slider(0.2, range=0..1),
    OptimizationPenalization=Slider(1, range=0..3),
    LoadCase=0,
    AllCases=True)  # -> FEModel, MaxDeflection, Weight

division_3 = Division(A=Slider(0, range=0..9), B=fe_solver.MaxDeflection)
frame_visualization = FrameVisualization(
    FEModel=fe_solver.FEModel,
    DetailedOutput=Toggle(True),
    Deflection=division_3,
    Inflation=Slider(0, range=0..2),
    Subdivision=0.1,
    OptScale=Toggle(True),
    ColorMode=0)  # -> Curves, Meshes, CompleteRange, VisibleRange
preview = CustomPreview(Geometry=frame_visualization.Meshes, Shader=ColourSwatch(SwatchColor=RGB(79, 79, 79)))

division_4 = Division(A=Slider(0, range=0..9), B=fe_solver_2.MaxDeflection)
frame_visualization_2 = FrameVisualization(
    FEModel=fe_solver_2.FEModel,
    DetailedOutput=Toggle(True),
    Deflection=division_4,
    Inflation=Slider(0, range=0..2),
    Subdivision=0.1,
    OptScale=Toggle(True),
    ColorMode=8)  # -> Curves, Meshes, CompleteRange, VisibleRange
preview_2 = CustomPreview(Geometry=frame_visualization_2.Meshes, Shader=ColourSwatch(SwatchColor=RGB(148, 148, 148)))
