# Grasshopper definition 07_lattice_truss.gh (Grasshopper 0.9.64)
# plug-ins: Millipede

pipeline = GeometryPipeline(
    GroupByLayer=False,
    GroupByType=False,
    IncludeHidden=True,
    IncludeLocked=True,
    LayerFilter="truss",
    NameFilter="*",
    TypeFilter=4)
pipeline_2 = GeometryPipeline(
    GroupByLayer=False,
    GroupByType=False,
    IncludeHidden=True,
    IncludeLocked=True,
    LayerFilter="truss_edges",
    NameFilter="*",
    TypeFilter=4)
mat = Material(MaterialType=2)
csection = CrossSection(Material=mat, InnerRadius=Slider(0.226, range=0..1), Thickness=0.01, CrossSectionType=1)
fcurves = FrameCurves(Curves=flatten([pipeline, pipeline_2]), CrossSection=csection, LinearLoad=Vector(0, 0, 0), SupportType=0)

pipeline_3 = GeometryPipeline(
    GroupByLayer=False,
    GroupByType=False,
    IncludeHidden=True,
    IncludeLocked=True,
    LayerFilter="piers",
    NameFilter="*",
    TypeFilter=4)
mat_2 = Material(MaterialType=2)
csection_2 = CrossSection(Material=mat_2, InnerRadius=Slider(0.654, range=0..1), Thickness=0.01, CrossSectionType=1)
fcurves_2 = FrameCurves(Curves=pipeline_3, CrossSection=csection_2, LinearLoad=Vector(0, 0, 0), SupportType=0)

mat_3 = MillC_StockSupportType(X=True, Y=True, Z=True, RX=True, RY=True, RZ=True)
brep = Brep([<brep referenced from the Rhino model> x3])
support_region = MSupportTypeRegion(Boundary=brep, SupportType=mat_3, AmmendExistingSupports=True)

brep_2 = Brep(<brep referenced from the Rhino model>)
Z = UnitZ(Factor=Slider(-5500, range=-10000..0))
load_region = LoadRegion(Boundary=brep_2, LineLoad=Z)
loadcase = LoadCase(LoadElements=[load_region, support_region], SelfWeightFactor=Slider(0, range=0..1), Name="Load Case")

brep_3 = Brep(<brep referenced from the Rhino model>)
X = UnitX(Factor=Slider(-5500, range=-10000..0))
load_region_2 = LoadRegion(Boundary=brep_3, LineLoad=X)
loadcase_2 = LoadCase(LoadElements=[load_region_2, support_region], SelfWeightFactor=Slider(0, range=0..1), Name="Load Case")

fea_system = FEASystem(
    ModelComponents=flatten([fcurves, fcurves_2, loadcase, loadcase_2]),
    IntersectAddedCurves=True,
    MergeTolerance=0.0001,
    MinimumCurveSpan=0.05,
    MaximumCurveSpan=10000,
    CurveTolerance=0.1)
fe_solver = FESolver(
    FEModel=fea_system,
    SelfWeightCoefficient=1,
    BeamOptimisationIterations=Slider(3, range=0..4),
    QuadOptimisationIterations=0,
    OptimizationTarget=Slider(0.452, range=0..1),
    OptimizationPenalization=Slider(0.884, range=0..4),
    LoadCase=Slider(0, range=0..3),
    AllCases=Toggle(True))  # -> FEModel, MaxDeflection, Weight

division = Division(A=Slider(0, range=0..28), B=fe_solver.MaxDeflection)
frame_visualization = FrameVisualization(
    FEModel=fe_solver.FEModel,
    DetailedOutput=Toggle(True),
    Deflection=division,
    Inflation=Slider(0, range=0..1),
    Subdivision=0.1,
    OptScale=Toggle(True),
    ColorMode=0)  # -> Curves, Meshes, CompleteRange, VisibleRange
preview = CustomPreview(Geometry=frame_visualization.Meshes, Shader=ColourSwatch(SwatchColor=RGB(79, 79, 79)))

c_script = CSharpScript(
    ri=fe_solver.FEModel,
    Reference=["C:\Users\pan\AppData\Roaming\Grasshopper\Libraries\SawapanStatica.dll", "C:\Users\pan\AppData\Roaming\Grasshopper\Libraries\SawapanStatRhino.dll"])  # -> out, A, B
# ---------- c_script: C# ----------
    RStatSystem rs = ri as RStatSystem;


    List<Line> slines = new List<Line>();

    foreach(RStatBeam b0 in rs.Beams) {

      if (b0.StiffnessMultiplier < 0.3) continue;

      slines.Add(new Line(b0.P0.ToPoint3d(), b0.P1.ToPoint3d()));
    }

    A = slines;
# ---------- end c_script ----------
