# Grasshopper definition workshop_curvature.gh (Grasshopper 0.9.64)
# plug-ins: Millipede

slider = Slider(0.335, range=0..1)
brep = Brep(<brep referenced from the Rhino model>)
custom_mesh_settings = SettingsCustom(
    StitchSeams=True,
    SimplePlanes=False,
    Refine=True,
    MinCount=16,
    MaxCount=400,
    AspectRatio=20,
    MaxDistance=0,
    MaxAngle=20,
    MinEdge=slider,
    MaxEdge=slider)

mesh = Mesh(<mesh referenced from the Rhino model>)
pt = Point(<point referenced from the Rhino model>)
scale_nu = ScaleNU(Geometry=mesh, Plane=pt, ScaleX=Slider(0.75, range=0..1), ScaleY=Slider(0.69, range=0..1), ScaleZ=Slider(1, range=0..1))  # -> Geometry, Transform

slider_2 = Slider(0.188, range=0..1)
brep_2 = Brep(<brep referenced from the Rhino model>)
custom_mesh_settings_2 = SettingsCustom(
    StitchSeams=True,
    SimplePlanes=False,
    Refine=True,
    MinCount=16,
    MaxCount=400,
    AspectRatio=20,
    MaxDistance=0,
    MaxAngle=20,
    MinEdge=slider_2,
    MaxEdge=slider_2)

mesh_2 = MeshBrep(Brep=brep, Settings=custom_mesh_settings)
reparameterization = Reparameterization(
    Mesh=mesh_2,
    Omega=Slider(4.182, range=0..5),
    Scalefield=Toggle(True),
    Uselambda=Toggle(False),
    Smoothfactor=0,
    SmoothModulo=1,
    Iterations=Slider(0, range=0..5000),
    MeshDenisty=Slider(1, range=0..5))

reparameterization_2 = Reparameterization(
    Mesh=scale_nu.Geometry,
    Omega=Slider(5, range=0..5),
    Scalefield=Toggle(True),
    Uselambda=Toggle(False),
    Smoothfactor=0,
    SmoothModulo=1,
    Iterations=Slider(0, range=0..5000),
    MeshDenisty=Slider(1, range=0..5))

mesh_3 = MeshBrep(Brep=brep_2, Settings=custom_mesh_settings_2)
reparameterization_3 = Reparameterization(
    Mesh=mesh_3,
    Omega=Slider(4.182, range=0..5),
    Scalefield=Toggle(True),
    Uselambda=Toggle(False),
    Smoothfactor=0,
    SmoothModulo=1,
    Iterations=Slider(0, range=0..5000),
    MeshDenisty=Slider(1, range=0..5))

curves = Curves(System=reparameterization)
preview = CustomPreview(Geometry=curves, Shader=ColourSwatch(SwatchColor=RGB(0, 0, 0)))

quads = Quads(System=reparameterization_2)
curves_2 = Curves(System=reparameterization_2)

curves_3 = Curves(System=reparameterization_3)
preview_2 = CustomPreview(Geometry=curves_3, Shader=ColourSwatch(SwatchColor=RGB(0, 0, 0)))

preview_3 = CustomPreview(Geometry=curves_2, Shader=ColourSwatch(SwatchColor=RGB(0, 0, 0)))
