# Grasshopper definition workshop_stress_beams.gh (Grasshopper 0.9.64)
# plug-ins: Millipede

slider = Slider(0.199, range=0..1)
custom_mesh_settings = SettingsCustom(
    StitchSeams=True,
    SimplePlanes=False,
    Refine=True,
    MinCount=16,
    MaxCount=400,
    AspectRatio=20,
    MaxDistance=0,
    MaxAngle=20,
    MinEdge=slider,
    MaxEdge=slider)
brep = Brep(<brep referenced from the Rhino model>)

slider_2 = Slider(0.25, range=0..1)
custom_mesh_settings_2 = SettingsCustom(
    StitchSeams=True,
    SimplePlanes=False,
    Refine=True,
    MinCount=16,
    MaxCount=400,
    AspectRatio=20,
    MaxDistance=0,
    MaxAngle=20,
    MinEdge=slider_2,
    MaxEdge=slider_2)
brep_2 = Brep(<brep referenced from the Rhino model>)

mesh = MeshBrep(Brep=brep, Settings=custom_mesh_settings)
mat = MillC_StockSupportType(X=True, Y=True, Z=True, RX=True, RY=True, RZ=True)
mat_2 = Material(MaterialType=2)
brep_3 = Brep([<brep referenced from the Rhino model> x2])
support_region = MSupportTypeRegion(Boundary=brep_3, SupportType=mat, AmmendExistingSupports=True)
femesh = FEMesh(Meshes=mesh, Material=mat_2, Thickness=Slider(0.5, range=0..1), AreaLoad=Vector(0, 0, 0), NormalAreaLoad=0)

mesh_2 = MeshBrep(Brep=brep_2, Settings=custom_mesh_settings_2)
mat_3 = MillC_StockSupportType(X=True, Y=True, Z=True, RX=True, RY=True, RZ=True)
mat_4 = Material(MaterialType=2)
brep_4 = Brep([<brep referenced from the Rhino model> x2])
support_region_2 = MSupportTypeRegion(Boundary=brep_4, SupportType=mat_3, AmmendExistingSupports=True)
femesh_2 = FEMesh(Meshes=mesh_2, Material=mat_4, Thickness=Slider(0.5, range=0..1), AreaLoad=Vector(0, 0, 0), NormalAreaLoad=0)

fea_system = FEASystem(
    ModelComponents=flatten([femesh, support_region]),
    IntersectAddedCurves=True,
    MergeTolerance=0.0001,
    MinimumCurveSpan=0.05,
    MaximumCurveSpan=10000,
    CurveTolerance=0.1)
fe_solver = FESolver(
    FEModel=fea_system,
    SelfWeightCoefficient=1,
    BeamOptimisationIterations=0,
    QuadOptimisationIterations=0,
    OptimizationTarget=0.3,
    OptimizationPenalization=2,
    LoadCase=0,
    AllCases=True)  # -> FEModel, MaxDeflection, Weight

fea_system_2 = FEASystem(
    ModelComponents=flatten([femesh_2, support_region_2]),
    IntersectAddedCurves=True,
    MergeTolerance=0.0001,
    MinimumCurveSpan=0.05,
    MaximumCurveSpan=10000,
    CurveTolerance=0.1)
fe_solver_2 = FESolver(
    FEModel=fea_system_2,
    SelfWeightCoefficient=1,
    BeamOptimisationIterations=0,
    QuadOptimisationIterations=0,
    OptimizationTarget=0.3,
    OptimizationPenalization=2,
    LoadCase=0,
    AllCases=True)  # -> FEModel, MaxDeflection, Weight

slider_3 = Slider(1, range=-1..1)

division = Division(A=Slider(0, range=0..7), B=fe_solver_2.MaxDeflection)
mesh_visualization = MeshVisualization(FEModel=fe_solver_2.FEModel, Deflection=division, Plane=slider_3, ShowThickness=False, ColorMode=0)  # -> Mesh, CompleteRange, VisibleRange

stress_pattern = StressPattern(
    FEModel=fe_solver_2.FEModel,
    Omega=Slider(5, range=0..5),
    Scalefield=Toggle(True),
    Uselambda=Toggle(False),
    Smoothfactor=0,
    SmoothModulo=1,
    Iterations=Slider(0, range=0..5000),
    MeshDenisty=1,
    Layer=slider_3,
    Thickness=0,
    Bending=Toggle(False))
crv = Curve([<curve referenced from the Rhino model> x4])
pattern = Pattern(System=stress_pattern, Pattern=crv)  # -> Patterns, PatternPoints

slider_4 = Slider(1, range=-1..1)

division_2 = Division(A=Slider(0, range=0..7), B=fe_solver.MaxDeflection)
mesh_visualization_2 = MeshVisualization(FEModel=fe_solver.FEModel, Deflection=division_2, Plane=slider_4, ShowThickness=False, ColorMode=0)  # -> Mesh, CompleteRange, VisibleRange

stress_pattern_2 = StressPattern(
    FEModel=fe_solver.FEModel,
    Omega=Slider(5, range=0..5),
    Scalefield=Toggle(True),
    Uselambda=Toggle(False),
    Smoothfactor=0,
    SmoothModulo=1,
    Iterations=Slider(0, range=0..5000),
    MeshDenisty=1,
    Layer=slider_4,
    Thickness=0,
    Bending=Toggle(False))
crv_2 = Curve([<curve referenced from the Rhino model> x4])
pattern_2 = Pattern(System=stress_pattern_2, Pattern=crv_2)  # -> Patterns, PatternPoints

preview = CustomPreview(Geometry=pattern_2.Patterns, Shader=ColourSwatch(SwatchColor=RGB(0, 0, 0)))
preview_2 = CustomPreview(Geometry=pattern.Patterns, Shader=ColourSwatch(SwatchColor=RGB(0, 0, 0)))
