# Grasshopper definition workshop_stress_curves.gh (Grasshopper 0.9.64)
# plug-ins: Millipede

srf = Surface([<surface referenced from the Rhino model> x2])
mesh_uv = MeshSurface(Surface=srf, UCount=Slider(20, range=2..40), VCount=Slider(28, range=2..60), Overhang=True, Equalize=False)

mat = MillC_StockSupportType(X=True, Y=True, Z=True, RX=True, RY=True, RZ=True)
mat_2 = Material(MaterialType=2)
brep = Brep([<brep referenced from the Rhino model> x3])
support_region = MSupportTypeRegion(Boundary=brep, SupportType=mat, AmmendExistingSupports=True)
femesh = FEMesh(Meshes=mesh_uv, Material=mat_2, Thickness=Slider(0.5, range=0..1), AreaLoad=Vector(0, 0, 0), NormalAreaLoad=0)

fea_system = FEASystem(
    ModelComponents=flatten([femesh, support_region]),
    IntersectAddedCurves=True,
    MergeTolerance=0.0001,
    MinimumCurveSpan=0.05,
    MaximumCurveSpan=10000,
    CurveTolerance=0.1)
fe_solver = FESolver(
    FEModel=fea_system,
    SelfWeightCoefficient=1,
    BeamOptimisationIterations=0,
    QuadOptimisationIterations=0,
    OptimizationTarget=0.3,
    OptimizationPenalization=2,
    LoadCase=0,
    AllCases=True)  # -> FEModel, MaxDeflection, Weight

slider = Slider(1, range=-1..1)

division = Division(A=Slider(0, range=0..7), B=fe_solver.MaxDeflection)
mesh_visualization = MeshVisualization(FEModel=fe_solver.FEModel, Deflection=division, Plane=slider, ShowThickness=False, ColorMode=0)  # -> Mesh, CompleteRange, VisibleRange

stress_pattern = StressPattern(
    FEModel=fe_solver.FEModel,
    Omega=Slider(4.182, range=0..5),
    Scalefield=Toggle(True),
    Uselambda=Toggle(False),
    Smoothfactor=0,
    SmoothModulo=1,
    Iterations=Slider(1632, range=0..5000),
    MeshDenisty=Slider(1, range=0..5),
    Layer=slider,
    Thickness=0,
    Bending=Toggle(False))
crv = Curve([<curve referenced from the Rhino model> x4])
pattern = Pattern(System=stress_pattern, Pattern=crv)  # -> Patterns, PatternPoints

preview = CustomPreview(Geometry=mesh_visualization.Mesh, Shader=ColourSwatch(SwatchColor=RGB(255, 255, 255)))
