# Grasshopper definition workshop_stress_plates.gh (Grasshopper 0.9.64)
# plug-ins: Millipede

brep = Brep(<brep referenced from the Rhino model>)
mesh = MeshBrep(
    Brep=brep,
    Settings={GridMaxCount=0, GridMinCount=16, JaggedSeams=False, MaxEdgeLength=0.2, MinEdgeLength=0.2, MinTolerance=0, Refine=True, RefineAngle=0, RelativeTolerance=0.65, SimplePlanes=False, Tolerance=0})

brep_2 = Brep([<brep referenced from the Rhino model> x3])
mat = MillC_StockSupportType(X=True, Y=True, Z=True, RX=True, RY=True, RZ=True)
mat_2 = Material(MaterialType=2)
support_region = MSupportTypeRegion(Boundary=brep_2, SupportType=mat, AmmendExistingSupports=True)
femesh = FEMesh(Meshes=mesh, Material=mat_2, Thickness=Slider(0.5, range=0..1), AreaLoad=Vector(0, 0, 0), NormalAreaLoad=0)

fea_system = FEASystem(
    ModelComponents=flatten([femesh, support_region]),
    IntersectAddedCurves=True,
    MergeTolerance=0.0001,
    MinimumCurveSpan=0.05,
    MaximumCurveSpan=10000,
    CurveTolerance=0.1)
fe_solver = FESolver(
    FEModel=fea_system,
    SelfWeightCoefficient=1,
    BeamOptimisationIterations=0,
    QuadOptimisationIterations=0,
    OptimizationTarget=0.3,
    OptimizationPenalization=2,
    LoadCase=0,
    AllCases=True)  # -> FEModel, MaxDeflection, Weight

slider = Slider(1, range=-1..1)

stress_pattern = StressPattern(
    FEModel=fe_solver.FEModel,
    Omega=Slider(5, range=0..5),
    Scalefield=Toggle(True),
    Uselambda=Toggle(False),
    Smoothfactor=0,
    SmoothModulo=1,
    Iterations=Slider(1632, range=0..5000),
    MeshDenisty=Slider(1, range=0..5),
    Layer=slider,
    Thickness=0,
    Bending=Toggle(False))
crv = Curve([<curve referenced from the Rhino model> x4])
pattern = Pattern(System=stress_pattern, Pattern=crv)  # -> Patterns, PatternPoints

division = Division(A=Slider(0, range=0..7), B=fe_solver.MaxDeflection)
mesh_visualization = MeshVisualization(FEModel=fe_solver.FEModel, Deflection=division, Plane=slider, ShowThickness=False, ColorMode=8)  # -> Mesh, CompleteRange, VisibleRange
