# Grasshopper definition workshop_tiling_attractors.gh (Grasshopper 0.9.64)
# plug-ins: Millipede

slider = Slider(0.322, range=0..1)
brep = Brep(<brep referenced from the Rhino model>)
custom_mesh_settings = SettingsCustom(
    StitchSeams=True,
    SimplePlanes=False,
    Refine=True,
    MinCount=16,
    MaxCount=400,
    AspectRatio=20,
    MaxDistance=0,
    MaxAngle=20,
    MinEdge=slider,
    MaxEdge=slider)

slider_2 = Slider(0.322, range=0..1)
custom_mesh_settings_2 = SettingsCustom(
    StitchSeams=True,
    SimplePlanes=False,
    Refine=True,
    MinCount=16,
    MaxCount=400,
    AspectRatio=20,
    MaxDistance=0,
    MaxAngle=20,
    MinEdge=slider_2,
    MaxEdge=slider_2)
brep_2 = Brep(<brep referenced from the Rhino model>)

mesh = MeshBrep(Brep=brep, Settings=custom_mesh_settings)
geo = Geometry([<point referenced from the Rhino model>, <curve referenced from the Rhino model> x2])
distance_pattern = DistancePattern(
    Mesh=mesh,
    Geometry=geo,
    Blending=Slider(0.679, range=0..1),
    Omega=Slider(4.182, range=0..5),
    Scalefield=Toggle(True),
    Uselambda=False,
    Smoothfactor=0,
    SmoothModulo=1,
    Iterations=Slider(0, range=0..5000),
    MeshDenisty=1)  # -> Field, Mesh

mesh_2 = MeshBrep(Brep=brep_2, Settings=custom_mesh_settings_2)
geo_2 = Geometry(<curve referenced from the Rhino model>)
crv = Curve([<curve referenced from the Rhino model> x4])
distance_pattern_2 = DistancePattern(
    Mesh=mesh_2,
    Geometry=geo_2,
    Blending=Slider(0.679, range=0..1),
    Omega=Slider(4.182, range=0..5),
    Scalefield=Toggle(True),
    Uselambda=False,
    Smoothfactor=0,
    SmoothModulo=1,
    Iterations=Slider(0, range=0..5000),
    MeshDenisty=1)  # -> Field, Mesh

crv_2 = Curve([<curve referenced from the Rhino model> x4])
pattern = Pattern(System=distance_pattern.Mesh, Pattern=crv_2)  # -> Patterns, PatternPoints

crv_3 = Curve([<curve referenced from the Rhino model> x4])
pattern_2 = Pattern(System=distance_pattern_2.Mesh, Pattern=crv_3)  # -> Patterns, PatternPoints
