# Grasshopper definition workshop_tiling_function.gh (Grasshopper 0.9.64)
# plug-ins: Millipede

slider = Slider(0.2, range=0..1)
custom_mesh_settings = SettingsCustom(
    StitchSeams=True,
    SimplePlanes=False,
    Refine=True,
    MinCount=16,
    MaxCount=400,
    AspectRatio=20,
    MaxDistance=0,
    MaxAngle=20,
    MinEdge=slider,
    MaxEdge=slider)
brep = Brep(<brep referenced from the Rhino model>)

mesh = MeshBrep(Brep=brep, Settings=custom_mesh_settings)
mcomp = Decompose(Mesh=mesh)  # -> Vertices, Faces, Colours, Normals
c_script = CSharpScript(p=mcomp.Vertices, x=Slider(2.304, range=0..8))  # -> out, A; inputs p: Point3d, x: Double
# ---------- c_script: C# ----------
    A = new Vector3d(Math.Cos(p.X)*Math.Cos(x) , Math.Sin(p.Y)*Math.Sin(x), Math.Cos(p.Z));
# ---------- end c_script ----------
unit = UnitVector(Vector=c_script.A)
vdis = VectorDisplay(Anchor=mcomp.Vertices, Vector=c_script.A)

reparameterization = Reparameterization(
    Mesh=mesh,
    Field=unit,
    Omega=Slider(3.95, range=0..7),
    Scalefield=Toggle(True),
    Uselambda=False,
    Smoothfactor=0,
    SmoothModulo=1,
    Iterations=Slider(0, range=0..5000),
    MeshDenisty=1)
crv = Curve([<curve referenced from the Rhino model> x4])
pattern = Pattern(System=reparameterization, Pattern=crv)  # -> Patterns, PatternPoints
