# Grasshopper definition workshop_tiling_patterns.gh (Grasshopper 0.9.64)
# plug-ins: Millipede

slider = Slider(0.2, range=0..1)
brep = Brep(<brep referenced from the Rhino model>)
custom_mesh_settings = SettingsCustom(
    StitchSeams=True,
    SimplePlanes=False,
    Refine=True,
    MinCount=16,
    MaxCount=400,
    AspectRatio=20,
    MaxDistance=0,
    MaxAngle=20,
    MinEdge=slider,
    MaxEdge=slider)

mesh = MeshBrep(Brep=brep, Settings=custom_mesh_settings)
geo = Geometry([<point referenced from the Rhino model>, <curve referenced from the Rhino model> x2])
distance_pattern = DistancePattern(
    Mesh=mesh,
    Geometry=geo,
    Blending=Slider(0.199, range=0..1),
    Omega=Slider(5.07, range=0..7),
    Scalefield=Toggle(True),
    Uselambda=False,
    Smoothfactor=0,
    SmoothModulo=1,
    Iterations=Slider(0, range=0..5000),
    MeshDenisty=1)  # -> Field, Mesh

crv = Curve([<curve referenced from the Rhino model> x9])
pattern = Pattern(System=distance_pattern.Mesh, Pattern=crv)  # -> Patterns, PatternPoints
