# Grasshopper definition 007_topostruct2dPeriodic.gh (Grasshopper 0.9.64)
# plug-ins: Millipede

crv = Curve(<curve referenced from the Rhino model>)
boundary = _2DBoundaryRegion(Boundary=crv, IsVoid=False)

mat = MillC_StockSupportType(X=True, Y=True, Z=True, RX=True, RY=True, RZ=True)
crv_2 = Curve(<curve referenced from the Rhino model>)
support = _2DSupportRegion(Boundary=crv_2, SupportType=mat, AmendExistingSupports=Toggle(True), Displacement=Vector(0, 0, 0))

crv_3 = Curve(<curve referenced from the Rhino model>)
boundary_2 = _2DBoundaryRegion(Boundary=crv_3, IsVoid=Toggle(True))

crv_4 = Curve(<curve referenced from the Rhino model>)
Y = UnitY(Factor=Slider(-2160, range=-3000..0))
load = _2DLoadRegion(Boundary=crv_4, Load=Y)

topostruct_2d = Topostruct2DModel(ModelComponents=[boundary, load, support, boundary_2], XResolution=Slider(70, range=0..76))  # -> FEModel, CellCentres, CellSize
topostruct_2d_solver = Topostruct2DSolver(
    FEModel=topostruct_2d.FEModel,
    SelfWeightCoefficient=0,
    OptimizationIterations=Slider(3, range=0..10),
    Smoothing=0.1,
    Penalization=3,
    TargetDensity=Slider(0.25, range=0..1),
    MinimumDensity=0.001,
    DeleteThreshold=0.5,
    PeriodicX=Toggle(True),
    PeriodicY=Toggle(True),
    LoadCase=0,
    AllCases=True,
    CompliantMechanism=False)  # -> FEModel, MaxDeflection

pt = Point(<point referenced from the Rhino model>)
division = Division(A=Slider(0, range=0..4), B=topostruct_2d_solver.MaxDeflection)
_2d_iso_contour = _2DIsoContour(FEModel=topostruct_2d_solver.FEModel, Deflection=0, IsoContourValue=Slider(0.388, range=0..1))
stress_lines = StressLines(FEModel=topostruct_2d_solver.FEModel, Seeds=pt)  # -> Curves1, Curves2
_2d_mesh_results = _2DMeshResults(FEModel=topostruct_2d_solver.FEModel, Deflection=division, ColorMode=0)

bbox = BoundingBox(Content=_2d_mesh_results, Union=False, Plane=PlaneXY(0, 0, 0))  # -> Box, Box_2
box_corners = BoxCorners(Box=bbox.Box)  # -> CornerA, CornerB, CornerC, CornerD, CornerE, CornerF, CornerG, CornerH
subtraction = Subtraction(A=box_corners.CornerA, B=box_corners.CornerC)
subtraction_2 = Subtraction(A=box_corners.CornerC, B=box_corners.CornerD)
subtraction_3 = Subtraction(A=box_corners.CornerA, B=box_corners.CornerB)
move = Move(Geometry=_2d_mesh_results, Motion=[subtraction_2, subtraction_3, subtraction])  # -> Geometry, Transform
preview = CustomPreview(
    Geometry=move.Geometry,
    Shader={ambient=RGB(0, 0, 0), diffuse=RGB(255, 105, 180), emission=RGB(76, 32, 54), shine=0.5, specular=RGB(255, 255, 255), transparency=0})
