# Grasshopper definition b006_topostruct2dLoadCases.gh (Grasshopper 0.9.64)
# plug-ins: Millipede

crv = Curve(<curve referenced from the Rhino model>)
crv_2 = Curve(<curve referenced from the Rhino model>)
boundary = _2DBoundaryRegion(Boundary=crv, IsVoid=Toggle(True))
boundary_2 = _2DBoundaryRegion(Boundary=crv_2, IsVoid=False)

crv_3 = Curve(<curve referenced from the Rhino model>)
Y = UnitY(Factor=Slider(-103000, range=-103000..0))
load = _2DLoadRegion(Boundary=crv_3, Load=Y)

crv_4 = Curve(<curve referenced from the Rhino model>)
mat = MillC_StockSupportType(X=True, Y=True, Z=True, RX=True, RY=True, RZ=True)
support = _2DSupportRegion(Boundary=crv_4, SupportType=mat, AmendExistingSupports=Toggle(True), Displacement=Vector(0, 0, 0))

loadcase = LoadCase(LoadElements=[load, support], SelfWeightFactor=Slider(0, range=0..1), Name="Load Case")

crv_5 = Curve(<curve referenced from the Rhino model>)
mat_2 = MillC_StockSupportType(X=True, Y=True, Z=True, RX=True, RY=True, RZ=True)
support_2 = _2DSupportRegion(Boundary=crv_5, SupportType=mat_2, AmendExistingSupports=Toggle(True), Displacement=Vector(0, 0, 0))

crv_6 = Curve(<curve referenced from the Rhino model>)
slider = Slider(-103000, range=-103000..0)
Y_2 = UnitY(Factor=slider)
X = UnitX(Factor=slider)
load_2 = _2DLoadRegion(Boundary=crv_6, Load=X)

loadcase_2 = LoadCase(LoadElements=[load_2, support_2], SelfWeightFactor=Slider(0, range=0..1), Name="Load Case")

topostruct_2d = Topostruct2DModel(ModelComponents=[loadcase, boundary, boundary_2, loadcase_2], XResolution=Slider(66, range=0..76))  # -> FEModel, CellCentres, CellSize
topostruct_2d_solver = Topostruct2DSolver(
    FEModel=topostruct_2d.FEModel,
    SelfWeightCoefficient=0,
    OptimizationIterations=Slider(3, range=0..10),
    Smoothing=0.1,
    Penalization=3,
    TargetDensity=Slider(0.3, range=0..1),
    MinimumDensity=0.001,
    DeleteThreshold=0.5,
    PeriodicX=False,
    PeriodicY=False,
    LoadCase=Slider(1, range=0..3),
    AllCases=Toggle(True),
    CompliantMechanism=False)  # -> FEModel, MaxDeflection

division = Division(A=Slider(0, range=0..4), B=topostruct_2d_solver.MaxDeflection)
_2d_mesh_results = _2DMeshResults(FEModel=topostruct_2d_solver.FEModel, Deflection=division, ColorMode=0)
