# Grasshopper definition compliant_05.gh (Grasshopper 0.9.64)
# plug-ins: Millipede

slider = Slider(0.106, range=0..0.5)

multiplication = Multiplication(A=Slider(33000, range=-33000..33000), B=slider)
X = UnitX(Factor=multiplication)
crv = Curve(<curve referenced from the Rhino model>)
load = _2DLoadRegion(Boundary=crv, Load=X)

multiplication_2 = Multiplication(A=Slider(33000, range=-33000..33000), B=slider)
crv_2 = Curve(<curve referenced from the Rhino model>)
Y = UnitY(Factor=multiplication_2)
load_2 = _2DLoadRegion(Boundary=crv_2, Load=Y)

crv_3 = Curve(<curve referenced from the Rhino model>)
multiplication_3 = Multiplication(A=Slider(-33000, range=-33000..33000), B=slider)
Y_2 = UnitY(Factor=multiplication_3)
load_3 = _2DLoadRegion(Boundary=crv_3, Load=Y_2)

crv_4 = Curve([<curve referenced from the Rhino model> x2])
mat = MillC_StockSupportType(X=True, Y=True, Z=True, RX=True, RY=True, RZ=True)
support = _2DSupportRegion(Boundary=crv_4, SupportType=mat, AmendExistingSupports=Toggle(True), Displacement=Vector(0, 0, 0))

crv_5 = Curve(<curve referenced from the Rhino model>)
boundary = _2DBoundaryRegion(Boundary=crv_5, IsVoid=False)

slider_2 = Slider(0, range=0..1)
loadcase = LoadCase(LoadElements=[load, support], SelfWeightFactor=slider_2, Name="Load Case")
loadcase_2 = LoadCase(LoadElements=[support, load_2, load_3], SelfWeightFactor=slider_2, Name="Load Case")

crv_6 = Curve(<curve referenced from the Rhino model>)
boundary_2 = _2DBoundaryRegion(Boundary=crv_6, IsVoid=Toggle(True))

topostruct_2d = Topostruct2DModel(ModelComponents=[boundary, boundary_2, loadcase, loadcase_2], XResolution=Slider(50, range=0..76))  # -> FEModel, CellCentres, CellSize
topostruct_2d_solver = Topostruct2DSolver(
    FEModel=topostruct_2d.FEModel,
    SelfWeightCoefficient=0,
    OptimizationIterations=Slider(4, range=0..10),
    Smoothing=Slider(0.186, range=0..1),
    Penalization=Slider(1, range=0..4),
    TargetDensity=Slider(0.276, range=0..1),
    MinimumDensity=Slider(0.003, range=0.003..1),
    DeleteThreshold=0.5,
    PeriodicX=False,
    PeriodicY=False,
    LoadCase=Slider(0, range=0..10),
    AllCases=Toggle(False),
    CompliantMechanism=Toggle(True))  # -> FEModel, MaxDeflection

division = Division(A=Slider(0, range=0..2), B=topostruct_2d_solver.MaxDeflection)
_2d_mesh_results = _2DMeshResults(FEModel=topostruct_2d_solver.FEModel, Deflection=division, ColorMode=0)
