# Grasshopper definition compliant_05_b.gh (Grasshopper 0.9.64)
# plug-ins: Millipede

crv = Curve([<curve referenced from the Rhino model> x2])
end = EndPoints(Curve=crv)  # -> Start, End
cir = Circle(Plane=end.Start, Radius=1)
vec2pt = Vector2Pt(PointA=end.Start, PointB=end.End, Unitize=False)  # -> Vector, Length

crv_2 = Curve(<curve referenced from the Rhino model>)
end_2 = EndPoints(Curve=crv_2)  # -> Start, End
cir_2 = Circle(Plane=end_2.Start, Radius=1)
vec2pt_2 = Vector2Pt(PointA=end_2.Start, PointB=end_2.End, Unitize=False)  # -> Vector, Length

crv_3 = Curve(<curve referenced from the Rhino model>)
end_3 = EndPoints(Curve=crv_3)  # -> Start, End
vec2pt_3 = Vector2Pt(PointA=end_3.Start, PointB=end_3.End, Unitize=False)  # -> Vector, Length
cir_3 = Circle(Plane=end_3.Start, Radius=1)

crv_4 = Curve(<curve referenced from the Rhino model>)
mat = MillC_StockSupportType(X=True, Y=True, Z=True, RX=True, RY=True, RZ=True)
support = _2DSupportRegion(Boundary=crv_4, SupportType=mat, AmendExistingSupports=Toggle(True), Displacement=Vector(0, 0, 0))

crv_5 = Curve(<curve referenced from the Rhino model>)
mat_2 = MillC_StockSupportType(X=Toggle(False), Y=True, Z=True, RX=True, RY=True, RZ=True)
support_2 = _2DSupportRegion(Boundary=crv_5, SupportType=mat_2, AmendExistingSupports=Toggle(True), Displacement=Vector(0, 0, 0))

load = _2DLoadRegion(Boundary=cir, Load=vec2pt.Vector)

load_2 = _2DLoadRegion(Boundary=cir_3, Load=vec2pt_3.Vector)
load_3 = _2DLoadRegion(Boundary=cir_2, Load=vec2pt_2.Vector)

crv_6 = Curve(<curve referenced from the Rhino model>)
boundary = _2DBoundaryRegion(Boundary=crv_6, IsVoid=False)

slider = Slider(0, range=0..1)
loadcase = LoadCase(LoadElements=[load, support, support_2], SelfWeightFactor=slider, Name="Load Case")
loadcase_2 = LoadCase(LoadElements=[support, load_2, load_3, support_2], SelfWeightFactor=slider, Name="Load Case")

crv_7 = Curve(<curve referenced from the Rhino model>)
boundary_2 = _2DBoundaryRegion(Boundary=crv_7, IsVoid=Toggle(True))

topostruct_2d = Topostruct2DModel(ModelComponents=[boundary, boundary_2, loadcase, loadcase_2], XResolution=Slider(60, range=0..76))  # -> FEModel, CellCentres, CellSize
topostruct_2d_solver = Topostruct2DSolver(
    FEModel=topostruct_2d.FEModel,
    SelfWeightCoefficient=0,
    OptimizationIterations=Slider(4, range=0..10),
    Smoothing=Slider(0.186, range=0..1),
    Penalization=Slider(1, range=0..4),
    TargetDensity=Slider(0.3, range=0..1),
    MinimumDensity=Slider(0.003, range=0.003..1),
    DeleteThreshold=0.5,
    PeriodicX=False,
    PeriodicY=False,
    LoadCase=Slider(1, range=0..10),
    AllCases=Toggle(False),
    CompliantMechanism=Toggle(True))  # -> FEModel, MaxDeflection

division = Division(A=Slider(0, range=0..6), B=topostruct_2d_solver.MaxDeflection)
_2d_mesh_results = _2DMeshResults(FEModel=topostruct_2d_solver.FEModel, Deflection=division, ColorMode=0)
