# Grasshopper definition w3_explicitSolid.gh (Grasshopper 0.9.64)
# plug-ins: Millipede

crv = Curve(<curve referenced from the Rhino model>)
mat = MillC_StockSupportType(X=True, Y=True, Z=True, RX=True, RY=True, RZ=True)
support = _2DSupportRegion(Boundary=crv, SupportType=mat, AmendExistingSupports=Toggle(True), Displacement=Vector(0, 0, 0))

crv_2 = Curve(<curve referenced from the Rhino model>)
Y = UnitY(Factor=Slider(-2160, range=-3000..0))
load = _2DLoadRegion(Boundary=crv_2, Load=Y)

crv_3 = Curve(<curve referenced from the Rhino model>)
density = _2DDensityRegion(Boundary=crv_3, Density=Slider(1, range=0..1))

crv_4 = Curve(<curve referenced from the Rhino model>)
boundary = _2DBoundaryRegion(Boundary=crv_4, IsVoid=Toggle(True))

crv_5 = Curve(<curve referenced from the Rhino model>)
boundary_2 = _2DBoundaryRegion(Boundary=crv_5, IsVoid=False)

loadcase = LoadCase(LoadElements=[load, support], SelfWeightFactor=Slider(0, range=0..1), Name="Load Case")

topostruct_2d = Topostruct2DModel(ModelComponents=[boundary, boundary_2, loadcase, density], XResolution=Slider(76, range=0..76))  # -> FEModel, CellCentres, CellSize
topostruct_2d_solver = Topostruct2DSolver(
    FEModel=topostruct_2d.FEModel,
    SelfWeightCoefficient=0,
    OptimizationIterations=Slider(3, range=0..10),
    Smoothing=Slider(0.25, range=0..1),
    Penalization=Slider(2.9, range=0..4),
    TargetDensity=Slider(0.25, range=0..1),
    MinimumDensity=0.001,
    DeleteThreshold=0.5,
    PeriodicX=False,
    PeriodicY=False,
    LoadCase=Slider(1, range=0..3),
    AllCases=Toggle(True),
    CompliantMechanism=False)  # -> FEModel, MaxDeflection

division = Division(A=Slider(0, range=0..4), B=topostruct_2d_solver.MaxDeflection)
_2d_iso_contour = _2DIsoContour(FEModel=topostruct_2d_solver.FEModel, Deflection=0, IsoContourValue=Slider(0.313, range=0..1))
_2d_mesh_results = _2DMeshResults(FEModel=topostruct_2d_solver.FEModel, Deflection=division, ColorMode=0)
