# Grasshopper definition w5_multipleLoadCases.gh (Grasshopper 0.9.64)
# plug-ins: Millipede

load = Slider(-2160, range=-3000..0)
selfweight = Slider(0, range=0..1)
Y = UnitY(Factor=load)
Y_2 = UnitY(Factor=load)
rev = Reverse(Vector=Y_2)

crv = Curve(<curve referenced from the Rhino model>)
boundary = _2DBoundaryRegion(Boundary=crv, IsVoid=False)

crv_2 = Curve(<curve referenced from the Rhino model>)
mat = MillC_StockSupportType(X=Toggle(False), Y=True, Z=True, RX=True, RY=True, RZ=True)
support = _2DSupportRegion(Boundary=crv_2, SupportType=mat, AmendExistingSupports=Toggle(True), Displacement=Vector(0, 0, 0))

crv_3 = Curve(<curve referenced from the Rhino model>)
mat_2 = MillC_StockSupportType(X=True, Y=True, Z=True, RX=True, RY=True, RZ=True)
support_2 = _2DSupportRegion(Boundary=crv_3, SupportType=mat_2, AmendExistingSupports=Toggle(True), Displacement=Vector(0, 0, 0))

crv_4 = Curve(<curve referenced from the Rhino model>)
load_2 = _2DLoadRegion(Boundary=crv_4, Load=rev)
loadcase = LoadCase(LoadElements=[load_2, support_2, support], SelfWeightFactor=selfweight, Name="Load Case")

crv_5 = Curve(<curve referenced from the Rhino model>)
load_3 = _2DLoadRegion(Boundary=crv_5, Load=Y)
loadcase_2 = LoadCase(LoadElements=[load_3, support_2, support], SelfWeightFactor=selfweight, Name="Load Case")

loadcase_3 = LoadCase(LoadElements=[load_2, load_3, support, support_2], SelfWeightFactor=selfweight, Name="Load Case")

topostruct_2d = Topostruct2DModel(ModelComponents=[boundary, loadcase_2, loadcase, loadcase_3], XResolution=Slider(60, range=0..76))  # -> FEModel, CellCentres, CellSize
topostruct_2d_solver = Topostruct2DSolver(
    FEModel=topostruct_2d.FEModel,
    SelfWeightCoefficient=0,
    OptimizationIterations=Slider(10, range=0..10),
    Smoothing=Slider(0.25, range=0..1),
    Penalization=Slider(2.9, range=0..4),
    TargetDensity=Slider(0.25, range=0..1),
    MinimumDensity=0.001,
    DeleteThreshold=0.5,
    PeriodicX=False,
    PeriodicY=False,
    LoadCase=Slider(2, range=0..3),
    AllCases=Toggle(True),
    CompliantMechanism=False)  # -> FEModel, MaxDeflection

division = Division(A=Slider(0, range=0..4), B=topostruct_2d_solver.MaxDeflection)
_2d_mesh_results = _2DMeshResults(FEModel=topostruct_2d_solver.FEModel, Deflection=division, ColorMode=0)
