# Grasshopper definition w6_pointDensity.gh (Grasshopper 0.9.64)
# plug-ins: Millipede

crv = Curve(<curve referenced from the Rhino model>)
boundary = _2DBoundaryRegion(Boundary=crv, IsVoid=Toggle(True))

crv_2 = Curve(<curve referenced from the Rhino model>)
Y = UnitY(Factor=Slider(-2160, range=-3000..0))
load = _2DLoadRegion(Boundary=crv_2, Load=Y)

crv_3 = Curve(<curve referenced from the Rhino model>)
mat = MillC_StockSupportType(X=True, Y=True, Z=True, RX=True, RY=True, RZ=True)
support = _2DSupportRegion(Boundary=crv_3, SupportType=mat, AmendExistingSupports=Toggle(True), Displacement=Vector(0, 0, 0))

crv_4 = Curve(<curve referenced from the Rhino model>)
boundary_2 = _2DBoundaryRegion(Boundary=crv_4, IsVoid=False)

galapagos = Galapagos(fitness=topostruct_2d_solver, gene=[slider_4, slider_2, slider_8, slider_5, slider, slider_6, slider_3, slider_7])

topostruct_2d = Topostruct2DModel(ModelComponents=[boundary, boundary_2, load, support], XResolution=Slider(40, range=0..76))  # -> FEModel, CellCentres, CellSize

slider = Slider(16, range=5..16)
slider_2 = Slider(4.905, range=1..12)
slider_3 = Slider(5.07, range=5..16)
slider_4 = Slider(5, range=5..16)
slider_5 = Slider(7.758, range=1..12)
slider_6 = Slider(6.619, range=1..12)
slider_7 = Slider(8.024, range=1..12)
slider_8 = Slider(16, range=5..16)
pt = ConstructPoint(XCoordinate=slider, YCoordinate=slider_6, ZCoordinate=0)
pt_2 = ConstructPoint(XCoordinate=slider_3, YCoordinate=slider_7, ZCoordinate=0)
pt_3 = ConstructPoint(XCoordinate=slider_4, YCoordinate=slider_2, ZCoordinate=0)
pt_4 = ConstructPoint(XCoordinate=slider_8, YCoordinate=slider_5, ZCoordinate=0)
ln = Line(StartPoint=pt, EndPoint=pt_2)
ln_2 = Line(StartPoint=pt_3, EndPoint=pt_4)
pull = PullPoint(Point=topostruct_2d.CellCentres, Geometry=[ln_2, ln], ClosestOnly=True)  # -> ClosestPoint, Distance
c_script = CSharpScript(d=pull.Distance, a=Slider(0.5, range=0..1))  # -> out, A; inputs d: Double, a: Double
# ---------- c_script: C# ----------
    A = Math.Exp(-a * d * d);
# ---------- end c_script ----------

topostruct_2d_solver = Topostruct2DSolver(
    FEModel=topostruct_2d.FEModel,
    SelfWeightCoefficient=0,
    OptimizationIterations=Slider(0, range=0..10),
    Smoothing=0.1,
    Penalization=3,
    TargetDensity=0.4,
    InitialDensities=c_script.A,
    MinimumDensity=0.001,
    DeleteThreshold=0.5,
    PeriodicX=False,
    PeriodicY=False,
    LoadCase=0,
    AllCases=True,
    CompliantMechanism=False)  # -> FEModel, MaxDeflection

panel = Panel(topostruct_2d_solver.MaxDeflection)

division = Division(A=Slider(0, range=0..4), B=topostruct_2d_solver.MaxDeflection)
_2d_mesh_results = _2DMeshResults(FEModel=topostruct_2d_solver.FEModel, Deflection=division, ColorMode=0)
