# Grasshopper definition w7_functionDensity.gh (Grasshopper 0.9.64)
# plug-ins: Millipede

crv = Curve(<curve referenced from the Rhino model>)
boundary = _2DBoundaryRegion(Boundary=crv, IsVoid=False)

crv_2 = Curve(<curve referenced from the Rhino model>)
boundary_2 = _2DBoundaryRegion(Boundary=crv_2, IsVoid=Toggle(True))

crv_3 = Curve(<curve referenced from the Rhino model>)
mat = MillC_StockSupportType(X=True, Y=True, Z=True, RX=True, RY=True, RZ=True)
support = _2DSupportRegion(Boundary=crv_3, SupportType=mat, AmendExistingSupports=Toggle(True), Displacement=Vector(0, 0, 0))

Y = UnitY(Factor=Slider(-2160, range=-3000..0))
crv_4 = Curve(<curve referenced from the Rhino model>)
load = _2DLoadRegion(Boundary=crv_4, Load=Y)

galapagos = Galapagos(fitness=topostruct_2d_solver, gene=[slider, slider_2])

topostruct_2d = Topostruct2DModel(ModelComponents=[boundary_2, boundary, load, support], XResolution=Slider(40, range=0..76))  # -> FEModel, CellCentres, CellSize

slider = Slider(1.069, range=-5..5)
slider_2 = Slider(-1.511, range=-5..5)
c_script = CSharpScript(a=slider, b=slider_2, p=topostruct_2d.CellCentres)  # -> out, A; inputs a: Double, b: Double, p: Point3d
# ---------- c_script: C# ----------
    A = Math.Cos(p.X*a) + b * Math.Cos(p.Y);
# ---------- end c_script ----------
bnd = Bounds(Numbers=c_script.A)

remap = RemapNumbers(Value=c_script.A, Source=bnd, Target=Domain(0.01, 1))
topostruct_2d_solver = Topostruct2DSolver(
    FEModel=topostruct_2d.FEModel,
    SelfWeightCoefficient=0,
    OptimizationIterations=Slider(0, range=0..10),
    Smoothing=0.1,
    Penalization=3,
    TargetDensity=0.4,
    InitialDensities=remap,
    MinimumDensity=0.001,
    DeleteThreshold=0.5,
    PeriodicX=False,
    PeriodicY=False,
    LoadCase=Slider(0, range=0..3),
    AllCases=Toggle(False),
    CompliantMechanism=False)  # -> FEModel, MaxDeflection

division = Division(A=Slider(0, range=0..4), B=topostruct_2d_solver.MaxDeflection)
_2d_mesh_results = _2DMeshResults(FEModel=topostruct_2d_solver.FEModel, Deflection=division, ColorMode=0)
