# Grasshopper definition w8_thickness.gh (Grasshopper 0.9.64)
# plug-ins: Millipede

crv = Curve(<curve referenced from the Rhino model>)
mat = MillC_StockSupportType(X=True, Y=True, Z=True, RX=True, RY=True, RZ=True)
support = _2DSupportRegion(Boundary=crv, SupportType=mat, AmendExistingSupports=Toggle(True), Displacement=Vector(0, 0, 0))

crv_2 = Curve(<curve referenced from the Rhino model>)
boundary = _2DBoundaryRegion(Boundary=crv_2, IsVoid=False)

crv_3 = Curve(<curve referenced from the Rhino model>)
Y = UnitY(Factor=Slider(-33000, range=-33000..0))
load = _2DLoadRegion(Boundary=crv_3, Load=Y)

loadcase = LoadCase(LoadElements=[load, support], SelfWeightFactor=Slider(0, range=0..1), Name="Load Case")

slider = Slider(76, range=0..76)
topostruct_2d = Topostruct2DModel(ModelComponents=[boundary, loadcase], XResolution=slider)  # -> FEModel, CellCentres, CellSize
topostruct_2d_solver = Topostruct2DSolver(
    FEModel=topostruct_2d.FEModel,
    SelfWeightCoefficient=0,
    OptimizationIterations=Slider(3, range=0..10),
    Smoothing=Slider(0.216, range=0..1),
    Penalization=Slider(2.5, range=0..4),
    TargetDensity=Slider(0.2, range=0..1),
    MinimumDensity=0.001,
    DeleteThreshold=0.5,
    PeriodicX=False,
    PeriodicY=False,
    LoadCase=0,
    AllCases=True,
    CompliantMechanism=False)  # -> FEModel, MaxDeflection

c_script = CSharpScript(
    th=Slider(1.556, range=0..6),
    fe=topostruct_2d_solver.FEModel,
    rx=slider,
    ry=slider,
    Reference=["C:\Users\pan\AppData\Roaming\Grasshopper\Libraries\SawapanStatica.dll", "C:\Users\pan\AppData\Roaming\Grasshopper\Libraries\SawapanStatRhino.dll"])  # -> out, A; inputs th: Double, rx: Int32, ry: Int32
# ---------- c_script: C# ----------
    SawapanStatRhino.RStatSystem2D fsys = fe as SawapanStatRhino.RStatSystem2D;
    if (fsys == null) return;

    List<Point3d> pt = new List<Point3d>();

    double ddx = (fsys.MaxPoint.x - fsys.MinPoint.x) / (double) (rx - 1.0);
    double ddy = (fsys.MaxPoint.y - fsys.MinPoint.y) / (double) (ry - 1.0);

    for(int j = 0; j < ry; ++j) {
      for(int i = 0; i < rx; ++i) {
        Point3d p = new Point3d(fsys.MinPoint.x + i * ddx, fsys.MinPoint.y + j * ddy, 0.0);
        p.Z = DensityAtPoint(fsys, p) * th;
        pt.Add(p);
      }
    }

    A = NurbsSurface.CreateThroughPoints(pt, ry, rx, 3, 3, false, false);


    // A = pt;
# ---------- c_script: C# additional code ----------
  double DensityAtPoint(RStatSystem2D fs, Point3d p) {
    StatPlate2DSquare q = fs.FindQuad(new C_vector2(p.X, p.Y));
    if (q == null) return 0.0;


    double dx = (p.X - q.nd[0].p.x) / fs.ElementSize;
    double dy = (p.Y - q.nd[0].p.y) / fs.ElementSize;

    double ix0 = q.nd[0].Density * (1.0 - dx) + q.nd[1].Density * dx;
    double ix1 = q.nd[3].Density * (1.0 - dx) + q.nd[2].Density * dx;

    return ix0 * (1.0 - dy) + ix1 * dy;
  }
# ---------- end c_script ----------
preview = CustomPreview(Geometry=c_script.A, Shader=ColourSwatch(SwatchColor=RGB(173, 173, 173)))

division = Division(A=Slider(0, range=0..4), B=topostruct_2d_solver.MaxDeflection)
_2d_mesh_results = _2DMeshResults(FEModel=topostruct_2d_solver.FEModel, Deflection=division, ColorMode=0)
