# Grasshopper definition w9_raster.gh (Grasshopper 0.9.64)
# plug-ins: Millipede

crv = Curve(<curve referenced from the Rhino model>)
mat = MillC_StockSupportType(X=True, Y=True, Z=True, RX=True, RY=True, RZ=True)
support = _2DSupportRegion(Boundary=crv, SupportType=mat, AmendExistingSupports=Toggle(True), Displacement=Vector(0, 0, 0))

crv_2 = Curve(<curve referenced from the Rhino model>)
Y = UnitY(Factor=Slider(-33000, range=-33000..0))
load = _2DLoadRegion(Boundary=crv_2, Load=Y)

crv_3 = Curve(<curve referenced from the Rhino model>)
boundary = _2DBoundaryRegion(Boundary=crv_3, IsVoid=False)

loadcase = LoadCase(LoadElements=[load, support], SelfWeightFactor=Slider(0, range=0..1), Name="Load Case")

topostruct_2d = Topostruct2DModel(ModelComponents=[boundary, loadcase], XResolution=Slider(76, range=0..76))  # -> FEModel, CellCentres, CellSize
topostruct_2d_solver = Topostruct2DSolver(
    FEModel=topostruct_2d.FEModel,
    SelfWeightCoefficient=0,
    OptimizationIterations=Slider(3, range=0..10),
    Smoothing=Slider(0.216, range=0..1),
    Penalization=Slider(2.5, range=0..4),
    TargetDensity=Slider(0.2, range=0..1),
    MinimumDensity=0.001,
    DeleteThreshold=0.5,
    PeriodicX=False,
    PeriodicY=False,
    LoadCase=0,
    AllCases=True,
    CompliantMechanism=False)  # -> FEModel, MaxDeflection

division = Division(A=Slider(0, range=0..4), B=topostruct_2d_solver.MaxDeflection)
_2d_mesh_results = _2DMeshResults(FEModel=topostruct_2d_solver.FEModel, Deflection=division, ColorMode=0)

path = FilePath("E:\Google Drive\SYNCmain\LittleProjects\Millipede_DOCS\March2014\Examples\TopologyOptimization2D\disk.png")
c_script = CSharpScript(
    fe=topostruct_2d_solver.FEModel,
    rx=Slider(272, range=1..400),
    ry=Slider(240, range=1..400),
    nx=Slider(37, range=1..40),
    ny=Slider(34, range=1..40),
    fpath=path,
    Reference=["C:\Users\pan\AppData\Roaming\Grasshopper\Libraries\SawapanStatica.dll", "C:\Users\pan\AppData\Roaming\Grasshopper\Libraries\SawapanStatRhino.dll"])  # -> out, A, B; inputs rx: Int32, ry: Int32, nx: Int32, ny: Int32, fpath: String
# ---------- c_script: C# ----------
    SawapanStatRhino.RStatSystem2D fsys = fe as SawapanStatRhino.RStatSystem2D;
    if (fsys == null) return;

    Bitmap bmp = new Bitmap(fpath);

    //List<Point3d> pt = new List<Point3d>();

    List<double> val = new List<double>();

    Mesh nm = Mesh.CreateFromPlane(Plane.WorldXY, new Interval(fsys.MinPoint.x, fsys.MaxPoint.x), new Interval(fsys.MinPoint.y, fsys.MaxPoint.y), rx - 1, ry - 1);


    double ddx = (fsys.MaxPoint.x - fsys.MinPoint.x) / (double) (rx - 1.0);
    double ddy = (fsys.MaxPoint.y - fsys.MinPoint.y) / (double) (ry - 1.0);

    int k = 0;

    for(int j = 0; j < ry; ++j) {
      for(int i = 0; i < rx; ++i) {

        double pxu = nx * i / (double) (rx - 1.0);
        double pxv = ny * j / (double) (ry - 1.0);

        double bd = PixelAt(bmp, pxu - Math.Floor(pxu), pxv - Math.Floor(pxv));
        Point3d p = new Point3d(fsys.MinPoint.x + i * ddx, fsys.MinPoint.y + j * ddy, 0.0);
        p.Z = ( bd) * (1.0 - DensityAtPoint(fsys, p));
        // nm.Vertices.SetVertex(k, nm.Vertices[k].X, nm.Vertices[k].Y, p.Z);

        val.Add(p.Z);
        //nm.TextureCoordinates.SetTextureCoordinate(k, p.Z, 0.0);
        //pt.Add(p);
        k++;
      }
    }

    nm.FaceNormals.ComputeFaceNormals();
    nm.Normals.ComputeNormals();

    A = nm;

    B = val;
    // A = pt;
# ---------- c_script: C# additional code ----------
  double DensityAtPoint(RStatSystem2D fs, Point3d p) {
    StatPlate2DSquare q = fs.FindQuad(new C_vector2(p.X, p.Y));
    if (q == null) return 0.0;


    double dx = (p.X - q.nd[0].p.x) / fs.ElementSize;
    double dy = (p.Y - q.nd[0].p.y) / fs.ElementSize;

    double ix0 = q.nd[0].Density * (1.0 - dx) + q.nd[1].Density * dx;
    double ix1 = q.nd[3].Density * (1.0 - dx) + q.nd[2].Density * dx;

    return ix0 * (1.0 - dy) + ix1 * dy;
  }

  double PixelAt(Bitmap b, double u, double v) {
    int i = (int) (u * b.Width);
    if (i < 0) i = 0;
    else if (i >= b.Width) i = b.Width - 1;

    int j = (int) (v * b.Height);
    if (j < 0) j = 0;
    else if (j >= b.Height) j = b.Height - 1;

    return b.GetPixel(i, j).R / 255.0;
  }
# ---------- end c_script ----------
mesh_contours = MeshContourField(Mesh=c_script.A, Values=c_script.B, IsoValues=Slider(0.214, range=0..1))
