# Grasshopper definition w9_stresslines.gh (Grasshopper 0.9.64)
# plug-ins: Millipede

crv = Curve(<curve referenced from the Rhino model>)
Y = UnitY(Factor=Slider(-14000, range=-14000..0))
load = _2DLoadRegion(Boundary=crv, Load=Y)

crv_2 = Curve(<curve referenced from the Rhino model>)
mat = MillC_StockSupportType(X=Toggle(False), Y=True, Z=True, RX=True, RY=True, RZ=True)
support = _2DSupportRegion(Boundary=crv_2, SupportType=mat, AmendExistingSupports=Toggle(True), Displacement=Vector(0, 0, 0))

crv_3 = Curve(<curve referenced from the Rhino model>)
mat_2 = MillC_StockSupportType(X=True, Y=True, Z=True, RX=True, RY=True, RZ=True)
support_2 = _2DSupportRegion(Boundary=crv_3, SupportType=mat_2, AmendExistingSupports=Toggle(True), Displacement=Vector(0, 0, 0))

crv_4 = Curve(<curve referenced from the Rhino model>)
boundary = _2DBoundaryRegion(Boundary=crv_4, IsVoid=False)

topostruct_2d = Topostruct2DModel(ModelComponents=[boundary, load, support, support_2], XResolution=Slider(76, range=0..76))  # -> FEModel, CellCentres, CellSize
topostruct_2d_solver = Topostruct2DSolver(
    FEModel=topostruct_2d.FEModel,
    SelfWeightCoefficient=0,
    OptimizationIterations=Slider(10, range=0..10),
    Smoothing=Slider(0.25, range=0..1),
    Penalization=Slider(2.9, range=0..4),
    TargetDensity=Slider(0.4, range=0..1),
    MinimumDensity=0.001,
    DeleteThreshold=0.5,
    PeriodicX=False,
    PeriodicY=False,
    LoadCase=0,
    AllCases=True,
    CompliantMechanism=False)  # -> FEModel, MaxDeflection

stress_pattern = StressPattern(
    FEModel=topostruct_2d_solver.FEModel,
    Omega=Slider(3.865, range=0..10),
    Scalefield=Toggle(True),
    Uselambda=False,
    Smoothfactor=0,
    SmoothModulo=1,
    Iterations=Slider(1000, range=0..1000),
    MeshDenisty=1)
curves = Curves(System=stress_pattern)

division = Division(A=Slider(0, range=0..4), B=topostruct_2d_solver.MaxDeflection)
_2d_mesh_results = _2DMeshResults(FEModel=topostruct_2d_solver.FEModel, Deflection=division, ColorMode=2)
