# Grasshopper definition 009_CustomDensityFieldAnalysis.gh (Grasshopper 0.9.64)
# plug-ins: Millipede

slider = Slider(161499.9, range=0..500000)
neg = Negative(Value=slider)

mat = MillC_StockSupportType(X=True, Y=True, Z=True, RX=True, RY=True, RZ=True)
brep = Brep(<brep referenced from the Rhino model>)
support = _3DSupportRegion(Boundary=brep, SupportType=mat, AmendExistingSupports=True)

brep_2 = Brep(<brep referenced from the Rhino model>)
X = UnitX(Factor=neg)
load = _3DLoadRegion(Boundary=brep_2, Load=X)

X_2 = UnitX(Factor=slider)
brep_3 = Brep(<brep referenced from the Rhino model>)
load_2 = _3DLoadRegion(Boundary=brep_3, Load=X_2)

brep_4 = Brep(<brep referenced from the Rhino model>)
Y = UnitY(Factor=neg)
load_3 = _3DLoadRegion(Boundary=brep_4, Load=Y)

brep_5 = Brep(<brep referenced from the Rhino model>)
Y_2 = UnitY(Factor=slider)
load_4 = _3DLoadRegion(Boundary=brep_5, Load=Y_2)

Z = UnitZ(Factor=neg)
brep_6 = Brep(<brep referenced from the Rhino model>)
load_5 = _3DLoadRegion(Boundary=brep_6, Load=Z)

brep_7 = Brep(<brep referenced from the Rhino model>)
Z_2 = UnitZ(Factor=slider)
load_6 = _3DLoadRegion(Boundary=brep_7, Load=Z_2)

brep_8 = Brep(<brep referenced from the Rhino model>)
boundary = _3DBoundaryRegion(Boundary=brep_8, IsVoid=Toggle(False))

topostruct_3d = Topostruct3DModel(ModelComponents=[boundary, load_6, support, load_5, load_2, load, load_4, load_3], XResolution=Slider(20, range=2..30))  # -> FEModel, CellCentres, CellSize
c_script = CSharpScript(p=topostruct_3d.CellCentres, p1=Slider(2, range=1..5), p2=Slider(3.619, range=1..5), p3=Slider(1, range=1..5))  # -> out, A; inputs p: Point3d, p1: Double, p2: Double, p3: Double
# ---------- c_script: C# ----------
    A = 0.1+(3.0+Math.Cos(p.X * p1) + Math.Sin(p.Y * p2) + Math.Cos(p.Z * p3))/6.0;
# ---------- end c_script ----------
topostruct_3d_solver = Topostruct3DSolver(
    FEModel=topostruct_3d.FEModel,
    SelfWeightCoefficient=0,
    OptimisationIterations=Slider(0, range=0..4),
    Smoothing=Slider(0.13, range=0..1),
    Penalization=3,
    TargetDensity=Slider(0.4, range=0..1),
    InitialDensities=c_script.A,
    MinimumDensity=0.001,
    DeleteThreshold=0.5,
    PeriodicX=False,
    PeriodicY=False,
    PeriodicZ=False,
    LoadCase=0,
    AllCases=True)  # -> FEModel, MaxDeflection

division = Division(A=Slider(0, range=0..10), B=topostruct_3d_solver.MaxDeflection)
_3d_mesh_results = _3DMeshResults(FEModel=topostruct_3d_solver.FEModel, Deflection=division, ColorMode=1)  # disabled
_3d_iso_mesh = _3DIsoMesh(FEModel=topostruct_3d_solver.FEModel, Deflection=division, IsoContourValue=Slider(0.631, range=0..1), ColorMode=2)
preview = CustomPreview(Geometry=_3d_iso_mesh, Shader=ColourSwatch(SwatchColor=RGB(191, 191, 191)))
