# Grasshopper definition 010_PressureCell.gh (Grasshopper 0.9.64)
# plug-ins: Millipede

slider = Slider(161499.9, range=0..500000)
neg = Negative(Value=slider)

mat = MillC_StockSupportType(X=True, Y=True, Z=True, RX=True, RY=True, RZ=True)
brep = Brep(<brep referenced from the Rhino model>)
support = _3DSupportRegion(Boundary=brep, SupportType=mat, AmendExistingSupports=True)

brep_2 = Brep(<brep referenced from the Rhino model>)
boundary = _3DBoundaryRegion(Boundary=brep_2, IsVoid=Toggle(False))

brep_3 = Brep(<brep referenced from the Rhino model>)
X = UnitX(Factor=neg)
load = _3DLoadRegion(Boundary=brep_3, Load=X)

brep_4 = Brep(<brep referenced from the Rhino model>)
X_2 = UnitX(Factor=slider)
load_2 = _3DLoadRegion(Boundary=brep_4, Load=X_2)

brep_5 = Brep(<brep referenced from the Rhino model>)
Y = UnitY(Factor=neg)
load_3 = _3DLoadRegion(Boundary=brep_5, Load=Y)

brep_6 = Brep(<brep referenced from the Rhino model>)
Y_2 = UnitY(Factor=slider)
load_4 = _3DLoadRegion(Boundary=brep_6, Load=Y_2)

brep_7 = Brep(<brep referenced from the Rhino model>)
Z = UnitZ(Factor=neg)
load_5 = _3DLoadRegion(Boundary=brep_7, Load=Z)

brep_8 = Brep(<brep referenced from the Rhino model>)
Z_2 = UnitZ(Factor=slider)
load_6 = _3DLoadRegion(Boundary=brep_8, Load=Z_2)

topostruct_3d = Topostruct3DModel(ModelComponents=[boundary, load_6, support, load_5, load_2, load, load_4, load_3], XResolution=Slider(17, range=2..19))  # -> FEModel, CellCentres, CellSize
topostruct_3d_solver = Topostruct3DSolver(
    FEModel=topostruct_3d.FEModel,
    SelfWeightCoefficient=0,
    OptimisationIterations=Slider(2, range=0..4),
    Smoothing=Slider(0.13, range=0..1),
    Penalization=3,
    TargetDensity=Slider(0.4, range=0..1),
    MinimumDensity=0.001,
    DeleteThreshold=0.5,
    PeriodicX=False,
    PeriodicY=False,
    PeriodicZ=False,
    LoadCase=0,
    AllCases=True)  # -> FEModel, MaxDeflection

division = Division(A=Slider(0, range=0..10), B=topostruct_3d_solver.MaxDeflection)

_3d_iso_mesh = _3DIsoMesh(FEModel=topostruct_3d_solver.FEModel, Deflection=division, IsoContourValue=Slider(0.421, range=0..1), ColorMode=0)
preview = CustomPreview(Geometry=_3d_iso_mesh, Shader=ColourSwatch(SwatchColor=RGB(191, 191, 191)))
