# Grasshopper definition 012_TopostructPorosity.gh (Grasshopper 0.9.64)
# plug-ins: Millipede

pi = Pi(Factor=1)
neg = Negative(Value=pi)
dom = Domain(DomainStart=neg, DomainEnd=pi)
slider = Slider(15, range=2..50)
slider_2 = Slider(15, range=2..50)
slider_3 = Slider(15, range=2..50)
box = DomainBox(Base=PlaneXY(0, 0, 0), X=dom, Y=dom, Z=dom)
c_script = CSharpScript(b=box, rx=slider, ry=slider_2, rz=slider_3)  # -> out, A; inputs b: Box, rx: Int32, ry: Int32, rz: Int32
# ---------- c_script: C# ----------
    double dx = 1.0 / (double) (rx - 1.0);
    double dy = 1.0 / (double) (ry - 1.0);
    double dz = 1.0 / (double) (rz - 1.0);

    int k = 0;
    int j = 0;
    int i = 0;

    List<double> d = new List<double>(rx * ry * rz);

    double dd = 0.0;
    double nx;
    double ny;
    double nz;

    double px;
    double py;
    double pz;

    double pi2 = Math.PI * 2.0;

    for(k = 0; k < rz;++k) {
      nz = k * dz;
      for(j = 0; j < ry;++j) {
        ny = j * dy;
        for(i = 0; i < rx;++i) {
          nx = i * dx;
          Point3d p = b.PointAt(nx, ny, nz);
          px = p.X;
          py = p.Y;
          pz = p.Z;


          //dd = 0.1 * Math.Cos(pi2 * nx) * Math.Cos(2.0 * pi2 * (nz - ny)) - 0.1 * Math.Cos(pi2 * (3.0 * ny - 2.0 * nz)) + 0.2 * Math.Sin(2.0 * pi2 * (nz + ny));
          //Sherk surface
          //dd = Math.Exp(pz) * Math.Cos(px) - Math.Cos(py);
          //dd = pz * Math.Cos(px) - Math.Cos(py);
          //dd = pz * pz * Math.Cos(px) - Math.Cos(py);
          //Swartz P
          //dd = Math.Cos(px) + Math.Cos(py) + Math.Cos(pz);

          //Diamond
          /* dd = Math.Sin(px) * Math.Sin(py) * Math.Sin(pz) +
          Math.Sin(px) * Math.Cos(py) * Math.Cos(pz) +
          Math.Cos(px) * Math.Sin(py) * Math.Cos(pz) +
          Math.Cos(px) * Math.Cos(py) * Math.Sin(pz);*/

          //Gyroid
          dd = Math.Cos(px) * Math.Sin(py) +
          Math.Cos(py) * Math.Sin(pz) +
          Math.Cos(pz) * Math.Sin(px);

          //Neovius

          /*dd = 3.0 * (Math.Cos(px) + Math.Cos(py) + Math.Cos(pz)) +
            4.0 * (Math.Cos(px) * Math.Cos(py) * Math.Cos(pz));*/

          //Math.Cos(px) * Math.Cos(py) - Math.Cos(pz) * Math.Cos(py)

          d.Add(dd);
        }
      }
    }

    A = d;
# ---------- end c_script ----------

geo = Geometry(<brep referenced from the Rhino model>)
Z = UnitZ(Factor=Slider(-21000, range=-21000..21000))
load = _3DLoadRegion(Boundary=geo, Load=Z)

geo_2 = Geometry([<brep referenced from the Rhino model> x2])
mat = MillC_StockSupportType(X=True, Y=True, Z=True, RX=True, RY=True, RZ=True)
support = _3DSupportRegion(Boundary=geo_2, SupportType=mat, AmendExistingSupports=True)

geo_3 = Geometry(<brep referenced from the Rhino model>)
boundary = _3DBoundaryRegion(Boundary=geo_3, IsVoid=False)

topostruct_3d = Topostruct3DModel(ModelComponents=[boundary, support, load], XResolution=Slider(11, range=2..16))  # -> FEModel, CellCentres, CellSize
topostruct_3d_solver = Topostruct3DSolver(
    FEModel=topostruct_3d.FEModel,
    SelfWeightCoefficient=0,
    OptimisationIterations=Slider(5, range=-1..5),
    Smoothing=0.1,
    Penalization=3,
    TargetDensity=Slider(0.25, range=0..1),
    MinimumDensity=0.001,
    DeleteThreshold=0.5,
    PeriodicX=False,
    PeriodicY=False,
    PeriodicZ=False,
    LoadCase=0,
    AllCases=True)  # -> FEModel, MaxDeflection

range = Range(Domain=Domain(0, 1.3), Steps=10)
iso_surface = IsoSurface(
    Box=box,
    Values=c_script.A,
    XResolution=slider,
    YResolution=slider_2,
    ZResolution=slider_3,
    IsoValue=range,
    MergeVertices=Toggle(True))

_3d_cell_results = _3DCellResults(FEModel=topostruct_3d_solver.FEModel)  # -> PrincipalStressPlanes, PrincipalStresses, VonMisesStress, Density
lng = ListLength(List=iso_surface)
dom_2 = Domain(DomainStart=expr("A-1", lng), DomainEnd=0)
division = Division(A=topostruct_3d.CellSize, B=pi)
num = Number(0.5)
bnd = Bounds(Numbers=_3d_cell_results.Density)
multiplication = Multiplication(A=division, B=num)
remap = RemapNumbers(Values=_3d_cell_results.Density, Source=bnd, Target=dom_2)
scale = Scale(Geometry=iso_surface, Center=Point(0, 0, 0), Factor=multiplication)  # -> Geometry, Transform
round = Round(Number=remap)  # -> Nearest, Floor, Ceiling
pt = PointXYZ(XComponent=0, YComponent=0, ZComponent=0, System=PlaneXY(0, 0, 0))
item = ListItem(List=scale.Geometry, Index=round.Nearest, Wrap=False)
vec2pt = Vector2Pt(PointA=pt, PointB=_3d_cell_results.PrincipalStressPlanes, Unitize=False)  # -> Vector, Length
move = Move(Geometry=item, Motion=vec2pt.Vector)  # -> Geometry, Transform
preview = CustomPreview(Geometry=move.Geometry, Shader=ColourSwatch(SwatchColor=RGB(166, 166, 166)))

_3d_iso_mesh = _3DIsoMesh(
    FEModel=topostruct_3d_solver.FEModel,
    Deflection=Slider(0, range=0..501000),
    IsoContourValue=Slider(0.2, range=0..1),
    ColorMode=3)
