# Grasshopper definition 013_stressAlign.gh (Grasshopper 0.9.64)
# plug-ins: Millipede

geo = Geometry(<brep referenced from the Rhino model>)
Z = UnitZ(Factor=Slider(-21000, range=-21000..21000))
load = _3DLoadRegion(Boundary=geo, Load=Z)

geo_2 = Geometry([<brep referenced from the Rhino model> x2])
mat = MillC_StockSupportType(X=True, Y=True, Z=True, RX=True, RY=True, RZ=True)
support = _3DSupportRegion(Boundary=geo_2, SupportType=mat, AmendExistingSupports=True)

geo_3 = Geometry(<brep referenced from the Rhino model>)
boundary = _3DBoundaryRegion(Boundary=geo_3, IsVoid=False)

topostruct_3d = Topostruct3DModel(ModelComponents=[boundary, support, load], XResolution=Slider(16, range=2..16))  # -> FEModel, CellCentres, CellSize
topostruct_3d_solver = Topostruct3DSolver(
    FEModel=topostruct_3d.FEModel,
    SelfWeightCoefficient=0,
    OptimisationIterations=1,
    Smoothing=0.1,
    Penalization=3,
    TargetDensity=0.4,
    MinimumDensity=0.001,
    DeleteThreshold=0.5,
    PeriodicX=False,
    PeriodicY=False,
    PeriodicZ=False,
    LoadCase=0,
    AllCases=True)  # -> FEModel, MaxDeflection

geo_4 = Geometry(<mesh referenced from the Rhino model>)
_3d_cell_results = _3DCellResults(FEModel=topostruct_3d_solver.FEModel)  # -> PrincipalStressPlanes, PrincipalStresses, VonMisesStress, Density
multiplication = Multiplication(A=topostruct_3d.CellSize, B=Slider(1.466, range=0..3))
pcomp = Decompose(Point=_3d_cell_results.PrincipalStresses, System=PlaneXY(0, 0, 0))  # -> XComponent, YComponent, ZComponent
bnd = Bounds(Numbers=_3d_cell_results.VonMisesStress)
dom = Domain(DomainStart=0, DomainEnd=multiplication)
msmooth = SmoothMesh(Mesh=geo_4, Strength=Slider(0.042, range=0..1), SkipNaked=True, Iterations=Slider(3, range=0..4))
remap = RemapNumbers(Values=pcomp.XComponent, Source=bnd, Target=dom)
remap_2 = RemapNumbers(Values=pcomp.YComponent, Source=bnd, Target=dom)
remap_3 = RemapNumbers(Values=pcomp.ZComponent, Source=bnd, Target=dom)
scale_nu = ScaleNU(Geometry=msmooth, Plane=PlaneXY(0, 0, 0), ScaleX=remap, ScaleY=remap_2, ScaleZ=remap_3)  # -> Geometry, Transform
orient = Orient(Geometry=scale_nu.Geometry, Source=PlaneXY(0, 0, 0), Target=_3d_cell_results.PrincipalStressPlanes)  # -> Geometry, Transform
preview = CustomPreview(Geometry=orient.Geometry, Shader=ColourSwatch(SwatchColor=RGB(158, 158, 158)))
