# Grasshopper definition b008_topostruct3d.gh (Grasshopper 0.9.64)
# plug-ins: Millipede

neg = Negative(Value=Slider(161499.9, range=0..500000))
brep = Brep(<brep referenced from the Rhino model>)
Z = UnitZ(Factor=neg)
load = _3DLoadRegion(Boundary=brep, Load=Z)

brep_2 = Brep(<brep referenced from the Rhino model>)
mat = MillC_StockSupportType(X=True, Y=True, Z=True, RX=True, RY=True, RZ=True)
support = _3DSupportRegion(Boundary=brep_2, SupportType=mat, AmendExistingSupports=True)

neg_2 = Negative(Value=Slider(161499.9, range=0..500000))
Z_2 = UnitZ(Factor=neg_2)
brep_3 = Brep(<brep referenced from the Rhino model>)
load_2 = _3DLoadRegion(Boundary=brep_3, Load=Z_2)

brep_4 = Brep(<brep referenced from the Rhino model>)
mat_2 = MillC_StockSupportType(X=True, Y=True, Z=True, RX=True, RY=True, RZ=True)
support_2 = _3DSupportRegion(Boundary=brep_4, SupportType=mat_2, AmendExistingSupports=True)

loadcase = LoadCase(LoadElements=[load, support], SelfWeightFactor=Slider(0, range=0..1), Name="Load Case")

loadcase_2 = LoadCase(LoadElements=[load_2, support_2], SelfWeightFactor=Slider(0, range=0..1), Name="Load Case")

brep_5 = Brep(<brep referenced from the Rhino model>)
boundary = _3DBoundaryRegion(Boundary=brep_5, IsVoid=Toggle(False))

topostruct_3d = Topostruct3DModel(ModelComponents=[loadcase, boundary, loadcase_2], XResolution=Slider(16, range=2..29))  # -> FEModel, CellCentres, CellSize
topostruct_3d_solver = Topostruct3DSolver(
    FEModel=topostruct_3d.FEModel,
    SelfWeightCoefficient=0,
    OptimisationIterations=Slider(4, range=0..4),
    Smoothing=Slider(0.09, range=0..1),
    Penalization=3,
    TargetDensity=Slider(0.15, range=0..1),
    MinimumDensity=0.001,
    DeleteThreshold=0.5,
    PeriodicX=False,
    PeriodicY=False,
    PeriodicZ=False,
    LoadCase=Slider(1, range=0..3),
    AllCases=Toggle(True))  # -> FEModel, MaxDeflection

division = Division(A=Slider(0, range=0..10), B=topostruct_3d_solver.MaxDeflection)

_3d_iso_mesh = _3DIsoMesh(FEModel=topostruct_3d_solver.FEModel, Deflection=division, IsoContourValue=Slider(0.088, range=0..1), ColorMode=3)
preview = CustomPreview(Geometry=_3d_iso_mesh, Shader=ColourSwatch(SwatchColor=RGB(128, 128, 128)))
