# Grasshopper definition 016_FFTsound.gh (Grasshopper 0.9.64)
# plug-ins: Millipede, Firefly_X

timer = Timer(TimerInterval=20, Target=capture)  # disabled
capture = SoundCapture(Duration=0.1, StartSoundCapture=True)  # -> SamplesFromLeftChannel, SamplesFromRightChannel, Volume
fft = FFT(Real=capture.SamplesFromLeftChannel, IsForward=True)
cmod = ComplexModulus(Complex=fft)
graph = QuickGraph(cmod)
