# Grasshopper definition 017_FFTSimple.gh (Grasshopper 0.9.64)
# plug-ins: Millipede

range = Range(Domain=Domain(0, 1), Steps=60)
multiplication = Multiplication(A=range, B=Slider(130.398, range=0..222))
cos = Cosine(Value=multiplication)
graph = QuickGraph(cos)
fft = FFT(Real=cos, IsForward=True)
cmod = ComplexModulus(Complex=fft)
graph_2 = QuickGraph(cmod)
