# Grasshopper definition Exoskeleton with Topoligizer.gh (Grasshopper 1.0.7)
# plug-ins: Topologizer, Kangaroo2 Components, Weaverbird, Exoskeleton2

point = Point(Point(-38, 209, 0))
point_2 = Point(Point(45, 209, 0))
point_3 = Point(Point(5, 209, 0))
point_4 = Point(Point(43.01950252, 209.0015001, 38.06346221))
point_5 = Point(Point(4.752878653, 247, 0.08392547383))
point_6 = Point(Point(5, 170, 0))
line = Line(StartPoint=point, EndPoint=point_2)
line_2 = Line(StartPoint=point_3, EndPoint=point_4)
line_3 = Line(StartPoint=point_5, EndPoint=point_6)
line_4 = Line(Line((5, 170, 0), (5, 247, 0)))
line_5 = Line(Line((5, 209, 0), (43, 209, 38)))
line_6 = Line(Line((45, 209, 0), (-38, 209, 0)))
cull_index = CullIndex(Wrap=True)
topologizer = Topologizer(LinesInput=[line_3, line, line_2], Tolerance=Slider(1, range=0..1))  # -> Lines, Points, LineStart, LineStart_2, Neighbours, Incoming, Outgoing, Graph
number_slider = Slider(6, range=0..10)
end_points = EndPoints()  # -> Start, End
list_item = ListItem(Index=Slider(5, range=0..5), Wrap=True)
vector_xyz = VectorXYZ(XComponent=Slider(3, range=0..10), YComponent=0, ZComponent=0)  # -> Vector, Length
exowireframe = ExoWireframe(
    Lines=topologizer.Lines,
    Sides=Slider(20, range=0..50),
    StartRadius=number_slider,
    EndRadius=number_slider,
    NodeDepth=0,
    Division=Slider(39, range=0..100),
    Open=Slider(1, range=0..1))
number_slider_2 = Slider(1, range=0..1)
number_slider_3 = Slider(1, range=0..10)
number_slider_4 = Slider(8, range=0..10)
move = Move(Motion=vector_xyz.Vector)  # -> Geometry, Transform
number_slider_5 = Slider(7, range=0..10)
number_slider_6 = Slider(9, range=0..10)
weaverbird_s_loop_subdivision = WeaverbirdsLoopSubdivision(MeshCurves=exowireframe, Level=number_slider_3, SmoothNakedEdges=1)
weaverbird_s_catmull_clark_subdivision = WeaverbirdsCatmullClarkSubdivision(MeshCurves=exowireframe, Level=number_slider_3, SmoothNakedEdges=0)
refine = Refine(Mesh=exowireframe, Level=Slider(2, range=0..3))
number_slider_7 = Slider(4, range=0..10)
number_slider_8 = Slider(1, range=0..1)
number_slider_9 = Slider(8, range=0..10)
number_slider_10 = Slider(7, range=0..10)
number_slider_11 = Slider(9, range=0..10)
list_item_2 = ListItem(Index=number_slider_7, Wrap=True)
line_7 = Line(list_item_2)
weaverbird_s_laplacian_smoothing = WeaverbirdsLaplacianSmoothing(MeshCurves=weaverbird_s_loop_subdivision, Level=Slider(23, range=0..100), SmoothNakedEdges=0, Thin=1)
cull_index_2 = CullIndex(Indices=number_slider_7, Wrap=True)
point_7 = Point(list_item_2)
mesh_edges = MeshEdges(Mesh=weaverbird_s_laplacian_smoothing)  # -> NakedEdges, InteriorEdges, NonManifoldEdges
weaverbird_s_mesh_thicken = WeaverbirdsMeshThicken(MeshCurves=weaverbird_s_laplacian_smoothing, Distance=Slider(1, range=0..1), OffsetType=0)
refine_2 = Refine(Level=Slider(2, range=0..3))
weaverbird_s_catmull_clark_subdivision_2 = WeaverbirdsCatmullClarkSubdivision(MeshCurves=weaverbird_s_mesh_thicken, Level=Slider(2, range=0..10), SmoothNakedEdges=1)
weaverbird_s_laplacian_smoothing_2 = WeaverbirdsLaplacianSmoothing(MeshCurves=refine_2, Level=Slider(100, range=0..100), SmoothNakedEdges=1, Thin=1)
