# Grasshopper definition Fibrouspattern_Jesse.gh (Grasshopper 0.9.75)
# plug-ins: LunchBox

srf = Surface(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)
offset = Offset(Surface=srf, Distance=Slider(3, range=0..10), Retrim=True)
hex = HexagonalStructure(Surface=srf, UDivisions=10, VDivisions=10, AdjustShape=0.3, Type=False)  # -> graft(StructureLines), StructureNodes
hex_2 = HexagonalStructure(Surface=offset, UDivisions=10, VDivisions=10, AdjustShape=0.3, Type=False)  # -> graft(StructureLines), StructureNodes
loft = Loft(
    Curves=[hex_2.StructureLines, hex.StructureLines],
    Options={Adjust=False, Closed=False, LoftEnds=0, LoftSimp=0, LoftType=0, Rebuild=10, Refit=0.01})
