# Grasshopper definition 120945f5-86d0-5e1d-e5f0-9027e17e7046.gh (Grasshopper 1.0.7)
# plug-ins: Heteroptera, Pufferfish, Human, HDTTreeUtils

curve = Curve([<curve referenced from the Rhino model> x5000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])

center = Center(Geometric=curve)  # -> Center, Dimension
deconstruct = Deconstruct(Point=center.Center)  # -> XComponent, YComponent, ZComponent
round_to_decimal_place = RoundToDecimalPlace(NumberX=deconstruct.YComponent, DecimalPlace="0", RoundType=0)  # -> Rounded, Difference

larger_than = LargerThan(FirstNumber=round_to_decimal_place.Rounded, SecondNumber="0")  # -> LargerThan, OrEqualTo
smaller_than = SmallerThan(FirstNumber=round_to_decimal_place.Rounded, SecondNumber="0")  # -> SmallerThan, OrEqualTo
equality = Equality(FirstNumber=round_to_decimal_place.Rounded, SecondNumber="0")  # -> Equality, Inequality

cull_pattern = CullPattern(List=deconstruct.XComponent, CullPattern=larger_than.LargerThan)
cull_pattern_2 = CullPattern(List=curve, CullPattern=larger_than.LargerThan)

cull_pattern_3 = CullPattern(List=deconstruct.XComponent, CullPattern=equality.Equality)
cull_pattern_4 = CullPattern(List=curve, CullPattern=equality.Equality)
cull_pattern_5 = CullPattern(List=center.Center, CullPattern=equality.Equality)

cull_pattern_6 = CullPattern(List=curve, CullPattern=smaller_than.SmallerThan)
cull_pattern_7 = CullPattern(List=deconstruct.XComponent, CullPattern=smaller_than.SmallerThan)

sort_list = SortList(Keys=cull_pattern, ValuesValuesA=cull_pattern_2)  # -> reverse(Keys), reverse(ValuesValuesA)
create_set = CreateSet(List=sort_list.Keys)  # -> Set, Map
assignpaths = AssignPaths(InputData=flatten(sort_list.ValuesValuesA), PathsToAssign=flatten(create_set.Map))
area = Area(Geometry=assignpaths)  # -> Area, Centroid
deconstruct_2 = Deconstruct(Point=area.Centroid)  # -> XComponent, YComponent, ZComponent
sort_list_2 = SortList(Keys=deconstruct_2.YComponent, ValuesValuesA=area.Centroid, ValuesA=assignpaths)  # -> Keys, ValuesValuesA, ValuesA

sort_list_3 = SortList(Keys=cull_pattern_3, ValuesValuesA=cull_pattern_4, ValuesA=cull_pattern_5)  # -> Keys, reverse(ValuesValuesA), reverse(ValuesA)

sort_list_4 = SortList(Keys=cull_pattern_7, ValuesValuesA=cull_pattern_6)  # -> reverse(Keys), reverse(ValuesValuesA)
create_set_2 = CreateSet(List=sort_list_4.Keys)  # -> Set, Map
assignpaths_2 = AssignPaths(InputData=flatten(sort_list_4.ValuesValuesA), PathsToAssign=flatten(create_set_2.Map))
area_2 = Area(Geometry=assignpaths_2)  # -> Area, Centroid
deconstruct_3 = Deconstruct(Point=area_2.Centroid)  # -> XComponent, YComponent, ZComponent
sort_list_5 = SortList(Keys=deconstruct_3.YComponent, ValuesValuesA=area_2.Centroid, ValuesA=assignpaths_2)  # -> Keys, reverse(ValuesValuesA), reverse(ValuesA)

# ---- group: NORTH_PAVER_OUTLINE_CENTERS
point = Point(sort_list_2.ValuesValuesA)

# ---- group: CENTER_PAVER_OUTLINE_CENTER
curve_2 = Curve(sort_list_3.ValuesValuesA)

# ---- group: CENTER_PAVER_OUTLINE
point_2 = Point(sort_list_3.ValuesA)

# ---- group: NORTH_PAVER_OUTLINE
curve_3 = Curve(sort_list_2.ValuesA)

# ---- group: SOUTH_PAVER_OUTLINE_CENTER
point_3 = Point(sort_list_5.ValuesValuesA)

# ---- group: SOUTH_PAVER_OUTLINE
curve_4 = Curve(sort_list_5.ValuesA)

# ---- group: North Pavers
curve_5 = Curve(curve_3)

# ---- group: NORTH_CENTERS
point_4 = Point(point)

# ---- group: SOUTH_PAVER_OUTLINE_CENTER
point_5 = Point(point_3)

# ---- group: SOUTH_PAVER_OUTLINE
curve_6 = Curve(curve_4)

# ----
list_length = ListLength(List=point_4)
param_viewer = ParamViewer(list_length)
list_length_2 = ListLength(List=param_viewer)
series = Series(Start="6", Step=1, Count=list_length_2)
format = Format(Format="{0:00} - N", Culture=127, Data0=series)  # -> graft(Text)
repeat_data = RepeatData(Data=format, Length=list_length)  # -> flatten(Data)
series_2 = Series(Start="1", Step=1, Count=list_length)  # -> flatten(Series)
concatenate = Concatenate(FragmentA=repeat_data, FragmentB=series_2)
unflatten_tree = UnflattenTree(Tree=concatenate, Guide=point_4)

list_length_3 = ListLength(List=point_5)
param_viewer_2 = ParamViewer(list_length_3)
series_3 = Series(Start="1", Step=1, Count=list_length_3)  # -> flatten(Series)
list_length_4 = ListLength(List=param_viewer_2)
series_4 = Series(Start="1", Step=1, Count=list_length_4)
format_2 = Format(Format="{0:00} - S", Culture=127, Data0=series_4)  # -> graft(Text)
repeat_data_2 = RepeatData(Data=format_2, Length=list_length_3)  # -> flatten(Data)
concatenate_2 = Concatenate(FragmentA=repeat_data_2, FragmentB=series_3)
unflatten_tree_2 = UnflattenTree(Tree=concatenate_2, Guide=point_5)

# ---- group: CENTER_PAVER_OUTLINE_CENTER
curve_7 = Curve(curve_2)

# ---- group: CENTER_PAVER_OUTLINE
point_6 = Point(point_2)

# ----
list_length_5 = ListLength(List=curve_7)
series_5 = Series(Start="5", Step=1, Count=list_length_5)
format_3 = Format(Format="{0:00} - C", Culture=127, Data0=series_5)
concatenate_3 = Concatenate(FragmentA=format_3, FragmentB="1")

panel = Panel(format)

# ---- group: GENERATED TEXT_CENTER
text = Text(concatenate_3)

# ----
justifiedtext3d = JustifiedText3d(
    Location=point,
    Text=unflatten_tree,
    Size=1,
    Color="0,0,0",
    HorizontalAlignment="1",
    VerticalAlginment="1",
    UseMeshes=False,
    Bake=False)
justifiedtext3d_2 = JustifiedText3d(
    Location=point_2,
    Text=text,
    Size=1,
    Color="0,0,0",
    HorizontalAlignment="1",
    VerticalAlginment="1",
    UseMeshes=False,
    Bake=False)
justifiedtext3d_3 = JustifiedText3d(
    Location=point_3,
    Text=unflatten_tree_2,
    Size=1,
    Color="0,0,0",
    HorizontalAlignment="1",
    VerticalAlginment="1",
    UseMeshes=False,
    Bake=False)
