# Grasshopper definition 159f0042-fef7-71ce-00b0-f396f1bba411.gh (Grasshopper 1.0.7)
# plug-ins: Human

number_slider = Slider(53, range=0..100)
curve = Curve(<curve referenced from the Rhino model>)
curve_2 = Curve(<curve referenced from the Rhino model>)
brep = Brep([<brep referenced from the Rhino model> x20])
curve_3 = Curve(<curve referenced from the Rhino model>)
range = Range(Domain=Domain(0, 1), Steps=10)
divide_curve = DivideCurve(Curve=curve_3, Count=Slider(37, range=0..100), Kinks=False)  # -> Points, Tangents, Parameters
volume = Volume(Geometry=brep)  # -> Volume, Centroid
graph_mapper = GraphMapper(range)
number_slider_2 = Slider(62, range=0..100)
interpolate = Interpolate(Vertices=divide_curve.Points, Degree=3, Periodic=False, KnotStyle=1)  # -> Curve, Length, Domain
panel = Panel(volume.Volume)
line = Line()
polyline = PolyLine(Vertices=divide_curve.Points, Closed=False)
division = Division(A=volume.Volume, B="1728")
evaluate_curve = EvaluateCurve(Curve=reparameterize(curve_2), Parameter=graph_mapper)  # -> Point, Tangent, Angle
kinky_curve = KinkyCurve(Vertices=divide_curve.Points, Degree=3, Angle=Slider(0, range=0..1000))  # -> Curve, Length, Domain
multiplication = Multiplication(A=division, B=Slider(189, range=0..1000))
evaluate_curve_2 = EvaluateCurve(Curve=reparameterize(curve), Parameter=graph_mapper)  # -> Point, Tangent, Angle
larger_than = LargerThan(FirstNumber=multiplication, SecondNumber=Slider(2100, range=0..10000))  # -> LargerThan, OrEqualTo
bounds = Bounds(Numbers=multiplication)
deconstruct_domain = DeconstructDomain(Domain=bounds)  # -> Start, End
cull_pattern = CullPattern(List=brep, CullPattern=invert(larger_than.LargerThan))
cull_pattern_2 = CullPattern(List=brep, CullPattern=larger_than.LargerThan)
panel_2 = Panel(multiplication)
gradient = Gradient(
    LowerLimit=deconstruct_domain.Start,
    UpperLimit=deconstruct_domain.End,
    Parameter=multiplication,
    stops=[0.00377: RGB(0, 219, 4), 0.742: RGB(247, 183, 72), 1: RGB(255, 0, 60)])
custom_preview = CustomPreview(
    Geometry=cull_pattern_2,
    Material={diffuse=RGB(220, 20, 60), emission=RGB(66, 48, 66), shine=0.5, specular=RGB(255, 255, 255), transparency=0})  # disabled
custom_preview_2 = CustomPreview(
    Geometry=cull_pattern,
    Material={diffuse=RGB(221, 160, 221), emission=RGB(66, 48, 66), shine=0, specular=RGB(255, 255, 255), transparency=0})  # disabled
panel_3 = Panel(cull_pattern)
number_slider_3 = Slider(6, range=0..100)
unit_z = UnitZ(Factor=Slider(61, range=0..100))
custom_preview_3 = CustomPreview(Geometry=brep, Material=gradient)
move = Move(Geometry=volume.Centroid, Motion=unit_z)  # -> Geometry, Transform
text_tag_3d = TextTag3D(Location=move.Geometry, Text=division, Size=number_slider_3, Justification=5)
text_tag_3d_2 = TextTag3D(Location=move.Geometry, Text=multiplication, Size=number_slider_3, Justification=5)
brep_wireframe = BrepWireframe(Brep=brep, Density=-1)
create_material = CreateMaterial(Diffuse=RGB(0, 0, 0), Specular=RGB(255, 255, 255), Emission=RGB(0, 0, 0), Transparency=Slider(1, range=0..1), Shine=0)
custom_preview_lineweights = CustomPreviewLineweights(Geometry=brep_wireframe, Shader=create_material, Thickness=Slider(1, range=0..1), Absolute=False)
