# Grasshopper definition 30e8c9b5-ee1e-2ec1-ecca-65d7d37c2c78.gh (Grasshopper 1.0.7)
# plug-ins: Heteroptera, Pufferfish, Human, EleFront, LunchBox, HDTTreeUtils

file_path = FilePath("\\qs-file1\netshare\Prospects & Projects\Job Information\05372F - 19730 UCSD Ann Hamilton\04_Drafting\Ticket Drawings\QuarraTrack Data\2-01.csv")

read_file = ReadFile(File=file_path, PerLineParse=True)
read_csv = ReadCSV(CSVString=read_file, Delimiter=",")  # -> Headers, Values
text_split = TextSplit(Text=read_file, Separators=",")
replace_members = ReplaceMembers(Set=text_split, Replace="0")
flatten_tree = FlattenTree(Tree=replace_members, Path="{0}")
partition_list = PartitionList(List=flatten_tree, Size="11")
path_mapper = PathMapper(text_split, source="{A;B;C} (i)", target="{A;B;i%item_count}")
flip_matrix = FlipMatrix(Data=partition_list)
explode_tree = ExplodeTree(Data=flip_matrix)  # -> Branch0, Branch1, Branch2, Branch3, Branch4, Branch5, Branch6, Branch7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
panel = Panel(explode_tree.Branch2)
piece_status = GhPythonScript(Stat=explode_tree.Branch1)  # -> _4001, _3601, _3001_3002, Remainder
# ---------- piece_status: Python ----------
__author__ = "ccheng"
__version__ = "2021.09.17"

import rhinoscriptsyntax as rs

x=Stat

#Filter for 4001 [Shipped]
if x==4001:
    a=1
    _4001=a
    
else:
    a=0
    _4001=a

#Filter for 3601 [Palletized]
if x==3601:
    a=1
    _3601=a
    
else:
    a=0
    _3601=a

#Filter for 3001 & 3002 [Fabricated]
if x in range(3000,3003):
    a=1
    _3001_3002=a
    
else:
    a=0
    _3001_3002=a

#Filter for Not Done [No good :(]
if x<3001:
    a=1
    Remainder=a
    
else:
    a=0
    Remainder=a
# ---------- end piece_status ----------
text = Text(panel)
text_fix = TEXTFIX(text=text, cull_pattern=piece_status._3601)  # -> result, list
text_fix_2 = TEXTFIX(text=text, cull_pattern=piece_status._3001_3002)  # -> result, list
text_fix_3 = TEXTFIX(text=text, cull_pattern=piece_status.Remainder)  # -> result, list
text_fix_4 = TEXTFIX(text=text, cull_pattern=piece_status._4001)  # -> result, list

curve = Curve([<curve referenced from the Rhino model> x5000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])

# ---- group: SOURCE DATA
text_2 = Text(panel)

# ----
colour_picker = ColourPicker(PickedColour=RGB(0, 0, 0))
colour = Colour(colour_picker)

# ---- group: TEXT_SIZE
number = Number(Slider(1.26, range=0..5))

# ---- group: 3601
text_3 = Text(text_fix.list)

# ---- group: 3001/3002
text_4 = Text(text_fix_2.list)

# ---- group: REMAINDER
text_5 = Text(text_fix_3.list)

# ---- group: 4001
text_6 = Text(text_fix_4.list)

text_7 = Text(text_6)

# ----
panel_2 = Panel(file_path)
panel_3 = Panel(read_csv.Headers)
panel_4 = Panel(partition_list)
panel_5 = Panel(text_split)
panel_6 = Panel(replace_members)
panel_7 = Panel(flip_matrix)
panel_9 = Panel(text_7)

# ---- group: 3601
text_8 = Text(text_3)

# ---- group: 3001/3002
text_9 = Text(text_4)

# ---- group: REMAINDER
text_10 = Text(text_5)

# ----
colour_swatch = ColourSwatch(SwatchColor=RGB(48, 209, 56))
colour_swatch_2 = ColourSwatch(SwatchColor=RGB(227, 252, 61))
colour_swatch_3 = ColourSwatch(SwatchColor=RGB(252, 61, 61))
colour_swatch_4 = ColourSwatch(SwatchColor=RGBA(255, 0, 0, 91))
colour_swatch_5 = ColourSwatch(SwatchColor=RGB(48, 155, 255))
curve_2 = Curve([<curve referenced from the Rhino model> x1301])
boundary_surfaces = BoundarySurfaces(Edges=curve_2)
gate_not = GateNot(A=Button())

# ---- group: 3001/3002_FABRICATED
text_11 = Text("3001/3002_Fabricated")

# ---- group: LATEST SHIPPING LOAD_TEXT
text_12 = Text("LATEST SHIPPING LOAD_TEXT")

# ---- group: LATEST_SHIPPING_LOAD
text_13 = Text("LATEST SHIPPING LOAD")

# ---- group: 4001_SHIPPED
text_14 = Text("4001_Shipped")

# ---- group: 3601_PALLETIZED
text_15 = Text("3601_Palletized")

# ---- group: BLUE
colour_2 = Colour(colour_swatch_5)

# ---- group: GREEN
colour_3 = Colour(colour_swatch)

# ---- group: YELLOW
colour_4 = Colour(colour_swatch_2)

# ---- group: RED
colour_5 = Colour(colour_swatch_4)

# ---- group: IN_PROGRESS
text_16 = Text("In Progress")

# ----
custom_preview = CustomPreview(
    Geometry=boundary_surfaces,
    Material={diffuse=RGB(221, 160, 221), emission=RGB(66, 48, 66), shine=0.5, specular=RGB(255, 255, 255), transparency=0})

# ---- group: VISIBILITY
boolean = Boolean(gate_not)

# ----
create_modify_layers = CreateModifyLayers(LayerName=text_12, LayerColor=colour, Visibility=gate_not, DeleteLayer=False, enableFullPath=False)  # -> LayerNames, LayerFullPath
create_modify_layers_2 = CreateModifyLayers(LayerName=text_13, LayerColor=colour, Visibility=gate_not, DeleteLayer=False, enableFullPath=False)  # -> LayerNames, LayerFullPath
create_modify_layers_3 = CreateModifyLayers(LayerName="4001_Shipped", LayerColor=colour_swatch_5, Visibility=gate_not, DeleteLayer=False, enableFullPath=False)  # -> LayerNames, LayerFullPath
create_modify_layers_4 = CreateModifyLayers(LayerName="3601_Palletized", LayerColor=colour_swatch, Visibility=gate_not, DeleteLayer=False, enableFullPath=False)  # -> LayerNames, LayerFullPath
create_modify_layers_5 = CreateModifyLayers(
    LayerName="3001/3002_Fabricated",
    LayerColor=colour_swatch_2,
    Visibility=gate_not,
    DeleteLayer=False,
    enableFullPath=False)  # -> LayerNames, LayerFullPath
create_modify_layers_6 = CreateModifyLayers(LayerName="In Progress", LayerColor=colour_swatch_4, Visibility=gate_not, DeleteLayer=False, enableFullPath=False)  # -> LayerNames, LayerFullPath

# ---- group: 4001
text_17 = Text(text_7)

# ---- group: 3601
text_18 = Text(text_8)

# ---- group: 3001/3002
text_19 = Text(text_9)

# ---- group: REMAINDER
text_20 = Text(text_5)

# ---- group: 4001
text_21 = Text(text_7)

# ---- group: 3601
text_22 = Text(text_8)

# ---- group: 3001/3002
text_23 = Text(text_9)

# ---- group: REMAINDER
text_24 = Text(text_10)

# ---- group: 4001
text_25 = Text(text_7)

# ---- group: 3601
text_26 = Text(text_8)

# ---- group: 3001/3002
text_27 = Text(text_9)

# ---- group: REMAINDER
text_28 = Text(text_10)

# ----
file_path_2 = FilePath("I:\Prospects & Projects\Job Information\05372F - 19730 UCSD Ann Hamilton\04_Drafting\Ticket Drawings\QuarraTrack Data\1-09_SHIPPED.csv")  # disabled
read_file_2 = ReadFile(File=file_path_2, PerLineParse=True)
text_split_2 = TextSplit(Text=read_file_2, Separators=",")  # -> flatten(Result)
replace_members_2 = ReplaceMembers(Set=text_split_2, Replace="0")
panel_10 = Panel(file_path_2)
number_slider = Slider(1, range=0..1)
cluster = Cluster(text=replace_members_2)

# ---- group: 4001
text_29 = Text(text_17)

# ----
panel_11 = Panel(cluster)
bake_toggle = BooleanToggle(False)

# ---- group: BAKE?
boolean_2 = Boolean(bake_toggle)

boolean_3 = Boolean(boolean_2)

# ---- group: BAKE
number_2 = Number(number)
boolean_4 = Boolean(bake_toggle)
colour_6 = Colour(colour_3)

# ---- group: BAKE / BLACK
colour_7 = Colour(colour)

# ---- group: BAKE / 3001/3002_FABRICATED
text_30 = Text(text_15)

# ---- group: IN_PROGRESS
text_31 = Text(text_16)

# ---- group: RED
colour_8 = Colour(colour_5)

# ---- group: BLACK
colour_9 = Colour(colour)

# ----
number_3 = Number(number)
colour_10 = Colour(colour_5)

# ---- group: 4001_SHIPPED
text_32 = Text(text_14)

# ---- group: BLUE
colour_11 = Colour(colour_2)

# ----
boolean_5 = Boolean(bake_toggle)
text_33 = Text("3601_Palletized")
colour_12 = Colour(colour_3)
text_34 = Text(text_11)
colour_13 = Colour(colour_4)
text_35 = Text(text_16)
text_36 = Text(text_14)

# ---- group: YELLOW
colour_14 = Colour(colour_4)

# ---- group: RED
colour_15 = Colour(colour_5)

# ----
text_37 = Text(text_11)

# ---- group: IN_PROGRESS
text_38 = Text(text_16)

# ----
boolean_6 = Boolean(bake_toggle)
text_39 = Text(text_15)
colour_16 = Colour(colour_3)

# ---- group: BLACK
colour_17 = Colour(colour)

# ----
text_40 = Text(text_11)
colour_18 = Colour(colour_4)
colour_19 = Colour(colour_2)

# ---- group: BAKE?
boolean_7 = Boolean(boolean_2)

# ---- group: LATEST SHIPPING LOAD_TEXT
text_41 = Text(text_12)

# ---- group: BLACK
colour_20 = Colour(colour)

# ---- group: BAKE?
boolean_8 = Boolean(boolean_2)

# ---- group: BLUE
colour_21 = Colour(colour_2)

# ---- group: BAKE?
boolean_9 = Boolean(boolean_2)

# ---- group: TEXT_SIZE
number_4 = Number(number)

# ---- group: BAKE?
boolean_10 = Boolean(boolean_2)

# ---- group: VISIBILITY
boolean_11 = Boolean(boolean)

# ---- group: LATEST_SHIPPING_LOAD
text_42 = Text(text_13)

# ---- group: 4001_SHIPPED
text_43 = Text(text_14)

# ---- group: VISIBILITY
boolean_12 = Boolean(boolean)

# ---- group: BAKE?
boolean_13 = Boolean(boolean_2)

# ---- group: BLUE
colour_22 = Colour(colour_2)

# ----
createattributes = CreateAttributes(Name=text_41, LayerName=text_41, Color=colour_20, Visibility=boolean_11, enableFullPath=False)
createattributes_2 = CreateAttributes(Name=text_43, LayerName=text_43, Visibility=boolean_12, enableFullPath=False)

# ---- group: BAKE?
boolean_14 = Boolean(boolean_2)

boolean_15 = Boolean(boolean_2)

boolean_16 = Boolean(boolean_2)

boolean_17 = Boolean(boolean_2)

boolean_18 = Boolean(boolean_2)

boolean_19 = Boolean(boolean_2)

# ----
# 27 EMPTY PAVERS
curve_3 = Curve([<curve referenced from the Rhino model> x27])
list_length = ListLength(List=curve_3)

center = Center(Geometric=curve)  # -> Center, Dimension
deconstruct = Deconstruct(Point=center.Center)  # -> XComponent, YComponent, ZComponent
round_to_decimal_place = RoundToDecimalPlace(NumberX=deconstruct.YComponent, DecimalPlace="0", RoundType=0)  # -> Rounded, Difference

larger_than = LargerThan(FirstNumber=round_to_decimal_place.Rounded, SecondNumber="0")  # -> LargerThan, OrEqualTo
smaller_than = SmallerThan(FirstNumber=round_to_decimal_place.Rounded, SecondNumber="0")  # -> SmallerThan, OrEqualTo
equality = Equality(FirstNumber=round_to_decimal_place.Rounded, SecondNumber="0")  # -> Equality, Inequality

cull_pattern = CullPattern(List=deconstruct.XComponent, CullPattern=larger_than.LargerThan)
cull_pattern_2 = CullPattern(List=curve, CullPattern=larger_than.LargerThan)

cull_pattern_3 = CullPattern(List=deconstruct.XComponent, CullPattern=equality.Equality)
cull_pattern_4 = CullPattern(List=curve, CullPattern=equality.Equality)
cull_pattern_5 = CullPattern(List=center.Center, CullPattern=equality.Equality)

cull_pattern_6 = CullPattern(List=curve, CullPattern=smaller_than.SmallerThan)
cull_pattern_7 = CullPattern(List=deconstruct.XComponent, CullPattern=smaller_than.SmallerThan)

sort_list = SortList(Keys=cull_pattern, ValuesValuesA=cull_pattern_2)  # -> reverse(Keys), reverse(ValuesValuesA)
create_set = CreateSet(List=sort_list.Keys)  # -> Set, Map
assignpaths = AssignPaths(InputData=flatten(sort_list.ValuesValuesA), PathsToAssign=flatten(create_set.Map))
area = Area(Geometry=assignpaths)  # -> Area, Centroid
deconstruct_2 = Deconstruct(Point=area.Centroid)  # -> XComponent, YComponent, ZComponent
sort_list_2 = SortList(Keys=deconstruct_2.YComponent, ValuesValuesA=area.Centroid, ValuesA=assignpaths)  # -> Keys, ValuesValuesA, ValuesA

sort_list_3 = SortList(Keys=cull_pattern_3, ValuesValuesA=cull_pattern_4, ValuesA=cull_pattern_5)  # -> Keys, reverse(ValuesValuesA), reverse(ValuesA)

sort_list_4 = SortList(Keys=cull_pattern_7, ValuesValuesA=cull_pattern_6)  # -> reverse(Keys), reverse(ValuesValuesA)
create_set_2 = CreateSet(List=sort_list_4.Keys)  # -> Set, Map
assignpaths_2 = AssignPaths(InputData=flatten(sort_list_4.ValuesValuesA), PathsToAssign=flatten(create_set_2.Map))
area_2 = Area(Geometry=assignpaths_2)  # -> Area, Centroid
deconstruct_3 = Deconstruct(Point=area_2.Centroid)  # -> XComponent, YComponent, ZComponent
sort_list_5 = SortList(Keys=deconstruct_3.YComponent, ValuesValuesA=area_2.Centroid, ValuesA=assignpaths_2)  # -> Keys, reverse(ValuesValuesA), reverse(ValuesA)

# ---- group: NORTH_PAVER_OUTLINE
curve_4 = Curve(sort_list_2.ValuesA)

# ---- group: SOUTH_PAVER_OUTLINE_CENTER
point = Point(sort_list_5.ValuesValuesA)

# ---- group: SOUTH_PAVER_OUTLINE
curve_5 = Curve(sort_list_5.ValuesA)

# ---- group: NORTH_PAVER_OUTLINE_CENTERS
point_2 = Point(sort_list_2.ValuesValuesA)

# ---- group: CENTER_PAVER_OUTLINE_CENTER
curve_6 = Curve(sort_list_3.ValuesValuesA)

# ---- group: CENTER_PAVER_OUTLINE
point_3 = Point(sort_list_3.ValuesA)

# ---- group: North Pavers
curve_7 = Curve(curve_4)

# ---- group: NORTH_CENTERS
point_4 = Point(point_2)

# ----
list_length_2 = ListLength(List=point_4)
param_viewer = ParamViewer(list_length_2)
list_length_3 = ListLength(List=param_viewer)
series = Series(Start="437", Step=1, Count=list_length_3)
format = Format(Format="{0:00} - N", Culture=127, Data0=series)  # -> graft(Text)
repeat_data = RepeatData(Data=format, Length=list_length_2)  # -> flatten(Data)
series_2 = Series(Start="1", Step=1, Count=list_length_2)  # -> flatten(Series)
concatenate = Concatenate(FragmentA=repeat_data, FragmentB=series_2)
unflatten_tree = UnflattenTree(Tree=concatenate, Guide=point_4)

# ---- group: CENTER_PAVER_OUTLINE_CENTER
curve_8 = Curve(curve_6)

# ---- group: CENTER_PAVER_OUTLINE
point_5 = Point(point_3)

# ---- group: SOUTH_PAVER_OUTLINE_CENTER
point_6 = Point(point)

# ---- group: SOUTH_PAVER_OUTLINE
curve_9 = Curve(curve_5)

# ----
list_length_4 = ListLength(List=curve_8)
series_3 = Series(Start="437", Step=1, Count=list_length_4)
format_2 = Format(Format="{0:00} - C", Culture=127, Data0=series_3)
concatenate_2 = Concatenate(FragmentA=format_2, FragmentB="1")

list_length_5 = ListLength(List=point_6)
param_viewer_2 = ParamViewer(list_length_5)
list_length_6 = ListLength(List=param_viewer_2)
series_4 = Series(Start="437", Step=1, Count=list_length_6)
format_3 = Format(Format="{0:00} - S", Culture=127, Data0=series_4)  # -> graft(Text)
repeat_data_2 = RepeatData(Data=format_3, Length=list_length_5)  # -> flatten(Data)
series_5 = Series(Start="1", Step=1, Count=list_length_5)  # -> flatten(Series)
concatenate_3 = Concatenate(FragmentA=repeat_data_2, FragmentB=series_5)
unflatten_tree_2 = UnflattenTree(Tree=concatenate_3, Guide=point_6)

# ---- group: GENERATED TEXT_CENTER
text_44 = Text(concatenate_2)

# ----
list_length_7 = ListLength(List=point_5)
panel_12 = Panel(format)
duplicate_data = DuplicateData(Data="1", Number=list_length_7, Order=True)

# ---- group: NORTH_CENTERS
point_7 = Point(flatten(point_4))

# ---- group: NORTH_CENTER
curve_10 = Curve(flatten(curve_7))

# ---- group: South Pavers
curve_11 = Curve(flatten(curve_5))

# ---- group: South Centers
point_8 = Point(flatten(point_6))

# ---- group: GENERATED TEXT
text_45 = Text(text_44)

# ---- group: CENTER PIECE CENTERS
point_9 = Point(point_3)

# ---- group: CENTER PAVERS
curve_12 = Curve(curve_6)

# ---- group: 3601_CENTER
member_index = MemberIndex(Set=text_22, Member=concatenate_2)  # -> Index, Count
cull_pattern_8 = CullPattern(List=curve_8, CullPattern=member_index.Count)  # -> flatten(List)
cull_pattern_9 = CullPattern(List=point_5, CullPattern=member_index.Count)
cull_pattern_10 = CullPattern(List=concatenate_2, CullPattern=member_index.Count)

# ---- group: 3001 & 3002_CENTER
member_index_2 = MemberIndex(Set=text_23, Member=concatenate_2)  # -> Index, Count
cull_pattern_11 = CullPattern(List=curve_8, CullPattern=member_index_2.Count)  # -> flatten(List)
cull_pattern_12 = CullPattern(List=point_5, CullPattern=member_index_2.Count)
cull_pattern_13 = CullPattern(List=concatenate_2, CullPattern=member_index_2.Count)

# ---- group: 4001_CENTER
member_index_3 = MemberIndex(Set=text_21, Member=concatenate_2)  # -> Index, Count
cull_pattern_14 = CullPattern(List=curve_8, CullPattern=member_index_3.Count)  # -> flatten(List)
cull_pattern_15 = CullPattern(List=point_5, CullPattern=member_index_3.Count)
cull_pattern_16 = CullPattern(List=concatenate_2, CullPattern=member_index_3.Count)

# ----
list_length_8 = ListLength(List=point_6)
duplicate_data_2 = DuplicateData(Data="1", Number=list_length_8, Order=True)
text_46 = Text(unflatten_tree)

# ---- group: GENERATED_TEXT_NORTH
text_47 = Text(text_46)

text_48 = Text(flatten(text_47))

# ----
list_length_9 = ListLength(List=point_4)

# ---- group: 3601_SOUTH
member_index_4 = MemberIndex(Set=text_26, Member=unflatten_tree_2)  # -> Index, Count
cull_pattern_17 = CullPattern(List=curve_9, CullPattern=member_index_4.Count)  # -> flatten(List)
cull_pattern_18 = CullPattern(List=point_6, CullPattern=member_index_4.Count)
cull_pattern_19 = CullPattern(List=unflatten_tree_2, CullPattern=member_index_4.Count)

# ---- group: 4001_SOUTH
member_index_5 = MemberIndex(Set=text_25, Member=unflatten_tree_2)  # -> Index, Count
cull_pattern_20 = CullPattern(List=curve_9, CullPattern=member_index_5.Count)  # -> flatten(List)
cull_pattern_21 = CullPattern(List=point_6, CullPattern=member_index_5.Count)
cull_pattern_22 = CullPattern(List=unflatten_tree_2, CullPattern=member_index_5.Count)

# ----
member_index_6 = MemberIndex(Set=cluster, Member=text_45)  # -> Index, Count
cull_pattern_23 = CullPattern(List=text_45, CullPattern=member_index_6.Count)
cull_pattern_24 = CullPattern(List=point_9, CullPattern=member_index_6.Count)
cull_pattern_25 = CullPattern(List=curve_12, CullPattern=member_index_6.Count)

member_index_7 = MemberIndex(Set=cluster, Member=text_48)  # -> Index, Count
cull_pattern_26 = CullPattern(List=text_48, CullPattern=member_index_7.Count)
cull_pattern_27 = CullPattern(List=point_7, CullPattern=member_index_7.Count)
cull_pattern_28 = CullPattern(List=curve_10, CullPattern=member_index_7.Count)

# ---- group: 3001 & 3002_CENTER
member_index_8 = MemberIndex(Set=text_27, Member=unflatten_tree_2)  # -> Index, Count
cull_pattern_29 = CullPattern(List=curve_9, CullPattern=member_index_8.Count)  # -> flatten(List)
cull_pattern_30 = CullPattern(List=point_6, CullPattern=member_index_8.Count)
cull_pattern_31 = CullPattern(List=unflatten_tree_2, CullPattern=member_index_8.Count)

# ---- group: GENERATED_TEXT_SOUTH
text_49 = Text(unflatten_tree_2)

# ----
text_50 = Text(flatten(text_49))

member_index_9 = MemberIndex(Set=cluster, Member=text_50)  # -> Index, Count
cull_pattern_32 = CullPattern(List=text_50, CullPattern=member_index_9.Count)
cull_pattern_33 = CullPattern(List=point_8, CullPattern=member_index_9.Count)
cull_pattern_34 = CullPattern(List=curve_11, CullPattern=member_index_9.Count)

# ---- group: GENERATED_TEXT_NORTH
text_51 = Text(text_47)

text_52 = Text(text_47)

# ----
duplicate_data_3 = DuplicateData(Data="1", Number=list_length_9, Order=True)

# ---- group: GENERATED_TEXT_NORTH
text_53 = Text(text_47)

# ---- group: 4001_NORTH
member_index_10 = MemberIndex(Set=text_17, Member=text_46)  # -> Index, Count
cull_pattern_35 = CullPattern(List=curve_7, CullPattern=member_index_10.Count)  # -> flatten(List)
cull_pattern_36 = CullPattern(List=text_46, CullPattern=member_index_10.Count)
cull_pattern_37 = CullPattern(List=point_4, CullPattern=member_index_10.Count)

# ---- group: 3601_NORTH
member_index_11 = MemberIndex(Set=text_18, Member=text_51)  # -> Index, Count
cull_pattern_38 = CullPattern(List=curve_7, CullPattern=member_index_11.Count)  # -> flatten(List)
cull_pattern_39 = CullPattern(List=point_4, CullPattern=member_index_11.Count)
cull_pattern_40 = CullPattern(List=text_46, CullPattern=member_index_11.Count)

# ---- group: 3001 & 3002_NORTH
member_index_12 = MemberIndex(Set=text_19, Member=text_52)  # -> Index, Count
cull_pattern_41 = CullPattern(List=curve_7, CullPattern=member_index_12.Count)  # -> flatten(List)
cull_pattern_42 = CullPattern(List=point_4, CullPattern=member_index_12.Count)
cull_pattern_43 = CullPattern(List=text_46, CullPattern=member_index_12.Count)

# ----
member_index_13 = MemberIndex(Set=text_29, Member=cull_pattern_23)  # -> Index, Count
text_54 = Text(cull_pattern_19)
point_10 = Point(cull_pattern_30)
text_55 = Text(cull_pattern_31)
point_11 = Point(cull_pattern_18)
boolean_20 = Boolean(member_index_4.Count)
member_index_14 = MemberIndex(Set=text_29, Member=cull_pattern_32)  # -> Index, Count
define_hatch = DefineHatch(Curve=[cull_pattern_28, cull_pattern_25, cull_pattern_34], Pattern="Solid", Rotation=0, Scale=1)
member_index_15 = MemberIndex(Set=text_29, Member=cull_pattern_26)  # -> Index, Count
text_56 = Text(cull_pattern_40)
curve_13 = Curve(cull_pattern_41)

# ---- group: SHIPPED_TEXT
text_57 = Text(text_56)

# ---- group: OUTLINES_3001/3002
curve_14 = Curve(curve_13)

# ----
cull_pattern_44 = CullPattern(List=cull_pattern_26, CullPattern=member_index_15.Count)
cull_pattern_45 = CullPattern(List=cull_pattern_28, CullPattern=member_index_15.Count)
cull_pattern_46 = CullPattern(List=cull_pattern_23, CullPattern=member_index_13.Count)
cull_pattern_47 = CullPattern(List=cull_pattern_25, CullPattern=member_index_13.Count)
cull_pattern_48 = CullPattern(List=cull_pattern_32, CullPattern=member_index_14.Count)
cull_pattern_49 = CullPattern(List=cull_pattern_34, CullPattern=member_index_14.Count)
panel_13 = Panel(cull_pattern_32)
panel_14 = Panel(cull_pattern_23)
panel_15 = Panel(cull_pattern_26)
custom_preview_2 = CustomPreview(
    Geometry=define_hatch,
    Material={diffuse=RGB(221, 160, 221), emission=RGB(66, 48, 66), shine=0.5, specular=RGB(255, 255, 255), transparency=0})
define_hatch_2 = DefineHatch(Curve=cull_pattern_14, Pattern="Solid", Rotation=0, Scale=1)

# ---- group: OUTLINES_3001/3002
curve_15 = Curve(curve_13)

# ----
list_length_10 = ListLength(List=cull_pattern_44)
list_length_11 = ListLength(List=cull_pattern_46)
list_length_12 = ListLength(List=cull_pattern_48)

# ---- group: OUTLINES_3001/3002
curve_16 = Curve(curve_13)

# ----
define_hatch_3 = DefineHatch(Curve=cull_pattern_8, Pattern="Solid", Rotation=0, Scale=1)
define_hatch_4 = DefineHatch(Curve=cull_pattern_11, Pattern="Solid", Rotation=0, Scale=1)
define_hatch_5 = DefineHatch(Curve=cull_pattern_17, Pattern="Solid", Rotation=0, Scale=1)

createattributes_3 = CreateAttributes(Name=text_33, LayerName=text_33, enableFullPath=False)
justifiedtext3d = JustifiedText3d(
    Location=cull_pattern_18,
    Text=cull_pattern_19,
    Size=number_3,
    Color=colour_9,
    HorizontalAlignment="1",
    VerticalAlginment="1",
    UseMeshes=False,
    Attributes=createattributes_3,
    Bake=boolean_5)
object_bake = ObjectBake(
    BakeToggle=boolean_5,
    GeometryObjects=cull_pattern_17,
    Layer=text_33,
    ObjectName=text_33,
    ObjectColor=colour_12,
    LayerColor=colour_12)
custom_preview_3 = CustomPreview(Geometry=define_hatch_5, Material=colour_12)

createattributes_4 = CreateAttributes(Name=text_36, LayerName=text_36, enableFullPath=False)
justifiedtext3d_2 = JustifiedText3d(
    Location=cull_pattern_15,
    Text=cull_pattern_16,
    Size=1,
    Color=colour_17,
    HorizontalAlignment="1",
    VerticalAlginment="1",
    UseMeshes=False,
    Attributes=createattributes_4,
    Bake=boolean_6)
object_bake_2 = ObjectBake(
    BakeToggle=boolean_6,
    GeometryObjects=cull_pattern_14,
    Layer=text_36,
    ObjectName=text_36,
    ObjectColor=colour_19,
    LayerColor=colour_19)
custom_preview_4 = CustomPreview(Geometry=define_hatch_2, Material=colour_19)

define_hatch_6 = DefineHatch(Curve=cull_pattern_29, Pattern="Solid", Rotation=0, Scale=1)

createattributes_5 = CreateAttributes(Name=text_34, LayerName=text_34, enableFullPath=False)
justifiedtext3d_3 = JustifiedText3d(
    Location=cull_pattern_30,
    Text=cull_pattern_31,
    Size=number_3,
    Color=colour_9,
    HorizontalAlignment="1",
    VerticalAlginment="1",
    UseMeshes=False,
    Attributes=createattributes_5,
    Bake=boolean_5)
object_bake_3 = ObjectBake(
    BakeToggle=boolean_5,
    GeometryObjects=cull_pattern_29,
    Layer=text_34,
    ObjectName=text_34,
    ObjectColor=colour_13,
    LayerColor=colour_13)
custom_preview_5 = CustomPreview(Geometry=define_hatch_6, Material=colour_13)

panel_16 = Panel(cull_pattern_46)
panel_17 = Panel(cull_pattern_48)
panel_18 = Panel(cull_pattern_44)

createattributes_6 = CreateAttributes(Name=text_39, LayerName=text_39, enableFullPath=False)
justifiedtext3d_4 = JustifiedText3d(
    Location=cull_pattern_9,
    Text=cull_pattern_10,
    Size=1,
    Color=colour_17,
    HorizontalAlignment="1",
    VerticalAlginment="1",
    UseMeshes=False,
    Attributes=createattributes_6,
    Bake=boolean_6)
object_bake_4 = ObjectBake(
    BakeToggle=boolean_6,
    GeometryObjects=cull_pattern_8,
    Layer=text_39,
    ObjectName=text_39,
    ObjectColor=colour_16,
    LayerColor=colour_16)
custom_preview_6 = CustomPreview(Geometry=define_hatch_3, Material=colour_16)

createattributes_7 = CreateAttributes(Name=text_40, LayerName=text_40, enableFullPath=False)
justifiedtext3d_5 = JustifiedText3d(
    Location=cull_pattern_12,
    Text=cull_pattern_13,
    Size=1,
    Color=colour_17,
    HorizontalAlignment=1,
    VerticalAlginment=1,
    UseMeshes=False,
    Attributes=createattributes_7,
    Bake=boolean_6)
object_bake_5 = ObjectBake(
    BakeToggle=boolean_6,
    GeometryObjects=cull_pattern_11,
    Layer=text_40,
    ObjectName=text_40,
    ObjectColor=colour_18,
    LayerColor=colour_18)
custom_preview_7 = CustomPreview(Geometry=define_hatch_4, Material=colour_18)

define_hatch_7 = DefineHatch(Curve=cull_pattern_38, Pattern="Solid", Rotation=0, Scale=1)
define_hatch_8 = DefineHatch(Curve=cull_pattern_20, Pattern="Solid", Rotation=0, Scale=1)

createattributes_8 = CreateAttributes(Name=text_32, LayerName=text_32, enableFullPath=False)
justifiedtext3d_6 = JustifiedText3d(
    Location=cull_pattern_21,
    Text=cull_pattern_22,
    Size=number_3,
    Color=colour_9,
    HorizontalAlignment="1",
    VerticalAlginment="1",
    UseMeshes=False,
    Attributes=createattributes_8,
    Bake=boolean_5)
object_bake_6 = ObjectBake(
    BakeToggle=boolean_5,
    GeometryObjects=cull_pattern_20,
    Layer=text_32,
    ObjectName=text_32,
    ObjectColor=colour_11,
    LayerColor=colour_11)
custom_preview_8 = CustomPreview(Geometry=define_hatch_8, Material=colour_11)

define_hatch_9 = DefineHatch(Curve=cull_pattern_35, Pattern="Solid", Rotation=0, Scale=1)
mass_addition = MassAddition(Input=flatten([list_length_10, list_length_12, list_length_11]))  # -> Result, PartialResults
define_hatch_10 = DefineHatch(Curve=curve_16, Pattern="Solid", Rotation=0, Scale=1)
panel_19 = Panel(list_length_10)
panel_20 = Panel(mass_addition.Result)
panel_21 = Panel(list_length_11)
panel_22 = Panel(list_length_12)

# ---- group: SHIPPED_TEXT
text_58 = Text(text_56)

# ----
createattributes_9 = CreateAttributes(Name=text_30, LayerName=text_30, enableFullPath=False)
justifiedtext3d_7 = JustifiedText3d(
    Location=cull_pattern_39,
    Text=text_58,
    Size=number_2,
    Color=colour_7,
    HorizontalAlignment="1",
    VerticalAlginment="1",
    UseMeshes=False,
    Attributes=createattributes_9,
    Bake=boolean_16)
object_bake_7 = ObjectBake(
    BakeToggle=boolean_15,
    GeometryObjects=cull_pattern_38,
    Layer=text_30,
    ObjectName=text_30,
    ObjectColor=colour_6,
    LayerColor=colour_6)
custom_preview_9 = CustomPreview(Geometry=define_hatch_7, Material=colour_6)

# ---- group: OUTLINES_3001/3002
curve_17 = Curve(curve_13)

# ----
createattributes_10 = CreateAttributes(Name=text_37, LayerName=text_37, enableFullPath=False)
justifiedtext3d_8 = JustifiedText3d(
    Location=cull_pattern_42,
    Text=cull_pattern_43,
    Size=number_2,
    Color=colour_7,
    HorizontalAlignment="1",
    VerticalAlginment="1",
    UseMeshes=False,
    Attributes=createattributes_10,
    Bake=boolean_18)
object_bake_8 = ObjectBake(
    BakeToggle=boolean_19,
    GeometryObjects=curve_17,
    Layer=text_37,
    ObjectName=text_37,
    ObjectColor=colour_14,
    LayerColor=colour_14)
custom_preview_10 = CustomPreview(Geometry=define_hatch_10, Material=colour_14)

justifiedtext3d_9 = JustifiedText3d(
    Location=cull_pattern_27,
    Text=cull_pattern_26,
    Size=number_4,
    HorizontalAlignment=1,
    VerticalAlginment=1,
    UseMeshes=False,
    Attributes=createattributes,
    Bake=boolean_7)
justifiedtext3d_10 = JustifiedText3d(
    Location=cull_pattern_24,
    Text=cull_pattern_23,
    Size=number_4,
    HorizontalAlignment=1,
    VerticalAlginment=1,
    UseMeshes=False,
    Attributes=createattributes,
    Bake=boolean_9)
justifiedtext3d_11 = JustifiedText3d(
    Location=cull_pattern_33,
    Text=cull_pattern_32,
    Size=number_4,
    HorizontalAlignment=1,
    VerticalAlginment=1,
    UseMeshes=False,
    Attributes=createattributes,
    Bake=boolean_10)
object_bake_9 = ObjectBake(
    BakeToggle=boolean_8,
    GeometryObjects=flatten([define_hatch, cull_pattern_28, cull_pattern_25, cull_pattern_34]),
    Layer=text_42,
    ObjectName=text_42,
    ObjectColor=colour_21,
    LayerColor=colour_21)
justifiedtext3d_12 = JustifiedText3d(
    Location=cull_pattern_37,
    Text=cull_pattern_36,
    Size=number_2,
    Color=colour_7,
    HorizontalAlignment="1",
    VerticalAlginment="1",
    UseMeshes=False,
    Attributes=createattributes_2,
    Bake=boolean_4)
object_bake_10 = ObjectBake(
    BakeToggle=boolean_13,
    GeometryObjects=cull_pattern_35,
    Layer=text_43,
    ObjectName=text_43,
    ObjectColor=colour_22,
    LayerColor=colour_22)
custom_preview_11 = CustomPreview(Geometry=define_hatch_9, Material=colour_22)
data = Data(concatenate_2)

# ---- group: OUTLINES_3001/3002
curve_18 = Curve(curve_13)

# ----
data_2 = Data(member_index_4.Count)
data_3 = Data(member_index_10.Count)
text_59 = Text(cull_pattern_36)

# ---- group: SHIPPED_TEXT
text_60 = Text(text_56)

# ----
text_61 = Text(cull_pattern_43)
point_12 = Point(cull_pattern_37)
point_13 = Point(cull_pattern_42)

# ---- group: SHIPPED_TEXT
text_62 = Text(text_56)

# ----
point_14 = Point(cull_pattern_21)
point_15 = Point(point_11)
text_63 = Text(unflatten_tree_2)
boolean_21 = Boolean(boolean_20)
point_16 = Point(point_10)
text_64 = Text(text_54)
text_65 = Text(text_55)
text_66 = Text(cull_pattern_22)
gate_not_2 = GateNot(A=boolean_21)
list_length_13 = ListLength(List=flatten(point_12))
list_length_14 = ListLength(List=flatten(text_62))
list_length_15 = ListLength(List=flatten(point_13))
cull_pattern_50 = CullPattern(List=text_63, CullPattern=gate_not_2)
flatten_tree_2 = FlattenTree(Tree=text_59, Path="{0}")
flatten_tree_3 = FlattenTree(Tree=text_60, Path="{0}")
flatten_tree_4 = FlattenTree(Tree=text_61, Path="{0}")
list_length_16 = ListLength(List=flatten(cull_pattern_50))
list_length_17 = ListLength(List=flatten(point_14))
list_length_18 = ListLength(List=flatten(point_15))
list_length_19 = ListLength(List=flatten(point_16))
panel_23 = Panel(list_length_13)
panel_24 = Panel(list_length_14)
panel_25 = Panel(list_length_15)
flatten_tree_5 = FlattenTree(Tree=text_65, Path="{0}")
flatten_tree_6 = FlattenTree(Tree=text_64, Path="{0}")
flatten_tree_7 = FlattenTree(Tree=text_66, Path="{0}")
panel_26 = Panel(list_length_17)
panel_27 = Panel(list_length_18)
panel_28 = Panel(list_length_19)
panel_29 = Panel(flatten_tree_4)
panel_30 = Panel(flatten_tree_2)
panel_31 = Panel(flatten_tree_3)
panel_32 = Panel(flatten_tree_7)
panel_33 = Panel(flatten_tree_6)
panel_34 = Panel(flatten_tree_5)

# ---- group: REMAINDER_CENTER
member_index_16 = MemberIndex(Set=text_24, Member=concatenate_2)  # -> Index, Count

# ----
stream_filter = StreamFilter(Gate=number_slider, Stream0=member_index_16.Count, Stream1=duplicate_data)

# ---- group: REMAINDER_CENTER (continued)
cull_pattern_51 = CullPattern(List=curve_8, CullPattern=stream_filter)  # -> flatten(List)
cull_pattern_52 = CullPattern(List=point_5, CullPattern=stream_filter)
cull_pattern_53 = CullPattern(List=concatenate_2, CullPattern=stream_filter)

# ----
point_17 = Point(cull_pattern_15)
text_67 = Text(cull_pattern_16)
point_18 = Point(cull_pattern_12)
point_19 = Point(cull_pattern_52)
point_20 = Point(cull_pattern_9)
text_68 = Text(cull_pattern_10)
text_69 = Text(concatenate_2)
boolean_22 = Boolean(member_index.Count)
text_70 = Text(cull_pattern_13)
text_71 = Text(cull_pattern_53)
curve_19 = Curve(cull_pattern_51)

# ---- group: CENTER_PAVER_OUTLINE_CENTER
curve_20 = Curve(curve_19)

# ---- group: CENTER_NAMES
text_72 = Text(text_71)

text_73 = Text(text_71)

# ---- group: CENTER_PAVER_OUTLINE_CENTER
curve_21 = Curve(curve_19)

curve_22 = Curve(curve_19)

curve_23 = Curve(curve_19)

# ----
boundary_surfaces_2 = BoundarySurfaces(Edges=curve_22)

createattributes_11 = CreateAttributes(Name=text_31, LayerName=text_31, enableFullPath=False)
justifiedtext3d_13 = JustifiedText3d(
    Location=cull_pattern_52,
    Text=text_73,
    Size=1,
    Color=colour_17,
    HorizontalAlignment=1,
    VerticalAlginment=1,
    UseMeshes=False,
    Attributes=createattributes_11,
    Bake=boolean_6)
object_bake_11 = ObjectBake(
    BakeToggle=boolean_6,
    GeometryObjects=curve_21,
    Layer=text_31,
    ObjectName=text_31,
    ObjectColor=colour_8,
    LayerColor=colour_8)
custom_preview_12 = CustomPreview(Geometry=boundary_surfaces_2, Material=colour_8)

merge = Merge(Data1=cull_pattern_14, Data2=cull_pattern_8, Data3=cull_pattern_11, Data4=curve_23)
text_74 = Text(text_70)
text_75 = Text(text_68)
text_76 = Text(text_71)
text_77 = Text(text_67)
data_4 = Data(merge)
point_21 = Point(point_17)
point_22 = Point(point_20)
point_23 = Point(point_18)
point_24 = Point(point_19)
list_length_20 = ListLength(List=flatten(data_4))
list_length_21 = ListLength(List=flatten(point_21))
list_length_22 = ListLength(List=flatten(point_22))
list_length_23 = ListLength(List=flatten(point_23))
list_length_24 = ListLength(List=flatten(point_24))
flatten_tree_8 = FlattenTree(Tree=text_75, Path="{0}")
flatten_tree_9 = FlattenTree(Tree=text_74, Path="{0}")
flatten_tree_10 = FlattenTree(Tree=text_76, Path="{0}")
flatten_tree_11 = FlattenTree(Tree=text_77, Path="{0}")
panel_35 = Panel(list_length_22)
panel_36 = Panel(list_length_21)
panel_37 = Panel(list_length_23)
panel_38 = Panel(list_length_24)
concatenate_4 = Concatenate(FragmentA=list_length_20, FragmentB=" TOTAL")
panel_39 = Panel(concatenate_4)
panel_40 = Panel(flatten_tree_11)
panel_41 = Panel(flatten_tree_8)
panel_42 = Panel(flatten_tree_9)
panel_43 = Panel(flatten_tree_10)

subtraction = Subtraction(A=list_length_20, B=list_length_21, C=list_length_22, D=list_length_23, E=list_length_24)
ghpython_script = GhPythonScript(x=subtraction)  # -> Result, Debugging; inputs x: Int32
# ---------- ghpython_script: Python ----------
__author__ = "ccheng"
__version__ = "2021.09.20"

import rhinoscriptsyntax as rs


if x==0:
    
    Result="(ﾉ￫ܫ￩)ﾉ"
    
else:
    Result="¯\(º_o)/¯"

#Debugging

#Missing
if x>0:
    Debugging="Missing Pieces"

#Duplicate
if x<0:
    Debugging="Duplicate"
# ---------- end ghpython_script ----------
panel_44 = Panel(ghpython_script.Result)
panel_45 = Panel(ghpython_script.Debugging)

division = Division(A=list_length_22, B=list_length_20)
division_2 = Division(A=list_length_21, B=list_length_20)
division_3 = Division(A=list_length_23, B=list_length_20)
division_4 = Division(A=list_length_24, B=list_length_20)
mass_addition_2 = MassAddition(Input=[list_length_13, list_length_21, list_length_17])  # -> Result, PartialResults
mass_addition_3 = MassAddition(Input=[list_length_14, list_length_22, list_length_18])  # -> Result, PartialResults
mass_addition_4 = MassAddition(Input=[list_length_15, list_length_23, list_length_19])  # -> Result, PartialResults
multiplication = Multiplication(A=division, B="100")
multiplication_2 = Multiplication(A=division_2, B="100")
multiplication_3 = Multiplication(A=division_3, B="100")
multiplication_4 = Multiplication(A=division_4, B="100")
panel_46 = Panel(multiplication_4)
panel_47 = Panel(multiplication_3)
panel_48 = Panel(multiplication)
panel_49 = Panel(mass_addition_4.Result)
panel_50 = Panel(mass_addition_2.Result)
panel_51 = Panel(mass_addition_3.Result)
panel_52 = Panel(multiplication_2)

# ---- group: REMAINDER_SOUTH
member_index_17 = MemberIndex(Set=text_28, Member=unflatten_tree_2)  # -> Index, Count

# ----
stream_filter_2 = StreamFilter(Gate=number_slider, Stream0=member_index_17.Count, Stream1=duplicate_data_2)

# ---- group: REMAINDER_SOUTH (continued)
cull_pattern_54 = CullPattern(List=curve_9, CullPattern=stream_filter_2)  # -> flatten(List)
cull_pattern_55 = CullPattern(List=point_6, CullPattern=stream_filter_2)
cull_pattern_56 = CullPattern(List=unflatten_tree_2, CullPattern=stream_filter_2)

# ----
text_78 = Text(cull_pattern_56)
point_25 = Point(cull_pattern_55)
boundary_surfaces_3 = BoundarySurfaces(Edges=cull_pattern_54)

createattributes_12 = CreateAttributes(Name=text_35, LayerName=text_35, enableFullPath=False)
justifiedtext3d_14 = JustifiedText3d(
    Location=cull_pattern_55,
    Text=cull_pattern_56,
    Size=number_3,
    Color=colour_9,
    HorizontalAlignment="1",
    VerticalAlginment="1",
    UseMeshes=False,
    Attributes=createattributes_12,
    Bake=boolean_5)
object_bake_12 = ObjectBake(
    BakeToggle=boolean_5,
    GeometryObjects=cull_pattern_54,
    Layer=text_35,
    ObjectName=text_35,
    ObjectColor=colour_10,
    LayerColor=colour_10)
custom_preview_13 = CustomPreview(Geometry=boundary_surfaces_3, Material=colour_10)

merge_2 = Merge(Data1=cull_pattern_20, Data2=cull_pattern_17, Data3=cull_pattern_29, Data4=cull_pattern_54)
data_5 = Data(merge_2)
point_26 = Point(point_25)
text_79 = Text(text_78)
list_length_25 = ListLength(List=flatten(data_5))
list_length_26 = ListLength(List=flatten(point_26))
flatten_tree_12 = FlattenTree(Tree=text_79, Path="{0}")
panel_53 = Panel(list_length_26)
concatenate_5 = Concatenate(FragmentA=list_length_25, FragmentB=" TOTAL")
panel_54 = Panel(flatten_tree_12)
subtraction_2 = Subtraction(A=list_length_25, B=list_length_17, C=list_length_18, D=list_length_19, E=list_length_26)
panel_55 = Panel(concatenate_5)
division_5 = Division(A=list_length_18, B=list_length_25)
division_6 = Division(A=list_length_17, B=list_length_25)
division_7 = Division(A=list_length_19, B=list_length_25)
division_8 = Division(A=list_length_26, B=list_length_25)
multiplication_5 = Multiplication(A=division_5, B="100")
multiplication_6 = Multiplication(A=division_6, B="100")
multiplication_7 = Multiplication(A=division_7, B="100")
multiplication_8 = Multiplication(A=division_8, B="100")

ghpython_script_2 = GhPythonScript(x=subtraction_2)  # -> Result, Debugging; inputs x: Int32; same code as ghpython_script
panel_56 = Panel(ghpython_script_2.Result)
panel_57 = Panel(ghpython_script_2.Debugging)

panel_58 = Panel(multiplication_8)
panel_59 = Panel(multiplication_7)
panel_60 = Panel(multiplication_5)
panel_61 = Panel(multiplication_6)

# ---- group: REMAINER NORTH
member_index_18 = MemberIndex(Set=text_20, Member=text_53)  # -> Index, Count
cull_pattern_57 = CullPattern(List=point_4, CullPattern=member_index_18.Count)

# ----
stream_filter_3 = StreamFilter(Gate=number_slider, Stream0=member_index_18.Count, Stream1=duplicate_data_3)  # disabled

# ---- group: REMAINER NORTH (continued)
cull_pattern_58 = CullPattern(List=curve_7, CullPattern=stream_filter_3)  # -> flatten(List)
cull_pattern_59 = CullPattern(List=text_46, CullPattern=stream_filter_3)

# ----
panel_62 = Panel(cull_pattern_58)
boundary_surfaces_4 = BoundarySurfaces(Edges=cull_pattern_58)

# ---- group: NORTH_CENTERS
point_27 = Point(cull_pattern_57)

point_28 = Point(point_27)

# ----
createattributes_13 = CreateAttributes(Name=text_38, LayerName=text_38, enableFullPath=False)
justifiedtext3d_15 = JustifiedText3d(
    Location=point_28,
    Text=cull_pattern_59,
    Size=number_2,
    Color=colour_7,
    HorizontalAlignment="1",
    VerticalAlginment="1",
    UseMeshes=False,
    Attributes=createattributes_13,
    Bake=boolean_14)
object_bake_13 = ObjectBake(
    BakeToggle=boolean_17,
    GeometryObjects=cull_pattern_58,
    Layer=text_38,
    ObjectName=text_38,
    ObjectColor=colour_15,
    LayerColor=colour_15)
custom_preview_14 = CustomPreview(Geometry=boundary_surfaces_4, Material=colour_15)

merge_3 = Merge(Data1=cull_pattern_35, Data2=cull_pattern_38, Data3=curve_18, Data4=cull_pattern_58)
text_80 = Text(cull_pattern_59)
data_6 = Data(merge_3)
point_29 = Point(point_27)
list_length_27 = ListLength(List=flatten(data_6))
list_length_28 = ListLength(List=flatten(point_29))
flatten_tree_13 = FlattenTree(Tree=text_80, Path="{0}")
panel_63 = Panel(list_length_28)
concatenate_6 = Concatenate(FragmentA=list_length_27, FragmentB=" TOTAL")
subtraction_3 = Subtraction(A=list_length_27, B=list_length_13, C=list_length_14, D=list_length_15, E=list_length_28)
addition = Addition(A=panel_23, B=panel_24, C=panel_25, D=panel_63)
panel_64 = Panel(concatenate_6)
panel_65 = Panel(flatten_tree_13)
division_9 = Division(A=list_length_14, B=list_length_27)
division_10 = Division(A=list_length_13, B=list_length_27)
division_11 = Division(A=list_length_15, B=list_length_27)
division_12 = Division(A=list_length_28, B=list_length_27)
multiplication_9 = Multiplication(A=division_9, B="100")
multiplication_10 = Multiplication(A=division_10, B="100")

ghpython_script_3 = GhPythonScript(x=subtraction_3)  # -> Result, Debugging; inputs x: Int32; same code as ghpython_script
panel_66 = Panel(ghpython_script_3.Result)
panel_67 = Panel(ghpython_script_3.Debugging)

multiplication_11 = Multiplication(A=division_11, B="100")
multiplication_12 = Multiplication(A=division_12, B="100")
mass_addition_5 = MassAddition(Input=[list_length_27, list_length_20, list_length_25])  # -> Result, PartialResults
mass_addition_6 = MassAddition(Input=[list_length_28, list_length_24, list_length_26])  # -> Result, PartialResults
panel_68 = Panel(multiplication_12)
panel_69 = Panel(multiplication_11)
panel_70 = Panel(multiplication_9)
panel_71 = Panel(multiplication_10)
panel_72 = Panel(mass_addition_5.Result)
panel_73 = Panel(mass_addition_6.Result)

# ==== cluster TEXTFIX
text = ClusterInput()

# ----
# _-_ to -
replace_text = ReplaceText(Text=text, Find=" - ", Replace="-", RecursiveReplace=False)

# ----
# _- to -
replace_text_2 = ReplaceText(Text=replace_text, Find=" -", Replace="-", RecursiveReplace=False)

# ----
# -_ to -
replace_text_3 = ReplaceText(Text=replace_text_2, Find="-", Replace="-", RecursiveReplace=False)

cull_pattern = ClusterInput()

# ----
# - to _-_
replace_text_4 = ReplaceText(Text=replace_text_3, Find="-", Replace=" - ", RecursiveReplace=False)

cull_pattern_2 = CullPattern(List=replace_text_4, CullPattern=cull_pattern)
result = ClusterOutput(replace_text_4)
list = ClusterOutput(cull_pattern_2)

# ==== cluster Cluster
text = ClusterInput()

# ----
# _-_ to -
replace_text = ReplaceText(Text=text, Find=" - ", Replace="-", RecursiveReplace=False)

# ----
# _- to -
replace_text_2 = ReplaceText(Text=replace_text, Find=" -", Replace="-", RecursiveReplace=False)

# ----
# -_ to -
replace_text_3 = ReplaceText(Text=replace_text_2, Find="-", Replace="-", RecursiveReplace=False)

# ----
# - to _-_
replace_text_4 = ReplaceText(Text=replace_text_3, Find="-", Replace=" - ", RecursiveReplace=False)

result = ClusterOutput(replace_text_4)
