# Grasshopper definition 5b2b3cb5-50b1-ed07-4d3c-2fffe45dab93.gh (Grasshopper 1.0.7)

data_rec = PythonScript(x=Slider(1, range=0..1), enable=Toggle(True), reset=Button(), limit=Slider(10, range=0..10))  # -> out, x; inputs enable: Boolean, reset: Boolean, limit: Int32
# ---------- data_rec: Python ----------
from scriptcontext import sticky
if reset or 'x' not in sticky: sticky['x'] = []
if enable and not reset and ghenv.Component.RunCount == 1 : sticky['x'].append(x)
x = sticky['x'][-limit:] if limit > 0 else sticky['x']
# ---------- end data_rec ----------
panel = Panel(data_rec.x)
