# Grasshopper definition 6454bdd9-5e36-5e41-80f2-9818197bb6d9.gh (Grasshopper 1.0.7)
# plug-ins: Pufferfish, DendroGH

number_slider = Slider(27, range=0..100)
number_slider_2 = Slider(27, range=0..100)
subtraction = Subtraction(A=number_slider, B="1")
range = Range(Domain="0 to 1", Steps=subtraction)
surface = Surface(graft([<surface referenced from the Rhino model> x2]))
number_slider_3 = Slider(1, range=0..10)
subtraction_2 = Subtraction(A=number_slider_2, B="1")
range_2 = Range(Domain="0 to 1", Steps=subtraction_2)
surface_2 = Surface(graft(<surface referenced from the Rhino model>))
number_slider_4 = Slider(2, range=0..10)
divide_surface = DivideSurface(Surface=surface, UCount=number_slider, VCount=number_slider)  # -> Points, Normals, Parameters
graph_mapper = GraphMapper(range, x0=0, x1=1, y0=0, y1=1, container_name="Sine", Equation_px=[0, 0.04274429008], Equation_py=[0, 0.9912772775])
divide_surface_2 = DivideSurface(Surface=surface_2, UCount=number_slider_2, VCount=number_slider_2)  # -> Points, Normals, Parameters
graph_mapper_2 = GraphMapper(range_2, x0=0, x1=1, y0=0, y1=1, container_name="Sine", Equation_px=[0, 0.04274429008], Equation_py=[0, 0.9912772775])
multiplication = Multiplication(A=graph_mapper, B=number_slider_3)
division = Division(A=number_slider_3, B="2")
amplitude = Amplitude(Vector=divide_surface.Normals, Amplitude=multiplication)
multiplication_2 = Multiplication(A=graph_mapper_2, B=number_slider_4)
division_2 = Division(A=number_slider_4, B="2")
amplitude_2 = Amplitude(Vector=divide_surface_2.Normals, Amplitude=multiplication_2)
move = Move(Geometry=divide_surface.Points, Motion=amplitude)  # -> Geometry, Transform
amplitude_3 = Amplitude(Vector=divide_surface.Normals, Amplitude=division)
move_2 = Move(Geometry=divide_surface_2.Points, Motion=amplitude_2)  # -> Geometry, Transform
amplitude_4 = Amplitude(Vector=divide_surface_2.Normals, Amplitude=division_2)
negative = Negative(Value=amplitude_3)
move_3 = Move(Geometry=move.Geometry, Motion=negative)  # -> Geometry, Transform
negative_2 = Negative(Value=amplitude_4)
move_4 = Move(Geometry=move_2.Geometry, Motion=negative_2)  # -> Geometry, Transform
interpolate = Interpolate(Vertices=move_3.Geometry, Degree=3, Periodic=False, KnotStyle=1)  # -> Curve, Length, Domain
interpolate_2 = Interpolate(Vertices=move_4.Geometry, Degree=3, Periodic=False, KnotStyle=1)  # -> Curve, Length, Domain
partition_list = PartitionList(List=flatten(interpolate.Curve), Size=expr("x+1", number_slider))
partition_list_2 = PartitionList(List=flatten(interpolate_2.Curve), Size=expr("x+1", number_slider_2))
loft = Loft(Curves=partition_list, Options={Adjust=False, Closed=False, LoftEnds=0, LoftSimp=0, LoftType=0, Rebuild=10, Refit=0.01})
range_3 = Range(Domain=Domain(0, 1), Steps=Slider(20, range=0..100))
range_4 = Range(Domain=Domain(0, 1), Steps=Slider(20, range=0..100))
parameter_loft_mesh = ParameterLoftMesh(
    Sections=partition_list,
    ParametersU=range_3,
    ParametersV=range_3,
    Weighted=True,
    Lengths=False,
    Angle=0,
    Closed=False,
    Triangulate=True)
brep = Brep(<brep referenced from the Rhino model>)
number_slider_5 = Slider(0.2, range=0..1)
box = Box(brep)
parameter_loft_mesh_2 = ParameterLoftMesh(
    Sections=partition_list_2,
    ParametersU=range_4,
    ParametersV=range_4,
    Weighted=True,
    Lengths=False,
    Angle=0,
    Closed=False,
    Triangulate=True)
mesh_box = MeshBox(Base=box, XCount="1", YCount="1", ZCount="1")
negative_3 = Negative(Value="0.25")
offset_surface = OffsetSurface(Surface=loft, Distance="0.25", BothSides=negative_3, CreateSolid=True)
mesh_brep = MeshBrep(
    Brep=offset_surface,
    Settings={GridMaxCount=0, GridMinCount=16, JaggedSeams=True, MaxEdgeLength=0, MinEdgeLength=0.0001, MinTolerance=0, Refine=True, RefineAngle=0, RelativeTolerance=0.65, SimplePlanes=True, Tolerance=0})
mesh = Mesh(<mesh referenced from the Rhino model>)
create_settings = CreateSettings(VoxelSize=number_slider_5, Bandwidth=Slider(0.75, range=0..1), Isovalue=0, Adaptivity=Slider(1, range=0..1))
create_settings_2 = CreateSettings(VoxelSize=number_slider_5, Bandwidth=1, Isovalue=0, Adaptivity=0.1)
offset_mesh = OffsetMesh(Mesh=parameter_loft_mesh, Distance="0.25", BothSides=negative_3, CreateSolid=True)
negative_4 = Negative(Value="1")
create_settings_3 = CreateSettings(VoxelSize=1, Bandwidth=1, Isovalue=0, Adaptivity=0.1)
create_settings_4 = CreateSettings(VoxelSize=1, Bandwidth=1, Isovalue=0, Adaptivity=0.1)
offset_mesh_2 = OffsetMesh(Mesh=parameter_loft_mesh_2, Distance="1", BothSides=negative_4, CreateSolid=True)
reverse_list = ReverseList(List=flatten(mesh_brep))
brep_2 = Brep(<brep referenced from the Rhino model>)
mesh_2 = Mesh(<mesh referenced from the Rhino model>)
list_item = ListItem(List=flatten(reverse_list), Index=0, Wrap=True)  # -> Item, Item1, Item2
mesh_to_volume = MeshToVolume(Mesh=mesh, Settings=create_settings_2)
deconstruct_brep = DeconstructBrep(Brep=brep_2)  # -> Faces, Edges, Vertices
mesh_to_volume_2 = MeshToVolume(Mesh=mesh_2, Settings=create_settings_4)
mesh_to_volume_3 = MeshToVolume(Mesh=list_item.Item, Settings=create_settings)  # -> flatten(Volume)
list_item_2 = ListItem(List=flatten(offset_mesh_2), Index=0, Wrap=True)  # -> Item, Item1, Item2
mesh_to_volume_4 = MeshToVolume(Mesh=list_item.Item1, Settings=create_settings)  # -> flatten(Volume)
mesh_surface = MeshSurface(Surface=deconstruct_brep.Faces, UCount="1", VCount="1", Overhang=True, Equalize=False)
mesh_3 = Mesh(list_item_2.Item2)
volume_difference = VolumeDifference(VolumeA=mesh_to_volume, VolumesB=mesh_to_volume_4)
mesh_join = MeshJoin(Meshes=mesh_surface)
mesh_to_volume_5 = MeshToVolume(Mesh=list_item_2.Item, Settings=create_settings_3)  # -> flatten(Volume)
mesh_to_volume_6 = MeshToVolume(Mesh=list_item_2.Item1, Settings=create_settings_3)  # -> flatten(Volume)
mesh_to_volume_7 = MeshToVolume(Mesh=mesh_3, Settings=create_settings_3)  # -> flatten(Volume)
volume_difference_2 = VolumeDifference(VolumeA=mesh_to_volume_2, VolumesB=mesh_to_volume_5)
offset_mesh_3 = OffsetMesh(Mesh=mesh_join, Distance="0.25", BothSides=negative_3, CreateSolid=True)
volume_to_mesh = VolumeToMesh(Volume=volume_difference, VolumeSettings=create_settings)
mesh_to_volume_8 = MeshToVolume(Mesh=offset_mesh_3, Settings=create_settings)  # -> flatten(Volume)
disjoint_mesh = DisjointMesh(Mesh=volume_difference_2)
rebuild_mesh = RebuildMesh(
    Mesh=volume_to_mesh,
    RebuildNormals="1",
    CullUnused="1",
    UnifyNormals="1",
    FlipNormals="1",
    IdenticalCombine="1",
    WeldVertices="0.01")
list_item_3 = ListItem(List=disjoint_mesh, Index=0, Wrap=True)  # -> Item, Item1
mesh_to_volume_9 = MeshToVolume(Mesh=list_item_3.Item1, Settings=create_settings_4)
mesh_to_volume_10 = MeshToVolume(Mesh=list_item_3.Item, Settings=create_settings_4)
volume_difference_3 = VolumeDifference(VolumeA=mesh_to_volume_10, VolumesB=mesh_to_volume_7)
volume_difference_4 = VolumeDifference(VolumeA=mesh_to_volume_9, VolumesB=mesh_to_volume_6)
disjoint_mesh_2 = DisjointMesh(Mesh=rebuild_mesh)
volume_to_mesh_2 = VolumeToMesh(Volume=[volume_difference_3, volume_difference_4], VolumeSettings=create_settings_3)
list_item_4 = ListItem(List=disjoint_mesh_2, Index=0, Wrap=True)  # -> Item, Item1
mesh_to_volume_11 = MeshToVolume(Mesh=list_item_4.Item1, Settings=create_settings_2)
mesh_to_volume_12 = MeshToVolume(Mesh=list_item_4.Item, Settings=create_settings_2)
disjoint_mesh_3 = DisjointMesh(Mesh=volume_to_mesh_2)
volume_difference_5 = VolumeDifference(VolumeA=mesh_to_volume_12, VolumesB=mesh_to_volume_3)
volume_difference_6 = VolumeDifference(VolumeA=mesh_to_volume_11, VolumesB=mesh_to_volume_8)
custom_preview = CustomPreview(
    Geometry=disjoint_mesh_3,
    Material={diffuse=RGB(221, 160, 221), emission=RGB(66, 48, 66), shine=0.5, specular=RGB(255, 255, 255), transparency=0})
volume_to_mesh_3 = VolumeToMesh(Volume=[volume_difference_5, volume_difference_6], VolumeSettings=create_settings)
rebuild_mesh_2 = RebuildMesh(
    Mesh=volume_to_mesh_3,
    RebuildNormals="1",
    CullUnused="1",
    UnifyNormals="1",
    FlipNormals="1",
    IdenticalCombine="1",
    WeldVertices="0.01")
disjoint_mesh_4 = DisjointMesh(Mesh=rebuild_mesh_2)  # -> flatten(Meshes)
custom_preview_2 = CustomPreview(
    Geometry=disjoint_mesh_4,
    Material={diffuse=RGB(221, 160, 221), emission=RGB(66, 48, 66), shine=0.5, specular=RGB(255, 255, 255), transparency=0})
