# Grasshopper definition 988d50e9-1c37-9535-05f7-c676fcb52eb9.gh (Grasshopper 1.0.7)

text = Text("I:\Prospects & Projects\Job Information\05372F - 19730 UCSD Ann Hamilton\04_Drafting\Ticket Drawings\North\108-142")

# ---- group: ROW RANGE
text_2 = Text("108-142")

# ----
boolean_toggle = BooleanToggle(False)  # disabled
text_3 = Text(["108 - N1", "108 - N2", "108 - N3", "108 - N4", "108 - N5", "108 - N6"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])
concatenate = Concatenate(Fragment_A=text, Fragment_B="\", A=text_2, B=".csv")
panel = Panel(concatenate)
text_join = TextJoin(Text=text_3, Join=",")
ghpython_script = GhPythonScript(x=boolean_toggle, FilePath=concatenate, z=text_join)  # inputs x: Boolean
# ---------- ghpython_script: Python ----------
__author__ = "ccheng"
__version__ = "2021.09.22"

import rhinoscriptsyntax as rs
import csv

fileName=open(FilePath,'w')
if x==1:
    fileName.write(z)
else:
    a=0

fileName.close()
# ---------- end ghpython_script ----------
panel_2 = Panel(text_join)
