# Grasshopper definition b4e969fc-3546-4d5f-fd9b-93c7f676781a.gh (Grasshopper 1.0.7)

file_path = FilePath("I:\Prospects & Projects\Job Information\05372F - 19730 UCSD Ann Hamilton\04_Drafting\Ticket Drawings\QuarraTrack Data\1-06_255-301.csv")
panel = Panel(file_path)
file_path_2 = FilePath("I:\Prospects & Projects\Job Information\05372F - 19730 UCSD Ann Hamilton\04_Drafting\Ticket Drawings\QuarraTrack Data\1-10_SHIPPED.csv")
create_set = CreateSet()  # -> Set, Map
read_file = ReadFile(File=file_path, PerLineParse=True)
read_file_2 = ReadFile(File=file_path_2, PerLineParse=True)
panel_2 = Panel(file_path_2)
text_split = TextSplit(Text=read_file_2, Separators=",")
text_split_2 = TextSplit(Text=read_file, Separators=",")
panel_3 = Panel(text_split)
list_item = ListItem(List=text_split_2, Index="2", Wrap=True)  # -> flatten(Item)
shift_paths = ShiftPaths(Data=text_split_2, Offset="2")
list_item_2 = ListItem(List=text_split, Index="2", Wrap=True)  # -> flatten(Item)
panel_4 = Panel(list_item_2)
flip_matrix = FlipMatrix(Data=shift_paths)
panel_5 = Panel(text_split_2)
member_index = MemberIndex(Set=list_item, Member=list_item_2)  # -> Index, Count
list_item_3 = ListItem(List=text_split_2, Index="1", Wrap=True)  # -> flatten(Item)
explode_tree = ExplodeTree(Data=flip_matrix)  # -> Branch0, Branch1, Branch2, Branch3, Branch4, Branch5, Branch6, Branch7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
trim_tree = TrimTree(Depth=1)
equality = Equality(FirstNumber=member_index.Count, SecondNumber="1")  # -> Equality, Inequality
panel_7 = Panel(list_item)
member_index_2 = MemberIndex(Set=list_item_2, Member=explode_tree.Branch2)  # -> Index, Count
cull_pattern = CullPattern(List=list_item, CullPattern=member_index.Count)
panel_8 = Panel(explode_tree.Branch2)
cull_pattern_2 = CullPattern(List=list_item_3, CullPattern=equality.Equality)
ghpython_script = GhPythonScript(x=member_index.Count)  # -> out, a; inputs x: Int32
# ---------- ghpython_script: Python ----------
__author__ = "CCheng"
__version__ = "2022.03.17"

import rhinoscriptsyntax as rs

if x is 1:
    a=4001
    
else:
    a=3601
# ---------- end ghpython_script ----------
param_viewer = ParamViewer(flip_matrix)
cull_pattern_3 = CullPattern(List=explode_tree.Branch2, CullPattern=member_index_2.Count)
panel_9 = Panel(ghpython_script.a)
list_length = ListLength(List=list_item)
panel_10 = Panel(cull_pattern_2)
panel_11 = Panel(cull_pattern)
duplicate_data = DuplicateData(Data="3601", Number=list_length, Order=True)  # disabled
duplicate_data_2 = DuplicateData(Data="4001", Number=list_length, Order=True)
replace_items = ReplaceItems(Wrap=False)
pick_n_choose = PickNChoose(Pattern=member_index_2.Count, Stream0=[duplicate_data, duplicate_data_2], Stream1=duplicate_data_2)
panel_12 = Panel(pick_n_choose)
panel_13 = Panel("4001")
replace_items_2 = ReplaceItems(List=text_split_2, Item=graft(pick_n_choose), Indices="1", Wrap=False)
text_join = TextJoin(Text=replace_items_2, Join=",")
match_text = MatchText(Text=flatten(replace_items_2), Pattern="261 - S4", Case=True)
panel_14 = Panel(text_join)
panel_15 = Panel(replace_items_2)
cull_pattern_4 = CullPattern(List=flatten(text_join), CullPattern=match_text)
