# Grasshopper definition c326eaf5-e905-7982-851a-2b775f722046.gh (Grasshopper 1.0.7)

number_slider = Slider(1.66, range=0..10)
spin = BooleanToggle(False)
boolean_toggle = BooleanToggle(True)
button = Button()
brep = Brep(<brep referenced from the Rhino model>)
area = Area(Geometry=brep)  # -> Area, Centroid
xy_plane = XYPlane(Origin=area.Centroid)

# ---- group: RESET
data = Data(button)

# ---- group: ACTIVATE
data_2 = Data(boolean_toggle)

# ---- group: NUM OF PAVERS
data_3 = Data("360")

# ----
ghpython_script = PythonScript(Run=data_2, Reset=data, Target=data_3, Interval=Slider(1, range=1..1000))  # -> Counter; inputs Run: Boolean, Target: Int32
# ---------- ghpython_script: Python ----------
import Grasshopper as gh

def updateComponent(interval):
    
    """ Update this component similar to using a grasshopper timer """
    
    def callBack(e):
        ghenv.Component.ExpireSolution(False)
        
    ghenv.Component.OnPingDocument().ScheduleSolution(interval,
    gh.Kernel.GH_Document.GH_ScheduleDelegate(callBack))

# Instantiate or reset persistent counter variable
if "count" not in globals() or Reset:
    count = 0

# Update the variable and component
if Run and not Reset and count < Target:
    count +=1
    updateComponent(Interval)

# Output counter
Counter = count
# ---------- end ghpython_script ----------
rotate = Rotate(Geometry=xy_plane, Angle=degrees(ghpython_script), Plane=area.Centroid)  # -> Geometry, Transform
bounding_box = BoundingBox(Content=brep, Plane=rotate.Geometry)  # -> Box, Box_2
boolean_toggle_2 = BooleanToggle(False)
number_slider_2 = Slider(1, range=0..1)
boolean_toggle_3 = BooleanToggle(True)
button_2 = Button()
number_slider_3 = Slider(1.66, range=0..10)
volume = Volume(Geometry=bounding_box.Box)  # -> Volume, Centroid
stream_filter = StreamFilter(Gate=spin, Stream1=bounding_box.Box)
number_slider_4 = Slider(1, range=0..10)
brep_2 = Brep(stream_filter)
subtraction = Subtraction(A="360", B="1")
data_rec = PythonScript(x=volume.Volume, enable=boolean_toggle, reset=button, limit="360")  # -> out, x; inputs enable: Boolean, reset: Boolean, limit: Int32; same code as data_rec
range = Range(Domain=subtraction, Steps=subtraction)
cluster = Cluster(B=number_slider_4)  # -> number_2, mapped

# ---- group: RESET
data_4 = Data(button_2)

# ---- group: ACTIVATE
data_5 = Data(number_slider_2)

# ---- group: NUM OF PAVERS
data_6 = Data(cluster.number_2)

# ----
panel = Panel(data_rec.x)
sort_list = SortList(Keys=data_rec.x, ValuesValuesA=range)  # -> Keys, ValuesValuesA
series = Series(Start=0, Step=1, Count="4")
panel_2 = Panel(range)
spin_2 = BooleanToggle(True)
list_item = ListItem(List=sort_list.Keys, Index=0, Wrap=True)
list_item_2 = ListItem(List=sort_list.ValuesValuesA, Index=0, Wrap=True)
area_2 = Area(Geometry=bounding_box.Box)  # -> Area, Centroid
brep_3 = Brep(<brep referenced from the Rhino model>)
counter = COUNTER(Run=data_5, Reset=data_4, Target=data_6, Interval=Slider(10, range=1..1000), Step=cluster.mapped)  # -> Counter; inputs Run: Boolean, Target: Int32
# ---------- counter: Python ----------
import Grasshopper as gh

def updateComponent(interval):
    
    """ Update this component similar to using a grasshopper timer """
    
    def callBack(e):
        ghenv.Component.ExpireSolution(False)
        
    ghenv.Component.OnPingDocument().ScheduleSolution(interval,
    gh.Kernel.GH_Document.GH_ScheduleDelegate(callBack))

# Instantiate or reset persistent counter variable
if "count" not in globals() or Reset:
    count = 0

# Update the variable and component
if Run and not Reset and count < Target:
    count +=Step
    updateComponent(Interval)

# Output counter
Counter = count
# ---------- end counter ----------
panel_3 = Panel(list_item_2)
panel_4 = Panel(list_item)
rotate_2 = Rotate(Geometry=bounding_box.Box, Angle=degrees(list_item_2), Plane=PlaneXY(0, 0, 0))  # -> Geometry, Transform
rotate_3 = Rotate(Geometry=brep, Angle=degrees(list_item_2), Plane=PlaneXY(0, 0, 0))  # -> Geometry, Transform
rotate_4 = Rotate(Geometry=area_2.Centroid, Angle=degrees(list_item_2), Plane=PlaneXY(0, 0, 0))  # -> Geometry, Transform
panel_5 = Panel(counter)
cluster_2 = Cluster_2(
    boolean=Toggle(True),
    gate=spin_2,
    boolean_2=Toggle(True),
    enable=number_slider_2,
    content=brep_3,
    reset=button_2,
    geometry=brep_3,
    angle=counter,
    B=number_slider_4,
    brep=brep_3,
    distance=Slider(1.01, range=0..10),
    B_2=number_slider_3,
    B_3=number_slider_3)  # -> s_1_2, s_1, i, x, i_2, s_1_3, s_1_4, range_2
panel_6 = Panel(cluster_2.x)
panel_7 = Panel(cluster_2.i)
panel_8 = Panel(cluster_2.i_2)
panel_9 = Panel(cluster_2.range_2)
custom_preview = CustomPreview(
    Geometry=cluster_2.s_1_2,
    Material={diffuse=RGB(221, 160, 221), emission=RGB(66, 48, 66), shine=0.5, specular=RGB(255, 255, 255), transparency=0})
custom_preview_2 = CustomPreview(
    Geometry=cluster_2.s_1_3,
    Material={diffuse=RGB(176, 224, 230), emission=RGB(255, 255, 255), shine=0, specular=RGB(0, 0, 0), transparency=0.95})
custom_preview_3 = CustomPreview(
    Geometry=cluster_2.s_1_4,
    Material={diffuse=RGB(176, 224, 230), emission=RGB(255, 255, 255), shine=0, specular=RGB(0, 0, 0), transparency=0.95})
brep_4 = Brep(cluster_2.s_1)
deconstruct_brep = DeconstructBrep(Brep=rotate_2.Geometry)  # -> Faces, Edges, Vertices
area_3 = Area(Geometry=deconstruct_brep.Faces)  # -> Area, Centroid
deconstruct = Deconstruct(Point=rotate_4.Geometry)  # -> XComponent, YComponent, ZComponent
boolean = Boolean(Toggle(False))
boolean_2 = Boolean(Toggle(False))
boolean_3 = Boolean(Toggle(False))
stream_filter_2 = StreamFilter(Gate=boolean, Stream1=rotate_2.Geometry)
stream_filter_3 = StreamFilter(Gate=boolean_2, Stream1=rotate_3.Geometry)
deconstruct_2 = Deconstruct(Point=area_3.Centroid)  # -> XComponent, YComponent, ZComponent
sort_list_2 = SortList(Keys=deconstruct_2.ZComponent, ValuesValuesA=deconstruct_brep.Faces)  # -> reverse(Keys), ValuesValuesA
sort_list_3 = SortList(Keys=deconstruct_2.ZComponent, ValuesValuesA=deconstruct_brep.Faces)  # -> Keys, ValuesValuesA
custom_preview_4 = CustomPreview(
    Geometry=stream_filter_2,
    Material={diffuse=RGB(176, 224, 230), emission=RGB(255, 255, 255), shine=0, specular=RGB(0, 0, 0), transparency=0.95})
custom_preview_5 = CustomPreview(
    Geometry=stream_filter_3,
    Material={diffuse=RGB(221, 160, 221), emission=RGB(66, 48, 66), shine=0.5, specular=RGB(255, 255, 255), transparency=0})
list_item_3 = ListItem(List=sort_list_2.Keys, Index=0, Wrap=True)
list_item_4 = ListItem(List=sort_list_3.ValuesValuesA, Index=0, Wrap=True)
list_item_5 = ListItem(List=sort_list_3.Keys, Index=0, Wrap=True)
brep_wireframe = BrepWireframe(Brep=list_item_4, Density=-1)
subtraction_2 = Subtraction(A=list_item_3, B=list_item_5)
join_curves = JoinCurves(Curves=brep_wireframe, Preserve=False)
offset_curve = OffsetCurve(Curve=join_curves, Distance=Slider(1.01, range=0..10), Plane=PlaneXY(0, 0, 0), Corners=1)
unit_z = UnitZ(Factor=deconstruct.ZComponent)
negative = Negative(Value=subtraction_2)
move = Move(Geometry=offset_curve, Motion=unit_z)  # -> Geometry, Transform
addition = Addition(A=subtraction_2, B=number_slider)
subtraction_3 = Subtraction(A=negative, B=number_slider)
merge = Merge(Data1=subtraction_3, Data2=addition)
unit_z_2 = UnitZ(Factor=expr("x/2", merge))
extrude = Extrude(Base=move.Geometry, Direction=unit_z_2)
brep_join = BrepJoin(Breps=extrude)  # -> Breps, Closed
cap_holes = CapHoles(Brep=brep_join.Breps)
stream_filter_4 = StreamFilter(Gate=boolean_3, Stream1=cap_holes)
custom_preview_6 = CustomPreview(
    Geometry=stream_filter_4,
    Material={diffuse=RGB(176, 224, 230), emission=RGB(255, 255, 255), shine=0, specular=RGB(0, 0, 0), transparency=0.95})

# ==== cluster Cluster
B = ClusterInput()
division = Division(A="90", B=B)
merge = Merge(Data1="0", Data2="90")
merge_2 = Merge(Data1="90")
bounds = Bounds(Numbers=merge)
remap_numbers = RemapNumbers(Value=division, Source=bounds, Target=Domain(0, 1))  # -> Mapped, Clipped
number = Number(merge_2)
number_2 = ClusterOutput(number)
mapped = ClusterOutput(remap_numbers.Mapped)

# ==== cluster Cluster_2
geometry = ClusterInput()
area = Area(Geometry=geometry)  # -> Area, Centroid
xy_plane = XYPlane(Origin=area.Centroid)
angle = ClusterInput()
rotate = Rotate(Geometry=xy_plane, Angle=degrees(angle), Plane=area.Centroid)  # -> Geometry, Transform
content = ClusterInput()
B = ClusterInput()
bounding_box = BoundingBox(Content=content, Plane=rotate.Geometry)  # -> Box, Box_2
multiplication = Multiplication(A="90", B=B)
gate = ClusterInput()
volume = Volume(Geometry=bounding_box.Box)  # -> Volume, Centroid
stream_filter = StreamFilter(Gate=gate, Stream1=bounding_box.Box)
expression = Expression(x="2.832", Expression="x*10^7")
addition = Addition(A=multiplication, B="1")
s_1 = ClusterOutput(stream_filter)
division = Division(A=volume.Volume, B=expression)
range = Range(Domain="90", Steps=multiplication)
enable = ClusterInput()
reset = ClusterInput()
data_rec = PythonScript(x=division, enable=enable, reset=reset, limit=addition)  # -> out, x; inputs enable: Boolean, reset: Boolean, limit: Int32
# ---------- data_rec: Python ----------
from scriptcontext import sticky
if reset or 'x' not in sticky: sticky['x'] = []
if enable and not reset and ghenv.Component.RunCount == 1 : sticky['x'].append(x)
x = sticky['x'][-limit:] if limit > 0 else sticky['x']
# ---------- end data_rec ----------
range_2 = ClusterOutput(range)
x = ClusterOutput(data_rec.x)
panel = Panel(data_rec.x)
panel_2 = Panel(range)
sort_list = SortList(Keys=data_rec.x, ValuesValuesA=range)  # -> Keys, ValuesValuesA
list_item = ListItem(List=sort_list.Keys, Index=0, Wrap=True)
list_item_2 = ListItem(List=sort_list.ValuesValuesA, Index=0, Wrap=True)
i = ClusterOutput(list_item)
i_2 = ClusterOutput(list_item_2)
xy_plane_2 = XYPlane(Origin=Point(0, 0, 0))
brep = ClusterInput()
rotate_2 = Rotate(Geometry=xy_plane_2, Angle=degrees(list_item_2), Plane=area.Centroid)  # -> Geometry, Transform
brep_2 = Brep(brep)
bounding_box_2 = BoundingBox(Content=brep_2, Plane=rotate_2.Geometry)  # -> Box, Box_2
deconstruct_brep = DeconstructBrep(Brep=bounding_box_2.Box)  # -> Faces, Edges, Vertices
deconstruct = Deconstruct(Point=volume.Centroid)  # -> XComponent, YComponent, ZComponent
boolean = ClusterInput()
boolean_2 = ClusterInput()
area_2 = Area(Geometry=deconstruct_brep.Faces)  # -> Area, Centroid
boolean_3 = Boolean(boolean)
boolean_4 = Boolean(boolean_2)
stream_filter_2 = StreamFilter(Gate=boolean_3, Stream1=brep_2)
deconstruct_2 = Deconstruct(Point=area_2.Centroid)  # -> XComponent, YComponent, ZComponent
s_1_2 = ClusterOutput(stream_filter_2)
sort_list_2 = SortList(Keys=deconstruct_2.ZComponent, ValuesValuesA=deconstruct_brep.Faces)  # -> reverse(Keys), ValuesValuesA
sort_list_3 = SortList(Keys=deconstruct_2.ZComponent, ValuesValuesA=deconstruct_brep.Faces)  # -> Keys, ValuesValuesA
list_item_3 = ListItem(List=sort_list_2.Keys, Index=0, Wrap=True)
list_item_4 = ListItem(List=sort_list_3.ValuesValuesA, Index=0, Wrap=True)
list_item_5 = ListItem(List=sort_list_3.Keys, Index=0, Wrap=True)
brep_wireframe = BrepWireframe(Brep=list_item_4, Density=-1)
subtraction = Subtraction(A=list_item_3, B=list_item_5)
join_curves = JoinCurves(Curves=brep_wireframe, Preserve=False)
distance = ClusterInput()
offset_curve = OffsetCurve(Curve=join_curves, Distance=distance, Plane=PlaneXY(0, 0, 0), Corners=1)
unit_z = UnitZ(Factor=deconstruct.ZComponent)
negative = Negative(Value=subtraction)
B_2 = ClusterInput()
move = Move(Geometry=offset_curve, Motion=unit_z)  # -> Geometry, Transform
B_3 = ClusterInput()
addition_2 = Addition(A=subtraction, B=B_2)
subtraction_2 = Subtraction(A=negative, B=B_3)
merge = Merge(Data1=subtraction_2, Data2=addition_2)
unit_z_2 = UnitZ(Factor=expr("x/2", merge))
extrude = Extrude(Base=move.Geometry, Direction=unit_z_2)
brep_join = BrepJoin(Breps=extrude)  # -> Breps, Closed
cap_holes = CapHoles(Brep=brep_join.Breps)
mesh_brep = MeshBrep(
    Brep=cap_holes,
    Settings={GridMaxCount=0, GridMinCount=16, JaggedSeams=False, MaxEdgeLength=0, MinEdgeLength=0.0001, MinTolerance=0, Refine=True, RefineAngle=0, RelativeTolerance=0.65, SimplePlanes=True, Tolerance=0})
unify_mesh = UnifyMesh(Mesh=mesh_brep)  # -> Result, Count
flip_mesh = FlipMesh(Mesh=unify_mesh.Result, VertexNormals=True, FaceNormals=True, FaceOrientation=True)
mesh_edges = MeshEdges(Mesh=flip_mesh)  # -> NakedEdges, InteriorEdges, NonManifoldEdges
stream_filter_3 = StreamFilter(Gate=boolean_4, Stream1=flip_mesh)
stream_filter_4 = StreamFilter(Gate=boolean_4, Stream1=mesh_edges.InteriorEdges)
s_1_3 = ClusterOutput(stream_filter_3)
s_1_4 = ClusterOutput(stream_filter_4)
