# Grasshopper definition 2.3.0.0 Update Notice.gh (Grasshopper 1.0.7)
# plug-ins: Pancake

# ----
# This document applies to 2.3.0.0
# New features:
# (1) XML-related I/O. Please refer to the XML example.
# (2) Import/export plain text files with encoding.
# It enables operation on files other than UTF-8,
# such as GB2312, Shift-JIS, etc.
# (3) Maintain Visual Appearance (beta)
# Pancake will update text sizes in Panel
# when the script is opened on a computer with
# another DPI setting.
# 
# You may also adjust font sizes by
# "Pancake" menu -> "Adjust Font Sizes..."
# (4) Better Assoc <-> CSV interopability.
# (5) MultiSort. and CurrentLayer.
# See Miscellaneous.gh for more info.
# (6) Many Assoc-related components
# are renamed for better understandings.
# Go through the "Data Organization" panel
# and take a look.
# (7) Pancake settings are merged into
# Grasshopper's setting dialog.
# Try "File" menu -> "Preferences...", and
# “Pancake“ on the left.
# (8) You may choose where the emergency
# save is stored.
# 
# (9) You may choose to hint optional parameters as well.
pcimporttxt = ImportTXT(Encoding="utf-8", LastSaveLocalization="neutral,N")
pcmultisort = MultiSort(FirstValueIndex=4, LastSaveLocalization="neutral,N")  # -> Key0, Key1, Key2, Key3, Data0, Data1, Data2
pcassoctocsv = AssocToCSV(Delimiter=",", LastSaveLocalization="neutral,N")
pcmaintainvisapp = MaintainVisualAppearance(DpiScale=1, LastSaveLocalization="neutral,N")
pcexporttxt = ExportTXT(Overwrite=False, Encoding="utf-8", Export=False, LastSaveLocalization="neutral,N")

pccurrentlayer = CurrentLayer(LastSaveLocalization="neutral,N")  # -> Name, Fullpath
panel = Panel(pccurrentlayer.Name)

# ----
# (2) "Serialize" component now serializes Assocs
# with GH objects correctly.
# 
# In former versions, some Grasshopper objects,
# such as Plane, Vector, Points, are
# converted into texts during serialization.
# 
# The following won't work in older versions:
# Major changes in existing features:
# (1) Set Metadata is able to store most
# Grasshopper objects, or Assoc with
# Grasshopper objects. In previous versions,
# they are stored as strings and you
# need to convert them back to Grasshopper
# objects.
# The following example won't work in previous versions.
# You may store data in an Assoc, or assign them as metadata directly.
# ^ Here you no longer need to convert
# the deserialized data to the expected object.
# 
# Pancake will take care of that.
# To simulate the old behavior, you should turn on
# "Compatible Mode" by right-click the component.
# 
# Compatible Mode is automatically switched on
# for older scripts with components created
# earlier than this Pancake release.
# 
# This change shouldn't break any existing scripts.
# In previous versions, you need to serialize / deserialize explicitly.
# ^ Right-click the icon/text of the component
# to see the option.
# However, if you need to send the serialized result to another
# computer running lower versions of Pancake, in order to ensure they can
# deserialize the data, you should turn on "Compatible Mode" by right-click
# the component.
# 
# Compatible Mode is automatically switched on
# for older scripts with components created
# earlier than this Pancake release.
# 
# This change shouldn't break any existing scripts.
xy = XYPlane(Origin=Point(0, 0, 0))
box = DomainBox(Base=PlaneXY(0, 0, 0), X=Domain(-2, 2), Y=Domain(-0.5, 0.5), Z=Domain(0, 0.25))
xy_2 = XYPlane(Origin=Point(0, 0, 0))
box_2 = DomainBox(Base=PlaneXY(0, 0, 0), X=Domain(-2, 2), Y=Domain(-0.5, 0.5), Z=Domain(0, 0.25))
brep = Brep(box_2)
pcserialize = Serialize(Object=xy_2, LastSaveLocalization="neutral,N")
brep_2 = Brep(box)
pcconassoc = ConstructAssoc(_0=xy, LastSaveLocalization="neutral,N")
pcconassoc_2 = ConstructAssoc(_0=pcserialize, LastSaveLocalization="neutral,N")
pcsetmetadata = SetMetadata(Object=brep, AssocToAssign=pcconassoc, LastSaveLocalization="neutral,N")
pcsetmetadata_2 = SetMetadata(Object=brep, AssocToAssign=xy, LastSaveLocalization="neutral,N")
pcsetmetadata_3 = SetMetadata(Object=brep_2, AssocToAssign=pcconassoc_2, CompatibleMode=False, LastSaveLocalization="neutral,N")
pcgetmetadata = GetMetadata(Object=pcsetmetadata, LastSaveLocalization="neutral,N")
pcgetmetadata_2 = GetMetadata(Object=pcsetmetadata_2, LastSaveLocalization="neutral,N")
pcgetmetadata_3 = GetMetadata(Object=pcsetmetadata_3, LastSaveLocalization="neutral,N")
pcdeconassoc = DeconstructAssoc(Assoc=pcgetmetadata, AllowAutoFill=False, LastSaveLocalization="neutral,N")
pcdeconassoc_2 = DeconstructAssoc(Assoc=pcgetmetadata_3, AllowAutoFill=False, LastSaveLocalization="neutral,N")
pln = Plane(pcgetmetadata_2)
pln_2 = Plane(pcdeconassoc)
pcdeserialize = Deserialize(Serialized=pcdeconassoc_2, LastSaveLocalization="neutral,N")
pln_3 = Plane(pcdeserialize)
xy_3 = XYPlane(Origin=Point(0, 0, 0))
xy_4 = XYPlane(Origin=Point(0, 0, 0))
pcconassoc_3 = ConstructAssoc(_0=xy_3, LastSaveLocalization="neutral,N")
pcconassoc_4 = ConstructAssoc(_0=xy_4, LastSaveLocalization="neutral,N")
pcserialize_2 = Serialize(Object=pcconassoc_3, CompatibleMode=True, LastSaveLocalization="neutral,N")
pcserialize_3 = Serialize(Object=pcconassoc_4, CompatibleMode=False, LastSaveLocalization="neutral,N")
panel_2 = Panel(pcserialize_2)
panel_3 = Panel(pcserialize_3)
pcdeserialize_2 = Deserialize(Serialized=panel_3, LastSaveLocalization="neutral,N")
pcdeserialize_3 = Deserialize(Serialized=panel_2, LastSaveLocalization="neutral,N")
pcdeconassoc_3 = DeconstructAssoc(Assoc=pcdeserialize_3, AllowAutoFill=False, LastSaveLocalization="neutral,N")
pcdeconassoc_4 = DeconstructAssoc(Assoc=pcdeserialize_2, AllowAutoFill=False, LastSaveLocalization="neutral,N")
panel_4 = Panel(pcdeconassoc_3)
pln_4 = Plane(pcdeconassoc_4)
