# Grasshopper definition 2.4.0.0 Update Notice.gh (Grasshopper 1.0.7)
# plug-ins: Pancake

# This document applies to the 2.4.0.0 update
# New features:
# (1) Extra user object location. See settings
# for more information.
# 
# (2) New performance analyzer.
# See "Pancake" -> "Analyze Performance"
# 
# (3) New portability report:
# See "Pancake" -> "Portability Report"
# 
# (4) Display parameter content
# See "Pancake" -> "Param Content Hint"
# 
# (5) Remove geometry reference
# Notice: This is NOT internalizing.
# 
# The component is used when some other
# components process referenced geometry
# and normal geometry differently.
# 
# 
# 
# 
# (6) You may use amount with units
# as quantity inputs.
# 
# In older versions, you may use:
# 
# 
# 
# 
# 
# From 2.4, you can also use:
# 
# 
# 
# 
# 
# 
# Notice: due to techinical limitations,
# feet & inch string is converted to
# decimal length. Use "To Feet & Inch Length"
# or "Parse String"
pcmaintainvisapp = MaintainVisualAppearance(DpiScale=1, LastSaveLocalization="neutral,N")
pcconqty = ConstructQuantity(Amount="500", Unit="mm", Precision=4, LastSaveLocalization="neutral,N")
pctoftinlen = ToFeetInchLength(Quantity="500mm", Precision=64, LastSaveLocalization="neutral,N")
pcunrefgeo = RemoveReference(LastSaveLocalization="neutral,N")
pctoftinlen_2 = ToFeetInchLength(Quantity="6'4\"", Precision=64, LastSaveLocalization="neutral,N")
qty = Quantity("6'4\"", LastSaveLocalization="neutral,N")
pcparsestring = ParseString(String="6'4\"", LastSaveLocalization="neutral,N")  # -> Parsed, Type
pctoftinlen_3 = ToFeetInchLength(Quantity=pcconqty, Precision=64, LastSaveLocalization="neutral,N")
panel = Panel(pctoftinlen)
panel_2 = Panel(qty)
panel_3 = Panel(pctoftinlen_2)
panel_4 = Panel(pcparsestring.Parsed)
panel_5 = Panel(pctoftinlen_3)
