# Grasshopper definition Associative array and Json.gh (Grasshopper 1.0.7)
# Copyright: All rights reserved © 2018
# plug-ins: Pancake

# ----
# Why does Pancake require "Wrap List" instead of accepting list input, like jSwan?
# (2) Same applies to generating Assocs  from a list of data.
# (1) It's unclear between an element and a list with 1 element.
# jSwan achieves this by choosing Item or List
# access in the context menu and provides no UI hinting.
panel = Panel("1")
pcwraplist = WrapList(Items=panel, LastSaveLocalization="neutral,N")
pcconassoc = ConstructAssoc(Item=panel, LastSaveLocalization="neutral,N")
pcconassoc_2 = ConstructAssoc(Item=pcwraplist, LastSaveLocalization="neutral,N")
pcassoctostring = AssocToString(Assoc=pcconassoc, Style="Json", LastSaveLocalization="neutral,N")
pcassoctostring_2 = AssocToString(Assoc=pcconassoc_2, Style="Json", LastSaveLocalization="neutral,N")
panel_2 = Panel(pcassoctostring)
panel_3 = Panel(pcassoctostring_2)
panel_4 = Panel("""Apple
Peach
Pear""")
pcwraplist_2 = WrapList(Items=panel_4, LastSaveLocalization="neutral,N")
pcconassoc_3 = ConstructAssoc(Fruit=panel_4, LastSaveLocalization="neutral,N")
pcconassoc_4 = ConstructAssoc(Fruit=pcwraplist_2, LastSaveLocalization="neutral,N")
pcassoctostring_3 = AssocToString(Assoc=pcconassoc_3, Style="Json", LastSaveLocalization="neutral,N")
pcassoctostring_4 = AssocToString(Assoc=pcconassoc_4, Style="Json", LastSaveLocalization="neutral,N")
panel_5 = Panel(pcassoctostring_3)
panel_6 = Panel(pcassoctostring_4)

# ----
# Assoc & Geometric Metadata
# You may append metadata to various types
# of geometry. The metadata will be preserved
# during many transformations. It is different from
# Assoc's "Principle Value" because the principle
# will be lost if the component doesn't support
# Assoc.
# Here the info is already lost.
panel_7 = Panel("box")
box = DomainBox(Base=PlaneXY(0, 0, 0), X=Domain(-2, 2), Y=Domain(-0.5, 0.5), Z=Domain(0, 0.25))
pcconassoc_5 = ConstructAssociativeArray(Name=panel_7)
pcappenddata = AppendMetadata(Geometry=box, AssocToAppend=pcconassoc_5, CompatibleMode=True)
pcconassoc_6 = ConstructAssociativeArray(Geo=box, Name=panel_7)
Z = UnitZ(Factor=1)
move = Move(Geometry=pcappenddata, Motion=Z)  # -> Geometry, Transform
move_2 = Move(Geometry=pcconassoc_6, Motion=Z)  # -> Geometry, Transform
pcextractdata = ExtractMetadata(Geometry=move.Geometry)
volume = Volume(Geometry=move.Geometry)  # -> Volume, Centroid
volume_2 = Volume(Geometry=move_2.Geometry)  # -> Volume, Centroid
pcdeconassoc = DeconstructAssociativeArray(Assoc=move_2.Geometry)
pcdeconassoc_2 = DeconstructAssociativeArray(Assoc=pcextractdata)
panel_8 = Panel(volume.Centroid)
panel_9 = Panel(volume_2.Centroid)
panel_10 = Panel(pcdeconassoc)
panel_11 = Panel(pcdeconassoc_2)

pcmaintainvisapp = MaintainVisualAppearance(DpiScale=1, LastSaveLocalization="neutral,N")
panel_12 = Panel("""Order ID
Ship Date""")

# ----
# Remarks of Pancake's Json capability
# and Differences between Pancake and jSwan
# (1) Pancake doesn't serialize/deserialize GH objects or Rhino Geometry but jSwan does.
# Pancake's Assoc is purely a container of objects, therefore Assoc is much faster than
# jSwan's "Serialize" if you are using them to store data. Pancake will only serialize integer,
# decimal numbers, boolean, null, nested list (AtomList) and nested object (Assoc). Any
# other object is treated as string/text.
# (2) Pancake's Json deserializer is robust, however strictly follows RFC 8259. Some Json,
# which works in other software, may not be parsed.
# A valid Json. Some interpreters cannot deserialize it properly.
# A invalid json (single-quote instead of double-quote).
# Because the incorrect style is widely used, some parser may parse it but Pancake doesn't.
# (3) Pancake doesn't escape unicode characters, as it is not required by the standard.
# Special characeters are escaped.
# (4) Pancake uses built-in parser to process Json and doesn't rely on third-party libraries.
panel_13 = Panel("""[
    "JSON Test Pattern pass1",
    {"object with 1 member":["array with 1 element"]},
    {},
    [],
    -42,
    true,
    false,
    null,
    {
        "integer": 1234567890,
        "real": -9876.543210,
        "e": 0.123456789e-12,
        "E": 1.234567890E+34,
        "":  23456789012E66,
        "zero": 0,
        "one": 1,
        "space": " ",
        "quote": "\"",
        "backslash": "\\",
        "controls": "\b\f\n\r\t",
        "slash": "/ & \/",
        "alpha": "abcdefghijklmnopqrstuvwyz",
        "ALPHA": "ABCDEFGHIJKLMNOPQRSTUVWYZ",
        "digit": "0123456789",
        "0123456789": "digit",
        "special": "`1~!@#$%^&*()_+-={':[,]}|;.</>?",
        "hex": "\u0123\u4567\u89AB\uCDEF\uabcd\uef4A",
        "true": true,
        "false": false,
        "null": null,
        "array":[  ],
        "object":{  },
        "address": "50 St. James Street",
        "url": "http://www.JSON.org/",
        "comment": "// /* <!-- --",
        "# -- --> */": " ",
        " s p a c e d " :[1,2 , 3

,

4 , 5        ,          6           ,7        ],"compact":[1,2,3,4,5,6,7],
        "jsontext": "{\"object with 1 member\":[\"array with 1 element\"]}",
        "quotes": "&#34; \u0022 %22 0x22 034 &#x22;",
        "\/\\\"\uCAFE\uBABE\uAB98\uFCDE\ubcda\uef4A\b\f\n\r\t`1~!@#$%^&*()_+-=[]{}|;:',./<>?"
: "A key can be any string"
    },
    0.5 ,98.6
,
99.44
,

1066,
1e1,
0.1e1,
1e-1,
1e00,2e+00,2e-00
,"rosebud"]""")
panel_14 = Panel("""	
\/"
""")
box_2 = DomainBox(Base=PlaneXY(0, 0, 0), X=Domain(-2, 2), Y=Domain(-0.5, 0.5), Z=Domain(0, 0.25))
pcconassoc_7 = ConstructAssociativeArray(_0=box_2)
pcassoctostring_5 = AssociativeArrayToString(Assoc=pcconassoc_7, Style="Json")
pcconassoc_8 = ConstructAssociativeArray(Chinese="测试文本", SpecialChars=panel_14)
pcparsestring = ParseString(String="{'aa':'bb'}")  # -> Parsed, Type
panel_15 = Panel(pcassoctostring_5)
pcassoctostring_6 = AssociativeArrayToString(Assoc=pcconassoc_8, Style="Json")
panel_16 = Panel(pcparsestring.Parsed)
pcparsestring_2 = ParseString(String=panel_13)  # -> Parsed, Type
panel_17 = Panel(pcassoctostring_6)
pcunwraplist = UnwrapList(AtomList=pcparsestring_2.Parsed)
item = ListItem(List=pcunwraplist, Index=Slider(8, range=0..10), Wrap=True)
# Please be advised this only applies to
# JSON serialization. As of the latest version,
# If you are using Assoc with "Serialize" or
# "Set Metadata", GH objects will be
# correctly handled.
panel_18 = Panel(pcunwraplist)
pcdeconassoc_3 = DeconstructAssociativeArray(Assoc=item)  # -> Integer, Real, _2, _3, _4, Zero, One, Space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

# ----
# Assoc and JSON, as well as other styled-string (Python, Mathematica, etc)
# Pancake provides a simple way to convert between Assoc and JSON, or export Assoc to other styled-string.
# Because Assoc accepts single items only, if you'd like to inclue a list, use "Wrap List" from Pancake or Metahopper.
# There are differences between how Pancake and jSwan handle JSON. See manual or below.
# New component "Parse String":
# You may use this component to process
# Json. It will try to determine what data
# the input string contains and convert it.
# It supports many more formats than Json,
# see description for more info.
# New component "Associative Array to String":
# Multiple styles are supported. You may change
# the style by right-clicking the component.
# You may use "Export TXT"
# component to export it.
# Pancake cannot parse other
# aforementioned styled-strings
# except Json.
panel_19 = Panel("42")
panel_20 = Panel("""1
2
3
4""")
panel_21 = Panel("""Pancake
2.0.0.0""")
int = Integer(panel_19)
num = Number("42.42")
bool = Boolean("true")
pcwraplist_3 = WrapList(Items=panel_20)
pcconassoc_9 = ConstructAssociativeArray(Demo=panel_21)
pcconassoc_10 = ConstructAssociativeArray(IntData=int, DoubleData=num, Boolean=bool, StrData="string data", List=pcwraplist_3, NestedObject=pcconassoc_9)
data = Data(pcconassoc_10)
panel_22 = Panel(pcconassoc_10)
pcghfilepath = DefinitionPath()  # -> Directory, Name, DirectorySeparator
concat = Concatenate(FragmentA=pcghfilepath.Directory, FragmentB=pcghfilepath.DirectorySeparator, FragmentC="Demo Export.json")
path = FilePath(concat)
truebutton = TrueOnlyButton()
overwrite = BooleanToggle(True)

# ---- group: Assoc to String
# Json
# Python (dict)
# Association
# Http Querystring
# (less supported)
pcassoctostring_7 = AssociativeArrayToString(Assoc=data, Style="Association")
pcassoctostring_8 = AssociativeArrayToString(Assoc=data, Style="Python")
pcassoctostring_9 = AssociativeArrayToString(Assoc=data, Style="Querystring")
pcassoctostring_10 = AssociativeArrayToString(Assoc=data, Style="Json")

# ----
# Assoc Basics
# New component "Set Principle Value":
# An assoc will take its first element as its
# principle value if the value is not explicitly
# set, unless the first element is a String/Text.
# 
# If the component receiving Assoc doesn't
# support Assoc, the assoc will behave like
# its principle value.
# For named elements, you may also
# right-click the component and use
# "Match output" feature to auto-fill
# the output list.
# New component "Deconstruct Associative Array":
# Deconstruct the array into its elements.
# As the construction component, you may
# retrieve elements by index, name or mixed.
# 
# For both construct and deconstruct component,
# Recompute (press F5) after you change a name
# to make sure the changes are reflected
# New component "Construct Associative Array":
# Create an assoc. You may designate the name
# for each object by right-clicking the input and
# changing its nickname. You can control the
# count of input by ZUI. Names aren't necessarily
# required. You may also mix names with indexes.
# However, some other operation may require
# names. You may also compose Assoc with
# different names into one list.
# Assoc is an immutable list of objects.
# The objects may be marked with names.
# One assoc is treated as one single object
# during Grasshopper tree manipulation.
# The inside object can be any single object.
# To include a list, use "Wrap List" component.
# The component fails here because the assoc's
# principle value is the integer 12. You cannot
# calculate the volume of a number.
# Try here
# All three name designation are valid.
# You can either designate
# the principle value by
# index or name.
# The component calculates because
# the principle value is now a box.
# If any assoc doesn't contain the desired
# element, the corresponding output will
# be Null and a warning is raised.
number_slider = Slider(6, range=0..10)
box_3 = DomainBox(Base=PlaneXY(0, 0, 0), X=Domain(-2, 2), Y=Domain(-0.5, 0.5), Z=Domain(0, 0.25))
box_4 = DomainBox(Base=PlaneXY(0, 0, 0), X=number_slider, Y=number_slider, Z=number_slider)
int_2 = Integer("12")

# ---- group: Construct Assoc
pcconassoc_11 = ConstructAssociativeArray(_0=int_2, _1="AA", Geometry=box_3)
pcconassoc_12 = ConstructAssociativeArray(Id=int_2, Remark="AA", Geometry=box_4)
pcconassoc_13 = ConstructAssociativeArray(_0=int_2, _1="AA", _2=box_3)

# ----
# Assoc & Operation on a Key-Value basis
# Pancake supports three key-value operations.
# You may deconstruct an assoc and retrieve
# all of its keys and values or retrieve some
# designated keys. / is by default used as the
# delimiter to denote a path.
# You can also construct an Assoc by Key-Value.
# Please notice by this way you cannot construct
# a list ([1, 2, 3]). You must use Wrapped List
# explicitly.
# You may also use this component to change
# an existing Assoc.
# You may reference a value in a list
# by its index.
# Newly-introduced "Append" mode allows
# to append data with same names. This
# feature is majorly used for XML export.
# Right-click the component to set the mode.
panel_23 = Panel("""{"menu": {
  "id": "file",
  "value": "File",
  "popup": {
    "menuitem": [
      {"value": "New", "onclick": "CreateNewDoc()"},
      {"value": "Open", "onclick": "OpenDoc()"},
      {"value": "Close", "onclick": "CloseDoc()"}
    ]
  }
}}""")
panel_24 = Panel("""menu/popup/menuitem/0/value
menu/popup/menuitem/2/onclick
menu/popup/menuitem/1""")
pcparsestring_3 = ParseString(String=panel_23)  # -> Parsed, Type
panel_25 = Panel("""Steve
Adam
Joe""")
panel_26 = Panel("""1
2
3
4
5""")
panel_27 = Panel("""1
2
3""")
panel_28 = Panel("""data1
data2/d/e/f
data3""")
pcconassoc_14 = ConstructAssoc(Name=panel_25, LastSaveLocalization="neutral,N")
panel_29 = Panel("""person
person
person""")
int_3 = Integer(panel_26)
pcparsestring_4 = ParseString(String="{\"sampledata\": 0}")  # -> Parsed, Type
int_4 = Integer(panel_27)
pcconassockv = ConstructAssociativeArrayByKeys(Paths=panel_29, Values=pcconassoc_14, Delimiter="/", AddMode=False)
pcconassockv_2 = ConstructAssociativeArrayByKeys(Paths=panel_29, Values=pcconassoc_14, Delimiter="/", AddMode=True)
pcwraplist_4 = WrapList(Items=int_3)
panel_30 = Panel(pcconassockv)
panel_31 = Panel(pcconassockv_2)
pcconassockv_3 = ConstructAssociativeArrayByKeys(Paths=panel_28, Values=int_4, Delimiter="/")
pcconassockv_4 = ConstructAssociativeArrayByKeys(Assoc=pcparsestring_4.Parsed, Paths="sampledata", Values=pcwraplist_4, Delimiter="/")
pcassoctostring_11 = AssociativeArrayToString(Assoc=pcconassockv_3, Style="Json")
pcassoctostring_12 = AssociativeArrayToString(Assoc=pcconassockv_4, Style="Json")
pcassoctoxml = AssocToXML(Assoc=pcconassockv_2, RootTag="people", LastSaveLocalization="neutral,N")
panel_32 = Panel(pcassoctostring_11)
panel_33 = Panel(pcassoctostring_12)
panel_34 = Panel(pcassoctoxml)

# ---- group: Deconstruct Assoc by Keys
pcdeconassockv = DeconstructAssociativeArrayByKeys(Assoc=pcparsestring_3.Parsed, Path=panel_24, Delimiter="/")

# ----
pcdeconassocaskvlist = AssocToKeyValues(Assoc=pcparsestring_3.Parsed, Depth=0, LastSaveLocalization="neutral,N")  # -> Paths, Values

panel_35 = Panel(pcdeconassocaskvlist.Paths)
panel_36 = Panel(pcdeconassockv)
panel_37 = Panel(pcdeconassocaskvlist.Values)

# ----
# Assoc and CSV
# You may use Pancake to export
# Assocs into CSV text and use
# "Export TXT" to export the text into file.
# Here is a demonstration of merging
# ("inner join") data from different sources.
# 
# New component "Merge Associative Array":
# You may merge two or more assocs into one
# assoc. If the input are lists, they are
# merged in order.
# New component "Definition Path":
# You can locate depending resources by relative path
# more easily.
# New component "Construct
# Associative Array from CSV":
# By default, each column is stored as
# one branch. Use the option in the
# context menu to store entries as branches
# The demo data is fake sales data
# (generated by randomizer) separated
# into two files, with one same column
# "Order ID"
# By default, numbers and quanties are
# automatically recognized from CSV data.
# You may disable this feature by right-clicking
# the component.
pcghfilepath_2 = DefinitionPath()  # -> Directory, Name, DirectorySeparator
concat_2 = Concatenate(FragmentA=pcghfilepath_2.Directory, FragmentB=pcghfilepath_2.DirectorySeparator, FragmentC="Demo data 1.csv")
concat_3 = Concatenate(FragmentA=pcghfilepath_2.Directory, FragmentB=pcghfilepath_2.DirectorySeparator, FragmentC="Demo data 2.csv")
path_2 = FilePath(concat_2)
path_3 = FilePath(concat_3)
file = ReadFile(File=path_3, PerLineParse=True)
file_2 = ReadFile(File=path_2, PerLineParse=True)

# ---- group: Construct Assoc from CSV
pcassocfromcsv = ConstructAssociativeArrayFromCSV(CSV=file, Delimiter=",", ParseAsQuantity=True, RecognizeType=True)
pcassocfromcsv_2 = ConstructAssociativeArrayFromCSV(CSV=file_2, Delimiter=",", ParseAsQuantity=True, RecognizeType=True)

# ----
data_2 = Data(pcconassoc_12)
data_3 = Data(pcconassoc_11)
data_4 = Data(pcconassoc_13)
data_5 = Data([data_3, data_2])
data_6 = Data([data_4, data_3, data_2])
pcdeconassoc_4 = DeconstructAssociativeArray(Assoc=data_6)
# New component "Associative Array to Datatable":
# This component converts a list of assocs
# to a table with headers and values, it can
# be exported back to CSV (LunchBox),
# used as a part of a bigger dataset (also
# LunchBox), used as the datasource
# for DataGrid (Human UI), and etc.
panel_38 = Panel(pcdeconassoc_4)
data_7 = Data(pcconassoc_12)
pcdeconassoc_5 = DeconstructAssociativeArray(Assoc=data_7)  # -> Id, Remark, Geometry
pcdeconassoc_6 = DeconstructAssociativeArray(Assoc=data_7)  # -> _0, _1
data_8 = Data(pcconassoc_12)
panel_39 = Panel(data_8)
pcsetassocpval = SetPrincipleValue(Assoc=data_8, Name="geometry")
volume_3 = Volume(Geometry=data_8)  # -> Volume, Centroid
panel_40 = Panel(volume_3.Volume)
volume_4 = Volume(Geometry=pcsetassocpval)  # -> Volume, Centroid
panel_41 = Panel(volume_4.Volume)

# ---- group: Decon Assoc
pcdeconassoc_7 = DeconstructAssociativeArray(Assoc=data_4)  # -> _0, _1
pcdeconassoc_8 = DeconstructAssociativeArray(Assoc=data_5)

# ----
panel_42 = Panel(pcdeconassoc_7._1)
panel_43 = Panel(pcdeconassoc_7._0)
volume_5 = Volume(Geometry=pcdeconassoc_8)  # -> Volume, Centroid
panel_44 = Panel(volume_5.Volume)

panel_45 = Panel(pcassoctostring_7)
panel_46 = Panel(pcassoctostring_10)
panel_47 = Panel(pcassoctostring_8)
panel_48 = Panel(pcassoctostring_9)
txt = Text(panel_46)
txt_2 = Text(panel_45)
txt_3 = Text(txt)
pcparsestring_5 = ParseString(String=txt_3)  # -> Parsed, Type
pcparsestring_6 = ParseString(String=txt_2)  # -> Parsed, Type
panel_49 = Panel(pcparsestring_6.Parsed)
panel_50 = Panel(pcparsestring_6.Type)
pcdeconassoc_9 = DeconstructAssociativeArray(Assoc=pcparsestring_5.Parsed)  # -> IntData, DoubleData, Boolean, StrData, List, NestedObject
panel_51 = Panel(pcparsestring_5.Type)
panel_52 = Panel(pcparsestring_5.Parsed)
pcunwraplist_2 = UnwrapList(AtomList=pcdeconassoc_9.List)
panel_53 = Panel(pcunwraplist_2)

pcexporttxt = ExportTXT(
    Content=txt,
    FileLocation=path,
    Overwrite=overwrite,
    Encoding="utf-8",
    Export=truebutton,
    LastSaveLocalization="neutral,N")

panel_54 = Panel(pcexporttxt)

pcdeconassoc_10 = DeconstructAssociativeArray(Assoc=pcassocfromcsv_2)  # -> OrderID, ShipDate, UnitsSold, UnitPrice, UnitCost, TotalRevenue, TotalCost, TotalProfit
pcdeconassoc_11 = DeconstructAssociativeArray(Assoc=pcassocfromcsv)
pcdeconassoc_12 = DeconstructAssociativeArray(Assoc=pcassocfromcsv)  # -> Region, Country, ItemType, SalesChannel, OrderPriority, OrderDate, OrderID
pcdeconassoc_13 = DeconstructAssociativeArray(Assoc=pcassocfromcsv_2)
sort = SortList(Keys=pcdeconassoc_11, ValuesA=pcassocfromcsv)  # -> Keys, ValuesA
sort_2 = SortList(Keys=pcdeconassoc_13, ValuesA=pcassocfromcsv_2)  # -> Keys, ValuesA

# ---- group: Merge Assoc
pcmergeassoc = MergeAssociativeArray(_0=sort_2.ValuesA, _1=sort.ValuesA)

# ---- group: Assoc to Datatable
pcassoctodatatable = AssociativeArrayToDatatable(Assoc=pcmergeassoc, FlipOutput=False)  # -> Headers, Values

# ----
pcdeconassoc_14 = DeconstructAssociativeArray(Assoc=pcmergeassoc)  # -> OrderID, ShipDate, UnitsSold, UnitPrice, UnitCost, TotalRevenue, TotalCost, TotalProfit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
txt_4 = Text(pcassoctodatatable.Headers)
data_9 = Data(pcassoctodatatable.Values)
# You may also specify which columns
# are included.
pcassoctocsv = AssocToCSV(Assoc=pcmergeassoc, Delimiter=",", LastSaveLocalization="neutral,N")
panel_55 = Panel(pcassoctocsv)
pcexporttxt_2 = ExportTXT(Content=panel_55, Overwrite=False, Encoding="utf-8", Export=False, LastSaveLocalization="neutral,N")

pcassoctocsv_2 = AssocToCSV(Assoc=pcmergeassoc, Names=panel_12, Delimiter=",", LastSaveLocalization="neutral,N")
panel_56 = Panel(pcassoctocsv_2)
