# Grasshopper definition Export to STL.gh (Grasshopper 1.0.7)
# Copyright: All rights reserved © 2018
# plug-ins: Pancake

# This example demonstrates how to use the "True Button",
#  "Export to STL" and "Filepath series" components from Pancake.
pcmaintainvisapp = MaintainVisualAppearance(DpiScale=1, LastSaveLocalization="neutral,N")
# Example Box
box = CenterBox(Base=PlaneXY(0, 0, 0), X=1, Y=1, Z=1)
mesh = Mesh(box)

# ----
# Multiple target files, multiple by multiple (Meshes are exported to multple files. In the example, ten would be generated after another ten)
panel = Panel("10")
mesh_2 = Mesh(mesh)
truebutton = TrueOnlyButton()
dup = DuplicateData(Data=mesh_2, Number=panel, Order=True)
fileseries = FilepathSeries(
    PatternOfFilepath="D:\STLExport{0}.stl",
    StartingIndex=1,
    QuantityOfFilenames=panel,
    GenerateNext=truebutton,
    Reset=False)  # -> Filepath, ListOfFilepath, CounterOfFirstFile
pcexportstl = ExportSTL(Mesh=dup, Relocate=True, SavePath=fileseries.ListOfFilepath, SaveAsBinaryFile=True, SaveNow=truebutton)
panel_2 = Panel(fileseries.ListOfFilepath)
panel_3 = Panel(pcexportstl)

# ----
# Multiple target files, at once (Meshes are exported to multple fixed files, all at once)
panel_4 = Panel("10")
panel_5 = Panel("""D:\STLExport1.stl
D:\STLExport2.stl
D:\STLExport3.stl
D:\STLExport4.stl
D:\STLExport5.stl
D:\STLExport6.stl
D:\STLExport7.stl
D:\STLExport8.stl
D:\STLExport9.stl
D:\STLExport10.stl""")
mesh_3 = Mesh(mesh)
dup_2 = DuplicateData(Data=mesh_3, Number=panel_4, Order=True)
truebutton_2 = TrueOnlyButton()
pcexportstl_2 = ExportSTL(Mesh=dup_2, Relocate=True, SavePath=panel_5, SaveAsBinaryFile=True, SaveNow=truebutton_2)
panel_6 = Panel(pcexportstl_2)

# ----
# Multiple target files, one-by-one. (Meshes are exported to multiple files, and one after another.)
mesh_4 = Mesh(mesh)
truebutton_3 = TrueOnlyButton()
fileseries_2 = FilepathSeries(PatternOfFilepath="D:\STLExport{0}.stl", StartingIndex=1, QuantityOfFilenames=-1, GenerateNext=truebutton_3, Reset=False)  # -> Filepath, ListOfFilepath, CounterOfFirstFile
pcexportstl_3 = ExportSTL(Mesh=mesh_4, Relocate=True, SavePath=fileseries_2.Filepath, SaveAsBinaryFile=True, SaveNow=truebutton_3)
panel_7 = Panel(fileseries_2.Filepath)
panel_8 = Panel(pcexportstl_3)

# ----
# One target file. (Mesh is exported to one fixed file. Overwrite if it already exists.)
mesh_5 = Mesh(mesh)
truebutton_4 = TrueOnlyButton()
pcexportstl_4 = ExportSTL(Mesh=mesh_5, Relocate=True, SavePath="D:\STLExport1.stl", SaveAsBinaryFile=True, SaveNow=truebutton_4)
panel_9 = Panel(pcexportstl_4)
