# Grasshopper definition Export to other formats.gh (Grasshopper 1.0.7)
# Copyright: All rights reserved © 2018
# plug-ins: Pancake

# Pancake supports two types of export:
# 
# (1) Format-specified export
#       Pancake deals with the export itself.
#       It is fast and raises fewer issues.
#       The drawback is only a few formats
#       are supported.
# 
# (2) "Export As" - general export
#       Pancake will use Rhinoceros to deal
#       with the export. It's just like you clicking
#       "File" -> "Export...", whereas it is
#       automatically done. Therefore it supports
#       any format Rhino supports.
# For exporting one file, Geo, Layer, ObjAttr needs to be
# either nothing, one element, or flattened lists.
# 
# The mentioned Export components all support
# complicated structure of Geo, Layer, ObjAttr,
# and multi-targetted export (in most cases).
# 
# See "Export to STL" example for hints.
pcmaintainvisapp = MaintainVisualAppearance(DpiScale=1, LastSaveLocalization="neutral,N")

# ----
# Export to 3DM
# Pancake can export to 3DM without
# the help of Rhino's interface. But not
# all objects are supported.
# 
# Annotations are mostly excluded.
# 
# You may feed ObjAttr with Object
# Attributes from Human or Elefront
# (some other plugins may also be
# compatible). Not all attributes are
# supported. Always do a test export
# before actual batch operations.
panel = Panel("test.3dm")
pcghfilepath = DefinitionPath()  # -> Directory, Name, DirectorySeparator
# Example of format-specified export:
# 
# * STL Export is included in another example
box = DomainBox(Base=PlaneXY(0, 0, 0), X=Domain(-2, 2), Y=Domain(-0.5, 0.5), Z=Domain(0, 0.25))
concat = Concatenate(FragmentA=pcghfilepath.Directory, FragmentB=pcghfilepath.DirectorySeparator, FragmentC=panel)
truebutton = TrueOnlyButton()
# Other support formats includes:
# IGES, DAE, KMZ, STL, TXT
# Right-click the component to see extra options.
# 
# Most Pancake export components have extra
# options that can be configured by right-click menus.
# 
# "Copy attributes from Rhino references"
# If Geo is a Guid or RhinoObject, attributes will
# be copied from it, instead of from the component's input.
# 
# "Also copy from Grasshopper references"
# If Geo is a referenced GH geometry, such as
# "Referenced XXX". Attributes will be copied
# from their corresponding Rhino objects.
# 
# "Override layer with component input"
# Given that layer is both provided in Layer input
# and ObjAttr input, the layer will be copied from
# Layer if this is on, otherwise copied from ObjAttr
pcexport3dm = Export3DM(Geometry=box, FileLocation=concat, Overwrite=Toggle(True), Version=0, Export=truebutton)  # -> OK, Log

pcghfilepath_2 = DefinitionPath()  # -> Directory, Name, DirectorySeparator
# Example of general export:
box_2 = DomainBox(Base=PlaneXY(0, 0, 0), X=Domain(-2, 2), Y=Domain(-0.5, 0.5), Z=Domain(0, 0.25))
concat_2 = Concatenate(FragmentA=pcghfilepath_2.Directory, FragmentB=pcghfilepath_2.DirectorySeparator, FragmentC="test2.3dm")
# "Export As" uses Rhino's interface and commandline
# to export. Therefore all formats supported by Rhino
# is supported.
# 
# Command templates are provided for some formats.
# Usually without a command template, the component
# will work following the export options from the last time
# of exporting the certain type.
truebutton_2 = TrueOnlyButton()
# Other than the aforementioned three options,
# "Export As" has two more options:
# 
# "Cleanup layers"
# Temporary layers will be removed after the
# export.
# 
# "Compatible mode"
# Cannot be used under multi-target export.
# Rhino is less likely prone to freeze in this mode.
# (If regular mode works, do not use this mode)
pcexportas = ExportAs(Geometry=box_2, FileLocation=concat_2, Overwrite=Toggle(True), Export=truebutton_2, CompMode=False)  # -> OK, ExportCommand

# ----
# Export/Import plain text file with encoding support
# The default encoding Grasshopper uses
# is UTF-8. It's possible that you need to
# operate on other encodings, such as
# Shift-JIS (Japanese), GB18030 (SimpChinese),
# or other Unicode dialect, such as UTF-16, etc.
# 
# By default the encoding input is "utf-8" (without quotes).
# You may assign an encoding name,
# or "default" (w/o quotes) to use the
# current default ASCII codepage.
# Example: Export パンケーキ (Pancake) into a Shift-JIS text file and read it back.
# ^ Notice "Read File" cannot read it.
panel_2 = Panel("TestJapaneseOutput.txt")
run = TrueOnlyButton(LastSaveLocalization="neutral,N")
overwrite = BooleanToggle(True)
# New in 2.3.0.0
pcghfilepath_3 = DefinitionPath(LastSaveLocalization="neutral,N")  # -> Directory, Name, DirectorySeparator
concat_3 = Concatenate(FragmentA=pcghfilepath_3.Directory, FragmentB=pcghfilepath_3.DirectorySeparator, FragmentC=panel_2)
txt = Text(concat_3)
pcexporttxt = ExportTXT(
    Content="パンケーキ",
    FileLocation=txt,
    Overwrite=overwrite,
    Encoding="Shift-JIS",
    Export=run,
    LastSaveLocalization="neutral,N")
pcwaituntil = WaitUntil(Signal=pcexporttxt, Data=txt, LastSaveLocalization="neutral,N")
pcimporttxt = ImportTXT(File=pcwaituntil, Encoding="Shift-JIS", LastSaveLocalization="neutral,N")
file = ReadFile(File=pcwaituntil, PerLineParse=False)
panel_3 = Panel(pcimporttxt)
panel_4 = Panel(file)
