# Grasshopper definition Miscellaneous.gh (Grasshopper 1.0.7)
# Copyright: All rights reserved © 2018
# plug-ins: Pancake

random = Random(Range=Slider(10, range=0..10), Number=Slider(100, range=0..100), Seed=2)
int = Integer(random)
addition = Addition(A=int, B=10)
txt = Text(addition)

# ----
# Default Value
# Default value is used in a cluster to
# detect whether a input is provided.
# 
# Double-click the cluster below to see how
# it is used.
panel = Panel("Double-click the cluster to see how it works")
cluster = Cluster()
cluster_2 = Cluster(in=panel)
panel_2 = Panel(cluster_2)
panel_3 = Panel(cluster)

# ----
# MultiSort
# Sort with multiple keys, or non-numeric data.
# 
# Sort with multiple keys:
# Sort with non-numeric keys:
# Non-numeric and non-supported types
# are treated as texts
# The sort is stable compared to the original
# GH component. (data with same keys will
# have the same order as they are in the input)
panel_4 = Panel("0.9")
panel_5 = Panel("""Apple
Bear
Cindy
Dallas""")
box = DomainBox(Base=PlaneXY(0, 0, 0), X=Domain(-2, 2), Y=Domain(-0.5, 0.5), Z=Domain(0, 0.25))
# New features in 2.3.0.0
panel_6 = Panel("""1
2
3
2""")
panel_7 = Panel("""a
b
c
d
e
f""")
panel_8 = Panel("""a.1
d
a.2
b""")
panel_9 = Panel("""1
1
1
1
1
1""")
panel_10 = Panel("""23:59
01:00
12:00
09:00
13:00""")
panel_11 = Panel("""apple
pear
avocano
peach""")
int_2 = Integer("0")
int_3 = Integer("1")
num = Number(panel_4)
int_4 = Integer(panel_6)
time = Time(panel_10)
merge = Merge(Data1=int_3, Data2=num, Data3="apple", Data4=int_2, Data5=box)
txt_2 = Text(panel_7)
int_5 = Integer(panel_9)
pcmultisort = MultiSort(Key0=int_4, Key1=panel_8, Data0=panel_5, FirstValueIndex=2, LastSaveLocalization="neutral,N")  # -> Key0, Key1, Data0
pcmultisort_2 = MultiSort(Key0=panel_11, LastSaveLocalization="neutral,N")  # -> Key0, Data0
pcmultisort_3 = MultiSort(Key0=time, LastSaveLocalization="neutral,N")  # -> Key0, Data0
panel_12 = Panel(merge)
panel_13 = Panel(pcmultisort.Key0)
panel_14 = Panel(pcmultisort.Data0)
panel_15 = Panel(pcmultisort.Key1)
panel_16 = Panel(pcmultisort_2.Key0)
sort = SortList(Keys=int_5, ValuesA=txt_2)  # -> Keys, ValuesA
pcmultisort_4 = MultiSort(Key0=int_5, Data0=txt_2, FirstValueIndex=1, LastSaveLocalization="neutral,N")  # -> Key0, Data0
panel_17 = Panel(pcmultisort_3.Key0)
pcmultisort_5 = MultiSort(Key0=panel_12, LastSaveLocalization="neutral,N")  # -> Key0, Data0
panel_18 = Panel(pcmultisort_4.Data0)
panel_19 = Panel(sort.ValuesA)
panel_20 = Panel(pcmultisort_5.Key0)

# ----
# Current Layer
# Get the name and fullpath or current layer.
# Will automatically refresh definition if the
# current layer is changed.
# This component would be halted
# during an active Pancake I/O operation.
# But it may cause trouble if you are using
# other Rhino-based export/import solutions,
# such as Elefront's Export Objects.
# This component would also be disabled
# if Pancake is in the safe mode.
pccurrentlayer = CurrentLayer(LastSaveLocalization="neutral,N")  # -> Name, Fullpath
panel_21 = Panel(pccurrentlayer.Name)
panel_22 = Panel(pccurrentlayer.Fullpath)

# ----
# Maintain Visual Appearance
# Put it into your canvas. And it will
# adjust font sizes in Panels, in accordance
# with Dpi settings.
pcmaintainvisapp = MaintainVisualAppearance(DpiScale=1, LastSaveLocalization="neutral,N")

# ----
# Categorize Data
# You may categorize a list of key-value pairs by their keys.
# The Integer Index version is more specialized and faster.
# 
# The key can be any value type.
# "Count unique" is used when you only need to count the occurences of keys.
# The keys are not necessarily integers and may have mixed types.
number_slider = Slider(5, range=0..10)
panel_23 = Panel("""3
1
2
3
2""")
panel_24 = Panel("""A
B
C
D
E""")
swatch = ColourSwatch(SwatchColor=RGB(255, 255, 255))
random_2 = Random(Range=Slider(10, range=0..10), Number=Slider(100, range=0..100), Seed=2)
merge_2 = Merge(Data1=number_slider, Data2="test", Data3=number_slider, Data4=swatch, Data5=swatch)
int_6 = Integer(random_2)

pccategorize = Categorize(Key=merge_2, Value=panel_24, SortIfPossible=False)  # -> KeyList, ValueTree
pccategorizebyind = CategorizeByIndex(Key=panel_23, Value=panel_24, DisableOptimization=False)  # -> KeyList, ValueTree

merge_3 = Merge(Data1=int_6, Data2=txt)  # -> flatten(Result)

panel_25 = Panel(pccategorize.ValueTree)
panel_26 = Panel(pccategorize.KeyList)
panel_27 = Panel(pccategorizebyind.ValueTree)
panel_28 = Panel(pccategorizebyind.KeyList)
pccountunique = CountUnique(Key=merge_3, SortIfPossible=False)  # -> KeyList, Count
panel_29 = Panel(pccountunique.KeyList)
panel_30 = Panel(pccountunique.Count)

# ==== cluster Cluster
in = ClusterInput()
txt = Text(in)
pcdefval = DefaultValue(Value=txt, DefaultValue="This cluster is fed with an empty input")  # -> Output, DefaultUsed
txt_2 = Text(pcdefval.Output)
out = ClusterOutput(txt_2)
