# Grasshopper definition Quantity (for Rhino 6+7).gh (Grasshopper 1.0.7)
# Copyright: All rights reserved © 2018
# plug-ins: Pancake

pcmaintainvisapp = MaintainVisualAppearance(DpiScale=1, LastSaveLocalization="neutral,N")
pcparsestring = ParseString(String="500yard")  # -> Parsed, Type
panel = Panel(pcparsestring.Parsed)

# ---- group: Param Quantity
qty = Quantity()

# ----
qty_2 = Quantity(pcparsestring.Parsed)
qty_3 = Quantity(pcparsestring.Parsed)

# ----
# Quantity and Basics
# Quantity is an amount with a unit.
# Currently only length quantity is supported.
# You may create a length quantity by a decimal
# number, or a feet-inch string/text
# If the unit is not provided in the "Construct Quantity" component,
# document model unit would be used.
# You may deconstruct a quantity to its amount
# and unit. If the quantity is a feet-inch length,
# the feet amount is returned.
# You may adjust the precision of a quantity.
# 
# For decimal quantities, the precision is how
# many digits are preserved after the decimal
# point.
# 
# For feet and inch length, the precision is the
# minimal fraction to be preserved. e.g.
# Precision = 64 will yield 1/64" as the
# smallest stepping. Precision doesn't
# need to be a power of two.
number_slider = Slider(1.2345678, range=0..10)
pcparsestring_2 = ParseString(String="5' - 1 179/256\"")  # -> Parsed, Type
pcconqty = ConstructQuantity(Amount=number_slider, Unit="m", Precision=4)
pcconqty_2 = ConstructQuantity(Amount="500", Unit="m", Precision=4)
qty_4 = Quantity(pcconqty_2)
pcparsestring_3 = ParseString(String="5' 0 3/8\"")  # -> Parsed, Type
qty_5 = Quantity(pcparsestring_3.Parsed)
pcconqty_3 = ConstructQuantity(Amount="500", Precision=4)
panel_2 = Panel(pcconqty)
panel_3 = Panel(pcconqty_2)
panel_4 = Panel(pcparsestring_3.Parsed)
panel_5 = Panel(pcconqty_3)

# ---- group: Deconstruct Quantity
pcdeconqty = DeconstructQuantity(Quantity=qty_5)  # -> Amount, Unit, UnitType
pcdeconqty_2 = DeconstructQuantity(Quantity=qty_4)  # -> Amount, Unit, UnitType

# ---- group: Set Precision
pcsetprecision = SetPrecision(Quantity=pcparsestring_2.Parsed, Precision=Slider(19, range=1..100))  # -> AdjustedQuantity, LostAccuracy
pcsetprecision_2 = SetPrecision(Quantity=pcparsestring_2.Parsed, Precision=Slider(32, range=1..100))  # -> AdjustedQuantity, LostAccuracy
pcsetprecision_3 = SetPrecision(Quantity=pcconqty, Precision=Slider(2, range=0..10))  # -> AdjustedQuantity, LostAccuracy

# ----
panel_6 = Panel(pcdeconqty_2.Amount)
panel_7 = Panel(pcdeconqty.Amount)
panel_8 = Panel(pcdeconqty.Unit)
panel_9 = Panel(pcdeconqty_2.Unit)
panel_10 = Panel(pcdeconqty_2.UnitType)
panel_11 = Panel(pcsetprecision_3.AdjustedQuantity)
panel_12 = Panel(pcsetprecision_3.LostAccuracy)
panel_13 = Panel(pcsetprecision_2.AdjustedQuantity)
panel_14 = Panel(pcsetprecision_2.LostAccuracy)
panel_15 = Panel(pcsetprecision.AdjustedQuantity)
panel_16 = Panel(pcsetprecision.LostAccuracy)

# ----
# Quantity Conversions
# You may convert the type of length.
# (1) From one decimal to another
# (2) From feet-inch to decimal
# (3) From decimal to feet-inch
# (4) From document unit to feet-inch
# (5) From length quantity to document unit
qty_6 = Quantity(pcconqty_2)
qty_7 = Quantity(pcparsestring_3.Parsed)
qty_8 = Quantity(pcconqty_2)
qty_9 = Quantity(pcconqty_2)
qty_10 = Quantity(pcparsestring_3.Parsed)
panel_17 = Panel(qty_8)
panel_18 = Panel(qty_6)
panel_19 = Panel(qty_7)
panel_20 = Panel(qty_10)
panel_21 = Panel(qty_9)
num = Number(qty_6)
num_2 = Number(qty_7)
pctodecimallen = ToDecimalLength(Quantity=qty_8, Unit="mile")
pctofeetinchlen = ToFeetInchLength(Quantity=qty_9, Precision="128")
pctodecimallen_2 = ToDecimalLength(Quantity=qty_10, Unit="cm")
pctofeetinchlen_2 = ToFeetInchLength(Quantity=Slider(500, range=0..1000), Precision=64)
panel_22 = Panel(num)
panel_23 = Panel(num_2)
panel_24 = Panel(pctodecimallen)
panel_25 = Panel(pctofeetinchlen_2)
panel_26 = Panel(pctofeetinchlen)
panel_27 = Panel(pctodecimallen_2)

# ----
# Quantity Operators
# You may conduct arithmetic operations
# on quantity, even if they have different unit
# or different types. The resulting type will
# follow the first operand.
# 
# Supported operators are:
# (1) + and -
# between two quantities
# (2) * and /
# between a quantity and a number.
# For *, the order of quantity and number doesn't matter
# (3) / and \ and %
# between two quantities
# (4) Arithmatic comparison
# between two quantities
qty_11 = Quantity(pcconqty_2)
qty_12 = Quantity(pcparsestring.Parsed)
number_slider_2 = Slider(5, range=0..10)
qty_13 = Quantity(pcconqty_2)
qty_14 = Quantity(pcparsestring.Parsed)
qty_15 = Quantity(pcconqty_2)
qty_16 = Quantity(pcconqty_2)
qty_17 = Quantity(pcparsestring.Parsed)
panel_28 = Panel(qty_12)
panel_29 = Panel(qty_11)
panel_30 = Panel(qty_14)
panel_31 = Panel(qty_13)
panel_32 = Panel(qty_17)
panel_33 = Panel(qty_15)
panel_34 = Panel(qty_16)
larger = LargerThan(FirstNumber=qty_16, SecondNumber=qty_17)  # -> LargerThan, OrEqualTo
smaller = SmallerThan(FirstNumber=qty_16, SecondNumber=qty_17)  # -> SmallerThan, OrEqualTo
equals = Equality(FirstNumber=qty_16, SecondNumber=qty_17)  # -> Equality, Inequality
similar = Similarity(FirstNumber=qty_16, SecondNumber=qty_17, Threshold=Slider(15, range=0..100))  # -> Similarity, AbsoluteDifference
pcqtyop = QuantityOperator(OperandA=qty_15, OperandB=number_slider_2, Operator="/")
pcqtyop_2 = QuantityOperator(OperandA=qty_15, OperandB=number_slider_2, Operator="*")
pcqtyop_3 = QuantityOperator(OperandA=qty_11, OperandB=qty_12, Operator="+")
pcqtyop_4 = QuantityOperator(OperandA=qty_11, OperandB=qty_12, Operator="-")
pcqtyop_5 = QuantityOperator(OperandA=qty_13, OperandB=qty_14, Operator="/")
pcqtyop_6 = QuantityOperator(OperandA=qty_13, OperandB=qty_14, Operator="\")
pcqtyop_7 = QuantityOperator(OperandA=qty_13, OperandB=qty_14, Operator="%")
panel_35 = Panel(pcqtyop)
panel_36 = Panel(pcqtyop_2)
panel_37 = Panel(smaller.SmallerThan)
panel_38 = Panel(equals.Equality)
panel_39 = Panel(similar.Similarity)
panel_40 = Panel(pcqtyop_3)
panel_41 = Panel(pcqtyop_4)
panel_42 = Panel(larger.LargerThan)
panel_43 = Panel(pcqtyop_5)
panel_44 = Panel(pcqtyop_6)
panel_45 = Panel(pcqtyop_7)

# ----
# Quantity Operators (Rhino 6 only)
# You may also use the built-in operators
# to conduct arithmetic operations
# 
# This feature applys to Rhino6 and GH1 only.
# Rhino 5 user may use the Pancake operator.
# 
# Supported operators are:
# (1) + and -
# between two quantities
# (2) *
# between a quantity and a number.
# The order of quantity and number doesn't matter
# (3) Mass Addition and Multipilication
# Notice: Multiplying two quantities is not defined.
qty_18 = Quantity(pcconqty_2)
qty_19 = Quantity(pcparsestring.Parsed)
qty_20 = Quantity(pcconqty_2)
qty_21 = Quantity(pcconqty_2)
panel_46 = Panel(qty_19)
panel_47 = Panel(qty_18)
panel_48 = Panel(qty_20)
panel_49 = Panel(qty_21)
dup = DuplicateData(Data=Slider(2, range=0..10), Number=Slider(5, range=0..10), Order=True)
dup_2 = DuplicateData(Data=qty_21, Number=Slider(5, range=0..10), Order=True)
multiplication = Multiplication(A=qty_20, B=Slider(5, range=0..10))
addition = Addition(A=qty_18, B=qty_19)
subtraction = Subtraction(A=qty_18, B=qty_19)
merge = Merge(Data1=qty_21, Data2=dup)  # -> flatten(Result)
ma = MassAddition(Input=dup_2)  # -> Result, PartialResults
panel_50 = Panel(multiplication)
panel_51 = Panel(subtraction)
panel_52 = Panel(addition)
mm = MassMultiplication(Input=merge)  # -> Result, PartialResults
panel_53 = Panel(mm.Result)
panel_54 = Panel(mm.PartialResults)
panel_55 = Panel(ma.PartialResults)
panel_56 = Panel(ma.Result)

qty_22 = Quantity(pcconqty_2)
qty_23 = Quantity(pcconqty_2)

# ----
# Interoperability with other components
# Other than several built-in arithmatic
# operators in Rhino 6, no other built-in
# operators support Quantity. A length
# will be automatically converted to a document
# length if being casted to Integer, or Number.
# 
# Notice: Some component are MathComponent,
# but doesn't take Number as its input. In such
# cases, automatic conversion doesn't occur.
# (1) Because "Smaller Than" takes Number
# as input, so that quantities are converted.
# (2) Some components don't do so,
# so the output is not expected.
# In such cases, you may convert it manually.
# Here's a sample of formula evaluation and keepping the unit.
qty_24 = Quantity(pcconqty_2)
qty_25 = Quantity(pcparsestring.Parsed)
qty_26 = Quantity(pcparsestring.Parsed)
qty_27 = Quantity(pcconqty_2)
panel_57 = Panel(qty_22)
panel_58 = Panel(qty_3)
panel_59 = Panel(qty_2)
panel_60 = Panel(qty_23)
panel_61 = Panel(qty_24)
panel_62 = Panel(qty_25)
panel_63 = Panel(qty_27)
panel_64 = Panel(qty_26)
num_3 = Number(qty_25)
num_4 = Number(qty_24)
num_5 = Number(qty_27)
num_6 = Number(qty_26)
smaller_2 = SmallerThan(FirstNumber=qty_23, SecondNumber=qty_3)  # -> SmallerThan, OrEqualTo
expression = Expression(x=num_6, y=num_5, Expression="x/3+(x+y)/2")
pcdeconqty_3 = DeconstructQuantity(Quantity=qty_26)  # -> Amount, Unit, UnitType
expression_2 = Expression(x=qty_22, y=qty_2, Expression="x+y")
expression_3 = Expression(x=num_4, y=num_3, Expression="x+y")
panel_65 = Panel(smaller_2.SmallerThan)
panel_66 = Panel(expression_2)
panel_67 = Panel(expression_3)
pctodecimallen_3 = ToDecimalLength(Quantity=expression, Unit=pcdeconqty_3.Unit)
panel_68 = Panel(pctodecimallen_3)
