# Grasshopper definition XML Operations.gh (Grasshopper 1.0.7)
# plug-ins: Pancake

# ----
# @ is the magical keyword to represent in-node text content.
# It would be automatically enscaped & unescaped, unless in a CDATA block.
panel = Panel("""In-node content test
<EscapeTest/&>""")
panel_2 = Panel("""<![CDATA[In-node content test
<EscapeTest/&>]]>""")
pcconassoc = ConstructAssoc(_0=panel, LastSaveLocalization="neutral,N")
pcconassoc_2 = ConstructAssoc(_0=panel_2, LastSaveLocalization="neutral,N")
pcassoctoxml = AssocToXML(Assoc=pcconassoc, RootTag="Content", Expand=False, LastSaveLocalization="neutral,N")
pcassoctoxml_2 = AssocToXML(Assoc=pcconassoc_2, RootTag="Content", Expand=False, LastSaveLocalization="neutral,N")
panel_3 = Panel(pcassoctoxml_2)
panel_4 = Panel(pcassoctoxml)
pcxmltoassoc = XMLToAssoc(String=panel_4, LastSaveLocalization="neutral,N")  # -> Assoc, RootTag
pcxmltoassoc_2 = XMLToAssoc(String=panel_3, LastSaveLocalization="neutral,N")  # -> Assoc, RootTag
pcdeconassoc = DeconstructAssoc(Assoc=pcxmltoassoc.Assoc, LastSaveLocalization="neutral,N")
pcdeconassoc_2 = DeconstructAssoc(Assoc=pcxmltoassoc_2.Assoc, LastSaveLocalization="neutral,N")
panel_5 = Panel(pcdeconassoc)
panel_6 = Panel(pcdeconassoc_2)

# ----
# You may choose to "Headless"/"Compact"/"Expand" by right-click the component.
# Normal
# Headless
# Expand. As you can see data is put in sub-nodes instead of attributes.
# Force data to be put in attributes, in a expand mode, by adding an empty @.
# Normal Parsing. Sub-node content is stored in @
# Compact after parsing. Sub-node content is promoted to the parent node,
# if no other attributes are available.
# If other attributes exist, in-node content
# is put in @ regardless of compacting.
panel_7 = Panel("25")
panel_8 = Panel("""<?xml version="1.0" encoding="UTF-8"?>
<root>
<age type="youth">25</age>
</root>""")
pcconassoc_3 = ConstructAssoc(Age=panel_7, LastSaveLocalization="neutral,N")
pcconassoc_4 = ConstructAssoc(Age="25", LastSaveLocalization="neutral,N")
pcconassoc_5 = ConstructAssoc(Age="25", LastSaveLocalization="neutral,N")
pcconassoc_6 = ConstructAssoc(Age="25", LastSaveLocalization="neutral,N")
pcxmltoassoc_3 = XMLToAssoc(String=panel_8, CollapseAttributes=True, LastSaveLocalization="neutral,N")  # -> Assoc, RootTag
pcassoctoxml_3 = AssocToXML(Assoc=pcconassoc_3, RootTag="root", Expand=False, Headless=False, LastSaveLocalization="neutral,N")
pcassoctoxml_4 = AssocToXML(Assoc=pcconassoc_4, RootTag="root", Expand=False, Headless=True, LastSaveLocalization="neutral,N")
pcdeconassoc_3 = DeconstructAssoc(Assoc=pcxmltoassoc_3.Assoc, LastSaveLocalization="neutral,N")
pcassoctoxml_5 = AssocToXML(Assoc=pcconassoc_5, RootTag="root", Expand=True, Headless=False, LastSaveLocalization="neutral,N")
pcassoctoxml_6 = AssocToXML(Assoc=pcconassoc_6, RootTag="root", Expand=True, Headless=False, LastSaveLocalization="neutral,N")
panel_9 = Panel(pcassoctoxml_6)
panel_10 = Panel(pcassoctoxml_6)
pcxmltoassoc_4 = XMLToAssoc(String=panel_9, CollapseAttributes=True, LastSaveLocalization="neutral,N")  # -> Assoc, RootTag
pcxmltoassoc_5 = XMLToAssoc(String=panel_10, LastSaveLocalization="neutral,N")  # -> Assoc, RootTag
pcdeconassoc_4 = DeconstructAssoc(Assoc=pcxmltoassoc_4.Assoc, LastSaveLocalization="neutral,N")
pcdeconassoc_5 = DeconstructAssoc(Assoc=pcxmltoassoc_5.Assoc, LastSaveLocalization="neutral,N")
panel_11 = Panel(pcassoctoxml_3)
panel_12 = Panel(pcassoctoxml_4)
pcdeconassoc_6 = DeconstructAssoc(Assoc=pcdeconassoc_5, LastSaveLocalization="neutral,N")
panel_13 = Panel(pcassoctoxml_5)
panel_14 = Panel(pcassoctoxml_6)
pcdeconassoc_7 = DeconstructAssoc(Assoc=pcdeconassoc_3, LastSaveLocalization="neutral,N")  # -> Type, _1
panel_15 = Panel(pcdeconassoc_6)
panel_16 = Panel(pcdeconassoc_4)
panel_17 = Panel(pcdeconassoc_7._1)
panel_18 = Panel(pcdeconassoc_7.Type)

# ----
# A difference between Json and XML is the tag names cannot be arbitrary.
# Invalid name for XML.
panel_19 = Panel("Test")
pcconassoc_7 = ConstructAssoc(FancyFormattedName=panel_19, LastSaveLocalization="neutral,N")
pcassoctoxml_7 = AssocToXML(Assoc=pcconassoc_7, RootTag=panel_19, LastSaveLocalization="neutral,N")
pcassoctostring = AssocToString(Assoc=pcconassoc_7, Style="Json", LastSaveLocalization="neutral,N")
panel_20 = Panel(pcassoctostring)

# ----
# Here's a simple example.
# ^
# You can use "Parse String" to parse XML.
# However it's not recommended as it lacks
# some control over XML parsing.
panel_21 = Panel("Steven")
# XML Operations
# Pancake provides a unified way to read/write XML, just as Json with a few differences.
# Make sure you have gone through "Associative array and Json" first
# Besides, Pancake deals XML with great performance.
# In the testing environment, it takes 3 seconds to parse a ~500M XML file.
panel_22 = Panel("24")
pcconassoc_8 = ConstructAssoc(Age=panel_22, Name=panel_21, LastSaveLocalization="neutral,N")
pcconassoc_9 = ConstructAssoc(Age="25", Name="Joe", LastSaveLocalization="neutral,N")
pcwraplist = WrapList(Items=[pcconassoc_8, pcconassoc_9], LastSaveLocalization="neutral,N")
pcconassoc_10 = ConstructAssoc(People=pcwraplist, Type="Student", LastSaveLocalization="neutral,N")
pcassoctoxml_8 = AssocToXML(Assoc=pcconassoc_10, RootTag="database", Expand=False, LastSaveLocalization="neutral,N")
panel_23 = Panel(pcassoctoxml_8)
pcxmltoassoc_6 = XMLToAssoc(String=panel_23, CollapseAttributes=False, LastSaveLocalization="neutral,N")  # -> Assoc, RootTag
root_tag = Panel(pcxmltoassoc_6.RootTag)
pcdeconassoc_8 = DeconstructAssoc(Assoc=pcxmltoassoc_6.Assoc, LastSaveLocalization="neutral,N")  # -> Type, People
pcunwraplist = UnwrapList(AtomList=pcdeconassoc_8.People, LastSaveLocalization="neutral,N")
pcdeconassoc_9 = DeconstructAssoc(Assoc=pcunwraplist, LastSaveLocalization="neutral,N")  # -> Age, Name
panel_24 = Panel(pcdeconassoc_9.Name)
panel_25 = Panel(pcdeconassoc_9.Age)

pcmaintainvisapp = MaintainVisualAppearance(DpiScale=1, LastSaveLocalization="neutral,N")
data = Data(pcconassoc_10)
pcassoctocsv = AssocToCSV(Assoc=[pcconassoc_8, pcconassoc_9], Delimiter=",", LastSaveLocalization="neutral,N")
pcassoctostring_2 = AssocToString(Assoc=data, Style="Json", LastSaveLocalization="neutral,N")
# ^ Same data can be easily saved in JSON or XML
panel_26 = Panel(pcassoctostring_2)
# ^ Or CSV... for simpler data.
panel_27 = Panel(pcassoctocsv)

# ----
# You may choose what to import. (The data structure stays same).
# For an imported XML, nodes with same names are wrapped into a list,
# as shown in the "person" below.
# You will need to use Unwrap List to get contents.
# And you can also access data by data path using "Extract from Assoc",
# or by deconstrcuting the assoc to a certain level.
panel_28 = Panel("""<?xml version="1.0" encoding="UTF-8"?>
<root>
<asset />
<people>
<student>
<person name="Joe" />
<person name="Steven" />
</student>
<teacher>
<person name="Mary" />
<person name="Kyle" />
</teacher>
</people>
</root>""")
pcxmltoassoc_7 = XMLToAssoc(String=panel_28, LastSaveLocalization="neutral,N")  # -> Assoc, RootTag
pcassoctokv = AssocToKeyValues(Assoc=pcxmltoassoc_7.Assoc, Depth=Slider(3, range=0..10), LastSaveLocalization="neutral,N")  # -> Paths, Value
pcextractfromassoc = ExtractFromAssoc(Assoc=pcxmltoassoc_7.Assoc, Path="people/student/person", Delimiter="/", LastSaveLocalization="neutral,N")
pcextractfromassoc_2 = ExtractFromAssoc(Assoc=pcxmltoassoc_7.Assoc, Path="people/student/person/1", Delimiter="/", LastSaveLocalization="neutral,N")
panel_29 = Panel(pcassoctokv.Value)
panel_30 = Panel(pcassoctokv.Paths)
pcxmltoassoc_8 = XMLToAssoc(String=panel_28, KeyPaths="people/student", LastSaveLocalization="neutral,N")  # -> Assoc, RootTag
pcdeconassoc_10 = DeconstructAssoc(Assoc=pcxmltoassoc_8.Assoc, LastSaveLocalization="neutral,N")
panel_31 = Panel(pcextractfromassoc_2)
panel_32 = Panel(pcextractfromassoc)
pcdeconassoc_11 = DeconstructAssoc(Assoc=pcdeconassoc_10, LastSaveLocalization="neutral,N")
pcdeconassoc_12 = DeconstructAssoc(Assoc=pcdeconassoc_11, LastSaveLocalization="neutral,N")

# ---- group: You need to Unwrap List here
pcunwraplist_2 = UnwrapList(AtomList=pcdeconassoc_12, LastSaveLocalization="neutral,N")

# ----
panel_33 = Panel(pcunwraplist_2)
