# Grasshopper definition dendro_conversion.gh (Grasshopper 0.9.76)
# plug-ins: DendroGH

vsettings = VolumeSettings(
    VoxelSize=Slider(0.3, range=0.05..1),
    Bandwidth=Slider(1, range=0..10),
    Isovalue=Slider(0, range=0..1),
    Adaptivity=Slider(0.05, range=0..1))
vsettings_2 = VolumeSettings(vsettings)

pt = Point([Point(-14.87967397, 7.877583172, 0), Point(-14.76157047, 7.753021168, 0), Point(-14.6458842, 7.626211499, 0), Point(-14.53283195, 7.497048397, 0), Point(-14.42265581, 7.365424442, 0), Point(-14.31562497, 7.231230923, 0)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])
dom = ConstructDomain(DomainStart=Slider(0.5, range=0..5), DomainEnd=Slider(2, range=0..5))
range = Range(Domain=dom, Steps=99)
vsettings_3 = VolumeSettings(vsettings_2)
vpoints = PointsToVolume(Points=pt, PointRadius=range, VolumeSettings=vsettings_3)
volume = Volume(vpoints)

crv = Curve(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)
vsettings_4 = VolumeSettings(vsettings_2)
vcurve = CurveToVolume(Curves=crv, CurveRadius=Slider(2, range=0..10), Settings=vsettings_4)
volume_2 = Volume(vcurve)

mesh = Mesh(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)
vsettings_5 = VolumeSettings(vsettings_2)
vmesh = MeshToVolume(Mesh=mesh, Settings=vsettings_5)
volume_3 = Volume(vmesh)

volume_4 = Volume(volume_2)
volume_5 = Volume(volume_3)
volume_6 = Volume(volume)
move = Move(Geometry=[volume_4, volume_6, volume_5], Motion=Vector(0, 20, 0))  # -> flatten(Geometry), Transform
vsettings_6 = VolumeSettings(vsettings_2)
volume_7 = Volume(move.Geometry)
mvolume = VolumeToMesh(Volume=volume_7, VolumeSettings=vsettings_6)
preview = CustomPreview(
    Geometry=mvolume,
    Shader={ambient=RGB(128, 128, 128), diffuse=RGB(32, 132, 178), emission=RGB(0, 0, 0), shine=0.1, specular=RGB(246, 250, 135), transparency=0})
