# Grasshopper definition dendro_csg.gh (Grasshopper 0.9.76)
# plug-ins: DendroGH

vsettings = VolumeSettings(
    VoxelSize=Slider(0.5, range=0..1),
    Bandwidth=Slider(1, range=0..10),
    Isovalue=Slider(0, range=0..1),
    Adaptivity=Slider(0.05, range=0..1))
vsettings_2 = VolumeSettings(vsettings)

mesh = Mesh(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)
vsettings_3 = VolumeSettings(vsettings_2)
mesh_2 = Mesh(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)
vsettings_4 = VolumeSettings(vsettings_2)
vmesh = MeshToVolume(Mesh=mesh, Settings=vsettings_3)
vmesh_2 = MeshToVolume(Mesh=mesh_2, Settings=vsettings_4)
vunion = VolumeUnion(Volumes=[vmesh, vmesh_2])
volume = Volume(vunion)
preview = CustomPreview(
    Geometry=volume,
    Shader={ambient=RGB(128, 128, 128), diffuse=RGB(32, 132, 178), emission=RGB(0, 0, 0), shine=0.1, specular=RGB(246, 250, 135), transparency=0})

mesh_3 = Mesh(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)
vsettings_5 = VolumeSettings(vsettings_2)
mesh_4 = Mesh(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)
vsettings_6 = VolumeSettings(vsettings_2)
vmesh_3 = MeshToVolume(Mesh=mesh_3, Settings=vsettings_5)
vmesh_4 = MeshToVolume(Mesh=mesh_4, Settings=vsettings_6)
vdiff = VolumeDifference(VolumeA=vmesh_3, VolumesB=vmesh_4)
volume_2 = Volume(vdiff)
preview_2 = CustomPreview(
    Geometry=volume_2,
    Shader={ambient=RGB(128, 128, 128), diffuse=RGB(32, 132, 178), emission=RGB(0, 0, 0), shine=0.1, specular=RGB(246, 250, 135), transparency=0})

vsettings_7 = VolumeSettings(vsettings_2)
vsettings_8 = VolumeSettings(vsettings_2)
mesh_5 = Mesh(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)
mesh_6 = Mesh(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)
vmesh_5 = MeshToVolume(Mesh=mesh_5, Settings=vsettings_7)
vmesh_6 = MeshToVolume(Mesh=mesh_6, Settings=vsettings_8)
vint = VolumeIntersection(VolumeA=vmesh_5, VolumesB=vmesh_6)
volume_3 = Volume(vint)
preview_3 = CustomPreview(
    Geometry=volume_3,
    Shader={ambient=RGB(128, 128, 128), diffuse=RGB(32, 132, 178), emission=RGB(0, 0, 0), shine=0.1, specular=RGB(246, 250, 135), transparency=0})
