# Grasshopper definition dendro_filters.gh (Grasshopper 0.9.76)
# plug-ins: DendroGH

vsettings = VolumeSettings(
    VoxelSize=Slider(0.3, range=0.05..1),
    Bandwidth=Slider(1, range=0..10),
    Isovalue=Slider(0, range=0..1),
    Adaptivity=Slider(0.05, range=0..1))
vsettings_2 = VolumeSettings(vsettings)

mesh = Mesh(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)
crv = Curve(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)
vsettings_3 = VolumeSettings(vsettings_2)
vsettings_4 = VolumeSettings(vsettings_2)
vmesh = MeshToVolume(Mesh=mesh, Settings=vsettings_3)
vcurve = CurveToVolume(Curves=crv, CurveRadius=Slider(2, range=0..10), Settings=vsettings_4)
neg = Negative(Value=Slider(0.5, range=0.01..1))
mask = CreateMask(Volume=vcurve, MinValue=neg, MaxValue=Slider(0.01, range=0.01..1), MaskInvert=Toggle(True))
list = ValueList({"gaussian": 0, "laplacian": 1, "mean": 2, "median": 3}, selected="mean")
vsmooth = SmoothVolume(Volume=vmesh, Width=Slider(2, range=1..10), Type=list, Iterations=Slider(5, range=1..15), Mask=mask)
volume = Volume(vsmooth)
preview = CustomPreview(
    Geometry=volume,
    Shader={ambient=RGB(128, 128, 128), diffuse=RGB(32, 132, 178), emission=RGB(0, 0, 0), shine=0.1, specular=RGB(246, 250, 135), transparency=0})

mesh_2 = Mesh(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)
vsettings_5 = VolumeSettings(vsettings_2)
vmesh_2 = MeshToVolume(Mesh=mesh_2, Settings=vsettings_5)
move = Move(Geometry=vmesh_2, Motion=Vector(0, -5.774648709, 0))  # -> Geometry, Transform
vblend = VolumeBlend(VolumeA=vmesh_2, VolumeB=move.Geometry, Parameter=Slider(0.3, range=0..1), EndTime=Slider(20, range=0..50))
vsmooth_2 = SmoothVolume(Volume=vblend, Width=2, Type=2, Iterations=5)
volume_2 = Volume(vsmooth_2)
preview_2 = CustomPreview(
    Geometry=volume_2,
    Shader={ambient=RGB(128, 128, 128), diffuse=RGB(32, 132, 178), emission=RGB(0, 0, 0), shine=0.1, specular=RGB(246, 250, 135), transparency=0})

list_2 = ValueList({"gaussian": 0, "laplacian": 1, "mean": 2, "median": 3}, selected="gaussian")
mesh_3 = Mesh(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)
vsettings_6 = VolumeSettings(vsettings_2)
vmesh_3 = MeshToVolume(Mesh=mesh_3, Settings=vsettings_6)
vsmooth_3 = SmoothVolume(Volume=vmesh_3, Width=Slider(1, range=1..10), Type=list_2, Iterations=Slider(3, range=1..15))
volume_3 = Volume(vsmooth_3)
preview_3 = CustomPreview(
    Geometry=volume_3,
    Shader={ambient=RGB(128, 128, 128), diffuse=RGB(32, 132, 178), emission=RGB(0, 0, 0), shine=0.1, specular=RGB(246, 250, 135), transparency=0})

mesh_4 = Mesh(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)
vsettings_7 = VolumeSettings(vsettings_2)
vmesh_4 = MeshToVolume(Mesh=mesh_4, Settings=vsettings_7)
voffset = OffsetVolume(Volume=vmesh_4, Distance=Slider(2.18, range=0..5))
bbox = BoundingBox(Content=voffset, Plane=PlaneXY(0, 0, 0), UnionBox=True)  # -> Box, Box_2
merge = Merge(Data1=flatten(vmesh_4), Data2=flatten(voffset))
volume_4 = Volume(Geometry=bbox.Box)  # -> Volume, Centroid
vsmooth_4 = SmoothVolume(Volume=merge, Width=1, Type=0, Iterations=3)
scale = Scale(Geometry=voffset, Center=volume_4.Centroid, Factor=1.3)  # -> Geometry, Transform
item = ListItem(List=vsmooth_4, Index=0, Wrap=True)  # -> Item, Item1
move_2 = Move(Geometry=scale.Geometry, Motion=Vector(0, 0, 10))  # -> Geometry, Transform
vdiff = VolumeDifference(VolumeA=item.Item1, VolumesB=item.Item)
vdiff_2 = VolumeDifference(VolumeA=vdiff, VolumesB=move_2.Geometry)
volume_5 = Volume(vdiff_2)
preview_4 = CustomPreview(
    Geometry=volume_5,
    Shader={ambient=RGB(128, 128, 128), diffuse=RGB(32, 132, 178), emission=RGB(0, 0, 0), shine=0.1, specular=RGB(246, 250, 135), transparency=0})
