# Grasshopper definition dendro_lattice.gh (Grasshopper 0.9.76)
# plug-ins: DendroGH

vsettings = CreateSettings(VoxelSize=Slider(0.4, range=0..1), Bandwidth=1, Isovalue=Slider(0.01, range=0..0.01), Adaptivity=Slider(0.1, range=0..1))
vsettings_2 = VolumeSettings(vsettings)

number_slider = Slider(3, range=0..10)
crv = Curve([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])
bbox = BoundingBox(Content=crv, Plane=PlaneXY(0, 0, 0), UnionBox=True)  # -> Box, Box_2
arrbox = BoxArray(Geometry=crv, Cell=bbox.Box, XCount=number_slider, YCount=number_slider, ZCount=number_slider)  # -> Geometry, Transform
divide = DivideCurve(Curve=arrbox.Geometry, Count=100, Kinks=False)  # -> flatten(Points), Tangents, Parameters
pt = Point(Point(-28.34181773, -30.23517135, 70.53868588))
lng = ListLength(List=divide.Points)
subtraction = Subtraction(A=lng, B=1)
dist = Distance(PointA=pt, PointB=divide.Points)
dots = DotDisplay(Point=pt, Colour=RGB(255, 0, 0), Size=0.5)
dom = ConstructDomain(DomainStart=Slider(0.6, range=0..2), DomainEnd=Slider(1.5, range=0..2))
range = Range(Domain=dom, Steps=subtraction)
sort = SortList(Keys=dist, ValuesA=divide.Points)  # -> Keys, ValuesA
vsettings_3 = VolumeSettings(vsettings_2)
vpoints = PointsToVolume(Points=sort.ValuesA, PointRadius=range, Settings=vsettings_3)
vsmooth = SmoothVolume(Volume=vpoints, Width=1, Type=2, Iterations=1)
vsettings_4 = VolumeSettings(vsettings_2)
mvolume = VolumeToMesh(Volume=vsmooth, VolumeSettings=vsettings_4)
preview = CustomPreview(
    Geometry=mvolume,
    Material={ambient=RGB(128, 128, 128), diffuse=RGB(81, 135, 237), emission=RGB(0, 0, 0), shine=0, specular=RGB(138, 138, 76), transparency=0})
