# Grasshopper definition dendro_native_components.gh (Grasshopper 0.9.76)
# plug-ins: DendroGH

vsettings = VolumeSettings(
    VoxelSize=Slider(0.35, range=0.05..1),
    Bandwidth=Slider(1, range=0..10),
    Isovalue=Slider(0.001, range=0..1),
    Adaptivity=Slider(0, range=0..1))
vsettings_2 = VolumeSettings(vsettings)

mesh = Mesh(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)
vsettings_3 = VolumeSettings(vsettings_2)
list = ValueList({"gaussian": 0, "laplacian": 1, "mean": 2, "median": 3}, selected="gaussian")
vmesh = MeshToVolume(Mesh=mesh, Settings=vsettings_3)
vsmooth = SmoothVolume(Volume=vmesh, Width=Slider(3, range=0..10), Type=list, Iterations=1)
mesh_2 = Mesh(vsmooth)
demesh = DeconstructMesh(Mesh=mesh_2)  # -> Vertices, Faces, Colours, Normals
cull = CullPattern(List=demesh.Vertices, CullPattern=[False, True, False, False, False, False, False])
cull_2 = CullPattern(List=demesh.Vertices, CullPattern=[True, False, False, False, False, False])
vsettings_4 = VolumeSettings(vsettings_2)
vsettings_5 = VolumeSettings(vsettings_2)
vpoints = PointsToVolume(Points=cull_2, PointRadius=Slider(0.55, range=0..1), Settings=vsettings_4)
vpoints_2 = PointsToVolume(Points=cull, PointRadius=Slider(0.55, range=0..1), Settings=vsettings_5)
vunion = VolumeUnion(Volumes=[vpoints, vpoints_2])
volume = Volume(vunion)
preview = CustomPreview(
    Geometry=volume,
    Shader={ambient=RGB(128, 128, 128), diffuse=RGB(32, 132, 178), emission=RGB(0, 0, 0), shine=0.1, specular=RGB(246, 250, 135), transparency=0})

crv = Curve([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])
number_slider = Slider(3, range=0..10)
vsettings_6 = VolumeSettings(vsettings_2)
bbox = BoundingBox(Content=crv, Plane=PlaneXY(0, 0, 0), UnionBox=True)  # -> Box, Box_2
vcurve = CurveToVolume(Curves=crv, CurveRadius=Slider(0.58, range=0..1), Settings=vsettings_6)
arrbox = BoxArray(Geometry=vcurve, Cell=bbox.Box, XCount=number_slider, YCount=number_slider, ZCount=number_slider)  # -> Geometry, Transform
vunion_2 = VolumeUnion(Volumes=arrbox.Geometry)
volume_2 = Volume(vunion_2)
preview_2 = CustomPreview(
    Geometry=volume_2,
    Shader={ambient=RGB(128, 128, 128), diffuse=RGB(32, 132, 178), emission=RGB(0, 0, 0), shine=0.1, specular=RGB(246, 250, 135), transparency=0})

mesh_3 = Mesh(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)
vsettings_7 = VolumeSettings(vsettings_2)
vmesh_2 = MeshToVolume(Mesh=mesh_3, Settings=vsettings_7)
bbox_2 = BoundingBox(Content=vmesh_2, Plane=PlaneXY(0, 0, 0))  # -> Box, Box_2
volume_3 = Volume(Geometry=bbox_2.Box)  # -> Volume, Centroid
rad = Radians(Degrees=[Slider(30, range=0..100), Slider(60, range=0..100), Slider(90, range=0..100)])
vec = VectorXYZ(XComponent=1, YComponent=1, ZComponent=1)  # -> Vector, Length
rot3d = Rotate3D(Geometry=vmesh_2, Angle=rad, Center=volume_3.Centroid, Axis=vec.Vector)  # -> Geometry, Transform
vunion_3 = VolumeUnion(Volumes=flatten([rot3d.Geometry, vmesh_2]))
Y = UnitY(Factor=Slider(4, range=0..10))
arrlinear = LinearArray(Geometry=vunion_3, Direction=Y, Count=Slider(6, range=0..10))  # -> Geometry, Transform
vunion_4 = VolumeUnion(Volumes=arrlinear.Geometry)
volume_4 = Volume(vunion_4)
preview_3 = CustomPreview(
    Geometry=volume_4,
    Shader={ambient=RGB(128, 128, 128), diffuse=RGB(32, 132, 178), emission=RGB(0, 0, 0), shine=0.1, specular=RGB(246, 250, 135), transparency=0})
