# Grasshopper definition Grid Distortion.gh (Grasshopper 1.0.7)

point = Point([<point referenced from the Rhino model> x4])
number_slider = Slider(0.5, range=0..1)
number_slider_2 = Slider(45, range=0..100)
point_charge = PointCharge(Point=point, Charge=Slider(0.35, range=0..1), Decay=Slider(0.8, range=0..10))
# Reference Points
point_2 = Point([<point referenced from the Rhino model> x4])
merge_fields = MergeFields(Fields=point_charge)
square = Square(Plane=PlaneXY(0, 0, 0), Size=number_slider, ExtentX=number_slider_2, ExtentY=number_slider_2)  # -> Cells, Points
square_2 = Square(Plane=PlaneXY(0, 0, 0), Size=number_slider, ExtentX=number_slider_2, ExtentY=number_slider_2)  # -> Cells, Points
panel = Panel(square.Points)
point_charge_2 = PointCharge(Point=point_2, Charge=Slider(1, range=0..1), Decay=Slider(1.5, range=0..10))
distance = Distance(PointA=flatten(square_2.Points), PointB=point)
point_3 = Point(flatten(square_2.Points))
point_4 = Point(flatten(square.Points))
panel_2 = Panel(point_charge_2)
evaluate_field = EvaluateField(Field=merge_fields, Point=point_3)  # -> Tensor, Strength
vector_length = VectorLength(Vector=evaluate_field.Tensor)
merge_fields_2 = MergeFields(Fields=point_charge_2)
bounds = Bounds(Numbers=distance)
panel_3 = Panel(point_4)
minimum = Minimum(A=vector_length, B=Slider(13, range=0..100))
panel_4 = Panel(merge_fields_2)
evaluate_field_2 = EvaluateField(Field=merge_fields_2, Point=point_4)  # -> Tensor, Strength
remap_numbers = RemapNumbers(Value=distance, Source=bounds, Target=minimum)  # -> Mapped, Clipped
amplitude = Amplitude(Vector=evaluate_field.Tensor, Amplitude=remap_numbers.Mapped)
panel_5 = Panel(evaluate_field_2.Tensor)
vector_length_2 = VectorLength(Vector=evaluate_field_2.Tensor)
panel_6 = Panel(vector_length_2)
move = Move(Geometry=flatten(square_2.Points), Motion=amplitude)  # -> Geometry, Transform
minimum_2 = Minimum(A=vector_length_2, B=Slider(0.5, range=0..3))
panel_7 = Panel(minimum_2)
amplitude_2 = Amplitude(Vector=evaluate_field_2.Tensor, Amplitude=minimum_2)
move_2 = Move(Geometry=point_4, Motion=amplitude_2)  # -> Geometry, Transform
panel_8 = Panel(move_2.Geometry)
unflatten_tree = UnflattenTree(Tree=move_2.Geometry, Guide=square.Points)
flip_matrix = FlipMatrix(Data=unflatten_tree)
interpolate = Interpolate(Vertices=flip_matrix, Degree=3, Periodic=False, KnotStyle=1)  # -> Curve, Length, Domain
interpolate_2 = Interpolate(Vertices=unflatten_tree, Degree=3, Periodic=False, KnotStyle=1)  # -> Curve, Length, Domain
panel_9 = Panel(interpolate_2.Curve)
