# Grasshopper definition Hexagonal Morphies.gh (Grasshopper 1.0.4)
# plug-ins: LunchBox

surface = Surface(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)
offset = Offset(Surface=surface, Distance=Slider(3, range=0..10), Retrim=True)
hexagonal_structure = HexagonalStructure(Surface=surface, UDivisions=10, VDivisions=10, AdjustShape=0.3, Type=False)  # -> graft(StructureLines), StructureNodes
hexagonal_structure_2 = HexagonalStructure(Surface=offset, UDivisions=10, VDivisions=10, AdjustShape=0.3, Type=False)  # -> graft(StructureLines), StructureNodes
loft = Loft(
    Curves=[hexagonal_structure_2.StructureLines, hexagonal_structure.StructureLines],
    Options={Adjust=False, Closed=False, LoftEnds=0, LoftSimp=0, LoftType=0, Rebuild=10, Refit=0.01})
