# Grasshopper definition Insulation Pattern.gh (Grasshopper 1.0.7)

number_slider = Slider(24, range=0..100)
curve = Curve(<curve referenced from the Rhino model>)
curve_2 = Curve(<curve referenced from the Rhino model>)
flip_curve = FlipCurve(Curve=curve)  # -> Curve, Flag
divide_curve = DivideCurve(Curve=curve, Count=number_slider, Kinks=False)  # -> Points, Tangents, Parameters
divide_curve_2 = DivideCurve(Curve=curve_2, Count=number_slider, Kinks=False)  # -> Points, Tangents, Parameters
reverse_list = ReverseList(List=divide_curve_2.Points)
weave = Weave(Pattern=[0, 1], Stream0=divide_curve.Points, Stream1=divide_curve_2.Points, NullGaps=False)
tangent_curve = TangentCurve(Vertices=weave, Tangents=[divide_curve.Tangents, divide_curve_2.Tangents], Blend=Slider(0.416, range=-1..1), Degree=3)  # -> Curve, Length, Domain
