# Grasshopper definition Kuka_Template (1).gh (Grasshopper 0.9.76)
# plug-ins: KUKA|prc - parametric robot control

# Input your points for toolpath
points_for_toolpath = Point([<point referenced from the Rhino model> x2])

# ----
# Note: all dimesions are in millimeters
# Drawing lines perpdicular to the page
panel = Panel("-90")
rad = Radians(Degrees=panel)
xz = XZPlane(Origin=points_for_toolpath)
rotate = Rotate(Geometry=xz, Angle=rad, Plane=xz)  # -> Geometry, Transform

# ----
# Remember to adjust
# the tool length after
# measuring the length
# of the pen in the collet
# (double click "set tool"
# and adjust tool z value)
custom_tool = CustomToolForKUKAPrc(toolid=14, toolvala=0, toolvalb=0, toolvalc=0, toolvalx=-0.587, toolvaly=6.74, toolvalz=275.822, valuesset=True)
lin_move = KUKAPrcLINearMovement(TargetAsPlane=rotate.Geometry, extaxenabled=False, impedancemode=False, interpolation="C_DIS")
kuka_kr30_60 = KUKAKR3060HA(highresactive=False, infiniterot=False)
kuka_prc = KUKAPrcCORE(
    SimulationSlider=Slider(0.34, range=0..1),
    KUKAPrcCommands=lin_move,
    KUKAPrcTool=custom_tool,
    KUKAPrcRobot=kuka_kr30_60,
    acc_cp=nan,
    acc_ptp=-1,
    basea=0,
    baseb=0,
    basec=0,
    baseindex=0,
    basex=0,
    basey=0,
    basez=0,
    camrobformatting="""&ACCESS RVP
&REL 1
&PARAM TEMPLATE = C:\KRC\Roboter\Template\vorgabe
&PARAM EDITMASK = *
[PROJECTNAME]

[SPLITDEFS]

;FOLD INI
;FOLD BASISTECH INI
GLOBAL INTERRUPT DECL 3 WHEN $STOPMESS==TRUE DO IR_STOPM ( )
INTERRUPT ON 3
BAS (#INITMOV,0 )
;ENDFOLD (BASISTECH INI)
;ENDFOLD (INI)

[STARTAXPOS]

[SETPARAMETERS]

[COMMANDS]

END""",
    camrobon=False,
    checkallcolls=False,
    enda01=5,
    enda02=-90,
    enda03=100,
    enda04=5,
    enda05=10,
    enda06=-5,
    ende01=0,
    ende02=0,
    ende03=0,
    ende04=0,
    endindex=0,
    haltatend=False,
    hash=26851,
    initialstatus="110",
    int_advance=3,
    int_cdis=nan,
    int_cori=nan,
    int_cptp=-1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)  # -> RobotGeometry, AnalysisOutput
