# Grasshopper definition Labeling Panels.gh (Grasshopper 1.0.7)
# plug-ins: Pufferfish

curve = Curve([<curve referenced from the Rhino model> x5000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])
bounding_box = BoundingBox(Content=curve, Plane=PlaneXY(0, 0, 0))  # -> Box, Box_2
area = Area(Geometry=bounding_box.Box)  # -> Area, Centroid
point = Point(<point referenced from the Rhino model>)
deconstruct = Deconstruct(Point=area.Centroid)  # -> XComponent, YComponent, ZComponent
deconstruct_2 = Deconstruct(Point=point)  # -> XComponent, YComponent, ZComponent
panel = Panel(deconstruct_2.XComponent)
round_to_decimal_place = RoundToDecimalPlace(NumberX=deconstruct.XComponent, DecimalPlace="0", RoundType=0)  # -> Rounded, Difference
similarity = Similarity(FirstNumber=round_to_decimal_place.Rounded, SecondNumber=panel, Threshold=Slider(0.1, range=0..0.1))  # -> Similarity, AbsoluteDifference
panel_2 = Panel(round_to_decimal_place.Rounded)
panel_3 = Panel(similarity.Similarity)
dispatch = Dispatch(List=area.Centroid, DispatchPattern=similarity.Similarity)  # -> ListA, ListB

deconstruct_3 = Deconstruct(Point=dispatch.ListB)  # -> XComponent, YComponent, ZComponent
larger_than = LargerThan(FirstNumber=deconstruct_3.XComponent, SecondNumber=panel)  # -> LargerThan, OrEqualTo

dispatch_2 = Dispatch(List=dispatch.ListB, DispatchPattern=larger_than.LargerThan)  # -> ListA, ListB
number_slider = Slider(0, range=0..100)
point_2 = Point(dispatch_2.ListB)
deconstruct_4 = Deconstruct(Point=point_2)  # -> XComponent, YComponent, ZComponent
point_3 = Point(dispatch.ListA)
round_to_decimal_place_2 = RoundToDecimalPlace(NumberX=deconstruct_4.YComponent, DecimalPlace=number_slider, RoundType=0)  # -> Rounded, Difference
deconstruct_5 = Deconstruct(Point=point_3)  # -> XComponent, YComponent, ZComponent
list_length = ListLength(List=point_3)
series = Series(Start="1", Step=1, Count=list_length)
round = RoundToIncrements(values=round_to_decimal_place_2.Rounded, factor=Slider(4, range=0..10))
round_to_decimal_place_3 = RoundToDecimalPlace(NumberX=deconstruct_5.YComponent, DecimalPlace=number_slider, RoundType=0)  # -> Rounded, Difference
point_4 = Point(dispatch_2.ListA)
create_set = CreateSet(List=round)  # -> Set, Map
deconstruct_6 = Deconstruct(Point=point_4)  # -> XComponent, YComponent, ZComponent
concatenate = Concatenate(Fragment_A=series, Fragment_B="-", A="C")
panel_4 = Panel("2")
sort_list = SortList(Keys=create_set.Set)  # -> Keys, ValuesValuesA
round_to_decimal_place_4 = RoundToDecimalPlace(NumberX=deconstruct_6.YComponent, DecimalPlace=number_slider, RoundType=0)  # -> Rounded, Difference
sort_list_2 = SortList(Keys=round_to_decimal_place_3.Rounded, ValuesValuesA=point_3)  # -> Keys, ValuesValuesA
round_2 = RoundToIncrements(values=round_to_decimal_place_4.Rounded, factor=Slider(5, range=0..10))
member_index = MemberIndex(Set=round, Member=sort_list.Keys)  # -> Index, Count
create_set_2 = CreateSet(List=round_2)  # -> Set, Map
list_item = ListItem(List=point_2, Index=member_index.Index, Wrap=True)
sort_list_3 = SortList(Keys=create_set_2.Set)  # -> Keys, ValuesValuesA
list_length_2 = ListLength(List=list_item)
deconstruct_7 = Deconstruct(Point=list_item)  # -> XComponent, YComponent, ZComponent
member_index_2 = MemberIndex(Set=round_2, Member=sort_list_3.Keys)  # -> Index, Count
flip_matrix = FlipMatrix(Data=list_length_2)
list_item_2 = ListItem(List=point_4, Index=member_index_2.Index, Wrap=True)
list_length_3 = ListLength(List=flip_matrix)
deconstruct_8 = Deconstruct(Point=list_item_2)  # -> XComponent, YComponent, ZComponent
list_length_4 = ListLength(List=deconstruct_8.XComponent)
flip_matrix_2 = FlipMatrix(Data=list_length_4)
series_2 = Series(Start="1", Step=1, Count=flip_matrix)
series_3 = Series(Start="1", Step=1, Count=list_length_3)
sort_list_4 = SortList(Keys=deconstruct_8.XComponent, ValuesValuesA=list_item_2)  # -> Keys, ValuesValuesA
list_length_5 = ListLength(List=flip_matrix_2)
sort_list_5 = SortList(Keys=deconstruct_7.XComponent, ValuesValuesA=list_item)  # -> Keys, reverse(ValuesValuesA)
flip_matrix_3 = FlipMatrix(Data=series_3)
series_4 = Series(Start="1", Step=1, Count=list_length_5)
series_5 = Series(Start="1", Step=1, Count=flip_matrix_2)
concatenate_2 = Concatenate(Fragment_A=flip_matrix_3, Fragment_B="-", A="S", B=series_2)
flip_matrix_4 = FlipMatrix(Data=series_4)
panel_5 = Panel(deconstruct_7.XComponent)
number_slider_2 = Slider(39.62, range=0..100)
concatenate_3 = Concatenate(Fragment_A=flip_matrix_4, Fragment_B="N", A="-", B=series_5)
text_tag_3d = TextTag3D(Location=sort_list_4.ValuesValuesA, Text=concatenate_3, Size=number_slider_2, Justification=5)
text_tag_3d_2 = TextTag3D(Location=sort_list_2.ValuesValuesA, Text=concatenate, Size=number_slider_2, Justification=5)
text_tag_3d_3 = TextTag3D(Location=sort_list_5.ValuesValuesA, Text=concatenate_2, Size=number_slider_2, Justification=5)

# ==== cluster RoundToIncrements: Round Number to nearst number on a multiplication table of factor
factor = ClusterInput()  # Rounding Factor
values = ClusterInput()  # Values to be Rounded
num = Number(factor)
num_2 = Number(values)
expression = Expression(x=num_2, y=num, Expression="y*Cint(x/y)")
num_3 = Number(expression)
rounded_values = ClusterOutput(num_3)
