# Grasshopper definition Mapping Surface.gh (Grasshopper 1.0.4)

number_slider = Slider(10, range=0..10)
hexagonal = Hexagonal(Plane=PlaneXY(0, 0, 0), Size=1, ExtentX=5, ExtentY=5)  # -> Cells, Points
hexagonal_2 = Hexagonal(
    Plane=PlaneXY(0, 0, 0),
    Size=Slider(11, range=0..100),
    ExtentX=Slider(80, range=0..100),
    ExtentY=Slider(12, range=0..100))  # -> Cells, Points
bounding_box = BoundingBox(Content=flatten(hexagonal_2.Cells), Plane=PlaneXY(0, 0, 0), UnionBox=True)  # -> Box, Box_2
surface = Surface(<surface referenced from the Rhino model>)
map_to_surface = MapToSurface(Curve=hexagonal_2.Cells, Source=bounding_box.Box, Target=surface)
