# Grasshopper definition Minimal Surface Setup.gh (Grasshopper 1.0.7)
# plug-ins: Kangaroo Components, Weaverbird, Kangaroo2 Components

catmull_clark_1_subd = Slider(1, range=0..10)
catmull_clark_2_subd = Slider(3, range=0..10)
mesh_surface_division = Slider(3, range=0..10)
mesh_thickness = Slider(0.25, range=0..1)
length_factor = Slider(0.18, range=0..1)

# ---- group: Brep to Mesh Surface
brep = Brep(<brep referenced from the Rhino model>)
deconstruct_brep = DeconstructBrep(Brep=brep)  # -> Faces, Edges, Vertices
mesh_surface = MeshSurface(
    Surface=deconstruct_brep.Faces,
    UCount=mesh_surface_division,
    VCount=mesh_surface_division,
    Overhang=True,
    Equalize=False)

# ----
weaverbird_s_join_meshes_and_weld = WeaverbirdsJoinMeshesAndWeld(Mesh=mesh_surface, Weld=True)

# ---- group: Knagaroo Physics
nakedvertices = NakedVertices(Mesh=weaverbird_s_join_meshes_and_weld)  # -> ClothedIndex, NakedIndex, ClothedPts, NakedPts
edgelengths = EdgeLengths(Mesh=weaverbird_s_join_meshes_and_weld, LengthFactor=length_factor, Strength=1)
show = Show(G=weaverbird_s_join_meshes_and_weld)
point = Point(nakedvertices.NakedPts)
anchor = Anchor(Point=point, Strength=10000)
merge = Merge(Data1=show, Data2=edgelengths, Data3=anchor)  # -> flatten(Result)
bouncysolver = BouncySolver(GoalObjects=merge, Reset=Button(), Threshold=1e-15, Tolerance=0.01, Damping=0.99, Iterations=10, On=Toggle(True))  # -> I, V, O

# ---- group: Mesh Smoothing
weaverbird_s_catmull_clark_subdivision = WeaverbirdsCatmullClarkSubdivision(MeshCurves=bouncysolver.O, Level=catmull_clark_1_subd, SmoothNakedEdges=0)
weaverbird_s_mesh_thicken = WeaverbirdsMeshThicken(MeshCurves=weaverbird_s_catmull_clark_subdivision, Distance=mesh_thickness, OffsetType=0)
weaverbird_s_catmull_clark_subdivision_2 = WeaverbirdsCatmullClarkSubdivision(MeshCurves=weaverbird_s_mesh_thicken, Level=catmull_clark_2_subd, SmoothNakedEdges=1)
mesh_edges = MeshEdges(Mesh=weaverbird_s_catmull_clark_subdivision_2)  # -> NakedEdges, InteriorEdges, NonManifoldEdges
