# Grasshopper definition Naming Files.gh (Grasshopper 1.0.7)

panel = Panel("D:\_MAIN\Side Projects\DesignMorphine Tutorials")
get_file_path = GetFilePath(panel, AtLeast=1, AtMost=1, TreeAccess=False)
panel_2 = Panel("D:\_MAIN\Side Projects\DesignMorphine Tutorials\Applied Houdini Liquid Fundamentals II\CGCircuitAppliedHoudiniLiquidsII\CGCircuit - Applied Houdini - Liquids II")
panel_3 = Panel(get_file_path)
path = FilePath("D:\_MAIN\Side Projects\DesignMorphine Tutorials\Doxia Houdini\")
c_script = CSharpScript(Folder=panel, Pattern="*i*", Recursive=Toggle(False))  # -> out, Subfolders; inputs Folder: String, Pattern: String, Recursive: Boolean
# ---------- c_script: C# ----------
    // Ensure valid search pattern.
    if (string.IsNullOrEmpty(Pattern))
      Pattern = "*";

    // Pick search option.
    SearchOption search = SearchOption.TopDirectoryOnly;
    if (Recursive)
      search = SearchOption.AllDirectories;

    // Perform subfolder search.
    string[] folders = System.IO.Directory.GetDirectories(Folder, Pattern, search);

    // Make sure each folder ends with a backslash.
    for (int i = 0; i < folders.Length; i++)
      folders[i] += System.IO.Path.DirectorySeparatorChar;

    Subfolders = folders;
# ---------- end c_script ----------
list_item = ListItem(List=c_script.Subfolders, Index=0, Wrap=True)  # -> Item, Item1, Item2
c_script_2 = CSharpScript(Folder=panel_2, Pattern=["*.mkv", "*.mp4", "*.webm"])  # -> out, flatten(Files); inputs Folder: String, Pattern: String
# ---------- c_script_2: C# ----------
    // Ensure valid search pattern.
    if (string.IsNullOrEmpty(Pattern))
      Pattern = "*";

    // Perform file search.
    Files = System.IO.Directory.GetFiles(Folder, Pattern);
# ---------- end c_script_2 ----------
c_script_3 = CSharpScript(File=c_script_2.Files)  # -> out, Name, Extension, Folder; inputs File: String
# ---------- c_script_3: C# ----------
    if (string.IsNullOrEmpty(File))
      return;

    Name = System.IO.Path.GetFileNameWithoutExtension(File);
    Extension = System.IO.Path.GetExtension(File);
    Folder = System.IO.Path.GetDirectoryName(File);
# ---------- end c_script_3 ----------
panel_4 = Panel(c_script_2.Files)
panel_5 = Panel(c_script_3.Name)
