# Grasshopper definition NetSrf_Examples.gh (Grasshopper 0.9.76)
# plug-ins: NetOnSurface

# ---- group: Net density controls
number_slider = Slider(4, range=0..100)
# Net On Surface - Closed surface
number_slider_2 = Slider(30, range=0..100)

# Net On Surface - Deformed surface UV's
number_slider_3 = Slider(30, range=0..100)
number_slider_4 = Slider(4, range=0..100)

# Net On Surface - Multiple surfaces touching
number_slider_5 = Slider(14, range=0..100)
number_slider_6 = Slider(3, range=0..100)

# Net On Surface - Basic
number_slider_7 = Slider(30, range=0..100)
number_slider_8 = Slider(4, range=0..100)

# ---- group: Flip net direction
# Flip net direction to see how the net
# works with the seam of closed surfaces.
toggle = BooleanToggle(False)

# Flip net direction to see how the net
# works with the seam of surfaces
# connected to eachother
# (make sure your surfaces connect U to U and V to V)
# for continous looking results
toggle_2 = BooleanToggle(False)

toggle_3 = BooleanToggle(False)

# Set to true to flip the direction of the net on the surface.
# U count can only be even integers, this is
# to make the edges end in the same way
# (important for closed surface seams).
# If you input an odd integer the component
# automatically converts it to the even
# integer that is one less than the odd integer.
toggle_4 = BooleanToggle(False)

# ---- group: Surface to apply net on
srf = Surface(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)

srf_2 = Surface(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)

srf_3 = Surface([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])

srf_4 = Surface(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)

# ----
netsrf = NetOnSurface(Surface=srf_2, UCount=number_slider_2, VCount=number_slider, Flip=toggle)
netsrf_2 = NetOnSurface(Surface=srf_3, UCount=number_slider_5, VCount=number_slider_6, Flip=toggle_2)
netsrf_3 = NetOnSurface(Surface=srf, UCount=number_slider_3, VCount=number_slider_4, Flip=toggle_3)
netsrf_4 = NetOnSurface(Surface=srf_4, UCount=number_slider_7, VCount=number_slider_8, Flip=toggle_4)

# ----
# The great thing about Net on Surface
# is that no matter how low the UV inputs
# are the curves still flow along the surface.
# Net On Surface
preview = CustomPreview(Geometry=netsrf_4, Shader=ColourSwatch(SwatchColor=RGB(0, 255, 238)))

# ----
# In this example I use the same surface
# as the previous example but I pulled
# the surface control points around in rhino.
# This deforms the surface UV's and
# results in nets that are more warped and
# deformed. Surface UV's have a large
# effect on how the net goes across the
# surface. So turn on your surface control
# points in rhino and pull them around
# to see how the net reacts along it.
# Net On Surface
preview_2 = CustomPreview(Geometry=netsrf_3, Shader=ColourSwatch(SwatchColor=RGB(247, 255, 0)))

# ----
# Using a closed surface made from a revolve in rhino.
# Net On Surface
preview_3 = CustomPreview(Geometry=netsrf, Shader=ColourSwatch(SwatchColor=RGB(255, 132, 0)))

# ----
# Using multiple surfaces that touch U to U and V to V so the net flows correctly.
# Net On Surface
preview_4 = CustomPreview(Geometry=netsrf_2, Shader=ColourSwatch(SwatchColor=RGB(255, 0, 195)))
