# Grasshopper definition Node Connection.gh (Grasshopper 0.9.76)
# plug-ins: Exoskeleton2, Weaverbird

curve = Curve([<curve referenced from the Rhino model> x4])
exow = ExoWireframe(
    Lines=curve,
    Sides=Slider(50, range=6..75),
    StartRadius=Slider(25, range=0..100),
    EndRadius=Slider(25, range=4..35),
    NodeDepth=Slider(0, range=0..75),
    Division=Slider(50, range=4..50),
    Open=Toggle(True))
weaverbird_s_laplacian_smoothing = WeaverbirdsLaplacianSmoothing(MeshCurves=exow, Level=Slider(1, range=1..5), SmoothNakedEdges=Slider(0, range=0..1), Thin=1)
weaverbird_s_loop_subdivision = WeaverbirdsLoopSubdivision(MeshCurves=weaverbird_s_laplacian_smoothing, Level=1, SmoothNakedEdges=1)
mesh = Mesh(weaverbird_s_loop_subdivision)
weaverbird_s_mesh_thicken = WeaverbirdsMeshThicken(MeshCurves=mesh, Distance=Slider(3, range=0..10), OffsetType=0)
