# Grasshopper definition noise field-dcx852-rhino6.gh (Grasshopper 1.0.7)
# plug-ins: Heteroptera, Pufferfish, DendroGH

center_box = CenterBox(Base=PlaneXY(0, 0, 0), X=Slider(6, range=0..10), Y=Slider(34, range=0..100), Z=Slider(5, range=0..10))

# ----
# traverse starting points
number_slider = Slider(405, range=0..1000)
populate_3d = Populate3D(Region=center_box, Count=number_slider, Seed=1)

# ----
# generate random points
# as locations of point charges
number_slider_2 = Slider(8, range=0..100)
populate_3d_2 = Populate3D(Region=center_box, Count=number_slider_2, Seed=1)

# ----
# simplex noise field
number_slider_3 = Slider(48.413, range=1..100)
noise_field = NoiseField(Point=populate_3d_2, Scale=number_slider_3, Charge=1)
merge_fields = MergeFields(Fields=noise_field)
field_traveler = FieldTraveler(Field=merge_fields, Point=populate_3d, Charge=0.4, Iteration=Slider(58, range=0..100))

number_slider_4 = Slider(0.5, range=0..1)
# create a mesh conversion from the result of curve to volume
panel = Panel("3")
division = Division(A=number_slider_4, B=panel)
create_settings = CreateSettings(VoxelSize=division, Bandwidth=1, Isovalue=0, Adaptivity=0.1)
curve_to_volume = CurveToVolume(Curves=field_traveler, CurveRadius=number_slider_4, Settings=create_settings)  # disabled
volume_to_mesh = VolumeToMesh(Volume=curve_to_volume, VolumeSettings=create_settings)  # disabled

number_slider_5 = Slider(50, range=0..100)  # disabled
number_slider_6 = Slider(50, range=0..100)  # disabled
number_slider_7 = Slider(0.5, range=0..1)  # disabled
range = Range(Domain=Domain(0, 1), Steps=number_slider_5)  # disabled
range_2 = Range(Domain=Domain(0, 1), Steps=number_slider_6)  # disabled
parameter_pipe_mesh = ParameterPipeMesh(
    Curve=field_traveler,
    Radius=0.5,
    ParametersU=range,
    ParametersV=range_2,
    Weighted=False,
    Lengths=False,
    Angle=0,
    Rotation=0,
    EndType=2,
    Triangulate=False)  # disabled
pipe = Pipe(Curve=field_traveler, Radius=number_slider_7, Caps=2)  # disabled
mesh_edges = MeshEdges(Mesh=parameter_pipe_mesh)  # -> NakedEdges, InteriorEdges, NonManifoldEdges; disabled
