# Grasshopper definition noise field-dcx852-rhino7.gh (Grasshopper 1.0.7)
# plug-ins: Heteroptera, DendroGH

box = CenterBox(Base=PlaneXY(0, 0, 0), X=Slider(6, range=0..10), Y=Slider(34, range=0..100), Z=Slider(5, range=0..10))

# ----
# traverse starting points
number_slider = Slider(405, range=0..1000)
pop3d = Populate3D(Region=box, Count=number_slider, Seed=1)

# ----
# generate random points
# as locations of point charges
number_slider_2 = Slider(8, range=0..100)
pop3d_2 = Populate3D(Region=box, Count=number_slider_2, Seed=1)

# ----
# simplex noise field
noisef = NoiseField(Point=pop3d_2, Scale=Slider(48.413, range=1..100), Charge=Slider(1, range=0..10))
mergef = MergeFields(Fields=noisef)
traveler = FieldTraveler(Field=mergef, Point=pop3d, Charge=0.4, Iteration=Slider(58, range=0..100))

number_slider_3 = Slider(0.5, range=0..1)  # disabled
# create a mesh conversion from the result of curve to volume
panel = Panel("3")  # disabled
division = Division(A=number_slider_3, B=panel)  # disabled
vsettings = CreateSettings(VoxelSize=division, Bandwidth=1, Isovalue=0, Adaptivity=0.1)  # disabled
# Parametric House
vcurve = CurveToVolume(Curves=traveler, CurveRadius=number_slider_3, Settings=vsettings)  # disabled
mvolume = VolumeToMesh(Volume=vcurve, VolumeSettings=vsettings)  # disabled
