# Grasshopper definition Organic Structure.gh (Grasshopper 1.0.7)
# plug-ins: Weaverbird

rectangle = Rectangle(Plane=PlaneXY(0, 0, 0), XSize=Slider(10, range=0..10), YSize=Slider(5, range=0..10), Radius=0)  # -> Rectangle, Length
box_rectangle = BoxRectangle(Rectangle=rectangle.Rectangle, Height=Domain(0, 10))
populate_3d = Populate3D(Region=box_rectangle, Count=Slider(9, range=0..100), Seed=1)
voronoi_3d = Voronoi3D(Points=populate_3d, Box=box_rectangle)  # -> Cells, Boundary
area = Area(Geometry=voronoi_3d.Cells)  # -> Area, graft(Centroid)
deconstruct_brep = DeconstructBrep(Brep=voronoi_3d.Cells)  # -> Faces, Edges, Vertices
internal = Slider(0.7, range=0..1)
external = Slider(0.47, range=0..1)
area_2 = Area(Geometry=deconstruct_brep.Faces)  # -> Area, Centroid
scale = Scale(Geometry=deconstruct_brep.Faces, Center=area_2.Centroid, Factor=external)  # -> Geometry, Transform
scale_2 = Scale(Geometry=deconstruct_brep.Faces, Center=area.Centroid, Factor=internal)  # -> Geometry, Transform
deconstruct_brep_2 = DeconstructBrep(Brep=scale.Geometry)  # -> Faces, Edges, Vertices
deconstruct_brep_3 = DeconstructBrep(Brep=scale_2.Geometry)  # -> Faces, Edges, Vertices
panel = Panel(scale.Geometry)
end_points = EndPoints(Curve=deconstruct_brep_2.Edges)  # -> graft(Start), graft(End)
end_points_2 = EndPoints(Curve=deconstruct_brep_3.Edges)  # -> graft(Start), graft(End)
merge = Merge(Data1=end_points.Start, Data2=end_points.End, Data3=end_points_2.Start, Data4=end_points_2.End)  # -> simplify(Result)
point = Point(simplify([end_points.Start, end_points.End, end_points_2.Start, end_points_2.End]))
panel_2 = Panel(merge)
tree_statistics = TreeStatistics(Tree=merge)  # -> Paths, Length, Count
mesh_quad = MeshQuad(CornerA=0, CornerB=1, CornerC=3, CornerD=2)
list_item = ListItem(List=tree_statistics.Paths, Index=Slider(3, range=0..10), Wrap=True)
tree_branch = TreeBranch(Tree=merge, Path=list_item, MaintainPaths=True)
construct_mesh = ConstructMesh(Vertices=merge, Faces=mesh_quad)
panel_3 = Panel(mesh_quad)
mesh = Mesh(construct_mesh)
mesh_quad_2 = MeshQuad(CornerA=0, CornerB=1, CornerC=3, CornerD=2)
weaverbird_s_join_meshes_and_weld = WeaverbirdsJoinMeshesAndWeld(Mesh=flatten(mesh), Weld=True)
list_item_2 = ListItem(List=tree_branch, Index=Slider(2, range=0..3), Wrap=True)
negative = Negative(Value=Slider(0.25, range=0..1))
panel_4 = Panel(mesh_quad_2)
construct_mesh_2 = ConstructMesh(Vertices=tree_branch, Faces=mesh_quad_2)
weaverbird_s_mesh_thicken = WeaverbirdsMeshThicken(MeshCurves=weaverbird_s_join_meshes_and_weld, Distance=negative, OffsetType=0)
weaverbird_s_catmull_clark_subdivision = WeaverbirdsCatmullClarkSubdivision(MeshCurves=weaverbird_s_mesh_thicken, Level=Slider(3, range=0..10), SmoothNakedEdges=1)
custom_preview = CustomPreview(
    Geometry=weaverbird_s_catmull_clark_subdivision,
    Material={diffuse=RGB(221, 160, 221), emission=RGB(66, 48, 66), shine=0.5, specular=RGB(255, 255, 255), transparency=0})
