# Grasshopper definition Parking.gh (Grasshopper 0.8.52)

questions_comments = Panel("erick.katzenstein@gmail.com")
# Parking Generator:
# work in progress.
# Step1: Select perimeter of parking spaces.  The perimeter should be a closed, exploded set of curves.
# Step2: Select the perimeter curve which will generate the median direction of the parking spaces.
step3 = Panel("Adjust parameters")

# ----
# Tree Stuff...you can slide these
randomizervalueperptocurve_0_uniform_1_m = Slider(0, range=0..0.5)  # "RandomizerValuePerpToCurve (0=Uniform, 1=MostRandom)"
randomizervaluealongcurve_0_uniform_1_mo = Slider(0.2, range=0..1)  # "RandomizerValueAlongCurve (0=Uniform, 1=Most Random)"
treespacing = Slider(51, range=30..101)
foliageradius = Slider(24, range=0..31)
trunkradius = Slider(1.96, range=0..3)

# ----
# OtherStuff  (ignore these)
variableoffsetfromedge = Slider(6, range=0..31)
perpfromcurve = Slider(0.08, range=0..3)

unjoined_perimeter_of_parking_surface = Curve([<curve referenced from the Rhino model> x4])
spine_generating_curve = Curve(<curve referenced from the Rhino model>)

# ----
# ParkingSpace Controls...
# sliders will be slow. input manually
spacesperisland = Slider(10, range=0..31)
parkingspacewidth = Slider(9, range=0..31)
medianwidth = Slider(7, range=0..31)
parkingspacesize = Slider(18, range=0..31)
curbsize_inches = Slider(6, range=0..31)
islandwidth = Slider(8, range=0..31)
drivesize = Slider(24, range=0..31)
textsize = Slider(11, range=0..31)

division = Division(A=randomizervalueperptocurve_0_uniform_1_m, B=2)
# BakeHere
# Double Click to Bake ("True")
# Be sure to turn it back to false after baking.
toggle = BooleanToggle(False)
layernames = Panel("""ParkingSpaces
Curb
Median
TreeTrunk
TreeLeaves""")
graft = GraftTree(Data=layernames, Strip=False)
graft_2 = GraftTree(
    Data=[ColourSwatch(SwatchColor=RGB(255, 255, 255)), ColourSwatch(SwatchColor=RGB(0, 115, 255)), ColourSwatch(SwatchColor=RGB(0, 0, 0)), ColourSwatch(SwatchColor=RGB(171, 138, 21)), ColourSwatch(SwatchColor=RGB(25, 138, 0))],
    Strip=False)
material = CreateMaterial(Diffuse=RGB(0, 0, 0), Specular=RGB(255, 255, 255), Emission=RGB(0, 0, 0), Transparency=0.35, Shine=0)
material_2 = CreateMaterial(Diffuse=RGB(128, 77, 0), Specular=RGB(255, 255, 255), Emission=RGB(0, 0, 0), Transparency=0, Shine=0)
material_3 = CreateMaterial(Diffuse=RGB(51, 196, 2), Specular=RGB(255, 255, 255), Emission=RGB(0, 0, 0), Transparency=0.5, Shine=0)
parkingspacegenerator = Cluster(
    UnjoinedPerimeterOfParkingSurface=unjoined_perimeter_of_parking_surface,
    SpineGeneratingLine=spine_generating_curve,
    ParkingSpaceSize=parkingspacesize,
    MedianWidth=medianwidth,
    CurbSize=curbsize_inches,
    IslandWidth=islandwidth,
    ParkingSpaceWidth=parkingspacewidth,
    SpacesPerIsland=spacesperisland,
    DriveSize=drivesize,
    TextSize=textsize,
    PerimeterOfParkingSurface=parkingspacegenerator.Data,
    SpineGeneratingLine_2=parkingspacegenerator.Stream,
    Curve=parkingspacegenerator.Curve,
    Distance=parkingspacegenerator.Tree,
    Curve_2=parkingspacegenerator.Curve,
    Distance_2=expr("-d", parkingspacegenerator.Tree),
    Curves=parkingspacegenerator.Curve,
    StreamA=parkingspacegenerator.Curve,
    StreamB=parkingspacegenerator.Curve,
    Data=flatten(parkingspacegenerator.Stream),
    Number=[parkingspacegenerator.Number, parkingspacegenerator.Result, parkingspacegenerator.Result, parkingspacegenerator.Number, parkingspacegenerator.Number],
    Input=parkingspacegenerator.Data,
    Data_2=parkingspacegenerator.Number,
    BoundaryCurve=flatten(parkingspacegenerator.Curves),
    CurvesToTrim=flatten(parkingspacegenerator.Data),
    Data_3=parkingspacegenerator.PartialResult,
    List=parkingspacegenerator.Curves,
    CullPattern=parkingspacegenerator.CullPattern,
    Curve_3=parkingspacegenerator.Curves,
    Distance_3=expr("-d", parkingspacegenerator.Result),
    A=parkingspacegenerator.Number,
    B=parkingspacegenerator.Number,
    Curves_2=flatten(parkingspacegenerator.Element),
    CurvesToTrimExtend=flatten(parkingspacegenerator.Curve),
    BoundaryCurve_2=flatten(parkingspacegenerator.Curve),
    Edges=parkingspacegenerator.Curves,
    Content=flatten([parkingspacegenerator.Surfaces, parkingspacegenerator.Curve]),
    Brep=parkingspacegenerator.Box,
    Curve_4=parkingspacegenerator.Tree,
    Start=parkingspacegenerator.Weave,
    End=parkingspacegenerator.Weave,
    Base=parkingspacegenerator.Surfaces,
    Direction=parkingspacegenerator.UnitVector,
    Geometry=parkingspacegenerator.Extrusion,
    Translation=expr("-t/2", parkingspacegenerator.UnitVector),
    Curve_5=parkingspacegenerator.Inside,
    Curve_6=parkingspacegenerator.Curve,
    Brep_2=flatten(parkingspacegenerator.Geometry),
    Curve_7=parkingspacegenerator.Tree,
    Brep_3=flatten(parkingspacegenerator.Geometry),
    Point=parkingspacegenerator.Point,
    Point_2=parkingspacegenerator.Start,
    List_2=parkingspacegenerator.Area,
    CullPattern_2=parkingspacegenerator.Inside,
    Data_4=parkingspacegenerator.Curve,
    Curve_8=parkingspacegenerator.Tree,
    Brep_4=flatten(parkingspacegenerator.Geometry),
    Point_3=parkingspacegenerator.Point,
    Point_4=parkingspacegenerator.End,
    List_3=parkingspacegenerator.Area,
    CullPattern_3=parkingspacegenerator.Inside,
    List_4=parkingspacegenerator.Curve,
    Count=parkingspacegenerator.Length,
    Data_5=parkingspacegenerator.Series,
    List_5=parkingspacegenerator.Tree,
    CullPattern_4=parkingspacegenerator.Result,
    Stream0=parkingspacegenerator.List,
    Stream1=parkingspacegenerator.List,
    List_6=parkingspacegenerator.Tree,
    CullPattern_5=parkingspacegenerator.Result,
    Stream0_2=parkingspacegenerator.List,
    Stream1_2=parkingspacegenerator.List,
    Curves_3=parkingspacegenerator.Curve,
    Point_5=parkingspacegenerator.Start,
    Curve_9=parkingspacegenerator.Tree,
    FirstNumber=parkingspacegenerator.Distance,
    List_7=parkingspacegenerator.Curve,
    CullPattern_6=parkingspacegenerator.Result,
    Curve_10=parkingspacegenerator.Curve,
    Point_6=parkingspacegenerator.End,
    Curve_11=parkingspacegenerator.Tree,
    FirstNumber_2=parkingspacegenerator.Distance,
    Curve_12=parkingspacegenerator.Curve,
    A_2=parkingspacegenerator.SmallerThan,
    B_2=parkingspacegenerator.SmallerThan,
    Data_6=parkingspacegenerator.List,
    Curve_13=parkingspacegenerator.Curve,
    Curves_4=flatten(parkingspacegenerator.Data),
    ClusterOutput=parkingspacegenerator.Curves,
    PointOnCurve=parkingspacegenerator.Tree,
    Point_7=parkingspacegenerator.PointOnCurve,
    Curve_14=parkingspacegenerator.Curve,
    FirstNumber_3=parkingspacegenerator.Distance,
    A_3=parkingspacegenerator.Result,
    B_3=parkingspacegenerator.SmallerThan,
    CurvesToTrimExtend_2=parkingspacegenerator.ClusterInput,
    BoundaryCurve_3=parkingspacegenerator.ClusterInput,
    A_4=parkingspacegenerator.Inside,
    A_5=parkingspacegenerator.Inside,
    CurvesToTrimExtend_3=parkingspacegenerator.Curve,
    BoundaryCurve_4=parkingspacegenerator.Curve,
    SpineGeneratingLine_3=parkingspacegenerator.Curve,
    Curve_15=parkingspacegenerator.Curve,
    Distance_4=expr("-d", parkingspacegenerator.Result),
    Point_8=parkingspacegenerator.PointOnCurve,
    Curve_16=parkingspacegenerator.Curves,
    PointOnCurve_2=parkingspacegenerator.Curve,
    Curve_17=parkingspacegenerator.Curve,
    Distance_5=parkingspacegenerator.Result,
    PointOnCurve_3=parkingspacegenerator.Curve,
    Point_9=parkingspacegenerator.PointOnCurve,
    Curve_18=parkingspacegenerator.Curves,
    X=parkingspacegenerator.Relationship,
    X_2=parkingspacegenerator.Relationship,
    List_8=parkingspacegenerator.Curve,
    CullPattern_7=parkingspacegenerator.Result,
    List_9=parkingspacegenerator.Curve,
    CullPattern_8=parkingspacegenerator.Result,
    StreamA_2=parkingspacegenerator.List,
    StreamB_2=parkingspacegenerator.List,
    Curve_19=parkingspacegenerator.Curve,
    Start_2=parkingspacegenerator.Length,
    End_2=parkingspacegenerator.Length,
    Curve_20=parkingspacegenerator.Curves,
    SpineGeneratingLine_4=parkingspacegenerator.ClusterInput,
    Number_2=parkingspacegenerator.Number,
    ParkingDriveSize=parkingspacegenerator.Number,
    Number_3=parkingspacegenerator.Number,
    IslandSize=parkingspacegenerator.Number,
    ParkingSpaceWidth_2=parkingspacegenerator.Number,
    ParkingSpaceSize_2=parkingspacegenerator.ClusterInput,
    UnjoinedPerimeterOfParkingSurface_2=parkingspacegenerator.Curves,
    Data_7=parkingspacegenerator.Segments,
    Curves_5=flatten(parkingspacegenerator.Data),
    UnjoinedPerimeterOfParkingSurface_3=parkingspacegenerator.Curve,
    Curve_21=parkingspacegenerator.Curves,
    Distance_6=expr("d", parkingspacegenerator.Result),
    Brep_5=parkingspacegenerator.Curve,
    Brep_6=parkingspacegenerator.Curve,
    Keys=parkingspacegenerator.Stream,
    ValuesA=parkingspacegenerator.Stream,
    StreamA_3=parkingspacegenerator.Area,
    StreamB_3=parkingspacegenerator.Area,
    StreamA_4=parkingspacegenerator.Curve,
    StreamB_4=parkingspacegenerator.Curve,
    List_10=parkingspacegenerator.ValuesA,
    UnjoinedPerimeterOfParkingSurface_4=parkingspacegenerator.ClusterInput,
    A_6=parkingspacegenerator.Number,
    A_7=parkingspacegenerator.Number,
    Data_8=parkingspacegenerator.List,
    Curve_22=reparameterize(parkingspacegenerator.Data),
    A_8=parkingspacegenerator.Number,
    B_4=parkingspacegenerator.Number,
    A_9=parkingspacegenerator.Number,
    A_10=parkingspacegenerator.Result,
    B_5=parkingspacegenerator.Length,
    Curve_23=parkingspacegenerator.Curve,
    Keys_2=parkingspacegenerator.Length,
    ValuesA_2=parkingspacegenerator.Curve,
    List_11=reverse(parkingspacegenerator.ValuesA),
    Curve_24=reparameterize(parkingspacegenerator.Tree),
    A_11=parkingspacegenerator.Number,
    B_6=parkingspacegenerator.Result,
    A_12=parkingspacegenerator.Number,
    B_7=parkingspacegenerator.Number,
    Start_3=parkingspacegenerator.Result,
    Step=parkingspacegenerator.Result,
    Count_2=parkingspacegenerator.Integer,
    A_13=parkingspacegenerator.Result,
    B_8=parkingspacegenerator.Result,
    A_14=parkingspacegenerator.Length,
    B_9=parkingspacegenerator.Result,
    A_15=parkingspacegenerator.Result,
    Integer=parkingspacegenerator.Result,
    A_16=parkingspacegenerator.Result,
    B_10=parkingspacegenerator.Length,
    Data_9=parkingspacegenerator.Curve,
    Start_4=parkingspacegenerator.Origin,
    Direction_2=parkingspacegenerator.YAxis,
    Length=parkingspacegenerator.Number,
    Plane=parkingspacegenerator.Plane,
    Start_5=parkingspacegenerator.Origin,
    Direction_3=parkingspacegenerator.YAxis,
    Length_2=parkingspacegenerator.Number,
    Plane_2=parkingspacegenerator.Geometry,
    Geometry_2=parkingspacegenerator.Line,
    Translation_2=parkingspacegenerator.Vector,
    Vector=parkingspacegenerator.Line,
    Amplitude=expr("a/2", parkingspacegenerator.Number),
    Geometry_3=parkingspacegenerator.Line,
    Translation_3=parkingspacegenerator.Vector,
    Vector_2=parkingspacegenerator.Line,
    Amplitude_2=expr("a/2", parkingspacegenerator.Number),
    Curve_25=parkingspacegenerator.Weave,
    Curve_26=parkingspacegenerator.Weave,
    Curve_27=parkingspacegenerator.Tree,
    Distance_7=expr("d/2", parkingspacegenerator.Number),
    Curve_28=parkingspacegenerator.Tree,
    Distance_8=expr("-d/2", parkingspacegenerator.Number),
    CurveA=reparameterize(parkingspacegenerator.Curve),
    CurveB=flatten(parkingspacegenerator.Curve),
    Data_10=parkingspacegenerator.ParamsA,
    Data_11=parkingspacegenerator.Data,
    ParamViewer=treegenerator.Data,
    Branch=treegenerator.ParamViewer,
    List_12=treegenerator.Indices,
    Shift=expr("-S", treegenerator.Integer),
    Index=treegenerator.List,
    Integer_2=treegenerator.Integer,
    Data_12=treegenerator.Data,
    Search=treegenerator.ParamViewer,
    Replace=flatten(treegenerator.Branch),
    Data_13=treegenerator.Data,
    ClusterOutput_2=treegenerator.Data,
    Data_14=parkingspacegenerator.Tree,
    Curve_29=reparameterize(parkingspacegenerator.Curve),
    Parameters=parkingspacegenerator.Data,
    Curve_30=parkingspacegenerator.Segments,
    FirstNumber_4=parkingspacegenerator.Length,
    SecondNumber=expr("b+1", parkingspacegenerator.Number),
    List_13=parkingspacegenerator.Segments,
    CullPattern_9=parkingspacegenerator.LargerThan,
    CurveA_2=reparameterize(parkingspacegenerator.Curve),
    CurveB_2=flatten(parkingspacegenerator.Curve),
    Data_15=parkingspacegenerator.ParamsA,
    Data_16=parkingspacegenerator.Data,
    ParamViewer_2=treegenerator.Data,
    Branch_2=treegenerator.ParamViewer,
    List_14=treegenerator.Indices,
    Shift_2=expr("-S", treegenerator.Integer),
    Index_2=treegenerator.List,
    Integer_3=treegenerator.Integer,
    Data_17=treegenerator.Data,
    Search_2=treegenerator.ParamViewer,
    Replace_2=flatten(treegenerator.Branch),
    Data_18=treegenerator.Data,
    ClusterOutput_3=treegenerator.Data,
    Data_19=parkingspacegenerator.Tree,
    Curve_31=reparameterize(parkingspacegenerator.Curve),
    Parameters_2=parkingspacegenerator.Data,
    Curve_32=parkingspacegenerator.Segments,
    FirstNumber_5=parkingspacegenerator.Length,
    SecondNumber_2=expr("b+1", parkingspacegenerator.Number),
    List_15=parkingspacegenerator.Segments,
    CullPattern_10=parkingspacegenerator.LargerThan,
    Curve_33=parkingspacegenerator.Curve,
    Curve_34=parkingspacegenerator.Curve,
    PointA=parkingspacegenerator.End,
    PointB=parkingspacegenerator.End,
    PointA_2=parkingspacegenerator.Start,
    PointB_2=parkingspacegenerator.Start,
    Curve_35=[parkingspacegenerator.List, parkingspacegenerator.List, parkingspacegenerator.Line, parkingspacegenerator.Line, parkingspacegenerator.Curve, parkingspacegenerator.Curve, parkingspacegenerator.Line, parkingspacegenerator.Line],
    Geometry_4=parkingspacegenerator.Plane,
    Angle=parkingspacegenerator.Output,
    Plane_3=parkingspacegenerator.Plane,
    List_16=parkingspacegenerator.Curve,
    X_3=parkingspacegenerator.Result,
    A_17=parkingspacegenerator.Length,
    List_17=parkingspacegenerator.Curve,
    List_18=parkingspacegenerator.ListB,
    CullPattern_11=parkingspacegenerator.Result,
    A_18=parkingspacegenerator.Result,
    List_19=parkingspacegenerator.Curve,
    CullPattern_12=parkingspacegenerator.Result,
    Stream0_3=parkingspacegenerator.List,
    Stream1_3=parkingspacegenerator.List,
    Curve_36=parkingspacegenerator.Curve,
    List_20=parkingspacegenerator.Curve,
    X_4=parkingspacegenerator.Result,
    A_19=parkingspacegenerator.Length,
    List_21=parkingspacegenerator.Curve,
    List_22=parkingspacegenerator.ListB,
    CullPattern_13=parkingspacegenerator.Result,
    A_20=parkingspacegenerator.Result,
    List_23=parkingspacegenerator.Curve,
    CullPattern_14=parkingspacegenerator.Result,
    Stream0_4=parkingspacegenerator.List,
    Stream1_4=parkingspacegenerator.List,
    Curve_37=parkingspacegenerator.Curve,
    Curve_38=reparameterize(parkingspacegenerator.Tree),
    Parameter=parkingspacegenerator.List,
    List_24=parkingspacegenerator.Series,
    CullPattern_15=parkingspacegenerator.SmallerThan,
    FirstNumber_6=parkingspacegenerator.Series,
    Start_6=parkingspacegenerator.Origin,
    Direction_4=parkingspacegenerator.YAxis,
    Plane_4=parkingspacegenerator.Frame,
    Curve_39=reparameterize(parkingspacegenerator.Tree),
    Parameter_2=parkingspacegenerator.List,
    Curve_40=parkingspacegenerator.Line,
    Point_10=parkingspacegenerator.Start,
    Curve_41=reparameterize(parkingspacegenerator.Tree),
    A_21=parkingspacegenerator.Parameter,
    B_11=parkingspacegenerator.Result,
    A_22=parkingspacegenerator.Parameter,
    B_12=parkingspacegenerator.Result,
    Curve_42=reparameterize(parkingspacegenerator.Tree),
    Parameter_3=parkingspacegenerator.Result,
    Curve_43=reparameterize(parkingspacegenerator.Tree),
    Parameter_4=parkingspacegenerator.Result,
    StreamA_5=parkingspacegenerator.Frame,
    StreamB_5=parkingspacegenerator.Frame,
    Plane_5=parkingspacegenerator.Frame,
    Curve_44=reparameterize(parkingspacegenerator.Tree),
    Length_3=parkingspacegenerator.Number,
    Data_20=flatten(parkingspacegenerator.List),
    Curve_45=reparameterize(parkingspacegenerator.Tree),
    Parameter_5=parkingspacegenerator.Parameters,
    Start_7=parkingspacegenerator.Frame,
    Direction_5=parkingspacegenerator.YAxis,
    Length_4=parkingspacegenerator.Number,
    Plane_6=parkingspacegenerator.Frame,
    List_25=parkingspacegenerator.Line,
    List_26=reverse(parkingspacegenerator.ListB),
    Geometry_5=parkingspacegenerator.ListB,
    Curve_46=reparameterize(parkingspacegenerator.Tree),
    Length_5=parkingspacegenerator.Number,
    Data_21=flatten(parkingspacegenerator.List),
    Curve_47=reparameterize(parkingspacegenerator.Tree),
    Parameter_6=parkingspacegenerator.Parameters,
    Start_8=parkingspacegenerator.Geometry,
    Direction_6=parkingspacegenerator.YAxis,
    Length_6=parkingspacegenerator.Number,
    Plane_7=parkingspacegenerator.Geometry,
    List_27=parkingspacegenerator.Line,
    List_28=reverse(parkingspacegenerator.ListB),
    Geometry_6=parkingspacegenerator.Frame,
    Angle_2=parkingspacegenerator.Output,
    Plane_8=parkingspacegenerator.Frame,
    Curves_6=flatten(parkingspacegenerator.Curve),
    Curve_48=parkingspacegenerator.Curves,
    PointA_3=parkingspacegenerator.Start,
    PointB_3=parkingspacegenerator.End,
    Curves_7=flatten([parkingspacegenerator.Curves, parkingspacegenerator.Line]),
    Curve_49=parkingspacegenerator.Curves,
    List_29=parkingspacegenerator.Curves,
    CullPattern_16=parkingspacegenerator.Closed,
    Edges_2=parkingspacegenerator.List,
    Surface=parkingspacegenerator.Surfaces,
    Curves_8=parkingspacegenerator.Curve,
    Curve_50=parkingspacegenerator.Curve,
    Point_11=parkingspacegenerator.Centroid,
    Curve_51=parkingspacegenerator.Curve,
    Brep_7=parkingspacegenerator.Fragments,
    X_5=parkingspacegenerator.Relationship,
    List_30=parkingspacegenerator.Fragments,
    CullPattern_17=parkingspacegenerator.Result,
    A_23=parkingspacegenerator.Result,
    Curve_52=parkingspacegenerator.Geometry,
    Point_12=parkingspacegenerator.End,
    Curve_53=parkingspacegenerator.Curve,
    X_6=parkingspacegenerator.Relationship,
    List_31=parkingspacegenerator.Geometry,
    CullPattern_18=parkingspacegenerator.Result,
    A_24=parkingspacegenerator.Result,
    Geometry_7=parkingspacegenerator.ListB,
    Curve_54=parkingspacegenerator.Geometry,
    Point_13=parkingspacegenerator.End,
    Curve_55=parkingspacegenerator.Curve,
    X_7=parkingspacegenerator.Relationship,
    List_32=parkingspacegenerator.Geometry,
    CullPattern_19=parkingspacegenerator.Result,
    A_25=parkingspacegenerator.Result,
    Curve_56=parkingspacegenerator.Curve,
    Data_22=flatten(parkingspacegenerator.List),
    Curve_57=parkingspacegenerator.Tree,
    Distance_9=expr("d/12", parkingspacegenerator.Number),
    Curve_58=parkingspacegenerator.Tree,
    Distance_10=expr("-d/12", parkingspacegenerator.Number),
    Data_23=flatten(parkingspacegenerator.Curve),
    Stream0_5=parkingspacegenerator.Curve,
    Stream1_5=parkingspacegenerator.Curve,
    Curve_59=parkingspacegenerator.Data,
    Keys_3=parkingspacegenerator.Length,
    ValuesA_3=parkingspacegenerator.Data,
    List_33=parkingspacegenerator.ValuesA,
    Brep_8=parkingspacegenerator.List,
    Curves_9=parkingspacegenerator.Wireframe,
    DriveSize_2=parkingspacegenerator.ClusterInput,
    Number_4=parkingspacegenerator.Result,
    ParkingSpaceWidth_3=parkingspacegenerator.ClusterInput,
    IslandWidth_2=parkingspacegenerator.ClusterInput,
    MedianWidth_2=parkingspacegenerator.ClusterInput,
    SpacesBetween=parkingspacegenerator.Number,
    List_34=parkingspacegenerator.Curve,
    Curve_60=reparameterize(parkingspacegenerator.Element),
    Curve_61=reparameterize(parkingspacegenerator.Element),
    PointA_4=parkingspacegenerator.Start,
    PointB_4=parkingspacegenerator.Point,
    Geometry_8=parkingspacegenerator.Frame,
    Translation_4=parkingspacegenerator.Line,
    Curve_62=reparameterize(parkingspacegenerator.Tree),
    Plane_9=parkingspacegenerator.Geometry,
    Start_9=parkingspacegenerator.Origin,
    Direction_7=parkingspacegenerator.XAxis,
    Start_10=parkingspacegenerator.Origin,
    Direction_8=parkingspacegenerator.UnitVector,
    List_35=parkingspacegenerator.Curve,
    Curve_63=parkingspacegenerator.List,
    List_36=parkingspacegenerator.Curve,
    Curve_64=reparameterize(parkingspacegenerator.Element),
    Curve_65=reparameterize(parkingspacegenerator.Element),
    PointA_5=parkingspacegenerator.Start,
    PointB_5=parkingspacegenerator.Point,
    Geometry_9=parkingspacegenerator.Frame,
    Translation_5=parkingspacegenerator.Line,
    Curve_66=reparameterize(parkingspacegenerator.Tree),
    List_37=parkingspacegenerator.Curve,
    Curve_67=parkingspacegenerator.List,
    Input_2=flatten([parkingspacegenerator.Length, parkingspacegenerator.Length]),
    Content_2=parkingspacegenerator.Curve,
    Brep_9=parkingspacegenerator.Box,
    List_38=parkingspacegenerator.Edges,
    Geometry_10=parkingspacegenerator.Element,
    Translation_6=parkingspacegenerator.UnitVector,
    Curve_68=reparameterize(parkingspacegenerator.Geometry),
    Origin=parkingspacegenerator.Point,
    Start_11=parkingspacegenerator.Result,
    A_26=parkingspacegenerator.Number,
    Curves_10=flatten(parkingspacegenerator.Curve),
    Brep_10=parkingspacegenerator.Curves,
    Curve_69=reparameterize(parkingspacegenerator.Geometry),
    Origin_2=parkingspacegenerator.Point,
    Start_12=parkingspacegenerator.Result,
    A_27=parkingspacegenerator.Number,
    Geometry_11=parkingspacegenerator.Geometry,
    Translation_7=expr("t*3", parkingspacegenerator.UnitVector),
    Factor=parkingspacegenerator.Number,
    X_8=parkingspacegenerator.Area,
    Start_13=parkingspacegenerator.Result,
    X_9=parkingspacegenerator.Result,
    SpacesPerIsland_2=parkingspacegenerator.ClusterInput,
    Curve_70=parkingspacegenerator.Data,
    PerimeterOfParkingSurface_2=parkingspacegenerator.Data,
    Curves_11=parkingspacegenerator.Curve,
    Curve_71=reparameterize(parkingspacegenerator.Tree),
    Length_7=parkingspacegenerator.Number,
    Data_24=parkingspacegenerator.Curve,
    Plane_10=parkingspacegenerator.Geometry,
    Start_14=parkingspacegenerator.Origin,
    Direction_9=parkingspacegenerator.YAxis,
    Length_8=parkingspacegenerator.Number,
    Geometry_12=parkingspacegenerator.Frame,
    Angle_3=parkingspacegenerator.Output,
    Plane_11=parkingspacegenerator.Frame,
    Perimeter=parkingspacegenerator.Curve,
    Plane_12=parkingspacegenerator.Frame,
    Start_15=parkingspacegenerator.Origin,
    Direction_10=parkingspacegenerator.YAxis,
    Length_9=parkingspacegenerator.Number,
    Curves_12=[parkingspacegenerator.Line, parkingspacegenerator.Line],
    Curve_72=parkingspacegenerator.Curves,
    PointOnCurve_4=parkingspacegenerator.Segments,
    Point_14=parkingspacegenerator.PointOnCurve,
    Curve_73=parkingspacegenerator.Curves,
    X_10=parkingspacegenerator.Relationship,
    List_39=parkingspacegenerator.Segments,
    CullPattern_20=parkingspacegenerator.Result,
    Curve_74=reparameterize(parkingspacegenerator.Tree),
    Parameter_7=parkingspacegenerator.Parameters,
    ExteriorSpaceLines=parkingspacegenerator.List,
    Number_5=parkingspacegenerator.Number,
    ParkingSpaceWidth_4=parkingspacegenerator.ClusterInput,
    ParkingSpaceSize_3=parkingspacegenerator.ClusterInput,
    Point_15=parkingspacegenerator.Tree,
    Curve_75=flatten(parkingspacegenerator.Data),
    Curve_76=reparameterize(parkingspacegenerator.Geometry),
    X_11=parkingspacegenerator.Relationship,
    ExteriorSpaceLines_2=parkingspacegenerator.List,
    Data_25=parkingspacegenerator.Point,
    Keys_4=parkingspacegenerator.Result,
    List_40=parkingspacegenerator.List,
    X_12=parkingspacegenerator.Element,
    List_41=parkingspacegenerator.Tree,
    CullPattern_21=parkingspacegenerator.Result,
    Data_26=parkingspacegenerator.Geometry,
    Curve_77=parkingspacegenerator.Segments,
    Distance_11=parkingspacegenerator.Number,
    Curve_78=parkingspacegenerator.Segments,
    Distance_12=expr("-d", parkingspacegenerator.Number),
    UnjoinedPerimeterOfParkingSurface_5=parkingspacegenerator.Curves,
    Data_27=parkingspacegenerator.Segments,
    Section=[parkingspacegenerator.Curve, parkingspacegenerator.Curve],
    Data_28=flatten(parkingspacegenerator.Loft),
    GroupA=parkingspacegenerator.Tree,
    GroupB=parkingspacegenerator.Tree,
    List_42=flatten(parkingspacegenerator.Loft),
    Data_29=flatten(parkingspacegenerator.List),
    Data_30=parkingspacegenerator.Result,
    Curves_13=flatten(parkingspacegenerator.Data),
    UnjoinedPerimeterOfParkingSurface_6=parkingspacegenerator.ClusterInput,
    Curve_79=parkingspacegenerator.Geometry,
    ParamViewer_3=treegenerator.Data,
    Branch_3=treegenerator.ParamViewer,
    List_43=treegenerator.Indices,
    Shift_3=expr("-S", treegenerator.Integer),
    Index_3=treegenerator.List,
    Integer_4=treegenerator.Integer,
    Data_31=treegenerator.Data,
    Search_3=treegenerator.ParamViewer,
    Replace_3=flatten(treegenerator.Branch),
    Data_32=treegenerator.Data,
    ClusterOutput_4=treegenerator.Data,
    Data_33=parkingspacegenerator.Curve,
    ClusterOutput_5=parkingspacegenerator.Data,
    UnjoinedPerimeterOfParkingSurface_7=parkingspacegenerator.Curve,
    ParkingSpaceSize_4=parkingspacegenerator.Number,
    ParkingSpaceWidth_5=parkingspacegenerator.Number,
    List_44=parkingspacegenerator.Curve,
    A_28=parkingspacegenerator.Length,
    A_29=parkingspacegenerator.Length,
    Integer_5=parkingspacegenerator.Result,
    List_45=parkingspacegenerator.Curve,
    Index_4=parkingspacegenerator.Integer,
    Curve_80=reparameterize(parkingspacegenerator.Element),
    Origin_3=parkingspacegenerator.Frame,
    A_30=flatten(parkingspacegenerator.Result),
    B_13=flatten(parkingspacegenerator.Result),
    Input_3=flatten(parkingspacegenerator.Result),
    Point_16=flatten(parkingspacegenerator.Point),
    Curve_81=parkingspacegenerator.Tree,
    Data_34=flatten(parkingspacegenerator.Curves),
    Curve_82=reparameterize(parkingspacegenerator.Curve),
    FirstNumber_7=parkingspacegenerator.Relationship,
    List_46=parkingspacegenerator.Curve,
    CullPattern_22=parkingspacegenerator.Equality,
    Surface_2=parkingspacegenerator.Tree,
    Curves_14=parkingspacegenerator.Curve,
    Curve_83=parkingspacegenerator.Curve,
    Curve_84=flatten(parkingspacegenerator.Curve),
    Brep_11=parkingspacegenerator.Tree,
    Data_35=flatten(parkingspacegenerator.Surfaces),
    ClusterOutput_6=parkingspacegenerator.Tree,
    ClusterOutput_7=parkingspacegenerator.List,
    CurbSize_2=parkingspacegenerator.ClusterInput,
    ClusterOutput_8=parkingspacegenerator.Element,
    ClusterOutput_9=parkingspacegenerator.List,
    ClusterOutput_10=parkingspacegenerator.List,
    TextSize45=parkingspacegenerator.Number,
    PerimeterParkingSpaces=parkingspacegenerator.Data,
    ClusterOutput_11=parkingspacegenerator.Curve,
    ClusterOutput_12=parkingspacegenerator.Result,
    ClusterOutput_13=parkingspacegenerator.Plane,
    ClusterOutput_14=parkingspacegenerator.Result,
    ClusterOutput_15=parkingspacegenerator.Plane,
    ClusterOutput_16=parkingspacegenerator.Result,
    ClusterOutput_17=parkingspacegenerator.Plane,
    ClusterOutput_18=parkingspacegenerator.Result,
    ClusterOutput_19=parkingspacegenerator.Geometry,
    ClusterOutput_20=parkingspacegenerator.Length,
    ClusterOutput_21=parkingspacegenerator.Geometry,
    ClusterOutput_22=parkingspacegenerator.Length,
    TextSize_2=parkingspacegenerator.ClusterInput,
    ClusterOutput_23=parkingspacegenerator.Number,
    List_47=parkingspacegenerator.Stream,
    Index_5=parkingspacegenerator.NumberSlider,
    Start_16=parkingspacegenerator.Origin,
    Direction_11=parkingspacegenerator.YAxis,
    Length_10=parkingspacegenerator.Number,
    Plane_13=parkingspacegenerator.Plane,
    Start_17=parkingspacegenerator.Origin,
    Direction_12=parkingspacegenerator.YAxis,
    Length_11=parkingspacegenerator.Number,
    Plane_14=parkingspacegenerator.Geometry,
    Geometry_13=parkingspacegenerator.Line,
    Translation_8=parkingspacegenerator.Vector,
    Vector_3=parkingspacegenerator.Line,
    Amplitude_3=expr("a/2", parkingspacegenerator.Number),
    Geometry_14=parkingspacegenerator.Line,
    Translation_9=parkingspacegenerator.Vector,
    Vector_4=parkingspacegenerator.Line,
    Amplitude_4=expr("a/2", parkingspacegenerator.Number),
    Geometry_15=parkingspacegenerator.Plane,
    Angle_4=parkingspacegenerator.Output,
    Plane_15=parkingspacegenerator.Plane,
    Plane_16=parkingspacegenerator.Frame,
    Curve_85=[parkingspacegenerator.Geometry, parkingspacegenerator.Geometry],
    Curve_86=[parkingspacegenerator.Geometry, parkingspacegenerator.Geometry],
    Curve_87=parkingspacegenerator.Geometry,
    Curve_88=parkingspacegenerator.Geometry,
    PointA_6=parkingspacegenerator.End,
    PointB_6=parkingspacegenerator.End,
    Curve_89=parkingspacegenerator.Geometry,
    Curve_90=parkingspacegenerator.Geometry,
    PointA_7=parkingspacegenerator.End,
    PointB_7=parkingspacegenerator.End,
    Curves_15=flatten(parkingspacegenerator.Curve),
    Curve_91=parkingspacegenerator.Curves,
    Curve_92=parkingspacegenerator.Curves,
    List_48=parkingspacegenerator.Curves,
    CullPattern_23=parkingspacegenerator.Closed,
    Data_36=parkingspacegenerator.Weave,
    InternalDocument_plugin_version=(0, 8, 52),
    InternalDocument_DocumentHeader_PreviewNormal=RGBA(150, 0, 0, 100),
    InternalDocument_DocumentHeader_PreviewSelected=RGBA(0, 120, 0, 100),
    InternalDocument_DefinitionProperties_Projection_Zoom=0.2621440291,
    InternalDocument_DefinitionObjects_Object18_Container_ClusterInput=[parkingspacegenerator, parkingspacegenerator],
    InternalDocument_DefinitionObjects_Object18_Container_ClusterOutput=parkingspacegenerator,
    InternalDocument_DefinitionObjects_Object18_Container_InternalDocument_plugin_version=(0, 8, 52),
    InternalDocument_DefinitionObjects_Object87_Container_ClusterInput=[treegenerator, treegenerator],
    InternalDocument_DefinitionObjects_Object87_Container_ClusterOutput=treegenerator,
    InternalDocument_DefinitionObjects_Object87_Container_InternalDocument_plugin_version=(0, 8, 52),
    InternalDocument_DefinitionObjects_Object95_Container_ClusterInput=[treegenerator, treegenerator],
    InternalDocument_DefinitionObjects_Object95_Container_ClusterOutput=treegenerator,
    InternalDocument_DefinitionObjects_Object95_Container_InternalDocument_plugin_version=(0, 8, 52),
    InternalDocument_DefinitionObjects_Object114_Container_NullGaps=False,
    InternalDocument_DefinitionObjects_Object123_Container_NullGaps=False,
    InternalDocument_DefinitionObjects_Object186_Container_NullGaps=False,
    InternalDocument_DefinitionObjects_Object241_Container_ClusterInput=[parkingspacegenerator, parkingspacegenerator, parkingspacegenerator],
    InternalDocument_DefinitionObjects_Object241_Container_ClusterOutput=parkingspacegenerator,
    InternalDocument_DefinitionObjects_Object241_Container_InternalDocument_plugin_version=(0, 8, 52))  # -> L1, T1, L2, T2, L3, T3, L4, T4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
treegenerator = Cluster(
    MedianSurface=parkingspacegenerator.MedianSurface,
    CenterAxisOfMedian=parkingspacegenerator.CenterAxisOfMedian,
    CurbSize=curbsize_inches,
    MedianWidth=medianwidth,
    TreeSpacing=treespacing,
    TrunkRadius=trunkradius,
    FoliageRadius=foliageradius,
    RandomizerValueAlongCurve=randomizervaluealongcurve_0_uniform_1_mo,
    RandomizerValuePerpToCurve=division,
    PerpFromCurve=perpfromcurve,
    VariableOffsetFromEdge=variableoffsetfromedge,
    Curve=reparameterize(treegenerator.Curve),
    Length=treegenerator.Number,
    Center=treegenerator.Point,
    Radius=treegenerator.Number,
    Center_2=treegenerator.Point,
    Radius_2=treegenerator.Number,
    Geometry=treegenerator.Circle,
    Translation=treegenerator.Line,
    PointA=treegenerator.Point,
    PointB=treegenerator.Frame,
    Geometry_2=treegenerator.Circle,
    Translation_2=treegenerator.Line,
    Curve_2=treegenerator.Data,
    A=treegenerator.Number,
    B=treegenerator.Length,
    Curve_3=reparameterize(treegenerator.Data),
    Parameters=treegenerator.Result,
    List=treegenerator.Segments,
    Curve_4=treegenerator.Element,
    Curve_5=reparameterize(treegenerator.Curve),
    Parameters_2=treegenerator.Result,
    List_2=treegenerator.Segments,
    Curve_6=treegenerator.Element,
    A_2=treegenerator.Number,
    B_2=treegenerator.Length,
    DomainStart=expr("-a", treegenerator.Result),
    DomainEnd=treegenerator.Result,
    Range=treegenerator.Domain,
    Number=treegenerator.Length,
    Seed=treegenerator.Result,
    List_3=treegenerator.Parameters,
    A_3=treegenerator.Range,
    B_3=treegenerator.Parameters,
    Curve_7=reparameterize(treegenerator.Curve),
    Parameter=treegenerator.Result,
    A_4=treegenerator.Result,
    B_4=treegenerator.Number,
    A_5=treegenerator.Number,
    Plane=treegenerator.Plane,
    Start=treegenerator.Origin,
    Direction=treegenerator.YAxis,
    MedianWidth_2=expr("l/2", treegenerator.Data),
    Geometry_3=treegenerator.Plane,
    Angle=treegenerator.Output,
    Plane_2=treegenerator.Plane,
    Start_2=treegenerator.Geometry,
    Direction_2=treegenerator.YAxis,
    MedianWiddth=expr("l/2", treegenerator.Data),
    Plane_3=treegenerator.Geometry,
    Curves=[treegenerator.Line, treegenerator.Line],
    Range_2=treegenerator.Domain,
    Number_2=treegenerator.Length,
    Seed_2=treegenerator.Result,
    A_6=treegenerator.Number,
    Curve_8=reparameterize(treegenerator.Data),
    Parameter_2=treegenerator.Data,
    Range_3=treegenerator.Domain,
    Number_3=treegenerator.Length,
    Seed_3=treegenerator.Result,
    B_5=treegenerator.Range,
    B_6=treegenerator.Range,
    B_7=treegenerator.Result,
    Input=treegenerator.Result,
    Input_2=treegenerator.Result,
    Data=treegenerator.Output,
    Data_2=treegenerator.Output,
    Keys=treegenerator.Number,
    ValuesA=treegenerator.Number,
    Data_3=treegenerator.Range,
    Data_4=treegenerator.Range,
    Number_4=[treegenerator.Tree, treegenerator.Tree],
    Number_5=[treegenerator.Tree, treegenerator.Tree],
    List_4=treegenerator.ValuesA,
    ParamViewer=treegenerator.Data,
    Branch=treegenerator.ParamViewer,
    List_5=treegenerator.Indices,
    Shift=expr("-S", treegenerator.Integer),
    Index=treegenerator.List,
    Integer=treegenerator.Integer,
    Data_5=treegenerator.Data,
    Search=treegenerator.ParamViewer,
    Replace=flatten(treegenerator.Branch),
    Data_6=treegenerator.Data,
    ClusterOutput=treegenerator.Data,
    Data_7=treegenerator.Element,
    B_8=treegenerator.Number,
    DomainEnd_2=treegenerator.Result,
    DomainStart_2=treegenerator.Result,
    A_7=treegenerator.Number,
    A_8=treegenerator.Result,
    B_9=treegenerator.Length,
    Curve_9=reparameterize(treegenerator.Tree),
    Parameters_3=treegenerator.Result,
    List_6=treegenerator.Segments,
    Curve_10=treegenerator.Element,
    Curve_11=reparameterize(treegenerator.Curve),
    Parameters_4=treegenerator.Result,
    List_7=treegenerator.Segments,
    Curve_12=treegenerator.Element,
    Data_8=treegenerator.Curves,
    Curve_13=treegenerator.Tree,
    A_9=treegenerator.Number,
    B_10=treegenerator.Number,
    ParamViewer_2=treegenerator.Data,
    Branch_2=treegenerator.ParamViewer,
    List_8=treegenerator.Indices,
    Shift_2=expr("-S", treegenerator.Integer),
    Index_2=treegenerator.List,
    Integer_2=treegenerator.Integer,
    Data_9=treegenerator.Data,
    Search_2=treegenerator.ParamViewer,
    Replace_2=flatten(treegenerator.Branch),
    Data_10=treegenerator.Data,
    ClusterOutput_2=treegenerator.Data,
    Data_11=treegenerator.Curve,
    Curve_14=treegenerator.Curve,
    A_10=treegenerator.Result,
    B_11=treegenerator.Length,
    A_11=treegenerator.Result,
    B_12=treegenerator.Result,
    CurbSize_2=treegenerator.ClusterInput,
    TreeSpacing_2=treegenerator.ClusterInput,
    TrunkRadius_2=treegenerator.ClusterInput,
    FoliageRadius_2=treegenerator.ClusterInput,
    RandomizerValueAlongCurve_2=treegenerator.ClusterInput,
    RandomizerValuePerpToCurve_2=treegenerator.ClusterInput,
    PerpFromCurve_2=treegenerator.ClusterInput,
    VariableOffsetFromEdge_2=treegenerator.ClusterInput,
    A_12=treegenerator.Result,
    B_13=treegenerator.Tree,
    List_9=flatten(treegenerator.Length),
    Count=treegenerator.Length,
    Data_12=treegenerator.Series,
    A_13=treegenerator.Result,
    B_14=treegenerator.Tree,
    FirstNumber=treegenerator.Result,
    List_10=treegenerator.Result,
    CullPattern=treegenerator.SmallerThan,
    FirstNumber_2=treegenerator.List,
    List_11=treegenerator.List,
    CullPattern_2=treegenerator.LargerThan,
    Plane_4=treegenerator.List,
    Point=treegenerator.Frame,
    MedianSurface_2=treegenerator.ClusterInput,
    FirstNumber_3=treegenerator.Relationship,
    List_12=treegenerator.Frame,
    CullPattern_3=treegenerator.Inequality,
    ClusterOutput_3=treegenerator.Geometry,
    ClusterOutput_4=treegenerator.Geometry,
    CenterAxisOfMedian_2=treegenerator.ClusterInput,
    MedianWidth_3=treegenerator.ClusterInput,
    InternalDocument_plugin_version=(0, 8, 52),
    InternalDocument_DocumentHeader_PreviewNormal=RGBA(150, 0, 0, 100),
    InternalDocument_DocumentHeader_PreviewSelected=RGBA(0, 120, 0, 100),
    InternalDocument_DefinitionProperties_Projection_Zoom=1,
    InternalDocument_DefinitionObjects_Object47_Container_ClusterInput=[treegenerator, treegenerator],
    InternalDocument_DefinitionObjects_Object47_Container_ClusterOutput=treegenerator,
    InternalDocument_DefinitionObjects_Object47_Container_InternalDocument_plugin_version=(0, 8, 52),
    InternalDocument_DefinitionObjects_Object62_Container_ClusterInput=[treegenerator, treegenerator],
    InternalDocument_DefinitionObjects_Object62_Container_ClusterOutput=treegenerator,
    InternalDocument_DefinitionObjects_Object62_Container_InternalDocument_plugin_version=(0, 8, 52))  # -> TreeTrunk, TreeFoliage
tag = TextTag3D(Location=parkingspacegenerator.L1, Text=parkingspacegenerator.T1, Size=parkingspacegenerator.TextSize_145)
tag_2 = TextTag3D(Location=parkingspacegenerator.L2, Text=parkingspacegenerator.T2, Size=parkingspacegenerator.TextSize_23)
tag_3 = TextTag3D(Location=parkingspacegenerator.L3, Text=parkingspacegenerator.T3, Size=parkingspacegenerator.TextSize_23)
tag_4 = TextTag3D(Location=parkingspacegenerator.L4, Text=parkingspacegenerator.T4, Size=parkingspacegenerator.TextSize_145)
tag_5 = TextTag3D(Location=parkingspacegenerator.L5, Text=parkingspacegenerator.T5, Size=parkingspacegenerator.TextSize_145)
treetrunk = Curve(treegenerator.TreeTrunk)
treefoliage = Curve(treegenerator.TreeFoliage)
wires = BrepWireframe(Brep=parkingspacegenerator.MedianSurface, Density=-1)
join = JoinCurves(Curves=wires, Preserve=False)
planar = PlanarSrf(Edges=treefoliage)
wires_2 = BrepWireframe(Brep=treetrunk, Density=-1)
planar_2 = PlanarSrf(Edges=treetrunk)
perimeterparkingspacelines = Curve(parkingspacegenerator.PerimeterParkingSpaces)
mediansurfaceoutline = Data(join)
treefoliageoutline = Data(treefoliage)
parkingspacelines = Curve([parkingspacegenerator.ParkingSpaces2, parkingspacegenerator.ParkingSpaces1])
mediansurface = Data(parkingspacegenerator.MedianSurface)
curboutline = Data(parkingspacegenerator.Curb)
treefoliage_2 = Data(planar)
treetrunk_2 = Data(planar_2)
group = Group(Objects=flatten([perimeterparkingspacelines, parkingspacelines]))
group_2 = Group(Objects=flatten(curboutline))
group_3 = Group(Objects=flatten(mediansurfaceoutline))
group_4 = Group(Objects=flatten(wires_2))
group_5 = Group(Objects=flatten(treefoliageoutline))
graft_3 = GraftTree(Data=[group, group_2, group_3, group_4, group_5], Strip=False)
ungroup = Ungroup(Group=graft_3)
lng = ListLength(List=ungroup)
dup = DuplicateData(Data=graft_2, Number=lng, Order=True)
bakeattributes = CSharpScript(obj=ungroup, layer=graft, color=dup, activate=toggle)  # -> out; inputs obj: GeometryBase, name: String, layer: String, color: Color, pWidth: Double, wires: Int32, activate: Boolean
# ---------- bakeattributes: C# ----------
    //Inserts geometry into the Rhino document, with custom attributes
    //Written by Giulio Piacentino
    //Version written 2010 11 21 - for Grasshopper 0.8.002

    if (activate)
    {
      if(obj == null)
      {
        Print("No object to bake");
        return;
      }

      //Make new attribute to set name
      Rhino.DocObjects.ObjectAttributes att = new Rhino.DocObjects.ObjectAttributes();

      //Set object name
      if(!string.IsNullOrEmpty(name))
      {
        att.Name = name;
      }

      //Set color
      if(!color.IsEmpty)
      {
        att.ColorSource = Rhino.DocObjects.ObjectColorSource.ColorFromObject; //Make the color type "by object"
        att.ObjectColor = color;

        att.PlotColorSource = Rhino.DocObjects.ObjectPlotColorSource.PlotColorFromObject; //Make the plot color type "by object"
        att.PlotColor = color;
      }

      //Set layer
      if(!string.IsNullOrEmpty(layer) && Rhino.DocObjects.Layer.IsValidName(layer))
      {
        //Get the current layer index
        Rhino.DocObjects.Tables.LayerTable layerTable = doc.Layers;
        int layerIndex = layerTable.Find(layer, true);

        if(layerIndex < 0) //This layer does not exist, we add it
        {
          Rhino.DocObjects.Layer onlayer = new Rhino.DocObjects.Layer(); //Make a new layer
          onlayer.Name = layer;

          layerIndex = layerTable.Add(onlayer); //Add the layer to the layer table
          if (layerIndex > -1) //We manged to add layer!
          {
            att.LayerIndex = layerIndex;
            Print("Added new layer to the document at position " + layerIndex + " named " + layer + ". ");
          } else
            Print("Layer did not add. Try cleaning up your layers."); //This never happened to me.
        }
        else
          att.LayerIndex = layerIndex; //We simply add to the existing layer
      }


      //Set plotweight
      if(pWidth > 0)
      {
        att.PlotWeightSource = Rhino.DocObjects.ObjectPlotWeightSource.PlotWeightFromObject;
        att.PlotWeight = pWidth;
      }


      //Set material
      bool materialByName = !string.IsNullOrEmpty(material as string);
      Rhino.Display.DisplayMaterial inMaterial = material as Rhino.Display.DisplayMaterial;
      if(material is Color)
      {
        inMaterial = new Rhino.Display.DisplayMaterial((Color) material);
      }
      if(material != null && inMaterial == null && !materialByName)
      {
        if(!(material is string))
        {
          try //We also resort to try with IConvertible
          {
            inMaterial = (Rhino.Display.DisplayMaterial) Convert.ChangeType(material, typeof(Rhino.Display.DisplayMaterial));
          }
          catch(InvalidCastException)
          {
          }
        }
      }
      if(inMaterial != null || materialByName)
      {
        string matName;

        if(!materialByName)
        {
          matName = string.Format("A:{0}-D:{1}-E:{2}-S:{3},{4}-T:{5}",
            Format(inMaterial.Ambient),
            Format(inMaterial.Diffuse),
            Format(inMaterial.Emission),
            Format(inMaterial.Specular),
            inMaterial.Shine.ToString(),
            inMaterial.Transparency.ToString()
            );
        }
        else
        {
          matName = (string) material;
        }

        int materialIndex = doc.Materials.Find(matName, true);
        if(materialIndex < 0 && !materialByName) //Material does not exist and we have its specs
        {
          materialIndex = doc.Materials.Add(); //Let's add it
          if(materialIndex > -1)
          {
            Print("Added new material at position " + materialIndex + " named \"" + matName + "\". ");
            Rhino.DocObjects.Material m = doc.Materials[materialIndex];
            m.Name = matName;
            m.AmbientColor = inMaterial.Ambient;
            m.DiffuseColor = inMaterial.Diffuse;
            m.EmissionColor = inMaterial.Emission;
            //m.ReflectionColor = no equivalent
            m.SpecularColor = inMaterial.Specular;
            m.Shine = inMaterial.Shine;
            m.Transparency = inMaterial.Transparency;
            //m.TransparentColor = no equivalent
            m.CommitChanges();

            att.MaterialSource = Rhino.DocObjects.ObjectMaterialSource.MaterialFromObject;
            att.MaterialIndex = materialIndex;
          }
          else
            Print("Material did not add. Try cleaning up your materials."); //This never happened to me.
        }
        else if(materialIndex < 0 && materialByName) //Material does not exist and we do not have its specs. We do nothing
        {
          Print("Warning: material name not found. I cannot set the source to this material name. Add a material with name: " + matName);
        }
        else
        {
          //If this material exists, we do not replace it!
          att.MaterialSource = Rhino.DocObjects.ObjectMaterialSource.MaterialFromObject;
          att.MaterialIndex = materialIndex;
        }
      }


      //Set wire density
      if(wires == -1 || wires > 0)
      {
        att.WireDensity = wires;
      }


      //Bake to the right type of object
      switch(obj.ObjectType)
      {
        case Rhino.DocObjects.ObjectType.Brep:
          doc.Objects.AddBrep(obj as Brep, att);
          break;
        case Rhino.DocObjects.ObjectType.Curve:
          doc.Objects.AddCurve(obj as Curve, att);
          break;
        case Rhino.DocObjects.ObjectType.Point:
          doc.Objects.AddPoint((obj as Rhino.Geometry.Point).Location, att);
          break;
        case Rhino.DocObjects.ObjectType.Surface:
          doc.Objects.AddSurface(obj as Surface, att);
          break;
        case Rhino.DocObjects.ObjectType.Mesh:
          doc.Objects.AddMesh(obj as Mesh, att);
          break;
        case Rhino.DocObjects.ObjectType.Extrusion:
          typeof(Rhino.DocObjects.Tables.ObjectTable).InvokeMember("AddExtrusion", BindingFlags.Instance | BindingFlags.InvokeMethod, null, doc.Objects, new object[]{obj, att});
          break;
        case Rhino.DocObjects.ObjectType.PointSet:
          doc.Objects.AddPointCloud(obj as Rhino.Geometry.PointCloud, att); //This is a speculative entry
          break;
        default:
          Print("The script does not know how to handle this type of geometry: " + obj.GetType().FullName);
          break;
      }
      Print("Added " + obj.GetType().Name);

    }
    else
    {
      Print("Inactive");
    }
# ---------- bakeattributes: C# additional code ----------
  static string Format(Color c)
  {
    return (new System.Text.StringBuilder("A")).Append(c.A.ToString()).Append("R").Append(c.R.ToString()).Append("G")
      .Append(c.G.ToString()).Append("B").Append(c.B.ToString()).ToString();
  }
# ---------- end bakeattributes ----------
preview = CustomPreview(Geometry=perimeterparkingspacelines, Shader=ColourSwatch(SwatchColor=RGB(255, 255, 255)))
preview_2 = CustomPreview(Geometry=parkingspacelines, Shader=ColourSwatch(SwatchColor=RGB(255, 255, 255)))
preview_3 = CustomPreview(Geometry=curboutline, Shader=ColourSwatch(SwatchColor=RGB(255, 200, 0)))
preview_4 = CustomPreview(Geometry=mediansurfaceoutline, Shader=ColourSwatch(SwatchColor=RGB(255, 200, 0)))
preview_5 = CustomPreview(Geometry=mediansurface, Shader=material)
preview_6 = CustomPreview(Geometry=treetrunk_2, Shader=material_2)
preview_7 = CustomPreview(Geometry=treefoliage_2, Shader=material_3)
preview_8 = CustomPreview(Geometry=treefoliageoutline, Shader=ColourSwatch(SwatchColor=RGB(0, 0, 0)))
