# Grasshopper definition PathMapper_20110315.ghx (Grasshopper 0.8.9)

# Path Mapper:
# UPDATED 2011-03-15 v0.8.0009
gallery = ImageGallery(CycleDelay=30, Randomize=False, UseLocalImages=True, UseRemoteImages=True)
# Flatten
# Location:             Sets>Tree>Flatten Tree
# Description:          Removes all branching
#                        information from a tree
# Keyword Shortcut:  "flat"
panel = Panel(" ")
# Graft
# Location:             Sets>Tree>Graft Tree
# Description:          Graft a tree by adding an
#                        extra branch for every
#                        data item
# Keyword Shortcut:  "graf"
panel_2 = Panel(" ")
# Simplify
# Location:             Sets>Tree>Simplify Tree
# Description:          Simplify a tree by removing
#                        the ovelap shared amongst
#                        all branches
# Keyword Shortcut:  "simp"
panel_3 = Panel(" ")
# Flip Matrix
# Location:             Sets>Tree>Flip Matrix
# Description:          Flip a data matrix by
#                        swapping rows and columns
# Keyword Shortcut:  "flipmat"
panel_4 = Panel(" ")
# "%" a.k.a Modulo Operation
# Grouping
# Location:             No Component
# Description:          Group consecutive data on
#                        separate branches by a user
#                        determined amount
# Keyword Shortcut:  None
panel_5 = Panel(" ")
# "\" a.k.a Backslah Divide or Integer Divide
# Grouping: By Replace Branches
# Location:             Sets>Tree>Replace Branches
# Description:          Find/Replace branch paths
#                        on a tree structure
# Keyword Shortcut:  "replacebranch"
panel_6 = Panel(" ")
rectangle = Rectangle(Plane=PlaneXY(0, 0, 0), XSize=Domain(-10, 10), YSize=Domain(-5, 5), Radius=0)  # -> Rec, Length
rectangle_2 = Rectangle(Plane=PlaneXY(0, 0, 0), XSize=Domain(-10, 10), YSize=Domain(-5, 5), Radius=0)  # -> Rec, Length
rectangle_3 = Rectangle(Plane=PlaneXY(0, 0, 0), XSize=Domain(-10, 10), YSize=Domain(-5, 5), Radius=0)  # -> Rec, Length
rectangle_4 = Rectangle(Plane=PlaneXY(0, 0, 0), XSize=Domain(-10, 10), YSize=Domain(-5, 5), Radius=0)  # -> Rec, Length
rectangle_5 = Rectangle(Plane=PlaneXY(0, 0, 0), XSize=Domain(-10, 10), YSize=Domain(-5, 5), Radius=0)  # -> Rec, Length
rectangle_6 = Rectangle(Plane=PlaneXY(0, 0, 0), XSize=Domain(-10, 10), YSize=Domain(-5, 5), Radius=0)  # -> Rec, Length
V = VCount(5)
sdivide = DivideSurface(Surface=rectangle.Rec, UCount=10, VCount=5)  # -> Points, Normals, Parameters
sdivide_2 = DivideSurface(Surface=rectangle_2.Rec, UCount=10, VCount=5)  # -> Points, Normals, Parameters
sdivide_3 = DivideSurface(Surface=rectangle_3.Rec, UCount=10, VCount=5)  # -> Points, Normals, Parameters
sdivide_4 = DivideSurface(Surface=rectangle_4.Rec, UCount=10, VCount=5)  # -> Points, Normals, Parameters
sdivide_5 = DivideSurface(Surface=rectangle_5.Rec, UCount=10, VCount=5)  # -> Points, Normals, Parameters
sdivide_6 = DivideSurface(Surface=rectangle_6.Rec, UCount=10, VCount=V)  # -> Points, Normals, Parameters
flatten = FlattenTree(Data=1, Path="{0}")
simplify = SimplifyTree(Tree=1, Front=False)
graft = GraftTree(Data=1, Strip=False)
addition = Addition(A=V, B="1")
flip = FlipMatrix(Data=1)
path_mapper = PathMapper(sdivide_2.Points, source="{A;B;C}(i)", target="{A;B;i%item_count}")
flatten_2 = FlattenTree(Data=sdivide_3.Points, Path="{0}")
flatten_3 = FlattenTree(Data=1, Path="{0}")
simplify_2 = SimplifyTree(Tree=1, Front=False)
flatten_4 = FlattenTree(Data=sdivide_6.Points, Path="{0}")
graft_2 = GraftTree(Data=1, Strip=False)
lng = ListLength(List=flatten_4)
path_mapper_2 = PathMapper(sdivide_4.Points, source="{A;B;C}(i)", target="{A;B;C;i}")
flip_2 = FlipMatrix(Data=1)
path_mapper_3 = PathMapper(sdivide_5.Points, source="{A;B;C}", target="{C}")
path_mapper_4 = PathMapper(sdivide.Points, source="{A;B;C}", target="{1}")
path_mapper_5 = PathMapper(sdivide.Points, source="{A;B;C}", target="{0}")
series = Series(Start=0, Step=1, Count=lng)
path_mapper_6 = PathMapper(flatten_2, source="{A}(i)", target="{i\6}")
flip_3 = FlipMatrix(Data=sdivide_2.Points)
simplify_3 = SimplifyTree(Tree=sdivide_5.Points)
graft_3 = GraftTree(Data=flatten_4, Strip=False)
graft_4 = GraftTree(Data=sdivide_4.Points, Strip=False)
flatten_5 = FlattenTree(Data=sdivide.Points, Path="{0}")
flatten_6 = FlattenTree(Data=sdivide.Points, Path="{1}")
replace = ReplaceBranches(Data=1, Search="0", Replace="{1}")
simplify_4 = SimplifyTree(Tree=graft_3, Front=False)
f_x_y = F2(Function="x\y", X=series, Y=addition)
# ----------------
# {A;B;C}(i) --> {0}
# ----------------
# {0;0;0}(0) --> {0}
# {0;0;0}(1) --> {0}
# {0;0;0}(2) --> {0}
# {0;0;0}(3) --> {0}
# {0;0;0}(4) --> {0}
# {0;0;0}(5) --> {0}
# {0;0;1}(0) --> {0}
# {0;0;1}(1) --> {0}
# {0;0;1}(2) --> {0}
# {0;0;1}(3) --> {0}
# ...
# {0;0;10}(5) --> {0}
# ----------------
# ----------------
# {A;B;C}(i) --> {1}
# ----------------
# {0;0;0}(0) --> {1}
# {0;0;0}(1) --> {1}
# {0;0;0}(2) --> {1}
# {0;0;0}(3) --> {1}
# {0;0;0}(4) --> {1}
# {0;0;0}(5) --> {1}
# {0;0;1}(0) --> {1}
# {0;0;1}(1) --> {1}
# {0;0;1}(2) --> {1}
# {0;0;1}(3) --> {1}
# ...
# {0;0;10}(5) --> {1}
# ----------------
viewer = ParamViewer(sdivide.Points)
viewer_2 = ParamViewer(flatten_5)
viewer_3 = ParamViewer(path_mapper_5)
viewer_4 = ParamViewer(flatten_6)
viewer_5 = ParamViewer(path_mapper_4)
viewer_6 = ParamViewer(flip_3)
viewer_7 = ParamViewer(path_mapper)
viewer_8 = ParamViewer(graft_4)
viewer_9 = ParamViewer(path_mapper_2)
# -----------------------------
# {A;B;C}(i) --> {A;B;i%item_count}
# -----------------------------
# {0;0;0}(0) --> {0;0;0%6} = {0;0;0}
# {0;0;0}(1) --> {0;0;1%6} = {0;0;1}
# {0;0;0}(2) --> {0;0;2%6} = {0;0;2}
# {0;0;0}(3) --> {0;0;3%6} = {0;0;3}
# {0;0;0}(4) --> {0;0;4%6} = {0;0;4}
# {0;0;0}(5) --> {0;0;5%6} = {0;0;5}
# {0;0;1}(0) --> {0;0;0%6} = {0;0;0}
# {0;0;1}(1) --> {0;0;1%6} = {0;0;1}
# {0;0;1}(2) --> {0;0;2%6} = {0;0;2}
# {0;0;1}(3) --> {0;0;3%6} = {0;0;3}
# ...
# {0;0;10}(5) --> {0;0;5%6} = {0;0;5}
# ------------------------------
viewer_10 = ParamViewer(sdivide_2.Points)
# ---------------------
# {A;B;C}(i) --> {A;B;C;i}
# ---------------------
# {0;0;0}(0) --> {0;0;0;0}
# {0;0;0}(1) --> {0;0;0;1}
# {0;0;0}(2) --> {0;0;0;2}
# {0;0;0}(3) --> {0;0;0;3}
# {0;0;0}(4) --> {0;0;0;4}
# {0;0;0}(5) --> {0;0;0;5}
# {0;0;1}(0) --> {0;0;1;0}
# {0;0;1}(1) --> {0;0;1;1}
# {0;0;1}(2) --> {0;0;1;2}
# {0;0;1}(3) --> {0;0;1;3}
# ...
# {0;0;10}(5) --> {0;0;10;5}
# ----------------------
viewer_11 = ParamViewer(sdivide_4.Points)
viewer_12 = ParamViewer(simplify_3)
viewer_13 = ParamViewer(path_mapper_3)
# ----------------
# {A;B;C}(i) --> {C}
# ----------------
# {0;0;0}(0) --> {0}
# {0;0;0}(1) --> {0}
# {0;0;0}(2) --> {0}
# {0;0;0}(3) --> {0}
# {0;0;0}(4) --> {0}
# {0;0;0}(5) --> {0}
# {0;0;1}(0) --> {1}
# {0;0;1}(1) --> {1}
# {0;0;1}(2) --> {1}
# {0;0;1}(3) --> {1}
# ...
# {0;0;10}(5) --> {10}
# ----------------
viewer_14 = ParamViewer(sdivide_5.Points)
# -------------------
# {A}(i) --> {i\x*}
# -------------------
# {0}(0) --> {0\6} = {0}
# {0}(1) --> {1\6} = {0}
# {0}(2) --> {2\6} = {0}
# {0}(3) --> {3\6} = {0}
# {0}(4) --> {4\6} = {0}
# {0}(5) --> {5\6} = {0}
# {0}(6) --> {6\6} = {1}
# {0}(7) --> {7\6} = {1}
# {0}(8) --> {8\6} = {1}
# {0}(9) --> {9\6} = {1}
# ...
# {0}(66) --> {65\6} = {10}
# ---------------------
# *x must be entered manually
viewer_15 = ParamViewer(flatten_2)
viewer_16 = ParamViewer(path_mapper_6)
replace_2 = ReplaceBranches(Data=1, Search="0", Replace="{1}")
viewer_17 = ParamViewer(simplify_4)
replace_3 = ReplaceBranches(Data=simplify_4, Search=viewer_17, Replace=f_x_y)
viewer_18 = ParamViewer(replace_3)
search = Panel(viewer_17)
replace_4 = Panel(f_x_y)
