# Grasshopper definition PnS_Example 1-Curves.gh (Grasshopper 0.9.76)
# plug-ins: PinchNSpread

# ---- group: Points to Pinch or Spread
crv = Curve([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])
divide = DivideCurve(Curve=crv, Count=Slider(35, range=0..100), Kinks=False)  # -> Points, Tangents, Parameters

# ---- group: Radius and Strength
strength_1 = Slider(0.613, range=-1..1)
strength_2 = Slider(-0.703, range=-1..1)
strength_3 = Slider(0.505, range=-1..1)
radius_2 = Slider(500, range=0..500)
radius_3 = Slider(400, range=0..400)
radius_1 = Slider(500, range=0..500)
merge = Merge(Data1=radius_1, Data2=radius_2, Data3=radius_3)
# Multiple values for radius and strength
merge_2 = Merge(Data1=strength_1, Data2=strength_2, Data3=strength_3)

# ---- group: Points to Pinch or Spread
crv_2 = Curve([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])
divide_2 = DivideCurve(Curve=crv_2, Count=Slider(47, range=0..100), Kinks=False)  # -> Points, Tangents, Parameters

# ---- group: Radius and Strength
strength_1_2 = Slider(0.654, range=-1..1)
strength_2_2 = Slider(-1, range=-1..1)
# Location points set off plane from the points to spread effects the pinching and spreading in 3d.
strength_3_2 = Slider(0.505, range=-1..1)
radius_2_2 = Slider(500, range=0..500)
radius_3_2 = Slider(400, range=0..400)
radius_1_2 = Slider(643.36, range=0..1000)
merge_3 = Merge(Data1=radius_1_2, Data2=radius_2_2, Data3=radius_3_2)
merge_4 = Merge(Data1=strength_1_2, Data2=strength_2_2, Data3=strength_3_2)

# ---- group: Points to Pinch or Spread
crv_3 = Curve([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])
divide_3 = DivideCurve(Curve=crv_3, Count=Slider(100, range=0..100), Kinks=False)  # -> Points, Tangents, Parameters

# ---- group: Radius and Strength
# Positive strength to pinch. Change to negative to spread.
# Change number of division points to change tightness of result curve.
strength = Slider(0.6, range=-1..1)
radius = Slider(500, range=0..500)

# ---- group: Points that Pinch or Spread
# Pinch'n'Spread points for curves
pt = Point([Point(-112.0675275, -271.8344158, 0), Point(-820.0939328, 266.0740596, 0), Point(970.3352712, -98.2700515, 0)])

# Pinch'n'Spread points for curves - Multiple Values
pt_2 = Point([Point(970.3352712, -2117.277463, 0), Point(-112.0675275, -2290.841827, 0), Point(-820.0939328, -1752.933351, 0)])

# Pinch'n'Spread points for curves - Locations off Plane
pt_3 = Point([Point(978.3410604, -4127.018705, 479.593576), Point(-104.0617383, -4300.58307, 94.93847179), Point(-812.0881436, -3762.674594, 260.0377673)])

# ----
location = Data(pt)
points = Data(divide.Points)
radius_4 = Data(radius)
strength_4 = Data(strength)
p_n_s = PinchNSpread(Location=location, Points=points, Radius=radius_4, Strength=strength_4)

points_2 = Data(divide_2.Points)
strength_5 = Data(merge_2)
location_2 = Data(pt_2)
radius_5 = Data(merge)
p_n_s_2 = PinchNSpread(Location=location_2, Points=points_2, Radius=radius_5, Strength=strength_5)

# ---- group: Preview Radius
msphere = MeshSphere(Base=pt, Radius=radius, UCount=10, VCount=20)

msphere_2 = MeshSphere(Base=pt_2, Radius=merge, UCount=10, VCount=20)

# ----
points_3 = Data(divide_3.Points)
strength_6 = Data(merge_4)
location_3 = Data(pt_3)
radius_6 = Data(merge_3)
p_n_s_3 = PinchNSpread(Location=location_3, Points=points_3, Radius=radius_6, Strength=strength_6)

# ---- group: Preview Radius
msphere_3 = MeshSphere(Base=pt_3, Radius=merge_3, UCount=10, VCount=20)

# ---- group: Make Curves
nurbs = NurbsCurve(Vertices=p_n_s, Degree=3, Periodic=False)  # -> Curve, Length, Domain
# Pinch'n'Spread
preview = CustomPreview(Geometry=nurbs.Curve, Shader=ColourSwatch(SwatchColor=RGB(47, 245, 192)))

nurbs_2 = NurbsCurve(Vertices=p_n_s_2, Degree=3, Periodic=False)  # -> Curve, Length, Domain
# Pinch'n'Spread
preview_2 = CustomPreview(Geometry=nurbs_2.Curve, Shader=ColourSwatch(SwatchColor=RGB(205, 245, 47)))

nurbs_3 = NurbsCurve(Vertices=p_n_s_3, Degree=3, Periodic=False)  # -> Curve, Length, Domain
# Pinch'n'Spread
preview_3 = CustomPreview(Geometry=nurbs_3.Curve, Shader=ColourSwatch(SwatchColor=RGB(47, 245, 119)))

# ---- group: Points to Pinch or Spread
crv_4 = Curve([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])
divide_4 = DivideCurve(Curve=crv_4, Count=Slider(35, range=0..100), Kinks=False)  # -> Points, Tangents, Parameters

# ---- group: Radius and Strength
strength_7 = Slider(0.6, range=-1..1)
radius_7 = Slider(500, range=0..500)

# ---- group: Points that Pinch or Spread
# Pinch'n'Spread points for curves - Using Anchors
pt_4 = Point([Point(-2313.558681, -98.2700515, 0), Point(-3395.96148, -271.8344158, 0), Point(-4103.987885, 266.0740596, 0)])

# ---- group: Preview Radius
msphere_4 = MeshSphere(Base=pt_4, Radius=radius_7, UCount=10, VCount=20)

# ----
location_4 = Data(pt_4)
radius_8 = Data(radius_7)
points_4 = Data(divide_4.Points)
strength_8 = Data(strength_7)

# ---- group: Anchor Points (start & end points in this case)
item = ListItem(List=reverse(points_4), Index=0, Wrap=True)
item_2 = ListItem(List=points_4, Index=0, Wrap=True)
merge_5 = Merge(Data1=item_2, Data2=item)

# ----
p_n_s_4 = PinchNSpread(Location=location_4, Points=points_4, Radius=radius_8, Strength=strength_8, Anchors=merge_5)

# ---- group: Make Curves
# Anchor Points are specific points from the point(P)
# list that you do not want to be effected by the pinch&spread
swatch = ColourSwatch(SwatchColor=RGB(47, 245, 192))
nurbs_4 = NurbsCurve(Vertices=p_n_s_4, Degree=3, Periodic=False)  # -> Curve, Length, Domain
# Pinch'n'Spread
preview_4 = CustomPreview(Geometry=nurbs_4.Curve, Shader=swatch)
