# Grasshopper definition PnS_Example 2-Grids.gh (Grasshopper 0.9.76)
# plug-ins: PinchNSpread

# ---- group: Grid of Polylines
# Change number of division points to change tightness of result curve.
# Pinch'n'Spread 2d Grid - Locations off Plane
number_slider = Slider(36, range=0..100)
# Pinch'n'Spread 2d Grid
number_slider_2 = Slider(100, range=0..100)
# You can use multiple radius and
# strengths to set different values to each
# pinch and spread location point. - add
# more sliders
sqgrid = Square(Plane=PlaneXY(0, 0, 0), Size=number_slider_2, ExtentX=number_slider, ExtentY=number_slider)  # -> Cells, Points
flip = FlipMatrix(Data=sqgrid.Points)
merge = Merge(Data1=sqgrid.Points, Data2=simplify(flip))
pline = PolyLine(Vertices=merge, Closed=False)

# Change number of division points to change tightness of result curve.
# Pinch'n'Spread 3d Grid - Negative strength
number_slider_3 = Slider(36, range=0..100)
# You can use multiple radius and
# strengths to set different values to each
# pinch and spread location point. - add
# more sliders
sqgrid_2 = Square(Plane=PlaneXY(0, -5215.974269, 0), Size=Slider(100, range=0..100), ExtentX=number_slider_3, ExtentY=number_slider_3)  # -> Cells, Points
flip_2 = FlipMatrix(Data=sqgrid_2.Points)
merge_2 = Merge(Data1=sqgrid_2.Points, Data2=simplify(flip_2))
pline_2 = PolyLine(Vertices=merge_2, Closed=False)

# ---- group: 3d grid
crv = Curve([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])

crv_2 = Curve([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])

# ---- group: Points that Pinch or Spread
bbox = BoundingBox(Content=crv, Plane=PlaneXY(0, 0, 0), UnionBox=True)  # -> Box, Box_2
pop3d = Populate3D(Region=bbox.Box, Count=Slider(7, range=0..100), Seed=1)

bbox_2 = BoundingBox(Content=crv_2, Plane=PlaneXY(0, 0, 0), UnionBox=True)  # -> Box, Box_2
pop3d_2 = Populate3D(Region=bbox_2.Box, Count=Slider(12, range=0..100), Seed=1)

# ---- group: Radius and Strength
strength = Slider(-0.898, range=-1..1)
radius = Slider(1265.351, range=0..2000)

# Pinch'n'Spread 3d Grid - Positive strength
radius_2 = Slider(1540.636, range=0..2000)
strength_2 = Slider(0.852, range=-1..1)

strength_3 = Slider(0.795, range=-1..1)
radius_3 = Slider(1330, range=0..2000)

strength_4 = Slider(-0.73, range=-1..1)
radius_4 = Slider(1088.198, range=0..2000)

# ---- group: Points that Pinch or Spread
pt = Point([Point(794.0346456, 2433.132224, 0), Point(1330.596917, 789.9631519, 0), Point(2402.018407, 1121.632763, 0), Point(1812.200649, 2183.927813, 0), Point(2677.894603, 2812.888362, 0)])

# ---- group: Points to Spread
divide = DivideCurve(Curve=crv, Count=Slider(6, range=0..100), Kinks=False)  # -> Points, Tangents, Parameters

# ---- group: Points that Pinch or Spread
pt_2 = Point([Point(670.1115657, -2804.532599, -271.6214658), Point(1168.697831, -4100.856589, -231.805972), Point(2402.018407, -4044.678648, -249.6603798), Point(1812.200649, -2522.124777, 210.7529949), Point(2677.894603, -2462.372561, -193.3527804)])

# ---- group: Points to Spread
divide_2 = DivideCurve(Curve=crv_2, Count=Slider(12, range=0..100), Kinks=False)  # -> Points, Tangents, Parameters

# ---- group: Preview Radius
msphere = MeshSphere(Base=pop3d, Radius=radius, UCount=10, VCount=20)

msphere_2 = MeshSphere(Base=pop3d_2, Radius=radius_2, UCount=10, VCount=20)

# ---- group: Points to Spread
divide_3 = DivideCurve(Curve=pline, Count=Slider(12, range=0..100), Kinks=False)  # -> Points, Tangents, Parameters

divide_4 = DivideCurve(Curve=pline_2, Count=Slider(22, range=0..100), Kinks=False)  # -> Points, Tangents, Parameters

# ---- group: Preview Radius
msphere_3 = MeshSphere(Base=pt, Radius=radius_3, UCount=10, VCount=20)

msphere_4 = MeshSphere(Base=pt_2, Radius=radius_4, UCount=10, VCount=20)

# ----
# You can use multiple radius and
# strengths to set different values to each
# pinch and spread location point. - add
# more sliders
# Change number of division points to change tightness of result curve.
p_n_s = PinchNSpread(Location=pop3d, Points=divide.Points, Radius=radius, Strength=strength)

# ----
# You can use multiple radius and
# strengths to set different values to each
# pinch and spread location point. - add
# more sliders
# Change number of division points to change tightness of result curve.
p_n_s_2 = PinchNSpread(Location=pop3d_2, Points=divide_2.Points, Radius=radius_2, Strength=strength_2)

p_n_s_3 = PinchNSpread(Location=pt, Points=divide_3.Points, Radius=radius_3, Strength=strength_3)

p_n_s_4 = PinchNSpread(Location=pt_2, Points=divide_4.Points, Radius=radius_4, Strength=strength_4)

# ---- group: Make Curves
nurbs = NurbsCurve(Vertices=p_n_s, Degree=3, Periodic=False)  # -> Curve, Length, Domain
# Pinch'n'Spread
preview = CustomPreview(Geometry=nurbs.Curve, Shader=ColourSwatch(SwatchColor=RGB(46, 252, 255)))

nurbs_2 = NurbsCurve(Vertices=p_n_s_2, Degree=3, Periodic=False)  # -> Curve, Length, Domain
# Pinch'n'Spread
preview_2 = CustomPreview(Geometry=nurbs_2.Curve, Shader=ColourSwatch(SwatchColor=RGB(119, 255, 46)))

nurbs_3 = NurbsCurve(Vertices=p_n_s_3, Degree=3, Periodic=False)  # -> Curve, Length, Domain
# Pinch'n'Spread
preview_3 = CustomPreview(Geometry=nurbs_3.Curve, Shader=ColourSwatch(SwatchColor=RGB(47, 245, 192)))

nurbs_4 = NurbsCurve(Vertices=p_n_s_4, Degree=3, Periodic=False)  # -> Curve, Length, Domain
# Pinch'n'Spread
preview_4 = CustomPreview(Geometry=nurbs_4.Curve, Shader=ColourSwatch(SwatchColor=RGB(47, 202, 245)))

# ---- group: Grid of Polylines
# Change number of division points to change tightness of result curve.
number_slider_4 = Slider(36, range=0..100)
# Pinch'n'Spread 2d Grid - Positive strength with Anchors
number_slider_5 = Slider(100, range=0..100)
# You can use multiple radius and
# strengths to set different values to each
# pinch and spread location point. - add
# more sliders
sqgrid_3 = Square(Plane=PlaneXY(-5808.37949, 0, 0), Size=number_slider_5, ExtentX=number_slider_4, ExtentY=number_slider_4)  # -> Cells, Points
flip_3 = FlipMatrix(Data=sqgrid_3.Points)
merge_3 = Merge(Data1=sqgrid_3.Points, Data2=simplify(flip_3))
pline_3 = PolyLine(Vertices=merge_3, Closed=False)

# ---- group: 3d grid
crv_3 = Curve([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])

# ---- group: Points that Pinch or Spread
bbox_3 = BoundingBox(Content=crv_3, Plane=PlaneXY(0, 0, 0), UnionBox=True)  # -> Box, Box_2
pop3d_3 = Populate3D(Region=bbox_3.Box, Count=Slider(12, range=0..100), Seed=1)

# ---- group: Radius and Strength
strength_5 = Slider(0.817, range=-1..1)
# Pinch'n'Spread 3d Grid - Positive strength with Anchors
radius_5 = Slider(1533.801, range=0..2000)

strength_6 = Slider(0.856, range=-1..1)
radius_6 = Slider(1130, range=0..2000)

# ---- group: Points to Spread
divide_5 = DivideCurve(Curve=crv_3, Count=Slider(12, range=0..100), Kinks=False)  # -> Points, Tangents, Parameters

# ---- group: Points that Pinch or Spread
pt_3 = Point([Point(-5295.434151, 2433.132224, 0), Point(-4626.40979, 789.9631519, 0), Point(-3343.167038, 1121.632763, 0), Point(-3538.294143, 2183.927813, 0), Point(-2763.737559, 2812.888362, 0)])

# ---- group: Preview Radius
msphere_5 = MeshSphere(Base=pop3d_3, Radius=radius_5, UCount=10, VCount=20)

# ---- group: Points to Spread
divide_6 = DivideCurve(Curve=pline_3, Count=Slider(12, range=0..100), Kinks=False)  # -> Points, Tangents, Parameters

# ---- group: Preview Radius
msphere_6 = MeshSphere(Base=pt_3, Radius=radius_6, UCount=10, VCount=20)

# ---- group: Anchor Points (start & end points in this case)
item = ListItem(List=reverse(divide_5.Points), Index=0, Wrap=True)
item_2 = ListItem(List=divide_5.Points, Index=0, Wrap=True)
# Anchor Points are specific points from the point(P)
# list that you do not want to be effected by the pinch&spread
merge_4 = Merge(Data1=item_2, Data2=item)

item_3 = ListItem(List=reverse(divide_6.Points), Index=0, Wrap=True)
item_4 = ListItem(List=divide_6.Points, Index=0, Wrap=True)
# Anchor Points are specific points from the point(P)
# list that you do not want to be effected by the pinch&spread
merge_5 = Merge(Data1=item_4, Data2=item_3)

# ----
# You can use multiple radius and
# strengths to set different values to each
# pinch and spread location point. - add
# more sliders
# Change number of division points to change tightness of result curve.
p_n_s_5 = PinchNSpread(Location=pop3d_3, Points=divide_5.Points, Radius=radius_5, Strength=strength_5, Anchors=merge_4)

p_n_s_6 = PinchNSpread(Location=pt_3, Points=divide_6.Points, Radius=radius_6, Strength=strength_6, Anchors=merge_5)

# ---- group: Make Curves
nurbs_5 = NurbsCurve(Vertices=p_n_s_5, Degree=3, Periodic=False)  # -> Curve, Length, Domain
# Pinch'n'Spread
preview_5 = CustomPreview(Geometry=nurbs_5.Curve, Shader=ColourSwatch(SwatchColor=RGB(119, 255, 46)))

nurbs_6 = NurbsCurve(Vertices=p_n_s_6, Degree=3, Periodic=False)  # -> Curve, Length, Domain
# Pinch'n'Spread
preview_6 = CustomPreview(Geometry=nurbs_6.Curve, Shader=ColourSwatch(SwatchColor=RGB(47, 245, 192)))
