# Grasshopper definition PnS_Example 3-Surface and Mesh.gh (Grasshopper 0.9.76)
# plug-ins: MeshEdit Components, PinchNSpread

# ---- group: Radius and Strength
strength = Slider(-1, range=-1..1)
# Pinch'n'Spread Surface
radius = Slider(1624.221, range=0..2000)

strength_2 = Slider(-1, range=-1..1)
# Pinch'n'Spread Mesh
radius_2 = Slider(1579.126, range=0..2000)

# ---- group: Points that Pinch or Spread
pt = Point([Point(794.0346456, 2433.132224, -566.4643509), Point(1036.046544, 131.0633995, 498.3241286), Point(2402.018407, 542.8754227, -547.1301264), Point(2104.855947, 2629.404484, -397.9065342), Point(3760.847314, 2812.888362, 441.126402)])

pt_2 = Point([Point(2464.643095, 6711.158988, 659.3882111), Point(2659.955811, 8487.546875, -522.0714434), Point(721.340332, 8099.82373, 856.5055113), Point(721.340332, 6548.931152, -378.4348741)])

# ---- group: Preview Radius
msphere = MeshSphere(Base=pt, Radius=radius, UCount=10, VCount=20)

msphere_2 = MeshSphere(Base=pt_2, Radius=radius_2, UCount=10, VCount=20)

# ---- group: Radius and Strength
strength_3 = Slider(0.987, range=-1..1)
# Pinch'n'Spread Mesh - with Anchors
radius_3 = Slider(2000, range=0..2000)

# ---- group: Points that Pinch or Spread
pt_3 = Point([Point(7268.651283, 6548.931152, -1523.83512), Point(6789.593013, 8660.024611, 685.5029031), Point(9011.954046, 6711.158988, 1654.749298), Point(9207.266762, 8487.546875, -949.3321023)])

# ---- group: Preview Radius
msphere_3 = MeshSphere(Base=pt_3, Radius=radius_3, UCount=10, VCount=20)

# ----
# You can use multiple radius and
# strengths to set different values to each
# pinch and spread location point. - add
# more sliders
# Positive strength to pinch. Negative to spread.
srf = Surface(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)

# ---- group: Points to spread
srfpt = SurfacePoints(Surface=srf)  # -> Points, Weights, Greville, UCount, VCount

# ----
p_n_s = PinchNSpread(Location=pt, Points=srfpt.Points, Radius=radius, Strength=strength)

# ---- group: Make Surface
srfgrid = SurfaceFromPoints(Points=p_n_s, UCount=srfpt.UCount, Interpolate=False)
# Pinch'n'Spread
preview = CustomPreview(Geometry=srfgrid, Shader=ColourSwatch(SwatchColor=RGB(47, 245, 192)))

# ----
# You can use multiple radius and
# strengths to set different values to each
# pinch and spread location point. - add
# more sliders
# Positive strength to pinch. Negative to spread.
mesh = Mesh(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)

# ---- group: Points to spread
demesh = DeconstructMesh(Mesh=mesh)  # -> Vertices, Faces, Colours, Normals

# ----
p_n_s_2 = PinchNSpread(Location=pt_2, Points=demesh.Vertices, Radius=radius_2, Strength=strength_2)

# ---- group: Make Mesh
strength_4 = Slider(1, range=-1..1)
conmesh = ConstructMesh(Vertices=p_n_s_2, Faces=demesh.Faces)
msmooth = SmoothMesh(Mesh=conmesh, Strength=strength_4, SkipNaked=True, Iterations=Slider(10, range=0..10))
# Pinch'n'Spread
preview_2 = CustomPreview(Geometry=msmooth, Shader=ColourSwatch(SwatchColor=RGB(245, 199, 47)))

# ----
# You can use multiple radius and
# strengths to set different values to each
# pinch and spread location point. - add
# more sliders
# Positive strength to pinch. Negative to spread.
mesh_2 = Mesh(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)

# ---- group: Points to spread
demesh_2 = DeconstructMesh(Mesh=mesh_2)  # -> Vertices, Faces, Colours, Normals

# ---- group: Anchor Points (naked edges in this case)
nakededge = MeshNakedEdge(Mesh=mesh_2)  # -> V, A, B
item = ListItem(List=nakededge.V, Index=nakededge.A, Wrap=True)

# ----
p_n_s_3 = PinchNSpread(Location=pt_3, Points=demesh_2.Vertices, Radius=radius_3, Strength=strength_3, Anchors=item)

# ---- group: Make Mesh
strength_5 = Slider(1, range=-1..1)
conmesh_2 = ConstructMesh(Vertices=p_n_s_3, Faces=demesh_2.Faces)
msmooth_2 = SmoothMesh(Mesh=conmesh_2, Strength=strength_5, SkipNaked=True, Iterations=Slider(10, range=0..10))
# Pinch'n'Spread
preview_3 = CustomPreview(Geometry=msmooth_2, Shader=ColourSwatch(SwatchColor=RGB(245, 199, 47)))
