# Grasshopper definition PnS_Example 4-Mesh Extra.gh (Grasshopper 0.9.76)
# plug-ins: MeshEdit Components, PinchNSpread, Weaverbird

# ---- group: Mesh Plane
# Pinch'n'Spread Mesh - Point Suction
mesh = Mesh(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)

# Pinch'n'Spread Mesh - Bubble Tower
mesh_2 = Mesh(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)

# ---- group: Points that Pinch or Spread
demesh = DeconstructMesh(Mesh=mesh_2)  # -> Vertices, Faces, Colours, Normals

# ---- group: Volume to fill with Location Points
volume = Volume(Geometry=mesh_2)  # -> Volume, Centroid
bbox = BoundingBox(Content=mesh_2, Plane=PlaneXY(0, 0, 0))  # -> Box, Box_2
scale = Scale(Geometry=bbox.Box, Center=volume.Centroid, Factor=Slider(0.9, range=0..10))  # -> Geometry, Transform

# ---- group: Radius and Strength
number_slider = Slider(0.895, range=0..1)
number_slider_2 = Slider(26.938, range=0..50)

# ---- group: Points that Pinch or Spread
demesh_2 = DeconstructMesh(Mesh=mesh)  # -> Vertices, Faces, Colours, Normals

# ---- group: Anchor Points
nakededge = MeshNakedEdge(Mesh=mesh)  # -> V, A, B
item = ListItem(List=nakededge.V, Index=nakededge.A, Wrap=True)

# ---- group: Points that Pinch or Spread
pop3d = Populate3D(Region=scale.Geometry, Count=Slider(28, range=0..100), Seed=Slider(13, range=0..100))

pt = Point([Point(-167.5288027, -86.43407569, -21.62033459), Point(-133.0365585, -120.3922409, -21.62033459), Point(-170.0606477, -147.6227373, -21.62033459), Point(-87.43344545, -86.43407569, -21.62033459), Point(-121.9256896, -120.3922409, -21.62033459), Point(-84.90160036, -147.6227373, -21.62033459)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])

# ---- group: Radius and Strength
number_slider_3 = Slider(11.114, range=0..20)
number_slider_4 = Slider(-1, range=-1..0)

# ----
# Change the strength
# to change suction
p_n_s = PinchNSpread(Location=pt, Points=demesh_2.Vertices, Radius=number_slider_2, Strength=number_slider, Anchors=item)

# ---- group: Reconstruct Mesh
conmesh = ConstructMesh(Vertices=p_n_s, Faces=demesh_2.Faces)

# ----
# Change the strength
# to inflate bubbles
p_n_s_2 = PinchNSpread(Location=pop3d, Points=demesh.Vertices, Radius=number_slider_3, Strength=number_slider_4)

# ---- group: Smooth Mesh
wblaplace = WeaverbirdsLaplacianSmoothing(MeshCurves=conmesh, Level=8, SmoothNakedEdges=0, Thin=1)
wbcatmullclark = WeaverbirdsCatmullClarkSubdivision(MeshCurves=wblaplace, Level=1, SmoothNakedEdges=1)
# Pinch'n'Spread
preview = CustomPreview(Geometry=wbcatmullclark, Shader=ColourSwatch(SwatchColor=RGB(243, 105, 250)))

# ---- group: Reconstruct Mesh
conmesh_2 = ConstructMesh(Vertices=p_n_s_2, Faces=demesh.Faces)

# ---- group: Smooth Mesh
wblaplace_2 = WeaverbirdsLaplacianSmoothing(MeshCurves=conmesh_2, Level=8, SmoothNakedEdges=0, Thin=1)
wbcatmullclark_2 = WeaverbirdsCatmullClarkSubdivision(MeshCurves=wblaplace_2, Level=1, SmoothNakedEdges=1)
# Pinch'n'Spread
preview_2 = CustomPreview(Geometry=wbcatmullclark_2, Shader=ColourSwatch(SwatchColor=RGB(0, 149, 255)))
