# Grasshopper definition LBML_GaussianMixture-2D.gh (Grasshopper 0.9.76)
# plug-ins: LunchBoxML

# Gaussian Mixture
# Version:  2017.07.27
# Company Info: Authored by Proving Ground
# 
# http://ProvingGround.io
# Copyright (c) 2017 Proving Ground LLC
pt = Point([Point(36.37578333, 11.345662, 0), Point(32.03957431, 13.62217174, 0), Point(33.12362656, 17.19954419, 0), Point(38.11026694, 17.84997554, 0), Point(39.30272442, 21.10213231, 0), Point(46.13225364, 17.09113896, 0)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])

# ---- group: Input Data
pdecon = Deconstruct(Point=pt)  # -> XComponent, YComponent, ZComponent
panel = Panel(pdecon.XComponent)
panel_2 = Panel(pdecon.YComponent)
entwine = Entwine(Branch00=panel, Branch01=panel_2, FlattenInputs=True)
flip = FlipMatrix(Data=entwine)

# ----
gaussianmix = GaussianMixture(Inputs=flip, Components=Slider(5, range=0..10), RandomSeed=Slider(-8, range=-10..10))  # -> Result, Likelihood, Probability

# ---- group: Result Plot
cset = CreateSet(List=gaussianmix.Result)  # -> Set, Map
lng = ListLength(List=cset.Set)
gradient = Gradient(
    LowerLimit=0,
    UpperLimit=lng,
    Parameter=cset.Map,
    stops=[0: RGB(234, 38, 0), 0.25: RGB(234, 126, 0), 0.5: RGB(254, 244, 84), 0.75: RGB(173, 203, 249), 1: RGB(75, 107, 169)])
argb = SplitARGB(Colour=gradient, IntegerChannels=True)  # -> Alpha, Red, Green, Blue
rgb = ColourRGB(Alpha=Slider(122, range=0..255), Red=argb.Red, Green=argb.Green, Blue=argb.Blue)
preview = CustomPreview(Geometry=pt, Shader=rgb)
