# Grasshopper definition LBML_GaussianMixture-3D.gh (Grasshopper 0.9.76)
# plug-ins: LunchBoxML

# Gaussian Mixture - 3D Points
# Version:  2017.07.27
# Company Info: Authored by Proving Ground
# 
# http://ProvingGround.io
# Copyright (c) 2017 Proving Ground LLC
pt = Point([Point(28.67273517, 4.331811554, 0), Point(28.73955757, 6.937885343, 0), Point(32.28114503, 16.62713405, 0), Point(15.57918526, 9.783392537, -4), Point(17.39411477, 11.02084448, -4), Point(17.22912118, 9.123418169, -4)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])

# ---- group: Input Data
pdecon = Deconstruct(Point=pt)  # -> XComponent, YComponent, ZComponent
panel = Panel(pdecon.XComponent)
panel_2 = Panel(pdecon.YComponent)
panel_3 = Panel(pdecon.ZComponent)
entwine = Entwine(Branch00=panel, Branch01=panel_2, Branch02=panel_3, FlattenInputs=True)
flip = FlipMatrix(Data=entwine)

# ----
gaussianmix = GaussianMixture(Inputs=flip, Components=Slider(4, range=0..10), RandomSeed=Slider(0, range=-10..10))  # -> Result, Likelihood, Probability

# ---- group: Result Plot
cset = CreateSet(List=gaussianmix.Result)  # -> Set, Map
lng = ListLength(List=cset.Set)
gradient = Gradient(
    LowerLimit=0,
    UpperLimit=lng,
    Parameter=cset.Map,
    stops=[0: RGB(234, 38, 0), 0.25: RGB(234, 126, 0), 0.5: RGB(254, 244, 84), 0.75: RGB(173, 203, 249), 1: RGB(75, 107, 169)])
argb = SplitARGB(Colour=gradient, IntegerChannels=True)  # -> Alpha, Red, Green, Blue
rgb = ColourRGB(Alpha=Slider(122, range=0..255), Red=argb.Red, Green=argb.Green, Blue=argb.Blue)
preview = CustomPreview(Geometry=pt, Shader=rgb)
