# Grasshopper definition LBML_GaussianMixture-5D-SchoolOfFish.gh (Grasshopper 0.9.76)
# plug-ins: LunchBoxML

# ---- group: "Importance" of parameter to classification
direction_importance = Slider(1, range=0.1..10)
size_importance = Slider(1, range=0.1..10)
location_importance = Slider(1, range=0.1..10)

# ---- group: Main input parameters
number_of_fish = Slider(2000, range=0..2000)
direction_seed = Slider(781, range=0..1000)
location_seed = Slider(1000, range=0..1000)
size_range = Panel("0.25 to 2.0")
# Gaussian Mixture - 5D School of Fish
# Version:  2017.07.27
# Company Info: Authored by Proving Ground
# 
# http://ProvingGround.io
# Copyright (c) 2017 Proving Ground LLC
location_range = Panel("0 to 100")
direction_range = Panel("-1 to 1")

# ---- group: Number of clusters
number_slider = Slider(3, range=0..20)

# ----
random = Random(Range=location_range, Number=expr("x*2", number_of_fish), Seed=location_seed)
random_2 = Random(Range=direction_range, Number=expr("x*2", number_of_fish), Seed=direction_seed)
random_3 = Random(Range=size_range, Number=number_of_fish, Seed=2)
pt2num = NumbersToPoints(Numbers=random, Mask="XY")
pt2num_2 = NumbersToPoints(Numbers=random_2, Mask="XY")
fish = CSharpScript(P=pt2num, V=pt2num_2, S=random_3)  # -> out, A; inputs P: Point3d, V: Vector3d, S: Double
# ---------- fish: C# ----------
    Plane pln = new Plane(P, Vector3d.ZAxis);
    pln.Rotate(Vector3d.VectorAngle(Vector3d.XAxis, V, Plane.WorldXY), Vector3d.ZAxis);

    var pts = new List<Point3d>();

    pts.Add(pln.PointAt(S, 0, 0));
    pts.Add(pln.PointAt(-S / 2, S / 2, 0));
    pts.Add(P);
    pts.Add(pln.PointAt(-S / 2, -S / 2, 0));
    pts.Add(pln.PointAt(S, 0, 0));

    A = new Polyline(pts);
# ---------- end fish ----------
vec = Vector(unitize(pt2num_2))

# ---- group: Data regularization
pdecon = Deconstruct(Point=pt2num)  # -> XComponent, YComponent, ZComponent
pdecon_2 = Deconstruct(Point=vec)  # -> XComponent, YComponent, ZComponent
remap = RemapNumbers(Value=pdecon.XComponent, Source=location_range, Target=Domain(0, 1))  # -> Mapped, Clipped
remap_2 = RemapNumbers(Value=pdecon.YComponent, Source=location_range, Target=Domain(0, 1))  # -> Mapped, Clipped
remap_3 = RemapNumbers(Value=random_3, Source=size_range, Target=Domain(0, 1))  # -> Mapped, Clipped
remap_4 = RemapNumbers(Value=pdecon_2.XComponent, Source=direction_range, Target=Domain(0, 1))  # -> Mapped, Clipped
remap_5 = RemapNumbers(Value=pdecon_2.YComponent, Source=direction_range, Target=Domain(0, 1))  # -> Mapped, Clipped
multiplication = Multiplication(A=remap.Mapped, B=location_importance)
multiplication_2 = Multiplication(A=remap_2.Mapped, B=location_importance)
multiplication_3 = Multiplication(A=remap_4.Mapped, B=direction_importance)
multiplication_4 = Multiplication(A=remap_5.Mapped, B=direction_importance)
multiplication_5 = Multiplication(A=remap_3.Mapped, B=size_importance)
entwine = Entwine(
    Branch00=multiplication,
    Branch01=multiplication_2,
    Branch02=multiplication_3,
    Branch03=multiplication_4,
    Branch04=multiplication_5,
    FlattenInputs=True)
flip = FlipMatrix(Data=entwine)

# ----
gaussianmix = GaussianMixture(Inputs=flip, Components=number_slider, RandomSeed=5)  # -> Result, Likelihood, Probability

# ---- group: Result Plot
cset = CreateSet(List=gaussianmix.Result)  # -> Set, Map
lng = ListLength(List=cset.Set)
gradient = Gradient(
    LowerLimit=0,
    UpperLimit=lng,
    Parameter=cset.Map,
    stops=[0: RGB(243, 57, 0), 0.1: RGB(236, 27, 60), 0.2: RGB(210, 0, 118), 0.3: RGB(103, 0, 120), 0.4: RGB(39, 72, 161), 0.5: RGB(1, 192, 229), 0.6: RGB(18, 178, 90), 0.7: RGB(79, 186, 8), 0.8: RGB(220, 237, 32), 0.9: RGB(247, 159, 20), 1: RGB(243, 57, 0)])
argb = SplitARGB(Colour=gradient, IntegerChannels=True)  # -> Alpha, Red, Green, Blue
rgb = ColourRGB(Alpha=Slider(122, range=0..255), Red=argb.Red, Green=argb.Green, Blue=argb.Blue)
mcol = MeshColours(Mesh=graft(fish.A), Colours=graft(rgb))
