# Grasshopper definition LBML_LinearRegression-LinePlot.gh (Grasshopper 0.9.76)
# plug-ins: Human, LunchBoxML

# ---- group: Input points
# Company Info: Authored by Proving Ground
# 
# http://ProvingGround.io
# Copyright (c) 2017 Proving Ground LLC
pt = Point([Point(48.85484087, 42.93944115, 0), Point(47.54230675, 39.26946931, 0), Point(46.48351837, 36.27833523, 0), Point(17.5074815, 13.16084453, 0), Point(31.61152177, 22.39151598, 0), Point(36.3971641, 22.07227592, 0)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])
pdecon = Deconstruct(Point=pt)  # -> XComponent, YComponent, ZComponent
preview = CustomPreview(Geometry=pt, Shader=ColourSwatch(SwatchColor=RGB(255, 0, 115)))

# ---- group: X Test
# Linear Regression
# Version:  2017/07/21
series = Series(Start=0, Step=5, Count=10)

# ----
linereg = LinearRegression(TestData=series, Inputs=pdecon.XComponent, Output=pdecon.YComponent, RandomSeed=5)

# ---- group: LIne Plot
pt_2 = ConstructPoint(XCoordinate=series, YCoordinate=linereg, ZCoordinate=0)
pline = PolyLine(Vertices=pt_2, Closed=False)
previewlw = CustomPreviewLineweights(Geometry=pline, Shader=ColourSwatch(SwatchColor=RGB(255, 255, 255)), Thickness=Slider(3, range=0..10), Absolute=False)
