# Grasshopper definition LBML_MultivariateLinearRegression.gh (Grasshopper 0.9.76)
# plug-ins: Human, LunchBoxML

# ---- group: Sample Data
# Multivariate Linear Regression - 3D Line Plot
# Version:  2017.07.27
# Company Info: Authored by Proving Ground
# 
# http://ProvingGround.io
# Copyright (c) 2017 Proving Ground LLC
pt = Point([Point(1.351036543, 3.971966414, -8.539178762), Point(1.230609394, 8.840402651, -6.562385308), Point(3.995575449, 4.68975127, -8.247727393), Point(10.00861558, 18.09229774, -2.805719973), Point(18.62721199, 5.908814564, -7.752735527), Point(20.1565894, 17.80562482, -2.922121448)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])
pdecon = Deconstruct(Point=pt)  # -> XComponent, YComponent, ZComponent
preview = CustomPreview(Geometry=pt, Shader=ColourSwatch(SwatchColor=RGB(255, 0, 115)))
entwine = Entwine(Branch00=pdecon.YComponent, Branch01=pdecon.ZComponent, FlattenInputs=True)
flip = FlipMatrix(Data=entwine)

# ---- group: Test Data
series = Series(Start=0, Step=5, Count=10)

# ---- group: Multivariate Linerar Regression
multilinereg = MultivariateLinearRegression(TestData=graft(series), Inputs=graft(pdecon.XComponent), Output=flip, RandomSeed=5)

# ---- group: Curve Plot
flip_2 = FlipMatrix(Data=multilinereg)
branch = TreeBranch(Tree=flip_2, Path="{1}", MaintainPaths=True)
branch_2 = TreeBranch(Tree=flip_2, Path="{0}", MaintainPaths=True)
pt_2 = ConstructPoint(XCoordinate=series, YCoordinate=branch_2, ZCoordinate=branch)
pline = PolyLine(Vertices=pt_2, Closed=False)
previewlw = CustomPreviewLineweights(Geometry=pline, Shader=ColourSwatch(SwatchColor=RGB(255, 255, 255)), Thickness=Slider(4, range=0..10), Absolute=False)
