# Grasshopper definition LBML_NonlinearRegression-CurvePlot.gh (Grasshopper 0.9.76)
# plug-ins: Human, LunchBoxML

# ---- group: Sample Points
pt = Point([Point(25.0973048, 20.94949138, 0), Point(26.33156766, 20.61724581, 0), Point(30.5683667, 18.61734927, 0), Point(29.70665446, 19.958941, 0), Point(33.87801945, 19.41892409, 0), Point(35.13680678, 17.85952601, 0)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])
# Nonlinear Regression
# Version:  2017.7.23
# Company Info: Authored by Proving Ground
# 
# http://ProvingGround.io
# Copyright (c) 2017 Proving Ground LLC
swatch = ColourSwatch(SwatchColor=RGB(255, 0, 115))
pdecon = Deconstruct(Point=pt)  # -> graft(XComponent), YComponent, ZComponent
preview = CustomPreview(Geometry=pt, Shader=swatch)

# ---- group: Test X Value
series = Series(Start=0, Step=2, Count=25)  # -> graft(Series)

# ---- group: Nonlinear Solver
seqminreg = SequentialMinimalOptimizationRegression(
    TestData=series,
    Inputs=pdecon.XComponent,
    Output=pdecon.YComponent,
    Degree=Slider(15, range=0..50),
    Complexity=Slider(65, range=0..100),
    RandomSeed=5)  # -> Result, Score, Error

# ---- group: Fit Curve
pt_2 = ConstructPoint(XCoordinate=flatten(series), YCoordinate=flatten(seqminreg.Result), ZCoordinate=0)
intcrv = Interpolate(Vertices=pt_2, Degree=3, Periodic=False, KnotStyle=1)  # -> Curve, Length, Domain
previewlw = CustomPreviewLineweights(
    Geometry=intcrv.Curve,
    Shader=ColourSwatch(SwatchColor=RGB(255, 255, 255)),
    Thickness=Slider(4, range=0..5),
    Absolute=False)
