# Grasshopper definition LBML_NonlinearRegression-SurfacePlot.gh (Grasshopper 0.9.76)
# plug-ins: LunchBoxML

# ---- group: Sample Points
number_slider = Slider(34, range=0..50)
panel = Panel("0 to 30")
random = Random(Range="0 to 5", Number=number_slider, Seed="10")
random_2 = Random(Range=panel, Number=number_slider, Seed="8")
random_3 = Random(Range=panel, Number=number_slider, Seed="5")
pt = ConstructPoint(XCoordinate=random_3, YCoordinate=random_2, ZCoordinate=random)
entwine = Entwine(Branch00=random_3, Branch01=random_2, FlattenInputs=True)
flip = FlipMatrix(Data=entwine)
dots = DotDisplay(Point=pt, Colour=ColourSwatch(SwatchColor=RGB(255, 0, 115)), Size=Slider(0.3, range=0..1))

# ---- group: Test Points
# Nonlinear Regression
# Version:  2017.7.27
# Company Info: Authored by Proving Ground
# 
# http://ProvingGround.io
# Copyright (c) 2017 Proving Ground LLC
number_slider_2 = Slider(50, range=0..50)
range = Range(Domain=panel, Steps=number_slider_2)
range_2 = Range(Domain=panel, Steps=number_slider_2)
crossref = CrossReference(ListA=range_2, ListB=range, CrossMode=1)  # -> ListA, ListB
entwine_2 = Entwine(Branch00=crossref.ListA, Branch01=crossref.ListB, FlattenInputs=True)
flip_2 = FlipMatrix(Data=entwine_2)

# ----
sigma = Slider(1.761, range=0..50)
nonlinereg = NonlinearRegression(TestData=flip_2, Inputs=flip, Output=random, Degree=sigma, Complexity=100, RandomSeed=5)  # -> Result, Score, Error

# ---- group: Prediction Points
pt_2 = ConstructPoint(XCoordinate=crossref.ListA, YCoordinate=crossref.ListB, ZCoordinate=flatten(nonlinereg.Result))
preview = CustomPreview(Geometry=pt_2, Shader=ColourSwatch(SwatchColor=RGB(255, 255, 255)))
