# Grasshopper definition Pf_01-Number.gh (Grasshopper 0.9.76)
# plug-ins: Pufferfish

number_slider = Slider(0, range=0..10)  # disabled
number_slider_2 = Slider(2, range=0..10)  # disabled
number_slider_3 = Slider(0, range=0..10)  # disabled
# 06-List Length Range
pt = Point([Point(-8.600549939, 1.066710505, 0), Point(-1.129117342, 6.531205964, 0), Point(5.871699566, 9.952918646, 0), Point(-2.289155114, -11.3673946, 0), Point(11.24568257, -7.669513508, 0), Point(13.25643308, 17.82787734, 0), Point(-4.202145939, 20.42746541, 0), Point(-1.129117342, 6.531205964, 0)])  # disabled
# 12-Round To Decimal Place
number_slider_4 = Slider(7.816, range=0..10)  # disabled
# 13-Round To Factor
number_slider_5 = Slider(8.63, range=0..10)  # disabled
# The index to cut the list and
# mirror at.Try with negative
# index also to see how it
# effects the list.
number_slider_6 = Slider(3, range=-10..10)  # disabled
# 05-Last Index Range
pt_2 = Point([Point(-8.600549939, 1.066710505, 0), Point(-1.129117342, 6.531205964, 0), Point(5.871699566, 9.952918646, 0), Point(-2.289155114, -11.3673946, 0), Point(11.24568257, -7.669513508, 0), Point(13.25643308, 17.82787734, 0), Point(-4.202145939, 20.42746541, 0), Point(-1.129117342, 6.531205964, 0)])  # disabled
# Plug this tolerance into t and it will be false
panel = Panel("0.00000000000000000001")  # disabled
# 22-Partition Number
number_slider_7 = Slider(8, range=0..10)  # disabled
# 17-Deconstruct Number
number_slider_8 = Slider(5.56, range=0..10)  # disabled
# 11-Percentage
number_slider_9 = Slider(75, range=0..100)  # disabled
number_slider_10 = Slider(3, range=0..10)  # disabled
# 15-X Minus One
number_slider_11 = Slider(10, range=0..10)  # disabled
# Values to remap
number_slider_12 = Slider(0, range=0..10)  # disabled
# Domain of the Y axis mapped values
# (bounds of what we are remapping to)
# If nothing is input then the Y axis
# domain is the bounds of the input
# values to be remapped.
number_slider_13 = Slider(5, range=0..10)  # disabled
# 16-X Plus One
number_slider_14 = Slider(10, range=0..10)  # disabled
# Domain bounds to fit the
# linearized numbers between
number_slider_15 = Slider(0, range=0..10)  # disabled
# 03-Tween Through Numbers
number_slider_16 = Slider(0.5, range=0..1)  # disabled
# Pf_01-Number
# 01-Tween Two Numbers
# Factor from 0 to 1 determines the number
# between inputs. So 0.5 will be halfway
# between the inputs. You can use lists /
# mutiple factors as well.
number_slider_17 = Slider(0.5, range=0..1)  # disabled
# 02-Tween Consecutive Numbers
# Factor from 0 to 1 determines the number
# between each input as a list. So 0.5 will
# be halfway between each input
# consecutively through the list.
# You can use lists / mutiple factors as well.
number_slider_18 = Slider(0.5, range=0..1)  # disabled
number_slider_19 = Slider(10, range=0..10)  # disabled
# 07-Reparameterized Range
number_slider_20 = Slider(10, range=0..100)  # disabled
# This can be a list of anything (in this case points).
# The component measures this list and uses the
# last index (list length -1) as the end of the
# domain for the range.
number_slider_21 = Slider(10, range=0..100)  # disabled
# This can be a list of anything (in this case points).
# The component measures this list and uses the
# list length as the end of the domain for the range.
number_slider_22 = Slider(10, range=0..100)  # disabled
# 08-Equality Within Tolerance
panel_2 = Panel("5.00000000000001")  # disabled
panel_3 = Panel("5.00000000000002")  # disabled
# 19-Linearize Numbers
range = Range(Domain=Domain(0, 1), Steps=20)  # disabled
# Inverts the reparameterization
# so it is from 1 to 0 instead of 0 to 1
toggle = BooleanToggle(False)  # disabled
# 14-Round To Nearest
panel_4 = Panel("""3
7
25
100
1000""")  # disabled
panel_5 = Panel("""5
20""")  # disabled
# 23-Reparameterize Numbers
panel_6 = Panel("""0
2
4
6
8
10
12
14
15
18
26""")  # disabled
# Equalizes the tween distribution along the
# input extremes. So 0.5 would be the middle
# of the overall tween between the lowest and
# highest input numbers, not the middle input number.
# Factor from 0  to 1 determines the tween number.
# 0 is the first number in the set, 1 is the last number in the set.
# If for instance there are 3 numbers in the set then 0.5
# would be the second (middle) number, unless equalized is true.
# You can input as many numbers as you want.
# You can use lists / mutiple factors as well.
# 04-Curve Graph Mapper
toggle_2 = BooleanToggle(False)  # disabled
toggle_3 = BooleanToggle(False)  # disabled
toggle_4 = BooleanToggle(False)  # disabled
# 0 = Reflected - Mirrors the exact values
# 1 = Inverted - Mirrors the inverse, so
# positives become negatives and vice versa.
# Joins the list at the seam so the duplicate number is removed
# where the mirror list meets the input list. Make it true and see how
# the result list changes at the seam.
# Determines if the list mirrors at the start or end
number_slider_23 = Slider(0, range=0..1)  # disabled
# 0 = Reflected - Mirrors the exact values
# 1 = Inverted - Mirrors the inverse, so
# positives become negatives and vice versa.
# Joins the list at the seam so the duplicate number is removed
# where the mirror list meets the input list. Make it true and see how
# the result list changes at the seam.
# Determines if the list mirrors after or before the index
number_slider_24 = Slider(0, range=0..1)  # disabled
# 20-Mirror Combine Numbers
# List of numbers
series = Series(Start=0, Step=1, Count=8)  # disabled
# Set to false to output the
# division as doubles. Will
# just be the division result
# repeated the same amount
# as the division amount
toggle_5 = BooleanToggle(True)  # disabled
toggle_6 = BooleanToggle(False)  # disabled
toggle_7 = BooleanToggle(False)  # disabled
# 10-Mass Subtraction
# Subtracts numbers in list order
panel_7 = Panel("""5
4
7
8
9""")  # disabled
# 18-Highest & Lowest Numbers
panel_8 = Panel("""3
5
7
8
2
1
3
4""")  # disabled
# 09-Mass Division
# Don't divide by zero :D
# Divides numbers in list order
panel_9 = Panel("""5
4
7
8
9""")  # disabled
# Boolean to start at 0 and end at
# last index, or have a list between 0
# and last index but not reach 0 or
# last index.
toggle_8 = BooleanToggle(True)  # disabled
# Boolean to start at 0 and end
# at 1, or have a list between 0
# and 1 but not reach 0 or 1.
toggle_9 = BooleanToggle(True)  # disabled
# Boolean to start at 0 and end at
# list length, or have a list between 0
# and list length but not reach 0 or
# list length.
toggle_10 = BooleanToggle(True)  # disabled
# 25-Document Angle Tolerance
docat = DocumentAngleTolerance()  # -> Degrees, Radians; disabled
# 27-Default Angle Tolerance
defat = DefaultAngleTolerance()  # -> Degrees, Radians; disabled
# 24-Document Distance Tolerance
docdt = DocumentDistanceTolerance()  # disabled
# 26-Zero Distance Tolerance
zerdt = ZeroDistanceTolerance()  # disabled
series_2 = Series(Start=0, Step=1, Count=11)  # disabled
panel_10 = Panel("0.001")  # disabled
# Size of the graph label text
number_slider_25 = Slider(1.25, range=0..2)  # disabled
# Rectangle which defines
# the plane and boundary
# of the graph. This rectangle
# can be oriented in any plane.
rec = Rectangle({Plane=PlaneXY(-2.843546302, 87.41839834, 0), Size=Domain2(u=0..59.91311751, v=0..33.18658091)})  # disabled
# Good for rounding numbers
# to specific decimal intervals
panel_11 = Panel(".25")  # disabled
panel_12 = Panel("500")  # disabled
panel_13 = Panel("5")  # disabled
panel_14 = Panel("10")  # disabled
panel_15 = Panel("10")  # disabled
panel_16 = Panel("5")  # disabled
panel_17 = Panel("15")  # disabled
panel_18 = Panel("5")  # disabled
panel_19 = Panel("12")  # disabled
panel_20 = Panel("15")  # disabled
# Great for making wave spaced tweens
# as the tween components factor values
# Wave graph
graph = GraphMapper(range, x0=0, x1=1, y0=0, y1=1, container_name="Sine", Equation_px=[0, 0.2536231875], Equation_py=[0, 1])  # disabled
# 21-Mirror Cut Numbers
# List of numbers
series_3 = Series(Start=0, Step=1, Count=8)  # disabled
# Flip the X axis to be
# the top of the graph
toggle_11 = BooleanToggle(False)  # disabled
# Resize graph by snapping to
# the extents of the graph curves
toggle_12 = BooleanToggle(False)  # disabled
panel_21 = Panel(docat.Degrees)  # disabled
# Outputs Rhino documents
# Angle tolerance.
panel_22 = Panel(docat.Radians)  # disabled
panel_23 = Panel(defat.Degrees)  # disabled
# Outputs Rhino.Math
# default angle tolerance
panel_24 = Panel(defat.Radians)  # disabled
# The graph curve or curves to map with.
# One or multiple curves can be used.
# The curves do not need to be fully in
# the rectangle boundary but should be
# atleast partially inside. If the graph curves
# are not in plane with the rectangle boundary
# they will be projected to it.
crv = Curve(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)  # disabled
# Outputs Rhino documents
# Absolute distance tolerance.
panel_25 = Panel(docdt)  # disabled
# Outputs Rhino.Math
# zero distance tolerance
panel_26 = Panel(zerdt)  # disabled
roundf = RoundToFactor(NumberX=number_slider_5, Factor=panel_11, RoundType=number_slider)  # -> Rounded, Difference, MultiplierR, MultiplierX; disabled
roundn = RoundToNearest(NumbersX=panel_4, NumbersY=panel_5, RemapX=False)  # -> Nearest, Index, Difference, RemappedX; disabled
# X+1 is a common operation in
# code, one example is using
# it for the U input on the
# Surface From Points component.
x_plus_one = XPlusOne(NumberX=number_slider_14)  # disabled
denum = DeconstructNumber(Number=number_slider_8)  # -> Whole, Remainder; disabled
reparange = ReparameterizedRange(Steps=number_slider_20, Include=toggle_9)  # disabled
equalst = EqualityWithinTolerance(FirstNumber=panel_2, SecondNumber=panel_3, Tolerance=panel_10)  # -> Equality, Inequality; disabled
pcent = Percentage(Number=panel_12, Percent=number_slider_9)  # disabled
hilonums = HighestLowestNumbers(Numbers=panel_8)  # -> Highest, Lowest; disabled
reparamnums = ReparameterizeNumbers(Numbers=panel_6, Invert=toggle)  # -> Reparameterized, Original; disabled
twnconnums = TweenConsecutiveNumbers(Numbers=[panel_16, panel_15, panel_17], Factor=number_slider_18)  # disabled
lastrange = LastIndexRange(List=pt_2, Steps=number_slider_21, Include=toggle_8)  # disabled
mdiv = MassDivision(Numbers=panel_9)  # -> Divided, Partial; disabled
roundd = RoundToDecimalPlace(NumberX=number_slider_4, DecimalPlace=number_slider_2, RoundType=number_slider_3)  # -> Rounded, Difference; disabled
# X-1 is a common operation in
# code, one example is using
# it for the getting the last index
# of a list
x_minus_one = XMinusOne(NumberX=number_slider_11)  # disabled
# Pufferfish
# By: Michael Pryor
twn2nums = TweenTwoNumbers(NumberA=panel_13, NumberB=panel_14, Factor=number_slider_17)  # disabled
msub = MassSubtraction(Numbers=panel_7)  # -> Subtracted, Partial; disabled
partnum = PartitionNumber(Number=number_slider_7, Division=number_slider_10, Integer=toggle_5)  # disabled
twnthrunums = TweenThroughNumbers(Numbers=[panel_18, panel_19, panel_20], Factor=number_slider_16, Normalized=True, Equalized=toggle_2)  # disabled
lengrange = ListLengthRange(List=pt, Steps=number_slider_22, Include=toggle_10)  # disabled
# Optional domain of the X axis.
# If nothing is input then the X axis
# domain is the bounds of the input
# values to be remapped.
dom = ConstructDomain(DomainStart=number_slider_12, DomainEnd=number_slider_13)  # disabled
dom_2 = ConstructDomain(DomainStart=number_slider_15, DomainEnd=number_slider_19)  # disabled
mircomnums = MirrorCombineNumbers(Numbers=series, Flip=toggle_4, Join=toggle_3, MirrorType=number_slider_23)  # -> Mirrored, SplitIndex; disabled
mircutnums = MirrorCutNumbers(Numbers=series_3, MirrorIndex=number_slider_6, Flip=toggle_7, Join=toggle_6, MirrorType=number_slider_24)  # -> MirrorCut, SplitIndex, Intersected; disabled
panel_27 = Panel(twnconnums)  # disabled
panel_28 = Panel(twn2nums)  # disabled
panel_29 = Panel(denum.Whole)  # disabled
# Splits numbers at
# the decimal point
panel_30 = Panel(denum.Remainder)  # disabled
# Component is a shortcut for this
panel_31 = Panel(x_plus_one)  # disabled
# Addition of the result = the input number
panel_32 = Panel(partnum)  # disabled
# Using Non-Normalized Factor
panel_33 = Panel(twnthrunums)  # disabled
panel_34 = Panel(reparange)  # disabled
# Component is a shortcut for this
panel_35 = Panel(x_minus_one)  # disabled
# Component is a shortcut for this
panel_36 = Panel(lastrange)  # disabled
# Component is a shortcut for this
panel_37 = Panel(lengrange)  # disabled
panel_38 = Panel(hilonums.Lowest)  # disabled
panel_39 = Panel(hilonums.Highest)  # disabled
# Component is a shortcut for this
panel_40 = Panel(equalst.Equality)  # disabled
panel_41 = Panel(equalst.Inequality)  # disabled
# Index of closest y value
panel_42 = Panel(roundn.Index)  # disabled
# Result
# With remap option on
panel_43 = Panel(roundn.Nearest)  # disabled
# Difference
panel_44 = Panel(roundn.Difference)  # disabled
# Component is a shortcut for this
panel_45 = Panel(reparamnums.Reparameterized)  # disabled
# The original range
# of the input numbers
panel_46 = Panel(reparamnums.Original)  # disabled
# Difference
panel_47 = Panel(roundd.Difference)  # disabled
# Result
# Truncate to decimal place instead of round
panel_48 = Panel(roundd.Rounded)  # disabled
panel_49 = Panel(mdiv.Divided)  # disabled
panel_50 = Panel(mdiv.Partial)  # disabled
panel_51 = Panel(msub.Subtracted)  # disabled
panel_52 = Panel(msub.Partial)  # disabled
panel_53 = Panel(pcent)  # disabled
panel_54 = Panel(roundf.MultiplierX)  # disabled
panel_55 = Panel(roundf.MultiplierR)  # disabled
panel_56 = Panel(mircutnums.Intersected)  # disabled
# Difference
# Number of times the
# factor fits into result
# and orginal number
panel_57 = Panel(roundf.Difference)  # disabled
# Non-linear wave numbers
panel_58 = Panel(series)  # disabled
panel_59 = Panel(series_3)  # disabled
crvgraphmap = CurveGraphMapper(Curves=crv, Rectangle=rec, Values=series_2, YAxis=dom, Flip=toggle_11, Snap=toggle_12, TextSize=number_slider_25)  # -> Mapped, GraphCurves, GraphPoints, ValueLines, ValuePoints, MappedLines, MappedPoints, Boundary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; disabled
# Is input value outside
# of the X axis domain?
panel_60 = Panel(crvgraphmap.OutOfBounds)  # disabled
panel_61 = Panel(graph)  # disabled
linearnums = LinearizeNumbers(Numbers=graph, Domain=dom_2)  # -> Linearized, Actual, Original; disabled
# Result
panel_62 = Panel(roundf.Rounded)  # disabled
# List cut
# and mirrored
panel_63 = Panel(mircutnums.MirrorCut)  # disabled
# Linearized numbers
# List mirrored
# and combined
panel_64 = Panel(mircomnums.Mirrored)  # disabled
# Visualize Graph
graph_2 = QuickGraph(crvgraphmap.Mapped)  # disabled
# Input Values
panel_65 = Panel(series_2)  # disabled
# did input value intersect
# any of the graph curves?
panel_66 = Panel(crvgraphmap.Intersected)  # disabled
panel_67 = Panel(linearnums.Actual)  # disabled
panel_68 = Panel(linearnums.Original)  # disabled
pt_3 = Point([Point(-8.600549939, 1.066710505, 0), Point(-1.129117342, 6.531205964, 0), Point(5.871699566, 9.952918646, 0), Point(-2.289155114, -11.3673946, 0), Point(11.24568257, -7.669513508, 0), Point(13.25643308, 17.82787734, 0), Point(-4.202145939, 20.42746541, 0), Point(-1.129117342, 6.531205964, 0)])  # disabled
# This also doesnt have the boolean option
# to be between the domain rather than
# starting and ending on the domain.
number_slider_26 = Slider(10, range=0..100)  # disabled
# This also doesnt have the boolean option
# to be between the domain rather than
# starting and ending on the domain.
number_slider_27 = Slider(10, range=0..100)  # disabled
panel_69 = Panel("5.00000000000001")  # disabled
panel_70 = Panel("5.00000000000002")  # disabled
# Same at this
# But this doesnt have the boolean
# option to be between the domain rather
# than starting and ending on the domain.
number_slider_28 = Slider(10, range=0..100)  # disabled
number_slider_29 = Slider(0.1, range=0..100)  # disabled
pt_4 = Point([Point(-8.600549939, 1.066710505, 0), Point(-1.129117342, 6.531205964, 0), Point(5.871699566, 9.952918646, 0), Point(-2.289155114, -11.3673946, 0), Point(11.24568257, -7.669513508, 0), Point(13.25643308, 17.82787734, 0), Point(-4.202145939, 20.42746541, 0), Point(-1.129117342, 6.531205964, 0)])  # disabled
lng = ListLength(List=pt_3)  # disabled
number_slider_30 = Slider(10, range=0..10)  # disabled
number_slider_31 = Slider(10, range=0..10)  # disabled
panel_71 = Panel("1")  # disabled
# With remap on the numbers in x get
# remapped to the domain of the numbers
# in y before rounding to nearest.
# The remapped x values are output
# in the Rx output. Remapping gets you a
# more even result when the x numbers
# are far outside of the y numbers domain
# as it fits them within.
toggle_13 = BooleanToggle(True)  # disabled
panel_72 = Panel("""0
2
4
6
8
10
12
14
15
18
26""")  # disabled
panel_73 = Panel("""3
7
25
100
1000""")  # disabled
panel_74 = Panel("""5
20""")  # disabled
# Mapped Values
panel_75 = Panel(crvgraphmap.Mapped)  # disabled
# Using linearized wave values for parameters
panel_76 = Panel(linearnums.Linearized)  # disabled
# Num @
# index 0
number_slider_32 = Slider(1.5, range=0..2)  # disabled
lng_2 = ListLength(List=pt_4)  # disabled
subtraction = Subtraction(A=lng, B=panel_71)  # disabled
# Use rounding option 1 for truncating
# the number at the decimal place
number_slider_33 = Slider(1, range=0..10)  # disabled
number_slider_34 = Slider(2, range=0..10)  # disabled
number_slider_35 = Slider(7.816, range=0..10)  # disabled
panel_77 = Panel("1.0")  # disabled
panel_78 = Panel("1.0")  # disabled
pipe = Pipe(Curve=crvgraphmap.GraphCurves, Radius=0.2, Caps=0)  # disabled
subtraction_2 = Subtraction(A=panel_69, B=panel_70)  # disabled
# Change boolean to False
# to turn off Normalized Factor
# When Normalized is False the factor is
# from 0 to the last index. This
# can be considered like a timeline.
# This lets each number have an equally
# controllable section of the slider between.
# As opposed to going from 0 to 1, this lets
# you easily pinpoint your location.
# You can use lists / mutiple factors as well.
toggle_14 = BooleanToggle(False)  # disabled
bnd = Bounds(Numbers=panel_72)  # disabled
range_2 = Range(Domain=subtraction, Steps=number_slider_27)  # disabled
range_3 = Range(Domain=lng_2, Steps=number_slider_26)  # disabled
range_4 = Range(Domain=Domain(0, 1), Steps=number_slider_28)  # disabled
swatch = ColourSwatch(SwatchColor=RGB(0, 55, 255))  # disabled
swatch_2 = ColourSwatch(SwatchColor=RGB(255, 255, 255))  # disabled
swatch_3 = ColourSwatch(SwatchColor=RGB(255, 0, 0))  # disabled
swatch_4 = ColourSwatch(SwatchColor=RGB(0, 0, 0))  # disabled
# Alternatively there is the gh native
# similarity component which uses a
# percent for tolerance but I think
# using an actual distance value is
# more relevant / understandable
# in some cases.
similar = Similarity(FirstNumber=panel_69, SecondNumber=panel_70, Threshold=number_slider_29)  # -> Similarity, AbsoluteDifference; disabled
panel_79 = Panel("5")  # disabled
panel_80 = Panel("12")  # disabled
# Num @
# index 1
# Num @
# index 2
panel_81 = Panel("15")  # disabled
swatch_5 = ColourSwatch(SwatchColor=RGB(0, 255, 166))  # disabled
roundn_2 = RoundToNearest(NumbersX=panel_73, NumbersY=panel_74, RemapX=toggle_13)  # -> Nearest, Index, Difference, RemappedX; disabled
subtraction_3 = Subtraction(A=number_slider_30, B=panel_77)  # disabled
addition = Addition(A=number_slider_31, B=panel_78)  # disabled
boundary = BoundarySurfaces(Edges=crvgraphmap.Labels)  # disabled
abs = Absolute(Value=subtraction_2)  # disabled
panel_82 = Panel("0.001")  # disabled
remap = RemapNumbers(Value=panel_72, Source=bnd, Target=Domain(0, 1))  # -> Mapped, Clipped; disabled
panel_83 = Panel(range_2)  # disabled
panel_84 = Panel(range_3)  # disabled
# Splitting the list
number_slider_36 = Slider(4, range=-10..10)  # disabled
panel_85 = Panel(range_4)  # disabled
toggle_15 = BooleanToggle(False)  # disabled
toggle_16 = BooleanToggle(False)  # disabled
number_slider_37 = Slider(0, range=0..1)  # disabled
series_4 = Series(Start=0, Step=1, Count=8)  # disabled
panel_86 = Panel(subtraction_3)  # disabled
panel_87 = Panel(addition)  # disabled
twnthrunums_2 = TweenThroughNumbers(Numbers=[panel_79, panel_80, panel_81], Factor=number_slider_32, Normalized=toggle_14, Equalized=False)  # disabled
series_5 = Series(Start=0, Step=1, Count=8)  # disabled
toggle_17 = BooleanToggle(False)  # disabled
# Splitting the list
toggle_18 = BooleanToggle(False)  # disabled
number_slider_38 = Slider(0, range=0..1)  # disabled
panel_88 = Panel(similar.Similarity)  # disabled
# Customize the
# graph visualization
preview = CustomPreview(Geometry=crvgraphmap.MappedLines, Shader=swatch)  # disabled
dots = DotDisplay(Point=crvgraphmap.MappedPoints, Colour=swatch, Size=0.5)  # disabled
preview_2 = CustomPreview(Geometry=crvgraphmap.Boundary, Shader=swatch_2)  # disabled
# Using multiple graph curves
preview_3 = CustomPreview(Geometry=crvgraphmap.ValueLines, Shader=swatch_3)  # disabled
preview_4 = CustomPreview(Geometry=boundary, Shader=swatch_4)  # disabled
smaller = SmallerThan(FirstNumber=abs, SecondNumber=panel_82)  # -> SmallerThan, OrEqualTo; disabled
preview_5 = CustomPreview(Geometry=pipe, Shader=swatch_5)  # disabled
dots_2 = DotDisplay(Point=crvgraphmap.ValuePoints, Colour=swatch_3, Size=0.5)  # disabled
dots_3 = DotDisplay(Point=crvgraphmap.GraphPoints, Colour=swatch_5, Size=1)  # disabled
# Remapped x numbers
# to the domain of the y numbers
panel_89 = Panel(roundn_2.RemappedX)  # disabled
# This is really good for large attractor
# distances which you would like to use
# for a few specific sizes, potentially
# something like panel sizes.
panel_90 = Panel(roundn_2.Nearest)  # disabled
panel_91 = Panel(remap.Mapped)  # disabled
roundd_2 = RoundToDecimalPlace(NumberX=number_slider_35, DecimalPlace=number_slider_34, RoundType=number_slider_33)  # -> Rounded, Difference; disabled
panel_92 = Panel(twnthrunums_2)  # disabled
panel_93 = Panel(smaller.OrEqualTo)  # disabled
# Difference
panel_94 = Panel(roundd_2.Difference)  # disabled
# You see here the number is chopped at
# the decimal place instead of rounded
# Result
panel_95 = Panel(roundd_2.Rounded)  # disabled
# If  join is false you can use this index
# to split the list at the mirror seam.
mircomnums_2 = MirrorCombineNumbers(Numbers=series_5, Flip=toggle_18, Join=toggle_17, MirrorType=number_slider_38)  # -> Mirrored, SplitIndex; disabled
mircutnums_2 = MirrorCutNumbers(Numbers=series_4, MirrorIndex=number_slider_36, Flip=toggle_15, Join=toggle_16, MirrorType=number_slider_37)  # -> MirrorCut, SplitIndex, Intersected; disabled
# Domain bounds to fit the
# linearized numbers between
number_slider_39 = Slider(0, range=0..10)  # disabled
number_slider_40 = Slider(1, range=0..10)  # disabled
range_5 = Range(Domain=Domain(0, 1), Steps=50)  # disabled
split = SplitList(List=mircomnums_2.Mirrored, Index=mircomnums_2.SplitIndex)  # -> ListA, ListB; disabled
# If  join is false you can use this index
# to split the list at the mirror seam.
split_2 = SplitList(List=mircutnums_2.MirrorCut, Index=mircutnums_2.SplitIndex)  # -> ListA, ListB; disabled
# Wave graph
graph_3 = GraphMapper(
    range_5,
    x0=0,
    x1=1,
    y0=0,
    y1=1,
    container_name="Sine",
    Equation_px=[0.01726321876, 0.1834778786],
    Equation_py=[0.2260529995, 0.7959302664])  # disabled
# GH native equality
panel_96 = Panel("5.00000000000001")  # disabled
panel_97 = Panel("5.00000000000002")  # disabled
# Repeating the list
# for repeating patterns
panel_98 = Panel(split.ListB)  # disabled
# Repeating the list
# for repeating patterns
panel_99 = Panel(split_2.ListB)  # disabled
panel_100 = Panel(split.ListA)  # disabled
panel_101 = Panel(split_2.ListA)  # disabled
dom_3 = ConstructDomain(DomainStart=number_slider_39, DomainEnd=number_slider_40)  # disabled
# Domain of the Y axis mapped values
# (bounds of what we are remapping to)
# If nothing is input then the Y axis
# domain is the bounds of the input
# values to be remapped.
number_slider_41 = Slider(5, range=0..10)  # disabled
# Values to remap
number_slider_42 = Slider(0, range=0..10)  # disabled
# GH native equality has a zero tolerance
# which makes it very accurate but is not
# good for floating point error of numbers
# with large decimal places or simply
# if you want to test if something is equal "enough".
# This is a common question on the gh forum
# when people are confused about why
# they get false when comparing 0 to 0.
# This is because behind the scenes
# those 0 might actually be something like
# 0.000000000001 and 0.000000000002
# which are technically not equal, but we
# don't usually care for that much precision
# in the real world.
equals = Equality(FirstNumber=panel_96, SecondNumber=panel_97)  # -> Equality, Inequality; disabled
series_6 = Series(Start=0, Step=1, Count=11)  # disabled
# Size of the graph label text
number_slider_43 = Slider(1.25, range=0..2)  # disabled
# Rectangle which defines
# the plane and boundary
# of the graph. This rectangle
# can be oriented in any plane.
rec_2 = Rectangle({Plane=PlaneXY(79.36729653, 87.41839834, 0), Size=Domain2(u=0..59.91311751, v=0..33.18658091)})  # disabled
panel_102 = Panel(equals.Equality)  # disabled
linearnums_2 = LinearizeNumbers(Numbers=graph_3, Domain=dom_3)  # -> Linearized, Actual, Original; disabled
# Flip the X axis to be
# the top of the graph
toggle_19 = BooleanToggle(False)  # disabled
# Resize graph by snapping to
# the extents of the graph curves
toggle_20 = BooleanToggle(False)  # disabled
crv_2 = Curve([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])  # disabled
# Optional domain of the X axis.
# If nothing is input then the X axis
# domain is the bounds of the input
# values to be remapped.
dom_4 = ConstructDomain(DomainStart=number_slider_42, DomainEnd=number_slider_41)  # disabled
number_slider_44 = Slider(6, range=-10..10)  # disabled
number_slider_45 = Slider(0, range=0..1)  # disabled
toggle_21 = BooleanToggle(False)  # disabled
toggle_22 = BooleanToggle(False)  # disabled
toggle_23 = BooleanToggle(False)  # disabled
toggle_24 = BooleanToggle(False)  # disabled
series_7 = Series(Start=0, Step=1, Count=8)  # disabled
number_slider_46 = Slider(0, range=0..1)  # disabled
# Non linearized wave values make
# the points go all over themselves
crv_3 = Curve(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)  # disabled
# Linearized wave values make
# the points space in wave like spacing
crv_4 = Curve(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)  # disabled
# Change the index value to shrink or grow the wave
series_8 = Series(Start=0, Step=1, Count=8)  # disabled
eval = EvaluateLength(Curve=crv_3, Length=graph_3, Normalized=True)  # -> Point, Tangent, Parameter; disabled
eval_2 = EvaluateLength(Curve=crv_4, Length=linearnums_2.Linearized, Normalized=True)  # -> Point, Tangent, Parameter; disabled
crvgraphmap_2 = CurveGraphMapper(Curves=crv_2, Rectangle=rec_2, Values=series_6, YAxis=dom_4, Flip=toggle_19, Snap=toggle_20, TextSize=number_slider_43)  # -> Mapped, GraphCurves, GraphPoints, ValueLines, ValuePoints, MappedLines, MappedPoints, Boundary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; disabled
# Is input value outside
# of the X axis domain?
panel_103 = Panel(crvgraphmap_2.OutOfBounds)  # disabled
swatch_6 = ColourSwatch(SwatchColor=RGB(0, 55, 255))  # disabled
mircutnums_3 = MirrorCutNumbers(Numbers=series_8, MirrorIndex=number_slider_44, Flip=toggle_21, Join=toggle_22, MirrorType=number_slider_45)  # -> MirrorCut, SplitIndex, Intersected; disabled
mircomnums_3 = MirrorCombineNumbers(Numbers=series_7, Flip=toggle_24, Join=toggle_23, MirrorType=number_slider_46)  # -> Mirrored, SplitIndex; disabled
# Visualize Graph
graph_4 = QuickGraph(crvgraphmap_2.Mapped)  # disabled
# Input Values
panel_104 = Panel(series_6)  # disabled
# did input value intersect
# any of the graph curves?
panel_105 = Panel(crvgraphmap_2.Intersected)  # disabled
# Move the slider to shorten or lengthen the wave
number_slider_47 = Slider(83, range=0..200)  # disabled
# Move the slider to shorten or lengthen the wave
number_slider_48 = Slider(100, range=0..200)  # disabled
points = PointList(Points=eval.Point, Size=0.2)  # disabled
# Look at Rhino
# to preview results
preview_6 = CustomPreview(Geometry=eval_2.Point, Shader=swatch_6)  # disabled
# Look at Rhino
# to preview results
preview_7 = CustomPreview(
    Geometry=eval.Point,
    Shader={ambient=RGB(0, 0, 0), diffuse=RGB(255, 105, 180), emission=RGB(76, 32, 54), shine=0.5, specular=RGB(255, 255, 255), transparency=0})  # disabled
points_2 = PointList(Points=eval_2.Point, Size=0.2)  # disabled
# Mapped Values
panel_106 = Panel(crvgraphmap_2.Mapped)  # disabled
# By repeating the mirror cut list data
# you can make patterns such as waves.
repeat = RepeatData(Data=mircutnums_3.MirrorCut, Length=number_slider_47)  # disabled
# By repeating the mirror combine list data
# you can make patterns such as waves.
repeat_2 = RepeatData(Data=mircomnums_3.Mirrored, Length=number_slider_48)  # disabled
pipe_2 = Pipe(Curve=crvgraphmap_2.GraphCurves, Radius=0.2, Caps=0)  # disabled
series_9 = Series(Start=0, Step=1, Count=number_slider_47)  # disabled
series_10 = Series(Start=0, Step=1, Count=number_slider_48)  # disabled
swatch_7 = ColourSwatch(SwatchColor=RGB(0, 55, 255))  # disabled
swatch_8 = ColourSwatch(SwatchColor=RGB(255, 255, 255))  # disabled
swatch_9 = ColourSwatch(SwatchColor=RGB(255, 0, 0))  # disabled
swatch_10 = ColourSwatch(SwatchColor=RGB(0, 255, 166))  # disabled
swatch_11 = ColourSwatch(SwatchColor=RGB(0, 0, 0))  # disabled
Y = UnitY(Factor=series_9)  # disabled
Y_2 = UnitY(Factor=series_10)  # disabled
boundary_2 = BoundarySurfaces(Edges=crvgraphmap_2.Labels)  # disabled
pt_5 = Point(Point(112.3594873, -66.8176387, 0))  # disabled
pt_6 = Point(Point(78.16022402, -66.8176387, 0))  # disabled
panel_107 = Panel(repeat)  # disabled
Z = UnitZ(Factor=repeat)  # disabled
move = Move(Geometry=pt_5, Motion=Y)  # -> Geometry, Transform; disabled
panel_108 = Panel(repeat_2)  # disabled
Z_2 = UnitZ(Factor=repeat_2)  # disabled
move_2 = Move(Geometry=pt_6, Motion=Y_2)  # -> Geometry, Transform; disabled
# Customize the
# graph visualization
preview_8 = CustomPreview(Geometry=crvgraphmap_2.MappedLines, Shader=swatch_7)  # disabled
dots_4 = DotDisplay(Point=crvgraphmap_2.MappedPoints, Colour=swatch_7, Size=0.5)  # disabled
preview_9 = CustomPreview(Geometry=crvgraphmap_2.Boundary, Shader=swatch_8)  # disabled
preview_10 = CustomPreview(Geometry=crvgraphmap_2.ValueLines, Shader=swatch_9)  # disabled
preview_11 = CustomPreview(Geometry=boundary_2, Shader=swatch_11)  # disabled
preview_12 = CustomPreview(Geometry=pipe_2, Shader=swatch_10)  # disabled
dots_5 = DotDisplay(Point=crvgraphmap_2.ValuePoints, Colour=swatch_9, Size=0.5)  # disabled
dots_6 = DotDisplay(Point=crvgraphmap_2.GraphPoints, Colour=swatch_10, Size=1)  # disabled
move_3 = Move(Geometry=move.Geometry, Motion=Z)  # -> Geometry, Transform; disabled
move_4 = Move(Geometry=move_2.Geometry, Motion=Z_2)  # -> Geometry, Transform; disabled
# Look at Rhino
# to preview results
pt_7 = Point(move_3.Geometry)  # disabled
# Look at Rhino
# to preview results
pt_8 = Point(move_4.Geometry)  # disabled
