# Grasshopper definition Pf_02-Domain.gh (Grasshopper 0.9.76)
# plug-ins: Pufferfish

# The index to cut the list and
# mirror at.Try with negative
# index also to see how it
# effects the list.
number_slider = Slider(3, range=-10..10)  # disabled
# The index to cut the list and
# mirror at.Try with negative
# index also to see how it
# effects the list.
number_slider_2 = Slider(3, range=-10..10)  # disabled
number_slider_3 = Slider(0.5, range=0..1)  # disabled
number_slider_4 = Slider(0.5, range=0..1)  # disabled
# Multiple domains input
number_slider_5 = Slider(0.68, range=0..1)  # disabled
number_slider_6 = Slider(0.17, range=0..1)  # disabled
number_slider_7 = Slider(0.27, range=0..1)  # disabled
# Ajust the weights, If one has all the weight
# then the result is that domain. If all have same
# weight then the result is same as average.
number_slider_8 = Slider(0.85, range=0..1)  # disabled
number_slider_9 = Slider(0.66, range=0..1)  # disabled
number_slider_10 = Slider(0.232, range=0..1)  # disabled
# Ajust the weights for UV, If one has all the weight
# then the result is that domain UV. If all have same
# weight then the result is same as average. You can
# also weight U and V separately.
number_slider_11 = Slider(0.846, range=0..1)  # disabled
# 15-Tween Consecutive Domains²
number_slider_12 = Slider(0.25, range=0..1)  # disabled
# Factor from 0 to 1 determines the number
# between domain start and end. So 0.5 will be halfway
# between the domain start and end. You can use lists /
# mutiple factors as well.
number_slider_13 = Slider(0.25, range=0..1)  # disabled
# Factor from 0 to 1 determines the domain
# between inputs. So 0.5 will be halfway
# between the inputs. You can use lists /
# mutiple factors as well.
number_slider_14 = Slider(0.25, range=0..1)  # disabled
# Multiple domains input
# Factor from 0 to 1 determines the domain
# between each input as a list. So 0.5 will
# be halfway between each input
# consecutively through the list.
# You can use lists / mutiple factors as well.
number_slider_15 = Slider(0.25, range=0..1)  # disabled
# 13-Slide Within Domain²
# Factor from 0 to 1 determines the number
# between UV domain start and end. So 0.5 will be halfway
# between the UV domain start and end. You can use lists /
# mutiple factors as well. You can also slide U and V separately.
# 14-Tween Two Domains²
number_slider_16 = Slider(0.25, range=0..1)  # disabled
# 16-Tween Through Domains²
number_slider_17 = Slider(0.25, range=0..1)  # disabled
# 07-Mirror Combine Domains
# Multiple domains input
panel = Panel("""0.0 to 1.0
1.0 to 2.0
2.0 to 3.0
4.0 to 5.0
5.0 to 6.0
6.0 to 7.0""")  # disabled
toggle = BooleanToggle(False)  # disabled
toggle_2 = BooleanToggle(False)  # disabled
toggle_3 = BooleanToggle(False)  # disabled
toggle_4 = BooleanToggle(False)  # disabled
# 0 = Reflected - Mirrors the exact values
# 1 = Inverted - Mirrors the inverse, so
# positives become negatives and vice versa.
# Joins the list at the seam so the duplicate domain is removed
# where the mirror list meets the input list. Make it true and see
# how the result list changes at the seam.
# Determines if the list mirrors at the start or end
number_slider_18 = Slider(0, range=0..1)  # disabled
# 0 = Reflected - Mirrors the exact values
# 1 = Inverted - Mirrors the inverse, so
# positives become negatives and vice versa.
# Joins the list at the seam so the duplicate domain² is removed
# where the mirror list meets the input list. Make it true and see
# how the result list changes at the seam.
# Determines if the list mirrors at the start or end
# 18-Mirror Cut Domains²
number_slider_19 = Slider(0, range=0..1)  # disabled
# 20-Two Way Domain²
number_slider_20 = Slider(2, range=0..10)  # disabled
toggle_5 = BooleanToggle(False)  # disabled
# 0 = Reflected - Mirrors the exact values
# 1 = Inverted - Mirrors the inverse, so
# positives become negatives and vice versa.
# Joins the list at the seam so the duplicate domain is removed
# where the mirror list meets the input list. Make it true and see how
# the result list changes at the seam.
# Determines if the list mirrors after or before the index
number_slider_21 = Slider(0, range=0..1)  # disabled
toggle_6 = BooleanToggle(False)  # disabled
# 0 = Reflected - Mirrors the exact values
# 1 = Inverted - Mirrors the inverse, so
# positives become negatives and vice versa.
# Joins the list at the seam so the duplicate domain² is removed
# where the mirror list meets the input list. Make it true and see how
# the result list changes at the seam.
# Determines if the list mirrors after or before the index
# 19-Reparameterize Domains²
number_slider_22 = Slider(0, range=0..1)  # disabled
number_slider_23 = Slider(4, range=0..10)  # disabled
toggle_7 = BooleanToggle(False)  # disabled
toggle_8 = BooleanToggle(False)  # disabled
# 10-Two Way Domain
number_slider_24 = Slider(10, range=0..10)  # disabled
# Multiple domain²s input
domain² = Domain²([Domain2(u=0..1, v=2..3), Domain2(u=1..2, v=3..4), Domain2(u=2..3, v=4..5), Domain2(u=3..4, v=5..6), Domain2(u=4..5, v=6..7), Domain2(u=5..6, v=7..8)])  # disabled
toggle_9 = BooleanToggle(True)  # disabled
toggle_10 = BooleanToggle(True)  # disabled
toggle_11 = BooleanToggle(True)  # disabled
toggle_12 = BooleanToggle(True)  # disabled
toggle_13 = BooleanToggle(True)  # disabled
toggle_14 = BooleanToggle(True)  # disabled
# Pf_02-Domain
# 01-Average Domain
# Multiple domains input
panel_2 = Panel("""0.0 to 1.0
1.0 to 2.0
2.0 to 3.0
3.0 to 4.0""")  # disabled
# 05-Tween Consecutive Domains
panel_3 = Panel("""0.0 to 1.0
1.0 to 2.0
2.0 to 3.0
3.0 to 4.0""")  # disabled
# Equalizes the tween distribution along the
# input extremes. So 0.5 would be the middle
# of the overall tween between the lowest and
# highest input domain²s UV, not the middle input domain² UV.
# Factor from 0  to 1 determines the tween domain² UV.
# 0 is the first domain² UV in the set, 1 is the last domain² UV in the set.
# If for instance there are 3 domain²s in the set then 0.5
# would be the second (middle) domain² UV, unless equalized is true.
# You can input as many domain²s as you want.
# You can use lists / mutiple factors as well.
# You can also tween U and V separately.
toggle_15 = BooleanToggle(False)  # disabled
# 02-Weighted Average Domain
panel_4 = Panel("""0.0 to 1.0
1.0 to 2.0
2.0 to 3.0
3.0 to 4.0""")  # disabled
# 06-Tween Through Domains
panel_5 = Panel("""0.0 to 1.0
1.0 to 2.0
5.0 to 6.0""")  # disabled
# Multiple domains input
# Equalizes the tween distribution along the
# input extremes. So 0.5 would be the middle
# of the overall tween between the lowest and
# highest input domains, not the middle input domain.
# Factor from 0  to 1 determines the tween domain.
# 0 is the first domain in the set, 1 is the last domain in the set.
# If for instance there are 3 domains in the set then 0.5
# would be the second (middle) domain, unless equalized is true.
# You can input as many domains as you want.
# You can use lists / mutiple factors as well.
toggle_16 = BooleanToggle(False)  # disabled
# 17-Mirror Combine Domains²
# Multiple domain²s input
domain²_2 = Domain²([Domain2(u=0..1, v=2..3), Domain2(u=1..2, v=3..4), Domain2(u=2..3, v=4..5), Domain2(u=3..4, v=5..6), Domain2(u=4..5, v=6..7), Domain2(u=5..6, v=7..8)])  # disabled
# 03-Slide Within Domain
panel_6 = Panel("5.0 to 20.0")  # disabled
# 04-Tween Two Domains
panel_7 = Panel("5.0 to 20.0")  # disabled
panel_8 = Panel("10.0 to 40.0")  # disabled
# Inverts the reparameterization
# so it is from 1 to 0 instead of 0 to 1
# Controls whether to reparemetrize just
# the starts, ends, or both parts of the domains
toggle_17 = BooleanToggle(False)  # disabled
# Inverts the reparameterization
# so it is from 1 to 0 instead of 0 to 1
# Controls whether to reparemetrize just
# the starts, ends, or all parts of the domain²s
toggle_18 = BooleanToggle(False)  # disabled
# 08-Mirror Cut Domains
# Multiple domains input
panel_9 = Panel("""0.0 to 1.0
1.0 to 2.0
2.0 to 3.0
4.0 to 5.0
5.0 to 6.0
6.0 to 7.0""")  # disabled
# 09-Reparameterize Domains
# Multiple domains input
panel_10 = Panel("""0.0 to 1.0
1.0 to 2.0
2.0 to 3.0
4.0 to 5.0
5.0 to 6.0
10.0 to 15.0""")  # disabled
# Multiple domain²s input
domain²_3 = Domain²([Domain2(u=0..1, v=2..3), Domain2(u=1..2, v=3..4), Domain2(u=2..3, v=4..5), Domain2(u=3..4, v=5..6), Domain2(u=4..5, v=6..7), Domain2(u=5..6, v=7..8)])  # disabled
toggle_19 = BooleanToggle(True)  # disabled
domain²_4 = Domain²(Domain2(u=2..30, v=1..20))  # disabled
domain²_5 = Domain²(Domain2(u=1..15, v=0..10))  # disabled
domain²_6 = Domain²(Domain2(u=5..55, v=60..25))  # disabled
# 11-Average Domain²
domain²_7 = Domain²(Domain2(u=1..15, v=0..10))  # disabled
# Multiple domain²s input
domain²_8 = Domain²(Domain2(u=5..55, v=60..25))  # disabled
domain²_9 = Domain²(Domain2(u=1..15, v=0..10))  # disabled
domain²_10 = Domain²(Domain2(u=2..30, v=1..20))  # disabled
# 12-Weighted Average Domain²
domain²_11 = Domain²(Domain2(u=1..15, v=0..10))  # disabled
domain²_12 = Domain²(Domain2(u=2..30, v=1..20))  # disabled
# Multiple domain²s input
domain²_13 = Domain²(Domain2(u=5..55, v=60..25))  # disabled
domain²_14 = Domain²(Domain2(u=1..15, v=0..10))  # disabled
# Factor from 0 to 1 determines the domain² UV
# between inputs. So 0.5 will be halfway
# between the inputs. You can use lists /
# mutiple factors as well. You can also
# tween U and V separately.
domain²_15 = Domain²(Domain2(u=5..55, v=60..25))  # disabled
domain²_16 = Domain²(Domain2(u=1..15, v=0..10))  # disabled
domain²_17 = Domain²(Domain2(u=2..30, v=1..20))  # disabled
# Factor from 0 to 1 determines the domain² UV
# between each input as a list. So 0.5 will
# be halfway between each input
# consecutively through the list.
# You can use lists / mutiple factors as well.
# You can also tween U and V separately.
domain²_18 = Domain²(Domain2(u=5..55, v=60..25))  # disabled
toggle_20 = BooleanToggle(True)  # disabled
panel_11 = Panel(domain²)  # disabled
panel_12 = Panel(domain²_5)  # disabled
mircutdoms = MirrorCutDomains(Domains=panel_9, MirrorIndex=number_slider, Flip=toggle_7, Join=toggle_5, MirrorType=number_slider_21)  # -> MirrorCut, SplitIndex, Intersected; disabled
avrdom² = AverageDomain²(Domain²s=[domain²_7, domain²_4, domain²_8])  # disabled
panel_13 = Panel(domain²_10)  # disabled
panel_14 = Panel(domain²_6)  # disabled
# Numbers becomes negative and positive UV extents
_2waydom² = TwoWayDomain²(ExtentU=number_slider_20, ExtentV=number_slider_23, Direction=toggle_20)  # disabled
# Pufferfish
# By: Michael Pryor
avrdom = AverageDomain(Domains=panel_2)  # disabled
twn2doms = TweenTwoDomains(DomainA=panel_7, DomainB=panel_8, Factor=number_slider_14)  # disabled
# Number becomes negative and positive extents
_2waydom = TwoWayDomain(Extent=number_slider_24, Direction=toggle_19)  # disabled
twncondoms² = TweenConsecutiveDomains²(Domain²s=[domain²_18, domain²_17, domain²_16], FactorU=number_slider_17, FactorV=number_slider_17)  # disabled
mircomdoms² = MirrorCombineDomains²(Domain²s=domain²_2, Flip=toggle_4, Join=toggle_2, MirrorType=number_slider_19)  # -> Mirrored, SplitIndex; disabled
mircutdoms² = MirrorCutDomains²(Domain²s=domain²_3, MirrorIndex=number_slider_2, Flip=toggle_8, Join=toggle_6, MirrorType=number_slider_22)  # -> MirrorCut, SplitIndex, Intersected; disabled
reparamdoms² = ReparameterizeDomains²(Domain²s=domain², StartsU=toggle_11, EndsU=toggle_12, StartsV=toggle_13, EndsV=toggle_14, Invert=toggle_18)  # -> Reparameterized, OriginalSU, OriginalEU, OriginalSV, OriginalEV; disabled
wavdom = WeightedAverageDomain(Domains=panel_4, Weights=[number_slider_5, number_slider_6, number_slider_7, number_slider_8])  # disabled
slideindom = SlideWithinDomain(Domain=panel_6, Factor=number_slider_13)  # disabled
twncondoms = TweenConsecutiveDomains(Domains=panel_3, Factor=number_slider_15)  # disabled
twnthrudoms = TweenThroughDomains(Domains=panel_5, Factor=number_slider_4, Normalized=True, Equalized=toggle_16)  # disabled
mircomdoms = MirrorCombineDomains(Domains=panel, Flip=toggle_3, Join=toggle, MirrorType=number_slider_18)  # -> Mirrored, SplitIndex; disabled
reparamdoms = ReparameterizeDomains(Domains=panel_10, Starts=toggle_9, Ends=toggle_10, Invert=toggle_17)  # -> Reparameterized, OriginalS, OriginalE; disabled
wavdom² = WeightedAverageDomain²(
    Domain²s=[domain²_11, domain²_12, domain²_13],
    WeightsU=[number_slider_9, number_slider_10, number_slider_11],
    WeightsV=[number_slider_9, number_slider_10, number_slider_11])  # disabled
panel_15 = Panel(domain²_9)  # disabled
slideindom² = SlideWithinDomain²(Domain²=domain²_9, FactorU=number_slider_16, FactorV=number_slider_16)  # -> SlidU, SlidV; disabled
panel_16 = Panel(domain²_15)  # disabled
twn2doms² = TweenTwoDomains²(Domain²A=domain²_14, Domain²B=domain²_15, FactorU=number_slider_12, FactorV=number_slider_12)  # disabled
panel_17 = Panel(domain²_16)  # disabled
panel_18 = Panel(domain²_17)  # disabled
panel_19 = Panel(domain²_18)  # disabled
panel_20 = Panel(domain²_14)  # disabled
twnthrudoms² = TweenThroughDomains²(
    Domain²s=[domain²_5, domain²_10, domain²_6],
    FactorU=number_slider_3,
    FactorV=number_slider_3,
    Normalized=True,
    Equalized=toggle_15)  # disabled
# Component is a shortcut for this
panel_21 = Panel(_2waydom)  # disabled
panel_22 = Panel(_2waydom²)  # disabled
# The original range
# of the input domains
# start values
panel_23 = Panel(reparamdoms.OriginalS)  # disabled
# The original range
# of the input domains
# end values
panel_24 = Panel(reparamdoms.OriginalE)  # disabled
panel_25 = Panel(reparamdoms.Reparameterized)  # disabled
panel_26 = Panel(slideindom)  # disabled
panel_27 = Panel(slideindom².SlidU)  # disabled
panel_28 = Panel(slideindom².SlidV)  # disabled
panel_29 = Panel(twnthrudoms²)  # disabled
# Using Non-Normalized Factor
panel_30 = Panel(twnthrudoms)  # disabled
panel_31 = Panel([domain²_11, domain²_12, domain²_13])  # disabled
panel_32 = Panel(wavdom²)  # disabled
panel_33 = Panel(avrdom)  # disabled
panel_34 = Panel(wavdom)  # disabled
panel_35 = Panel(twn2doms)  # disabled
panel_36 = Panel(twncondoms)  # disabled
panel_37 = Panel(twn2doms²)  # disabled
panel_38 = Panel([domain²_7, domain²_4, domain²_8])  # disabled
panel_39 = Panel(avrdom²)  # disabled
panel_40 = Panel(twncondoms²)  # disabled
panel_41 = Panel(panel_9)  # disabled
panel_42 = Panel(domain²_3)  # disabled
panel_43 = Panel(mircutdoms.Intersected)  # disabled
panel_44 = Panel(mircutdoms².Intersected)  # disabled
# The original range
# of the input domain²s
# V start values
panel_45 = Panel(reparamdoms².OriginalSV)  # disabled
# The original range
# of the input domain²s
# V end values
panel_46 = Panel(reparamdoms².OriginalEV)  # disabled
# The original range
# of the input domain²s
# U start values
panel_47 = Panel(reparamdoms².OriginalSU)  # disabled
# The original range
# of the input domain²s
# U end values
panel_48 = Panel(reparamdoms².OriginalEU)  # disabled
panel_49 = Panel(reparamdoms².Reparameterized)  # disabled
# List mirrored
# and combined
panel_50 = Panel(mircomdoms².Mirrored)  # disabled
panel_51 = Panel(domain²_2)  # disabled
panel_52 = Panel(panel)  # disabled
# List mirrored
# and combined
panel_53 = Panel(mircomdoms.Mirrored)  # disabled
# List cut
# and mirrored
panel_54 = Panel(mircutdoms.MirrorCut)  # disabled
# List cut
# and mirrored
panel_55 = Panel(mircutdoms².MirrorCut)  # disabled
number_slider_25 = Slider(10, range=0..10)  # disabled
# Dom @
# index 0
number_slider_26 = Slider(1.5, range=0..2)  # disabled
# Splitting the list
number_slider_27 = Slider(4, range=-10..10)  # disabled
toggle_21 = BooleanToggle(False)  # disabled
toggle_22 = BooleanToggle(False)  # disabled
number_slider_28 = Slider(0, range=0..1)  # disabled
# Dom @
# index 2
# Dom @
# index 1
# Change boolean to False
# to turn off Normalized Factor
# When Normalized is False the factor is
# from 0 to the last index. This
# can be considered like a timeline.
# This lets each domain have an equally
# controllable section of the slider between.
# As opposed to going from 0 to 1, this lets
# you easily pinpoint your location.
# You can use lists / mutiple factors as well.
toggle_23 = BooleanToggle(False)  # disabled
toggle_24 = BooleanToggle(False)  # disabled
# Multiple domains input
panel_56 = Panel("""0.0 to 1.0
1.0 to 2.0
5.0 to 6.0""")  # disabled
# Multiple domains input
panel_57 = Panel("""0.0 to 1.0
1.0 to 2.0
2.0 to 3.0
4.0 to 5.0
5.0 to 6.0
6.0 to 7.0""")  # disabled
# Splitting the list
toggle_25 = BooleanToggle(False)  # disabled
number_slider_29 = Slider(0, range=0..1)  # disabled
neg = Negative(Value=number_slider_25)  # disabled
# Multiple domains input
panel_58 = Panel("""0.0 to 1.0
1.0 to 2.0
2.0 to 3.0
4.0 to 5.0
5.0 to 6.0
6.0 to 7.0""")  # disabled
# Using Non-Normalized Factor
# Dom² @
# index 0
number_slider_30 = Slider(1, range=0..2)  # disabled
dom = ConstructDomain(DomainStart=neg, DomainEnd=number_slider_25)  # disabled
toggle_26 = BooleanToggle(False)  # disabled
# Splitting the list
toggle_27 = BooleanToggle(False)  # disabled
number_slider_31 = Slider(0, range=0..1)  # disabled
# Dom² @
# index 1
# Change boolean to False
# to turn off Normalized Factor
# When Normalized is False the factor is
# from 0 to the last index. This
# can be considered like a timeline.
# This lets each domain² UV have an equally
# controllable section of the slider between.
# As opposed to going from 0 to 1, this lets
# you easily pinpoint your location.
# You can use lists / mutiple factors as well.
# You can also tween U and V separately.
toggle_28 = BooleanToggle(False)  # disabled
# Multiple domain²s input
domain²_19 = Domain²([Domain2(u=0..1, v=2..3), Domain2(u=1..2, v=3..4), Domain2(u=2..3, v=4..5), Domain2(u=3..4, v=5..6), Domain2(u=4..5, v=6..7), Domain2(u=5..6, v=7..8)])  # disabled
twnthrudoms_2 = TweenThroughDomains(Domains=panel_56, Factor=number_slider_26, Normalized=toggle_23, Equalized=False)  # disabled
# If join is false you can use this index
# to split the list at the mirror seam.
mircomdoms_2 = MirrorCombineDomains(Domains=panel_57, Flip=toggle_25, Join=toggle_24, MirrorType=number_slider_29)  # -> Mirrored, SplitIndex; disabled
mircutdoms_2 = MirrorCutDomains(Domains=panel_58, MirrorIndex=number_slider_27, Flip=toggle_21, Join=toggle_22, MirrorType=number_slider_28)  # -> MirrorCut, SplitIndex, Intersected; disabled
domain²_20 = Domain²(Domain2(u=1..15, v=0..10))  # disabled
domain²_21 = Domain²(Domain2(u=2..30, v=1..20))  # disabled
# Dom² @
# index 2
domain²_22 = Domain²(Domain2(u=5..55, v=60..25))  # disabled
# Splitting the list
toggle_29 = BooleanToggle(False)  # disabled
toggle_30 = BooleanToggle(False)  # disabled
number_slider_32 = Slider(0, range=0..1)  # disabled
number_slider_33 = Slider(4, range=-10..10)  # disabled
panel_59 = Panel(twnthrudoms_2)  # disabled
split = SplitList(List=mircomdoms_2.Mirrored, Index=mircomdoms_2.SplitIndex)  # -> ListA, ListB; disabled
# If join is false you can use this index
# to split the list at the mirror seam.
split_2 = SplitList(List=mircutdoms_2.MirrorCut, Index=mircutdoms_2.SplitIndex)  # -> ListA, ListB; disabled
panel_60 = Panel(domain²_19)  # disabled
# If join is false you can use this index
# to split the list at the mirror seam.
mircomdoms²_2 = MirrorCombineDomains²(Domain²s=domain²_19, Flip=toggle_27, Join=toggle_26, MirrorType=number_slider_31)  # -> Mirrored, SplitIndex; disabled
twnthrudoms²_2 = TweenThroughDomains²(
    Domain²s=[domain²_20, domain²_21, domain²_22],
    FactorU=number_slider_30,
    FactorV=number_slider_30,
    Normalized=toggle_28,
    Equalized=False)  # disabled
panel_61 = Panel(domain²_20)  # disabled
panel_62 = Panel(domain²_21)  # disabled
panel_63 = Panel(domain²_22)  # disabled
# Multiple domains input
panel_64 = Panel("""0.0 to 1.0
1.0 to 2.0
2.0 to 3.0
4.0 to 5.0
5.0 to 6.0
6.0 to 7.0""")  # disabled
panel_65 = Panel(twnthrudoms²_2)  # disabled
split_3 = SplitList(List=mircomdoms²_2.Mirrored, Index=mircomdoms²_2.SplitIndex)  # -> ListA, ListB; disabled
# Repeating the list
# for repeating patterns
panel_66 = Panel(split.ListB)  # disabled
panel_67 = Panel(split.ListA)  # disabled
panel_68 = Panel(split_2.ListA)  # disabled
# Repeating the list
# for repeating patterns
panel_69 = Panel(split_2.ListB)  # disabled
mircutdoms²_2 = MirrorCutDomains²(Domain²s=panel_64, MirrorIndex=number_slider_33, Flip=toggle_29, Join=toggle_30, MirrorType=number_slider_32)  # -> MirrorCut, SplitIndex, Intersected; disabled
panel_70 = Panel(split_3.ListB)  # disabled
panel_71 = Panel(split_3.ListA)  # disabled
# If join is false you can use this index
# to split the list at the mirror seam.
split_4 = SplitList()  # -> ListA, ListB; disabled
toggle_31 = BooleanToggle(False)  # disabled
toggle_32 = BooleanToggle(False)  # disabled
number_slider_34 = Slider(3, range=-10..10)  # disabled
number_slider_35 = Slider(0, range=0..1)  # disabled
panel_72 = Panel(split_4.ListA)  # disabled
panel_73 = Panel(split_4.ListB)  # disabled
# Multiple domains input
panel_74 = Panel("""0.0 to 1.0
1.0 to 2.0
2.0 to 3.0
4.0 to 5.0
5.0 to 6.0
6.0 to 7.0""")  # disabled
toggle_33 = BooleanToggle(False)  # disabled
toggle_34 = BooleanToggle(False)  # disabled
number_slider_36 = Slider(0, range=0..1)  # disabled
# Multiple domains input
panel_75 = Panel("""0.0 to 1.0
1.0 to 2.0
2.0 to 3.0
4.0 to 5.0
5.0 to 6.0
6.0 to 7.0""")  # disabled
mircutdoms_3 = MirrorCutDomains(Domains=panel_75, MirrorIndex=number_slider_34, Flip=toggle_31, Join=toggle_32, MirrorType=number_slider_35)  # -> MirrorCut, SplitIndex, Intersected; disabled
mircomdoms_3 = MirrorCombineDomains(Domains=panel_74, Flip=toggle_34, Join=toggle_33, MirrorType=number_slider_36)  # -> Mirrored, SplitIndex; disabled
number_slider_37 = Slider(50, range=0..200)  # disabled
number_slider_38 = Slider(50, range=0..200)  # disabled
toggle_35 = BooleanToggle(False)  # disabled
# Repeating the list
# for repeating patterns
toggle_36 = BooleanToggle(False)  # disabled
number_slider_39 = Slider(0, range=0..1)  # disabled
# Multiple domain²s input
domain²_23 = Domain²([Domain2(u=0..1, v=2..3), Domain2(u=1..2, v=3..4), Domain2(u=2..3, v=4..5), Domain2(u=3..4, v=5..6), Domain2(u=4..5, v=6..7), Domain2(u=5..6, v=7..8)])  # disabled
# By repeating the mirror combine list data
# you can make patterns such as waves.
repeat = RepeatData(Data=mircomdoms_3.Mirrored, Length=number_slider_37)  # disabled
# By repeating the mirror cut list data
# you can make patterns such as waves.
repeat_2 = RepeatData(Data=mircutdoms_3.MirrorCut, Length=number_slider_38)  # disabled
number_slider_40 = Slider(0, range=0..1)  # disabled
panel_76 = Panel(domain²_23)  # disabled
number_slider_41 = Slider(3, range=-10..10)  # disabled
# Repeating the list
# for repeating patterns
toggle_37 = BooleanToggle(False)  # disabled
toggle_38 = BooleanToggle(False)  # disabled
mircomdoms²_3 = MirrorCombineDomains²(Domain²s=domain²_23, Flip=toggle_36, Join=toggle_35, MirrorType=number_slider_39)  # -> Mirrored, SplitIndex; disabled
panel_77 = Panel(repeat)  # disabled
# Multiple domains input
panel_78 = Panel("""0.0 to 1.0
1.0 to 2.0
2.0 to 3.0
4.0 to 5.0
5.0 to 6.0
6.0 to 7.0""")  # disabled
panel_79 = Panel(repeat_2)  # disabled
number_slider_42 = Slider(50, range=0..200)  # disabled
mircutdoms²_3 = MirrorCutDomains²(Domain²s=panel_78, MirrorIndex=number_slider_41, Flip=toggle_37, Join=toggle_38, MirrorType=number_slider_40)  # -> MirrorCut, SplitIndex, Intersected; disabled
# By repeating the mirror combine list data
# you can make patterns such as waves.
repeat_3 = RepeatData(Data=mircomdoms²_3.Mirrored, Length=number_slider_42)  # disabled
number_slider_43 = Slider(50, range=0..200)  # disabled
panel_80 = Panel(repeat_3)  # disabled
# By repeating the mirror cut list data
# you can make patterns such as waves.
repeat_4 = RepeatData(Data=mircutdoms²_3.MirrorCut, Length=number_slider_43)  # disabled
panel_81 = Panel(repeat_4)  # disabled
