# Grasshopper definition Pf_03-List.gh (Grasshopper 0.9.76)
# plug-ins: Pufferfish

# The index to cut the list and
# mirror at.Try with negative
# index also to see how it
# effects the list.
number_slider = Slider(2, range=-10..10)  # disabled
# 06-List Indices
# Some random list
panel = Panel("""Hello
Are
You
Actually
Reading
This
List""")  # disabled
# 01-Dispatch Indices
number_slider_2 = Slider(11, range=0..100)  # disabled
number_slider_3 = Slider(24, range=0..100)  # disabled
number_slider_4 = Slider(11, range=0..100)  # disabled
number_slider_5 = Slider(41, range=0..100)  # disabled
number_slider_6 = Slider(62, range=0..100)  # disabled
# Dispatching indices
number_slider_7 = Slider(76, range=0..100)  # disabled
number_slider_8 = Slider(24, range=0..100)  # disabled
number_slider_9 = Slider(62, range=0..100)  # disabled
number_slider_10 = Slider(41, range=0..100)  # disabled
# Sifting indices
number_slider_11 = Slider(76, range=0..100)  # disabled
# Joins the list at the seam so the duplicate item is removed
# where the mirror list meets the input list. Make it true and see how
# the result list changes at the seam.
# Determines if the list mirrors at the start or end
toggle = BooleanToggle(False)  # disabled
# 05-Last Index
# Some random list
pt = Point([Point(-8.600549939, 1.066710505, 0), Point(-1.129117342, 6.531205964, 0), Point(5.871699566, 9.952918646, 0), Point(-2.289155114, -11.3673946, 0), Point(11.24568257, -7.669513508, 0), Point(13.25643308, 17.82787734, 0), Point(-4.202145939, 20.42746541, 0), Point(-1.129117342, 6.531205964, 0)])  # disabled
toggle_2 = BooleanToggle(False)  # disabled
# Joins the list at the seam so the duplicate item is removed
# where the mirror list meets the input list. Make it true and see how
# the result list changes at the seam.
# Determines if the list mirrors after or before the index
toggle_3 = BooleanToggle(False)  # disabled
toggle_4 = BooleanToggle(False)  # disabled
# 03-Mirror Combine Items
# List of items
panel_2 = Panel("""All
Kinds
of
Items
Can
Be
Used""")  # disabled
# 04-Mirror Cut Items
# List of items
panel_3 = Panel("""All
Kinds
of
Items
Can
Be
Used""")  # disabled
# Pufferfish
# By: Michael Pryor
# Pf_03-List
# List of items (can be any type of items)
pop3d = Populate3D(Region={Plane=PlaneXY(0, 0, 0), X=Domain(0, 10), Y=Domain(0, 10), Z=Domain(0, 2)}, Count=100, Seed=1)  # disabled
# 02-Sift Indices
# List of items (can be any type of items)
pop3d_2 = Populate3D(Region={Plane=PlaneXY(0, -20, 0), X=Domain(0, 10), Y=Domain(0, 10), Z=Domain(0, 2)}, Count=100, Seed=1)  # disabled
lastdex = LastIndex(List=pt)  # disabled
listdexs = ListIndices(List=panel)  # disabled
panel_4 = Panel("""True
False""")  # disabled
panel_5 = Panel("""True
False""")  # disabled
pop3d_3 = Populate3D(Region={Plane=PlaneXY(0, 0, 0), X=Domain(0, 10), Y=Domain(0, 10), Z=Domain(0, 2)}, Count=100, Seed=1)  # disabled
pop3d_4 = Populate3D(Region={Plane=PlaneXY(0, 0, 0), X=Domain(0, 10), Y=Domain(0, 10), Z=Domain(0, 2)}, Count=100, Seed=1)  # disabled
int = Integer([number_slider_2, number_slider_3, number_slider_5, number_slider_6, number_slider_7])  # disabled
int_2 = Integer([number_slider_4, number_slider_8, number_slider_10, number_slider_9, number_slider_11])  # disabled
mircutitems = MirrorCutItems(Items=panel_3, MirrorIndex=number_slider, Flip=toggle_4, Join=toggle_3)  # -> MirrorCut, SplitIndex, Intersected; disabled
mircomitems = MirrorCombineItems(Items=panel_2, Flip=toggle_2, Join=toggle)  # -> Mirrored, SplitIndex; disabled
panel_6 = Panel(lastdex)  # disabled
# The last index
# (List length - 1)
panel_7 = Panel(pt)  # disabled
# Component is a shortcut for this
# Sometimes you need a list of the item indices
# for things like replacing items ect. by culling
# or specifiying indices from the item list.
panel_8 = Panel(listdexs)  # disabled
dispdexs = DispatchIndices(List=pop3d, Indices=int)  # -> AtI, NotI; disabled
siftdexs = SiftIndices(List=pop3d_2, Indices=int_2)  # -> AtI, NotI; disabled
dispatch = Dispatch(List=pop3d_3, DispatchPattern=panel_4)  # -> ListA, ListB; disabled
sift = SiftPattern(List=pop3d_4, SiftPattern=panel_5)  # -> Output0, Output1; disabled
# List cut
# and mirrored
panel_9 = Panel(mircutitems.MirrorCut)  # disabled
panel_10 = Panel(panel_3)  # disabled
panel_11 = Panel(mircutitems.Intersected)  # disabled
# Grasshopper has a Dispatch component
# which splits the list by boolean patterns.
swatch = ColourSwatch(SwatchColor=RGB(101, 41, 255))  # disabled
# Grasshopper has a Sift component
# which sifts the list by boolean patterns.
swatch_2 = ColourSwatch(SwatchColor=RGB(101, 41, 255))  # disabled
swatch_3 = ColourSwatch(SwatchColor=RGB(41, 255, 226))  # disabled
swatch_4 = ColourSwatch(SwatchColor=RGB(41, 255, 226))  # disabled
# List mirrored
# and combined
panel_12 = Panel(mircomitems.Mirrored)  # disabled
panel_13 = Panel(panel_2)  # disabled
data = Data(dispdexs.NotI)  # disabled
data_2 = Data(siftdexs.NotI)  # disabled
data_3 = Data(dispdexs.AtI)  # disabled
data_4 = Data(siftdexs.AtI)  # disabled
# Look at Rhino window
# to preview results
# Similar to using List Item + Cull Index
# Items not at the dispatching indicies
preview = CustomPreview(Geometry=data, Shader=swatch)  # disabled
# Look at Rhino window
# to preview results
# Items not at the sifting indicies,
# with null place holders
preview_2 = CustomPreview(Geometry=data_2, Shader=swatch_2)  # disabled
# Items at the dispatching indicies
preview_3 = CustomPreview(Geometry=data_3, Shader=swatch_3)  # disabled
# Items at the sifting indicies,
# with null place holders
# Using Grasshoppers Combine component
# to bring the lists back together by filling nulls
preview_4 = CustomPreview(Geometry=data_4, Shader=swatch_4)  # disabled
panel_14 = Panel(data_4)  # disabled
panel_15 = Panel(data_2)  # disabled
panel_16 = Panel("""You
Really
Are
Reading
This
Stuff
LOL""")  # disabled
# Component is a shortcut for this
# Often in code you will need the last index (list length -1)
pt_2 = Point([Point(-8.600549939, 1.066710505, 0), Point(-1.129117342, 6.531205964, 0), Point(5.871699566, 9.952918646, 0), Point(-2.289155114, -11.3673946, 0), Point(11.24568257, -7.669513508, 0), Point(13.25643308, 17.82787734, 0), Point(-4.202145939, 20.42746541, 0), Point(-1.129117342, 6.531205964, 0)])  # disabled
lng = ListLength(List=pt_2)  # disabled
panel_17 = Panel("1")  # disabled
lng_2 = ListLength(List=panel_16)  # disabled
subtraction = Subtraction(A=lng, B=panel_17)  # disabled
number_slider_12 = Slider(3, range=-10..10)  # disabled
# Splitting the list
toggle_5 = BooleanToggle(False)  # disabled
toggle_6 = BooleanToggle(False)  # disabled
number_slider_13 = Slider(11, range=0..100)  # disabled
number_slider_14 = Slider(24, range=0..100)  # disabled
number_slider_15 = Slider(62, range=0..100)  # disabled
number_slider_16 = Slider(41, range=0..100)  # disabled
number_slider_17 = Slider(76, range=0..100)  # disabled
number_slider_18 = Slider(11, range=0..100)  # disabled
number_slider_19 = Slider(24, range=0..100)  # disabled
number_slider_20 = Slider(41, range=0..100)  # disabled
number_slider_21 = Slider(62, range=0..100)  # disabled
# Sifting indices
number_slider_22 = Slider(76, range=0..100)  # disabled
series = Series(Start=0, Step=1, Count=lng_2)  # disabled
panel_18 = Panel(subtraction)  # disabled
# Splitting the list
toggle_7 = BooleanToggle(False)  # disabled
toggle_8 = BooleanToggle(False)  # disabled
pop3d_5 = Populate3D(Region={Plane=PlaneXY(20, 0, 0), X=Domain(0, 10), Y=Domain(0, 10), Z=Domain(0, 2)}, Count=100, Seed=1)  # disabled
# List of items (can be any type of items)
pop3d_6 = Populate3D(Region={Plane=PlaneXY(20, -20, 0), X=Domain(0, 10), Y=Domain(0, 10), Z=Domain(0, 2)}, Count=100, Seed=1)  # disabled
panel_19 = Panel("""All
Kinds
of
Items
Can
Be
Used""")  # disabled
panel_20 = Panel("""All
Kinds
of
Items
Can
Be
Used""")  # disabled
panel_21 = Panel(series)  # disabled
int_3 = Integer([number_slider_13, number_slider_14, number_slider_16, number_slider_15, number_slider_17])  # disabled
int_4 = Integer([number_slider_18, number_slider_19, number_slider_20, number_slider_21, number_slider_22])  # disabled
# If  join is false you can use this index
# to split the list at the mirror seam.
mircutitems_2 = MirrorCutItems(Items=panel_19, MirrorIndex=number_slider_12, Flip=toggle_5, Join=toggle_6)  # -> MirrorCut, SplitIndex, Intersected; disabled
siftdexs_2 = SiftIndices(List=pop3d_6, Indices=int_4)  # -> AtI, NotI; disabled
# If  join is false you can use this index
# to split the list at the mirror seam.
mircomitems_2 = MirrorCombineItems(Items=panel_20, Flip=toggle_7, Join=toggle_8)  # -> Mirrored, SplitIndex; disabled
cull_i = CullIndex(List=pop3d_5, Indices=int_3, Wrap=True)  # disabled
item = ListItem(List=pop3d_5, Index=int_3, Wrap=True)  # disabled
split = SplitList(List=mircutitems_2.MirrorCut, Index=mircutitems_2.SplitIndex)  # -> ListA, ListB; disabled
swatch_5 = ColourSwatch(SwatchColor=RGB(101, 41, 255))  # disabled
swatch_6 = ColourSwatch(SwatchColor=RGB(101, 41, 255))  # disabled
swatch_7 = ColourSwatch(SwatchColor=RGB(41, 255, 226))  # disabled
number_slider_23 = Slider(3, range=0..5)  # disabled
data_5 = Data(siftdexs_2.NotI)  # disabled
data_6 = Data(siftdexs_2.AtI)  # disabled
data_7 = Data(cull_i)  # disabled
split_2 = SplitList(List=mircomitems_2.Mirrored, Index=mircomitems_2.SplitIndex)  # -> ListA, ListB; disabled
data_8 = Data(item)  # disabled
# Look at Rhino window
# to preview results
# Items not at the sifting indicies,
# with null place holders
preview_5 = CustomPreview(Geometry=data_5, Shader=swatch_5)  # disabled
# Look at Rhino window
# to preview results
preview_6 = CustomPreview(Geometry=data_7, Shader=swatch_6)  # disabled
panel_22 = Panel(split.ListA)  # disabled
panel_23 = Panel(split.ListB)  # disabled
preview_7 = CustomPreview(Geometry=data_8, Shader=swatch_7)  # disabled
panel_24 = Panel(split_2.ListB)  # disabled
panel_25 = Panel(split_2.ListA)  # disabled
# Perform some operation
# on one of the lists
Z = UnitZ(Factor=number_slider_23)  # disabled
swatch_8 = ColourSwatch(SwatchColor=RGB(41, 255, 226))  # disabled
move = Move(Geometry=data_6, Motion=Z)  # -> Geometry, Transform; disabled
# Combine the lists
# The list is combined
combine = CombineData(Input0=move.Geometry, Input1=data_5)  # -> Result, Index; disabled
# Items at the sifting indicies,
# with null place holders
# Look at Rhino window
# to preview results
preview_8 = CustomPreview(Geometry=move.Geometry, Shader=swatch_8)  # disabled
panel_26 = Panel(combine.Result)  # disabled
# Change the index value
# to shrink or grow the wave
# Repeating the list
# for repeating patterns
number_slider_24 = Slider(3, range=-10..10)  # disabled
toggle_9 = BooleanToggle(False)  # disabled
toggle_10 = BooleanToggle(False)  # disabled
toggle_11 = BooleanToggle(False)  # disabled
# Repeating the list
# for repeating patterns
toggle_12 = BooleanToggle(False)  # disabled
panel_27 = Panel("""All
Kinds
of
Items
Can
Be
Used""")  # disabled
panel_28 = Panel("""All
Kinds
of
Items
Can
Be
Used""")  # disabled
mircutitems_3 = MirrorCutItems(Items=panel_27, MirrorIndex=number_slider_24, Flip=toggle_9, Join=toggle_10)  # -> MirrorCut, SplitIndex, Intersected; disabled
mircomitems_3 = MirrorCombineItems(Items=panel_28, Flip=toggle_12, Join=toggle_11)  # -> Mirrored, SplitIndex; disabled
# Move the slider to shorten or lengthen the wave
number_slider_25 = Slider(83, range=0..200)  # disabled
# Move the slider to shorten or lengthen the wave
number_slider_26 = Slider(100, range=0..200)  # disabled
# By repeating the mirror cut list data
# you can make patterns such as waves.
repeat = RepeatData(Data=mircutitems_3.MirrorCut, Length=number_slider_25)  # disabled
# By repeating the mirror combine list data
# you can make patterns such as waves.
repeat_2 = RepeatData(Data=mircomitems_3.Mirrored, Length=number_slider_26)  # disabled
panel_29 = Panel(repeat)  # disabled
panel_30 = Panel(repeat_2)  # disabled
