# Grasshopper definition Pf_04-Color.gh (Grasshopper 0.9.76)
# plug-ins: Pufferfish

number_slider = Slider(0.25, range=0..1)  # disabled
number_slider_2 = Slider(3, range=-10..10)  # disabled
number_slider_3 = Slider(0.25, range=0..1)  # disabled
# 04-Grayscale Color
range = Range(Domain=Domain(0, 1), Steps=10)  # disabled
# 05-Invert Color
range_2 = Range(Domain=Domain(0, 1), Steps=10)  # disabled
# Changes the grayscale luminosity scheme.
# There are 4 types used in most software
# and image production.
number_slider_4 = Slider(0, range=0..3)  # disabled
# 01-Tween Two Colors
# Factor from 0 to 1 determines the color
# between inputs. So 0.5 will be halfway
# between the inputs. You can use lists /
# mutiple factors as well.
number_slider_5 = Slider(0.5, range=0..1)  # disabled
toggle = BooleanToggle(False)  # disabled
# Weights the tween distribution by curvature
# if the interpolation is not linear and degree is not 1.
toggle_2 = BooleanToggle(False)  # disabled
# 09-Point To Color
number_slider_6 = Slider(255, range=0..255)  # disabled
# Change the coordinate values
# make the point in different location
# which will output a different color
number_slider_7 = Slider(142, range=0..255)  # disabled
number_slider_8 = Slider(55, range=0..255)  # disabled
# Weights the tween distribution by curvature
# if the interpolation is not linear and degree is not 1.
# Equalizes the tween
# distribution along the
# tween path. So 0.5
# would be the middle
# of the overall tween
# path, not the middle
# input color.
toggle_3 = BooleanToggle(False)  # disabled
swatch = ColourSwatch(SwatchColor=RGB(75, 29, 224))  # disabled
# 02-Tween Consecutive Colors
swatch_2 = ColourSwatch(SwatchColor=RGB(224, 185, 29))  # disabled
swatch_3 = ColourSwatch(SwatchColor=RGB(61, 138, 121))  # disabled
swatch_4 = ColourSwatch(SwatchColor=RGB(255, 196, 0))  # disabled
swatch_5 = ColourSwatch(SwatchColor=RGB(119, 255, 0))  # disabled
swatch_6 = ColourSwatch(SwatchColor=RGB(0, 255, 221))  # disabled
swatch_7 = ColourSwatch(SwatchColor=RGB(202, 193, 232))  # disabled
# 06-Mirror Combine Colors
swatch_8 = ColourSwatch(SwatchColor=RGB(255, 255, 255))  # disabled
swatch_9 = ColourSwatch(SwatchColor=RGB(255, 0, 0))  # disabled
swatch_10 = ColourSwatch(SwatchColor=RGB(0, 47, 255))  # disabled
swatch_11 = ColourSwatch(SwatchColor=RGB(255, 0, 0))  # disabled
swatch_12 = ColourSwatch(SwatchColor=RGB(255, 196, 0))  # disabled
swatch_13 = ColourSwatch(SwatchColor=RGB(119, 255, 0))  # disabled
swatch_14 = ColourSwatch(SwatchColor=RGB(0, 255, 221))  # disabled
# The index to cut the list and
# mirror at.Try with negative
# index also to see how it
# effects the list.
swatch_15 = ColourSwatch(SwatchColor=RGB(0, 47, 255))  # disabled
# 03-Tween Through Colors
swatch_16 = ColourSwatch(SwatchColor=RGB(161, 8, 77))  # disabled
swatch_17 = ColourSwatch(SwatchColor=RGB(30, 212, 172))  # disabled
# 07-Mirror Cut Colors
swatch_18 = ColourSwatch(SwatchColor=RGB(255, 255, 255))  # disabled
toggle_4 = BooleanToggle(False)  # disabled
toggle_5 = BooleanToggle(False)  # disabled
# 08-Color To Point
swatch_19 = ColourSwatch(SwatchColor=RGB(66, 117, 199))  # disabled
toggle_6 = BooleanToggle(False)  # disabled
# 0 = Reflected - Mirrors the exact values
# 1 = Inverted - Mirrors as inverted
# Joins the list at the seam so the duplicate color is removed
# where the mirror list meets the input list. Make it true and see how
# the result list changes at the seam.
# Determines if the list mirrors at the start or end
number_slider_9 = Slider(0, range=0..1)  # disabled
toggle_7 = BooleanToggle(False)  # disabled
# 0 = Reflected - Mirrors the exact values
# 1 = Inverted - Mirrors as inverted
# Joins the list at the seam so the duplicate color is removed
# where the mirror list meets the input list. Make it true and see how
# the result list changes at the seam.
# Determines if the list mirrors at the start or end
number_slider_10 = Slider(0, range=0..1)  # disabled
# Pf_04-Color
swatch_20 = ColourSwatch(SwatchColor=RGB(255, 255, 255))  # disabled
# Optional to tween alpha
swatch_21 = ColourSwatch(SwatchColor=RGB(255, 0, 0))  # disabled
gradient = Gradient(
    LowerLimit=0,
    UpperLimit=1,
    Parameter=range,
    stops=[0: RGB(234, 38, 0), 0.25: RGB(234, 126, 0), 0.5: RGB(254, 244, 84), 0.75: RGB(173, 203, 249), 1: RGB(75, 107, 169)])  # disabled
gradient_2 = Gradient(
    LowerLimit=0,
    UpperLimit=1,
    Parameter=range_2,
    stops=[0: RGB(0, 98, 0), 0.25: RGB(81, 175, 17), 0.5: RGB(159, 198, 146), 0.75: RGB(170, 235, 41), 1: RGB(221, 255, 53)])  # disabled
# Factor from 0 to 1 determines the color
# between each input as a list. So 0.5 will
# be halfway between each input
# consecutively through the list.
# You can use lists / mutiple factors as well.
number_slider_11 = Slider(3, range=0..7)  # disabled
# Determines how the tween path is interpolated, for colors the difference is usually in subtle
# changes of the color, depending on the location of the color in relation to the other colors.
# Determines the curvature degree of the tween path if the interpolation type is not linear.
number_slider_12 = Slider(0, range=0..3)  # disabled
# Change the alpha value
number_slider_13 = Slider(255, range=0..255)  # disabled
# Factor from 0  to 1 determines the tween color.
# 0 is the first color in the set, 1 is the last color in the set.
# If for instance there are 3 colors in the set then 0.5
# would be the second (middle) color, unless equalized is true.
# You can input as many colors as you want.
# You can use lists / mutiple factors as well.
number_slider_14 = Slider(3, range=0..7)  # disabled
# Determines how the tween path is interpolated, for colors the difference is usually in subtle
# changes of the color, depending on the location of the color in relation to the other colors.
# Determines the curvature degree of the tween path if the interpolation type is not linear.
number_slider_15 = Slider(0, range=0..3)  # disabled
# List of colors
col = Colour([swatch_8, swatch_9, swatch_4, swatch_5, swatch_6, swatch_10])  # disabled
# List of colors
col_2 = Colour([swatch_18, swatch_11, swatch_12, swatch_13, swatch_14, swatch_15])  # disabled
# Change the color to see the point move in Rhino
col2pt = ColorToPoint(Color=swatch_19)  # -> Point, Alpha; disabled
# Pufferfish
# By: Michael Pryor
twn2cols = TweenTwoColors(ColorA=swatch_20, ColorB=swatch_21, Factor=number_slider_5, Alpha=True)  # disabled
pt = ConstructPoint(XCoordinate=number_slider_6, YCoordinate=number_slider_8, ZCoordinate=number_slider_7)  # disabled
# Optional remove alpha
graycol = GrayscaleColor(Color=gradient, LuminosityType=number_slider_4, Alpha=False)  # disabled
# Optional invert alpha
invcol = InvertColor(Color=gradient_2, Alpha=False)  # disabled
# Optional mirror alpha
mircomcols = MirrorCombineColors(Colors=col, Flip=toggle_6, Join=toggle_4, MirrorType=number_slider_9, Alpha=False)  # -> Mirrored, SplitIndex; disabled
mircutcols = MirrorCutColors(Colors=col_2, MirrorIndex=number_slider_2, Flip=toggle_7, Join=toggle_5, MirrorType=number_slider_10, Alpha=False)  # -> MirrorCut, SplitIndex, Intersected; disabled
panel = Panel(col2pt.Alpha)  # disabled
swatch_22 = ColourSwatch(SwatchColor=RGB(255, 255, 255))  # disabled
# Works with transparency too
legend = Legend(Colour=twn2cols, Tags="Tween Color", LegendType=1)  # disabled
legend_2 = Legend(Colour=col, Tags="Colors", LegendType=1)  # disabled
twnconcols = TweenConsecutiveColors(
    Colors=[swatch_2, swatch_3, swatch],
    Factor=number_slider,
    Weighted=toggle_2,
    Degree=number_slider_11,
    InterpolationType=number_slider_12,
    Alpha=True)  # disabled
twnthrucols = TweenThroughColors(
    Colors=[swatch_16, swatch_17, swatch_7],
    Factor=number_slider_3,
    Normalized=True,
    Equalized=toggle,
    Weighted=toggle_3,
    Degree=number_slider_14,
    InterpolationType=number_slider_15,
    Alpha=True)  # disabled
pt2col = PointToColor(Point=pt, Alpha=number_slider_13)  # disabled
panel_2 = Panel(col2pt.Point)  # disabled
panel_3 = Panel(swatch_19)  # disabled
legend_3 = Legend(Colour=invcol, Tags="I", LegendType=102)  # disabled
legend_4 = Legend(Colour=graycol, Tags="G", LegendType=102)  # disabled
legend_5 = Legend(Colour=col_2, Tags="Colors", LegendType=1)  # disabled
# Optional mirror alpha
panel_4 = Panel(mircutcols.Intersected)  # disabled
# Color RBG = Point XYZ
# Look at Rhino window
# to preview results
preview = CustomPreview(Geometry=col2pt.Point, Shader=swatch_22)  # disabled
# List mirrored
# and combined
legend_6 = Legend(Colour=mircomcols.Mirrored, Tags="Colors", LegendType=1)  # disabled
# Look at Rhino window
# to preview results
preview_2 = CustomPreview(Geometry=pt, Shader=pt2col)  # disabled
legend_7 = Legend(Colour=pt2col, Tags="Color", LegendType=1)  # disabled
# List cut
# and mirrored
legend_8 = Legend(Colour=mircutcols.MirrorCut, Tags="Colors", LegendType=1)  # disabled
# Optional to tween alpha
legend_9 = Legend(Colour=twnconcols, Tags=["Tween Color 1", "Tween Color 2"], LegendType=1)  # disabled
# Using Non-Normalized Factor
# Optional to tween alpha
legend_10 = Legend(Colour=twnthrucols, Tags="Tween Color", LegendType=1)  # disabled
# All the Tween Colors
# components do
number_slider_16 = Slider(0.516, range=0..1)  # disabled
# with alpha set to true the
# color transparencies will
# also tween. If it is false only
# the colors will tween.
toggle_8 = BooleanToggle(True)  # disabled
# this color is transparent
swatch_23 = ColourSwatch(SwatchColor=RGBA(255, 255, 255, 0))  # disabled
swatch_24 = ColourSwatch(SwatchColor=RGB(255, 0, 0))  # disabled
twn2cols_2 = TweenTwoColors(ColorA=swatch_23, ColorB=swatch_24, Factor=number_slider_16, Alpha=toggle_8)  # disabled
swatch_25 = ColourSwatch(SwatchColor=RGB(255, 196, 0))  # disabled
swatch_26 = ColourSwatch(SwatchColor=RGB(119, 255, 0))  # disabled
swatch_27 = ColourSwatch(SwatchColor=RGB(0, 255, 221))  # disabled
swatch_28 = ColourSwatch(SwatchColor=RGB(0, 47, 255))  # disabled
swatch_29 = ColourSwatch(SwatchColor=RGB(255, 255, 255))  # disabled
swatch_30 = ColourSwatch(SwatchColor=RGB(255, 0, 0))  # disabled
# Splitting the list
number_slider_17 = Slider(3, range=-10..10)  # disabled
number_slider_18 = Slider(0, range=0..1)  # disabled
toggle_9 = BooleanToggle(False)  # disabled
toggle_10 = BooleanToggle(False)  # disabled
swatch_31 = ColourSwatch(SwatchColor=RGB(255, 196, 0))  # disabled
swatch_32 = ColourSwatch(SwatchColor=RGB(0, 255, 221))  # disabled
swatch_33 = ColourSwatch(SwatchColor=RGB(255, 255, 255))  # disabled
swatch_34 = ColourSwatch(SwatchColor=RGB(255, 0, 0))  # disabled
swatch_35 = ColourSwatch(SwatchColor=RGB(119, 255, 0))  # disabled
# Splitting the list
swatch_36 = ColourSwatch(SwatchColor=RGB(0, 47, 255))  # disabled
toggle_11 = BooleanToggle(False)  # disabled
toggle_12 = BooleanToggle(False)  # disabled
number_slider_19 = Slider(0, range=0..1)  # disabled
number_slider_20 = Slider(1.5, range=0..2)  # disabled
legend_11 = Legend(Colour=twn2cols_2, Tags="Tween Color", LegendType=1)  # disabled
# Change boolean to False
# to turn off Normalized Factor
# When Normalized is False the factor is
# from 0 to the last index. This
# can be considered like a timeline.
# This lets each color have an equally
# controllable section of the slider between.
# As opposed to going from 0 to 1, this lets
# you easily pinpoint your location.
# You can use lists / mutiple factors as well.
toggle_13 = BooleanToggle(False)  # disabled
# Col @
# index 0
# Col @
# index 1
# Col @
# index 2
swatch_37 = ColourSwatch(SwatchColor=RGB(202, 193, 232))  # disabled
swatch_38 = ColourSwatch(SwatchColor=RGB(161, 8, 77))  # disabled
swatch_39 = ColourSwatch(SwatchColor=RGB(30, 212, 172))  # disabled
col_3 = Colour([swatch_29, swatch_30, swatch_25, swatch_26, swatch_27, swatch_28])  # disabled
col_4 = Colour([swatch_33, swatch_34, swatch_31, swatch_35, swatch_32, swatch_36])  # disabled
# If  join is false you can use this index
# to split the list at the mirror seam.
mircomcols_2 = MirrorCombineColors(Colors=col_4, Flip=toggle_12, Join=toggle_11, MirrorType=number_slider_19, Alpha=False)  # -> Mirrored, SplitIndex; disabled
mircutcols_2 = MirrorCutColors(Colors=col_3, MirrorIndex=number_slider_17, Flip=toggle_10, Join=toggle_9, MirrorType=number_slider_18, Alpha=False)  # -> MirrorCut, SplitIndex, Intersected; disabled
twnthrucols_2 = TweenThroughColors(
    Colors=[swatch_38, swatch_39, swatch_37],
    Factor=number_slider_20,
    Normalized=toggle_13,
    Equalized=False,
    Weighted=False,
    Degree=3,
    InterpolationType=0,
    Alpha=True)  # disabled
split = SplitList(List=mircomcols_2.Mirrored, Index=mircomcols_2.SplitIndex)  # -> ListA, ListB; disabled
# If  join is false you can use this index
# to split the list at the mirror seam.
split_2 = SplitList(List=mircutcols_2.MirrorCut, Index=mircutcols_2.SplitIndex)  # -> ListA, ListB; disabled
legend_12 = Legend(Colour=twnthrucols_2, Tags="Tween Color", LegendType=1)  # disabled
legend_13 = Legend(Colour=split.ListA, Tags="Colors", LegendType=1)  # disabled
# Repeating the list
# for repeating patterns
legend_14 = Legend(Colour=split.ListB, Tags="Colors", LegendType=1)  # disabled
legend_15 = Legend(Colour=split_2.ListA, Tags="Colors", LegendType=1)  # disabled
# Repeating the list
# for repeating patterns
legend_16 = Legend(Colour=split_2.ListB, Tags="Colors", LegendType=1)  # disabled
swatch_40 = ColourSwatch(SwatchColor=RGB(255, 0, 0))  # disabled
swatch_41 = ColourSwatch(SwatchColor=RGB(255, 196, 0))  # disabled
swatch_42 = ColourSwatch(SwatchColor=RGB(119, 255, 0))  # disabled
swatch_43 = ColourSwatch(SwatchColor=RGB(0, 255, 221))  # disabled
swatch_44 = ColourSwatch(SwatchColor=RGB(0, 47, 255))  # disabled
number_slider_21 = Slider(3, range=-10..10)  # disabled
swatch_45 = ColourSwatch(SwatchColor=RGB(255, 255, 255))  # disabled
toggle_14 = BooleanToggle(False)  # disabled
number_slider_22 = Slider(0, range=0..1)  # disabled
toggle_15 = BooleanToggle(False)  # disabled
swatch_46 = ColourSwatch(SwatchColor=RGB(255, 196, 0))  # disabled
swatch_47 = ColourSwatch(SwatchColor=RGB(119, 255, 0))  # disabled
swatch_48 = ColourSwatch(SwatchColor=RGB(0, 255, 221))  # disabled
swatch_49 = ColourSwatch(SwatchColor=RGB(0, 47, 255))  # disabled
swatch_50 = ColourSwatch(SwatchColor=RGB(255, 255, 255))  # disabled
swatch_51 = ColourSwatch(SwatchColor=RGB(255, 0, 0))  # disabled
toggle_16 = BooleanToggle(False)  # disabled
toggle_17 = BooleanToggle(False)  # disabled
number_slider_23 = Slider(0, range=0..1)  # disabled
col_5 = Colour([swatch_45, swatch_40, swatch_41, swatch_42, swatch_43, swatch_44])  # disabled
col_6 = Colour([swatch_50, swatch_51, swatch_46, swatch_47, swatch_48, swatch_49])  # disabled
mircutcols_3 = MirrorCutColors(Colors=col_5, MirrorIndex=number_slider_21, Flip=toggle_15, Join=toggle_14, MirrorType=number_slider_22, Alpha=False)  # -> MirrorCut, SplitIndex, Intersected; disabled
mircomcols_3 = MirrorCombineColors(Colors=col_6, Flip=toggle_17, Join=toggle_16, MirrorType=number_slider_23, Alpha=False)  # -> Mirrored, SplitIndex; disabled
# Move the slider to shorten or lengthen the pattern
number_slider_24 = Slider(48, range=0..200)  # disabled
# Move the slider to shorten or lengthen the pattern
number_slider_25 = Slider(48, range=0..200)  # disabled
# By repeating the mirror combine list data
# you can make repeating patterns.
repeat = RepeatData(Data=mircomcols_3.Mirrored, Length=number_slider_24)  # disabled
# By repeating the mirror combine list data
# you can make repeating patterns.
repeat_2 = RepeatData(Data=mircutcols_3.MirrorCut, Length=number_slider_25)  # disabled
legend_17 = Legend(Colour=repeat, Tags="Colors", LegendType=2)  # disabled
legend_18 = Legend(Colour=repeat_2, Tags="Colors", LegendType=2)  # disabled
