# Grasshopper definition Pf_05-Vector.gh (Grasshopper 0.9.76)
# plug-ins: Pufferfish

# 08-Vector Star
# The vector star and vector world are
# good to use as the target vectors of
# closest vector component.
number_slider = Slider(3, range=0..10)  # disabled
number_slider_2 = Slider(0.25, range=0..1)  # disabled
# 01-Tween Two Vectors
# Factor from 0 to 1 determines the vector
# between inputs. So 0.5 will be halfway
# between the inputs. You can use lists /
# mutiple factors as well.
number_slider_3 = Slider(0.5, range=0..1)  # disabled
# 04-Closest Vector
crv = Curve(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)  # disabled
# 06-Mirror Cut Vectors
# The index to cut the list and
# mirror at.Try with negative
# index also to see how it
# effects the list.
number_slider_4 = Slider(4, range=-10..10)  # disabled
# Target vectors (in this case as curves)
crv_2 = Curve(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)  # disabled
# 09-Vector World
# The vector star and vector world are
# good to use as the target vectors of
# closest vector component.
number_slider_5 = Slider(2, range=0..2)  # disabled
number_slider_6 = Slider(0, range=0..1)  # disabled
# Weights the tween distribution by curvature
# if the interpolation is not linear and degree is not 1.
toggle = BooleanToggle(False)  # disabled
# 03-Tween Through Vectors
number_slider_7 = Slider(0.25, range=0..1)  # disabled
# Inverts the reparameterization
# so it is from 1 to 0 instead of 0 to 1
toggle_2 = BooleanToggle(False)  # disabled
toggle_3 = BooleanToggle(False)  # disabled
merge = Merge(Data1=crv, Data2=crv_2)  # disabled
# Weights the tween distribution by curvature
# if the interpolation is not linear and degree is not 1.
# Equalizes the tween
# distribution along the
# tween path. So 0.5
# would be the middle
# of the overall tween
# path, not the middle
# input vector.
toggle_4 = BooleanToggle(False)  # disabled
toggle_5 = BooleanToggle(False)  # disabled
toggle_6 = BooleanToggle(False)  # disabled
toggle_7 = BooleanToggle(True)  # disabled
# 0 = Reflected - Mirrors the exact values
# 1 = Inverted - Mirrors the inverse, so
# positives become negatives and vice versa.
# Joins the list at the seam so the
# duplicate vector is removed
# where the mirror list meets the
# input list. Make it true and see how
# the result list changes at the seam.
number_slider_8 = Slider(0, range=0..1)  # disabled
toggle_8 = BooleanToggle(False)  # disabled
# 0 = Reflected - Mirrors the exact values
# 1 = Inverted - Mirrors the inverse, so
# positives become negatives and vice versa.
# Joins the list at the seam so the
# duplicate vector is removed
# where the mirror list meets the
# input list. Make it true and see how
# the result list changes at the seam.
number_slider_9 = Slider(0, range=0..1)  # disabled
# 07-Reparameterize Vectors
vec = Vector([Vector(14.67759458, 14.67719438, 14.6771953), Vector(12.78696436, 12.78661572, 0), Vector(7.690429861, 7.690220174, -7.690220659), Vector(21.00202248, -1.324276803e-06, 21.00145117), Vector(12.18009267, -7.680124233e-07, 0), Vector(11.4083389, -7.193496999e-07, -11.40802856)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])  # disabled
# Boolean toggle to switch
# between 3D or 2D star
# Cubic or spherical star type
toggle_9 = BooleanToggle(False)  # disabled
# Boolean toggle to switch
# between 3D or 2D star
# Cardial, InterCardial, or both world types
toggle_10 = BooleanToggle(False)  # disabled
# Factor from 0 to 1 determines the vector
# between each input as a list. So 0.5 will
# be halfway between each input
# consecutively through the list.
# You can use lists / mutiple factors as well.
number_slider_10 = Slider(3, range=0..7)  # disabled
vec_2 = Vector(Vector(-40.29144489, 0, 0))  # disabled
# 02-Tween Consecutive Vectors
vec_3 = Vector(Vector(30.0055933, 0, 0))  # disabled
vec_4 = Vector(Vector(0, 51.53545939, 0))  # disabled
# Pf_05-Vector
vec_5 = Vector(Vector(30.0055933, 0, 0))  # disabled
vec_6 = Vector(Vector(0, 51.53545939, 0))  # disabled
# Determines how the tween path is interpolated.
# Determines the curvature degree of the tween path if the interpolation type is not linear.
number_slider_11 = Slider(0, range=0..3)  # disabled
vec_7 = Vector(Vector(-40.29144489, 0, 0))  # disabled
vec_8 = Vector(Vector(30.0055933, 0, 0))  # disabled
vec_9 = Vector(Vector(0, 51.53545939, 0))  # disabled
pl = Plane(PlaneXY(405.7385566, -40.44130523, 0))  # disabled
pl_2 = Plane(PlaneXY(419.2711959, -40.99914008, 0))  # disabled
number_slider_12 = Slider(3, range=0..7)  # disabled
end = EndPoints(Curve=merge)  # -> Start, End; disabled
# Determines how the tween path is interpolated.
# Determines the curvature degree of the tween path if the interpolation type is not linear.
# Factor from 0  to 1 determines the tween vector.
# 0 is the first vector in the set, 1 is the last vector in the set.
# If for instance there are 3 vectors in the set then 0.5
# would be the second (middle) vector, unless equalized is true.
# You can input as many vectors as you want.
# You can use lists / mutiple factors as well.
number_slider_13 = Slider(0, range=0..3)  # disabled
# 05-Mirror Combine Vectors
# List of vectors
vec_10 = Vector([Vector(0, 1, 0), Vector(0.1244053565, 0.9922314787, 0), Vector(0.2842769683, 0.9587421996, 0), Vector(0.4831086444, 0.8755604135, 0), Vector(0.6803059523, 0.7329282443, 0), Vector(0.80542675, 0.5926953268, 0), Vector(0.9179587771, 0.3966757915, 0), Vector(0.9834874623, 0.180976273, 0), Vector(1, 0, 0)])  # disabled
# List of vectors
vec_11 = Vector([Vector(0, 1, 0), Vector(0.1244053565, 0.9922314787, 0), Vector(0.2842769683, 0.9587421996, 0), Vector(0.4831086444, 0.8755604135, 0), Vector(0.6803059523, 0.7329282443, 0), Vector(0.80542675, 0.5926953268, 0), Vector(0.9179587771, 0.3966757915, 0), Vector(0.9834874623, 0.180976273, 0), Vector(1, 0, 0)])  # disabled
reparamvecs = ReparameterizeVectors(Vectors=vec, Invert=toggle_2)  # -> Reparameterized, Original; disabled
twn2vecs = TweenTwoVectors(VectorA=vec_5, VectorB=vec_6, Factor=number_slider_3)  # disabled
# Change this slider to change
# the reference vector location.
pline = PolyLine(Vertices=end.End, Closed=False)  # disabled
vecworld = VectorWorld(Plane=pl_2, WorldType=number_slider_5, Dimensionality=toggle_10)  # -> Vectors, Lines; disabled
vecstar = VectorStar(Plane=pl, Resolution=number_slider, StarType=number_slider_6, Dimensionality=toggle_9)  # -> Vectors, Lines; disabled
# Determines if the list
# mirrors at the start or end
# Optional plane to mirror the
# vector directions when in
# reflected mode. Without a plane
# only the list order is mirrored. Plug
# this plane in and see the results.
yz = YZPlane(Origin=Point(0, 0, 0))  # disabled
# Determines if the list
# mirrors at the start or end
# Optional plane to mirror the
# vector directions when in
# reflected mode. Without a plane
# only the list order is mirrored. Plug
# this plane in and see the results.
yz_2 = YZPlane(Origin=Point(0, 0, 0))  # disabled
panel = Panel(reparamvecs.Original)  # disabled
curvepoint = PointOnCurve(pline, parameter=0.749)  # disabled
panel_2 = Panel("0,0,0")  # disabled
mircutvecs = MirrorCutVectors(Vectors=vec_11, MirrorIndex=number_slider_4, Flip=toggle_8, Join=toggle_6, MirrorType=number_slider_9)  # -> MirrorCut, SplitIndex, Intersected; disabled
mircomvecs = MirrorCombineVectors(Vectors=vec_10, Flip=toggle_7, Join=toggle_5, MirrorType=number_slider_8)  # -> Mirrored, SplitIndex; disabled
twnconvecs = TweenConsecutiveVectors(
    Vectors=[vec_3, vec_4, vec_2],
    Factor=number_slider_2,
    Weighted=toggle,
    Degree=number_slider_10,
    InterpolationType=number_slider_11)  # disabled
twnthruvecs = TweenThroughVectors(
    Vectors=[vec_8, vec_9, vec_7],
    Factor=number_slider_7,
    Normalized=True,
    Equalized=toggle_3,
    Weighted=toggle_4,
    Degree=number_slider_12,
    InterpolationType=number_slider_13)  # disabled
# if true, the result closest target vector
# will have the length of the reference vector.
toggle_11 = BooleanToggle(False)  # disabled
# Look at Rhino window
# to preview results
vdisex = VectorDisplayEx(Point=panel_2, Vector=twn2vecs, Colour=RGB(0, 0, 0), Width=2)  # disabled
# Pufferfish
# By: Michael Pryor
vdis = VectorDisplay(Anchor=panel_2, Vector=[vec_5, vec_6])
pt = Point(Point(833.3233981, 7.128306452, 0))  # disabled
# Line representation
# of result vectors
line = Line(vecstar.Lines)  # disabled
# Line representation
# of result vectors
line_2 = Line(vecworld.Lines)  # disabled
panel_3 = Panel(vecworld.Vectors)  # disabled
panel_4 = Panel(vecstar.Vectors)  # disabled
panel_5 = Panel(vec_10)  # disabled
panel_6 = Panel(vec_11)  # disabled
# Reference vector
ln = Line(StartPoint=Point(405.4249471, -4.159345701, 0), EndPoint=curvepoint)  # disabled
vlen = VectorLength(Vector=reparamvecs.Reparameterized)  # disabled
vlen_2 = VectorLength(Vector=vec)  # disabled
# Look at Rhino window
# to preview results
vdisex_2 = VectorDisplayEx(Point=pt, Vector=reparamvecs.Reparameterized, Colour=RGB(0, 0, 0), Width=2)  # disabled
vdis_2 = VectorDisplay(Anchor=pt, Vector=vec)  # disabled
amp = Amplitude(Vector=mircomvecs.Mirrored, Amplitude=60)  # disabled
amp_2 = Amplitude(Vector=mircutvecs.MirrorCut, Amplitude=60)  # disabled
panel_7 = Panel("150,0,0")  # disabled
panel_8 = Panel("300,0,0")  # disabled
# Index of closest vector
cvec = ClosestVector(Reference=ln, Targets=merge, KeepLength=toggle_11)  # -> Closest, Index, Angle; disabled
# Look at Rhino window
# to preview results
vdis_3 = VectorDisplay(Anchor=pl, Vector=vecstar.Vectors)  # disabled
# Look at Rhino window
# to preview results
vdis_4 = VectorDisplay(Anchor=pl_2, Vector=vecworld.Vectors)  # disabled
# Look at Rhino
# to preview results
vdis_5 = VectorDisplay(Anchor=Point(552.8286294, -4.991244429, 0), Vector=amp)  # disabled
# Look at Rhino
# to preview results
vdis_6 = VectorDisplay(Anchor=Point(690.1851545, -4.991244429, 0), Vector=amp_2)  # disabled
# Look at Rhino window
# to preview results
vdisex_3 = VectorDisplayEx(Point=panel_7, Vector=twnconvecs, Colour=RGB(0, 0, 0), Width=2)  # disabled
vdis_7 = VectorDisplay(Anchor=panel_7, Vector=[vec_3, vec_4, vec_2])  # disabled
# Using Non-Normalized Factor
# Look at Rhino window
# to preview results
vdisex_4 = VectorDisplayEx(Point=panel_8, Vector=twnthruvecs, Colour=RGB(0, 0, 0), Width=2)  # disabled
vdis_8 = VectorDisplay(Anchor=panel_8, Vector=[vec_8, vec_9, vec_7])  # disabled
# Angle between reference
# and closest target
panel_9 = Panel(cvec.Angle)  # disabled
panel_10 = Panel(vlen_2)  # disabled
# Original vector length
# compared to reparameterized
panel_11 = Panel(vlen)  # disabled
panel_12 = Panel(cvec.Index)  # disabled
# List mirrored
# and combined
panel_13 = Panel(mircomvecs.Mirrored)  # disabled
# List cut
# and mirrored
panel_14 = Panel(mircutvecs.MirrorCut)  # disabled
line_3 = LineSDL(Start=Point(405.4249471, -4.159345701, 0), Direction=cvec.Closest, Length=75)  # disabled
swatch = ColourSwatch(SwatchColor=RGB(255, 0, 0))  # disabled
swatch_2 = ColourSwatch(SwatchColor=RGB(43, 255, 28))  # disabled
swatch_3 = ColourSwatch(SwatchColor=RGB(0, 0, 0))  # disabled
pipe = Pipe(Curve=merge, Radius=1, Caps=0)  # disabled
pipe_2 = Pipe(Curve=line_3, Radius=0.5, Caps=0)  # disabled
pipe_3 = Pipe(Curve=ln, Radius=0.5, Caps=0)  # disabled
# Look at Rhino window
# to preview results
# Visualization of the target vectors
# Look at Rhino window
# to preview results
preview = CustomPreview(Geometry=pipe, Shader=swatch)  # disabled
# Visualization of the closest vector result.
# You will see the closest target vector
# to the reference vector gets selected
# as you change the reference vector direction.
preview_2 = CustomPreview(Geometry=pipe_2, Shader=swatch_2)  # disabled
# Visualization of the reference vector
# Look at Rhino window
# to preview results
preview_3 = CustomPreview(Geometry=pipe_3, Shader=swatch_3)  # disabled
number_slider_14 = Slider(1.5, range=0..2)  # disabled
# Vec @
# index 0
# Vec @
# index 1
# Vec @
# index 2
vec_12 = Vector(Vector(-40.29144489, 0, 0))  # disabled
vec_13 = Vector(Vector(30.0055933, 0, 0))  # disabled
vec_14 = Vector(Vector(0, 51.53545939, 0))  # disabled
# Change boolean to False
# to turn off Normalized Factor
# When Normalized is False the factor is
# from 0 to the last index. This
# can be considered like a timeline.
# This lets each vector have an equally
# controllable section of the slider between.
# As opposed to going from 0 to 1, this lets
# you easily pinpoint your location.
# You can use lists / mutiple factors as well.
toggle_12 = BooleanToggle(False)  # disabled
number_slider_15 = Slider(4, range=-10..10)  # disabled
# Splitting the list
toggle_13 = BooleanToggle(False)  # disabled
toggle_14 = BooleanToggle(False)  # disabled
number_slider_16 = Slider(0, range=0..1)  # disabled
# Splitting the list
toggle_15 = BooleanToggle(False)  # disabled
toggle_16 = BooleanToggle(False)  # disabled
number_slider_17 = Slider(0, range=0..1)  # disabled
twnthruvecs_2 = TweenThroughVectors(
    Vectors=[vec_13, vec_14, vec_12],
    Factor=number_slider_14,
    Normalized=toggle_12,
    Equalized=False,
    Weighted=False,
    Degree=3,
    InterpolationType=0)  # disabled
vec_15 = Vector([Vector(0, 1, 0), Vector(0.1244053565, 0.9922314787, 0), Vector(0.2842769683, 0.9587421996, 0), Vector(0.4831086444, 0.8755604135, 0), Vector(0.6803059523, 0.7329282443, 0), Vector(0.80542675, 0.5926953268, 0), Vector(0.9179587771, 0.3966757915, 0), Vector(0.9834874623, 0.180976273, 0), Vector(1, 0, 0)])  # disabled
vec_16 = Vector([Vector(0, 1, 0), Vector(0.1244053565, 0.9922314787, 0), Vector(0.2842769683, 0.9587421996, 0), Vector(0.4831086444, 0.8755604135, 0), Vector(0.6803059523, 0.7329282443, 0), Vector(0.80542675, 0.5926953268, 0), Vector(0.9179587771, 0.3966757915, 0), Vector(0.9834874623, 0.180976273, 0), Vector(1, 0, 0)])  # disabled
swatch_4 = ColourSwatch(SwatchColor=RGB(25, 0, 255))  # disabled
panel_15 = Panel("300,0,0")  # disabled
# If  join is false you can use this index
# to split the list at the mirror seam.
mircutvecs_2 = MirrorCutVectors(Vectors=vec_15, MirrorIndex=number_slider_15, Flip=toggle_14, Join=toggle_13, MirrorType=number_slider_16)  # -> MirrorCut, SplitIndex, Intersected; disabled
# If  join is false you can use this index
# to split the list at the mirror seam.
mircomvecs_2 = MirrorCombineVectors(Vectors=vec_16, Flip=toggle_16, Join=toggle_15, MirrorType=number_slider_17)  # -> Mirrored, SplitIndex; disabled
# Look at Rhino window
# to preview results
vdisex_5 = VectorDisplayEx(Point=panel_15, Vector=twnthruvecs_2, Colour=swatch_4, Width=2)  # disabled
vdis_9 = VectorDisplay(Anchor=panel_15)  # disabled
split = SplitList(List=mircomvecs_2.Mirrored, Index=mircomvecs_2.SplitIndex)  # -> ListA, ListB; disabled
split_2 = SplitList(List=mircutvecs_2.MirrorCut, Index=mircutvecs_2.SplitIndex)  # -> ListA, ListB; disabled
panel_16 = Panel(split.ListA)  # disabled
panel_17 = Panel(split_2.ListA)  # disabled
panel_18 = Panel(split.ListB)  # disabled
panel_19 = Panel(split_2.ListB)  # disabled
toggle_17 = BooleanToggle(False)  # disabled
number_slider_18 = Slider(4, range=-10..10)  # disabled
# Repeating the list
# for repeating patterns
toggle_18 = BooleanToggle(False)  # disabled
number_slider_19 = Slider(0, range=0..1)  # disabled
# Repeating the list
# for repeating patterns
toggle_19 = BooleanToggle(False)  # disabled
toggle_20 = BooleanToggle(False)  # disabled
number_slider_20 = Slider(0, range=0..1)  # disabled
# Change the index value to shrink or grow the wave
vec_17 = Vector([Vector(0, 1, 0), Vector(0.1244053565, 0.9922314787, 0), Vector(0.2842769683, 0.9587421996, 0), Vector(0.4831086444, 0.8755604135, 0), Vector(0.6803059523, 0.7329282443, 0), Vector(0.80542675, 0.5926953268, 0), Vector(0.9179587771, 0.3966757915, 0), Vector(0.9834874623, 0.180976273, 0), Vector(1, 0, 0)])  # disabled
vec_18 = Vector([Vector(0, 1, 0), Vector(0.1244053565, 0.9922314787, 0), Vector(0.2842769683, 0.9587421996, 0), Vector(0.4831086444, 0.8755604135, 0), Vector(0.6803059523, 0.7329282443, 0), Vector(0.80542675, 0.5926953268, 0), Vector(0.9179587771, 0.3966757915, 0), Vector(0.9834874623, 0.180976273, 0), Vector(1, 0, 0)])  # disabled
mircomvecs_3 = MirrorCombineVectors(Vectors=vec_18, Flip=toggle_20, Join=toggle_19, MirrorType=number_slider_20)  # -> Mirrored, SplitIndex; disabled
mircutvecs_3 = MirrorCutVectors(Vectors=vec_17, MirrorIndex=number_slider_18, Flip=toggle_18, Join=toggle_17, MirrorType=number_slider_19)  # -> MirrorCut, SplitIndex, Intersected; disabled
# Move the slider to shorten or lengthen the wave
number_slider_21 = Slider(74, range=0..200)  # disabled
# Move the slider to shorten or lengthen the wave
number_slider_22 = Slider(74, range=0..200)  # disabled
# By repeating the mirror combine list data
# you can make patterns such as waves.
amp_3 = Amplitude(Vector=mircomvecs_3.Mirrored, Amplitude=10)  # disabled
# By repeating the mirror combine list data
# you can make patterns such as waves.
amp_4 = Amplitude(Vector=mircutvecs_3.MirrorCut, Amplitude=10)  # disabled
repeat = RepeatData(Data=amp_3, Length=number_slider_21)  # disabled
repeat_2 = RepeatData(Data=amp_4, Length=number_slider_22)  # disabled
series = Series(Start=0, Step=1, Count=number_slider_21)  # disabled
series_2 = Series(Start=0, Step=1, Count=number_slider_22)  # disabled
Y = UnitY(Factor=series)  # disabled
Y_2 = UnitY(Factor=series_2)  # disabled
pt_2 = Point(Point(553.9670907, 68.17972828, 0))  # disabled
pt_3 = Point(Point(690.7392917, 68.17972828, 0))  # disabled
panel_20 = Panel(repeat)  # disabled
panel_21 = Panel(repeat_2)  # disabled
move = Move(Geometry=pt_2, Motion=Y)  # -> Geometry, Transform; disabled
move_2 = Move(Geometry=pt_3, Motion=Y_2)  # -> Geometry, Transform; disabled
move_3 = Move(Geometry=move.Geometry, Motion=repeat)  # -> Geometry, Transform; disabled
move_4 = Move(Geometry=move_2.Geometry, Motion=repeat_2)  # -> Geometry, Transform; disabled
# Look at Rhino
# to preview results
pt_4 = Point(move_4.Geometry)  # disabled
# Look at Rhino
# to preview results
pt_5 = Point(move_3.Geometry)  # disabled
