# Grasshopper definition Pf_06-Point.gh (Grasshopper 0.9.76)
# plug-ins: Pufferfish

# Change the slider value to move the
# mirror plane and see how it effects the
# mirror cutting.
# Change the slider value to rotate the
# mirror plane and see how it effects the
# mirror cutting.
number_slider = Slider(-3.38, range=-20..40)  # disabled
# Unlike grasshoppers native surface
# divide component, this component uses
# parameter values along the u and v
# surface domains. Here we use range
# components to generate the lists
# of parameters. The native grasshopper
# component uses a division value which
# always makes an even grid on surface.
# By using parameter values there can be
# more customization of the grid spacing.
number_slider_2 = Slider(5, range=0..10)  # disabled
# 14-Parameter Point Divide Surface
number_slider_3 = Slider(6, range=0..10)  # disabled
number_slider_4 = Slider(0.25, range=0..1)  # disabled
# 02-Tween Consecutive Points
number_slider_5 = Slider(0.5, range=0..1)  # disabled
# 03-Tween Through Points
number_slider_6 = Slider(0.25, range=0..1)  # disabled
number_slider_7 = Slider(0.25, range=0..1)  # disabled
# 01-Tween Two Points
# Factor from 0 to 1 determines the point
# between inputs. So 0.5 will be halfway
# between the inputs. You can use lists /
# mutiple factors as well.
number_slider_8 = Slider(0.5, range=0..1)  # disabled
number_slider_9 = Slider(0.5, range=0..1)  # disabled
# The target division length
# to divide equally closest to.
number_slider_10 = Slider(0, range=0..2)  # disabled
toggle = BooleanToggle(False)  # disabled
toggle_2 = BooleanToggle(False)  # disabled
toggle_3 = BooleanToggle(False)  # disabled
# Toggle between getting the curves middle
# point of length or middle point of domain
toggle_4 = BooleanToggle(True)  # disabled
# Weights the tween distribution by curvature
# if the interpolation is not linear and degree is not 1.
toggle_5 = BooleanToggle(False)  # disabled
# Weights the tween distribution by curvature
# if the interpolation is not linear and degree is not 1.
toggle_6 = BooleanToggle(False)  # disabled
# 09-Point Divide Curve Target Length
number_slider_11 = Slider(6.57, range=0..10)  # disabled
# Weights the tween distribution by curvature
# if the curve is not linear and degree is not 1.
# Equalizes the tween distribution along the
# tween path curve. So 0.5 would be the
# middle of the overall tween path curve,
# not the middle input point.
toggle_7 = BooleanToggle(False)  # disabled
# Weights the tween distribution by curvature
# if the interpolation is not linear and degree is not 1.
# Equalizes the tween
# distribution along the
# tween path. So 0.5
# would be the middle
# of the overall tween
# path, not the middle
# input point.
toggle_8 = BooleanToggle(False)  # disabled
# 08-Point Divide Curve Segments
# Curves that have segments.
# If curve has no segments
# it will divide the entire curve
# equally.
number_slider_12 = Slider(4, range=0..10)  # disabled
# 11-Tween Consecutive Points On Curve
number_slider_13 = Slider(0.25, range=0..1)  # disabled
# Weights the tween distribution by curvature
# if the interpolation is not linear and degree is not 1.
# Equalizes the tween
# distribution along the
# tween path. So 0.5
# would be the middle
# of the overall tween
# path, not the middle
# input point.
toggle_9 = BooleanToggle(False)  # disabled
# 04-Curve Coil Points
# Number of curve divisions
number_slider_14 = Slider(30, range=0..300)  # disabled
# 05-Curve Edit Points
# Points that make
# the interpolated curve
pt = Point([Point(-29.02972034, -37.7493154, 0), Point(-21.08704348, -24.2888909, 0), Point(-18.82805911, -41.56297066, 0), Point(-11.21430931, -38.46604538, 0), Point(-8.341026918, -27.89432168, 0), Point(-1.346393572, -28.82077906, 0), Point(-2.16486807, -33.89551287, 0)])  # disabled
# 07-Curve Wave Points
# Number of curve divisions
number_slider_15 = Slider(16, range=0..300)  # disabled
# 16-Tween Two Points On Surface
# Factor from 0 to 1 determines the point
# between inputs. So 0.5 will be halfway
# between the inputs. You can use lists /
# mutiple factors as well.
number_slider_16 = Slider(0.5, range=0..1)  # disabled
# 10-Tween Two Points On Curve
number_slider_17 = Slider(0.75, range=0..1)  # disabled
# When true you will get the exact points
# an interpolated surface intrpolated through.
# When false you get all the edit points.
toggle_10 = BooleanToggle(True)  # disabled
# 06-Curve Middle Point
# Curve to get middle point of
crv = Curve(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)  # disabled
# Look at Rhino window
# to preview input
srf = Surface(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)  # disabled
# Look at Rhino window
# to preview input
pt_2 = Point([Point(325.5520587, 31.57608545, 0), Point(323.8966654, 35.81595267, 0), Point(325.7606027, 40.8413618, 0), Point(323.6040234, 43.40561871, 0), Point(325.6045943, 46.47199461, 0)])  # disabled
# Look at Rhino window
# to preview input
# 25-Point Mesh Side
pt_3 = Point([Point(346.8049865, 43.05811251, 0), Point(360.1318976, 32.87852886, 5.551820468), Point(362.3969426, 39.3699745, 0), Point(355.8875511, 39.29368178, 5.968781172), Point(351.0927132, 35.19006957, 8.475941061), Point(345.9748615, 49.27502895, 3.885920796), Point(356.7796706, 46.63735712, 1.634975231), Point(362.5812773, 45.91734624, 0), Point(356.3655021, 42.26102496, 0), Point(345.7013584, 36.59335232, 4.48282604)])  # disabled
# 26-Point Plane Side
# Look at Rhino window
# to preview input
P = Point([Point(386.6808249, 14.35611416, 0), Point(393.4243007, 26.41474937, 0), Point(397.0236269, 6.128508145, 0)])  # disabled
# Look at Rhino window
# to preview input
pln = Plane(Plane(origin=(393.2790545, 16.56715766, 0), x=(0.8358830235, 0.5489076161, 0), y=(-0.1934579719, 0.2946000925, 0.9358337452)))  # disabled
# 28-Point Surface Side
# Look at Rhino window
# to preview input
P_2 = Point([Point(434.1747247, 24.59822565, -6.164891909), Point(439.7942874, 17.40689664, 4.711794715), Point(438.6823186, 4.784021885, 0)])  # disabled
# 24-Are Points Coplanar
# Look at Rhino window
# to preview input
pt_4 = Point([Point(346.2847634, 5.232681052, 0), Point(343.4994108, 11.35254045, 0), Point(354.2452198, 8.772409421, 0), Point(357.0595754, 12.71831237, 0), Point(351.2700316, 17.74632269, 0), Point(345.5279449, 18.69694115, 0), Point(349.5414901, 14.19521807, 0), Point(351.6576722, 5.765518158, 0), Point(358.2225393, 6.541713044, 0)])  # disabled
# 23-Are Points Collinear
# Look at Rhino window
# to preview input
pt_5 = Point([Point(325.6664664, 9.052529564, 0), Point(325.6664664, 12.32449107, 0), Point(325.6664664, 15.19140289, 0), Point(325.6664664, 18.90055936, 0), Point(325.6664664, 22.69806613, 0)])  # disabled
# Factor from 0 to 1 determines the point
# between each input as a list. So 0.5 will
# be halfway between each input
# consecutively through the list.
# You can use lists / mutiple factors as well.
number_slider_18 = Slider(3, range=0..7)  # disabled
# This option includes the endpoint
# only for closed curves. If true with open
# curves nothing will happen.
# There are 3 division types.
# Closest, Ceiling, Floor
toggle_11 = BooleanToggle(False)  # disabled
# Look at Rhino window
# to preview input
mesh = Mesh(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)  # disabled
# Look at Rhino window
# to preview input
pt_6 = Point([Point(473.5437578, 4.784021885, 0), Point(469.036164, 24.59822565, -6.164891909), Point(474.6612854, 17.14358139, 5.553543568)])  # disabled
pt_7 = Point(Point(234.8998708, -35.34307548, 6.093886903))  # disabled
crv_2 = Curve(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)  # disabled
# 12-Tween Through Points On Curve
pt_8 = Point(Point(214.1157338, -32.43889709, 6.72241149))  # disabled
pt_9 = Point(Point(217.5356104, -34.27453508, 9.529547685))  # disabled
pt_10 = Point(Point(20.01330408, 0.1258942597, 0))  # disabled
pt_11 = Point(Point(23.31911307, 14.24566655, 0))  # disabled
pt_12 = Point(Point(33.26946213, 4.963962088, 10.58820749))  # disabled
pt_13 = Point(Point(70.62259451, 2.357067053, 12.45169359))  # disabled
# Pf_06-Point
pt_14 = Point(Point(0, 0, 0))  # disabled
pt_15 = Point(Point(-12.14069583, 8.722292686, 12.10213129))  # disabled
pt_16 = Point(Point(55.57101076, -0.2038058289, 0))  # disabled
pt_17 = Point(Point(58.98943748, 13.50022619, 0))  # disabled
# Factor from 0 to 1 determines the point
# between each input as a list. So 0.5 will
# be halfway between each input
# consecutively through the list.
# You can use lists / mutiple factors as well.
number_slider_19 = Slider(3, range=0..7)  # disabled
# 18-Tween Through Points On Surface
pt_18 = Point(Point(212.6256624, 7.490051243, 19.87992176))  # disabled
pt_19 = Point(Point(225.0310305, 2.164932681, 22.20601964))  # disabled
pt_20 = Point(Point(217.0803439, 5.383579774, 6.396566713))  # disabled
srf_2 = Surface(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)  # disabled
toggle_12 = BooleanToggle(True)  # disabled
toggle_13 = BooleanToggle(True)  # disabled
toggle_14 = BooleanToggle(True)  # disabled
srf_3 = Surface(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)  # disabled
# Look at Rhino window
# to preview input
srf_4 = Surface(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)  # disabled
pt_21 = Point(Point(161.6973641, 5.383579774, 6.396566713))  # disabled
# 27-Point Surface Edge
# Move point to see edge selection change
pt_22 = Point(Point(437.199458, 62.35048772, 14.37295248))  # disabled
# 17-Tween Consecutive Points On Surface
pt_23 = Point(Point(157.2426826, 7.490051243, 19.87992176))  # disabled
pt_24 = Point(Point(169.6480507, 2.164932681, 22.20601964))  # disabled
toggle_15 = BooleanToggle(False)  # disabled
# Determines how the tween path is interpolated.
# Determines the curvature degree of the tween path if the interpolation type is not linear.
number_slider_20 = Slider(0, range=0..3)  # disabled
# Weights the tween distribution by curvature
# if the curve is not linear and degree is not 1.
# Factor from 0 to 1 determines the point
# between inputs. So 0.5 will be halfway
# between the inputs. You can use lists /
# mutiple factors as well.
toggle_16 = BooleanToggle(False)  # disabled
# Weights the tween distribution by curvature
# if the curve is not linear and degree is not 1.
# Factor from 0 to 1 determines the point
# between each input as a list. So 0.5 will
# be halfway between each input
# consecutively through the list.
# You can use lists / mutiple factors as well.
toggle_17 = BooleanToggle(False)  # disabled
# Check in Rhino, the points are the same
intcrv = Interpolate(Vertices=pt, Degree=3, Periodic=False, KnotStyle=0)  # -> Curve, Length, Domain; disabled
# 20-Pinch'n'Spread
sqgrid = Square(Plane=PlaneXY(296.0699263, 6.778350916, 0), Size=1, ExtentX=10, ExtentY=20)  # -> Cells, Points; disabled
number_slider_21 = Slider(5, range=0..10)  # disabled
# negative strengths spread
number_slider_22 = Slider(0.6, range=-1..1)  # disabled
# Factor from 0  to 1 determines the tween point.
# 0 is the first point in the set, 1 is the last point in the set.
# If for instance there are 3 points in the set then 0.5
# would be the second (middle) point, unless equalized is true.
# You can input as many points as you want.
# You can use lists / mutiple factors as well.
number_slider_23 = Slider(3, range=0..7)  # disabled
number_slider_24 = Slider(3, range=0..7)  # disabled
# 15-Surface Edit Points
srf_5 = Surface(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)  # disabled
# 21-Plane Trim Points
# The point set that will get
# trimmed (turn its preview
# on to see the original point set)
# Plane that trims
O = Origin(Point(109.9575421, 174.9278551, 8.970328456))  # disabled
# Domain offsets coil width,
# you can use a single number
# instead of domain.
number_slider_25 = Slider(5.164, range=-100..100)  # disabled
number_slider_26 = Slider(0, range=-100..100)  # disabled
# Determines how the tween path is interpolated.
# Determines the curvature degree of the tween path if the interpolation type is not linear.
number_slider_27 = Slider(0, range=0..3)  # disabled
number_slider_28 = Slider(0, range=-100..100)  # disabled
# Domain offsets coil width,
# you can use a single number
# instead of domain.
number_slider_29 = Slider(4, range=-100..100)  # disabled
# Determines how the tween path is interpolated.
# Determines the curvature degree of the tween path if the interpolation type is not linear.
number_slider_30 = Slider(0, range=0..3)  # disabled
# Determines how the tween path is interpolated.
# Determines the curvature degree of the tween path if the interpolation type is not linear.
number_slider_31 = Slider(0, range=0..3)  # disabled
toggle_18 = BooleanToggle(False)  # disabled
# 22-Reparameterize Points
pop3d = Populate3D(Region={Plane=PlaneXY(0, 0, 0), X=Domain(0, 10), Y=Domain(0, 10), Z=Domain(0, 2)}, Count=100, Seed=1)  # disabled
C = Curve(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)  # disabled
# 19-Mirror Cut Points
# Plane
yz = YZPlane(Origin=Point(11.90780968, 89.77094321, 12.959768))  # disabled
range = Range(Domain=Domain(0, 1), Steps=number_slider_2)  # disabled
range_2 = Range(Domain=Domain(0, 1), Steps=number_slider_3)  # disabled
X = UnitX(Factor=number_slider)  # disabled
# When true you will get the exact points
# an interpolated curve intrpolated through.
# When false you get all the edit points like
# Rhino's EditPtOn command.
toggle_19 = BooleanToggle(True)  # disabled
# 13-Map Point To Surface
P_3 = Point([Point(236.2352132, 89.50113052, 0.02928425763), Point(248.5178667, 90.717984, 4.910189948), Point(257.1646837, 82.98160275, 0.0944416689), Point(244.8278706, 81.79918391, -6.44751132)])  # disabled
S = Source(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)  # disabled
# Points to map. Keep in mind these points
# map to the surface space not the surface.
# So if the points are not on the source
# surface they will map in the same
# relationship offset from the target surface.
T = Target(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)  # disabled
S_2 = Surface(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)  # disabled
C_2 = Curve(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)  # disabled
pt_25 = Point(Point(115.5878299, 2.164932681, 22.20601964))  # disabled
pt_26 = Point(Point(107.6371433, 5.383579774, 6.396566713))  # disabled
srf_6 = Surface(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)  # disabled
pt_27 = Point(Point(155.2705652, -32.78540489, 5.10494556))  # disabled
pt_28 = Point(Point(164.922715, -39.12393166, 5.681341046))  # disabled
pt_29 = Point(Point(177.5028649, -35.85937778, 7.352637512))  # disabled
crv_3 = Curve(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)  # disabled
pt_30 = Point(Point(102.4326287, -34.86945525, 9.432029348))  # disabled
pt_31 = Point(Point(119.6495025, -35.6104692, 6.78547959))  # disabled
crv_4 = Curve(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)  # disabled
# Inverts the reparameterization
# so it is from 1 to 0 instead of 0 to 1
# Switches the reparameterization
# between 3D and 2D
# Controls whether to reparemetrize just
# the X, Y, Z, or all parts of the point set
toggle_20 = BooleanToggle(False)  # disabled
yz_2 = YZPlane(Origin=O)  # disabled
# Flips the mirror direction to
# cut the other side instead.
toggle_21 = BooleanToggle(False)  # disabled
crvmidpt = CurveMiddlePoint(Curve=crv, EvaluationType=toggle_4)  # -> Middle, Tangent, Parameter, Length; disabled
ptmshside = PointMeshSide(Point=pt_6, Mesh=mesh)  # -> Side, Front, Back, Distance; disabled
ptplnside = PointPlaneSide(Point=P, Plane=pln)  # -> Side, Front, Back, Distance; disabled
ptscoplnr = ArePointsCoplanar(Points=pt_3)  # disabled
ptsrfside = PointSurfaceSide(Point=P_2, Surface=srf)  # -> Side, Front, Back, Distance; disabled
# Pufferfish
# By: Michael Pryor
twn2pts = TweenTwoPoints(PointA=pt_14, PointB=pt_15, Factor=number_slider_8)  # disabled
ptscolinr = ArePointsCollinear(Points=pt_2)  # disabled
ptscoplnr_2 = ArePointsCoplanar(Points=pt_4)  # disabled
ptscolinr_2 = ArePointsCollinear(Points=pt_5)  # disabled
ptsrfedge = PointSurfaceEdge(Point=pt_22, Surface=srf_4)  # -> Edge, EdgeIndex; disabled
pt_32 = Point(sqgrid.Points)  # disabled
pt_33 = Point([Point(298.2637905, 23.34915656, 0), Point(303.8596274, 18.52742326, 0), Point(299.2662198, 7.780096092, 0)])  # disabled
# Amount of rotation
number_slider_32 = Slider(50, range=-100..100)  # disabled
# Amount of rotation
number_slider_33 = Slider(9.986, range=-100..100)  # disabled
move = Move(Geometry=yz, Motion=X)  # -> Geometry, Transform; disabled
# The reach distance determines how
# far from the mirror plane that the cutting
# reaches. Anything within that distance
# from the mirror plane will be additionally
# cut away. Set it to zero and the cutting will
# only happen exactly at the mirror plane.
number_slider_34 = Slider(69, range=0..360)  # disabled
pop3d_2 = Populate3D(
    Region={Plane=Plane(origin=(92.33638854, 159.5173607, 0), x=(0, 1, 0), y=(1, 0, 0)), X=Domain(0, 32.66751416), Y=Domain(0, 33.61439863), Z=Domain(-29.50894418, 0)},
    Count=500,
    Seed=1)  # disabled
# This option includes the endpoint
# only for closed curves. If true with open
# curves nothing will happen.
ptdivcrvsegs = PointDivideCurveSegments(Curve=C_2, Number=number_slider_12, EndPoint=toggle_15)  # -> Points, Tangents, Parameters; disabled
twn2ptscrv = TweenTwoPointsOnCurve(PointA=pt_30, PointB=pt_31, Curve=crv_4, Factor=number_slider_17, Weighted=toggle_16)  # disabled
twnconptscrv = TweenConsecutivePointsOnCurve(Points=[pt_27, pt_28, pt_29], Curve=crv_3, Factor=number_slider_13, Weighted=toggle_17)  # disabled
mappt2srf = MapPointToSurface(Point=P_3, Source=S, Target=T)  # disabled
srfeditpts = SurfaceEditPoints(Surface=srf_5, Knots=toggle_10)  # -> Points, Normals, CountU, CountV, Parameters; disabled
crveditpts = CurveEditPoints(Curve=intcrv.Curve, Knots=toggle_19)  # -> Points, Tangents, Parameters; disabled
ptdivcrvtarg = PointDivideCurveTargetLength(Curve=C, Target=number_slider_11, DivisionType=number_slider_10, EndPoint=toggle_11)  # -> Points, Tangents, Parameters, Length, R; disabled
paramptdivsrf = ParameterPointDivideSurface(Surface=S_2, ParametersU=range_2, ParametersV=range)  # -> Points, Normals; disabled
twn2ptssrf = TweenTwoPointsOnSurface(PointA=pt_25, PointB=pt_26, Surface=srf_6, Factor=number_slider_16)  # disabled
twnthruptscrv = TweenThroughPointsOnCurve(Points=[pt_8, pt_9, pt_7], Curve=crv_2, Factor=number_slider_4, Normalized=True, Equalized=toggle, Weighted=toggle_7)  # disabled
# Weights the division
# distribution by curvature.
toggle_22 = BooleanToggle(False)  # disabled
# Weights the division
# distribution by curvature.
toggle_23 = BooleanToggle(False)  # disabled
panel = Panel(ptsrfedge.EdgeIndex)  # disabled
swatch = ColourSwatch(SwatchColor=RGB(10, 22, 255))  # disabled
x_plus_one = XPlusOne(NumberX=number_slider_14)  # disabled
x_plus_one_2 = XPlusOne(NumberX=number_slider_15)  # disabled
panel_2 = Panel(ptscolinr_2)  # disabled
panel_3 = Panel(ptscolinr)  # disabled
panel_4 = Panel(ptscoplnr_2)  # disabled
panel_5 = Panel(ptscoplnr)  # disabled
# The point set that will get
# mirror cut (turn its preview
# on to see the original point set)
# Using as the mirror plane
deplane = DeconstructPlane(Plane=move.Geometry)  # -> Origin, XAxis, YAxis, ZAxis; disabled
# Look at Rhino window
# to preview results
preview = CustomPreview(
    Geometry=twn2pts,
    Shader={ambient=RGB(0, 0, 0), diffuse=RGB(255, 105, 180), emission=RGB(76, 32, 54), shine=0.5, specular=RGB(255, 255, 255), transparency=0})  # disabled
panel_6 = Panel(range_2)  # disabled
panel_7 = Panel(range)  # disabled
panel_8 = Panel(ptplnside.Distance)  # disabled
panel_9 = Panel(ptplnside.Back)  # disabled
number_slider_35 = Slider(1.596, range=0..10)  # disabled
panel_10 = Panel(ptmshside.Distance)  # disabled
panel_11 = Panel(ptplnside.Front)  # disabled
panel_12 = Panel(ptsrfside.Back)  # disabled
panel_13 = Panel(ptsrfside.Distance)  # disabled
panel_14 = Panel(ptmshside.Front)  # disabled
panel_15 = Panel(ptmshside.Back)  # disabled
panel_16 = Panel(ptplnside.Side)  # disabled
panel_17 = Panel(ptsrfside.Front)  # disabled
panel_18 = Panel(ptmshside.Side)  # disabled
panel_19 = Panel(ptsrfside.Side)  # disabled
reparampts = ReparameterizePoints(
    Points=pop3d,
    CoordinatesX=toggle_12,
    CoordinatesY=toggle_13,
    CoordinatesZ=toggle_14,
    Dimensionality=toggle_18,
    Invert=toggle_20)  # -> Reparameterized, OriginalX, OriginalY, OriginalZ; disabled
twnconptssrf = TweenConsecutivePointsOnSurface(
    Points=[pt_23, pt_24, pt_21],
    Surface=srf_3,
    Factor=number_slider_9,
    Weighted=toggle_6,
    Degree=number_slider_19,
    InterpolationType=number_slider_27)  # disabled
twnthrupts = TweenThroughPoints(
    Points=[pt_16, pt_17, pt_13],
    Factor=number_slider_6,
    Normalized=True,
    Equalized=toggle_2,
    Weighted=toggle_8,
    Degree=number_slider_23,
    InterpolationType=number_slider_30)  # disabled
twnthruptssrf = TweenThroughPointsOnSurface(
    Points=[pt_18, pt_19, pt_20],
    Surface=srf_2,
    Factor=number_slider_7,
    Normalized=True,
    Equalized=toggle_3,
    Weighted=toggle_9,
    Degree=number_slider_24,
    InterpolationType=number_slider_31)  # disabled
plntrimpts = PlaneTrimPoints(Points=pop3d_2, Plane=yz_2, Flip=toggle_21)  # -> Trimmed, KeptIndicies, Intersected; disabled
twnconpts = TweenConsecutivePoints(
    Points=[pt_10, pt_11, pt_12],
    Factor=number_slider_5,
    Weighted=toggle_5,
    Degree=number_slider_18,
    InterpolationType=number_slider_20)  # disabled
range_3 = Range(Domain=Domain(0, 1), Steps=number_slider_14)  # disabled
range_4 = Range(Domain=Domain(0, 1), Steps=number_slider_15)  # disabled
ln = Line(StartPoint=P_3, EndPoint=mappt2srf)  # disabled
p_n_s = PinchNSpread(Points=pt_32, Locations=pt_33, Radiuses=number_slider_21, Strengths=number_slider_22)  # disabled
dom = ConstructDomain(DomainStart=number_slider_28, DomainEnd=number_slider_29)  # disabled
dom_2 = ConstructDomain(DomainStart=number_slider_26, DomainEnd=number_slider_25)  # disabled
# The offser distance determines how
# far to offset the cut. It does not do any
# additional cut removing like
# the reach plane, it just moves the
# actual cut away from the mirror plane.
# Set it to zero and there will be no gap
# in the mirror cut.
number_slider_36 = Slider(3.352, range=0..10)  # disabled
# Curve to coil around
crv_5 = Curve(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)  # disabled
# Curve to wave around
crv_6 = Curve(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)  # disabled
# Look at Rhino window
# to preview results
preview_2 = CustomPreview(
    Geometry=twnconptscrv,
    Shader={ambient=RGB(0, 0, 0), diffuse=RGB(255, 105, 180), emission=RGB(76, 32, 54), shine=0.5, specular=RGB(255, 255, 255), transparency=0})  # disabled
# Look at Rhino window
# to preview results
preview_3 = CustomPreview(
    Geometry=twn2ptssrf,
    Shader={ambient=RGB(0, 0, 0), diffuse=RGB(255, 105, 180), emission=RGB(76, 32, 54), shine=0.5, specular=RGB(255, 255, 255), transparency=0})  # disabled
# With closed segmented curves
# Look at Rhino window
# to preview results
preview_4 = CustomPreview(
    Geometry=ptdivcrvsegs.Points,
    Shader={ambient=RGB(0, 0, 0), diffuse=RGB(255, 105, 180), emission=RGB(76, 32, 54), shine=0.5, specular=RGB(255, 255, 255), transparency=0})  # disabled
# Look at Rhino window
# to preview results
# This allows the start and end of the grid
# to be altered on the surface so grids can
# exist only on parts of the surface.
preview_5 = CustomPreview(
    Geometry=paramptdivsrf.Points,
    Shader={ambient=RGB(0, 0, 0), diffuse=RGB(255, 105, 180), emission=RGB(76, 32, 54), shine=0.5, specular=RGB(255, 255, 255), transparency=0})  # disabled
# Just to visualize the relationship
# between input points and mapped points.
# Look at Rhino window
# to preview results
preview_6 = CustomPreview(
    Geometry=mappt2srf,
    Shader={ambient=RGB(0, 0, 0), diffuse=RGB(255, 105, 180), emission=RGB(76, 32, 54), shine=0.5, specular=RGB(255, 255, 255), transparency=0})  # disabled
# Look at Rhino window
# to preview results
preview_7 = CustomPreview(
    Geometry=twn2ptscrv,
    Shader={ambient=RGB(0, 0, 0), diffuse=RGB(255, 105, 180), emission=RGB(76, 32, 54), shine=0.5, specular=RGB(255, 255, 255), transparency=0})  # disabled
# Rotations for each division
series = Series(Start=0, Step=number_slider_32, Count=x_plus_one)  # disabled
# Rotations for each division
series_2 = Series(Start=number_slider_15, Step=number_slider_33, Count=x_plus_one_2)  # disabled
shatter = Shatter(Curve=C, Parameters=ptdivcrvtarg.Parameters)  # disabled
swatch_2 = ColourSwatch(SwatchColor=RGB(0, 13, 255))  # disabled
# Parameter value of the middle point
panel_20 = Panel(crvmidpt.Parameter)  # disabled
panel_21 = Panel(srfeditpts.CountU)  # disabled
panel_22 = Panel(srfeditpts.CountV)  # disabled
panel_23 = Panel(srfeditpts.Parameters)  # disabled
# Look at Rhino window
# to preview results
# If we try and remake the interpolated curve.
preview_8 = CustomPreview(
    Geometry=crveditpts.Points,
    Shader={ambient=RGB(0, 0, 0), diffuse=RGB(255, 105, 180), emission=RGB(76, 32, 54), shine=0.5, specular=RGB(255, 255, 255), transparency=0})  # disabled
vdis = VectorDisplay(Anchor=crvmidpt.Middle, Vector=crvmidpt.Tangent)  # disabled
# Length value of the middle point
panel_24 = Panel(crvmidpt.Length)  # disabled
toggle_24 = BooleanToggle(False)  # disabled
# Using Non-Normalized Factor
# Look at Rhino window
# to preview results
preview_9 = CustomPreview(
    Geometry=twnthruptscrv,
    Shader={ambient=RGB(0, 0, 0), diffuse=RGB(255, 105, 180), emission=RGB(76, 32, 54), shine=0.5, specular=RGB(255, 255, 255), transparency=0})  # disabled
# Look at Rhino window
# to preview results
preview_10 = CustomPreview(
    Geometry=srfeditpts.Points,
    Shader={ambient=RGB(0, 0, 0), diffuse=RGB(255, 105, 180), emission=RGB(76, 32, 54), shine=0.5, specular=RGB(255, 255, 255), transparency=0})  # disabled
# Index of edge
preview_11 = CustomPreview(Geometry=ptsrfedge.Edge, Shader=swatch)  # disabled
# The length that was
# used to divide the curve.
panel_25 = Panel(ptdivcrvtarg.Length)  # disabled
# Look at Rhino window
# to preview results
preview_12 = CustomPreview(
    Geometry=ptdivcrvtarg.Points,
    Shader={ambient=RGB(0, 0, 0), diffuse=RGB(255, 105, 180), emission=RGB(76, 32, 54), shine=0.5, specular=RGB(255, 255, 255), transparency=0})  # disabled
rot3d = Rotate3D(Geometry=move.Geometry, Angle=degrees(number_slider_34), Center=deplane.Origin, Axis=deplane.YAxis)  # -> Geometry, Transform; disabled
panel_26 = Panel(plntrimpts.Intersected)  # disabled
# Look at Rhino window
# to preview results
preview_13 = CustomPreview(
    Geometry=twnconpts,
    Shader={ambient=RGB(0, 0, 0), diffuse=RGB(255, 105, 180), emission=RGB(76, 32, 54), shine=0.5, specular=RGB(255, 255, 255), transparency=0})  # disabled
# Look at Rhino window
# to preview results
preview_14 = CustomPreview(
    Geometry=plntrimpts.Trimmed,
    Shader={ambient=RGB(0, 0, 0), diffuse=RGB(255, 105, 180), emission=RGB(76, 32, 54), shine=0.5, specular=RGB(255, 255, 255), transparency=0})  # disabled
intcrv_2 = Interpolate(Vertices=p_n_s, Degree=3, Periodic=False, KnotStyle=1)  # -> Curve, Length, Domain; disabled
len = Length(Curve=shatter)  # disabled
swatch_3 = ColourSwatch(SwatchColor=RGB(10, 22, 255))  # disabled
# Look at Rhino window
# to preview results
preview_15 = CustomPreview(
    Geometry=twnconptssrf,
    Shader={ambient=RGB(0, 0, 0), diffuse=RGB(255, 105, 180), emission=RGB(76, 32, 54), shine=0.5, specular=RGB(255, 255, 255), transparency=0})  # disabled
# Using Non-Normalized Factor
# Look at Rhino window
# to preview results
preview_16 = CustomPreview(
    Geometry=twnthrupts,
    Shader={ambient=RGB(0, 0, 0), diffuse=RGB(255, 105, 180), emission=RGB(76, 32, 54), shine=0.5, specular=RGB(255, 255, 255), transparency=0})  # disabled
crvwavepts = CurveWavePoints(Curve=crv_6, ParametersT=range_4, Weighted=toggle_23, Offsets=dom_2, Rotations=series_2)  # disabled
crvcoilpts = CurveCoilPoints(Curve=crv_5, ParametersT=range_3, Weighted=toggle_22, Offsets=dom, Rotations=series)  # disabled
# Look at Rhino window
# to preview results
# With optional anchor points
preview_17 = CustomPreview(
    Geometry=p_n_s,
    Shader={ambient=RGB(0, 0, 0), diffuse=RGB(255, 105, 180), emission=RGB(76, 32, 54), shine=0.5, specular=RGB(255, 255, 255), transparency=0})  # disabled
pop3d_3 = Populate3D(
    Region={Plane=Plane(origin=(-1.660426231, 77.85177226, 0), x=(0, 1, 0), y=(1, 0, 0)), X=Domain(0, 26.51413644), Y=Domain(0, 29.98173965), Z=Domain(-28.20855015, 0)},
    Count=500,
    Seed=1)  # disabled
# Using Non-Normalized Factor
# Look at Rhino window
# to preview results
preview_18 = CustomPreview(
    Geometry=twnthruptssrf,
    Shader={ambient=RGB(0, 0, 0), diffuse=RGB(255, 105, 180), emission=RGB(76, 32, 54), shine=0.5, specular=RGB(255, 255, 255), transparency=0})  # disabled
panel_27 = Panel(reparampts.OriginalX)  # disabled
# The original range
# of the input points
# Y coordinates
panel_28 = Panel(reparampts.OriginalY)  # disabled
# The original range
# of the input points
# Z coordinates
panel_29 = Panel(reparampts.OriginalZ)  # disabled
# Look at Rhino window
# to preview results
# Tanget vector at the middle point
preview_19 = CustomPreview(Geometry=crvmidpt.Middle, Shader=swatch_2)  # disabled
# Indices of kept points
panel_30 = Panel(plntrimpts.KeptIndicies)  # disabled
# Proof of equal lengths
panel_31 = Panel(len)  # disabled
# Flips the mirror direction to
# cut the other side instead.
# If true the entire input point set is mirrored
# normally if it is mirror cut into non existance.
toggle_25 = BooleanToggle(False)  # disabled
# Look at Rhino window
# to preview results
# The original range
# of the input points
# X coordinates
preview_20 = CustomPreview(Geometry=reparampts.Reparameterized, Shader=swatch_3)  # disabled
swatch_4 = ColourSwatch(SwatchColor=RGB(0, 13, 255))  # disabled
swatch_5 = ColourSwatch(SwatchColor=RGB(0, 13, 255))  # disabled
mircutpts = MirrorCutPoints(
    Points=pop3d_3,
    MirrorPlane=rot3d.Geometry,
    Reach=number_slider_35,
    Offset=number_slider_36,
    Flip=toggle_24,
    Keep=toggle_25)  # -> MirrorCut, SplitIndex, ReachPlane, OffsetPlane, Intersected; disabled
nurbs = NurbsCurve(Vertices=crvwavepts, Degree=3, Periodic=False)  # -> Curve, Length, Domain; disabled
# Look at Rhino window
# to preview results
preview_21 = CustomPreview(Geometry=crvcoilpts, Shader=swatch_5)  # disabled
# Look at Rhino window
# to preview results
preview_22 = CustomPreview(Geometry=crvwavepts, Shader=swatch_4)  # disabled
# Use any curve making component
# to make a coil curve from the points
intcrv_3 = Interpolate(Vertices=crvcoilpts, Degree=3, Periodic=False, KnotStyle=1)  # -> Curve, Length, Domain; disabled
panel_32 = Panel(mircutpts.Intersected)  # disabled
number_slider_37 = Slider(0.25, range=0..1)  # disabled
number_slider_38 = Slider(0.801, range=0..1)  # disabled
number_slider_39 = Slider(0.13, range=0..1)  # disabled
# Adjusting the start and end domains
# of the ranges positions the grid on
# specified parts of the surface.
number_slider_40 = Slider(0.537, range=0..1)  # disabled
swatch_6 = ColourSwatch(SwatchColor=RGB(255, 0, 0))  # disabled
swatch_7 = ColourSwatch(SwatchColor=RGB(10, 255, 210))  # disabled
swatch_8 = ColourSwatch(SwatchColor=RGB(10, 22, 255))  # disabled
# Closed curve with segments
number_slider_41 = Slider(7, range=0..10)  # disabled
swatch_9 = ColourSwatch(SwatchColor=RGB(10, 255, 210))  # disabled
# Use any curve making component
# to make a wave curve from the points
swatch_10 = ColourSwatch(SwatchColor=RGB(10, 255, 210))  # disabled
# Pt @
# index 0
number_slider_42 = Slider(1.5, range=0..2)  # disabled
number_slider_43 = Slider(5, range=0..10)  # disabled
# negative strengths spread
number_slider_44 = Slider(0.6, range=-1..1)  # disabled
sqgrid_2 = Square(Plane=PlaneXY(297.1664411, 33.02169456, 0), Size=1, ExtentX=10, ExtentY=20)  # -> Cells, Points; disabled
toggle_26 = BooleanToggle(True)  # disabled
# Look at Rhino window
# to preview results
# Result mirror cut point set
preview_23 = CustomPreview(Geometry=mircutpts.MirrorCut, Shader=swatch_6)  # disabled
preview_24 = CustomPreview(Geometry=mircutpts.ReachPlane, Shader=swatch_7)  # disabled
# Reach plane (this plane essentially does the cutting)
# Offset plane (offsets the cuts from the mirror plane)
preview_25 = CustomPreview(Geometry=mircutpts.OffsetPlane, Shader=swatch_8)  # disabled
number_slider_45 = Slider(5, range=0..10)  # disabled
number_slider_46 = Slider(6, range=0..10)  # disabled
# Change boolean to False
# to turn off Normalized Factor
toggle_27 = BooleanToggle(False)  # disabled
# Points that make
# the interpolated curve
pt_34 = Point([Point(-28.19519075, -59.89703666, 0), Point(-20.57113848, -51.82060688, 0), Point(-18.46523545, -64.78892227, 0), Point(-12.13263942, -63.84486467, 0), Point(-7.927496532, -51.6530219, 0), Point(0.857587239, -55.03540981, 0), Point(0.2808675506, -61.44473558, 0)])  # disabled
# Pt @
# index 0
number_slider_47 = Slider(1.5, range=0..2)  # disabled
# Pt @
# index 0
number_slider_48 = Slider(1.5, range=0..2)  # disabled
# Using Graph Mappers
# Look at Rhino window
# to preview results
preview_26 = CustomPreview(Geometry=intcrv_3.Curve, Shader=swatch_9)  # disabled
# With closed segmented curves
number_slider_49 = Slider(0, range=0..2)  # disabled
# Using Graph Mappers
# Look at Rhino window
# to preview results
preview_27 = CustomPreview(Geometry=nurbs.Curve, Shader=swatch_10)  # disabled
C_3 = Curve(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)  # disabled
pt_35 = Point(sqgrid_2.Points)  # disabled
pt_36 = Point([Point(299.323942, 50.2939864, 0), Point(304.8847094, 43.14808817, 0), Point(299.4633236, 35.43533383, 0)])  # disabled
pt_37 = Point(Point(234.8998708, -35.34307548, 6.093886903))  # disabled
# Pt @
# index 1
# Pt @
# index 2
crv_7 = Curve(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)  # disabled
pt_38 = Point(Point(214.1157338, -32.43889709, 6.72241149))  # disabled
pt_39 = Point(Point(217.5356104, -34.27453508, 9.529547685))  # disabled
# Closed curve
number_slider_50 = Slider(6.57, range=0..10)  # disabled
# Change boolean to False
# to turn off Normalized Factor
# When Normalized is False the factor is
# from 0 to the last index. This
# can be considered like a timeline.
# This lets each point have an equally
# controllable section of the slider between.
# As opposed to going from 0 to 1, this lets
# you easily pinpoint your location.
# You can use lists / mutiple factors as well.
toggle_28 = BooleanToggle(False)  # disabled
# Change boolean to False
# to turn off Normalized Factor
toggle_29 = BooleanToggle(False)  # disabled
intcrv_4 = Interpolate(Vertices=pt_34, Degree=3, Periodic=False, KnotStyle=0)  # -> Curve, Length, Domain; disabled
dom_3 = ConstructDomain(DomainStart=number_slider_37, DomainEnd=number_slider_38)  # disabled
dom_4 = ConstructDomain(DomainStart=number_slider_39, DomainEnd=number_slider_40)  # disabled
# The important thing here is that the new interpolated
# curve uses the same knot style as the original or the
# new curve wont match.
toggle_30 = BooleanToggle(True)  # disabled
# Set to true the end point is added
# which is duplicate of the start point.
toggle_31 = BooleanToggle(True)  # disabled
pt_40 = Point(Point(212.6256624, 7.490051243, 19.87992176))  # disabled
pt_41 = Point(Point(225.0310305, 2.164932681, 22.20601964))  # disabled
pt_42 = Point(Point(217.0803439, 5.383579774, 6.396566713))  # disabled
# Pt @
# index 1
# Pt @
# index 2
srf_7 = Surface(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)  # disabled
pt_43 = Point(Point(55.57101076, -0.2038058289, 0))  # disabled
# Pt @
# index 1
# Pt @
# index 2
pt_44 = Point(Point(70.62259451, 2.357067053, 12.45169359))  # disabled
pt_45 = Point(Point(58.98943748, 13.50022619, 0))  # disabled
# Set to true the end point is added
# which is duplicate of the start point.
ptdivcrvsegs_2 = PointDivideCurveSegments(Curve=C_3, Number=number_slider_41, EndPoint=toggle_26)  # -> Points, Tangents, Parameters; disabled
C_4 = Curve(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)  # disabled
range_5 = Range(Domain=dom_4, Steps=number_slider_45)  # disabled
range_6 = Range(Domain=dom_3, Steps=number_slider_46)  # disabled
S_3 = Surface(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)  # disabled
# Anchor points from the points list
# to make as achor points which
# will not be moved by the Pinch'n'Spread.
item = ListItem(List=reverse(pt_35), Index=0, Wrap=True)  # disabled
item_2 = ListItem(List=pt_35, Index=0, Wrap=True)  # disabled
twnthruptscrv_2 = TweenThroughPointsOnCurve(
    Points=[pt_38, pt_39, pt_37],
    Curve=crv_7,
    Factor=number_slider_42,
    Normalized=toggle_27,
    Equalized=False,
    Weighted=False)  # disabled
crveditpts_2 = CurveEditPoints(Curve=intcrv_4.Curve, Knots=toggle_30)  # -> Points, Tangents, Parameters; disabled
lng = ListLength(List=ptdivcrvsegs_2.Points)  # disabled
# Look at Rhino window
# to preview results
preview_28 = CustomPreview(
    Geometry=ptdivcrvsegs_2.Points,
    Shader={ambient=RGB(0, 0, 0), diffuse=RGB(255, 105, 180), emission=RGB(76, 32, 54), shine=0.5, specular=RGB(255, 255, 255), transparency=0})  # disabled
ptdivcrvtarg_2 = PointDivideCurveTargetLength(Curve=C_4, Target=number_slider_50, DivisionType=number_slider_49, EndPoint=toggle_31)  # -> Points, Tangents, Parameters, Length, R; disabled
twnthrupts_2 = TweenThroughPoints(
    Points=[pt_43, pt_45, pt_44],
    Factor=number_slider_47,
    Normalized=toggle_28,
    Equalized=False,
    Weighted=False,
    Degree=3,
    InterpolationType=0)  # disabled
paramptdivsrf_2 = ParameterPointDivideSurface(Surface=S_3, ParametersU=range_6, ParametersV=range_5)  # -> Points, Normals; disabled
# Look at Rhino window
# to preview results
# End point (duplicate of start if End Points
# boolean is true), switch it to false to see
# the end point change.
item_3 = ListItem(List=ptdivcrvsegs_2.Points, Index=expr("x-1", lng), Wrap=False)  # disabled
# Look at Rhino window
# to preview results
# Start point
item_4 = ListItem(List=ptdivcrvsegs_2.Points, Index=0, Wrap=False)  # disabled
swatch_11 = ColourSwatch(SwatchColor=RGB(0, 13, 255))  # disabled
# Look at Rhino window
# to preview results
# You will see the new
# interpolated curve is exact.
intcrv_5 = Interpolate(Vertices=crveditpts_2.Points, Degree=3, Periodic=False, KnotStyle=0)  # -> Curve, Length, Domain; disabled
twnthruptssrf_2 = TweenThroughPointsOnSurface(
    Points=[pt_40, pt_41, pt_42],
    Surface=srf_7,
    Factor=number_slider_48,
    Normalized=toggle_29,
    Equalized=False,
    Weighted=False,
    Degree=3,
    InterpolationType=0)  # disabled
# Look at Rhino window
# to preview results
# Keep in mind this only works in
# an exact way with intrpolated curves.
# You can still get the edit points of a
# nurbs curve but you wont be able to
# recreate it by interpolating the edit points.
preview_29 = CustomPreview(
    Geometry=crveditpts_2.Points,
    Shader={ambient=RGB(0, 0, 0), diffuse=RGB(255, 105, 180), emission=RGB(76, 32, 54), shine=0.5, specular=RGB(255, 255, 255), transparency=0})  # disabled
p_n_s_2 = PinchNSpread(Points=pt_35, Locations=pt_36, Radiuses=number_slider_43, Strengths=number_slider_44, Anchors=[item_2, item])  # disabled
# Using unevenly spaced parameter
# values will result in uneven spaced
# grids. The grid spacing can be
# controlled with custom values
# such as values from graph mappers.
# Look at Rhino window
# to preview results
preview_30 = CustomPreview(
    Geometry=paramptdivsrf_2.Points,
    Shader={ambient=RGB(0, 0, 0), diffuse=RGB(255, 105, 180), emission=RGB(76, 32, 54), shine=0.5, specular=RGB(255, 255, 255), transparency=0})  # disabled
swatch_12 = ColourSwatch(SwatchColor=RGB(0, 13, 255))  # disabled
lng_2 = ListLength(List=ptdivcrvtarg_2.Points)  # disabled
# Look at Rhino window
# to preview results
preview_31 = CustomPreview(
    Geometry=ptdivcrvtarg_2.Points,
    Shader={ambient=RGB(0, 0, 0), diffuse=RGB(255, 105, 180), emission=RGB(76, 32, 54), shine=0.5, specular=RGB(255, 255, 255), transparency=0})  # disabled
# Number of curve divisions
number_slider_51 = Slider(30, range=0..300)  # disabled
# Number of curve divisions
number_slider_52 = Slider(30, range=0..300)  # disabled
# Look at Rhino window
# to preview results
preview_32 = CustomPreview(Geometry=twnthruptscrv_2, Shader=swatch_11)  # disabled
item_5 = ListItem(List=ptdivcrvtarg_2.Points, Index=expr("x-1", lng_2), Wrap=False)  # disabled
swatch_13 = ColourSwatch(SwatchColor=RGB(0, 34, 255))  # disabled
intcrv_6 = Interpolate(Vertices=p_n_s_2, Degree=3, Periodic=False, KnotStyle=1)  # -> Curve, Length, Domain; disabled
# Look at Rhino window
# to preview results
item_6 = ListItem(List=ptdivcrvtarg_2.Points, Index=0, Wrap=False)  # disabled
# Look at Rhino window
# to preview results
preview_33 = CustomPreview(Geometry=twnthrupts_2, Shader=swatch_12)  # disabled
# Look at Rhino window
# to preview results
preview_34 = CustomPreview(
    Geometry=p_n_s_2,
    Shader={ambient=RGB(0, 0, 0), diffuse=RGB(255, 105, 180), emission=RGB(76, 32, 54), shine=0.5, specular=RGB(255, 255, 255), transparency=0})  # disabled
swatch_14 = ColourSwatch(SwatchColor=RGB(0, 13, 255))  # disabled
# Look at Rhino window
# to preview results
preview_35 = CustomPreview(Geometry=twnthruptssrf_2, Shader=swatch_13)  # disabled
# Splitting the list
number_slider_53 = Slider(-8.615, range=-20..20)  # disabled
range_7 = Range(Domain=Domain(0, 1), Steps=number_slider_51)  # disabled
range_8 = Range(Domain=Domain(0, 1), Steps=number_slider_52)  # disabled
# Start point
# End point (duplicate of start if End Points
# boolean is true), switch it to false to see
# the end point change.
# Look at Rhino window
# to preview results
preview_36 = CustomPreview(Geometry=item_5, Shader=swatch_14)  # disabled
number_slider_54 = Slider(10, range=0..10)  # disabled
number_slider_55 = Slider(10, range=0..10)  # disabled
graph = GraphMapper(range_7, x0=0, x1=1, y0=0, y1=1, container_name="Bezier", cpx=[0, 0.4227280915, 1, 1], cpy=[0, 0, 0.4295446277, 1])  # disabled
graph_2 = GraphMapper(range_8, x0=0, x1=1, y0=0, y1=1, container_name="Bezier", cpx=[0, 0.4227280915, 1, 1], cpy=[0, 0, 0.4295446277, 1])  # disabled
graph_3 = GraphMapper(range_7, x0=0, x1=1, y0=0, y1=1, container_name="Bezier", cpx=[0, 0, 1, 1], cpy=[0, 0.4836370349, 0.6727280617, 1])  # disabled
graph_4 = GraphMapper(range_8, x0=0, x1=1, y0=0, y1=1, container_name="Bezier", cpx=[0, 0, 1, 1], cpy=[0, 0.4836370349, 0.6727280617, 1])  # disabled
yz_3 = YZPlane(Origin=Point(11.89746159, 181.6583616, 15.38031074))  # disabled
X_2 = UnitX(Factor=number_slider_53)  # disabled
# Graph for division spacing
graph_5 = GraphMapper(range_7, x0=0, x1=1, y0=0, y1=1, container_name="Bezier", cpx=[0, 0.4227280915, 1, 1], cpy=[0, 0, 0.4295446277, 1])  # disabled
# Graph for division spacing
graph_6 = GraphMapper(range_8, x0=0, x1=1, y0=0, y1=1, container_name="Bezier", cpx=[0, 0.4227280915, 1, 1], cpy=[0, 0, 0.4295446277, 1])  # disabled
# Graph for offsets
number_slider_56 = Slider(3.146, range=0..100)  # disabled
# Graph for offsets
number_slider_57 = Slider(7.242, range=0..100)  # disabled
number_slider_58 = Slider(0, range=0..100)  # disabled
# Graph for rotations
number_slider_59 = Slider(0, range=0..100)  # disabled
number_slider_60 = Slider(0, range=0..100)  # disabled
# Graph for rotations
number_slider_61 = Slider(0, range=0..100)  # disabled
number_slider_62 = Slider(2000, range=0..2000)  # disabled
number_slider_63 = Slider(85.713, range=0..2000)  # disabled
range_9 = Range(Domain=Domain(0, 1), Steps=number_slider_54)  # disabled
range_10 = Range(Domain=Domain(0, 1), Steps=number_slider_55)  # disabled
S_4 = Surface(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)  # disabled
move_2 = Move(Geometry=yz_3, Motion=X_2)  # -> Geometry, Transform; disabled
number_slider_64 = Slider(33, range=0..360)  # disabled
# Points that make
# the interpolated curve
pt_46 = Point([Point(-29.26701831, -85.66265904, 0), Point(-22.82478216, -74.89169846, 0), Point(-15.30870553, -92.82720719, 0), Point(-10.71856417, -71.27924022, 0), Point(-3.982425891, -80.78145877, 0), Point(-1.213773113, -88.04379228, 0)])  # disabled
deplane_2 = DeconstructPlane(Plane=move_2.Geometry)  # -> Origin, XAxis, YAxis, ZAxis; disabled
number_slider_65 = Slider(0, range=0..10)  # disabled
graph_7 = GraphMapper(
    range_10,
    x0=0,
    x1=1,
    y0=0,
    y1=1,
    container_name="Bezier",
    cpx=[0, 0.7955461144, 0.533728838, 1],
    cpy=[0, 0.104544878, 0.4652709961, 1])  # disabled
# Graphmappers creating gradient grid spacing.
graph_8 = GraphMapper(
    range_9,
    x0=0,
    x1=1,
    y0=0,
    y1=1,
    container_name="Bezier",
    cpx=[0, 0.161364466, 0.3795443475, 1],
    cpy=[0, 0.5532698631, 0.9518182874, 1])  # disabled
# Using nurbs curve
nurbs_2 = NurbsCurve(Vertices=pt_46, Degree=3, Periodic=False)  # -> Curve, Length, Domain; disabled
number_slider_66 = Slider(0, range=0..10)  # disabled
toggle_32 = BooleanToggle(False)  # disabled
# Weights the division
# distribution by curvature.
toggle_33 = BooleanToggle(False)  # disabled
# Weights the division
# distribution by curvature.
toggle_34 = BooleanToggle(False)  # disabled
# Extents of offsets
dom_5 = ConstructDomain(DomainStart=number_slider_56, DomainEnd=number_slider_58)  # disabled
# Extents of offsets
dom_6 = ConstructDomain(DomainStart=number_slider_57, DomainEnd=number_slider_60)  # disabled
# Extents of roatations
dom_7 = ConstructDomain(DomainStart=number_slider_59, DomainEnd=number_slider_62)  # disabled
# Extents of roatations
dom_8 = ConstructDomain(DomainStart=number_slider_61, DomainEnd=number_slider_63)  # disabled
toggle_35 = BooleanToggle(False)  # disabled
toggle_36 = BooleanToggle(False)  # disabled
# Curve to coil around
crv_8 = Curve(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)  # disabled
rot3d_2 = Rotate3D(Geometry=move_2.Geometry, Angle=degrees(number_slider_64), Center=deplane_2.Origin, Axis=deplane_2.YAxis)  # -> Geometry, Transform; disabled
# Curve to wave around
crv_9 = Curve(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)  # disabled
# That's how you remake a nurbs curve
cp = ControlPoints(Curve=nurbs_2.Curve)  # -> Points, Weights, Knots; disabled
crveditpts_3 = CurveEditPoints(Curve=nurbs_2.Curve, Knots=toggle_32)  # -> Points, Tangents, Parameters; disabled
paramptdivsrf_3 = ParameterPointDivideSurface(Surface=S_4, ParametersU=graph_7, ParametersV=graph_8)  # -> Points, Normals; disabled
remap = RemapNumbers(Value=graph, Source=Domain(0, 1), Target=dom_5)  # -> Mapped, Clipped; disabled
remap_2 = RemapNumbers(Value=graph_2, Source=Domain(0, 1), Target=dom_6)  # -> Mapped, Clipped; disabled
remap_3 = RemapNumbers(Value=graph_3, Source=Domain(0, 1), Target=dom_7)  # -> Mapped, Clipped; disabled
remap_4 = RemapNumbers(Value=graph_4, Source=Domain(0, 1), Target=dom_8)  # -> Mapped, Clipped; disabled
pop3d_4 = Populate3D(
    Region={Plane=PlaneXY(-0.9244912087, 168.3586188, 0), X=Domain(0, 29.53403581), Y=Domain(0, 26.07914594), Z=Domain(0, 28.27359997)},
    Count=500,
    Seed=1)  # disabled
nurbs_3 = NurbsCurve(Vertices=cp.Points, Degree=3, Periodic=False)  # -> Curve, Length, Domain; disabled
# Look at Rhino window
# to preview results
preview_37 = CustomPreview(
    Geometry=paramptdivsrf_3.Points,
    Shader={ambient=RGB(0, 0, 0), diffuse=RGB(255, 105, 180), emission=RGB(76, 32, 54), shine=0.5, specular=RGB(255, 255, 255), transparency=0})  # disabled
intcrv_7 = Interpolate(Vertices=crveditpts_3.Points, Degree=3, Periodic=False, KnotStyle=0)  # -> Curve, Length, Domain; disabled
# Look at Rhino window
# to preview results
preview_38 = CustomPreview(
    Geometry=crveditpts_3.Points,
    Shader={ambient=RGB(0, 0, 0), diffuse=RGB(255, 105, 180), emission=RGB(76, 32, 54), shine=0.5, specular=RGB(255, 255, 255), transparency=0})  # disabled
crvwavepts_2 = CurveWavePoints(Curve=crv_9, ParametersT=graph_6, Weighted=toggle_34, Offsets=remap_2.Mapped, Rotations=remap_4.Mapped)  # disabled
mircutpts_2 = MirrorCutPoints(
    Points=pop3d_4,
    MirrorPlane=rot3d_2.Geometry,
    Reach=number_slider_65,
    Offset=number_slider_66,
    Flip=toggle_35,
    Keep=toggle_36)  # -> MirrorCut, SplitIndex, ReachPlane, OffsetPlane, Intersected; disabled
crvcoilpts_2 = CurveCoilPoints(Curve=crv_8, ParametersT=graph_5, Weighted=toggle_33, Offsets=remap.Mapped, Rotations=remap_3.Mapped)  # disabled
# You will see we can get close to the
# original nurbs curve but an interpolation
# of the edit points won't be exact. That is
# because to remake nurbs curves you
# should use nurbs control points, not edit points.
swatch_15 = ColourSwatch(SwatchColor=RGB(0, 255, 208))  # disabled
swatch_16 = ColourSwatch(SwatchColor=RGB(0, 13, 255))  # disabled
swatch_17 = ColourSwatch(SwatchColor=RGB(0, 13, 255))  # disabled
split = SplitList(List=mircutpts_2.MirrorCut, Index=mircutpts_2.SplitIndex)  # -> ListA, ListB; disabled
swatch_18 = ColourSwatch(SwatchColor=RGB(10, 255, 210))  # disabled
# You can use this index to
# split the list at the mirror seam.
swatch_19 = ColourSwatch(SwatchColor=RGB(10, 22, 255))  # disabled
# Look at Rhino window
# to preview results
preview_39 = CustomPreview(Geometry=intcrv_7.Curve, Shader=swatch_15)  # disabled
# Use any curve making component
# to make a wave curve from the points
nurbs_4 = NurbsCurve(Vertices=crvwavepts_2, Degree=3, Periodic=False)  # -> Curve, Length, Domain; disabled
# Look at Rhino window
# to preview results
preview_40 = CustomPreview(Geometry=crvwavepts_2, Shader=swatch_16)  # disabled
# Use any curve making component
# to make a coil curve from the points
intcrv_8 = Interpolate(Vertices=crvcoilpts_2, Degree=3, Periodic=False, KnotStyle=1)  # -> Curve, Length, Domain; disabled
# Look at Rhino window
# to preview results
preview_41 = CustomPreview(Geometry=crvcoilpts_2, Shader=swatch_17)  # disabled
preview_42 = CustomPreview(Geometry=split.ListA, Shader=swatch_18)  # disabled
# Look at Rhino window
# to preview results
preview_43 = CustomPreview(Geometry=split.ListB, Shader=swatch_19)  # disabled
swatch_20 = ColourSwatch(SwatchColor=RGB(10, 255, 210))  # disabled
swatch_21 = ColourSwatch(SwatchColor=RGB(10, 255, 210))  # disabled
# Look at Rhino window
# to preview results
preview_44 = CustomPreview(Geometry=nurbs_4.Curve, Shader=swatch_20)  # disabled
# Look at Rhino window
# to preview results
preview_45 = CustomPreview(Geometry=intcrv_8.Curve, Shader=swatch_21)  # disabled
