# Grasshopper definition Pf_08-Curve.gh (Grasshopper 0.9.76)
# plug-ins: Pufferfish

# Check out the different
# cap types and other settings.
number_slider = Slider(2, range=0..4)  # disabled
# 03-Tween Two Curves
# Factor from 0 to 1 determines the curve
# between inputs. So 0.5 will be halfway
# between the inputs. You can use lists /
# mutiple factors as well.
number_slider_2 = Slider(0.5, range=0..1)  # disabled
# 26-Close Curve
# Different close types.
# Try them out.
number_slider_3 = Slider(0, range=0..4)  # disabled
# Curve degree to
# search segments
# Degree to fit the segments to
# that match the search degree
number_slider_4 = Slider(3, range=0..10)  # disabled
number_slider_5 = Slider(0.5, range=0..1)  # disabled
# 06-Slide Curve Along Curve
# Guide curve to slide
# along. If does not even
# need to touch the curve
# to slide.
number_slider_6 = Slider(0.558, range=0..1)  # disabled
# 07-Tween Two Curves Along Curve
# Guide curve to tween
# along. If does not even
# need to touch the curve
# to tween.
# Factor from 0 to 1 determines the curve
# between inputs. So 0.5 will be halfway
# between the inputs. You can use lists /
# mutiple factors as well.
number_slider_7 = Slider(0.333, range=0..1)  # disabled
# 08-Tween Consecutive Curves Along Curve
# Guide curve to tween
# along. If does not even
# need to touch the curve
# to tween.
# Factor from 0 to 1 determines the curve
# between each input as a list. So 0.5 will
# be halfway between each input
# consecutively through the list.
# You can use lists / mutiple factors as well.
number_slider_8 = Slider(0.5, range=0..1)  # disabled
# 31-Mirror Cut Curves
# Change the slider value to move the
# mirror plane and see how it effects the
# mirror cutting.
# Change the slider value to rotate the
# mirror plane and see how it effects the
# mirror cutting.
number_slider_9 = Slider(4, range=-20..100)  # disabled
# Curve degree to
# search segments
number_slider_10 = Slider(1, range=0..10)  # disabled
# 17-Arc/Circle/Ellipse
number_slider_11 = Slider(2, range=0..3)  # disabled
# Tolerance to output an arc, circle,
# or ellipse if possibe.
# 18-Bounding Rectangle
number_slider_12 = Slider(5, range=0..5)  # disabled
number_slider_13 = Slider(0.347, range=0..1)  # disabled
number_slider_14 = Slider(0.572, range=0..1)  # disabled
# Ajust the weights, If one has all the weight
# then the result is that curve. If all have same
# weight then the result is same as average.
number_slider_15 = Slider(0.381, range=0..1)  # disabled
# 32-Offset Curve
number_slider_16 = Slider(5.68, range=-5..10)  # disabled
# This input changes the seam position of
# the first curve in the list. All other seams
# will follow this seam iteratively in order
# of the curve list.
number_slider_17 = Slider(0.853, range=0..1)  # disabled
# 33-Open Curve
number_slider_18 = Slider(21.76, range=0..100)  # disabled
# 10-Net On Surface
number_slider_19 = Slider(30, range=0..30)  # disabled
number_slider_20 = Slider(10, range=0..10)  # disabled
# Change the seam parameter to
# change the location of the opening.
# 34-Plane Trim Curve
number_slider_21 = Slider(0, range=0..1)  # disabled
number_slider_22 = Slider(0, range=0..1)  # disabled
# Increase the tolerance to see it read
# as an arc, circle, and ellipse.
number_slider_23 = Slider(0, range=0..5)  # disabled
# Tolerance for closing. If set to 0 then
# the curve will close no matter what.
# If tolerance is anything above 0 the curve
# will not close unless the gap is smaller
# than the tolerance. Curves that are already
# closed will just be passed through with
# no change.
number_slider_24 = Slider(20.339, range=0..40)  # disabled
number_slider_25 = Slider(1, range=0..4)  # disabled
crv = Curve(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)  # disabled
number_slider_26 = Slider(0.5, range=0..1)  # disabled
# 43 - Curve Degree
crv_2 = Curve(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)  # disabled
# Look at Rhino window
# to preview inputs
# 44-Curve Length At
crv_3 = Curve(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)  # disabled
number_slider_27 = Slider(0.5, range=0..1)  # disabled
# 14-Tween Two Curves On Surface
# Factor from 0 to 1 determines the curve
# between inputs. So 0.5 will be halfway
# between the inputs. You can use lists /
# mutiple factors as well.
number_slider_28 = Slider(0.5, range=0..1)  # disabled
# 37-Rebuild Curve
number_slider_29 = Slider(0, range=0..1)  # disabled
number_slider_30 = Slider(5, range=0..5)  # disabled
# 36-Prude Curve
number_slider_31 = Slider(6.585, range=0..30)  # disabled
# 46-Curve Spans
# Look at Rhino window
# to preview input
crv_4 = Curve(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)  # disabled
# The blend length removes the kinks.
# It also knows to not go too far based
# on its neighboring curve segments. Try
# putting the length very high and you will
# see blends automatically stop at their
# local maximum possible curve blend.
number_slider_32 = Slider(0.5, range=0..1)  # disabled
number_slider_33 = Slider(4, range=0..10)  # disabled
# Guide curve to tween
# along. If does not even
# need to touch the curve
# to tween.
number_slider_34 = Slider(0.25, range=0..1)  # disabled
# Angle tolerance in degrees
# which will smooth kinks within
# this angle tolerance. Look at
# the kink parts of the curve to
# see the smoothing.
number_slider_35 = Slider(180, range=0..180)  # disabled
number_slider_36 = Slider(0.25, range=0..1)  # disabled
number_slider_37 = Slider(0.25, range=0..1)  # disabled
number_slider_38 = Slider(20, range=0..100)  # disabled
# 27-Compatibilize Polylines
# Multiple polylines set
# with varying control point counts
crv_5 = Curve([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])  # disabled
# Determines how the tween is interpolated.
# Factor from 0 to 1 determines the curve
# between each input as a list. So 0.5 will
# be halfway between each input
# consecutively through the list.
# You can use lists / mutiple factors as well.
number_slider_39 = Slider(0, range=0..3)  # disabled
# 39-Remap Curve Domain
number_slider_40 = Slider(0, range=0..100)  # disabled
toggle = BooleanToggle(False)  # disabled
toggle_2 = BooleanToggle(False)  # disabled
# The curve that will get
# trimmed (turn its preview
# on to see the original curve)
# Plane that trims
O = Origin(Point(428.8772453, -544.0072538, 0))  # disabled
# Look at Rhino window
# to preview inputs
# Option to normalize
# the length output
toggle_3 = BooleanToggle(False)  # disabled
number_slider_41 = Slider(0.31, range=0..1)  # disabled
# Proportional scale factors for the
# input planes axes. Use same value
# for all for uniform scaling. These values
# are more like weights which balance with
# eachother like percentage overall, as
# opposed to traditional scale factors.
# They are proportional.
# The area
# the geometry
# will scale to
number_slider_42 = Slider(0.769, range=0..1)  # disabled
number_slider_43 = Slider(0.31, range=0..1)  # disabled
# The area
# the geometry
# will scale to
number_slider_44 = Slider(0.769, range=0..1)  # disabled
toggle_4 = BooleanToggle(True)  # disabled
# True to transfer
# properties from
# reference to target
toggle_5 = BooleanToggle(True)  # disabled
# Preserve targets end tangents
toggle_6 = BooleanToggle(False)  # disabled
# Look at Rhino window
# to preview inputs
# Option to normalize
# the length output
# 45-Curve Length Between
toggle_7 = BooleanToggle(False)  # disabled
# If true the slide curve is always
# aligned to the input curve.
# Factor from 0 to 1 determines the curve
# slide. So 0.5 will be halfway
# along the curve. You can use lists /
# mutiple factors as well.
toggle_8 = BooleanToggle(False)  # disabled
# Equalizes the tween distribution
# along the tween path. So 0.5 would
# be the middle of the overall tween path,
# not the middle input curve.
toggle_9 = BooleanToggle(False)  # disabled
number_slider_45 = Slider(0.31, range=0..1)  # disabled
# The area
# the geometry
# will scale to
number_slider_46 = Slider(0.769, range=0..1)  # disabled
toggle_10 = BooleanToggle(True)  # disabled
# 13-Parameter Surface Isocurve
number_slider_47 = Slider(0.25, range=0..1)  # disabled
number_slider_48 = Slider(1000, range=0..1000)  # disabled
# 21-Constrained Area Rectangle
number_slider_49 = Slider(1000, range=0..1000)  # disabled
number_slider_50 = Slider(1000, range=0..1000)  # disabled
cp = ControlPoints(Curve=crv_5)  # -> Points, Weights, Knots; disabled
# 20-Constrained Area Polygon
# Number of
# polygon sides
number_slider_51 = Slider(6, range=0..100)  # disabled
# Switches which side
# gets trimmed away
toggle_11 = BooleanToggle(False)  # disabled
# 30-Fit Curve Smooth
# Curve degree to
# fit the curve to
number_slider_52 = Slider(3, range=0..10)  # disabled
toggle_12 = BooleanToggle(True)  # disabled
# Determines how the tween path is interpolated.
# Equalizes the tween distribution along the
# tween path. So 0.5 would be the middle
# of the overall tween path, not the middle
# input curve.
number_slider_53 = Slider(0, range=0..3)  # disabled
# Boolean to
# flip direction
# of net on surface.
toggle_13 = BooleanToggle(False)  # disabled
# Determines how the tween path is interpolated.
# Equalizes the tween distribution along the
# tween path. So 0.5 would be the middle
# of the overall tween path, not the middle
# input curve.
# Factor from 0  to 1 determines the tween curve.
# 0 is the first curve in the set, 1 is the last curve in the set.
# If for instance there are 3 curves in the set then 0.5
# would be the second (middle) curve.
# You can input as many curves as you want.
# You can use lists / mutiple factors as well.
number_slider_54 = Slider(1, range=0..3)  # disabled
# 40-Reparameterize Curve
number_slider_55 = Slider(0.5, range=0..1)  # disabled
# Unlike grasshoppers native iso curve component, this
# component uses parameter values along the u and v
# surface domains separately. Here we use range
# components to generate the lists of parameters.
# By using parameter values there can be
# more customization of the grid spacing.
number_slider_56 = Slider(5, range=0..10)  # disabled
# Unlike grasshoppers native grid components, this
# component uses parameter values. Here we use range
# components to generate the lists of parameters.
# By using parameter values there can be
# more customization of the grid spacing.
number_slider_57 = Slider(8, range=0..10)  # disabled
number_slider_58 = Slider(8, range=0..10)  # disabled
# Preserve end tangents
# Point count to rebuild the segments to
# that match the search degree
# Degree to rebuild the segments to
# that match the search degree
toggle_14 = BooleanToggle(False)  # disabled
# 11-Parameter Curve Divide Surface
number_slider_59 = Slider(6, range=0..10)  # disabled
# 12-Parameter Surface Grid
number_slider_60 = Slider(9, range=0..10)  # disabled
number_slider_61 = Slider(9, range=0..10)  # disabled
# Guide curve to align semas along,
# it does not even need to touch the
# curves it is aligning seams of.
crv_6 = Curve(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)  # disabled
# 25-Align Curve Seams
crv_7 = Curve([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])  # disabled
# 28-Curve Align Curve Seams
crv_8 = Curve([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])  # disabled
# Same as setting reparmeterize of curve
# inputs/outputs but sometimes it is nice
# to have a seperate component
crv_9 = Curve(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)  # disabled
# 41-Seam To Curve Corner
# Curve with corners
crv_10 = Curve(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)  # disabled
# Determines how the tween is interpolated.
# Factor from 0 to 1 determines the curve
# between each input as a list. So 0.5 will
# be halfway between each input
# consecutively through the list.
# You can use lists / mutiple factors as well.
number_slider_62 = Slider(0, range=0..3)  # disabled
# Open curve can also shorten already opened curves
crv_11 = Curve(reparameterize(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))  # disabled
# Try plugging this plane in to see how
# the bounding rectangle changes
# Deterimes which axis of the
# orientation plane to find the
# bounding rectangle along.
# Try changing the slider.
number_slider_63 = Slider(0, range=0..3)  # disabled
# 05-Tween Through Curves
crv_12 = Curve(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)  # disabled
crv_13 = Curve(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)  # disabled
crv_14 = Curve(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)  # disabled
crv_15 = Curve(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)  # disabled
srf = Surface(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)  # disabled
# 24-Rectangle Fit
# Move the points around to see
# how the rectangle changes.
pt = Point([Point(455.6325058, 163.4195474, 0.8564565973), Point(464.7466324, 169.7061396, 5.968911539), Point(466.8893769, 158.7729999, 4.185108293), Point(453.7158516, 155.6604277, 0.8564565973), Point(461.883234, 159.5429143, 4.185108293), Point(473.1051079, 163.6287158, 8.079935058), Point(477.166867, 158.3897425, 8.079935058), Point(467.1129028, 153.3235561, 0.8564565973), Point(459.3992502, 147.6553663, -0.5931314776), Point(465.6135799, 145.1439505, -0.5931314776), Point(473.1062934, 149.4019549, 0.8564565973), Point(449.2814238, 156.7334064, 0.8564565973), Point(459.3235496, 170.3275385, 5.736267949), Point(472.3990029, 169.9179975, 8.286852212)])  # disabled
# 02-Weighted Average Curve
# Multiple curves set here
crv_16 = Curve([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])  # disabled
crv_17 = Curve(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)  # disabled
# 16-Tween Through Curves On Surface
crv_18 = Curve(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)  # disabled
crv_19 = Curve(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)  # disabled
xy = XYPlane(Origin=Point(0, 0, 0))  # disabled
# non kinked curve
# Look at Rhino window
# to preview input
crv_20 = Curve(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)  # disabled
# non segmented curve
# Look at Rhino window
# to preview input
crv_21 = Curve(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)  # disabled
# 42-Superimpose Curve
crv_22 = Curve(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)  # disabled
crv_23 = Curve(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)  # disabled
# non linear curve
# Look at Rhino window
# to preview input
crv_24 = Curve(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)  # disabled
# Pf_08-Curve
# 01-Average Curve
# Multiple curves set here
crv_25 = Curve([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])  # disabled
crv_26 = Curve(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)  # disabled
crv_27 = Curve(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)  # disabled
# 04-Tween Consecutive Curves
crv_28 = Curve(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)  # disabled
crv_29 = Curve(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)  # disabled
crv_30 = Curve(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)  # disabled
crv_31 = Curve(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)  # disabled
crv_32 = Curve(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)  # disabled
pt_2 = Point(Point(535.6981531, -633.0888979, 0))  # disabled
pt_3 = Point([Point(504.5375467, -666.5041904, 0), Point(519.225857, -661.7730781, 0), Point(547.8750715, -685.3530881, 0)])  # disabled
# 47-Is Arc/Circle/Ellipse
# Look at Rhino window
# to preview input
crv_33 = Curve(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)  # disabled
# Look at Rhino window
# to preview input
crv_34 = Curve(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)  # disabled
# 48-Is Curve Kinky
# kinked curve
# Look at Rhino window
# to preview input
crv_35 = Curve(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)  # disabled
crv_36 = Curve(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)  # disabled
crv_37 = Curve(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)  # disabled
# 09-Tween Through Curves Along Curve
crv_38 = Curve(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)  # disabled
# 35-Points Trim Curve
crv_39 = Curve(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)  # disabled
crv_40 = Curve(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)  # disabled
# 49-Is Curve Linear
# linear curve
# Look at Rhino window
# to preview input
crv_41 = Curve(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)  # disabled
# 50-Is Curve Segmented
# segmented curve
# Look at Rhino window
# to preview input
crv_42 = Curve(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)  # disabled
panel = Panel("2")  # disabled
pt_4 = Point([Point(502.3658289, -525.3784359, 0), Point(538.9617975, -541.277041, 0)])  # disabled
# 29-Fit Curve Segments
# Segment curve
crv_43 = Curve(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)  # disabled
panel_2 = Panel("2")  # disabled
# 38-Rebuild Curve Segments
# Segment curve
crv_44 = Curve(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)  # disabled
# 22-Discrete Polyline
pt_5 = Point([Point(595.1496153, -102.3323976, 0), Point(613.2041788, -56.85072473, 0), Point(641.4153483, -109.6828754, 0), Point(661.9444019, -77.798228, 0), Point(640.8873635, -68.31900634, 0), Point(662.1458276, -55.86640971, 0), Point(678.0820439, -66.01774496, 0)])  # disabled
# The result discrete polyline will only
# be made up of these vectors angles.
# The vector star and vector world components
# are good to use for this input
# 23-Parameter Rectangle Grid
crv_45 = Curve([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])  # disabled
yz = YZPlane(Origin=O)  # disabled
# Offset curve can do both sides and cap ends.
crv_46 = Curve(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)  # disabled
# Look at Rhino window
# to preview input
crv_47 = Curve(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)  # disabled
number_slider_64 = Slider(3, range=0..10)  # disabled
number_slider_65 = Slider(5, range=0..10)  # disabled
# 15-Tween Consecutive Curves On Surface
crv_48 = Curve(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)  # disabled
crv_49 = Curve(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)  # disabled
crv_50 = Curve(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)  # disabled
srf_2 = Surface(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)  # disabled
crv_51 = Curve(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)  # disabled
crv_52 = Curve(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)  # disabled
srf_3 = Surface(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)  # disabled
srf_4 = Surface(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)  # disabled
crv_53 = Curve(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)  # disabled
# Isocurve location
# Toggle to change isocurve direction
toggle_15 = BooleanToggle(True)  # disabled
# Flips the mirror direction to
# cut the other side instead.
toggle_16 = BooleanToggle(False)  # disabled
# Input control point counts
# are all mismatched
lng = ListLength(List=cp.Points)  # -> flatten(Length); disabled
crvdeg = CurveDegree(Curve=[crv_2, crv, crv_3])  # disabled
# Open curve input
crv_54 = Curve(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)  # disabled
crvspans = CurveSpans(Curve=crv_4)  # -> SubDomains, Amount, Lengths, Degrees, Parameters; disabled
number_slider_66 = Slider(0, range=0..1)  # disabled
# 19-Constrained Area Ellipse
# Plane the ellipse is on
xy_2 = XYPlane(Origin=Point(515.2410372, 200.6108747, 0))  # disabled
# Plane the polygon is on
xy_3 = XYPlane(Origin=Point(514.2197723, 277.7809382, 0))  # disabled
# Plane the rectangle is on
xy_4 = XYPlane(Origin=Point(515.040441, 119.9787056, 0))  # disabled
toggle_17 = BooleanToggle(False)  # disabled
crv_55 = Curve(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)  # disabled
crv_56 = Curve(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)  # disabled
crv_57 = Curve([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])  # disabled
crv_58 = Curve(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)  # disabled
crv_59 = Curve([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])  # disabled
# Plane
yz_2 = YZPlane(Origin=Point(664.0352788, 162.2578874, 0))  # disabled
X = UnitX(Factor=number_slider_9)  # disabled
# Orientation plane
xy_5 = XYPlane(Origin=Point(0, 0, 0))  # disabled
# Curve with kinks
crv_60 = Curve(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)  # disabled
crv_61 = Curve(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)  # disabled
toggle_18 = BooleanToggle(False)  # disabled
S = Surface(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)  # disabled
pln = Plane(Plane(origin=(453.4417163, 129.3432883, 0), x=(0.4160140161, 0.9093582014, 0), y=(-0.6180203613, 0.2827325163, 0.7335619655)))  # disabled
# The reach distance determines how
# far from the mirror plane that the cutting
# reaches. Anything within that distance
# from the mirror plane will be additionally
# cut away. Set it to zero and the cutting will
# only happen exactly at the mirror plane.
number_slider_67 = Slider(2.276, range=0..10)  # disabled
alicrvseams = AlignCurveSeams(Curves=reparameterize(crv_7), Seam=number_slider_17, Snap=False, Iterative=True)  # -> Aligned, Points, R; disabled
ace = ArcCircleEllipse(Curve=crv_47, GetType=number_slider_11, Tolerance=number_slider_12)  # disabled
wavcrv = WeightedAverageCurve(Curves=crv_16, Weights=[number_slider_13, number_slider_14, number_slider_15], Refit=3, PointSample=0)  # disabled
# Pufferfish
# By: Michael Pryor
avrcrv = AverageCurve(Curves=crv_25, Refit=3, PointSample=0)  # disabled
# Union rectangle or separate rectangles
# Determines the location along the axis
# of the rectangle through the bounding volume.
# Try changing the slider.
toggle_19 = BooleanToggle(True)  # disabled
rebcrvsegs = RebuildCurveSegments(Curve=crv_44, Search=panel_2, Degree=number_slider_10, Count=number_slider_33, EndTangents=toggle_14)  # -> Rebuilt, Amount, DegreesR, DegreesC, R; disabled
# Look at Rhino window
# to see input curves seam
end = EndPoints(Curve=crv_10)  # -> Start, End; disabled
fitcrvsegs = FitCurveSegments(Curve=crv_43, Search=panel, Degree=number_slider_4, Tolerance=0.001)  # -> Fitted, Amount, DegreesF, DegreesC, R; disabled
complines = CompatibilizePolylines(Polylines=crv_5)  # -> Compatibilized, R; disabled
offcrv = OffsetCurve(Curve=crv_46, Distance=number_slider_16, Plane=xy, BothSides=toggle_12, Kinks=number_slider_25, CapType=number_slider)  # disabled
crvsegs = IsCurveSegmented(Curve=crv_42)  # -> Segments, Amount, Lengths, Degrees; disabled
opncrv = OpenCurve(Curve=crv_11, Length=number_slider_18, Normalized=False, Seam=number_slider_21)  # -> Opened, R; disabled
seam2crvcorn = SeamToCurveCorner(Curve=crv_10)  # -> Adjusted, Point, R; disabled
crvlenat = CurveLengthAt(Curve=crv_32, Point=pt_2, Normalized=toggle_7)  # -> Length, Parameter; disabled
crvlenbtwn = CurveLengthBetween(Curve=crv_40, Points=pt_3, Normalized=toggle_3)  # -> Lengths, Parameters; disabled
isace = IsArcCircleEllipse(Curve=crv_33, Tolerance=1e-12)  # -> Arc, Circle, Ellipse; disabled
crvsegs_2 = IsCurveSegmented(Curve=crv_21)  # -> Segments, Amount, Lengths, Degrees; disabled
twn2crvssrf = TweenTwoCurvesOnSurface(CurveA=crv_51, CurveB=crv_52, Surface=srf_3, Factor=number_slider_28, Refit=3, PointSample=0)  # disabled
crvalicrvseams = CurveAlignCurveSeams(Curves=crv_8, Guide=crv_6, Snap=False)  # -> Aligned, Points, R; disabled
ptstrimcrv = PointsTrimCurve(Curve=crv_39, Points=pt_4, Flip=toggle_11)  # -> Trimmed, SubDomains, Intersected; disabled
supercrv = SuperimposeCurve(Reference=crv_22, Target=crv_23, Points=toggle_4, Degree=toggle_10, Domain=toggle_5, EndTangents=toggle_6)  # disabled
crvkinky = IsCurveKinky(Curve=crv_35)  # -> Kinked, Amount, Lengths; disabled
crvkinky_2 = IsCurveKinky(Curve=crv_20)  # -> Kinked, Amount, Lengths; disabled
twn2crvs = TweenTwoCurves(CurveA=crv_26, CurveB=crv_27, Factor=number_slider_2, Refit=0, PointSample=0)  # disabled
reparamcrv = ReparameterizeCurve(Curve=crv_9)  # -> Reparameterized, Original; disabled
isace_2 = IsArcCircleEllipse(Curve=crv_34, Tolerance=number_slider_23)  # -> Arc, Circle, Ellipse; disabled
netsrf = NetOnSurface(Surface=srf_4, UCount=number_slider_19, VCount=number_slider_20, Flip=toggle_13)  # disabled
crvlinr = IsCurveLinear(Curve=crv_41)  # disabled
recfit = RectangleFit(Points=pt)  # disabled
# The offser distance determines how
# far to offset the cut. It does not do any
# additional cut removing like
# the reach plane, it just moves the
# actual cut away from the mirror plane.
# Set it to zero and there will be no
# additional gap in the mirror cut.
number_slider_68 = Slider(5.238, range=0..10)  # disabled
dom = ConstructDomain(DomainStart=number_slider_29, DomainEnd=number_slider_30)  # disabled
crvlinr_2 = IsCurveLinear(Curve=crv_24)  # disabled
panel_3 = Panel(lng)  # disabled
crv_62 = Curve(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)  # disabled
# Geometry to contain in rectangle
geo = Geometry([Point(456.32806, 115.5583201, 0), Point(469.1044244, 119.1683536, 0), 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, Point(464.7863506, 107.4306887, 0), Point(455.6049694, 109.6402123, 0), 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])  # disabled
move = Move(Geometry=yz_2, Motion=X)  # -> Geometry, Transform; disabled
# Make domain for curve
dom_2 = ConstructDomain(DomainStart=number_slider_40, DomainEnd=number_slider_38)  # disabled
range = Range(Domain=Domain(0, 1), Steps=number_slider_56)  # disabled
range_2 = Range(Domain=Domain(0, 1), Steps=number_slider_57)  # disabled
range_3 = Range(Domain=Domain(0, 1), Steps=number_slider_58)  # disabled
range_4 = Range(Domain=Domain(0, 1), Steps=number_slider_59)  # disabled
range_5 = Range(Domain=Domain(0, 1), Steps=number_slider_60)  # disabled
range_6 = Range(Domain=Domain(0, 1), Steps=number_slider_61)  # disabled
rec = Rectangle({Plane=PlaneXY(295.821564, 230.5437144, 0), Size=Domain2(u=0..20.23464176, v=0..32.60345045)})  # disabled
number_slider_69 = Slider(54, range=0..360)  # disabled
# Look at Rhino window
# to preview input
crv_63 = Curve(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)  # disabled
S_2 = Surface(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)  # disabled
S_3 = Surface(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)  # disabled
# Gets the degree value
# for different types of curves
panel_4 = Panel(crvdeg)  # disabled
consareaply = ConstrainedAreaPolygon(Plane=xy_3, Sides=number_slider_51, Area=number_slider_50, FactorX=number_slider_45, FactorY=number_slider_46)  # disabled
# Flips the mirror direction to
# cut the other side instead.
toggle_20 = BooleanToggle(False)  # disabled
twnconcrvs = TweenConsecutiveCurves(Curves=[crv_28, crv_29, crv_30], Factor=number_slider_5, InterpolationType=number_slider_39, Refit=0, PointSample=0)  # disabled
slidecrvcrv = SlideCurveAlongCurve(Curve=crv_58, Guide1=crv_31, Factor=number_slider_6, Align=toggle_8, Refit=0, PointSample=0)  # disabled
twnconcrvscrv = TweenConsecutiveCurvesAlongCurve(Curves=crv_57, Guide1=crv_37, Factor=number_slider_8, Refit=0, PointSample=0)  # disabled
twnthrucrvscrv = TweenThroughCurvesAlongCurve(Curves=crv_59, Guide1=crv_38, Factor=number_slider_34, Normalized=True, Equalized=toggle_9, Refit=0, PointSample=0)  # disabled
dpline = DiscretePolyline(References=pt_5, Targets=crv_45, KeepLength=toggle_17)  # disabled
fitcrvsmo = FitCurveSmooth(Curve=crv_60, Degree=number_slider_52, FitTolerance=0.001, AngleTolerance=number_slider_35)  # disabled
prudecrv = PrudeCurve(Curve=crv_53, Length=number_slider_31, BlendType=number_slider_22, Bulge=number_slider_32)  # -> Prude, R; disabled
eval = EvaluateCurve(Curve=crv_9, Parameter=number_slider_55)  # -> Point, Tangent, Angle; disabled
twn2crvscrv = TweenTwoCurvesAlongCurve(CurveA=crv_55, CurveB=crv_56, Guide1=crv_36, Factor=number_slider_7, Refit=0, PointSample=0)  # disabled
consareaeli = ConstrainedAreaEllipse(Plane=xy_2, Area=number_slider_48, FactorX=number_slider_41, FactorY=number_slider_42)  # disabled
consarearec = ConstrainedAreaRectangle(Plane=xy_4, Area=number_slider_49, FactorX=number_slider_43, FactorY=number_slider_44)  # -> Rectangle, DimensionX, DimensionY; disabled
pline = PolyLine(Vertices=pt_5, Closed=False)  # disabled
clscrv = CloseCurve(Curve=crv_54, CloseType=number_slider_3, Bulge=number_slider_26, Tolerance=number_slider_24)  # -> Closed, R; disabled
plntrimcrv = PlaneTrimCurve(Curve=crv_61, Plane=yz, Flip=toggle_16)  # -> Trimmed, Parameters, Intersected; disabled
paramsrfiso = ParameterSurfaceIsocurve(Surface=S, Parameter=number_slider_47, Direction=toggle_15)  # disabled
eval_2 = EvaluateCurve(Curve=reparameterize(crv_7), Parameter=0)  # -> Point, Tangent, Angle; disabled
eval_3 = EvaluateCurve(Curve=reparameterize(crv_8), Parameter=0)  # -> Point, Tangent, Angle; disabled
swatch = ColourSwatch(SwatchColor=RGB(0, 0, 255))  # disabled
# Optional Refit and Sample Point
# match methods. Read input descriptions.
swatch_2 = ColourSwatch(SwatchColor=RGB(0, 0, 255))  # disabled
swatch_3 = ColourSwatch(SwatchColor=RGB(0, 0, 255))  # disabled
swatch_4 = ColourSwatch(SwatchColor=RGB(0, 255, 200))  # disabled
swatch_5 = ColourSwatch(SwatchColor=RGB(0, 0, 255))  # disabled
# Optional Refit and Sample Point
# match methods. Read input descriptions.
swatch_6 = ColourSwatch(SwatchColor=RGB(0, 0, 255))  # disabled
swatch_7 = ColourSwatch(SwatchColor=RGB(0, 255, 200))  # disabled
swatch_8 = ColourSwatch(SwatchColor=RGB(0, 0, 255))  # disabled
swatch_9 = ColourSwatch(SwatchColor=RGB(0, 0, 255))  # disabled
# Amount of spans
panel_5 = Panel(crvspans.Amount)  # disabled
swatch_10 = ColourSwatch(SwatchColor=RGB(0, 0, 255))  # disabled
panel_6 = Panel(ptstrimcrv.Intersected)  # disabled
swatch_11 = ColourSwatch(SwatchColor=RGB(0, 0, 255))  # disabled
panel_7 = Panel(ptstrimcrv.SubDomains)  # disabled
# Optional Refit and Sample Point
# match methods. Read input descriptions.
swatch_12 = ColourSwatch(SwatchColor=RGB(0, 0, 255))  # disabled
swatch_13 = ColourSwatch(SwatchColor=RGB(0, 0, 255))  # disabled
# The curves original domain
panel_8 = Panel(reparamcrv.Original)  # disabled
cp_2 = ControlPoints(Curve=complines.Compatibilized)  # -> Points, Weights, Knots; disabled
swatch_14 = ColourSwatch(SwatchColor=RGB(0, 0, 255))  # disabled
# Optional Refit and Sample Point
# match methods. Read input descriptions.
swatch_15 = ColourSwatch(SwatchColor=RGB(0, 0, 255))  # disabled
swatch_16 = ColourSwatch(SwatchColor=RGB(0, 0, 255))  # disabled
number_slider_70 = Slider(0.5, range=0..1)  # disabled
swatch_17 = ColourSwatch(SwatchColor=RGB(0, 0, 255))  # disabled
panel_9 = Panel(crvlenat.Length)  # disabled
# Using parameters instead of points.
panel_10 = Panel(crvlenat.Parameter)  # disabled
# The curve that will get
# mirror cut (turn its preview
# on to see the original curve)
# Using as the mirror plane
deplane = DeconstructPlane(Plane=move.Geometry)  # -> Origin, XAxis, YAxis, ZAxis; disabled
# Lengths along curve
# between points
panel_11 = Panel(crvlenbtwn.Lengths)  # disabled
# Using parameters instead of points.
panel_12 = Panel(crvlenbtwn.Parameters)  # disabled
swatch_18 = ColourSwatch(SwatchColor=RGB(0, 0, 255))  # disabled
swatch_19 = ColourSwatch(SwatchColor=RGB(0, 0, 255))  # disabled
swatch_20 = ColourSwatch(SwatchColor=RGB(0, 0, 255))  # disabled
swatch_21 = ColourSwatch(SwatchColor=RGB(0, 0, 255))  # disabled
swatch_22 = ColourSwatch(SwatchColor=RGB(0, 0, 255))  # disabled
# Segment degrees
panel_13 = Panel(crvkinky_2.Kinked)  # disabled
panel_14 = Panel(crvkinky_2.Lengths)  # disabled
# Segmented
panel_15 = Panel(crvsegs_2.Segments)  # disabled
panel_16 = Panel(crvkinky_2.Amount)  # disabled
panel_17 = Panel(crvlinr_2)  # disabled
# Segment amount
panel_18 = Panel(crvsegs_2.Amount)  # disabled
# Segment lengths
panel_19 = Panel(crvsegs_2.Lengths)  # disabled
panel_20 = Panel(isace.Arc)  # disabled
panel_21 = Panel(isace.Circle)  # disabled
panel_22 = Panel(isace.Ellipse)  # disabled
panel_23 = Panel(isace_2.Ellipse)  # disabled
panel_24 = Panel(crvsegs_2.Degrees)  # disabled
panel_25 = Panel(isace_2.Circle)  # disabled
panel_26 = Panel(crvkinky.Kinked)  # disabled
# Extracting the kink points
panel_27 = Panel(crvkinky.Amount)  # disabled
panel_28 = Panel(crvkinky.Lengths)  # disabled
panel_29 = Panel(crvlinr)  # disabled
# Segmented
panel_30 = Panel(crvsegs.Segments)  # disabled
# Extracting the segments or points between segments
# Segment amount
panel_31 = Panel(crvsegs.Amount)  # disabled
panel_32 = Panel(isace_2.Arc)  # disabled
# Segment lengths
panel_33 = Panel(crvsegs.Lengths)  # disabled
# Segment degrees
panel_34 = Panel(crvsegs.Degrees)  # disabled
recrvdom = RemapCurveDomain(Curve=crv_63, Domain=dom_2)  # -> Remapped, Original, New; disabled
brec = BoundingRectangle(Geometry=geo, Plane=xy_5, Axis=number_slider_63, Slide=number_slider_66, Union=toggle_19)  # -> Bounding, DimensionX, DimensionY; disabled
rebcrv = RebuildCurve(Curve=crv_62, Count=number_slider_65, Degree=number_slider_64, Domain=dom, EndTangents=toggle_18)  # disabled
paramcrvdivsrf = ParameterCurveDivideSurface(Surface=S_2, ParametersU=range_4, ParametersV=range)  # -> CurvesU, CurvesV; disabled
twnconcrvssrf = TweenConsecutiveCurvesOnSurface(
    Curves=[crv_48, crv_49, crv_50],
    Surface=srf_2,
    Factor=number_slider_27,
    InterpolationType=number_slider_62,
    Refit=3,
    PointSample=0)  # disabled
paramrecgrid = ParameterRectangleGrid(Rectangle=rec, ParametersX=range_6, ParametersY=range_3)  # -> Cells, Points; disabled
twnthrucrvs = TweenThroughCurves(
    Curves=[crv_12, crv_13, crv_14, crv_17],
    Factor=number_slider_36,
    Normalized=True,
    Equalized=toggle_2,
    InterpolationType=number_slider_54,
    Refit=0,
    PointSample=0)  # disabled
paramsrfgrid = ParameterSurfaceGrid(Surface=S_3, ParametersU=range_5, ParametersV=range_2)  # -> Cells, Points; disabled
twnthrucrvssrf = TweenThroughCurvesOnSurface(
    Curves=[crv_18, crv_19, crv_15],
    Surface=srf,
    Factor=number_slider_37,
    Normalized=True,
    Equalized=toggle,
    InterpolationType=number_slider_53,
    Refit=3,
    PointSample=0)  # disabled
swatch_23 = ColourSwatch(SwatchColor=RGB(0, 0, 255))  # disabled
panel_35 = Panel(complines.R)  # disabled
domain = Domain(crv_22)  # disabled
domain_2 = Domain(supercrv)  # disabled
# Did segment
# of curve fit
panel_36 = Panel(fitcrvsegs.R)  # disabled
# Did segment
# of curve rebuild
panel_37 = Panel(rebcrvsegs.R)  # disabled
swatch_24 = ColourSwatch(SwatchColor=RGB(0, 0, 255))  # disabled
# Normal polyline through the vertices
swatch_25 = ColourSwatch(SwatchColor=RGB(0, 0, 255))  # disabled
swatch_26 = ColourSwatch(SwatchColor=RGB(0, 0, 255))  # disabled
swatch_27 = ColourSwatch(SwatchColor=RGB(0, 0, 255))  # disabled
panel_38 = Panel(plntrimcrv.Intersected)  # disabled
# Optional Refit and Sample Point
# match methods. Read input descriptions.
swatch_28 = ColourSwatch(SwatchColor=RGB(0, 0, 255))  # disabled
swatch_29 = ColourSwatch(SwatchColor=RGB(0, 0, 255))  # disabled
swatch_30 = ColourSwatch(SwatchColor=RGB(0, 0, 255))  # disabled
swatch_31 = ColourSwatch(SwatchColor=RGB(0, 0, 255))  # disabled
# Look at Rhino window
# to preview results
panel_39 = Panel(alicrvseams.R)  # disabled
# Look at Rhino window
# to preview results
panel_40 = Panel(crvalicrvseams.R)  # disabled
# Original seams of the input curves,
# Using a guide point
preview = CustomPreview(Geometry=alicrvseams.Aligned, Shader=swatch_3)  # disabled
# Original seams of the input curves,
# Snap aligned seams to corners
preview_2 = CustomPreview(Geometry=crvalicrvseams.Aligned, Shader=swatch_5)  # disabled
# Look at Rhino window
# to preview results
# Aligned seams
preview_3 = CustomPreview(Geometry=alicrvseams.Points, Shader=swatch_4)  # disabled
# Look at Rhino window
# to preview results
# Aligned seams
preview_4 = CustomPreview(Geometry=crvalicrvseams.Points, Shader=swatch_7)  # disabled
# Some notes about averaging / tweening curves:
# 
# 1.Tweens can work between all types of combinations of curves - open, closed, segmented, kinked, & polylines.
# 
# 2.Tweens always work best between polylines when they have the same control point count,
# control points make them easier to predict in results. All the tween curve components can
# automatically compatabilize polylines but you can make the results fit your specific look
# by making them have matching control points yourself before tweening. For non polyline curves
# this is not necessary.
# 
# 3.If no curve shows up or looks weird, try flipping one of your curves - tweens work based on curve direction.
# Look at Rhino window
# to preview results
preview_5 = CustomPreview(Geometry=avrcrv, Shader=swatch_2)  # disabled
# Look at Rhino window
# to preview results
preview_6 = CustomPreview(Geometry=wavcrv, Shader=swatch_6)  # disabled
# Look at Rhino window
# to preview results
preview_7 = CustomPreview(Geometry=netsrf, Shader=swatch_8)  # disabled
# Look at Rhino window
# to preview results
preview_8 = CustomPreview(Geometry=recfit, Shader=swatch)  # disabled
# Look at Rhino window
# to preview results
preview_9 = CustomPreview(Geometry=ace, Shader=swatch_9)  # disabled
# Optional Refit and Sample Point
# match methods. Read input descriptions.
swatch_32 = ColourSwatch(SwatchColor=RGB(0, 0, 255))  # disabled
# Optional Refit and Sample Point
# match methods. Read input descriptions.
swatch_33 = ColourSwatch(SwatchColor=RGB(0, 0, 255))  # disabled
# Optional Refit and Sample Point
# match methods. Read input descriptions.
swatch_34 = ColourSwatch(SwatchColor=RGB(0, 0, 255))  # disabled
# Optional Refit and Sample Point
# match methods. Read input descriptions.
swatch_35 = ColourSwatch(SwatchColor=RGB(0, 0, 255))  # disabled
swatch_36 = ColourSwatch(SwatchColor=RGB(0, 0, 255))  # disabled
# True is made compatibile.
# False if already compatible.
lng_2 = ListLength(List=cp_2.Points)  # -> flatten(Length); disabled
# True is closed.
# False if not or already closed.
panel_41 = Panel(clscrv.R)  # disabled
# Using Normalized Lengths
# Look at Rhino window
# to preview results
preview_10 = CustomPreview(Geometry=opncrv.Opened, Shader=swatch_10)  # disabled
panel_42 = Panel(consarearec.DimensionX)  # disabled
# Result dimensions
# Since it is proportional:
# Dimension X / Dimension Y
# will equal the same number as
# Factor X / Factor Y
panel_43 = Panel(consarearec.DimensionY)  # disabled
panel_44 = Panel(fitcrvsegs.Amount)  # disabled
# Look at Rhino window
# to preview results
preview_11 = CustomPreview(Geometry=twn2crvssrf, Shader=swatch_12)  # disabled
# Look at Rhino window
# to preview results
# Control points of resulting curve.
# See how they change when you
# change the degree.
cp_3 = ControlPoints(Curve=fitcrvsegs.Fitted)  # -> Points, Weights, Knots; disabled
# Look at Rhino window
# to preview results
# Control points of resulting curve.
# See how they change when you
# change the degree.
cp_4 = ControlPoints(Curve=fitcrvsmo)  # -> Points, Weights, Knots; disabled
# Look at Rhino window
# to preview results
panel_45 = Panel(rebcrvsegs.Amount)  # disabled
# Using optional guide point
# Look at Rhino window
# to preview results
preview_12 = CustomPreview(Geometry=seam2crvcorn.Point, Shader=swatch_11)  # disabled
# Look at Rhino window
# to preview results
preview_13 = CustomPreview(Geometry=supercrv, Shader=swatch_17)  # disabled
# GH native Tween Curve comparison
# Look at Rhino window
# to preview results
preview_14 = CustomPreview(Geometry=twn2crvs, Shader=swatch_15)  # disabled
area = Area(Geometry=consareaeli)  # -> Area, Centroid; disabled
area_2 = Area(Geometry=consareaply)  # -> Area, Centroid; disabled
area_3 = Area(Geometry=consarearec.Rectangle)  # -> Area, Centroid; disabled
# See how the segments change
# when you change the degree
# and control point counts of
# the searched segments.
preview_15 = CustomPreview(Geometry=rebcrvsegs.Rebuilt, Shader=swatch_14)  # disabled
# Span curve sub-domains
panel_46 = Panel(crvspans.SubDomains)  # disabled
# Look at Rhino window
# to preview results
preview_16 = CustomPreview(Geometry=offcrv, Shader=swatch_16)  # disabled
# Using multiple points to trim
# between every two points.
# Look at Rhino window
# to preview results
preview_17 = CustomPreview(Geometry=ptstrimcrv.Trimmed, Shader=swatch_13)  # disabled
rot3d = Rotate3D(Geometry=move.Geometry, Angle=degrees(number_slider_69), Center=deplane.Origin, Axis=deplane.YAxis)  # -> Geometry, Transform; disabled
preview_18 = CustomPreview(Geometry=fitcrvsegs.Fitted, Shader=swatch_21)  # disabled
preview_19 = CustomPreview(Geometry=fitcrvsmo, Shader=swatch_22)  # disabled
# Reference Domain
panel_47 = Panel(domain)  # disabled
# Superimposed Domain
panel_48 = Panel(domain_2)  # disabled
# New curve domain
panel_49 = Panel(recrvdom.New)  # disabled
# Original curve domain
panel_50 = Panel(recrvdom.Original)  # disabled
# Look at Rhino window
# to preview results
preview_20 = CustomPreview(Geometry=complines.Compatibilized, Shader=swatch_23)  # disabled
swatch_37 = ColourSwatch(SwatchColor=RGB(0, 0, 255))  # disabled
swatch_38 = ColourSwatch(SwatchColor=RGB(0, 0, 255))  # disabled
# Optional Refit and Sample Point
# match methods. Read input descriptions.
swatch_39 = ColourSwatch(SwatchColor=RGB(0, 0, 255))  # disabled
# Amount of segments in curve
# Input curve
# segment degrees
panel_51 = Panel(fitcrvsegs.DegreesC)  # disabled
# Look at Rhino window
# to preview results
panel_52 = Panel(prudecrv.R)  # disabled
# Amount of segments in curve
# Input curve
# segment degrees
panel_53 = Panel(rebcrvsegs.DegreesC)  # disabled
preview_21 = CustomPreview(Geometry=prudecrv.Prude, Shader=swatch_24)  # disabled
# Look at Rhino window
# to preview results
panel_54 = Panel(range_4)  # disabled
panel_55 = Panel(range)  # disabled
# Look at Rhino window
# to preview results
panel_56 = Panel(range_5)  # disabled
panel_57 = Panel(range_2)  # disabled
# Look at Rhino window
# to preview results
panel_58 = Panel(range_6)  # disabled
panel_59 = Panel(range_3)  # disabled
toggle_21 = BooleanToggle(True)  # disabled
# Look at Rhino window
# to preview results
# This allows the start and end of the grid
# to be altered on the surface so grids can
# exist only on parts of the surface.
preview_22 = CustomPreview(Geometry=paramcrvdivsrf.CurvesU, Shader=swatch_19)  # disabled
# Look at Rhino window
# to preview results
# This allows the start and end of the grid
# to be altered on the surface so grids can
# exist only on parts of the surface.
preview_23 = CustomPreview(Geometry=paramsrfgrid.Cells, Shader=swatch_18)  # disabled
# Look at Rhino window
# to preview results
preview_24 = CustomPreview(Geometry=paramsrfiso, Shader=swatch_26)  # disabled
# Using keep lengths option
# Look at Rhino window
# to preview results
preview_25 = CustomPreview(Geometry=dpline, Shader=swatch_25)  # disabled
preview_26 = CustomPreview(
    Geometry=paramcrvdivsrf.CurvesV,
    Shader={ambient=RGB(0, 0, 0), diffuse=RGB(255, 105, 180), emission=RGB(76, 32, 54), shine=0.5, specular=RGB(255, 255, 255), transparency=0})  # disabled
preview_27 = CustomPreview(
    Geometry=paramsrfgrid.Points,
    Shader={ambient=RGB(0, 0, 0), diffuse=RGB(255, 105, 180), emission=RGB(76, 32, 54), shine=0.5, specular=RGB(255, 255, 255), transparency=0})  # disabled
preview_28 = CustomPreview(
    Geometry=paramrecgrid.Points,
    Shader={ambient=RGB(0, 0, 0), diffuse=RGB(255, 105, 180), emission=RGB(76, 32, 54), shine=0.5, specular=RGB(255, 255, 255), transparency=0})  # disabled
# Optional Refit and Sample Point
# match methods. Read input descriptions.
swatch_40 = ColourSwatch(SwatchColor=RGB(0, 0, 255))  # disabled
# Look at Rhino window
# to preview results
# This allows the start and end of the grid
# to be altered in the rectangle so grids can
# exist only in parts of the rectangle.
preview_29 = CustomPreview(Geometry=paramrecgrid.Cells, Shader=swatch_20)  # disabled
# Look at Rhino window
# to preview results
preview_30 = CustomPreview(Geometry=plntrimcrv.Trimmed, Shader=swatch_27)  # disabled
# Look at Rhino window
# to preview results
preview_31 = CustomPreview(Geometry=twnconcrvs, Shader=swatch_28)  # disabled
domain_3 = Domain(rebcrv)  # disabled
# Look at Rhino window
# to preview results
preview_32 = CustomPreview(Geometry=consareaeli, Shader=swatch_29)  # disabled
# Look at Rhino window
# to preview results
preview_33 = CustomPreview(Geometry=consareaply, Shader=swatch_31)  # disabled
# Look at Rhino window
# to preview results
preview_34 = CustomPreview(Geometry=consarearec.Rectangle, Shader=swatch_30)  # disabled
# Join makes the
# two mirror sides
# into one curve.
toggle_22 = BooleanToggle(False)  # disabled
# Result area matches
# input area exactly
panel_60 = Panel(area.Area)  # disabled
# Result area matches
# input area exactly
panel_61 = Panel(area_3.Area)  # disabled
# Result area matches
# input area exactly
panel_62 = Panel(area_2.Area)  # disabled
# Output control point counts
# are matched and the polyline
# shapes were not changed.
panel_63 = Panel(lng_2)  # disabled
# Optional Refit and Sample Point
# match methods. Read input descriptions.
swatch_41 = ColourSwatch(SwatchColor=RGB(0, 0, 255))  # disabled
crv_64 = Curve(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)  # disabled
# Look at Rhino window
# to preview results
preview_35 = CustomPreview(Geometry=clscrv.Closed, Shader=swatch_36)  # disabled
# Two guide curves to slide
# along and deform between
# Look at Rhino window
# to preview results
preview_36 = CustomPreview(Geometry=slidecrvcrv, Shader=swatch_32)  # disabled
# Two guide curves to tween
# along and deform between
# Look at Rhino window
# to preview results
preview_37 = CustomPreview(Geometry=twn2crvscrv, Shader=swatch_33)  # disabled
# Two guide curves to tween
# along and deform between
# Look at Rhino window
# to preview results
preview_38 = CustomPreview(Geometry=twnconcrvscrv, Shader=swatch_34)  # disabled
# Using Non-Normalized Factor
# Look at Rhino window
# to preview results
preview_39 = CustomPreview(Geometry=twnthrucrvscrv, Shader=swatch_35)  # disabled
# When curve is not reparameterized you
# can't evaluate from 0 to 1
eval_4 = EvaluateCurve(Curve=reparamcrv.Reparameterized, Parameter=number_slider_70)  # -> Point, Tangent, Angle; disabled
# If true the entire input
# curve is mirrored
# normally if it is mirror
# cut into non existance.
number_slider_71 = Slider(2, range=0..10)  # disabled
# Domain
panel_64 = Panel(domain_3)  # disabled
# Look at Rhino window
# to preview results
# Control Points
cp_5 = ControlPoints(Curve=rebcrv)  # -> Points, Weights, Knots; disabled
panel_65 = Panel(brec.DimensionX)  # disabled
# X and Y rectangle dimensions
panel_66 = Panel(brec.DimensionY)  # disabled
preview_40 = CustomPreview(Geometry=rebcrv, Shader=swatch_38)  # disabled
# Look at Rhino window
# to preview results
preview_41 = CustomPreview(Geometry=brec.Bounding, Shader=swatch_37)  # disabled
# Look at Rhino window
# to preview results
preview_42 = CustomPreview(Geometry=twnconcrvssrf, Shader=swatch_39)  # disabled
# Notice how we search for degree 2
# segments and how they change to the
# degree that is set in the degree input.
# Result curve
# segment degrees
panel_67 = Panel(fitcrvsegs.DegreesF)  # disabled
# Notice how we search for degree 2
# segments and how they change to the
# degree that is set in the degree input.
# Result curve
# segment degrees
panel_68 = Panel(rebcrvsegs.DegreesR)  # disabled
# Using Non-Normalized Factor
# Look at Rhino window
# to preview results
preview_43 = CustomPreview(Geometry=twnthrucrvs, Shader=swatch_40)  # disabled
# Bulge factor for the connection curve
# When mirror cuts have a reach or offset
# that is not zero, they can create a connection
# curve between the mirror cut sides, which
# blends them together. There are various types.
number_slider_72 = Slider(0.595, range=-1..1)  # disabled
# Using Non-Normalized Factor
# Look at Rhino window
# to preview results
preview_44 = CustomPreview(Geometry=twnthrucrvssrf, Shader=swatch_41)  # disabled
swatch_42 = ColourSwatch(SwatchColor=RGB(0, 0, 255))  # disabled
# Span lengths
panel_69 = Panel(crvspans.Lengths)  # disabled
panel_70 = Panel("""5.3
16.9
84.6""")  # disabled
number_slider_73 = Slider(0.472, range=0..1)  # disabled
mircutcrv = MirrorCutCurve(
    Curve=crv_64,
    MirrorPlane=rot3d.Geometry,
    Reach=number_slider_67,
    Offset=number_slider_68,
    Flip=toggle_20,
    Join=toggle_21,
    Keep=toggle_22,
    ConnectionType=number_slider_71,
    Bulge=number_slider_72)  # -> MirrorCut, SplitIndex, ReachPlane, OffsetPlane, Intersected; disabled
# Using division points to
# trim like a dash line.
number_slider_74 = Slider(18, range=0..100)  # disabled
panel_71 = Panel("59.8")  # disabled
# Look at Rhino window
# to preview results
preview_45 = CustomPreview(Geometry=eval_4.Point, Shader=swatch_42)  # disabled
# Look at Rhino window
# to preview input
crv_65 = Curve(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)  # disabled
# kinked curve
# Look at Rhino window
# to preview input
crv_66 = Curve(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)  # disabled
# Option to normalize
# the length output
# Optionally, you can use curve parameters
# instead of points. If both points and parameters
# are input the parameters will be used.
toggle_23 = BooleanToggle(False)  # disabled
# Option to normalize
# the length output
# Optionally, you can use curve parameters
# instead of points. If both points and parameters
# are input the parameters will be used.
toggle_24 = BooleanToggle(False)  # disabled
# Span degrees
panel_72 = Panel(crvspans.Degrees)  # disabled
# Normalized set to true
# Change the seam parameter to
# change the location of the opening.
number_slider_75 = Slider(0, range=0..1)  # disabled
# 0 to 0.5 length used
number_slider_76 = Slider(0.065, range=0..1)  # disabled
crv_67 = Curve(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)  # disabled
crv_68 = Curve(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)  # disabled
number_slider_77 = Slider(0.376, range=0..1)  # disabled
number_slider_78 = Slider(0.664, range=0..1)  # disabled
# Adjusting the start and end domains
# of the ranges positions the grid on
# specified parts of the surface.
number_slider_79 = Slider(0.652, range=0..1)  # disabled
number_slider_80 = Slider(0.376, range=0..1)  # disabled
number_slider_81 = Slider(0.664, range=0..1)  # disabled
number_slider_82 = Slider(0.376, range=0..1)  # disabled
number_slider_83 = Slider(0.664, range=0..1)  # disabled
number_slider_84 = Slider(0.428, range=0..1)  # disabled
number_slider_85 = Slider(0.428, range=0..1)  # disabled
# Adjusting the start and end domains
# of the ranges positions the grid on
# specified parts of the surface.
number_slider_86 = Slider(0.652, range=0..1)  # disabled
number_slider_87 = Slider(0.428, range=0..1)  # disabled
# Adjusting the start and end domains
# of the ranges positions the grid on
# specified parts of the surface.
number_slider_88 = Slider(0.652, range=0..1)  # disabled
crv_69 = Curve(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)  # disabled
# Look at Rhino window
# to preview inputs
crv_70 = Curve(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)  # disabled
# Look at Rhino window
# to preview inputs
crv_71 = Curve(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)  # disabled
# Parameters at span ends
# Extracting the spans or points between spans
panel_73 = Panel(crvspans.Parameters)  # disabled
toggle_25 = BooleanToggle(True)  # disabled
swatch_43 = ColourSwatch(SwatchColor=RGB(10, 255, 210))  # disabled
panel_74 = Panel(mircutcrv.Intersected)  # disabled
swatch_44 = ColourSwatch(SwatchColor=RGB(10, 22, 255))  # disabled
swatch_45 = ColourSwatch(SwatchColor=RGB(255, 0, 0))  # disabled
# When snap is true, the seam alignes to
#  the closest corner for curves with corners.
# Toggle the boolean to see the difference.
toggle_26 = BooleanToggle(True)  # disabled
crvkinky_3 = IsCurveKinky(Curve=crv_66)  # -> Kinked, Amount, Lengths; disabled
crvsegs_3 = IsCurveSegmented(Curve=crv_65)  # -> Segments, Amount, Lengths, Degrees; disabled
# Switches which side
# gets trimmed away
toggle_27 = BooleanToggle(True)  # disabled
crv_72 = Curve(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)  # disabled
crv_73 = Curve([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])  # disabled
# Curve with corners
crv_74 = Curve(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)  # disabled
# Move the guide point around to see how
# the seam switches to different corners
pt_6 = Point(Point(443.3137013, -189.8333808, 0))  # disabled
crv_75 = Curve(reparameterize(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))  # disabled
# Crv @
# index 0
number_slider_89 = Slider(2.5, range=0..3)  # disabled
# Crv @
# index 0
number_slider_90 = Slider(2.5, range=0..3)  # disabled
divide = DivideCurve(Curve=crv_69, Count=number_slider_74, Kinks=False)  # -> Points, Tangents, Parameters; disabled
pt_7 = Point([Point(595.1496153, -198.9540922, 0), Point(613.2041788, -153.4724193, 0), Point(641.4153483, -206.3045701, 0), Point(661.9444019, -174.4199226, 0), Point(640.8873635, -164.940701, 0), Point(662.1458276, -152.4881043, 0), Point(678.0820439, -162.6394396, 0)])  # disabled
crv_76 = Curve([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])  # disabled
number_slider_91 = Slider(0.551, range=0..1)  # disabled
crvlenat_2 = CurveLengthAt(Curve=crv_70, Parameter=panel_71, Normalized=toggle_23)  # -> Length, Parameter; disabled
twn2crvs_2 = TweenTwoCurves(CurveA=crv_67, CurveB=crv_68, Factor=number_slider_73, Refit=0, PointSample=0)  # disabled
crv_77 = Curve([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])  # disabled
# Optionally you can
# align the seams
# with a guide start
#  point. Move the
# point around to
# see the seams
# realign to it.
pt_8 = Point(Point(406.232057, -65.476253, 0))  # disabled
crvlenbtwn_2 = CurveLengthBetween(Curve=crv_71, Parameters=panel_70, Normalized=toggle_24)  # -> Lengths, Parameters; disabled
number_slider_92 = Slider(0.5, range=0..1)  # disabled
number_slider_93 = Slider(5, range=0..10)  # disabled
number_slider_94 = Slider(5, range=0..10)  # disabled
# GH native Tween
tweencrv = TweenCurve(CurveA=crv_67, CurveB=crv_68, Factor=number_slider_73, BlendType=0)  # disabled
number_slider_95 = Slider(5, range=0..10)  # disabled
number_slider_96 = Slider(5, range=0..10)  # disabled
number_slider_97 = Slider(5, range=0..10)  # disabled
number_slider_98 = Slider(5, range=0..10)  # disabled
number_slider_99 = Slider(0.467, range=0..1)  # disabled
# Look at Rhino window
# to preview results
# Result mirror cut curve
preview_46 = CustomPreview(Geometry=mircutcrv.MirrorCut, Shader=swatch_45)  # disabled
preview_47 = CustomPreview(Geometry=mircutcrv.ReachPlane, Shader=swatch_43)  # disabled
# Using the keep lengths option will make
# the result discrete polyline have the same
# length as the normal polyline through
# the vertices but the discrete polyline will
# deviate further from the reference vertices
toggle_28 = BooleanToggle(True)  # disabled
# Reach plane (this plane essentially does the cutting)
# Offset plane (offsets the cuts from the mirror plane)
preview_48 = CustomPreview(Geometry=mircutcrv.OffsetPlane, Shader=swatch_44)  # disabled
# Look at Rhino window
# to preview guide point
preview_49 = CustomPreview(
    Geometry=pt_8,
    Shader={ambient=RGB(0, 0, 0), diffuse=RGB(255, 105, 180), emission=RGB(76, 32, 54), shine=0.5, specular=RGB(255, 255, 255), transparency=0})  # disabled
# Crv@
# index 1
# Change boolean to False
# to turn off Normalized Factor
toggle_29 = BooleanToggle(False)  # disabled
# Crv@
# index 1
# Change boolean to False
# to turn off Normalized Factor
# When Normalized is False the factor is
# from 0 to the last index. This
# can be considered like a timeline.
# This lets each curve have an equally
# controllable section of the slider between.
# As opposed to going from 0 to 1, this lets
# you easily pinpoint your location.
# You can use lists / mutiple factors as well.
toggle_30 = BooleanToggle(False)  # disabled
# Look at Rhino window
# to see input curves seam
end_2 = EndPoints(Curve=crv_74)  # -> Start, End; disabled
# You can use the lengths with
# Grasshopper's Evalute Length
# component to extract the points
# at the kinks.
eval_5 = EvaluateLength(Curve=crv_66, Length=crvkinky_3.Lengths, Normalized=False)  # -> Point, Tangent, Parameter; disabled
# You can use the lengths with
# Grasshopper's Mass Addition
# + Evalute Length component to extract
# the points between the segments.
ma = MassAddition(Input=crvsegs_3.Lengths)  # -> Result, PartialResults; disabled
crvalicrvseams_2 = CurveAlignCurveSeams(Curves=crv_73, Guide=crv_72, Snap=toggle_26)  # -> Aligned, Points, R; disabled
# When normalized is true then the
# length uses a normalized value for
# opening. So 0 is closed and 0.5 is all
# the way open (half the curve from
# both sides because the entire curves
# normalized length is 1)
opncrv_2 = OpenCurve(Curve=crv_75, Length=number_slider_76, Normalized=toggle_25, Seam=number_slider_75)  # -> Opened, R; disabled
seam2crvcorn_2 = SeamToCurveCorner(Curve=crv_74, Guide=pt_6)  # -> Adjusted, Point, R; disabled
toggle_31 = BooleanToggle(False)  # disabled
ptstrimcrv_2 = PointsTrimCurve(Curve=crv_69, Points=divide.Points, Flip=toggle_27)  # -> Trimmed, SubDomains, Intersected; disabled
# Crv @
# index 0
number_slider_100 = Slider(1.5, range=0..2)  # disabled
dom_3 = ConstructDomain(DomainStart=number_slider_77, DomainEnd=number_slider_78)  # disabled
dom_4 = ConstructDomain(DomainStart=number_slider_84, DomainEnd=number_slider_79)  # disabled
dom_5 = ConstructDomain(DomainStart=number_slider_80, DomainEnd=number_slider_81)  # disabled
dom_6 = ConstructDomain(DomainStart=number_slider_85, DomainEnd=number_slider_86)  # disabled
dom_7 = ConstructDomain(DomainStart=number_slider_82, DomainEnd=number_slider_83)  # disabled
dom_8 = ConstructDomain(DomainStart=number_slider_87, DomainEnd=number_slider_88)  # disabled
# Pf Tween
# GH has a native tween curve component
# however it sometimes outputs strange
# results, specifically when dealing with
# polylines (even with same control point
# counts). Pf's tween curve resolves this and
# acts more like Rhino's tween curve.
swatch_46 = ColourSwatch(SwatchColor=RGB(0, 0, 255))  # disabled
crv_78 = Curve(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)  # disabled
crv_79 = Curve(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)  # disabled
crv_80 = Curve(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)  # disabled
# Crv@
# index 3
# Crv@
# index 2
crv_81 = Curve(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)  # disabled
swatch_47 = ColourSwatch(SwatchColor=RGB(255, 0, 0))  # disabled
# Second guide curve. When using two
# guide curves the tween curves will tween
# along them while deforming between them.
crv_82 = Curve(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)  # disabled
crv_83 = Curve(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)  # disabled
# Second guide curve. When using two
# guide curves the tween curves will tween
# along them while deforming between them.
crv_84 = Curve(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)  # disabled
crv_85 = Curve(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)  # disabled
# Look at Rhino window
# to preview input
# Remapping domain to a guide curve
crv_86 = Curve(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)  # disabled
panel_75 = Panel(crvlenat_2.Length)  # disabled
panel_76 = Panel(crvlenat_2.Parameter)  # disabled
# Crv@
# index 3
# Crv@
# index 2
crv_87 = Curve(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)  # disabled
# Guide curve to match domain of
crv_88 = Curve(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)  # disabled
crv_89 = Curve(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)  # disabled
# Second guide curve. When using two
# guide curves the slide curves will slide
# along them while deforming between them.
crv_90 = Curve(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)  # disabled
# Change boolean to False
# to turn off Normalized Factor
toggle_32 = BooleanToggle(False)  # disabled
# Lengths along curve
# between points
panel_77 = Panel(crvlenbtwn_2.Lengths)  # disabled
panel_78 = Panel(crvlenbtwn_2.Parameters)  # disabled
eval_6 = EvaluateLength(Curve=crv_65, Length=ma.PartialResults, Normalized=False)  # -> Point, Tangent, Parameter; disabled
dpline_2 = DiscretePolyline(References=pt_7, Targets=crv_76, KeepLength=toggle_28)  # disabled
pline_2 = PolyLine(Vertices=pt_7, Closed=False)  # disabled
alicrvseams_2 = AlignCurveSeams(Curves=crv_77, Guide=pt_8, Snap=False, Iterative=True)  # -> Aligned, Points, R; disabled
eval_7 = EvaluateCurve(Curve=reparameterize(crv_73), Parameter=0)  # -> Point, Tangent, Angle; disabled
swatch_48 = ColourSwatch(SwatchColor=RGB(0, 0, 255))  # disabled
swatch_49 = ColourSwatch(SwatchColor=RGB(0, 255, 200))  # disabled
crv_91 = Curve(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)  # disabled
crv_92 = Curve([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])  # disabled
crv_93 = Curve([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])  # disabled
crv_94 = Curve(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)  # disabled
crv_95 = Curve(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)  # disabled
swatch_50 = ColourSwatch(SwatchColor=RGB(0, 0, 255))  # disabled
swatch_51 = ColourSwatch(SwatchColor=RGB(0, 0, 255))  # disabled
swatch_52 = ColourSwatch(SwatchColor=RGB(0, 0, 255))  # disabled
range_7 = Range(Domain=dom_4, Steps=number_slider_95)  # disabled
range_8 = Range(Domain=dom_6, Steps=number_slider_96)  # disabled
range_9 = Range(Domain=dom_8, Steps=number_slider_97)  # disabled
range_10 = Range(Domain=dom_3, Steps=number_slider_98)  # disabled
range_11 = Range(Domain=dom_5, Steps=number_slider_93)  # disabled
range_12 = Range(Domain=dom_7, Steps=number_slider_94)  # disabled
rec_2 = Rectangle({Plane=PlaneXY(331.0816594, 230.3581947, 0), Size=Domain2(u=0..19.36112898, v=0..33.2196213)})  # disabled
crv_96 = Curve(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)  # disabled
crv_97 = Curve(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)  # disabled
crv_98 = Curve(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)  # disabled
# Crv @
# index 1
# Crv @
# index 2
srf_5 = Surface(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)  # disabled
S_4 = Surface(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)  # disabled
S_5 = Surface(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)  # disabled
panel_79 = Panel(eval_5.Point)  # disabled
recrvdom_2 = RemapCurveDomain(Curve=crv_86, Guide=crv_88)  # -> Remapped, Original, New; disabled
# Look at Rhino window
# to preview results
preview_50 = CustomPreview(Geometry=twn2crvs_2, Shader=swatch_46)  # disabled
# Look at Rhino window
# to preview results
preview_51 = CustomPreview(Geometry=tweencrv, Shader=swatch_47)  # disabled
eval_8 = EvaluateCurve(Curve=reparameterize(crv_77), Parameter=0)  # -> Point, Tangent, Angle; disabled
swatch_53 = ColourSwatch(SwatchColor=RGB(0, 0, 255))  # disabled
swatch_54 = ColourSwatch(SwatchColor=RGB(0, 255, 200))  # disabled
swatch_55 = ColourSwatch(SwatchColor=RGB(0, 0, 255))  # disabled
# Look at Rhino window
# to preview results
panel_80 = Panel(crvalicrvseams_2.R)  # disabled
# Original seams of the input curves,
preview_52 = CustomPreview(Geometry=crvalicrvseams_2.Aligned, Shader=swatch_48)  # disabled
# Look at Rhino window
# to preview results
# Aligned seams
preview_53 = CustomPreview(Geometry=crvalicrvseams_2.Points, Shader=swatch_49)  # disabled
swatch_56 = ColourSwatch(SwatchColor=RGB(0, 0, 255))  # disabled
swatch_57 = ColourSwatch(SwatchColor=RGB(0, 0, 255))  # disabled
swatch_58 = ColourSwatch(SwatchColor=RGB(0, 0, 255))  # disabled
# Look at Rhino window
# to preview results
preview_54 = CustomPreview(Geometry=opncrv_2.Opened, Shader=swatch_51)  # disabled
# Using parameters instead of points.
# Look at Rhino window
# to preview results
preview_55 = CustomPreview(Geometry=ptstrimcrv_2.Trimmed, Shader=swatch_50)  # disabled
# Look at Rhino window
# to preview results
preview_56 = CustomPreview(Geometry=seam2crvcorn_2.Point, Shader=swatch_52)  # disabled
len = Length(Curve=dpline_2)  # disabled
# Normal polyline through the vertices
len_2 = Length(Curve=pline_2)  # disabled
slidecrvcrv_2 = SlideCurveAlongCurve(Curve=crv_91, Guide1=crv_90, Guide2=crv_89, Factor=number_slider_99, Align=toggle_31, Refit=0, PointSample=0)  # disabled
twn2crvscrv_2 = TweenTwoCurvesAlongCurve(CurveA=crv_94, CurveB=crv_95, Guide1=crv_82, Guide2=crv_83, Factor=number_slider_91, Refit=0, PointSample=0)  # disabled
twnthrucrvscrv_2 = TweenThroughCurvesAlongCurve(Curves=crv_93, Guide1=crv_87, Factor=number_slider_89, Normalized=toggle_29, Equalized=False, Refit=0, PointSample=0)  # disabled
twnconcrvscrv_2 = TweenConsecutiveCurvesAlongCurve(Curves=crv_92, Guide1=crv_84, Guide2=crv_85, Factor=number_slider_92, Refit=0, PointSample=0)  # disabled
paramcrvdivsrf_2 = ParameterCurveDivideSurface(Surface=S_4, ParametersU=range_10, ParametersV=range_7)  # -> CurvesU, CurvesV; disabled
twnthrucrvs_2 = TweenThroughCurves(
    Curves=[crv_78, crv_79, crv_80, crv_81],
    Factor=number_slider_90,
    Normalized=toggle_30,
    Equalized=False,
    InterpolationType=0,
    Refit=0,
    PointSample=0)  # disabled
paramrecgrid_2 = ParameterRectangleGrid(Rectangle=rec_2, ParametersX=range_12, ParametersY=range_9)  # -> Cells, Points; disabled
paramsrfgrid_2 = ParameterSurfaceGrid(Surface=S_5, ParametersU=range_11, ParametersV=range_8)  # -> Cells, Points; disabled
# You can then use
# Grasshoper's Shatter
# component to get each
# segment seperated.
shatter = Shatter(Curve=crv_65, Parameters=eval_6.Parameter)  # disabled
panel_81 = Panel(eval_6.Point)  # disabled
# New curve domain
panel_82 = Panel(recrvdom_2.New)  # disabled
# Original curve domain
panel_83 = Panel(recrvdom_2.Original)  # disabled
# Look at Rhino window
# to preview results
panel_84 = Panel(alicrvseams_2.R)  # disabled
# Original seams of the input curves,
# Using iterative to progressively
# align along the flow of curves
preview_57 = CustomPreview(Geometry=alicrvseams_2.Aligned, Shader=swatch_53)  # disabled
# Look at Rhino window
# to preview results
# Aligned seams
preview_58 = CustomPreview(Geometry=alicrvseams_2.Points, Shader=swatch_54)  # disabled
# Look at Rhino window
# to preview results
preview_59 = CustomPreview(Geometry=dpline_2, Shader=swatch_55)  # disabled
twnthrucrvssrf_2 = TweenThroughCurvesOnSurface(
    Curves=[crv_96, crv_97, crv_98],
    Surface=srf_5,
    Factor=number_slider_100,
    Normalized=toggle_32,
    Equalized=False,
    InterpolationType=0,
    Refit=3,
    PointSample=0)  # disabled
# Lengths are the same
panel_85 = Panel([len_2, len])  # disabled
# Look at Rhino window
# to preview input
crv_99 = Curve(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)  # disabled
panel_86 = Panel(shatter)  # disabled
# Look at Rhino window
# to preview results
# Using unevenly spaced parameter
# values will result in uneven spaced
# grids. The grid spacing can be
# controlled with custom values
# such as values from graph mappers.
preview_60 = CustomPreview(Geometry=paramcrvdivsrf_2.CurvesU, Shader=swatch_56)  # disabled
# Look at Rhino window
# to preview results
# Using unevenly spaced parameter
# values will result in uneven spaced
# grids. The grid spacing can be
# controlled with custom values
# such as values from graph mappers.
preview_61 = CustomPreview(Geometry=paramsrfgrid_2.Cells, Shader=swatch_57)  # disabled
# Look at Rhino window
# to preview results
# Using unevenly spaced parameter
# values will result in uneven spaced
# grids. The grid spacing can be
# controlled with custom values
# such as values from graph mappers.
preview_62 = CustomPreview(Geometry=paramrecgrid_2.Cells, Shader=swatch_58)  # disabled
# Optional Refit and Sample Point
# match methods. Read input descriptions.
swatch_59 = ColourSwatch(SwatchColor=RGB(0, 255, 170))  # disabled
# Look at Rhino window
# to preview results
preview_63 = CustomPreview(
    Geometry=paramcrvdivsrf_2.CurvesV,
    Shader={ambient=RGB(0, 0, 0), diffuse=RGB(255, 105, 180), emission=RGB(76, 32, 54), shine=0.5, specular=RGB(255, 255, 255), transparency=0})  # disabled
# Look at Rhino window
# to preview results
preview_64 = CustomPreview(
    Geometry=paramsrfgrid_2.Points,
    Shader={ambient=RGB(0, 0, 0), diffuse=RGB(255, 105, 180), emission=RGB(76, 32, 54), shine=0.5, specular=RGB(255, 255, 255), transparency=0})  # disabled
# Look at Rhino window
# to preview results
preview_65 = CustomPreview(
    Geometry=paramrecgrid_2.Points,
    Shader={ambient=RGB(0, 0, 0), diffuse=RGB(255, 105, 180), emission=RGB(76, 32, 54), shine=0.5, specular=RGB(255, 255, 255), transparency=0})  # disabled
swatch_60 = ColourSwatch(SwatchColor=RGB(0, 0, 255))  # disabled
# Optional Refit and Sample Point
# match methods. Read input descriptions.
swatch_61 = ColourSwatch(SwatchColor=RGB(0, 255, 170))  # disabled
swatch_62 = ColourSwatch(SwatchColor=RGB(0, 0, 255))  # disabled
swatch_63 = ColourSwatch(SwatchColor=RGB(0, 0, 255))  # disabled
# Optional Refit and Sample Point
# match methods. Read input descriptions.
swatch_64 = ColourSwatch(SwatchColor=RGB(0, 255, 170))  # disabled
crvspans_2 = CurveSpans(Curve=crv_99)  # -> SubDomains, Amount, Lengths, Degrees, Parameters; disabled
# Look at Rhino window
# to preview results
preview_66 = CustomPreview(Geometry=twnthrucrvs_2, Shader=swatch_59)  # disabled
# Look at Rhino window
# to preview results
preview_67 = CustomPreview(Geometry=slidecrvcrv_2, Shader=swatch_60)  # disabled
# Look at Rhino window
# to preview results
preview_68 = CustomPreview(Geometry=twn2crvscrv_2, Shader=swatch_62)  # disabled
# Look at Rhino window
# to preview results
preview_69 = CustomPreview(Geometry=twnconcrvscrv_2, Shader=swatch_63)  # disabled
# Two guide curves to tween
# along and deform between
# Look at Rhino window
# to preview results
preview_70 = CustomPreview(Geometry=twnthrucrvscrv_2, Shader=swatch_61)  # disabled
number_slider_101 = Slider(16, range=0..100)  # disabled
# Look at Rhino window
# to preview results
preview_71 = CustomPreview(Geometry=twnthrucrvssrf_2, Shader=swatch_64)  # disabled
# You can use the parameters with
# Grasshopper's Evaluate Curve
# component to extract the points
# between the spans.
eval_9 = EvaluateCurve(Curve=crv_99, Parameter=crvspans_2.Parameters)  # -> Point, Tangent, Angle; disabled
# You can use the sub-domains
# with Grasshopper's Sub Curve
# component to extract the spans
# as separate curves.
subcrv = SubCurve(BaseCurve=crv_99, Domain=crvspans_2.SubDomains)  # disabled
# Splitting the list
number_slider_102 = Slider(-8.615, range=-20..20)  # disabled
crv_100 = Curve(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)  # disabled
number_slider_103 = Slider(10, range=0..10)  # disabled
number_slider_104 = Slider(10, range=0..10)  # disabled
number_slider_105 = Slider(10, range=0..10)  # disabled
number_slider_106 = Slider(10, range=0..10)  # disabled
number_slider_107 = Slider(10, range=0..10)  # disabled
number_slider_108 = Slider(10, range=0..10)  # disabled
panel_87 = Panel(subcrv)  # disabled
panel_88 = Panel(eval_9.Point)  # disabled
# Optionally, you can use curve parameters
# instead of points. If both points and parameters
# are input the parameters will be used.
divide_2 = DivideCurve(Curve=crv_100, Count=number_slider_101, Kinks=False)  # -> Points, Tangents, Parameters; disabled
yz_3 = YZPlane(Origin=Point(656.1557064, 279.952923, 0))  # disabled
X_2 = UnitX(Factor=number_slider_102)  # disabled
# Switch iterative on and off to see
# the difference. Iterative aligning
# alignes each curves seam to the
# aligned seam of the previous curve
# in the list. If itaritive is false then all
# curve seams align directly to the start
# curves seam or the optional guide point.
toggle_33 = BooleanToggle(True)  # disabled
ptstrimcrv_3 = PointsTrimCurve(Curve=crv_100, Parameters=divide_2.Parameters, Flip=False)  # -> Trimmed, SubDomains, Intersected; disabled
crv_101 = Curve([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])  # disabled
range_13 = Range(Domain=Domain(0, 1), Steps=number_slider_103)  # disabled
range_14 = Range(Domain=Domain(0, 1), Steps=number_slider_104)  # disabled
range_15 = Range(Domain=Domain(0, 1), Steps=number_slider_105)  # disabled
range_16 = Range(Domain=Domain(0, 1), Steps=number_slider_106)  # disabled
range_17 = Range(Domain=Domain(0, 1), Steps=number_slider_107)  # disabled
range_18 = Range(Domain=Domain(0, 1), Steps=number_slider_108)  # disabled
move_2 = Move(Geometry=yz_3, Motion=X_2)  # -> Geometry, Transform; disabled
number_slider_109 = Slider(33, range=0..360)  # disabled
S_6 = Surface(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)  # disabled
rec_3 = Rectangle({Plane=PlaneXY(364.0304492, 229.9530635, 0), Size=Domain2(u=0..18.95352626, v=0..33.2196213)})  # disabled
S_7 = Surface(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)  # disabled
number_slider_110 = Slider(2, range=0..10)  # disabled
number_slider_111 = Slider(0.75, range=0..1)  # disabled
swatch_65 = ColourSwatch(SwatchColor=RGB(0, 0, 255))  # disabled
deplane_2 = DeconstructPlane(Plane=move_2.Geometry)  # -> Origin, XAxis, YAxis, ZAxis; disabled
number_slider_112 = Slider(1.676, range=0..10)  # disabled
number_slider_113 = Slider(5.36, range=0..10)  # disabled
number_slider_114 = Slider(0.313, range=-1..1)  # disabled
alicrvseams_3 = AlignCurveSeams(Curves=crv_101, Snap=False, Iterative=toggle_33)  # -> Aligned, Points, R; disabled
graph = GraphMapper(
    range_16,
    x0=0,
    x1=1,
    y0=0,
    y1=1,
    container_name="Bezier",
    cpx=[0, 0.7955461144, 0.533728838, 1],
    cpy=[0, 0.104544878, 0.4652709961, 1])  # disabled
# Graphmappers creating gradient grid spacing.
graph_2 = GraphMapper(
    range_13,
    x0=0,
    x1=1,
    y0=0,
    y1=1,
    container_name="Bezier",
    cpx=[0, 0.161364466, 0.3795443475, 1],
    cpy=[0, 0.5532698631, 0.9518182874, 1])  # disabled
graph_3 = GraphMapper(
    range_17,
    x0=0,
    x1=1,
    y0=0,
    y1=1,
    container_name="Bezier",
    cpx=[0, 0.7955461144, 0.533728838, 1],
    cpy=[0, 0.104544878, 0.4652709961, 1])  # disabled
# Graphmappers creating gradient grid spacing.
graph_4 = GraphMapper(
    range_14,
    x0=0,
    x1=1,
    y0=0,
    y1=1,
    container_name="Bezier",
    cpx=[0, 0.161364466, 0.3795443475, 1],
    cpy=[0, 0.5532698631, 0.9518182874, 1])  # disabled
graph_5 = GraphMapper(
    range_18,
    x0=0,
    x1=1,
    y0=0,
    y1=1,
    container_name="Bezier",
    cpx=[0, 0.7955461144, 0.533728838, 1],
    cpy=[0, 0.104544878, 0.4652709961, 1])  # disabled
# Graphmappers creating gradient grid spacing.
graph_6 = GraphMapper(
    range_15,
    x0=0,
    x1=1,
    y0=0,
    y1=1,
    container_name="Bezier",
    cpx=[0, 0.161364466, 0.3795443475, 1],
    cpy=[0, 0.5532698631, 0.9518182874, 1])  # disabled
toggle_34 = BooleanToggle(False)  # disabled
toggle_35 = BooleanToggle(False)  # disabled
toggle_36 = BooleanToggle(False)  # disabled
# Second guide curve. When using two
# guide curves the tween curves will tween
# along them while deforming between them.
crv_102 = Curve(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)  # disabled
crv_103 = Curve(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)  # disabled
# Look at Rhino window
# to preview results
preview_72 = CustomPreview(Geometry=ptstrimcrv_3.Trimmed, Shader=swatch_65)  # disabled
rot3d_2 = Rotate3D(Geometry=move_2.Geometry, Angle=degrees(number_slider_109), Center=deplane_2.Origin, Axis=deplane_2.YAxis)  # -> Geometry, Transform; disabled
eval_10 = EvaluateCurve(Curve=reparameterize(crv_101), Parameter=0)  # -> Point, Tangent, Angle; disabled
swatch_66 = ColourSwatch(SwatchColor=RGB(0, 255, 200))  # disabled
swatch_67 = ColourSwatch(SwatchColor=RGB(0, 0, 255))  # disabled
crv_104 = Curve([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])  # disabled
crv_105 = Curve(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)  # disabled
swatch_68 = ColourSwatch(SwatchColor=RGB(0, 0, 255))  # disabled
swatch_69 = ColourSwatch(SwatchColor=RGB(0, 0, 255))  # disabled
paramcrvdivsrf_3 = ParameterCurveDivideSurface(Surface=S_6, ParametersU=graph, ParametersV=graph_2)  # -> CurvesU, CurvesV; disabled
paramsrfgrid_3 = ParameterSurfaceGrid(Surface=S_7, ParametersU=graph_3, ParametersV=graph_4)  # -> Cells, Points; disabled
# Look at Rhino window
# to preview results
panel_89 = Panel(alicrvseams_3.R)  # disabled
swatch_70 = ColourSwatch(SwatchColor=RGB(0, 0, 255))  # disabled
# Original seams of the input curves,
preview_73 = CustomPreview(Geometry=alicrvseams_3.Aligned, Shader=swatch_67)  # disabled
# Look at Rhino window
# to preview results
# Aligned seams
preview_74 = CustomPreview(Geometry=alicrvseams_3.Points, Shader=swatch_66)  # disabled
twnthrucrvscrv_3 = TweenThroughCurvesAlongCurve(
    Curves=crv_104,
    Guide1=crv_102,
    Guide2=crv_103,
    Factor=number_slider_111,
    Normalized=True,
    Equalized=False,
    Refit=0,
    PointSample=0)  # disabled
paramrecgrid_3 = ParameterRectangleGrid(Rectangle=rec_3, ParametersX=graph_5, ParametersY=graph_6)  # -> Cells, Points; disabled
# Look at Rhino window
# to preview results
# Using only one parameter input
# for one direction makes isocurve.
preview_75 = CustomPreview(Geometry=paramcrvdivsrf_3.CurvesU, Shader=swatch_68)  # disabled
# Look at Rhino window
# to preview results
preview_76 = CustomPreview(Geometry=paramsrfgrid_3.Cells, Shader=swatch_69)  # disabled
# Look at Rhino window
# to preview results
preview_77 = CustomPreview(
    Geometry=paramcrvdivsrf_3.CurvesV,
    Shader={ambient=RGB(0, 0, 0), diffuse=RGB(255, 105, 180), emission=RGB(76, 32, 54), shine=0.5, specular=RGB(255, 255, 255), transparency=0})  # disabled
# Look at Rhino window
# to preview results
preview_78 = CustomPreview(
    Geometry=paramsrfgrid_3.Points,
    Shader={ambient=RGB(0, 0, 0), diffuse=RGB(255, 105, 180), emission=RGB(76, 32, 54), shine=0.5, specular=RGB(255, 255, 255), transparency=0})  # disabled
mircutcrv_2 = MirrorCutCurve(
    Curve=crv_105,
    MirrorPlane=rot3d_2.Geometry,
    Reach=number_slider_113,
    Offset=number_slider_112,
    Flip=toggle_35,
    Join=toggle_36,
    Keep=toggle_34,
    ConnectionType=number_slider_110,
    Bulge=number_slider_114)  # -> MirrorCut, SplitIndex, ReachPlane, OffsetPlane, Intersected; disabled
# Look at Rhino window
# to preview results
preview_79 = CustomPreview(Geometry=paramrecgrid_3.Cells, Shader=swatch_70)  # disabled
# Look at Rhino window
# to preview results
preview_80 = CustomPreview(
    Geometry=paramrecgrid_3.Points,
    Shader={ambient=RGB(0, 0, 0), diffuse=RGB(255, 105, 180), emission=RGB(76, 32, 54), shine=0.5, specular=RGB(255, 255, 255), transparency=0})  # disabled
# Optional Refit and Sample Point
# match methods. Read input descriptions.
swatch_71 = ColourSwatch(SwatchColor=RGB(0, 0, 255))  # disabled
intcrv = Interpolate(Vertices=alicrvseams_3.Points, Degree=3, Periodic=False, KnotStyle=1)  # -> Curve, Length, Domain; disabled
split = SplitList(List=mircutcrv_2.MirrorCut, Index=mircutcrv_2.SplitIndex)  # -> ListA, ListB; disabled
# Using snap to snap aligned seams to corners
# Look at Rhino window
# to preview results
# Now the curve seams have a flowing
# orientation relationship along the set
# of curves in relation to eachother, rather
# than all facing the same direction in the
# world.
preview_81 = CustomPreview(
    Geometry=intcrv.Curve,
    Shader={ambient=RGB(0, 0, 0), diffuse=RGB(255, 105, 180), emission=RGB(76, 32, 54), shine=0.5, specular=RGB(255, 255, 255), transparency=0})  # disabled
swatch_72 = ColourSwatch(SwatchColor=RGB(10, 255, 210))  # disabled
# If  join is false you can use this index
# to split the list at the mirror seam.
swatch_73 = ColourSwatch(SwatchColor=RGB(10, 22, 255))  # disabled
# Look at Rhino window
# to preview results
preview_82 = CustomPreview(Geometry=twnthrucrvscrv_3, Shader=swatch_71)  # disabled
preview_83 = CustomPreview(Geometry=split.ListA, Shader=swatch_72)  # disabled
# Look at Rhino window
# to preview results
preview_84 = CustomPreview(Geometry=split.ListB, Shader=swatch_73)  # disabled
number_slider_115 = Slider(0.375, range=0..1)  # disabled
S_8 = Surface(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)  # disabled
paramcrvdivsrf_4 = ParameterCurveDivideSurface(Surface=S_8, ParametersU=number_slider_115)  # -> CurvesU, CurvesV; disabled
# When snap is true, the seam alignes to
#  the closest corner for curves with corners.
# Toggle the boolean to see the difference.
toggle_37 = BooleanToggle(True)  # disabled
crv_106 = Curve([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])  # disabled
# Divisions along u results in iso curves along V.
# Divisions along v results in iso curves along U.
# Look at Rhino window
# to preview results
preview_85 = CustomPreview(
    Geometry=paramcrvdivsrf_4.CurvesV,
    Shader={ambient=RGB(0, 0, 0), diffuse=RGB(255, 105, 180), emission=RGB(76, 32, 54), shine=0.5, specular=RGB(255, 255, 255), transparency=0})  # disabled
alicrvseams_4 = AlignCurveSeams(Curves=crv_106, Snap=toggle_37, Iterative=True)  # -> Aligned, Points, R; disabled
swatch_74 = ColourSwatch(SwatchColor=RGB(0, 255, 200))  # disabled
eval_11 = EvaluateCurve(Curve=reparameterize(crv_106), Parameter=0)  # -> Point, Tangent, Angle; disabled
swatch_75 = ColourSwatch(SwatchColor=RGB(0, 0, 255))  # disabled
# Look at Rhino window
# to preview results
panel_90 = Panel(alicrvseams_4.R)
# Look at Rhino window
# to preview results
# Aligned seams
preview_86 = CustomPreview(Geometry=alicrvseams_4.Points, Shader=swatch_74)
# Original seams of the input curves,
preview_87 = CustomPreview(Geometry=alicrvseams_4.Aligned, Shader=swatch_75)
