# Grasshopper definition Pf_09-Surface.gh (Grasshopper 0.9.76)
# plug-ins: Pufferfish

number_slider = Slider(100, range=0..100)  # disabled
# 30-Extrude Tapered Polysurface
number_slider_2 = Slider(56, range=0..100)  # disabled
number_slider_3 = Slider(15.12, range=-100..100)  # disabled
# Change the slider value to move the
# mirror plane and see how it effects the
# mirror cutting.
# Change the slider value to rotate the
# mirror plane and see how it effects the
# mirror cutting.
number_slider_4 = Slider(10.125, range=-100..150)  # disabled
# 14-Unsplit Revolve Surface
# Range of degrees to revolve
number_slider_5 = Slider(0, range=0..360)  # disabled
number_slider_6 = Slider(250, range=0..360)  # disabled
# 22-Rebuild Surface
number_slider_7 = Slider(10, range=0..10)  # disabled
number_slider_8 = Slider(10, range=0..10)  # disabled
number_slider_9 = Slider(3, range=0..10)  # disabled
number_slider_10 = Slider(3, range=0..10)  # disabled
number_slider_11 = Slider(0, range=0..10)  # disabled
number_slider_12 = Slider(5, range=0..10)  # disabled
number_slider_13 = Slider(0, range=0..10)  # disabled
# 23-Remap Surface Domain²
number_slider_14 = Slider(10, range=0..10)  # disabled
# Change the slider value to move the
# mirror plane and see how it effects the
# mirror cutting.
# Change the slider value to rotate the
# mirror plane and see how it effects the
# mirror cutting.
number_slider_15 = Slider(4.849, range=-50..150)  # disabled
# 19-Offset Surface
number_slider_16 = Slider(10, range=0..10)  # disabled
# Unlike grasshoppers native iso
# trim component, this component uses
# parameter values along the u and v
# surface domains. Here we use range
# components to generate the lists
# of parameters. The native grasshopper
# component uses a division value which
# always makes an even grid on surface.
# By using parameter values there can be
# more customization of the grid spacing.
number_slider_17 = Slider(5, range=0..10)  # disabled
number_slider_18 = Slider(0.64, range=0..1)  # disabled
number_slider_19 = Slider(0.658, range=0..1)  # disabled
# Ajust the weights, If one has all the weight
# then the result is that surface. If all have same
# weight then the result is same as average.
number_slider_20 = Slider(0.865, range=0..1)  # disabled
number_slider_21 = Slider(6, range=0..10)  # disabled
# 09-Split Kinky Surface
number_slider_22 = Slider(1, range=0..10)  # disabled
# Loft types
# If you bake it, it will become
# a polysurface brep, or use the
# Split Kinky Surface component.
number_slider_23 = Slider(0, range=0..10)  # disabled
number_slider_24 = Slider(0.25, range=0..1)  # disabled
# 03-Tween Two Surfaces
# Factor from 0 to 1 determines the surface
# between inputs. So 0.5 will be halfway
# between the inputs. You can use lists /
# mutiple factors as well.
number_slider_25 = Slider(0.5, range=0..1)  # disabled
number_slider_26 = Slider(0.5, range=0..1)  # disabled
toggle = BooleanToggle(False)  # disabled
toggle_2 = BooleanToggle(True)  # disabled
toggle_3 = BooleanToggle(True)  # disabled
toggle_4 = BooleanToggle(True)  # disabled
toggle_5 = BooleanToggle(True)  # disabled
toggle_6 = BooleanToggle(True)  # disabled
toggle_7 = BooleanToggle(True)  # disabled
# True to transfer
# properties from
# reference to target
toggle_8 = BooleanToggle(True)  # disabled
# 27-Swap Surface Directions
toggle_9 = BooleanToggle(False)  # disabled
toggle_10 = BooleanToggle(False)  # disabled
# Change booleans to see how the
# UV directions of the surface change.
toggle_11 = BooleanToggle(False)  # disabled
# 21-Plane Trim Surface
# The surface that will get
# trimmed (turn its preview
# on to see the original surface)
# Can also be a polysurface
# Plane that trims
O = Origin(Point(799.3315675, 560.7123149, 0))  # disabled
number_slider_27 = Slider(30, range=0..100)  # disabled
number_slider_28 = Slider(20, range=0..100)  # disabled
number_slider_29 = Slider(0, range=0..100)  # disabled
number_slider_30 = Slider(0, range=0..100)  # disabled
# Look at Rhino window
# to preview input
srf = Surface(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)  # disabled
number_slider_31 = Slider(0.165, range=0..1)  # disabled
number_slider_32 = Slider(0.963, range=0..1)  # disabled
# Proportional scale factors for the
# input planes axes. Use same value
# for all for uniform scaling. These values
# are more like weights which balance with
# eachother like percentage overall, as
# opposed to traditional scale factors.
# They are proportional.
# The volume
# the geometry
# will scale to
number_slider_33 = Slider(0.631, range=0..1)  # disabled
number_slider_34 = Slider(0.268, range=0..1)  # disabled
number_slider_35 = Slider(0.963, range=0..1)  # disabled
# The volume
# the geometry
# will scale to
number_slider_36 = Slider(0.646, range=0..1)  # disabled
# Weights the tween distribution by curvature
# if the interpolation is not linear and degree is not 1.
toggle_12 = BooleanToggle(False)  # disabled
# 28-Constrained Volume Box
number_slider_37 = Slider(50000, range=0..50000)  # disabled
# 29-Constrained Volume Ellipsoid
number_slider_38 = Slider(50000, range=0..50000)  # disabled
# When the taper is outward you can
# have different corner options like
# rounded and smooth corners or sharp.
# Draft angle determines the taper,
# try negative value for outward taper
number_slider_39 = Slider(0, range=0..10)  # disabled
# Weights the tween distribution by curvature
# if the interpolation is not linear and degree is not 1.
# Equalizes the tween
# distribution along the
# tween path. So 0.5
# would be the middle
# of the overall tween
# path, not the middle
# input surface.
toggle_13 = BooleanToggle(False)  # disabled
# Profile to revolve
# Revolve axis
# Guide rail
toggle_14 = BooleanToggle(True)  # disabled
# 33-Mesh To Polysurface
toggle_15 = BooleanToggle(False)  # disabled
# Switch this boolean to true to
# merge coplanar faces into single faces.
# Be careful with this option on meshes
# with a lot of faces, it can be heavy.
# 34-Mirror Cut Polysurface
toggle_16 = BooleanToggle(False)  # disabled
# 35-Shell Polysurface
number_slider_40 = Slider(0, range=0..10)  # disabled
toggle_17 = BooleanToggle(True)  # disabled
# Offset surface can do both sides and solid.
# 20-Parameter Subdivide Surface
toggle_18 = BooleanToggle(True)  # disabled
# 25-Shrink Trimmed Surface
# Trimmed surface
srf_2 = Surface(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)  # disabled
# 04-Tween Two Surfaces Along Curve
# Guide curve to tween
# along. If does not even
# need to touch the surface
# to tween.
# Factor from 0 to 1 determines the surface
# between inputs. So 0.5 will be halfway
# between the inputs. You can use lists /
# mutiple factors as well.
number_slider_41 = Slider(0.352, range=0..1)  # disabled
# If true, a closed
# loft will be made
toggle_19 = BooleanToggle(False)  # disabled
# 12-Unsplit Loft Surface
# Sections to loft
crv = Curve([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])  # disabled
# You can add more removal values to
# remove multiple faces but atleast one
# face must be removed for shelling.
number_slider_42 = Slider(9.899, range=0..15)  # disabled
# Keep faces together or
# unroll as a linear array
toggle_20 = BooleanToggle(False)  # disabled
# 18-Mirror Cut Surface
panel = Panel("1")  # disabled
# 11-Unsplit  Extrude Surface
# Profile to extrude
# Direction - can be Vector, Curve, or Point
crv_2 = Curve(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)  # disabled
# 07-Automatic Edge Surface
# Edges that define
# the surface boundary
crv_3 = Curve([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])  # disabled
# 08-Automatic Network Surface
# Curve network that
# defines the surface shape
# The surface curvature type,
# the difference is usually not noticable.
crv_4 = Curve([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])  # disabled
# 10-Unsplit  Edge Surface
# Edges that define
# the surface boundary
# If you bake it, it will become
# a polysurface brep, or use the
# Split Kinky Surface component.
crv_5 = Curve([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])  # disabled
# One rail curve
# If you bake it, it will become
# a polysurface brep, or use the
# Split Kinky Surface component.
crv_6 = Curve(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)  # disabled
# 17-Fit Surface
# Surface with many
# unnecessary control
# points input
srf_3 = Surface(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)  # disabled
# 26-Superimpose Surface
srf_4 = Surface(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)  # disabled
srf_5 = Surface(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)  # disabled
srf_6 = Surface(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)  # disabled
# 31-Flip Polysurface
brep = Brep(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)  # disabled
# 32-Is Polysurface Closed
# Closed Polysurface
# Look at Rhino window
# to preview input
brep_2 = Brep(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)  # disabled
# Open Polysurface
# Look at Rhino window
# to preview input
brep_3 = Brep(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)  # disabled
# 36-Unroll Polysurface
# Optional plane to unroll to
pt = Point(Point(2082.313569, 249.9648511, 0))  # disabled
# Optional points to unroll
pt_2 = Point([Point(1869.557225, 197.7839419, 36.53503775), Point(1883.264501, 197.7839419, 40.51826645), Point(1883.264501, 197.7839419, 27.21517342)])  # disabled
# Optional curves to unroll
crv_7 = Curve(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)  # disabled
srf_7 = Surface(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)  # disabled
# 16-Unsplit Sweep Surface
# Sections to sweep
crv_8 = Curve([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])  # disabled
# 24-Reparameterize Surface
md_slider = MDSlider(slider_value=Point(0.5, 0.5, 0.5), SliderMode=0, x_domain=Domain(0, 1), y_domain=Domain(0, 1), z_domain=Domain(0, 1))  # disabled
# 37-Is Surface Closed
# Surface with a
# closed side input
# Look at Rhino window
# to preview input
# 38-Is Surface Collapsed
srf_8 = Surface(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)  # disabled
# Same as setting reparmeterize of surface
# inputs/outputs but sometimes it is nice
# to have a seperate component
srf_9 = Surface(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)  # disabled
# 02-Weighted Average Surface
# Multiple surfaces set here
srf_10 = Surface([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])  # disabled
# Surface with one edge
# collapsed, point 0 and 4
# overlap eachother
# Look at Rhino window
# to preview input
# 39-Is Surface Trimmed
srf_11 = Surface(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)  # disabled
# Pf_09-Surface
# 01-Average Surface
# Multiple surfaces set here
srf_12 = Surface([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])  # disabled
# 15-Unsplit Sum Surface
# U direction edge
crv_9 = Curve(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)  # disabled
# V direction edge
crv_10 = Curve(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)  # disabled
# 13-Unsplit Rail Revolve Surface
crv_11 = Curve(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)  # disabled
line = Line(Line((908.5192796, 1040.667346, 96.07640207), (908.5192796, 1040.667346, 0.1885564136)))  # disabled
# Locally scales the revolution,
# set to true to see how the guide
# rail shape effect more of the shape
# along the axis line.
crv_12 = Curve(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)  # disabled
mesh = Mesh(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)  # disabled
srf_13 = Surface(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)  # disabled
yz = YZPlane(Origin=O)  # disabled
# 06-Tween Through Surfaces
srf_14 = Surface(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)  # disabled
srf_15 = Surface(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)  # disabled
srf_16 = Surface(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)  # disabled
srf_17 = Surface(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)  # disabled
srf_18 = Surface(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)  # disabled
srf_19 = Surface(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)  # disabled
srf_20 = Surface(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)  # disabled
# 05-Tween Consecutive Surfaces
srf_21 = Surface(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)  # disabled
srf_22 = Surface(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)  # disabled
srf_23 = Surface(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)  # disabled
# Factor from 0 to 1 determines the surface
# between each input as a list. So 0.5 will
# be halfway between each input
# consecutively through the list.
# You can use lists / mutiple factors as well.
number_slider_43 = Slider(3, range=0..7)  # disabled
# 40-Is Surface Degree
# Look at Rhino window
# to preview input
# 41-Surface Spans
srf_24 = Surface(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)  # disabled
# Flips the mirror direction to
# cut the other side instead.
toggle_21 = BooleanToggle(False)  # disabled
# Trimmed surface
# Look at Rhino window
# to preview input
srf_25 = Surface(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)  # disabled
# Untrimmed surface
# Look at Rhino window
# to preview input
srf_26 = Surface(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)  # disabled
# Factor from 0  to 1 determines the tween surface.
# 0 is the first surface in the set, 1 is the last surface in the set.
# If for instance there are 3 surfaces in the set then 0.5
# would be the second (middle) surface, unless equalized is true.
# You can input as many surfaces as you want.
# You can use lists / mutiple factors as well.
number_slider_44 = Slider(3, range=0..7)  # disabled
# Plane the box is on
xy = XYPlane(Origin=Point(1387.067882, 345.9521907, 0))  # disabled
# Plane the ellipsoid is on
xy_2 = XYPlane(Origin=Point(1386.406989, 470.6700969, 0))  # disabled
# Determines how the tween path is interpolated.
# Determines the curvature degree of the tween path if the interpolation type is not linear.
number_slider_45 = Slider(0, range=0..3)  # disabled
xz = XZPlane(Origin=pt)  # disabled
# Determines how the tween path is interpolated.
# Determines the curvature degree of the tween path if the interpolation type is not linear.
number_slider_46 = Slider(0, range=0..3)  # disabled
# Plane
yz_2 = YZPlane(Origin=Point(520.4868808, 215.3928318, 0))  # disabled
# Polysurface to unroll
brep_4 = Brep(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)  # disabled
# Plane
yz_3 = YZPlane(Origin=Point(776.1584606, 222.8777354, 0))  # disabled
X = UnitX(Factor=number_slider_4)  # disabled
range = Range(Domain=Domain(0, 1), Steps=number_slider_17)  # disabled
X_2 = UnitX(Factor=number_slider_15)  # disabled
range_2 = Range(Domain=Domain(0, 1), Steps=number_slider_21)  # disabled
Z = UnitZ(Factor=number_slider_2)  # disabled
# Planar curve,
# closed or unclosed
crv_13 = Curve(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)  # disabled
# True merges faces and removes corner
# faces made by the tapered extrude.
toggle_22 = BooleanToggle(True)  # disabled
# Profile to revolve
crv_14 = Curve(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)  # disabled
# Revolve axis
line_2 = Line(Line((1052.357637, 1026.451159, 0), (1052.357637, 1026.451159, 95.88784566)))  # disabled
srf_27 = Surface(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)  # disabled
S = Surface(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)  # disabled
crv_15 = Curve(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)  # disabled
brep_5 = Brep(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)  # disabled
# If you bake it, it will become
# a polysurface brep, or use the
# Split Kinky Surface component.
Z_2 = UnitZ(Factor=number_slider)  # disabled
number_slider_47 = Slider(3.62, range=0..10)  # disabled
# The reach distance determines how
# far from the mirror plane that the cutting
# reaches. Anything within that distance
# from the mirror plane will be additionally
# cut away. Set it to zero and the cutting will
# only happen exactly at the mirror plane.
number_slider_48 = Slider(3.62, range=0..10)  # disabled
# If you bake it, it will become
# a polysurface brep, or use the
# Split Kinky Surface component.
dom = ConstructDomain(DomainStart=number_slider_5, DomainEnd=number_slider_6)  # disabled
dom_2 = ConstructDomain(DomainStart=number_slider_11, DomainEnd=number_slider_12)  # disabled
dom_3 = ConstructDomain(DomainStart=number_slider_13, DomainEnd=number_slider_14)  # disabled
# Optional Refit and Sample Point
# match methods. Read input descriptions.
wavsrf = WeightedAverageSurface(Surfaces=srf_10, Weights=[number_slider_18, number_slider_19, number_slider_20], Refit=0, PointSample=0)  # disabled
# Pufferfish
# By: Michael Pryor
# Optional Refit and Sample Point
# match methods. Read input descriptions.
avrsrf = AverageSurface(Surfaces=srf_12, Refit=0, PointSample=0)  # disabled
# Also works on trimmed surfaces
swapsrfdir = SwapSurfaceDirections(Surface=srf_6, ReverseU=toggle_9, ReverseV=toggle_10, SwapUV=toggle_11)  # disabled
msh2psrf = MeshToPolysurface(Mesh=mesh, Triangles=toggle_15, FaceMerge=toggle_16)  # disabled
srfpans = SurfaceSpans(Surface=srf)  # -> SubDomain²s, SubDomainU, SubDomainV, AmountU, AmountV, LengthsU, LengthsV, DegreesU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; disabled
# Also works on trimmed surfaces
supersrf = SuperimposeSurface(
    Reference=srf_4,
    Target=srf_5,
    PointsU=toggle_3,
    PointsV=toggle_2,
    DegreeU=toggle_4,
    DegreeV=toggle_5,
    DomainU=toggle_6,
    DomainV=toggle_7,
    Trims=toggle_8)  # disabled
psrfclsd = IsPolysurfaceClosed(Polysurface=brep_2)  # disabled
unsplitswp = UnsplitSweepSurface(Sections=crv_8, Rail1=crv_6)  # disabled
flippsrf = FlipPolysurface(Polysurface=brep)  # -> Flipped, R; disabled
psrfclsd_2 = IsPolysurfaceClosed(Polysurface=brep_3)  # disabled
splitkinkysrf = SplitKinkySurface(Surface=srf_7)  # -> Polysurface, R; disabled
# Also works on trimmed surfaces
offsrf = OffsetSurface(Surface=srf_13, Distance=number_slider_16, BothSides=toggle_17, CreateSolid=toggle_18)  # disabled
autonetsrf = AutomaticNetworkSurface(Network=crv_4, ContinuityType=number_slider_22)  # disabled
unsplitedge = UnsplitEdgeSurface(Edges=crv_5)  # disabled
# Also works on trimmed surfaces
fitsrf = FitSurface(Surface=srf_3, Tolerance=panel)  # -> Fitted, R; disabled
srfcollapsed = IsSurfaceCollapsed(Surface=srf_11)  # -> Edge1, Edge2, Edge3, Edge4; disabled
unsplitrailrev = UnsplitRailRevolveSurface(Profile=crv_11, Axis=line, Rail=crv_12, Scale=toggle_14)  # disabled
unsplitsum = UnsplitSumSurface(CurveA=crv_9, CurveB=crv_10)  # disabled
shrinktrimsrf = ShrinkTrimmedSurface(Surface=srf_2)  # -> Shrunken, Underlying, R; disabled
srfclsd = IsSurfaceClosed(Surface=srf_8)  # -> Closed, ClosedU, ClosedV; disabled
twn2srfs = TweenTwoSurfaces(SurfaceA=srf_19, SurfaceB=srf_20, Factor=number_slider_25, Refit=0, PointSample=0)  # disabled
autoedgsrf = AutomaticEdgeSurface(Edges=crv_3)  # disabled
unsplitloft = UnsplitLoftSurface(Sections=crv, Closed=toggle_19, LoftType=number_slider_23)  # disabled
# Also works on trimmed surfaces
reparamsrf = ReparameterizeSurface(Surface=srf_9)  # -> Reparameterized, Original; disabled
srfdeg = SurfaceDegree(Surface=srf_24)  # -> DegreeU, DegreeV; disabled
srftrimd = IsSurfaceTrimmed(Surface=srf_25)  # disabled
srftrimd_2 = IsSurfaceTrimmed(Surface=srf_26)  # disabled
number_slider_49 = Slider(20, range=0..20)  # disabled
# The offser distance determines how
# far to offset the cut. It does not do any
# additional cut removing like
# the reach plane, it just moves the
# actual cut away from the mirror plane.
# Set it to zero and there will be no
# additional gap in the mirror cut.
number_slider_50 = Slider(20, range=0..20)  # disabled
srf_28 = Surface(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)  # disabled
srf_29 = Surface(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)  # disabled
# Make domain² for surface
dom²num = ConstructDomain²(UMin=number_slider_30, UMax=number_slider_28, VMin=number_slider_29, VMax=number_slider_27)  # disabled
move = Move(Geometry=yz_2, Motion=X)  # -> Geometry, Transform; disabled
# Look at Rhino window
# to preview input
srf_30 = Surface(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)  # disabled
move_2 = Move(Geometry=yz_3, Motion=X_2)  # -> Geometry, Transform; disabled
number_slider_51 = Slider(44, range=0..360)  # disabled
number_slider_52 = Slider(32, range=0..360)  # disabled
# Flips the mirror direction to
# cut the other side instead.
toggle_23 = BooleanToggle(False)  # disabled
# Flips the mirror direction to
# cut the other side instead.
toggle_24 = BooleanToggle(False)  # disabled
unsplitextr = UnsplitExtrudeSurface(Profile=crv_2, Direction=Z_2)  # disabled
unsplitrev = UnsplitRevolveSurface(Profile=crv_14, Axis=line_2, Revolution=dom)  # disabled
consvolbox = ConstrainedVolumeBox(Plane=xy, Volume=number_slider_37, FactorX=number_slider_31, FactorY=number_slider_32, FactorZ=number_slider_33)  # -> Box, DimensionX, DimensionY, DimensionZ; disabled
extrtaper = ExtrudeTaperedPolysurface(Profile=crv_13, Direction=Z, Angle=number_slider_3, CornerType=number_slider_39, FaceMerge=toggle_22)  # disabled
paramsubdivsrf = ParameterSubdivideSurface(Surface=S, ParametersU=range_2, ParametersV=range)  # disabled
# Also works on trimmed surfaces
# and polysurfaces
plntrimsrf = PlaneTrimSurface(Surface=srf_27, Plane=yz, Flip=toggle_21)  # -> Trimmed, Intersected; disabled
shellpsrf = ShellPolysurface(Polysurface=brep_5, Removal=number_slider_40, Thickness=number_slider_42, FaceMerge=False)  # disabled
unrollpsrf = UnrollPolysurface(Polysurface=brep_4, Plane=xz, Points=pt_2, Curves=crv_7, Explode=toggle_20)  # -> Unrolled, UnrolledPoints, UnrolledCurves; disabled
consvoleli = ConstrainedVolumeEllipsoid(Plane=xy_2, Volume=number_slider_38, FactorX=number_slider_34, FactorY=number_slider_35, FactorZ=number_slider_36)  # disabled
# The surfaces original domain²
panel_2 = Panel(reparamsrf.Original)  # disabled
panel_3 = Panel(psrfclsd_2)  # disabled
# Using a polysurface brep
# that has some trimmed faces
panel_4 = Panel(srftrimd)  # disabled
panel_5 = Panel(srftrimd_2)  # disabled
panel_6 = Panel(psrfclsd)  # disabled
# True if surface was fit
panel_7 = Panel(fitsrf.R)  # disabled
srf_31 = Surface(swapsrfdir)  # disabled
# The polysurface that will get
# mirror cut (turn its preview
# on to see the original polysurface)
# Using as the mirror plane
deplane = DeconstructPlane(Plane=move.Geometry)  # -> Origin, XAxis, YAxis, ZAxis; disabled
# Look at Rhino window
# to preview results
preview = CustomPreview(
    Geometry=wavsrf,
    Shader={ambient=RGB(0, 0, 0), diffuse=RGB(255, 105, 180), emission=RGB(76, 32, 54), shine=0.5, specular=RGB(255, 255, 255), transparency=0})  # disabled
# The surface that will get
# mirror cut (turn its preview
# on to see the original surface)
# Using as the mirror plane
deplane_2 = DeconstructPlane(Plane=move_2.Geometry)  # -> Origin, XAxis, YAxis, ZAxis; disabled
# Look at Rhino window
# to preview results
preview_2 = CustomPreview(
    Geometry=avrsrf,
    Shader={ambient=RGB(0, 0, 0), diffuse=RGB(255, 105, 180), emission=RGB(76, 32, 54), shine=0.5, specular=RGB(255, 255, 255), transparency=0})  # disabled
# Look at Rhino window
# to preview results
# Optional Refit and Sample Point
# match methods. Read input descriptions.
preview_3 = CustomPreview(
    Geometry=twn2srfs,
    Shader={ambient=RGB(0, 0, 0), diffuse=RGB(255, 105, 180), emission=RGB(76, 32, 54), shine=0.5, specular=RGB(255, 255, 255), transparency=0})  # disabled
panel_8 = Panel(range_2)  # disabled
panel_9 = Panel(range)  # disabled
panel_10 = Panel(srfdeg.DegreeV)  # disabled
panel_11 = Panel(srfdeg.DegreeU)  # disabled
panel_12 = Panel(unsplitrailrev)  # disabled
# The unsplit surface components
# make polysurface like single surfaces
# from kinked (polyline) curves so
# you can use surface components
# on them such as this divide surface
# component.
sdivide = DivideSurface(Surface=unsplitrailrev, UCount=10, VCount=10)  # -> Points, Normals, Parameters; disabled
# Look at Rhino window
# to preview results
preview_4 = CustomPreview(
    Geometry=unsplitrailrev,
    Shader={ambient=RGB(0, 0, 0), diffuse=RGB(255, 105, 180), emission=RGB(76, 32, 54), shine=0.5, specular=RGB(255, 255, 255), transparency=0})  # disabled
panel_13 = Panel(unsplitloft)  # disabled
# The unsplit surface components
# make polysurface like single surfaces
# from kinked (polyline) curves so
# you can use surface components
# on them such as this divide surface
# component.
sdivide_2 = DivideSurface(Surface=unsplitloft, UCount=10, VCount=10)  # -> Points, Normals, Parameters; disabled
# Look at Rhino window
# to preview results
preview_5 = CustomPreview(
    Geometry=unsplitloft,
    Shader={ambient=RGB(0, 0, 0), diffuse=RGB(255, 105, 180), emission=RGB(76, 32, 54), shine=0.5, specular=RGB(255, 255, 255), transparency=0})  # disabled
panel_14 = Panel(shrinktrimsrf.R)  # disabled
# Look at Rhino window
# to preview results
preview_6 = CustomPreview(
    Geometry=autoedgsrf,
    Shader={ambient=RGB(0, 0, 0), diffuse=RGB(255, 105, 180), emission=RGB(76, 32, 54), shine=0.5, specular=RGB(255, 255, 255), transparency=0})  # disabled
# Look at Rhino window
# to preview results
preview_7 = CustomPreview(
    Geometry=autonetsrf,
    Shader={ambient=RGB(0, 0, 0), diffuse=RGB(255, 105, 180), emission=RGB(76, 32, 54), shine=0.5, specular=RGB(255, 255, 255), transparency=0})  # disabled
panel_15 = Panel(unsplitedge)  # disabled
# The unsplit surface components
# make polysurface like single surfaces
# from kinked (polyline) curves so
# you can use surface components
# on them such as this divide surface
# component.
sdivide_3 = DivideSurface(Surface=unsplitedge, UCount=10, VCount=10)  # -> Points, Normals, Parameters; disabled
# Look at Rhino window
# to preview results
preview_8 = CustomPreview(
    Geometry=unsplitedge,
    Shader={ambient=RGB(0, 0, 0), diffuse=RGB(255, 105, 180), emission=RGB(76, 32, 54), shine=0.5, specular=RGB(255, 255, 255), transparency=0})  # disabled
# Look at Rhino window
# to preview results
# The newly shrunk underlaying
# untrimmed surface. The output is hidden
# by default to not get in the way. Use a
# data component like it is done here
# to expose it in the viewport.
data = Data(shrinktrimsrf.Underlying)  # disabled
panel_16 = Panel(splitkinkysrf.R)  # disabled
preview_9 = CustomPreview(
    Geometry=shrinktrimsrf.Shrunken,
    Shader={ambient=RGB(0, 0, 0), diffuse=RGB(255, 105, 180), emission=RGB(76, 32, 54), shine=0.5, specular=RGB(255, 255, 255), transparency=0})  # disabled
panel_17 = Panel(srfclsd.Closed)  # disabled
# Just closed in this direction
panel_18 = Panel(srfclsd.ClosedU)  # disabled
panel_19 = Panel(srfclsd.ClosedV)  # disabled
panel_20 = Panel(splitkinkysrf.Polysurface)  # disabled
# Also works for trimmed surfaces
# and surfaces with holes.
# Look at Rhino window
# to preview results
preview_10 = CustomPreview(
    Geometry=offsrf,
    Shader={ambient=RGB(0, 0, 0), diffuse=RGB(255, 105, 180), emission=RGB(76, 32, 54), shine=0.5, specular=RGB(255, 255, 255), transparency=0})  # disabled
panel_21 = Panel(srfcollapsed.Edge2)  # disabled
panel_22 = Panel(srf_7)  # disabled
# Look at Rhino window
# to preview results
preview_11 = CustomPreview(
    Geometry=msh2psrf,
    Shader={ambient=RGB(0, 0, 0), diffuse=RGB(255, 105, 180), emission=RGB(76, 32, 54), shine=0.5, specular=RGB(255, 255, 255), transparency=0})  # disabled
panel_23 = Panel(srfcollapsed.Edge1)  # disabled
panel_24 = Panel(srfcollapsed.Edge3)  # disabled
# This edge is a singularity (collapsed)
panel_25 = Panel(srfcollapsed.Edge4)  # disabled
panel_26 = Panel(unsplitswp)  # disabled
# The unsplit surface components
# make polysurface like single surfaces
# from kinked (polyline) curves so
# you can use surface components
# on them such as this divide surface
# component.
sdivide_4 = DivideSurface(Surface=unsplitswp, UCount=10, VCount=10)  # -> Points, Normals, Parameters; disabled
# Look at Rhino window
# to preview results
preview_12 = CustomPreview(
    Geometry=unsplitswp,
    Shader={ambient=RGB(0, 0, 0), diffuse=RGB(255, 105, 180), emission=RGB(76, 32, 54), shine=0.5, specular=RGB(255, 255, 255), transparency=0})  # disabled
# Also works on trimmed surfaces
rebsrf = RebuildSurface(
    Surface=srf_18,
    CountU=number_slider_7,
    CountV=number_slider_8,
    DegreeU=number_slider_9,
    DegreeV=number_slider_10,
    DomainU=dom_2,
    DomainV=dom_3)  # disabled
twn2srfscrv = TweenTwoSurfacesAlongCurve(SurfaceA=srf_28, SurfaceB=srf_29, Guide1=crv_15, Factor=number_slider_41, Refit=0, PointSample=0)  # disabled
# Also works on trimmed surfaces
resrfdom² = RemapSurfaceDomain²(Surface=srf_30, Domain²=dom²num)  # -> Remapped, Original, New; disabled
# Look at Rhino window
# to preview results
panel_27 = Panel(flippsrf.R)  # disabled
domain² = Domain²(srf_4)  # disabled
domain²_2 = Domain²(supersrf)  # disabled
preview_13 = CustomPreview(
    Geometry=flippsrf.Flipped,
    Shader={ambient=RGB(0, 0, 0), diffuse=RGB(255, 105, 180), emission=RGB(76, 32, 54), shine=0.5, specular=RGB(255, 255, 255), transparency=0})  # disabled
# Look at Rhino window
# to preview results
preview_14 = CustomPreview(
    Geometry=supersrf,
    Shader={ambient=RGB(0, 0, 0), diffuse=RGB(255, 105, 180), emission=RGB(76, 32, 54), shine=0.5, specular=RGB(255, 255, 255), transparency=0})  # disabled
swatch = ColourSwatch(SwatchColor=RGB(0, 0, 255))  # disabled
panel_28 = Panel(plntrimsrf.Intersected)  # disabled
eval = EvaluateCurve(Curve=srf_9, Parameter=md_slider)  # -> Point, Tangent, Angle; disabled
# This allows the start and end of the grid
# to be altered on the surface so grids can
# exist only on parts of the surface.
# Look at Rhino window
# to preview results
preview_15 = CustomPreview(
    Geometry=paramsubdivsrf,
    Shader={ambient=RGB(0, 0, 0), diffuse=RGB(255, 105, 180), emission=RGB(76, 32, 54), shine=0.5, specular=RGB(255, 255, 255), transparency=0})  # disabled
edges = BrepEdges(Brep=srf_31)  # -> Naked, Interior, NonManifold; disabled
panel_29 = Panel(unsplitextr)  # disabled
# The unsplit surface components
# make polysurface like single surfaces
# from kinked (polyline) curves so
# you can use surface components
# on them such as this divide surface
# component.
sdivide_5 = DivideSurface(Surface=unsplitextr, UCount=10, VCount=10)  # -> Points, Normals, Parameters; disabled
# Look at Rhino window
# to preview results
preview_16 = CustomPreview(
    Geometry=unsplitextr,
    Shader={ambient=RGB(0, 0, 0), diffuse=RGB(255, 105, 180), emission=RGB(76, 32, 54), shine=0.5, specular=RGB(255, 255, 255), transparency=0})  # disabled
panel_30 = Panel(unsplitrev)  # disabled
# The unsplit surface components
# make polysurface like single surfaces
# from kinked (polyline) curves so
# you can use surface components
# on them such as this divide surface
# component.
sdivide_6 = DivideSurface(Surface=unsplitrev, UCount=10, VCount=10)  # -> Points, Normals, Parameters; disabled
# Look at Rhino window
# to preview results
preview_17 = CustomPreview(
    Geometry=unsplitrev,
    Shader={ambient=RGB(0, 0, 0), diffuse=RGB(255, 105, 180), emission=RGB(76, 32, 54), shine=0.5, specular=RGB(255, 255, 255), transparency=0})  # disabled
panel_31 = Panel(unsplitsum)  # disabled
# The unsplit surface components
# make polysurface like single surfaces
# from kinked (polyline) curves so
# you can use surface components
# on them such as this divide surface
# component.
sdivide_7 = DivideSurface(Surface=unsplitsum, UCount=10, VCount=10)  # -> Points, Normals, Parameters; disabled
# Look at Rhino window
# to preview results
preview_18 = CustomPreview(
    Geometry=unsplitsum,
    Shader={ambient=RGB(0, 0, 0), diffuse=RGB(255, 105, 180), emission=RGB(76, 32, 54), shine=0.5, specular=RGB(255, 255, 255), transparency=0})  # disabled
swatch_2 = ColourSwatch(SwatchColor=RGB(10, 22, 255))  # disabled
# Look at Rhino window
# to preview results
preview_19 = CustomPreview(
    Geometry=fitsrf.Fitted,
    Shader={ambient=RGB(0, 0, 0), diffuse=RGB(255, 105, 180), emission=RGB(76, 32, 54), shine=0.5, specular=RGB(255, 255, 255), transparency=0})  # disabled
swatch_3 = ColourSwatch(SwatchColor=RGB(10, 22, 255))  # disabled
# Removing multiple faces.
# Look at Rhino window
# to preview results
preview_20 = CustomPreview(
    Geometry=shellpsrf,
    Shader={ambient=RGB(0, 0, 0), diffuse=RGB(255, 105, 180), emission=RGB(76, 32, 54), shine=0.5, specular=RGB(255, 255, 255), transparency=0})  # disabled
# Optional Refit and Sample Point
# match methods. Read input descriptions.
twnconsrfs = TweenConsecutiveSurfaces(
    Surfaces=[srf_21, srf_22, srf_23],
    Factor=number_slider_26,
    Weighted=toggle_12,
    Degree=number_slider_43,
    InterpolationType=number_slider_45,
    Refit=0,
    PointSample=0)  # disabled
panel_32 = Panel(consvolbox.DimensionX)  # disabled
# Result dimensions
panel_33 = Panel(consvolbox.DimensionY)  # disabled
panel_34 = Panel(consvolbox.DimensionZ)  # disabled
twnthrusrfs = TweenThroughSurfaces(
    Surfaces=[srf_14, srf_15, srf_16, srf_17],
    Factor=number_slider_24,
    Normalized=True,
    Equalized=toggle,
    Weighted=toggle_13,
    Degree=number_slider_44,
    InterpolationType=number_slider_46,
    Refit=0,
    PointSample=0)  # disabled
volume = Volume(Geometry=consvoleli)  # -> Volume, Centroid; disabled
# Look at Rhino window
# to preview results
preview_21 = CustomPreview(
    Geometry=extrtaper,
    Shader={ambient=RGB(0, 0, 0), diffuse=RGB(255, 105, 180), emission=RGB(76, 32, 54), shine=0.5, specular=RGB(255, 255, 255), transparency=0})  # disabled
volume_2 = Volume(Geometry=consvolbox.Box)  # -> Volume, Centroid; disabled
rot3d = Rotate3D(Geometry=move.Geometry, Angle=degrees(number_slider_51), Center=deplane.Origin, Axis=deplane.YAxis)  # -> Geometry, Transform; disabled
rot3d_2 = Rotate3D(Geometry=move_2.Geometry, Angle=degrees(number_slider_52), Center=deplane_2.Origin, Axis=deplane_2.YAxis)  # -> Geometry, Transform; disabled
# Domains
panel_35 = Panel(domain²)  # disabled
# Domains
panel_36 = Panel(domain²_2)  # disabled
# Then untrimmed kinky surface
# became a Polysurface (Brep)
# Look at Rhino window
# to preview results
preview_22 = CustomPreview(
    Geometry=splitkinkysrf.Polysurface,
    Shader={ambient=RGB(0, 0, 0), diffuse=RGB(255, 105, 180), emission=RGB(76, 32, 54), shine=0.5, specular=RGB(255, 255, 255), transparency=0})  # disabled
md_slider_2 = MDSlider(slider_value=Point(0.5, 0.5, 0.5), SliderMode=0, x_domain=Domain(0, 1), y_domain=Domain(0, 1), z_domain=Domain(0, 1))  # disabled
# New surface domain²
panel_37 = Panel(resrfdom².New)  # disabled
# Original surface domain²
panel_38 = Panel(resrfdom².Original)  # disabled
toggle_25 = BooleanToggle(True)  # disabled
srfpt = SurfacePoints(Surface=srf_2)  # -> Points, Weights, Greville, UCount, VCount; disabled
srfpt_2 = SurfacePoints(Surface=shrinktrimsrf.Shrunken)  # -> Points, Weights, Greville, UCount, VCount; disabled
toggle_26 = BooleanToggle(True)  # disabled
# Look at Rhino window
# to preview results
preview_23 = CustomPreview(Geometry=plntrimsrf.Trimmed, Shader=swatch)  # disabled
# Optional Refit and Sample Point
# match methods. Read input descriptions.
swatch_4 = ColourSwatch(SwatchColor=RGB(0, 0, 255))  # disabled
item = ListItem(List=edges.Naked, Index=0, Wrap=True)  # disabled
# Join makes the
# two mirror sides
# into one surface.
# If true the entire input
# surface is mirrored
# normally if it is mirror
# cut into non existance.
toggle_27 = BooleanToggle(False)  # disabled
# Join makes the
# two mirror sides
# into one polysurface.
# If true the entire input
# polysurface is mirrored
# normally if it is mirror
# cut into non existance.
toggle_28 = BooleanToggle(False)  # disabled
# Look at Rhino window
# to preview results
preview_24 = CustomPreview(
    Geometry=consvolbox.Box,
    Shader={ambient=RGB(0, 0, 0), diffuse=RGB(255, 105, 180), emission=RGB(76, 32, 54), shine=0.5, specular=RGB(255, 255, 255), transparency=0})  # disabled
# Result volume matches
# input volume exactly
panel_39 = Panel(volume.Volume)  # disabled
# Result volume matches
# input volume exactly
panel_40 = Panel(volume_2.Volume)  # disabled
brep_6 = Brep(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)  # disabled
# Look at Rhino window
# to preview results
preview_25 = CustomPreview(
    Geometry=consvoleli,
    Shader={ambient=RGB(0, 0, 0), diffuse=RGB(255, 105, 180), emission=RGB(76, 32, 54), shine=0.5, specular=RGB(255, 255, 255), transparency=0})  # disabled
srf_32 = Surface(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)  # disabled
# Look at Rhino window
# to preview results
preview_26 = CustomPreview(Geometry=unrollpsrf.UnrolledPoints, Shader=swatch_2)  # disabled
# Look at Rhino window
# to preview results
# Look at Rhino window
# to preview results
preview_27 = CustomPreview(Geometry=unrollpsrf.UnrolledCurves, Shader=swatch_3)  # disabled
preview_28 = CustomPreview(
    Geometry=unrollpsrf.Unrolled,
    Shader={ambient=RGB(0, 0, 0), diffuse=RGB(255, 105, 180), emission=RGB(76, 32, 54), shine=0.5, specular=RGB(255, 255, 255), transparency=0})  # disabled
domain²_3 = Domain²(rebsrf)  # disabled
# View new control points
srfpt_3 = SurfacePoints(Surface=rebsrf)  # -> Points, Weights, Greville, UCount, VCount; disabled
# Look at Rhino window
# to preview results
preview_29 = CustomPreview(
    Geometry=rebsrf,
    Shader={ambient=RGB(0, 0, 0), diffuse=RGB(255, 105, 180), emission=RGB(76, 32, 54), shine=0.5, specular=RGB(255, 255, 255), transparency=0})  # disabled
number_slider_53 = Slider(1, range=0..10)  # disabled
swatch_5 = ColourSwatch(SwatchColor=RGB(0, 98, 255))  # disabled
swatch_6 = ColourSwatch(SwatchColor=RGB(30, 255, 0))  # disabled
number_slider_54 = Slider(1, range=0..10)  # disabled
# Span surface U isocurve parameters
panel_41 = Panel(srfpans.ParametersU)  # disabled
# Span surface U sub-domains
panel_42 = Panel(srfpans.SubDomainU)  # disabled
# Span surface V sub-domains
panel_43 = Panel(srfpans.SubDomainV)  # disabled
# Span surface V amount
panel_44 = Panel(srfpans.AmountV)  # disabled
# Span surface U lengths
panel_45 = Panel(srfpans.LengthsU)  # disabled
# Span surface V lengths
panel_46 = Panel(srfpans.LengthsV)  # disabled
# Span surface U degrees
panel_47 = Panel(srfpans.DegreesU)  # disabled
# Span surface V isocurve parameters
panel_48 = Panel(srfpans.ParametersV)  # disabled
# Parameter coordinates at span ends
panel_49 = Panel(srfpans.ParametersUV)  # disabled
# Span surface sub-domain²s
panel_50 = Panel(srfpans.SubDomain²s)  # disabled
# Span surface U amount
panel_51 = Panel(srfpans.AmountU)  # disabled
# Span surface V degrees
panel_52 = Panel(srfpans.DegreesV)  # disabled
end = EndPoints(Curve=item)  # -> Start, End; disabled
# When surface is not reparameterized you
# can't evaluate from 0 to 1
evalsrf = EvaluateSurface(Surface=reparamsrf.Reparameterized, Point=md_slider_2)  # -> Point, Normal, Frame; disabled
pipe = Pipe(Curve=item, Radius=1, Caps=0)  # disabled
# Look at Rhino window
# to preview results
preview_30 = CustomPreview(
    Geometry=twnconsrfs,
    Shader={ambient=RGB(0, 0, 0), diffuse=RGB(255, 105, 180), emission=RGB(76, 32, 54), shine=0.5, specular=RGB(255, 255, 255), transparency=0})  # disabled
# Using Non-Normalized Factor
# Look at Rhino window
# to preview results
# Optional Refit and Sample Point
# match methods. Read input descriptions.
preview_31 = CustomPreview(
    Geometry=twnthrusrfs,
    Shader={ambient=RGB(0, 0, 0), diffuse=RGB(255, 105, 180), emission=RGB(76, 32, 54), shine=0.5, specular=RGB(255, 255, 255), transparency=0})  # disabled
# Bulge factor for the connection surface
# When mirror cuts have a reach or offset
# that is not zero, they can create a connection
# surface between the mirror cut sides, which
# blends them together. There are various types.
number_slider_55 = Slider(0.313, range=-1..1)  # disabled
# Domains
panel_53 = Panel(domain²_3)  # disabled
# Two guide curves to tween
# along and deform between
# Look at Rhino window
# to preview results
preview_32 = CustomPreview(Geometry=twn2srfscrv, Shader=swatch_4)  # disabled
# Bulge factor for the connection surface
# When mirror cuts have a reach or offset
# that is not zero, they can create a connection
# polysurface between the mirror cut sides, which
# blends them together. There are various types.
number_slider_56 = Slider(-0.173, range=-1..1)  # disabled
# Look at Rhino window
# to preview results
# Control points after shrinking
preview_33 = CustomPreview(Geometry=srfpt_2.Points, Shader=swatch_6)  # disabled
# Look at Rhino window
# to preview results
# Control points before shrinking
preview_34 = CustomPreview(Geometry=srfpt.Points, Shader=swatch_5)  # disabled
swatch_7 = ColourSwatch(SwatchColor=RGB(0, 0, 255))  # disabled
# Visual representation of the directions
# reversing and swapping.
sph = Sphere(Base=end.Start, Radius=5)  # disabled
# Brep that has
# trimmed faces
# Look at Rhino window
# to preview input
brep_7 = Brep(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)  # disabled
number_slider_57 = Slider(10, range=0..10)  # disabled
mircutsrf = MirrorCutSurface(
    Surface=srf_32,
    MirrorPlane=rot3d_2.Geometry,
    Reach=number_slider_48,
    Offset=number_slider_50,
    Flip=toggle_24,
    Join=toggle_26,
    Keep=toggle_27,
    ConnectionType=number_slider_53,
    Bulge=number_slider_55)  # -> MirrorCut, SplitIndex, ReachPlane, OffsetPlane, Intersected; disabled
mircutpsrf = MirrorCutPolysurface(
    Polysurface=brep_6,
    MirrorPlane=rot3d.Geometry,
    Reach=number_slider_47,
    Offset=number_slider_49,
    Flip=toggle_23,
    Join=toggle_25,
    Keep=toggle_28,
    ConnectionType=number_slider_54,
    Bulge=number_slider_56)  # -> MirrorCut, SplitIndex, ReachPlane, OffsetPlane, Intersected; disabled
number_slider_58 = Slider(0.25, range=0..1)  # disabled
number_slider_59 = Slider(0.801, range=0..1)  # disabled
# Adjusting the start and end domains
# of the ranges positions the grid on
# specified parts of the surface.
number_slider_60 = Slider(0.537, range=0..1)  # disabled
number_slider_61 = Slider(0.13, range=0..1)  # disabled
# Look at Rhino window
# to preview results
preview_35 = CustomPreview(Geometry=evalsrf.Point, Shader=swatch_7)  # disabled
toggle_29 = BooleanToggle(True)  # disabled
toggle_30 = BooleanToggle(True)  # disabled
number_slider_62 = Slider(0, range=0..10)  # disabled
number_slider_63 = Slider(1, range=0..10)  # disabled
number_slider_64 = Slider(2, range=0..10)  # disabled
# Switch this boolean to true to merge
# coplanar faces into single faces.
# Be careful with this option with a lot
# of coplanar faces, it can be heavy.
number_slider_65 = Slider(9.899, range=0..15)  # disabled
srftrimd_3 = IsSurfaceTrimmed(Surface=brep_7)  # disabled
swatch_8 = ColourSwatch(SwatchColor=RGB(0, 98, 255))  # disabled
srf_33 = Surface(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)  # disabled
swatch_9 = ColourSwatch(SwatchColor=RGB(10, 255, 210))  # disabled
panel_54 = Panel(mircutpsrf.Intersected)  # disabled
swatch_10 = ColourSwatch(SwatchColor=RGB(10, 255, 210))  # disabled
swatch_11 = ColourSwatch(SwatchColor=RGB(10, 22, 255))  # disabled
swatch_12 = ColourSwatch(SwatchColor=RGB(10, 22, 255))  # disabled
panel_55 = Panel(mircutsrf.Intersected)  # disabled
toggle_31 = BooleanToggle(False)  # disabled
number_slider_66 = Slider(5, range=0..10)  # disabled
number_slider_67 = Slider(6, range=0..10)  # disabled
# Sphere which is a
# fully closed surface
# Fully closed surface
# Look at Rhino window
# to preview input
srf_34 = Surface(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)  # disabled
# True are faces that are trimmed
panel_56 = Panel(srftrimd_3)  # disabled
# Look at Rhino window
# to preview results
preview_36 = CustomPreview(Geometry=[pipe, sph], Shader=swatch_8)  # disabled
debrep = DeconstructBrep(Brep=brep_7)  # -> Faces, Edges, Vertices; disabled
brep_8 = Brep(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)  # disabled
offsrf_2 = OffsetSurface(Surface=srf_33, Distance=number_slider_57, BothSides=toggle_29, CreateSolid=toggle_30)  # disabled
# Look at Rhino window
# to preview results
# Result mirror cut polysurface
preview_37 = CustomPreview(
    Geometry=mircutpsrf.MirrorCut,
    Shader={ambient=RGB(0, 0, 0), diffuse=RGB(255, 105, 180), emission=RGB(76, 32, 54), shine=0.5, specular=RGB(255, 255, 255), transparency=0})  # disabled
preview_38 = CustomPreview(Geometry=mircutpsrf.ReachPlane, Shader=swatch_9)  # disabled
# Reach plane (this plane essentially does the cutting)
# Offset plane (offsets the cuts from the mirror plane)
preview_39 = CustomPreview(Geometry=mircutpsrf.OffsetPlane, Shader=swatch_11)  # disabled
# Look at Rhino window
# to preview results
# Result mirror cut surface
preview_40 = CustomPreview(
    Geometry=mircutsrf.MirrorCut,
    Shader={ambient=RGB(0, 0, 0), diffuse=RGB(255, 105, 180), emission=RGB(76, 32, 54), shine=0.5, specular=RGB(255, 255, 255), transparency=0})  # disabled
preview_41 = CustomPreview(Geometry=mircutsrf.ReachPlane, Shader=swatch_10)  # disabled
# Reach plane (this plane essentially does the cutting)
# Offset plane (offsets the cuts from the mirror plane)
preview_42 = CustomPreview(Geometry=mircutsrf.OffsetPlane, Shader=swatch_12)  # disabled
dom_4 = ConstructDomain(DomainStart=number_slider_58, DomainEnd=number_slider_59)  # disabled
dom_5 = ConstructDomain(DomainStart=number_slider_61, DomainEnd=number_slider_60)  # disabled
# Two rail curves
crv_16 = Curve(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)  # disabled
# Two rail curve
crv_17 = Curve(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)  # disabled
# Sections to sweep
crv_18 = Curve([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])  # disabled
# Srf@
# index 0
number_slider_68 = Slider(2.5, range=0..3)  # disabled
cull = CullPattern(List=debrep.Faces, CullPattern=srftrimd_3)  # disabled
shellpsrf_2 = ShellPolysurface(
    Polysurface=brep_8,
    Removal=[number_slider_62, number_slider_63, number_slider_64],
    Thickness=number_slider_65,
    FaceMerge=toggle_31)  # disabled
srfclsd_2 = IsSurfaceClosed(Surface=srf_34)  # -> Closed, ClosedU, ClosedV; disabled
number_slider_69 = Slider(0.633, range=0..1)  # disabled
range_3 = Range(Domain=dom_5, Steps=number_slider_66)  # disabled
range_4 = Range(Domain=dom_4, Steps=number_slider_67)  # disabled
# Profile to extrude
crv_19 = Curve(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)  # disabled
# Extrude along curve
# Curve to extrude along
crv_20 = Curve(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)  # disabled
S_2 = Surface(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)  # disabled
# Look at Rhino window
# to preview results
preview_43 = CustomPreview(
    Geometry=offsrf_2,
    Shader={ambient=RGB(0, 0, 0), diffuse=RGB(255, 105, 180), emission=RGB(76, 32, 54), shine=0.5, specular=RGB(255, 255, 255), transparency=0})  # disabled
# Srf@
# index 1
# Change boolean to False
# to turn off Normalized Factor
# When Normalized is False the factor is
# from 0 to the last index. This
# can be considered like a timeline.
# This lets each surface have an equally
# controllable section of the slider between.
# As opposed to going from 0 to 1, this lets
# you easily pinpoint your location.
# You can use lists / mutiple factors as well.
toggle_32 = BooleanToggle(False)  # disabled
unsplitswp_2 = UnsplitSweepSurface(Sections=crv_18, Rail1=crv_16, Rail2=crv_17)  # disabled
# Extract the trimmed faces
# Look at Rhino window
# to preview results
preview_44 = CustomPreview(
    Geometry=cull,
    Shader={ambient=RGB(0, 0, 0), diffuse=RGB(255, 105, 180), emission=RGB(76, 32, 54), shine=0.5, specular=RGB(255, 255, 255), transparency=0})  # disabled
srf_35 = Surface(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)  # disabled
srf_36 = Surface(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)  # disabled
srf_37 = Surface(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)  # disabled
# Crv@
# index 3
# Srf@
# index 2
srf_38 = Surface(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)  # disabled
# Second guide curve. When using two
# guide curves the tween surfaces will tween
# along them while deforming between them.
crv_21 = Curve(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)  # disabled
crv_22 = Curve(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)  # disabled
# A sphere for instance is a
# fully closed surface as solid
panel_57 = Panel(srfclsd_2.Closed)  # disabled
panel_58 = Panel(srfclsd_2.ClosedV)  # disabled
panel_59 = Panel(srfclsd_2.ClosedU)  # disabled
# Look at Rhino window
# to preview results
preview_45 = CustomPreview(
    Geometry=shellpsrf_2,
    Shader={ambient=RGB(0, 0, 0), diffuse=RGB(255, 105, 180), emission=RGB(76, 32, 54), shine=0.5, specular=RGB(255, 255, 255), transparency=0})  # disabled
unsplitextr_2 = UnsplitExtrudeSurface(Profile=crv_19, Direction=crv_20)  # disabled
paramsubdivsrf_2 = ParameterSubdivideSurface(Surface=S_2, ParametersU=range_4, ParametersV=range_3)  # disabled
srf_39 = Surface(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)  # disabled
srf_40 = Surface(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)  # disabled
# Extracting the spans or points between spans
# Look at Rhino window
# to preview input
srf_41 = Surface(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)  # disabled
# Splitting the list
sdivide_8 = DivideSurface(Surface=unsplitswp_2, UCount=10, VCount=10)  # -> Points, Normals, Parameters; disabled
# Look at Rhino window
# to preview results
preview_46 = CustomPreview(
    Geometry=unsplitswp_2,
    Shader={ambient=RGB(0, 0, 0), diffuse=RGB(255, 105, 180), emission=RGB(76, 32, 54), shine=0.5, specular=RGB(255, 255, 255), transparency=0})  # disabled
panel_60 = Panel(unsplitswp_2)  # disabled
# Look at Rhino window
# to preview input
# Remapping domain²  to a guide surface
srf_42 = Surface(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)  # disabled
# Guide surface to match domain² of
srf_43 = Surface(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)  # disabled
# Using unevenly spaced parameter
# values will result in uneven spaced
# grids. The grid spacing can be
# controlled with custom values
# such as values from graph mappers.
# Look at Rhino window
# to preview results
preview_47 = CustomPreview(
    Geometry=paramsubdivsrf_2,
    Shader={ambient=RGB(0, 0, 0), diffuse=RGB(255, 105, 180), emission=RGB(76, 32, 54), shine=0.5, specular=RGB(255, 255, 255), transparency=0})  # disabled
sdivide_9 = DivideSurface(Surface=unsplitextr_2, UCount=10, VCount=10)  # -> Points, Normals, Parameters; disabled
# Look at Rhino window
# to preview results
preview_48 = CustomPreview(
    Geometry=unsplitextr_2,
    Shader={ambient=RGB(0, 0, 0), diffuse=RGB(255, 105, 180), emission=RGB(76, 32, 54), shine=0.5, specular=RGB(255, 255, 255), transparency=0})  # disabled
panel_61 = Panel(unsplitextr_2)  # disabled
twn2srfscrv_2 = TweenTwoSurfacesAlongCurve(SurfaceA=srf_39, SurfaceB=srf_40, Guide1=crv_21, Guide2=crv_22, Factor=number_slider_69, Refit=0, PointSample=0)  # disabled
twnthrusrfs_2 = TweenThroughSurfaces(
    Surfaces=[srf_35, srf_36, srf_37, srf_38],
    Factor=number_slider_68,
    Normalized=toggle_32,
    Equalized=False,
    Weighted=False,
    Degree=3,
    InterpolationType=0,
    Refit=0,
    PointSample=0)  # disabled
srfpans_2 = SurfaceSpans(Surface=srf_41)  # -> SubDomain²s, SubDomainU, SubDomainV, AmountU, AmountV, LengthsU, LengthsV, DegreesU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; disabled
# Also works on trimmed surfaces
resrfdom²_2 = RemapSurfaceDomain²(Surface=srf_42, Guide=srf_43)  # -> Remapped, Original, New; disabled
swatch_13 = ColourSwatch(SwatchColor=RGB(0, 0, 255))  # disabled
# New surface domain²
panel_62 = Panel(resrfdom²_2.New)  # disabled
# Original surface domain²
panel_63 = Panel(resrfdom²_2.Original)  # disabled
# Optional Refit and Sample Point
# match methods. Read input descriptions.
swatch_14 = ColourSwatch(SwatchColor=RGB(0, 25, 255))  # disabled
# Look at Rhino window
# to preview results
preview_49 = CustomPreview(Geometry=twn2srfscrv_2, Shader=swatch_13)  # disabled
# You can use the sub-domain²s
# with Grasshopper's IsoTrim
# component to extract the spans
# as separate surfaces.
subsrf = Isotrim(Surface=srf_41, Domain=srfpans_2.SubDomain²s)  # disabled
# You can use the parameters with
# Grasshopper's Evaluate Surface
# component to extract the points
# between the spans.
evalsrf_2 = EvaluateSurface(Surface=srf_41, Point=srfpans_2.ParametersUV)  # -> Point, Normal, Frame; disabled
# Look at Rhino window
# to preview results
preview_50 = CustomPreview(Geometry=twnthrusrfs_2, Shader=swatch_14)  # disabled
number_slider_70 = Slider(10, range=0..10)  # disabled
number_slider_71 = Slider(10, range=0..10)  # disabled
# Splitting the list
number_slider_72 = Slider(-8.615, range=-20..20)  # disabled
number_slider_73 = Slider(-8.615, range=-20..20)  # disabled
panel_64 = Panel(subsrf)  # disabled
panel_65 = Panel(evalsrf_2.Point)  # disabled
yz_4 = YZPlane(Origin=Point(530.4016103, 400.3952381, 0))  # disabled
range_5 = Range(Domain=Domain(0, 1), Steps=number_slider_70)  # disabled
yz_5 = YZPlane(Origin=Point(772.8575256, 394.8681756, 0))  # disabled
range_6 = Range(Domain=Domain(0, 1), Steps=number_slider_71)  # disabled
X_3 = UnitX(Factor=number_slider_72)  # disabled
X_4 = UnitX(Factor=number_slider_73)  # disabled
S_3 = Surface(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)  # disabled
# Profile to extrude
crv_23 = Curve(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)  # disabled
# Extrude to point
# Point to extrude to
pt_3 = Point(Point(1293.711271, 730.3317257, 88.97271923))  # disabled
move_3 = Move(Geometry=yz_4, Motion=X_3)  # -> Geometry, Transform; disabled
move_4 = Move(Geometry=yz_5, Motion=X_4)  # -> Geometry, Transform; disabled
number_slider_74 = Slider(48, range=0..360)  # disabled
number_slider_75 = Slider(33, range=0..360)  # disabled
graph = GraphMapper(
    range_6,
    x0=0,
    x1=1,
    y0=0,
    y1=1,
    container_name="Bezier",
    cpx=[0, 0.7955461144, 0.533728838, 1],
    cpy=[0, 0.104544878, 0.4652709961, 1])  # disabled
# Graphmappers creating gradient grid spacing.
graph_2 = GraphMapper(
    range_5,
    x0=0,
    x1=1,
    y0=0,
    y1=1,
    container_name="Bezier",
    cpx=[0, 0.161364466, 0.3795443475, 1],
    cpy=[0, 0.5532698631, 0.9518182874, 1])  # disabled
unsplitextr_3 = UnsplitExtrudeSurface(Profile=crv_23, Direction=pt_3)  # disabled
number_slider_76 = Slider(2, range=0..10)  # disabled
number_slider_77 = Slider(2, range=0..10)  # disabled
deplane_3 = DeconstructPlane(Plane=move_3.Geometry)  # -> Origin, XAxis, YAxis, ZAxis; disabled
deplane_4 = DeconstructPlane(Plane=move_4.Geometry)  # -> Origin, XAxis, YAxis, ZAxis; disabled
number_slider_78 = Slider(1.676, range=0..10)  # disabled
number_slider_79 = Slider(1.676, range=0..10)  # disabled
number_slider_80 = Slider(5.36, range=0..10)  # disabled
number_slider_81 = Slider(5.36, range=0..10)  # disabled
number_slider_82 = Slider(0.006, range=-1..1)  # disabled
number_slider_83 = Slider(0.313, range=-1..1)  # disabled
toggle_33 = BooleanToggle(False)  # disabled
toggle_34 = BooleanToggle(False)  # disabled
toggle_35 = BooleanToggle(False)  # disabled
toggle_36 = BooleanToggle(False)  # disabled
toggle_37 = BooleanToggle(False)  # disabled
toggle_38 = BooleanToggle(False)  # disabled
sdivide_10 = DivideSurface(Surface=unsplitextr_3, UCount=10, VCount=10)  # -> Points, Normals, Parameters; disabled
# Look at Rhino window
# to preview results
preview_51 = CustomPreview(
    Geometry=unsplitextr_3,
    Shader={ambient=RGB(0, 0, 0), diffuse=RGB(255, 105, 180), emission=RGB(76, 32, 54), shine=0.5, specular=RGB(255, 255, 255), transparency=0})  # disabled
panel_66 = Panel(unsplitextr_3)  # disabled
paramsubdivsrf_3 = ParameterSubdivideSurface(Surface=S_3, ParametersU=graph, ParametersV=graph_2)  # disabled
rot3d_3 = Rotate3D(Geometry=move_3.Geometry, Angle=degrees(number_slider_74), Center=deplane_3.Origin, Axis=deplane_3.YAxis)  # -> Geometry, Transform; disabled
rot3d_4 = Rotate3D(Geometry=move_4.Geometry, Angle=degrees(number_slider_75), Center=deplane_4.Origin, Axis=deplane_4.YAxis)  # -> Geometry, Transform; disabled
srf_44 = Surface(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)  # disabled
brep_9 = Brep(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)  # disabled
# Look at Rhino window
# to preview results
preview_52 = CustomPreview(
    Geometry=paramsubdivsrf_3,
    Shader={ambient=RGB(0, 0, 0), diffuse=RGB(255, 105, 180), emission=RGB(76, 32, 54), shine=0.5, specular=RGB(255, 255, 255), transparency=0})  # disabled
mircutsrf_2 = MirrorCutSurface(
    Surface=srf_44,
    MirrorPlane=rot3d_4.Geometry,
    Reach=number_slider_81,
    Offset=number_slider_79,
    Flip=toggle_36,
    Join=toggle_37,
    Keep=toggle_38,
    ConnectionType=number_slider_77,
    Bulge=number_slider_83)  # -> MirrorCut, SplitIndex, ReachPlane, OffsetPlane, Intersected; disabled
mircutpsrf_2 = MirrorCutPolysurface(
    Polysurface=brep_9,
    MirrorPlane=rot3d_3.Geometry,
    Reach=number_slider_80,
    Offset=number_slider_78,
    Flip=toggle_33,
    Join=toggle_34,
    Keep=toggle_35,
    ConnectionType=number_slider_76,
    Bulge=number_slider_82)  # -> MirrorCut, SplitIndex, ReachPlane, OffsetPlane, Intersected; disabled
split = SplitList(List=mircutpsrf_2.MirrorCut, Index=mircutpsrf_2.SplitIndex)  # -> ListA, ListB; disabled
split_2 = SplitList(List=mircutsrf_2.MirrorCut, Index=mircutsrf_2.SplitIndex)  # -> ListA, ListB; disabled
swatch_15 = ColourSwatch(SwatchColor=RGB(10, 255, 210))  # disabled
# If  join is false you can use this index
# to split the list at the mirror seam.
swatch_16 = ColourSwatch(SwatchColor=RGB(10, 22, 255))  # disabled
swatch_17 = ColourSwatch(SwatchColor=RGB(10, 255, 210))  # disabled
# If  join is false you can use this index
# to split the list at the mirror seam.
swatch_18 = ColourSwatch(SwatchColor=RGB(10, 22, 255))  # disabled
preview_53 = CustomPreview(Geometry=split.ListA, Shader=swatch_17)  # disabled
# Look at Rhino window
# to preview results
preview_54 = CustomPreview(Geometry=split.ListB, Shader=swatch_18)  # disabled
preview_55 = CustomPreview(Geometry=split_2.ListA, Shader=swatch_15)  # disabled
# Look at Rhino window
# to preview results
preview_56 = CustomPreview(Geometry=split_2.ListB, Shader=swatch_16)  # disabled
