# Grasshopper definition Pf_10-Mesh.gh (Grasshopper 0.9.76)
# plug-ins: Pufferfish

# 15-Reduce Mesh
number_slider = Slider(20, range=0..100)  # disabled
# Change the slider value to move the
# mirror plane and see how it effects the
# mirror cutting.
# Change the slider value to rotate the
# mirror plane and see how it effects the
# mirror cutting.
number_slider_2 = Slider(-2.6, range=-100..100)  # disabled
number_slider_3 = Slider(5, range=0..10)  # disabled
number_slider_4 = Slider(5, range=0..10)  # disabled
number_slider_5 = Slider(0.935, range=0..1)  # disabled
number_slider_6 = Slider(0.122, range=0..1)  # disabled
# Ajust the weights, If one has all the weight
# then the result is that mesh. If all have same
# weight then the result is same as average.
number_slider_7 = Slider(0.409, range=0..1)  # disabled
# 06-Parameter Rectangle Mesh
number_slider_8 = Slider(6, range=0..10)  # disabled
# 07-Parameter Surface Mesh
number_slider_9 = Slider(6, range=0..10)  # disabled
# 14-Recursive Morph Mesh
# Number of steps
# Mesh geometry to morph
number_slider_10 = Slider(3, range=0..4)  # disabled
number_slider_11 = Slider(0, range=0..10)  # disabled
# 11-Offset Mesh
number_slider_12 = Slider(5.625, range=0..10)  # disabled
number_slider_13 = Slider(0.25, range=0..1)  # disabled
number_slider_14 = Slider(1, range=0..10)  # disabled
number_slider_15 = Slider(0.5, range=0..1)  # disabled
# 03-Tween Two Meshes
# Factor from 0 to 1 determines the mesh
# between inputs. So 0.5 will be halfway
# between the inputs. You can use lists /
# mutiple factors as well.
number_slider_16 = Slider(0.5, range=0..1)  # disabled
toggle = BooleanToggle(False)  # disabled
# Many options to
# clean and fix a mesh
number_slider_17 = Slider(0, range=0..1)  # disabled
# Weights the tween distribution by curvature
# if the interpolation is not linear and degree is not 1.
toggle_2 = BooleanToggle(False)  # disabled
# 12-Plane Trim Mesh
# The mesh that will get
# trimmed (turn its preview
# on to see the original mesh)
# Plane that trims
# Flips the mirror direction to
# cut the other side instead.
O = Origin(Point(498.194458, 536.5426636, 2.482121468))  # disabled
# Weights the tween distribution by curvature
# if the interpolation is not linear and degree is not 1.
# Equalizes the tween
# distribution along the
# tween path. So 0.5
# would be the middle
# of the overall tween
# path, not the middle
# input mesh.
toggle_3 = BooleanToggle(False)  # disabled
# 09-Close Mesh
# Try and make quads
# 10-Mirror Cut Mesh
toggle_4 = BooleanToggle(True)  # disabled
# 08-Polyline To Mesh
# Try and make quads
toggle_5 = BooleanToggle(True)  # disabled
toggle_6 = BooleanToggle(True)  # disabled
toggle_7 = BooleanToggle(True)  # disabled
# Read input descriptions
toggle_8 = BooleanToggle(False)  # disabled
toggle_9 = BooleanToggle(True)  # disabled
# Look at Rhino window
# to preview input
# Opened mesh
mesh = Mesh(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)  # disabled
# 16-Is Mesh Closed
# Look at Rhino window
# to preview input
# Closed mesh
mesh_2 = Mesh(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)  # disabled
# Thickness height of the morphed mesh geometry
number_slider_18 = Slider(3, range=0..10)  # disabled
# 02-Weighted Average Mesh
# Multiple meshes input
mesh_3 = Mesh([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])  # disabled
# Initial base mesh to start morphing onto
mesh_4 = Mesh(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)  # disabled
mesh_5 = Mesh(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)  # disabled
# Pf_10-Mesh
# 01-Average Mesh
# Multiple meshes input
mesh_6 = Mesh([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])  # disabled
# Open mesh input
mesh_7 = Mesh(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)  # disabled
yz = YZPlane(Origin=O)  # disabled
crv = Curve(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)  # disabled
# Factor from 0 to 1 determines the mesh
# between each input as a list. So 0.5 will
# be halfway between each input
# consecutively through the list.
# You can use lists / mutiple factors as well.
number_slider_19 = Slider(3, range=0..7)  # disabled
# 13-Rebuild Mesh
toggle_10 = BooleanToggle(False)  # disabled
toggle_11 = BooleanToggle(False)  # disabled
toggle_12 = BooleanToggle(False)  # disabled
toggle_13 = BooleanToggle(False)  # disabled
# With weld you use a value for distance.
# If set to 0 there is no welding. If set
# greater then zero then vertices within that
# numbers proximity to eachother will weld.
# Try increasing the slider and see how the
# gap of the mesh welds together in Rhino.
toggle_14 = BooleanToggle(False)  # disabled
mesh_8 = Mesh(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)  # disabled
mesh_9 = Mesh(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)  # disabled
mesh_10 = Mesh(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)  # disabled
# 05-Tween Through Meshes
mesh_11 = Mesh(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)  # disabled
mesh_12 = Mesh(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)  # disabled
mesh_13 = Mesh(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)  # disabled
# Offset mesh can do both sides and solid.
mesh_14 = Mesh(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)  # disabled
# 04-Tween Consecutive Meshes
mesh_15 = Mesh(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)  # disabled
mesh_16 = Mesh(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)  # disabled
# Triangulate
# Unlike grasshoppers native mesh plane
# component, this component uses
# parameter values along the u and v
# surface domains. Here we use range
# components to generate the lists
# of parameters. The native grasshopper
# component uses a division value which
# always makes an even grid on surface.
# By using parameter values there can be
# more customization of the grid spacing.
toggle_15 = BooleanToggle(False)  # disabled
toggle_16 = BooleanToggle(False)  # disabled
# Enable mesh component to run reduce component.
mesh_17 = Mesh(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)  # disabled
# Triangulate
# Unlike grasshoppers native mesh surface
# component, this component uses
# parameter values along the u and v
# surface domains. Here we use range
# components to generate the lists
# of parameters. The native grasshopper
# component uses a division value which
# always makes an even grid on surface.
# By using parameter values there can be
# more customization of the grid spacing.
toggle_17 = BooleanToggle(False)  # disabled
# Factor from 0  to 1 determines the tween mesh.
# 0 is the first mesh in the set, 1 is the last mesh in the set.
# If for instance there are 3 meshes in the set then 0.5
# would be the second (middle) mesh, unless equalized is true.
# You can input as many meshes as you want.
# You can use lists / mutiple factors as well.
number_slider_20 = Slider(3, range=0..7)  # disabled
# Determines how the tween path is interpolated.
# Determines the curvature degree of the tween path if the interpolation type is not linear.
number_slider_21 = Slider(0, range=0..3)  # disabled
# Determines how to trim
number_slider_22 = Slider(0, range=0..10)  # disabled
# Determines how the tween path is interpolated.
# Determines the curvature degree of the tween path if the interpolation type is not linear.
number_slider_23 = Slider(0, range=0..3)  # disabled
# Plane
yz_2 = YZPlane(Origin=Point(504.0497437, 172.2830658, 0))  # disabled
range = Range(Domain=Domain(0, 1), Steps=number_slider_3)  # disabled
range_2 = Range(Domain=Domain(0, 1), Steps=number_slider_8)  # disabled
X = UnitX(Factor=number_slider_2)  # disabled
range_3 = Range(Domain=Domain(0, 1), Steps=number_slider_4)  # disabled
range_4 = Range(Domain=Domain(0, 1), Steps=number_slider_9)  # disabled
mesh_18 = Mesh(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)  # disabled
mesh_19 = Mesh(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)  # disabled
crv_2 = Curve(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)  # disabled
S = Surface(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)  # disabled
# The reach distance determines how
# far from the mirror plane that the cutting
# reaches. Anything within that distance
# from the mirror plane will be additionally
# cut away. Set it to zero and the cutting will
# only happen exactly at the mirror plane.
number_slider_24 = Slider(2.724, range=0..10)  # disabled
avrmsh = AverageMesh(Meshes=mesh_6)  # disabled
wavmsh = WeightedAverageMesh(Meshes=mesh_3, Weights=[number_slider_5, number_slider_6, number_slider_7])  # disabled
pline2msh = PolylineToMesh(Polyline=crv, Quadrangulate=toggle_5)  # disabled
offmsh = OffsetMesh(Mesh=mesh_14, Distance=number_slider_12, BothSides=toggle_6, CreateSolid=toggle_7)  # disabled
mshclsd = IsMeshClosed(Mesh=mesh_2)  # disabled
clsmsh = CloseMesh(Mesh=mesh_7, Quadrangulate=toggle_4)  # -> Closed, R; disabled
mshclsd_2 = IsMeshClosed(Mesh=mesh)  # disabled
twn2mshs = TweenTwoMeshes(MeshA=mesh_9, MeshB=mesh_8, Factor=number_slider_16)  # disabled
bbox = BoundingBox(Content=mesh_5, Plane=PlaneXY(0, 0, 0))  # -> Box, Box_2; disabled
# The offser distance determines how
# far to offset the cut. It does not do any
# additional cut removing like
# the reach plane, it just moves the
# actual cut away from the mirror plane.
# Set it to zero and there will be no
# additional gap in the mirror cut.
number_slider_25 = Slider(24.145, range=0..100)  # disabled
move = Move(Geometry=yz_2, Motion=X)  # -> Geometry, Transform; disabled
number_slider_26 = Slider(77, range=0..360)  # disabled
# Flips the mirror direction to
# cut the other side instead.
toggle_18 = BooleanToggle(False)  # disabled
paramrecmsh = ParameterRectangleMesh(Rectangle=crv_2, ParametersX=range_2, ParametersY=range, Triangulate=toggle_15)  # disabled
paramsrfmsh = ParameterSurfaceMesh(Surface=S, ParametersU=range_4, ParametersV=range_3, Triangulate=toggle_17)  # disabled
plntrimmsh = PlaneTrimMesh(Mesh=mesh_19, Plane=yz, Flip=toggle_16, TrimType=number_slider_22)  # -> Trimmed, Intersected; disabled
# You can see a progress meter
# of the mesh reduction in the
# Rhino command line.
redumsh = ReduceMesh(
    Mesh=mesh_17,
    FaceCount=number_slider,
    Accuracy=number_slider_14,
    FaceType=number_slider_11,
    Distort=toggle_9,
    Normalize=toggle_8)  # -> Reduced, CountDifference; disabled
rebmsh = RebuildMesh(
    Mesh=mesh_18,
    RebuildNormals=toggle_10,
    CullUnused=toggle_11,
    UnifyNormals=toggle_12,
    FlipNormals=toggle_13,
    IdenticalCombine=toggle_14,
    WeldVertices=number_slider_17)  # disabled
# Look at Rhino window
# to preview results
preview = CustomPreview(
    Geometry=wavmsh,
    Shader={ambient=RGB(0, 0, 0), diffuse=RGB(255, 105, 180), emission=RGB(76, 32, 54), shine=0.5, specular=RGB(255, 255, 255), transparency=0})  # disabled
# Look at Rhino window
# to preview results
preview_2 = CustomPreview(
    Geometry=pline2msh,
    Shader={ambient=RGB(0, 0, 0), diffuse=RGB(255, 105, 180), emission=RGB(76, 32, 54), shine=0.5, specular=RGB(255, 255, 255), transparency=0})  # disabled
# Pufferfish
# By: Michael Pryor
# Look at Rhino window
# to preview results
preview_3 = CustomPreview(
    Geometry=avrmsh,
    Shader={ambient=RGB(0, 0, 0), diffuse=RGB(255, 105, 180), emission=RGB(76, 32, 54), shine=0.5, specular=RGB(255, 255, 255), transparency=0})  # disabled
# Using as the mirror plane
deplane = DeconstructPlane(Plane=move.Geometry)  # -> Origin, XAxis, YAxis, ZAxis; disabled
# Look at Rhino window
# to preview results
preview_4 = CustomPreview(
    Geometry=offmsh,
    Shader={ambient=RGB(0, 0, 0), diffuse=RGB(255, 105, 180), emission=RGB(76, 32, 54), shine=0.5, specular=RGB(255, 255, 255), transparency=0})  # disabled
# Look at Rhino window
# to preview results
preview_5 = CustomPreview(
    Geometry=twn2mshs,
    Shader={ambient=RGB(0, 0, 0), diffuse=RGB(255, 105, 180), emission=RGB(76, 32, 54), shine=0.5, specular=RGB(255, 255, 255), transparency=0})  # disabled
panel = Panel(range_2)  # disabled
panel_2 = Panel(range)  # disabled
panel_3 = Panel(range_4)  # disabled
panel_4 = Panel(range_3)  # disabled
panel_5 = Panel(mshclsd)  # disabled
# Vertice welding distance
remorphmsh = RecursiveMorphMesh(
    BaseMesh=mesh_4,
    Steps=number_slider_10,
    Meshes=mesh_5,
    References=bbox.Box,
    Thicknesses=number_slider_18,
    WeldVertices=0.01)  # disabled
panel_6 = Panel(mshclsd_2)  # disabled
# Look at Rhino window
# to preview results
# True if mesh was closed
panel_7 = Panel(clsmsh.R)  # disabled
preview_6 = CustomPreview(
    Geometry=clsmsh.Closed,
    Shader={ambient=RGB(0, 0, 0), diffuse=RGB(255, 105, 180), emission=RGB(76, 32, 54), shine=0.5, specular=RGB(255, 255, 255), transparency=0})  # disabled
panel_8 = Panel(plntrimmsh.Intersected)  # disabled
# This allows the start and end of the mesh
# to be altered in the rectangle so grids can
# exist only in parts of the rectangle.
# Look at Rhino window
# to preview results
preview_7 = CustomPreview(
    Geometry=paramrecmsh,
    Shader={ambient=RGB(0, 0, 0), diffuse=RGB(255, 105, 180), emission=RGB(76, 32, 54), shine=0.5, specular=RGB(255, 255, 255), transparency=0})  # disabled
# This allows the start and end of the mesh
# to be altered on the surface so grids can
# exist only on parts of the surface.
# Look at Rhino window
# to preview results
preview_8 = CustomPreview(
    Geometry=paramsrfmsh,
    Shader={ambient=RGB(0, 0, 0), diffuse=RGB(255, 105, 180), emission=RGB(76, 32, 54), shine=0.5, specular=RGB(255, 255, 255), transparency=0})  # disabled
# Look at Rhino window
# to preview results
preview_9 = CustomPreview(
    Geometry=plntrimmsh.Trimmed,
    Shader={ambient=RGB(0, 0, 0), diffuse=RGB(255, 105, 180), emission=RGB(76, 32, 54), shine=0.5, specular=RGB(255, 255, 255), transparency=0})  # disabled
# Look at Rhino window
# to preview results
# Face count difference
panel_9 = Panel(redumsh.CountDifference)  # disabled
twnthrumshs = TweenThroughMeshes(
    Meshes=[mesh_11, mesh_12, mesh_13],
    Factor=number_slider_13,
    Normalized=True,
    Equalized=toggle,
    Weighted=toggle_3,
    Degree=number_slider_20,
    InterpolationType=number_slider_23)  # disabled
twnconmshs = TweenConsecutiveMeshes(
    Meshes=[mesh_15, mesh_16, mesh_10],
    Factor=number_slider_15,
    Weighted=toggle_2,
    Degree=number_slider_19,
    InterpolationType=number_slider_21)  # disabled
# Look at Rhino window
# to preview results
preview_10 = CustomPreview(
    Geometry=rebmsh,
    Shader={ambient=RGB(0, 0, 0), diffuse=RGB(255, 105, 180), emission=RGB(76, 32, 54), shine=0.5, specular=RGB(255, 255, 255), transparency=0})  # disabled
preview_11 = CustomPreview(
    Geometry=redumsh.Reduced,
    Shader={ambient=RGB(0, 0, 0), diffuse=RGB(255, 105, 180), emission=RGB(76, 32, 54), shine=0.5, specular=RGB(255, 255, 255), transparency=0})  # disabled
rot3d = Rotate3D(Geometry=move.Geometry, Angle=degrees(number_slider_26), Center=deplane.Origin, Axis=deplane.YAxis)  # -> Geometry, Transform; disabled
toggle_19 = BooleanToggle(True)  # disabled
# Use a different mesh geometry
# to morph for each recursion step
# Look at Rhino window
# to preview results
preview_12 = CustomPreview(
    Geometry=remorphmsh,
    Shader={ambient=RGB(0, 0, 0), diffuse=RGB(255, 105, 180), emission=RGB(76, 32, 54), shine=0.5, specular=RGB(255, 255, 255), transparency=0})  # disabled
# Join makes the
# two mirror sides
# into one mesh.
# If true the entire input
# mesh is mirrored
# normally if it is mirror
# cut into non existance.
toggle_20 = BooleanToggle(False)  # disabled
number_slider_27 = Slider(2, range=0..10)  # disabled
# Using Non-Normalized Factor
# Look at Rhino window
# to preview results
preview_13 = CustomPreview(
    Geometry=twnthrumshs,
    Shader={ambient=RGB(0, 0, 0), diffuse=RGB(255, 105, 180), emission=RGB(76, 32, 54), shine=0.5, specular=RGB(255, 255, 255), transparency=0})  # disabled
# Look at Rhino window
# to preview results
preview_14 = CustomPreview(
    Geometry=twnconmshs,
    Shader={ambient=RGB(0, 0, 0), diffuse=RGB(255, 105, 180), emission=RGB(76, 32, 54), shine=0.5, specular=RGB(255, 255, 255), transparency=0})  # disabled
# Bulge factor for the connection mesh
# When mirror cuts have a reach or offset
# that is not zero, they can create a connection
# mesh between the mirror cut sides, which
# blends them together. There are various types.
number_slider_28 = Slider(-0.596, range=-1..1)  # disabled
# The mesh that will get
# mirror cut (turn its preview
# on to see the original mesh)
mesh_20 = Mesh(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)  # disabled
number_slider_29 = Slider(0.25, range=0..1)  # disabled
number_slider_30 = Slider(0.801, range=0..1)  # disabled
number_slider_31 = Slider(0.25, range=0..1)  # disabled
number_slider_32 = Slider(0.801, range=0..1)  # disabled
# Adjusting the start and end domains
# of the ranges positions the grid on
# specified parts of the surface.
number_slider_33 = Slider(0.537, range=0..1)  # disabled
# Adjusting the start and end domains
# of the ranges positions the grid on
# specified parts of the surface.
number_slider_34 = Slider(0.537, range=0..1)  # disabled
number_slider_35 = Slider(0.13, range=0..1)  # disabled
number_slider_36 = Slider(0.13, range=0..1)  # disabled
# Number of mesh face divisions
# along the connection mesh
number_slider_37 = Slider(4, range=0..10)  # disabled
mircutmsh = MirrorCutMesh(
    Mesh=mesh_20,
    MirrorPlane=rot3d.Geometry,
    Reach=number_slider_24,
    Offset=number_slider_25,
    Flip=toggle_18,
    Join=toggle_19,
    Keep=toggle_20,
    ConnectionType=number_slider_27,
    Bulge=number_slider_28,
    Divisions=number_slider_37,
    WeldVertices=0.01)  # -> MirrorCut, SplitIndex, ReachPlane, OffsetPlane, Intersected; disabled
number_slider_38 = Slider(5, range=0..10)  # disabled
number_slider_39 = Slider(5, range=0..10)  # disabled
number_slider_40 = Slider(6, range=0..10)  # disabled
number_slider_41 = Slider(6, range=0..10)  # disabled
# Msh@
# index 0
number_slider_42 = Slider(1.5, range=0..2)  # disabled
dom = ConstructDomain(DomainStart=number_slider_29, DomainEnd=number_slider_30)  # disabled
dom_2 = ConstructDomain(DomainStart=number_slider_35, DomainEnd=number_slider_33)  # disabled
dom_3 = ConstructDomain(DomainStart=number_slider_31, DomainEnd=number_slider_32)  # disabled
dom_4 = ConstructDomain(DomainStart=number_slider_36, DomainEnd=number_slider_34)  # disabled
# Change boolean to False
# to turn off Normalized Factor
# When Normalized is False the factor is
# from 0 to the last index. This
# can be considered like a timeline.
# This lets each mesh have an equally
# controllable section of the slider between.
# As opposed to going from 0 to 1, this lets
# you easily pinpoint your location.
# You can use lists / mutiple factors as well.
toggle_21 = BooleanToggle(False)  # disabled
swatch = ColourSwatch(SwatchColor=RGB(10, 255, 210))  # disabled
swatch_2 = ColourSwatch(SwatchColor=RGB(10, 22, 255))  # disabled
# Welding tolerance for join. You usually
# won't need to change this unless for
# some reason the mesh does not weld.
panel_10 = Panel(mircutmsh.Intersected)  # disabled
range_5 = Range(Domain=dom_2, Steps=number_slider_38)  # disabled
range_6 = Range(Domain=dom, Steps=number_slider_40)  # disabled
mesh_21 = Mesh(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)  # disabled
mesh_22 = Mesh(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)  # disabled
# Msh@
# index 1
# Msh@
# index 2
mesh_23 = Mesh(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)  # disabled
range_7 = Range(Domain=dom_4, Steps=number_slider_39)  # disabled
range_8 = Range(Domain=dom_3, Steps=number_slider_41)  # disabled
crv_3 = Curve(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)  # disabled
S_2 = Surface(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)  # disabled
# Triangulate
toggle_22 = BooleanToggle(False)  # disabled
# Triangulate
toggle_23 = BooleanToggle(False)  # disabled
# You can use a different thickenss
# for each recursion step as well
number_slider_43 = Slider(1.526, range=0..10)  # disabled
# Mesh geometry to
# morph in first step
mesh_24 = Mesh(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)  # disabled
# Mesh geometry to
# morph in second step
mesh_25 = Mesh(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)  # disabled
# Mesh geometry to
# morph in third and
# every step after
# unless more mesh
# geometries are added.
mesh_26 = Mesh(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)  # disabled
number_slider_44 = Slider(7.398, range=0..10)  # disabled
number_slider_45 = Slider(4.882, range=0..10)  # disabled
# Look at Rhino window
# to preview results
# Result mirror cut mesh
preview_15 = CustomPreview(
    Geometry=mircutmsh.MirrorCut,
    Shader={ambient=RGB(0, 0, 0), diffuse=RGB(255, 105, 180), emission=RGB(76, 32, 54), shine=0.5, specular=RGB(255, 255, 255), transparency=0})  # disabled
preview_16 = CustomPreview(Geometry=mircutmsh.ReachPlane, Shader=swatch)  # disabled
# Reach plane (this plane essentially does the cutting)
# Offset plane (offsets the cuts from the mirror plane)
preview_17 = CustomPreview(Geometry=mircutmsh.OffsetPlane, Shader=swatch_2)  # disabled
paramsrfmsh_2 = ParameterSurfaceMesh(Surface=S_2, ParametersU=range_8, ParametersV=range_7, Triangulate=toggle_23)  # disabled
paramrecmsh_2 = ParameterRectangleMesh(Rectangle=crv_3, ParametersX=range_6, ParametersY=range_5, Triangulate=toggle_22)  # disabled
# Number of steps
number_slider_46 = Slider(3, range=0..4)  # disabled
twnthrumshs_2 = TweenThroughMeshes(
    Meshes=[mesh_21, mesh_22, mesh_23],
    Factor=number_slider_42,
    Normalized=toggle_21,
    Equalized=False,
    Weighted=False,
    Degree=3,
    InterpolationType=0)  # disabled
# Using unevenly spaced parameter
# values will result in uneven spaced
# faces. The face spacing can be
# controlled with custom values
# such as values from graph mappers.
# Look at Rhino window
# to preview results
preview_18 = CustomPreview(
    Geometry=paramrecmsh_2,
    Shader={ambient=RGB(0, 0, 0), diffuse=RGB(255, 105, 180), emission=RGB(76, 32, 54), shine=0.5, specular=RGB(255, 255, 255), transparency=0})  # disabled
# Look at Rhino window
# to preview results
preview_19 = CustomPreview(
    Geometry=paramsrfmsh_2,
    Shader={ambient=RGB(0, 0, 0), diffuse=RGB(255, 105, 180), emission=RGB(76, 32, 54), shine=0.5, specular=RGB(255, 255, 255), transparency=0})  # disabled
merge = Merge(Data1=mesh_24, Data2=mesh_25, Data3=mesh_26)  # disabled
# You shouldnt have more mesh geometries or
# thicknessees than number of recursion steps,
# using split list we can control the number of meshes
# and thicknesses we use when the step count is
# lower than the mesh or thickness list lengths.
merge_2 = Merge(Data1=number_slider_44, Data2=number_slider_45, Data3=number_slider_43)  # disabled
# Initial base mesh to start morphing onto
mesh_27 = Mesh(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)  # disabled
swatch_3 = ColourSwatch(SwatchColor=RGB(47, 0, 255))  # disabled
split = SplitList(List=merge, Index=number_slider_46)  # -> ListA, ListB; disabled
split_2 = SplitList(List=merge_2, Index=number_slider_46)  # -> ListA, ListB; disabled
# Look at Rhino window
# to preview results
preview_20 = CustomPreview(Geometry=twnthrumshs_2, Shader=swatch_3)  # disabled
bbox_2 = BoundingBox(Content=split.ListA, Plane=PlaneXY(0, 0, 0))  # -> Box, Box_2; disabled
number_slider_47 = Slider(10, range=0..10)  # disabled
number_slider_48 = Slider(10, range=0..10)  # disabled
number_slider_49 = Slider(10, range=0..10)  # disabled
number_slider_50 = Slider(10, range=0..10)  # disabled
remorphmsh_2 = RecursiveMorphMesh(
    BaseMesh=mesh_27,
    Steps=number_slider_46,
    Meshes=split.ListA,
    References=bbox_2.Box,
    Thicknesses=split_2.ListA,
    WeldVertices=0.01)  # disabled
# Splitting the list
number_slider_51 = Slider(20, range=-20..20)  # disabled
range_9 = Range(Domain=Domain(0, 1), Steps=number_slider_48)  # disabled
range_10 = Range(Domain=Domain(0, 1), Steps=number_slider_47)  # disabled
range_11 = Range(Domain=Domain(0, 1), Steps=number_slider_49)  # disabled
range_12 = Range(Domain=Domain(0, 1), Steps=number_slider_50)  # disabled
crv_4 = Curve(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)  # disabled
S_3 = Surface(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)  # disabled
# Look at Rhino window
# to preview results
preview_21 = CustomPreview(
    Geometry=remorphmsh_2,
    Shader={ambient=RGB(0, 0, 0), diffuse=RGB(255, 105, 180), emission=RGB(76, 32, 54), shine=0.5, specular=RGB(255, 255, 255), transparency=0})  # disabled
graph = GraphMapper(
    range_10,
    x0=0,
    x1=1,
    y0=0,
    y1=1,
    container_name="Bezier",
    cpx=[0, 0.7955461144, 0.533728838, 1],
    cpy=[0, 0.104544878, 0.4652709961, 1])  # disabled
# Graphmappers creating gradient grid spacing.
graph_2 = GraphMapper(
    range_9,
    x0=0,
    x1=1,
    y0=0,
    y1=1,
    container_name="Bezier",
    cpx=[0, 0.161364466, 0.3795443475, 1],
    cpy=[0, 0.5532698631, 0.9518182874, 1])  # disabled
graph_3 = GraphMapper(
    range_12,
    x0=0,
    x1=1,
    y0=0,
    y1=1,
    container_name="Bezier",
    cpx=[0, 0.7955461144, 0.533728838, 1],
    cpy=[0, 0.104544878, 0.4652709961, 1])  # disabled
# Graphmappers creating gradient grid spacing.
graph_4 = GraphMapper(
    range_11,
    x0=0,
    x1=1,
    y0=0,
    y1=1,
    container_name="Bezier",
    cpx=[0, 0.161364466, 0.3795443475, 1],
    cpy=[0, 0.5532698631, 0.9518182874, 1])  # disabled
yz_3 = YZPlane(Origin=Point(504.0497437, 352.1925049, 0))  # disabled
X_2 = UnitX(Factor=number_slider_51)  # disabled
move_2 = Move(Geometry=yz_3, Motion=X_2)  # -> Geometry, Transform; disabled
number_slider_52 = Slider(204, range=0..360)  # disabled
# Triangulate
toggle_24 = BooleanToggle(False)  # disabled
# Triangulate
toggle_25 = BooleanToggle(False)  # disabled
number_slider_53 = Slider(1, range=0..10)  # disabled
number_slider_54 = Slider(4, range=0..10)  # disabled
deplane_2 = DeconstructPlane(Plane=move_2.Geometry)  # -> Origin, XAxis, YAxis, ZAxis; disabled
number_slider_55 = Slider(47.976, range=0..100)  # disabled
number_slider_56 = Slider(5.648, range=0..10)  # disabled
number_slider_57 = Slider(-0.634, range=-1..1)  # disabled
paramrecmsh_3 = ParameterRectangleMesh(Rectangle=crv_4, ParametersX=graph, ParametersY=graph_2, Triangulate=toggle_24)  # disabled
paramsrfmsh_3 = ParameterSurfaceMesh(Surface=S_3, ParametersU=graph_3, ParametersV=graph_4, Triangulate=toggle_25)  # disabled
toggle_26 = BooleanToggle(False)  # disabled
toggle_27 = BooleanToggle(False)  # disabled
toggle_28 = BooleanToggle(False)  # disabled
rot3d_2 = Rotate3D(Geometry=move_2.Geometry, Angle=degrees(number_slider_52), Center=deplane_2.Origin, Axis=deplane_2.YAxis)  # -> Geometry, Transform; disabled
mesh_28 = Mesh(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)  # disabled
# Look at Rhino window
# to preview results
preview_22 = CustomPreview(
    Geometry=paramrecmsh_3,
    Shader={ambient=RGB(0, 0, 0), diffuse=RGB(255, 105, 180), emission=RGB(76, 32, 54), shine=0.5, specular=RGB(255, 255, 255), transparency=0})  # disabled
preview_23 = CustomPreview(
    Geometry=paramsrfmsh_3,
    Shader={ambient=RGB(0, 0, 0), diffuse=RGB(255, 105, 180), emission=RGB(76, 32, 54), shine=0.5, specular=RGB(255, 255, 255), transparency=0})  # disabled
mircutmsh_2 = MirrorCutMesh(
    Mesh=mesh_28,
    MirrorPlane=rot3d_2.Geometry,
    Reach=number_slider_56,
    Offset=number_slider_55,
    Flip=toggle_27,
    Join=toggle_28,
    Keep=toggle_26,
    ConnectionType=number_slider_53,
    Bulge=number_slider_57,
    Divisions=number_slider_54,
    WeldVertices=0.01)  # -> MirrorCut, SplitIndex, ReachPlane, OffsetPlane, Intersected; disabled
split_3 = SplitList(List=mircutmsh_2.MirrorCut, Index=mircutmsh_2.SplitIndex)  # -> ListA, ListB; disabled
# If  join is false you can use this index
# to split the list at the mirror seam.
swatch_4 = ColourSwatch(SwatchColor=RGB(10, 22, 255))  # disabled
swatch_5 = ColourSwatch(SwatchColor=RGB(10, 255, 210))  # disabled
preview_24 = CustomPreview(Geometry=split_3.ListA, Shader=swatch_5)  # disabled
# Look at Rhino window
# to preview results
preview_25 = CustomPreview(Geometry=split_3.ListB, Shader=swatch_4)  # disabled
