# Grasshopper definition Pf_11-Twisted Box.gh (Grasshopper 0.9.76)
# plug-ins: Pufferfish

# 20-Twisted Box Pipe Variable
number_slider = Slider(17, range=0..100)  # disabled
number_slider_2 = Slider(-18, range=-30..30)  # disabled
number_slider_3 = Slider(29, range=-30..30)  # disabled
# 15-Twisted Box Curve
# This component uses parameter values
# along the curve domain. Here we use a
# range component to generate the lists
# of parameters. By using parameter
# values there can be more customization
# of the spacing.
number_slider_4 = Slider(20, range=0..100)  # disabled
number_slider_5 = Slider(17, range=0..100)  # disabled
number_slider_6 = Slider(17, range=0..100)  # disabled
# Separate U divisions for each V,
# Graphmappers can let you change
# the division spacing.
number_slider_7 = Slider(17, range=0..100)  # disabled
# Thickness of the strip
number_slider_8 = Slider(17, range=0..100)  # disabled
# 30-Domain Twisted Box
number_slider_9 = Slider(-11, range=-30..30)  # disabled
number_slider_10 = Slider(16, range=-30..30)  # disabled
number_slider_11 = Slider(-6, range=-30..30)  # disabled
# Factor from 0 to 1 determines the twisted box
# between inputs. So 0.5 will be halfway
# between the inputs. You can use lists /
# mutiple factors as well.
number_slider_12 = Slider(0.5, range=0..1)  # disabled
# Non quadrilateral
# Direction - can be Vector, Curve, or Point
number_slider_13 = Slider(36, range=0..100)  # disabled
number_slider_14 = Slider(5, range=0..10)  # disabled
number_slider_15 = Slider(17, range=0..100)  # disabled
# 31-Reference Twisted Box
number_slider_16 = Slider(10, range=-30..30)  # disabled
number_slider_17 = Slider(8, range=0..10)  # disabled
number_slider_18 = Slider(17, range=0..100)  # disabled
number_slider_19 = Slider(17, range=0..100)  # disabled
number_slider_20 = Slider(17, range=0..100)  # disabled
# Separate T divisions for each rail curve,
# Graphmappers can let you change
# the division spacing.
number_slider_21 = Slider(17, range=0..100)  # disabled
# 41-Deconstruct Twisted Box
# Change the integer to select
# which part of the twisted box
# to deconstruct. Either the
# corner points, edge lines,
# or face polylines.
number_slider_22 = Slider(0, range=0..10)  # disabled
number_slider_23 = Slider(0.36, range=0..1)  # disabled
number_slider_24 = Slider(0.13, range=0..1)  # disabled
# Ajust the weights, If one has all the weight
# then the result is that twisted box. If all have
# same weight then the result is same as average.
# 03-Tween Two Twisted Boxes
number_slider_25 = Slider(0.93, range=0..1)  # disabled
# Thickness of the strip
number_slider_26 = Slider(7, range=0..10)  # disabled
number_slider_27 = Slider(0.5, range=0..1)  # disabled
# Thickness of the strips
number_slider_28 = Slider(12, range=0..20)  # disabled
number_slider_29 = Slider(0.25, range=0..1)  # disabled
# 19-Twisted Box Pipe
number_slider_30 = Slider(17, range=0..100)  # disabled
# 21-Twisted Box Strip
number_slider_31 = Slider(10, range=0..10)  # disabled
number_slider_32 = Slider(10, range=0..10)  # disabled
# 23-Twisted Box Strips
number_slider_33 = Slider(6, range=0..20)  # disabled
# This component uses parameter values
# along the thickness domain. Here we use
# a range component to generate the lists
# of parameters. By using parameter
# values there can be more customization
# of the spacing.
number_slider_34 = Slider(3, range=0..10)  # disabled
# 16-Twisted Box Curve Variable
number_slider_35 = Slider(18, range=0..100)  # disabled
number_slider_36 = Slider(1, range=0..5)  # disabled
number_slider_37 = Slider(2, range=0..5)  # disabled
number_slider_38 = Slider(10.105, range=0..100)  # disabled
number_slider_39 = Slider(21.808, range=0..100)  # disabled
# Weights the division distribution by curvature
# if the curve is not linear and degree is not 1.
number_slider_40 = Slider(-8.058, range=-20..20)  # disabled
number_slider_41 = Slider(3.497, range=-20..20)  # disabled
number_slider_42 = Slider(-4.576, range=-20..20)  # disabled
# Domain sizes of the
# twisted boxes from
# the curve. You can use
# single numbers also.
# For easy symmetrical
# sizes use Pufferfish's
# "Two Way Domain" component
number_slider_43 = Slider(9.86, range=-20..20)  # disabled
# 17-Twisted Box Extrude
panel = Panel("1")  # disabled
number_slider_44 = Slider(15, range=0..100)  # disabled
number_slider_45 = Slider(12, range=0..100)  # disabled
# 29-Center Twisted Box
number_slider_46 = Slider(14, range=0..100)  # disabled
number_slider_47 = Slider(-36, range=-100..100)  # disabled
# Vector for each corner point to deform
# (in this case 2 vectors because 2 points)
# 33-Mesh Boolean Twisted Boxes [Multi-Threaded]
number_slider_48 = Slider(40, range=0..100)  # disabled
number_slider_49 = Slider(4, range=0..10)  # disabled
number_slider_50 = Slider(2, range=0..100)  # disabled
number_slider_51 = Slider(6, range=0..100)  # disabled
# 27-Twisted Box Tube Variable
number_slider_52 = Slider(28, range=0..100)  # disabled
number_slider_53 = Slider(1.293, range=0..5)  # disabled
number_slider_54 = Slider(0.318, range=0..5)  # disabled
number_slider_55 = Slider(4.254, range=0..100)  # disabled
number_slider_56 = Slider(8.935, range=0..100)  # disabled
number_slider_57 = Slider(0.683, range=0..10)  # disabled
toggle = BooleanToggle(False)  # disabled
number_slider_58 = Slider(43, range=0..100)  # disabled
# 14-Twisted Box Array
# Box defines the size of the array.
# Any box can be used.
number_slider_59 = Slider(50, range=0..100)  # disabled
number_slider_60 = Slider(58, range=0..100)  # disabled
number_slider_61 = Slider(15, range=0..20)  # disabled
# 42-Evaluate Twisted Box
number_slider_62 = Slider(0.574, range=0..1)  # disabled
number_slider_63 = Slider(0.248, range=0..1)  # disabled
number_slider_64 = Slider(0.785, range=0..1)  # disabled
# Determines the twisted box corner
# locations in the surface
# Weights the u division distribution by curvature
# if the curve is not linear and degree is not 1.
number_slider_65 = Slider(0.75, range=0..1)  # disabled
# 34-Mesh Trim Twisted Boxes [Multi-Threaded]
number_slider_66 = Slider(15, range=0..20)  # disabled
# 35-Plane Trim Twisted Boxes [Multi-Threaded]
number_slider_67 = Slider(15, range=0..20)  # disabled
# 36-Polysurface Boolean Twisted Boxes [Multi-Threaded]
number_slider_68 = Slider(15, range=0..20)  # disabled
# 37-Surface Trim Twisted Boxes [Multi-Threaded]
number_slider_69 = Slider(15, range=0..20)  # disabled
# Weights the tween distribution by curvature
# if the interpolation is not linear and degree is not 1.
toggle_2 = BooleanToggle(False)  # disabled
number_slider_70 = Slider(0.5, range=0..1)  # disabled
number_slider_71 = Slider(0, range=0..1)  # disabled
number_slider_72 = Slider(0.26, range=0..1)  # disabled
panel_2 = Panel("1")  # disabled
# 18-Twisted Box Loft
toggle_3 = BooleanToggle(False)  # disabled
number_slider_73 = Slider(2, range=0..10)  # disabled
number_slider_74 = Slider(4, range=0..10)  # disabled
# 26-Twisted Box Tube
number_slider_75 = Slider(13, range=0..100)  # disabled
number_slider_76 = Slider(5, range=0..10)  # disabled
number_slider_77 = Slider(4, range=0..10)  # disabled
number_slider_78 = Slider(3, range=0..100)  # disabled
number_slider_79 = Slider(6, range=0..10)  # disabled
# This component uses parameter values
# along the mesh thickness domain. Here we
# use a range component to generate the lists
# of parameters. By using parameter values
# there can be more customization of the spacing.
number_slider_80 = Slider(2, range=0..10)  # disabled
# This component uses parameter values
# along the surface domain. Here we use
# range components to generate the lists
# of parameters. By using parameter
# values there can be more customization
# of the spacing.
number_slider_81 = Slider(2, range=0..10)  # disabled
number_slider_82 = Slider(2, range=0..10)  # disabled
number_slider_83 = Slider(2, range=0..10)  # disabled
number_slider_84 = Slider(6, range=0..10)  # disabled
# This component uses parameter values
# along the box domain. Here we use
# range components to generate the lists
# of parameters. By using parameter
# values there can be more customization
# of the spacing.
number_slider_85 = Slider(5, range=0..10)  # disabled
# Weights the tween distribution by curvature
# if the interpolation is not linear and degree is not 1.
# Equalizes the tween
# distribution along the
# tween path. So 0.5
# would be the middle
# of the overall tween
# path, not the middle
# input twisted box.
toggle_4 = BooleanToggle(False)  # disabled
number_slider_86 = Slider(3, range=0..100)  # disabled
number_slider_87 = Slider(6, range=0..10)  # disabled
# 08-Twisted Box Two Meshes
# This component uses parameter values
# between the meshes thickness domain. Here we
# use a range component to generate the lists
# of parameters. By using parameter values
# there can be more customization of the spacing.
number_slider_88 = Slider(2, range=0..10)  # disabled
# 09-Twisted Box Two Surfaces
number_slider_89 = Slider(3, range=0..100)  # disabled
number_slider_90 = Slider(6, range=0..10)  # disabled
number_slider_91 = Slider(3, range=0..100)  # disabled
number_slider_92 = Slider(6, range=0..10)  # disabled
number_slider_93 = Slider(3, range=0..100)  # disabled
# 43-Twisted Box Centers
# Change the integer to select
# which part of the twisted box
# to get the center of. Either the
# corner points, edge lines,
# or face polylines.
number_slider_94 = Slider(0, range=0..10)  # disabled
# 12-Twisted Box Through Meshes
mesh = Mesh([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])  # disabled
# 38-Subdivide Twisted Box
# Count is the subdivision
# iteration. Be careful as recursion
# is exponetial and can quickly
# generate a lot of geometry.
# 39-Thicken Twisted Box
number_slider_95 = Slider(2, range=0..10)  # disabled
# 13-Twisted Box Through Surfaces
srf = Surface([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])  # disabled
addition = Addition(A=number_slider_35, B=panel)  # disabled
number_slider_96 = Slider(-8.058, range=-20..20)  # disabled
# Domain offset of the
# twisted boxes from
# the curve. You can use
# single numbers also.
number_slider_97 = Slider(3.497, range=-20..20)  # disabled
# 11-Twisted Box Consecutive Surfaces
srf_2 = Surface([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])  # disabled
# 44-Twisted Box Corners
# Input can be
# a box also
# Faster than converting to Brep
# and keeps the corner point order
tbox = TwistedBox({C=Point(9.434291702, -451.3340058, 3.42147918), C=Point(29.08855508, -451.3340058, 10.31291601), C=Point(29.08855508, -424.1094375, 10.31291601), C=Point(9.434291702, -424.1094375, 3.42147918), C=Point(-18.21964268, -457.0595706, 31.31779612), C=Point(4.728705022, -454.1233813, 43.10665076), C=Point(15.58320709, -429.156265, 43.10665076), C=Point(-2.441331509, -421.320062, 31.31779612)})  # disabled
# 40-Construct Twisted Box
# Each list of 8 points
# will make a twisted box
pt = Point([Point(36.799002, -262.8733535, -6.770521539), Point(67.13795178, -258.5800082, -1.834673377), Point(60.67299073, -235.0701612, -5.130762752), Point(47.38449389, -210.626525, -10.85627703), Point(36.01440544, -255.6552959, 22.47890964), Point(53.94523378, -254.887404, 19.32843667), Point(61.14259391, -228.1635375, 18.89532396), Point(33.8362313, -228.9942799, 11.84655581)])  # disabled
# 10-Twisted Box Consecutive Meshes
mesh_2 = Mesh([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])  # disabled
# Mesh to trim with
# Move the mesh to see how the trimming changes
number_slider_98 = Slider(54, range=0..200)  # disabled
# Mesh to trim with
# Move the mesh to see how the trimming changes
number_slider_99 = Slider(86.272, range=0..200)  # disabled
# Plane to trim with
# Move the plane to see how the trimming changes
number_slider_100 = Slider(65.472, range=0..200)  # disabled
# 45-Twisted Box Volume
# Input can be
# a box also
tbox_2 = TwistedBox({C=Point(80.68216627, -450.7589373, 3.42147918), C=Point(100.3364296, -463.9627252, 10.31291601), C=Point(115.6246692, -423.5343691, 10.31291601), C=Point(80.68216627, -423.5343691, 3.42147918), C=Point(62.20306794, -456.4845022, 31.31779612), C=Point(81.04492082, -453.5483129, 43.10665076), C=Point(91.89942289, -428.5811965, 43.10665076), C=Point(73.87488428, -420.7449935, 31.31779612)})  # disabled
# Multiple types
# of curves work.
crv = Curve([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])  # disabled
# Polysurface to trim with
# Move the polysurface to see how the trimming changes
number_slider_101 = Slider(109.232, range=0..200)  # disabled
# Surface to trim with
# Move the mesh to see how the trimming changes
number_slider_102 = Slider(69.12, range=0..200)  # disabled
# Factor from 0 to 1 determines the twisted box
# between each input as a list. So 0.5 will
# be halfway between each input
# consecutively through the list.
# You can use lists / mutiple factors as well.
number_slider_103 = Slider(3, range=0..7)  # disabled
# Pf_11-Twisted Box
# 01-Average Twisted Box
# Inputs can be
# a box also
tbox_3 = TwistedBox({C=Point(0.2767163542, -2.885417957, 2.848093993), C=Point(11.98361996, -0.6798435998, 8.131637228), C=Point(11.77944181, 5.034487917, -0.8745563705), C=Point(0.2767163542, 7.042854922, -1.296386917), C=Point(0.8508071702, 3.732387969, 18.70131772), C=Point(12.35353262, 7.113097098, 16.87352001), C=Point(12.19686514, 11.70660347, 9.87581275), C=Point(0.9104268514, 12.02702404, 17.17204554)})  # disabled
tbox_4 = TwistedBox({C=Point(-4.853529641, 37.64169373, 14.8223935), C=Point(-0.5781370408, 30.93001684, 14.19478221), C=Point(7.448365413, 37.40224869, 15.27984079), C=Point(1.090906942, 46.08260893, 17.84926463), C=Point(-11.80844474, 30.04218679, 22.30910542), C=Point(-1.567506245, 31.98562418, 28.50821515), C=Point(-8.327535232, 39.75976106, 31.04952635), C=Point(-12.47271797, 37.52423645, 26.14588654)})  # disabled
# 02-Weighted Average Twisted Box
tbox_5 = TwistedBox({C=Point(31.55401253, 37.64169373, 7.15216462), C=Point(35.82940513, 30.93001684, 6.52455333), C=Point(43.85590758, 37.40224869, 7.609611906), C=Point(37.49844911, 46.08260893, 3.013852335), C=Point(23.58224597, 41.23451945, 14.63887654), C=Point(21.26124436, 31.07249595, 20.83798627), C=Point(34.36312396, 34.1528845, 23.37929747), C=Point(33.97499093, 43.56728227, 18.47565766)})  # disabled
# Inputs can be
# a box also
tbox_6 = TwistedBox({C=Point(95.27671635, -2.885417957, 2.848093993), C=Point(106.98362, -0.6798435998, 8.131637228), C=Point(106.7794418, 5.034487917, -0.8745563705), C=Point(95.27671635, 7.042854922, -1.296386917), C=Point(95.85080717, 3.732387969, 18.70131772), C=Point(107.3535326, 7.113097098, 16.87352001), C=Point(107.1968651, 11.70660347, 9.87581275), C=Point(95.91042685, 12.02702404, 17.17204554)})  # disabled
tbox_7 = TwistedBox({C=Point(90.14647036, 37.64169373, 14.8223935), C=Point(94.42186296, 30.93001684, 14.19478221), C=Point(102.4483654, 37.40224869, 15.27984079), C=Point(96.09090694, 46.08260893, 17.84926463), C=Point(83.19155526, 30.04218679, 22.30910542), C=Point(93.43249375, 31.98562418, 28.50821515), C=Point(86.67246477, 39.75976106, 31.04952635), C=Point(82.52728203, 37.52423645, 26.14588654)})  # disabled
tbox_8 = TwistedBox({C=Point(126.5540125, 37.64169373, 7.15216462), C=Point(130.8294051, 30.93001684, 6.52455333), C=Point(138.8559076, 37.40224869, 7.609611906), C=Point(132.4984491, 46.08260893, 3.013852335), C=Point(118.582246, 41.23451945, 14.63887654), C=Point(116.2612444, 31.07249595, 20.83798627), C=Point(129.363124, 34.1528845, 23.37929747), C=Point(128.9749909, 43.56728227, 18.47565766)})  # disabled
# Inputs can be
# a box also
tbox_9 = TwistedBox({C=Point(190.1464704, 37.64169373, 14.8223935), C=Point(194.421863, 30.93001684, 14.19478221), C=Point(202.4483654, 37.40224869, 15.27984079), C=Point(196.0909069, 46.08260893, 17.84926463), C=Point(183.1915553, 30.04218679, 22.30910542), C=Point(193.4324938, 31.98562418, 28.50821515), C=Point(186.6724648, 39.75976106, 31.04952635), C=Point(182.527282, 37.52423645, 26.14588654)})  # disabled
tbox_10 = TwistedBox({C=Point(226.5540125, 37.64169373, 7.15216462), C=Point(230.8294051, 30.93001684, 6.52455333), C=Point(238.8559076, 37.40224869, 7.609611906), C=Point(232.4984491, 46.08260893, 3.013852335), C=Point(218.582246, 41.23451945, 14.63887654), C=Point(216.2612444, 31.07249595, 20.83798627), C=Point(229.363124, 34.1528845, 23.37929747), C=Point(228.9749909, 43.56728227, 18.47565766)})  # disabled
# 04-Tween Consecutive Twisted Boxes
# Inputs can be
# a box also
tbox_11 = TwistedBox({C=Point(319.2767164, -2.885417957, 2.848093993), C=Point(330.98362, -0.6798435998, 8.131637228), C=Point(330.7794418, 5.034487917, -0.8745563705), C=Point(319.2767164, 7.042854922, -1.296386917), C=Point(319.8508072, 3.732387969, 18.70131772), C=Point(331.3535326, 7.113097098, 16.87352001), C=Point(331.1968651, 11.70660347, 9.87581275), C=Point(319.9104269, 12.02702404, 17.17204554)})  # disabled
tbox_12 = TwistedBox({C=Point(314.1464704, 37.64169373, 14.8223935), C=Point(318.421863, 30.93001684, 14.19478221), C=Point(326.4483654, 37.40224869, 15.27984079), C=Point(320.0909069, 46.08260893, 17.84926463), C=Point(307.1915553, 30.04218679, 22.30910542), C=Point(317.4324938, 31.98562418, 28.50821515), C=Point(310.6724648, 39.75976106, 31.04952635), C=Point(306.527282, 37.52423645, 26.14588654)})  # disabled
tbox_13 = TwistedBox({C=Point(350.5540125, 37.64169373, 7.15216462), C=Point(354.8294051, 30.93001684, 6.52455333), C=Point(362.8559076, 37.40224869, 7.609611906), C=Point(356.4984491, 46.08260893, 3.013852335), C=Point(342.582246, 41.23451945, 14.63887654), C=Point(340.2612444, 31.07249595, 20.83798627), C=Point(353.363124, 34.1528845, 23.37929747), C=Point(352.9749909, 43.56728227, 18.47565766)})  # disabled
addition_2 = Addition(A=number_slider_52, B=panel_2)  # disabled
# Look at Rhino window
# to preview input
# Brep that was initially made with a
# Rhino Box.
geo = Geometry(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)  # disabled
# 28-2Pt Twisted Box
pt_2 = Point(Point(-0.7132974382, -148.0944444, 0))  # disabled
pt_3 = Point(Point(17.38468439, -162.7949443, 27.36352223))  # disabled
# Weights the division distribution by curvature
# if the interpolation is not linear and degree is not 1.
toggle_5 = BooleanToggle(False)  # disabled
# Weights the division distribution by curvature
# if the curve is not linear and degree is not 1.
number_slider_104 = Slider(30, range=0..100)  # disabled
# Diameter and thickness
number_slider_105 = Slider(8, range=0..100)  # disabled
# 06-Twisted Box Mesh
number_slider_106 = Slider(30, range=0..100)  # disabled
# 07-Twisted Box Surface
number_slider_107 = Slider(10, range=0..100)  # disabled
# Set to true to
# make a closed loft.
swatch = ColourSwatch(SwatchColor=RGB(255, 0, 255))  # disabled
tbox_14 = TwistedBox({C=Point(439.1464704, 37.64169373, 14.8223935), C=Point(443.421863, 30.93001684, 14.19478221), C=Point(451.4483654, 37.40224869, 15.27984079), C=Point(445.0909069, 46.08260893, 17.84926463), C=Point(432.1915553, 30.04218679, 22.30910542), C=Point(442.4324938, 31.98562418, 28.50821515), C=Point(435.6724648, 39.75976106, 31.04952635), C=Point(431.527282, 37.52423645, 26.14588654)})  # disabled
tbox_15 = TwistedBox({C=Point(475.5540125, 37.64169373, 7.15216462), C=Point(479.8294051, 30.93001684, 6.52455333), C=Point(487.8559076, 37.40224869, 7.609611906), C=Point(481.4984491, 46.08260893, 3.013852335), C=Point(467.582246, 41.23451945, 14.63887654), C=Point(465.2612444, 31.07249595, 20.83798627), C=Point(478.363124, 34.1528845, 23.37929747), C=Point(477.9749909, 43.56728227, 18.47565766)})  # disabled
# 05-Tween Through Twisted Boxes
# Inputs can be
# a box also
tbox_16 = TwistedBox({C=Point(444.2767164, -2.885417957, 2.848093993), C=Point(455.98362, -0.6798435998, 8.131637228), C=Point(455.7794418, 5.034487917, -0.8745563705), C=Point(444.2767164, 7.042854922, -1.296386917), C=Point(444.8508072, 3.732387969, 18.70131772), C=Point(456.3535326, 7.113097098, 16.87352001), C=Point(456.1968651, 11.70660347, 9.87581275), C=Point(444.9104269, 12.02702404, 17.17204554)})  # disabled
# Determines how the tween path is interpolated.
# Determines the curvature degree of the tween path if the interpolation type is not linear.
number_slider_108 = Slider(0, range=0..3)  # disabled
# Factor from 0  to 1 determines the tween twisted box.
# 0 is the first twisted box in the set, 1 is the last twisted box in the set.
# If for instance there are 3 twisted boxes in the set then 0.5
# would be the second (middle) twisted box, unless equalized is true.
# You can input as many twisted boxes as you want.
# You can use lists / mutiple factors as well.
number_slider_109 = Slider(3, range=0..7)  # disabled
# Weights the division distribution by curvature
# if the rails are not linear and degree is not 1.
toggle_6 = BooleanToggle(False)  # disabled
# Weights the division distribution by curvature
# if the rails are not linear and degree is not 1.
toggle_7 = BooleanToggle(False)  # disabled
# Weights the division distribution by curvature
# if the rails are not linear and degree is not 1.
# 25-Twisted Box Sweep Variable
toggle_8 = BooleanToggle(False)  # disabled
# Thickness factor
number_slider_110 = Slider(0.823, range=0..1)  # disabled
toggle_9 = BooleanToggle(False)  # disabled
toggle_10 = BooleanToggle(False)  # disabled
# 32-Deform Twisted Box
# Input can be
# a box also
tbox_17 = TwistedBox({C=Point(-3.584041856, -627.4952361, 3.638681958), C=Point(35.05237618, -627.4952361, 3.638681958), C=Point(35.05237618, -592.621845, 3.638681958), C=Point(-3.584041856, -592.621845, 3.638681958), C=Point(-3.584041856, -627.4952361, 35.43837563), C=Point(35.05237618, -627.4952361, 35.43837563), C=Point(35.05237618, -592.621845, 35.43837563), C=Point(-3.584041856, -592.621845, 35.43837563)})  # disabled
# Corner points to deform,
# or points that deform the
# closest corner point.
pt_4 = Point([Point(-5.50551615, -629.4579956, 0), Point(26.87759787, -594.7407118, 51.55892794)])  # disabled
# Weights the division distribution by curvature
# if the interpolation is not linear and degree is not 1.
toggle_11 = BooleanToggle(False)  # disabled
# Determines how the tween path is interpolated.
# Determines the curvature degree of the tween path if the interpolation type is not linear.
number_slider_111 = Slider(0, range=0..3)  # disabled
# Determines the twisted box corner
# locations in the surface
# Weights the u division distribution by curvature
# if the curve is not linear and degree is not 1.
number_slider_112 = Slider(0.75, range=0..1)  # disabled
number_slider_113 = Slider(0.5, range=0..1)  # disabled
number_slider_114 = Slider(0, range=0..1)  # disabled
number_slider_115 = Slider(0.25, range=0..1)  # disabled
# Surface
srf_3 = Surface(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)  # disabled
number_slider_116 = Slider(3, range=0..7)  # disabled
# The curve should be quadrilateral. If it
# is not, it will be converted. Triangles are
# also acceptable. Curves can be opened
# or closed. Can be surfaces also.
# Quadrilateral
crv_2 = Curve(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)  # disabled
# Triangle
crv_3 = Curve(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)  # disabled
crv_4 = Curve(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)  # disabled
# Opened
crv_5 = Curve(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)  # disabled
# Input can be
# a box also
tbox_18 = TwistedBox({C=Point(-8.683444932, -370.2027664, 0), C=Point(10.97081845, -370.2027664, 0), C=Point(10.97081845, -342.9781981, 0), C=Point(-8.683444932, -342.9781981, 0), C=Point(-18.21964268, -375.9283312, 32.79373475), C=Point(4.728705022, -372.9921419, 32.79373475), C=Point(15.58320709, -348.0250256, 32.79373475), C=Point(-2.441331509, -340.1888226, 32.79373475)})  # disabled
range = Range(Domain=Domain(0, 1), Steps=number_slider_4)  # disabled
# Weights the division distribution by curvature
# if the interpolation is not linear and degree is not 1.
# Equalizes the division
# distribution along the
# interpolation path. So 0.5
# would be the middle
# of the overall interpolation
# path, not the middle
# input mesh.
toggle_12 = BooleanToggle(False)  # disabled
# Weights the division distribution by curvature
# if the interpolation is not linear and degree is not 1.
# Equalizes the division
# distribution along the
# interpolation path. So 0.5
# would be the middle
# of the overall interpolation
# path, not the middle
# input surface.
toggle_13 = BooleanToggle(False)  # disabled
# Rail curves
crv_6 = Curve(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)  # disabled
crv_7 = Curve(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)  # disabled
crv_8 = Curve(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)  # disabled
crv_9 = Curve(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)  # disabled
# Rail curves
crv_10 = Curve(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)  # disabled
crv_11 = Curve(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)  # disabled
# Rail curves
crv_12 = Curve(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)  # disabled
crv_13 = Curve(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)  # disabled
# Rail curves
crv_14 = Curve([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])  # disabled
range_2 = Range(Domain=Domain(0, 1), Steps=number_slider)  # disabled
range_3 = Range(Domain=Domain(0, 1), Steps=number_slider_5)  # disabled
range_4 = Range(Domain=Domain(0, 1), Steps=number_slider_6)  # disabled
range_5 = Range(Domain=Domain(0, 1), Steps=number_slider_7)  # disabled
range_6 = Range(Domain=Domain(0, 1), Steps=number_slider_26)  # disabled
range_7 = Range(Domain=Domain(0, 1), Steps=number_slider_8)  # disabled
# Separate T divisions for each rail,
# Graphmappers can let you change
# the division spacing.
range_8 = Range(Domain=Domain(0, 1), Steps=number_slider_15)  # disabled
range_9 = Range(Domain=Domain(0, 1), Steps=number_slider_28)  # disabled
range_10 = Range(Domain=Domain(0, 1), Steps=number_slider_17)  # disabled
# Input can be
# a box also
tbox_19 = TwistedBox({C=Point(-63.200998, -262.8733535, -6.770521539), C=Point(-32.86204822, -258.5800082, -1.834673377), C=Point(-39.32700927, -235.0701612, -5.130762752), C=Point(-52.61550611, -210.626525, -10.85627703), C=Point(-63.98559456, -255.6552959, 22.47890964), C=Point(-46.05476622, -254.887404, 19.32843667), C=Point(-38.85740609, -228.1635375, 18.89532396), C=Point(-66.1637687, -228.9942799, 11.84655581)})  # disabled
range_11 = Range(Domain=Domain(0, 1), Steps=number_slider_18)  # disabled
range_12 = Range(Domain=Domain(0, 1), Steps=number_slider_19)  # disabled
range_13 = Range(Domain=Domain(0, 1), Steps=number_slider_20)  # disabled
range_14 = Range(Domain=Domain(0, 1), Steps=number_slider_21)  # disabled
range_15 = Range(Domain=Domain(0, 1), Steps=number_slider_14)  # disabled
range_16 = Range(Domain=Domain(0, 1), Steps=number_slider_34)  # disabled
# Rotation around twisted box centers
number_slider_117 = Slider(360, range=-1000..1000)  # disabled
swatch_2 = ColourSwatch(SwatchColor=RGB(255, 0, 255))  # disabled
# This component uses parameter values
# along the extrusion domain. Here we use a
# range component to generate the lists
# of parameters. By using parameter
# values there can be more customization
# of the spacing.
Z = UnitZ(Factor=number_slider_13)  # disabled
srf_4 = Surface(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)  # disabled
range_17 = Range(Domain=Domain(0, 1), Steps=number_slider_30)  # disabled
crv_15 = Curve(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)  # disabled
srf_5 = Surface(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)  # disabled
# Determines how the interpolation path is interpolated.
# Determines the curvature degree of the interpolation path if the interpolation type is not linear.
number_slider_118 = Slider(0, range=0..3)  # disabled
swatch_3 = ColourSwatch(SwatchColor=RGB(255, 0, 255))  # disabled
# 22-Twisted Box Strip Variable
swatch_4 = ColourSwatch(SwatchColor=RGB(255, 0, 255))  # disabled
toggle_14 = BooleanToggle(False)  # disabled
# Use to flip the twisted box flow direction
# if it is flowing the opposite way that it should.
# Depends of the way you build your surface.
toggle_15 = BooleanToggle(False)  # disabled
X = UnitX(Factor=number_slider_47)  # disabled
# Input can be
# a box also
tbox_20 = TwistedBox({C=Point(-63.200998, -327.8733535, -6.770521539), C=Point(-32.86204822, -323.5800082, -1.834673377), C=Point(-39.32700927, -300.0701612, -5.130762752), C=Point(-52.61550611, -275.626525, -10.85627703), C=Point(-63.98559456, -320.6552959, 22.47890964), C=Point(-46.05476622, -319.887404, 19.32843667), C=Point(-38.85740609, -293.1635375, 18.89532396), C=Point(-66.1637687, -293.9942799, 11.84655581)})  # disabled
toggle_16 = BooleanToggle(False)  # disabled
Z_2 = UnitZ(Factor=number_slider_48)  # disabled
# Input can be
# a box also
tbox_21 = TwistedBox({C=Point(-13.50944187, -703.3949996, 0), C=Point(27.88634463, -703.3949996, 0), C=Point(27.88634463, -679.2792878, 0), C=Point(-13.50944187, -679.2792878, 0), C=Point(-3.885490883, -711.9873967, 24.87455473), C=Point(30.62051802, -691.3954473, 34.82031316), C=Point(18.26239364, -670.6868907, 34.82031316), C=Point(-16.24361526, -691.2788401, 24.87455473)})  # disabled
range_18 = Range(Domain=Domain(0, 1), Steps=number_slider_49)  # disabled
# 24-Twisted Box Sweep
swatch_5 = ColourSwatch(SwatchColor=RGB(255, 0, 255))  # disabled
number_slider_119 = Slider(3, range=0..7)  # disabled
avrtbox = AverageTwistedBox(TwistedBoxes=[tbox_3, tbox_4, tbox_5])  # disabled
wavtbox = WeightedAverageTwistedBox(TwistedBoxes=[tbox_6, tbox_7, tbox_8], Weights=[number_slider_23, number_slider_24, number_slider_25])  # disabled
reftbox = ReferenceTwistedBox(Polysurface=geo)  # disabled
# Determines how the interpolation path is interpolated.
# Determines the curvature degree of the interpolation path if the interpolation type is not linear.
number_slider_120 = Slider(0, range=0..3)  # disabled
_2pttbox = _2PtTwistedBox(PointA=pt_2, PointB=pt_3, Plane=PlaneXY(0, 0, 0))  # disabled
# Faster than converting to Brep
tboxvol = TwistedBoxVolume(TwistedBox=tbox_2)  # -> Volume, Centroid; disabled
centbox = CenterTwistedBox(Plane=PlaneXY(-57.1195639, -161.453227, 0), X=number_slider_46, Y=number_slider_44, Z=number_slider_45)  # disabled
tbox_corners = TwistedBoxCorners(TwistedBox=tbox)  # -> CornerA, CornerB, CornerC, CornerD, CornerE, CornerF, CornerG, CornerH; disabled
range_19 = Range(Domain=Domain(0, 1), Steps=number_slider_61)  # disabled
range_20 = Range(Domain=Domain(0, 1), Steps=number_slider_66)  # disabled
range_21 = Range(Domain=Domain(0, 1), Steps=number_slider_67)  # disabled
range_22 = Range(Domain=Domain(0, 1), Steps=number_slider_68)  # disabled
cotbox = ConstructTwistedBox(Corners=pt)  # disabled
range_23 = Range(Domain=Domain(0, 1), Steps=number_slider_77)  # disabled
# Rotation around curve
number_slider_121 = Slider(-421, range=-1000..1000)  # disabled
range_24 = Range(Domain=Domain(0, 1), Steps=number_slider_69)  # disabled
range_25 = Range(Domain=Domain(0, 1), Steps=number_slider_74)  # disabled
range_26 = Range(Domain=Domain(0, 1), Steps=number_slider_79)  # disabled
range_27 = Range(Domain=Domain(0, 1), Steps=number_slider_78)  # disabled
range_28 = Range(Domain=Domain(0, 1), Steps=number_slider_85)  # disabled
dom = ConstructDomain(DomainStart=number_slider_40, DomainEnd=number_slider_41)  # disabled
dom_2 = ConstructDomain(DomainStart=number_slider_42, DomainEnd=number_slider_43)  # disabled
range_29 = Range(Domain=Domain(0, 1), Steps=number_slider_73)  # disabled
range_30 = Range(Domain=Domain(0, 1), Steps=number_slider_80)  # disabled
range_31 = Range(Domain=Domain(0, 1), Steps=number_slider_81)  # disabled
range_32 = Range(Domain=Domain(0, 1), Steps=number_slider_82)  # disabled
range_33 = Range(Domain=Domain(0, 1), Steps=number_slider_83)  # disabled
range_34 = Range(Domain=Domain(0, 1), Steps=number_slider_84)  # disabled
# Look at Rhino window
# to preview results
preview = CustomPreview(Geometry=crv, Shader=swatch)  # disabled
range_35 = Range(Domain=Domain(0, 1), Steps=number_slider_76)  # disabled
range_36 = Range(Domain=Domain(0, 1), Steps=number_slider_87)  # disabled
range_37 = Range(Domain=Domain(0, 1), Steps=number_slider_88)  # disabled
range_38 = Range(Domain=Domain(0, 1), Steps=number_slider_90)  # disabled
range_39 = Range(Domain=Domain(0, 1), Steps=number_slider_92)  # disabled
range_40 = Range(Domain=Domain(0, 1), Steps=number_slider_93)  # disabled
range_41 = Range(Domain=Domain(0, 1), Steps=number_slider_75)  # disabled
twn2tboxs = TweenTwoTwistedBoxes(TwistedBoxA=tbox_9, TwistedBoxB=tbox_10, Factor=number_slider_12)  # disabled
range_42 = Range(Domain=Domain(0, 1), Steps=number_slider_86)  # disabled
range_43 = Range(Domain=Domain(0, 1), Steps=number_slider_89)  # disabled
range_44 = Range(Domain=Domain(0, 1), Steps=number_slider_91)  # disabled
box = CenterBox(Base=PlaneXY(1628.048772, 71.39929591, 0), X=number_slider_59, Y=number_slider_60, Z=number_slider_58)  # disabled
dom_3 = ConstructDomain(DomainStart=number_slider_11, DomainEnd=number_slider_16)  # disabled
dom_4 = ConstructDomain(DomainStart=number_slider_9, DomainEnd=number_slider_10)  # disabled
dom_5 = ConstructDomain(DomainStart=number_slider_2, DomainEnd=number_slider_3)  # disabled
geo_2 = Geometry(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)  # disabled
geo_3 = Geometry(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)  # disabled
swatch_6 = ColourSwatch(SwatchColor=RGB(255, 0, 255))  # disabled
geo_4 = Geometry(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)  # disabled
geo_5 = Geometry(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)  # disabled
geo_6 = Geometry(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)  # disabled
tboxloft = TwistedBoxLoft(Sections=crv, Closed=toggle_3)  # disabled
crv_16 = Curve(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)  # disabled
mesh_3 = Mesh(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)  # disabled
srf_6 = Surface(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)  # disabled
srf_7 = Surface(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)  # disabled
srf_8 = Surface(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)  # disabled
mesh_4 = Mesh(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)  # disabled
mesh_5 = Mesh(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)  # disabled
# Decides whether to have a
# twisted box in the center or not.
toggle_17 = BooleanToggle(True)  # disabled
# Rotation around twisted box centers
number_slider_122 = Slider(360, range=-1000..1000)  # disabled
# Switch which side of the
# twisted boxes get trimmed away
# Determines how much of the
# twisted boxes to trim away:
# 0:Complete
# 1:Halfway
# 2:Partial
number_slider_123 = Slider(0, range=0..3)  # disabled
# Switch which side of the
# twisted boxes get trimmed away
# Determines how much of the
# twisted boxes to trim away:
# 0:Complete
# 1:Halfway
# 2:Partial
number_slider_124 = Slider(0, range=0..3)  # disabled
# Switch which side of the
# twisted boxes get trimmed away
# Determines how much of the
# twisted boxes to trim away:
# 0:Complete
# 1:Halfway
# 2:Partial
number_slider_125 = Slider(0, range=0..3)  # disabled
# Switch which side of the
# twisted boxes get trimmed away
# Determines how much of the
# twisted boxes to trim away:
# 0:Complete
# 1:Halfway
# 2:Partial
number_slider_126 = Slider(0, range=0..3)  # disabled
# Switch which side of the
# twisted boxes get trimmed away
# Determines how much of the
# twisted boxes to trim away:
# 0:Complete
# 1:Halfway
# 2:Partial
number_slider_127 = Slider(0, range=0..3)  # disabled
swatch_7 = ColourSwatch(SwatchColor=RGB(255, 0, 255))  # disabled
toggle_18 = BooleanToggle(False)  # disabled
# Faster than converting to Brep
# 0 to 1 is inside the Brep form of the twisted box
# but converting to Brep is slow so we don't do that.
brep = Brep(tbox_19)  # disabled
# Input can be
# a box also
tbox_22 = TwistedBox({C=Point(-8.140568303, -773.3943285, 0), C=Point(22.88415037, -773.3943285, 0), C=Point(22.88415037, -747.8405088, 0), C=Point(-8.140568303, -747.8405088, 0), C=Point(-8.140568303, -773.3943285, 26.13464867), C=Point(22.88415037, -773.3943285, 26.13464867), C=Point(22.88415037, -747.8405088, 26.13464867), C=Point(-8.140568303, -747.8405088, 26.13464867)})  # disabled
toggle_19 = BooleanToggle(False)  # disabled
wires = BrepWireframe(Brep=box, Density=-1)  # disabled
Z_3 = UnitZ(Factor=number_slider_99)  # disabled
Z_4 = UnitZ(Factor=number_slider_100)  # disabled
Z_5 = UnitZ(Factor=number_slider_102)  # disabled
geo_7 = Geometry(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)  # disabled
number_slider_128 = Slider(3, range=0..7)  # disabled
number_slider_129 = Slider(3, range=0..7)  # disabled
X_2 = UnitX(Factor=number_slider_98)  # disabled
X_3 = UnitX(Factor=number_slider_101)  # disabled
geo_8 = Geometry(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)  # disabled
geo_9 = Geometry(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)  # disabled
geo_10 = Geometry(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)  # disabled
pln = Plane(Plane(origin=(812.7196041, -942.7823523, -34.97085545), x=(-0.6406882869, -0.7385788365, 0.2098090117), y=(0.6530124296, -0.6678936483, -0.3570613971)))  # disabled
geo_11 = Geometry(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)  # disabled
detbox = DeconstructTwistedBox(TwistedBox=tbox_18, DeconstructType=number_slider_22)  # disabled
geo_12 = Geometry(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)  # disabled
geo_13 = Geometry(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)  # disabled
geo_14 = Geometry(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)  # disabled
subdivtbox = SubdivideTwistedBox(TwistedBox=tbox_21, Steps=number_slider_95)  # disabled
toggle_20 = BooleanToggle(False)  # disabled
deformtbox = DeformTwistedBox(TwistedBox=tbox_17, Corners=pt_4, Motions=[X, Z_2])  # -> Deformed, Index; disabled
mesh_6 = Mesh(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)  # disabled
mesh_7 = Mesh(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)  # disabled
# Faster than converting to Brep
tboxcents = TwistedBoxCenters(TwistedBox=tbox_20, CenterType=number_slider_94)  # disabled
# Pufferfish
# By: Michael Pryor
geo_15 = Geometry(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)  # disabled
evaltbox = EvaluateTwistedBox(TwistedBox=tbox_19, ParameterU=number_slider_62, ParameterV=number_slider_63, ParameterW=number_slider_64)  # -> Evaluation, R; disabled
brep_2 = Brep(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)  # disabled
# Rotation around curve
number_slider_130 = Slider(-421, range=-1000..1000)  # disabled
srf_9 = Surface(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)  # disabled
dom_6 = ConstructDomain(DomainStart=number_slider_96, DomainEnd=number_slider_97)  # disabled
range_45 = Range(Domain=Domain(0, 1), Steps=number_slider_35)  # disabled
series = Series(Start=1, Step=number_slider_38, Count=addition)  # disabled
series_2 = Series(Start=1, Step=number_slider_39, Count=addition)  # disabled
# Look at Rhino window
# to preview inputs
preview_2 = CustomPreview(Geometry=[crv_10, crv_11], Shader=swatch_3)  # disabled
# Look at Rhino window
# to preview inputs
preview_3 = CustomPreview(Geometry=[crv_12, crv_13], Shader=swatch_4)  # disabled
# Look at Rhino window
# to preview inputs
preview_4 = CustomPreview(Geometry=crv_14, Shader=swatch_2)  # disabled
# Look at Rhino window
# to preview inputs
preview_5 = CustomPreview(Geometry=[crv_6, crv_7, crv_8, crv_9], Shader=swatch_5)  # disabled
series_3 = Series(Start=1, Step=number_slider_36, Count=addition)  # disabled
series_4 = Series(Start=1, Step=number_slider_37, Count=addition)  # disabled
# Determines how the interpolation path is interpolated.
# Determines the curvature degree of the interpolation path if the interpolation type is not linear.
number_slider_131 = Slider(0, range=0..3)  # disabled
# Determines how the interpolation path is interpolated.
# Determines the curvature degree of the interpolation path if the interpolation type is not linear.
number_slider_132 = Slider(0, range=0..3)  # disabled
swatch_8 = ColourSwatch(SwatchColor=RGB(255, 255, 255))  # disabled
tboxsweep = TwistedBoxSweep(R¹=crv_6, R²=crv_7, R³=crv_8, R⁴=crv_9, t=range_10, W=toggle_8)  # disabled
series_5 = Series(Start=1, Step=number_slider_55, Count=addition_2)  # disabled
series_6 = Series(Start=1, Step=number_slider_56, Count=addition_2)  # disabled
tboxstrip = TwistedBoxStrip(Rail1=crv_10, Rail2=crv_11, Thickness=number_slider_31, ParametersT=range_6, Weighted=toggle_6)  # disabled
# Weights the division distribution by curvature
# if the curve is not linear and degree is not 1.
series_7 = Series(Start=1, Step=number_slider_53, Count=addition_2)  # disabled
series_8 = Series(Start=1, Step=number_slider_54, Count=addition_2)  # disabled
series_9 = Series(Start=1, Step=number_slider_57, Count=addition_2)  # disabled
tboxstrips = TwistedBoxStrips(Rails=crv_14, Thickness=number_slider_33, ParametersT=range_9, Weighted=toggle_7)  # disabled
range_46 = Range(Domain=Domain(0, 1), Steps=number_slider_52)  # disabled
range_47 = Range(Domain=Domain(0, 1), Steps=number_slider_51)  # disabled
range_48 = Range(Domain=Domain(0, 1), Steps=number_slider_50)  # disabled
# Weights the division distribution by curvature
# if the rails are not linear and degree is not 1.
toggle_21 = BooleanToggle(False)  # disabled
crv_17 = Curve(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)  # disabled
# Use to flip the twisted box flow direction
# if it is flowing the opposite way that it should.
# Depends of the way you build your surface.
toggle_22 = BooleanToggle(False)  # disabled
graph = GraphMapper(range_2, x0=0, x1=1, y0=0, y1=1, container_name="Bezier", cpx=[0, 0.25, 0.2454546094, 1], cpy=[0, 0.25, 0.6545410156, 1])  # disabled
graph_2 = GraphMapper(range_3, x0=0, x1=1, y0=0, y1=1, container_name="Bezier", cpx=[0, 0.25, 0.4963635504, 1], cpy=[0, 0.25, 0.5913640857, 1])  # disabled
graph_3 = GraphMapper(range_4, x0=0, x1=1, y0=0, y1=1, container_name="Bezier", cpx=[0, 0.25, 0.3636363745, 1], cpy=[0, 0.25, 0.8818137646, 1])  # disabled
graph_4 = GraphMapper(range_5, x0=0, x1=1, y0=0, y1=1, container_name="Bezier", cpx=[0, 0.2454546094, 0.75, 1], cpy=[0, 0.6295387745, 0.75, 1])  # disabled
graph_5 = GraphMapper(range_8, x0=0, x1=1, y0=0, y1=1, container_name="Bezier", cpx=[0, 0.25, 0.1454547495, 1], cpy=[0, 0.25, 0.9045410156, 1])  # disabled
graph_6 = GraphMapper(
    range_7,
    x0=0,
    x1=1,
    y0=0,
    y1=1,
    container_name="Bezier",
    cpx=[0, 0.525000155, 0.2250002027, 1],
    cpy=[0, 0.07272058725, 0.7204478979, 1])  # disabled
graph_7 = GraphMapper(
    range_12,
    x0=0,
    x1=1,
    y0=0,
    y1=1,
    container_name="Bezier",
    cpx=[0, 0.25, 0.7136365771, 1],
    cpy=[0, 0.25, 0.4159046412, 1])  # disabled
graph_8 = GraphMapper(
    range_11,
    x0=0,
    x1=1,
    y0=0,
    y1=1,
    container_name="Bezier",
    cpx=[0, 0.25, 0.08409083635, 1],
    cpy=[0, 0.25, 0.870450139, 1])  # disabled
graph_9 = GraphMapper(
    range_13,
    x0=0,
    x1=1,
    y0=0,
    y1=1,
    container_name="Bezier",
    cpx=[0, 0.25, 0.3636363745, 1],
    cpy=[0, 0.25, 0.8818137646, 1])  # disabled
graph_10 = GraphMapper(
    range_14,
    x0=0,
    x1=1,
    y0=0,
    y1=1,
    container_name="Bezier",
    cpx=[0, 0.2454546094, 0.75, 1],
    cpy=[0, 0.6295387745, 0.75, 1])  # disabled
crv_18 = Curve(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)  # disabled
swatch_9 = ColourSwatch(SwatchColor=RGB(255, 255, 255))  # disabled
swatch_10 = ColourSwatch(SwatchColor=RGB(255, 255, 255))  # disabled
swatch_11 = ColourSwatch(SwatchColor=RGB(255, 255, 255))  # disabled
toggle_23 = BooleanToggle(True)  # disabled
toggle_24 = BooleanToggle(True)  # disabled
toggle_25 = BooleanToggle(True)  # disabled
toggle_26 = BooleanToggle(True)  # disabled
swatch_12 = ColourSwatch(SwatchColor=RGB(255, 255, 255))  # disabled
swatch_13 = ColourSwatch(SwatchColor=RGB(255, 255, 255))  # disabled
toggle_27 = BooleanToggle(True)  # disabled
swatch_14 = ColourSwatch(SwatchColor=RGB(255, 255, 255))  # disabled
swatch_15 = ColourSwatch(SwatchColor=RGB(255, 255, 255))  # disabled
# Look at Rhino window
# to preview inputs
preview_6 = CustomPreview(Geometry=[crv_2, crv_3, crv_4, crv_5], Shader=swatch_6)  # disabled
panel_3 = Panel(tboxvol.Volume)  # disabled
bbox = BoundingBox(Content=geo_14, Plane=PlaneXY(0, 0, 0))  # -> Box, Box_2; disabled
bbox_2 = BoundingBox(Content=geo_10, Plane=PlaneXY(0, 0, 0))  # -> Box, Box_2; disabled
bbox_3 = BoundingBox(Content=geo_11, Plane=PlaneXY(0, 0, 0))  # -> Box, Box_2; disabled
bbox_4 = BoundingBox(Content=geo_7, Plane=PlaneXY(0, 0, 0))  # -> Box, Box_2; disabled
tboxextr = TwistedBoxExtrude(Profile=[crv_2, crv_3, crv_4, crv_5], Direction=Z, ParametersT=range_15, Weighted=False)  # disabled
bbox_5 = BoundingBox(Content=geo_9, Plane=PlaneXY(0, 0, 0))  # -> Box, Box_2; disabled
geo_16 = Geometry(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)  # disabled
bbox_6 = BoundingBox(Content=geo_8, Plane=PlaneXY(0, 0, 0))  # -> Box, Box_2; disabled
tboxmsh = TwistedBoxMesh(Mesh=mesh_3, Thickness=number_slider_106, ParametersW=range_30)  # disabled
# Look at Rhino window
# to preview results
preview_7 = CustomPreview(Geometry=wires, Shader=swatch_7)  # disabled
move = Move(Geometry=mesh_6, Motion=X_2)  # -> Geometry, Transform; disabled
move_2 = Move(Geometry=mesh_7, Motion=Z_3)  # -> Geometry, Transform; disabled
move_3 = Move(Geometry=pln, Motion=Z_4)  # -> Geometry, Transform; disabled
move_4 = Move(Geometry=brep_2, Motion=X_3)  # -> Geometry, Transform; disabled
bbox_7 = BoundingBox(Content=geo_12, Plane=PlaneXY(0, 0, 0))  # -> Box, Box_2; disabled
bbox_8 = BoundingBox(Content=geo_13, Plane=PlaneXY(0, 0, 0))  # -> Box, Box_2; disabled
# Unlike grasshoppers native
# Surface Box component, This
# Twisted Box Surface component
# can also do layers of twisted boxes
# in the thickness {w} direction.
tboxsrf = TwistedBoxSurface(Surface=srf_6, Thickness=number_slider_107, ParametersU=range_42, ParametersV=range_36, ParametersW=range_31)  # disabled
# Just to display boundary
# of twisted boxes
edges = BrepEdges(Brep=geo_2)  # -> Naked, Interior, NonManifold; disabled
# Just to display boundary
# of twisted boxes
edges_2 = BrepEdges(Brep=geo_3)  # -> Naked, Interior, NonManifold; disabled
# Just to display boundary
# of twisted boxes
edges_3 = BrepEdges(Brep=geo_4)  # -> Naked, Interior, NonManifold; disabled
# Just to display boundary
# of twisted boxes
edges_4 = BrepEdges(Brep=geo_5)  # -> Naked, Interior, NonManifold; disabled
move_5 = Move(Geometry=srf_9, Motion=Z_5)  # -> Geometry, Transform; disabled
bbox_9 = BoundingBox(Content=geo_15, Plane=PlaneXY(0, 0, 0))  # -> Box, Box_2; disabled
tbox2mshs = TwistedBoxTwoMeshes(MeshA=mesh_4, MeshB=mesh_5, ParametersW=range_37)  # disabled
domtbox = DomainTwistedBox(Plane=PlaneXY(110.3625391, -162.2494292, 0), X=dom_4, Y=dom_5, Z=dom_3)  # disabled
# Just to display boundary
# of twisted boxes
edges_5 = BrepEdges(Brep=geo_6)  # -> Naked, Interior, NonManifold; disabled
# Unlike grasshoppers native
# Blend Box component, This
# Twisted Box Two Surface component
# can also do layers of twisted boxes
# in the thickness {w} direction.
tbox2srfs = TwistedBoxTwoSurfaces(SurfaceA=srf_7, SurfaceB=srf_8, ParametersU=range_43, ParametersV=range_38, ParametersW=range_32)  # disabled
twncontboxs = TweenConsecutiveTwistedBoxes(
    TwistedBoxes=[tbox_11, tbox_12, tbox_13],
    Factor=number_slider_27,
    Weighted=toggle_2,
    Degree=number_slider_103,
    InterpolationType=number_slider_108)  # disabled
twnthrutboxs = TweenThroughTwistedBoxes(
    TwistedBoxes=[tbox_16, tbox_14, tbox_15],
    Factor=number_slider_29,
    Normalized=True,
    Equalized=toggle,
    Weighted=toggle_4,
    Degree=number_slider_109,
    InterpolationType=number_slider_111)  # disabled
# Making twisted boxes to boolean,
# doesnt have to be an array,
# can be any twisted boxes
tboxarray = TwistedBoxArray(Box=geo_2, ParametersX=range_19, ParametersY=range_19, ParametersZ=range_19)  # disabled
# Making twisted boxes to trim,
# doesnt have to be an array,
# can be any twisted boxes
tboxarray_2 = TwistedBoxArray(Box=geo_3, ParametersX=range_20, ParametersY=range_20, ParametersZ=range_20)  # disabled
# Making twisted boxes to trim,
# doesnt have to be an array,
# can be any twisted boxes
tboxarray_3 = TwistedBoxArray(Box=geo_4, ParametersX=range_21, ParametersY=range_21, ParametersZ=range_21)  # disabled
# Making twisted boxes to boolean,
# doesnt have to be an array,
# can be any twisted boxes
tboxarray_4 = TwistedBoxArray(Box=geo_5, ParametersX=range_22, ParametersY=range_22, ParametersZ=range_22)  # disabled
tboxarray_5 = TwistedBoxArray(Box=box, ParametersX=range_40, ParametersY=range_34, ParametersZ=range_28)  # disabled
# Making twisted boxes to trim,
# doesnt have to be an array,
# can be any twisted boxes
tboxarray_6 = TwistedBoxArray(Box=geo_6, ParametersX=range_24, ParametersY=range_24, ParametersZ=range_24)  # disabled
thicktbox = ThickenTwistedBox(TwistedBox=tbox_22, Thickness=number_slider_110, ParametersW=range_16, Hollow=toggle_17)  # disabled
geo_17 = Geometry(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)  # disabled
geo_18 = Geometry(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)  # disabled
geo_19 = Geometry(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)  # disabled
swatch_16 = ColourSwatch(SwatchColor=RGB(255, 255, 255))  # disabled
# Index of corner being deformed
panel_4 = Panel(deformtbox.Index)  # disabled
swatch_17 = ColourSwatch(SwatchColor=RGB(255, 255, 255))  # disabled
geo_20 = Geometry(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)  # disabled
panel_5 = Panel(detbox)  # disabled
swatch_18 = ColourSwatch(SwatchColor=RGB(255, 255, 255))  # disabled
swatch_19 = ColourSwatch(SwatchColor=RGB(255, 255, 255))  # disabled
swatch_20 = ColourSwatch(SwatchColor=RGB(255, 255, 255))  # disabled
swatch_21 = ColourSwatch(SwatchColor=RGB(255, 255, 255))  # disabled
# Look at Rhino window
# to preview results
preview_8 = CustomPreview(Geometry=tboxvol.Centroid, Shader=swatch_8)  # disabled
toggle_28 = BooleanToggle(False)  # disabled
tboxconsrfs = TwistedBoxConsecutiveSurfaces(
    Surfaces=srf_2,
    ParametersU=range_44,
    ParametersV=range_39,
    ParametersW=range_33,
    Weighted=toggle_11,
    Degree=number_slider_119,
    InterpolationType=number_slider_120)  # disabled
swatch_22 = ColourSwatch(SwatchColor=RGB(255, 255, 255))  # disabled
bbox_10 = BoundingBox(Content=geo_16, Plane=PlaneXY(0, 0, 0))  # -> Box, Box_2; disabled
swatch_23 = ColourSwatch(SwatchColor=RGB(255, 255, 255))  # disabled
swatch_24 = ColourSwatch(SwatchColor=RGB(255, 255, 255))  # disabled
# Weights the division distribution by curvature
# if the rails are not linear and degree is not 1.
toggle_29 = BooleanToggle(False)  # disabled
geo_21 = Geometry(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)  # disabled
tboxpipe = TwistedBoxPipe(
    Surface=srf_5,
    ParametersU=range_17,
    ParameterV1=number_slider_71,
    ParameterV2=number_slider_72,
    ParameterV3=number_slider_70,
    ParameterV4=number_slider_65,
    Weighted=toggle_15,
    Flip=toggle_20)  # disabled
# Look at Rhino window
# to preview results
preview_9 = CustomPreview(Geometry=wavtbox, Shader=swatch_10)  # disabled
# Look at Rhino window
# to preview results
preview_10 = CustomPreview(Geometry=twn2tboxs, Shader=swatch_13)  # disabled
# Look at Rhino window
# to preview results
preview_11 = CustomPreview(Geometry=centbox, Shader=swatch_11)  # disabled
# Look at Rhino window
# to preview results
preview_12 = CustomPreview(Geometry=cotbox, Shader=swatch_9)  # disabled
# Look at Rhino window
# to preview results
preview_13 = CustomPreview(Geometry=avrtbox, Shader=swatch_12)  # disabled
geo_22 = Geometry(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)  # disabled
geo_23 = Geometry(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)  # disabled
geo_24 = Geometry(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)  # disabled
geo_25 = Geometry(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)  # disabled
geo_26 = Geometry(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)  # disabled
geo_27 = Geometry(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)  # disabled
geo_28 = Geometry(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)  # disabled
# Look at Rhino window
# to preview results
preview_14 = CustomPreview(Geometry=_2pttbox, Shader=swatch_14)  # disabled
tboxconmshs = TwistedBoxConsecutiveMeshes(Meshes=mesh_2, ParametersW=range_18, Weighted=toggle_5, Degree=number_slider_116, InterpolationType=number_slider_118)  # disabled
# Look at Rhino window
# to preview results
preview_15 = CustomPreview(Geometry=tboxloft, Shader=swatch_15)  # disabled
# Box Morphing,
# If using Rhino 6
# you can use Pufferfish's
# Multi-Threaded "Morph To Twisted Box" component.
morph = BoxMorph(Geometry=geo_10, Reference=bbox_2.Box, Target=deformtbox.Deformed)  # disabled
# Box Morphing,
# If using Rhino 6
# you can use Pufferfish's
# Multi-Threaded "Morph To Twisted Box" component.
morph_2 = BoxMorph(Geometry=geo_14, Reference=bbox.Box, Target=subdivtbox)  # disabled
# Box Morphing,
# If using Rhino 6
# you can use Pufferfish's
# Multi-Threaded "Morph To Twisted Box" component.
morph_3 = BoxMorph(Geometry=geo_11, Reference=bbox_3.Box, Target=cotbox)  # disabled
# Box Morphing,
# If using Rhino 6
# you can use Pufferfish's
# Multi-Threaded "Morph To Twisted Box" component.
morph_4 = BoxMorph(Geometry=geo_7, Reference=bbox_4.Box, Target=centbox)  # disabled
geo_29 = Geometry(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)  # disabled
# Box Morphing,
# If using Rhino 6
# you can use Pufferfish's
# Multi-Threaded "Morph To Twisted Box" component.
morph_5 = BoxMorph(Geometry=geo_9, Reference=bbox_5.Box, Target=_2pttbox)  # disabled
tboxcrv = TwistedBoxCurve(
    Curve=crv_15,
    ParametersT=range,
    Weighted=toggle_16,
    SizeX=dom,
    SizeY=dom_2,
    Rotation1=number_slider_117,
    Rotation2=number_slider_121)  # disabled
bbox_11 = BoundingBox(Content=geo_18, Plane=PlaneXY(0, 0, 0))  # -> Box, Box_2; disabled
bbox_12 = BoundingBox(Content=geo_19, Plane=PlaneXY(0, 0, 0))  # -> Box, Box_2; disabled
bbox_13 = BoundingBox(Content=geo_17, Plane=PlaneXY(0, 0, 0))  # -> Box, Box_2; disabled
# Box Morphing,
# If using Rhino 6
# you can use Pufferfish's
# Multi-Threaded "Morph To Twisted Box" component.
morph_6 = BoxMorph(Geometry=geo_8, Reference=bbox_6.Box, Target=tboxloft)  # disabled
# Box Morphing,
# If using Rhino 6
# you can use Pufferfish's
# Multi-Threaded "Morph To Twisted Box" component.
morph_7 = BoxMorph(Geometry=geo_12, Reference=bbox_7.Box, Target=wavtbox)  # disabled
# Box Morphing,
# If using Rhino 6
# you can use Pufferfish's
# Multi-Threaded "Morph To Twisted Box" component.
morph_8 = BoxMorph(Geometry=geo_13, Reference=bbox_8.Box, Target=twn2tboxs)  # disabled
# Some notes about twisted boxes:
# 
# 1.Pufferfish twisted boxes are faster than the traditional way because they don't require lots of
# point data creation to make them as with Grasshopper's Twisted Box component.
# 
# 2.If using Rhino 6 some versions have weird mesh display glitches, this is not a Pufferfish issue
# but a Grasshopper one. If meshes look glitchy you can fix the display by recomputing (F5) until its looks correct.
# If the glitch display doesn't fix, don't worry, they will bake correctly despite Grasshopper's display.
# 
# 3.If using Rhino 6 you can use Pufferfish's "Morph To Twisted Box" component which is Multi-Threaded,
# instead of Grasshopper's Box Morph component. It can be much faster depending on your computers
# amount and quality of cores, especially if morphing many geometries. Pufferfish's "Morph To Twisted Box"
# component will not work correctly in Rhino 5 because Rhino 5's morph class is not thread safe.
# Box Morphing,
# If using Rhino 6
# you can use Pufferfish's
# Multi-Threaded "Morph To Twisted Box" component.
morph_9 = BoxMorph(Geometry=geo_15, Reference=bbox_9.Box, Target=avrtbox)  # disabled
bbox_14 = BoundingBox(Content=geo_20, Plane=PlaneXY(0, 0, 0))  # -> Box, Box_2; disabled
eval = EvaluateCurve(Curve=reparameterize(crv_15), Parameter=range)  # -> Point, Tangent, Angle; disabled
swatch_25 = ColourSwatch(SwatchColor=RGB(255, 255, 255))  # disabled
panel_6 = Panel(evaltbox.R)  # disabled
swatch_26 = ColourSwatch(SwatchColor=RGB(255, 255, 255))  # disabled
swatch_27 = ColourSwatch(SwatchColor=RGB(255, 255, 255))  # disabled
swatch_28 = ColourSwatch(SwatchColor=RGB(255, 255, 255))  # disabled
swatch_29 = ColourSwatch(SwatchColor=RGB(255, 255, 255))  # disabled
# This component works directly in
# relationship with Grasshoppers
# Twisted Box component.
# Look at Rhino window
# to preview results
preview_16 = CustomPreview(
    Geometry=[tbox_corners.CornerA, tbox_corners.CornerB, tbox_corners.CornerC, tbox_corners.CornerD, tbox_corners.CornerE, tbox_corners.CornerF, tbox_corners.CornerG, tbox_corners.CornerH],
    Shader=swatch_16)  # disabled
crv_19 = Curve(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)  # disabled
swatch_30 = ColourSwatch(SwatchColor=RGB(255, 255, 255))  # disabled
# Rail curves
crv_20 = Curve(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)  # disabled
crv_21 = Curve(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)  # disabled
crv_22 = Curve(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)  # disabled
# You can get this info like this but it
# is much slower as it converts to Brep
# and outputs all the geometry together.
# The other bad thing is it ruins the
# corner point order of the twisted box.
# However, this way you can get the
# faces as surfaces if you need them.
# Look at Rhino window
# to preview results
preview_17 = CustomPreview(Geometry=detbox, Shader=swatch_17)  # disabled
geo_30 = Geometry(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)  # disabled
bbox_15 = BoundingBox(Content=geo_21, Plane=PlaneXY(0, 0, 0))  # -> Box, Box_2; disabled
swatch_31 = ColourSwatch(SwatchColor=RGB(255, 255, 255))  # disabled
geo_31 = Geometry(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)  # disabled
# This component has the same functionality
# as the regular Twisted Box Curve so be
# sure to see the notes above for that. The
# difference is that this component can have
# variable sizes and rotations of the twisted
# boxes along the curve. You can also use
# graph mappers for these lists.
tboxcrvvar = TwistedBoxCurveVariable(
    Curve=crv_17,
    ParametersT=range_45,
    Weighted=toggle_18,
    SizesX=series_3,
    SizesY=series_4,
    Rotations1=series,
    Rotations2=series_2)  # disabled
# Look at Rhino window
# to preview results
preview_18 = CustomPreview(Geometry=reftbox, Shader=swatch_20)  # disabled
swatch_32 = ColourSwatch(SwatchColor=RGB(255, 255, 255))  # disabled
swatch_33 = ColourSwatch(SwatchColor=RGB(255, 255, 255))  # disabled
geo_32 = Geometry(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)  # disabled
bbox_16 = BoundingBox(Content=geo_22, Plane=PlaneXY(0, 0, 0))  # -> Box, Box_2; disabled
bbox_17 = BoundingBox(Content=geo_23, Plane=PlaneXY(0, 0, 0))  # -> Box, Box_2; disabled
bbox_18 = BoundingBox(Content=geo_24, Plane=PlaneXY(0, 0, 0))  # -> Box, Box_2; disabled
swatch_34 = ColourSwatch(SwatchColor=RGB(255, 255, 255))  # disabled
bbox_19 = BoundingBox(Content=geo_25, Plane=PlaneXY(0, 0, 0))  # -> Box, Box_2; disabled
bbox_20 = BoundingBox(Content=geo_27, Plane=PlaneXY(0, 0, 0))  # -> Box, Box_2; disabled
bbox_21 = BoundingBox(Content=geo_28, Plane=PlaneXY(0, 0, 0))  # -> Box, Box_2; disabled
swatch_35 = ColourSwatch(SwatchColor=RGB(255, 255, 255))  # disabled
bbox_22 = BoundingBox(Content=geo_26, Plane=PlaneXY(0, 0, 0))  # -> Box, Box_2; disabled
# Deforming with indices
# Look at Rhino window
# to preview results
preview_19 = CustomPreview(Geometry=deformtbox.Deformed, Shader=swatch_21)  # disabled
# Look at Rhino window
# to preview results
preview_20 = CustomPreview(Geometry=tboxcents, Shader=swatch_19)  # disabled
# Box Morphing,
# If using Rhino 6
# you can use Pufferfish's
# Multi-Threaded "Morph To Twisted Box" component.
# The referenced Brep does not need to be
# a Box, It just needs to have started with
# a Rhino Box for the point order.
morph_10 = BoxMorph(Geometry=geo_16, Reference=bbox_10.Box, Target=reftbox)  # disabled
# Look at Rhino window
# to preview results
preview_21 = CustomPreview(Geometry=subdivtbox, Shader=swatch_18)  # disabled
bbox_23 = BoundingBox(Content=geo_29, Plane=PlaneXY(0, 0, 0))  # -> Box, Box_2; disabled
geo_33 = Geometry(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)  # disabled
# This allows the start and end of the twisted boxes
# to be altered on the rails so twisted boxes can
# exist only on parts of the rails.
# Look at Rhino window
# to preview results
preview_22 = CustomPreview(Geometry=tboxstrip, Shader=swatch_24)  # disabled
# This allows the start and end of the twisted boxes
# to be altered on the rails so twisted boxes can
# exist only on parts of the rails.
# Look at Rhino window
# to preview results
preview_23 = CustomPreview(Geometry=tboxstrips, Shader=swatch_22)  # disabled
# This allows the start and end of the twisted boxes
# to be altered on the rails so twisted boxes can
# exist only on parts of the rails.
# Look at Rhino window
# to preview results
preview_24 = CustomPreview(Geometry=tboxsweep, Shader=swatch_23)  # disabled
# Box Morphing,
# If using Rhino 6
# you can use Pufferfish's
# Multi-Threaded "Morph To Twisted Box" component.
morph_11 = BoxMorph(Geometry=geo_18, Reference=bbox_11.Box, Target=tboxstrip)  # disabled
# Box Morphing,
# If using Rhino 6
# you can use Pufferfish's
# Multi-Threaded "Morph To Twisted Box" component.
morph_12 = BoxMorph(Geometry=geo_19, Reference=bbox_12.Box, Target=tboxstrips)  # disabled
# Box Morphing,
# If using Rhino 6
# you can use Pufferfish's
# Multi-Threaded "Morph To Twisted Box" component.
morph_13 = BoxMorph(Geometry=geo_17, Reference=bbox_13.Box, Target=tboxsweep)  # disabled
# Box Morphing,
# If using Rhino 6
# you can use Pufferfish's
# Multi-Threaded "Morph To Twisted Box" component.
morph_14 = BoxMorph(Geometry=geo_20, Reference=bbox_14.Box, Target=thicktbox)  # disabled
# Variable version
# of this component
geo_34 = Geometry(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)  # disabled
swatch_36 = ColourSwatch(SwatchColor=RGB(255, 255, 255))  # disabled
# This component has the same functionality
# as the regular Twisted Box Strip so be
# sure to see the notes above for that. The
# difference is that this component can have
# variable t divisions per rail of the twisted
# boxes. You can also use graph mappers
# for these lists.
ttboxstripvar = TwistedBoxStripVariable(Rail1=crv_12, Rail2=crv_13, Thickness=number_slider_32, ParametersT1=graph_6, ParametersT2=graph_5, Weighted=toggle_21)  # disabled
swatch_37 = ColourSwatch(SwatchColor=RGB(255, 255, 255))  # disabled
swatch_38 = ColourSwatch(SwatchColor=RGB(255, 255, 255))  # disabled
swatch_39 = ColourSwatch(SwatchColor=RGB(255, 255, 255))  # disabled
bbox_24 = BoundingBox(Content=geo_30, Plane=PlaneXY(0, 0, 0))  # -> Box, Box_2; disabled
mshtrimtboxs = MeshTrimTwistedBoxes(TwistedBoxes=tboxarray_2, Mesh=move_2.Geometry, Flip=toggle_24, KeepType=number_slider_124)  # -> Trimmed, KeptIndicies, Intersected; disabled
plntrimtboxs = PlaneTrimTwistedBoxes(TwistedBoxes=tboxarray_3, Plane=move_3.Geometry, Flip=toggle_25, KeepType=number_slider_125)  # -> Trimmed, KeptIndicies, Intersected; disabled
# Look at Rhino window
# to preview results
preview_25 = CustomPreview(Geometry=twncontboxs, Shader=swatch_26)  # disabled
# Look at Rhino window
# to preview results
preview_26 = CustomPreview(Geometry=twnthrutboxs, Shader=swatch_27)  # disabled
tboxthrusrfs = TwistedBoxThroughSurfaces(
    Surfaces=srf,
    ParametersU=range_27,
    ParametersV=range_26,
    ParametersW=range_23,
    Normalized=True,
    Equalized=toggle_10,
    Weighted=toggle_13,
    Degree=number_slider_129,
    InterpolationType=number_slider_132)  # disabled
srftrimtboxs = SurfaceTrimTwistedBoxes(TwistedBoxes=tboxarray_6, Surface=move_5.Geometry, Flip=toggle_27, KeepType=number_slider_127)  # -> Trimmed, KeptIndicies, Intersected; disabled
tboxthrumshs = TwistedBoxThroughMeshes(
    Meshes=mesh,
    ParametersW=range_25,
    Normalized=True,
    Equalized=toggle_9,
    Weighted=toggle_12,
    Degree=number_slider_128,
    InterpolationType=number_slider_131)  # disabled
# Look at Rhino window
# to preview results
preview_27 = CustomPreview(Geometry=tboxarray_5, Shader=swatch_28)  # disabled
mshbooltboxs = MeshBooleanTwistedBoxes(TwistedBoxes=tboxarray, Meshes=move.Geometry, BooleanType=toggle_23, KeepType=number_slider_123)  # -> Trimmed, KeptIndicies, Intersected; disabled
psrfbooltboxs = PolysurfaceBooleanTwistedBoxes(TwistedBoxes=tboxarray_4, Polysurfaces=move_4.Geometry, BooleanType=toggle_26, KeepType=number_slider_126)  # -> Trimmed, KeptIndicies, Intersected; disabled
bbox_25 = BoundingBox(Content=geo_31, Plane=PlaneXY(0, 0, 0))  # -> Box, Box_2; disabled
# Look at Rhino window
# to preview results
preview_28 = CustomPreview(Geometry=evaltbox.Evaluation, Shader=swatch_25)  # disabled
bbox_26 = BoundingBox(Content=geo_32, Plane=PlaneXY(0, 0, 0))  # -> Box, Box_2; disabled
tboxtube = TwistedBoxTube(
    Curve=crv_16,
    ParametersU=range_41,
    ParametersV=range_35,
    ParametersW=range_29,
    Weighted=toggle_14,
    Diameter=number_slider_104,
    Thickness=number_slider_105,
    Offset=dom_6,
    Rotation1=number_slider_122,
    Rotation2=number_slider_130)  # disabled
# Using unevenly spaced parameter
# values will result in uneven spaced
# twisted boxes. The spacing can be
# controlled with custom values
# such as values from graph mappers.
# Look at Rhino window
# to preview results
preview_29 = CustomPreview(Geometry=tboxextr, Shader=swatch_29)  # disabled
# Box Morphing,
# If using Rhino 6
# you can use Pufferfish's
# Multi-Threaded "Morph To Twisted Box" component.
morph_15 = BoxMorph(Geometry=geo_21, Reference=bbox_15.Box, Target=tboxextr)  # disabled
# Box Morphing,
# If using Rhino 6
# you can use Pufferfish's
# Multi-Threaded "Morph To Twisted Box" component.
morph_16 = BoxMorph(Geometry=geo_24, Reference=bbox_18.Box, Target=tboxsrf)  # disabled
# Box Morphing,
# If using Rhino 6
# you can use Pufferfish's
# Multi-Threaded "Morph To Twisted Box" component.
morph_17 = BoxMorph(Geometry=geo_22, Reference=bbox_16.Box, Target=twncontboxs)  # disabled
# Box Morphing,
# If using Rhino 6
# you can use Pufferfish's
# Multi-Threaded "Morph To Twisted Box" component.
morph_18 = BoxMorph(Geometry=geo_23, Reference=bbox_17.Box, Target=tboxmsh)  # disabled
# Box Morphing,
# If using Rhino 6
# you can use Pufferfish's
# Multi-Threaded "Morph To Twisted Box" component.
morph_19 = BoxMorph(Geometry=geo_25, Reference=bbox_19.Box, Target=tbox2srfs)  # disabled
# Look at Rhino window
# to preview results
preview_30 = CustomPreview(Geometry=domtbox, Shader=swatch_30)  # disabled
# Box Morphing,
# If using Rhino 6
# you can use Pufferfish's
# Multi-Threaded "Morph To Twisted Box" component.
morph_20 = BoxMorph(Geometry=geo_27, Reference=bbox_20.Box, Target=twnthrutboxs)  # disabled
# Box Morphing,
# If using Rhino 6
# you can use Pufferfish's
# Multi-Threaded "Morph To Twisted Box" component.
morph_21 = BoxMorph(Geometry=geo_28, Reference=bbox_21.Box, Target=tbox2mshs)  # disabled
# Box Morphing,
# If using Rhino 6
# you can use Pufferfish's
# Multi-Threaded "Morph To Twisted Box" component.
# This allows the start and end of the array
# to be altered in the box so twisted boxes
# can exist only in parts of the box.
morph_22 = BoxMorph(Geometry=geo_26, Reference=bbox_22.Box, Target=tboxarray_5)  # disabled
bbox_27 = BoundingBox(Content=geo_33, Plane=PlaneXY(0, 0, 0))  # -> Box, Box_2; disabled
# Box Morphing,
# If using Rhino 6
# you can use Pufferfish's
# Multi-Threaded "Morph To Twisted Box" component.
morph_23 = BoxMorph(Geometry=geo_29, Reference=bbox_23.Box, Target=domtbox)  # disabled
# This allows the twisted boxes to
# be placed at a specific portion of
# the mesh thickness.
# Look at Rhino window
# to preview results
preview_31 = CustomPreview(Geometry=tboxmsh, Shader=swatch_31)  # disabled
# This allows the start and end of the grid
# to be altered on the surface so twisted boxes
# can exist only on parts of the surface.
# Look at Rhino window
# to preview results
preview_32 = CustomPreview(Geometry=tboxsrf, Shader=swatch_34)  # disabled
# This allows the start and end of the grid
# to be altered on the surface so twisted boxes
# can exist only on parts of the surface.
# Look at Rhino window
# to preview results
preview_33 = CustomPreview(Geometry=tbox2srfs, Shader=swatch_33)  # disabled
# This allows the twisted boxes to
# be placed at a specific portion
# between the meshs .
# Look at Rhino window
# to preview results
preview_34 = CustomPreview(Geometry=tbox2mshs, Shader=swatch_32)  # disabled
# This allows the start and end of the twisted boxes
# to be altered on the thickness so twisted boxes
# can exist only on parts of the thickness.
# Look at Rhino window
# to preview results
preview_35 = CustomPreview(Geometry=thicktbox, Shader=swatch_35)  # disabled
tboxtubevar = TwistedBoxTubeVariable(
    Curve=crv_18,
    ParametersU=range_46,
    ParametersV=range_47,
    ParametersW=range_48,
    Weighted=toggle_19,
    Diameters=series_7,
    Thicknesses=series_8,
    Offsets=series_9,
    Rotations1=series_5,
    Rotations2=series_6)  # disabled
swatch_40 = ColourSwatch(SwatchColor=RGB(255, 255, 255))  # disabled
bbox_28 = BoundingBox(Content=geo_34, Plane=PlaneXY(0, 0, 0))  # -> Box, Box_2; disabled
geo_35 = Geometry(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)  # disabled
geo_36 = Geometry(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)  # disabled
geo_37 = Geometry(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)  # disabled
# Box Morphing,
# If using Rhino 6
# you can use Pufferfish's
# Multi-Threaded "Morph To Twisted Box" component.
morph_24 = BoxMorph(Geometry=geo_30, Reference=bbox_24.Box, Target=tboxcrv)  # disabled
# Box Morphing,
# If using Rhino 6
# you can use Pufferfish's
# Multi-Threaded "Morph To Twisted Box" component.
morph_25 = BoxMorph(Geometry=geo_31, Reference=bbox_25.Box, Target=tboxconmshs)  # disabled
# Box Morphing,
# If using Rhino 6
# you can use Pufferfish's
# Multi-Threaded "Morph To Twisted Box" component.
morph_26 = BoxMorph(Geometry=geo_32, Reference=bbox_26.Box, Target=tboxconsrfs)  # disabled
# Variable version
# of this component
geo_38 = Geometry(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)  # disabled
# This allows the twisted boxes to
# be placed at a specific portion
# between the meshs .
# Look at Rhino window
# to preview results
preview_36 = CustomPreview(Geometry=tboxconmshs, Shader=swatch_39)  # disabled
# This allows the start and end of the grid
# to be altered on the surface so twisted boxes
# can exist only on parts of the surface.
# Look at Rhino window
# to preview results
preview_37 = CustomPreview(Geometry=tboxconsrfs, Shader=swatch_37)  # disabled
# This allows the start and end of the twisted boxes
# to be altered on the curve so twisted boxes can
# exist only on parts of the curve.
# Look at Rhino window
# to preview results
preview_38 = CustomPreview(Geometry=tboxcrv, Shader=swatch_38)  # disabled
# This allows the start and end of the twisted boxes
# to be altered on the curve so twisted boxes can
# exist only on parts of the curve.
# Look at Rhino window
# to preview results
preview_39 = CustomPreview(Geometry=tboxpipe, Shader=swatch_36)  # disabled
# Box Morphing,
# If using Rhino 6
# you can use Pufferfish's
# Multi-Threaded "Morph To Twisted Box" component.
morph_27 = BoxMorph(Geometry=geo_33, Reference=bbox_27.Box, Target=tboxpipe)  # disabled
swatch_41 = ColourSwatch(SwatchColor=RGB(255, 255, 255))  # disabled
swatch_42 = ColourSwatch(SwatchColor=RGB(255, 255, 255))  # disabled
swatch_43 = ColourSwatch(SwatchColor=RGB(255, 255, 255))  # disabled
swatch_44 = ColourSwatch(SwatchColor=RGB(255, 255, 255))  # disabled
swatch_45 = ColourSwatch(SwatchColor=RGB(255, 255, 255))  # disabled
swatch_46 = ColourSwatch(SwatchColor=RGB(255, 255, 255))  # disabled
swatch_47 = ColourSwatch(SwatchColor=RGB(255, 255, 255))  # disabled
bbox_29 = BoundingBox(Content=geo_37, Plane=PlaneXY(0, 0, 0))  # -> Box, Box_2; disabled
# Did twisted box
# set get trimmed
panel_7 = Panel(mshbooltboxs.Intersected)  # disabled
# This component has the same functionality
# as the regular Twisted Box Sweep so be
# sure to see the notes above for that. The
# difference is that this component can have
# variable t divisions per rail of the twisted
# boxes. You can also use graph mappers
# for these lists.
tboxsweepvar = TwistedBoxSweepVariable(R¹=crv_20, R²=crv_21, R³=crv_22, R⁴=crv_19, t¹=graph_8, t²=graph_7, t³=graph_9, t⁴=graph_10, W=toggle_29)  # disabled
# Did twisted box
# set get trimmed
panel_8 = Panel(mshtrimtboxs.Intersected)  # disabled
# Did twisted box
# set get trimmed
panel_9 = Panel(plntrimtboxs.Intersected)  # disabled
# Did twisted box
# set get trimmed
panel_10 = Panel(psrfbooltboxs.Intersected)  # disabled
swatch_48 = ColourSwatch(SwatchColor=RGB(255, 255, 255))  # disabled
# Did twisted box
# set get trimmed
panel_11 = Panel(srftrimtboxs.Intersected)  # disabled
bbox_30 = BoundingBox(Content=geo_35, Plane=PlaneXY(0, 0, 0))  # -> Box, Box_2; disabled
bbox_31 = BoundingBox(Content=geo_36, Plane=PlaneXY(0, 0, 0))  # -> Box, Box_2; disabled
swatch_49 = ColourSwatch(SwatchColor=RGB(255, 255, 255))  # disabled
# Box Morphing,
# If using Rhino 6
# you can use Pufferfish's
# Multi-Threaded "Morph To Twisted Box" component.
morph_28 = BoxMorph(Geometry=geo_34, Reference=bbox_28.Box, Target=tboxcrvvar)  # disabled
bbox_32 = BoundingBox(Content=geo_38, Plane=PlaneXY(0, 0, 0))  # -> Box, Box_2; disabled
# Variable version
# of this component
geo_39 = Geometry(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)  # disabled
# Look at Rhino window
# to preview results
preview_40 = CustomPreview(Geometry=tboxcrvvar, Shader=swatch_40)  # disabled
# Variable version
# of this component
tboxpipevar = TwistedBoxPipeVariable(
    Surface=srf_4,
    ParametersU1=graph,
    ParametersU2=graph_2,
    ParametersU3=graph_3,
    ParametersU4=graph_4,
    ParameterV1=number_slider_114,
    ParameterV2=number_slider_115,
    ParameterV3=number_slider_113,
    ParameterV4=number_slider_112,
    Weighted=toggle_22,
    Flip=toggle_28)  # disabled
bbox_33 = BoundingBox(Content=geo_39, Plane=PlaneXY(0, 0, 0))  # -> Box, Box_2; disabled
# Box Morphing,
# If using Rhino 6
# you can use Pufferfish's
# Multi-Threaded "Morph To Twisted Box" component.
morph_29 = BoxMorph(Geometry=geo_37, Reference=bbox_29.Box, Target=tboxtube)  # disabled
# Box Morphing,
# If using Rhino 6
# you can use Pufferfish's
# Multi-Threaded "Morph To Twisted Box" component.
morph_30 = BoxMorph(Geometry=geo_35, Reference=bbox_30.Box, Target=tboxthrusrfs)  # disabled
# Indices of remaining
# twisted boxes
panel_12 = Panel(mshbooltboxs.KeptIndicies)  # disabled
# Indices of remaining
# twisted boxes
panel_13 = Panel(mshtrimtboxs.KeptIndicies)  # disabled
# Indices of remaining
# twisted boxes
panel_14 = Panel(plntrimtboxs.KeptIndicies)  # disabled
# Indices of remaining
# twisted boxes
panel_15 = Panel(psrfbooltboxs.KeptIndicies)  # disabled
# Indices of remaining
# twisted boxes
panel_16 = Panel(srftrimtboxs.KeptIndicies)  # disabled
# Box Morphing,
# If using Rhino 6
# you can use Pufferfish's
# Multi-Threaded "Morph To Twisted Box" component.
morph_31 = BoxMorph(Geometry=geo_36, Reference=bbox_31.Box, Target=tboxthrumshs)  # disabled
# Look at Rhino window
# to preview results
preview_41 = CustomPreview(Geometry=mshbooltboxs.Trimmed, Shader=swatch_43)  # disabled
# Look at Rhino window
# to preview results
preview_42 = CustomPreview(Geometry=mshtrimtboxs.Trimmed, Shader=swatch_41)  # disabled
# Look at Rhino window
# to preview results
preview_43 = CustomPreview(Geometry=plntrimtboxs.Trimmed, Shader=swatch_44)  # disabled
# Look at Rhino window
# to preview results
preview_44 = CustomPreview(Geometry=psrfbooltboxs.Trimmed, Shader=swatch_45)  # disabled
# Look at Rhino window
# to preview results
preview_45 = CustomPreview(Geometry=srftrimtboxs.Trimmed, Shader=swatch_42)  # disabled
# This component has the same functionality
# as the regular Twisted Box Tube so be
# sure to see the notes above for that. The
# difference is that this component can have
# variable sizes and rotations of the twisted
# boxes along the curve. You can also use
# graph mappers for these lists.
swatch_50 = ColourSwatch(SwatchColor=RGB(255, 255, 255))  # disabled
tbox_23 = TwistedBox({C=Point(9.434291702, -522.1123305, 3.42147918), C=Point(29.08855508, -522.1123305, 10.31291601), C=Point(29.08855508, -494.8877623, 10.31291601), C=Point(9.434291702, -494.8877623, 3.42147918), C=Point(-18.21964268, -527.8378954, 31.31779612), C=Point(4.728705022, -524.9017061, 43.10665076), C=Point(15.58320709, -499.9345897, 43.10665076), C=Point(-2.441331509, -492.0983867, 31.31779612)})  # disabled
# Look at Rhino window
# to preview results
preview_46 = CustomPreview(Geometry=ttboxstripvar, Shader=swatch_47)  # disabled
# Box Morphing,
# If using Rhino 6
# you can use Pufferfish's
# Multi-Threaded "Morph To Twisted Box" component.
morph_32 = BoxMorph(Geometry=geo_38, Reference=bbox_32.Box, Target=ttboxstripvar)  # disabled
# Using Non-Normalized w Parameter
# Look at Rhino window
# to preview results
preview_47 = CustomPreview(Geometry=tboxthrumshs, Shader=swatch_46)  # disabled
# Using Non-Normalized w Parameter
# Look at Rhino window
# to preview results
preview_48 = CustomPreview(Geometry=tboxthrusrfs, Shader=swatch_48)  # disabled
# This allows the start and end, revolution, and thickness
# of the twisted box pipe to be altered on the curve so
# twisted boxes can exist only on parts of the pipe.
# Look at Rhino window
# to preview results
preview_49 = CustomPreview(Geometry=tboxtube, Shader=swatch_49)  # disabled
# Variable version
# of this component
geo_40 = Geometry(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)  # disabled
# Convert twisted box to Brep
tbox_24 = TwistedBox({C=Point(34.91655507, -370.2027664, 0), C=Point(54.57081845, -370.2027664, 0), C=Point(54.57081845, -342.9781981, 0), C=Point(34.91655507, -342.9781981, 0), C=Point(25.38035732, -375.9283312, 32.79373475), C=Point(48.32870502, -372.9921419, 32.79373475), C=Point(59.18320709, -348.0250256, 32.79373475), C=Point(41.15866849, -340.1888226, 32.79373475)})  # disabled
number_slider_133 = Slider(-36, range=-100..100)  # disabled
number_slider_134 = Slider(18, range=0..100)  # disabled
# Box Morphing,
# If using Rhino 6
# you can use Pufferfish's
# Multi-Threaded "Morph To Twisted Box" component.
morph_33 = BoxMorph(Geometry=geo_39, Reference=bbox_33.Box, Target=tboxtubevar)  # disabled
number_slider_135 = Slider(26, range=0..100)  # disabled
swatch_51 = ColourSwatch(SwatchColor=RGB(255, 255, 255))  # disabled
number_slider_136 = Slider(33, range=0..100)  # disabled
bbox_34 = BoundingBox(Content=geo_40, Plane=PlaneXY(0, 0, 0))  # -> Box, Box_2; disabled
# Index of corner to deform
number_slider_137 = Slider(5, range=0..10)  # disabled
number_slider_138 = Slider(0.061, range=0..1)  # disabled
number_slider_139 = Slider(0.517, range=0..1)  # disabled
number_slider_140 = Slider(0.335, range=0..1)  # disabled
# Adjusting the start and end domains
# of the ranges positions the twisted
# boxes on specified parts of the surface.
number_slider_141 = Slider(0.839, range=0..1)  # disabled
number_slider_142 = Slider(0.061, range=0..1)  # disabled
number_slider_143 = Slider(0.517, range=0..1)  # disabled
number_slider_144 = Slider(0.335, range=0..1)  # disabled
# Adjusting the start and end domains
# of the ranges positions the twisted
# boxes on specified parts of the surface.
number_slider_145 = Slider(0.814, range=0..1)  # disabled
number_slider_146 = Slider(0.527, range=0..1)  # disabled
number_slider_147 = Slider(0.007, range=0..1)  # disabled
number_slider_148 = Slider(0.335, range=0..1)  # disabled
# Adjusting the start and end domains
# of the ranges positions the twisted
# boxes in specified parts of the box.
number_slider_149 = Slider(0.839, range=0..1)  # disabled
number_slider_150 = Slider(0.207, range=0..1)  # disabled
number_slider_151 = Slider(0.592, range=0..1)  # disabled
number_slider_152 = Slider(0.207, range=0..1)  # disabled
number_slider_153 = Slider(0.592, range=0..1)  # disabled
number_slider_154 = Slider(0.207, range=0..1)  # disabled
number_slider_155 = Slider(0.486, range=0..1)  # disabled
# Look at Rhino window
# to preview results
preview_50 = CustomPreview(Geometry=tboxtubevar, Shader=swatch_50)  # disabled
geo_41 = Geometry(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)  # disabled
tbox_corners_2 = TwistedBoxCorners(TwistedBox=tbox_23)  # -> CornerA, CornerB, CornerC, CornerD, CornerE, CornerF, CornerG, CornerH; disabled
# Adjusting the start and end domain
# of the range positions the twisted
# boxes on specified parts of the thickness.
number_slider_156 = Slider(0.592, range=0..1)  # disabled
number_slider_157 = Slider(0.207, range=0..1)  # disabled
# Adjusting the start and end domain
# of the range positions the twisted
# boxes on specified parts
# between the meshes.
number_slider_158 = Slider(0.592, range=0..1)  # disabled
number_slider_159 = Slider(0.207, range=0..1)  # disabled
brep_3 = Brep(tbox_24)  # disabled
number_slider_160 = Slider(12, range=0..100)  # disabled
# Look at Rhino window
# to preview input
# Brep that was initially made with a
# Rhino Box and then moving the
# solid control points to edit the corners.
# You could also deform the Rhino Box
# with a cage edit.
geo_42 = Geometry(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)  # disabled
# This component has the same functionality
# as the regular Twisted Box Pipe so be
# sure to see the notes above for that. The
# difference is that this component can have
# variable u divisions per corner of the twisted
# boxes. You can also use graph mappers
# for these lists.
swatch_52 = ColourSwatch(SwatchColor=RGB(255, 255, 255))  # disabled
# Look at Rhino window
# to preview results
preview_51 = CustomPreview(Geometry=tboxsweepvar, Shader=swatch_51)  # disabled
# Box Morphing,
# If using Rhino 6
# you can use Pufferfish's
# Multi-Threaded "Morph To Twisted Box" component.
morph_34 = BoxMorph(Geometry=geo_40, Reference=bbox_34.Box, Target=tboxsweepvar)  # disabled
bbox_35 = BoundingBox(Content=geo_41, Plane=PlaneXY(0, 0, 0))  # -> Box, Box_2; disabled
# Input can be
# a box also
tbox_25 = TwistedBox({C=Point(81.58377591, -627.4952361, 3.638681958), C=Point(120.2201939, -627.4952361, 3.638681958), C=Point(120.2201939, -592.621845, 3.638681958), C=Point(81.58377591, -592.621845, 3.638681958), C=Point(81.58377591, -627.4952361, 35.43837563), C=Point(120.2201939, -627.4952361, 35.43837563), C=Point(120.2201939, -592.621845, 35.43837563), C=Point(81.58377591, -592.621845, 35.43837563)})  # disabled
number_slider_161 = Slider(71, range=0..100)  # disabled
debrep = DeconstructBrep(Brep=brep_3)  # -> Faces, Edges, Vertices; disabled
number_slider_162 = Slider(0.248, range=0..1)  # disabled
# Adjusting the start and end domains
# of the range positions the twisted box on
# a specified part of the rails.
number_slider_163 = Slider(0.743, range=0..1)  # disabled
number_slider_164 = Slider(0.248, range=0..1)  # disabled
# Adjusting the start and end domains
# of the range positions the twisted box on
# a specified part of the rails.
number_slider_165 = Slider(0.743, range=0..1)  # disabled
# Adjusting the start and end domains
# of the range positions the twisted box on
# a specified part of the rails.
number_slider_166 = Slider(0.793, range=0..1)  # disabled
number_slider_167 = Slider(0.248, range=0..1)  # disabled
number_slider_168 = Slider(43, range=0..100)  # disabled
# Box defines the size of the array.
# Any box can be used.
number_slider_169 = Slider(50, range=0..100)  # disabled
number_slider_170 = Slider(58, range=0..100)  # disabled
swatch_53 = ColourSwatch(SwatchColor=RGB(255, 0, 255))  # disabled
X_4 = UnitX(Factor=number_slider_133)  # disabled
number_slider_171 = Slider(2, range=0..10)  # disabled
number_slider_172 = Slider(2, range=0..10)  # disabled
number_slider_173 = Slider(1, range=0..10)  # disabled
number_slider_174 = Slider(3, range=0..100)  # disabled
number_slider_175 = Slider(3, range=0..100)  # disabled
number_slider_176 = Slider(6, range=0..10)  # disabled
number_slider_177 = Slider(3, range=0..100)  # disabled
number_slider_178 = Slider(6, range=0..10)  # disabled
number_slider_179 = Slider(5, range=0..100)  # disabled
number_slider_180 = Slider(5, range=0..10)  # disabled
number_slider_181 = Slider(3, range=0..100)  # disabled
X_5 = UnitX(Factor=number_slider_134)  # disabled
Z_6 = UnitZ(Factor=number_slider_135)  # disabled
Z_7 = UnitZ(Factor=number_slider_136)  # disabled
reftbox_2 = ReferenceTwistedBox(Polysurface=geo_42)  # disabled
# Look at Rhino window
# to preview results
preview_52 = CustomPreview(Geometry=tboxpipevar, Shader=swatch_52)  # disabled
tbox_26 = TwistedBox(geo_42)  # disabled
# Box Morphing,
# If using Rhino 6
# you can use Pufferfish's
# Multi-Threaded "Morph To Twisted Box" component.
morph_35 = BoxMorph(Geometry=geo_41, Reference=bbox_35.Box, Target=tboxpipevar)  # disabled
dom_7 = ConstructDomain(DomainStart=number_slider_138, DomainEnd=number_slider_139)  # disabled
dom_8 = ConstructDomain(DomainStart=number_slider_140, DomainEnd=number_slider_141)  # disabled
dom_9 = ConstructDomain(DomainStart=number_slider_142, DomainEnd=number_slider_143)  # disabled
dom_10 = ConstructDomain(DomainStart=number_slider_144, DomainEnd=number_slider_145)  # disabled
dom_11 = ConstructDomain(DomainStart=number_slider_146, DomainEnd=number_slider_147)  # disabled
dom_12 = ConstructDomain(DomainStart=number_slider_148, DomainEnd=number_slider_149)  # disabled
dom_13 = ConstructDomain(DomainStart=number_slider_154, DomainEnd=number_slider_155)  # disabled
dom_14 = ConstructDomain(DomainStart=number_slider_150, DomainEnd=number_slider_151)  # disabled
dom_15 = ConstructDomain(DomainStart=number_slider_152, DomainEnd=number_slider_153)  # disabled
number_slider_182 = Slider(70, range=0..100)  # disabled
number_slider_183 = Slider(10, range=0..100)  # disabled
move_6 = Move(Geometry=tbox_corners_2.CornerF, Motion=X_5)  # -> Geometry, Transform; disabled
move_7 = Move(Geometry=tbox_corners_2.CornerG, Motion=Z_6)  # -> Geometry, Transform; disabled
# Perform some operations on specific
# corners and reconstruct the twisted box
# with Grasshoppers Twisted Box component.
move_8 = Move(Geometry=tbox_corners_2.CornerH, Motion=Z_7)  # -> Geometry, Transform; disabled
# Graphmappers creating gradient spacing.
range_49 = Range(Domain=Domain(0, 1), Steps=number_slider_160)  # disabled
# TB@
# index 0
# Using Non-Normalized Factor
number_slider_184 = Slider(1.5, range=0..2)  # disabled
number_slider_185 = Slider(8, range=0..10)  # disabled
number_slider_186 = Slider(8, range=0..10)  # disabled
dom_16 = ConstructDomain(DomainStart=number_slider_157, DomainEnd=number_slider_156)  # disabled
geo_43 = Geometry(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)  # disabled
dom_17 = ConstructDomain(DomainStart=number_slider_159, DomainEnd=number_slider_158)  # disabled
deformtbox_2 = DeformTwistedBox(TwistedBox=tbox_25, Indices=number_slider_137, Motions=X_4)  # -> Deformed, Index; disabled
# If you try to use grasshoppers twisted box
# parameter it will only output the twisted box
# for the Breps bounding box.
# Look at Rhino window
# to preview results
preview_53 = CustomPreview(Geometry=tbox_26, Shader=swatch_53)  # disabled
number_slider_187 = Slider(8, range=0..10)  # disabled
number_slider_188 = Slider(8.96, range=0..10)  # disabled
# Weights the division distribution by curvature
# if the curve is not linear and degree is not 1.
number_slider_189 = Slider(-8.058, range=-20..20)  # disabled
number_slider_190 = Slider(3.497, range=-20..20)  # disabled
number_slider_191 = Slider(-4.576, range=-20..20)  # disabled
number_slider_192 = Slider(8.96, range=0..10)  # disabled
# Domain sizes of the
# twisted boxes from
# the curve. You can use
# single numbers also.
# For easy symmetrical
# sizes use Pufferfish's
# "Two Way Domain" component
number_slider_193 = Slider(9.86, range=-20..20)  # disabled
number_slider_194 = Slider(0.222, range=0..1)  # disabled
# Adjusting the start and end domains
# of the range positions the twisted box on
# a specified part of the thickness.
number_slider_195 = Slider(0.473, range=0..1)  # disabled
# Adjusting the start and end domain
# of the range positions the twisted
# boxes on specified parts
# between the meshes.
number_slider_196 = Slider(0.592, range=0..1)  # disabled
number_slider_197 = Slider(0.207, range=0..1)  # disabled
number_slider_198 = Slider(0.401, range=0..1)  # disabled
# Adjusting the start and end domains
# of the range positions the twisted box on
# a specified part of the curve.
number_slider_199 = Slider(0.872, range=0..1)  # disabled
Z_8 = UnitZ(Factor=number_slider_161)  # disabled
number_slider_200 = Slider(0.324, range=0..1)  # disabled
# Adjusting the start and end domains
# of the range positions the twisted box on
# a specified part of the curve.
number_slider_201 = Slider(0.872, range=0..1)  # disabled
number_slider_202 = Slider(0.061, range=0..1)  # disabled
number_slider_203 = Slider(0.517, range=0..1)  # disabled
# Adjusting the start and end domains
# of the ranges positions the twisted
# boxes on specified parts of the surface.
number_slider_204 = Slider(0.814, range=0..1)  # disabled
number_slider_205 = Slider(0.335, range=0..1)  # disabled
number_slider_206 = Slider(0.592, range=0..1)  # disabled
number_slider_207 = Slider(0.207, range=0..1)  # disabled
crv_23 = Curve(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)  # disabled
# Change boolean to False
# to turn off Normalized Factor
# When Normalized is False the factor is
# from 0 to the last index. This
# can be considered like a timeline.
# This lets each twisted box have an equally
# controllable section of the slider between.
# As opposed to going from 0 to 1, this lets
# you easily pinpoint your location.
# You can use lists / mutiple factors as well.
toggle_30 = BooleanToggle(False)  # disabled
geo_44 = Geometry(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)  # disabled
bbox_36 = BoundingBox(Content=geo_43, Plane=PlaneXY(0, 0, 0))  # -> Box, Box_2; disabled
range_50 = Range(Domain=dom_8, Steps=number_slider_171)  # disabled
range_51 = Range(Domain=dom_10, Steps=number_slider_172)  # disabled
range_52 = Range(Domain=dom_12, Steps=number_slider_173)  # disabled
range_53 = Range(Domain=dom_7, Steps=number_slider_176)  # disabled
range_54 = Range(Domain=dom_9, Steps=number_slider_178)  # disabled
range_55 = Range(Domain=dom_11, Steps=number_slider_180)  # disabled
range_56 = Range(Domain=dom_16, Steps=number_slider_174)  # disabled
range_57 = Range(Domain=dom_14, Steps=number_slider_175)  # disabled
range_58 = Range(Domain=dom_15, Steps=number_slider_177)  # disabled
range_59 = Range(Domain=dom_13, Steps=number_slider_179)  # disabled
range_60 = Range(Domain=dom_17, Steps=number_slider_181)  # disabled
box_2 = CenterBox(Base=PlaneXY(1629.166302, -113.0696505, 0), X=number_slider_169, Y=number_slider_170, Z=number_slider_168)  # disabled
graph_11 = GraphMapper(
    range_49,
    x0=0,
    x1=1,
    y0=0,
    y1=1,
    container_name="Bezier",
    cpx=[0, 0.8319993615, 0.2199984491, 1],
    cpy=[0, 0.1687344909, 0.4554554224, 1])  # disabled
# Thickness of the strip
dom_18 = ConstructDomain(DomainStart=number_slider_164, DomainEnd=number_slider_165)  # disabled
# Thickness of the strip
dom_19 = ConstructDomain(DomainStart=number_slider_167, DomainEnd=number_slider_166)  # disabled
dom_20 = ConstructDomain(DomainStart=number_slider_162, DomainEnd=number_slider_163)  # disabled
swatch_54 = ColourSwatch(SwatchColor=RGB(255, 0, 255))  # disabled
mesh_8 = Mesh(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)  # disabled
mesh_9 = Mesh(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)  # disabled
mesh_10 = Mesh(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)  # disabled
srf_10 = Surface(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)  # disabled
srf_11 = Surface(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)  # disabled
srf_12 = Surface(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)  # disabled
# Index of corner being deformed
panel_17 = Panel(deformtbox_2.Index)  # disabled
# Inputs can be
# a box also
tbox_27 = TwistedBox({C=Point(444.2767164, -2.885417957, 2.848093993), C=Point(455.98362, -0.6798435998, 8.131637228), C=Point(455.7794418, 5.034487917, -0.8745563705), C=Point(444.2767164, 7.042854922, -1.296386917), C=Point(444.8508072, 3.732387969, 18.70131772), C=Point(456.3535326, 7.113097098, 16.87352001), C=Point(456.1968651, 11.70660347, 9.87581275), C=Point(444.9104269, 12.02702404, 17.17204554)})  # disabled
tbox_28 = TwistedBox({C=Point(439.1464704, 37.64169373, 14.8223935), C=Point(443.421863, 30.93001684, 14.19478221), C=Point(451.4483654, 37.40224869, 15.27984079), C=Point(445.0909069, 46.08260893, 17.84926463), C=Point(432.1915553, 30.04218679, 22.30910542), C=Point(442.4324938, 31.98562418, 28.50821515), C=Point(435.6724648, 39.75976106, 31.04952635), C=Point(431.527282, 37.52423645, 26.14588654)})  # disabled
# TB@
# index 1
# TB@
# index 2
tbox_29 = TwistedBox({C=Point(475.5540125, 37.64169373, 7.15216462), C=Point(479.8294051, 30.93001684, 6.52455333), C=Point(487.8559076, 37.40224869, 7.609611906), C=Point(481.4984491, 46.08260893, 3.013852335), C=Point(467.582246, 41.23451945, 14.63887654), C=Point(465.2612444, 31.07249595, 20.83798627), C=Point(478.363124, 34.1528845, 23.37929747), C=Point(477.9749909, 43.56728227, 18.47565766)})  # disabled
tbox_30 = TwistedBox(
    CornerA=tbox_corners_2.CornerA,
    CornerB=tbox_corners_2.CornerB,
    CornerC=tbox_corners_2.CornerC,
    CornerD=tbox_corners_2.CornerD,
    CornerE=tbox_corners_2.CornerE,
    CornerF=move_6.Geometry,
    CornerG=move_7.Geometry,
    CornerH=move_8.Geometry)  # disabled
# Determines the twisted box corner
# locations in the surface
# Weights the u division distribution by curvature
# if the curve is not linear and degree is not 1.
number_slider_208 = Slider(0.75, range=0..1)  # disabled
number_slider_209 = Slider(0.5, range=0..1)  # disabled
swatch_55 = ColourSwatch(SwatchColor=RGB(255, 0, 255))  # disabled
number_slider_210 = Slider(0, range=0..1)  # disabled
number_slider_211 = Slider(0.25, range=0..1)  # disabled
geo_45 = Geometry(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)  # disabled
swatch_56 = ColourSwatch(SwatchColor=RGB(255, 255, 255))  # disabled
swatch_57 = ColourSwatch(SwatchColor=RGB(255, 255, 255))  # disabled
wires_2 = BrepWireframe(Brep=box_2, Density=-1)  # disabled
number_slider_212 = Slider(3, range=0..100)  # disabled
# Weights the division distribution by curvature
# if the rails are not linear and degree is not 1.
toggle_31 = BooleanToggle(False)  # disabled
bbox_37 = BoundingBox(Content=geo_44, Plane=PlaneXY(0, 0, 0))  # -> Box, Box_2; disabled
number_slider_213 = Slider(6, range=0..100)  # disabled
number_slider_214 = Slider(8, range=0..100)  # disabled
# Weights the division distribution by curvature
# if the rails are not linear and degree is not 1.
toggle_32 = BooleanToggle(False)  # disabled
# Weights the division distribution by curvature
# if the rails are not linear and degree is not 1.
toggle_33 = BooleanToggle(False)  # disabled
number_slider_215 = Slider(3, range=0..10)  # disabled
# Box Morphing,
# If using Rhino 6
# you can use Pufferfish's
# Multi-Threaded "Morph To Twisted Box" component.
morph_36 = BoxMorph(Geometry=geo_43, Reference=bbox_36.Box, Target=deformtbox_2.Deformed)  # disabled
# Weights the division distribution by curvature
# if the interpolation is not linear and degree is not 1.
toggle_34 = BooleanToggle(False)  # disabled
mesh_11 = Mesh([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])  # disabled
# Rotation around twisted box centers
number_slider_216 = Slider(360, range=-1000..1000)  # disabled
# Rail curves
crv_24 = Curve(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)  # disabled
crv_25 = Curve(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)  # disabled
crv_26 = Curve(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)  # disabled
crv_27 = Curve(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)  # disabled
# Rail curves
crv_28 = Curve(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)  # disabled
crv_29 = Curve(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)  # disabled
# Rail curves
crv_30 = Curve([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])  # disabled
range_61 = Range(Domain=dom_18, Steps=number_slider_185)  # disabled
range_62 = Range(Domain=dom_19, Steps=number_slider_186)  # disabled
range_63 = Range(Domain=dom_20, Steps=number_slider_187)  # disabled
bbox_38 = BoundingBox(Content=geo_45, Plane=PlaneXY(0, 0, 0))  # -> Box, Box_2; disabled
# Completely fill or subtract
# mesh with twisted boxes
# Mesh to fill or subtract
number_slider_217 = Slider(15, range=0..20)  # disabled
# Completely fill or subtract
# polysurface with twisted boxes
# Polysurface to fill or subtract
number_slider_218 = Slider(15, range=0..20)  # disabled
swatch_58 = ColourSwatch(SwatchColor=RGB(255, 0, 255))  # disabled
number_slider_219 = Slider(2, range=0..10)  # disabled
number_slider_220 = Slider(6, range=0..10)  # disabled
toggle_35 = BooleanToggle(False)  # disabled
swatch_59 = ColourSwatch(SwatchColor=RGB(255, 0, 255))  # disabled
number_slider_221 = Slider(3, range=0..100)  # disabled
# When Normalized is False
# w Parameter is from 0 to the last index.
# This lets each mesh have an equally
# controllable section of parameters between.
# As opposed to going from 0 to 1 where
# it would be hard to control with many meshes.
# This lets you easily pinpoint your location.
# So if there is 3 meshes, parameters
# from 0 to 1 would be between mesh 1 and 2.
# Parameters from 1 to 2 would be between
# mesh 2 and 3
number_slider_222 = Slider(6, range=0..10)  # disabled
# When Normalized is False
# w Parameter is from 0 to the last index.
# This lets each surface have an equally
# controllable section of parameters between.
# As opposed to going from 0 to 1 where
# it would be hard to control with many surfaces.
# This lets you easily pinpoint your location.
# So if there is 3 surfaces, parameters
# from 0 to 1 would be between surface 1 and 2.
# Parameters from 1 to 2 would be between
# surface 2 and 3
number_slider_223 = Slider(6, range=0..10)  # disabled
# Look at Rhino window
# to preview inputs
preview_54 = CustomPreview(Geometry=crv_23, Shader=swatch_54)  # disabled
swatch_60 = ColourSwatch(SwatchColor=RGB(255, 0, 255))  # disabled
number_slider_224 = Slider(6, range=0..10)  # disabled
number_slider_225 = Slider(3, range=0..100)  # disabled
swatch_61 = ColourSwatch(SwatchColor=RGB(255, 255, 255))  # disabled
number_slider_226 = Slider(3, range=0..7)  # disabled
# Look at Rhino window
# to preview results
preview_55 = CustomPreview(Geometry=reftbox_2, Shader=swatch_56)  # disabled
# Look at Rhino window
# to preview results
preview_56 = CustomPreview(Geometry=wires_2, Shader=swatch_55)  # disabled
tboxsrf_2 = TwistedBoxSurface(Surface=srf_12, Thickness=number_slider_183, ParametersU=range_57, ParametersV=range_53, ParametersW=range_50)  # disabled
mesh_12 = Mesh([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])  # disabled
tboxmsh_2 = TwistedBoxMesh(Mesh=mesh_8, Thickness=number_slider_182, ParametersW=range_56)  # disabled
tbox2srfs_2 = TwistedBoxTwoSurfaces(SurfaceA=srf_10, SurfaceB=srf_11, ParametersU=range_58, ParametersV=range_54, ParametersW=range_51)  # disabled
tbox2mshs_2 = TwistedBoxTwoMeshes(MeshA=mesh_9, MeshB=mesh_10, ParametersW=range_60)  # disabled
tboxarray_7 = TwistedBoxArray(Box=box_2, ParametersX=range_59, ParametersY=range_55, ParametersZ=range_52)  # disabled
dom_21 = ConstructDomain(DomainStart=number_slider_189, DomainEnd=number_slider_190)  # disabled
dom_22 = ConstructDomain(DomainStart=number_slider_191, DomainEnd=number_slider_193)  # disabled
# Box Morphing,
# If using Rhino 6
# you can use Pufferfish's
# Multi-Threaded "Morph To Twisted Box" component.
# The Reference Twisted Box will not
# work for Grasshopper boxes. For that
# you can use Grasshoppers Twisted Box
# parameter or Twisted Box component.
morph_37 = BoxMorph(Geometry=geo_44, Reference=bbox_37.Box, Target=reftbox_2)  # disabled
# Look at Rhino window
# to preview results
preview_57 = CustomPreview(Geometry=deformtbox_2.Deformed, Shader=swatch_57)  # disabled
dom_23 = ConstructDomain(DomainStart=number_slider_194, DomainEnd=number_slider_195)  # disabled
# Determines how the interpolation path is interpolated.
# Determines the curvature degree of the interpolation path if the interpolation type is not linear.
number_slider_227 = Slider(0, range=0..3)  # disabled
# Rotation around curve
number_slider_228 = Slider(-421, range=-1000..1000)  # disabled
dom_24 = ConstructDomain(DomainStart=number_slider_197, DomainEnd=number_slider_196)  # disabled
tboxextr_2 = TwistedBoxExtrude(Profile=crv_23, Direction=Z_8, ParametersT=graph_11, Weighted=False)  # disabled
srf_13 = Surface([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])  # disabled
dom_25 = ConstructDomain(DomainStart=number_slider_198, DomainEnd=number_slider_199)  # disabled
dom_26 = ConstructDomain(DomainStart=number_slider_200, DomainEnd=number_slider_201)  # disabled
dom_27 = ConstructDomain(DomainStart=number_slider_202, DomainEnd=number_slider_203)  # disabled
dom_28 = ConstructDomain(DomainStart=number_slider_205, DomainEnd=number_slider_204)  # disabled
dom_29 = ConstructDomain(DomainStart=number_slider_207, DomainEnd=number_slider_206)  # disabled
srf_14 = Surface(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)  # disabled
srf_15 = Surface([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])  # disabled
# Use to flip the twisted box flow direction
# if it is flowing the opposite way that it should.
# Depends of the way you build your surface.
toggle_36 = BooleanToggle(False)  # disabled
number_slider_229 = Slider(0, range=0..1)  # disabled
number_slider_230 = Slider(0.567, range=0..1)  # disabled
number_slider_231 = Slider(0.335, range=0..1)  # disabled
# Adjusting the start and end domains
# of the ranges positions the twisted boxes on
# specified parts of the pipe around the curve.
number_slider_232 = Slider(0.895, range=0..1)  # disabled
# Box Morphing,
# If using Rhino 6
# you can use Pufferfish's
# Multi-Threaded "Morph To Twisted Box" component.
morph_38 = BoxMorph(Geometry=geo_45, Reference=bbox_38.Box, Target=tbox_30)  # disabled
number_slider_233 = Slider(0.198, range=0..1)  # disabled
number_slider_234 = Slider(0.608, range=0..1)  # disabled
lng = ListLength(List=mesh_12)  # -> expr("x-1", Length); disabled
lng_2 = ListLength(List=srf_13)  # -> expr("x-1", Length); disabled
# Thickness factor
number_slider_235 = Slider(0.823, range=0..1)  # disabled
twnthrutboxs_2 = TweenThroughTwistedBoxes(
    TwistedBoxes=[tbox_27, tbox_28, tbox_29],
    Factor=number_slider_184,
    Normalized=toggle_30,
    Equalized=False,
    Weighted=False,
    Degree=3,
    InterpolationType=0)  # disabled
geo_46 = Geometry(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)  # disabled
geo_47 = Geometry(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)  # disabled
geo_48 = Geometry(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)  # disabled
geo_49 = Geometry(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)  # disabled
geo_50 = Geometry(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)  # disabled
# Weights the division distribution by curvature
# if the interpolation is not linear and degree is not 1.
toggle_37 = BooleanToggle(False)  # disabled
geo_51 = Geometry(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)  # disabled
# Look at Rhino window
# to preview inputs
preview_58 = CustomPreview(Geometry=[crv_28, crv_29], Shader=swatch_59)  # disabled
# Look at Rhino window
# to preview inputs
preview_59 = CustomPreview(Geometry=crv_30, Shader=swatch_58)  # disabled
# Look at Rhino window
# to preview inputs
preview_60 = CustomPreview(Geometry=[crv_24, crv_25, crv_26, crv_27], Shader=swatch_60)  # disabled
# Look at Rhino window
# to preview results
preview_61 = CustomPreview(Geometry=tbox_30, Shader=swatch_61)  # disabled
number_slider_236 = Slider(-8.058, range=-20..20)  # disabled
# Domain offset of the
# twisted boxes from
# the curve. You can use
# single numbers also.
number_slider_237 = Slider(3.497, range=-20..20)  # disabled
range_64 = Range(Domain=dom_24, Steps=number_slider_212)  # disabled
tboxsweep_2 = TwistedBoxSweep(R¹=crv_24, R²=crv_25, R³=crv_26, R⁴=crv_27, t=range_63, W=toggle_31)  # disabled
range_65 = Range(Domain=dom_25, Steps=number_slider_213)  # disabled
range_66 = Range(Domain=dom_26, Steps=number_slider_214)  # disabled
# Change boolean to False
# to turn off Normalized Factor
toggle_38 = BooleanToggle(False)  # disabled
range_67 = Range(Domain=dom_23, Steps=number_slider_215)  # disabled
# Change boolean to False
# to turn off Normalized Factor
toggle_39 = BooleanToggle(False)  # disabled
crv_31 = Curve(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)  # disabled
# Weights the division distribution by curvature
# if the curve is not linear and degree is not 1.
number_slider_238 = Slider(30, range=0..100)  # disabled
# Diameter and thickness
number_slider_239 = Slider(8, range=0..100)  # disabled
# Use bounding box
# to completely fill
# or subtract
mesh_13 = Mesh(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)  # disabled
swatch_62 = ColourSwatch(SwatchColor=RGB(255, 255, 255))  # disabled
# Use bounding box
# to completely fill
# or subtract
brep_4 = Brep(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)  # disabled
number_slider_240 = Slider(3, range=0..7)  # disabled
geo_52 = Geometry(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)  # disabled
bbox_39 = BoundingBox(Content=geo_49, Plane=PlaneXY(0, 0, 0))  # -> Box, Box_2; disabled
range_68 = Range(Domain=dom_28, Steps=number_slider_219)  # disabled
range_69 = Range(Domain=dom_27, Steps=number_slider_220)  # disabled
swatch_63 = ColourSwatch(SwatchColor=RGB(255, 255, 255))  # disabled
range_70 = Range(Domain=dom_29, Steps=number_slider_221)  # disabled
range_71 = Range(Domain=lng, Steps=number_slider_222)  # disabled
swatch_64 = ColourSwatch(SwatchColor=RGB(255, 255, 255))  # disabled
bbox_40 = BoundingBox(Content=geo_46, Plane=PlaneXY(0, 0, 0))  # -> Box, Box_2; disabled
bbox_41 = BoundingBox(Content=geo_47, Plane=PlaneXY(0, 0, 0))  # -> Box, Box_2; disabled
bbox_42 = BoundingBox(Content=geo_48, Plane=PlaneXY(0, 0, 0))  # -> Box, Box_2; disabled
bbox_43 = BoundingBox(Content=geo_51, Plane=PlaneXY(0, 0, 0))  # -> Box, Box_2; disabled
bbox_44 = BoundingBox(Content=geo_50, Plane=PlaneXY(0, 0, 0))  # -> Box, Box_2; disabled
swatch_65 = ColourSwatch(SwatchColor=RGB(255, 255, 255))  # disabled
swatch_66 = ColourSwatch(SwatchColor=RGB(255, 255, 255))  # disabled
range_72 = Range(Domain=lng_2, Steps=number_slider_223)  # disabled
toggle_40 = BooleanToggle(False)  # disabled
swatch_67 = ColourSwatch(SwatchColor=RGB(255, 255, 255))  # disabled
# Determines how the interpolation path is interpolated.
# Determines the curvature degree of the interpolation path if the interpolation type is not linear.
number_slider_241 = Slider(0, range=0..3)  # disabled
range_73 = Range(Domain=Domain(0, 1), Steps=number_slider_224)  # disabled
range_74 = Range(Domain=Domain(0, 1), Steps=number_slider_217)  # disabled
range_75 = Range(Domain=Domain(0, 1), Steps=number_slider_218)  # disabled
range_76 = Range(Domain=Domain(0, 1), Steps=number_slider_225)  # disabled
geo_53 = Geometry(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)  # disabled
tboxstrips_2 = TwistedBoxStrips(Rails=crv_30, Thickness=number_slider_192, ParametersT=range_62, Weighted=toggle_33)  # disabled
tboxstrip_2 = TwistedBoxStrip(Rail1=crv_28, Rail2=crv_29, Thickness=number_slider_188, ParametersT=range_61, Weighted=toggle_32)  # disabled
# Decides whether to have a
# twisted box in the center or not.
toggle_41 = BooleanToggle(True)  # disabled
# Switch which side of the
# twisted boxes get trimmed away
# Determines how much of the
# twisted boxes to trim away:
# 0:Complete
# 1:Halfway
# 2:Partial
number_slider_242 = Slider(0, range=0..3)  # disabled
# Switch which side of the
# twisted boxes get trimmed away
# Determines how much of the
# twisted boxes to trim away:
# 0:Complete
# 1:Halfway
# 2:Partial
number_slider_243 = Slider(0, range=0..3)  # disabled
swatch_68 = ColourSwatch(SwatchColor=RGB(0, 76, 255))  # disabled
toggle_42 = BooleanToggle(False)  # disabled
bbox_45 = BoundingBox(Content=mesh_13, Plane=PlaneXY(0, 0, 0))  # -> Box, Box_2; disabled
bbox_46 = BoundingBox(Content=brep_4, Plane=PlaneXY(0, 0, 0))  # -> Box, Box_2; disabled
number_slider_244 = Slider(2, range=0..10)  # disabled
# Input can be
# a box also
tbox_31 = TwistedBox({C=Point(48, -773, 0), C=Point(77, -773, 0), C=Point(77, -748, 0), C=Point(48, -748, 0), C=Point(48, -773, 28), C=Point(77, -773, 28), C=Point(77, -748, 28), C=Point(48, -748, 28)})  # disabled
number_slider_245 = Slider(10, range=0..100)  # disabled
number_slider_246 = Slider(7, range=0..10)  # disabled
swatch_69 = ColourSwatch(SwatchColor=RGB(255, 255, 255))  # disabled
bbox_47 = BoundingBox(Content=geo_52, Plane=PlaneXY(0, 0, 0))  # -> Box, Box_2; disabled
tboxcrv_2 = TwistedBoxCurve(
    Curve=crv_31,
    ParametersT=range_65,
    Weighted=toggle_35,
    SizeX=dom_21,
    SizeY=dom_22,
    Rotation1=number_slider_216,
    Rotation2=number_slider_228)  # disabled
# Box Morphing,
# If using Rhino 6
# you can use Pufferfish's
# Multi-Threaded "Morph To Twisted Box" component.
morph_39 = BoxMorph(Geometry=geo_49, Reference=bbox_39.Box, Target=tboxextr_2)  # disabled
# Look at Rhino window
# to preview results
preview_62 = CustomPreview(Geometry=tboxextr_2, Shader=swatch_62)  # disabled
bbox_48 = BoundingBox(Content=geo_53, Plane=PlaneXY(0, 0, 0))  # -> Box, Box_2; disabled
# Box Morphing,
# If using Rhino 6
# you can use Pufferfish's
# Multi-Threaded "Morph To Twisted Box" component.
morph_40 = BoxMorph(Geometry=geo_46, Reference=bbox_40.Box, Target=tboxmsh_2)  # disabled
# Box Morphing,
# If using Rhino 6
# you can use Pufferfish's
# Multi-Threaded "Morph To Twisted Box" component.
morph_41 = BoxMorph(Geometry=geo_47, Reference=bbox_41.Box, Target=tboxsrf_2)  # disabled
# Box Morphing,
# If using Rhino 6
# you can use Pufferfish's
# Multi-Threaded "Morph To Twisted Box" component.
morph_42 = BoxMorph(Geometry=geo_48, Reference=bbox_42.Box, Target=tbox2srfs_2)  # disabled
# Box Morphing,
# If using Rhino 6
# you can use Pufferfish's
# Multi-Threaded "Morph To Twisted Box" component.
morph_43 = BoxMorph(Geometry=geo_51, Reference=bbox_43.Box, Target=tboxarray_7)  # disabled
# Box Morphing,
# If using Rhino 6
# you can use Pufferfish's
# Multi-Threaded "Morph To Twisted Box" component.
morph_44 = BoxMorph(Geometry=geo_50, Reference=bbox_44.Box, Target=tbox2mshs_2)  # disabled
geo_54 = Geometry(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)  # disabled
geo_55 = Geometry(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)  # disabled
# Look at Rhino window
# to preview results
preview_63 = CustomPreview(Geometry=tboxmsh_2, Shader=swatch_63)  # disabled
# Using unevenly spaced parameter
# values will result in uneven spaced
# twisted boxes. The spacing can be
# controlled with custom values
# such as values from graph mappers.
# Look at Rhino window
# to preview results
preview_64 = CustomPreview(Geometry=tboxsrf_2, Shader=swatch_67)  # disabled
# Using unevenly spaced parameter
# values will result in uneven spaced
# twisted boxes. The spacing can be
# controlled with custom values
# such as values from graph mappers.
# Look at Rhino window
# to preview results
preview_65 = CustomPreview(Geometry=tbox2srfs_2, Shader=swatch_66)  # disabled
# Using unevenly spaced parameter
# values will result in uneven spaced
# twisted boxes. The spacing can be
# controlled with custom values
# such as values from graph mappers.
# Look at Rhino window
# to preview results
preview_66 = CustomPreview(Geometry=tboxarray_7, Shader=swatch_64)  # disabled
# Look at Rhino window
# to preview results
preview_67 = CustomPreview(Geometry=tbox2mshs_2, Shader=swatch_65)  # disabled
dom_30 = ConstructDomain(DomainStart=number_slider_229, DomainEnd=number_slider_230)  # disabled
dom_31 = ConstructDomain(DomainStart=number_slider_231, DomainEnd=number_slider_232)  # disabled
# Rotation around twisted box centers
number_slider_247 = Slider(360, range=-1000..1000)  # disabled
dom_32 = ConstructDomain(DomainStart=number_slider_233, DomainEnd=number_slider_234)  # disabled
toggle_43 = BooleanToggle(True)  # disabled
toggle_44 = BooleanToggle(True)  # disabled
swatch_70 = ColourSwatch(SwatchColor=RGB(255, 255, 255))  # disabled
swatch_71 = ColourSwatch(SwatchColor=RGB(255, 255, 255))  # disabled
# Look at Rhino window
# to preview results
preview_68 = CustomPreview(Geometry=twnthrutboxs_2, Shader=swatch_68)  # disabled
geo_56 = Geometry(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)  # disabled
tboxpipe_2 = TwistedBoxPipe(
    Surface=srf_14,
    ParametersU=range_66,
    ParameterV1=number_slider_210,
    ParameterV2=number_slider_211,
    ParameterV3=number_slider_209,
    ParameterV4=number_slider_208,
    Weighted=toggle_36,
    Flip=toggle_40)  # disabled
# Making twisted boxes to boolean
tboxarray_8 = TwistedBoxArray(Box=bbox_45.Box, ParametersX=range_74, ParametersY=range_74, ParametersZ=range_74)  # disabled
# Making twisted boxes to boolean
tboxarray_9 = TwistedBoxArray(Box=bbox_46.Box, ParametersX=range_75, ParametersY=range_75, ParametersZ=range_75)  # disabled
tboxconmshs_2 = TwistedBoxConsecutiveMeshes(Meshes=mesh_11, ParametersW=range_64, Weighted=toggle_34, Degree=number_slider_226, InterpolationType=number_slider_227)  # disabled
# Just to display boundary
# of twisted boxes
edges_6 = BrepEdges(Brep=bbox_45.Box)  # -> Naked, Interior, NonManifold; disabled
# Just to display boundary
# of twisted boxes
edges_7 = BrepEdges(Brep=bbox_46.Box)  # -> Naked, Interior, NonManifold; disabled
dom_33 = ConstructDomain(DomainStart=number_slider_236, DomainEnd=number_slider_237)  # disabled
# Rotation around curve
number_slider_248 = Slider(-421, range=-1000..1000)  # disabled
thicktbox_2 = ThickenTwistedBox(TwistedBox=tbox_31, Thickness=number_slider_235, ParametersW=range_67, Hollow=toggle_41)  # disabled
# Box Morphing,
# If using Rhino 6
# you can use Pufferfish's
# Multi-Threaded "Morph To Twisted Box" component.
morph_45 = BoxMorph(Geometry=geo_52, Reference=bbox_47.Box, Target=twnthrutboxs_2)  # disabled
bbox_49 = BoundingBox(Content=geo_54, Plane=PlaneXY(0, 0, 0))  # -> Box, Box_2; disabled
bbox_50 = BoundingBox(Content=geo_55, Plane=PlaneXY(0, 0, 0))  # -> Box, Box_2; disabled
# Look at Rhino window
# to preview results
preview_69 = CustomPreview(Geometry=tboxsweep_2, Shader=swatch_69)  # disabled
# Box Morphing,
# If using Rhino 6
# you can use Pufferfish's
# Multi-Threaded "Morph To Twisted Box" component.
morph_46 = BoxMorph(Geometry=geo_53, Reference=bbox_48.Box, Target=tboxsweep_2)  # disabled
geo_57 = Geometry(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)  # disabled
geo_58 = Geometry(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)  # disabled
bbox_51 = BoundingBox(Content=geo_56, Plane=PlaneXY(0, 0, 0))  # -> Box, Box_2; disabled
tboxthrumshs_2 = TwistedBoxThroughMeshes(
    Meshes=mesh_12,
    ParametersW=range_71,
    Normalized=toggle_39,
    Equalized=False,
    Weighted=False,
    Degree=3,
    InterpolationType=0)  # disabled
tboxthrusrfs_2 = TwistedBoxThroughSurfaces(
    Surfaces=srf_13,
    ParametersU=range_76,
    ParametersV=range_73,
    ParametersW=range_72,
    Normalized=toggle_38,
    Equalized=False,
    Weighted=False,
    Degree=3,
    InterpolationType=0)  # disabled
swatch_72 = ColourSwatch(SwatchColor=RGB(255, 255, 255))  # disabled
range_77 = Range(Domain=dom_31, Steps=number_slider_244)  # disabled
range_78 = Range(Domain=dom_30, Steps=number_slider_246)  # disabled
range_79 = Range(Domain=dom_32, Steps=number_slider_245)  # disabled
crv_32 = Curve(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)  # disabled
# Using unevenly spaced parameter
# values will result in uneven spaced
# twisted boxes. The spacing can be
# controlled with custom values
# such as values from graph mappers.
# Look at Rhino window
# to preview results
preview_70 = CustomPreview(Geometry=tboxstrip_2, Shader=swatch_70)  # disabled
# Using unevenly spaced parameter
# values will result in uneven spaced
# twisted boxes. The spacing can be
# controlled with custom values
# such as values from graph mappers.
# Look at Rhino window
# to preview results
preview_71 = CustomPreview(Geometry=tboxstrips_2, Shader=swatch_71)  # disabled
bbox_52 = BoundingBox(Content=geo_57, Plane=PlaneXY(0, 0, 0))  # -> Box, Box_2; disabled
# Box Morphing,
# If using Rhino 6
# you can use Pufferfish's
# Multi-Threaded "Morph To Twisted Box" component.
morph_47 = BoxMorph(Geometry=geo_54, Reference=bbox_49.Box, Target=tboxstrip_2)  # disabled
# Box Morphing,
# If using Rhino 6
# you can use Pufferfish's
# Multi-Threaded "Morph To Twisted Box" component.
morph_48 = BoxMorph(Geometry=geo_55, Reference=bbox_50.Box, Target=tboxstrips_2)  # disabled
geo_59 = Geometry(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)  # disabled
tboxconsrfs_2 = TwistedBoxConsecutiveSurfaces(
    Surfaces=srf_15,
    ParametersU=range_70,
    ParametersV=range_69,
    ParametersW=range_68,
    Weighted=toggle_37,
    Degree=number_slider_240,
    InterpolationType=number_slider_241)  # disabled
swatch_73 = ColourSwatch(SwatchColor=RGB(255, 255, 255))  # disabled
swatch_74 = ColourSwatch(SwatchColor=RGB(255, 255, 255))  # disabled
bbox_53 = BoundingBox(Content=geo_58, Plane=PlaneXY(0, 0, 0))  # -> Box, Box_2; disabled
box_3 = CenterBox(Base=PlaneXY(180.2044702, -287.196372, 0), X=15, Y=15, Z=15)  # disabled
geo_60 = Geometry(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)  # disabled
swatch_75 = ColourSwatch(SwatchColor=RGB(255, 255, 255))  # disabled
# Box Morphing,
# If using Rhino 6
# you can use Pufferfish's
# Multi-Threaded "Morph To Twisted Box" component.
morph_49 = BoxMorph(Geometry=geo_56, Reference=bbox_51.Box, Target=tboxcrv_2)  # disabled
# Using unevenly spaced parameter
# values will result in uneven spaced
# twisted boxes. The spacing can be
# controlled with custom values
# such as values from graph mappers.
# Look at Rhino window
# to preview results
preview_72 = CustomPreview(Geometry=tboxcrv_2, Shader=swatch_72)  # disabled
bbox_54 = BoundingBox(Content=geo_59, Plane=PlaneXY(0, 0, 0))  # -> Box, Box_2; disabled
geo_61 = Geometry(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)  # disabled
# Box Morphing,
# If using Rhino 6
# you can use Pufferfish's
# Multi-Threaded "Morph To Twisted Box" component.
morph_50 = BoxMorph(Geometry=geo_57, Reference=bbox_52.Box, Target=thicktbox_2)  # disabled
mshbooltboxs_2 = MeshBooleanTwistedBoxes(TwistedBoxes=tboxarray_8, Meshes=mesh_13, BooleanType=toggle_43, KeepType=number_slider_242)  # -> Trimmed, KeptIndicies, Intersected; disabled
psrfbooltboxs_2 = PolysurfaceBooleanTwistedBoxes(TwistedBoxes=tboxarray_9, Polysurfaces=brep_4, BooleanType=toggle_44, KeepType=number_slider_243)  # -> Trimmed, KeptIndicies, Intersected; disabled
geo_62 = Geometry(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)  # disabled
swatch_76 = ColourSwatch(SwatchColor=RGB(255, 255, 255))  # disabled
bbox_55 = BoundingBox(Content=geo_60, Plane=PlaneXY(0, 0, 0))  # -> Box, Box_2; disabled
# Box Morphing,
# If using Rhino 6
# you can use Pufferfish's
# Multi-Threaded "Morph To Twisted Box" component.
morph_51 = BoxMorph(Geometry=geo_58, Reference=bbox_53.Box, Target=tboxconmshs_2)  # disabled
# Using unevenly spaced parameter
# values will result in uneven spaced
# twisted boxes. The spacing can be
# controlled with custom values
# such as values from graph mappers.
# Look at Rhino window
# to preview results
preview_73 = CustomPreview(Geometry=tboxconmshs_2, Shader=swatch_73)  # disabled
# Using unevenly spaced parameter
# values will result in uneven spaced
# twisted boxes. The spacing can be
# controlled with custom values
# such as values from graph mappers.
# Look at Rhino window
# to preview results
preview_74 = CustomPreview(Geometry=tboxpipe_2, Shader=swatch_74)  # disabled
swatch_77 = ColourSwatch(SwatchColor=RGB(255, 255, 255))  # disabled
bbox_56 = BoundingBox(Content=geo_61, Plane=PlaneXY(0, 0, 0))  # -> Box, Box_2; disabled
# Box Morphing,
# If using Rhino 6
# you can use Pufferfish's
# Multi-Threaded "Morph To Twisted Box" component.
morph_52 = BoxMorph(Geometry=geo_59, Reference=bbox_54.Box, Target=tboxpipe_2)  # disabled
swatch_78 = ColourSwatch(SwatchColor=RGB(255, 0, 255))  # disabled
# Using unevenly spaced parameter
# values will result in uneven spaced
# twisted boxes. The spacing can be
# controlled with custom values
# such as values from graph mappers.
# Look at Rhino window
# to preview results
preview_75 = CustomPreview(Geometry=thicktbox_2, Shader=swatch_75)  # disabled
number_slider_249 = Slider(2, range=0..10)  # disabled
number_slider_250 = Slider(3, range=0..10)  # disabled
number_slider_251 = Slider(6, range=0..10)  # disabled
number_slider_252 = Slider(6, range=0..10)  # disabled
number_slider_253 = Slider(3, range=0..10)  # disabled
number_slider_254 = Slider(4, range=0..100)  # disabled
number_slider_255 = Slider(4, range=0..100)  # disabled
number_slider_256 = Slider(6, range=0..10)  # disabled
number_slider_257 = Slider(4, range=0..100)  # disabled
tboxtube_2 = TwistedBoxTube(
    Curve=crv_32,
    ParametersU=range_79,
    ParametersV=range_78,
    ParametersW=range_77,
    Weighted=toggle_42,
    Diameter=number_slider_238,
    Thickness=number_slider_239,
    Offset=dom_33,
    Rotation1=number_slider_247,
    Rotation2=number_slider_248)  # disabled
# Using unevenly spaced parameter
# values will result in uneven spaced
# twisted boxes. The spacing can be
# controlled with custom values
# such as values from graph mappers.
number_slider_258 = Slider(3, range=0..10)  # disabled
# Using unevenly spaced parameter
# values will result in uneven spaced
# twisted boxes. The spacing can be
# controlled with custom values
# such as values from graph mappers.
number_slider_259 = Slider(3, range=0..10)  # disabled
reftbox_3 = ReferenceTwistedBox(Polysurface=box_3)  # disabled
swatch_79 = ColourSwatch(SwatchColor=RGB(255, 255, 255))  # disabled
bbox_57 = BoundingBox(Content=geo_62, Plane=PlaneXY(0, 0, 0))  # -> Box, Box_2; disabled
tbox_32 = TwistedBox(box_3)  # disabled
# Using unevenly spaced parameter
# values will result in uneven spaced
# twisted boxes. The spacing can be
# controlled with custom values
# such as values from graph mappers.
number_slider_260 = Slider(12, range=0..100)  # disabled
# Box Morphing,
# If using Rhino 6
# you can use Pufferfish's
# Multi-Threaded "Morph To Twisted Box" component.
morph_53 = BoxMorph(Geometry=geo_60, Reference=bbox_55.Box, Target=tboxthrusrfs_2)  # disabled
# This allows the start and end of the grid
# to be altered on the surface so twisted boxes
# can exist only on parts of the surface.
# Look at Rhino window
# to preview results
preview_76 = CustomPreview(Geometry=tboxthrusrfs_2, Shader=swatch_76)  # disabled
# Box Morphing,
# If using Rhino 6
# you can use Pufferfish's
# Multi-Threaded "Morph To Twisted Box" component.
morph_54 = BoxMorph(Geometry=geo_61, Reference=bbox_56.Box, Target=tboxthrumshs_2)  # disabled
# This allows the twisted boxes to
# be placed at a specific portion
# between the meshs .
# Look at Rhino window
# to preview results
preview_77 = CustomPreview(Geometry=tboxthrumshs_2, Shader=swatch_77)  # disabled
swatch_80 = ColourSwatch(SwatchColor=RGB(255, 255, 255))  # disabled
swatch_81 = ColourSwatch(SwatchColor=RGB(255, 255, 255))  # disabled
# Notice the point order does not work
# with Grasshopper box and the result
# is a criss crossed twisted box.
# You can use Grasshoppers
# twisted box parameter in this case.
# Look at Rhino window
# to preview results
preview_78 = CustomPreview(Geometry=tbox_32, Shader=swatch_78)  # disabled
# Extrude along curve
number_slider_261 = Slider(5, range=0..10)  # disabled
geo_63 = Geometry(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)  # disabled
# Box Morphing,
# If using Rhino 6
# you can use Pufferfish's
# Multi-Threaded "Morph To Twisted Box" component.
morph_55 = BoxMorph(Geometry=geo_62, Reference=bbox_57.Box, Target=tboxconsrfs_2)  # disabled
swatch_82 = ColourSwatch(SwatchColor=RGB(255, 255, 255))  # disabled
# Using unevenly spaced parameter
# values will result in uneven spaced
# twisted boxes. The spacing can be
# controlled with custom values
# such as values from graph mappers.
# Look at Rhino window
# to preview results
preview_79 = CustomPreview(Geometry=tboxconsrfs_2, Shader=swatch_79)  # disabled
# Box defines the size of the array.
# Any box can be used.
number_slider_262 = Slider(50, range=0..100)  # disabled
number_slider_263 = Slider(43, range=0..100)  # disabled
number_slider_264 = Slider(58, range=0..100)  # disabled
bbox_58 = BoundingBox(Content=geo_63, Plane=PlaneXY(0, 0, 0))  # -> Box, Box_2; disabled
range_80 = Range(Domain=Domain(0, 1), Steps=number_slider_249)  # disabled
range_81 = Range(Domain=Domain(0, 1), Steps=number_slider_250)  # disabled
range_82 = Range(Domain=Domain(0, 1), Steps=number_slider_251)  # disabled
range_83 = Range(Domain=Domain(0, 1), Steps=number_slider_252)  # disabled
range_84 = Range(Domain=Domain(0, 1), Steps=number_slider_253)  # disabled
range_85 = Range(Domain=Domain(0, 1), Steps=number_slider_254)  # disabled
range_86 = Range(Domain=Domain(0, 1), Steps=number_slider_255)  # disabled
range_87 = Range(Domain=Domain(0, 1), Steps=number_slider_256)  # disabled
swatch_83 = ColourSwatch(SwatchColor=RGB(255, 255, 255))  # disabled
range_88 = Range(Domain=Domain(0, 1), Steps=number_slider_257)  # disabled
# Graphmappers creating gradient spacing.
range_89 = Range(Domain=Domain(0, 1), Steps=number_slider_258)  # disabled
# Graphmappers creating gradient spacing.
range_90 = Range(Domain=Domain(0, 1), Steps=number_slider_259)  # disabled
# Look at Rhino window
# to preview results
# Using multiple meshes
preview_80 = CustomPreview(Geometry=mshbooltboxs_2.Trimmed, Shader=swatch_80)  # disabled
# Look at Rhino window
# to preview results
# Using multiple polysurfaces
preview_81 = CustomPreview(Geometry=psrfbooltboxs_2.Trimmed, Shader=swatch_81)  # disabled
number_slider_265 = Slider(10, range=0..100)  # disabled
number_slider_266 = Slider(70, range=0..100)  # disabled
range_91 = Range(Domain=Domain(0, 1), Steps=number_slider_260)  # disabled
# Look at Rhino window
# to preview results
preview_82 = CustomPreview(Geometry=reftbox_3, Shader=swatch_82)  # disabled
# Weights the division distribution by curvature
# if a curve is used for extrusion direction and
# the curve is not linear and degree is not 1.
toggle_45 = BooleanToggle(True)  # disabled
number_slider_267 = Slider(12, range=0..100)  # disabled
number_slider_268 = Slider(12, range=0..100)  # disabled
# Box Morphing,
# If using Rhino 6
# you can use Pufferfish's
# Multi-Threaded "Morph To Twisted Box" component.
morph_56 = BoxMorph(Geometry=geo_63, Reference=bbox_58.Box, Target=tboxtube_2)  # disabled
range_92 = Range(Domain=Domain(0, 1), Steps=number_slider_261)  # disabled
# Using unevenly spaced parameter
# values will result in uneven spaced
# twisted boxes. The spacing can be
# controlled with custom values
# such as values from graph mappers.
# Look at Rhino window
# to preview results
preview_83 = CustomPreview(Geometry=tboxtube_2, Shader=swatch_83)  # disabled
graph_12 = GraphMapper(
    range_89,
    x0=0,
    x1=1,
    y0=0,
    y1=1,
    container_name="Bezier",
    cpx=[0, 0.7391828895, 0.628637135, 1],
    cpy=[0, 0.2603593469, 0.5803611279, 1])  # disabled
graph_13 = GraphMapper(
    range_90,
    x0=0,
    x1=1,
    y0=0,
    y1=1,
    container_name="Bezier",
    cpx=[0, 0.7391828895, 0.628637135, 1],
    cpy=[0, 0.2603593469, 0.5803611279, 1])  # disabled
graph_14 = GraphMapper(
    range_82,
    x0=0,
    x1=1,
    y0=0,
    y1=1,
    container_name="Bezier",
    cpx=[0, 0.8328191638, 0.4255454242, 1],
    cpy=[0, 0.1305431128, 0.758908391, 1])  # disabled
graph_15 = GraphMapper(
    range_83,
    x0=0,
    x1=1,
    y0=0,
    y1=1,
    container_name="Bezier",
    cpx=[0, 0.8328191638, 0.4255454242, 1],
    cpy=[0, 0.1305431128, 0.758908391, 1])  # disabled
# Graphmappers creating gradient spacing.
graph_16 = GraphMapper(
    range_84,
    x0=0,
    x1=1,
    y0=0,
    y1=1,
    container_name="Bezier",
    cpx=[0, 0.5887284875, 0.838911593, 1],
    cpy=[0, 0.2389970422, 0.5531810522, 1])  # disabled
graph_17 = GraphMapper(range_85, x0=0, x1=1, y0=0, y1=1, container_name="Bezier", cpx=[0, 1, 0.2749994397, 1], cpy=[0, 0, 0.8804543018, 1])  # disabled
# Graphmappers creating gradient spacing.
graph_18 = GraphMapper(
    range_80,
    x0=0,
    x1=1,
    y0=0,
    y1=1,
    container_name="Bezier",
    cpx=[0, 0.7920920849, 0.2108182013, 1],
    cpy=[0, 0.07999765873, 0.7866321802, 1])  # disabled
graph_19 = GraphMapper(range_86, x0=0, x1=1, y0=0, y1=1, container_name="Bezier", cpx=[0, 1, 0.2749994397, 1], cpy=[0, 0, 0.8804543018, 1])  # disabled
# Graphmappers creating gradient spacing.
graph_20 = GraphMapper(
    range_81,
    x0=0,
    x1=1,
    y0=0,
    y1=1,
    container_name="Bezier",
    cpx=[0, 0.5540910363, 0.6268171668, 1],
    cpy=[0, 0.2577292919, 0.5195479393, 1])  # disabled
graph_21 = GraphMapper(
    range_87,
    x0=0,
    x1=1,
    y0=0,
    y1=1,
    container_name="Bezier",
    cpx=[0, 0.8328191638, 0.8231811523, 1],
    cpy=[0, 0.1305431128, 0.5109086037, 1])  # disabled
# Curve to extrude along
crv_33 = Curve(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)  # disabled
crv_34 = Curve(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)  # disabled
graph_22 = GraphMapper(
    range_88,
    x0=0,
    x1=1,
    y0=0,
    y1=1,
    container_name="Bezier",
    cpx=[0, 0.7827259302, 0.6227278113, 1],
    cpy=[0, 0.2577292919, 0.4177274108, 1])  # disabled
graph_23 = GraphMapper(range_91, x0=0, x1=1, y0=0, y1=1, container_name="Bezier", cpx=[0, 1, 0.2199984491, 1], cpy=[0, 0, 0.4554554224, 1])  # disabled
number_slider_269 = Slider(12, range=0..100)  # disabled
# Graphmappers creating gradient spacing.
# Weights the division distribution by curvature
# if the rails are not linear and degree is not 1.
toggle_46 = BooleanToggle(False)  # disabled
box_4 = CenterBox(Base=PlaneXY(1622.595655, -317.402594, 0), X=number_slider_262, Y=number_slider_264, Z=number_slider_263)  # disabled
swatch_84 = ColourSwatch(SwatchColor=RGB(255, 0, 255))  # disabled
swatch_85 = ColourSwatch(SwatchColor=RGB(0, 255, 106))  # disabled
srf_16 = Surface(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)  # disabled
mesh_14 = Mesh(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)  # disabled
mesh_15 = Mesh(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)  # disabled
mesh_16 = Mesh(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)  # disabled
srf_17 = Surface(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)  # disabled
srf_18 = Surface(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)  # disabled
# Rail curves
crv_35 = Curve(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)  # disabled
crv_36 = Curve(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)  # disabled
crv_37 = Curve(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)  # disabled
crv_38 = Curve(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)  # disabled
swatch_86 = ColourSwatch(SwatchColor=RGB(255, 0, 255))  # disabled
number_slider_270 = Slider(8.96, range=0..10)  # disabled
number_slider_271 = Slider(6.257, range=0..10)  # disabled
swatch_87 = ColourSwatch(SwatchColor=RGB(255, 0, 255))  # disabled
wires_3 = BrepWireframe(Brep=box_4, Density=-1)  # disabled
# Weights the division distribution by curvature
# if the curve is not linear and degree is not 1.
number_slider_272 = Slider(-8.058, range=-20..20)  # disabled
number_slider_273 = Slider(3.497, range=-20..20)  # disabled
number_slider_274 = Slider(-4.576, range=-20..20)  # disabled
# Domain sizes of the
# twisted boxes from
# the curve. You can use
# single numbers also.
# For easy symmetrical
# sizes use Pufferfish's
# "Two Way Domain" component
number_slider_275 = Slider(9.86, range=-20..20)  # disabled
# Thickness of the strip
# Graphmappers creating gradient spacing.
range_93 = Range(Domain=Domain(0, 1), Steps=number_slider_267)  # disabled
# Thickness of the strip
range_94 = Range(Domain=Domain(0, 1), Steps=number_slider_268)  # disabled
preview_84 = CustomPreview(Geometry=crv_33, Shader=swatch_84)  # disabled
# Look at Rhino window
# to preview inputs
# Look at Rhino window
# to preview inputs
preview_85 = CustomPreview(Geometry=crv_34, Shader=swatch_85)  # disabled
number_slider_276 = Slider(3, range=0..10)  # disabled
number_slider_277 = Slider(3, range=0..10)  # disabled
number_slider_278 = Slider(12, range=0..100)  # disabled
tboxmsh_3 = TwistedBoxMesh(Mesh=mesh_16, Thickness=number_slider_266, ParametersW=graph_12)  # disabled
# Look at Rhino window
# to preview results
preview_86 = CustomPreview(Geometry=wires_3, Shader=swatch_86)  # disabled
tbox2mshs_3 = TwistedBoxTwoMeshes(MeshA=mesh_15, MeshB=mesh_14, ParametersW=graph_13)  # disabled
tbox2srfs_3 = TwistedBoxTwoSurfaces(SurfaceA=srf_17, SurfaceB=srf_18, ParametersU=graph_19, ParametersV=graph_15, ParametersW=graph_20)  # disabled
tboxsrf_3 = TwistedBoxSurface(Surface=srf_16, Thickness=number_slider_265, ParametersU=graph_17, ParametersV=graph_14, ParametersW=graph_18)  # disabled
# Look at Rhino window
# to preview inputs
preview_87 = CustomPreview(Geometry=[crv_35, crv_36, crv_37, crv_38], Shader=swatch_87)  # disabled
tboxarray_10 = TwistedBoxArray(Box=box_4, ParametersX=graph_22, ParametersY=graph_21, ParametersZ=graph_16)  # disabled
tboxextr_3 = TwistedBoxExtrude(Profile=crv_33, Direction=crv_34, ParametersT=range_92, Weighted=toggle_45)  # disabled
range_95 = Range(Domain=Domain(0, 1), Steps=number_slider_269)  # disabled
graph_24 = GraphMapper(range_93, x0=0, x1=1, y0=0, y1=1, container_name="Bezier", cpx=[0, 1, 0.2199984491, 1], cpy=[0, 0, 0.4554554224, 1])  # disabled
graph_25 = GraphMapper(range_94, x0=0, x1=1, y0=0, y1=1, container_name="Bezier", cpx=[0, 1, 0.2199984491, 1], cpy=[0, 0, 0.4554554224, 1])  # disabled
geo_64 = Geometry(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)  # disabled
geo_65 = Geometry(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)  # disabled
geo_66 = Geometry(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)  # disabled
geo_67 = Geometry(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)  # disabled
geo_68 = Geometry(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)  # disabled
geo_69 = Geometry(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)  # disabled
# Weights the division distribution by curvature
# if the rails are not linear and degree is not 1.
toggle_47 = BooleanToggle(False)  # disabled
# Graphmappers creating gradient spacing.
# Weights the division distribution by curvature
# if the rails are not linear and degree is not 1.
toggle_48 = BooleanToggle(False)  # disabled
tboxsweep_3 = TwistedBoxSweep(R¹=crv_35, R²=crv_36, R³=crv_37, R⁴=crv_38, t=graph_23, W=toggle_46)  # disabled
# Rail curves
crv_39 = Curve([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])  # disabled
# Rail curves
crv_40 = Curve(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)  # disabled
crv_41 = Curve(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)  # disabled
# Rotation around twisted box centers
number_slider_279 = Slider(360, range=-1000..1000)  # disabled
# Determines the twisted box corner
# locations in the surface
# Weights the u division distribution by curvature
# if the curve is not linear and degree is not 1.
number_slider_280 = Slider(0.75, range=0..1)  # disabled
# Graphmappers creating gradient spacing.
number_slider_281 = Slider(0, range=0..1)  # disabled
number_slider_282 = Slider(0.5, range=0..1)  # disabled
graph_26 = GraphMapper(range_95, x0=0, x1=1, y0=0, y1=1, container_name="Bezier", cpx=[0, 1, 0.2199984491, 1], cpy=[0, 0, 0.4554554224, 1])  # disabled
number_slider_283 = Slider(0.25, range=0..1)  # disabled
# Graphmappers creating gradient spacing.
toggle_49 = BooleanToggle(True)  # disabled
swatch_88 = ColourSwatch(SwatchColor=RGB(255, 0, 255))  # disabled
swatch_89 = ColourSwatch(SwatchColor=RGB(255, 0, 255))  # disabled
number_slider_284 = Slider(3, range=0..10)  # disabled
number_slider_285 = Slider(6, range=0..10)  # disabled
number_slider_286 = Slider(4, range=0..100)  # disabled
number_slider_287 = Slider(0.061, range=0..1)  # disabled
number_slider_288 = Slider(0.517, range=0..1)  # disabled
# Adjusting the start and end domains
# of the ranges positions the twisted
# boxes on specified parts of the surface.
number_slider_289 = Slider(0.814, range=0..1)  # disabled
number_slider_290 = Slider(0.351, range=0..1)  # disabled
number_slider_291 = Slider(0.592, range=0..1)  # disabled
number_slider_292 = Slider(0.207, range=0..1)  # disabled
swatch_90 = ColourSwatch(SwatchColor=RGB(255, 255, 255))  # disabled
swatch_91 = ColourSwatch(SwatchColor=RGB(255, 255, 255))  # disabled
bbox_59 = BoundingBox(Content=geo_68, Plane=PlaneXY(0, 0, 0))  # -> Box, Box_2; disabled
swatch_92 = ColourSwatch(SwatchColor=RGB(255, 255, 255))  # disabled
swatch_93 = ColourSwatch(SwatchColor=RGB(255, 255, 255))  # disabled
swatch_94 = ColourSwatch(SwatchColor=RGB(255, 255, 255))  # disabled
bbox_60 = BoundingBox(Content=geo_69, Plane=PlaneXY(0, 0, 0))  # -> Box, Box_2; disabled
bbox_61 = BoundingBox(Content=geo_65, Plane=PlaneXY(0, 0, 0))  # -> Box, Box_2; disabled
swatch_95 = ColourSwatch(SwatchColor=RGB(255, 255, 255))  # disabled
bbox_62 = BoundingBox(Content=geo_67, Plane=PlaneXY(0, 0, 0))  # -> Box, Box_2; disabled
bbox_63 = BoundingBox(Content=geo_66, Plane=PlaneXY(0, 0, 0))  # -> Box, Box_2; disabled
bbox_64 = BoundingBox(Content=geo_64, Plane=PlaneXY(0, 0, 0))  # -> Box, Box_2; disabled
dom_34 = ConstructDomain(DomainStart=number_slider_272, DomainEnd=number_slider_273)  # disabled
dom_35 = ConstructDomain(DomainStart=number_slider_274, DomainEnd=number_slider_275)  # disabled
range_96 = Range(Domain=Domain(0, 1), Steps=number_slider_276)  # disabled
number_slider_293 = Slider(0.217, range=0..1)  # disabled
# Adjusting the start and end domain
# of the range positions the twisted
# boxes on specified parts
# between the meshes.
number_slider_294 = Slider(0.819, range=0..1)  # disabled
range_97 = Range(Domain=Domain(0, 1), Steps=number_slider_277)  # disabled
crv_42 = Curve(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)  # disabled
range_98 = Range(Domain=Domain(0, 1), Steps=number_slider_278)  # disabled
# Thickness factor
number_slider_295 = Slider(0.823, range=0..1)  # disabled
# Rotation around curve
number_slider_296 = Slider(-421, range=-1000..1000)  # disabled
geo_70 = Geometry(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)  # disabled
# Works with multiple meshes
# automatically so you don't
# even need to boolean union
# the meshes to use them.
number_slider_297 = Slider(15, range=0..20)  # disabled
# Works with multiple polysurfaces
# automatically so you don't
# even need to boolean union
# the polysurfaces to use them.
number_slider_298 = Slider(15, range=0..20)  # disabled
swatch_96 = ColourSwatch(SwatchColor=RGB(255, 255, 255))  # disabled
# Graphmappers creating
# gradient spacing.
# Weights the division distribution by curvature
# if the interpolation is not linear and degree is not 1.
toggle_50 = BooleanToggle(False)  # disabled
toggle_51 = BooleanToggle(False)  # disabled
# Look at Rhino window
# to preview inputs
preview_88 = CustomPreview(Geometry=[crv_40, crv_41], Shader=swatch_88)  # disabled
# Look at Rhino window
# to preview inputs
preview_89 = CustomPreview(Geometry=crv_39, Shader=swatch_89)  # disabled
mesh_17 = Mesh([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])  # disabled
# Box Morphing,
# If using Rhino 6
# you can use Pufferfish's
# Multi-Threaded "Morph To Twisted Box" component.
morph_57 = BoxMorph(Geometry=geo_68, Reference=bbox_59.Box, Target=tboxextr_3)  # disabled
# Look at Rhino window
# to preview results
preview_90 = CustomPreview(Geometry=tboxextr_3, Shader=swatch_90)  # disabled
bbox_65 = BoundingBox(Content=geo_70, Plane=PlaneXY(0, 0, 0))  # -> Box, Box_2; disabled
# Box Morphing,
# If using Rhino 6
# you can use Pufferfish's
# Multi-Threaded "Morph To Twisted Box" component.
morph_58 = BoxMorph(Geometry=geo_69, Reference=bbox_60.Box, Target=tboxmsh_3)  # disabled
# Box Morphing,
# If using Rhino 6
# you can use Pufferfish's
# Multi-Threaded "Morph To Twisted Box" component.
morph_59 = BoxMorph(Geometry=geo_65, Reference=bbox_61.Box, Target=tboxsrf_3)  # disabled
# Box Morphing,
# If using Rhino 6
# you can use Pufferfish's
# Multi-Threaded "Morph To Twisted Box" component.
morph_60 = BoxMorph(Geometry=geo_67, Reference=bbox_62.Box, Target=tbox2srfs_3)  # disabled
# Box Morphing,
# If using Rhino 6
# you can use Pufferfish's
# Multi-Threaded "Morph To Twisted Box" component.
morph_61 = BoxMorph(Geometry=geo_66, Reference=bbox_63.Box, Target=tbox2mshs_3)  # disabled
# Box Morphing,
# If using Rhino 6
# you can use Pufferfish's
# Multi-Threaded "Morph To Twisted Box" component.
morph_62 = BoxMorph(Geometry=geo_64, Reference=bbox_64.Box, Target=tboxarray_10)  # disabled
# Weights the division distribution by curvature
# if the interpolation is not linear and degree is not 1.
# Equalizes the division
# distribution along the
# interpolation path. So 0.5
# would be the middle
# of the overall interpolation
# path, not the middle
# input mesh.
toggle_52 = BooleanToggle(False)  # disabled
# Look at Rhino window
# to preview results
preview_91 = CustomPreview(Geometry=tboxmsh_3, Shader=swatch_92)  # disabled
# Look at Rhino window
# to preview results
preview_92 = CustomPreview(Geometry=tboxsrf_3, Shader=swatch_95)  # disabled
# Look at Rhino window
# to preview results
preview_93 = CustomPreview(Geometry=tbox2srfs_3, Shader=swatch_93)  # disabled
# Look at Rhino window
# to preview results
preview_94 = CustomPreview(Geometry=tbox2mshs_3, Shader=swatch_94)  # disabled
# Look at Rhino window
# to preview results
preview_95 = CustomPreview(Geometry=tboxarray_10, Shader=swatch_91)  # disabled
# Graphmappers creating gradient spacing.
# Decides whether to have a
# twisted box in the center or not.
toggle_53 = BooleanToggle(True)  # disabled
graph_27 = GraphMapper(
    range_96,
    x0=0,
    x1=1,
    y0=0,
    y1=1,
    container_name="Bezier",
    cpx=[0, 0.7840909362, 0.628637135, 1],
    cpy=[0, 0.1613603234, 0.5803611279, 1])  # disabled
graph_28 = GraphMapper(range_98, x0=0, x1=1, y0=0, y1=1, container_name="Bezier", cpx=[0, 1, 0.2199984491, 1], cpy=[0, 0, 0.4554554224, 1])  # disabled
graph_29 = GraphMapper(
    range_97,
    x0=0,
    x1=1,
    y0=0,
    y1=1,
    container_name="Bezier",
    cpx=[0, 0.8642356396, 0.007798628416, 1],
    cpy=[0, 0.2268953919, 0.9343816638, 1])  # disabled
srf_19 = Surface(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)  # disabled
# Use to flip the twisted box flow direction
# if it is flowing the opposite way that it should.
# Depends of the way you build your surface.
toggle_54 = BooleanToggle(False)  # disabled
number_slider_299 = Slider(3, range=0..7)  # disabled
number_slider_300 = Slider(6, range=0..10)  # disabled
number_slider_301 = Slider(6, range=0..10)  # disabled
number_slider_302 = Slider(3, range=0..100)  # disabled
number_slider_303 = Slider(8, range=0..100)  # disabled
tboxstrip_3 = TwistedBoxStrip(Rail1=crv_40, Rail2=crv_41, Thickness=number_slider_270, ParametersT=graph_24, Weighted=toggle_47)  # disabled
# Determines how the interpolation path is interpolated.
# Determines the curvature degree of the interpolation path if the interpolation type is not linear.
number_slider_304 = Slider(0, range=0..3)  # disabled
# Input can be
# a box also
tbox_33 = TwistedBox({C=Point(102, -773, 0), C=Point(131, -773, 0), C=Point(131, -748, 0), C=Point(102, -748, 0), C=Point(102, -773, 28), C=Point(131, -773, 28), C=Point(131, -748, 28), C=Point(102, -748, 28)})  # disabled
range_99 = Range(Domain=Domain(0, 1), Steps=number_slider_284)  # disabled
range_100 = Range(Domain=Domain(0, 1), Steps=number_slider_285)  # disabled
range_101 = Range(Domain=Domain(0, 1), Steps=number_slider_286)  # disabled
number_slider_305 = Slider(17, range=0..100)  # disabled
number_slider_306 = Slider(7, range=0..10)  # disabled
number_slider_307 = Slider(2, range=0..10)  # disabled
tboxstrips_3 = TwistedBoxStrips(Rails=crv_39, Thickness=number_slider_271, ParametersT=graph_25, Weighted=toggle_48)  # disabled
# Box Morphing,
# If using Rhino 6
# you can use Pufferfish's
# Multi-Threaded "Morph To Twisted Box" component.
morph_63 = BoxMorph(Geometry=geo_70, Reference=bbox_65.Box, Target=tboxsweep_3)  # disabled
# Look at Rhino window
# to preview results
preview_96 = CustomPreview(Geometry=tboxsweep_3, Shader=swatch_96)  # disabled
dom_36 = ConstructDomain(DomainStart=number_slider_287, DomainEnd=number_slider_288)  # disabled
dom_37 = ConstructDomain(DomainStart=number_slider_290, DomainEnd=number_slider_289)  # disabled
dom_38 = ConstructDomain(DomainStart=number_slider_292, DomainEnd=number_slider_291)  # disabled
number_slider_308 = Slider(3, range=0..7)  # disabled
toggle_55 = BooleanToggle(False)  # disabled
dom_39 = ConstructDomain(DomainStart=number_slider_293, DomainEnd=number_slider_294)  # disabled
toggle_56 = BooleanToggle(False)  # disabled
range_102 = Range(Domain=Domain(0, 1), Steps=number_slider_297)  # disabled
# Multiple polysurfaces
range_103 = Range(Domain=Domain(0, 1), Steps=number_slider_298)  # disabled
# Determines how the interpolation path is interpolated.
# Determines the curvature degree of the interpolation path if the interpolation type is not linear.
number_slider_309 = Slider(0, range=0..3)  # disabled
tboxcrv_3 = TwistedBoxCurve(
    Curve=crv_42,
    ParametersT=graph_26,
    Weighted=toggle_49,
    SizeX=dom_34,
    SizeY=dom_35,
    Rotation1=number_slider_279,
    Rotation2=number_slider_296)  # disabled
geo_71 = Geometry(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)  # disabled
geo_72 = Geometry(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)  # disabled
# Weights the division distribution by curvature
# if the interpolation is not linear and degree is not 1.
# Equalizes the division
# distribution along the
# interpolation path. So 0.5
# would be the middle
# of the overall interpolation
# path, not the middle
# input surface.
toggle_57 = BooleanToggle(False)  # disabled
geo_73 = Geometry(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)  # disabled
geo_74 = Geometry(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)  # disabled
graph_30 = GraphMapper(
    range_100,
    x0=0,
    x1=1,
    y0=0,
    y1=1,
    container_name="Bezier",
    cpx=[0, 0.8328191638, 0.4255454242, 1],
    cpy=[0, 0.1305431128, 0.758908391, 1])  # disabled
# Switch which side of the
# twisted boxes get trimmed away
# Determines how much of the
# twisted boxes to trim away:
# 0:Complete
# 1:Halfway
# 2:Partial
number_slider_310 = Slider(0, range=0..3)  # disabled
graph_31 = GraphMapper(range_101, x0=0, x1=1, y0=0, y1=1, container_name="Bezier", cpx=[0, 1, 0.2749994397, 1], cpy=[0, 0, 0.8804543018, 1])  # disabled
graph_32 = GraphMapper(
    range_99,
    x0=0,
    x1=1,
    y0=0,
    y1=1,
    container_name="Bezier",
    cpx=[0, 0.5540910363, 0.6268171668, 1],
    cpy=[0, 0.2577292919, 0.5195479393, 1])  # disabled
# Switch which side of the
# twisted boxes get trimmed away
# Determines how much of the
# twisted boxes to trim away:
# 0:Complete
# 1:Halfway
# 2:Partial
number_slider_311 = Slider(0, range=0..3)  # disabled
srf_20 = Surface([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])  # disabled
swatch_97 = ColourSwatch(SwatchColor=RGB(255, 255, 255))  # disabled
swatch_98 = ColourSwatch(SwatchColor=RGB(255, 255, 255))  # disabled
geo_75 = Geometry(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)  # disabled
# Graphmappers creating gradient spacing.
# Weights the division distribution by curvature
# if the interpolation is not linear and degree is not 1.
toggle_58 = BooleanToggle(False)  # disabled
range_104 = Range(Domain=dom_37, Steps=number_slider_300)  # disabled
thicktbox_3 = ThickenTwistedBox(TwistedBox=tbox_33, Thickness=number_slider_295, ParametersW=graph_29, Hollow=toggle_53)  # disabled
range_105 = Range(Domain=dom_36, Steps=number_slider_301)  # disabled
range_106 = Range(Domain=dom_39, Steps=number_slider_303)  # disabled
range_107 = Range(Domain=dom_38, Steps=number_slider_302)  # disabled
bbox_66 = BoundingBox(Content=geo_71, Plane=PlaneXY(0, 0, 0))  # -> Box, Box_2; disabled
bbox_67 = BoundingBox(Content=geo_72, Plane=PlaneXY(0, 0, 0))  # -> Box, Box_2; disabled
mesh_18 = Mesh([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])  # disabled
srf_21 = Surface([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])  # disabled
range_108 = Range(Domain=Domain(0, 1), Steps=number_slider_307)  # disabled
range_109 = Range(Domain=Domain(0, 1), Steps=number_slider_306)  # disabled
range_110 = Range(Domain=Domain(0, 1), Steps=number_slider_305)  # disabled
geo_76 = Geometry(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)  # disabled
number_slider_312 = Slider(-8.058, range=-20..20)  # disabled
# Domain offset of the
# twisted boxes from
# the curve. You can use
# single numbers also.
number_slider_313 = Slider(3.497, range=-20..20)  # disabled
# Multiple meshes
toggle_59 = BooleanToggle(True)  # disabled
toggle_60 = BooleanToggle(True)  # disabled
number_slider_314 = Slider(3, range=0..7)  # disabled
tboxpipe_3 = TwistedBoxPipe(
    Surface=srf_19,
    ParametersU=graph_28,
    ParameterV1=number_slider_281,
    ParameterV2=number_slider_283,
    ParameterV3=number_slider_282,
    ParameterV4=number_slider_280,
    Weighted=toggle_54,
    Flip=toggle_56)  # disabled
number_slider_315 = Slider(3, range=0..7)  # disabled
swatch_99 = ColourSwatch(SwatchColor=RGB(255, 255, 255))  # disabled
# Diameter and thickness
number_slider_316 = Slider(8, range=0..100)  # disabled
# Weights the division distribution by curvature
# if the curve is not linear and degree is not 1.
number_slider_317 = Slider(30, range=0..100)  # disabled
bbox_68 = BoundingBox(Content=geo_75, Plane=PlaneXY(0, 0, 0))  # -> Box, Box_2; disabled
# Determines how the interpolation path is interpolated.
# Determines the curvature degree of the interpolation path if the interpolation type is not linear.
number_slider_318 = Slider(0, range=0..3)  # disabled
# Just to display boundary
# of twisted boxes
edges_8 = BrepEdges(Brep=geo_73)  # -> Naked, Interior, NonManifold; disabled
# Just to display boundary
# of twisted boxes
edges_9 = BrepEdges(Brep=geo_74)  # -> Naked, Interior, NonManifold; disabled
# Making twisted boxes to boolean,
# doesnt have to be an array,
# can be any twisted boxes
tboxarray_11 = TwistedBoxArray(Box=geo_73, ParametersX=range_102, ParametersY=range_102, ParametersZ=range_102)  # disabled
# Making twisted boxes to boolean,
# doesnt have to be an array,
# can be any twisted boxes
tboxarray_12 = TwistedBoxArray(Box=geo_74, ParametersX=range_103, ParametersY=range_103, ParametersZ=range_103)  # disabled
# Determines how the interpolation path is interpolated.
# Determines the curvature degree of the interpolation path if the interpolation type is not linear.
number_slider_319 = Slider(0, range=0..3)  # disabled
# Look at Rhino window
# to preview results
preview_97 = CustomPreview(Geometry=tboxstrip_3, Shader=swatch_98)  # disabled
# Look at Rhino window
# to preview results
preview_98 = CustomPreview(Geometry=tboxstrips_3, Shader=swatch_97)  # disabled
# Box Morphing,
# If using Rhino 6
# you can use Pufferfish's
# Multi-Threaded "Morph To Twisted Box" component.
morph_64 = BoxMorph(Geometry=geo_71, Reference=bbox_66.Box, Target=tboxstrip_3)  # disabled
# Box Morphing,
# If using Rhino 6
# you can use Pufferfish's
# Multi-Threaded "Morph To Twisted Box" component.
morph_65 = BoxMorph(Geometry=geo_72, Reference=bbox_67.Box, Target=tboxstrips_3)  # disabled
brep_5 = Brep([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])  # disabled
mesh_19 = Mesh([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])  # disabled
bbox_69 = BoundingBox(Content=geo_76, Plane=PlaneXY(0, 0, 0))  # -> Box, Box_2; disabled
tboxconmshs_3 = TwistedBoxConsecutiveMeshes(Meshes=mesh_17, ParametersW=graph_27, Weighted=toggle_50, Degree=number_slider_299, InterpolationType=number_slider_304)  # disabled
# Graphmappers creating gradient spacing.
toggle_61 = BooleanToggle(False)  # disabled
graph_33 = GraphMapper(
    range_108,
    x0=0,
    x1=1,
    y0=0,
    y1=1,
    container_name="Bezier",
    cpx=[0, 0.7920920849, 0.08338234574, 1],
    cpy=[0, 0.07999765873, 0.9310413599, 1])  # disabled
graph_34 = GraphMapper(
    range_109,
    x0=0,
    x1=1,
    y0=0,
    y1=1,
    container_name="Bezier",
    cpx=[0, 0.8328191638, 0.4368175268, 1],
    cpy=[0, 0.1305431128, 0.6513671875, 1])  # disabled
graph_35 = GraphMapper(
    range_110,
    x0=0,
    x1=1,
    y0=0,
    y1=1,
    container_name="Bezier",
    cpx=[0, 0.679998219, 0.3599992096, 1],
    cpy=[0, 0.2050004601, 0.7140891552, 1])  # disabled
swatch_100 = ColourSwatch(SwatchColor=RGB(255, 255, 255))  # disabled
# Box Morphing,
# If using Rhino 6
# you can use Pufferfish's
# Multi-Threaded "Morph To Twisted Box" component.
morph_66 = BoxMorph(Geometry=geo_75, Reference=bbox_68.Box, Target=tboxcrv_3)  # disabled
geo_77 = Geometry(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)  # disabled
# Look at Rhino window
# to preview results
preview_99 = CustomPreview(Geometry=tboxcrv_3, Shader=swatch_99)  # disabled
# Box Morphing,
# If using Rhino 6
# you can use Pufferfish's
# Multi-Threaded "Morph To Twisted Box" component.
morph_67 = BoxMorph(Geometry=geo_76, Reference=bbox_69.Box, Target=thicktbox_3)  # disabled
crv_43 = Curve(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)  # disabled
geo_78 = Geometry(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)  # disabled
# Rotation around twisted box centers
number_slider_320 = Slider(360, range=-1000..1000)  # disabled
tboxthrumshs_3 = TwistedBoxThroughMeshes(
    Meshes=mesh_18,
    ParametersW=range_106,
    Normalized=True,
    Equalized=toggle_51,
    Weighted=toggle_52,
    Degree=number_slider_308,
    InterpolationType=number_slider_309)  # disabled
swatch_101 = ColourSwatch(SwatchColor=RGB(255, 255, 255))  # disabled
# Extrude to point
number_slider_321 = Slider(5, range=0..10)  # disabled
bbox_70 = BoundingBox(Content=geo_77, Plane=PlaneXY(0, 0, 0))  # -> Box, Box_2; disabled
dom_40 = ConstructDomain(DomainStart=number_slider_312, DomainEnd=number_slider_313)  # disabled
# Rotation around curve
number_slider_322 = Slider(-421, range=-1000..1000)  # disabled
# Look at Rhino window
# to preview results
preview_100 = CustomPreview(Geometry=thicktbox_3, Shader=swatch_100)  # disabled
swatch_102 = ColourSwatch(SwatchColor=RGB(255, 255, 255))  # disabled
bbox_71 = BoundingBox(Content=geo_78, Plane=PlaneXY(0, 0, 0))  # -> Box, Box_2; disabled
geo_79 = Geometry(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)  # disabled
psrfbooltboxs_3 = PolysurfaceBooleanTwistedBoxes(TwistedBoxes=tboxarray_12, Polysurfaces=brep_5, BooleanType=toggle_60, KeepType=number_slider_311)  # -> Trimmed, KeptIndicies, Intersected; disabled
mshbooltboxs_3 = MeshBooleanTwistedBoxes(TwistedBoxes=tboxarray_11, Meshes=mesh_19, BooleanType=toggle_59, KeepType=number_slider_310)  # -> Trimmed, KeptIndicies, Intersected; disabled
# Look at Rhino window
# to preview results
preview_101 = CustomPreview(Geometry=tboxpipe_3, Shader=swatch_101)  # disabled
# Box Morphing,
# If using Rhino 6
# you can use Pufferfish's
# Multi-Threaded "Morph To Twisted Box" component.
morph_68 = BoxMorph(Geometry=geo_77, Reference=bbox_70.Box, Target=tboxpipe_3)  # disabled
tboxconsrfs_3 = TwistedBoxConsecutiveSurfaces(
    Surfaces=srf_20,
    ParametersU=graph_31,
    ParametersV=graph_30,
    ParametersW=graph_32,
    Weighted=toggle_58,
    Degree=number_slider_314,
    InterpolationType=number_slider_318)  # disabled
swatch_103 = ColourSwatch(SwatchColor=RGB(255, 255, 255))  # disabled
tboxthrusrfs_3 = TwistedBoxThroughSurfaces(
    Surfaces=srf_21,
    ParametersU=range_107,
    ParametersV=range_105,
    ParametersW=range_104,
    Normalized=True,
    Equalized=toggle_55,
    Weighted=toggle_57,
    Degree=number_slider_315,
    InterpolationType=number_slider_319)  # disabled
# Box Morphing,
# If using Rhino 6
# you can use Pufferfish's
# Multi-Threaded "Morph To Twisted Box" component.
morph_69 = BoxMorph(Geometry=geo_78, Reference=bbox_71.Box, Target=tboxconmshs_3)  # disabled
bbox_72 = BoundingBox(Content=geo_79, Plane=PlaneXY(0, 0, 0))  # -> Box, Box_2; disabled
# Look at Rhino window
# to preview results
preview_102 = CustomPreview(Geometry=tboxconmshs_3, Shader=swatch_102)  # disabled
range_111 = Range(Domain=Domain(0, 1), Steps=number_slider_321)  # disabled
# Point  to extrude to
crv_44 = Curve(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)  # disabled
pt_5 = Point(Point(436.0686286, -370.405151, 73.32144686))  # disabled
swatch_104 = ColourSwatch(SwatchColor=RGB(255, 255, 255))  # disabled
swatch_105 = ColourSwatch(SwatchColor=RGB(255, 255, 255))  # disabled
geo_80 = Geometry(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)  # disabled
# Did twisted box
# set get trimmed
panel_18 = Panel(mshbooltboxs_3.Intersected)  # disabled
geo_81 = Geometry(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)  # disabled
# Did twisted box
# set get trimmed
panel_19 = Panel(psrfbooltboxs_3.Intersected)  # disabled
# Box Morphing,
# If using Rhino 6
# you can use Pufferfish's
# Multi-Threaded "Morph To Twisted Box" component.
morph_70 = BoxMorph(Geometry=geo_79, Reference=bbox_72.Box, Target=tboxthrumshs_3)  # disabled
swatch_106 = ColourSwatch(SwatchColor=RGB(0, 255, 106))  # disabled
swatch_107 = ColourSwatch(SwatchColor=RGB(255, 0, 255))  # disabled
# Using unevenly spaced parameter
# values will result in uneven spaced
# twisted boxes. The spacing can be
# controlled with custom values
# such as values from graph mappers.
# Look at Rhino window
# to preview results
preview_103 = CustomPreview(Geometry=tboxthrumshs_3, Shader=swatch_103)  # disabled
tboxtube_3 = TwistedBoxTube(
    Curve=crv_43,
    ParametersU=graph_35,
    ParametersV=graph_34,
    ParametersW=graph_33,
    Weighted=toggle_61,
    Diameter=number_slider_317,
    Thickness=number_slider_316,
    Offset=dom_40,
    Rotation1=number_slider_320,
    Rotation2=number_slider_322)  # disabled
bbox_73 = BoundingBox(Content=geo_80, Plane=PlaneXY(0, 0, 0))  # -> Box, Box_2; disabled
swatch_108 = ColourSwatch(SwatchColor=RGB(255, 255, 255))  # disabled
bbox_74 = BoundingBox(Content=geo_81, Plane=PlaneXY(0, 0, 0))  # -> Box, Box_2; disabled
swatch_109 = ColourSwatch(SwatchColor=RGB(255, 255, 255))  # disabled
# Indices of remaining
# twisted boxes
panel_20 = Panel(mshbooltboxs_3.KeptIndicies)  # disabled
# Indices of remaining
# twisted boxes
panel_21 = Panel(psrfbooltboxs_3.KeptIndicies)  # disabled
# Look at Rhino window
# to preview results
preview_104 = CustomPreview(Geometry=mshbooltboxs_3.Trimmed, Shader=swatch_104)  # disabled
# Look at Rhino window
# to preview results
preview_105 = CustomPreview(Geometry=psrfbooltboxs_3.Trimmed, Shader=swatch_105)  # disabled
preview_106 = CustomPreview(Geometry=crv_44, Shader=swatch_107)  # disabled
# Look at Rhino window
# to preview inputs
# Look at Rhino window
# to preview inputs
preview_107 = CustomPreview(Geometry=pt_5, Shader=swatch_106)  # disabled
tboxextr_4 = TwistedBoxExtrude(Profile=crv_44, Direction=pt_5, ParametersT=range_111, Weighted=False)  # disabled
# Box Morphing,
# If using Rhino 6
# you can use Pufferfish's
# Multi-Threaded "Morph To Twisted Box" component.
morph_71 = BoxMorph(Geometry=geo_80, Reference=bbox_73.Box, Target=tboxthrusrfs_3)  # disabled
# Box Morphing,
# If using Rhino 6
# you can use Pufferfish's
# Multi-Threaded "Morph To Twisted Box" component.
morph_72 = BoxMorph(Geometry=geo_81, Reference=bbox_74.Box, Target=tboxconsrfs_3)  # disabled
geo_82 = Geometry(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)  # disabled
# Look at Rhino window
# to preview results
preview_108 = CustomPreview(Geometry=tboxconsrfs_3, Shader=swatch_108)  # disabled
# Look at Rhino window
# to preview results
preview_109 = CustomPreview(Geometry=tboxthrusrfs_3, Shader=swatch_109)  # disabled
geo_83 = Geometry(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)  # disabled
bbox_75 = BoundingBox(Content=geo_82, Plane=PlaneXY(0, 0, 0))  # -> Box, Box_2; disabled
swatch_110 = ColourSwatch(SwatchColor=RGB(255, 255, 255))  # disabled
swatch_111 = ColourSwatch(SwatchColor=RGB(255, 255, 255))  # disabled
bbox_76 = BoundingBox(Content=geo_83, Plane=PlaneXY(0, 0, 0))  # -> Box, Box_2; disabled
# Box Morphing,
# If using Rhino 6
# you can use Pufferfish's
# Multi-Threaded "Morph To Twisted Box" component.
morph_73 = BoxMorph(Geometry=geo_82, Reference=bbox_75.Box, Target=tboxtube_3)  # disabled
# Look at Rhino window
# to preview results
preview_110 = CustomPreview(Geometry=tboxtube_3, Shader=swatch_110)  # disabled
# Box Morphing,
# If using Rhino 6
# you can use Pufferfish's
# Multi-Threaded "Morph To Twisted Box" component.
morph_74 = BoxMorph(Geometry=geo_83, Reference=bbox_76.Box, Target=tboxextr_4)  # disabled
# Look at Rhino window
# to preview results
preview_111 = CustomPreview(Geometry=tboxextr_4, Shader=swatch_111)  # disabled
number_slider_323 = Slider(9, range=0..10)  # disabled
number_slider_324 = Slider(10, range=0..10)  # disabled
number_slider_325 = Slider(6, range=0..10)  # disabled
# Using unevenly spaced parameter
# values will result in uneven spaced
# twisted boxes. The spacing can be
# controlled with custom values
# such as values from graph mappers.
number_slider_326 = Slider(4, range=0..100)  # disabled
range_112 = Range(Domain=Domain(0, 1), Steps=number_slider_323)  # disabled
# Graphmappers creating gradient spacing.
toggle_62 = BooleanToggle(False)  # disabled
# Weights the division distribution by curvature
# if the interpolation is not linear and degree is not 1.
# Equalizes the division
# distribution along the
# interpolation path. So 0.5
# would be the middle
# of the overall interpolation
# path, not the middle
# input mesh.
toggle_63 = BooleanToggle(False)  # disabled
graph_36 = GraphMapper(
    range_112,
    x0=0,
    x1=1,
    y0=0,
    y1=1,
    container_name="Bezier",
    cpx=[0, 0.7391828895, 0.628637135, 1],
    cpy=[0, 0.2603593469, 0.5803611279, 1])  # disabled
range_113 = Range(Domain=Domain(0, 1), Steps=number_slider_324)  # disabled
range_114 = Range(Domain=Domain(0, 1), Steps=number_slider_325)  # disabled
range_115 = Range(Domain=Domain(0, 1), Steps=number_slider_326)  # disabled
mesh_20 = Mesh([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])  # disabled
# Graphmappers creating gradient spacing.
toggle_64 = BooleanToggle(False)  # disabled
# Weights the division distribution by curvature
# if the interpolation is not linear and degree is not 1.
# Equalizes the division
# distribution along the
# interpolation path. So 0.5
# would be the middle
# of the overall interpolation
# path, not the middle
# input surface.
toggle_65 = BooleanToggle(False)  # disabled
number_slider_327 = Slider(3, range=0..7)  # disabled
# Determines how the interpolation path is interpolated.
# Determines the curvature degree of the interpolation path if the interpolation type is not linear.
number_slider_328 = Slider(0, range=0..3)  # disabled
graph_37 = GraphMapper(range_115, x0=0, x1=1, y0=0, y1=1, container_name="Bezier", cpx=[0, 1, 0.2749994397, 1], cpy=[0, 0, 0.8804543018, 1])  # disabled
graph_38 = GraphMapper(
    range_114,
    x0=0,
    x1=1,
    y0=0,
    y1=1,
    container_name="Bezier",
    cpx=[0, 0.8328191638, 0.4255454242, 1],
    cpy=[0, 0.1305431128, 0.758908391, 1])  # disabled
graph_39 = GraphMapper(
    range_113,
    x0=0,
    x1=1,
    y0=0,
    y1=1,
    container_name="Bezier",
    cpx=[0, 0.5540910363, 0.6268171668, 1],
    cpy=[0, 0.2577292919, 0.5195479393, 1])  # disabled
srf_22 = Surface([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])  # disabled
number_slider_329 = Slider(3, range=0..7)  # disabled
# Determines how the interpolation path is interpolated.
# Determines the curvature degree of the interpolation path if the interpolation type is not linear.
number_slider_330 = Slider(0, range=0..3)  # disabled
tboxthrumshs_4 = TwistedBoxThroughMeshes(
    Meshes=mesh_20,
    ParametersW=graph_36,
    Normalized=True,
    Equalized=toggle_62,
    Weighted=toggle_63,
    Degree=number_slider_327,
    InterpolationType=number_slider_328)  # disabled
geo_84 = Geometry(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)  # disabled
swatch_112 = ColourSwatch(SwatchColor=RGB(255, 255, 255))  # disabled
bbox_77 = BoundingBox(Content=geo_84, Plane=PlaneXY(0, 0, 0))  # -> Box, Box_2; disabled
# Box Morphing,
# If using Rhino 6
# you can use Pufferfish's
# Multi-Threaded "Morph To Twisted Box" component.
morph_75 = BoxMorph(Geometry=geo_84, Reference=bbox_77.Box, Target=tboxthrumshs_4)  # disabled
# Look at Rhino window
# to preview results
preview_112 = CustomPreview(Geometry=tboxthrumshs_4, Shader=swatch_112)  # disabled
tboxthrusrfs_4 = TwistedBoxThroughSurfaces(
    Surfaces=srf_22,
    ParametersU=graph_37,
    ParametersV=graph_38,
    ParametersW=graph_39,
    Normalized=True,
    Equalized=toggle_64,
    Weighted=toggle_65,
    Degree=number_slider_329,
    InterpolationType=number_slider_330)  # disabled
geo_85 = Geometry(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)  # disabled
bbox_78 = BoundingBox(Content=geo_85, Plane=PlaneXY(0, 0, 0))  # -> Box, Box_2; disabled
swatch_113 = ColourSwatch(SwatchColor=RGB(255, 255, 255))  # disabled
# Box Morphing,
# If using Rhino 6
# you can use Pufferfish's
# Multi-Threaded "Morph To Twisted Box" component.
morph_76 = BoxMorph(Geometry=geo_85, Reference=bbox_78.Box, Target=tboxthrusrfs_4)  # disabled
# Look at Rhino window
# to preview results
preview_113 = CustomPreview(Geometry=tboxthrusrfs_4, Shader=swatch_113)  # disabled
