# Grasshopper definition Pf_12-Transform.gh (Grasshopper 0.9.76)
# plug-ins: Pufferfish

# 09-Transform Twisted Box
number_slider = Slider(25, range=0..100)  # disabled
# 12-Mirror Cut Transforms
# The index to cut the list and
# mirror at.Try with negative
# index also to see how it
# effects the list.
number_slider_2 = Slider(1, range=-10..10)  # disabled
number_slider_3 = Slider(10, range=0..10)  # disabled
# 05-Rotate Euler
# Initial plane for rotation
pl = Plane(PlaneXY(-2.669523384, 93.53754807, 0))  # disabled
# 06-Rotate Quaternion
# Plane to rotate from
xy = XYPlane(Origin=Point(-20.69206653, 104.9533839, 0))  # disabled
# Plane to rotate to
yz = YZPlane(Origin=Point(-20.69206653, 104.9533839, 0))  # disabled
# 07-Rotate World
# Initial plane that
# sets axis system
pl_2 = Plane(PlaneXY(-3.750784621, 121.3401178, 0))  # disabled
# Proportional scale factors for the
# input planes axes. Use same value
# for all for uniform scaling. These values
# are more like weights which balance with
# eachother like percentage overall, as
# opposed to traditional scale factors.
# They are proportional.
# The area
# the geometry
# will scale to
number_slider_4 = Slider(0.665, range=0.1..1)  # disabled
number_slider_5 = Slider(0.361, range=0.1..1)  # disabled
# The length
# the curve
# will scale to
number_slider_6 = Slider(0.694, range=0.1..1)  # disabled
number_slider_7 = Slider(0.361, range=0.1..1)  # disabled
number_slider_8 = Slider(0.189, range=0.1..1)  # disabled
number_slider_9 = Slider(0.161, range=0.1..1)  # disabled
number_slider_10 = Slider(0.248, range=0.1..1)  # disabled
number_slider_11 = Slider(0.225, range=0.1..1)  # disabled
# The volume
# the geometry
# will scale to
number_slider_12 = Slider(1, range=0.1..1)  # disabled
# 02-Scale To Area
# Any geometry that can have its area taken.
# Surface, Polysurface(Brep), Mesh, Curve
# Plane for scaling orientation
number_slider_13 = Slider(1000, range=0..1000)  # disabled
# 03-Scale To Length
# Curve
# Plane for scaling orientation
number_slider_14 = Slider(100, range=0..1000)  # disabled
# 04-Scale To Volume
# Any geometry that can have its volume
# taken. Surface, Polysurface(Brep), Mesh
# Plane for scaling orientation
number_slider_15 = Slider(5000, range=0..5000)  # disabled
number_slider_16 = Slider(60, range=0..1000)  # disabled
# 13-Recursive Transform
# The geometry to transform
geo = Geometry(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)  # disabled
# Joins the list at the seam so the duplicate transform is removed
# where the mirror list meets the input list. Make it true and see how
# the result list changes at the seam.
# Determines if the list mirrors at the start or end
toggle = BooleanToggle(False)  # disabled
toggle_2 = BooleanToggle(False)  # disabled
# X output of transform components
# to get transformation data
number_slider_17 = Slider(0.9, range=0..1)  # disabled
# Joins the list at the seam so the duplicate transforn is removed
# where the mirror list meets the input list. Make it true and see how
# the result list changes at the seam.
# Determines if the list mirrors after or before the index
toggle_3 = BooleanToggle(False)  # disabled
toggle_4 = BooleanToggle(False)  # disabled
# 11-Mirror Combine Transforms
# List of transforms
transform = Transform([{TransformCount=1, Name="Translation", tx=0, ty=0, tz=10}, {TransformCount=1, frame.origin.x=0, frame.origin.y=0, frame.origin.z=0, frame.xaxis.x=1, frame.xaxis.y=0, frame.xaxis.z=0, frame.yaxis.x=0, frame.yaxis.y=1, frame.yaxis.z=0, Name="Scale", x=0.5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}, {TransformCount=1, angle=1.570796327, ax=0, ay=0, az=1, cx=0, cy=0, cz=0, Name="Rotation"}, {TransformCount=1, frame.origin.x=0, frame.origin.y=0, frame.origin.z=0, frame.xaxis.x=0, frame.xaxis.y=1, frame.xaxis.z=0, frame.yaxis.x=0, frame.yaxis.y=0, frame.yaxis.z=1, Name="Scale", x=1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}])  # disabled
# 10-Mass Transform
geo_2 = Geometry(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)  # disabled
# Pf_12-Transform
# 01-Move To Point
# Any geometry
geo_3 = Geometry(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)  # disabled
pt = Point(Point(4.119700559, -113.0370824, 0))  # disabled
pt_2 = Point(Point(17.40970513, -103.262798, 10.6850993))  # disabled
number_slider_18 = Slider(0, range=0..3)  # disabled
number_slider_19 = Slider(1, range=0..3)  # disabled
number_slider_20 = Slider(2, range=0..3)  # disabled
number_slider_21 = Slider(0, range=0..3)  # disabled
number_slider_22 = Slider(1, range=0..3)  # disabled
number_slider_23 = Slider(2, range=0..3)  # disabled
# List of transforms
transform_2 = Transform([{TransformCount=1, Name="Translation", tx=0, ty=0, tz=10}, {TransformCount=1, frame.origin.x=0, frame.origin.y=0, frame.origin.z=0, frame.xaxis.x=1, frame.xaxis.y=0, frame.xaxis.z=0, frame.yaxis.x=0, frame.yaxis.y=1, frame.yaxis.z=0, Name="Scale", x=0.5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}, {TransformCount=1, angle=1.570796327, ax=0, ay=0, az=1, cx=0, cy=0, cz=0, Name="Rotation"}, {TransformCount=1, frame.origin.x=0, frame.origin.y=0, frame.origin.z=0, frame.xaxis.x=0, frame.xaxis.y=1, frame.xaxis.z=0, frame.yaxis.x=0, frame.yaxis.y=0, frame.yaxis.z=1, Name="Scale", x=1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}])  # disabled
xy_2 = XYPlane(Origin=Point(-0.6402722879, 50.28212892, 6.306471627))  # disabled
# Rotation factor between planes
number_slider_24 = Slider(0.5, range=0..1)  # disabled
xy_3 = XYPlane(Origin=Point(4.327286669, -47.54571542, 0))  # disabled
xy_4 = XYPlane(Origin=Point(0, 0, 0))  # disabled
crv = Curve(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)  # disabled
geo_4 = Geometry(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)  # disabled
number_slider_25 = Slider(70.779, range=0..360)  # disabled
geo_5 = Geometry(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)  # disabled
number_slider_26 = Slider(125.338, range=0..360)  # disabled
# Rotation degrees for each axis
# The axis for each successive plane axis rotation.
# Common rotation patterns are:
# XYZ
# ZYX
# ZYZ
number_slider_27 = Slider(73.728, range=0..360)  # disabled
number_slider_28 = Slider(70.779, range=0..360)  # disabled
number_slider_29 = Slider(125.338, range=0..360)  # disabled
# Rotation degrees for each axis
# The axes to rotate around from the initial plane
# 08-Morph To Twisted Box [Multi-Threaded] ***Rhino 6 Only!
# If you are running this on Rhino 5 then you will be seeing a jumbled mess as the result.
# Why? because Rhino's Transform class required for morphing is not thread-safe
# in Rhino 5. In Rhino 6 the Transform class was made thread-safe and that is why
# the results are only correct in Rhino 6, so don't use this component in Rhino 5, unless
# of course you are into jumbled messes :D
# 
# If you are running this in Rhino 6 and see any weird glitchy result display mesh, that is because
# some versions of Rhino 6 have a bug in mesh dispays, unrelated to Pufferfish. The result
# will however bake correctly and you can usually fix the Grasshopper display by recomputing
# the component or solution a few times until it fixes. Again, this is not a Pufferfish issue.
# This component does what Grasshoppers Box Morph component does
# but it is Multi-Threaded. It is potentially much faster, but there are two conditions
# that are important with multi-threading which are directly related to better performance.
# 
# 1. How many cores your computers CPU has
# 2. How good those cores are
# 
# The more cores you have and the better they are, the faster the component will go.
# Please don't expect a 2010 single core low end laptop using this component to
# perform much better than with Grasshopper's Box Morph.
# 
# You may not see much of a speed difference with a low number of morphs as the performance boost is exponential,
# meaning the more things you morph at once the greater the performance difference will be from Grasshopper's Box Morph.
# On the example to the right with my computer, Pufferfish's Morph To Twisted Box finishes 6 times faster then Grasshoppers Box Morph.
# 
# (My Computers CPU = Intel(R) Core(TM) i7-6700HQ CPU @ 2.60GHz _ Quad (4) Cores)
# 
# You can turn on the components performace time display by going to Display > Canvas Widgets > and turning on the Profiler.
# Then recompute the components.
number_slider_30 = Slider(73.728, range=0..360)  # disabled
# Geometry to rotate
box = CenterBox(Base=pl, X=4, Y=4, Z=4)  # disabled
# Geometry to rotate
box_2 = CenterBox(Base=xy, X=4, Y=4, Z=4)  # disabled
# Geometry to rotate
box_3 = CenterBox(Base=pl_2, X=4, Y=4, Z=4)  # disabled
# The transformation
# Number of recursion steps
number_slider_31 = Slider(20, range=0..20)  # disabled
area = Area(Geometry=geo)  # -> Area, Centroid; disabled
# All transformation components have an
# X output with transform data. This is the
# data the Transform Twisted Box component
# uses. The components with transform data
# are components like Move, Scale, Rotate,
# Project, Mirror, Orient, Array, and other
# components in Grasshoppers Transform tab.
Z = UnitZ(Factor=number_slider)  # disabled
volume = Volume(Geometry=geo_2)  # -> Volume, Centroid; disabled
X = UnitX(Factor=number_slider_3)  # disabled
# Pufferfish
# By: Michael Pryor
move2pt = MoveToPoint(Geometry=geo_3, PointA=pt, PointB=pt_2)  # -> Moved, Vector, Transform; disabled
# If true then only the final
# transformation is calculated
# and output.
toggle_5 = BooleanToggle(False)  # disabled
# Transformation 2
rotate = Rotate(Angle=degrees(number_slider_16), Plane=volume.Centroid)  # -> Geometry, Transform; disabled
scale = Scale(Center=area.Centroid, Factor=number_slider_17)  # -> Geometry, Transform; disabled
move = Move(Motion=Z)  # -> Geometry, Transform; disabled
# Transformation 3
move_2 = Move(Motion=X)  # -> Geometry, Transform; disabled
# Just to display the input geometry as wireframe
wires = BrepWireframe(Brep=geo_2, Density=-1)  # disabled
# Transformation 1
scale_2 = Scale(Center=volume.Centroid, Factor=0.5)  # -> Geometry, Transform; disabled
# Input can be
# a box also
tbox = TwistedBox({C=Point(-2.465472475, 155.8678715, 0.5782825404), C=Point(7.666240382, 161.4108396, 4.739790727), C=Point(5.470729611, 168.6692017, 7.886584936), C=Point(1.512596681, 168.6692017, 0.4464082798), C=Point(-4.38608478, 154.0340536, 10.37201541), C=Point(0.1858138587, 159.5051915, 19.87017005), C=Point(-2.226868427, 170.5030196, 11.87849548), C=Point(-13.86627736, 165.0318817, 12.51010234)})  # disabled
mircomtrans = MirrorCombineTransforms(Transforms=transform, Flip=toggle_2, Join=toggle)  # -> Mirrored, SplitIndex; disabled
scale2area = ScaleToArea(
    Geometry=geo_5,
    Plane=xy_4,
    Area=number_slider_13,
    FactorX=number_slider_7,
    FactorY=number_slider_8,
    FactorZ=number_slider_4)  # -> Scaled, Transform; disabled
scale2vol = ScaleToVolume(
    Geometry=geo_4,
    Plane=xy_2,
    Volume=number_slider_15,
    FactorX=number_slider_10,
    FactorY=number_slider_11,
    FactorZ=number_slider_12)  # -> Scaled, Transform; disabled
scale2len = ScaleToLength(
    Curve=crv,
    Plane=xy_3,
    Length=number_slider_14,
    FactorX=number_slider_5,
    FactorY=number_slider_9,
    FactorZ=number_slider_6)  # -> Scaled, Transform; disabled
mircuttrans = MirrorCutTransforms(Transforms=transform_2, MirrorIndex=number_slider_2, Flip=toggle_4, Join=toggle_3)  # -> MirrorCut, SplitIndex, Intersected; disabled
# Look at Rhino window
# to preview results
# Transformation data to use
# with the transform component
panel = Panel(move2pt.Vector)  # disabled
# Faster than converting to Brep
trantbox = TransformTwistedBox(TwistedBox=tbox, Transform=move.Transform)  # disabled
# Component is a shortcut for this
preview = CustomPreview(
    Geometry=move2pt.Moved,
    Shader={ambient=RGB(0, 0, 0), diffuse=RGB(255, 105, 180), emission=RGB(76, 32, 54), shine=0.5, specular=RGB(255, 255, 255), transparency=0})  # disabled
merge = Merge(Data1=scale_2.Transform, Data2=rotate.Transform, Data3=move_2.Transform)  # disabled
# Result transform data for use
# with the transform component
panel_2 = Panel(scale2vol.Transform)  # disabled
# Result transform data for use
# with the transform component
panel_3 = Panel(scale2len.Transform)  # disabled
# Result transform data for use
# with the transform component
panel_4 = Panel(scale2area.Transform)  # disabled
# Look at Rhino
# to preview results
geo_6 = Geometry(scale2area.Scaled)  # disabled
# Look at Rhino
# to preview results
crv_2 = Curve(scale2len.Scaled)  # disabled
roteuler = RotateEuler(
    Geometry=box,
    Plane=pl,
    Axis1=number_slider_18,
    Axis2=number_slider_19,
    Axis3=number_slider_20,
    Degrees1=number_slider_25,
    Degrees2=number_slider_26,
    Degrees3=number_slider_27)  # -> Rotated, Plane1, Plane2, Plane3, Transform; disabled
# List mirrored
# and combined
panel_5 = Panel(mircomtrans.Mirrored)  # disabled
panel_6 = Panel(transform_2)  # disabled
# Look at Rhino
# to preview results
geo_7 = Geometry(scale2vol.Scaled)  # disabled
rotquat = RotateQuaternion(Geometry=box_2, Plane1=xy, Plane2=yz, Factor=number_slider_24)  # -> Rotated, Plane, Axis, Degree, Transform; disabled
panel_7 = Panel(mircuttrans.Intersected)  # disabled
rotworld = RotateWorld(
    Geometry=box_3,
    Plane=pl_2,
    Axis1=number_slider_21,
    Axis2=number_slider_22,
    Axis3=number_slider_23,
    Degrees1=number_slider_28,
    Degrees2=number_slider_29,
    Degrees3=number_slider_30)  # -> Rotated, Plane1, Plane2, Plane3, Transform; disabled
panel_8 = Panel(transform)  # disabled
# List cut
# and mirrored
panel_9 = Panel(mircuttrans.MirrorCut)  # disabled
retrans = RecursiveTransform(Geometry=geo, Transform=scale.Transform, Steps=number_slider_31, Last=toggle_5)  # disabled
volume_2 = Volume(Geometry=geo_7)  # -> Volume, Centroid; disabled
area_2 = Area(Geometry=geo_6)  # -> Area, Centroid; disabled
len = Length(Curve=crv_2)  # disabled
geo_8 = Geometry(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)  # disabled
mtrans = MassTransform(Transforms=merge)  # -> MassTransform, PartialTransforms; disabled
swatch = ColourSwatch(SwatchColor=RGB(60, 0, 255))  # disabled
swatch_2 = ColourSwatch(SwatchColor=RGB(0, 76, 255))  # disabled
# The planes at each axis step
# of the rotation. Hidden by default.
# Transform data
swatch_3 = ColourSwatch(SwatchColor=RGB(0, 0, 255))  # disabled
# The planes at each axis step
# of the rotation. Hidden by default.
# Transform data
swatch_4 = ColourSwatch(SwatchColor=RGB(0, 0, 255))  # disabled
bbox = BoundingBox(Content=geo_8, Plane=PlaneXY(0, 0, 0))  # -> Box, Box_2; disabled
# The final compound transformation
# Grasshopper's compound component
# can do this, what's different with Pufferfish's
# is the partial results which can give you
# each step of the compound transformation.
comp = Compound(Transforms=merge)  # disabled
# Transform data
swatch_5 = ColourSwatch(SwatchColor=RGB(0, 0, 255))  # disabled
# Area of result matches
# the input area to scale to
panel_10 = Panel(area_2.Area)  # disabled
# Length of result matches
# the input length to scale to
panel_11 = Panel(len)  # disabled
# Volume of result matches
# the input area to scale to
panel_12 = Panel(volume_2.Volume)  # disabled
# Perform the transform
transform_3 = Transform(Geometry=geo_2, Transform=mtrans.MassTransform)  # disabled
# Look at Rhino window
# to preview results
preview_2 = CustomPreview(Geometry=trantbox, Shader=swatch)  # disabled
# Combining multiple transformations
# Look at Rhino window
# to preview results
preview_3 = CustomPreview(Geometry=retrans, Shader=swatch_2)  # disabled
# Box Morphing
# (If using Rhino 6 you can use Pufferfish's
# multi-threaded "Morph To Twisted Box" component)
# If you try transform components
# directly with twisted boxes it will
# not work. No transformation will occur.
morph = BoxMorph(Geometry=geo_8, Reference=bbox.Box, Target=trantbox)  # disabled
# Twisted Boxes
# to morph to
tbox_2 = TwistedBox([{C=Point(-40.05703648, 218.613708, 0), C=Point(-37.42869547, 218.613708, 0), C=Point(-37.42869547, 221.242049, 0), C=Point(-40.05703648, 221.242049, 0), C=Point(-40.05703648, 218.613708, 2.644859784), C=Point(-37.42869547, 218.613708, 2.644859784), C=Point(-37.42869547, 221.242049, 2.644859784), C=Point(-40.05703648, 221.242049, 2.644859784)}, {C=Point(-40.05703648, 221.242049, 0), C=Point(-37.42869547, 221.242049, 0), C=Point(-37.42869547, 223.8703901, 0), C=Point(-40.05703648, 223.8703901, 0), C=Point(-40.05703648, 221.242049, 2.644859784), C=Point(-37.42869547, 221.242049, 2.644859784), C=Point(-37.42869547, 223.8703901, 2.644859784), C=Point(-40.05703648, 223.8703901, 2.644859784)}, {C=Point(-40.05703648, 223.8703901, 0), C=Point(-37.42869547, 223.8703901, 0), C=Point(-37.42869547, 226.4987311, 0), C=Point(-40.05703648, 226.4987311, 0), C=Point(-40.05703648, 223.8703901, 2.644859784), C=Point(-37.42869547, 223.8703901, 2.644859784), C=Point(-37.42869547, 226.4987311, 2.644859784), C=Point(-40.05703648, 226.4987311, 2.644859784)}, {C=Point(-40.05703648, 226.4987311, 0), C=Point(-37.42869547, 226.4987311, 0), C=Point(-37.42869547, 229.1270721, 0), C=Point(-40.05703648, 229.1270721, 0), C=Point(-40.05703648, 226.4987311, 2.644859784), C=Point(-37.42869547, 226.4987311, 2.644859784), C=Point(-37.42869547, 229.1270721, 2.644859784), C=Point(-40.05703648, 229.1270721, 2.644859784)}, {C=Point(-40.05703648, 229.1270721, 0), C=Point(-37.42869547, 229.1270721, 0), C=Point(-37.42869547, 231.7554131, 0), C=Point(-40.05703648, 231.7554131, 0), C=Point(-40.05703648, 229.1270721, 2.644859784), C=Point(-37.42869547, 229.1270721, 2.644859784), C=Point(-37.42869547, 231.7554131, 2.644859784), C=Point(-40.05703648, 231.7554131, 2.644859784)}, {C=Point(-40.05703648, 231.7554131, 0), C=Point(-37.42869547, 231.7554131, 0), C=Point(-37.42869547, 234.3837541, 0), C=Point(-40.05703648, 234.3837541, 0), C=Point(-40.05703648, 231.7554131, 2.644859784), C=Point(-37.42869547, 231.7554131, 2.644859784), C=Point(-37.42869547, 234.3837541, 2.644859784), C=Point(-40.05703648, 234.3837541, 2.644859784)}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])  # disabled
# The plane at the final rotation
preview_4 = CustomPreview(Geometry=roteuler.Plane3, Shader=swatch_4)  # disabled
# Geometry to morph
# Reference Box
# to morph from
geo_9 = Geometry(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)  # disabled
# The plane at the final rotation
preview_5 = CustomPreview(Geometry=rotworld.Plane3, Shader=swatch_3)  # disabled
geo_10 = Geometry(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)  # disabled
pt_3 = Point(Point(259.9602786, 5.452049486, 0))  # disabled
pt_4 = Point(Point(273.6166618, 23.9598674, 0))  # disabled
# The rotated geometry
# Look at Rhino window
# to preview results
preview_6 = CustomPreview(
    Geometry=roteuler.Rotated,
    Shader={ambient=RGB(0, 0, 0), diffuse=RGB(255, 105, 180), emission=RGB(76, 32, 54), shine=0.5, specular=RGB(255, 255, 255), transparency=0})  # disabled
# The rotated geometry
# Look at Rhino window
# to preview results
preview_7 = CustomPreview(
    Geometry=rotquat.Rotated,
    Shader={ambient=RGB(0, 0, 0), diffuse=RGB(255, 105, 180), emission=RGB(76, 32, 54), shine=0.5, specular=RGB(255, 255, 255), transparency=0})  # disabled
# The plane at the quaternion rotation
preview_8 = CustomPreview(Geometry=rotquat.Plane, Shader=swatch_5)  # disabled
# The rotated geometry
# Look at Rhino window
# to preview results
preview_9 = CustomPreview(
    Geometry=rotworld.Rotated,
    Shader={ambient=RGB(0, 0, 0), diffuse=RGB(255, 105, 180), emission=RGB(76, 32, 54), shine=0.5, specular=RGB(255, 255, 255), transparency=0})  # disabled
# Look at Rhino window
# to preview results
preview_10 = CustomPreview(
    Geometry=transform_3,
    Shader={ambient=RGB(0, 0, 0), diffuse=RGB(255, 105, 180), emission=RGB(76, 32, 54), shine=0.5, specular=RGB(255, 255, 255), transparency=0})  # disabled
bbox_2 = BoundingBox(Content=geo_9, Plane=PlaneXY(0, 0, 0))  # -> Box, Box_2; disabled
vec2pt = Vector2Pt(PointA=pt_3, PointB=pt_4, Unitize=False)  # -> Vector, Length; disabled
move_3 = Move(Geometry=geo_10, Motion=vec2pt.Vector)  # -> Geometry, Transform; disabled
morph2tbox = MorphToTwistedBox(Geometries=geo_9, References=bbox_2.Box, Targets=tbox_2)  # disabled
# Grasshopper's Box Morph
morph_2 = BoxMorph(Geometry=geo_9, Reference=bbox_2.Box, Target=tbox_2)  # disabled
number_slider_32 = Slider(1, range=-10..10)  # disabled
# Splitting the list
toggle_6 = BooleanToggle(False)  # disabled
toggle_7 = BooleanToggle(False)  # disabled
toggle_8 = BooleanToggle(False)  # disabled
# Splitting the list
toggle_9 = BooleanToggle(False)  # disabled
# Partial results
number_slider_33 = Slider(10, range=0..10)  # disabled
# Look at Rhino window
# to preview results
preview_11 = CustomPreview(
    Geometry=morph2tbox,
    Shader={ambient=RGB(0, 0, 0), diffuse=RGB(255, 105, 180), emission=RGB(76, 32, 54), shine=0.5, specular=RGB(255, 255, 255), transparency=0})  # disabled
transform_4 = Transform([{TransformCount=1, Name="Translation", tx=0, ty=0, tz=10}, {TransformCount=1, frame.origin.x=0, frame.origin.y=0, frame.origin.z=0, frame.xaxis.x=1, frame.xaxis.y=0, frame.xaxis.z=0, frame.yaxis.x=0, frame.yaxis.y=1, frame.yaxis.z=0, Name="Scale", x=0.5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}, {TransformCount=1, angle=1.570796327, ax=0, ay=0, az=1, cx=0, cy=0, cz=0, Name="Rotation"}, {TransformCount=1, frame.origin.x=0, frame.origin.y=0, frame.origin.z=0, frame.xaxis.x=0, frame.xaxis.y=1, frame.xaxis.z=0, frame.yaxis.x=0, frame.yaxis.y=0, frame.yaxis.z=1, Name="Scale", x=1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}])  # disabled
transform_5 = Transform([{TransformCount=1, Name="Translation", tx=0, ty=0, tz=10}, {TransformCount=1, frame.origin.x=0, frame.origin.y=0, frame.origin.z=0, frame.xaxis.x=1, frame.xaxis.y=0, frame.xaxis.z=0, frame.yaxis.x=0, frame.yaxis.y=1, frame.yaxis.z=0, Name="Scale", x=0.5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}, {TransformCount=1, angle=1.570796327, ax=0, ay=0, az=1, cx=0, cy=0, cz=0, Name="Rotation"}, {TransformCount=1, frame.origin.x=0, frame.origin.y=0, frame.origin.z=0, frame.xaxis.x=0, frame.xaxis.y=1, frame.xaxis.z=0, frame.yaxis.x=0, frame.yaxis.y=0, frame.yaxis.z=1, Name="Scale", x=1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}])  # disabled
# The geometry to transform
geo_11 = Geometry(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)  # disabled
number_slider_34 = Slider(60, range=0..1000)  # disabled
number_slider_35 = Slider(46, range=0..100)  # disabled
geo_12 = Geometry(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)  # disabled
number_slider_36 = Slider(3.635, range=0..10)  # disabled
number_slider_37 = Slider(0.88, range=0..1)  # disabled
number_slider_38 = Slider(394.689, range=0..1000)  # disabled
volume_3 = Volume(Geometry=geo_12)  # -> Volume, Centroid; disabled
# Multiple transformations
disc = Discontinuity(Curve=geo_11, Level=1)  # -> Points, Parameters; disabled
X_2 = UnitX(Factor=number_slider_33)  # disabled
# If  join is false you can use this index
# to split the list at the mirror seam.
mircuttrans_2 = MirrorCutTransforms(Transforms=transform_4, MirrorIndex=number_slider_32, Flip=toggle_6, Join=toggle_7)  # -> MirrorCut, SplitIndex, Intersected; disabled
# If  join is false you can use this index
# to split the list at the mirror seam.
mircomtrans_2 = MirrorCombineTransforms(Transforms=transform_5, Flip=toggle_9, Join=toggle_8)  # -> Mirrored, SplitIndex; disabled
# Transformation 2
rotate_2 = Rotate(Angle=degrees(number_slider_34), Plane=volume_3.Centroid)  # -> Geometry, Transform; disabled
# Transformation 3
move_4 = Move(Motion=X_2)  # -> Geometry, Transform; disabled
# Just to display the input geometry as wireframe
wires_2 = BrepWireframe(Brep=geo_12, Density=-1)  # disabled
# Transformation 1
scale_3 = Scale(Center=volume_3.Centroid, Factor=0.5)  # -> Geometry, Transform; disabled
item = ListItem(List=disc.Points, Index=0, Wrap=True)  # disabled
Z_2 = UnitZ(Factor=number_slider_35)  # disabled
tbox_3 = TwistedBox({C=Point(-2.465472475, 155.8678715, 0.5782825404), C=Point(7.666240382, 161.4108396, 4.739790727), C=Point(5.470729611, 168.6692017, 7.886584936), C=Point(1.512596681, 168.6692017, 0.4464082798), C=Point(-4.38608478, 154.0340536, 10.37201541), C=Point(0.1858138587, 159.5051915, 19.87017005), C=Point(-2.226868427, 170.5030196, 11.87849548), C=Point(-13.86627736, 165.0318817, 12.51010234)})  # disabled
area_3 = Area(Geometry=geo_11)  # -> Area, Centroid; disabled
Z_3 = UnitZ(Factor=number_slider_36)  # disabled
# Look at the result in Rhino and you
# will notice that no change occurs
# to the twisted box.
move_5 = Move(Geometry=tbox_3, Motion=Z_2)  # -> Geometry, Transform; disabled
split = SplitList(List=mircuttrans_2.MirrorCut, Index=mircuttrans_2.SplitIndex)  # -> ListA, ListB; disabled
split_2 = SplitList(List=mircomtrans_2.Mirrored, Index=mircomtrans_2.SplitIndex)  # -> ListA, ListB; disabled
rotate_3 = Rotate(Angle=degrees(number_slider_38), Plane=item)  # -> Geometry, Transform; disabled
merge_2 = Merge(Data1=scale_3.Transform, Data2=rotate_2.Transform, Data3=move_4.Transform)  # disabled
move_6 = Move(Motion=Z_3)  # -> Geometry, Transform; disabled
scale_4 = Scale(Center=area_3.Centroid, Factor=number_slider_37)  # -> Geometry, Transform; disabled
# Using the partial results you
# can see all the steps of the
# mass transformation
mtrans_2 = MassTransform(Transforms=merge_2)  # -> MassTransform, PartialTransforms; disabled
panel_13 = Panel(split.ListA)  # disabled
panel_14 = Panel(split.ListB)  # disabled
# Compound the transformations
# into one transformation to use
# Number of recursion steps
number_slider_39 = Slider(20, range=0..20)  # disabled
mtrans_3 = MassTransform(Transforms=flatten([move_6.Transform, scale_4.Transform, rotate_3.Transform]))  # -> MassTransform, PartialTransforms; disabled
panel_15 = Panel(split_2.ListB)  # disabled
panel_16 = Panel(split_2.ListA)  # disabled
# Perform the transform
transform_6 = Transform(Geometry=geo_12, Transform=mtrans_2.PartialTransforms)  # disabled
# Look at Rhino window
# to preview results
# Stepping through the partial results
preview_12 = CustomPreview(
    Geometry=transform_6,
    Shader={ambient=RGB(0, 0, 0), diffuse=RGB(255, 105, 180), emission=RGB(76, 32, 54), shine=0.5, specular=RGB(255, 255, 255), transparency=0})  # disabled
retrans_2 = RecursiveTransform(Geometry=geo_11, Transform=mtrans_3.MassTransform, Steps=number_slider_39, Last=False)  # disabled
swatch_6 = ColourSwatch(SwatchColor=RGB(0, 76, 255))  # disabled
# Look at Rhino window
# to preview results
preview_13 = CustomPreview(Geometry=retrans_2, Shader=swatch_6)  # disabled
# Repeating the list
# for repeating patterns
number_slider_40 = Slider(1, range=-10..10)  # disabled
toggle_10 = BooleanToggle(False)  # disabled
toggle_11 = BooleanToggle(False)  # disabled
toggle_12 = BooleanToggle(False)  # disabled
# Repeating the list
# for repeating patterns
toggle_13 = BooleanToggle(False)  # disabled
number_slider_41 = Slider(10, range=0..10)  # disabled
transform_7 = Transform([{TransformCount=1, Name="Translation", tx=0, ty=0, tz=10}, {TransformCount=1, frame.origin.x=0, frame.origin.y=0, frame.origin.z=0, frame.xaxis.x=1, frame.xaxis.y=0, frame.xaxis.z=0, frame.yaxis.x=0, frame.yaxis.y=1, frame.yaxis.z=0, Name="Scale", x=0.5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}, {TransformCount=1, angle=1.570796327, ax=0, ay=0, az=1, cx=0, cy=0, cz=0, Name="Rotation"}, {TransformCount=1, frame.origin.x=0, frame.origin.y=0, frame.origin.z=0, frame.xaxis.x=0, frame.xaxis.y=1, frame.xaxis.z=0, frame.yaxis.x=0, frame.yaxis.y=0, frame.yaxis.z=1, Name="Scale", x=1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}])  # disabled
# Change the index value to shrink or grow the wave
transform_8 = Transform([{TransformCount=1, Name="Translation", tx=0, ty=0, tz=10}, {TransformCount=1, frame.origin.x=0, frame.origin.y=0, frame.origin.z=0, frame.xaxis.x=1, frame.xaxis.y=0, frame.xaxis.z=0, frame.yaxis.x=0, frame.yaxis.y=1, frame.yaxis.z=0, Name="Scale", x=0.5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}, {TransformCount=1, angle=1.570796327, ax=0, ay=0, az=1, cx=0, cy=0, cz=0, Name="Rotation"}, {TransformCount=1, frame.origin.x=0, frame.origin.y=0, frame.origin.z=0, frame.xaxis.x=0, frame.xaxis.y=1, frame.xaxis.z=0, frame.yaxis.x=0, frame.yaxis.y=0, frame.yaxis.z=1, Name="Scale", x=1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}])  # disabled
number_slider_42 = Slider(60, range=0..1000)  # disabled
geo_13 = Geometry(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)  # disabled
volume_4 = Volume(Geometry=geo_13)  # -> Volume, Centroid; disabled
X_3 = UnitX(Factor=number_slider_41)  # disabled
mircuttrans_3 = MirrorCutTransforms(Transforms=transform_8, MirrorIndex=number_slider_40, Flip=toggle_10, Join=toggle_11)  # -> MirrorCut, SplitIndex, Intersected; disabled
mircomtrans_3 = MirrorCombineTransforms(Transforms=transform_7, Flip=toggle_13, Join=toggle_12)  # -> Mirrored, SplitIndex; disabled
# Transformation 2
rotate_4 = Rotate(Angle=degrees(number_slider_42), Plane=volume_4.Centroid)  # -> Geometry, Transform; disabled
# Transformation 3
move_7 = Move(Motion=X_3)  # -> Geometry, Transform; disabled
# Just to display the input geometry as wireframe
wires_3 = BrepWireframe(Brep=geo_13, Density=-1)  # disabled
# Transformation 1
scale_5 = Scale(Center=volume_4.Centroid, Factor=0.5)  # -> Geometry, Transform; disabled
# Move the slider to shorten or lengthen the wave
number_slider_43 = Slider(83, range=0..200)  # disabled
# Move the slider to shorten or lengthen the wave
number_slider_44 = Slider(100, range=0..200)  # disabled
merge_3 = Merge(Data1=scale_5.Transform, Data2=rotate_4.Transform, Data3=move_7.Transform)  # disabled
# By repeating the mirror cut list data
# you can make patterns such as waves.
repeat = RepeatData(Data=mircuttrans_3.MirrorCut, Length=number_slider_43)  # disabled
# By repeating the mirror combine list data
# you can make patterns such as waves.
repeat_2 = RepeatData(Data=mircomtrans_3.Mirrored, Length=number_slider_44)  # disabled
# You can use list item to browse
# through the steps of the
# mass transformation. Change the
# slider value to see the steps.
number_slider_45 = Slider(0, range=0..2)  # disabled
mtrans_4 = MassTransform(Transforms=merge_3)  # -> MassTransform, PartialTransforms; disabled
panel_17 = Panel(repeat)  # disabled
panel_18 = Panel(repeat_2)  # disabled
item_2 = ListItem(List=mtrans_4.PartialTransforms, Index=number_slider_45, Wrap=True)  # disabled
# Perform the transform
transform_9 = Transform(Geometry=geo_13, Transform=item_2)  # disabled
# Look at Rhino window
# to preview results
preview_14 = CustomPreview(
    Geometry=transform_9,
    Shader={ambient=RGB(0, 0, 0), diffuse=RGB(255, 105, 180), emission=RGB(76, 32, 54), shine=0.5, specular=RGB(255, 255, 255), transparency=0})  # disabled
