# Grasshopper definition Pf_ClosestVectorLoops - Requires Anemone Plugin.gh (Grasshopper 0.9.76)
# plug-ins: Pufferfish, Anemone

# ---- group: Spin force random location
number_slider = Slider(4, range=0..50)
box = CenterBox(Base=PlaneXY(0, 0, 0), X=Slider(20, range=0..100), Y=Slider(20, range=0..100), Z=Slider(20, range=0..100))
pop3d = Populate3D(Region=box, Count=number_slider, Seed=Slider(347, range=0..1000))

# ---- group: Guide Curves
crv = Curve([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])

# ---- group: Start surface to host start points
srf = Surface(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)

# ---- group: number of movements along the curves from start to end
# Closest Vector Guide Curves
# Double Click Loop Start to Run Loop
number_slider_2 = Slider(20, range=0..100)

# ---- group: Field start random location points
# Pufferfish
# By: Michael Pryor
# Pf_Closest Vector Loops
# Closest Vector Fields
number_slider_3 = Slider(20, range=0..100)
# Just generating some vector field here to get some movement,
# you can make "swarm" type vectors anyway you like
# - for instance using the Boids plug-in
number_slider_4 = Slider(644, range=0..1000)
box_2 = CenterBox(Base=PlaneXY(0, 0, 0), X=number_slider_3, Y=Slider(20, range=0..100), Z=Slider(20, range=0..100))
pop3d_2 = Populate3D(Region=box_2, Count=Slider(500, range=0..1000), Seed=number_slider_4)

# ---- group: random spin rotation axis 1
degree = Slider(308, range=0..360)
degree_2 = Slider(214.8, range=0..360)
dom = ConstructDomain(DomainStart=degree, DomainEnd=degree_2)
random = Random(Range=dom, Number=number_slider, Seed=Slider(544, range=0..1000))

# ---- group: random spin rotation axis 2
degree_3 = Slider(0, range=0..360)
degree_4 = Slider(0, range=0..360)
dom_2 = ConstructDomain(DomainStart=degree_3, DomainEnd=degree_4)
random_2 = Random(Range=dom_2, Number=number_slider, Seed=Slider(655, range=0..1000))

# ---- group: random spin strength
charge = Slider(0.3, range=-50..50)
charge_2 = Slider(0.1, range=-50..50)
dom_3 = ConstructDomain(DomainStart=charge, DomainEnd=charge_2)
random_3 = Random(Range=dom_3, Number=number_slider, Seed=Slider(645, range=0..1000))

# ---- group: random spin radius
charge_3 = Slider(15, range=-15..50)
charge_4 = Slider(15, range=-15..50)
dom_4 = ConstructDomain(DomainStart=charge_3, DomainEnd=charge_4)
random_4 = Random(Range=dom_4, Number=number_slider, Seed=Slider(587, range=0..1000))

# ---- group: random spin decay
charge_5 = Slider(7, range=-15..15)
charge_6 = Slider(7, range=-15..15)
dom_5 = ConstructDomain(DomainStart=charge_6, DomainEnd=charge_5)
random_5 = Random(Range=dom_5, Number=number_slider, Seed=Slider(665, range=0..1000))

# ----
# Double Click Loop Start to Run Loop
number_slider_5 = Slider(100, range=0..1000)

# ---- group: Rotation axis 1
xz = XZPlane(Origin=pop3d)
yz = YZPlane(Origin=pop3d)
rotate = Rotate(Geometry=xz, Angle=degrees(random), Plane=yz)  # -> Geometry, Transform

# ---- group: Rotation axis 2
xy = XYPlane(Origin=rotate.Geometry)
rotate_2 = Rotate(Geometry=rotate.Geometry, Angle=degrees(random_2), Plane=xy)  # -> Geometry, Transform

# ---- group: Loop Start (double click to run loop)
loop_start = LoopStart(Repeat=number_slider_5, Trigger=Toggle(False), Data=pop3d_2)  # -> port, Counter, Data

# ----
panel = Panel(loop_start.Counter)

# ---- group: Spin force
fspin = SpinForce(Plane=rotate_2.Geometry, Strength=random_3, Radius=random_4, Decay=random_5)

# ---- group: Merge and evaluate field
mergef = MergeFields(Fields=fspin)
evf = EvaluateField(Field=mergef, Point=loop_start.Data)  # -> Tensor, Strength

# ----
# Closest vector and vector star
number_slider_6 = Slider(1, range=0..10)
vec = Vector(evf.Tensor)
vecstar = VectorStar(Plane=PlaneXY(0, 0, 0), Resolution=number_slider_6, StarType=0, Dimensionality=False)  # -> Vectors, Lines
# Switch between continuous
# and discrete vectors
number_slider_7 = Slider(1, range=0..1)
cvec = ClosestVector(Reference=vec, Targets=vecstar.Vectors, KeepLength=False)  # -> Closest, Index, Angle
filter = StreamFilter(Gate=number_slider_7, Stream0=vec, Stream1=cvec.Closest)

# ---- group: Move point in field
amp = Amplitude(Vector=filter, Amplitude=Slider(2, range=0..5))
move = Move(Geometry=loop_start.Data, Motion=amp)  # -> Geometry, Transform

# ----
loop_end = LoopEnd(port=loop_start.port, Exit=False, Data=move.Geometry, pausedState=False, state="Constant & Record", TimeOutVal=0)

# ---- group: Make curves
flip = FlipMatrix(Data=loop_end)
pline = PolyLine(Vertices=flip, Closed=False)

# ----
# Look at Rhino window
# to preview results
preview = CustomPreview(Geometry=pline, Shader=ColourSwatch(SwatchColor=RGB(17, 20, 189)))

# ---- group: Controls
random_seed_of_start_points = Slider(48, range=0..100)
number_of_start_points = Slider(100, range=0..100)
size_of_guide_planes_on_curve = Slider(18, range=0..100)
max_search_radius_to_neighbor_points = Slider(15, range=0..100)
number_of_neighbor_points_to_follow = Slider(2, range=0..100)
resolution_of_discrete_vectors = Slider(2, range=0..10)

# ---- group: start points
pop2d = Populate2D(Region=srf, Count=number_of_start_points, Seed=random_seed_of_start_points)

# ---- group: Loop Start (double click to run loop)
loop_start_2 = LoopStart(N=number_slider_2, D0=pop2d)  # -> port, Counter, Data, Data_2

# ---- group: Vector towards closest plane
division = Division(A=loop_start_2.Counter, B=number_slider_2)
neg = Negative(Value=size_of_guide_planes_on_curve)
pframe = PerpFrame(Curve=reparameterize(crv), Parameter=division)
dom_6 = ConstructDomain(DomainStart=neg, DomainEnd=size_of_guide_planes_on_curve)
planesrf = PlaneSurface(Plane=pframe, XSize=dom_6, YSize=dom_6)
pull = PullPoint(Point=loop_start_2.Data, Geometry=planesrf, ClosestOnly=True)  # -> ClosestPoint, Distance
vec2pt = Vector2Pt(PointA=loop_start_2.Data, PointB=pull.ClosestPoint, Unitize=False)  # -> Vector, Length

# ---- group: Average vector towards neighbor points
prox = Proximity3D(Points=loop_start_2.Data, Group=number_of_neighbor_points_to_follow, MaxRadius=max_search_radius_to_neighbor_points)  # -> Links, Topology
vec_2 = Vector(prox.Links)
avr = Average(Input=vec_2)  # -> flatten(ArithmeticMean)

# ---- group: Add all vectors
addition = Addition(A=vec2pt.Vector, B=avr, C=loop_start_2.Data_2)

# ----
# Closest vector and vector star
number_slider_8 = Slider(1, range=0..10)
vecstar_2 = VectorStar(Plane=PlaneXY(0, 0, 0), Resolution=number_slider_8, StarType=0, Dimensionality=False)  # -> Vectors, Lines
cvec_2 = ClosestVector(Reference=addition, Targets=vecstar_2.Vectors, KeepLength=False)  # -> Closest, Index, Angle

# ---- group: Use closest plane vector length
amp_2 = Amplitude(Vector=cvec_2.Closest, Amplitude=pull.Distance)

# ---- group: move points
move_2 = Move(Geometry=loop_start_2.Data, Motion=amp_2)  # -> Geometry, Transform

# ---- group: Controls (continued)
preview_2 = CustomPreview(Geometry=planesrf, Shader=ColourSwatch(SwatchColor=RGB(130, 255, 71)))
preview_3 = CustomPreview(Geometry=move_2.Geometry, Shader=ColourSwatch(SwatchColor=RGB(255, 145, 71)))

# ---- group: Loop end
loop_end_2 = LoopEnd(
    port=loop_start_2.port,
    Exit=False,
    Data=move_2.Geometry,
    Data_2=amp_2,
    pausedState=False,
    state="Constant & Record",
    TimeOutVal=0)  # -> D0, D1

# ---- group: Make curves
flip_2 = FlipMatrix(Data=loop_end_2.D0)
pline_2 = PolyLine(Vertices=flip_2, Closed=False)

# ----
# Look at Rhino window
# to preview results
preview_4 = CustomPreview(Geometry=pline_2, Shader=ColourSwatch(SwatchColor=RGB(17, 20, 189)))
