# Grasshopper definition Pf_CurveGraphMapperAttractor.gh (Grasshopper 0.9.76)
# plug-ins: Pufferfish

# ---- group: Graph curves
# Points that edits
# graph curve one
# Slider that edits
# graoh curve 2
number_slider = Slider(13, range=0..100)
X = UnitX(Factor=1)
pt = Point([Point(7.212977944, 5.22046304, 0), Point(20.31110679, 21.82992166, 0), Point(32.72322746, 6.118051737, 0), Point(51.26950395, 26.9559937, 0)])
pt_2 = Point(Point(-0.8444983573, 2.760367191, 0))
intcrv = Interpolate(Vertices=pt, Degree=3, Periodic=False, KnotStyle=1)  # -> Curve, Length, Domain
line = LineSDL(Start=pt_2, Direction=X, Length=number_slider)
merge = Merge(Data1=intcrv.Curve, Data2=line)

# ---- group: Grid of points
# Pf_Curve Graph Mapper Attractor
number_slider_2 = Slider(1.402, range=0..10)
# Pufferfish
# By: Michael Pryor
sqgrid = Square(
    Plane=PlaneXY(83.44665397, 0.0176681498, 0),
    Size=number_slider_2,
    ExtentX=Slider(25, range=0..25),
    ExtentY=Slider(25, range=0..25))  # -> Cells, flatten(Points)

# ---- group: Optional input value domain (XAxis)
# Optional X Axis domain, plug it in to see
# change. If nothing is plugged into X then
# bounds of the input value lists domain
# is used.
number_slider_3 = Slider(100, range=0..100)
dom = ConstructDomain(DomainStart=Slider(0, range=0..10), DomainEnd=number_slider_3)

# ---- group: Domain to map to (Y Axis)
dom_2 = ConstructDomain(DomainStart=Slider(0.1, range=0..10), DomainEnd=Slider(1, range=0..10))

# ---- group: Additional options
# Flip graph
# Snap graph to curves
# Label size
number_slider_4 = Slider(1, range=0..2)
toggle = BooleanToggle(False)
toggle_2 = BooleanToggle(False)

# ---- group: Atrractor
pt_3 = Point(Point(81.18338585, 37.13399198, 0))
pull = PullPoint(Point=sqgrid.Points, Geometry=pt_3, ClosestOnly=True)  # -> ClosestPoint, Distance

# ----
# Input Values
panel = Panel(pull.Distance)

# ---- group: Graph Boundary
rec = Rectangle({Plane=PlaneXY(0, 0, 0), Size=Domain2(u=0..50.29201212, v=0..25.01011503)})

# ----
crvgraphmap = CurveGraphMapper(Curves=merge, Rectangle=rec, Values=pull.Distance, YAxis=dom_2, Flip=toggle, Snap=toggle_2, TextSize=number_slider_4)  # -> Mapped, GraphCurves, GraphPoints, ValueLines, ValuePoints, MappedLines, MappedPoints, Boundary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
# Mapped Values
panel_2 = Panel(crvgraphmap.Mapped)

# ---- group: Visualize parts of graph
pipe = Pipe(Curve=crvgraphmap.GraphCurves, Radius=0.2, Caps=0)  # -> flatten(Pipe)
preview = CustomPreview(Geometry=crvgraphmap.Boundary, Shader=ColourSwatch(SwatchColor=RGB(255, 255, 255)))
preview_2 = CustomPreview(Geometry=crvgraphmap.Labels, Shader=ColourSwatch(SwatchColor=RGB(0, 0, 0)))
preview_3 = CustomPreview(Geometry=pipe, Shader=ColourSwatch(SwatchColor=RGB(0, 0, 0)))
preview_4 = CustomPreview(Geometry=crvgraphmap.ValueLines, Shader=ColourSwatch(SwatchColor=RGB(255, 0, 0)))
preview_5 = CustomPreview(Geometry=crvgraphmap.MappedLines, Shader=ColourSwatch(SwatchColor=RGB(0, 255, 115)))

# ---- group: Use graph mapped values for circle sizes
cir = Circle(Plane=sqgrid.Points, Radius=crvgraphmap.Mapped)
preview_6 = CustomPreview(Geometry=cir, Shader=ColourSwatch(SwatchColor=RGB(0, 255, 149)))
