# Grasshopper definition Pf_DiscretePolylines.gh (Grasshopper 0.9.76)
# plug-ins: Pufferfish

# Polyline to Discrete Polyline
crv = Curve(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)
# Multiple Divided Curve to Discrete PolyLines
number_slider = Slider(6, range=0..20)
# Control Point Curve to Discrete Polyline
crv_2 = Curve(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)
# Rotate the base plane for the
# vector star orientation
number_slider_2 = Slider(268, range=0..360)
# Divided Curve to Discrete Polyline
crv_3 = Curve(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)
# Multiple Divided Curve to Discrete PolyLines - Rotate Vector Star
xz = XZPlane(Origin=Point(0, 0, 0))
# Using 2d vector star
# since vertices are flat
toggle = BooleanToggle(True)
cp = ControlPoints(Curve=crv_2)  # -> Points, Weights, Knots
# Using 2d vector star
# since vertices are flat
toggle_2 = BooleanToggle(True)
# Using 2d vector star
# since vertices are flat
toggle_3 = BooleanToggle(True)
# Using 2d vector star
# since vertices are flat
toggle_4 = BooleanToggle(True)
# Using 3d vector star
# in this case since the
# vertices are not flat
toggle_5 = BooleanToggle(False)
disc = Discontinuity(Curve=crv, Level=1)  # -> Points, Parameters
crv_4 = Curve([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])
# Pf_Discrete Polyline
# Points to Discrete PolyLine
pt = Point([Point(-37.98424288, 60.45440537, 0), Point(-55.75425281, 52.03990522, 0), Point(-57.32921268, 39.55328122, 0), Point(-37.6485483, 29.55013894, 0), Point(-30.62695698, 19.67317136, 0), Point(-55.09764018, 11.40543384, 0), Point(-44.04902552, -2.598120262, 0)])
deplane = DeconstructPlane(Plane=xz)  # -> Origin, XAxis, YAxis, ZAxis
divide = DivideCurve(Curve=crv_4, Count=number_slider, Kinks=False)  # -> Points, Tangents, Parameters
divide_2 = DivideCurve(Curve=crv_3, Count=Slider(10, range=0..20), Kinks=False)  # -> Points, Tangents, Parameters
rot3d = Rotate3D(Geometry=xz, Angle=degrees(number_slider_2), Center=xz, Axis=deplane.XAxis)  # -> Geometry, Transform
vecstar = VectorStar(Plane=PlaneXY(0, 0, 0), Resolution=Slider(2, range=0..10), StarType=0, Dimensionality=toggle)  # -> Vectors, Lines
vecstar_2 = VectorStar(Plane=PlaneXY(0, 0, 0), Resolution=Slider(2, range=0..10), StarType=0, Dimensionality=toggle_2)  # -> Vectors, Lines
vecstar_3 = VectorStar(Plane=PlaneXY(0, 0, 0), Resolution=Slider(2, range=0..10), StarType=0, Dimensionality=toggle_3)  # -> Vectors, Lines
vecstar_4 = VectorStar(Plane=PlaneXY(0, 0, 0), Resolution=Slider(2, range=0..10), StarType=0, Dimensionality=toggle_4)  # -> Vectors, Lines
vecstar_5 = VectorStar(Plane=PlaneXY(0, 0, 0), Resolution=Slider(2, range=0..10), StarType=0, Dimensionality=toggle_5)  # -> Vectors, Lines
rot3d_2 = Rotate3D(Geometry=rot3d.Geometry, Angle=degrees(number_slider_2), Center=xz, Axis=deplane.YAxis)  # -> Geometry, Transform
# Pufferfish
# By: Michael Pryor
dpline = DiscretePolyline(References=pt, Targets=vecstar.Vectors, KeepLength=False)
dpline_2 = DiscretePolyline(References=disc.Points, Targets=vecstar_2.Vectors, KeepLength=False)
dpline_3 = DiscretePolyline(References=cp.Points, Targets=vecstar_3.Vectors, KeepLength=False)
dpline_4 = DiscretePolyline(References=divide_2.Points, Targets=vecstar_4.Vectors, KeepLength=False)
dpline_5 = DiscretePolyline(References=divide.Points, Targets=vecstar_5.Vectors, KeepLength=False)
# Using 3d vector star
# in this case since the
# vertices are not flat
toggle_6 = BooleanToggle(False)
# Look at Rhino window
# to preview results
preview = CustomPreview(Geometry=dpline, Shader=ColourSwatch(SwatchColor=RGB(17, 20, 189)))
# Look at Rhino window
# to preview results
preview_2 = CustomPreview(Geometry=dpline_2, Shader=ColourSwatch(SwatchColor=RGB(17, 20, 189)))
# Look at Rhino window
# to preview results
preview_3 = CustomPreview(Geometry=dpline_3, Shader=ColourSwatch(SwatchColor=RGB(17, 20, 189)))
# Look at Rhino window
# to preview results
preview_4 = CustomPreview(Geometry=dpline_4, Shader=ColourSwatch(SwatchColor=RGB(17, 20, 189)))
# Look at Rhino window
# to preview results
preview_5 = CustomPreview(Geometry=dpline_5, Shader=ColourSwatch(SwatchColor=RGB(17, 20, 189)))
crv_5 = Curve([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])
divide_3 = DivideCurve(Curve=crv_5, Count=Slider(6, range=0..20), Kinks=False)  # -> Points, Tangents, Parameters
vecstar_6 = VectorStar(Plane=rot3d_2.Geometry, Resolution=Slider(2, range=0..10), StarType=0, Dimensionality=toggle_6)  # -> Vectors, Lines
dpline_6 = DiscretePolyline(References=divide_3.Points, Targets=vecstar_6.Vectors, KeepLength=False)
# Look at Rhino window
# to preview results
preview_6 = CustomPreview(Geometry=dpline_6, Shader=ColourSwatch(SwatchColor=RGB(17, 20, 189)))
