# Grasshopper definition Pf_MirrorCutMeshCompound - Requires Anemone Plugin.gh (Grasshopper 0.9.76)
# plug-ins: Pufferfish, Anemone

# ---- group: Mesh to mirror cut
mbox = MeshBox(Base={Plane=PlaneXY(0, 0, 0), X=Domain(-10, 10), Y=Domain(-10, 10), Z=Domain(-10, 10)}, XCount=10, YCount=10, ZCount=10)

# ----
# Pf_Mirror Cut Mesh Compound
# Double Click Loop Start to Run Loop
# Number of compound iterations
number_slider = Slider(20, range=0..100)

# ---- group: Loop Start (double click to run loop)
# Pufferfish
# By: Michael Pryor
loop_start = LoopStart(Repeat=number_slider, Data=mbox)  # -> port, Counter, Data

# ---- group: Random location of plane
volume = Volume(Geometry=mbox)  # -> Volume, Centroid
scale = Scale(Geometry=mbox, Center=volume.Centroid, Factor=0.8)  # -> Geometry, Transform
addition = Addition(A=loop_start.Counter, B=Slider(5, range=0..10))
pop3d = Populate3D(Region=scale.Geometry, Count=1, Seed=addition)

# ---- group: Random values for rotation
dom = ConstructDomain(DomainStart="0", DomainEnd="360")
addition_2 = Addition(A=loop_start.Counter, B=[Slider(6, range=0..10), Slider(7, range=0..10)])
random = Random(Range=dom, Number=1, Seed=addition_2)
bang = ExplodeTree(Data=random)  # -> Branch0, Branch1

# ----
panel = Panel(loop_start.Counter)

# ---- group: Rotate mirror cut plane
xy = XYPlane(Origin=pop3d)
yz = YZPlane(Origin=Point(0, 0, 0))
# Here we use keep as true, in case
# the mirror cuts the mesh into non
# existance in any of the loops, then
# we wont get a null but will still get
# a mesh to keep cutting with.
xz = XZPlane(Origin=Point(0, 0, 0))
rotate = Rotate(Geometry=xy, Angle=degrees(bang.Branch1), Plane=yz)  # -> Geometry, Transform
rotate_2 = Rotate(Geometry=rotate.Geometry, Angle=degrees(bang.Branch0), Plane=xz)  # -> Geometry, Transform

# ---- group: Mirror Cut Mesh Options
number_slider_2 = Slider(2, range=0..10)
number_slider_3 = Slider(1, range=0..10)
number_slider_4 = Slider(0, range=0..100)
number_slider_5 = Slider(2.16, range=0..10)
number_slider_6 = Slider(0, range=-1..1)
toggle = BooleanToggle(False)
toggle_2 = BooleanToggle(True)

# ---- group: Move mirror cut plane
Z = UnitZ(Factor=8)
move = Move(Geometry=rotate_2.Geometry, Motion=Z)  # -> Geometry, Transform

# ----
mircutmsh = MirrorCutMesh(
    Mesh=loop_start.Data,
    MirrorPlane=move.Geometry,
    Reach=number_slider_5,
    Offset=number_slider_4,
    Flip=toggle,
    Join=toggle_2,
    Keep=Toggle(True),
    ConnectionType=number_slider_2,
    Bulge=number_slider_6,
    Divisions=number_slider_3,
    WeldVertices=0.01)  # -> MirrorCut, SplitIndex, ReachPlane, OffsetPlane, Intersected
loop_end = LoopEnd(port=loop_start.port, Exit=False, Data=mircutmsh.MirrorCut, pausedState=False, state="Constant output", TimeOutVal=0)  # -> flatten(Data)

# ---- group: Mesh smoothing
msmooth = SmoothMesh(Mesh=loop_end, Strength=Slider(0.398, range=0..1), SkipNaked=True, Iterations=Slider(10, range=0..10))

# ---- group: Result Preview
preview = CustomPreview(
    Geometry=msmooth,
    Shader={ambient=RGB(0, 0, 0), diffuse=RGB(255, 105, 180), emission=RGB(76, 32, 54), shine=0.5, specular=RGB(255, 255, 255), transparency=0})
