# Grasshopper definition Pf_NetOnSurface.gh (Grasshopper 0.9.76)
# plug-ins: Pufferfish

# Flip net direction to see how the net
# works with the seam of closed surfaces.
toggle = BooleanToggle(False)
# Flip net direction to see how the net
# works with the seam of surfaces
# connected to eachother
# (make sure your surfaces connect U to U and V to V)
# for continous looking results
toggle_2 = BooleanToggle(False)
# Set to true to flip the direction of the net on the surface.
# U count can only be even integers, this is
# to make the edges end in the same way
# (important for closed surface seams).
# If you input an odd integer the component
# automatically converts it to the even
# integer that is one less than the odd integer.
toggle_3 = BooleanToggle(False)
# Net On Surface - Multiple surfaces touching
base_surfaces = Surface([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])
# Net On Surface - Deformed surface UV's
base_surface = Surface(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)
# Net On Surface - Closed surface
base_surface_2 = Surface(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)
# Pufferfish
# By: Michael Pryor
# Pf_Net On Surface
# Net On Surface - Basic
base_surface_3 = Surface(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)
netsrf = NetOnSurface(Surface=base_surface_3, UCount=Slider(30, range=0..100), VCount=Slider(4, range=0..100), Flip=toggle_3)
netsrf_2 = NetOnSurface(Surface=base_surfaces, UCount=Slider(14, range=0..100), VCount=Slider(3, range=0..100), Flip=toggle_2)
netsrf_3 = NetOnSurface(Surface=base_surface, UCount=Slider(30, range=0..100), VCount=Slider(4, range=0..100), Flip=Toggle(False))
netsrf_4 = NetOnSurface(Surface=base_surface_2, UCount=Slider(30, range=0..100), VCount=Slider(4, range=0..100), Flip=toggle)

# ----
# The great thing about Net on Surface
# is that no matter how low the UV inputs
# are the curves still flow along the surface.
preview = CustomPreview(Geometry=netsrf, Shader=ColourSwatch(SwatchColor=RGB(0, 255, 238)))

# ----
# In this example I use the same surface
# as the previous example but I pulled
# the surface control points around in rhino.
# This deforms the surface UV's and
# results in nets that are more warped and
# deformed. Surface UV's have a large
# effect on how the net goes across the
# surface. So turn on your surface control
# points in rhino and pull them around
# to see how the net reacts along it.
preview_2 = CustomPreview(Geometry=netsrf_3, Shader=ColourSwatch(SwatchColor=RGB(247, 255, 0)))

# ----
# Using a closed surface made from a revolve in rhino.
preview_3 = CustomPreview(Geometry=netsrf_4, Shader=ColourSwatch(SwatchColor=RGB(74, 227, 0)))
# Using multiple surfaces that touch U to U and V to V so the net flows correctly.
preview_4 = CustomPreview(Geometry=netsrf_2, Shader=ColourSwatch(SwatchColor=RGB(255, 255, 195)))
