# Grasshopper definition Pf_PinchNSpread - Requires Weaverbird Plugin.gh (Grasshopper 0.9.76)
# plug-ins: MeshEdit Components, Pufferfish, Weaverbird

# ---- group: Grid of Polylines
# Change number of division points to change tightness of result curve.
number_slider = Slider(36, range=0..100)
# You can use multiple radius and
# strengths to set different values to each
# pinch and spread location point. - add
# more sliders. Negative strength to spread.
number_slider_2 = Slider(100, range=0..100)
sqgrid = Square(Plane=PlaneXY(-1682.857562, -10093.66384, 0), Size=number_slider_2, ExtentX=number_slider, ExtentY=number_slider)  # -> Cells, Points
flip = FlipMatrix(Data=sqgrid.Points)
merge = Merge(Data1=sqgrid.Points, Data2=simplify(flip))
pline = PolyLine(Vertices=merge, Closed=False)

# ---- group: 3d grid
# Change number of division points to change tightness of result curve.
crv = Curve([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])

# ---- group: Mesh Box
# Pinch'n'Spread - Mesh Bubbles
mesh = Mesh(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)

# ---- group: Radius and Strength
strength_1 = Slider(0.654, range=-1..1)
strength_2 = Slider(-1, range=-1..1)
# Location points set off plane from the points to spread effects the pinching and spreading in 3d.
# Pinch'n'Spread - 2D Grid
strength_3 = Slider(0.505, range=-1..1)
radius_2 = Slider(500, range=0..500)
radius_3 = Slider(400, range=0..400)
radius_1 = Slider(643.36, range=0..1000)
merge_2 = Merge(Data1=radius_1, Data2=radius_2, Data3=radius_3)
merge_3 = Merge(Data1=strength_1, Data2=strength_2, Data3=strength_3)

# ---- group: Points to Pinch or Spread
crv_2 = Curve([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])
divide = DivideCurve(Curve=crv_2, Count=Slider(35, range=0..100), Kinks=False)  # -> Points, Tangents, Parameters

crv_3 = Curve([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])
divide_2 = DivideCurve(Curve=crv_3, Count=Slider(100, range=0..100), Kinks=False)  # -> Points, Tangents, Parameters

# ---- group: Radius and Strength
strength_1_2 = Slider(0.613, range=-1..1)
strength_2_2 = Slider(-0.703, range=-1..1)
strength_3_2 = Slider(0.505, range=-1..1)
radius_2_2 = Slider(500, range=0..500)
radius_3_2 = Slider(400, range=0..400)
radius_1_2 = Slider(500, range=0..500)
merge_4 = Merge(Data1=radius_1_2, Data2=radius_2_2, Data3=radius_3_2)
# Multiple values for radius and strength
merge_5 = Merge(Data1=strength_1_2, Data2=strength_2_2, Data3=strength_3_2)

# ---- group: Mesh Plane
# Pinch'n'Spread - Mesh Suction
mesh_2 = Mesh(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)

# ---- group: Points to Pinch or Spread
crv_4 = Curve([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])
divide_3 = DivideCurve(Curve=crv_4, Count=Slider(35, range=0..100), Kinks=False)  # -> Points, Tangents, Parameters

crv_5 = Curve([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])
divide_4 = DivideCurve(Curve=crv_5, Count=Slider(47, range=0..100), Kinks=False)  # -> Points, Tangents, Parameters

# ---- group: Radius and Strength
strength = Slider(0.6, range=-1..1)
radius = Slider(500, range=0..500)

# Positive strength to pinch. Change to negative to spread.
# Change number of division points to change tightness of result curve.
strength_4 = Slider(0.6, range=-1..1)
radius_4 = Slider(500, range=0..500)

# ---- group: Points that Pinch or Spread
bbox = BoundingBox(Content=crv, Plane=PlaneXY(0, 0, 0), UnionBox=True)  # -> Box, Box_2
pop3d = Populate3D(Region=bbox.Box, Count=Slider(12, range=0..100), Seed=1)

# Pinch'n'Spread - Curves Locations off Plane
pt = Point([Point(978.3410604, -4127.018705, 479.593576), Point(-104.0617383, -4300.58307, 94.93847179), Point(-812.0881436, -3762.674594, 260.0377673)])

# Pinch'n'Spread - Curves Multiple Values
pt_2 = Point([Point(970.3352712, -2117.277463, 0), Point(-112.0675275, -2290.841827, 0), Point(-820.0939328, -1752.933351, 0)])

# Pinch'n'Spread - Curves Using Anchors
pt_3 = Point([Point(-2313.558681, -98.2700515, 0), Point(-3395.96148, -271.8344158, 0), Point(-4103.987885, 266.0740596, 0)])

# Pf_Pinch N Spread
# Pinch'n'Spread - Curves
pt_4 = Point([Point(-112.0675275, -271.8344158, 0), Point(-820.0939328, 266.0740596, 0), Point(970.3352712, -98.2700515, 0)])

# ---- group: Volume to fill with Location Points
volume = Volume(Geometry=mesh)  # -> Volume, Centroid
bbox_2 = BoundingBox(Content=mesh, Plane=PlaneXY(0, 0, 0))  # -> Box, Box_2
scale = Scale(Geometry=bbox_2.Box, Center=volume.Centroid, Factor=Slider(0.9, range=0..10))  # -> Geometry, Transform

# ---- group: Points to Pinch or Spread
demesh = DeconstructMesh(Mesh=mesh_2)  # -> Vertices, Faces, Colours, Normals

# ---- group: Radius and Strength
number_slider_3 = Slider(827.802, range=0..2000)
# Change the strength
# to change suction
number_slider_4 = Slider(0.672, range=0..1)

# ---- group: Anchor Points
nakededge = MeshNakedEdge(Mesh=mesh_2)  # -> V, A, B
# Anchor Points are specific points from the point(P)
# list that you do not want to be effected by the pinch&spread
# Unplug them if you do not want anchors.
item = ListItem(List=nakededge.V, Index=nakededge.A, Wrap=True)

# ---- group: Points to Pinch or Spread
demesh_2 = DeconstructMesh(Mesh=mesh)  # -> Vertices, Faces, Colours, Normals

# ---- group: Radius and Strength
strength_5 = Slider(0.893, range=-1..1)
# Pinch'n'Spread - 3D Grid
# You can use multiple radius and
# strengths to set different values to each
# pinch and spread location point. - add
# more sliders. Negative strength to spread.
radius_5 = Slider(1218.146, range=0..2000)

number_slider_5 = Slider(839.2, range=0..2000)
# Change the strength
# to inflate bubbles
number_slider_6 = Slider(-1, range=-1..0)

# ---- group: Points that Pinch or Spread
pop3d_2 = Populate3D(Region=scale.Geometry, Count=Slider(28, range=0..100), Seed=Slider(13, range=0..100))

# ---- group: Radius and Strength
# Positive strength to pinch. Negative to spread.
strength_6 = Slider(-1, range=-1..1)
# Pinch'n'Spread - Mesh
# You can use multiple radius and
# strengths to set different values to each
# pinch and spread location point. - add
# more sliders
radius_6 = Slider(1376.205, range=0..2000)

# Positive strength to pinch. Negative to spread.
strength_7 = Slider(-1, range=-1..1)
# Pinch'n'Spread - Surface
# You can use multiple radius and
# strengths to set different values to each
# pinch and spread location point. - add
# more sliders
radius_7 = Slider(1614.826, range=0..2000)

# ---- group: Points that Pinch or Spread
pt_5 = Point([Point(-1383.178298, -35391.39542, -325.6154935), Point(-304.9914221, -34598.40998, -325.6154935), Point(-1309.447865, -33609.50657, -325.6154935), Point(1096.757577, -35391.39542, -325.6154935), Point(18.57070124, -34598.40998, -325.6154935), Point(1023.027144, -33609.50657, -325.6154935)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])

# ---- group: Radius and Strength
strength_8 = Slider(0.642, range=-1..1)
radius_8 = Slider(1024.312, range=0..2000)

# ----
points = Data(divide_2.Points)
strength_9 = Data(merge_3)
location = Data(pt)
radius_9 = Data(merge_2)
points_2 = Data(divide_4.Points)
strength_10 = Data(merge_5)
location_2 = Data(pt_2)
radius_10 = Data(merge_4)
points_3 = Data(divide.Points)
location_3 = Data(pt_3)
radius_11 = Data(radius)
strength_11 = Data(strength)

# ---- group: Preview Radius
msphere = MeshSphere(Base=pt, Radius=merge_2, UCount=10, VCount=20)

# ----
points_4 = Data(divide_3.Points)
location_4 = Data(pt_4)
radius_12 = Data(radius_4)
strength_12 = Data(strength_4)

# ---- group: Preview Radius
msphere_2 = MeshSphere(Base=pt_2, Radius=merge_4, UCount=10, VCount=20)

# ---- group: Points that Pinch or Spread
pt_6 = Point([Point(1169.298245, -21451.68408, -380.4406859), Point(389.1090786, -24329.94452, -548.7194301), Point(-841.7845761, -22102.57749, 335.8004377)])

pt_7 = Point([Point(400.9828119, -27477.77107, 468.7576232), Point(969.8028564, -29862.36719, -479.9846358), Point(-774.9505615, -29668.50586, 413.2118934)])

# ----
mesh_3 = Mesh(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)

# ---- group: Preview Radius
msphere_3 = MeshSphere(Base=pt_3, Radius=radius, UCount=10, VCount=20)

# ---- group: Points to Spread
divide_5 = DivideCurve(Curve=crv, Count=Slider(7, range=0..100), Kinks=False)  # -> Points, Tangents, Parameters

# ----
srf = Surface(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)

# ---- group: Preview Radius
# Pufferfish
# By: Michael Pryor
msphere_4 = MeshSphere(Base=pt_4, Radius=radius_4, UCount=10, VCount=20)

# ----
p_n_s = PinchNSpread(Points=demesh.Vertices, Locations=pt_5, Radiuses=number_slider_3, Strengths=number_slider_4, Anchors=item)

# ---- group: Points that Pinch or Spread
pt_8 = Point([Point(-1051.112187, -7329.748059, 0), Point(1027.777188, -7420.134553, 0), Point(1072.970435, -8775.931972, 0), Point(-814.1669922, -9363.444186, 0), Point(-215.0371121, -8064.29614, 0)])

# ---- group: Preview Radius
msphere_5 = MeshSphere(Base=pop3d, Radius=radius_5, UCount=10, VCount=20)

# ----
p_n_s_2 = PinchNSpread(Points=points_2, Locations=location_2, Radiuses=radius_10, Strengths=strength_10)
p_n_s_3 = PinchNSpread(Points=points_4, Locations=location_4, Radiuses=radius_12, Strengths=strength_12)
p_n_s_4 = PinchNSpread(Points=points, Locations=location, Radiuses=radius_9, Strengths=strength_9)

# ---- group: Reconstruct Mesh
conmesh = ConstructMesh(Vertices=p_n_s, Faces=demesh.Faces)

# ---- group: Points to spread
demesh_3 = DeconstructMesh(Mesh=mesh_3)  # -> Vertices, Faces, Colours, Normals

# ---- group: Preview Radius
msphere_6 = MeshSphere(Base=pt_7, Radius=radius_6, UCount=10, VCount=20)

msphere_7 = MeshSphere(Base=pt_6, Radius=radius_7, UCount=10, VCount=20)

# ---- group: Anchor Points (start & end points in this case)
item_2 = ListItem(List=reverse(points_3), Index=0, Wrap=True)
item_3 = ListItem(List=points_3, Index=0, Wrap=True)
merge_6 = Merge(Data1=item_3, Data2=item_2)

# ---- group: Points to spread
srfpt = SurfacePoints(Surface=srf)  # -> Points, Weights, Greville, UCount, VCount

# ---- group: Points to Spread
divide_6 = DivideCurve(Curve=pline, Count=Slider(13, range=0..100), Kinks=False)  # -> Points, Tangents, Parameters

# ----
p_n_s_5 = PinchNSpread(Points=demesh_2.Vertices, Locations=pop3d_2, Radiuses=number_slider_5, Strengths=number_slider_6)

# ---- group: Smooth Mesh
wblaplace = WeaverbirdsLaplacianSmoothing(MeshCurves=conmesh, Level=8, SmoothNakedEdges=0, Thin=1)
wbcatmullclark = WeaverbirdsCatmullClarkSubdivision(MeshCurves=wblaplace, Level=1, SmoothNakedEdges=1)
preview = CustomPreview(Geometry=wbcatmullclark, Shader=ColourSwatch(SwatchColor=RGB(202, 105, 250)))

# ---- group: Preview Radius
msphere_8 = MeshSphere(Base=pt_8, Radius=radius_8, UCount=10, VCount=20)

# ---- group: Anchor Points (naked edges in this case)
nakededge_2 = MeshNakedEdge(Mesh=mesh_3)  # -> V, A, B
item_4 = ListItem(List=nakededge_2.V, Index=nakededge_2.A, Wrap=True)

# ---- group: Make Curves
nurbs = NurbsCurve(Vertices=p_n_s_4, Degree=3, Periodic=False)  # -> Curve, Length, Domain
preview_2 = CustomPreview(Geometry=nurbs.Curve, Shader=ColourSwatch(SwatchColor=RGB(47, 245, 119)))

nurbs_2 = NurbsCurve(Vertices=p_n_s_2, Degree=3, Periodic=False)  # -> Curve, Length, Domain
preview_3 = CustomPreview(Geometry=nurbs_2.Curve, Shader=ColourSwatch(SwatchColor=RGB(205, 245, 47)))

nurbs_3 = NurbsCurve(Vertices=p_n_s_3, Degree=3, Periodic=False)  # -> Curve, Length, Domain
preview_4 = CustomPreview(Geometry=nurbs_3.Curve, Shader=ColourSwatch(SwatchColor=RGB(47, 245, 192)))

# ---- group: Reconstruct Mesh
conmesh_2 = ConstructMesh(Vertices=p_n_s_5, Faces=demesh_2.Faces)

# ---- group: Anchor Points (start & end points in this case)
item_5 = ListItem(List=reverse(divide_5.Points), Index=0, Wrap=True)
item_6 = ListItem(List=divide_5.Points, Index=0, Wrap=True)
# Anchor Points are specific points from the point(P)
# list that you do not want to be effected by the pinch&spread
# Unplug them if you do not want anchors.
merge_7 = Merge(Data1=item_6, Data2=item_5)

# ---- group: Smooth Mesh
wblaplace_2 = WeaverbirdsLaplacianSmoothing(MeshCurves=conmesh_2, Level=8, SmoothNakedEdges=0, Thin=1)
wbcatmullclark_2 = WeaverbirdsCatmullClarkSubdivision(MeshCurves=wblaplace_2, Level=1, SmoothNakedEdges=1)
preview_5 = CustomPreview(Geometry=wbcatmullclark_2, Shader=ColourSwatch(SwatchColor=RGB(0, 149, 255)))

# ----
p_n_s_6 = PinchNSpread(Points=points_3, Locations=location_3, Radiuses=radius_11, Strengths=strength_11, Anchors=merge_6)
p_n_s_7 = PinchNSpread(Points=demesh_3.Vertices, Locations=pt_7, Radiuses=radius_6, Strengths=strength_6, Anchors=item_4)
p_n_s_8 = PinchNSpread(Points=srfpt.Points, Locations=pt_6, Radiuses=radius_7, Strengths=strength_7)

# ---- group: Anchor Points (start & end points in this case)
item_7 = ListItem(List=reverse(divide_6.Points), Index=0, Wrap=True)
item_8 = ListItem(List=divide_6.Points, Index=0, Wrap=True)
# Anchor Points are specific points from the point(P)
# list that you do not want to be effected by the pinch&spread
# Unplug them if you do not want anchors.
merge_8 = Merge(Data1=item_8, Data2=item_7)

# ---- group: Make Mesh
# Anchor Points are specific points from the point(P)
# list that you do not want to be effected by the pinch&spread
# Unplug them if you do not want anchors.
number_slider_7 = Slider(10, range=0..10)
strength_13 = Slider(1, range=-1..1)
conmesh_3 = ConstructMesh(Vertices=p_n_s_7, Faces=demesh_3.Faces)
msmooth = SmoothMesh(Mesh=conmesh_3, Strength=strength_13, SkipNaked=True, Iterations=number_slider_7)
preview_6 = CustomPreview(Geometry=msmooth, Shader=ColourSwatch(SwatchColor=RGB(245, 199, 47)))

# ---- group: Make Surface
srfgrid = SurfaceFromPoints(Points=p_n_s_8, UCount=srfpt.UCount, Interpolate=False)
preview_7 = CustomPreview(Geometry=srfgrid, Shader=ColourSwatch(SwatchColor=RGB(47, 245, 192)))

# ---- group: Make Curves
# Anchor Points are specific points from the point(P)
# list that you do not want to be effected by the pinch&spread
swatch = ColourSwatch(SwatchColor=RGB(47, 245, 192))
nurbs_4 = NurbsCurve(Vertices=p_n_s_6, Degree=3, Periodic=False)  # -> Curve, Length, Domain
preview_8 = CustomPreview(Geometry=nurbs_4.Curve, Shader=swatch)

# ----
p_n_s_9 = PinchNSpread(Points=divide_5.Points, Locations=pop3d, Radiuses=radius_5, Strengths=strength_5, Anchors=merge_7)
p_n_s_10 = PinchNSpread(Points=divide_6.Points, Locations=pt_8, Radiuses=radius_8, Strengths=strength_8, Anchors=merge_8)

# ---- group: Make Curves
nurbs_5 = NurbsCurve(Vertices=p_n_s_9, Degree=3, Periodic=False)  # -> Curve, Length, Domain
preview_9 = CustomPreview(Geometry=nurbs_5.Curve, Shader=ColourSwatch(SwatchColor=RGB(0, 229, 255)))

nurbs_6 = NurbsCurve(Vertices=p_n_s_10, Degree=3, Periodic=False)  # -> Curve, Length, Domain
preview_10 = CustomPreview(Geometry=nurbs_6.Curve, Shader=ColourSwatch(SwatchColor=RGB(47, 245, 192)))
