# Grasshopper definition Pf_RecursiveMeshMorphing - Requires Weaverbird Plugin.gh (Grasshopper 0.9.76)
# plug-ins: Pufferfish, Weaverbird

# By using Grasshoppers Mesh Join component
# you can join multiple meshes even if they do
# not touch, so that Grasshopper uses them as
# one mesh. Bake this and look in Rhino to see
# what this mesh looks like, especially with a
# back face color on in Rhino's display so you
# can see which way the mesh face normals are.
mesh = Mesh(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)  # disabled
# Using multi mesh geometries you
# can use a different mesh geometry
# for each recursive step. Changing the
# order of the input mesh geometries
# will change the morphed mesh results.
mesh_2 = Mesh(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)  # disabled

# ---- group: Meshes to morph
mesh_3 = Mesh(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)  # disabled
mesh_4 = Mesh(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)  # disabled
merge = Merge(Data1=mesh_3, Data2=mesh_4, Data3=mesh_2)  # disabled

# ---- group: Mesh to morph and its bounding box
mesh_5 = Mesh(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)  # disabled
bbox = BoundingBox(Content=mesh_5, Plane=PlaneXY(0, 0, 0))  # -> Box, Box_2; disabled

# ---- group: Meshes to morph
# In this case each mesh geometry
# will be used to morph to a different
# base mesh by way of grafting data.
mesh_6 = Mesh(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)  # disabled
mesh_7 = Mesh(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)  # disabled
merge_2 = Merge(Data1=mesh_7, Data2=mesh_6)  # disabled

# ---- group: Mesh to morph and its bounding box
# Meshes that you want to morph should
# be symmetrical on four sides if you want
# the morphed mesh geometries to
# connect to eachother once morphed.
# It is also important to pay attention to
# the normal directions of the faces of your
# base mesh and mesh geometries as normals
# will determine how things connect and smooth
# together. Bake this and look in Rhino to see
# what this mesh looks like, especially with a
# back face color on in Rhino's display so you
# can see which way the mesh face normals are.
mesh_8 = Mesh(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)  # disabled
bbox_2 = BoundingBox(Content=mesh_8, Plane=PlaneXY(0, 0, 0))  # -> Box, Box_2; disabled

mesh_9 = Mesh(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)  # disabled
bbox_3 = BoundingBox(Content=mesh_9, Plane=PlaneXY(0, 0, 0))  # -> Box, Box_2; disabled

# ---- group: Base mesh
mesh_10 = Mesh(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)  # disabled

# Multiple Thickness Recursive Mesh Morphing
mesh_11 = Mesh(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)  # disabled

# Pufferfish
# By: Michael Pryor
# Pf_Recursive Mesh Morphing
# Basic Recursive Mesh Morphing
mesh_12 = Mesh(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)  # disabled

# Automatic Multiple Thickness Recursive Mesh Morphing
mesh_13 = Mesh(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)  # disabled

# Multiple Mesh Geometry Recursive Mesh Morphing
mesh_14 = Mesh(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)  # disabled

# ---- group: Recursion step count
# Be careful going over 3!
number_slider = Slider(3, range=0..6)  # disabled

# Multiple Base Mesh Recursive Mesh Morphing
# I've split a base mesh up into two
# different sections in Rhino and
# referenced them here as two
# different base meshes. This
# way we can morph a different
# mesh to each base mesh.
# Be careful going over 3!
number_slider_2 = Slider(1, range=0..6)  # disabled

# ---- group: Different morphing offset thickness for each recursive step
# One thickness value for each recursion step.
# Typically the thickness sizes should
# be larger at first and go smaller with
# each step to prevent intersections.
number_slider_3 = Slider(0.5, range=0..10)  # disabled
number_slider_4 = Slider(3.113, range=0..10)  # disabled
number_slider_5 = Slider(0.713, range=0..10)  # disabled
merge_3 = Merge(Data1=number_slider_4, Data2=number_slider_5, Data3=number_slider_3)  # disabled

# ---- group: Automatic multiple thicknesses
panel = Panel("1")  # disabled
subtraction = Subtraction(A=number_slider, B=panel)  # disabled
number_slider_6 = Slider(10, range=0..10)  # disabled
# Extremes of the thickness list
number_slider_7 = Slider(0.5, range=0..10)  # disabled
range = Range(Domain=Domain(0, 1), Steps=subtraction)  # disabled
graph = GraphMapper(range, x0=0, x1=1, y0=0, y1=1, container_name="Bezier", cpx=[0, 0.25, 0.1203543916, 1], cpy=[0, 0.25, 0.9334938526, 1])  # disabled
dom = ConstructDomain(DomainStart=number_slider_6, DomainEnd=number_slider_7)  # disabled
remap = RemapNumbers(Value=graph, Source=Domain(0, 1), Target=dom)  # -> Mapped, Clipped; disabled

# ---- group: Recursion step count
# Be careful going over 3!
number_slider_8 = Slider(2, range=0..6)  # disabled

# ---- group: Automatic multiple thicknesses
panel_2 = Panel("1")  # disabled
subtraction_2 = Subtraction(A=number_slider_8, B=panel_2)  # disabled
number_slider_9 = Slider(10, range=0..10)  # disabled
# Extremes of the thickness list
number_slider_10 = Slider(1, range=0..10)  # disabled
range_2 = Range(Domain=Domain(0, 1), Steps=subtraction_2)  # disabled
graph_2 = GraphMapper(range_2, x0=0, x1=1, y0=0, y1=1, container_name="Bezier", cpx=[0, 0.25, 0.75, 1], cpy=[0, 0.25, 0.75, 1])  # disabled
# Using a graph and remapping
# to create a list of thicknesses.
dom_2 = ConstructDomain(DomainStart=number_slider_9, DomainEnd=number_slider_10)  # disabled
remap_2 = RemapNumbers(Value=graph_2, Source=Domain(0, 1), Target=dom_2)  # -> Mapped, Clipped; disabled

# ---- group: Different morphing offset thickness for each recursive step
number_slider_11 = Slider(10, range=0..10)  # disabled
number_slider_12 = Slider(1, range=0..10)  # disabled
# One thickness value for each recursion step.
# Typically the thickness sizes should
# be larger at first and go smaller with
# each step to prevent intersections.
number_slider_13 = Slider(0.5, range=0..10)  # disabled
merge_4 = Merge(Data1=number_slider_11, Data2=number_slider_12, Data3=number_slider_13)  # disabled

# ---- group: Relax base mesh
number_slider_14 = Slider(8, range=0..10)  # disabled
wblaplace = WeaverbirdsLaplacianSmoothing(MeshCurves=mesh_12, Level=number_slider_14, SmoothNakedEdges=0, Thin=1)  # disabled

number_slider_15 = Slider(8, range=0..10)  # disabled
wblaplace_2 = WeaverbirdsLaplacianSmoothing(MeshCurves=mesh_10, Level=number_slider_15, SmoothNakedEdges=0, Thin=1)  # disabled

number_slider_16 = Slider(8, range=0..10)  # disabled
wblaplace_3 = WeaverbirdsLaplacianSmoothing(MeshCurves=mesh_11, Level=number_slider_16, SmoothNakedEdges=0, Thin=1)  # disabled

# ---- group: Recursion step count
# Be careful going over 3!
number_slider_17 = Slider(2, range=0..6)  # disabled

# Be careful going over 3!
number_slider_18 = Slider(2, range=0..6)  # disabled

# Be careful going over 3!
number_slider_19 = Slider(2, range=0..6)  # disabled

# ---- group: Relax base mesh
number_slider_20 = Slider(8, range=0..10)  # disabled
wblaplace_4 = WeaverbirdsLaplacianSmoothing(MeshCurves=mesh_13, Level=number_slider_20, SmoothNakedEdges=0, Thin=1)  # disabled

number_slider_21 = Slider(8, range=0..10)  # disabled
wblaplace_5 = WeaverbirdsLaplacianSmoothing(MeshCurves=mesh_14, Level=number_slider_21, SmoothNakedEdges=0, Thin=1)  # disabled

# ---- group: Morphing offset thickness from mesh faces
number_slider_22 = Slider(2, range=0..10)  # disabled

number_slider_23 = Slider(2, range=0..10)  # disabled

# ---- group: Base mesh 2
mesh_15 = Mesh(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)  # disabled

# ---- group: Base mesh 1
mesh_16 = Mesh(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)  # disabled

# ---- group: Split thickness list at recursive step
# This chops your list of meshes to the
# recursion step count if you have more
# meshes than recursive steps
# which would cause an error.
split = SplitList(List=merge, Index=number_slider)  # -> ListA, ListB; disabled

# ----
swatch = ColourSwatch(SwatchColor=RGB(0, 170, 255))  # disabled
swatch_2 = ColourSwatch(SwatchColor=RGB(255, 68, 0))  # disabled

# ---- group: Bounding boxes
bbox_4 = BoundingBox(Content=merge_2, Plane=PlaneXY(0, 0, 0))  # -> Box, Box_2; disabled

bbox_5 = BoundingBox(Content=split.ListA, Plane=PlaneXY(0, 0, 0))  # -> Box, Box_2; disabled

# ---- group: Split thickness list at recursive step
# This chops your list of thicknesses to the
# recursion step count if you have more
# thicknesses than recursive steps
# which would cause an error.
split_2 = SplitList(List=merge_3, Index=number_slider_2)  # -> ListA, ListB; disabled

# ----
# Look at Rhino window
# to preview input
preview = CustomPreview(Geometry=mesh_16, Shader=swatch)  # disabled
# Look at Rhino window
# to preview input
preview_2 = CustomPreview(Geometry=mesh_15, Shader=swatch_2)  # disabled

# ---- group: Split thickness list at recursive step
# This chops your list of thicknesses to the
# recursion step count if you have more
# thicknesses than recursive steps
# which would cause an error.
split_3 = SplitList(List=merge_4, Index=number_slider_17)  # -> ListA, ListB; disabled

# ---- group: Pf_Recursive Mesh Morph
remorphmsh = RecursiveMorphMesh(
    BaseMesh=graft([mesh_16, mesh_15]),
    Steps=number_slider_2,
    Meshes=graft(merge_2),
    References=graft(bbox_4.Box),
    Thicknesses=split_2.ListA,
    WeldVertices=0.01)  # disabled

remorphmsh_2 = RecursiveMorphMesh(
    BaseMesh=wblaplace,
    Steps=number_slider_18,
    Meshes=mesh_8,
    References=bbox_2.Box,
    Thicknesses=number_slider_23,
    WeldVertices=0.01)  # disabled

remorphmsh_3 = RecursiveMorphMesh(
    BaseMesh=wblaplace_3,
    Steps=number_slider_17,
    Meshes=mesh_5,
    References=bbox.Box,
    Thicknesses=split_3.ListA,
    WeldVertices=0.01)  # disabled

remorphmsh_4 = RecursiveMorphMesh(
    BaseMesh=wblaplace_4,
    Steps=number_slider_8,
    Meshes=mesh_9,
    References=bbox_3.Box,
    Thicknesses=remap_2.Mapped,
    WeldVertices=0.01)  # disabled

remorphmsh_5 = RecursiveMorphMesh(
    BaseMesh=wblaplace_5,
    Steps=number_slider,
    Meshes=split.ListA,
    References=bbox_5.Box,
    Thicknesses=remap.Mapped,
    WeldVertices=0.01)  # disabled

# ----
panel_3 = Panel(remap.Mapped)  # disabled
# Graft the base meshes, mesh geometries
# to morph, and bounding boxes so that
# the mesh geometries morph to the correct
# intended base mesh.
panel_4 = Panel(merge_3)  # disabled
# Thicknesses chopped to
# recursive step count
panel_5 = Panel(split_2.ListA)  # disabled
panel_6 = Panel(remap_2.Mapped)  # disabled
panel_7 = Panel(merge_4)  # disabled
# Thicknesses chopped to
# recursive step count
panel_8 = Panel(split_3.ListA)  # disabled

# ---- group: Result mesh thickening and smoothing
number_slider_24 = Slider(0.22, range=0..1)  # disabled
number_slider_25 = Slider(1, range=0..3)  # disabled
wbthicken = WeaverbirdsMeshThicken(MeshCurves=remorphmsh_2, Distance=number_slider_24, OffsetType=0)  # disabled
wbcatmullclark = WeaverbirdsCatmullClarkSubdivision(MeshCurves=wbthicken, Level=number_slider_25, SmoothNakedEdges=1)  # disabled

number_slider_26 = Slider(0.5, range=0..1)  # disabled
number_slider_27 = Slider(1, range=0..3)  # disabled
wbthicken_2 = WeaverbirdsMeshThicken(MeshCurves=remorphmsh_3, Distance=number_slider_26, OffsetType=0)  # disabled
wbcatmullclark_2 = WeaverbirdsCatmullClarkSubdivision(MeshCurves=wbthicken_2, Level=number_slider_27, SmoothNakedEdges=1)  # disabled

number_slider_28 = Slider(0.5, range=0..1)  # disabled
number_slider_29 = Slider(1, range=0..3)  # disabled
wbthicken_3 = WeaverbirdsMeshThicken(MeshCurves=remorphmsh_5, Distance=number_slider_28, OffsetType=0)  # disabled
wbcatmullclark_3 = WeaverbirdsCatmullClarkSubdivision(MeshCurves=wbthicken_3, Level=number_slider_29, SmoothNakedEdges=1)  # disabled

number_slider_30 = Slider(0.5, range=0..1)  # disabled
number_slider_31 = Slider(1, range=0..3)  # disabled
wbthicken_4 = WeaverbirdsMeshThicken(MeshCurves=remorphmsh, Distance=number_slider_30, OffsetType=0)  # disabled
wbcatmullclark_4 = WeaverbirdsCatmullClarkSubdivision(MeshCurves=wbthicken_4, Level=number_slider_31, SmoothNakedEdges=1)  # disabled

number_slider_32 = Slider(0.5, range=0..1)  # disabled
number_slider_33 = Slider(1, range=0..3)  # disabled
wbthicken_5 = WeaverbirdsMeshThicken(MeshCurves=remorphmsh_4, Distance=number_slider_32, OffsetType=0)  # disabled
wbcatmullclark_5 = WeaverbirdsCatmullClarkSubdivision(MeshCurves=wbthicken_5, Level=number_slider_33, SmoothNakedEdges=1)  # disabled

# ----
swatch_3 = ColourSwatch(SwatchColor=RGB(170, 0, 255))  # disabled
swatch_4 = ColourSwatch(SwatchColor=RGB(170, 0, 255))  # disabled
swatch_5 = ColourSwatch(SwatchColor=RGB(170, 0, 255))  # disabled
swatch_6 = ColourSwatch(SwatchColor=RGB(170, 0, 255))  # disabled
swatch_7 = ColourSwatch(SwatchColor=RGB(170, 0, 255))  # disabled
swatch_8 = ColourSwatch(SwatchColor=RGB(170, 0, 255))  # disabled
# Look at Rhino window
# to preview results
preview_3 = CustomPreview(Geometry=wbcatmullclark, Shader=swatch_3)  # disabled
# Look at Rhino window
# to preview results
preview_4 = CustomPreview(Geometry=wbcatmullclark_2, Shader=swatch_6)  # disabled
# Look at Rhino window
# to preview results
preview_5 = CustomPreview(Geometry=wbcatmullclark_5, Shader=swatch_4)  # disabled
# Look at Rhino window
# to preview results
preview_6 = CustomPreview(Geometry=wbcatmullclark_3, Shader=swatch_7)  # disabled
# Look at Rhino window
# to preview results
preview_7 = CustomPreview(Geometry=wbcatmullclark_4, Shader=swatch_8)  # disabled

# ---- group: Joined mesh to morph and its bounding box
mesh_17 = Mesh(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)  # disabled

# ----
# Disjoint Single Geometry Recursive Mesh Morphing
panel_9 = Panel([mesh_17, mesh])  # disabled
mjoin = MeshJoin(Meshes=[mesh_17, mesh])  # disabled
# Joined even though
# they dont touch
panel_10 = Panel(mjoin)  # disabled

# ---- group: Joined mesh to morph and its bounding box (continued)
bbox_6 = BoundingBox(Content=mjoin, Plane=PlaneXY(0, 0, 0))  # -> Box, Box_2; disabled

# ---- group: Pf_Recursive Mesh Morph
remorphmsh_6 = RecursiveMorphMesh(
    BaseMesh=wblaplace_2,
    Steps=number_slider_19,
    Meshes=mjoin,
    References=bbox_6.Box,
    Thicknesses=number_slider_22,
    WeldVertices=0.01)  # disabled

# ---- group: Result mesh thickening and smoothing
number_slider_34 = Slider(0.22, range=0..1)  # disabled
number_slider_35 = Slider(1, range=0..3)  # disabled
wbthicken_6 = WeaverbirdsMeshThicken(MeshCurves=remorphmsh_6, Distance=number_slider_34, OffsetType=0)  # disabled
wbcatmullclark_6 = WeaverbirdsCatmullClarkSubdivision(MeshCurves=wbthicken_6, Level=number_slider_35, SmoothNakedEdges=1)  # disabled

# ----
# Look at Rhino window
# to preview results
preview_8 = CustomPreview(Geometry=wbcatmullclark_6, Shader=swatch_5)  # disabled
