# Grasshopper definition Pf_RecursiveTransformSpikeBall.gh (Grasshopper 0.9.76)
# plug-ins: Pufferfish

# ---- group: Subdivided mesh sphere
# Pf_Recursive Transform Spike Ball
number_slider = Slider(2, range=0..10)
# Pufferfish
# By: Michael Pryor
msphereex = MeshSphereEx(Base=PlaneXY(0, 0, 0), Radius=10, Count=number_slider)

# ---- group: Mesh face outlines and normals
facen = FaceNormals(Mesh=msphereex)  # -> Centers, Normals
faceb = FaceBoundaries(Mesh=msphereex)

# ---- group: Initial transforms
amp = Amplitude(Vector=facen.Normals, Amplitude=Slider(3.351, range=0..10))
rot3d = Rotate3D(Angle=degrees(Slider(62.106, range=0..1000)), Center=facen.Centers, Axis=facen.Normals)  # -> Geometry, Transform
move = Move(Motion=amp)  # -> Geometry, Transform
scale = Scale(Center=facen.Centers, Factor=Slider(0.684, range=0..1))  # -> Geometry, Transform
merge = Merge(Data1=graft(scale.Transform), Data2=graft(move.Transform), Data3=graft(rot3d.Transform))

# ---- group: Iteration Count
number_slider_2 = Slider(3, range=0..10)

# ----
mtrans = MassTransform(Transforms=merge)  # -> flatten(MassTransform), PartialTransforms
retrans = RecursiveTransform(Geometry=faceb, Transform=mtrans.MassTransform, Steps=number_slider_2, Last=False)

# ---- group: Loft and join the spikes
loft = Loft(Curves=retrans, Options={Adjust=False, Closed=False, LoftEnds=0, LoftSimp=0, LoftType=0, Rebuild=10, Refit=0.01})  # -> flatten(Loft)
join = BrepJoin(Breps=loft)  # -> Breps, Closed

# ---- group: Cap ends to close geometry
edges = BrepEdges(Brep=join.Breps)  # -> Naked, Interior, NonManifold
join_2 = JoinCurves(Curves=edges.Naked, Preserve=False)
disc = Discontinuity(Curve=join_2, Level=1)  # -> Points, Parameters
flip = FlipMatrix(Data=disc.Points)
bang = ExplodeTree(Data=flip)  # -> _0000, _0001, _0002, _0003
srf4pt = _4PointSurface(CornerA=bang._0000, CornerB=bang._0001, CornerC=bang._0002, CornerD=bang._0003)

# ---- group: Join caps and spikes
join_3 = BrepJoin(Breps=flatten([srf4pt, join.Breps]))  # -> Breps, Closed

# ----
preview = CustomPreview(Geometry=join_3.Breps, Shader=ColourSwatch(SwatchColor=RGB(0, 229, 255)))
