# Grasshopper definition Pf_RoundToNearest.gh (Grasshopper 0.9.76)
# plug-ins: Pufferfish

# Round To Nearest - Panels
base_surface = Surface(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)
# Round To Nearest - Attractors
attractor_point = Point(Point(101.1912262, 93.50831401, 0))
attractor_point_2 = Point(Point(385.6450545, 96.06112685, 0))
# Using graphmapper to change the
# proportions of the attractor distances.
attractor_point_3 = Point(Point(685.0392519, 95.43066377, 0))
divide = DivideDomain²(Domain=base_surface, UCount=10, VCount=10)
subsrf = Isotrim(Surface=base_surface, Domain=divide)
sqgrid = Square(
    Plane=PlaneXY(570.3504154, 0, 0),
    Size=Slider(10, range=0..10),
    ExtentX=Slider(20, range=0..100),
    ExtentY=Slider(20, range=0..100))  # -> Cells, flatten(Points)
sqgrid_2 = Square(Plane=PlaneXY(0, 0, 0), Size=Slider(10, range=0..10), ExtentX=Slider(20, range=0..100), ExtentY=Slider(20, range=0..100))  # -> Cells, flatten(Points)
sqgrid_3 = Square(
    Plane=PlaneXY(284.3036389, 0, 0),
    Size=Slider(10, range=0..10),
    ExtentX=Slider(20, range=0..100),
    ExtentY=Slider(20, range=0..100))  # -> Cells, flatten(Points)
# Higher than the y max (5.5)
panel = Panel("""1
5.5
3""")
# If you want the x numbers to fit into the
# domain of the y numbers (good for attractors)
# then we could remap x with the remap
# component like seen below.
# Lower than the y min (1)
# In the domain of y
panel_2 = Panel("""-2
2.5
54
60
101""")
# Rather than using the remap component
# you can use Round To Nearest's
# Remap (R) input boolean value set to
# true. This will automatically remap the
# x number to the y numbers domain.
# Lower than the y min (1)
# In the domain of y
panel_3 = Panel("""-2
2.5
54
75
101""")
# Higher than the y max (5.5)
# Remap x numbers to y numbers domain
panel_4 = Panel("""1
5.5
3""")
# Pufferfish
# By: Michael Pryor
# Pf_Round To Nearest
# Round To Nearest - Basic
# Input numbers to round
panel_5 = Panel("""1.1
2.5
3.3
4.6
5.2""")
# Input numbers to round nearest to
panel_6 = Panel("""1
5.5
3""")
# Round To Nearest - Remapping
# You will see here some numbers are
# outside of the domain of the y list (1 to 5.5).
# In this the case numbers lower than
# the min of y will round the lowest y,
# Numbers higher than the max of y
# will round to the highest y.
# Lower than the y min (1)
# In the domain of y
panel_7 = Panel("""-2
2.5
54
50
101""")
# Higher than the y max (5.5)
panel_8 = Panel("""1
5.5
3""")
attractor_point_4 = Point(Point(382.9466383, 605.9450014, 0))
faceb = FaceBoundaries(Mesh=subsrf)  # -> flatten(Boundaries)
pull = PullPoint(Point=sqgrid.Points, Geometry=attractor_point_3, ClosestOnly=True)  # -> ClosestPoint, Distance
pull_2 = PullPoint(Point=sqgrid_2.Points, Geometry=attractor_point, ClosestOnly=True)  # -> ClosestPoint, Distance
# Using the remap option to get the proper
# attractor gradient by remapping number
# x to the domain of numbers y.
pull_3 = PullPoint(Point=sqgrid_3.Points, Geometry=attractor_point_2, ClosestOnly=True)  # -> ClosestPoint, Distance
panel_9 = Panel("""1
5.5
3""")
panel_10 = Panel("""1
5.5
3""")
pcen = PolygonCenter(Polyline=faceb)  # -> CenterV, CenterE, CenterA
panel_11 = Panel("""1
5.5
3""")
# Boolean to true to remap x numbers to
# domain of y numbers.
toggle = BooleanToggle(True)
numbers_y = Data(panel_9)
numbers_y_2 = Data(panel_10)
number_x = Data(pull_2.Distance)
number_x_2 = Data(pull_3.Distance)
bnd = Bounds(Numbers=pull.Distance)
numbers_y_3 = Data(panel_6)
numbers_y_4 = Data(panel_8)
number_x_3 = Data(panel_7)
bnd_2 = Bounds(Numbers=panel_2)
bnd_3 = Bounds(Numbers=panel)
number_x_4 = Data(panel_5)
pull_4 = PullPoint(Point=pcen.CenterV, Geometry=attractor_point_4, ClosestOnly=True)  # -> ClosestPoint, Distance
numbers_y_5 = Data(panel_11)
number_x_5 = Data(pull_4.Distance)
number_x_6 = Data(panel_3)
numbers_y_6 = Data(panel_4)
roundn = RoundToNearest(NumbersX=number_x, NumbersY=numbers_y, RemapX=False)  # -> Nearest, Index, Difference, RemappedX
roundn_2 = RoundToNearest(NumbersX=number_x_2, NumbersY=numbers_y_2, RemapX=toggle)  # -> Nearest, Index, Difference, RemappedX
remap = RemapNumbers(Value=pull.Distance, Source=bnd, Target=Domain(0, 1))  # -> Mapped, Clipped
remap_2 = RemapNumbers(Value=panel_2, Source=bnd_2, Target=bnd_3)  # -> Mapped, Clipped
roundn_3 = RoundToNearest(NumbersX=number_x_3, NumbersY=numbers_y_4, RemapX=False)  # -> Nearest, Index, Difference, RemappedX
roundn_4 = RoundToNearest(NumbersX=number_x_4, NumbersY=numbers_y_3, RemapX=False)  # -> Nearest, Index, Difference, RemappedX
graph = GraphMapper(remap.Mapped, x0=0, x1=1, y0=0, y1=1, container_name="Sine", Equation_px=[0, 0.2391304374], Equation_py=[0, 1])
roundn_5 = RoundToNearest(NumbersX=number_x_5, NumbersY=numbers_y_5, RemapX=Toggle(True))  # -> Nearest, Index, Difference, RemappedX
# Remapped x numbers. Keep in mind
# x numbers that were already in the
# domain of the y numbers (1 to 5.5) will
# also be remapped. As you see here
# item 1 was 2.5 and became 1.96602.
panel_12 = Panel(remap_2.Mapped)
panel_13 = Panel(roundn.Nearest)
panel_14 = Panel(roundn_2.Nearest)
roundn_6 = RoundToNearest(NumbersX=number_x_6, NumbersY=numbers_y_6, RemapX=Toggle(True))  # -> Nearest, Index, Difference, RemappedX
numbers_y_7 = Data(panel)
sph = Sphere(Base=sqgrid_2.Points, Radius=roundn.Nearest)
sph_2 = Sphere(Base=sqgrid_3.Points, Radius=roundn_2.Nearest)
number_x_7 = Data(remap_2.Mapped)
# Number in y closest to each x
panel_15 = Panel(roundn_4.Nearest)
# Because so many x numbers are out of
# the y domain you get many of the highest
# y numbers, to adjust this we can remap
# like seen below.
panel_16 = Panel(roundn_3.Nearest)
panel_17 = Panel(roundn_5.RemappedX)
neg = Negative(Value=roundn_5.Nearest)
panel_18 = Panel(roundn_6.Nearest)
# The Rx output displays how the x values
# got changed from the remap to y domain
panel_19 = Panel(roundn_6.RemappedX)
panel_20 = Panel("""1
5.5
3""")
roundn_7 = RoundToNearest(NumbersX=number_x_7, NumbersY=numbers_y_7, RemapX=False)  # -> Nearest, Index, Difference, RemappedX
dom = ConstructDomain(DomainStart=0, DomainEnd=neg)
# Because the attractor distance values
# are so high out of our desired domain
# of sizes (y numbers) most of the x
# numbers get rounded to the highest y
# number. This is not a desired result.
# You could divide the distance results
# to make them smaller to fit closer into
# the domain of your input y numbers.
# However, you can use the remap option in the
# definition seen below to fit the attractor
# distances into the domain of the y numbers.
# This way you keep the proportional
# gradient of the attractor but have the
# numbers you set in y.
preview = CustomPreview(Geometry=sph, Shader=ColourSwatch(SwatchColor=RGB(120, 255, 142)))
preview_2 = CustomPreview(Geometry=sph_2, Shader=ColourSwatch(SwatchColor=RGB(17, 0, 255)))
# Boolean to true to remap x numbers to
# domain of y numbers.
toggle_2 = BooleanToggle(True)
numbers_y_8 = Data(panel_20)
# Manipulate the graph to see the changes
number_x_8 = Data(graph)
# Notice all these numbers changed from
# the above example.
panel_21 = Panel(roundn_7.Nearest)
rectangle = Rectangle(Plane=pcen.CenterV, XSize=dom, YSize=dom, Radius=0)  # -> Rectangle, Length
roundn_8 = RoundToNearest(NumbersX=number_x_8, NumbersY=numbers_y_8, RemapX=toggle_2)  # -> Nearest, Index, Difference, RemappedX
Z = UnitZ(Factor=1)
move = Move(Geometry=rectangle.Rectangle, Motion=Z)  # -> Geometry, Transform
panel_22 = Panel(roundn_8.Nearest)
sph_3 = Sphere(Base=sqgrid.Points, Radius=roundn_8.Nearest)
weave = Weave(Pattern=[0, 1], Stream0=graft(faceb), Stream1=graft(move.Geometry), NullGaps=False)
loft = Loft(Curves=weave, Options={Adjust=True, Closed=False, LoftEnds=0, LoftSimp=0, LoftType=0, Rebuild=10, Refit=0.01})  # -> flatten(Loft)
preview_3 = CustomPreview(Geometry=sph_3, Shader=ColourSwatch(SwatchColor=RGB(255, 140, 0)))
# Because of Round To Nearest there
# are only 3 different panel types which
# equal exactly the y numbers specified.
preview_4 = CustomPreview(Geometry=loft, Shader=ColourSwatch(SwatchColor=RGB(0, 208, 255)))
# In contrast, without Round To Nearest
# we can use normal remapping which will
# get us a gradient of x numbers making
# smoother attraction results but having
# so much variation in results, may not be
# great for fabrication.
number_slider = Slider(20, range=0..100)
attractor_point_5 = Point(Point(380.2044893, -149.0066426, 0))
sqgrid_4 = Square(Plane=PlaneXY(0, 0, 0), Size=Slider(10, range=0..10), ExtentX=number_slider, ExtentY=Slider(20, range=0..100))  # -> Cells, flatten(Points)
# Using normal remap gets an even gradient
# but of many different panel types. Each
# panel is unique which may not be desired
# for fabrication.
base_surface_2 = Surface(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)
pull_5 = PullPoint(Point=sqgrid_4.Points, Geometry=attractor_point_5, ClosestOnly=True)  # -> ClosestPoint, Distance
panel_23 = Panel("""1
5.5
3""")
divide_2 = DivideDomain²(Domain=base_surface_2, UCount=10, VCount=10)
numbers_y_9 = Data(panel_23)
number_x_9 = Data(pull_5.Distance)
subsrf_2 = Isotrim(Surface=base_surface_2, Domain=divide_2)
bnd_4 = Bounds(Numbers=number_x_9)
bnd_5 = Bounds(Numbers=numbers_y_9)
attractor_point_6 = Point(Point(382.9466383, 883.8087497, 0))
faceb_2 = FaceBoundaries(Mesh=subsrf_2)  # -> flatten(Boundaries)
remap_3 = RemapNumbers(Value=number_x_9, Source=bnd_4, Target=bnd_5)  # -> Mapped, Clipped
pcen_2 = PolygonCenter(Polyline=faceb_2)  # -> CenterV, CenterE, CenterA
panel_24 = Panel("""1
5.5
3""")
sph_4 = Sphere(Base=sqgrid_4.Points, Radius=remap_3.Mapped)
pull_6 = PullPoint(Point=pcen_2.CenterV, Geometry=attractor_point_6, ClosestOnly=True)  # -> ClosestPoint, Distance
numbers_y_10 = Data(panel_24)
# Normal remapping of attraction values
panel_25 = Panel(remap_3.Mapped)
number_x_10 = Data(pull_6.Distance)
bnd_6 = Bounds(Numbers=numbers_y_10)
bnd_7 = Bounds(Numbers=number_x_10)
# Notice the numbers are in the domain of
# the y numbers but are a gradient of
# numbers rather than the specified y
# numbers. This may not be good
# for real world applications as there
# are too many custom sizes to build.
preview_5 = CustomPreview(Geometry=sph_4, Shader=ColourSwatch(SwatchColor=RGB(150, 143, 255)))
remap_4 = RemapNumbers(Value=number_x_10, Source=bnd_7, Target=bnd_6)  # -> Mapped, Clipped
panel_26 = Panel(remap_4.Mapped)
neg_2 = Negative(Value=remap_4.Mapped)
dom_2 = ConstructDomain(DomainStart=remap_4.Mapped, DomainEnd=neg_2)
rectangle_2 = Rectangle(Plane=pcen_2.CenterV, XSize=dom_2, YSize=dom_2, Radius=0)  # -> Rectangle, Length
Z_2 = UnitZ(Factor=remap_4.Mapped)
move_2 = Move(Geometry=rectangle_2.Rectangle, Motion=Z_2)  # -> Geometry, Transform
weave_2 = Weave(Pattern=[0, 1], Stream0=graft(faceb_2), Stream1=graft(move_2.Geometry), NullGaps=False)
# We can also use the division method but
# this method is very manual and not so
# accurate to specified sizes and domains.
number_slider_2 = Slider(20, range=0..100)
loft_2 = Loft(Curves=weave_2, Options={Adjust=True, Closed=False, LoftEnds=0, LoftSimp=0, LoftType=0, Rebuild=10, Refit=0.01})  # -> flatten(Loft)
attractor_point_7 = Point(Point(373.773131, -422.5810727, 0))
sqgrid_5 = Square(
    Plane=PlaneXY(283.048765, -521.229349, 0),
    Size=Slider(10, range=0..10),
    ExtentX=Slider(20, range=0..100),
    ExtentY=number_slider_2)  # -> Cells, flatten(Points)
preview_6 = CustomPreview(Geometry=loft_2, Shader=ColourSwatch(SwatchColor=RGB(221, 0, 255)))
pull_7 = PullPoint(Point=sqgrid_5.Points, Geometry=attractor_point_7, ClosestOnly=True)  # -> ClosestPoint, Distance
number_x_11 = Data(pull_7.Distance)
division = Division(A=number_x_11, B=Slider(12, range=0..100))
# Divide x numbers and try to get close
# to your desired y numbers by eye.
panel_27 = Panel(division)
sph_5 = Sphere(Base=sqgrid_5.Points, Radius=division)
panel_28 = Panel("""1
5.5
3""")
# Divided x numbers results, have to adjust
# slider to try and get the numbers within
# the desired domain.
preview_7 = CustomPreview(Geometry=sph_5, Shader=ColourSwatch(SwatchColor=RGB(181, 176, 255)))
