# Grasshopper definition Pf_TweenCurveTwistedBoxPatterns.gh (Grasshopper 0.9.76)
# plug-ins: Pufferfish

# ---- group: X and Y grid divisions
# Tween Curve Twisted Box Patterns Flow
number_slider = Slider(20, range=0..100)
range = Range(Domain=Domain(0, 1), Steps=number_slider)
range_2 = Range(Domain=Domain(0, 1), Steps=Slider(20, range=0..100))
graph = GraphMapper(range_2, x0=0, x1=1, y0=0, y1=1, container_name="Bezier", cpx=[0, 0.25, 0.75, 1], cpy=[0, 0.25, 0.75, 1])
graph_2 = GraphMapper(range, x0=0, x1=1, y0=0, y1=1, container_name="Bezier", cpx=[0, 0.25, 0.75, 1], cpy=[0, 0.25, 0.75, 1])

# ---- group: Number of tweens
range_3 = Range(Domain=Domain(0, 1), Steps=Slider(30, range=0..100))
graph_3 = GraphMapper(range_3, x0=0, x1=1, y0=0, y1=1, container_name="Bezier", cpx=[0, 0.25, 0.75, 1], cpy=[0, 0.25, 0.75, 1])

# ---- group: Surface defining grid size
# Pf_Tween Curve Twisted Box Patterns
# Tween Curve Twisted Box Patterns Array
number_slider_2 = Slider(200, range=0..500)
planesrf = PlaneSurface(Plane=PlaneXY(-74.7475868, -94.4359915, 0), XSize=number_slider_2, YSize=Slider(200, range=0..500))

# ---- group: Interpolation type
number_slider_3 = Slider(1, range=0..3)

# ---- group: Equalize tween spacing
toggle = BooleanToggle(True)

# ---- group: Curves to morph between
crv = Curve([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])

# ---- group: Strip density
range_4 = Range(Domain=Domain(0, 1), Steps=Slider(18, range=0..100))
graph_4 = GraphMapper(range_4, x0=0, x1=1, y0=0, y1=1, container_name="Bezier", cpx=[0, 0.25, 0.650000155, 1], cpy=[0, 0.25, 0.6499994397, 1])

# ---- group: Pf_Twisted Box Surface
# Using an attractor we will tween
# curves and morph these tweens
# to a grid based on the distance
# values to the attractor. You can
# use multiple attractors too and
# even curves if you want.
tboxsrf = TwistedBoxSurface(Surface=planesrf, Thickness=2, ParametersU=graph, ParametersV=graph_2, ParametersW=[0, 1])

# ---- group: Pf_Tween Through Curves
# Tween curves control the
# amount of twisted box strips
twnthrucrvs = TweenThroughCurves(Curves=crv, Factor=graph_3, Normalized=True, Equalized=toggle, InterpolationType=number_slider_3, Refit=0, PointSample=0)

# ---- group: Attractors
# Try plugging
# in the curves
# or points + curves
crv_2 = Curve(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)
# Pufferfish
# By: Michael Pryor
pt = Point(Point(-6.683246778, -6.97829539, 0))

# ---- group: Pf_Twisted Box Centers
tboxcents = TwistedBoxCenters(TwistedBox=tboxsrf, CenterType=0)  # -> flatten(Center)

# ---- group: Thickness
number_slider_4 = Slider(2.3, range=0..10)

# ---- group: Weight the density
toggle_2 = BooleanToggle(True)

# ---- group: Attractor distances
geo = Geometry(pt)
pull = PullPoint(Point=tboxcents, Geometry=geo, ClosestOnly=True)  # -> ClosestPoint, Distance

# ---- group: Pf_Twisted Box Strips
# Using an attractor we will tween
# curves and morph these tweens
# to a grid based on the distance
# values to the attractor. You can
# use multiple attractors too and
# even curves if you want.
tboxstrips = TwistedBoxStrips(Rails=twnthrucrvs, Thickness=number_slider_4, ParametersT=graph_4, Weighted=toggle_2)

# ---- group: Invert distances
toggle_3 = BooleanToggle(False)

# ---- group: Pf_Reparameterize Numbers
reparamnums = ReparameterizeNumbers(Numbers=pull.Distance, Invert=toggle_3)  # -> Reparameterized, Original

# ---- group: Graph map distances
# Optionally you can shuffle the order of
# the input curve list to change the pattern.
graph_5 = GraphMapper(
    reparamnums.Reparameterized,
    x0=0,
    x1=1,
    y0=0,
    y1=1,
    container_name="Bezier",
    cpx=[0, 0.5217391253, 0.1376811564, 1],
    cpy=[0, 0.07246375084, 0.789855063, 1])

# ---- group: Attractors
# Try plugging
# in the curves
# or points + curves
crv_3 = Curve(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)
pt_2 = Point(Point(-14.96677924, -512.6622595, 0))

# ---- group: Pf_Twisted Box Centers
tboxcents_2 = TwistedBoxCenters(TwistedBox=tboxstrips, CenterType=0)  # -> flatten(Center)

# ---- group: Curve shapes to make patterns with
# You can use more than two
# curves for the tweening.
# In this case the curves are
# in the same place to make
# bounding boxes simpler
# later on after the tweening.
# Be aware of your curve seam
# locations and curve directions.
crv_4 = Curve([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])

# ---- group: Shuffle input curve order
jitter = Jitter(List=crv_4, Jitter=Slider(0, range=0..1), Seed=Slider(0, range=0..1000))  # -> Values, Indices

# ---- group: Attractor distances
geo_2 = Geometry(pt_2)
# Optionally you can shuffle the order of
# the input curve list to change the pattern.
pull_2 = PullPoint(Point=tboxcents_2, Geometry=geo_2, ClosestOnly=True)  # -> ClosestPoint, Distance

# ---- group: Equalize tweens
toggle_4 = BooleanToggle(False)

# ---- group: Invert distances
toggle_5 = BooleanToggle(False)

# ---- group: Pf_Tween Through Curves
twnthrucrvs_2 = TweenThroughCurves(Curves=jitter.Values, Factor=graph_5, Normalized=True, Equalized=toggle_4, InterpolationType=0, Refit=0, PointSample=0)

# ---- group: Pf_Reparameterize Numbers
reparamnums_2 = ReparameterizeNumbers(Numbers=pull_2.Distance, Invert=toggle_5)  # -> Reparameterized, Original

# ---- group: Curve shapes to make patterns with
crv_5 = Curve([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])

# ---- group: Shuffle input curve order
jitter_2 = Jitter(List=crv_5, Jitter=Slider(0, range=0..1), Seed=Slider(0, range=0..1000))  # -> Values, Indices

# ---- group: Graph map distances
graph_6 = GraphMapper(
    reparamnums_2.Reparameterized,
    x0=0,
    x1=1,
    y0=0,
    y1=1,
    container_name="Bezier",
    cpx=[0, 0.5217391253, 0.1376811564, 1],
    cpy=[0, 0.07246375084, 0.789855063, 1])

# ---- group: Pf_Bounding Rectangle
brec = BoundingRectangle(Geometry=twnthrucrvs_2, Plane=PlaneXY(0, 0, 0), Axis=0, Slide=0, Union=True)  # -> Bounding, DimensionX, DimensionY

# ---- group: Scale bounding rectangle
pcen = PolygonCenter(Polyline=brec.Bounding)  # -> CenterV, CenterE, CenterA
# Scaling the bounding rectangle changes
# its spatial relationship to the curve shapes.
# This will change how the pattern shapes
# overlap, touch, or intersect after morphing.
scale = Scale(Geometry=brec.Bounding, Center=pcen.CenterA, Factor=Slider(1, range=0..2))  # -> Geometry, Transform

# ---- group: Equalize tweens
toggle_6 = BooleanToggle(False)

# ---- group: Pf_Tween Through Curves
twnthrucrvs_3 = TweenThroughCurves(Curves=jitter_2.Values, Factor=graph_6, Normalized=True, Equalized=toggle_6, InterpolationType=0, Refit=0, PointSample=0)

# ---- group: Unit extrude rectangle
Z = UnitZ(Factor=1)
extr = Extrude(Base=scale.Geometry, Direction=Z)

# ---- group: Box morph
morph = BoxMorph(Geometry=twnthrucrvs_2, Reference=extr, Target=tboxsrf)

# ---- group: Pf_Bounding Rectangle
brec_2 = BoundingRectangle(Geometry=twnthrucrvs_3, Plane=PlaneXY(0, 0, 0), Axis=0, Slide=0, Union=True)  # -> Bounding, DimensionX, DimensionY

# ----
# Box Morphing,
# If using Rhino 6
# you can use Pufferfish's
# Multi-Threaded "Morph To Twisted Box" component.
swatch = ColourSwatch(SwatchColor=RGB(0, 36, 196))

# ---- group: Scale bounding rectangle
pcen_2 = PolygonCenter(Polyline=brec_2.Bounding)  # -> CenterV, CenterE, CenterA
# Scaling the bounding rectangle changes
# its spatial relationship to the curve shapes.
# This will change how the pattern shapes
# overlap, touch, or intersect after morphing.
scale_2 = Scale(Geometry=brec_2.Bounding, Center=pcen_2.CenterA, Factor=Slider(1, range=0..2))  # -> Geometry, Transform

# ----
# Look at Rhino window
# to preview results
preview = CustomPreview(Geometry=morph, Shader=swatch)

# ---- group: Unit extrude rectangle
Z_2 = UnitZ(Factor=1)
extr_2 = Extrude(Base=scale_2.Geometry, Direction=Z_2)

# ---- group: Box morph
morph_2 = BoxMorph(Geometry=twnthrucrvs_3, Reference=extr_2, Target=tboxstrips)

# ----
# Box Morphing,
# If using Rhino 6
# you can use Pufferfish's
# Multi-Threaded "Morph To Twisted Box" component.
swatch_2 = ColourSwatch(SwatchColor=RGB(0, 36, 196))
# Look at Rhino window
# to preview results
preview_2 = CustomPreview(Geometry=morph_2, Shader=swatch_2)
