# Grasshopper definition Pf_TweenCurvesPulseRing - Requires Weaverbird Plugin.gh (Grasshopper 0.9.76)
# plug-ins: Pufferfish, Weaverbird

# ---- group: Center of cirlce
# Pf_Tween Curves Pulse Ring
# Original Design by Radul Shishkov @ DesignMorphine
z_deformation = Slider(0.449, range=0..10)
multiplication = Multiplication(A=z_deformation, B=-1)
# Pufferfish
# By: Michael Pryor
pt = ConstructPoint(XCoordinate=0, YCoordinate=0, ZCoordinate=multiplication)

# ---- group: Radius of ring circle
cir = Circle(Plane=pt, Radius=Slider(7, range=0..10))

# ---- group: Adjust seam location
seam = Seam(Curve=reparameterize(cir), Seam=Slider(0.61, range=0..1))

# ---- group: Divide curve for accuracy
divide = DivideCurve(Curve=seam, Count=Slider(15, range=0..50), Kinks=False)  # -> Points, Tangents, Parameters

# ---- group: Make 3 copies of the divisions upward
series = Series(Start=0, Step=Slider(3.079, range=0..10), Count="3")
Z = UnitZ(Factor=series)
move = Move(Geometry=divide.Points, Motion=graft(Z))  # -> Geometry, Transform

# ---- group: Get point location values
pdecon = Deconstruct(Point=move.Geometry)  # -> XComponent, YComponent, ZComponent

# ---- group: Set a spread maximum reach in y direction
max = Maximum(A=pdecon.YComponent, B=Slider(3.769, range=0..10))

# ---- group: Reparemetrize the Y values and graph map
reparamnums = ReparameterizeNumbers(Numbers=max, Invert=False)  # -> Reparameterized, Original
graph = GraphMapper(
    reparamnums.Reparameterized,
    x0=0,
    x1=1,
    y0=0,
    y1=1,
    container_name="Bezier",
    cpx=[0, 0.3206272423, 1, 1],
    cpy=[0, 0.3967629075, 0, 0.316994369])

# ---- group: Multiply the Y values by the Z values and move points in Z direction for spreading
multiplication_2 = Multiplication(A=graph, B=pdecon.ZComponent)
multiplication_3 = Multiplication(A=multiplication_2, B=Slider(19.2, range=0..20))
Z_2 = UnitZ(Factor=multiplication_3)
move_2 = Move(Geometry=move.Geometry, Motion=Z_2)  # -> Geometry, Transform

# ---- group: Get Z values of the spreaded points
pdecon_2 = Deconstruct(Point=move_2.Geometry)  # -> XComponent, YComponent, ZComponent

# ---- group: Reparemetrize the Z values and graph map
bnd = Bounds(Numbers=flatten(pdecon_2.ZComponent))
remap = RemapNumbers(Value=pdecon_2.ZComponent, Source=bnd, Target=Domain(0, 1))  # -> Mapped, Clipped
graph_2 = GraphMapper(
    remap.Mapped,
    x0=0,
    x1=1,
    y0=0,
    y1=1,
    container_name="Gaussian",
    factor=0.4227501154,
    mean=0.4612989426,
    sdev=0.1288317144)

# ---- group: Graph map the reparameterized Y values then multiply
graph_3 = GraphMapper(
    reparamnums.Reparameterized,
    x0=0,
    x1=1,
    y0=0,
    y1=1,
    container_name="Bezier",
    cpx=[0, 1, 0.3425002992, 1],
    cpy=[0, 0, 0.6978100538, 1])
multiplication_4 = Multiplication(A=graph_3, B=Slider(1, range=0..1))

# ---- group: Make curves
nurbs = NurbsCurve(Vertices=move_2.Geometry, Degree=3, Periodic=Toggle(True))  # -> flatten(Curve), Length, Domain

# ---- group: Remap the Z values back to a larger domain
dom = ConstructDomain(DomainStart=Slider(3.277, range=0..100), DomainEnd=Slider(20, range=0..20))
remap_2 = RemapNumbers(Value=graph_2, Source=Domain(0, 1), Target=dom)  # -> Mapped, Clipped

# ---- group: Multiply the Y values by the spreaded Z values and move points in X direction for Expanding
multiplication_5 = Multiplication(A=multiplication_4, B=remap_2.Mapped)
Y = UnitY(Factor=multiplication_5)
move_3 = Move(Geometry=move_2.Geometry, Motion=Y)  # -> Geometry, Transform

# ---- group: Make curves
nurbs_2 = NurbsCurve(Vertices=move_3.Geometry, Degree=3, Periodic=Toggle(True))  # -> flatten(Curve), Length, Domain

# ---- group: Scale curves in the x direction
Z_3 = UnitZ(Factor=series)
move_4 = Move(Geometry=pt, Motion=Z_3)  # -> flatten(Geometry), Transform
lng = ListLength(List=move_4.Geometry)
series_2 = Series(Start=0, Step=1, Count=lng)
reparamnums_2 = ReparameterizeNumbers(Numbers=series_2, Invert=False)  # -> Reparameterized, Original
graph_4 = GraphMapper(
    reparamnums_2.Reparameterized,
    x0=0,
    x1=1,
    y0=0,
    y1=1,
    container_name="Gaussian",
    factor=0.5016885996,
    mean=0.4678866565,
    sdev=0.4489286058)
scale_nu = ScaleNU(Geometry=nurbs_2.Curve, Plane=move_4.Geometry, ScaleX=expr("x+1", graph_4), ScaleY=1, ScaleZ=1)  # -> flatten(Geometry), Transform

# ---- group: Tween ring curves
entwine = Entwine(Branch00=nurbs.Curve, Branch01=scale_nu.Geometry, FlattenInputs=True)
range = Range(Domain=Domain(0, 1), Steps=Slider(9, range=0..100))
twnthrucrvs = TweenThroughCurves(
    Curves=entwine,
    Factor=range,
    Normalized=Toggle(True),
    Equalized=Toggle(True),
    InterpolationType=Slider(1, range=0..3),
    Refit=0,
    PointSample=0)

# ---- group: Weave pairs of primary and secondary ring curves
bang = ExplodeTree(Data=twnthrucrvs)  # -> Branch0, Branch1
toggle = BooleanToggle(False)
shift = ShiftList(List=bang.Branch1, Shift="-1", Wrap=toggle)
shift_2 = ShiftList(List=bang.Branch0, Shift="1", Wrap=toggle)
weave = Weave(Pattern=[0, 1], Stream0=graft(shift_2), Stream1=graft(shift), NullGaps=False)

# ---- group: Surface strips to mesh
range_2 = Range(Domain=Domain(0, 1), Steps=Slider(4, range=0..100))
range_3 = Range(Domain=Domain(0, 1), Steps=Slider(17, range=0..100))
loft = Loft(Curves=weave, Options={Adjust=False, Closed=False, LoftEnds=0, LoftSimp=0, LoftType=0, Rebuild=10, Refit=0.01})
paramsrfmsh = ParameterSurfaceMesh(Surface=loft, ParametersU=range_2, ParametersV=range_3, Triangulate=False)  # -> flatten(Mesh)

# ---- group: Cretae and graftmap a series of ring thicknesses
lng_2 = ListLength(List=paramsrfmsh)
series_3 = Series(Start=0, Step=1, Count=lng_2)
reparamnums_3 = ReparameterizeNumbers(Numbers=series_3, Invert=False)  # -> Reparameterized, Original
graph_5 = GraphMapper(
    flatten(reparamnums_3.Reparameterized),
    x0=0,
    x1=1,
    y0=0,
    y1=1,
    container_name="Bezier",
    cpx=[0, 0.3701739609, 0.5487788916, 1],
    cpy=[0.01428574324, 0.3039995432, 0.3442277908, 0])

# ---- group: Remap thickness values to larger numbers
dom_2 = ConstructDomain(DomainStart=Slider(10, range=0..10), DomainEnd=Slider(25.645, range=0..100))
remap_3 = RemapNumbers(Value=graph_5, Source=Domain(0, 1), Target=dom_2)  # -> Mapped, Clipped

# ---- group: Divide value and make negative
division = Division(A=remap_3.Mapped, B=Slider(7.227, range=0..10))
neg = Negative(Value=division)

# ---- group: Thicken mesh strips
wbthicken = WeaverbirdsMeshThicken(MeshCurves=graft(paramsrfmsh), Distance=graft(neg), OffsetType=0)  # -> flatten(OutputMeshCurves)

# ---- group: Smooth mesh strips
wbcatmullclark = WeaverbirdsCatmullClarkSubdivision(MeshCurves=wbthicken, Level=Slider(3, range=0..10), SmoothNakedEdges=1)  # -> flatten(OutputMeshCurves)

# ---- group: Spread thickened mesh strips apart
series_4 = Series(Start=0, Step=Slider(0.016, range=0..10), Count=lng_2)
Z_4 = UnitZ(Factor=series_4)
move_5 = Move(Geometry=wbcatmullclark, Motion=Z_4)  # -> Geometry, Transform

# ----
preview = CustomPreview(Geometry=move_5.Geometry, Shader=ColourSwatch(SwatchColor=RGB(64, 255, 204)))
