# Grasshopper definition Pf_TweenMeshTwistedBoxMorphing - Requires Weaverbird Plugin.gh (Grasshopper 1.0.7)
# plug-ins: MeshEdit Components, Pufferfish, Weaverbird

# ---- group: U and V surface divisions
range = Range(Domain=Domain(0, 1), Steps=Slider(8, range=0..100))
range_2 = Range(Domain=Domain(0, 1), Steps=Slider(20, range=0..100))
graph = GraphMapper(range, x0=0, x1=1, y0=0, y1=1, container_name="Bezier", cpx=[0, 0.25, 0.75, 1], cpy=[0, 0.25, 0.75, 1])
graph_2 = GraphMapper(range_2, x0=0, x1=1, y0=0, y1=1, container_name="Bezier", cpx=[0, 0.25, 0.75, 1], cpy=[0, 0.25, 0.75, 1])

# ---- group: X Y Z box divisions
# Tween Mesh Twisted Box Morphing to Array
number_slider = Slider(5, range=0..100)
range_3 = Range(Domain=Domain(0, 1), Steps=number_slider)
range_4 = Range(Domain=Domain(0, 1), Steps=Slider(5, range=0..100))
range_5 = Range(Domain=Domain(0, 1), Steps=Slider(5, range=0..100))
graph_3 = GraphMapper(range_3, x0=0, x1=1, y0=0, y1=1, container_name="Bezier", cpx=[0, 0.25, 0.75, 1], cpy=[0, 0.25, 0.75, 1])
graph_4 = GraphMapper(range_4, x0=0, x1=1, y0=0, y1=1, container_name="Bezier", cpx=[0, 0.25, 0.75, 1], cpy=[0, 0.25, 0.75, 1])
graph_5 = GraphMapper(range_5, x0=0, x1=1, y0=0, y1=1, container_name="Bezier", cpx=[0, 0.25, 0.75, 1], cpy=[0, 0.25, 0.75, 1])

# ---- group: Number of tweens
# Tween Mesh Twisted Box Morphing to Curves
number_slider_2 = Slider(20, range=0..100)
range_6 = Range(Domain=Domain(0, 1), Steps=number_slider_2)
graph_6 = GraphMapper(range_6, x0=0, x1=1, y0=0, y1=1, container_name="Bezier", cpx=[0, 0.25, 0.75, 1], cpy=[0, 0.25, 0.75, 1])

# ---- group: X Y Z curve divisions
# Tween Mesh Twisted Box Morphing to Curve
number_slider_3 = Slider(17, range=0..100)
range_7 = Range(Domain=Domain(0, 1), Steps=number_slider_3)
range_8 = Range(Domain=Domain(0, 1), Steps=Slider(1, range=0..100))
range_9 = Range(Domain=Domain(0, 1), Steps=Slider(7, range=0..100))
graph_7 = GraphMapper(range_7, x0=0, x1=1, y0=0, y1=1, container_name="Bezier", cpx=[0, 0.25, 0.75, 1], cpy=[0, 0.25, 0.75, 1])
graph_8 = GraphMapper(range_8, x0=0, x1=1, y0=0, y1=1, container_name="Bezier", cpx=[0, 0.25, 0.75, 1], cpy=[0, 0.25, 0.75, 1])
graph_9 = GraphMapper(range_9, x0=0, x1=1, y0=0, y1=1, container_name="Bezier", cpx=[0, 0.25, 0.75, 1], cpy=[0, 0.25, 0.75, 1])

# ---- group: Interpolation type
number_slider_4 = Slider(1, range=0..3)

# ---- group: Twisted box thickness
number_slider_5 = Slider(3, range=0..10)

number_slider_6 = Slider(3, range=0..10)

# ---- group: Surface to morph onto
# Tween Mesh Twisted Box Morphing to Surface
srf = Surface(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)

# ---- group: Mesh to morph onto
# Pf_Tween Mesh Twisted Box Morphing
# Tween Mesh Twisted Box Morphing to Mesh
mesh = Mesh(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)

# ---- group: Equalize tween spacing
toggle = BooleanToggle(True)

# ----
# Domain offset of the
# twisted boxes from
# the curve. You can use
# single numbers also.
number_slider_7 = Slider(3.497, range=-20..20)

# ---- group: Curves to morph between
crv = Curve([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])

# ----
# Weights the division distribution by curvature
# if the curve is not linear and degree is not 1.
number_slider_8 = Slider(30, range=0..100)
# Diameter and thickness
number_slider_9 = Slider(8, range=0..100)

# ---- group: Box to morph into
B = Box({Plane=Plane(origin=(3.876875693, -663.9961358, 0), x=(0, 1, 0), y=(1, 0, 0)), X=Domain(0, 58.34186134), Y=Domain(0, 58.34186134), Z=Domain(-60.97738605, 0)})

# ---- group: Curve to morph along
crv_2 = Curve(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)

# ----
# Rotation around twisted box centers
number_slider_10 = Slider(360, range=-1000..1000)

# ---- group: Pf_Twisted Box Mesh
# Pufferfish
# By: Michael Pryor
tboxmsh = TwistedBoxMesh(Mesh=mesh, Thickness=number_slider_6, ParametersW=[0, 1])

# ----
dom = ConstructDomain(DomainStart=Slider(-8.058, range=-20..20), DomainEnd=number_slider_7)
# Rotation around curve
number_slider_11 = Slider(-421, range=-1000..1000)

# ---- group: Attractor point
# Using an attractor we will tween
# meshes and morph these tweens
# to another mesh based on the
# distance values to the attractor.
# You can use multiple attractors
# too and even curves if you want.
pt = Point(Point(60.76778501, -90.79458595, 31.12772605))

# ---- group: Pf_Twisted Box Centers
tboxcents = TwistedBoxCenters(TwistedBox=tboxmsh, CenterType=0)  # -> flatten(Center)

# ---- group: Pf_Twisted Box Array
tboxarray = TwistedBoxArray(Box=B, ParametersX=graph_3, ParametersY=graph_5, ParametersZ=graph_4)

# ---- group: Pf_Twisted Box Surface
tboxsrf = TwistedBoxSurface(Surface=srf, Thickness=number_slider_5, ParametersU=graph, ParametersV=graph_2, ParametersW=[0, 1])

# ---- group: Pf_Tween Through Curves
# Tween curves control the
# amount of twisted box strips
twnthrucrvs = TweenThroughCurves(Curves=crv, Factor=graph_6, Normalized=True, Equalized=toggle, InterpolationType=number_slider_4, Refit=0, PointSample=0)

# ---- group: Strip density
range_10 = Range(Domain=Domain(0, 1), Steps=Slider(10, range=0..100))
graph_10 = GraphMapper(range_10, x0=0, x1=1, y0=0, y1=1, container_name="Bezier", cpx=[0, 0.25, 0.650000155, 1], cpy=[0, 0.25, 0.6499994397, 1])

# ----
preview = CustomPreview(Geometry=pt, Shader=ColourSwatch(SwatchColor=RGB(0, 55, 255)))

# ---- group: Attractor point
# Using an attractor we will tween
# meshes and morph these tweens
# to another mesh based on the
# distance values to the attractor.
# You can use multiple attractors
# too and even curves if you want.
pt_2 = Point(Point(40.59569272, -258.0835846, 58.11747955))

# Using an attractor we will tween
# meshes and morph these tweens
# to another mesh based on the
# distance values to the attractor.
# You can use multiple attractors
# too and even curves if you want.
pt_3 = Point(Point(70.4134482, -601.8130064, 58.11747955))

# ---- group: Invert attractor
toggle_2 = BooleanToggle(True)

# ---- group: Get distances to attractor
pull = PullPoint(Point=tboxcents, Geometry=pt, ClosestOnly=True)  # -> ClosestPoint, Distance

# ---- group: Pf_Twisted Box Centers
tboxcents_2 = TwistedBoxCenters(TwistedBox=tboxsrf, CenterType=0)  # -> flatten(Center)

tboxcents_3 = TwistedBoxCenters(TwistedBox=tboxarray, CenterType=0)  # -> flatten(Center)

# ---- group: Thickness
number_slider_12 = Slider(2.3, range=0..10)

# ----
preview_2 = CustomPreview(Geometry=pt_2, Shader=ColourSwatch(SwatchColor=RGB(0, 55, 255)))
preview_3 = CustomPreview(Geometry=pt_3, Shader=ColourSwatch(SwatchColor=RGB(0, 55, 255)))

# ---- group: Pf_Twisted Box Tube
tboxtube = TwistedBoxTube(
    Curve=crv_2,
    ParametersU=graph_7,
    ParametersV=graph_9,
    ParametersW=graph_8,
    Weighted=Toggle(False),
    Diameter=number_slider_8,
    Thickness=number_slider_9,
    Offset=dom,
    Rotation1=number_slider_10,
    Rotation2=number_slider_11)

# ---- group: Pf_Reparameterize Numbers
reparamnums = ReparameterizeNumbers(Numbers=pull.Distance, Invert=toggle_2)  # -> Reparameterized, Original

# ---- group: Get distances to attractor
pull_2 = PullPoint(Point=tboxcents_2, Geometry=pt_2, ClosestOnly=True)  # -> ClosestPoint, Distance

pull_3 = PullPoint(Point=tboxcents_3, Geometry=pt_3, ClosestOnly=True)  # -> ClosestPoint, Distance

# ---- group: Invert attractor
toggle_3 = BooleanToggle(True)

toggle_4 = BooleanToggle(True)

# ---- group: Weight the density
toggle_5 = BooleanToggle(True)

# ---- group: Attractor point
# Using an attractor we will tween
# meshes and morph these tweens
# to another mesh based on the
# distance values to the attractor.
# You can use multiple attractors
# too and even curves if you want.
pt_4 = Point(Point(-35.12578352, -839.6554969, 29.21056088))

# ---- group: Graph map attractor values
graph_11 = GraphMapper(
    reparamnums.Reparameterized,
    x0=0,
    x1=1,
    y0=0,
    y1=1,
    container_name="Bezier",
    cpx=[0, 0.9202898741, 0.2942031622, 1],
    cpy=[0, 0.06666654348, 0.5536231399, 1])

# ---- group: Pf_Twisted Box Centers
tboxcents_4 = TwistedBoxCenters(TwistedBox=tboxtube, CenterType=0)  # -> flatten(Center)

# ---- group: Pf_Reparameterize Numbers
reparamnums_2 = ReparameterizeNumbers(Numbers=pull_2.Distance, Invert=toggle_3)  # -> Reparameterized, Original

reparamnums_3 = ReparameterizeNumbers(Numbers=pull_3.Distance, Invert=toggle_4)  # -> Reparameterized, Original

# ----
preview_4 = CustomPreview(Geometry=pt_4, Shader=ColourSwatch(SwatchColor=RGB(0, 55, 255)))

# ---- group: Get distances to attractor
pull_4 = PullPoint(Point=tboxcents_4, Geometry=pt_4, ClosestOnly=True)  # -> ClosestPoint, Distance

# ---- group: Pf_Twisted Box Strips
tboxstrips = TwistedBoxStrips(Rails=twnthrucrvs, Thickness=number_slider_12, ParametersT=graph_10, Weighted=toggle_5)

# ---- group: Invert attractor
toggle_6 = BooleanToggle(True)

# ---- group: Graph map attractor values
graph_12 = GraphMapper(
    reparamnums_2.Reparameterized,
    x0=0,
    x1=1,
    y0=0,
    y1=1,
    container_name="Bezier",
    cpx=[0, 0.9202898741, 0.2942031622, 1],
    cpy=[0, 0.06666654348, 0.5536231399, 1])

graph_13 = GraphMapper(
    reparamnums_3.Reparameterized,
    x0=0,
    x1=1,
    y0=0,
    y1=1,
    container_name="Bezier",
    cpx=[0, 0.9202898741, 0.2942031622, 1],
    cpy=[0, 0.06666654348, 0.5536231399, 1])

# ---- group: Meshes to tween
# The meshes you want to tween should have
# the same topology and for proper connecting
# they should have identical naked edge openings.
# You can use more than two meshes for the tweening.
# In this case the meshes are in the same place to
# make bounding boxes simpler later on after the tweening.
mesh_2 = Mesh([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])

# ---- group: Attractor point
# Using an attractor we will tween
# meshes and morph these tweens
# to another mesh based on the
# distance values to the attractor.
# You can use multiple attractors
# too and even curves if you want.
pt_5 = Point(Point(-16.74760573, -406.8722946, -10.31720425))

# ----
# Look at Rhino window
# to preview results
preview_5 = CustomPreview(
    Geometry=mesh_2,
    Shader={diffuse=RGB(255, 105, 180), emission=RGB(76, 32, 54), shine=0.5, specular=RGB(255, 255, 255), transparency=0})

# ---- group: Pf_Reparameterize Numbers
reparamnums_4 = ReparameterizeNumbers(Numbers=pull_4.Distance, Invert=toggle_6)  # -> Reparameterized, Original

# ---- group: Pf_Twisted Box Centers
tboxcents_5 = TwistedBoxCenters(TwistedBox=tboxstrips, CenterType=0)  # -> flatten(Center)

# ---- group: Pf_Tween Through Meshes
twnthrumshs = TweenThroughMeshes(Meshes=mesh_2, Factor=graph_11, Normalized=True, Equalized=False, Weighted=False, Degree=3, InterpolationType=0)

# ---- group: Meshes to tween
mesh_3 = Mesh([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])

mesh_4 = Mesh([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])

# ----
preview_6 = CustomPreview(Geometry=pt_5, Shader=ColourSwatch(SwatchColor=RGB(0, 55, 255)))

# ---- group: Graph map attractor values
graph_14 = GraphMapper(
    reparamnums_4.Reparameterized,
    x0=0,
    x1=1,
    y0=0,
    y1=1,
    container_name="Bezier",
    cpx=[0, 0.9202898741, 0.2942031622, 1],
    cpy=[0, 0.06666654348, 0.5536231399, 1])

# ---- group: Get distances to attractor
pull_5 = PullPoint(Point=tboxcents_5, Geometry=pt_5, ClosestOnly=True)  # -> ClosestPoint, Distance

# ---- group: Invert attractor
toggle_7 = BooleanToggle(True)

# ----
# Look at Rhino window
# to preview results
preview_7 = CustomPreview(
    Geometry=mesh_3,
    Shader={diffuse=RGB(255, 105, 180), emission=RGB(76, 32, 54), shine=0.5, specular=RGB(255, 255, 255), transparency=0})
# Look at Rhino window
# to preview results
preview_8 = CustomPreview(
    Geometry=mesh_4,
    Shader={diffuse=RGB(255, 105, 180), emission=RGB(76, 32, 54), shine=0.5, specular=RGB(255, 255, 255), transparency=0})

# ---- group: Make bounding boxes around mesh naked edges
# If you make the meshes to tween in the same place
# then you can just use one of them to get the bounding
# box. This will save a lot of computation time.
item = ListItem(List=twnthrumshs, Index=0, Wrap=True)
nakededge = MeshNakedEdge(Mesh=item)  # -> V, A, B
item_2 = ListItem(List=nakededge.V, Index=nakededge.A, Wrap=True)
# The bounding boxes should be around
# the naked vertices of the tween meshes,
# this ensures all the meshes morph the
# correct way for connecting even though
# the overall size of the meshes to morph
# changes with the tweening. If you just do
# bounding boxes around the entire
# geometries then the connections wont
# align correctly for the final mesh smoothing.
bbox = BoundingBox(Content=item_2, Plane=PlaneXY(0, 0, 0), UnionBox=True)  # -> Box, Box_2

# ----
# Look at Rhino window
# to preview results
preview_9 = CustomPreview(
    Geometry=twnthrumshs,
    Shader={diffuse=RGB(255, 105, 180), emission=RGB(76, 32, 54), shine=0.5, specular=RGB(255, 255, 255), transparency=0})

# ---- group: Pf_Tween Through Meshes
twnthrumshs_2 = TweenThroughMeshes(Meshes=mesh_3, Factor=graph_12, Normalized=True, Equalized=False, Weighted=False, Degree=3, InterpolationType=0)

twnthrumshs_3 = TweenThroughMeshes(Meshes=mesh_4, Factor=graph_13, Normalized=True, Equalized=False, Weighted=False, Degree=3, InterpolationType=0)

# ---- group: Pf_Reparameterize Numbers
reparamnums_5 = ReparameterizeNumbers(Numbers=pull_5.Distance, Invert=toggle_7)  # -> Reparameterized, Original

# ---- group: Meshes to tween
mesh_5 = Mesh([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])

# ----
# Look at Rhino window
# to preview results
preview_10 = CustomPreview(
    Geometry=twnthrumshs_2,
    Shader={diffuse=RGB(255, 105, 180), emission=RGB(76, 32, 54), shine=0.5, specular=RGB(255, 255, 255), transparency=0})
# Look at Rhino window
# to preview results
preview_11 = CustomPreview(
    Geometry=twnthrumshs_3,
    Shader={diffuse=RGB(255, 105, 180), emission=RGB(76, 32, 54), shine=0.5, specular=RGB(255, 255, 255), transparency=0})

# ---- group: Make bounding boxes around mesh naked edges
# If you make the meshes to tween in the same place
# then you can just use one of them to get the bounding
# box. This will save a lot of computation time.
item_3 = ListItem(List=twnthrumshs_3, Index=0, Wrap=True)
nakededge_2 = MeshNakedEdge(Mesh=item_3)  # -> V, A, B
item_4 = ListItem(List=nakededge_2.V, Index=nakededge_2.A, Wrap=True)
bbox_2 = BoundingBox(Content=item_4, Plane=PlaneXY(0, 0, 0), UnionBox=True)  # -> Box, Box_2

# If you make the meshes to tween in the same place
# then you can just use one of them to get the bounding
# box. This will save a lot of computation time.
item_5 = ListItem(List=twnthrumshs_2, Index=0, Wrap=True)
nakededge_3 = MeshNakedEdge(Mesh=item_5)  # -> V, A, B
item_6 = ListItem(List=nakededge_3.V, Index=nakededge_3.A, Wrap=True)
bbox_3 = BoundingBox(Content=item_6, Plane=PlaneXY(0, 0, 0), UnionBox=True)  # -> Box, Box_2

# ----
# Look at Rhino window
# to preview results
preview_12 = CustomPreview(
    Geometry=mesh_5,
    Shader={diffuse=RGB(255, 105, 180), emission=RGB(76, 32, 54), shine=0.5, specular=RGB(255, 255, 255), transparency=0})

# ---- group: Graph map attractor values
graph_15 = GraphMapper(
    reparamnums_5.Reparameterized,
    x0=0,
    x1=1,
    y0=0,
    y1=1,
    container_name="Bezier",
    cpx=[0, 0.9202898741, 0.2942031622, 1],
    cpy=[0, 0.06666654348, 0.5536231399, 1])

# ---- group: Pf_Tween Through Meshes
twnthrumshs_4 = TweenThroughMeshes(Meshes=mesh_5, Factor=graph_14, Normalized=True, Equalized=False, Weighted=False, Degree=3, InterpolationType=0)

# ---- group: Morph tweened meshes to mesh twisted boxes
# Box Morphing,
# If using Rhino 6
# you can use Pufferfish's
# Multi-Threaded "Morph To Twisted Box" component.
morph = BoxMorph(Geometry=twnthrumshs, Reference=bbox.Box, Target=tboxmsh)

# ---- group: Make bounding boxes around mesh naked edges
# If you make the meshes to tween in the same place
# then you can just use one of them to get the bounding
# box. This will save a lot of computation time.
item_7 = ListItem(List=twnthrumshs_4, Index=0, Wrap=True)
nakededge_4 = MeshNakedEdge(Mesh=item_7)  # -> V, A, B
item_8 = ListItem(List=nakededge_4.V, Index=nakededge_4.A, Wrap=True)
bbox_4 = BoundingBox(Content=item_8, Plane=PlaneXY(0, 0, 0), UnionBox=True)  # -> flatten(Box), Box_2

# ----
# Look at Rhino window
# to preview results
preview_13 = CustomPreview(
    Geometry=twnthrumshs_4,
    Shader={diffuse=RGB(255, 105, 180), emission=RGB(76, 32, 54), shine=0.5, specular=RGB(255, 255, 255), transparency=0})

# ---- group: Meshes to tween
mesh_6 = Mesh([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])

# ---- group: Morph tweened meshes to mesh twisted boxes
# Box Morphing,
# If using Rhino 6
# you can use Pufferfish's
# Multi-Threaded "Morph To Twisted Box" component.
morph_2 = BoxMorph(Geometry=twnthrumshs_2, Reference=bbox_3.Box, Target=tboxsrf)

# Box Morphing,
# If using Rhino 6
# you can use Pufferfish's
# Multi-Threaded "Morph To Twisted Box" component.
morph_3 = BoxMorph(Geometry=twnthrumshs_3, Reference=bbox_2.Box, Target=tboxarray)

# ----
# Look at Rhino window
# to preview results
preview_14 = CustomPreview(
    Geometry=mesh_6,
    Shader={diffuse=RGB(255, 105, 180), emission=RGB(76, 32, 54), shine=0.5, specular=RGB(255, 255, 255), transparency=0})
mjoin = MeshJoin(Meshes=morph)

# ---- group: Pf_Tween Through Meshes
twnthrumshs_5 = TweenThroughMeshes(Meshes=mesh_6, Factor=graph_15, Normalized=True, Equalized=False, Weighted=False, Degree=3, InterpolationType=0)

# ---- group: Pf_Rebuild Mesh
rebmsh = RebuildMesh(
    Mesh=mjoin,
    RebuildNormals=False,
    CullUnused=False,
    UnifyNormals=False,
    FlipNormals=False,
    IdenticalCombine=False,
    WeldVertices="0.01")

# ---- group: Morph tweened meshes to mesh twisted boxes
# Box Morphing,
# If using Rhino 6
# you can use Pufferfish's
# Multi-Threaded "Morph To Twisted Box" component.
morph_4 = BoxMorph(Geometry=twnthrumshs_4, Reference=bbox_4.Box, Target=tboxtube)

# ----
mjoin_2 = MeshJoin(Meshes=morph_2)
mjoin_3 = MeshJoin(Meshes=morph_3)

# ---- group: Make bounding boxes around mesh naked edges
# If you make the meshes to tween in the same place
# then you can just use one of them to get the bounding
# box. This will save a lot of computation time.
item_9 = ListItem(List=twnthrumshs_5, Index=0, Wrap=True)
nakededge_5 = MeshNakedEdge(Mesh=item_9)  # -> V, A, B
item_10 = ListItem(List=nakededge_5.V, Index=nakededge_5.A, Wrap=True)
bbox_5 = BoundingBox(Content=item_10, Plane=PlaneXY(0, 0, 0), UnionBox=True)  # -> flatten(Box), Box_2

# ----
# Look at Rhino window
# to preview results
preview_15 = CustomPreview(
    Geometry=twnthrumshs_5,
    Shader={diffuse=RGB(255, 105, 180), emission=RGB(76, 32, 54), shine=0.5, specular=RGB(255, 255, 255), transparency=0})

# ---- group: Pf_Rebuild Mesh
rebmsh_2 = RebuildMesh(
    Mesh=mjoin_2,
    RebuildNormals=False,
    CullUnused=False,
    UnifyNormals=False,
    FlipNormals=False,
    IdenticalCombine=False,
    WeldVertices="0.01")

rebmsh_3 = RebuildMesh(
    Mesh=mjoin_3,
    RebuildNormals=False,
    CullUnused=False,
    UnifyNormals=False,
    FlipNormals=False,
    IdenticalCombine=False,
    WeldVertices="0.01")

# ---- group: Join and smooth morphed meshes
wbcatmullclark = WeaverbirdsCatmullClarkSubdivision(MeshCurves=rebmsh, Level=Slider(1, range=0..3), SmoothNakedEdges=1)

# ----
mjoin_4 = MeshJoin(Meshes=morph_4)

# ---- group: Morph tweened meshes to mesh twisted boxes
# Box Morphing,
# If using Rhino 6
# you can use Pufferfish's
# Multi-Threaded "Morph To Twisted Box" component.
morph_5 = BoxMorph(Geometry=twnthrumshs_5, Reference=bbox_5.Box, Target=tboxstrips)

# ---- group: Join and smooth morphed meshes
wbcatmullclark_2 = WeaverbirdsCatmullClarkSubdivision(MeshCurves=rebmsh_3, Level=Slider(1, range=0..3), SmoothNakedEdges=1)

wbcatmullclark_3 = WeaverbirdsCatmullClarkSubdivision(MeshCurves=rebmsh_2, Level=Slider(1, range=0..3), SmoothNakedEdges=1)

# ---- group: Pf_Rebuild Mesh
rebmsh_4 = RebuildMesh(
    Mesh=mjoin_4,
    RebuildNormals=False,
    CullUnused=False,
    UnifyNormals=False,
    FlipNormals=False,
    IdenticalCombine=False,
    WeldVertices="0.01")

# ----
# Look at Rhino window
# to preview results
preview_16 = CustomPreview(Geometry=wbcatmullclark, Shader=ColourSwatch(SwatchColor=RGB(255, 112, 77)))
mjoin_5 = MeshJoin(Meshes=morph_5)

# ---- group: Join and smooth morphed meshes
wbcatmullclark_4 = WeaverbirdsCatmullClarkSubdivision(MeshCurves=rebmsh_4, Level=Slider(1, range=0..3), SmoothNakedEdges=1)

# ---- group: Pf_Rebuild Mesh
rebmsh_5 = RebuildMesh(
    Mesh=mjoin_5,
    RebuildNormals=False,
    CullUnused=False,
    UnifyNormals=False,
    FlipNormals=False,
    IdenticalCombine=False,
    WeldVertices="0.01")

# ----
# Look at Rhino window
# to preview results
preview_17 = CustomPreview(Geometry=wbcatmullclark_3, Shader=ColourSwatch(SwatchColor=RGB(255, 112, 77)))
# Look at Rhino window
# to preview results
preview_18 = CustomPreview(Geometry=wbcatmullclark_2, Shader=ColourSwatch(SwatchColor=RGB(255, 112, 77)))

# ---- group: Join and smooth morphed meshes
wbcatmullclark_5 = WeaverbirdsCatmullClarkSubdivision(MeshCurves=rebmsh_5, Level=Slider(1, range=0..3), SmoothNakedEdges=1)

# ----
# Look at Rhino window
# to preview results
preview_19 = CustomPreview(Geometry=wbcatmullclark_4, Shader=ColourSwatch(SwatchColor=RGB(255, 112, 77)))
# Look at Rhino window
# to preview results
preview_20 = CustomPreview(Geometry=wbcatmullclark_5, Shader=ColourSwatch(SwatchColor=RGB(255, 112, 77)))
