# Grasshopper definition Pf_TweenMeshes.gh (Grasshopper 0.9.76)
# plug-ins: Pufferfish

# Slide to grow the squid :)
number_slider = Slider(1, range=0..1)
# Tween Mesh - Basic
# Tween factor of surface blend.
# 0 = surface A and 1 = surface B.
# Values can be lower than 0 and higher
# than 1 which will tween beyond
# surface A and B.
factor = Slider(0.518, range=0..1)
# Number of steps to do between
of_steps = Slider(9, range=0..100)
# Number of steps to do between
of_steps_2 = Slider(9, range=0..100)

# ---- group: Inputs
# Tween Mesh - Grow the Squid
mesh = Mesh(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)
mesh_2 = Mesh(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)

# ----
# Consider these sliders like percentages.
# 0=0% and 1=100%
weights = Slider(0.265, range=0..1)
weights_2 = Slider(0.105, range=0..1)
weights_3 = Slider(0.906, range=0..1)
# Pf_Tween Meshes
mesh_3 = Mesh(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)
mesh_4 = Mesh(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)
# Tween Mesh - Multiple
mesh_5 = Mesh(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)
mesh_6 = Mesh(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)
# Tween Mesh - Multiple Gradients
mesh_7 = Mesh(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)
mesh_8 = Mesh(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)
# Tween Mesh - To Weighted Average
mesh_9 = Mesh(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)
mesh_10 = Mesh(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)
mesh_11 = Mesh(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)
mesh_12 = Mesh(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)
twn2mshs = TweenTwoMeshes(MeshA=mesh, MeshB=mesh_2, Factor=number_slider)
mesh_b1 = Data(mesh_10)
mesh_b2 = Data(mesh_11)
mesh_b3 = Data(mesh_12)
mesh_a = Data(mesh_3)
mesh_b = Data(mesh_4)
factor_2 = Data(factor)
mesh_a_2 = Data(mesh_9)
# Setting to false will make the range
# never reach the start and end (0 or 1)
toggle = BooleanToggle(False)
# Setting to false will make the range
# never reach the start and end (0 or 1)
toggle_2 = BooleanToggle(False)

# ---- group: Output
preview = CustomPreview(Geometry=twn2mshs, Shader=ColourSwatch(SwatchColor=RGB(16, 82, 255)))

# ----
# Pufferfish
# By: Michael Pryor
twn2mshs_2 = TweenTwoMeshes(MeshA=mesh_a, MeshB=mesh_b, Factor=factor_2)
wavmsh = WeightedAverageMesh(Meshes=[mesh_b1, mesh_b2, mesh_b3], Weights=[weights_2, weights_3, weights])
faceb = FaceBoundaries(Mesh=[mesh_b1, mesh_b2, mesh_b3])
reparange = ReparameterizedRange(Steps=of_steps, Include=toggle)
# Use the graph to change the distribution
# of tweens as gradients between the surfaces
reparange_2 = ReparameterizedRange(Steps=of_steps_2, Include=toggle_2)
preview_2 = CustomPreview(
    Geometry=faceb,
    Shader={ambient=RGB(0, 0, 0), diffuse=RGB(255, 105, 180), emission=RGB(76, 32, 54), shine=0.5, specular=RGB(255, 255, 255), transparency=0})
twn2mshs_3 = TweenTwoMeshes(MeshA=mesh_a_2, MeshB=wavmsh, Factor=Slider(0.4, range=0..1))
preview_3 = CustomPreview(Geometry=twn2mshs_2, Shader=ColourSwatch(SwatchColor=RGB(0, 229, 255)))
mesh_a_3 = Data(mesh_5)
mesh_b_2 = Data(mesh_6)
factor_3 = Data(reparange)
graph = GraphMapper(
    reparange_2,
    x0=0,
    x1=1,
    y0=0,
    y1=1,
    container_name="Bezier",
    cpx=[0, 0.506944418, 0.9236111045, 1],
    cpy=[0, 0.0478259325, 0.5985505581, 0.9289851785])
# So we get a weighted average (blend)
# of multiple surfaces and then tween to that.
swatch = ColourSwatch(SwatchColor=RGB(0, 25, 255))
twn2mshs_4 = TweenTwoMeshes(MeshA=mesh_a_3, MeshB=mesh_b_2, Factor=factor_3)
preview_4 = CustomPreview(Geometry=twn2mshs_3, Shader=swatch)
mesh_a_4 = Data(mesh_7)
mesh_b_3 = Data(mesh_8)
factor_4 = Data(graph)
preview_5 = CustomPreview(Geometry=twn2mshs_4, Shader=ColourSwatch(SwatchColor=RGB(0, 195, 255)))
twn2mshs_5 = TweenTwoMeshes(MeshA=mesh_a_4, MeshB=mesh_b_3, Factor=factor_4)
preview_6 = CustomPreview(Geometry=twn2mshs_5, Shader=ColourSwatch(SwatchColor=RGB(0, 141, 217)))
