# Grasshopper definition Pf_TweenSurfaces.gh (Grasshopper 0.9.76)
# plug-ins: Pufferfish

# Tween Surface - Basic
# Tween factor of surface blend.
# 0 = surface A and 1 = surface B.
# Values can be lower than 0 and higher
# than 1 which will tween beyond
# surface A and B.
factor = Slider(0.582, range=0..1)
# Consider these sliders like percentages.
# 0=0% and 1=100%
weights = Slider(0.695, range=0..1)
# Number of steps to do between
of_steps = Slider(9, range=0..100)
weights_2 = Slider(0.215, range=0..1)
weights_3 = Slider(0.366, range=0..1)
# Number of steps to do between
of_steps_2 = Slider(9, range=0..100)
# Pf_Tween Surfaces
srf = Surface(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)
srf_2 = Surface(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)
# Tween Surface - Multiple
srf_3 = Surface(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)
srf_4 = Surface(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)
srf_5 = Surface(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)
# Tween Surface - Multiple Gradient
srf_6 = Surface(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)
srf_7 = Surface(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)
srf_8 = Surface(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)
srf_9 = Surface(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)
# Tween Surface - To Weighted Average
srf_10 = Surface(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)
surface_b1 = Data(srf_8)
surface_b2 = Data(srf_5)
surface_b3 = Data(srf_9)
surface_a = Data(srf)
surface_b = Data(srf_2)
surface_a_2 = Data(srf_10)
factor_2 = Data(factor)
# Setting to false will make the range
# never reach the start and end (0 or 1)
toggle = BooleanToggle(False)
# Setting to false will make the range
# never reach the start and end (0 or 1)
toggle_2 = BooleanToggle(False)
# Pufferfish
# By: Michael Pryor
twn2srfs = TweenTwoSurfaces(SurfaceA=surface_a, SurfaceB=surface_b, Factor=factor_2, Refit=0, PointSample=0)
wavsrf = WeightedAverageSurface(Surfaces=[surface_b1, surface_b2, surface_b3], Weights=[weights_2, weights_3, weights], Refit=0, PointSample=0)
wires = BrepWireframe(Brep=[surface_b1, surface_b3, surface_b2], Density=-1)
reparange = ReparameterizedRange(Steps=of_steps, Include=toggle)
# Use the graph to change the distribution
# of tweens as gradients between the surfaces
reparange_2 = ReparameterizedRange(Steps=of_steps_2, Include=toggle_2)
# Optional Refit and Sample Point
# match methods. Read input descriptions.
swatch = ColourSwatch(SwatchColor=RGB(0, 229, 255))
# So we get a weighted average (blend)
# of multiple surfaces and then tween to that.
preview = CustomPreview(
    Geometry=wires,
    Shader={ambient=RGB(0, 0, 0), diffuse=RGB(255, 105, 180), emission=RGB(76, 32, 54), shine=0.5, specular=RGB(255, 255, 255), transparency=0})
twn2srfs_2 = TweenTwoSurfaces(SurfaceA=surface_a_2, SurfaceB=wavsrf, Factor=Slider(0.59, range=0..1), Refit=0, PointSample=0)
surface_b_2 = Data(srf_4)
preview_2 = CustomPreview(Geometry=twn2srfs, Shader=swatch)
surface_a_3 = Data(srf_3)
factor_3 = Data(reparange)
graph = GraphMapper(
    reparange_2,
    x0=0,
    x1=1,
    y0=0,
    y1=1,
    container_name="Bezier",
    cpx=[0, 0.506944418, 0.9236111045, 1],
    cpy=[0, 0.0478259325, 0.5985505581, 0.9289851785])
twn2srfs_3 = TweenTwoSurfaces(SurfaceA=surface_a_3, SurfaceB=surface_b_2, Factor=factor_3, Refit=0, PointSample=0)
preview_3 = CustomPreview(Geometry=twn2srfs_2, Shader=ColourSwatch(SwatchColor=RGB(0, 25, 255)))
# Optional Refit and Sample Point
# match methods. Read input descriptions.
swatch_2 = ColourSwatch(SwatchColor=RGB(0, 195, 255))
surface_b_3 = Data(srf_7)
surface_a_4 = Data(srf_6)
factor_4 = Data(graph)
preview_4 = CustomPreview(Geometry=twn2srfs_3, Shader=swatch_2)
twn2srfs_4 = TweenTwoSurfaces(SurfaceA=surface_a_4, SurfaceB=surface_b_3, Factor=factor_4, Refit=0, PointSample=0)
# Optional Refit and Sample Point
# match methods. Read input descriptions.
swatch_3 = ColourSwatch(SwatchColor=RGB(0, 141, 217))
preview_5 = CustomPreview(Geometry=twn2srfs_4, Shader=swatch_3)
