# Grasshopper definition Pf_TweenTwistedBoxStrips.gh (Grasshopper 0.9.76)
# plug-ins: Pufferfish

# ---- group: Number of tweens
# Tween Twisted Box Strips - Curves
number_slider = Slider(30, range=0..100)
range = Range(Domain=Domain(0, 1), Steps=number_slider)

range_2 = Range(Domain=Domain(0, 1), Steps=Slider(30, range=0..100))

# ---- group: Interpolation type
number_slider_2 = Slider(1, range=0..3)

# Tween Twisted Box Strips - On Surface
number_slider_3 = Slider(1, range=0..3)

# ---- group: Equalize tween spacing
toggle = BooleanToggle(True)

toggle_2 = BooleanToggle(True)

# ----
srf = Surface(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)

# ---- group: Curves
# Pufferfish
# By: Michael Pryor
# Pf_Tween Twisted Box Strips
crv = Curve([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])

crv_2 = Curve([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])

# ---- group: Strip density
range_3 = Range(Domain=Domain(0, 1), Steps=Slider(21, range=0..100))

range_4 = Range(Domain=Domain(0, 1), Steps=Slider(21, range=0..100))

# ----
# Tween curves control the
# amount of twisted box strips
twnthrucrvs = TweenThroughCurves(Curves=crv, Factor=range, Normalized=True, Equalized=toggle_2, InterpolationType=number_slider_3, Refit=0, PointSample=0)
# Tween curves control the
# amount of twisted box strips
twnthrucrvssrf = TweenThroughCurvesOnSurface(
    Curves=crv_2,
    Surface=srf,
    Factor=range_2,
    Normalized=True,
    Equalized=toggle,
    InterpolationType=number_slider_2,
    Refit=3,
    PointSample=0)

# ---- group: Thickness
number_slider_4 = Slider(2.3, range=0..10)

number_slider_5 = Slider(2.3, range=0..10)

# ---- group: Weight the density
toggle_3 = BooleanToggle(False)

toggle_4 = BooleanToggle(False)

# ----
tboxstrips = TwistedBoxStrips(Rails=twnthrucrvs, Thickness=number_slider_4, ParametersT=range_3, Weighted=toggle_3)
mesh = Mesh(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)
mesh_2 = Mesh(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)
tboxstrips_2 = TwistedBoxStrips(Rails=twnthrucrvssrf, Thickness=number_slider_5, ParametersT=range_4, Weighted=toggle_4)
bbox = BoundingBox(Content=mesh, Plane=PlaneXY(0, 0, 0))  # -> Box, Box_2
bbox_2 = BoundingBox(Content=mesh_2, Plane=PlaneXY(0, 0, 0))  # -> Box, Box_2
morph = BoxMorph(Geometry=mesh, Reference=bbox.Box, Target=tboxstrips)
morph_2 = BoxMorph(Geometry=mesh_2, Reference=bbox_2.Box, Target=tboxstrips_2)
# Box Morphing,
# If using Rhino 6
# you can use Pufferfish's
# Multi-Threaded "Morph To Twisted Box" component.
preview = CustomPreview(Geometry=morph, Shader=ColourSwatch(SwatchColor=RGB(0, 229, 255)))
# Box Morphing,
# If using Rhino 6
# you can use Pufferfish's
# Multi-Threaded "Morph To Twisted Box" component.
preview_2 = CustomPreview(Geometry=morph_2, Shader=ColourSwatch(SwatchColor=RGB(0, 229, 255)))
