# Grasshopper definition Pf_TweenWaveSpacing.gh (Grasshopper 0.9.76)
# plug-ins: Pufferfish

# ---- group: Wave tween values
# Pf_Tween Wave Spacing
number_slider = Slider(75, range=0..100)
range = Range(Domain=Domain(0, 1), Steps=number_slider)
graph = GraphMapper(
    range,
    x0=0,
    x1=1,
    y0=0,
    y1=1,
    container_name="Sine",
    Equation_px=[0.001739059691, 0.0842897743],
    Equation_py=[0.2263767123, 0.8003363013])

# ---- group: Interpolation type
number_slider_2 = Slider(3, range=0..10)

# ----
linearnums = LinearizeNumbers(Numbers=graph, Domain=Domain(0, 1))  # -> Linearized, Actual, Original

# ---- group: Various tween types
# Pufferfish
# By: Michael Pryor
pt = Point([Point(15.90809817, 9.884687138, 0), Point(32.49745719, -10.10049015, 9.315465605), Point(20.29768924, -26.70962702, 0)])
crv = Curve([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])
srf = Surface([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])
mesh = Mesh([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])
pln = Plane([Plane(origin=(-28.84004676, 9.884687138, 0), x=(-1, 0, 0), y=(0, -1, 0)), Plane(origin=(-12.25068774, -10.10049015, 9.315465605), x=(0.7972377655, -0.4636253769, -0.3866050377), y=(-0.008870807101, 0.6313625918, -0.7754370293)), Plane(origin=(-24.45045569, -26.70962702, 0), x=(-0.6358715205, 0.771794927, 0), y=(-0.3309296156, -0.2726484854, 0.9034093164))])
twnthrupts = TweenThroughPoints(
    Points=pt,
    Factor=linearnums.Linearized,
    Normalized=True,
    Equalized=False,
    Weighted=False,
    Degree=3,
    InterpolationType=number_slider_2)
twnthrumshs = TweenThroughMeshes(
    Meshes=mesh,
    Factor=linearnums.Linearized,
    Normalized=True,
    Equalized=False,
    Weighted=False,
    Degree=3,
    InterpolationType=number_slider_2)
twnthruplns = TweenThroughPlanes(
    Planes=pln,
    Factor=linearnums.Linearized,
    Normalized=True,
    Equalized=False,
    Weighted=False,
    Degree=3,
    InterpolationType=number_slider_2,
    Quaternion=True)
twnthrucrvs = TweenThroughCurves(
    Curves=crv,
    Factor=linearnums.Linearized,
    Normalized=True,
    Equalized=False,
    InterpolationType=number_slider_2,
    Refit=0,
    PointSample=0)
twnthrusrfs = TweenThroughSurfaces(
    Surfaces=srf,
    Factor=linearnums.Linearized,
    Normalized=True,
    Equalized=False,
    Weighted=False,
    Degree=3,
    InterpolationType=number_slider_2,
    Refit=0,
    PointSample=0)

# ----
preview = CustomPreview(
    Geometry=[twnthrupts, twnthruplns, twnthrusrfs, twnthrumshs, twnthrucrvs],
    Shader=ColourSwatch(SwatchColor=RGB(0, 255, 229)))
