# Grasshopper definition Pf_TwistedBoxArrayAttractorCells.gh (Grasshopper 0.9.76)
# plug-ins: Pufferfish

# ---- group: Box that defines the twisted box array
# Pf_Twisted Box Array Attractor Cells
number_slider = Slider(34, range=0..100)
number_slider_2 = Slider(14, range=0..100)
# Pufferfish
# By: Michael Pryor
box = CenterBox(Base=PlaneXY(0, 0, 0), X=number_slider, Y=Slider(24, range=0..100), Z=number_slider_2)
Z = UnitZ(Factor=number_slider_2)
move = Move(Geometry=box, Motion=Z)  # -> Geometry, Transform

# ---- group: Parameters for number of divisions and spacing
range = Range(Domain=Domain(0, 1), Steps=Slider(20, range=0..100))
range_2 = Range(Domain=Domain(0, 1), Steps=Slider(14, range=0..100))
# Graphs in pufferfish twisted box
# components can change the spacing
# sizes like gradients. You can use a
# graph in the x and z inputs of the
# twisted box array as well.
range_3 = Range(Domain=Domain(0, 1), Steps=Slider(12, range=0..100))
graph = GraphMapper(
    range_2,
    x0=0,
    x1=1,
    y0=0,
    y1=1,
    container_name="Bezier",
    cpx=[0, 0.1417391151, 0.2377600223, 1],
    cpy=[0, 0.5188408494, 0.8820980787, 1])

# ----
tboxarray = TwistedBoxArray(Box=move.Geometry, ParametersX=range, ParametersY=graph, ParametersZ=range_3)
tboxcents = TwistedBoxCenters(TwistedBox=tboxarray, CenterType=0)  # -> flatten(Center)

# ---- group: Curve attractor
# Can be any geometry,
# not only curves.
geo = Geometry(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)

# ---- group: Remove twisted boxes based on distance to curve attractor
pull = PullPoint(Point=tboxcents, Geometry=geo, ClosestOnly=True)  # -> ClosestPoint, Distance
# The cells that will fill the twisted
# boxes.You can add or remove as
# many to the merge as you would like.
larger = LargerThan(FirstNumber=pull.Distance, SecondNumber=Slider(10, range=0..100))  # -> LargerThan, OrEqualTo
cull = CullPattern(List=tboxarray, CullPattern=larger.LargerThan)

# ----
tboxcents_2 = TwistedBoxCenters(TwistedBox=cull, CenterType=0)  # -> flatten(Center)

# ---- group: Point attractors
# Can be any geometry,
# not only points.
geo_2 = Geometry([Point(-27.82187019, 24.88162767, 26.41877081), Point(37.8617892, -11.68294139, 28.79939822)])

# ---- group: Cell Types
geo_3 = Geometry(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)
geo_4 = Geometry(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)
geo_5 = Geometry(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)
geo_6 = Geometry(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)

# ---- group: Attractor values to determine where cells go
pull_2 = PullPoint(Point=tboxcents_2, Geometry=geo_2, ClosestOnly=True)  # -> ClosestPoint, Distance
# Remaps the x input
# (attractor values)
# to the bounds of the
# y input (list of number
# of cells) before
# the rounding.
reparamnums = ReparameterizeNumbers(Numbers=pull_2.Distance, Invert=False)  # -> Reparameterized, Original
graph_2 = GraphMapper(
    reparamnums.Reparameterized,
    x0=0,
    x1=1,
    y0=0,
    y1=1,
    container_name="Bezier",
    cpx=[0, 0.2157212347, 0.8144734502, 1],
    cpy=[0.1592000127, 0.3883832693, 0.445438087, 0.4935059547])

# ----
merge = Merge(Data1=geo_3, Data2=geo_4, Data3=geo_5, Data4=geo_6)  # -> graft(Result)

# ---- group: Make list of number of cells so we can round attractor values to the nearest cell index
lng = ListLength(List=flatten(merge))
series = Series(Start=0, Step=1, Count=lng)

# ----
roundn = RoundToNearest(NumbersX=graph_2, NumbersY=series, RemapX=Toggle(True))  # -> Nearest, Index, Difference, RemappedX
panel = Panel(roundn.Nearest)

# ---- group: Group the twisted boxes by the cell it will bet filled with
equals = Equality(FirstNumber=roundn.Nearest, SecondNumber=graft(series))  # -> Equality, Inequality
cull_2 = CullPattern(List=cull, CullPattern=equals.Equality)

# ---- group: Morph the cells into their twisted box group
bbox = BoundingBox(Content=merge, Plane=PlaneXY(0, 0, 0))  # -> Box, Box_2
# Box Morphing,
# If using Rhino 6
# you can use Pufferfish's
# Multi-Threaded "Morph To Twisted Box" component.
morph = BoxMorph(Geometry=merge, Reference=bbox.Box, Target=cull_2)

# ----
# Now we have 4 groups of twisted boxes and 4 cells.
viewer = ParamViewer(cull_2)
viewer_2 = ParamViewer(merge)
# Pufferfish rebuild mesh has many useful
# mesh options for common mesh fixes. In
# this case we recompute the mesh normals
# which fixes occasional mesh display
# issues that occur with morphing meshes.
toggle = BooleanToggle(True)
rebmsh = RebuildMesh(
    Mesh=morph,
    RebuildNormals=toggle,
    CullUnused=False,
    UnifyNormals=False,
    FlipNormals=False,
    IdenticalCombine=False,
    WeldVertices=0)
preview = CustomPreview(
    Geometry=rebmsh,
    Shader={ambient=RGB(0, 0, 0), diffuse=RGB(255, 105, 180), emission=RGB(76, 32, 54), shine=0.5, specular=RGB(255, 255, 255), transparency=0})
