# Grasshopper definition Pf_TwistedBoxCurveCustom.gh (Grasshopper 0.9.76)
# plug-ins: Pufferfish

# ---- group: Initial parameters for frame locations and rectangle dimensions
# Number of twisted boxes
range = Range(Domain=Domain(0, 1), Steps=Slider(30, range=0..30))

# ---- group: Input rail curve
# Pufferfish
# By: Michael Pryor
# Pf_Twisted Box Curve Custom
# Twisted Box Curve Custom - Loft Twisted Box
crv = Curve(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)

# ---- group: Make variable frames using graph mappers to change parameters
graph = GraphMapper(
    range,
    x0=0,
    x1=1,
    y0=0,
    y1=1,
    container_name="Bezier",
    cpx=[0, 0.207272619, 0.7309088111, 1],
    cpy=[0, 0.3068181872, 0.4377275109, 1])
pframe = PerpFrame(Curve=reparameterize(crv), Parameter=graph)

# ---- group: Make variable rectange dimensions using graph mappers to change parameters
# Dimension multiplier
number_slider = Slider(7.64, range=0..10)
graph_2 = GraphMapper(
    range,
    x0=0,
    x1=1,
    y0=0,
    y1=1,
    container_name="Bezier",
    cpx=[0, 0.539773047, 0.4076704681, 1],
    cpy=[0.154545188, 0.3721584082, 0.8295454383, 1])
graph_3 = GraphMapper(
    range,
    x0=0,
    x1=1,
    y0=0,
    y1=1,
    container_name="Bezier",
    cpx=[0, 0.4750002027, 0.3659092188, 1],
    cpy=[0.1886360645, 0.625, 0.7522728443, 1])
# Rectangle Y dimensions
multiplication = Multiplication(A=graph_3, B=number_slider)
# Rectangle X dimensions
multiplication_2 = Multiplication(A=graph_2, B=number_slider)
neg = Negative(Value=multiplication)
neg_2 = Negative(Value=multiplication_2)
dom = ConstructDomain(DomainStart=neg, DomainEnd=multiplication)
dom_2 = ConstructDomain(DomainStart=neg_2, DomainEnd=multiplication_2)
rectangle = Rectangle(Plane=pframe, XSize=dom_2, YSize=dom, Radius=0)  # -> Rectangle, Length

# ---- group: Rotate rectangles on frames using graph mappers to change parameters
graph_4 = GraphMapper(
    range,
    x0=0,
    x1=1,
    y0=0,
    y1=1,
    container_name="Bezier",
    cpx=[0, 0.7585234046, 0.3039779663, 1],
    cpy=[0.1886360645, 0.5852265358, 0.6136356592, 1])
# Min and Max of rotation degree
dom_3 = ConstructDomain(DomainStart=Slider(0, range=0..1000), DomainEnd=Slider(360, range=0..1000))
bnd = Bounds(Numbers=graph_4)
remap = RemapNumbers(Value=graph_4, Source=bnd, Target=dom_3)  # -> Mapped, Clipped
rotate = Rotate(Geometry=rectangle.Rectangle, Angle=degrees(remap.Mapped), Plane=pframe)  # -> Geometry, Transform

# ----
tboxloft = TwistedBoxLoft(Sections=rotate.Geometry, Closed=False)
geo = Geometry(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)
bbox = BoundingBox(Content=geo, Plane=PlaneXY(0, 0, 0))  # -> Box, Box_2
# Look at Rhino window
# to preview results
preview = CustomPreview(Geometry=tboxloft, Shader=ColourSwatch(SwatchColor=RGB(255, 255, 255)))
morph = BoxMorph(Geometry=geo, Reference=bbox.Box, Target=tboxloft)
# Box Morphing,
# If using Rhino 6
# you can use Pufferfish's
# Multi-Threaded "Morph To Twisted Box" component.
preview_2 = CustomPreview(
    Geometry=morph,
    Shader={ambient=RGB(0, 0, 0), diffuse=RGB(255, 105, 180), emission=RGB(76, 32, 54), shine=0.5, specular=RGB(255, 255, 255), transparency=0})
