# Grasshopper definition Pf_TwistedBoxLatticeBunnies.gh (Grasshopper 0.9.76)
# plug-ins: Pufferfish

# ---- group: Rotate the twisted box array orientation
# Rotating the plane for the bounding box
# will allow the array to orient in different ways.
number_slider = Slider(314, range=0..1000)
# Twisted Box Lattice Bunnies - Many Bunnies
xy = XYPlane(Origin=Point(0, 0, 0))
rotate = Rotate(Geometry=xy, Angle=degrees(Slider(341, range=0..1000)), Plane=PlaneXY(0, 0, 0))  # -> Geometry, Transform
yz = YZPlane(Origin=Point(0, 0, 0))
rotate_2 = Rotate(Geometry=rotate.Geometry, Angle=degrees(number_slider), Plane=yz)  # -> Geometry, Transform

# Rotating the plane for the bounding box
# will allow the array to orient in different ways.
number_slider_2 = Slider(314, range=0..1000)
# Pf_Twisted Box Lattice Bunnies
# Twisted Box Lattice Bunnies - One Bunny
xy_2 = XYPlane(Origin=Point(0, 0, 0))
rotate_3 = Rotate(Geometry=xy_2, Angle=degrees(Slider(341, range=0..1000)), Plane=PlaneXY(0, 0, 0))  # -> Geometry, Transform
yz_2 = YZPlane(Origin=Point(0, 0, 0))
rotate_4 = Rotate(Geometry=rotate_3.Geometry, Angle=degrees(number_slider_2), Plane=yz_2)  # -> Geometry, Transform

# ---- group: Number of twisted boxes in each direction of the array
range = Range(Domain=Domain(0, 1), Steps=Slider(19, range=0..100))
range_2 = Range(Domain=Domain(0, 1), Steps=Slider(24, range=0..100))
# Can also change the domain of these
# ranges as well as use graph mappers
# to vary the spacing and coverage of
# the twisted boxes.
range_3 = Range(Domain=Domain(0, 1), Steps=Slider(26, range=0..100))

# Change bounding
# box to union box
range_4 = Range(Domain=Domain(0, 1), Steps=Slider(38, range=0..100))
range_5 = Range(Domain=Domain(0, 1), Steps=Slider(49, range=0..100))
# Can also change the domain of these
# ranges as well as use graph mappers
# to vary the spacing and coverage of
# the twisted boxes.
range_6 = Range(Domain=Domain(0, 1), Steps=Slider(45, range=0..100))

# ---- group: Input mesh
# Pufferfish
# By: Michael Pryor
mesh = Mesh(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)

# ---- group: Input meshes
# It can work for multiple meshes.
# The meshes can even intersect
# without having to boolean the
# meshes together.
mesh_2 = Mesh([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])

# ---- group: Bounding Box which the array goes in
bbox = BoundingBox(Content=mesh_2, Plane=rotate_2.Geometry, UnionBox=True)  # -> Box, Box_2

bbox_2 = BoundingBox(Content=mesh, Plane=rotate_4.Geometry)  # -> Box, Box_2

# ----
tboxarray = TwistedBoxArray(Box=bbox.Box, ParametersX=range_4, ParametersY=range_5, ParametersZ=range_6)
tboxarray_2 = TwistedBoxArray(Box=bbox_2.Box, ParametersX=range, ParametersY=range_2, ParametersZ=range_3)
mshbooltboxs = MeshBooleanTwistedBoxes(TwistedBoxes=tboxarray, Meshes=mesh_2, BooleanType=Toggle(True), KeepType=Slider(1, range=0..2))  # -> Trimmed, KeptIndicies, Intersected
mshbooltboxs_2 = MeshBooleanTwistedBoxes(TwistedBoxes=tboxarray_2, Meshes=mesh, BooleanType=Toggle(True), KeepType=Slider(1, range=0..2))  # -> Trimmed, KeptIndicies, Intersected
mesh_3 = Mesh(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)
mesh_4 = Mesh(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)
bbox_3 = BoundingBox(Content=mesh_4, Plane=PlaneXY(0, 0, 0))  # -> Box, Box_2
bbox_4 = BoundingBox(Content=mesh_3, Plane=PlaneXY(0, 0, 0))  # -> Box, Box_2
# Box Morphing,
# If using Rhino 6
# you can use Pufferfish's
# Multi-Threaded "Morph To Twisted Box" component.
morph = BoxMorph(Geometry=mesh_4, Reference=bbox_3.Box, Target=mshbooltboxs.Trimmed)
# Box Morphing,
# If using Rhino 6
# you can use Pufferfish's
# Multi-Threaded "Morph To Twisted Box" component.
morph_2 = BoxMorph(Geometry=mesh_3, Reference=bbox_4.Box, Target=mshbooltboxs_2.Trimmed)
rebmsh = RebuildMesh(
    Mesh=morph_2,
    RebuildNormals=Toggle(True),
    CullUnused=False,
    UnifyNormals=False,
    FlipNormals=False,
    IdenticalCombine=False,
    WeldVertices=0)
rebmsh_2 = RebuildMesh(
    Mesh=morph,
    RebuildNormals=Toggle(True),
    CullUnused=False,
    UnifyNormals=False,
    FlipNormals=False,
    IdenticalCombine=False,
    WeldVertices=0)
# Recompute mesh normals to fix
# display issues that the box morph
# component sometimes causes
# when morphing meshes.
swatch = ColourSwatch(SwatchColor=RGB(64, 255, 204))
# Recompute mesh normals to fix
# display issues that the box morph
# component sometimes causes
# when morphing meshes.
swatch_2 = ColourSwatch(SwatchColor=RGB(64, 255, 204))
# Look at Rhino window
# to preview results
preview = CustomPreview(Geometry=rebmsh_2, Shader=swatch)
# Look at Rhino window
# to preview results
preview_2 = CustomPreview(Geometry=rebmsh, Shader=swatch_2)
