# Grasshopper definition Pf_TwistedBoxPinchSpreadMap.gh (Grasshopper 0.9.76)
# plug-ins: Pufferfish

number_slider = Slider(100, range=0..100)
# Pf_Twisted Box Pinch Spread Map
# Twisted Box Pinch Spread Map
number_slider_2 = Slider(20, range=0..20)
range = Range(Domain=Domain(0, 1), Steps=Slider(3, range=0..10))
# Pufferfish
# By: Michael Pryor
range_2 = Range(Domain=Domain(0, 1), Steps=number_slider_2)
range_3 = Range(Domain=Domain(0, 1), Steps=number_slider_2)

# ---- group: Box as array size
box = CenterBox(Base=PlaneXY(0, 0, 0), X=number_slider, Y=number_slider, Z=Slider(39, range=0..100))

# ---- group: Pf_Twisted Box Array
tboxarray = TwistedBoxArray(Box=box, ParametersX=range_2, ParametersY=range_3, ParametersZ=range)
swatch = ColourSwatch(SwatchColor=RGB(255, 255, 255))

# ---- group: Pf_Deconstruct Twisted Box
detbox = DeconstructTwistedBox(TwistedBox=tboxarray, DeconstructType=0)

# ---- group: Using curve for pinch locations
crv = Curve(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)
divide = DivideCurve(Curve=crv, Count=Slider(69, range=0..100), Kinks=False)  # -> flatten(Points), Tangents, Parameters

# ---- group: Bottom of array as source surface for mapping
bbox = BoundingBox(Content=box, Plane=PlaneXY(0, 0, 0))  # -> Box, Box_2
debrep = DeconstructBrep(Brep=bbox.Box)  # -> Faces, Edges, Vertices
item = ListItem(List=debrep.Faces, Index=4, Wrap=True)

# ---- group: Pf_Pinch'n'Spread
p_n_s = PinchNSpread(Points=detbox, Locations=divide.Points, Radiuses=Slider(86.354, range=0..100), Strengths=Slider(0.504, range=-1..1))

# ---- group: Target surface for mapping
srf = Surface(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)

# ---- group: Pf_Map Point To Surface
mappt2srf = MapPointToSurface(Point=p_n_s, Source=item, Target=srf)

# ---- group: Pf_Construct Twisted Box
cotbox = ConstructTwistedBox(Corners=mappt2srf)  # -> flatten(TwistedBox)

# ---- group: Box morph geometry
geo = Geometry(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)
bbox_2 = BoundingBox(Content=geo, Plane=PlaneXY(0, 0, 0))  # -> Box, Box_2
morph = BoxMorph(Geometry=geo, Reference=bbox_2.Box, Target=cotbox)

# ----
# Look at Rhino window
# to preview results
preview = CustomPreview(Geometry=cotbox, Shader=swatch)
# Box Morphing,
# If using Rhino 6
# you can use Pufferfish's
# Multi-Threaded "Morph To Twisted Box" component.
preview_2 = CustomPreview(
    Geometry=morph,
    Shader={ambient=RGB(0, 0, 0), diffuse=RGB(255, 105, 180), emission=RGB(76, 32, 54), shine=0.5, specular=RGB(255, 255, 255), transparency=0})
