# Grasshopper definition Pf_TwistedBoxPipeCustom.gh (Grasshopper 0.9.76)
# plug-ins: Pufferfish

# ---- group: Initial parameters for radius
number_slider = Slider(6, range=0..10)
range = Range(Domain=Domain(0, 1), Steps=number_slider)
range_2 = Range(Domain=Domain(0, 1), Steps=number_slider)

# Twisted Box Pipe Custom - Twisted Box Two Surfaces
number_slider_2 = Slider(5, range=0..10)
range_3 = Range(Domain=Domain(0, 1), Steps=number_slider_2)
range_4 = Range(Domain=Domain(0, 1), Steps=number_slider_2)

# ---- group: Input rail curve
# Pufferfish
# By: Michael Pryor
# Pf_Twisted Box Pipe Custom
# Twisted Box Pipe Custom - Twisted Box Surface
crv = Curve(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)

crv_2 = Curve(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)

# ---- group: Make variable pipe using graph mappers to change parameters
graph = GraphMapper(
    range_4,
    x0=0,
    x1=1,
    y0=0,
    y1=1,
    container_name="Sine",
    Equation_px=[0.147818312, 0.4154545069],
    Equation_py=[0.04109054804, 1])
graph_2 = GraphMapper(
    range_3,
    x0=0,
    x1=1,
    y0=0,
    y1=1,
    container_name="Bezier",
    cpx=[0, 0.1539091617, 0.270272851, 1],
    cpy=[0, 0.2553634644, 0.5462726355, 1])
multiplication = Multiplication(A=graph, B=Slider(10, range=0..10))
# Using Grasshoppers
# native variable pipe.
vpipe = PipeVariable(Curve=reparameterize(crv), Parameters=graph_2, Radii=multiplication, Caps=0)

# ---- group: Inner variable pipe
graph_3 = GraphMapper(
    range_2,
    x0=0,
    x1=1,
    y0=0,
    y1=1,
    container_name="Sine",
    Equation_px=[0.147818312, 0.423363775],
    Equation_py=[0.04109054804, 1])
graph_4 = GraphMapper(
    range,
    x0=0,
    x1=1,
    y0=0,
    y1=1,
    container_name="Bezier",
    cpx=[0, 0.1539091617, 0.270272851, 1],
    cpy=[0, 0.2553634644, 0.5462726355, 1])
# Smaller radius multiplier to
# make it the inner (smaller) pipe
multiplication_2 = Multiplication(A=graph_3, B=Slider(10, range=0..10))
# Using Grasshoppers
# native variable pipe
# as inner surface.
vpipe_2 = PipeVariable(Curve=reparameterize(crv_2), Parameters=graph_4, Radii=multiplication_2, Caps=0)

# ---- group: Outer variable pipe
graph_5 = GraphMapper(range, x0=0, x1=1, y0=0, y1=1, container_name="Bezier", cpx=[0, 0.353545785, 1, 1], cpy=[0, 0.01254409552, 0, 1])
graph_6 = GraphMapper(
    range_2,
    x0=0,
    x1=1,
    y0=0,
    y1=1,
    container_name="Bezier",
    cpx=[0, 0.5860002637, 1, 1],
    cpy=[0.3522688746, 0.5593700409, 0.1451676488, 1])
# Larger radius multiplier to
# make it the outer (larger) pipe
multiplication_3 = Multiplication(A=graph_6, B=Slider(20, range=0..20))
# Using Grasshoppers
# native variable pipe
# as outer surface.
vpipe_3 = PipeVariable(Curve=reparameterize(crv_2), Parameters=graph_5, Radii=multiplication_3, Caps=0)

# ----
range_5 = Range(Domain=Domain(0, 1), Steps=Slider(10, range=0..10))
range_6 = Range(Domain=Domain(0, 1), Steps=Slider(10, range=0..10))
range_7 = Range(Domain=Domain(0, 1), Steps=Slider(5, range=0..10))
range_8 = Range(Domain=Domain(0, 1), Steps=Slider(6, range=0..10))
# Can also change the domain of these
# ranges as well as use graph mappers
# to vary the spacing and coverage of
# the twisted boxes.
range_9 = Range(Domain=Domain(0, 1), Steps=Slider(2, range=0..10))
# Can also change the domain of these
# ranges as well as use graph mappers
# to vary the spacing and coverage of
# the twisted boxes.
range_10 = Range(Domain=Domain(0, 1), Steps=Slider(2, range=0..10))
tbox2srfs = TwistedBoxTwoSurfaces(SurfaceA=vpipe_2, SurfaceB=vpipe_3, ParametersU=range_6, ParametersV=range_8, ParametersW=range_10)
tboxsrf = TwistedBoxSurface(Surface=vpipe, Thickness=Slider(6.196, range=0..10), ParametersU=range_5, ParametersV=range_7, ParametersW=range_9)

# ---- group: Box morph geometry
geo = Geometry(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)
bbox = BoundingBox(Content=geo, Plane=PlaneXY(0, 0, 0))  # -> Box, Box_2
morph = BoxMorph(Geometry=geo, Reference=bbox.Box, Target=tboxsrf)

geo_2 = Geometry(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)
bbox_2 = BoundingBox(Content=geo_2, Plane=PlaneXY(0, 0, 0))  # -> Box, Box_2
morph_2 = BoxMorph(Geometry=geo_2, Reference=bbox_2.Box, Target=tbox2srfs)

# ----
# Look at Rhino window
# to preview results
preview = CustomPreview(Geometry=tboxsrf, Shader=ColourSwatch(SwatchColor=RGB(255, 255, 255)))
# Look at Rhino window
# to preview results
preview_2 = CustomPreview(Geometry=tbox2srfs, Shader=ColourSwatch(SwatchColor=RGB(255, 255, 255)))
# Box Morphing,
# If using Rhino 6
# you can use Pufferfish's
# Multi-Threaded "Morph To Twisted Box" component.
preview_3 = CustomPreview(
    Geometry=morph_2,
    Shader={ambient=RGB(0, 0, 0), diffuse=RGB(255, 105, 180), emission=RGB(76, 32, 54), shine=0.5, specular=RGB(255, 255, 255), transparency=0})
# Box Morphing,
# If using Rhino 6
# you can use Pufferfish's
# Multi-Threaded "Morph To Twisted Box" component.
preview_4 = CustomPreview(
    Geometry=morph,
    Shader={ambient=RGB(0, 0, 0), diffuse=RGB(255, 105, 180), emission=RGB(76, 32, 54), shine=0.5, specular=RGB(255, 255, 255), transparency=0})
