# Grasshopper definition Pf_TwistedBoxSubdivideAttractor.gh (Grasshopper 0.9.76)
# plug-ins: Pufferfish

# ---- group: Number of twisted boxes in each surface direction
range = Range(Domain=Domain(0, 1), Steps=Slider(2, range=0..5))
range_2 = Range(Domain=Domain(0, 1), Steps=Slider(17, range=0..100))
range_3 = Range(Domain=Domain(0, 1), Steps=Slider(14, range=0..100))

range_4 = Range(Domain=Domain(0, 1), Steps=Slider(2, range=0..5))
range_5 = Range(Domain=Domain(0, 1), Steps=Slider(17, range=0..100))
range_6 = Range(Domain=Domain(0, 1), Steps=Slider(14, range=0..100))

# ---- group: Thickness of twisted boxes on surface
# Twisted Box Subdivide Attractor - Curve
number_slider = Slider(7, range=0..10)

# Twisted Box Subdivide Attractor - Points
number_slider_2 = Slider(7, range=0..10)

# ---- group: Surface to put twisted boxes on
srf = Surface(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)

# Pufferfish
# By: Michael Pryor
# Pf_Twisted Box Subdivide Attractor
srf_2 = Surface(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)

# ---- group: Pf_Twisted Box Surface
tboxsrf = TwistedBoxSurface(Surface=srf_2, Thickness=number_slider, ParametersU=range_3, ParametersV=range_2, ParametersW=range)

tboxsrf_2 = TwistedBoxSurface(Surface=srf, Thickness=number_slider_2, ParametersU=range_6, ParametersV=range_5, ParametersW=range_4)

# ---- group: Pf_Twisted Box Centers
tboxcents = TwistedBoxCenters(TwistedBox=tboxsrf, CenterType=0)  # -> flatten(Center)

tboxcents_2 = TwistedBoxCenters(TwistedBox=tboxsrf_2, CenterType=0)  # -> flatten(Center)

# ---- group: Attractor points
pt = Point([Point(45.28053813, 145.1058528, 10.0579063), Point(21.43746947, 146.1811461, 33.11244665), Point(63.79378305, 141.8860688, 44.06760025)])
cp = ClosestPoint(Point=tboxcents_2, Cloud=pt)  # -> ClosestPoint, CPIndex, Distance

# ---- group: Attractor curve
crv = Curve(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)
crv_cp = CurveClosestPoint(Point=tboxcents, Curve=crv)  # -> Point, Parameter, Distance

# ---- group: Remap attractor distances to the bounds of the resolutions
toggle = BooleanToggle(True)

toggle_2 = BooleanToggle(True)

# ---- group: Resolutions: Number of subdivision iterations
panel = Panel("""0
1
2""")

panel_2 = Panel("""0
1
2""")

# ---- group: Pf_Round To Nearest
roundn = RoundToNearest(NumbersX=crv_cp.Distance, NumbersY=panel, RemapX=toggle)  # -> Nearest, Index, Difference, RemappedX

roundn_2 = RoundToNearest(NumbersX=cp.Distance, NumbersY=panel_2, RemapX=toggle_2)  # -> Nearest, Index, Difference, RemappedX

# ---- group: Pf_Subdivide Twisted Box
subdivtbox = SubdivideTwistedBox(TwistedBox=tboxsrf, Steps=roundn.Nearest)

subdivtbox_2 = SubdivideTwistedBox(TwistedBox=tboxsrf_2, Steps=roundn_2.Nearest)

# ----
panel_3 = Panel(roundn.Nearest)
panel_4 = Panel(roundn_2.Nearest)

# ---- group: Box morph geometry
geo = Geometry(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)
bbox = BoundingBox(Content=geo, Plane=PlaneXY(0, 0, 0))  # -> Box, Box_2
morph = BoxMorph(Geometry=geo, Reference=bbox.Box, Target=subdivtbox)  # -> flatten(Geometry)

geo_2 = Geometry(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)
bbox_2 = BoundingBox(Content=geo_2, Plane=PlaneXY(0, 0, 0))  # -> Box, Box_2
morph_2 = BoxMorph(Geometry=geo_2, Reference=bbox_2.Box, Target=subdivtbox_2)  # -> flatten(Geometry)

# ----
# Box Morphing,
# If using Rhino 6
# you can use Pufferfish's
# Multi-Threaded "Morph To Twisted Box" component.
preview = CustomPreview(
    Geometry=morph,
    Shader={ambient=RGB(0, 0, 0), diffuse=RGB(255, 105, 180), emission=RGB(76, 32, 54), shine=0.5, specular=RGB(255, 255, 255), transparency=0})
# Box Morphing,
# If using Rhino 6
# you can use Pufferfish's
# Multi-Threaded "Morph To Twisted Box" component.
preview_2 = CustomPreview(
    Geometry=morph_2,
    Shader={ambient=RGB(0, 0, 0), diffuse=RGB(255, 105, 180), emission=RGB(76, 32, 54), shine=0.5, specular=RGB(255, 255, 255), transparency=0})
preview_3 = CustomPreview(Geometry=subdivtbox, Shader=ColourSwatch(SwatchColor=RGB(255, 255, 255)))
preview_4 = CustomPreview(Geometry=subdivtbox_2, Shader=ColourSwatch(SwatchColor=RGB(255, 255, 255)))
