# Grasshopper definition Pf_TwistedBoxSweepTower.gh (Grasshopper 0.9.76)
# plug-ins: Pufferfish

# ---- group: Curve cutting parameters for planar floor levels
series = Series(Start=0, Step=Slider(5.307, range=0..30), Count=Slider(15, range=0..100))
xy = XYPlane(Origin=Point(0, 0, 0))
Z = UnitZ(Factor=series)
move = Move(Geometry=xy, Motion=Z)  # -> Geometry, Transform

# ---- group: Rails
# Pufferfish
# By: Michael Pryor
# Pf_Twisted Box Sweep Tower
crv = Curve(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)
crv_2 = Curve(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)
crv_3 = Curve(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)
crv_4 = Curve(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)

# ---- group: get plane curve intersection parameters
pcx = CurvePlane(Curve=reparameterize(graft([crv, crv_3, crv_2, crv_4])), Plane=move.Geometry)  # -> Points, ParamsC, ParamsP
pshift = ShiftPaths(Data=pcx.ParamsC, Offset=-1)
bang = ExplodeTree(Data=pshift)  # -> Branch0, Branch1, Branch2, Branch3

# ---- group: Twisted Boxes at floor levels
# Use weighted distribution
# to line up twisted boxes
# with plane curve intersection parameters
toggle = BooleanToggle(True)
tboxsweepvar = TwistedBoxSweepVariable(R¹=crv, R²=crv_3, R³=crv_2, R⁴=crv_4, t¹=bang.Branch0, t²=bang.Branch1, t³=bang.Branch2, t⁴=bang.Branch3, W=toggle)

# ----
geo = Geometry(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)
bbox = BoundingBox(Content=geo, Plane=PlaneXY(0, 0, 0))  # -> Box, Box_2
# Box Morphing,
# If using Rhino 6
# you can use Pufferfish's
# Multi-Threaded "Morph To Twisted Box" component.
morph = BoxMorph(Geometry=geo, Reference=bbox.Box, Target=tboxsweepvar)
preview = CustomPreview(Geometry=morph, Shader=ColourSwatch(SwatchColor=RGB(0, 229, 255)))
