# Grasshopper definition Pf_TwistedBoxThickenAttractor.gh (Grasshopper 0.9.76)
# plug-ins: Pufferfish

# ---- group: Number of twisted boxes in each surface direction
range = Range(Domain=Domain(0, 1), Steps=Slider(1, range=0..5))
range_2 = Range(Domain=Domain(0, 1), Steps=Slider(17, range=0..100))
range_3 = Range(Domain=Domain(0, 1), Steps=Slider(14, range=0..100))

# Twisted Box Thicken Attractor - Points
number_slider = Slider(1, range=0..5)
range_4 = Range(Domain=Domain(0, 1), Steps=number_slider)
range_5 = Range(Domain=Domain(0, 1), Steps=Slider(17, range=0..100))
range_6 = Range(Domain=Domain(0, 1), Steps=Slider(14, range=0..100))

# ---- group: Thickness of twisted boxes on surface
# Twisted Box Thicken Attractor - Curve
number_slider_2 = Slider(4, range=0..10)

number_slider_3 = Slider(4, range=0..10)

# ---- group: Surface to put twisted boxes on
srf = Surface(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)

# Pufferfish
# By: Michael Pryor
# Pf_Twisted Box Thicken Attractor
srf_2 = Surface(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)

# ---- group: Pf_Twisted Box Surface
tboxsrf = TwistedBoxSurface(Surface=srf, Thickness=number_slider_3, ParametersU=range_3, ParametersV=range_2, ParametersW=range)

tboxsrf_2 = TwistedBoxSurface(Surface=srf_2, Thickness=number_slider_2, ParametersU=range_6, ParametersV=range_5, ParametersW=range_4)

# ---- group: Pf_Twisted Box Centers
tboxcents = TwistedBoxCenters(TwistedBox=tboxsrf, CenterType=0)  # -> flatten(Center)

tboxcents_2 = TwistedBoxCenters(TwistedBox=tboxsrf_2, CenterType=0)  # -> flatten(Center)

# ---- group: Attractor points
pt = Point([Point(63.79378305, 141.8860688, 44.06760025), Point(21.43746947, 146.1811461, 33.11244665), Point(45.28053813, 147.4800424, 10.0579063)])
cp = ClosestPoint(Point=tboxcents, Cloud=pt)  # -> ClosestPoint, CPIndex, Distance

# ---- group: Attractor curve
crv = Curve(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)
crv_cp = CurveClosestPoint(Point=tboxcents_2, Curve=crv)  # -> Point, Parameter, Distance

# ---- group: Number of thickness layers
range_7 = Range(Domain=Domain(0, 1), Steps=Slider(4, range=0..10))

range_8 = Range(Domain=Domain(0, 1), Steps=Slider(4, range=0..10))

# ---- group: Pf_Reparameterize Numbers
reparamnums = ReparameterizeNumbers(Numbers=cp.Distance, Invert=False)  # -> Reparameterized, Original

reparamnums_2 = ReparameterizeNumbers(Numbers=crv_cp.Distance, Invert=False)  # -> Reparameterized, Original

# ---- group: So thickness can't be zero
max = Maximum(A=reparamnums_2.Reparameterized, B="0.1")

max_2 = Maximum(A=reparamnums.Reparameterized, B="0.1")

# ---- group: Pf_Thicken Twisted Box
thicktbox = ThickenTwistedBox(TwistedBox=tboxsrf, Thickness=max_2, ParametersW=range_7, Hollow=True)

# ---- group: Box morph geometry
geo = Geometry(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)
bbox = BoundingBox(Content=geo, Plane=PlaneXY(0, 0, 0))  # -> Box, Box_2
morph = BoxMorph(Geometry=geo, Reference=bbox.Box, Target=thicktbox)  # -> flatten(Geometry)

# ---- group: Pf_Thicken Twisted Box
thicktbox_2 = ThickenTwistedBox(TwistedBox=tboxsrf_2, Thickness=max, ParametersW=range_8, Hollow=True)

# ---- group: Box morph geometry
geo_2 = Geometry(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)
bbox_2 = BoundingBox(Content=geo_2, Plane=PlaneXY(0, 0, 0))  # -> Box, Box_2
morph_2 = BoxMorph(Geometry=geo_2, Reference=bbox_2.Box, Target=thicktbox_2)  # -> flatten(Geometry)

# ----
# Box Morphing,
# If using Rhino 6
# you can use Pufferfish's
# Multi-Threaded "Morph To Twisted Box" component.
preview = CustomPreview(
    Geometry=morph,
    Shader={ambient=RGB(0, 0, 0), diffuse=RGB(255, 105, 180), emission=RGB(76, 32, 54), shine=0.5, specular=RGB(255, 255, 255), transparency=0})
# Box Morphing,
# If using Rhino 6
# you can use Pufferfish's
# Multi-Threaded "Morph To Twisted Box" component.
preview_2 = CustomPreview(
    Geometry=morph_2,
    Shader={ambient=RGB(0, 0, 0), diffuse=RGB(255, 105, 180), emission=RGB(76, 32, 54), shine=0.5, specular=RGB(255, 255, 255), transparency=0})
preview_3 = CustomPreview(Geometry=thicktbox, Shader=ColourSwatch(SwatchColor=RGB(255, 255, 255)))
preview_4 = CustomPreview(Geometry=thicktbox_2, Shader=ColourSwatch(SwatchColor=RGB(255, 255, 255)))
