# Grasshopper definition Pf_TwistedBoxWaveSpacing.gh (Grasshopper 0.9.76)
# plug-ins: Pufferfish

# ---- group: Wave tween values
# Pf_Twisted Box Wave Spacing
number_slider = Slider(75, range=0..100)
range = Range(Domain=Domain(0, 1), Steps=number_slider)
graph = GraphMapper(
    range,
    x0=0,
    x1=1,
    y0=0,
    y1=1,
    container_name="Sine",
    Equation_px=[0.001739059691, 0.1536232829],
    Equation_py=[0.2263767123, 0.807246089])

# ---- group: Interpolation type
number_slider_2 = Slider(3, range=0..10)

# ----
linearnums = LinearizeNumbers(Numbers=graph, Domain=Domain(0, 1))  # -> Linearized, Actual, Original
mesh = Mesh([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])
srf = Surface([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])
# Pufferfish
# By: Michael Pryor
B = Box({Plane=PlaneXY(-251.499111, -20.47808885, 0), X=Domain(0, 36.46779493), Y=Domain(0, 28.83576652), Z=Domain(0, 52.85680796)})
crv = Curve(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)

# ---- group: Various twisted box types
crv_2 = Curve(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)
tboxthrumshs = TwistedBoxThroughMeshes(
    Meshes=mesh,
    ParametersW=linearnums.Linearized,
    Normalized=True,
    Equalized=False,
    Weighted=False,
    Degree=3,
    InterpolationType=number_slider_2)
tboxthrusrfs = TwistedBoxThroughSurfaces(
    Surfaces=srf,
    ParametersU=[0, 0.25, 0.5, 0.75, 1],
    ParametersV=[0, 0.25, 0.5, 0.75, 1],
    ParametersW=linearnums.Linearized,
    Normalized=True,
    Equalized=False,
    Weighted=False,
    Degree=3,
    InterpolationType=number_slider_2)
tboxarray = TwistedBoxArray(Box=B, ParametersX=[0, 0.25, 0.5, 0.75, 1], ParametersY=[0, 0.25, 0.5, 0.75, 1], ParametersZ=linearnums.Linearized)
tboxcrv = TwistedBoxCurve(
    Curve=crv,
    ParametersT=linearnums.Linearized,
    Weighted=False,
    SizeX=Slider(8, range=0..10),
    SizeY=Slider(8, range=0..10),
    Rotation1=0,
    Rotation2=0)
tboxtube = TwistedBoxTube(
    Curve=crv_2,
    ParametersU=linearnums.Linearized,
    ParametersV=[0, 0.166667, 0.333333, 0.5, 0.666667, 0.833333, 1],
    ParametersW=[0, 0.5, 1],
    Weighted=False,
    Diameter=4,
    Thickness=2,
    Offset=Domain(0, 0),
    Rotation1=0,
    Rotation2=0)

# ----
preview = CustomPreview(Geometry=[tboxarray, tboxthrusrfs, tboxthrumshs, tboxcrv, tboxtube], Shader=ColourSwatch(SwatchColor=RGB(0, 72, 255)))
