# Grasshopper definition Random Extrusion Height.gh (Grasshopper 1.0.4)

populate_2d = Populate2D(Region={Plane=PlaneXY(0, 0, 0), Size=Domain2(u=0..20, v=0..10)}, Count=Slider(26, range=0..100), Seed=1)
circle = Circle(Plane=populate_2d, Radius=Slider(0.51, range=0..1))
list_length = ListLength(List=circle)
construct_domain = ConstructDomain(DomainStart=Slider(5, range=0..10), DomainEnd=Slider(8, range=0..100))
random = Random(Range=construct_domain, Number=list_length, Seed=2)
panel = Panel(list_length)
unit_z = UnitZ(Factor=random)
extrude = Extrude(Base=circle, Direction=unit_z)
