# Grasshopper definition Ripple.gh (Grasshopper 1.0.7)
# Copyright: Copyright <c> RMA 2013

point = Point([<point referenced from the Rhino model> x4])
circle = Circle(Plane=point, Radius=Slider(0.59, range=0..1))
R = Region({Plane=PlaneXY(0, 0, 0), Size=Domain2(u=0..30, v=0..30)})
area = Area(Geometry=circle)  # -> Area, Centroid
divide_curve = DivideCurve(Curve=circle, Count=10, Kinks=False)  # -> Points, Tangents, Parameters
number_slider = Slider(50, range=0..100)
boundary_surfaces = BoundarySurfaces(Edges=R)
divide_surface = DivideSurface(Surface=boundary_surfaces, UCount=number_slider, VCount=number_slider)  # -> Points, Normals, Parameters
addition = Addition(A=number_slider, B="1")
merge = Merge(Data1=area.Centroid, Data2=divide_curve.Points)
closest_point = ClosestPoint(Point=flatten(divide_surface.Points), Cloud=flatten(merge))  # -> ClosestPoint, CPIndex, Distance
graph_mapper = GraphMapper(
    closest_point.Distance,
    x0=0,
    x1=10,
    y0=0,
    y1=10,
    container_name="Sinc",
    Equation_X0=0.0213366244,
    Equation_X1=0.1156817153,
    Equation_Y0=1,
    Equation_Y1=0.2015626431)
negative = Negative(Value=Slider(0, range=0..1))
mass_addition = MassAddition(Input=graph_mapper)  # -> Result, PartialResults
bounds = Bounds(Numbers=graph_mapper)
construct_domain = ConstructDomain(DomainStart=negative, DomainEnd=Slider(3, range=0..10))
panel = Panel(mass_addition.Result)
remap_numbers = RemapNumbers(Value=graph_mapper, Source=bounds, Target=construct_domain)  # -> Mapped, Clipped
unit_z = UnitZ(Factor=remap_numbers.Mapped)
move = Move(Geometry=flatten(divide_surface.Points), Motion=unit_z)  # -> flatten(Geometry), Transform
number_slider_2 = Slider(11, range=0..100)
unflatten_tree = UnflattenTree(Tree=move.Geometry, Guide=divide_surface.Points)
surface_from_points = SurfaceFromPoints(Points=move.Geometry, UCount=addition, Interpolate=True)
