# Grasshopper definition SaltLoomScript_Haggar_Ababio.gh (Grasshopper 1.0.4)

square = Square(Plane=PlaneXY(0, 0, 0), Size=2, ExtentX=Slider(15, range=0..100), ExtentY=Slider(20, range=0..100))  # -> flatten(Cells), Points
polygon_center = PolygonCenter(Polyline=square.Cells)  # -> CenterV, CenterE, CenterA
curve = Curve([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])
point = Point(graft(polygon_center.CenterA))
curve_closest_point = CurveClosestPoint(Point=point, Curve=curve)  # -> Point, Parameter, Distance
graph_mapper = GraphMapper(
    curve_closest_point.Distance,
    x0=0,
    x1=30,
    y0=0,
    y1=1,
    container_name="Bezier",
    cpx=[0, 0.748945713, 0.3694658279, 1],
    cpy=[1, 1, 0.01308405399, 0])
graph_mapper_2 = GraphMapper(
    curve_closest_point.Distance,
    x0=0,
    x1=25,
    y0=0,
    y1=1,
    container_name="Bezier",
    cpx=[0, 0.4030533433, 0, 1],
    cpy=[1, 0.6728972197, 0, 0])
mass_addition = MassAddition(Input=graph_mapper_2)  # -> Result, PartialResults
vector = Vector(unitize(curve))
construct_domain = ConstructDomain(DomainStart=Slider(4.536, range=0..20), DomainEnd=Slider(1.101, range=0..20))
bounds = Bounds(Numbers=flatten(mass_addition.Result))
multiplication = Multiplication(A=graph_mapper, B=vector)
mass_addition_2 = MassAddition(Input=multiplication)  # -> Result, PartialResults
move = Move(Geometry=point, Motion=mass_addition_2.Result)  # -> Geometry, Transform
deconstruct = Deconstruct(Point=move.Geometry)  # -> XComponent, YComponent, ZComponent
remap_numbers = RemapNumbers(Value=mass_addition.Result, Source=bounds, Target=construct_domain)  # -> Mapped, Clipped
b = Slider(0.302, range=0..1)
a = Slider(0.078, range=0..1)
b_2 = Slider(0.293, range=0..1)
a_2 = Slider(0.183, range=0..1)
unit_z = UnitZ(Factor=remap_numbers.Mapped)
expression = Expression(Variable_x=deconstruct.XComponent, Variable_y=deconstruct.YComponent, a=a, b=b_2, Expression="y + Sin(a*x) + Cos(b*y)")
expression_2 = Expression(Variable_x=deconstruct.XComponent, Variable_y=deconstruct.YComponent, a=a_2, b=b, Expression="x + Sin(a*x) + Cos(b*y)")
construct_point = ConstructPoint(XCoordinate=expression_2, YCoordinate=expression, ZCoordinate=0)
move_2 = Move(Geometry=construct_point, Motion=unit_z)  # -> Geometry, Transform
xy_plane = XYPlane(Origin=point)
curve_2 = Curve(graft(square.Cells))
vector_2pt = Vector2Pt(PointA=point, PointB=move_2.Geometry, Unitize=False)  # -> Vector, Length
adjust_plane = AdjustPlane(Plane=xy_plane, Normal=vector_2pt.Vector)
number_slider = Slider(0.795, range=0..2)
number_slider_2 = Slider(0, range=0..1)
move_3 = Move(Geometry=adjust_plane, Motion=vector_2pt.Vector)  # -> Geometry, Transform
construct_domain_2 = ConstructDomain(DomainStart=expr("-x/2", number_slider), DomainEnd=expr("x/2", number_slider))
rectangle = Rectangle(Plane=move_3.Geometry, XSize=construct_domain_2, YSize=construct_domain_2, Radius=0)  # -> Rectangle, Length
offset_curve = Offset(Curve=curve_2, Distance=expr("-x", number_slider_2), Plane=PlaneXY(0, 0, 0), Corners=1)
offset_curve_2 = Offset(Curve=rectangle.Rectangle, Distance=expr("-x", number_slider_2), Plane=PlaneXY(0, 0, 0), Corners=1)
loft = Loft(
    Curves=[offset_curve_2, offset_curve],
    Options={Adjust=False, Closed=False, LoftEnds=0, LoftSimp=0, LoftType=0, Rebuild=10, Refit=0.01})
shift_paths = ShiftPaths(Data=offset_curve, Offset=-1)
shift_paths_2 = ShiftPaths(Data=offset_curve_2, Offset=-1)
loft_2 = Loft(
    Curves=[rectangle.Rectangle, curve_2],
    Options={Adjust=False, Closed=False, LoftEnds=0, LoftSimp=0, LoftType=0, Rebuild=10, Refit=0.01})
shift_paths_3 = ShiftPaths(Data=loft, Offset=-1)
boundary_surfaces = BoundarySurfaces(Edges=[curve_2, shift_paths])
boundary_surfaces_2 = BoundarySurfaces(Edges=[rectangle.Rectangle, shift_paths_2])
merge = Merge(Data1=loft_2, Data2=shift_paths_3, Data3=boundary_surfaces, Data4=boundary_surfaces_2)
brep_join = BrepJoin(Breps=merge)  # -> Breps, Closed
panel = Panel(brep_join.Breps)
