# Grasshopper definition Stairs.gh (Grasshopper 1.0.4)
# plug-ins: LunchBox

number_slider = Slider(10, range=0..10)
height_of_rails = Slider(0.28, range=0..1)
width_x_2 = Slider(0.092, range=0..10)
length_x_2 = Slider(0.263, range=0..10)
stair_depth = Slider(0.4864, range=0..12)
point = Point(<point referenced from the Rhino model>)
point_2 = Point(<point referenced from the Rhino model>)
point_3 = Point(<point referenced from the Rhino model>)
point_4 = Point(<point referenced from the Rhino model>)
line = Line(StartPoint=point_2, EndPoint=point)
line_2 = Line(StartPoint=point, EndPoint=point_4)
line_3 = Line(StartPoint=point_2, EndPoint=point_3)
divide_curve = DivideCurve(Curve=line_3, Count=number_slider, Kinks=False)  # -> Points, Tangents, Parameters
divide_curve_2 = DivideCurve(Curve=line_2, Count=number_slider, Kinks=False)  # -> Points, Tangents, Parameters
panel = Panel(divide_curve.Points)
line_4 = Line(StartPoint=divide_curve.Points, EndPoint=divide_curve_2.Points)
project = Project(Geometry=divide_curve.Points, Plane=PlaneXY(0, 0, 0))  # -> Geometry, Transform
list_item = ListItem(List=project.Geometry, Index=0, Wrap=True)
list_item_2 = ListItem(List=project.Geometry, Index=Slider(1, range=0..1), Wrap=True)
distance = Distance(PointA=list_item, PointB=list_item_2)
unit_y = UnitY(Factor=distance)
negative = Negative(Value=unit_y)
move = Move(Geometry=line_4, Motion=negative)  # -> Geometry, Transform
division = Division(A=stair_depth, B=Slider(12, range=0..100))
edge_surface = EdgeSurface(CurveA=line_4, CurveB=move.Geometry)
unit_z = UnitZ(Factor=division)
explode = Explode(Curve=edge_surface, Recursive=True)  # -> Segments, Vertices
number_slider_2 = Slider(0.5, range=0..1)
extrude = Extrude(Base=edge_surface, Direction=unit_z)
list_item_3 = ListItem(List=explode.Segments, Index=0, Wrap=True)
list_item_4 = ListItem(List=explode.Segments, Index=Slider(2, range=0..10), Wrap=True)
evaluate_length = EvaluateLength(Curve=list_item_3, Length=number_slider_2, Normalized=True)  # -> Point, Tangent, Parameter
evaluate_length_2 = EvaluateLength(Curve=list_item_4, Length=number_slider_2, Normalized=True)  # -> Point, Tangent, Parameter
unit_z_2 = UnitZ(Factor=height_of_rails)
unit_z_3 = UnitZ(Factor=height_of_rails)
number_slider_3 = Slider(0.149, range=0..10)
number_slider_4 = Slider(12, range=0..100)
division_2 = Division(A=number_slider_3, B=number_slider_4)
unit_x = UnitX(Factor=division_2)
negative_2 = Negative(Value=unit_x)
move_2 = Move(Geometry=evaluate_length_2.Point, Motion=negative_2)  # -> Geometry, Transform
move_3 = Move(Geometry=move_2.Geometry, Motion=unit_z_2)  # -> Geometry, Transform
line_5 = Line(StartPoint=move_2.Geometry, EndPoint=move_3.Geometry)
division_3 = Division(A=number_slider_3, B=number_slider_4)
unit_x_2 = UnitX(Factor=division_3)
move_4 = Move(Geometry=evaluate_length.Point, Motion=unit_x_2)  # -> Geometry, Transform
move_5 = Move(Geometry=move_4.Geometry, Motion=unit_z_3)  # -> Geometry, Transform
line_6 = Line(StartPoint=move_4.Geometry, EndPoint=move_5.Geometry)
number_slider_5 = Slider(12, range=0..100)
circle = Circle(Plane=line_6, Radius=division_3)
polyline = PolyLine(Vertices=flatten(move_2.Geometry), Closed=False)
panel_2 = Panel(polyline)
division_4 = Division(A=length_x_2, B=number_slider_5)
division_5 = Division(A=length_x_2, B=number_slider_5)
division_6 = Division(A=width_x_2, B=number_slider_5)
division_7 = Division(A=width_x_2, B=number_slider_5)
negative_3 = Negative(Value=division_4)
number_slider_6 = Slider(0.092, range=0..10)
negative_4 = Negative(Value=division_6)
number_slider_7 = Slider(12, range=0..100)
circle_2 = Circle(Plane=line_5, Radius=division_2)
number_slider_8 = Slider(0.263, range=0..10)
construct_domain = ConstructDomain(DomainStart=negative_3, DomainEnd=division_5)
construct_domain_2 = ConstructDomain(DomainStart=negative_4, DomainEnd=division_7)
polyline_2 = PolyLine(Vertices=flatten(move_4.Geometry), Closed=False)
perp_frame = PerpFrame(Curve=polyline, Parameter=Slider(0, range=0..100))
rectangle = Rectangle(Plane=PlaneXY(0, 0, 0), XSize=construct_domain, YSize=construct_domain_2, Radius=0)  # -> Rectangle, Length
panel_3 = Panel(polyline_2)
division_8 = Division(A=number_slider_8, B=number_slider_7)
division_9 = Division(A=number_slider_8, B=number_slider_7)
division_10 = Division(A=number_slider_6, B=number_slider_7)
division_11 = Division(A=number_slider_6, B=number_slider_7)
negative_5 = Negative(Value=division_8)
negative_6 = Negative(Value=division_10)
construct_domain_3 = ConstructDomain(DomainStart=negative_5, DomainEnd=division_9)
area = Area(Geometry=rectangle.Rectangle)  # -> Area, Centroid
construct_domain_4 = ConstructDomain(DomainStart=negative_6, DomainEnd=division_11)
perp_frame_2 = PerpFrame(Curve=polyline_2, Parameter=Slider(0, range=0..100))
rectangle_2 = Rectangle(Plane=PlaneXY(0, 0, 0), XSize=construct_domain_3, YSize=construct_domain_4, Radius=0)  # -> Rectangle, Length
orient = Orient(Geometry=rectangle.Rectangle, Source=area.Centroid, Target=perp_frame)  # -> Geometry, Transform
area_2 = Area(Geometry=rectangle_2.Rectangle)  # -> Area, Centroid
sweep1 = Sweep1(Rail=polyline, Sections=orient.Geometry, Miter=1)
extrude_along = ExtrudeAlong(Base=circle, Curve=line_6)
unit_z_4 = UnitZ(Factor=height_of_rails)
orient_2 = Orient(Geometry=rectangle_2.Rectangle, Source=area_2.Centroid, Target=perp_frame_2)  # -> Geometry, Transform
extrude_along_2 = ExtrudeAlong(Base=circle_2, Curve=line_5)
move_6 = Move(Geometry=sweep1, Motion=unit_z_4)  # -> Geometry, Transform
sweep1_2 = Sweep1(Rail=polyline_2, Sections=orient_2.Geometry, Miter=1)
cap_holes = CapHoles(Brep=extrude_along)
unit_z_5 = UnitZ(Factor=height_of_rails)
cap_holes_2 = CapHoles(Brep=extrude_along_2)
move_7 = Move(Geometry=sweep1_2, Motion=unit_z_5)  # -> Geometry, Transform
object_bake = ObjectBake(
    BakeToggle=Toggle(False),
    GeometryObjects=[cap_holes_2, cap_holes, move_7.Geometry, move_6.Geometry, extrude],
    Layer="GH_Bake",
    ObjectName="GH_Obj",
    ObjectColor=RGB(255, 255, 255),
    LayerColor=RGB(255, 255, 255))
