# Grasshopper definition Surface Manipulation.gh (Grasshopper 1.0.5)

number_slider = Slider(45, range=0..100)
curve = Curve(<curve referenced from the Rhino model>)
divide_curve = DivideCurve(Curve=curve, Count=Slider(54, range=0..100), Kinks=False)  # -> Points, Tangents, Parameters
point = Point(<point referenced from the Rhino model>)
plane_surface = PlaneSurface(Plane=PlaneXY(0, 0, 0), XSize=number_slider, YSize=number_slider)
number_slider_2 = Slider(23, range=0..100)
divide_surface = DivideSurface(Surface=plane_surface, UCount=number_slider_2, VCount=number_slider_2)  # -> flatten(Points), Normals, Parameters
closest_point = ClosestPoint(Point=divide_surface.Points, Cloud=divide_curve.Points)  # -> ClosestPoint, CPIndex, Distance
graph_mapper = GraphMapper(closest_point.Distance, x0=0, x1=7, y0=0, y1=7, container_name="Bezier", cpx=[0, 0.25, 0.75, 1], cpy=[0, 0.25, 0.75, 1])
graph_mapper_2 = GraphMapper(
    closest_point.Distance,
    x0=0,
    x1=30,
    y0=0,
    y1=30,
    container_name="Gaussian",
    factor=0.2439281344,
    mean=0.04271749035,
    sdev=0.07134060189)
bounds = Bounds(Numbers=graph_mapper)
construct_domain = ConstructDomain(DomainStart=Slider(3, range=0..100), DomainEnd=Slider(0, range=0..100))
remap_numbers = RemapNumbers(Value=graph_mapper, Source=bounds, Target=construct_domain)  # -> Mapped, Clipped
amplitude = Amplitude(Vector=divide_surface.Normals, Amplitude=remap_numbers.Mapped)
move = Move(Geometry=divide_surface.Points, Motion=amplitude)  # -> Geometry, Transform
_1 = Number(1)
addition = Addition(A=number_slider_2, B=_1)
surface_from_points = SurfaceFromPoints(Points=move.Geometry, UCount=addition, Interpolate=False)
