# Grasshopper definition Sweep 1 (Pipe of any Shape).gh (Grasshopper 1.0.4)

curve = Curve()
perp_frame = PerpFrame(Curve=curve)
polygon = Polygon(Plane=perp_frame, Radius=3, Segments=6, FilletRadius=0)  # -> Polygon, Length
sweep1 = Sweep1(Rail=curve, Sections=polygon.Polygon, Miter=1)
perp_frame_2 = PerpFrame(Parameter=Slider(0, range=0..10))
polygon_2 = Polygon(Plane=perp_frame_2, Radius=Slider(0.11, range=0..1), Segments=6, FilletRadius=0)  # -> Polygon, Length
radians = Radians(Degrees=Slider(55, range=0..90))
rotate = Rotate(Geometry=polygon_2.Polygon, Angle=radians, Plane=perp_frame_2)  # -> Geometry, Transform
sweep1_2 = Sweep1(Sections=rotate.Geometry, Miter=1)
