# Grasshopper definition Triangular Trusses.gh (Grasshopper 1.0.7)

center_line = Curve(<curve referenced from the Rhino model>)

number_of_divisions = Slider(37, range=0..100)
exterior_truss = Slider(0.41, range=0..1)
# Units for this are in Feet
triangulated_trusses = Slider(0.19, range=0..1)
fillet_radius = Slider(0.75, range=0..2)

perp_frames = PerpFrames(Curve=center_line, Count=Slider(2, range=0..100), Align=True)  # -> Frames, Parameters
multiplication = Multiplication(A=exterior_truss, B="12")
panel = Panel(multiplication)
polygon = Polygon(Plane=perp_frames.Frames, Radius=3, Segments="3", FilletRadius=0)  # -> Polygon, Length
list_length = ListLength(List=polygon.Polygon)
list_item = ListItem(List=polygon.Polygon, Index=0, Wrap=True)
explode = Explode(Curve=polygon.Polygon, Recursive=True)  # -> Segments, Vertices
subtraction = Subtraction(A=list_length, B="1")
list_item_2 = ListItem(List=explode.Vertices, Index=0, Wrap=True)  # -> flatten(Item), flatten(Item1), flatten(Item2)
list_item_3 = ListItem(List=polygon.Polygon, Index=subtraction, Wrap=True)
polyline = PolyLine(Vertices=list_item_2.Item, Closed=False)
polyline_2 = PolyLine(Vertices=list_item_2.Item1, Closed=False)
polyline_3 = PolyLine(Vertices=list_item_2.Item2, Closed=False)
panel_2 = Panel("""1
0""")
divide_curve = DivideCurve(Curve=polyline_2, Count=number_of_divisions, Kinks=False)  # -> Points, Tangents, Parameters
divide_curve_2 = DivideCurve(Curve=polyline, Count=number_of_divisions, Kinks=False)  # -> Points, Tangents, Parameters
divide_curve_3 = DivideCurve(Curve=polyline_3, Count=number_of_divisions, Kinks=False)  # -> Points, Tangents, Parameters
divide_curve_4 = DivideCurve(Curve=polyline_3, Count=number_of_divisions, Kinks=False)  # -> Points, Tangents, Parameters
divide_curve_5 = DivideCurve(Curve=polyline, Count=number_of_divisions, Kinks=False)  # -> Points, Tangents, Parameters
divide_curve_6 = DivideCurve(Curve=polyline_2, Count=number_of_divisions, Kinks=False)  # -> Points, Tangents, Parameters
reverse_list = ReverseList(List=panel_2)
reverse_list_2 = ReverseList(List=panel_2)
reverse_list_3 = ReverseList(List=panel_2)
cull_pattern = CullPattern(List=divide_curve_2.Points, CullPattern=reverse_list_3)
cull_pattern_2 = CullPattern(List=divide_curve_6.Points, CullPattern=panel_2)
cull_pattern_3 = CullPattern(List=divide_curve.Points, CullPattern=reverse_list)
cull_pattern_4 = CullPattern(List=divide_curve_3.Points, CullPattern=panel_2)
cull_pattern_5 = CullPattern(List=divide_curve_4.Points, CullPattern=reverse_list_2)
cull_pattern_6 = CullPattern(List=divide_curve_5.Points, CullPattern=panel_2)
weave = Weave(Pattern=[0, 1], Stream0=cull_pattern_2, Stream1=cull_pattern, NullGaps=False)
weave_2 = Weave(Pattern=[0, 1], Stream0=cull_pattern_4, Stream1=cull_pattern_3, NullGaps=False)
weave_3 = Weave(Pattern=[0, 1], Stream0=cull_pattern_6, Stream1=cull_pattern_5, NullGaps=False)
polyline_4 = PolyLine(Vertices=weave, Closed=False)
polyline_5 = PolyLine(Vertices=weave_2, Closed=False)
polyline_6 = PolyLine(Vertices=weave_3, Closed=False)

divide_curve_7 = DivideCurve(Curve=polyline_2, Count=10, Kinks=False)  # -> Points, Tangents, Parameters
circle = Circle(Plane=divide_curve_7.Points, Radius=Slider(0.09, range=0..1))
unit_z = UnitZ(Factor=Slider(5, range=0..100))
negative = Negative(Value=unit_z)
extrude = Extrude(Base=circle, Direction=negative)
cap_holes = CapHoles(Brep=extrude)

multiplication_2 = Multiplication(A=triangulated_trusses, B=fillet_radius)
fillet = Fillet(Curve=polyline_4, Radius=multiplication_2)
fillet_2 = Fillet(Curve=polyline_6, Radius=multiplication_2)
fillet_3 = Fillet(Curve=polyline_5, Radius=multiplication_2)

pipe = Pipe(Curve=list_item_3, Radius=triangulated_trusses, Caps=0)
pipe_2 = Pipe(Curve=list_item, Radius=triangulated_trusses, Caps=0)
pipe_3 = Pipe(Curve=fillet, Radius=triangulated_trusses, Caps=0)
pipe_4 = Pipe(Curve=[polyline_3, polyline_2, polyline], Radius=exterior_truss, Caps=0)
pipe_5 = Pipe(Curve=fillet_3, Radius=triangulated_trusses, Caps=0)
pipe_6 = Pipe(Curve=fillet_2, Radius=triangulated_trusses, Caps=0)

merge = Merge(Data1=pipe, Data2=pipe_2, Data3=pipe_3, Data4=pipe_4, Data5=pipe_5, Data6=pipe_6)  # -> flatten(Result)
custom_preview = CustomPreview(
    Geometry=merge,
    Material={diffuse=RGB(221, 160, 221), emission=RGB(66, 48, 66), shine=0.5, specular=RGB(255, 255, 255), transparency=0})
