# Grasshopper definition Twisted Box Ripple Example.gh (Grasshopper 1.0.7)
# plug-ins: MeshEdit Components, Pufferfish, Weaverbird

mesh = Mesh(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)
mesh_2 = Mesh(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)

weaverbird_s_catmull_clark_subdivision = WeaverbirdsCatmullClarkSubdivision(MeshCurves=mesh, Level="1", SmoothNakedEdges=1)
curve = Curve(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)
point = Point(Point(-316.8407555, 50.1453275, 10.18274135))

mesh_explode = MeshExplode(Mesh=weaverbird_s_catmull_clark_subdivision, Interpolate=False)
face_normals = FaceNormals(Mesh=mesh_explode)  # -> Centers, Normals

bounding_box = BoundingBox(Content=mesh_2, Plane=PlaneXY(0, 0, 0), UnionBox=True)  # -> Box, Box_2
divide_curve = DivideCurve(Curve=curve, Count=Slider(62, range=0..100), Kinks=False)  # -> Points, Tangents, Parameters

closest_point = ClosestPoint(Point=flatten(face_normals.Centers), Cloud=divide_curve.Points)  # -> ClosestPoint, CPIndex, Distance
graph_mapper = GraphMapper(
    closest_point.Distance,
    x0=0,
    x1=50,
    y0=0,
    y1=1,
    container_name="Sine",
    Equation_px=[0, 0.2316461056],
    Equation_py=[0, 1])
construct_domain = ConstructDomain(DomainStart=Slider(2, range=0..100), DomainEnd="0")
bounds = Bounds(Numbers=graph_mapper)
remap_numbers = RemapNumbers(Value=graph_mapper, Source=bounds, Target=construct_domain)  # -> Mapped, Clipped

graph_mapper_2 = GraphMapper(closest_point.Distance, x0=0, x1=50, y0=0, y1=1, container_name="Bezier", cpx=[0, 0, 0, 1], cpy=[0, 1, 0.992561698, 1])
panel = Panel(graph_mapper)

panel_2 = Panel("""0
1""")
twisted_box_mesh = TwistedBoxMesh(Mesh=mesh_explode, Thickness=remap_numbers.Mapped, ParametersW=panel_2)  # -> flatten(TwistedBoxes)
box_morph = BoxMorph(Geometry=mesh_2, Reference=bounding_box.Box, Target=twisted_box_mesh)

weaverbird_s_join_meshes_and_weld = WeaverbirdsJoinMeshesAndWeld(Mesh=box_morph, Weld=True)
weaverbird_s_catmull_clark_subdivision_2 = WeaverbirdsCatmullClarkSubdivision(MeshCurves=weaverbird_s_join_meshes_and_weld, Level=Slider(0, range=0..10), SmoothNakedEdges=1)
custom_preview = CustomPreview(
    Geometry=weaverbird_s_catmull_clark_subdivision_2,
    Material={diffuse=RGB(221, 160, 221), emission=RGB(66, 48, 66), shine=0.5, specular=RGB(255, 255, 255), transparency=0})
