# Grasshopper definition Voronoi Cylindrical Pattern Weaverbird.gh (Grasshopper 1.0.7)
# plug-ins: Weaverbird

surface = Surface(<surface referenced from the Rhino model>)
populate_geometry = PopulateGeometry(Geometry=surface, Count=Slider(50, range=0..100), Seed=1)
bounding_box = BoundingBox(Content=surface, Plane=PlaneXY(0, 0, 0))  # -> Box, Box_2
voronoi_3d = Voronoi3D(Points=populate_geometry, Box=bounding_box.Box)  # -> Cells, Boundary
brep_brep = BrepBrep(BrepA=surface, BrepB=voronoi_3d.Cells)  # -> Curves, Points
explode = Explode(Curve=brep_brep.Curves, Recursive=True)  # -> Segments, Vertices
average = Average(Input=explode.Vertices)
polyline = PolyLine(Vertices=explode.Vertices, Closed=True)
surface_closest_point = SurfaceClosestPoint(Point=average, Surface=surface)  # -> Point, UVPoint, Distance
evaluate_surface = EvaluateSurface(Surface=surface, Point=surface_closest_point.UVPoint)  # -> Point, Normal, UDirection, VDirection, Frame
scale = Scale(Geometry=polyline, Center=average, Factor=Slider(0.87, range=0..1))  # -> Geometry, Transform
negative = Negative(Value=evaluate_surface.Normal)
amplitude = Amplitude(Vector=evaluate_surface.Normal, Amplitude=Slider(4.22, range=0..10))
move = Move(Geometry=average, Motion=amplitude)  # -> Geometry, Transform
extrude_point = ExtrudePoint(Base=polyline, Point=move.Geometry)
simple_mesh = SimpleMesh(Brep=extrude_point)  # -> flatten(Mesh)
scale_2 = Scale(Geometry=simple_mesh, Center=flatten(move.Geometry), Factor=Slider(0.9, range=0..1))  # -> Geometry, Transform
weaverbird_s_join_meshes_and_weld = WeaverbirdsJoinMeshesAndWeld(Mesh=simple_mesh, Weld=True)
number_slider = Slider(3, range=0..10)
unify_mesh = UnifyMesh(Mesh=weaverbird_s_join_meshes_and_weld)  # -> Result, Count
weaverbird_s_catmull_clark_subdivision = WeaverbirdsCatmullClarkSubdivision(MeshCurves=unify_mesh.Result, Level=number_slider, SmoothNakedEdges=0)
weaverbird_s_catmull_clark_subdivision_2 = WeaverbirdsCatmullClarkSubdivision(MeshCurves=scale_2.Geometry, Level=number_slider, SmoothNakedEdges=1)
