# Grasshopper definition WavyFacadeStudyBaselMesseHM.gh (Grasshopper 0.9.76)

# ---- group: Base Surface
surface = Surface(<surface referenced from the Rhino model>)

# ----
brep_edges = BrepEdges(Brep=surface)  # -> Naked, Interior, NonManifold
wave_period_count = Slider(100, range=0..300)
row_count = Slider(50, range=0..100)
divide_curve = DivideCurve(Curve=brep_edges.Interior, Count=row_count, Kinks=False)  # -> Points, Tangents, Parameters
surface_closest_point = SurfaceClosestPoint(Point=divide_curve.Points, Surface=surface)  # -> Point, UVPoint, Distance
iso_curve = IsoCurve(Surface=surface, UVPoint=surface_closest_point.UVPoint)  # -> UIsocurve, VIsocurve
divide_curve_2 = DivideCurve(Curve=iso_curve.UIsocurve, Count=wave_period_count, Kinks=False)  # -> Points, Tangents, Parameters
surface_closest_point_2 = SurfaceClosestPoint(Point=divide_curve_2.Points, Surface=surface)  # -> Point, UVPoint, Distance
range = Range(Domain=Domain(0, 1), Steps=expr("x-1", row_count))
evaluate_surface = EvaluateSurface(Surface=surface, Point=surface_closest_point_2.UVPoint)  # -> simplify(Point), simplify(Normal), Frame
panel = Panel(evaluate_surface.Point)
tree_statistics = TreeStatistics(Tree=evaluate_surface.Point)  # -> Paths, Length, Count

amplitude_max = Slider(1.273, range=0..5)
amplitude_min = Slider(0.134, range=0..5)
construct_domain = ConstructDomain(DomainStart=amplitude_min, DomainEnd=amplitude_max)

graph_mapper = GraphMapper(range, x0=0, x1=1, y0=0, y1=1, container_name="Parabola", Ox=0.5043476224, Oy=0.07681143284, Px=0.75, Py=0.25)
shift_list = ShiftList(List=tree_statistics.Paths, Shift="1", Wrap=invert(True))
shift_list_2 = ShiftList(List=tree_statistics.Paths, Shift="-1", Wrap=invert(True))
bounds = Bounds(Numbers=graph_mapper)
tree_branch = TreeBranch(Tree=evaluate_surface.Normal, Path=shift_list, MaintainPaths=True)
tree_branch_2 = TreeBranch(Tree=evaluate_surface.Point, Path=shift_list_2, MaintainPaths=True)
tree_branch_3 = TreeBranch(Tree=evaluate_surface.Normal, Path=shift_list_2, MaintainPaths=True)
tree_branch_4 = TreeBranch(Tree=evaluate_surface.Point, Path=shift_list, MaintainPaths=True)
remap_numbers = RemapNumbers(Value=graph_mapper, Source=bounds, Target=construct_domain)  # -> Mapped, Clipped
sift_pattern = SiftPattern(List=tree_branch_2, SiftPattern=[0, 1])  # -> Output0, Output1
sift_pattern_2 = SiftPattern(List=tree_branch_3, SiftPattern=[0, 1])  # -> Output0, Output1
sift_pattern_3 = SiftPattern(List=tree_branch, SiftPattern=[0, 1])  # -> Output0, Output1
sift_pattern_4 = SiftPattern(List=tree_branch_4, SiftPattern=[0, 1])  # -> Output0, Output1
flip_matrix = FlipMatrix(Data=sift_pattern_3.Output1)
flip_matrix_2 = FlipMatrix(Data=sift_pattern_2.Output0)
flip_matrix_3 = FlipMatrix(Data=sift_pattern_4.Output1)
flip_matrix_4 = FlipMatrix(Data=sift_pattern.Output0)
amplitude = Amplitude(Vector=flip_matrix, Amplitude=remap_numbers.Mapped)
amplitude_2 = Amplitude(Vector=flip_matrix_2, Amplitude=remap_numbers.Mapped)
move = Move(Geometry=flip_matrix_4, Motion=amplitude_2)  # -> Geometry, Transform
move_2 = Move(Geometry=flip_matrix_3, Motion=amplitude)  # -> Geometry, Transform
flip_matrix_5 = FlipMatrix(Data=move.Geometry)  # -> simplify(Data)
flip_matrix_6 = FlipMatrix(Data=move_2.Geometry)  # -> simplify(Data)
combine_data = CombineData(Input0=flip_matrix_5, Input1=sift_pattern.Output1)  # -> Result, Index
combine_data_2 = CombineData(Input0=sift_pattern_4.Output0, Input1=flip_matrix_6)  # -> Result, Index
interpolate = Interpolate(Vertices=combine_data.Result, Degree=3, Periodic=False, KnotStyle=1)  # -> flatten(Curve), Length, Domain
interpolate_2 = Interpolate(Vertices=combine_data_2.Result, Degree=3, Periodic=False, KnotStyle=1)  # -> flatten(Curve), Length, Domain
panel_2 = Panel("""0
1""")
panel_3 = Panel("""1
0""")
cull_pattern = CullPattern(List=interpolate_2.Curve, CullPattern=panel_3)
cull_pattern_2 = CullPattern(List=interpolate.Curve, CullPattern=panel_3)
cull_pattern_3 = CullPattern(List=interpolate_2.Curve, CullPattern=panel_2)
cull_pattern_4 = CullPattern(List=interpolate.Curve, CullPattern=panel_2)
merge = Merge(Data1=graft(cull_pattern_2), Data2=graft(cull_pattern_4))
merge_2 = Merge(Data1=graft(cull_pattern), Data2=graft(cull_pattern_3))
loft = Loft(Curves=reverse(merge), Options={Adjust=False, Closed=False, LoftEnds=0, LoftSimp=0, LoftType=0, Rebuild=10, Refit=0.01})  # -> flatten(Loft)
loft_2 = Loft(
    Curves=reverse(merge_2),
    Options={Adjust=False, Closed=False, LoftEnds=0, LoftSimp=0, LoftType=0, Rebuild=10, Refit=0.01})  # -> flatten(Loft)

# ---- group: Geometry to Bake
weave = Weave(Pattern=[0, 1], Stream0=loft, Stream1=loft_2, NullGaps=False)

# ----
list_length = ListLength(List=weave)
series = Series(Start=0, Step=1, Count=list_length)
gradient = Gradient(LowerLimit=0, UpperLimit=expr("x-1", list_length), Parameter=series, stops=[0: RGB(255, 255, 255), 1: RGB(0, 0, 0)])
brep_wireframe = BrepWireframe(Brep=weave, Density=-1)
custom_preview = CustomPreview(Geometry=weave, Shader=gradient)
