# Grasshopper definition assignment 9 final (1).gh (Grasshopper 0.9.76)

number_slider = Slider(18, range=0..30)
square = Square(Plane=PlaneXY(0, 0, 0), Size=1, ExtentX=number_slider, ExtentY=number_slider)  # -> Cells, Points
explode = Explode(Curve=square.Cells, Recursive=True)  # -> Segments, Vertices
panel = Panel("right side")
number_slider_2 = Slider(2, range=0..10)
panel_2 = Panel("left side")
list_item = ListItem(List=explode.Segments, Index=Slider(1, range=0..1), Wrap=True)
list_item_2 = ListItem(List=explode.Segments, Index=Slider(3, range=0..10), Wrap=True)
area = Area(Geometry=square.Cells)  # -> Area, Centroid
panel_3 = Panel(area.Centroid)
lng = ListLength(List=area.Centroid)
number_slider_3 = Slider(1, range=0..10)
divide_curve = DivideCurve(Curve=list_item_2, Count=number_slider_2, Kinks=number_slider_2)  # -> Points, Tangents, Parameters
divide_curve_2 = DivideCurve(Curve=list_item, Count=number_slider_2, Kinks=False)  # -> Points, Tangents, Parameters
panel_4 = Panel("bottom right")
panel_5 = Panel("bottom left")
list_item_3 = ListItem(List=explode.Vertices, Index=Slider(1, range=0..1), Wrap=True)  # -> flatten(Item)
panel_6 = Panel("top right")
list_item_4 = ListItem(List=divide_curve.Points, Index=number_slider_3, Wrap=True)
list_item_5 = ListItem(List=divide_curve_2.Points, Index=number_slider_3, Wrap=True)
panel_7 = Panel("top left")
list_item_6 = ListItem(List=explode.Vertices, Index=0, Wrap=True)  # -> flatten(Item)
list_item_7 = ListItem(List=explode.Vertices, Index=Slider(3, range=0..10), Wrap=True)  # -> flatten(Item)
list_item_8 = ListItem(List=explode.Vertices, Index=Slider(2, range=0..10), Wrap=True)  # -> flatten(Item)
line = Line(StartPoint=list_item_5, EndPoint=list_item_4)  # -> flatten(Line)
divide = DivideCurve(Curve=line, Count=Slider(2, range=0..10), Kinks=False)  # -> Points, Tangents, Parameters
panel_8 = Panel(line)
panel_9 = Panel("vertical movement")
item = ListItem(List=divide.Points, Index=Slider(1, range=0..1), Wrap=True)  # -> flatten(Item)

pt = Point([<point referenced from the Rhino model> x6])
cp = ClosestPoint(Point=item, Cloud=pt)  # -> ClosestPoint, CPIndex, Distance
dom = ConstructDomain(DomainStart=Slider(1.1, range=0..2), DomainEnd=Slider(2, range=0..10))
bnd = Bounds(Numbers=cp.Distance)
remap = RemapNumbers(Value=cp.Distance, Source=bnd, Target=dom)  # -> Mapped, Clipped
Z = UnitZ(Factor=remap.Mapped)
move = Move(Geometry=line, Motion=Z)  # -> flatten(Geometry), Transform

cp_2 = ClosestPoint(Point=item, Cloud=pt)  # -> ClosestPoint, CPIndex, Distance
dom_2 = ConstructDomain(DomainStart=Slider(-1.3, range=-2..2), DomainEnd=Slider(2.594, range=0..5))
bnd_2 = Bounds(Numbers=cp_2.Distance)
remap_2 = RemapNumbers(Value=cp_2.Distance, Source=bnd_2, Target=dom_2)  # -> Mapped, Clipped
Y = UnitY(Factor=remap_2.Mapped)
move_2 = Move(Geometry=move.Geometry, Motion=Y)  # -> flatten(Geometry), Transform

panel_10 = Panel("horizontal movement")
end_points = EndPoints(Curve=move_2.Geometry)  # -> Start, End
_4point_surface = _4PointSurface(CornerA=list_item_7, CornerB=list_item_6, CornerC=end_points.End)
_4point_surface_2 = _4PointSurface(CornerA=list_item_8, CornerB=list_item_3, CornerC=end_points.Start)
_4point_surface_3 = _4PointSurface(CornerA=end_points.Start, CornerB=end_points.End, CornerC=list_item_7, CornerD=list_item_8)
_4point_surface_4 = _4PointSurface(CornerA=end_points.Start, CornerB=end_points.End, CornerC=list_item_6, CornerD=list_item_3)
