# Grasshopper definition circlepacking2 (1).gh (Grasshopper 0.8.52)

slider = Slider(300, range=0..300)
random = Random(Range=Domain(2, 15), Number=slider, Seed=Slider(13, range=0..100), Integers=False)
random_2 = Random(Range=Domain(-150, 150), Number=slider, Seed=20, Integers=False)
random_3 = Random(Range=Domain(-150, 150), Number=slider, Seed=2, Integers=False)
pt = PointXYZ(XComponent=random_2, YComponent=random_3, ZComponent=0)
lng = ListLength(List=pt)
series = Series(Start=1, Step=1, Count=lng)
circle = CircleCNR(Center=pt, Normal=Vector(0, 0, 1), Radius=random)
rev = ReverseList(List=series)
repeat = RepeatData(Data=Toggle(False), Length=graft(series))
repeat_2 = RepeatData(Data=Toggle(True), Length=graft(rev))
repeat_3 = RepeatData(Data=graft(random), Length=lng)
repeat_4 = RepeatData(Data=graft(pt), Length=lng)
path_mapper = PathMapper(repeat_2, source="{A;B;C;D;E;F}", target="{A;B;C;D;E}")
path_mapper_2 = PathMapper(repeat, source="{A;B;C;D;E}", target="{A;B;C;E;D}")
flip = FlipMatrix(Data=repeat_3)
flip_2 = FlipMatrix(Data=repeat_4)
merge = Merge(StreamA=path_mapper_2, StreamB=path_mapper)
cull = CullPattern(List=flip, CullPattern=merge)
cull_2 = CullPattern(List=flip_2, CullPattern=merge)
path_mapper_3 = PathMapper(cull, source="{A;B;C;D;E;F}", target="{A;E}")
path_mapper_4 = PathMapper(cull_2, source="{A;B;C;D;E;F}", target="{A;E}")
ln = Line(PointA=graft(pt), PointB=path_mapper_4, DataComparison="cross_reference")
addition = Addition(A=graft(random), B=path_mapper_3)
len = Length(Curve=ln)
equals = Equality(FirstNumber=len, SecondNumber=0)  # -> Equality, Inequality
dispatch = Dispatch(List=addition, DispatchPattern=equals.Equality)  # -> ListA, ListB
dispatch_2 = Dispatch(List=ln, DispatchPattern=equals.Equality)  # -> ListA, ListB
flatten = FlattenTree(Data=dispatch.ListB, Path="{0}")
flatten_2 = FlattenTree(Data=dispatch_2.ListB, Path="{0}")
springs = SpringsFromLine(
    Connection=flatten_2,
    Stiffness=4000,
    Damping=10,
    RestLength=flatten,
    Cutoff=flatten,
    CompressionFail=0,
    TensileFail=0,
    Plasticity=0)
plaw = PowerLaw(Connection=flatten_2, Exponents=-1, Strength=-3, Cutoff=0)
clean = CleanTree(Data=springs, CleanInvalid=True, CleanEmpty=False)
clean_2 = CleanTree(Data=plaw, CleanInvalid=True, CleanEmpty=False)
timer = Timer(TimerInterval=1, Target=kangaroo)
kangaroo = KangarooPhysics(ForceObjects=[clean, clean_2], Settings=null, SimulationReset=Toggle(False))  # -> Out, Iterations, ParticlesOut, GeometryOut
circle_2 = CircleCNR(Center=kangaroo.ParticlesOut, Normal=Vector(0, 0, 1), Radius=random)
planar = PlanarSrf(Edges=circle_2)  # disabled
