# Grasshopper definition circlepackingsurface.gh (Grasshopper 1.0.7)

curve = Curve(<curve referenced from the Rhino model>)
sph = Sphere(Base=PlaneXY(0, 0, 0), Radius=Slider(5, range=0..10))
boundary_surfaces = BoundarySurfaces(Edges=curve)
range = Range(Domain=Domain(0, 1), Steps=10)
get_geometry = GetGeometry(
    boundary_surfaces,
    AnnotationTypeFilter=3966,
    AtLeast=1,
    AtMost=1,
    DeleteInput=False,
    Filter=1074081855,
    TreeAccess=False)
get_number = GetNumber(range, AtLeast=1, AtMost=1, Maximum=1.797693135e+308, Minimum=-1.797693135e+308, TreeAccess=False)
get_integer = GetInteger(Slider(35, range=0..100), AtLeast=1, AtMost=1, Maximum=2147483647, Minimum=-2147483648, TreeAccess=False)
get_integer_2 = GetInteger("0", AtLeast=1, AtMost=1, Maximum=2147483647, Minimum=-2147483648, TreeAccess=False)
get_integer_3 = GetInteger("1000", AtLeast=1, AtMost=1, Maximum=2147483647, Minimum=-2147483648, TreeAccess=False)
circlepackingsurf = CirclePackingSurface(surface=get_geometry, sizes=get_number, count=get_integer, seed=get_integer_2, maximun_iterations=get_integer_3)  # -> circles, planes
context_bake = ContextBake(Content=circlepackingsurf.circles)
context_bake_2 = ContextBake(Content=circlepackingsurf.planes)

# ==== cluster CirclePackingSurface: Pack circles on a surface (kangaroo required) Note * This is useful for pave
surface = ClusterInput()  # Base surface
sizes = ClusterInput()  # Sizes of the circles
seed = ClusterInput()  # Random seed
count = ClusterInput()  # Number of circles
maximun_iterations = ClusterInput()  # Maximun number of iterations
tamaños = Number(sizes)
srf = Surface(surface)
nº = Integer(count)
max_iters = MaxIters(maximun_iterations)
seed_2 = Integer(seed)
edges = BrepEdges(Brep=srf)  # -> Naked, Interior, NonManifold
bnd = Bounds(Numbers=tamaños)
join = JoinCurves(Curves=edges.Naked, Preserve=False)
dedomain = DeconstructDomain(Domain=bnd)  # -> Start, expr("x/2", End)
offsets = OffsetOnSrf(Curve=join, Distance=dedomain.End, Surface=srf)
srfsplit = SurfaceSplit(Surface=srf, Curves=flatten(offsets))
area = Area(Geometry=srfsplit)  # -> Area, Centroid
repeat = RepeatData(Data=tamaños, Length=nº)
sort = SortList(Keys=area.Area, ValuesA=srfsplit)  # -> Keys, ValuesA
item = ListItem(List=reverse(sort.ValuesA), Index=0, Wrap=True)
jitter = Jitter(List=repeat, Jitter=1, Seed=seed_2)  # -> Values, Indices
item_2 = ListItem(List=item, Index=0, Wrap=True)
num = Number(expr("x/2", jitter.Values))
popgeo = PopulateGeometry(Geometry=item_2, Count=nº, Seed=seed_2)
lng = ListLength(List=num)
pt = Point(popgeo)
series = Series(Start=0, Step=1, Count=lng)
lng_2 = ListLength(List=pt)
series_2 = Series(Start=0, Step=1, Count=lng_2)
cull_i = CullIndex(List=num, Indices=graft(series), Wrap=False)
item_3 = ListItem(List=num, Index=series, Wrap=False)
cull_i_2 = CullIndex(List=pt, Indices=graft(series_2), Wrap=False)
item_4 = ListItem(List=pt, Index=series_2, Wrap=False)
addition = Addition(A=graft(item_3), B=cull_i)
ln = Line(PointA=graft(item_4), PointB=cull_i_2)
pulltosurf = PullToSurf(ConstraintSurface=item_2, Points=pt, PullStrength=1000)
springs = SpringsFromLine(
    Connection=ln,
    Stiffness=1000,
    Damping=10,
    RestLength=addition,
    Cutoff=addition,
    CompressionFail=0,
    TensileFail=0,
    Plasticity=0)
zombie = ZombieKangaroo(ForceObjects=flatten([pulltosurf, springs]), Settings=null, Geometry=pt, Threshold=0.1, MaxIters=max_iters)  # -> Out, Iterations, ParticlesOut, GeometryOut, KE
srf_2 = Surface(item_2)
srf_cp = SurfaceCP(Point=zombie.GeometryOut, Surface=srf_2)  # -> Point, UVPoint, Distance
eval = EvaluateSurface(Surface=srf_2, Point=srf_cp.UVPoint)  # -> Point, Normal, Frame
pl = PlaneNormal(Origin=eval.Point, ZAxis=eval.Normal)
cir = Circle(Plane=pl, Radius=num)
pln = Plane(pl)
circles = ClusterOutput(cir)  # Resulting circles
planes = ClusterOutput(pln)  # Resulting planes
