# Grasshopper definition insulation_hatch_2015.gh (Grasshopper 1.0.4)

# ---- group: BOUNDARY CURVES
crv = Curve(<curve referenced from the Rhino model>)
crv_2 = Curve(<curve referenced from the Rhino model>)

# ---- group: HATCH SCALE
number_slider = Slider(142, range=0..1000)

# ----
len = Length(Curve=crv)
division = Division(A=len, B=number_slider)
multiplication = Multiplication(A=number_slider, B=2)
division_2 = Division(A=len, B=multiplication)
divlength = DivideLength(Curve=crv, Length=division)  # -> Points, Tangents, Parameters
divlength_2 = DivideLength(Curve=crv_2, Length=division_2)  # -> Points, Tangents, Parameters
division_3 = Division(A=division, B=2)
cull = CullPattern(List=divlength_2.Points, CullPattern=[False, True])
Y = UnitY(Factor=division_3)
number_slider_2 = Slider(0, range=0..100)
addition = Addition(A=division_3, B=5)

# ---- group: TRIMMING REGION
flip = FlipCurve(Curve=crv)  # -> Curve, Flag
connect = ConnectCurves(Curves=[flip.Curve, crv_2], Continuity=Slider(0, range=0..10), Close=True, Bulge=1)

# ---- group: NORMALS
Y_2 = UnitY(Factor=1)
Z = UnitZ(Factor=1)
X = UnitX(Factor=1)
angle = Angle(VectorA=crv_2, VectorB=X)  # -> Angle, Reflex

# ----
rotate = Rotate(Geometry=Y, Angle=angle.Angle, Plane=PlaneXY(0, 0, 0))  # -> Geometry, Transform
neg = Negative(Value=rotate.Geometry)
move = Move(Geometry=cull, Motion=rotate.Geometry)  # -> Geometry, Transform
move_2 = Move(Geometry=divlength.Points, Motion=neg)  # -> Geometry, Transform

cir = Circle(Plane=move_2.Geometry, Radius=division_3)
cir_2 = Circle(Plane=move.Geometry, Radius=division_3)

lng = ListLength(List=cir)
lng_2 = ListLength(List=cir_2)
equals = Equality(FirstNumber=lng, SecondNumber=lng_2)  # -> Equality, Inequality
tanin = TangentLinesIn(CircleA=cir, CircleB=cir_2)  # -> Tangent1, Tangent2
subtraction = Subtraction(A=lng, B=1)

# ---- group: NORMALS (continued)
line = LineSDL(Start=move.Geometry, Direction=Y_2, Length=1)
line_2 = LineSDL(Start=move.Geometry, Direction=Z, Length=1)
rot3d = Rotate3D(Geometry=line, Angle=angle.Angle, Center=move.Geometry, Axis=line_2)  # -> Geometry, Transform

# ---- group: TANGENTS' MIRROR
geo = Geometry(tanin.Tangent1)
cull_i = CullIndex(List=geo, Indices=subtraction, Wrap=True)
filter = StreamFilter(Gate=equals.Equality, Stream0=cull_i, Stream1=geo)
mirror = MirrorCurve(Geometry=filter, Curve=rot3d.Geometry, Tangent=True)

# ----
end = EndPoints(Curve=filter)  # -> Start, End
end_2 = EndPoints(Curve=mirror)  # -> Start, End
lng_3 = ListLength(List=end_2.Start)
lng_4 = ListLength(List=end_2.End)
subtraction_2 = Subtraction(A=lng_3, B=1)
subtraction_3 = Subtraction(A=lng_4, B=1)
item = ListItem(List=end.Start, Index=0, Wrap=True)
item_2 = ListItem(List=end.End, Index=0, Wrap=True)
item_3 = ListItem(List=end_2.Start, Index=subtraction_2, Wrap=True)
item_4 = ListItem(List=end_2.End, Index=subtraction_3, Wrap=True)
ln = Line(StartPoint=item, EndPoint=item_3)
ln_2 = Line(StartPoint=item_2, EndPoint=item_4)
ext = ExtendCurve(Curve=ln, Type=number_slider_2, Start=addition, End=addition)
ext_2 = ExtendCurve(Curve=ln_2, Type=number_slider_2, Start=addition, End=addition)
loft = Loft(Curves=[ext, ext_2], Options={Adjust=False, Closed=False, LoftEnds=0, LoftSimp=0, LoftType=0, Rebuild=10, Refit=0.01})
trim = TrimWithRegions(Curve=cir, Regions=loft)  # -> Inside, Outside
trim_2 = TrimWithRegions(Curve=cir_2, Regions=loft)  # -> Inside, Outside

geo_2 = Geometry(trim.Outside)
geo_3 = Geometry(trim_2.Outside)

merge = Merge(Data1=geo_2, Data2=geo_3)  # -> flatten(Result)
trim_3 = TrimWithRegion(Curve=merge, Region=connect)  # -> Inside, Outside
geo_4 = Geometry(trim_3.Inside)

# ---- group: INSULATION HATCH
insulation = Merge(Data1=filter, Data2=mirror, Data3=geo_4)
