# Grasshopper definition mct_130726_metaballs.gh (Grasshopper 1.0.4)

genes = GenePool(
    Decimals=2,
    Maximum=200,
    Minimum=0,
    Value=[106.77, 93.48748228, 116.77, 102.0478315, 118.59, 152.5798816, 161.3431114, 135.22, 149.6711519, 136.16, 88.98])
pt = Point([Point(-167.0399843, -177.3311929, -99.7116489), Point(-506.9676429, 100.630529, 59.88356852), Point(-630.3165828, 85.45027123, 0), Point(-336.4461964, 106.5058128, 0), Point(-325.4961018, -286.5476614, 0), Point(-265.0449496, -36.20037006, -34.31273019), Point(-573.1800643, -95.62764288, -74.89439641), Point(-428.604698, -122.4504287, 12.91721303), Point(8.39143509, 196.766737, -22.39985827), Point(-116.8769061, 87.57918102, 0), Point(-443.4201236, 165.9871789, 29.94178426)])
vb = VBScript(c=pt, rad=genes, iso=Slider(0.086, range=0.001..0.3), res=Slider(50, range=10..50), smooth=Slider(10, range=0..80))  # -> out, bbox, sc, mb; inputs c: list of Point3d, rad: list
# ---------- vb: VB ----------
    use_charges = c
    use_radii = rad
    use_iso = iso

    Dim pl As Plane = Nothing

    Plane.FitPlaneToPoints(c, pl)
    pl.Origin = c(0)
    Dim dom As New interval(-rad(0), rad(0))
    Dim b As New Box(pl, dom, dom, dom)

    For set_s As Int32 = 1 To c.Count - 1
      pl.Origin = c(set_s)
      b.Union(pl.PointAt(-rad(set_s), -rad(set_s), -rad(set_s)))
      b.Union(pl.PointAt(rad(set_s), rad(set_s), rad(set_s)))
    Next

    b.Inflate(res)

    Dim xSet As Int32 = b.X.Length / res
    Dim ySet As Int32 = b.Y.Length / res
    Dim zSet As Int32 = b.Z.Length / res
    Dim xLength As Double = b.X.Length / xSet
    Dim yLength As Double = b.Y.Length / ySet
    Dim zLength As Double = b.Z.Length / zSet
    Dim xOffset As Double = xLength / 2
    Dim yOffset As Double = yLength / 2
    Dim zOffset As Double = zLength / 2

    pl.Origin = b.GetCorners(0)

    Dim bCenters As New List(Of Point3d)
    Dim msh_set As New Mesh

    For xRun As Int32 = 0 To xSet - 1
      For yRun As Int32 = 0 To ySet - 1
        For zRun As Int32 = 0 To zSet - 1
          Dim bTest As Point3d = pl.PointAt(xOffset + (xLength * xRun), yOffset + (yLength * yRun), zOffset + (zLength * zRun))
          For p_i As Int32 = 0 To c.count - 1
            If bTest.DistanceTo(c(p_i)) < rad(p_i) + res Then
              Dim local_pl As Plane = pl
              local_pl.Origin = bTest
              Dim value_check As List(Of Double) = Nothing
              Dim corner_check As List(Of Point3d) = Nothing
              Dim local_msh As Mesh = local_tet(local_pl, xOffset, yOffset, zOffset)
              msh_set.append(local_msh)
              bCenters.Add(bTest)
              Exit For
            End If
          Next
        Next
      Next
    Next

    refine_mesh(msh_set)
    Dim msh_smooth() As Mesh = msh_set.SplitDisjointPieces

    For m As Int32 = 0 To msh_smooth.length - 1
      refine_mesh(msh_smooth(m))
      For s As int32 = 0 To smooth
        Dim new_v() As Point3f = msh_smooth(m).Vertices.ToArray
        For v As Int32 = 0 To msh_smooth(m).TopologyVertices.Count - 1
          Dim mv() As Int32 = msh_smooth(m).TopologyVertices.MeshVertexIndices(v)
          Dim ctv() As Int32 = msh_smooth(m).TopologyVertices.ConnectedTopologyVertices(v)
          Dim new_x As Double = 0
          Dim new_y As Double = 0
          Dim new_z As Double = 0
          For Each ctv_i As Int32 In ctv
            Dim vtc() As Int32 = msh_smooth(m).TopologyVertices.MeshVertexIndices(ctv_i)
            new_x += msh_smooth(m).Vertices(vtc(0)).X / ctv.length
            new_y += msh_smooth(m).Vertices(vtc(0)).Y / ctv.length
            new_z += msh_smooth(m).Vertices(vtc(0)).Z / ctv.length
          Next
          new_v(mv(0)) = New Point3f(new_x, new_y, new_z)
        Next v
        For v As int32 = 0 To msh_smooth(m).Vertices.Count - 1
          msh_smooth(m).Vertices(v) = new_v(v)
        Next
        refine_mesh(msh_smooth(m))
        For v As int32 = 0 To new_v.length - 1

          Dim p1 As Point3d = new_v(v)
          Dim p2 As Point3d = new_v(v) + msh_smooth(m).Normals(v) * (res / 10)

          Dim v1 As Double = calculate_field(p1)
          Dim v2 As Double = calculate_field(p2)

          Dim new_p As Point3d = Nothing

          If v2 - v1 <> 0 Then
            new_p = interp_vertex(p1, p2, v1, v2)
          Else
            new_p = p1
          End If

          If p1.DistanceTo(new_p) > res Then
            new_v(v) = New Point3f(p1.x, p1.y, p1.z)
          Else
            new_v(v) = New Point3f(new_p.x, new_p.y, new_p.z)
          End If

        Next
        For v As int32 = 0 To msh_smooth(m).Vertices.Count - 1
          msh_smooth(m).Vertices(v) = new_v(v)
        Next
        refine_mesh(msh_smooth(m))
      Next s
    Next m

    bbox = b
    sc = bCenters
    mb = msh_smooth
# ---------- vb: VB additional code ----------
  Public use_charges As New List(Of Point3d)
  Public use_radii As New List(Of Double)
  Public use_iso As Double

  Public cA As Double = -0.444444
  Public cB As Double = 1.888889
  Public cC As Double = -2.444444

  Function refine_mesh(ByRef msh) As Boolean
    msh.Vertices.CombineIdentical(True, True)
    msh.FaceNormals.ComputeFaceNormals()
    msh.Normals.ComputeNormals()
    msh.UnifyNormals()
    Return True
  End Function

  Function calculate_field(ByVal test_pt As Point3d) As Double
    'metaball field calculations
    'based on methods described by Paul Bourke:
    'http://paulbourke.net/geometry/implicitsurf/
    Dim field_value As Double = 0
    For mc As Int32 = 0 To use_charges.Count - 1
      Dim test_dist As Double = test_pt.DistanceTo(use_charges(mc))
      If test_dist < use_radii(mc) Then
        field_value += cA * test_dist ^ 3 / use_radii(mc) ^ 3 + cB * test_dist ^ 2 / use_radii(mc) ^ 2 + cC * test_dist / use_radii(mc) + 1
      End If
    Next
    If field_value = 0 Then field_value = -1
    Return field_value
  End Function

  Function local_tet(ByVal pl As Plane, ByVal xBase As Double, ByVal yBase As Double, ByVal zBase As Double) As Mesh
    'marching tetrahedron algorithm
    'based on methods described by Paul Bourke:
    'http://paulbourke.net/geometry/polygonise/
    Dim c As New List(Of Point3d) 'corners
    c.add(pl.PointAt(-xBase, yBase, -zBase))
    c.add(pl.PointAt(xBase, yBase, -zBase))
    c.add(pl.PointAt(xBase, -yBase, -zBase))
    c.add(pl.PointAt(-xBase, -yBase, -zBase))
    c.add(pl.PointAt(-xBase, yBase, zBase))
    c.add(pl.PointAt(xBase, yBase, zBase))
    c.add(pl.PointAt(xBase, -yBase, zBase))
    c.add(pl.PointAt(-xBase, -yBase, zBase))

    Dim c_v As New List(Of Double)

    For Each corner As Point3d In C
      Dim field_value As Double = calculate_field(corner)
      c_v.add(field_value)
    Next

    Dim t As New DataTree(Of Point3d)
    t.AddRange({c(0),c(2),c(3),c(7)},New GH_Path(0))
    t.AddRange({c(0),c(2),c(6),c(7)},New GH_Path(1))
    t.AddRange({c(0),c(4),c(6),c(7)},New GH_Path(2))
    t.AddRange({c(0),c(6),c(1),c(2)},New GH_Path(3))
    t.AddRange({c(0),c(6),c(1),c(4)},New GH_Path(4))
    t.AddRange({c(5),c(6),c(1),c(4)},New GH_Path(5))

    Dim tv As New DataTree(Of Double)
    tv.AddRange({c_v(0),c_v(2),c_v(3),c_v(7)},New GH_Path(0))
    tv.AddRange({c_v(0),c_v(2),c_v(6),c_v(7)},New GH_Path(1))
    tv.AddRange({c_v(0),c_v(4),c_v(6),c_v(7)},New GH_Path(2))
    tv.AddRange({c_v(0),c_v(6),c_v(1),c_v(2)},New GH_Path(3))
    tv.AddRange({c_v(0),c_v(6),c_v(1),c_v(4)},New GH_Path(4))
    tv.AddRange({c_v(5),c_v(6),c_v(1),c_v(4)},New GH_Path(5))

    Dim box_mesh As New Mesh()

    For Each tet As GH_Path In tv.Paths

      Dim t_use As List(Of Point3d) = t.Branch(tet)
      Dim tv_use As List(Of Double) = tv.Branch(tet)

      Dim tri_idx As Int32 = 0

      If tv_use(0) < use_iso Then tri_idx = tri_idx Or 1
      If tv_use(1) < use_iso Then tri_idx = tri_idx Or 2
      If tv_use(2) < use_iso Then tri_idx = tri_idx Or 4
      If tv_use(3) < use_iso Then tri_idx = tri_idx Or 8

      Dim add_mesh As New Mesh()

      Select Case tri_idx
        Case 0, 15
          Exit Select
        Case 1, 14
          add_mesh.Vertices.Add(interp_vertex(t_use(0), t_use(1), tv_use(0), tv_use(1)))
          add_mesh.Vertices.Add(interp_vertex(t_use(0), t_use(2), tv_use(0), tv_use(2)))
          add_mesh.Vertices.Add(interp_vertex(t_use(0), t_use(3), tv_use(0), tv_use(3)))
          add_mesh.Faces.AddFace(0, 1, 2)
          Exit Select
        Case 2, 13
          add_mesh.Vertices.Add(interp_vertex(t_use(1), t_use(0), tv_use(1), tv_use(0)))
          add_mesh.Vertices.Add(interp_vertex(t_use(1), t_use(3), tv_use(1), tv_use(3)))
          add_mesh.Vertices.Add(interp_vertex(t_use(1), t_use(2), tv_use(1), tv_use(2)))
          add_mesh.Faces.AddFace(0, 1, 2)
        Case 3, 12
          add_mesh.Vertices.Add(interp_vertex(t_use(0), t_use(3), tv_use(0), tv_use(3)))
          add_mesh.Vertices.Add(interp_vertex(t_use(0), t_use(2), tv_use(0), tv_use(2)))
          add_mesh.Vertices.Add(interp_vertex(t_use(1), t_use(3), tv_use(1), tv_use(3)))
          add_mesh.Faces.AddFace(0, 1, 2)
          add_mesh.Vertices.Add(interp_vertex(t_use(1), t_use(2), tv_use(1), tv_use(2)))
          add_mesh.Faces.AddFace(2, 3, 1)
          Exit Select
        Case 4, 11
          add_mesh.Vertices.Add(interp_vertex(t_use(2), t_use(0), tv_use(2), tv_use(0)))
          add_mesh.Vertices.Add(interp_vertex(t_use(2), t_use(1), tv_use(2), tv_use(1)))
          add_mesh.Vertices.Add(interp_vertex(t_use(2), t_use(3), tv_use(2), tv_use(3)))
          add_mesh.Faces.AddFace(0, 1, 2)
        Case 5, 10
          add_mesh.Vertices.Add(interp_vertex(t_use(0), t_use(1), tv_use(0), tv_use(1)))
          add_mesh.Vertices.Add(interp_vertex(t_use(2), t_use(3), tv_use(2), tv_use(3)))
          add_mesh.Vertices.Add(interp_vertex(t_use(0), t_use(3), tv_use(0), tv_use(3)))
          add_mesh.Faces.AddFace(0, 1, 2)
          add_mesh.Vertices.Add(interp_vertex(t_use(1), t_use(2), tv_use(1), tv_use(2)))
          add_mesh.Faces.AddFace(0, 3, 1)
        Case 6, 9
          add_mesh.Vertices.Add(interp_vertex(t_use(0), t_use(1), tv_use(0), tv_use(1)))
          add_mesh.Vertices.Add(interp_vertex(t_use(1), t_use(3), tv_use(1), tv_use(3)))
          add_mesh.Vertices.Add(interp_vertex(t_use(2), t_use(3), tv_use(2), tv_use(3)))
          add_mesh.Faces.AddFace(0, 1, 2)
          add_mesh.Vertices.Add(interp_vertex(t_use(0), t_use(2), tv_use(0), tv_use(2)))
          add_mesh.Faces.AddFace(0, 3, 2)
        Case 7, 8
          add_mesh.Vertices.Add(interp_vertex(t_use(3), t_use(0), tv_use(3), tv_use(0)))
          add_mesh.Vertices.Add(interp_vertex(t_use(3), t_use(2), tv_use(3), tv_use(2)))
          add_mesh.Vertices.Add(interp_vertex(t_use(3), t_use(1), tv_use(3), tv_use(1)))
          add_mesh.Faces.AddFace(0, 1, 2)
      End Select

      box_mesh.Append(add_mesh)

    Next

    box_mesh.Vertices.CombineIdentical(True, True)

    Return box_mesh

  End Function

  Function interp_vertex(ByVal p1 As Point3d, ByVal p2 As Point3d, ByVal v1 As Double, ByVal v2 As Double) As Point3d

    Return New Point3d(P1 + (use_iso - v1) / (v2 - v1) * (p2 - p1))

  End Function
# ---------- end vb ----------
material = CreateMaterial(Diffuse=RGB(60, 17, 180), Specular=RGB(255, 255, 255), Emission=RGB(0, 0, 0), Transparency=0, Shine=0)
edges = BrepEdges(Brep=vb.bbox)  # -> Naked, Interior, NonManifold
preview = CustomPreview(Geometry=vb.mb, Shader=material)
