# Grasshopper definition pipeall_VPipe.gh (Grasshopper 0.9.76)

crv = Curve([<curve referenced from the Rhino model> x71])
divide = DivideCurve(Curve=crv, Count="2", Kinks=False)  # -> Points, Tangents, Parameters
vpipe = PipeVariable(
    Curve=crv,
    Parameters=divide.Parameters,
    Radii=[Slider(0.5, range=0..8), Slider(0.3, range=0..8), Slider(0.5, range=0..8)],
    Caps=1)
