# Grasshopper definition pipevariable.gh (Grasshopper 1.0.4)

crv = Curve(<curve referenced from the Rhino model>)
eval = EvaluateLength(Curve=crv, Length=[Slider(0, range=0..1), Slider(0.3, range=0..1), Slider(1, range=0..1)], Normalized=True)  # -> Point, Tangent, Parameter
vpipe = PipeVariable(
    Curve=crv,
    Parameters=eval.Parameter,
    Radii=[Slider(1, range=0..1), Slider(0.9, range=0..11), Slider(13.2, range=0..21)],
    Caps=0)
