# Grasshopper definition populate_without_intersect.gh (Grasshopper 1.0.4)

crv = Curve(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)
polygon = Polygon(Plane=PlaneXY(0, 0, 0), Radius=1, Segments=5, FilletRadius=0)  # -> Polygon, Length
srf = Surface(crv)
popgeo = PopulateGeometry(Geometry=srf, Count=Slider(100, range=10..500), Seed=1)
prox = Proximity3D(Points=popgeo, Group=1)  # -> flatten(Links), Topology
lng = ListLength(List=popgeo)
len = Length(Curve=prox.Links)
random = Random(Range=Domain(0, 360), Number=lng, Seed=2)
rotate = Rotate(Angle=degrees(random), Plane=PlaneXY(0, 0, 0))  # -> Geometry, simplify(graft(Transform))
scale = Scale(Center=Point(0, 0, 0), Factor=expr("0.5*x", len))  # -> Geometry, simplify(graft(Transform))
move = Move(Motion=popgeo)  # -> Geometry, simplify(graft(Transform))
comp = Compound(Transforms=[scale.Transform, rotate.Transform, move.Transform])  # -> flatten(Compound)
transform = Transform(Geometry=polygon.Polygon, Transform=comp)
