# Grasshopper definition shrinkwrap_example.gh (Grasshopper 0.9.76)
# plug-ins: Kangaroo Components, Kangaroo2 Components

brep = Brep([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])
bbox = BoundingBox(Content=brep, Plane=PlaneXY(0, 0, 0), UnionBox=True)  # -> Box, Box_2
volume = Volume(Geometry=bbox.Box)  # -> Volume, Centroid
custom_mesh_settings = SettingsCustom(
    StitchSeams=True,
    SimplePlanes=False,
    Refine=True,
    MinCount=16,
    MaxCount=400,
    AspectRatio=20,
    MaxDistance=0,
    MaxAngle=20,
    MinEdge=0,
    MaxEdge=Slider(0.25, range=0.1..1))
scale = Scale(Geometry=bbox.Box, Center=volume.Centroid, Factor=1.1)  # -> Geometry, Transform
mesh = MeshBrep(Brep=scale.Geometry, Settings=custom_mesh_settings)
tri = Triangulate(Mesh=mesh)  # -> Mesh, Count
clean = CombineClean(Meshes=tri.Mesh)
medges = MeshEdges(Mesh=clean)  # -> NakedEdges, InteriorEdges, NonManifoldEdges
demesh = DeconstructMesh(Mesh=clean)  # -> Vertices, Faces, Colours, Normals
len = Length(Curve=medges.InteriorEdges)
multiplication = Multiplication(A=len, B=Slider(0.5, range=0..1))
spc = SolidPointCollide(Points=demesh.Vertices, Solid=graft(brep), Interior=False, Unidirectional=Toggle(True), Strength=10)
show = Show(G=clean)
volume_2 = Volume(Mesh=clean, Volume="0", Strength="0.05")
length_line = LengthLine(Line=medges.InteriorEdges, Length=multiplication, Strength=1)

reset = Button()
on = BooleanToggle(False)

entwine = Entwine(Branch00=[spc, length_line, volume_2], Branch01=show, FlattenInputs=True)
solver = Solver(GoalObjects=entwine, Reset=reset, Threshold=1e-15, Tolerance=0.01, On=on)  # -> I, V, O
unflatten = UnflattenTree(Tree=solver.O, Guide=entwine)
bang = ExplodeTree(Data=unflatten)  # -> Branch0, Branch1
mesh_2 = Mesh(bang.Branch1)
