# Grasshopper definition space frame.gh (Grasshopper 0.9.76)
# plug-ins: LunchBox

number_slider = Slider(30, range=0..30)
surface = Surface(reparameterize(<surface referenced from the Rhino model>))
number_slider_2 = Slider(48, range=0..100)
number_slider_3 = Slider(20, range=0..100)
construct_domain² = ConstructDomain²(UMin=0, UMax=1, VMin=0, VMax=1)
divide_domain² = DivideDomain²(Domain=surface, UCount=Slider(30, range=0..50), VCount=number_slider)
range = Range(Domain=Domain(0, 1), Steps=number_slider_3)
range_2 = Range(Domain=Domain(0, 1), Steps=number_slider_2)
isotrim = Isotrim(Surface=surface, Domain=divide_domain²)
construct_point = ConstructPoint(XCoordinate=range_2, YCoordinate=range, ZCoordinate=0)
divide_domain²_2 = DivideDomain²(Domain=construct_domain², UCount=number_slider_2, VCount=number_slider_3)
number_slider_4 = Slider(0.1, range=0..1)
iso_curve = IsoCurve(UVPoint=construct_point)  # -> UIsocurve, VIsocurve
isotrim_2 = Isotrim(Domain=divide_domain²_2)
radians = Radians(Degrees=number_slider_4)
deconstruct_brep = DeconstructBrep(Brep=isotrim)  # -> Faces, Edges, Vertices
md_slider = MDSlider(
    slider_value=Point(0.5, 0.5013094413, 0.5),
    SliderMode=0,
    x_domain=Domain(0, 1),
    y_domain=Domain(0, 1),
    z_domain=Domain(0, 1))
explode_tree = ExplodeTree(Data=isotrim_2)  # -> Branch0, Branch1
unit_z = UnitZ(Factor=radians)
unit_z_2 = UnitZ(Factor=number_slider_4)
curve = Curve(iso_curve.UIsocurve)
curve_2 = Curve(iso_curve.VIsocurve)
evaluate_surface = EvaluateSurface(Surface=reparameterize(deconstruct_brep.Faces), Point=md_slider)  # -> Point, Normal, Frame
extrude = Extrude(Base=curve_2, Direction=unit_z_2)
extrude_2 = Extrude(Base=[unit_z, curve], Direction=unit_z)
list_item = ListItem(List=explode_tree.Branch1, Index=0, Wrap=True)
list_item_2 = ListItem(List=explode_tree.Branch1, Index=0, Wrap=True)
list_item_3 = ListItem(List=explode_tree.Branch1, Index=0, Wrap=True)
list_item_4 = ListItem(List=explode_tree.Branch1, Index=0, Wrap=True)
line = Line(StartPoint=list_item_2, EndPoint=list_item_3)
line_2 = Line(StartPoint=list_item_4, EndPoint=list_item)
reverse = Reverse(Vector=evaluate_surface.Normal)
xy_plane = XYPlane(Origin=Point(0, 0, 0))
move = Move(Geometry=[line_2, line], Motion=Vector(0, 0, 10))  # -> Geometry, Transform
project = Project(Plane=xy_plane)  # -> Geometry, Transform
line_sdl = LineSDL(Start=evaluate_surface.Point, Direction=reverse, Length=Slider(0.06, range=0..10))
pipe = Pipe(Curve=move.Geometry, Radius=Slider(0.02, range=0..0.1), Caps=0)
end_points = EndPoints(Curve=line_sdl)  # -> Start, End
point = Point(flatten(end_points.End))
partition_list = PartitionList(List=point, Size=number_slider)
surface_2 = Surface(<surface referenced from the Rhino model>)
flip_matrix = FlipMatrix(Data=partition_list)
quad_panels = QuadPanels(Surface=surface_2, UDivisions=Slider(20, range=0..100), VDivisions=Slider(30, range=0..100))
interpolate = Interpolate(Vertices=flip_matrix, Degree=3, Periodic=False, KnotStyle=1)  # -> Curve, Length, Domain
interpolate_2 = Interpolate(Vertices=partition_list, Degree=3, Periodic=False, KnotStyle=1)  # -> Curve, Length, Domain
unit_z_3 = UnitZ(Factor=Slider(0.01, range=0..1))
line_3 = Line(StartPoint=end_points.End, EndPoint=deconstruct_brep.Vertices)
curve_3 = Curve(deconstruct_brep.Edges)
extrude_3 = Extrude(Base=quad_panels, Direction=unit_z_3)
pipe_2 = Pipe(Curve=[interpolate.Curve, interpolate_2.Curve, line_3, curve_3], Radius=Slider(0.01, range=0..0.1), Caps=0)
cap_holes = CapHoles(Brep=extrude_3)
