# Grasshopper definition FileSystemComponents.gh (Grasshopper 1.0.8)

path = FilePath("D:\Website\clarkcheng.design\photography\assets\Turkiye\")
toggle = BooleanToggle(False)
path_2 = FilePath("C:\Users\David Rutten\Desktop\")
c_script = CSharpScript(Folder=path, Pattern="*i*", Recursive=toggle, IncludeFiles=Toggle(True))  # -> out, Subfolders, Files; inputs Folder: String, Pattern: String, Recursive: Boolean, IncludeFiles: Boolean
# ---------- c_script: C# ----------
// Grasshopper Script Instance
#region Usings
using System.IO;
using System.Linq;
using System.Data;
using System.Drawing;
using System.Reflection;
using System.Windows.Forms;
using System.Xml;
using System.Xml.Linq;
using System.Runtime.InteropServices;

using Rhino.DocObjects;
using Rhino.Collections;
using GH_IO;
using GH_IO.Serialization;
#endregion

public class Script_Instance : GH_ScriptInstance
{
    #region Notes
    /* 
      Members:
        RhinoDoc RhinoDocument
        GH_Document GrasshopperDocument
        IGH_Component Component
        int Iteration

      Methods (Virtual & overridable):
        Print(string text)
        Print(string format, params object[] args)
        Reflect(object obj)
        Reflect(object obj, string method_name)
    */
    #endregion

    private void RunScript(
		string Folder,
		string Pattern,
		bool Recursive,
		bool IncludeFiles,
		ref object Subfolders,
		ref object Files)
    {
        // Set default pattern if empty
        if (string.IsNullOrEmpty(Pattern))
        Pattern = "*";

        // Choose search option
        SearchOption searchOption = Recursive ? SearchOption.AllDirectories : SearchOption.TopDirectoryOnly;

        // Get subfolders
        string[] folders = System.IO.Directory.GetDirectories(Folder, "*", searchOption);
        for (int i = 0; i < folders.Length; i++)
        folders[i] += System.IO.Path.DirectorySeparatorChar;

        // Get files if requested
        string[] files = new string[0];
        if (IncludeFiles)
        {
        files = System.IO.Directory.GetFiles(Folder, Pattern, searchOption);
        }

        // Assign outputs
        Subfolders = folders;
        Files = files;

    }
}
# ---------- end c_script ----------
c_script_2 = CSharpScript(Folder=path_2, Pattern="*i*", Recursive=toggle)  # -> out, Subfolders; inputs Folder: String, Pattern: String, Recursive: Boolean; disabled
# ---------- c_script_2: C# ----------
    // Ensure valid search pattern.
    if (string.IsNullOrEmpty(Pattern))
      Pattern = "*";

    // Pick search option.
    SearchOption search = SearchOption.TopDirectoryOnly;
    if (Recursive)
      search = SearchOption.AllDirectories;

    // Perform subfolder search.
    string[] folders = System.IO.Directory.GetDirectories(Folder, Pattern, search);

    // Make sure each folder ends with a backslash.
    for (int i = 0; i < folders.Length; i++)
      folders[i] += System.IO.Path.DirectorySeparatorChar;

    Subfolders = folders;
# ---------- end c_script_2 ----------
c_script_3 = CSharpScript(Folder=path, Pattern="*i*", Recursive=toggle)  # -> out, Subfolders; inputs Folder: String, Pattern: String, Recursive: Boolean; disabled
# ---------- c_script_3: C# ----------
// Grasshopper Script Instance
#region Usings
using System.IO;
using System.Linq;
using System.Data;
using System.Drawing;
using System.Reflection;
using System.Windows.Forms;
using System.Xml;
using System.Xml.Linq;
using System.Runtime.InteropServices;

using Rhino.DocObjects;
using Rhino.Collections;
using GH_IO;
using GH_IO.Serialization;
#endregion

public class Script_Instance : GH_ScriptInstance
{
    #region Notes
    /* 
      Members:
        RhinoDoc RhinoDocument
        GH_Document GrasshopperDocument
        IGH_Component Component
        int Iteration

      Methods (Virtual & overridable):
        Print(string text)
        Print(string format, params object[] args)
        Reflect(object obj)
        Reflect(object obj, string method_name)
    */
    #endregion

    private void RunScript(
		string Folder,
		string Pattern,
		bool Recursive,
		ref object Subfolders)
    {
    // Ensure valid search pattern.
    if (string.IsNullOrEmpty(Pattern))
      Pattern = "*";

    // Pick search option.
    SearchOption search = SearchOption.TopDirectoryOnly;
    if (Recursive)
      search = SearchOption.AllDirectories;

    // Perform subfolder search.
    string[] folders = System.IO.Directory.GetDirectories(Folder, Pattern, search);

    // Make sure each folder ends with a backslash.
    for (int i = 0; i < folders.Length; i++)
      folders[i] += System.IO.Path.DirectorySeparatorChar;

    Subfolders = folders;
    }
}
# ---------- end c_script_3 ----------
c_script_4 = CSharpScript(Folder=c_script.Files, Pattern="*.png")  # -> out, Files; inputs Folder: String, Pattern: String
# ---------- c_script_4: C# ----------
    // Ensure valid search pattern.
    if (string.IsNullOrEmpty(Pattern))
      Pattern = "*";

    // Perform file search.
    Files = System.IO.Directory.GetFiles(Folder, Pattern);
# ---------- end c_script_4 ----------
panel = Panel(c_script.Files)
panel_2 = Panel(c_script_4.Files)
c_script_5 = CSharpScript(File=c_script.Files)  # -> out, Name, Extension, Folder; inputs File: String
# ---------- c_script_5: C# ----------
// Grasshopper Script Instance
#region Usings
using System.IO;
using System.Linq;
using System.Data;
using System.Drawing;
using System.Reflection;
using System.Windows.Forms;
using System.Xml;
using System.Xml.Linq;
using System.Runtime.InteropServices;

using Rhino.DocObjects;
using Rhino.Collections;
using GH_IO;
using GH_IO.Serialization;
#endregion

public class Script_Instance : GH_ScriptInstance
{
    #region Notes
    /* 
      Members:
        RhinoDoc RhinoDocument
        GH_Document GrasshopperDocument
        IGH_Component Component
        int Iteration

      Methods (Virtual & overridable):
        Print(string text)
        Print(string format, params object[] args)
        Reflect(object obj)
        Reflect(object obj, string method_name)
    */
    #endregion

    private void RunScript(
		string File,
		ref object Name,
		ref object Extension,
		ref object Folder)
    {
        if (string.IsNullOrEmpty(File))
        return;

        Name = System.IO.Path.GetFileNameWithoutExtension(File);
        Extension = System.IO.Path.GetExtension(File);
        Folder = System.IO.Path.GetDirectoryName(File);
    }
}
# ---------- end c_script_5 ----------
c_script_6 = CSharpScript(File=c_script.Files)  # -> out, Name, Extension, Folder; inputs File: String
# ---------- c_script_6: C# ----------
    if (string.IsNullOrEmpty(File))
      return;

    Name = System.IO.Path.GetFileNameWithoutExtension(File);
    Extension = System.IO.Path.GetExtension(File);
    Folder = System.IO.Path.GetDirectoryName(File);
# ---------- end c_script_6 ----------
panel_3 = Panel(c_script_5.Folder)
panel_4 = Panel(c_script_5.Name)
panel_5 = Panel(c_script_5.Extension)
