# Grasshopper definition Gait Curve Example.gh (Grasshopper 1.0.8)

curve = Curve(<curve referenced from the Rhino model>)  # disabled
surface = Surface(<surface referenced from the Rhino model>)
curve_2 = Curve(<curve referenced from the Rhino model>)  # disabled
subd = SubD(<subd referenced from the Rhino model>)
divide_surface = DivideSurface(Surface=curve, UCount=10, VCount=10)  # -> Points, Normals, Parameters; disabled
number_slider = Slider(5.59, range=0..10)  # disabled
xy_plane = XYPlane(Origin=Point(0, 0, 0))
divide_surface_2 = DivideSurface(Surface=surface, UCount=10, VCount=10)  # -> Points, Normals, Parameters
panel = Panel("3")  # disabled
polygon = Polygon(Plane=divide_surface.Points, Radius=number_slider, Segments=panel, FilletRadius=0)  # -> Polygon, Length; disabled
evaluate_surface = EvaluateSurface(Surface=surface, Point=divide_surface_2.Parameters)  # -> Point, Normal, UDirection, VDirection, Frame
orient = Orient(Geometry=subd, Source=xy_plane, Target=evaluate_surface.Frame)  # -> Geometry, Transform
rotate = Rotate(Geometry=polygon.Polygon, Angle=1.570796327, Plane=divide_surface.Points)  # -> Geometry, Transform; disabled
curve_closest_point = CurveClosestPoint(Point=divide_surface.Points, Curve=curve_2)  # -> Point, Parameter, Distance; disabled
curve_3 = Curve(<curve referenced from the Rhino model>)
vector_display = VectorDisplay(Anchor=evaluate_surface.Point, Vector=evaluate_surface.VDirection)
curve_closest_point_2 = CurveClosestPoint(Point=evaluate_surface.Point, Curve=curve_3)  # -> Point, Parameter, Distance
unit_y = UnitY(Factor=1)  # disabled
polygon_2 = Polygon(Plane=evaluate_surface.Frame, Radius=Slider(10, range=0..10), Segments="3", FilletRadius=0)  # -> Polygon, Length
evaluate_curve = EvaluateCurve(Curve=curve_2, Parameter=curve_closest_point.Parameter)  # -> Point, Tangent, Angle; disabled
evaluate_curve_2 = EvaluateCurve(Curve=curve_3, Parameter=curve_closest_point_2.Parameter)  # -> Point, Tangent, Angle
vector_display_2 = VectorDisplay(Anchor=evaluate_surface.Point, Vector=evaluate_curve_2.Tangent)
vector_display_3 = VectorDisplay(Anchor=divide_surface.Points, Vector=evaluate_curve.Tangent)  # disabled
orient_direction = OrientDirection(
    Geometry=rotate.Geometry,
    PointA=divide_surface.Points,
    DirectionA=unit_y,
    PointB=divide_surface.Points,
    DirectionB=evaluate_curve.Tangent)  # -> Geometry, Transform; disabled
deconstruct_vector = DeconstructVector(Vector=evaluate_curve_2.Tangent)  # -> XComponent, YComponent, ZComponent
deconstruct_vector_2 = DeconstructVector(Vector=evaluate_surface.VDirection)  # -> XComponent, YComponent, ZComponent
unit_z = UnitZ(Factor=1)  # disabled
vector_xyz = VectorXYZ(
    XComponent=deconstruct_vector.XComponent,
    YComponent=deconstruct_vector.YComponent,
    ZComponent=deconstruct_vector_2.ZComponent)  # -> Vector, Length
vector_display_4 = VectorDisplay(Anchor=evaluate_surface.Point, Vector=vector_xyz.Vector)
orient_direction_2 = OrientDirection(
    Geometry=orient.Geometry,
    PointA=evaluate_surface.Point,
    DirectionA=evaluate_surface.VDirection,
    PointB=evaluate_surface.Point,
    DirectionB=vector_xyz.Vector)  # -> Geometry, Transform
extrude = Extrude(Base=orient_direction.Geometry, Direction=unit_z)  # disabled
custom_preview = CustomPreview(
    Geometry=orient_direction_2.Geometry,
    Material={diffuse=RGB(221, 160, 221), emission=RGB(66, 48, 66), shine=0.5, specular=RGB(255, 255, 255), transparency=0})
