# Grasshopper definition Minkowsi Sum.gh (Grasshopper 1.0.8)
# plug-ins: Pufferfish, Analyse Direction, Clipper2

number_slider = Slider(3.07, range=0..10)
curve = Curve(<curve referenced from the Rhino model>)
number_slider_2 = Slider(1, range=0..1)
circle = Circle(Plane=PlaneXY(0, 0, 0), Radius=number_slider)
curve_2 = Curve([<curve referenced from the Rhino model> x3])
xy_plane = XYPlane(Origin=Point(0, 0, 0))
c_script = CSharpScript()  # -> out, a
# ---------- c_script: C# ----------
// Grasshopper Script Instance
#region Usings
using System;
using System.Linq;
using System.Collections;
using System.Collections.Generic;
using System.Drawing;

using Rhino;
using Rhino.Geometry;

using Grasshopper;
using Grasshopper.Kernel;
using Grasshopper.Kernel.Data;
using Grasshopper.Kernel.Types;
#endregion

public class Script_Instance : GH_ScriptInstance
{
    #region Notes
    /* 
      Members:
        RhinoDoc RhinoDocument
        GH_Document GrasshopperDocument
        IGH_Component Component
        int Iteration

      Methods (Virtual & overridable):
        Print(string text)
        Print(string format, params object[] args)
        Reflect(object obj)
        Reflect(object obj, string method_name)
    */
    #endregion

    private void RunScript(object x, object y, ref object a)
    {
        string f = "hello";
        System.Console.WriteLine(f);
        Console.WriteLine("hello");

        a = null;
    }
}
# ---------- end c_script ----------
c_script_2 = CSharpScript(seg=Slider(64, range=0..100), radius=Slider(2, range=0..10))  # -> out, a; inputs crv: Curve, seg: Int32, radius: Double
# ---------- c_script_2: C# ----------
// Grasshopper Script Instance
#region Usings
using System;
#r "D:\Architectural Templates\Ptarmigan\02_GH\_lib\Clipper2-main\Clipper2-main\Clipper2Lib.dll"
using System.Linq;
using System.Collections;
using System.Collections.Generic;
using System.Drawing;

using Rhino;
using Rhino.Geometry;

using Clipper2Lib;

using Grasshopper;
using Grasshopper.Kernel;
using Grasshopper.Kernel.Data;
using Grasshopper.Kernel.Types;
#endregion

public class Script_Instance : GH_ScriptInstance
{
    #region Notes
    /* 
      Members:
        RhinoDoc RhinoDocument
        GH_Document GrasshopperDocument
        IGH_Component Component
        int Iteration

      Methods (Virtual & overridable):
        Print(string text)
        Print(string format, params object[] args)
        Reflect(object obj)
        Reflect(object obj, string method_name)
    */
    #endregion

    private void RunScript(Curve crv, int seg, double radius, ref object a)
    {
        PathD pattern = new PathD();

        for (int i=0; i<seg; i++)
        {
            double angle = Math.PI*i/seg;

            double x = radius*Math.Cos(angle);
            double y = radius*Math.Sin(angle);

            pattern.Add(new PointD(x, y));
        }

        // Write your logic here
        a = null;
    }
}
# ---------- end c_script_2 ----------
c_script_3 = CSharpScript(crv=curve, div=Slider(100, range=0..100), offset=number_slider)  # -> out, a, b; inputs crv: Curve, div: Int32, offset: Double; disabled
# ---------- c_script_3: C# ----------
// Grasshopper Script Instance
#region Usings
using System;
using System.Linq;
using System.Collections;
using System.Collections.Generic;
using System.Drawing;

#r "D:\Architectural Templates\Ptarmigan\02_GH\_lib\Clipper2-main\Clipper2-main\Clipper2Lib.dll"

using Clipper2Lib;
using static Clipper2Lib.Clipper;






using Rhino;
using Rhino.Geometry;

using Grasshopper;
using Grasshopper.Kernel;
using Grasshopper.Kernel.Data;
using Grasshopper.Kernel.Types;
#endregion

public class Script_Instance : GH_ScriptInstance
{
    #region Notes
    /* 
      Members:
        RhinoDoc RhinoDocument
        GH_Document GrasshopperDocument
        IGH_Component Component
        int Iteration

      Methods (Virtual & overridable):
        Print(string text)
        Print(string format, params object[] args)
        Reflect(object obj)
        Reflect(object obj, string method_name)
    */
    #endregion

    private void RunScript(
		Curve crv,
		int div,
		double offset,
		ref object a,
		ref object b)
    {
        List<Point3d> sample = new List<Point3d>();
        Point3d[] divpts;

        crv.DivideByCount(div,true, out divpts);

        sample.AddRange(divpts);

        //Convert from Rhino.Crv to Path64
        Path64 path = new Path64();
        double scale = 100000;
        foreach (Point3d pt in sample)
        {
            long x = (long)(pt.X * scale);
            long y = (long)(pt.Y * scale);
            path.Add(new Point64(x, y));
        }

        //create circle with polys

        int seg=64;
        List<Point3d> circle = new List<Point3d>();

        for (int i=0; i<seg; i++)
        {
            double angle=2*Math.PI*i/seg;

            circle.Add(new Point3d(offset*Math.Cos(angle),offset*Math.Sin(angle),0));
            
        }
        b=circle;

        //convert to Path64
        Path64 clipper_circle = new Path64();
        foreach (Point3d pt in circle)
        {
            double x = pt.X;
            double y = pt.Y;
            double z = pt.Z;

            clipper_circle.Add(new Point64((long)x*scale,(long)y*scale));
        }

        Paths64 result = Clipper.MinkowskiSum(clipper_circle,path,true);


        List<List<Point3d>> allMinkowskiPts = new List<List<Point3d>>();

        foreach (Path64 mcrv in result)
        {
            List<Point3d> mpts = new List<Point3d>();

            foreach (Point64 pt in mcrv)
            {
                double x = (double) pt.X / scale;
                double y = (double) pt.Y / scale;
                mpts.Add(new Point3d(x, y, 0));
            }

            allMinkowskiPts.Add(mpts);
        }

        // ✅ Flatten outside the loop
        List<Point3d> flatPts = new List<Point3d>();
        foreach (List<Point3d> group in allMinkowskiPts)
        {
            flatPts.AddRange(group);
        }

        // ✅ Output to Grasshopper
        a = flatPts;

        Print("Minkowski result count: " + result.Count);
        Print("Scaled offset: " + (offset * scale));




            

            
    }

        


        //b=circle;

    
}
# ---------- end c_script_3 ----------
clipper2_union = Clipper2Union(Polylines=curve_2, UnionRule=0, Precision=4)
curve_to_polyline = CurveToPolyline(Curve=circle, ToleranceDistance=0, ToleranceAngle=0, MaxEdge=Slider(0.06, range=0..1))  # -> Polyline, Segments
polyline = PolyLine(Vertices=c_script_3.a, Closed=False)
explode = Explode(Curve=clipper2_union, Recursive=True)  # -> Segments, Vertices
number_slider_3 = Slider(10, range=0..10)
curve_3 = Curve([<curve referenced from the Rhino model> x3])
curve_4 = Curve(<curve referenced from the Rhino model>)
explode_2 = Explode(Curve=curve_3, Recursive=True)  # -> Segments, Vertices
number_slider_4 = Slider(1, range=0..1)
clipper2_minkowski_sum = Clipper2MinkowskiSum(Pattern=curve_to_polyline.Polyline, Path=curve, Plane=xy_plane, IsClosed=True, Precision=4)
panel = Panel(c_script_3.a)
explode_3 = Explode(Curve=curve_4, Recursive=True)  # -> Segments, Vertices
removeduplicatepts = RemoveDuplicatePts(Points=explode.Vertices, Tolerance=0.01)
number_slider_5 = Slider(4.72, range=0..10)
curve_to_polyline_2 = CurveToPolyline(Curve=curve_4, ToleranceDistance=0, ToleranceAngle=0)  # -> Polyline, Segments
range = Range(Domain=number_slider_3, Steps=Slider(10, range=0..100))
removeduplicatepts_2 = RemoveDuplicatePts(Points=explode_2.Vertices, Tolerance=0.01)
removeduplicatepts_3 = RemoveDuplicatePts(Points=explode_3.Vertices, Tolerance=0.01)
fillet = Fillet(Curve=clipper2_minkowski_sum, Radius=number_slider)

# ---- group: Sample Script Minkowski Sum
c_script_4 = CSharpScript()  # -> out, a
# ---------- c_script_4: C# ----------
// Grasshopper Script Instance
#region Usings
using System;
#r "D:\Architectural Templates\Ptarmigan\02_GH\_lib\Clipper2-main\Clipper2-main\Clipper2Lib.dll"
using System.Linq;
using System.Collections;
using System.Collections.Generic;
using System.Drawing;

using Rhino;
using Rhino.Geometry;

using Clipper2Lib;

using Grasshopper;
using Grasshopper.Kernel;
using Grasshopper.Kernel.Data;
using Grasshopper.Kernel.Types;
#endregion

public class Script_Instance : GH_ScriptInstance
{
    #region Notes
    /* 
      Members:
        RhinoDoc RhinoDocument
        GH_Document GrasshopperDocument
        IGH_Component Component
        int Iteration

      Methods (Virtual & overridable):
        Print(string text)
        Print(string format, params object[] args)
        Reflect(object obj)
        Reflect(object obj, string method_name)
    */
    #endregion

    private void RunScript(ref object a)
    {


        double scale = 1000.0;

        // 1. Build input shapes
        Path64 pattern = Clipper.Ellipse(new Point64(100, 100), 30, 30);
        Path64 path = Clipper.MakePath(new int[] { 0, 0, 200, 0, 200, 200, 0, 200, 0, 0 });

        // 2. Perform Minkowski sum
        Paths64 solution = Clipper.MinkowskiSum(pattern, path, true);

        // 3. Convert result to Rhino polylines
        List<PolylineCurve> curves = new List<PolylineCurve>();

        foreach (Path64 poly in solution)
        {
            Polyline rhinoPoly = new Polyline();

            foreach (Point64 pt in poly)
            {
                // De-scale for Rhino display
                double x = (double)pt.X / scale;
                double y = (double)pt.Y / scale;
                rhinoPoly.Add(new Point3d(x, y, 0));
            }

            // Close the polyline if necessary
            if (!rhinoPoly.IsClosed)
                rhinoPoly.Add(rhinoPoly[0]);

            curves.Add(new PolylineCurve(rhinoPoly));
        }

        // 4. Output to Grasshopper
        a = curves;

    }
}
# ---------- end c_script_4 ----------

# ----
c_script_5 = CSharpScript(pts=removeduplicatepts_2, radius=number_slider_3)  # -> out, a; inputs pts: list of Point3d, radius: Double
# ---------- c_script_5: C# ----------
// Grasshopper Script Instance
#region Usings
using System;
#r "D:\Architectural Templates\Ptarmigan\02_GH\_lib\Clipper2-main\Clipper2-main\Clipper2Lib.dll"
using System.Linq;
using System.Collections;
using System.Collections.Generic;
using System.Drawing;

using Rhino;
using Rhino.Geometry;

using Clipper2Lib;

using Grasshopper;
using Grasshopper.Kernel;
using Grasshopper.Kernel.Data;
using Grasshopper.Kernel.Types;
#endregion

public class Script_Instance : GH_ScriptInstance
{
    #region Notes
    /* 
      Members:
        RhinoDoc RhinoDocument
        GH_Document GrasshopperDocument
        IGH_Component Component
        int Iteration

      Methods (Virtual & overridable):
        Print(string text)
        Print(string format, params object[] args)
        Reflect(object obj)
        Reflect(object obj, string method_name)
    */
    #endregion

    private void RunScript(List<Point3d> pts, double radius, ref object a)
    {
        //Path points
        //Convert Point3d to PathD
        double scale = 1000;

        Path64 path = new Path64();

        foreach (Point3d pt in pts)
        {
            long x = (long)(pt.X*scale);
            long y = (long)(pt.Y*scale);
            path.Add(new Point64(x,y));
        }

        Path64 circle = new Path64();

        double seg = 64;
        for (int i=0; i<seg; i++)
        {
            double angle = 2*Math.PI*i/seg;
            double x = radius*Math.Cos(angle);
            double y = radius*Math.Sin(angle);

            long ix = (long)(x * scale);
            long iy = (long)(y * scale);

            circle.Add(new Point64(ix,iy));
        }

        Paths64 MinkSum = Clipper.MinkowskiSum(circle,path,true);

        List<Point3d> MinksPts = new List<Point3d>();
        
        foreach (Path64 offset in MinkSum)
        {
            foreach(Point64 pt in offset)
            {
                double x = pt.X/scale;
                double y = pt.Y/scale;
                double z = 0;

                MinksPts.Add(new Point3d(x,y,z));
            }

            a=MinksPts;

        }

        //Console.WriteLine(path);
        //Console.WriteLine(circle);
        //Console.WriteLine(MinksPts);
        Console.WriteLine(MinkSum);
        // Write your logic here
        //a = null;
    }
}
# ---------- end c_script_5 ----------
c_script_6 = CSharpScript(pts=removeduplicatepts, radius=range)  # -> out, a, b; inputs pts: list of Point3d, radius: Double
# ---------- c_script_6: C# ----------
// Grasshopper Script Instance
#region Usings
using System;
#r "D:\Architectural Templates\Ptarmigan\02_GH\_lib\Clipper2-main\Clipper2-main\Clipper2Lib.dll"
using System.Linq;
using System.Collections;
using System.Collections.Generic;
using System.Drawing;

using Rhino;
using Rhino.Geometry;

using Clipper2Lib;

using Grasshopper;
using Grasshopper.Kernel;
using Grasshopper.Kernel.Data;
using Grasshopper.Kernel.Types;
#endregion

public class Script_Instance : GH_ScriptInstance
{
    #region Notes
    /* 
      Members:
        RhinoDoc RhinoDocument
        GH_Document GrasshopperDocument
        IGH_Component Component
        int Iteration

      Methods (Virtual & overridable):
        Print(string text)
        Print(string format, params object[] args)
        Reflect(object obj)
        Reflect(object obj, string method_name)
    */
    #endregion

    private void RunScript(
		List<Point3d> pts,
		double radius,
		ref object a,
		ref object b)
    {
        //Path points
        //Convert Point3d to PathD
        double scale = 1000;

        Path64 path = new Path64();

        foreach (Point3d pt in pts)
        {
            long x = (long)(pt.X*scale);
            long y = (long)(pt.Y*scale);
            path.Add(new Point64(x,y));
        }

        Path64 circle = new Path64();

        double seg = 64;
        for (int i=0; i<seg; i++)
        {
            double angle = 2*Math.PI*i/seg;
            double x = radius*Math.Cos(angle);
            double y = radius*Math.Sin(angle);

            long ix = (long)(x * scale);
            long iy = (long)(y * scale);

            circle.Add(new Point64(ix,iy));
        }

        Paths64 MinkSum = Clipper.MinkowskiSum(circle,path,true);

        List<PolylineCurve> resultcrv = new List<PolylineCurve>();

        foreach (Path64 offset in MinkSum)
        {
            Polyline poly = new Polyline();
            foreach (Point64 pt in offset)
            {
                double x = pt.X/scale;
                double y = pt.Y/scale;
                double z = 0;
                poly.Add(new Point3d(x,y,z));

            }




            resultcrv.Add(new PolylineCurve(poly));

            
        }


        
        a=resultcrv;

        // Write your logic here
        //a = null;
    }
}
# ---------- end c_script_6 ----------
area = Area(Geometry=c_script_4.a)  # -> Area, Centroid
c_script_7 = CSharpScript(poly=curve_to_polyline_2.Polyline, offset=number_slider_5)  # -> out, A; inputs poly: Polyline, offset: Double
# ---------- c_script_7: C# ----------
// Grasshopper Script Instance
#region Usings
using System;
#r "D:\Architectural Templates\Ptarmigan\02_GH\_lib\Clipper2-main\Clipper2-main\CSharp\Clipper2Lib\bin\Debug\netstandard2.0\Clipper2Lib.dll"
using System.Linq;
using System.Collections;
using System.Collections.Generic;
using System.Drawing;

using Rhino;
using Rhino.Geometry;

using Clipper2Lib;

using Grasshopper;
using Grasshopper.Kernel;
using Grasshopper.Kernel.Data;
using Grasshopper.Kernel.Types;
#endregion

public class Script_Instance : GH_ScriptInstance
{
    #region Notes
    /* 
      Members:
        RhinoDoc RhinoDocument
        GH_Document GrasshopperDocument
        IGH_Component Component
        int Iteration

      Methods (Virtual & overridable):
        Print(string text)
        Print(string format, params object[] args)
        Reflect(object obj)
        Reflect(object obj, string method_name)
    */
    #endregion

    private void RunScript(Polyline poly, double offset, ref object A)
    {
        const double scale = 1e6;
        A = null;

        if (poly == null || poly.Count < 2) return;

        // 1. Convert to Clipper Path64
        Path64 path = new Path64();
        foreach (Point3d pt in poly)
            path.Add(new Point64((long)(pt.X * scale), (long)(pt.Y * scale)));

        // 2. Use your custom one-sided offset class
        ClipperOneSideOffset co = new ClipperOneSideOffset();
        co.AddPath(path, JoinType.Round, EndType.Round);  // <-- Changed from EndType.Round to EndType.Butt

        Paths64 solution = new Paths64();
        co.Execute(offset * scale, solution);

        // 3. Convert back to Rhino PolylineCurves
        List<PolylineCurve> curves = new List<PolylineCurve>();
        foreach (Path64 sol in solution)
        {
            Polyline pl = new Polyline();
            foreach (Point64 pt in sol)
                pl.Add(new Point3d(pt.X / scale, pt.Y / scale, 0));
            
            // Optional: If last point equals first point and you want open, remove last point
            if (pl.Count > 1 && pl[0] == pl[pl.Count - 1]) 
                pl.RemoveAt(pl.Count - 1);

            curves.Add(new PolylineCurve(pl));
        }

        A = curves;
    }
}
# ---------- end c_script_7 ----------
c_script_8 = CSharpScript(inputPolylines=curve_to_polyline_2.Polyline, radius=number_slider_5)  # -> out, A; inputs inputPolylines: list of Polyline, radius: Double; disabled
# ---------- c_script_8: C# ----------
// Grasshopper Script Instance
#region Usings
using System;
#r "D:\Architectural Templates\Ptarmigan\02_GH\_lib\Clipper2-main\Clipper2-main\Clipper2Lib.dll"
using System.Linq;
using System.Collections;
using System.Collections.Generic;
using System.Drawing;

using Rhino;
using Rhino.Geometry;

using Clipper2Lib;

using Grasshopper;
using Grasshopper.Kernel;
using Grasshopper.Kernel.Data;
using Grasshopper.Kernel.Types;
#endregion

public class Script_Instance : GH_ScriptInstance
{
    #region Notes
    /* 
      Members:
        RhinoDoc RhinoDocument
        GH_Document GrasshopperDocument
        IGH_Component Component
        int Iteration

      Methods (Virtual & overridable):
        Print(string text)
        Print(string format, params object[] args)
        Reflect(object obj)
        Reflect(object obj, string method_name)
    */
    #endregion

    private void RunScript(
		List<Polyline> inputPolylines,
		double radius,
		ref object A)
    {
        // Debug 0: Check input
        if (inputPolylines == null || inputPolylines.Count == 0)
        {
            Print("Input polylines are null or empty");
            A = null;
            return;
        }

        List<Curve> regions = new List<Curve>();
        int validPolylineCount = 0;

        // Debug 1: Process polylines
        foreach (Polyline pl in inputPolylines)
        {
            if (pl == null || pl.Count < 2)
            {
                Print($"Skipping invalid polyline (Null:{pl == null}, Count:{pl?.Count ?? 0})");
                continue;
            }
            validPolylineCount++;

            // 1a. Create vertex circles
            foreach (Point3d pt in pl)
            {
                regions.Add(new Circle(pt, radius).ToNurbsCurve());
            }

            // 1b. Create segment rectangles
            for (int i = 0; i < pl.Count - 1; i++)
            {
                Vector3d dir = pl[i + 1] - pl[i];
                if (dir.Length < 0.001)
                {
                    Print($"Skipping zero-length segment at index {i}");
                    continue;
                }

                Plane plane = new Plane(pl[i], dir);
                Rectangle3d rect = new Rectangle3d(
                    plane,
                    new Interval(-radius, radius),
                    new Interval(0, dir.Length)
                );
                regions.Add(rect.ToNurbsCurve());
            }
        }

        Print($"Processed {validPolylineCount} valid polylines, created {regions.Count} regions");

        // Debug 2: Convert to Clipper paths
        Paths64 combinedPaths = new Paths64();
        int convertedCurves = 0;
        foreach (Curve crv in regions)
        {
            if (crv.TryGetPolyline(out Polyline pl))
            {
                Path64 path = new Path64();
                foreach (Point3d pt in pl)
                {
                    path.Add(new Point64(
                        (long)(pt.X * 1000),
                        (long)(pt.Y * 1000)
                    ));
                }
                combinedPaths.Add(path);
                convertedCurves++;
            }
        }
        Print($"Converted {convertedCurves} curves to Clipper paths");

        // Debug 3: Boolean union
        if (combinedPaths.Count == 0)
        {
            Print("No valid paths for union operation");
            A = null;
            return;
        }

        Paths64 solution = Clipper.Union(combinedPaths, FillRule.Positive);
        Print($"Union operation produced {solution.Count} result paths");

        // Debug 4: Convert back to Rhino
        List<Curve> resultCurves = new List<Curve>();
        foreach (Path64 path in solution)
        {
            if (path.Count == 0) continue;

            Polyline resultPl = new Polyline();
            foreach (Point64 pt in path)
            {
                resultPl.Add(new Point3d(
                    pt.X / 1000.0,
                    pt.Y / 1000.0,
                    0
                ));
            }
            if (path.Count > 0) resultPl.Add(resultPl[0]);
            resultCurves.Add(resultPl.ToNurbsCurve());
        }

        // Debug 5: Final output
        if (resultCurves.Count == 0)
        {
            Print("No valid output curves generated");
            A = null;
            return;
        }

        Curve[] unionResults = Curve.JoinCurves(resultCurves);
        Print($"Final output contains {unionResults.Length} joined curves");

        A = unionResults.Length > 0 ? unionResults[0] : null;
    }
}
# ---------- end c_script_8 ----------
c_script_9 = CSharpScript(pts=removeduplicatepts_3, radius=range, type=Toggle(True))  # -> out, a, b, c; inputs pts: list of Point3d, radius: Double, type: Boolean
# ---------- c_script_9: C# ----------
// Grasshopper Script Instance
#region Usings
using System;
#r "D:\Architectural Templates\Ptarmigan\02_GH\_lib\Clipper2-main\Clipper2-main\CSharp\Clipper2Lib\bin\Debug\netstandard2.0\Clipper2Lib.dll"
using System.Linq;
using System.Collections;
using System.Collections.Generic;
using System.Drawing;

using Rhino;
using Rhino.Geometry;

using Clipper2Lib;

using Grasshopper;
using Grasshopper.Kernel;
using Grasshopper.Kernel.Data;
using Grasshopper.Kernel.Types;
#endregion

public class Script_Instance : GH_ScriptInstance
{
    #region Notes
    /* 
      Members:
        RhinoDoc RhinoDocument
        GH_Document GrasshopperDocument
        IGH_Component Component
        int Iteration

      Methods (Virtual & overridable):
        Print(string text)
        Print(string format, params object[] args)
        Reflect(object obj)
        Reflect(object obj, string method_name)
    */
    #endregion

    private void RunScript(
		List<Point3d> pts,
		double radius,
		bool type,
		ref object a,
		ref object b,
		ref object c)
    {
        //Path points
        //Convert Point3d to PathD
        double scale = 1000;

        Path64 path = new Path64();

        foreach (Point3d pt in pts)
        {
            long x = (long)(pt.X*scale);
            long y = (long)(pt.Y*scale);
            path.Add(new Point64(x,y));
        }

        Path64 circle = new Path64();

        double seg = 64;
        for (int i=0; i<seg; i++)
        {
            double angle = 2*Math.PI*i/seg;
            double x = radius*Math.Cos(angle);
            double y = radius*Math.Sin(angle);

            long ix = (long)(x * scale);
            long iy = (long)(y * scale);

            circle.Add(new Point64(ix,iy));
        }

        Paths64 MinkSum = Clipper.MinkowskiSum(circle,path,type);

        List<PolylineCurve> resultcrv = new List<PolylineCurve>();

        foreach (Path64 offset in MinkSum)
        {
            Polyline poly = new Polyline();
            foreach (Point64 pt in offset)
            {
                double x = pt.X/scale;
                double y = pt.Y/scale;
                double z = 0;
                poly.Add(new Point3d(x,y,z));

            }


            //Close polyline
            Polyline openpoly = poly;
            if (!openpoly.IsClosed)
            {
                openpoly.Add(openpoly[0]);
            }


            resultcrv.Add(new PolylineCurve(poly));
        }

        if (resultcrv.Count > 0) a = resultcrv[0];
        if (resultcrv.Count > 1) b = resultcrv[1];


        
        //put all segments in a polyline list
        List<PolylineCurve> plineseg = new List<PolylineCurve>(resultcrv);
        List<Polyline> allseg = new List<Polyline>();

        foreach (PolylineCurve ply in plineseg)
        {
            Polyline polyline = ply.ToPolyline();
            allseg.Add(polyline);
        }
        //convert polyline pts into Point3d
        List<Point3d> allpts = new List<Point3d>();
        foreach (Polyline ply in allseg)
        {
            allpts.AddRange(ply);
        }

        

        c=allpts;
        // Write your logic here
        //a = null;

    }
}
# ---------- end c_script_9 ----------
c_script_10 = CSharpScript()  # -> out, a
# ---------- c_script_10: C# ----------
// Grasshopper Script Instance
#region Usings
using System;
#r "D:\Architectural Templates\Ptarmigan\02_GH\_lib\Clipper2-main\Clipper2-main\CSharp\Clipper2Lib\bin\Debug\netstandard2.0\Clipper2Lib.dll"
using System.Linq;
using System.Collections;
using System.Collections.Generic;
using System.Drawing;

using Rhino;
using Rhino.Geometry;

using Clipper2Lib;

using Grasshopper;
using Grasshopper.Kernel;
using Grasshopper.Kernel.Data;
using Grasshopper.Kernel.Types;
#endregion

public class Script_Instance : GH_ScriptInstance
{
    #region Notes
    /* 
      Members:
        RhinoDoc RhinoDocument
        GH_Document GrasshopperDocument
        IGH_Component Component
        int Iteration

      Methods (Virtual & overridable):
        Print(string text)
        Print(string format, params object[] args)
        Reflect(object obj)
        Reflect(object obj, string method_name)
    */
    #endregion

    private void RunScript(ref object a)
    {
        // Write your logic here
        Print(typeof(Clipper2Lib.ClipperOffset).Assembly.Location);

    }
}
# ---------- end c_script_10 ----------

# ---- group: Converting Points3d to PathD
c_script_11 = CSharpScript(pts=removeduplicatepts_2)  # -> out, a; inputs pts: list of Point3d
# ---------- c_script_11: C# ----------
// Grasshopper Script Instance
#region Usings
using System;
#r "D:\Architectural Templates\Ptarmigan\02_GH\_lib\Clipper2-main\Clipper2-main\Clipper2Lib.dll"
using System.Linq;
using System.Collections;
using System.Collections.Generic;
using System.Drawing;

using Rhino;
using Rhino.Geometry;

using Clipper2Lib;

using Grasshopper;
using Grasshopper.Kernel;
using Grasshopper.Kernel.Data;
using Grasshopper.Kernel.Types;
#endregion

public class Script_Instance : GH_ScriptInstance
{
    #region Notes
    /* 
      Members:
        RhinoDoc RhinoDocument
        GH_Document GrasshopperDocument
        IGH_Component Component
        int Iteration

      Methods (Virtual & overridable):
        Print(string text)
        Print(string format, params object[] args)
        Reflect(object obj)
        Reflect(object obj, string method_name)
    */
    #endregion

    private void RunScript(List<Point3d> pts, ref object a)
    {
        //convert Point3d to PathD
        PathD path = new PathD();
        foreach (Point3d pt in pts)
        {
            path.Add(new PointD(pt.X, pt.Y));
        }

        Console.WriteLine(path);

        //convert PathD to Point3d
        List<Point3d> rhinoPoints = new List<Point3d>();

        foreach (PointD pt in path)
        {
            rhinoPoints.Add(new Point3d(pt.x, pt.y, 0));
        }
        Console.WriteLine(rhinoPoints);

        a=rhinoPoints;
    }
}
# ---------- end c_script_11 ----------

# ----
panel_2 = Panel(c_script_6.a)
c_script_12 = CSharpScript(poly=curve_to_polyline_2.Polyline, offset=number_slider_5)  # -> out, A; inputs poly: Polyline, offset: Double
# ---------- c_script_12: C# ----------
// Grasshopper Script Instance
#region Usings
using System;
#r "D:\Architectural Templates\Ptarmigan\02_GH\_lib\Clipper2-main\Clipper2-main\Clipper2Lib.dll"
using System.Linq;
using System.Collections;
using System.Collections.Generic;
using System.Drawing;

using Rhino;
using Rhino.Geometry;

using Clipper2Lib;

using Grasshopper;
using Grasshopper.Kernel;
using Grasshopper.Kernel.Data;
using Grasshopper.Kernel.Types;
#endregion

public class Script_Instance : GH_ScriptInstance
{
    #region Notes
    /* 
      Members:
        RhinoDoc RhinoDocument
        GH_Document GrasshopperDocument
        IGH_Component Component
        int Iteration

      Methods (Virtual & overridable):
        Print(string text)
        Print(string format, params object[] args)
        Reflect(object obj)
        Reflect(object obj, string method_name)
    */
    #endregion

    private void RunScript(Polyline poly, double offset, ref object A)
    {
        const double scale = 1e6;
        A = null;

        if (poly == null || poly.Count < 2) return;

        // Convert Rhino Polyline to Clipper2 Path64
        Path64 path = new Path64();
        foreach (Point3d pt in poly)
            path.Add(new Point64((long)(pt.X * scale), (long)(pt.Y * scale)));

        // Create the offset engine and add path
        ClipperOffset co = new ClipperOffset();
        co.AddPath(path, JoinType.Round, EndType.Round); // open curve with round ends

        // Perform the offset
        Paths64 solution = new Paths64();
        co.Execute(offset * scale, solution);

        // Convert result to Rhino curves
        List<PolylineCurve> curves = new List<PolylineCurve>();
        foreach (Path64 p in solution)
        {
            Polyline pl = new Polyline();
            foreach (Point64 pt in p)
                pl.Add(new Point3d(pt.X / scale, pt.Y / scale, 0));
            curves.Add(new PolylineCurve(pl));
        }

        A = curves;
    }
}
# ---------- end c_script_12 ----------
scale = Scale(Geometry=c_script_4.a, Center=area.Centroid, Factor=Slider(10, range=0..10))  # -> Geometry, Transform
curve_direction = CurveDirection()
# Paths64 MinkowskiSum(const Path64& pattern, const Path64& path, const isClosed);
# 
# 1. Convert points into Path64 (both pattern and the path)
# 2. Use Clipper.MinkowskiSum
# 3. Convert back into RhinoPoints
number_slider_6 = Slider(1.09, range=0..10)
curve_5 = Curve(<curve referenced from the Rhino model>)
curve_to_polyline_3 = CurveToPolyline(Curve=curve_5, ToleranceDistance=0, ToleranceAngle=0, MaxEdge=number_slider_6)  # -> Polyline, Segments
explode_4 = Explode(Curve=curve_to_polyline_3.Polyline, Recursive=True)  # -> Segments, Vertices
panel_3 = Panel("""0
1""")
evaluate_curve = EvaluateCurve(Curve=reparameterize(graft(explode_4.Segments)), Parameter=panel_3)  # -> Point, Tangent, Angle
unit_z = UnitZ(Factor=1)
cross_product = CrossProduct(VectorA=evaluate_curve.Tangent, VectorB=unit_z, Unitize=False)  # -> Vector, Length
list_length = ListLength(List=evaluate_curve.Point)
point_groups = PointGroups(Points=flatten(evaluate_curve.Point), Distance=Slider(0.01, range=0..0.01))  # -> Groups, Indices
amplitude = Amplitude(Vector=cross_product.Vector, Amplitude=Slider(0.61, range=0..10))
panel_4 = Panel(point_groups.Groups)
tween_two_vectors = TweenTwoVectors(Factor=0.5)
addition = Addition(A=evaluate_curve.Point, B=amplitude)  # -> flatten(Result)
vector_display = VectorDisplay(Anchor=evaluate_curve.Point, Vector=cross_product.Vector)
removeduplicatepts_4 = RemoveDuplicatePts(Points=addition, Tolerance=0.01)
list_item = ListItem(Index=0, Wrap=True)
polyline_2 = PolyLine(Vertices=removeduplicatepts_4, Closed=False)
curve_self = CurveSelf(Curve=polyline_2)  # -> Points, Params
simplify_curve = SimplifyCurve(Curve=polyline_2)  # -> Curve, Simplified
round = Round(Number=curve_self.Params)  # -> Nearest, Floor, Ceiling
create_set = CreateSet(List=round.Ceiling)  # -> graft(Set), Map
create_set_2 = CreateSet(List=round.Floor)  # -> graft(Set), Map
explode_5 = Explode(Curve=polyline_2, Recursive=True)  # -> Segments, Vertices
curve_6 = Curve(<curve referenced from the Rhino model>)
curve_closest_point = CurveClosestPoint(Point=explode_5.Vertices, Curve=polyline_2)  # -> Point, Parameter, Distance
merge = Merge(Data1=create_set_2.Set, Data2=create_set.Set)  # -> flatten(Result)
explode_6 = Explode(Curve=curve_6, Recursive=True)  # -> Segments, Vertices
create_set_3 = CreateSet(List=merge)  # -> Set, Map
equality = Equality(FirstNumber=graft(curve_closest_point.Parameter), SecondNumber=create_set_3.Set)  # -> Equality, Inequality
shatter = Shatter(Curve=polyline_2, Parameters=curve_self.Params)
curve_self_2 = CurveSelf(Curve=curve_6)  # -> Points, Params
c_script_13 = CSharpScript(P=explode_6.Vertices)  # -> out, SelfIntersecting, X; inputs P: list of Point3d
# ---------- c_script_13: C# ----------
using System;
using System.Collections.Generic;
using Rhino;
using Rhino.Geometry;

public class Script_Instance : GH_ScriptInstance
{
  #region Members
  // These are predefined by Grasshopper
  private void Print(string text) => Rhino.RhinoApp.WriteLine(text);
  private void Reflect(object obj) { }
  #endregion

  // === CLASS DEFINITIONS (put above RunScript) ===

  class Segment
  {
    public Point3d Start;
    public Point3d End;
    public int Index;

    public Segment(Point3d start, Point3d end, int index)
    {
      Start = start;
      End = end;
      Index = index;
    }

    public Line ToLine() => new Line(Start, End);
    public double MinX => Math.Min(Start.X, End.X);
  }

  class Event : IComparable<Event>
  {
    public double X;
    public Segment Segment;
    public bool IsStart;

    public Event(double x, Segment segment, bool isStart)
    {
      X = x;
      Segment = segment;
      IsStart = isStart;
    }

    public int CompareTo(Event other)
    {
      int cmp = X.CompareTo(other.X);
      if (cmp != 0) return cmp;
      if (IsStart != other.IsStart)
        return IsStart ? -1 : 1;
      return 0;
    }
  }

  bool Intersect(Segment a, Segment b, out Point3d pt)
  {
    pt = Point3d.Unset;
    Line la = a.ToLine();
    Line lb = b.ToLine();

    double a1, a2;
    if (Rhino.Geometry.Intersect.Intersection.LineLine(la, lb, out a1, out a2, RhinoDoc.ActiveDoc.ModelAbsoluteTolerance, false))
    {
      if (a1 >= 0 && a1 <= 1 && a2 >= 0 && a2 <= 1)
      {
        pt = la.PointAt(a1);
        return true;
      }
    }
    return false;
  }

  // === MAIN FUNCTION ===
  private void RunScript(
		List<Point3d> P,
		ref object SelfIntersecting,
		ref object X)
  {
    List<Segment> segments = new List<Segment>();
    for (int i = 0; i < P.Count - 1; i++)
    {
      segments.Add(new Segment(P[i], P[i + 1], i));
    }

    // If closed polyline, add final segment
    if (!P[P.Count - 1].Equals(P[0]))
    {
      segments.Add(new Segment(P[P.Count - 1], P[0], P.Count - 1));
    }

    SortedSet<Event> eventQueue = new SortedSet<Event>();
    foreach (var seg in segments)
    {
      eventQueue.Add(new Event(seg.MinX, seg, true));
      eventQueue.Add(new Event(Math.Max(seg.Start.X, seg.End.X), seg, false));
    }

    List<Segment> sweepLine = new List<Segment>();
    List<Point3d> intersections = new List<Point3d>();
    bool selfIntersecting = false;

    while (eventQueue.Count > 0)
    {
      Event e = eventQueue.Min;
      eventQueue.Remove(e);

      if (e.IsStart)
      {
        // Insert segment
        sweepLine.Add(e.Segment);

        foreach (var other in sweepLine)
        {
          if (other == e.Segment) continue;

          // Skip adjacent segments
          if (Math.Abs(other.Index - e.Segment.Index) <= 1 ||
              (e.Segment.Index == 0 && other.Index == segments.Count - 1) ||
              (other.Index == 0 && e.Segment.Index == segments.Count - 1))
            continue;

          Point3d pt;
          if (Intersect(e.Segment, other, out pt))
          {
            intersections.Add(pt);
            selfIntersecting = true;
          }
        }
      }
      else
      {
        sweepLine.Remove(e.Segment);
      }
    }

    SelfIntersecting = selfIntersecting;
    X = intersections;
  }
}
# ---------- end c_script_13 ----------
list_item_2 = ListItem(List=explode_5.Vertices, Index=create_set_3.Set, Wrap=True)
create_set_4 = CreateSet(List=equality.Equality)  # -> Set, Map
list_length_2 = ListLength(List=create_set_4.Set)
equality_2 = Equality(FirstNumber=list_length_2, SecondNumber="2")  # -> flatten(Equality), Inequality
circle_2 = Circle(Plane=c_script_13.X, Radius=1)
length = Length(Curve=shatter)
clean_tree = CleanTree(RemoveNulls=True, RemoveInvalid=True, RemoveEmpty=False, Tree=c_script_13.out)
closed = Closed(Curve=shatter)  # -> Closed, Periodic
panel_5 = Panel(c_script_13.SelfIntersecting)
sort_list = SortList(Keys=length, ValuesValuesA=shatter, ValuesA=shatter)  # -> Keys, ValuesValuesA, ValuesA
cull_pattern = CullPattern(List=explode_5.Vertices, CullPattern=invert(equality_2.Equality))
panel_6 = Panel("1")
cull_pattern_2 = CullPattern(List=shatter, CullPattern=invert(closed.Closed))
smaller_than = SmallerThan(FirstNumber=sort_list.Keys, SecondNumber=Slider(4.62, range=0..10))  # -> SmallerThan, OrEqualTo
cull_pattern_3 = CullPattern(List=shatter, CullPattern=closed.Closed)
polyline_3 = PolyLine(Vertices=cull_pattern, Closed=False)
join_curves = JoinCurves(Curves=cull_pattern_2, Preserve=False)
cull_pattern_4 = CullPattern(List=sort_list.ValuesA, CullPattern=invert(smaller_than.SmallerThan))
join_curves_2 = JoinCurves(Curves=cull_pattern_4, Preserve=False)
panel_7 = Panel(equality_2.Equality)
panel_8 = Panel(join_curves_2)
