# Grasshopper definition OpenNest Settings.gh (Grasshopper 1.0.7)
# plug-ins: OpenNest

curve = Curve(<curve referenced from the Rhino model>)
opennest = OpenNest(
    Sheets=curve,
    Spacing=Slider(0.03, range=0..1),
    Placement="0",
    Tolerance="0.1",
    Rotations="4",
    Iterations="0",
    Seed=1,
    Reset=Button(),
    Run=Toggle(False))  # -> Sheets, Geo, ID, Transform, IDS
