# Grasshopper definition Ref Text Dot with Guid.gh (Grasshopper 0.9.75)
# plug-ins: Python Interpreter

id = Guid([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])
python = PythonScript(textDots=id)  # -> out, values, pts; inputs textDots: list
# ---------- python: Python ----------
import Rhino

values = []
pts = []
for tdId in textDots:
    tdObj = Rhino.RhinoDoc.ActiveDoc.Objects.Find(tdId).Geometry
    values.append(tdObj.Text)
    pts.append(tdObj.Point)
# ---------- end python ----------
panel = Panel(python.values)
panel_2 = Panel(python.pts)
