# Grasshopper definition Rotational Vector Alignment.gh (Grasshopper 1.0.8)

md_slider = MDSlider(SliderMode=0, slider_value=Point(0.5, 0.5, 0.5), x_domain=Domain(0, 1), y_domain=Domain(0, 1), z_domain=Domain(0, 1))
surface = Surface(<surface referenced from the Rhino model>)
curve = Curve(<curve referenced from the Rhino model>)
point = Point(<point referenced from the Rhino model>)
evaluate_surface = EvaluateSurface(Surface=reparameterize(surface), Point=md_slider)  # -> Point, Normal, UDirection, VDirection, Frame
populate_2d = Populate2D(Region=curve, Count=Slider(83, range=0..100), Seed=1)
deconstruct_vector = DeconstructVector(Vector=evaluate_surface.Normal)  # -> XComponent, YComponent, ZComponent
panel = Panel(evaluate_surface.Normal)
unit_z = UnitZ(Factor=1)
subtraction = Subtraction(A=populate_2d, B=point)
vector_2pt = Vector2Pt(PointA=point, PointB=populate_2d, Unitize=False)  # -> Vector, Length
vector_display = VectorDisplay(Anchor=evaluate_surface.Point, Vector=evaluate_surface.Normal)
smaller_than = SmallerThan(FirstNumber=deconstruct_vector.ZComponent, SecondNumber="0")  # -> SmallerThan, OrEqualTo
cross_product = CrossProduct(VectorA=vector_2pt.Vector, VectorB=unit_z, Unitize=False)  # -> Vector, Length
cross_product_2 = CrossProduct(VectorA=cross_product.Vector, VectorB=vector_2pt.Vector, Unitize=False)  # -> Vector, Length
sift_pattern = SiftPattern(List=surface, SiftPattern=smaller_than.SmallerThan)  # -> Output0, Output1
unit_z_2 = UnitZ(Factor=1)
cross_product_3 = CrossProduct(VectorA=cross_product_2.Vector, VectorB=subtraction, Unitize=False)  # -> Vector, Length
flip = Flip(Surface=sift_pattern.Output1)  # -> Surface, Result
vector_display_2 = VectorDisplay(Anchor=populate_2d, Vector=cross_product_2.Vector)
combine_data = CombineData(Input0=sift_pattern.Output0, Input1=flip.Surface)  # -> Result, Index
reverse = Reverse(Vector=cross_product_3.Vector)
vector_display_3 = VectorDisplay(Anchor=populate_2d, Vector=reverse)
construct_plane = ConstructPlane(Origin=populate_2d, XAxis=reverse, YAxis=cross_product_2.Vector)
xy_plane = XYPlane(Origin=evaluate_surface.Point)
panel_2 = Panel(combine_data.Result)
orient = Orient(Geometry=combine_data.Result, Source=xy_plane, Target=construct_plane)  # -> Geometry, Transform
