# Grasshopper definition Threaded BooleanDiff.gh (Grasshopper 1.0.7)

# ---- group: Differencers
brep = Brep(simplify(Tree({0}: [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], {1}: [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], {2}: [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], {3}: [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], {4}: [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], {5}: [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]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)))

# ---- group: Panels
# NOTE:: Make sure the S input data tree matches the D input data tree exactly, or the component might fail (due to not enough error catching).
brep_2 = Brep(simplify(Tree({0}: [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], {1}: [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], {2}: [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], {3}: [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], {4}: [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], {5}: [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]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)))

# ----
c_recursive_boolean = CSharpScript(S=brep_2, D=brep)  # -> out, R, BB; inputs S: tree of Brep, D: tree of Brep
# ---------- c_recursive_boolean: C# usings ----------
using System.IO;
using System.Linq;
using System.Data;
using System.Drawing;
using System.Reflection;
using System.Windows.Forms;
using System.Xml;
using System.Xml.Linq;
using System.Runtime.InteropServices;


using System.Threading.Tasks;
using System.Collections.Concurrent;
using Rhino.DocObjects;
using Rhino.Collections;
using GH_IO;
using GH_IO.Serialization;
# ---------- c_recursive_boolean: C# ----------
    /////////////////////////////
    //written by Brian Washburn//
    //washburnarchitecture.com //
    //2018.06.06               //
    /////////////////////////////
    // Code cleanup, RIL 2020-10-17 (removed loooooong namespaces)
    
    var tolerance = doc.ModelAbsoluteTolerance;

    // Declare dictionaries that work in parallel to hold the successful boolean results and
    // the unsuccessful boolean cutters

    var mainBrepsMT = new ConcurrentDictionary<GH_Path, Brep>();
    var badBrepsMT = new ConcurrentDictionary<GH_Path,List<Brep>>();

    // Need to reserve a processor for GUI, otherwise we get a "Server Busy..." warning.
    // The booleaning still works, you would just have to click through the warning

    var totalMaxConcurrancy = System.Environment.ProcessorCount - 1;

    // Display us how many threads we're using

    this.Component.Message = totalMaxConcurrancy + " threads";


    // Start of the parallel engine

    Parallel.ForEach(S.Paths, new ParallelOptions {MaxDegreeOfParallelism = totalMaxConcurrancy}, pth =>
      {

      var badBrep = new List<Brep>();
      var goodBrep = new List<Brep>();
      var mainBrep = S.Branch(pth)[0];
      var diffBreps = D.Branch(pth);

      // Difference one cutter brep at a time from the main brep in the branch
      // this allows the boolean operation to continue without failing
      // and bad cutter breps can be discarded to a list that can be used for troubleshooting
      // haven't noticed a hit big hit on performance

      foreach (Brep b in diffBreps)
      {
        var breps = new Brep[]{};
        breps = Brep.CreateBooleanDifference(mainBrep, b, tolerance);
        if ((breps == null) || (breps.Length < 1))
        {
          badBrep.Add(b);
        }
        else
        {
          mainBrep = breps[0];
        }
      }
      mainBrepsMT[pth] = mainBrep;
      badBrepsMT[pth] = badBrep;
      });
    // End of the parallel engine

    // Convert dictionaries to regular old data trees

    var mainBreps = new DataTree<Brep>();
    var badBreps = new DataTree<Brep>();

    foreach(KeyValuePair<GH_Path,Brep> p in mainBrepsMT)
    {
      mainBreps.Add(p.Value, p.Key);
    }

    foreach(KeyValuePair<GH_Path, List<Brep>> b in badBrepsMT)
    {
      badBreps.AddRange(b.Value, b.Key);
    }

    // OUTPUT

    R = mainBreps;
    BB = badBreps;
# ---------- end c_recursive_boolean ----------
sdiff = SolidDifference(BrepsA=brep_2, BrepsB=brep)  # disabled
python__sdiff = PythonScript(x=brep_2, y=brep)  # -> out, a; inputs x: tree of Brep, y: tree of Brep; disabled
# ---------- python__sdiff: Python ----------
import rhinoscriptsyntax as rs
import ghpythonlib.components as ghcomp
import scriptcontext as sc
import Rhino
import ghpythonlib.parallel

#for accesing gh classes
import clr
clr.AddReference("Grasshopper")
from Grasshopper.Kernel.Data import GH_Path
from Grasshopper import DataTree

mytree = DataTree[Rhino.Geometry.Brep]()

for i in range(0,x.BranchCount,1):
    sub1 = x.Branches[i]
    ins1 = y.Branch(i)
    diff = []
    diff = Rhino.Geometry.Brep.CreateBooleanDifference(sub1,ins1,0.01)
    if diff: mytree.AddRange(diff)
a = mytree
# ---------- end python__sdiff ----------
python__sdiff_dk = PythonScript(x=brep_2, y=brep)  # -> out, a; inputs x: tree of Brep, y: tree of Brep; disabled
# ---------- python__sdiff_dk: Python ----------
import rhinoscriptsyntax as rs
import ghpythonlib.components as ghcomp
import scriptcontext as sc
import Rhino
import ghpythonlib.parallel

#for accesing gh classes
import clr
clr.AddReference("Grasshopper")
from Grasshopper.Kernel.Data import GH_Path
from Grasshopper import DataTree

mytree = DataTree[Rhino.Geometry.Brep]()


for i in range(0,x.BranchCount,1):
    myPath = GH_Path(i)
    sub1 = x.Branches[i]
    ins1 = y.Branch(i)
    diff = []
    diff = Rhino.Geometry.Brep.CreateBooleanDifference(sub1,ins1,0.01)
    if diff: mytree.AddRange(diff,myPath)
a = mytree
# ---------- end python__sdiff_dk ----------
geo = Geometry(c_recursive_boolean.R)
geo_2 = Geometry(python__sdiff.a)
geo_3 = Geometry(python__sdiff_dk.a)
geo_4 = Geometry(sdiff)
panel = Panel(sdiff)
panel_2 = Panel(python__sdiff.a)
panel_3 = Panel(c_recursive_boolean.R)
panel_4 = Panel(python__sdiff_dk.a)
