# Grasshopper definition Triple Product Example.gh (Grasshopper 1.0.8)

curve = Curve(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)
vector_length = Slider(4.47, range=0..10)
unit_z = UnitZ(Factor=1)
divide_curve = DivideCurve(Curve=curve, Count=10, Kinks=False)  # -> Points, Tangents, Parameters
cross_product = CrossProduct(VectorA=divide_curve.Tangents, VectorB=unit_z, Unitize=invert(False))  # -> Vector, Length
cross_product_2 = CrossProduct(VectorA=cross_product.Vector, VectorB=divide_curve.Tangents, Unitize=invert(False))  # -> Vector, Length
multiplication = Multiplication(A=cross_product.Vector, B=vector_length)
multiplication_2 = Multiplication(A=divide_curve.Tangents, B=vector_length)
multiplication_3 = Multiplication(A=cross_product_2.Vector, B=vector_length)
vector_display_ex = VectorDisplayEx(Point=divide_curve.Points, Vector=multiplication_3, Colour=RGB(12, 62, 242), Width=2)
vector_display_ex_2 = VectorDisplayEx(Point=divide_curve.Points, Vector=multiplication, Colour=RGB(255, 0, 0), Width=2)
vector_display_ex_3 = VectorDisplayEx(Point=divide_curve.Points, Vector=multiplication_2, Colour=RGB(13, 255, 0), Width=2)
