# Grasshopper definition USD Exporter.gh (Grasshopper 1.0.8)
# plug-ins: Pancake

center_box = CenterBox(Base=PlaneXY(0, 0, 0), X=1, Y=1, Z=1)
true_only_button = TrueOnlyButton(LastSaveLocalization="neutral,N")
mesh = Mesh(center_box)
c_script = CSharpScript()  # -> out, a
# ---------- c_script: C# ----------
// Grasshopper Script Instance
#region Usings
using System;
using System.Linq;
using System.Collections;
using System.Collections.Generic;
using System.Drawing;

using Rhino;
using Rhino.Geometry;

using Grasshopper;
using Grasshopper.Kernel;
using Grasshopper.Kernel.Data;
using Grasshopper.Kernel.Types;
#endregion

public class Script_Instance : GH_ScriptInstance
{
    #region Notes
    /* 
      Members:
        RhinoDoc RhinoDocument
        GH_Document GrasshopperDocument
        IGH_Component Component
        int Iteration

      Methods (Virtual & overridable):
        Print(string text)
        Print(string format, params object[] args)
        Reflect(object obj)
        Reflect(object obj, string method_name)
    */
    #endregion

    private void RunScript(ref object a)
    {
        // Write your logic here
        a = null;
    }
}
# ---------- end c_script ----------
c_script_2 = CSharpScript(geo=mesh, filepath="C:\Users\Clark\Desktop\", filename="test", export=Toggle(False))  # -> out, A; inputs geo: GeometryBase, filepath: String, filename: String, export: Int32
# ---------- c_script_2: C# ----------
// Grasshopper Script Instance
#region Usings
using System;
using Rhino;
using Rhino.Geometry;
using Rhino.DocObjects;
using Rhino.Commands;
using System.Collections.Generic;
#endregion

public class Script_Instance : GH_ScriptInstance
{
    #region Notes
    /* 
      Members:
        RhinoDoc RhinoDocument
        GH_Document GrasshopperDocument
        IGH_Component Component
        int Iteration

      Methods (Virtual & overridable):
        Print(string text)
        Print(string format, params object[] args)
        Reflect(object obj)
        Reflect(object obj, string method_name)
    */
    #endregion

    private void RunScript(
		GeometryBase geo,
		string filepath,
		string filename,
		int export,
		ref object A)
    {
        // Step 1: Bake to Rhino document
        Guid id = Guid.Empty;

        if (geo != null)
        {
            ObjectAttributes attr = new ObjectAttributes();
            id = Rhino.RhinoDoc.ActiveDoc.Objects.Add(geo, attr);
            Rhino.RhinoDoc.ActiveDoc.Views.Redraw();
        }

        if (id == Guid.Empty)
        {
            A = "Failed to bake geometry.";
            return;
        }

        // Step 2: Select the object
        Rhino.RhinoDoc.ActiveDoc.Objects.Select(id, true);

        string fullfilepath = filepath + filename+".usd";
        // Step 3: Export to USD via Rhino command
        if (export == 1 )
        {
            string exportCommand = $"_-Export \"{fullfilepath}\" _Enter";
            bool result = RhinoApp.RunScript(exportCommand, false);
            // Step 4: Cleanup
            Rhino.RhinoDoc.ActiveDoc.Objects.Delete(id, true);

            A = result ? $"Exported to {fullfilepath}" : "Export failed.";

        }
        else
        {
            A="stop";
            // Step 4: Cleanup
            Rhino.RhinoDoc.ActiveDoc.Objects.Delete(id, true);
            return;
        }
        


    }
}
# ---------- end c_script_2 ----------
panel = Panel(c_script_2.A)
