# Grasshopper definition Array Objects.gh (Grasshopper 1.0.7)
# plug-ins: Heteroptera, Pancake, Pufferfish

panel = Panel("""N:\US1475_GOCH_playscape forms_DA\05_Design Documentation\03_Working Documents\0A_Design\Pattern Prep_CC\02_RHINO\J\03_Final Models and Drawing Sets\US1475_JA-1;JA-2_UP2_FORPRINT.stl
N:\US1475_GOCH_playscape forms_DA\05_Design Documentation\03_Working Documents\0A_Design\Pattern Prep_CC\02_RHINO\J\03_Final Models and Drawing Sets\US1475_JA-3;JA-4_UP2_FORPRINT.stl
N:\US1475_GOCH_playscape forms_DA\05_Design Documentation\03_Working Documents\0A_Design\Pattern Prep_CC\02_RHINO\J\03_Final Models and Drawing Sets\US1475_JA-7;JA-8_UP2_FORPRINT.stl
N:\US1475_GOCH_playscape forms_DA\05_Design Documentation\03_Working Documents\0A_Design\Pattern Prep_CC\02_RHINO\J\03_Final Models and Drawing Sets\US1475_JA-9;JA-10_UP2_FORPRINT.stl
N:\US1475_GOCH_playscape forms_DA\05_Design Documentation\03_Working Documents\0A_Design\Pattern Prep_CC\02_RHINO\J\03_Final Models and Drawing Sets\US1475_JA-11;JA-12_UP2_FORPRINT.stl
N:\US1475_GOCH_playscape forms_DA\05_Design Documentation\03_Working Documents\0A_Design\Pattern Prep_CC\02_RHINO\J\03_Final Models and Drawing Sets\US1475_JA-15;JA-16_UP2_FORPRINT.stl
N:\US1475_GOCH_playscape forms_DA\05_Design Documentation\03_Working Documents\0A_Design\Pattern Prep_CC\02_RHINO\J\03_Final Models and Drawing Sets\US1475_JA-17;JA-18_UP2_FORPRINT.stl
N:\US1475_GOCH_playscape forms_DA\05_Design Documentation\03_Working Documents\0A_Design\Pattern Prep_CC\02_RHINO\J\03_Final Models and Drawing Sets\US1475_JA-19;JA-20_UP2_FORPRINT.stl
N:\US1475_GOCH_playscape forms_DA\05_Design Documentation\03_Working Documents\0A_Design\Pattern Prep_CC\02_RHINO\J\03_Final Models and Drawing Sets\US1475_JB-3;JB-4_UP2_FORPRINT.stl
N:\US1475_GOCH_playscape forms_DA\05_Design Documentation\03_Working Documents\0A_Design\Pattern Prep_CC\02_RHINO\J\03_Final Models and Drawing Sets\US1475_JB-5;JB-6_UP2_FORPRINT.stl
N:\US1475_GOCH_playscape forms_DA\05_Design Documentation\03_Working Documents\0A_Design\Pattern Prep_CC\02_RHINO\J\03_Final Models and Drawing Sets\US1475_JB-7;JB-8_UP2_FORPRINT.stl
N:\US1475_GOCH_playscape forms_DA\05_Design Documentation\03_Working Documents\0A_Design\Pattern Prep_CC\02_RHINO\J\03_Final Models and Drawing Sets\US1475_JB-9;JB-10_UP2_FORPRINT.stl
N:\US1475_GOCH_playscape forms_DA\05_Design Documentation\03_Working Documents\0A_Design\Pattern Prep_CC\02_RHINO\J\03_Final Models and Drawing Sets\US1475_JB-11;JB-12_UP2_FORPRINT.stl
N:\US1475_GOCH_playscape forms_DA\05_Design Documentation\03_Working Documents\0A_Design\Pattern Prep_CC\02_RHINO\J\03_Final Models and Drawing Sets\US1475_JB-13;JB-14_UP2_FORPRINT.stl
N:\US1475_GOCH_playscape forms_DA\05_Design Documentation\03_Working Documents\0A_Design\Pattern Prep_CC\02_RHINO\J\03_Final Models and Drawing Sets\US1475_JB-15;JB-16_UP2_FORPRINT.stl
N:\US1475_GOCH_playscape forms_DA\05_Design Documentation\03_Working Documents\0A_Design\Pattern Prep_CC\02_RHINO\J\03_Final Models and Drawing Sets\US1475_JB-19;JB-20_UP2_FORPRINT.stl
N:\US1475_GOCH_playscape forms_DA\05_Design Documentation\03_Working Documents\0A_Design\Pattern Prep_CC\02_RHINO\J\03_Final Models and Drawing Sets\US1475_JB-23;JB-24_UP2_FORPRINT.stl
N:\US1475_GOCH_playscape forms_DA\05_Design Documentation\03_Working Documents\0A_Design\Pattern Prep_CC\02_RHINO\J\03_Final Models and Drawing Sets\US1475_JB-1;JB-2_UP2_FORPRINT.stl
N:\US1475_GOCH_playscape forms_DA\05_Design Documentation\03_Working Documents\0A_Design\Pattern Prep_CC\02_RHINO\J\03_Final Models and Drawing Sets\US1475_JA-5;JA-6_JB-21;JB-22_UP2_FORPRINT.stl
N:\US1475_GOCH_playscape forms_DA\05_Design Documentation\03_Working Documents\0A_Design\Pattern Prep_CC\02_RHINO\J\03_Final Models and Drawing Sets\US1475_JA-13;JA-14_JB-17;JB-18_UP2_FORPRINT.stl""")
geometry = Geometry([<mesh referenced from the Rhino model> x20])
import_from = ImportFrom(File=panel, LastSaveLocalization="neutral,N")  # -> flatten(Geo), Layer, ObjectAttributes
list_length = ListLength(List=import_from.Geo)
panel_2 = Panel("""US1475_JA-1;JA-2_UP2_FORPRINT
US1475_JA-3;JA-4_UP2_FORPRINT
US1475_JA-7;JA-8_UP2_FORPRINT
US1475_JA-9;JA-10_UP2_FORPRINT
US1475_JA-11;JA-12_UP2_FORPRINT
US1475_JA-15;JA-16_UP2_FORPRINT
US1475_JA-17;JA-18_UP2_FORPRINT
US1475_JA-19;JA-20_UP2_FORPRINT
US1475_JB-3;JB-4_UP2_FORPRINT
US1475_JB-5;JB-6_UP2_FORPRINT
US1475_JB-7;JB-8_UP2_FORPRINT
US1475_JB-9;JB-10_UP2_FORPRINT
US1475_JB-11;JB-12_UP2_FORPRINT
US1475_JB-13;JB-14_UP2_FORPRINT
US1475_JB-15;JB-16_UP2_FORPRINT
US1475_JB-19;JB-20_UP2_FORPRINT
US1475_JB-23;JB-24_UP2_FORPRINT
US1475_JB-1;JB-2_UP2_FORPRINT
US1475_JA-5;JA-6_JB-21;JB-22_UP2_FORPRINT
US1475_JA-13;JA-14_JB-17;JB-18_UP2_FORPRINT""")
series = Series(Start=0, Step=Slider(63, range=0..100), Count=list_length)
number_slider = Slider(20, range=0..100)
center = Center(Geometry=import_from.Geo)  # -> Center, Dimension
construct_point = ConstructPoint(XCoordinate=series, YCoordinate=0, ZCoordinate=0)
close_mesh = CloseMesh(Mesh=import_from.Geo, Quadrangulate=True)  # -> Closed, Amount, Openings, flatten(ResultBoolean)
panel_3 = Panel(import_from.Geo)
unit_y = UnitY(Factor=number_slider)
subtraction = Subtraction(A=construct_point, B=center.Center)
subtraction_2 = Subtraction(A=number_slider, B="10")
gate_not = GateNot(A=close_mesh.Amount)
unit_y_2 = UnitY(Factor=subtraction_2)
move = Move(Geometry=import_from.Geo, Motion=subtraction)  # -> Geometry, Transform
addition = Addition(A=construct_point, B=unit_y)
vector_display = VectorDisplay(Anchor=center.Center, Vector=subtraction)
panel_4 = Panel(gate_not)
concatenate = Concatenate(FragmentA=panel_2, FragmentB=".stl")
addition_2 = Addition(A=construct_point, B=unit_y_2)
custom_preview = CustomPreview(
    Geometry=move.Geometry,
    Material={diffuse=RGB(221, 160, 221), emission=RGB(66, 48, 66), shine=0.5, specular=RGB(255, 255, 255), transparency=0})
text_tag_3d = TextTag3D(Location=addition, Text=panel_2, Size=1, Justification=5)
panel_5 = Panel(concatenate)
volume = Volume(Geometry=import_from.Geo)  # -> Volume, Centroid
panel_6 = Panel(volume.Volume)
text_tag_3d_2 = TextTag3D(Location=addition_2, Text=volume.Volume, Size=1, Justification=5)
