# Grasshopper definition Min BB_UAP.gh (Grasshopper 1.0.7)

distance = Slider(32, range=0..100)
colour_picker = ColourPicker(PickedColour=RGB(91, 109, 189))
colour_picker_2 = ColourPicker(PickedColour=RGB(84, 255, 5))
# Reference Geometry from Rhino Here
brep = Brep([<brep referenced from the Rhino model> x2])
min_bb = MinBB(G=brep, step=distance, diffuse_2=colour_picker, diffuse=colour_picker_2)  # -> moved, wireframe, bounding_box_solid, material_2, material
# Right  Click Here -> Bake
custom_preview = CustomPreview(Geometry=min_bb.moved, Material=min_bb.material_2)
custom_preview_2 = CustomPreview(Geometry=min_bb.wireframe, Material=min_bb.material)

# ==== cluster MinBB
G = ClusterInput()
minbb_c = CSharpScript(G=G, D="90")  # -> out, MinBB; inputs G: GeometryBase, D: Int32
# ---------- minbb_c: C# ----------
    /*
    Min Bounding Box Calculation
    Original Author Ilja Asanovic

    Parallel C# version,
    RIL
    */

    RhinoApp.ClearCommandHistoryWindow();

    var bb_partresults = new List<Box>();

    var geo = (GeometryBase) G;
    var init_plane = new Plane(Plane.WorldXY);
    var bb = Box.Unset;
    var rot_inc = D;

    // ===================
    // Rotate about X Axis
    // ===================
    var new_vol_x = new double[rot_inc]; // ROT X /0 to 180 degrees
    System.Threading.Tasks.Parallel.For(0, rot_inc, i =>
      {
      var new_plane = init_plane;
      new_plane.Rotate(i, init_plane.XAxis);
      var new_bb = geo.GetBoundingBox(new_plane);
      new_vol_x[i] = new_bb.Volume;
      });
    var rotation = MinVolumeIndex(new_vol_x);
    var plane_x = init_plane;
    plane_x.Rotate(rotation, init_plane.XAxis);

    // ===================
    // Rotate about Y Axis
    // ===================
    var new_vol_y = new double[rot_inc]; // #ROT Y  /0 to 180 degrees
    System.Threading.Tasks.Parallel.For(0, rot_inc, i =>
      {
      var new_plane = plane_x;
      new_plane.Rotate(i, plane_x.YAxis);
      var new_bb = geo.GetBoundingBox(new_plane);
      new_vol_y[i] = new_bb.Volume;
      });
    rotation = MinVolumeIndex(new_vol_y);
    var plane_y = plane_x;
    plane_y.Rotate(rotation, plane_x.YAxis);

    // ===================
    // Rotate about Z Axis
    // ===================
    var new_vol_z = new double[rot_inc]; // #ROT Y  /0 to 180 degrees
    System.Threading.Tasks.Parallel.For(0, rot_inc, i =>
      {
      var new_plane = plane_y;
      new_plane.Rotate(i, plane_y.ZAxis);
      var new_bb = geo.GetBoundingBox(new_plane);
      new_vol_z[i] = new_bb.Volume;
      });
    rotation = MinVolumeIndex(new_vol_z);
    var plane_z = plane_y;
    plane_z.Rotate(rotation, plane_y.ZAxis);

    // ===================================
    // Another round of rotations starting
    // from the axes of the last plane_z
    // ===================================
    var ref_axis1 = plane_z.XAxis;
    var ref_axis2 = plane_z.YAxis;
    var ref_axis3 = plane_z.ZAxis;

    // =======================
    // Rotate about Axis 1 (X)
    // =======================
    var new_vol_ref_axis1 = new double[rot_inc];
    System.Threading.Tasks.Parallel.For(0, rot_inc, i =>
      {
      var new_plane = plane_z;
      new_plane.Rotate(i, ref_axis1);
      var new_bb = geo.GetBoundingBox(new_plane);
      new_vol_ref_axis1[i] = new_bb.Volume;
      });
    rotation = MinVolumeIndex(new_vol_ref_axis1);
    var plane_ref_axis1 = plane_z;
    plane_ref_axis1.Rotate(rotation, ref_axis1);

    // =======================
    // Rotate about Axis 2 (Y)
    // =======================
    var new_vol_ref_axis2 = new double[rot_inc];
    System.Threading.Tasks.Parallel.For(0, rot_inc, i =>
      {
      var new_plane = plane_ref_axis1;
      new_plane.Rotate(i, ref_axis2);
      var new_bb = geo.GetBoundingBox(new_plane);
      new_vol_ref_axis2[i] = new_bb.Volume;
      });
    rotation = MinVolumeIndex(new_vol_ref_axis2);
    var plane_ref_axis2 = plane_ref_axis1;
    plane_ref_axis2.Rotate(rotation, ref_axis2);

    // =======================
    // Rotate about Axis 3 (Z)
    // =======================
    var new_vol_ref_axis3 = new double[rot_inc];
    System.Threading.Tasks.Parallel.For(0, rot_inc, i =>
      {
      var new_plane = plane_ref_axis2;
      new_plane.Rotate(i, ref_axis3);
      var new_bb = geo.GetBoundingBox(new_plane);
      new_vol_ref_axis3[i] = new_bb.Volume;
      });
    rotation = MinVolumeIndex(new_vol_ref_axis3);
    var plane_ref_axis3 = plane_ref_axis2;
    plane_ref_axis3.Rotate(rotation, ref_axis3);

    // =======================
    // Output
    // =======================
    geo.GetBoundingBox(plane_ref_axis3, out bb);
    MinBB = bb;
# ---------- minbb_c: C# additional code ----------
  private int MinVolumeIndex(double[] new_vol_x)
  {
    // Returns the index of the minimum volume in the array
    var min_index = -1;
    var min_value = Double.MaxValue;
    for (var i = 0; i < new_vol_x.Length; i++)
    {
      if (new_vol_x[i] < min_value)
      {
        min_index = i;
        min_value = new_vol_x[i];
      }
    }
    return min_index;
  }
# ---------- end minbb_c ----------
box = Box(minbb_c.MinBB)
list_length = ListLength(List=box)
step = ClusterInput()
series = Series(Start=0, Step=step, Count=list_length)
area = Area(Geometry=box)  # -> Area, Centroid
construct_point = ConstructPoint(XCoordinate=series, YCoordinate=0, ZCoordinate=0)
diffuse = ClusterInput()
diffuse_2 = ClusterInput()
create_material = CreateMaterial(Diffuse=diffuse, Specular=RGB(255, 255, 255), Emission=RGB(0, 0, 0), Transparency=0, Shine=0)
create_material_2 = CreateMaterial(Diffuse=diffuse_2, Specular=RGB(255, 255, 255), Emission=RGB(0, 0, 0), Transparency=0, Shine=0)
material = ClusterOutput(create_material)
material_2 = ClusterOutput(create_material_2)
move_to_point = MoveToPoint(Geometry=G, PointA=area.Centroid, PointB=construct_point)  # -> Moved, Vector, Transform
move_to_point_2 = MoveToPoint(Geometry=box, PointA=area.Centroid, PointB=construct_point)  # -> Moved, Vector, Transform
moved = ClusterOutput(move_to_point.Moved)
brep_wireframe = BrepWireframe(Brep=move_to_point_2.Moved, Density=-1)
wireframe = ClusterOutput(brep_wireframe)
bounding_box_solid = ClusterOutput(move_to_point_2.Moved)  # Solid Bounding Box
